# Grasshopper definition FacadeEmbed_JinQiao_Podium.gh (Grasshopper 1.0.7)
# Copyright: Arup
# plug-ins: EleFront, TT Toolbox, Pufferfish, Hare, treesloth01

# ----
# 线段延长长度
number_slider = Slider(1001, range=0..10000)  # disabled

# ----
# remove duplicate curves
geo = Geometry()  # disabled
number_slider_2 = Slider(0.1, range=0..0.1)  # disabled
boundary = BoundarySurfaces(Edges=geo)  # disabled
area = Area(Geometry=boundary)  # -> Area, Centroid; disabled
cullduppoints = RemoveDuplicatePoints(InputPoints=area.Centroid, Tolerance=number_slider_2)  # -> OutputPoints, FirstPointIndexes; disabled
null = NullItem(Item=cullduppoints.FirstPointIndexes)  # -> NullFlags, InvalidFlags, Description; disabled
dispatch = Dispatch(List=boundary, DispatchPattern=null.NullFlags)  # -> ListA, ListB; disabled
geo_2 = Geometry(dispatch.ListA)  # disabled

# ----
# 调换阴阳角设定
toggle = BooleanToggle(False)  # disabled

# ----
# 钢埋板长度（按需设定）
number_slider_3 = Slider(350, range=0..1000)

# ----
# 钢埋板厚度（按需设定）
number_slider_4 = Slider(16, range=0..100)

# ----
# 肋板倒角距离（按需设定）
number_slider_5 = Slider(30, range=0..100)

# ----
# （3.1）导入轴线
crv = Curve(<curve referenced from the Rhino model>)
layer = ObjectLayer(Guid=crv)  # -> LayerIndex, LayerPathName
panel = Panel(layer.LayerPathName)
reflay = ReferenceByLayer(LayerName=panel)
xy = XYPlane(Origin=Point(0, 0, 0))
project = Project(Geometry=reflay, Plane=xy)  # -> Geometry, Transform

# ----
# 导入下层建筑线
# 格式：Line-0-建筑
panel_2 = Panel("Line-0-建筑-Whole")
reflay_2 = ReferenceByLayer(LayerName=panel_2)

# ----
# 钢结构截面列表
txt = Text(["GL2A-1\tHN 250x125x6x9\t\tQ235B\t热轧", "GL3-1\tHN 300x150x6.5x9\t\tQ235B\t热轧", "GL3-2\tH 300x100x8x10\t\tQ235B\t焊接H型", "GL3-3\tH 300x200x8x16\t\tQ355B\t焊接H型", "GL3-4\tHW 300x300x10x15\t\tQ355B\t热轧", "GL4-1\tHN 400x200x8x13\t\tQ355B\t热轧", "GL4-2\tH 400x200x10x16\t\tQ355B\t焊接H型", "GL4-3\tH 400x250x10x20\t\tQ355B\t焊接H型", "GL4-4\tH 400x350x16x35\t\tQ355B\t焊接H型", "GL4a-1\tH 450x200x9x14\t\tQ355B\t热轧", "GL5-1\tHN 500x200x10x16\t\tQ355B\t热轧", "GL5-2\tH 500x200x10x20\t\tQ355B\t焊接H型", "GL5-3\tH 500x300x14x20\t\tQ355B\t焊接H型", "GL5a-1\tH 550x250x10x25\t\tQ355B\t焊接H型", "GL5a-2\tH 550x300x14x25\t\tQ355B\t焊接H型", "GL6-1\tHN 600x200x11x17\t\tQ355B\t热轧", "GL6-2\tH 600x300x12x20\t\tQ355B\t焊接H型", "GL6-3\tH 600x350x12x25\t\tQ355B\t焊接H型", "GL6-4\tH 600x350x16x35\t\tQ355B\t焊接H型", "GL7-1\tHN 700x300x13x24\t\tQ355B\t热轧", "GL7-2\tH 700x350x14x30\t\tQ355B\t焊接H型", "GL7-3\tH 700x350x14x35\t\tQ355B\t焊接H型", "GL8-1\tHN 800x300x14x26\t\tQ355B\t热轧", "GL8-2\tH 800x300x20x40\t\tQ345GJB\t焊接H型", "GL9-1\tH 900x300x20x30\t\tQ355B\t焊接H型", "GL9-2\tH 900x400x20x40\t\tQ345GJB\t焊接H型", "GL10-1\tH 1000x400x20x30\t\tQ355B\t焊接H型", "GL10-2\tH 1000x500x20x30\t\tQ355B\t焊接H型", "GL10-3\tH 1000x500x20x35\t\tQ355B\t焊接H型", "GL10-4\tH 1000x400x20x40\t\tQ345GJB\t焊接H型", "GL10-5\tH 1000x500x20x40\t\tQ345GJB\t焊接H型", "GL10-6\t□ 1000x400x20x40\t\tQ345GJB\t焊接箱型", "GL12-1\tH 1200x400x25x50\t\tQ345GJB\t焊接H型"])

# ----
# 导入上层建筑线+檐口线
# 格式：Line-1-
panel_3 = Panel("Line-1-檐口")
reflay_3 = ReferenceByLayer(LayerName="Line-1-建筑-Whole")
reflay_4 = ReferenceByLayer(LayerName=panel_3)

# ----
# 导入檐口出特殊区域参考线
# 格式：Line-1-
panel_4 = Panel("Line-1-檐口-吊顶处理区域")
reflay_5 = ReferenceByLayer(LayerName="Line-1-檐口-车道等灰空间区域")
reflay_6 = ReferenceByLayer(LayerName=panel_4)

# ----
# 需要出图的钢结构编号
panel_5 = Panel("GL3-3H")

# ----
# Step1.输入block names
# Step2:点击Update按钮
data = Data(["PX-GLAZ-F2$0$PX-GLAZ-F2$0$fin", "PX-GLAZ-F2$0$PX-GLAZ-F1$0$fin"])
panel_6 = Panel(data)

# ----
# Input Curves
# 
# Step1：选中其中一个curve,得到该图层所有curves
# Step2：点击Update按钮
crv_2 = Curve(<curve referenced from the Rhino model>)

# ----
# 1.导入建筑线-普遍适用
panel_8 = Panel("Arch_curve_Whole")
reflay_7 = ReferenceByLayer(LayerName=panel_8)
reflay_8 = ReferenceByLayer(LayerName="Arch_curve_smooth")
reflay_9 = ReferenceByLayer(LayerName="Arch_curve_withLocation")
reflay_10 = ReferenceByLayer(LayerName="Arch_curve_angular")

# ----
# 2.导入建筑线-此项目特殊处理：
panel_9 = Panel("Arch_curve_other")
reflay_11 = ReferenceByLayer(LayerName=panel_9)

# ----
# （1）导入埋件定位点
# (Block & Curve的形式)
# Input Blocks (Plane的Y轴向外)
# 
# Step1.输入Block所在图层
# Step2:点击Update按钮
data_2 = Data(["PX-GLAZ-F2$0$PX-GLAZ-F1$0$标准块", "PX-GLAZ-F2$0$PX-GLAZ-F2$0$标准块", "PX-GLAZ-F2$0$PX-GLAZ-F3$0$标准块"])

crv_3 = Curve(<curve referenced from the Rhino model>)

# ----
# Input Blocks (Plane的Y轴向内)
# 
# Step1:输入Block所在图层
# Step2:点击Update按钮
data_3 = Data("PX-GLAZ-F2$0$T3T")

# ----
# block names
listblockd = ListBlockDocument()

# ----
# 梁中线+Offset值+埋件单体组合包2（cluster已经explode）
# 钢结构截面列表
txt_2 = Text(["GL2A-1\tHN 250x125x6x9\t\tQ235B\t热轧", "GL3-1\tHN 300x150x6.5x9\t\tQ235B\t热轧", "GL3-2\tH 300x100x8x10\t\tQ235B\t焊接H型", "GL3-3\tH 300x200x8x16\t\tQ355B\t焊接H型", "GL3-4\tHW 300x300x10x15\t\tQ355B\t热轧", "GL4-1\tHN 400x200x8x13\t\tQ355B\t热轧", "GL4-2\tH 400x200x10x16\t\tQ355B\t焊接H型", "GL4-3\tH 400x250x10x20\t\tQ355B\t焊接H型", "GL4-4\tH 400x350x16x35\t\tQ355B\t焊接H型", "GL4a-1\tH 450x200x9x14\t\tQ355B\t热轧", "GL5-1\tHN 500x200x10x16\t\tQ355B\t热轧", "GL5-2\tH 500x200x10x20\t\tQ355B\t焊接H型", "GL5-3\tH 500x300x14x20\t\tQ355B\t焊接H型", "GL5a-1\tH 550x250x10x25\t\tQ355B\t焊接H型", "GL5a-2\tH 550x300x14x25\t\tQ355B\t焊接H型", "GL6-1\tHN 600x200x11x17\t\tQ355B\t热轧", "GL6-2\tH 600x300x12x20\t\tQ355B\t焊接H型", "GL6-3\tH 600x350x12x25\t\tQ355B\t焊接H型", "GL6-4\tH 600x350x16x35\t\tQ355B\t焊接H型", "GL7-1\tHN 700x300x13x24\t\tQ355B\t热轧", "GL7-2\tH 700x350x14x30\t\tQ355B\t焊接H型", "GL7-3\tH 700x350x14x35\t\tQ355B\t焊接H型", "GL8-1\tHN 800x300x14x26\t\tQ355B\t热轧", "GL8-2\tH 800x300x20x40\t\tQ345GJB\t焊接H型", "GL9-1\tH 900x300x20x30\t\tQ355B\t焊接H型", "GL9-2\tH 900x400x20x40\t\tQ345GJB\t焊接H型", "GL10-1\tH 1000x400x20x30\t\tQ355B\t焊接H型", "GL10-2\tH 1000x500x20x30\t\tQ355B\t焊接H型", "GL10-3\tH 1000x500x20x35\t\tQ355B\t焊接H型", "GL10-4\tH 1000x400x20x40\t\tQ345GJB\t焊接H型", "GL10-5\tH 1000x500x20x40\t\tQ345GJB\t焊接H型", "GL10-6\t□ 1000x400x20x40\t\tQ345GJB\t焊接箱型", "GL12-1\tH 1200x400x25x50\t\tQ345GJB\t焊接H型"])

layer_2 = ObjectLayer(Guid=crv_3)  # -> LayerIndex, LayerPathName

# ----
# (7) 撞到梁交点-Offset
number_slider_6 = Slider(450, range=0..1000)

layer_3 = ObjectLayer(Guid=crv_2)  # -> LayerIndex, LayerPathName
panel_10 = Panel(data_2)
panel_12 = Panel(layer_3.LayerPathName)
panel_13 = Panel(data_3)
refblock = ReferenceBlockByName(BlockName=panel_10)
refblock_2 = ReferenceBlockByName(BlockName=panel_13)
reflay_12 = ReferenceByLayer(LayerName=panel_12)
xy_2 = XYPlane(Origin=Point(0, 0, 0))
xy_3 = XYPlane(Origin=Point(0, 0, 0))
xy_4 = XYPlane(Origin=Point(0, 0, 0))
project_2 = Project(Geometry=refblock_2, Plane=xy_4)  # -> Geometry, Transform
project_3 = Project(Geometry=refblock, Plane=xy_3)  # -> Geometry, Transform
project_4 = Project(Geometry=reflay_12, Plane=xy_2)  # -> Geometry, Transform

panel_14 = Panel(layer_2.LayerPathName)

# ----
# （4）导入Default Embed
# 输入Embed的结构编号
panel_15 = Panel(txt)
cluster = Cluster_4(
    T=txt,
    D=panel_5,
    A=number_slider_3,
    A_2=number_slider_4,
    B=number_slider_4,
    B_2=number_slider_5,
    A_3=number_slider_3,
    B_3=number_slider_4,
    B_4=number_slider_4,
    B_5=number_slider_4)  # -> R, G, B_6
merge = Merge(Data1=cluster.B_6, Data2=cluster.G)

# ----
# （0）准备阶段
# 检测各个图层Block的Plane
panel_16 = Panel(listblockd)
refblock_3 = ReferenceBlockByName(BlockName=panel_6)
deblock = DeconstructBlock(Block=refblock_3)  # -> Name, Plane, Geometry

# ---- group: 混凝土
list = ValueList({"C15": 0, "C20": 1, "C25": 2, "C30": 3, "C35": 4, "C40": 5}, selected="C35")

# ---- group: 钢筋牌号
list_2 = ValueList({"HPB300": 0, "HRB400": 1}, selected="HPB300")

# ---- group: 直径
list_3 = ValueList({"10": 0, "12": 1, "16": 2, "18": 3, "20": 4, "25": 5}, selected="12")

# ---- group: 列
list_4 = ValueList({"2X": 0, "3X": 1, "4X": 2}, selected="3X")

# ---- group: 行
list_5 = ValueList({"2Y": 0, "3Y": 1, "4Y": 2}, selected="2Y")

# ---- group: 锚筋间距
s_x = Slider(22, range=14..60, expression="X*5")
s_y = Slider(22, range=14..60, expression="X*5")

# ----
# （3）导入单体建筑的参考线
# 按照图层导入建筑、檐口线、特殊区域线
# 
# Step1:将不同类型的curve按照以下图层分类放入Rhino中
# Step2:依次点击每个Update按钮
xy_5 = XYPlane(Origin=Point(0, 0, 0))
xy_6 = XYPlane(Origin=Point(0, 0, 0))
xy_7 = XYPlane(Origin=Point(0, 0, 0))
xy_8 = XYPlane(Origin=Point(0, 0, 0))
xy_9 = XYPlane(Origin=Point(0, 0, 0))
project_5 = Project(Geometry=reflay_3, Plane=xy_5)  # -> Geometry, Transform
project_6 = Project(Geometry=reflay_4, Plane=xy_6)  # -> Geometry, Transform
project_7 = Project(Geometry=reflay_2, Plane=xy_7)  # -> Geometry, Transform
project_8 = Project(Geometry=reflay_6, Plane=xy_8)  # -> Geometry, Transform
project_9 = Project(Geometry=reflay_5, Plane=xy_9)  # -> Geometry, Transform
crv_4 = Curve(<curve referenced from the Rhino model>)
crv_5 = Curve(project_9.Geometry)
crv_6 = Curve(project_7.Geometry)
crv_7 = Curve(project_5.Geometry)
crv_8 = Curve(project_6.Geometry)
crv_9 = Curve(project_8.Geometry)

reflay_13 = ReferenceByLayer(LayerName=panel_14)

# ----
# （2）导入整个site的建筑线
# 
# Step1:将不同类型的curve按照以下图层分类放入Rhino中（图层命名格式：Arch_curve_）
# Step2:依次点击每个Update按钮
xy_10 = XYPlane(Origin=Point(0, 0, 0))
xy_11 = XYPlane(Origin=Point(0, 0, 0))
xy_12 = XYPlane(Origin=Point(0, 0, 0))
xy_13 = XYPlane(Origin=Point(0, 0, 0))
xy_14 = XYPlane(Origin=Point(0, 0, 0))
project_10 = Project(Geometry=reflay_7, Plane=xy_10)  # -> Geometry, Transform
project_11 = Project(Geometry=reflay_8, Plane=xy_11)  # -> Geometry, Transform
project_12 = Project(Geometry=reflay_9, Plane=xy_12)  # -> Geometry, Transform
project_13 = Project(Geometry=reflay_10, Plane=xy_13)  # -> Geometry, Transform
project_14 = Project(Geometry=reflay_11, Plane=xy_14)  # -> Geometry, Transform
crv_10 = Curve(project_10.Geometry)
crv_11 = Curve(project_11.Geometry)
crv_12 = Curve(project_13.Geometry)
crv_13 = Curve(project_14.Geometry)
crv_14 = Curve(project_12.Geometry)

# ----
# 钢埋板长度（按需设定）
number_slider_7 = Slider(350, range=0..1000)

# ----
# 钢埋板长度（按需设定）
number_slider_8 = Slider(350, range=0..1000)

# ----
# 钢埋板厚度（按需设定）
number_slider_9 = Slider(16, range=0..100)

# ----
# 钢埋板厚度（按需设定）
number_slider_10 = Slider(16, range=0..100)

panel_17 = Panel(txt_2)

# ----
# 钢结构截面列表
txt_3 = Text(["GL2A-1\tHN 250x125x6x9\t\tQ235B\t热轧", "GL3-1\tHN 300x150x6.5x9\t\tQ235B\t热轧", "GL3-2\tH 300x100x8x10\t\tQ235B\t焊接H型", "GL3-3\tH 300x200x8x16\t\tQ355B\t焊接H型", "GL3-4\tHW 300x300x10x15\t\tQ355B\t热轧", "GL4-1\tHN 400x200x8x13\t\tQ355B\t热轧", "GL4-2\tH 400x200x10x16\t\tQ355B\t焊接H型", "GL4-3\tH 400x250x10x20\t\tQ355B\t焊接H型", "GL4-4\tH 400x350x16x35\t\tQ355B\t焊接H型", "GL4a-1\tH 450x200x9x14\t\tQ355B\t热轧", "GL5-1\tHN 500x200x10x16\t\tQ355B\t热轧", "GL5-2\tH 500x200x10x20\t\tQ355B\t焊接H型", "GL5-3\tH 500x300x14x20\t\tQ355B\t焊接H型", "GL5a-1\tH 550x250x10x25\t\tQ355B\t焊接H型", "GL5a-2\tH 550x300x14x25\t\tQ355B\t焊接H型", "GL6-1\tHN 600x200x11x17\t\tQ355B\t热轧", "GL6-2\tH 600x300x12x20\t\tQ355B\t焊接H型", "GL6-3\tH 600x350x12x25\t\tQ355B\t焊接H型", "GL6-4\tH 600x350x16x35\t\tQ355B\t焊接H型", "GL7-1\tHN 700x300x13x24\t\tQ355B\t热轧", "GL7-2\tH 700x350x14x30\t\tQ355B\t焊接H型", "GL7-3\tH 700x350x14x35\t\tQ355B\t焊接H型", "GL8-1\tHN 800x300x14x26\t\tQ355B\t热轧", "GL8-2\tH 800x300x20x40\t\tQ345GJB\t焊接H型", "GL9-1\tH 900x300x20x30\t\tQ355B\t焊接H型", "GL9-2\tH 900x400x20x40\t\tQ345GJB\t焊接H型", "GL10-1\tH 1000x400x20x30\t\tQ355B\t焊接H型", "GL10-2\tH 1000x500x20x30\t\tQ355B\t焊接H型", "GL10-3\tH 1000x500x20x35\t\tQ355B\t焊接H型", "GL10-4\tH 1000x400x20x40\t\tQ345GJB\t焊接H型", "GL10-5\tH 1000x500x20x40\t\tQ345GJB\t焊接H型", "GL10-6\t□ 1000x400x20x40\t\tQ345GJB\t焊接箱型", "GL12-1\tH 1200x400x25x50\t\tQ345GJB\t焊接H型"])

# ----
# 肋板倒角距离（按需设定）
number_slider_11 = Slider(30, range=0..100)

# ----
# 肋板倒角距离（按需设定）
number_slider_12 = Slider(30, range=0..100)

# ----
# 需要出图的钢结构编号
panel_18 = Panel(panel_14)

# ----
# 钢埋板长度（按需设定）
number_slider_13 = Slider(350, range=0..1000)

# ----
# 钢埋板厚度（按需设定）
number_slider_14 = Slider(16, range=0..100)

# ----
# Step3.检测plane是否存在+查看Plane的Y轴方向
pln = Plane(deblock.Plane)

# ----
# 钢结构截面列表
txt_4 = Text(["GL2A-1\tHN 250x125x6x9\t\tQ235B\t热轧", "GL3-1\tHN 300x150x6.5x9\t\tQ235B\t热轧", "GL3-2\tH 300x100x8x10\t\tQ235B\t焊接H型", "GL3-3\tH 300x200x8x16\t\tQ355B\t焊接H型", "GL3-4\tHW 300x300x10x15\t\tQ355B\t热轧", "GL4-1\tHN 400x200x8x13\t\tQ355B\t热轧", "GL4-2\tH 400x200x10x16\t\tQ355B\t焊接H型", "GL4-3\tH 400x250x10x20\t\tQ355B\t焊接H型", "GL4-4\tH 400x350x16x35\t\tQ355B\t焊接H型", "GL4a-1\tH 450x200x9x14\t\tQ355B\t热轧", "GL5-1\tHN 500x200x10x16\t\tQ355B\t热轧", "GL5-2\tH 500x200x10x20\t\tQ355B\t焊接H型", "GL5-3\tH 500x300x14x20\t\tQ355B\t焊接H型", "GL5a-1\tH 550x250x10x25\t\tQ355B\t焊接H型", "GL5a-2\tH 550x300x14x25\t\tQ355B\t焊接H型", "GL6-1\tHN 600x200x11x17\t\tQ355B\t热轧", "GL6-2\tH 600x300x12x20\t\tQ355B\t焊接H型", "GL6-3\tH 600x350x12x25\t\tQ355B\t焊接H型", "GL6-4\tH 600x350x16x35\t\tQ355B\t焊接H型", "GL7-1\tHN 700x300x13x24\t\tQ355B\t热轧", "GL7-2\tH 700x350x14x30\t\tQ355B\t焊接H型", "GL7-3\tH 700x350x14x35\t\tQ355B\t焊接H型", "GL8-1\tHN 800x300x14x26\t\tQ355B\t热轧", "GL8-2\tH 800x300x20x40\t\tQ345GJB\t焊接H型", "GL9-1\tH 900x300x20x30\t\tQ355B\t焊接H型", "GL9-2\tH 900x400x20x40\t\tQ345GJB\t焊接H型", "GL10-1\tH 1000x400x20x30\t\tQ355B\t焊接H型", "GL10-2\tH 1000x500x20x30\t\tQ355B\t焊接H型", "GL10-3\tH 1000x500x20x35\t\tQ355B\t焊接H型", "GL10-4\tH 1000x400x20x40\t\tQ345GJB\t焊接H型", "GL10-5\tH 1000x500x20x40\t\tQ345GJB\t焊接H型", "GL10-6\t□ 1000x400x20x40\t\tQ345GJB\t焊接箱型", "GL12-1\tH 1200x400x25x50\t\tQ345GJB\t焊接H型"])

# ----
# 肋板倒角距离（按需设定）
number_slider_15 = Slider(30, range=0..100)

deblock_2 = DeconstructBlock(Block=refblock_2)  # -> Name, Plane, Geometry
deblock_3 = DeconstructBlock(Block=refblock)  # -> Name, Plane, Geometry

# ----
# Step4.如果不存在则Blake geometry
# 并在rhino里面清理线段
geo_3 = Geometry(deblock.Geometry)

# ----
# 列表文字以空格进行分割
panel_19 = Panel(" ")
split = TextSplit(Text=txt_3, Separators=panel_19)

钢埋板长度_2 = Division(A=number_slider_8, B=2)
neg = Negative(Value=钢埋板长度_2)
dom = ConstructDomain(DomainStart=neg, DomainEnd=钢埋板长度_2)
panel_20 = Panel(dom)

钢埋板厚度_2 = Division(A=number_slider_10, B=2)
neg_2 = Negative(Value=钢埋板厚度_2)
dom_2 = ConstructDomain(DomainStart=neg_2, DomainEnd=钢埋板厚度_2)
panel_21 = Panel(dom_2)

# ----
# 钢埋板肋板位置 1/4处
panel_22 = Panel("4")
division = Division(A=number_slider_8, B=panel_22)

# ----
# 编号和截面尺寸分区
panel_23 = Panel("1")
split_2 = SplitList(List=split, Index=panel_23)  # -> flatten(ListA), flatten(ListB)

# ----
# 钢埋板高度，工字钢尺寸决定
cluster_2 = Cluster_7(
    T=txt_2,
    G=reflay_13,
    A=number_slider_7,
    B=number_slider_9,
    A_2=number_slider_9,
    text_offset=Slider(190, range=0..1000),
    structure_number=panel_18,
    B_2=number_slider_12,
    A_3=number_slider_7,
    B_3=number_slider_9,
    dimension_style="图例2-地上$0$XD100$0",
    B_4=number_slider_9,
    B_5=number_slider_9)  # -> R, G_2, R_2

# ----
# 要连接的embed
data_4 = Data(cluster_2.R_2)

# ----
# 要连接的curve
crv_15 = Curve(cluster_2.G_2)

# ----
# 要连接的梁中线Offest值
num = Number(cluster_2.R)

# ----
# 底埋钢埋件
panel_24 = Panel("-125 To 125")
rectangle = Rectangle(Plane=PlaneXY(0, 0, 0), XSize="-175 To 175", YSize=panel_24, Radius=0)  # -> Rectangle, Length
pln_2 = Plane(rectangle.Rectangle)
rec = Rectangle(rectangle.Rectangle)

merge_2 = Merge(Data1=rec, Data2=pln_2)

# ----
# 单体选型
list_6 = ValueList({"顶埋": 0, "侧埋": 1}, selected="顶埋")

# ----
# 选要重塑的线段长度
number_slider_16 = Slider(1200, range=0..10000)

# ----
# 调整重塑线段的平滑度
number_slider_17 = Slider(11, range=0..11)

# ----
# 根据F2建筑线制作轮廓线
crv_16 = Curve(crv_7)
explode = Explode(Curve=crv_16, Recursive=True)  # -> Segments, Vertices
len = Length(Curve=explode.Segments)
sort = SortList(Keys=len)  # -> Keys, ValuesA
larger = LargerThan(FirstNumber=len, SecondNumber=number_slider_16)  # -> LargerThan, OrEqualTo
panel_25 = Panel(sort.Keys)
dispatch_2 = Dispatch(List=explode.Segments, DispatchPattern=larger.LargerThan)  # -> ListA, ListB
data_5 = Data(dispatch_2.ListA)
data_6 = Data(dispatch_2.ListB)
join = JoinCurves(Curves=data_6, Preserve=False)
disc = Discontinuity(Curve=join, Level=1)  # -> Points, Parameters
nurbs = NurbsCurve(Vertices=disc.Points, Degree=number_slider_17, Periodic=False)  # -> flatten(Curve), Length, Domain
join_2 = JoinCurves(Curves=flatten([data_5, nurbs.Curve]), Preserve=False)
offset = OffsetCurve(Curve=join_2, Distance=Slider(6859, range=0..10000), Corners=1)

# ----
# Default Curve
reb = RebuildCurve(Curve=offset, Count=Slider(17, range=0..100), Tangents=invert(False))

# ----
# InputCurve
crv_17 = Curve()

# ----
# Curve-框住要分析的建筑单体
# 如果要用自己导入Curve作为分析线，
# 请在InputCurve那里导入curve,
# 然后在上方的选型列表选择Input Curve。
# 
# 如果要用Grasshopper自动生成的Curve,
# 请在上方的选型列表选择Default Curve。
list_7 = ValueList({"Default Curve": 0, "Input Curve": 1}, selected="Default Curve")
filter = StreamFilter(Gate=list_7, Stream0=reb, Stream1=crv_17)

# ----
# 埋件向外探索最远出的梁的距离
number_slider_18 = Slider(5000, range=0..10000)

# ----
# 是否有吊顶：
# 下层幕墙边线在结构边梁以内>350
# 
# （最外层结构线）
number_slider_19 = Slider(350, range=0..1000)

crv_18 = Curve(crv_6)

# ----
# 3.2下层建筑边线内侧300-600mm范围内
number_slider_20 = Slider(600, range=0..1000)
crv_19 = Curve(crv_18)
offset_2 = OffsetCurve(Curve=crv_19, Distance=expr("-x", Slider(300, range=0..1000)), Corners=1)
offset_3 = OffsetCurve(Curve=crv_19, Distance=expr("-x", number_slider_20), Corners=1)

# ----
# 3.1下层建筑边线外侧50-350mm范围内
number_slider_21 = Slider(350, range=0..1000)
crv_20 = Curve(crv_18)
offset_4 = OffsetCurve(Curve=crv_20, Distance=Slider(50, range=0..100), Corners=1)
offset_5 = OffsetCurve(Curve=crv_20, Distance=number_slider_21, Corners=1)

# ----
# 4下层建筑内侧到300到外侧50内
# 有钢结构
number_slider_22 = Slider(50, range=0..1000)
crv_21 = Curve(crv_18)
offset_6 = OffsetCurve(Curve=crv_21, Distance=expr("-x", Slider(300, range=0..1000)), Corners=1)
offset_7 = OffsetCurve(Curve=crv_21, Distance=number_slider_22, Corners=1)

data_7 = Data(merge_2)
item = ListItem(List=data_7, Index="-1", Wrap=True)
item_2 = ListItem(List=data_7, Index=0, Wrap=True)
data_8 = Data(flatten(merge))
item_3 = ListItem(List=data_8, Index=0, Wrap=True)
item_4 = ListItem(List=data_8, Index="-1", Wrap=True)
crv_22 = Curve(join_2)

crv_23 = Curve(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)
crv_24 = Curve(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)

crv_25 = Curve(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)
crv_26 = Curve(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)

# ----
# 求内部曲线转折点
crv_27 = Curve()  # disabled
number_slider_23 = Slider(300, range=0..1000)  # disabled
neg_3 = Negative(Value=number_slider_23)  # disabled
filter_2 = StreamFilter(Gate=toggle, Stream0=number_slider_23, Stream1=neg_3)  # disabled
number_slider_24 = Slider(60, range=0..100)  # disabled

ext = ExtendCurve(Curve=crv_27, Type=0, Start=number_slider, End=number_slider)  # disabled

# ----
# 第二层
# 
# Curves(location point)+ Smooth Curves(architecture line)
# 第二层-区分阴阳角
area_2 = Area(Geometry=geo_2)  # -> Area, Centroid; disabled
crv_28 = Curve(crv_27)  # disabled
pull = PullPoint(Point=area_2.Centroid, Geometry=crv_28, ClosestOnly=True)  # -> ClosestPoint, Distance; disabled
number_slider_25 = Slider(200, range=0..1000)  # disabled
number_slider_26 = Slider(100, range=0..300)  # disabled

# ----
# 第二层-阴阳角
panel_26 = Panel("0.5 * Pi")  # disabled
toggle_2 = BooleanToggle(True)  # disabled
neg_4 = Negative(Value=panel_26)  # disabled
filter_3 = StreamFilter(Gate=toggle_2, Stream0=panel_26, Stream1=neg_4)  # disabled

# ----
# 第二层-大面定位
panel_27 = Panel("0.5 * Pi")  # disabled
toggle_3 = BooleanToggle(True)  # disabled
neg_5 = Negative(Value=panel_27)  # disabled
filter_4 = StreamFilter(Gate=toggle_3, Stream0=panel_27, Stream1=neg_5)  # disabled

number_slider_27 = Slider(300, range=0..1000)  # disabled
number_slider_28 = Slider(1.5, range=0..10)  # disabled

number_slider_29 = Slider(300, range=0..1000)  # disabled
number_slider_30 = Slider(1.5, range=0..10)  # disabled

number_slider_31 = Slider(300, range=0..1000)  # disabled
number_slider_32 = Slider(1.5, range=0..10)  # disabled

# ----
# 显示"False"时要选择线段延长
list_8 = ValueList({"线段不延长": 0, "线段延长": 1}, selected="线段延长")  # disabled

filter_5 = StreamFilter(Gate=list_8, Stream0=crv_27, Stream1=ext)  # disabled

disc_2 = Discontinuity(Curve=graft(filter_5), Level=1)  # -> Points, Parameters; disabled
crv_cp = CurveClosestPoint(Point=disc_2.Points, Curve=graft(filter_5))  # -> Point, Parameter, Distance; disabled
eval = EvaluateCurve(Curve=graft(filter_5), Parameter=crv_cp.Parameter)  # -> flatten(Point), Tangent, flatten(Angle); disabled
deg = Degrees(Radians=eval.Angle)  # disabled
offset_8 = OffsetCurve(Curve=filter_5, Distance=expr("-X", filter_2), Corners=1)  # disabled
panel_28 = Panel(deg)  # disabled
larger_2 = LargerThan(FirstNumber=deg, SecondNumber=number_slider_24)  # -> LargerThan, OrEqualTo; disabled
disc_3 = Discontinuity(Curve=offset_8, Level=1)  # -> flatten(Points), Parameters; disabled
dispatch_3 = Dispatch(List=eval.Point, DispatchPattern=larger_2.LargerThan)  # -> ListA, ListB; disabled
end = EndPoints(Curve=filter_5)  # -> Start, End; disabled
data_9 = Data(dispatch_3.ListA)  # disabled
pull_2 = PullPoint(Point=data_9, Geometry=flatten(offset_8), ClosestOnly=True)  # -> ClosestPoint, Distance; disabled
testpoint = TestPoint(archPoint=pull_2.ClosestPoint, crvPoint=disc_3.Points)  # -> out, specialPt; inputs archPoint: list of Point3d, crvPoint: list of Point3d; disabled
# ---------- testpoint: C# ----------
    List<int> passIndex = new List<int>();

    for(int i = 0; i < archPoint.Count; i++){
      foreach(Point3d t in crvPoint){
        if(archPoint[i].X == t.X && archPoint[i].Y == t.Y && archPoint[i].Z == t.Z){
          Print("pass");
          passIndex.Add(i);}
      }
    }

    specialPt = passIndex;
# ---------- end testpoint ----------

# ----
# 阴角
item_5 = ListItem(List=data_9, Index=testpoint.specialPt, Wrap=True)  # disabled

# ----
# SmoothCurve-阴角&阳角
# 阳角
cull_i = CullIndex(List=data_9, Indices=testpoint.specialPt, Wrap=True)  # disabled

dist = Distance(PointA=pull.ClosestPoint, PointB=data_9)  # disabled
sort_2 = SortList(Keys=dist)  # -> Keys, ValuesA; disabled
panel_29 = Panel(sort_2.Keys)  # disabled
smaller = SmallerThan(FirstNumber=dist, SecondNumber=number_slider_25)  # -> SmallerThan, OrEqualTo; disabled
dispatch_4 = Dispatch(List=geo_2, DispatchPattern=smaller.SmallerThan)  # -> ListA, ListB; disabled
crv_29 = Curve(filter_5)  # disabled

data_10 = Data(dispatch_4.ListA)  # disabled
explode_2 = Explode(Curve=data_10, Recursive=True)  # -> Segments, Vertices; disabled
len_2 = Length(Curve=explode_2.Segments)  # disabled
sort_3 = SortList(Keys=reverse(len_2), ValuesA=explode_2.Segments)  # -> Keys, ValuesA; disabled
item_6 = ListItem(List=sort_3.ValuesA, Index=0, Wrap=True)  # -> flatten(Item); disabled
area_3 = Area(Geometry=data_10)  # -> Area, Centroid; disabled
midpt = CurveMiddle(Curve=item_6)  # disabled
move2pt = MoveToPoint(Geometry=item_6, PointA=midpt, PointB=area_3.Centroid)  # -> Moved, Vector, Transform; disabled
end_2 = EndPoints(Curve=move2pt.Moved)  # -> Start, End; disabled
ln = Line(StartPoint=end_2.Start, EndPoint=end_2.End)  # disabled
xy_15 = XYPlane(Origin=end_2.End)  # disabled
rotate = Rotate(Geometry=ln, Angle=filter_3, Plane=xy_15)  # -> Geometry, Transform; disabled
pl = ConstructPlane(Origin=end_2.End, XAxis=rotate.Geometry, YAxis=ln)  # disabled

data_11 = Data(dispatch_4.ListB)  # disabled
explode_3 = Explode(Curve=data_11, Recursive=True)  # -> Segments, Vertices; disabled
len_3 = Length(Curve=explode_3.Segments)  # disabled
sort_4 = SortList(Keys=reverse(len_3), ValuesA=explode_3.Segments)  # -> Keys, ValuesA; disabled
item_7 = ListItem(List=sort_4.ValuesA, Index=0, Wrap=True)  # -> flatten(Item); disabled
area_4 = Area(Geometry=data_11)  # -> Area, Centroid; disabled
midpt_2 = CurveMiddle(Curve=item_7)  # disabled
move2pt_2 = MoveToPoint(Geometry=item_7, PointA=midpt_2, PointB=area_4.Centroid)  # -> Moved, Vector, Transform; disabled
end_3 = EndPoints(Curve=move2pt_2.Moved)  # -> Start, End; disabled
ln_2 = Line(StartPoint=end_3.Start, EndPoint=end_3.End)  # disabled
xy_16 = XYPlane(Origin=end_3.End)  # disabled
rotate_2 = Rotate(Geometry=ln_2, Angle=filter_4, Plane=xy_16)  # -> Geometry, Transform; disabled
pl_2 = ConstructPlane(Origin=end_3.End, XAxis=rotate_2.Geometry, YAxis=ln_2)  # disabled

data_12 = Data(flatten(pl_2))  # disabled
deplane = DeconstructPlane(Plane=data_12)  # -> Origin, XAxis, YAxis, ZAxis; disabled
amp = Amplitude(Vector=deplane.YAxis, Amplitude=number_slider_29)  # disabled
move = Move(Geometry=deplane.Origin, Motion=amp)  # -> Geometry, Transform; disabled
ln_3 = Line(StartPoint=deplane.Origin, EndPoint=move.Geometry)  # disabled
midpt_3 = CurveMiddle(Curve=ln_3)  # disabled
scale = Scale(Geometry=ln_3, Center=midpt_3, Factor=number_slider_30)  # -> Geometry, Transform; disabled
ccx = CurveCurve(CurveA=scale.Geometry, CurveB=crv_29)  # -> Points, ParamsA, ParamsB; disabled

dist_2 = Distance(PointA=graft(end_2.End), PointB=cull_i)  # disabled
sort_5 = SortList(Keys=dist_2)  # -> Keys, ValuesA; disabled
item_8 = ListItem(List=sort_5.Keys, Index=0, Wrap=True)  # disabled
smaller_2 = SmallerThan(FirstNumber=item_8, SecondNumber=number_slider_26)  # -> SmallerThan, OrEqualTo; disabled
flatten = FlattenTree(Tree=item_8, Path="{0}")  # disabled
dispatch_5 = Dispatch(List=graft(pl), DispatchPattern=smaller_2.SmallerThan)  # -> ListA, ListB; disabled
panel_30 = Panel(flatten)  # disabled
flatten_2 = FlattenTree(Tree=ccx.Points, Path="{0}")  # disabled
lng = ListLength(List=scale.Geometry)  # disabled
lng_2 = ListLength(List=flatten_2)  # disabled

data_13 = Data(flatten(dispatch_5.ListA))  # disabled
deplane_2 = DeconstructPlane(Plane=data_13)  # -> Origin, XAxis, YAxis, ZAxis; disabled
amp_2 = Amplitude(Vector=deplane_2.YAxis, Amplitude=number_slider_27)  # disabled
move_2 = Move(Geometry=deplane_2.Origin, Motion=amp_2)  # -> Geometry, Transform; disabled
ln_4 = Line(StartPoint=deplane_2.Origin, EndPoint=move_2.Geometry)  # disabled
midpt_4 = CurveMiddle(Curve=ln_4)  # disabled
scale_2 = Scale(Geometry=ln_4, Center=midpt_4, Factor=number_slider_28)  # -> Geometry, Transform; disabled
ccx_2 = CurveCurve(CurveA=scale_2.Geometry, CurveB=crv_29)  # -> Points, ParamsA, ParamsB; disabled

data_14 = Data(flatten(dispatch_5.ListB))  # disabled
deplane_3 = DeconstructPlane(Plane=data_14)  # -> Origin, XAxis, YAxis, ZAxis; disabled
amp_3 = Amplitude(Vector=deplane_3.YAxis, Amplitude=number_slider_31)  # disabled
move_3 = Move(Geometry=deplane_3.Origin, Motion=amp_3)  # -> Geometry, Transform; disabled
ln_5 = Line(StartPoint=deplane_3.Origin, EndPoint=move_3.Geometry)  # disabled
midpt_5 = CurveMiddle(Curve=ln_5)  # disabled
scale_3 = Scale(Geometry=ln_5, Center=midpt_5, Factor=number_slider_32)  # -> Geometry, Transform; disabled
ccx_3 = CurveCurve(CurveA=scale_3.Geometry, CurveB=crv_29)  # -> Points, ParamsA, ParamsB; disabled

equals = Equality(FirstNumber=lng, SecondNumber=lng_2)  # -> Equality, Inequality; disabled
panel_31 = Panel(equals.Equality)  # disabled

# ----
# InsideCurve-大面
move2pt_3 = MoveToPoint(Geometry=data_12, PointA=flatten(deplane.Origin), PointB=flatten(ccx.Points))  # -> Moved, Vector, Transform; disabled

# ----
# InsideCurve-阳角
move2pt_4 = MoveToPoint(Geometry=data_13, PointA=deplane_2.Origin, PointB=ccx_2.Points)  # -> Moved, Vector, Transform; disabled

# ----
# InsideCurve-阴角
move2pt_5 = MoveToPoint(Geometry=data_14, PointA=deplane_3.Origin, PointB=ccx_3.Points)  # -> Moved, Vector, Transform; disabled

# ----
# 梁中线+Offset值+埋件单体组合包3（cluster已经explode）
crv_30 = Curve(<curve referenced from the Rhino model>)
layer_4 = ObjectLayer(Guid=crv_30)  # -> LayerIndex, LayerPathName
panel_32 = Panel(layer_4.LayerPathName)
reflay_14 = ReferenceByLayer(LayerName=panel_32)
addition = Addition(A=neg_2, B=division)
addition_2 = Addition(A=钢埋板厚度_2, B=division)
panel_33 = Panel(split_2.ListB)
dom_3 = ConstructDomain(DomainStart=addition, DomainEnd=addition_2)
钢埋板_侧视图 = Rectangle(Plane=PlaneXY(0, 0, 0), XSize=dom_2, YSize=dom, Radius=0)  # -> Rectangle, Length
dedomain = DeconstructDomain(Domain=dom)  # -> Start, End
multiplication = Multiplication(A=dedomain.Start, B=dedomain.Start)
panel_34 = Panel(txt_3)
xy_17 = XYPlane(Origin=Point(0, 0, 0))

# ----
# 需要出图的钢结构编号
panel_35 = Panel(panel_32)

# ----
# 求出对应输入编号的钢结构截面尺寸
fsim = FindSimilarMember(Data=panel_35, Set=split_2.ListA)  # -> Hit, Index
item_9 = ListItem(List=split_2.ListB, Index=fsim.Index, Wrap=True)

# ----
# 要连接的curve
project_15 = Project(Geometry=reflay_14, Plane=xy_17)  # -> Geometry, Transform

swatch = ColourSwatch(SwatchColor=RGB(255, 224, 66))
layer_5 = DefineLayer(Name="1-1-02钢板焊埋件", Color=swatch)
attributes = DefineObjectAttributes(Layer=layer_5, Color=swatch)

swatch_2 = ColourSwatch(SwatchColor=RGB(205, 255, 66))
layer_6 = DefineLayer(Name="1-0-01钢板焊埋件", Color=swatch_2)
attributes_2 = DefineObjectAttributes(Layer=layer_6, Color=swatch_2)

swatch_3 = ColourSwatch(SwatchColor=RGB(205, 255, 66))
layer_7 = DefineLayer(Name="2-1-03钢板焊埋件", Color=swatch_3)
attributes_3 = DefineObjectAttributes(Layer=layer_7, Color=swatch_3)

swatch_4 = ColourSwatch(SwatchColor=RGB(107, 255, 66))
layer_8 = DefineLayer(Name="3-1-03钢板焊埋件", Color=swatch_4)
attributes_4 = DefineObjectAttributes(Layer=layer_8, Color=swatch_4)

swatch_5 = ColourSwatch(SwatchColor=RGB(107, 255, 66))
layer_9 = DefineLayer(Name="3-2-03钢板焊埋件", Color=swatch_5)
attributes_5 = DefineObjectAttributes(Layer=layer_9, Color=swatch_5)

swatch_6 = ColourSwatch(SwatchColor=RGB(66, 255, 192))
layer_10 = DefineLayer(Name="4-1钢板焊底埋", Color=swatch_6)
attributes_6 = DefineObjectAttributes(Layer=layer_10, Color=swatch_6)

swatch_7 = ColourSwatch(SwatchColor=RGB(66, 167, 255))
layer_11 = DefineLayer(Name="4-0-03默认钢板焊", Color=swatch_7)
attributes_7 = DefineObjectAttributes(Layer=layer_11, Color=swatch_7)

swatch_8 = ColourSwatch(SwatchColor=RGB(66, 167, 255))
layer_12 = DefineLayer(Name="5-04板埋", Color=swatch_8)
attributes_8 = DefineObjectAttributes(Layer=layer_12, Color=swatch_8)

swatch_9 = ColourSwatch(SwatchColor=RGB(255, 138, 13))
layer_13 = DefineLayer(Name="阴阳角定位", Color=swatch_9)
attributes_9 = DefineObjectAttributes(Layer=layer_13, Color=swatch_9)

# ----
# （5）导入结构线+生成对应的钢板焊埋件
# 
# Step1:依次根据结构编号在Rhino中按照图层分类结构线
# Step2:按照结构编号依次建立 梁中线+Offset值+埋件单体组合包
# Step3:依次在每个组合包中的输入对应结构编号图层中的一条Curve
# Step4:依次将每个组合包中的Curve,Offset值和Embed连接到右侧的3个Entwine组件上
# Step5:最后Explode一下cluster以防embed的plane出现问题（组合包1没有explode，组合包2、3是已经explode之后的状态）
# 梁中线+Offset值+埋件单体组合包1
crv_31 = Curve(<curve referenced from the Rhino model>)
layer_14 = ObjectLayer(Guid=crv_31)  # -> LayerIndex, LayerPathName
panel_36 = Panel(layer_14.LayerPathName)
reflay_15 = ReferenceByLayer(LayerName=panel_36)
panel_37 = Panel(txt_4)
xy_18 = XYPlane(Origin=Point(0, 0, 0))

# ----
# 需要出图的钢结构编号
panel_38 = Panel(panel_36)

# ---- group: Step5:最后Explode一下cluster以防embed的plane出现问题
# Step5:最后Explode一下cluster
# 以防embed的plane出现问题
cluster_3 = Cluster_4(
    T=txt_4,
    D=panel_38,
    A=number_slider_13,
    A_2=number_slider_14,
    B=number_slider_14,
    B_2=number_slider_15,
    A_3=number_slider_13,
    B_3=number_slider_14,
    B_4=number_slider_14,
    B_5=number_slider_14)  # -> R, G, B_6

# ----
entwine = Entwine(Branch00=cluster_3.B_6, Branch01=cluster_3.G, FlattenInputs=True)

# ----
# 要连接的梁中线Offest值
num_2 = Number(cluster_3.R)

# ----
# 要连接的curve
project_16 = Project(Geometry=reflay_15, Plane=xy_18)  # -> Geometry, Transform

# ----
# 要连接的embed
data_15 = Data(entwine)

# ----
# 依次连接
# curve
entwine_2 = Entwine(Branch00=project_16.Geometry, Branch01=crv_15, Branch02=project_15.Geometry, FlattenInputs=True)

钢结构截面尺寸 = 钢结构截面尺寸(T=item_9)
cluster_4 = Cluster_2(L=钢结构截面尺寸, L_2=钢结构截面尺寸, L_4=钢结构截面尺寸, L_3=钢结构截面尺寸)  # -> i, i_2, i_4, i_3
钢肋板_侧视图 = 钢肋板侧视图_2(
    B_11=number_slider_10,
    A_7=cluster_4.i_2,
    Y=dom_3,
    B_12=cluster_4.i_4,
    B_13=钢埋板厚度_2,
    B=number_slider_11,
    A=addition,
    B_2=addition_2,
    A_2=division,
    B_3=钢埋板厚度_2,
    x=钢埋板厚度_2,
    A_3=division,
    B_4=number_slider_10,
    B_5=钢埋板厚度_2,
    x_2=钢埋板厚度_2,
    A_4=division,
    B_6=number_slider_10,
    B_7=钢埋板厚度_2,
    x_3=钢埋板厚度_2,
    B_8=number_slider_10,
    x_4=钢埋板厚度_2,
    A_5=division,
    B_9=钢埋板厚度_2,
    A_6=division,
    B_10=钢埋板厚度_2,
    x_5=钢埋板厚度_2)  # -> R, G, R_2
division_2 = Division(A=cluster_4.i_2, B=2)

# ----
# 钢埋板高度，工字钢尺寸决定
panel_39 = Panel("2")
division_3 = Division(A=cluster_4.i, B=panel_39)
subtraction = Subtraction(A=division_3, B=cluster_4.i_3)

侧视图 = Entwine(Branch00=钢埋板_侧视图.Rectangle, Branch01=钢肋板_侧视图.R_2, Branch02=钢肋板_侧视图.G, FlattenInputs=True)
cluster_5 = Cluster_3(G=侧视图, A=subtraction, B=Slider(200, range=0..1000), B_2=钢肋板_侧视图.R)

# ----
# 要连接的梁中线Offest值
num_3 = Number(division_2)

# ----
# 依次连接
# 梁中线Offest值
entwine_3 = Entwine(Branch00=num_2, Branch01=num, Branch02=num_3, FlattenInputs=True)

# ----
# 区分内外梁边线
crv_32 = Curve(filter)
crv_33 = Curve(entwine_2)
num_4 = Number(entwine_3)
offcrv = OffsetCurve(Curve=crv_33, Plane=PlaneXY(0, 0, 0), Distance=num_4, BothSides=expr("-x", num_4), Kinks=0, CapType="0")
midpt_6 = CurveMiddle(Curve=offcrv)
midpt_7 = CurveMiddle(Curve=crv_33)
crv_34 = Curve(offcrv)
offcrv_2 = OffsetCurve(Curve=crv_33, Plane=PlaneXY(0, 0, 0), Distance=num_4, BothSides=expr("-x", num_4), Kinks=0, CapType="1")
item_10 = ListItem(List=midpt_6, Index=0, Wrap=True)
item_11 = ListItem(List=crv_34, Index=0, Wrap=True)
item_12 = ListItem(List=crv_34, Index="-1", Wrap=True)
pull_3 = PullPoint(Point=midpt_7, Geometry=crv_32, ClosestOnly=True)  # -> ClosestPoint, Distance
ln_6 = Line(StartPoint=item_10, EndPoint=graft(pull_3.ClosestPoint))
graft = GraftTree(Tree=crv_33, IncludeEmptyLists=True, IncludeNullItems=True)
ccx_4 = CurveCurve(CurveA=ln_6, CurveB=graft)  # -> Points, ParamsA, ParamsB
null_2 = NullItem(Item=ccx_4.Points)  # -> NullFlags, InvalidFlags, Description
dispatch_6 = Dispatch(List=item_11, DispatchPattern=null_2.InvalidFlags)  # -> ListA, ListB
dispatch_7 = Dispatch(List=item_12, DispatchPattern=null_2.InvalidFlags)  # -> ListA, ListB

# ----
# 梁线闭合
shift = ShiftPaths(Data=offcrv_2, Offset=-1)

# ----
# 梁边线-内
merge_3 = Merge(Data1=dispatch_6.ListB, Data2=dispatch_7.ListA)

# ----
# 梁边线-外
merge_4 = Merge(Data1=dispatch_6.ListA, Data2=dispatch_7.ListB)

crv_35 = Curve(shift)

crv_36 = Curve(shift)

crv_37 = Curve(shift)

crv_38 = Curve(shift)

crv_39 = Curve(shift)

crv_40 = Curve(shift)

crv_41 = Curve(shift)

crv_42 = Curve(shift)

crv_43 = Curve(shift)

crv_44 = Curve(shift)

crv_45 = Curve(shift)

split_tree = SplitTree(Data=cluster_5, Masks=flatten("{0;0}"))  # -> Positive, Negative
dispatch_8 = Dispatch(List=split_tree.Negative, DispatchPattern=[True, False])  # -> flatten(ListA), ListB
merge_5 = Merge(Data1=split_tree.Positive, Data2=dispatch_8.ListA)
entwine_4 = Entwine(Branch00=merge_5, Branch01=dispatch_8.ListB, FlattenInputs=True)
flatten_3 = FlattenTree(Tree=entwine_4, Path="{0}")
group = Group(Objects=flatten_3)
cluster_6 = Cluster(G=group)
ungroup = Ungroup(Group=cluster_6)

# ---- group: Block
layer_15 = DefineLayer(Name="Embeded::Embeded Steel", Color=ColourSwatch(SwatchColor=RGB(255, 140, 140)))
attributes_10 = DefineObjectAttributes(Layer=layer_15)
block = DefineBlock(Geometry=ungroup, Attributes=attributes_10, BlockName="Steel Plate", BasePlane=PlaneXY(0, 0, 0))

# ----
deblock_4 = DeconstructBlock(Block=block)  # -> Name, flatten(Plane), flatten(Geometry)
group_2 = Group(Objects=deblock_4.Geometry)
bbox = BoundingBox(Content=group_2, Plane=PlaneXY(0, 0, 0))  # -> Box, Box_2
deplane_4 = DeconstructPlane(Plane=deblock_4.Plane)  # -> Origin, XAxis, YAxis, ZAxis
area_5 = Area(Geometry=bbox.Box)  # -> Area, Centroid
move2pt_6 = MoveToPoint(Geometry=flatten(deplane_4.Origin), PointA=flatten(deplane_4.Origin), PointB=flatten(area_5.Centroid))  # -> Moved, Vector, Transform
pl_3 = ConstructPlane(Origin=move2pt_6.Moved, XAxis=deplane_4.YAxis, YAxis=deplane_4.XAxis)  # -> graft(Plane)
deplane_5 = DeconstructPlane(Plane=pl_3)  # -> Origin, XAxis, YAxis, ZAxis
rotate_3 = Rotate(Geometry=pl_3, Angle="Pi", Plane=pl_3)  # -> Geometry, Transform
amp_4 = Amplitude(Vector=deplane_5.YAxis, Amplitude=multiplication)
move_4 = Move(Geometry=deplane_5.Origin, Motion=amp_4)  # -> Geometry, Transform
srf = Surface(bbox.Box)
crv_46 = Curve(srf)
ln_7 = Line(StartPoint=move_4.Geometry, EndPoint=deplane_5.Origin)
ccx_5 = CurveCurve(CurveA=ln_7, CurveB=crv_46)  # -> Points, ParamsA, ParamsB
ln_8 = Line(StartPoint=deplane_5.Origin, EndPoint=ccx_5.Points)
move_5 = Move(Geometry=rotate_3.Geometry, Motion=ln_8)  # -> Geometry, Transform
entwine_5 = Entwine(Branch00=block, Branch01=move_5.Geometry, FlattenInputs=True)

# ----
# 要连接的embed
data_16 = Data(entwine_5)

# ----
# 依次连接
# embed
entwine_6 = Entwine(Branch00=data_15, Branch01=data_4, Branch02=data_16, FlattenInputs=True)

data_17 = Data(entwine_6)
item_13 = ListItem(List=data_17, Index=0, Wrap=True)
item_14 = ListItem(List=data_17, Index="-1", Wrap=True)
data_18 = Data(entwine_6)
item_15 = ListItem(List=data_18, Index=0, Wrap=True)
item_16 = ListItem(List=data_18, Index="-1", Wrap=True)
data_19 = Data(entwine_6)
item_17 = ListItem(List=data_19, Index=0, Wrap=True)
item_18 = ListItem(List=data_19, Index="-1", Wrap=True)
rotate_4 = Rotate(Geometry=item_18, Angle="Pi", Plane=item_18)  # -> Geometry, Transform
data_20 = Data(entwine_6)
data_21 = Data(entwine_6)
item_19 = ListItem(List=data_20, Index=0, Wrap=True)
item_20 = ListItem(List=data_20, Index="-1", Wrap=True)
item_21 = ListItem(List=data_21, Index=0, Wrap=True)
item_22 = ListItem(List=data_21, Index="-1", Wrap=True)
rotate_5 = Rotate(Geometry=item_20, Angle="Pi", Plane=item_20)  # -> Geometry, Transform

# ----
# 找埋件定位点+区分阴阳角
# 测试Smooth Curve是否与每个Block相切
# blocks + smooth curves
# remove duplicate blocks
# blocks + special curves
deblock_5 = DeconstructBlock(Block=project_3.Geometry)  # -> Name, Plane, Geometry
pln_3 = Plane(flatten(deblock_5.Plane))
deplane_6 = DeconstructPlane(Plane=pln_3)  # -> Origin, XAxis, YAxis, ZAxis
cullduppoints_2 = RemoveDuplicatePoints(InputPoints=deplane_6.Origin, Tolerance=0.001)  # -> OutputPoints, FirstPointIndexes
null_3 = NullItem(Item=cullduppoints_2.FirstPointIndexes)  # -> NullFlags, InvalidFlags, Description
dispatch_9 = Dispatch(List=pln_3, DispatchPattern=null_3.InvalidFlags)  # -> ListA, ListB
dispatch_10 = Dispatch(List=flatten(project_3.Geometry), DispatchPattern=null_3.InvalidFlags)  # -> ListA, ListB
pln_4 = Plane(dispatch_9.ListA)
data_22 = Data(flatten(pln_4))
deplane_7 = DeconstructPlane(Plane=data_22)  # -> Origin, XAxis, YAxis, ZAxis
pln_5 = Plane(data_22)
amp_5 = Amplitude(Vector=deplane_7.YAxis, Amplitude=Slider(300, range=0..1000))
move_6 = Move(Geometry=deplane_7.Origin, Motion=amp_5)  # -> Geometry, Transform
ln_9 = Line(StartPoint=deplane_7.Origin, EndPoint=move_6.Geometry)
crv_47 = Curve(crv_11)
midpt_8 = CurveMiddle(Curve=ln_9)
scale_4 = Scale(Geometry=ln_9, Center=midpt_8, Factor=Slider(7.8, range=0..10))  # -> Geometry, Transform
merge_6 = Merge(Data1=scale_4.Geometry, Data2=crv_47)
mcx = MultipleCurves(Curves=flatten(merge_6))  # -> Points, IndexA, IndexB, ParamA, ParamB
cull_i_2 = CullIndex(List=flatten(pln_5), Indices=mcx.IndexA, Wrap=True)
item_23 = ListItem(List=pln_5, Index=mcx.IndexA, Wrap=True)
pln_6 = Plane(cull_i_2)
pln_7 = Plane(item_23)

deblock_6 = DeconstructBlock(Block=dispatch_10.ListA)  # -> Name, Plane, Geometry
data_23 = Data(dispatch_10.ListA)

cull_i_3 = CullIndex(List=flatten(data_23), Indices=mcx.IndexA, Wrap=True)
item_24 = ListItem(List=flatten(data_23), Index=mcx.IndexA, Wrap=True)
data_24 = Data(cull_i_3)
data_25 = Data(item_24)

# ----
# 第一层
# 
# Special Curves(architecture line)
crv_48 = Curve(crv_14)
pln_8 = Plane(pln_6)
deplane_8 = DeconstructPlane(Plane=pln_8)  # -> Origin, XAxis, YAxis, ZAxis
disc_4 = Discontinuity(Curve=crv_48, Level=1)  # -> Points, Parameters
pull_4 = PullPoint(Point=deplane_8.Origin, Geometry=disc_4.Points, ClosestOnly=True)  # -> ClosestPoint, Distance
sort_6 = SortList(Keys=pull_4.Distance)  # -> reverse(Keys), ValuesA
panel_40 = Panel(sort_6.Keys)
larger_3 = LargerThan(FirstNumber=pull_4.Distance, SecondNumber=Slider(300, range=0..1000))  # -> LargerThan, OrEqualTo
dispatch_11 = Dispatch(List=pln_8, DispatchPattern=larger_3.LargerThan)  # -> ListA, ListB
data_26 = Data(dispatch_11.ListB)
deplane_9 = DeconstructPlane(Plane=data_26)  # -> Origin, XAxis, YAxis, ZAxis
pull_5 = PullPoint(Point=deplane_9.Origin, Geometry=disc_4.Points, ClosestOnly=True)  # -> ClosestPoint, Distance
pl_4 = ConstructPlane(Origin=pull_5.ClosestPoint, XAxis=deplane_9.XAxis, YAxis=deplane_9.YAxis)

# ----
# 测试Smooth Curve是否与每个Block相切
# blocks + smooth curves
# remove duplicate blocks
# blocks + special curves
deblock_7 = DeconstructBlock(Block=project_2.Geometry)  # -> Name, Plane, Geometry
pln_9 = Plane(flatten(deblock_7.Plane))
deplane_10 = DeconstructPlane(Plane=pln_9)  # -> Origin, XAxis, YAxis, ZAxis
cullduppoints_3 = RemoveDuplicatePoints(InputPoints=deplane_10.Origin, Tolerance=0.001)  # -> OutputPoints, FirstPointIndexes
null_4 = NullItem(Item=cullduppoints_3.FirstPointIndexes)  # -> NullFlags, InvalidFlags, Description
dispatch_12 = Dispatch(List=pln_9, DispatchPattern=null_4.InvalidFlags)  # -> ListA, ListB
dispatch_13 = Dispatch(List=flatten(project_2.Geometry), DispatchPattern=null_4.InvalidFlags)  # -> ListA, ListB
pln_10 = Plane(dispatch_12.ListA)
data_27 = Data(flatten(pln_10))
deplane_11 = DeconstructPlane(Plane=data_27)  # -> Origin, XAxis, YAxis, ZAxis
pln_11 = Plane(data_27)
amp_6 = Amplitude(Vector=deplane_11.YAxis, Amplitude=Slider(300, range=0..1000))
move_7 = Move(Geometry=deplane_11.Origin, Motion=amp_6)  # -> Geometry, Transform
ln_10 = Line(StartPoint=deplane_11.Origin, EndPoint=move_7.Geometry)
crv_49 = Curve(crv_11)
midpt_9 = CurveMiddle(Curve=ln_10)
scale_5 = Scale(Geometry=ln_10, Center=midpt_9, Factor=Slider(7.8, range=0..10))  # -> Geometry, Transform
merge_7 = Merge(Data1=scale_5.Geometry, Data2=crv_49)
mcx_2 = MultipleCurves(Curves=flatten(merge_7))  # -> Points, IndexA, IndexB, ParamA, ParamB
cull_i_4 = CullIndex(List=flatten(pln_11), Indices=mcx_2.IndexA, Wrap=True)
item_25 = ListItem(List=pln_11, Index=mcx_2.IndexA, Wrap=True)
pln_12 = Plane(cull_i_4)
pln_13 = Plane(item_25)

deblock_8 = DeconstructBlock(Block=dispatch_13.ListA)  # -> Name, Plane, Geometry
data_28 = Data(dispatch_13.ListA)

cull_i_5 = CullIndex(List=flatten(data_28), Indices=mcx_2.IndexA, Wrap=True)
item_26 = ListItem(List=flatten(data_28), Index=mcx_2.IndexA, Wrap=True)
data_29 = Data(cull_i_5)
data_30 = Data(item_26)

# ----
# 制作板埋三视图
max = Maximum(A=s_x, B=s_y)
filter_6 = StreamFilter(Gate=list, Stream0=7.2, Stream1=9.6, Stream2=11.9, Stream3=14.3, Stream4=16.7, Stream5=19.1)
filter_7 = StreamFilter(Gate=list_2, Stream0=270, Stream1=360)
filter_8 = StreamFilter(Gate=list_3, Stream0=10, Stream1=12, Stream2=16, Stream3=18, Stream4=20, Stream5=25)
filter_9 = StreamFilter(Gate=list, Stream0=0.91, Stream1=1.1, Stream2=1.27, Stream3=1.43, Stream4=1.57, Stream5=1.71)
filter_10 = StreamFilter(Gate=list_2, Stream0=0.16, Stream1=0.14)
addition_3 = Addition(A=list_4, B=1)
addition_4 = Addition(A=list_5, B=1)
division_4 = Division(A=max, B=8)
t = Integer(division_4)
panel_41 = Panel(filter_9)
panel_42 = Panel(filter_6)
panel_43 = Panel(filter_10)
min = Minimum(A=filter_7, B=300)
panel_44 = Panel(min)
expression = Expression(A=filter_10, fy=filter_7, ft=filter_9, d=filter_8, Expression="(int((0.6*1.1*A*fy/ft*d)/5)+1)*5")

# ----
# 板埋Modeling
multiplication_2 = Multiplication(A=s_x, B=addition_3)
multiplication_3 = Multiplication(A=s_y, B=addition_4)
recgrid = Rectangular(Plane=PlaneXY(0, 0, 0), SizeX=s_x, SizeY=s_y, ExtentX=addition_3, ExtentY=addition_4)  # -> Cells, Points
直径 = Text(filter_8)
division_5 = Division(A=multiplication_2, B=2)
division_6 = Division(A=multiplication_3, B=2)
vec = VectorXYZ(XComponent=expr("-x", division_5), YComponent=expr("-x", division_6), ZComponent=0)  # -> Vector, Length
move_8 = Move(Geometry=recgrid.Points, Motion=vec.Vector)  # -> Geometry, Transform
division_7 = Division(A=直径, B=2)
cyl = Cylinder(Base=move_8.Geometry, Radius=division_7, Length=expr("-x", expression))
X = UnitX(Factor=直径)
multiplication_4 = Multiplication(A=直径, B=6)
edges = BrepEdges(Brep=cyl)  # -> Naked, Interior, NonManifold
item_27 = ListItem(List=edges.Naked, Index=0, Wrap=True)
max_2 = Maximum(A=multiplication_4, B=70)
move_9 = Move(Geometry=item_27, Motion=X)  # -> Geometry, Transform
multiplication_5 = Multiplication(A=max_2, B=2)
addition_5 = Addition(A=multiplication_2, B=multiplication_5)
addition_6 = Addition(A=multiplication_3, B=multiplication_5)
division_8 = Division(A=t, B=2)
expression_2 = Expression(x=addition_6, Expression="Ceiling(x/10)*10/2")
expression_3 = Expression(x=addition_5, Expression="Ceiling(x/10)*10/2")
round = Round(Number=division_8)  # -> Nearest, Floor, Ceiling
multiplication_6 = Multiplication(A=round.Ceiling, B=2)
dom_4 = ConstructDomain(DomainStart=expr("-x", expression_2), DomainEnd=expression_2)
dom_5 = ConstructDomain(DomainStart=expr("-x", expression_3), DomainEnd=expression_3)
box = DomainBox(Base=PlaneXY(0, 0, 0), X=dom_5, Y=dom_4, Z=multiplication_6)
Z = UnitZ(Factor=expr("-x", multiplication_6))

multiplication_7 = Multiplication(A=直径, B=5)

Z_2 = UnitZ(Factor=multiplication_7)
extr = Extrude(Base=move_9.Geometry, Direction=Z_2)
cap = CapHoles(Brep=[extr, cyl])
merge_8 = Merge(Data1=cap, Data2=box)
flatten_4 = FlattenTree(Tree=merge_8, Path="{0}")
move_10 = Move(Geometry=flatten_4, Motion=Z)  # -> Geometry, Transform

geo_4 = Geometry(project_4.Geometry)
boundary_2 = BoundarySurfaces(Edges=geo_4)
area_6 = Area(Geometry=boundary_2)  # -> Area, Centroid
cullduppoints_4 = RemoveDuplicatePoints(InputPoints=area_6.Centroid, Tolerance=Slider(0.1, range=0..0.1))  # -> OutputPoints, FirstPointIndexes
null_5 = NullItem(Item=cullduppoints_4.FirstPointIndexes)  # -> NullFlags, InvalidFlags, Description
dispatch_14 = Dispatch(List=boundary_2, DispatchPattern=null_5.NullFlags)  # -> ListA, ListB
geo_5 = Geometry(dispatch_14.ListA)
crv_50 = Curve(crv_11)
area_7 = Area(Geometry=geo_5)  # -> Area, Centroid
pull_6 = PullPoint(Point=area_7.Centroid, Geometry=crv_50, ClosestOnly=True)  # -> ClosestPoint, Distance
neg_6 = Negative(Value="0.5 * Pi")
neg_7 = Negative(Value="1.5 * Pi")
filter_11 = StreamFilter(Gate=Toggle(True), Stream0="0.5 * Pi", Stream1=neg_6)
filter_12 = StreamFilter(Gate=Toggle(True), Stream0="1.5 * Pi", Stream1=neg_7)
crv_51 = Curve(crv_11)

# ----
# 第一层
# 
# Angular Curves(architecture line)
number_slider_33 = Slider(84, range=0..1000)
crv_52 = Curve(crv_13)
disc_5 = Discontinuity(Curve=crv_52, Level=1)  # -> Points, Parameters
end_4 = EndPoints(Curve=crv_52)  # -> Start, End
flatten_5 = FlattenTree(Tree=disc_5.Points, Path="{0}")

# ----
# 第一层
# 
# Angular Curves(architecture line)
crv_53 = Curve(crv_12)
disc_6 = Discontinuity(Curve=crv_53, Level=1)  # -> Points, Parameters
end_5 = EndPoints(Curve=crv_53)  # -> Start, End
flatten_6 = FlattenTree(Tree=disc_6.Points, Path="{0}")

# ----
# remove duplicate curves
clscrv = CloseCurve(Curve=crv_10, CloseType=0, Bulge=0.5, Tolerance=0)  # -> Closed, R
# 第一层
# 
# Curves(location point)+ Smooth Curves(architecture line)
crv_54 = Curve(crv_11)
disc_7 = Discontinuity(Curve=graft(crv_54), Level=1)  # -> Points, Parameters
crv_cp_2 = CurveClosestPoint(Point=disc_7.Points, Curve=graft(crv_54))  # -> Point, Parameter, Distance
eval_2 = EvaluateCurve(Curve=graft(crv_54), Parameter=crv_cp_2.Parameter)  # -> flatten(Point), Tangent, flatten(Angle)
deg_2 = Degrees(Radians=eval_2.Angle)
offset_9 = OffsetCurve(Curve=clscrv.Closed, Distance=expr("-X", Slider(300, range=0..1000)), Corners=1)
panel_45 = Panel(deg_2)
larger_4 = LargerThan(FirstNumber=deg_2, SecondNumber=Slider(60, range=0..100))  # -> LargerThan, OrEqualTo
disc_8 = Discontinuity(Curve=offset_9, Level=1)  # -> flatten(Points), Parameters
dispatch_15 = Dispatch(List=eval_2.Point, DispatchPattern=larger_4.LargerThan)  # -> ListA, ListB
data_31 = Data(dispatch_15.ListA)
pull_7 = PullPoint(Point=data_31, Geometry=flatten(offset_9), ClosestOnly=True)  # -> ClosestPoint, Distance
pull_8 = PullPoint(Point=flatten(pln_7), Geometry=crv_54, ClosestOnly=True)  # -> ClosestPoint, Distance
testpoint_2 = TestPoint(archPoint=pull_7.ClosestPoint, crvPoint=disc_8.Points)  # -> out, specialPt; inputs archPoint: list of Point3d, crvPoint: list of Point3d; same code as testpoint
pull_9 = PullPoint(Point=pull_8.ClosestPoint, Geometry=data_31, ClosestOnly=True)  # -> ClosestPoint, Distance
flatten_7 = FlattenTree(Tree=data_25, Path="{0}")
sort_7 = SortList(Keys=pull_9.Distance, ValuesA=flatten_7)  # -> Keys, ValuesA
panel_46 = Panel(sort_7.Keys)
smaller_3 = SmallerThan(FirstNumber=sort_7.Keys, SecondNumber=Slider(100, range=0..100))  # -> SmallerThan, OrEqualTo
dispatch_16 = Dispatch(List=sort_7.ValuesA, DispatchPattern=smaller_3.SmallerThan)  # -> ListA, ListB
data_32 = Data(dispatch_16.ListA)
deblock_9 = DeconstructBlock(Block=data_32)  # -> Name, Plane, Geometry
deplane_12 = DeconstructPlane(Plane=deblock_9.Plane)  # -> Origin, XAxis, YAxis, ZAxis
pt = Point(data_31)
pull_10 = PullPoint(Point=deplane_12.Origin, Geometry=pt, ClosestOnly=True)  # -> ClosestPoint, Distance
cir = Circle(Plane=pull_10.ClosestPoint, Radius=Slider(300, range=0..1000))
crv_55 = Curve(crv_54)
amp_7 = Amplitude(Vector=deplane_12.YAxis, Amplitude=Slider(200, range=0..1000))
ccx_6 = CurveCurve(CurveA=cir, CurveB=crv_55)  # -> Points, ParamsA, ParamsB
move_11 = Move(Geometry=pull_10.ClosestPoint, Motion=amp_7)  # -> Geometry, Transform
item_28 = ListItem(List=ccx_6.Points, Index=0, Wrap=True)
clean = CleanTree(RemoveNulls=True, RemoveInvalid=True, RemoveEmpty=Toggle(True), Tree=item_28)
ln_11 = Line(StartPoint=pull_10.ClosestPoint, EndPoint=clean)
ln_12 = Line(StartPoint=pull_10.ClosestPoint, EndPoint=move_11.Geometry)
angle = Angle(VectorA=ln_12, VectorB=ln_11)  # -> Angle, Reflex
deg_3 = Degrees(Radians=angle.Angle)
flatten_8 = FlattenTree(Tree=deg_3, Path="{0}")
panel_47 = Panel(flatten_8)
c_script = CSharpScript(angle=flatten_8, minus=Slider(80, range=0..100))  # -> out, results; inputs angle: list of Double, minus: Double
# ---------- c_script: C# ----------
    List<double> MyAngle = new List<double>();
    for(int i = 0; i < angle.Count; i++){
      if (angle[i] > minus){
        angleEach = angle[i] - 90;
        Print("!!!!!!!!");
        MyAngle.Add(angleEach);
      }
      else{
        angleEach = angle[i];
        Print("00000");
        MyAngle.Add(angleEach);
      }

    }

    results = MyAngle;
# ---------- c_script: C# additional code ----------
  double angleEach = 0;
# ---------- end c_script ----------
larger_5 = LargerThan(FirstNumber=c_script.results, SecondNumber=Slider(30, range=0..100))  # -> LargerThan, OrEqualTo
panel_48 = Panel(c_script.results)
dispatch_17 = Dispatch(List=flatten(data_32), DispatchPattern=flatten(larger_5.LargerThan))  # -> ListA, ListB
data_33 = Data(dispatch_17.ListA)
deblock_10 = DeconstructBlock(Block=data_33)  # -> Name, Plane, Geometry
pln_14 = Plane(flatten(pln_7))
deplane_13 = DeconstructPlane(Plane=flatten(deblock_10.Plane))  # -> Origin, XAxis, YAxis, ZAxis
deplane_14 = DeconstructPlane(Plane=pln_14)  # -> Origin, XAxis, YAxis, ZAxis
# Rhino 文件中导入的块名
testpoint_3 = TestPoint(archPoint=deplane_14.Origin, crvPoint=deplane_13.Origin)  # -> out, specialPt; inputs archPoint: list of Point3d, crvPoint: list of Point3d; same code as testpoint
cull_i_6 = CullIndex(List=pln_14, Indices=testpoint_3.specialPt, Wrap=True)
pln_15 = Plane(deblock_10.Plane)
crv_56 = Curve(crv_11)
pln_16 = Plane(cull_i_6)
data_34 = Data(flatten(pln_16))
deplane_15 = DeconstructPlane(Plane=data_34)  # -> Origin, XAxis, YAxis, ZAxis
amp_8 = Amplitude(Vector=deplane_15.YAxis, Amplitude=Slider(300, range=0..1000))
move_12 = Move(Geometry=deplane_15.Origin, Motion=amp_8)  # -> Geometry, Transform
ln_13 = Line(StartPoint=deplane_15.Origin, EndPoint=move_12.Geometry)
midpt_10 = CurveMiddle(Curve=ln_13)
scale_6 = Scale(Geometry=ln_13, Center=midpt_10, Factor=Slider(4.7, range=0..10))  # -> Geometry, Transform
ccx_7 = CurveCurve(CurveA=graft(scale_6.Geometry), CurveB=crv_56)  # -> flatten(Points), ParamsA, ParamsB
# 这里如果跑红也不要紧，
# 说明单体没有出现相撞的情况
move2pt_7 = MoveToPoint(Geometry=data_34, PointA=deplane_15.Origin, PointB=ccx_7.Points)  # -> Moved, Vector, Transform

crv_57 = Curve(clscrv.Closed)
offset_10 = OffsetCurve(Curve=crv_57, Distance=expr("-x", number_slider_33), Corners=1)  # -> flatten(Curve)
pull_11 = PullPoint(Point=disc_5.Points, Geometry=offset_10, ClosestOnly=True)  # -> ClosestPoint, Distance
disc_9 = Discontinuity(Curve=offset_10, Level=1)  # -> Points, Parameters
pull_12 = PullPoint(Point=flatten(pull_11.ClosestPoint), Geometry=flatten(disc_9.Points), ClosestOnly=True)  # -> ClosestPoint, Distance
check_same_points = CheckSamePoints(archPoint=flatten(pull_11.ClosestPoint), crvPoint=flatten(pull_12.ClosestPoint))  # -> out, specialPt; inputs archPoint: list of Point3d, crvPoint: list of Point3d; same code as testpoint
cull_i_7 = CullIndex(List=flatten(disc_5.Points), Indices=check_same_points.specialPt, Wrap=True)
merge_9 = Merge(Data1=end_4.Start, Data2=end_4.End, Data3=cull_i_7)
check_same_points_2 = CheckSamePoints(archPoint=flatten(flatten_5), crvPoint=flatten(merge_9))  # -> out, specialPt; inputs archPoint: list of Point3d, crvPoint: list of Point3d; same code as testpoint
cull_i_8 = CullIndex(List=flatten(flatten_5), Indices=check_same_points_2.specialPt, Wrap=True)
pull_13 = PullPoint(Point=cull_i_8, Geometry=offset_10, ClosestOnly=True)  # -> ClosestPoint, Distance
ln_14 = Line(StartPoint=cull_i_8, EndPoint=pull_13.ClosestPoint)
rotate_6 = Rotate(Geometry=ln_14, Angle="Pi", Plane=cull_i_8)  # -> Geometry, Transform
rotate_7 = Rotate(Geometry=ln_14, Angle=1.570796327, Plane=cull_i_8)  # -> Geometry, Transform
# 阳角
# 阴角
pl_5 = ConstructPlane(Origin=cull_i_8, XAxis=rotate_6.Geometry, YAxis=rotate_7.Geometry)

crv_58 = Curve(clscrv.Closed)
offset_11 = OffsetCurve(Curve=crv_58, Distance=expr("-x", Slider(84, range=0..1000)), Corners=1)  # -> flatten(Curve)
pull_14 = PullPoint(Point=disc_6.Points, Geometry=offset_11, ClosestOnly=True)  # -> ClosestPoint, Distance
disc_10 = Discontinuity(Curve=offset_11, Level=1)  # -> Points, Parameters
pull_15 = PullPoint(Point=flatten(pull_14.ClosestPoint), Geometry=flatten(disc_10.Points), ClosestOnly=True)  # -> ClosestPoint, Distance
check_same_points_3 = CheckSamePoints(archPoint=flatten(pull_14.ClosestPoint), crvPoint=flatten(pull_15.ClosestPoint))  # -> out, specialPt; inputs archPoint: list of Point3d, crvPoint: list of Point3d; same code as testpoint
cull_i_9 = CullIndex(List=flatten(disc_6.Points), Indices=check_same_points_3.specialPt, Wrap=True)
merge_10 = Merge(Data1=end_5.Start, Data2=end_5.End, Data3=cull_i_9)
check_same_points_4 = CheckSamePoints(archPoint=flatten(flatten_6), crvPoint=flatten(merge_10))  # -> out, specialPt; inputs archPoint: list of Point3d, crvPoint: list of Point3d; same code as testpoint
cull_i_10 = CullIndex(List=flatten(flatten_6), Indices=check_same_points_4.specialPt, Wrap=True)
pull_16 = PullPoint(Point=cull_i_10, Geometry=offset_11, ClosestOnly=True)  # -> ClosestPoint, Distance
ln_15 = Line(StartPoint=cull_i_10, EndPoint=pull_16.ClosestPoint)
rotate_8 = Rotate(Geometry=ln_15, Angle="Pi", Plane=cull_i_10)  # -> Geometry, Transform
rotate_9 = Rotate(Geometry=rotate_8.Geometry, Angle=-1.570796327, Plane=cull_i_10)  # -> Geometry, Transform
pl_6 = ConstructPlane(Origin=cull_i_10, XAxis=rotate_8.Geometry, YAxis=rotate_9.Geometry)

# ----
# 阳角
item_29 = ListItem(List=data_31, Index=testpoint_2.specialPt, Wrap=True)

# ----
# 阴角
cull_i_11 = CullIndex(List=data_31, Indices=testpoint_2.specialPt, Wrap=True)

dist_3 = Distance(PointA=graft(deplane_13.Origin), PointB=item_29)
sort_8 = SortList(Keys=dist_3)  # -> Keys, ValuesA
item_30 = ListItem(List=sort_8.Keys, Index=0, Wrap=True)
flatten_9 = FlattenTree(Tree=item_30, Path="{0}")
smaller_4 = SmallerThan(FirstNumber=item_30, SecondNumber=Slider(100, range=0..300))  # -> SmallerThan, OrEqualTo
panel_49 = Panel(flatten_9)
dispatch_18 = Dispatch(List=graft(pln_15), DispatchPattern=smaller_4.SmallerThan)  # -> ListA, ListB
data_35 = Data(flatten(dispatch_18.ListA))
data_36 = Data(flatten(dispatch_18.ListB))
deplane_16 = DeconstructPlane(Plane=data_35)  # -> Origin, XAxis, YAxis, ZAxis
deplane_17 = DeconstructPlane(Plane=data_36)  # -> Origin, XAxis, YAxis, ZAxis
amp_9 = Amplitude(Vector=deplane_16.YAxis, Amplitude=Slider(300, range=0..1000))
amp_10 = Amplitude(Vector=deplane_17.YAxis, Amplitude=Slider(300, range=0..1000))
move_13 = Move(Geometry=deplane_16.Origin, Motion=amp_9)  # -> Geometry, Transform
move_14 = Move(Geometry=deplane_17.Origin, Motion=amp_10)  # -> Geometry, Transform
ln_16 = Line(StartPoint=deplane_16.Origin, EndPoint=move_13.Geometry)
ln_17 = Line(StartPoint=deplane_17.Origin, EndPoint=move_14.Geometry)
midpt_11 = CurveMiddle(Curve=ln_16)
midpt_12 = CurveMiddle(Curve=ln_17)
scale_7 = Scale(Geometry=ln_16, Center=midpt_11, Factor=Slider(1.5, range=0..10))  # -> Geometry, Transform
scale_8 = Scale(Geometry=ln_17, Center=midpt_12, Factor=Slider(1.5, range=0..10))  # -> Geometry, Transform
ccx_8 = CurveCurve(CurveA=graft(scale_7.Geometry), CurveB=crv_56)  # -> flatten(Points), ParamsA, ParamsB
ccx_9 = CurveCurve(CurveA=graft(scale_8.Geometry), CurveB=crv_56)  # -> flatten(Points), ParamsA, ParamsB
move2pt_8 = MoveToPoint(Geometry=data_35, PointA=deplane_16.Origin, PointB=ccx_8.Points)  # -> Moved, Vector, Transform
move2pt_9 = MoveToPoint(Geometry=data_36, PointA=deplane_17.Origin, PointB=ccx_9.Points)  # -> Moved, Vector, Transform

clscrv_2 = CloseCurve(Curve=crv_10, CloseType=0, Bulge=0.5, Tolerance=0)  # -> Closed, R
crv_59 = Curve(crv_11)
disc_11 = Discontinuity(Curve=graft(crv_59), Level=1)  # -> Points, Parameters
crv_cp_3 = CurveClosestPoint(Point=disc_11.Points, Curve=graft(crv_59))  # -> Point, Parameter, Distance
eval_3 = EvaluateCurve(Curve=graft(crv_59), Parameter=crv_cp_3.Parameter)  # -> flatten(Point), Tangent, flatten(Angle)
deg_4 = Degrees(Radians=eval_3.Angle)
offset_12 = OffsetCurve(Curve=clscrv_2.Closed, Distance=expr("-X", Slider(300, range=0..1000)), Corners=1)
panel_50 = Panel(deg_4)
larger_6 = LargerThan(FirstNumber=deg_4, SecondNumber=Slider(60, range=0..100))  # -> LargerThan, OrEqualTo
disc_12 = Discontinuity(Curve=offset_12, Level=1)  # -> flatten(Points), Parameters
dispatch_19 = Dispatch(List=eval_3.Point, DispatchPattern=larger_6.LargerThan)  # -> ListA, ListB
data_37 = Data(dispatch_19.ListA)
pull_17 = PullPoint(Point=data_37, Geometry=flatten(offset_12), ClosestOnly=True)  # -> ClosestPoint, Distance
testpoint_4 = TestPoint(archPoint=pull_17.ClosestPoint, crvPoint=disc_12.Points)  # -> out, specialPt; inputs archPoint: list of Point3d, crvPoint: list of Point3d; same code as testpoint
pull_18 = PullPoint(Point=flatten(pln_13), Geometry=crv_59, ClosestOnly=True)  # -> ClosestPoint, Distance
pull_19 = PullPoint(Point=pull_18.ClosestPoint, Geometry=data_37, ClosestOnly=True)  # -> ClosestPoint, Distance
flatten_10 = FlattenTree(Tree=data_30, Path="{0}")
sort_9 = SortList(Keys=pull_19.Distance, ValuesA=flatten_10)  # -> Keys, ValuesA
panel_51 = Panel(sort_9.Keys)
smaller_5 = SmallerThan(FirstNumber=sort_9.Keys, SecondNumber=Slider(100, range=0..100))  # -> SmallerThan, OrEqualTo
dispatch_20 = Dispatch(List=sort_9.ValuesA, DispatchPattern=smaller_5.SmallerThan)  # -> ListA, ListB
data_38 = Data(dispatch_20.ListA)
deblock_11 = DeconstructBlock(Block=data_38)  # -> Name, Plane, Geometry
deplane_18 = DeconstructPlane(Plane=deblock_11.Plane)  # -> Origin, XAxis, YAxis, ZAxis
pt_2 = Point(data_37)
pull_20 = PullPoint(Point=deplane_18.Origin, Geometry=pt_2, ClosestOnly=True)  # -> ClosestPoint, Distance
cir_2 = Circle(Plane=pull_20.ClosestPoint, Radius=Slider(300, range=0..1000))
crv_60 = Curve(crv_59)
amp_11 = Amplitude(Vector=deplane_18.YAxis, Amplitude=Slider(200, range=0..1000))
ccx_10 = CurveCurve(CurveA=cir_2, CurveB=crv_60)  # -> Points, ParamsA, ParamsB
move_15 = Move(Geometry=pull_20.ClosestPoint, Motion=amp_11)  # -> Geometry, Transform
item_31 = ListItem(List=ccx_10.Points, Index=0, Wrap=True)
clean_2 = CleanTree(RemoveNulls=True, RemoveInvalid=True, RemoveEmpty=Toggle(True), Tree=item_31)
item_32 = ListItem(List=data_37, Index=testpoint_4.specialPt, Wrap=True)
cull_i_12 = CullIndex(List=data_37, Indices=testpoint_4.specialPt, Wrap=True)
ln_18 = Line(StartPoint=pull_20.ClosestPoint, EndPoint=clean_2)
ln_19 = Line(StartPoint=pull_20.ClosestPoint, EndPoint=move_15.Geometry)
angle_2 = Angle(VectorA=ln_19, VectorB=ln_18)  # -> Angle, Reflex
deg_5 = Degrees(Radians=angle_2.Angle)
flatten_11 = FlattenTree(Tree=deg_5, Path="{0}")
panel_52 = Panel(flatten_11)
c_script_2 = CSharpScript(angle=flatten_11, minus=Slider(80, range=0..100))  # -> out, results; inputs angle: list of Double, minus: Double; same code as c_script
larger_7 = LargerThan(FirstNumber=c_script_2.results, SecondNumber=Slider(30, range=0..100))  # -> LargerThan, OrEqualTo
panel_53 = Panel(c_script_2.results)
dispatch_21 = Dispatch(List=flatten(data_38), DispatchPattern=flatten(larger_7.LargerThan))  # -> ListA, ListB
data_39 = Data(dispatch_21.ListA)
deblock_12 = DeconstructBlock(Block=data_39)  # -> Name, Plane, Geometry
pln_17 = Plane(flatten(pln_13))
deplane_19 = DeconstructPlane(Plane=flatten(deblock_12.Plane))  # -> Origin, XAxis, YAxis, ZAxis
deplane_20 = DeconstructPlane(Plane=pln_17)  # -> Origin, XAxis, YAxis, ZAxis
testpoint_5 = TestPoint(archPoint=deplane_20.Origin, crvPoint=deplane_19.Origin)  # -> out, specialPt; inputs archPoint: list of Point3d, crvPoint: list of Point3d; same code as testpoint
cull_i_13 = CullIndex(List=pln_17, Indices=testpoint_5.specialPt, Wrap=True)
pln_18 = Plane(deblock_12.Plane)
dist_4 = Distance(PointA=graft(deplane_19.Origin), PointB=item_32)
sort_10 = SortList(Keys=dist_4)  # -> Keys, ValuesA
item_33 = ListItem(List=sort_10.Keys, Index=0, Wrap=True)
flatten_12 = FlattenTree(Tree=item_33, Path="{0}")
smaller_6 = SmallerThan(FirstNumber=item_33, SecondNumber=Slider(100, range=0..300))  # -> SmallerThan, OrEqualTo
panel_54 = Panel(flatten_12)
dispatch_22 = Dispatch(List=graft(pln_18), DispatchPattern=smaller_6.SmallerThan)  # -> ListA, ListB
crv_61 = Curve(crv_11)
pln_19 = Plane(cull_i_13)

data_40 = Data(flatten(dispatch_22.ListB))
deplane_21 = DeconstructPlane(Plane=data_40)  # -> Origin, XAxis, YAxis, ZAxis
amp_12 = Amplitude(Vector=deplane_21.YAxis, Amplitude=Slider(300, range=0..1000))
move_16 = Move(Geometry=deplane_21.Origin, Motion=amp_12)  # -> Geometry, Transform
ln_20 = Line(StartPoint=deplane_21.Origin, EndPoint=move_16.Geometry)
midpt_13 = CurveMiddle(Curve=ln_20)
scale_9 = Scale(Geometry=ln_20, Center=midpt_13, Factor=Slider(1.5, range=0..10))  # -> Geometry, Transform
ccx_11 = CurveCurve(CurveA=graft(scale_9.Geometry), CurveB=crv_61)  # -> flatten(Points), ParamsA, ParamsB

data_41 = Data(flatten(dispatch_22.ListA))
deplane_22 = DeconstructPlane(Plane=data_41)  # -> Origin, XAxis, YAxis, ZAxis
amp_13 = Amplitude(Vector=deplane_22.YAxis, Amplitude=Slider(300, range=0..1000))
move_17 = Move(Geometry=deplane_22.Origin, Motion=amp_13)  # -> Geometry, Transform
ln_21 = Line(StartPoint=deplane_22.Origin, EndPoint=move_17.Geometry)
midpt_14 = CurveMiddle(Curve=ln_21)
scale_10 = Scale(Geometry=ln_21, Center=midpt_14, Factor=Slider(1.5, range=0..10))  # -> Geometry, Transform
ccx_12 = CurveCurve(CurveA=graft(scale_10.Geometry), CurveB=crv_61)  # -> flatten(Points), ParamsA, ParamsB

data_42 = Data(flatten(pln_19))
deplane_23 = DeconstructPlane(Plane=data_42)  # -> Origin, XAxis, YAxis, ZAxis
amp_14 = Amplitude(Vector=deplane_23.YAxis, Amplitude=Slider(300, range=0..1000))
move_18 = Move(Geometry=deplane_23.Origin, Motion=amp_14)  # -> Geometry, Transform
ln_22 = Line(StartPoint=deplane_23.Origin, EndPoint=move_18.Geometry)
midpt_15 = CurveMiddle(Curve=ln_22)
scale_11 = Scale(Geometry=ln_22, Center=midpt_15, Factor=Slider(4.7, range=0..10))  # -> Geometry, Transform
ccx_13 = CurveCurve(CurveA=graft(scale_11.Geometry), CurveB=crv_61)  # -> flatten(Points), ParamsA, ParamsB

move2pt_10 = MoveToPoint(Geometry=data_42, PointA=deplane_23.Origin, PointB=ccx_13.Points)  # -> Moved, Vector, Transform
move2pt_11 = MoveToPoint(Geometry=data_41, PointA=deplane_22.Origin, PointB=ccx_12.Points)  # -> Moved, Vector, Transform
move2pt_12 = MoveToPoint(Geometry=data_40, PointA=deplane_21.Origin, PointB=ccx_11.Points)  # -> Moved, Vector, Transform
xy_19 = XYPlane(Origin=move2pt_10.Moved)
xy_20 = XYPlane(Origin=move2pt_11.Moved)
xy_21 = XYPlane(Origin=move2pt_12.Moved)
rotate_10 = Rotate(Geometry=move2pt_10.Moved, Angle="Pi", Plane=xy_19)  # -> Geometry, Transform
rotate_11 = Rotate(Geometry=move2pt_11.Moved, Angle="Pi", Plane=xy_20)  # -> Geometry, Transform
rotate_12 = Rotate(Geometry=move2pt_12.Moved, Angle="Pi", Plane=xy_21)  # -> Geometry, Transform
filter_13 = StreamFilter(Gate=Toggle(True), Stream0=move2pt_11.Moved, Stream1=rotate_11.Geometry)
filter_14 = StreamFilter(Gate=Toggle(True), Stream0=move2pt_12.Moved, Stream1=rotate_12.Geometry)
filter_15 = StreamFilter(Gate=Toggle(True), Stream0=move2pt_10.Moved, Stream1=rotate_10.Geometry)

# ----
# 三视图
# hidden lines of top+pers view
# move to center
# 如果无法完整的生成埋件的三视图，
# 建议选择埋件的3D在Rhino中将
# Top/Perspective/Front/Right 试图缩放至合适大小后重新运行
panel_55 = Panel("""Top
Perspective
Front
Right""")
m2d_rhino = Make2DRhinoView(Name=panel_55, Clip=True)
number_slider_34 = Slider(1, range=0..10)
pt_3 = Point(Point(957.9296072, 367.7685097, 0))
pt_4 = Point("0,0,0")
recgrid_2 = Rectangular(
    Plane=pt_3,
    SizeX=Slider(12, range=1..20, expression="X*50"),
    SizeY=Slider(10, range=1..20, expression="X*50"),
    ExtentX=number_slider_34,
    ExtentY=number_slider_34)  # -> Cells, Points
flatten_13 = FlattenTree(Tree=recgrid_2.Points, Path="{0}")

# ----
# （6）生成板埋埋件
# 
# 注意：
# 1.记得点一下Compute按钮
# 2.如果无法完整的生成埋件的三视图，
# 建议选择埋件的3D在Rhino中将
# Top/Perspective/Front/Right 试图缩放至合适大小后重新运行
# 板埋几何INPUT
make2d = Make2D(Geometry=move_10.Geometry, View=m2d_rhino, TangentEdges=False, TangentSeams=False, AutoComputeMake2D=False)  # -> VisibleCurves, VisibleIndex, VisibleType, HiddenCurves, HiddenIndex, HiddenType

bang = ExplodeTree(Data=make2d.VisibleCurves)  # -> Branch0, Branch1, Branch2, Branch3, Branch4, Branch5, Branch6, Branch7
divdist = DivideDistance(Curve=make2d.HiddenCurves, Distance=Slider(1, range=0..10))  # -> Points, Tangents, Parameters
graft_2 = GraftTree(Tree=make2d.HiddenCurves, IncludeEmptyLists=True, IncludeNullItems=True)
shatter = Shatter(Curve=graft_2, Parameters=divdist.Parameters)
dispatch_23 = Dispatch(List=shatter, DispatchPattern=[True, False])  # -> ListA, ListB
crv_62 = Curve(dispatch_23.ListA)
pshift = ShiftPaths(Data=crv_62, Offset=-1)
pshift_2 = ShiftPaths(Data=pshift, Offset=-1)
bang_2 = ExplodeTree(Data=pshift_2)  # -> Branch0, Branch1, Branch2, Branch3, Branch4, Branch5, Branch6, Branch7
entwine_7 = Entwine(Branch00=bang_2.Branch0, Branch01=bang.Branch0, FlattenInputs=True)  # -> flatten(Result)
entwine_8 = Entwine(Branch00=bang_2.Branch1, Branch01=bang.Branch1, FlattenInputs=True)  # -> flatten(Result)
entwine_9 = Entwine(Branch00=entwine_7, Branch01=entwine_8, Branch02=bang.Branch2, Branch03=bang.Branch3, FlattenInputs=True)
group_3 = Group(Objects=entwine_9)
pshift_3 = ShiftPaths(Data=group_3, Offset=-1)
pshift_4 = ShiftPaths(Data=group_3, Offset=-1)
boxprop = BoxProperties(Box=pshift_3)  # -> Center, Diagonal, Area, Volume, Degeneracy
vec2pt = Vector2Pt(PointA=boxprop.Center, PointB=pt_4, Unitize=False)  # -> Vector, Length
move_19 = Move(Geometry=pshift_4, Motion=vec2pt.Vector)  # -> flatten(Geometry), Transform
orient = Orient(Geometry=flatten(move_19.Geometry), Source=PlaneXY(0, 0, 0), Target=flatten_13)  # -> Geometry, Transform
cull_i_14 = CullIndex(List=orient.Geometry, Indices="-1", Wrap=True)
split_3 = SplitList(List=cull_i_14, Index="4")  # -> ListA, ListB
# 阳角
# 阴角
geo_6 = Geometry(split_3.ListA)

# ---- group: 单体定Top/Side
item_34 = ListItem(List=geo_6, Index=Slider(0, range=0..10), Wrap=True)
item_35 = ListItem(List=geo_6, Index=2, Wrap=True)
cluster_7 = Cluster(G=item_34)
cluster_8 = Cluster(G=item_35)

# ----
dist_5 = Distance(PointA=pull_6.ClosestPoint, PointB=data_31)
sort_11 = SortList(Keys=dist_5)  # -> Keys, ValuesA
panel_56 = Panel(sort_11.Keys)
smaller_7 = SmallerThan(FirstNumber=dist_5, SecondNumber=Slider(200, range=0..1000))  # -> SmallerThan, OrEqualTo
dispatch_24 = Dispatch(List=geo_5, DispatchPattern=smaller_7.SmallerThan)  # -> ListA, ListB
data_43 = Data(dispatch_24.ListB)
explode_4 = Explode(Curve=data_43, Recursive=True)  # -> Segments, Vertices
len_4 = Length(Curve=explode_4.Segments)
sort_12 = SortList(Keys=reverse(len_4), ValuesA=explode_4.Segments)  # -> Keys, ValuesA
item_36 = ListItem(List=sort_12.ValuesA, Index=0, Wrap=True)  # -> flatten(Item)
area_8 = Area(Geometry=data_43)  # -> Area, Centroid
midpt_16 = CurveMiddle(Curve=item_36)
move2pt_13 = MoveToPoint(Geometry=item_36, PointA=midpt_16, PointB=area_8.Centroid)  # -> Moved, Vector, Transform
end_6 = EndPoints(Curve=move2pt_13.Moved)  # -> Start, End
pull_21 = PullPoint(Point=end_6.Start, Geometry=crv_50, ClosestOnly=True)  # -> ClosestPoint, Distance
crv_cp_4 = CurveClosestPoint(Point=graft(pull_21.ClosestPoint), Curve=crv_50)  # -> Point, Parameter, Distance
eval_4 = EvaluateCurve(Curve=crv_50, Parameter=crv_cp_4.Parameter)  # -> Point, Tangent, Angle
pull_22 = PullPoint(Point=eval_4.Point, Geometry=pull_21.ClosestPoint, ClosestOnly=True)  # -> ClosestPoint, Distance
sort_13 = SortList(Keys=pull_22.Distance, ValuesA=eval_4.Point)  # -> Keys, ValuesA
sort_14 = SortList(Keys=pull_22.Distance, ValuesA=eval_4.Tangent)  # -> Keys, ValuesA
item_37 = ListItem(List=sort_14.ValuesA, Index="0", Wrap=True)
item_38 = ListItem(List=sort_13.ValuesA, Index="0", Wrap=True)
amp_15 = Amplitude(Vector=item_37, Amplitude=Slider(100, range=0..100))
move_20 = Move(Geometry=item_38, Motion=amp_15)  # -> Geometry, Transform
xy_22 = XYPlane(Origin=item_38)
rotate_13 = Rotate(Geometry=move_20.Geometry, Angle="1 * Pi", Plane=xy_22)  # -> Geometry, Transform
ln_23 = Line(StartPoint=item_38, EndPoint=rotate_13.Geometry)
rotate_14 = Rotate(Geometry=ln_23, Angle=filter_12, Plane=xy_22)  # -> Geometry, Transform
pl_7 = ConstructPlane(Origin=move_20.Geometry, XAxis=ln_23, YAxis=rotate_14.Geometry)

# ----
# 转角点
data_44 = Data(dispatch_24.ListA)

explode_5 = Explode(Curve=data_44, Recursive=True)  # -> Segments, Vertices
len_5 = Length(Curve=explode_5.Segments)
sort_15 = SortList(Keys=reverse(len_5), ValuesA=explode_5.Segments)  # -> Keys, ValuesA
item_39 = ListItem(List=sort_15.ValuesA, Index=0, Wrap=True)  # -> flatten(Item)
area_9 = Area(Geometry=data_44)  # -> Area, Centroid
midpt_17 = CurveMiddle(Curve=item_39)
move2pt_14 = MoveToPoint(Geometry=item_39, PointA=midpt_17, PointB=area_9.Centroid)  # -> Moved, Vector, Transform
end_7 = EndPoints(Curve=move2pt_14.Moved)  # -> Start, End
ln_24 = Line(StartPoint=end_7.Start, EndPoint=end_7.End)
xy_23 = XYPlane(Origin=end_7.End)
rotate_15 = Rotate(Geometry=ln_24, Angle=filter_11, Plane=xy_23)  # -> Geometry, Transform
pl_8 = ConstructPlane(Origin=end_7.End, XAxis=rotate_15.Geometry, YAxis=ln_24)
dist_6 = Distance(PointA=graft(end_7.End), PointB=item_29)
sort_16 = SortList(Keys=dist_6)  # -> Keys, ValuesA
item_40 = ListItem(List=sort_16.Keys, Index=0, Wrap=True)
smaller_8 = SmallerThan(FirstNumber=item_40, SecondNumber=Slider(100, range=0..300))  # -> SmallerThan, OrEqualTo
flatten_14 = FlattenTree(Tree=item_40, Path="{0}")
dispatch_25 = Dispatch(List=graft(pl_8), DispatchPattern=smaller_8.SmallerThan)  # -> ListA, ListB
panel_57 = Panel(flatten_14)
data_45 = Data(flatten(dispatch_25.ListA))
data_46 = Data(flatten(dispatch_25.ListB))
deplane_24 = DeconstructPlane(Plane=data_45)  # -> Origin, XAxis, YAxis, ZAxis
deplane_25 = DeconstructPlane(Plane=data_46)  # -> Origin, XAxis, YAxis, ZAxis
amp_16 = Amplitude(Vector=deplane_24.YAxis, Amplitude=Slider(300, range=0..1000))
amp_17 = Amplitude(Vector=deplane_25.YAxis, Amplitude=Slider(300, range=0..1000))
move_21 = Move(Geometry=deplane_24.Origin, Motion=amp_16)  # -> Geometry, Transform
move_22 = Move(Geometry=deplane_25.Origin, Motion=amp_17)  # -> Geometry, Transform
ln_25 = Line(StartPoint=deplane_24.Origin, EndPoint=move_21.Geometry)
ln_26 = Line(StartPoint=deplane_25.Origin, EndPoint=move_22.Geometry)
midpt_18 = CurveMiddle(Curve=ln_25)
midpt_19 = CurveMiddle(Curve=ln_26)
scale_12 = Scale(Geometry=ln_25, Center=midpt_18, Factor=Slider(1.5, range=0..10))  # -> Geometry, Transform
scale_13 = Scale(Geometry=ln_26, Center=midpt_19, Factor=Slider(1.5, range=0..10))  # -> Geometry, Transform
ccx_14 = CurveCurve(CurveA=graft(scale_13.Geometry), CurveB=crv_51)  # -> flatten(Points), ParamsA, ParamsB
ccx_15 = CurveCurve(CurveA=graft(scale_12.Geometry), CurveB=crv_51)  # -> flatten(Points), ParamsA, ParamsB
move2pt_15 = MoveToPoint(Geometry=data_45, PointA=deplane_24.Origin, PointB=ccx_15.Points)  # -> Moved, Vector, Transform
move2pt_16 = MoveToPoint(Geometry=data_46, PointA=deplane_25.Origin, PointB=ccx_14.Points)  # -> Moved, Vector, Transform

# ----
# 阴阳角
number_slider_35 = Slider(1000, range=0..1000)
cir_3 = Circle(Plane=move2pt_8.Moved, Radius=number_slider_35)
cir_4 = Circle(Plane=move2pt_9.Moved, Radius=number_slider_35)
cir_5 = Circle(Plane=filter_13, Radius=1)
cir_6 = Circle(Plane=filter_13, Radius=number_slider_35)
cir_7 = Circle(Plane=move2pt_15.Moved, Radius=number_slider_35)
cir_8 = Circle(Plane=move2pt_16.Moved, Radius=number_slider_35)
merge_11 = Merge(Data1=cir_3, Data2=cir_4, Data3=cir_5, Data4=cir_6, Data5=cir_7, Data6=cir_8)

data_47 = Data(merge_11)
bake = BakeObjects(Geometry=data_47, Attributes=attributes_9, BakeName="阴阳角定位", Bake=False)

# ----
# SIte-所有的定位点
merge_12 = Merge(Data1=move2pt_7.Moved, Data2=filter_15, Data3=pl_7, Data4=pl_6, Data5=pl_4, Data6=pl_5)  # -> flatten(Result)

ungroup_2 = Ungroup(Group=cluster_8)
ungroup_3 = Ungroup(Group=cluster_7)

# ---- group: Top/Side
filter_16 = StreamFilter(Gate=list_6, Stream0=ungroup_3, Stream1=ungroup_2)

# ---- group: Block
# 自定义块所在图层
# 自定义块所在图层颜色
# 自定义块名称
panel_58 = Panel("Embeded::Embeded Board")
layer_16 = DefineLayer(Name=panel_58, Color=ColourSwatch(SwatchColor=RGB(255, 0, 0)))
attributes_11 = DefineObjectAttributes(Layer=layer_16)
block_2 = DefineBlock(Geometry=ungroup_3, Attributes=attributes_11, BlockName="Board Plate", BasePlane=PlaneXY(0, 0, 0))

# ----
deblock_13 = DeconstructBlock(Block=block_2)  # -> Name, flatten(Plane), flatten(Geometry)
boundary_3 = BoundarySurfaces(Edges=deblock_13.Geometry)
deplane_26 = DeconstructPlane(Plane=deblock_13.Plane)  # -> Origin, XAxis, YAxis, ZAxis
area_10 = Area(Geometry=boundary_3)  # -> Area, Centroid
move2pt_17 = MoveToPoint(Geometry=flatten(deplane_26.Origin), PointA=flatten(deplane_26.Origin), PointB=flatten(area_10.Centroid))  # -> Moved, Vector, Transform
pl_9 = ConstructPlane(Origin=move2pt_17.Moved, XAxis=deplane_26.XAxis, YAxis=deplane_26.YAxis)  # -> graft(Plane)
# SmoothCurve-阴角
# SmoothCurve-阳角
# SmoothCurve-阴角
# SmoothCurve-正常
# Angular Curve - All
# Special Curve(with location)- All
# Curve for this project only - All
entwine_10 = Entwine(Branch00=block_2, Branch01=pl_9, FlattenInputs=True)

flip = FlipMatrix(Data=entwine_10)
item_41 = ListItem(List=flip, Index=0, Wrap=True)
item_42 = ListItem(List=flip, Index="-1", Wrap=True)

# ----
# 1.是否有檐口线
toggle_4 = BooleanToggle(True)
clean_3 = CleanTree(RemoveNulls=True, RemoveInvalid=True, RemoveEmpty=toggle_4, Tree=merge_12)
crv_63 = Curve(crv_8)
deplane_27 = DeconstructPlane(Plane=clean_3)  # -> Origin, XAxis, YAxis, ZAxis
incurve = PointInCurve(Point=deplane_27.Origin, Curve=crv_63)  # -> Relationship, Point
equals_2 = Equality(FirstNumber=incurve.Relationship, SecondNumber="2")  # -> Equality, Inequality
dispatch_26 = Dispatch(List=clean_3, DispatchPattern=equals_2.Equality)  # -> ListA, ListB
crv_64 = Curve(crv_5)
crv_65 = Curve(crv_9)
merge_13 = Merge(Data1=crv_65, Data2=crv_64)

# ----
# Site - 无檐口线的定位点
pln_20 = Plane(dispatch_26.ListB)

# ----
# Site - 有檐口线的定位点
pln_21 = Plane(dispatch_26.ListA)

incurves = PointInCurves(Point=pln_21, Curves=crv_64)  # -> Relationship, Index, Point
incurves_2 = PointInCurves(Point=pln_21, Curves=merge_13)  # -> Relationship, Index, Point
equals_3 = Equality(FirstNumber=incurves_2.Relationship, SecondNumber="2")  # -> Equality, Inequality
equals_4 = Equality(FirstNumber=incurves.Relationship, SecondNumber="0")  # -> Equality, Inequality
dispatch_27 = Dispatch(List=pln_21, DispatchPattern=equals_3.Equality)  # -> ListA, ListB
dispatch_28 = Dispatch(List=pln_21, DispatchPattern=equals_4.Inequality)  # -> ListA, ListB
pln_22 = Plane(dispatch_27.ListB)

# ----
# 檐口出特殊处理:
# 比如作为吊顶处理
# +车道处特殊处理
pln_23 = Plane(dispatch_27.ListA)

# ----
# 车道处特殊处理
pln_24 = Plane(dispatch_28.ListA)

# ----
# 1.1有檐口线
pln_25 = Plane(pln_22)

# ----
# 1.0无檐口线初筛
pln_26 = Plane(pln_20)

deplane_28 = DeconstructPlane(Plane=pln_26)  # -> Origin, XAxis, YAxis, ZAxis
crv_66 = Curve(crv_32)
incurves_3 = PointInCurves(Point=deplane_28.Origin, Curves=flatten(crv_66))  # -> Relationship, Index, Point
equals_5 = Equality(FirstNumber=incurves_3.Relationship, SecondNumber="2")  # -> Equality, Inequality
dispatch_29 = Dispatch(List=pln_26, DispatchPattern=equals_5.Equality)  # -> ListA, ListB
crv_67 = Curve(crv_65)
data_48 = Data(dispatch_29.ListB)

# ----
# 1.1.1布埋件
pln_27 = Plane(pln_25)

# ----
# 1.1 有檐口-整个site一起处理
deplane_29 = DeconstructPlane(Plane=pln_27)  # -> Origin, XAxis, YAxis, ZAxis
amp_18 = Amplitude(Vector=deplane_29.YAxis, Amplitude=number_slider_18)
move_23 = Move(Geometry=deplane_29.Origin, Motion=amp_18)  # -> Geometry, Transform
ln_27 = Line(StartPoint=deplane_29.Origin, EndPoint=move_23.Geometry)
ccx_16 = CurveCurve(CurveA=graft(ln_27), CurveB=flatten(merge_4))  # -> Points, ParamsA, ParamsB
shift_2 = ShiftPaths(Data=ccx_16.Points, Offset=-1)
sort_17 = SortList(Keys=shift_2, ValuesA=shift_2)  # -> Keys, ValuesA
pull_23 = PullPoint(Point=sort_17.ValuesA, Geometry=graft(deplane_29.Origin), ClosestOnly=True)  # -> ClosestPoint, Distance
sort_18 = SortList(Keys=pull_23.Distance, ValuesA=sort_17.ValuesA)  # -> Keys, ValuesA
item_43 = ListItem(List=sort_18.ValuesA, Index="-1", Wrap=True)
null_6 = NullItem(Item=flatten(item_43))  # -> NullFlags, InvalidFlags, Description
crv_68 = Curve(shift)
dispatch_30 = Dispatch(List=item_43, DispatchPattern=item_43)  # -> ListA, ListB
dispatch_31 = Dispatch(List=pln_27, DispatchPattern=null_6.InvalidFlags)  # -> ListA, ListB
data_49 = Data(dispatch_30.ListA)
data_50 = Data(dispatch_31.ListB)
check_same_points_5 = CheckSamePoints(archPoint=pln_27, crvPoint=data_50)  # -> out, specialPt; inputs archPoint: list of Point3d, crvPoint: list of Point3d; same code as testpoint

pln_28 = Plane(dispatch_29.ListA)
incurves_4 = PointInCurves(Point=pln_28, Curves=flatten(crv_67))  # -> Relationship, Index, Point
equals_6 = Equality(FirstNumber=incurves_4.Relationship, SecondNumber="0")  # -> Equality, Inequality
dispatch_32 = Dispatch(List=pln_28, DispatchPattern=equals_6.Equality)  # -> ListA, ListB
pln_29 = Plane(dispatch_32.ListB)

# ----
# 1.0无檐口线
pln_30 = Plane(dispatch_32.ListA)

# ----
# 1.0 无檐口线+上下层幕墙边线连续
crv_69 = Curve(crv_6)
pln_31 = Plane(pln_30)
crv_70 = Curve(crv_7)
deplane_30 = DeconstructPlane(Plane=pln_31)  # -> Origin, XAxis, YAxis, ZAxis
number_slider_36 = Slider(3584, range=0..10000)
amp_19 = Amplitude(Vector=deplane_30.YAxis, Amplitude=number_slider_36)
amp_20 = Amplitude(Vector=deplane_30.YAxis, Amplitude=expr("-x", number_slider_36))
move_24 = Move(Geometry=deplane_30.Origin, Motion=amp_19)  # -> Geometry, Transform
move_25 = Move(Geometry=deplane_30.Origin, Motion=amp_20)  # -> Geometry, Transform
ln_28 = Line(StartPoint=move_25.Geometry, EndPoint=move_24.Geometry)
ccx_17 = CurveCurve(CurveA=ln_28, CurveB=crv_70)  # -> flatten(Points), ParamsA, ParamsB
ccx_18 = CurveCurve(CurveA=ln_28, CurveB=crv_69)  # -> flatten(Points), ParamsA, ParamsB
pull_24 = PullPoint(Point=ccx_18.Points, Geometry=ccx_17.Points, ClosestOnly=True)  # -> ClosestPoint, Distance
sort_19 = SortList(Keys=pull_24.Distance, ValuesA=pull_24.ClosestPoint)  # -> Keys, ValuesA
pln_32 = Plane(pln_31)
panel_59 = Panel(sort_19.Keys)
larger_8 = LargerThan(FirstNumber=sort_19.Keys, SecondNumber=Slider(1.1, range=0..10))  # -> LargerThan, OrEqualTo
dispatch_33 = Dispatch(List=sort_19.ValuesA, DispatchPattern=larger_8.LargerThan)  # -> ListA, ListB
pt_5 = Point(dispatch_33.ListB)
pt_6 = Point(dispatch_33.ListA)
pull_25 = PullPoint(Point=deplane_30.Origin, Geometry=graft(pt_5), ClosestOnly=True)  # -> ClosestPoint, Distance
sort_20 = SortList(Keys=pull_25.Distance, ValuesA=pln_32)  # -> Keys, ValuesA
item_44 = ListItem(List=sort_20.ValuesA, Index=0, Wrap=True)
check_same_points_6 = CheckSamePoints(archPoint=pln_32, crvPoint=flatten(item_44))  # -> out, specialPt; inputs archPoint: list of Point3d, crvPoint: list of Point3d; same code as testpoint
item_45 = ListItem(List=pln_32, Index=check_same_points_6.specialPt, Wrap=True)
deplane_31 = DeconstructPlane(Plane=item_45)  # -> Origin, XAxis, YAxis, ZAxis
amp_21 = Amplitude(Vector=deplane_31.YAxis, Amplitude=expr("-x", Slider(2756, range=0..10000)))
crv_71 = Curve(merge_4)
move_26 = Move(Geometry=deplane_31.Origin, Motion=amp_21)  # -> Geometry, Transform
ln_29 = Line(StartPoint=deplane_31.Origin, EndPoint=move_26.Geometry)
ccx_19 = CurveCurve(CurveA=graft(ln_29), CurveB=flatten(crv_71))  # -> Points, ParamsA, ParamsB
shift_3 = ShiftPaths(Data=ccx_19.Points, Offset=-1)
pull_26 = PullPoint(Point=deplane_31.Origin, Geometry=shift_3, ClosestOnly=True)  # -> ClosestPoint, Distance
sort_21 = SortList(Keys=pull_26.Distance, ValuesA=pull_26.ClosestPoint)  # -> Keys, ValuesA
item_46 = ListItem(List=sort_21.ValuesA, Index=0, Wrap=True)
null_7 = NullItem(Item=flatten(item_46))  # -> NullFlags, InvalidFlags, Description
dispatch_34 = Dispatch(List=item_45, DispatchPattern=null_7.InvalidFlags)  # -> ListA, ListB
dispatch_35 = Dispatch(List=item_46, DispatchPattern=item_46)  # -> ListA, ListB
data_51 = Data(dispatch_34.ListB)
data_52 = Data(dispatch_35.ListA)
flatten_15 = FlattenTree(Tree=data_52, Path="{0}")
ln_30 = Line(StartPoint=data_51, EndPoint=flatten_15)
len_6 = Length(Curve=ln_30)
sort_22 = SortList(Keys=len_6)  # -> reverse(Keys), ValuesA
move2pt_18 = MoveToPoint(Geometry=data_51, PointA=data_51, PointB=flatten(data_52))  # -> Moved, Vector, Transform

# ----
# 按照梁分类定位点
pt_7 = Point(data_49)
incurves_5 = PointInCurves(Point=flatten(pt_7), Curves=crv_68)  # -> Relationship, Index, Point
equals_7 = Equality(FirstNumber=incurves_5.Relationship, SecondNumber="0")  # -> Equality, Inequality
dispatch_36 = Dispatch(List=flatten(pt_7), DispatchPattern=equals_7.Inequality)  # -> ListA, ListB
data_53 = Data(dispatch_36.ListA)

# ----
# 按照梁分类定位点
pt_8 = Point(data_49)
incurves_6 = PointInCurves(Point=flatten(pt_8), Curves=crv_68)  # -> Relationship, Index, Point
equals_8 = Equality(FirstNumber=incurves_6.Relationship, SecondNumber="0")  # -> Equality, Inequality
dispatch_37 = Dispatch(List=flatten(data_50), DispatchPattern=equals_8.Inequality)  # -> ListA, ListB
data_54 = Data(dispatch_37.ListA)

move2pt_19 = MoveToPoint(Geometry=data_54, PointA=data_54, PointB=data_53)  # -> Moved, Vector, Transform
null_8 = NullItem(Item=move2pt_19.Moved)  # -> NullFlags, InvalidFlags, Description
dispatch_38 = Dispatch(List=move2pt_19.Moved, DispatchPattern=null_8.InvalidFlags)  # -> ListA, ListB

# ----
# 0无檐口线
# 与梁不相交
cull_i_15 = CullIndex(List=pln_27, Indices=check_same_points_5.specialPt, Wrap=True)

# ----
# 0 檐口出定位点
# 与结构无交点
pln_33 = Plane(cull_i_15)

# ----
# 0.Missing Point
# 埋件定位点Offset，没有找到和梁的交点
number_slider_37 = Slider(5000, range=0..10000)
deplane_32 = DeconstructPlane(Plane=pln_33)  # -> Origin, XAxis, YAxis, ZAxis
amp_22 = Amplitude(Vector=deplane_32.YAxis, Amplitude=number_slider_37)
move_27 = Move(Geometry=deplane_32.Origin, Motion=amp_22)  # -> Geometry, Transform
ln_31 = Line(StartPoint=move_27.Geometry, EndPoint=deplane_32.Origin)
amp_23 = Amplitude(Vector=deplane_32.XAxis, Amplitude=number_slider_6)
amp_24 = Amplitude(Vector=deplane_32.XAxis, Amplitude=expr("-x", number_slider_6))
move_28 = Move(Geometry=ln_31, Motion=amp_23)  # -> Geometry, Transform
move_29 = Move(Geometry=ln_31, Motion=amp_24)  # -> Geometry, Transform

ccx_20 = CurveCurve(CurveA=graft(move_29.Geometry), CurveB=flatten(merge_4))  # -> Points, ParamsA, ParamsB
shift_4 = ShiftPaths(Data=ccx_20.Points, Offset=-1)
sort_23 = SortList(Keys=shift_4, ValuesA=shift_4)  # -> Keys, ValuesA
pull_27 = PullPoint(Point=sort_23.ValuesA, Geometry=graft(pln_33), ClosestOnly=True)  # -> ClosestPoint, Distance
sort_24 = SortList(Keys=pull_27.Distance, ValuesA=sort_23.ValuesA)  # -> Keys, ValuesA
item_47 = ListItem(List=sort_24.ValuesA, Index="-1", Wrap=True)
null_9 = NullItem(Item=flatten(item_47))  # -> NullFlags, InvalidFlags, Description
dispatch_39 = Dispatch(List=simplify(item_47), DispatchPattern=simplify(graft(null_9.InvalidFlags)))  # -> ListA, ListB
dispatch_40 = Dispatch(List=pln_33, DispatchPattern=null_9.InvalidFlags)  # -> ListA, ListB
pln_34 = Plane(dispatch_40.ListB)
pt_9 = Point(dispatch_39.ListB)

ccx_21 = CurveCurve(CurveA=graft(move_28.Geometry), CurveB=flatten(merge_4))  # -> Points, ParamsA, ParamsB
shift_5 = ShiftPaths(Data=ccx_21.Points, Offset=-1)
sort_25 = SortList(Keys=shift_5, ValuesA=shift_5)  # -> Keys, ValuesA
pull_28 = PullPoint(Point=sort_25.ValuesA, Geometry=graft(pln_33), ClosestOnly=True)  # -> ClosestPoint, Distance
sort_26 = SortList(Keys=pull_28.Distance, ValuesA=sort_25.ValuesA)  # -> Keys, ValuesA
item_48 = ListItem(List=sort_26.ValuesA, Index="-1", Wrap=True)
null_10 = NullItem(Item=flatten(item_48))  # -> NullFlags, InvalidFlags, Description
dispatch_41 = Dispatch(List=simplify(item_48), DispatchPattern=simplify(graft(null_10.InvalidFlags)))  # -> ListA, ListB
dispatch_42 = Dispatch(List=pln_33, DispatchPattern=null_10.InvalidFlags)  # -> ListA, ListB
pln_35 = Plane(dispatch_42.ListB)
pt_10 = Point(dispatch_41.ListB)

# ----
# 按照梁分类定位点
pln_36 = Plane(pln_34)
pt_11 = Point(pt_9)
incurves_7 = PointInCurves(Point=flatten(pt_11), Curves=crv_35)  # -> Relationship, Index, Point
equals_9 = Equality(FirstNumber=incurves_7.Relationship, SecondNumber="0")  # -> Equality, Inequality
dispatch_43 = Dispatch(List=flatten(pln_36), DispatchPattern=equals_9.Inequality)  # -> ListA, ListB
data_55 = Data(dispatch_43.ListA)

# ----
# 按照梁分类定位点
pt_12 = Point(pt_9)
incurves_8 = PointInCurves(Point=flatten(pt_12), Curves=crv_35)  # -> Relationship, Index, Point
equals_10 = Equality(FirstNumber=incurves_8.Relationship, SecondNumber="0")  # -> Equality, Inequality
dispatch_44 = Dispatch(List=flatten(pt_12), DispatchPattern=equals_10.Inequality)  # -> ListA, ListB
data_56 = Data(dispatch_44.ListA)

# ----
# 按照梁分类定位点
pln_37 = Plane(pln_35)
pt_13 = Point(pt_10)
incurves_9 = PointInCurves(Point=flatten(pt_13), Curves=crv_35)  # -> Relationship, Index, Point
equals_11 = Equality(FirstNumber=incurves_9.Relationship, SecondNumber="0")  # -> Equality, Inequality
dispatch_45 = Dispatch(List=flatten(pln_37), DispatchPattern=equals_11.Inequality)  # -> ListA, ListB
data_57 = Data(dispatch_45.ListA)

# ----
# 按照梁分类定位点
pt_14 = Point(pt_10)
incurves_10 = PointInCurves(Point=flatten(pt_14), Curves=crv_35)  # -> Relationship, Index, Point
equals_12 = Equality(FirstNumber=incurves_10.Relationship, SecondNumber="0")  # -> Equality, Inequality
dispatch_46 = Dispatch(List=flatten(pt_14), DispatchPattern=equals_12.Inequality)  # -> ListA, ListB
data_58 = Data(dispatch_46.ListA)

move2pt_20 = MoveToPoint(Geometry=data_55, PointA=data_55, PointB=data_56)  # -> Moved, Vector, Transform
null_11 = NullItem(Item=move2pt_20.Moved)  # -> NullFlags, InvalidFlags, Description
dispatch_47 = Dispatch(List=move2pt_20.Moved, DispatchPattern=null_11.InvalidFlags)  # -> ListA, ListB
pln_38 = Plane(dispatch_47.ListB)

move2pt_21 = MoveToPoint(Geometry=data_57, PointA=data_57, PointB=data_58)  # -> Moved, Vector, Transform
null_12 = NullItem(Item=move2pt_21.Moved)  # -> NullFlags, InvalidFlags, Description
dispatch_48 = Dispatch(List=move2pt_21.Moved, DispatchPattern=null_12.InvalidFlags)  # -> ListA, ListB
pln_39 = Plane(dispatch_48.ListB)

# ----
# 撞到梁交点
pln_40 = Plane(pln_39)
pln_41 = Plane(pln_38)

# ----
# 0 檐口出特殊处理
# 比如作为吊顶处理
pln_42 = Plane(pln_23)
pt_15 = Point(pln_42)

# ----
# 1.1 檐口处侧埋，钢板焊
# 02：钢板焊埋件[钢梁外侧]
# @钢边梁宽@钢边梁高
pln_43 = Plane(dispatch_38.ListB)

merge_14 = Merge(Data1=pln_43, Data2=pln_40, Data3=pln_41)
orient_2 = Orient(Geometry=item_13, Source=item_14, Target=merge_14)  # -> Geometry, Transform

# ----
# 与梁无交点的定位点
pln_44 = Plane(dispatch_34.ListA)

cull_i_16 = CullIndex(List=pln_32, Indices=check_same_points_6.specialPt, Wrap=True)
pln_45 = Plane(pln_25)
merge_15 = Merge(Data1=cull_i_16, Data2=pln_45)  # -> flatten(Result)

# ----
# 和下层楼板发生关系的定位点
pln_46 = Plane(pln_45)

pln_47 = Plane(pln_46)

number_slider_38 = Slider(3584, range=0..10000)
deplane_33 = DeconstructPlane(Plane=pln_47)  # -> Origin, XAxis, YAxis, ZAxis
amp_25 = Amplitude(Vector=deplane_33.YAxis, Amplitude=number_slider_38)
amp_26 = Amplitude(Vector=deplane_33.YAxis, Amplitude=expr("-x", number_slider_38))
boundary_4 = BoundarySurfaces(Edges=[offset_4, offset_5])
crv_72 = Curve(merge_3)
move_30 = Move(Geometry=deplane_33.Origin, Motion=amp_26)  # -> Geometry, Transform
move_31 = Move(Geometry=deplane_33.Origin, Motion=amp_25)  # -> Geometry, Transform
scx = SurfaceCurve(Surface=boundary_4, Curve=crv_72)  # -> flatten(Curves), Points, UVPoints, Normals, Parameters, Tangents
ln_32 = Line(StartPoint=move_30.Geometry, EndPoint=move_31.Geometry)
ccx_22 = CurveCurve(CurveA=graft(ln_32), CurveB=scx.Curves)  # -> Points, ParamsA, ParamsB
shift_6 = ShiftPaths(Data=ccx_22.Points, Offset=-1)
pull_29 = PullPoint(Point=graft(pln_47), Geometry=shift_6, ClosestOnly=True)  # -> ClosestPoint, Distance
sort_27 = SortList(Keys=pull_29.Distance, ValuesA=pull_29.ClosestPoint)  # -> Keys, ValuesA
null_13 = NullItem(Item=sort_27.ValuesA)  # -> NullFlags, simplify(InvalidFlags), Description
item_49 = ListItem(List=sort_27.ValuesA, Index=0, Wrap=True)
dispatch_49 = Dispatch(List=simplify(graft(pln_47)), DispatchPattern=null_13.InvalidFlags)  # -> ListA, ListB
dispatch_50 = Dispatch(List=simplify(graft(item_49)), DispatchPattern=null_13.InvalidFlags)  # -> ListA, ListB
pt_16 = Point(dispatch_50.ListB)
pln_48 = Plane(dispatch_49.ListA)
pln_49 = Plane(dispatch_49.ListB)

pln_50 = Plane(pln_47)
number_slider_39 = Slider(3584, range=0..10000)
deplane_34 = DeconstructPlane(Plane=pln_50)  # -> Origin, XAxis, YAxis, ZAxis
crv_73 = Curve(merge_4)
boundary_5 = BoundarySurfaces(Edges=[offset_3, offset_2])
scx_2 = SurfaceCurve(Surface=boundary_5, Curve=crv_73)  # -> flatten(Curves), Points, UVPoints, Normals, Parameters, Tangents
amp_27 = Amplitude(Vector=deplane_34.YAxis, Amplitude=number_slider_39)
amp_28 = Amplitude(Vector=deplane_34.YAxis, Amplitude=expr("-x", number_slider_39))
move_32 = Move(Geometry=deplane_34.Origin, Motion=amp_28)  # -> Geometry, Transform
move_33 = Move(Geometry=deplane_34.Origin, Motion=amp_27)  # -> Geometry, Transform
ln_33 = Line(StartPoint=move_32.Geometry, EndPoint=move_33.Geometry)
ccx_23 = CurveCurve(CurveA=graft(ln_33), CurveB=scx_2.Curves)  # -> Points, ParamsA, ParamsB
shift_7 = ShiftPaths(Data=ccx_23.Points, Offset=-1)
pull_30 = PullPoint(Point=graft(pln_50), Geometry=shift_7, ClosestOnly=True)  # -> ClosestPoint, Distance
sort_28 = SortList(Keys=pull_30.Distance, ValuesA=pull_30.ClosestPoint)  # -> Keys, ValuesA
item_50 = ListItem(List=sort_28.ValuesA, Index=0, Wrap=True)
null_14 = NullItem(Item=item_50)  # -> NullFlags, simplify(InvalidFlags), Description
null_15 = NullItem(Item=sort_28.ValuesA)  # -> NullFlags, simplify(InvalidFlags), Description
dispatch_51 = Dispatch(List=simplify(graft(pln_50)), DispatchPattern=null_15.InvalidFlags)  # -> ListA, ListB
dispatch_52 = Dispatch(List=simplify(graft(item_50)), DispatchPattern=null_14.InvalidFlags)  # -> ListA, ListB
pln_51 = Plane(dispatch_51.ListB)
pln_52 = Plane(dispatch_51.ListA)
pt_17 = Point(dispatch_52.ListB)

# ----
# 按照梁分类定位点
pt_18 = Point(pt_16)
pln_53 = Plane(pln_49)
incurves_11 = PointInCurves(Point=flatten(pt_18), Curves=crv_40)  # -> Relationship, Index, Point
equals_13 = Equality(FirstNumber=incurves_11.Relationship, SecondNumber="0")  # -> Equality, Inequality
dispatch_53 = Dispatch(List=flatten(pln_53), DispatchPattern=equals_13.Inequality)  # -> ListA, ListB
data_59 = Data(dispatch_53.ListA)

incurves_12 = PointInCurves(Point=flatten(pt_18), Curves=crv_40)  # -> Relationship, Index, Point
equals_14 = Equality(FirstNumber=incurves_12.Relationship, SecondNumber="0")  # -> Equality, Inequality
dispatch_54 = Dispatch(List=flatten(pt_18), DispatchPattern=equals_14.Inequality)  # -> ListA, ListB
data_60 = Data(dispatch_54.ListA)

# ----
# 按照梁分类定位点
pt_19 = Point(pt_17)
pln_54 = Plane(pln_51)
incurves_13 = PointInCurves(Point=flatten(pt_19), Curves=crv_41)  # -> Relationship, Index, Point
equals_15 = Equality(FirstNumber=incurves_13.Relationship, SecondNumber="0")  # -> Equality, Inequality
dispatch_55 = Dispatch(List=flatten(pln_54), DispatchPattern=equals_15.Inequality)  # -> ListA, ListB
data_61 = Data(dispatch_55.ListA)

incurves_14 = PointInCurves(Point=flatten(pt_19), Curves=crv_41)  # -> Relationship, Index, Point
equals_16 = Equality(FirstNumber=incurves_14.Relationship, SecondNumber="0")  # -> Equality, Inequality
dispatch_56 = Dispatch(List=flatten(pt_19), DispatchPattern=equals_16.Inequality)  # -> ListA, ListB
data_62 = Data(dispatch_56.ListA)

move2pt_22 = MoveToPoint(Geometry=data_59, PointA=data_59, PointB=data_60)  # -> Moved, Vector, Transform
null_16 = NullItem(Item=move2pt_22.Moved)  # -> NullFlags, InvalidFlags, Description
dispatch_57 = Dispatch(List=move2pt_22.Moved, DispatchPattern=null_16.InvalidFlags)  # -> ListA, ListB
pln_55 = Plane(dispatch_57.ListB)

move2pt_23 = MoveToPoint(Geometry=data_61, PointA=data_61, PointB=data_62)  # -> Moved, Vector, Transform
null_17 = NullItem(Item=move2pt_23.Moved)  # -> NullFlags, InvalidFlags, Description
dispatch_58 = Dispatch(List=move2pt_23.Moved, DispatchPattern=null_17.InvalidFlags)  # -> ListA, ListB
pln_56 = Plane(dispatch_58.ListB)

# ----
# 可能的结构交点-大量
pln_57 = Plane(pln_52)

# ----
# 可能的结构交点-大量
pln_58 = Plane(pln_48)

# ----
# 0 檐口出定位点
# 与结构无交点
pln_59 = Plane(flatten(pln_58))

# ----
# 0 檐口出定位点
# 与结构无交点
pln_60 = Plane(flatten(pln_57))

# ----
# 3.1
# 下层建筑边线外侧50-350mm
# 03：钢板焊埋件[钢梁内侧]
# @钢边梁宽@钢边梁高
pln_61 = Plane(pln_55)

# ----
# 3.2
# 下层建筑边线内侧300-600mm范围
# 03：钢板焊埋件[钢梁外侧]
# @钢边梁宽@钢边梁高
pln_62 = Plane(pln_56)

# ----
# 5 上层建筑边线,
# 默认建筑提供上翻，如主结构提供示意则使用结构定位【该项目无】，
# 如无则使用建筑边线向内50mm作为埋件定位
merge_16 = Merge(Data1=pln_24, Data2=pln_47)
crv_74 = Curve(crv_7)
offset_13 = OffsetCurve(Curve=crv_74, Distance=expr("-x", Slider(50, range=0..100)), Corners=1)
pln_63 = Plane(merge_16)
number_slider_40 = Slider(3584, range=0..10000)
deplane_35 = DeconstructPlane(Plane=pln_63)  # -> Origin, XAxis, YAxis, ZAxis
amp_29 = Amplitude(Vector=deplane_35.YAxis, Amplitude=number_slider_40)
amp_30 = Amplitude(Vector=deplane_35.YAxis, Amplitude=expr("-x", number_slider_40))
move_34 = Move(Geometry=deplane_35.Origin, Motion=amp_30)  # -> Geometry, Transform
move_35 = Move(Geometry=deplane_35.Origin, Motion=amp_29)  # -> Geometry, Transform
ln_34 = Line(StartPoint=move_34.Geometry, EndPoint=move_35.Geometry)
ccx_24 = CurveCurve(CurveA=ln_34, CurveB=offset_13)  # -> simplify(Points), ParamsA, ParamsB
ln_35 = Line(StartPoint=ccx_24.Points, EndPoint=simplify(graft(pln_63)))
len_7 = Length(Curve=ln_35)
null_18 = NullItem(Item=ccx_24.Points)  # -> NullFlags, InvalidFlags, Description
sort_29 = SortList(Keys=len_7, ValuesA=simplify(ccx_24.Points))  # -> Keys, ValuesA
dispatch_59 = Dispatch(List=simplify(graft(pln_63)), DispatchPattern=null_18.NullFlags)  # -> ListA, ListB
item_51 = ListItem(List=sort_29.ValuesA, Index=0, Wrap=True)

# ----
# 可能的双点
pln_64 = Plane(dispatch_59.ListA)

# ----
# 0 檐口出定位点
# 与结构无交点
pln_65 = Plane(flatten(pln_64))

# ----
# 5 上层建筑边线,
# 默认建筑提供上翻
# 04：板埋埋件[混凝土楼板上侧]
# @板埋参数xn
move2pt_24 = MoveToPoint(Geometry=simplify(graft(pln_63)), PointA=simplify(graft(pln_63)), PointB=item_51)  # -> flatten(Moved), Vector, Transform

# ----
# (8)Finally!
# 
# Bake埋件和阴阳角定位
data_63 = Data(orient_2.Geometry)

bake_2 = BakeObjects(Geometry=data_63, Attributes=attributes, BakeName="1-1-02钢板焊埋件", Bake=False)

number = NumberGroups(Number=sort_22.Keys, Difference=Slider(50, range=0..100))  # -> simplify(Groups), Indices
panel_60 = Panel(number.Groups)
tstat = TreeStatistics(Tree=number.Groups)  # -> Paths, Length, Count
lng_3 = ListLength(List=tstat.Paths)
smaller_9 = SmallerThan(FirstNumber=lng_3, SecondNumber="2")  # -> SmallerThan, OrEqualTo
dispatch_60 = Dispatch(List=smaller_9.SmallerThan, DispatchPattern=[True, False])  # -> ListA, ListB
filter_17 = StreamFilter(Gate=dispatch_60.ListA, Stream0="-2", Stream1="-1")
item_52 = ListItem(List=tstat.Paths, Index=filter_17, Wrap=True)
branch = TreeBranch(Tree=number.Groups, Path=item_52, MaintainPaths=True)
sort_30 = SortList(Keys=branch)  # -> reverse(Keys), ValuesA
round_2 = Round(Number=sort_30.Keys)  # -> Nearest, Floor, Ceiling
item_53 = ListItem(List=round_2.Ceiling, Index=0, Wrap=True)

# ----
# 挑出反常点-交点距离起始点过远
list_9 = ValueList({"自己输入Value": 0, "GH Defaut Value": 1}, selected="GH Defaut Value")
panel_61 = Panel(item_53)
filter_18 = StreamFilter(Gate=list_9, Stream0=Slider(1000, range=0..10000), Stream1=panel_61)

larger_9 = LargerThan(FirstNumber=len_6, SecondNumber=filter_18)  # -> LargerThan, OrEqualTo
dispatch_61 = Dispatch(List=flatten_15, DispatchPattern=larger_9.LargerThan)  # -> ListA, ListB
dispatch_62 = Dispatch(List=data_51, DispatchPattern=larger_9.LargerThan)  # -> ListA, ListB
data_64 = Data(dispatch_62.ListB)
data_65 = Data(dispatch_61.ListB)

# ----
# 按照梁分类定位点
pt_20 = Point(data_65)
pln_66 = Plane(data_64)
incurves_15 = PointInCurves(Point=flatten(pt_20), Curves=crv_36)  # -> Relationship, Index, Point
equals_17 = Equality(FirstNumber=incurves_15.Relationship, SecondNumber="0")  # -> Equality, Inequality
dispatch_63 = Dispatch(List=flatten(pln_66), DispatchPattern=equals_17.Inequality)  # -> ListA, ListB
data_66 = Data(dispatch_63.ListA)

incurves_16 = PointInCurves(Point=flatten(pt_20), Curves=crv_36)  # -> Relationship, Index, Point
equals_18 = Equality(FirstNumber=incurves_16.Relationship, SecondNumber="0")  # -> Equality, Inequality
dispatch_64 = Dispatch(List=flatten(pt_20), DispatchPattern=equals_18.Inequality)  # -> ListA, ListB
data_67 = Data(dispatch_64.ListA)

move2pt_25 = MoveToPoint(Geometry=data_66, PointA=data_66, PointB=data_67)  # -> Moved, Vector, Transform
null_19 = NullItem(Item=move2pt_25.Moved)  # -> NullFlags, InvalidFlags, Description
dispatch_65 = Dispatch(List=move2pt_25.Moved, DispatchPattern=null_19.InvalidFlags)  # -> ListA, ListB
pln_67 = Plane(dispatch_65.ListB)

# ----
# 离梁过远的定位点
pln_68 = Plane(dispatch_62.ListA)

# ----
# 1.0无檐口线
# 与梁不相交
merge_17 = Merge(Data1=pln_44, Data2=pln_68)

# ----
# 0 檐口出定位点
# 与结构无交点
pln_69 = Plane(flatten(merge_17))

# ----
# 0.Missing Point
# 埋件定位点Offset，没有找到和梁的交点
number_slider_41 = Slider(5000, range=0..10000)
deplane_36 = DeconstructPlane(Plane=pln_69)  # -> Origin, XAxis, YAxis, ZAxis
amp_31 = Amplitude(Vector=deplane_36.YAxis, Amplitude=expr("-x", number_slider_41))
move_36 = Move(Geometry=deplane_36.Origin, Motion=amp_31)  # -> Geometry, Transform
ln_36 = Line(StartPoint=move_36.Geometry, EndPoint=deplane_36.Origin)
crv_75 = Curve(crv_71)
amp_32 = Amplitude(Vector=deplane_36.XAxis, Amplitude=number_slider_6)
amp_33 = Amplitude(Vector=deplane_36.XAxis, Amplitude=expr("-x", number_slider_6))
move_37 = Move(Geometry=ln_36, Motion=amp_33)  # -> Geometry, Transform
move_38 = Move(Geometry=ln_36, Motion=amp_32)  # -> Geometry, Transform

ccx_25 = CurveCurve(CurveA=graft(move_37.Geometry), CurveB=flatten(crv_75))  # -> Points, ParamsA, ParamsB
shift_8 = ShiftPaths(Data=ccx_25.Points, Offset=-1)
sort_31 = SortList(Keys=shift_8, ValuesA=shift_8)  # -> Keys, ValuesA
pull_31 = PullPoint(Point=sort_31.ValuesA, Geometry=graft(pln_69), ClosestOnly=True)  # -> ClosestPoint, Distance
sort_32 = SortList(Keys=pull_31.Distance, ValuesA=sort_31.ValuesA)  # -> Keys, ValuesA
item_54 = ListItem(List=sort_32.ValuesA, Index="0", Wrap=True)
null_20 = NullItem(Item=flatten(item_54))  # -> NullFlags, InvalidFlags, Description
dispatch_66 = Dispatch(List=simplify(item_54), DispatchPattern=simplify(graft(null_20.InvalidFlags)))  # -> ListA, ListB
dispatch_67 = Dispatch(List=pln_69, DispatchPattern=null_20.InvalidFlags)  # -> ListA, ListB
pln_70 = Plane(dispatch_67.ListB)
pt_21 = Point(dispatch_66.ListB)

ccx_26 = CurveCurve(CurveA=graft(move_38.Geometry), CurveB=flatten(crv_75))  # -> Points, ParamsA, ParamsB
shift_9 = ShiftPaths(Data=ccx_26.Points, Offset=-1)
sort_33 = SortList(Keys=shift_9, ValuesA=shift_9)  # -> Keys, ValuesA
pull_32 = PullPoint(Point=sort_33.ValuesA, Geometry=graft(pln_69), ClosestOnly=True)  # -> ClosestPoint, Distance
sort_34 = SortList(Keys=pull_32.Distance, ValuesA=sort_33.ValuesA)  # -> Keys, ValuesA
item_55 = ListItem(List=sort_34.ValuesA, Index="0", Wrap=True)
null_21 = NullItem(Item=flatten(item_55))  # -> NullFlags, InvalidFlags, Description
dispatch_68 = Dispatch(List=simplify(item_55), DispatchPattern=simplify(graft(null_21.InvalidFlags)))  # -> ListA, ListB
dispatch_69 = Dispatch(List=pln_69, DispatchPattern=null_21.InvalidFlags)  # -> ListA, ListB
pt_22 = Point(dispatch_68.ListB)
pln_71 = Plane(dispatch_69.ListB)

# ----
# 按照梁分类定位点
pln_72 = Plane(pln_71)
pt_23 = Point(pt_22)
incurves_17 = PointInCurves(Point=flatten(pt_23), Curves=crv_37)  # -> Relationship, Index, Point
equals_19 = Equality(FirstNumber=incurves_17.Relationship, SecondNumber="0")  # -> Equality, Inequality
dispatch_70 = Dispatch(List=flatten(pln_72), DispatchPattern=equals_19.Inequality)  # -> ListA, ListB
data_68 = Data(dispatch_70.ListA)

# ----
# 按照梁分类定位点
pln_73 = Plane(pln_70)
pt_24 = Point(pt_21)
incurves_18 = PointInCurves(Point=flatten(pt_24), Curves=crv_37)  # -> Relationship, Index, Point
equals_20 = Equality(FirstNumber=incurves_18.Relationship, SecondNumber="0")  # -> Equality, Inequality
dispatch_71 = Dispatch(List=flatten(pln_73), DispatchPattern=equals_20.Inequality)  # -> ListA, ListB
data_69 = Data(dispatch_71.ListA)

incurves_19 = PointInCurves(Point=flatten(pt_24), Curves=crv_37)  # -> Relationship, Index, Point
equals_21 = Equality(FirstNumber=incurves_19.Relationship, SecondNumber="0")  # -> Equality, Inequality
dispatch_72 = Dispatch(List=flatten(pt_24), DispatchPattern=equals_21.Inequality)  # -> ListA, ListB
data_70 = Data(dispatch_72.ListA)

incurves_20 = PointInCurves(Point=flatten(pt_23), Curves=crv_37)  # -> Relationship, Index, Point
equals_22 = Equality(FirstNumber=incurves_20.Relationship, SecondNumber="0")  # -> Equality, Inequality
dispatch_73 = Dispatch(List=flatten(pt_23), DispatchPattern=equals_22.Inequality)  # -> ListA, ListB
data_71 = Data(dispatch_73.ListA)

move2pt_26 = MoveToPoint(Geometry=data_68, PointA=data_68, PointB=data_71)  # -> Moved, Vector, Transform
null_22 = NullItem(Item=move2pt_26.Moved)  # -> NullFlags, InvalidFlags, Description
dispatch_74 = Dispatch(List=move2pt_26.Moved, DispatchPattern=null_22.InvalidFlags)  # -> ListA, ListB
pln_74 = Plane(dispatch_74.ListB)

move2pt_27 = MoveToPoint(Geometry=data_69, PointA=data_69, PointB=data_70)  # -> Moved, Vector, Transform
null_23 = NullItem(Item=move2pt_27.Moved)  # -> NullFlags, InvalidFlags, Description
dispatch_75 = Dispatch(List=move2pt_27.Moved, DispatchPattern=null_23.InvalidFlags)  # -> ListA, ListB
pln_75 = Plane(dispatch_75.ListB)

# ----
# 1.0无檐口线+上下层幕墙边线连续
# 01：钢板焊埋件[钢梁外侧]
# @钢边梁宽@钢边梁高
pln_76 = Plane(pln_67)

# ----
# 撞到梁交点
merge_18 = Merge(Data1=pln_74, Data2=pln_75)

merge_19 = Merge(Data1=pln_76, Data2=merge_18)
orient_3 = Orient(Geometry=item_15, Source=item_16, Target=merge_19)  # -> Geometry, Transform

data_72 = Data(orient_3.Geometry)

bake_3 = BakeObjects(Geometry=data_72, Attributes=attributes_2, BakeName="1-0-01钢板焊埋件", Bake=False)

# ----
# 2是否有吊顶
# 梁以内>350
deplane_37 = DeconstructPlane(Plane=pln_46)  # -> Origin, XAxis, YAxis, ZAxis
number_slider_42 = Slider(5000, range=0..10000)
amp_34 = Amplitude(Vector=deplane_37.YAxis, Amplitude=expr("-x", number_slider_42))
amp_35 = Amplitude(Vector=deplane_37.YAxis, Amplitude=number_slider_42)
move_39 = Move(Geometry=deplane_37.Origin, Motion=amp_35)  # -> Geometry, Transform
move_40 = Move(Geometry=deplane_37.Origin, Motion=amp_34)  # -> Geometry, Transform
ln_37 = Line(StartPoint=move_39.Geometry, EndPoint=move_40.Geometry)
crv_76 = Curve(crv_6)
ccx_27 = CurveCurve(CurveA=ln_37, CurveB=crv_76)  # -> Points, ParamsA, ParamsB
null_24 = NullItem(Item=ccx_27.Points)  # -> NullFlags, InvalidFlags, Description
dispatch_76 = Dispatch(List=simplify(graft(pln_46)), DispatchPattern=simplify(null_24.NullFlags))  # -> ListA, ListB
pln_77 = Plane(flatten(dispatch_76.ListB))
pt_25 = Point(pln_77)
crv_77 = Curve(merge_3)

dispatch_77 = Dispatch(List=simplify(ccx_27.Points), DispatchPattern=simplify(null_24.NullFlags))  # -> ListA, ListB
pt_26 = Point(dispatch_77.ListB)

# ----
# 可能的点-离结构很远
pln_78 = Plane(dispatch_76.ListA)

pull_33 = PullPoint(Point=flatten(pt_25), Geometry=flatten(pt_26), ClosestOnly=True)  # -> ClosestPoint, Distance
ln_38 = Line(StartPoint=pln_77, EndPoint=pull_33.ClosestPoint)

# ----
# 定位点Project到下层建筑线
move2pt_28 = MoveToPoint(Geometry=pln_77, PointA=pln_77, PointB=pull_33.ClosestPoint)  # -> Moved, Vector, Transform

deplane_38 = DeconstructPlane(Plane=move2pt_28.Moved)  # -> Origin, XAxis, YAxis, ZAxis
amp_36 = Amplitude(Vector=deplane_38.YAxis, Amplitude=Slider(5000, range=0..10000))
move_41 = Move(Geometry=deplane_38.Origin, Motion=amp_36)  # -> Geometry, Transform
ln_39 = Line(StartPoint=move_41.Geometry, EndPoint=deplane_38.Origin)
ccx_28 = CurveCurve(CurveA=graft(ln_39), CurveB=flatten(crv_77))  # -> simplify(Points), ParamsA, ParamsB
shift_10 = ShiftPaths(Data=ccx_28.Points, Offset=-1)
null_25 = NullItem(Item=shift_10)  # -> NullFlags, InvalidFlags, Description
dispatch_78 = Dispatch(List=simplify(graft(move2pt_28.Moved)), DispatchPattern=null_25.NullFlags)  # -> ListA, ListB
dispatch_79 = Dispatch(List=simplify(graft(ln_39)), DispatchPattern=null_25.NullFlags)  # -> ListA, ListB
pln_79 = Plane(dispatch_78.ListA)
pln_80 = Plane(dispatch_78.ListB)
crv_78 = Curve(dispatch_79.ListB)
ccx_29 = CurveCurve(CurveA=graft(crv_78), CurveB=flatten(crv_77))  # -> Points, ParamsA, ParamsB
shift_11 = ShiftPaths(Data=simplify(ccx_29.Points), Offset=-1)
pull_34 = PullPoint(Point=pln_80, Geometry=shift_11, ClosestOnly=True)  # -> ClosestPoint, Distance
sort_35 = SortList(Keys=pull_34.Distance, ValuesA=pull_34.ClosestPoint)  # -> Keys, ValuesA
item_56 = ListItem(List=sort_35.ValuesA, Index=0, Wrap=True)
ln_40 = Line(StartPoint=pln_80, EndPoint=item_56)
len_8 = Length(Curve=ln_40)
larger_10 = LargerThan(FirstNumber=len_8, SecondNumber=number_slider_19)  # -> LargerThan, OrEqualTo
panel_62 = Panel(len_8)
dispatch_80 = Dispatch(List=pln_80, DispatchPattern=larger_10.LargerThan)  # -> ListA, ListB
pln_81 = Plane(dispatch_80.ListB)
pln_82 = Plane(dispatch_80.ListA)

dispatch_81 = Dispatch(List=item_56, DispatchPattern=larger_10.LargerThan)  # -> ListA, ListB
pt_27 = Point(dispatch_81.ListA)

# ----
# 按照梁分类定位点
pln_83 = Plane(pln_82)
pt_28 = Point(pt_27)
incurves_21 = PointInCurves(Point=flatten(pt_28), Curves=crv_38)  # -> Relationship, Index, Point
equals_23 = Equality(FirstNumber=incurves_21.Relationship, SecondNumber="0")  # -> Equality, Inequality
dispatch_82 = Dispatch(List=flatten(pln_83), DispatchPattern=equals_23.Inequality)  # -> ListA, ListB
data_73 = Data(dispatch_82.ListA)

incurves_22 = PointInCurves(Point=flatten(pt_28), Curves=crv_38)  # -> Relationship, Index, Point
equals_24 = Equality(FirstNumber=incurves_22.Relationship, SecondNumber="0")  # -> Equality, Inequality
dispatch_83 = Dispatch(List=flatten(pt_28), DispatchPattern=equals_24.Inequality)  # -> ListA, ListB
data_74 = Data(dispatch_83.ListA)

move2pt_29 = MoveToPoint(Geometry=data_73, PointA=data_73, PointB=data_74)  # -> Moved, Vector, Transform
null_26 = NullItem(Item=move2pt_29.Moved)  # -> NullFlags, InvalidFlags, Description
dispatch_84 = Dispatch(List=move2pt_29.Moved, DispatchPattern=null_26.InvalidFlags)  # -> ListA, ListB
pln_84 = Plane(dispatch_84.ListB)

# ----
# 可能的结构交点-大量
pln_85 = Plane(pln_79)

# ----
# 可能的结构交点
pln_86 = Plane(pln_81)

# ----
# 2.1 梁以内>350
# 
# 侧埋，钢板焊
# 03：钢板焊埋件[钢梁内侧]
# @钢边梁宽@钢边梁高
pln_87 = Plane(pln_84)

# ----
# 2.1 Missing Point
# 埋件定位点Offset，没有找到和梁的交点
merge_20 = Merge(Data1=pln_78, Data2=pln_86, Data3=pln_85)
crv_79 = Curve(crv_77)

# ----
# 0 檐口出定位点
# 与结构无交点
pln_88 = Plane(flatten(merge_20))

deplane_39 = DeconstructPlane(Plane=pln_88)  # -> Origin, XAxis, YAxis, ZAxis
amp_37 = Amplitude(Vector=deplane_39.YAxis, Amplitude=Slider(5000, range=0..10000))
move_42 = Move(Geometry=deplane_39.Origin, Motion=amp_37)  # -> Geometry, Transform
ln_41 = Line(StartPoint=move_42.Geometry, EndPoint=deplane_39.Origin)
amp_38 = Amplitude(Vector=deplane_39.XAxis, Amplitude=number_slider_6)
amp_39 = Amplitude(Vector=deplane_39.XAxis, Amplitude=expr("-x", number_slider_6))
move_43 = Move(Geometry=ln_41, Motion=amp_38)  # -> Geometry, Transform
move_44 = Move(Geometry=ln_41, Motion=amp_39)  # -> Geometry, Transform

ccx_30 = CurveCurve(CurveA=graft(move_43.Geometry), CurveB=flatten(crv_79))  # -> Points, ParamsA, ParamsB
shift_12 = ShiftPaths(Data=ccx_30.Points, Offset=-1)
sort_36 = SortList(Keys=shift_12, ValuesA=shift_12)  # -> Keys, ValuesA
pull_35 = PullPoint(Point=sort_36.ValuesA, Geometry=graft(pln_88), ClosestOnly=True)  # -> ClosestPoint, Distance
sort_37 = SortList(Keys=pull_35.Distance, ValuesA=sort_36.ValuesA)  # -> Keys, ValuesA
item_57 = ListItem(List=sort_37.ValuesA, Index="-1", Wrap=True)
null_27 = NullItem(Item=flatten(item_57))  # -> NullFlags, InvalidFlags, Description
end_8 = EndPoints(Curve=move_43.Geometry)  # -> Start, End
dispatch_85 = Dispatch(List=graft(pln_88), DispatchPattern=graft(null_27.InvalidFlags))  # -> ListA, ListB
dispatch_86 = Dispatch(List=simplify(item_57), DispatchPattern=simplify(graft(null_27.InvalidFlags)))  # -> ListA, ListB
pt_29 = Point(dispatch_86.ListB)
pln_89 = Plane(dispatch_85.ListB)
dispatch_87 = Dispatch(List=simplify(graft(end_8.End)), DispatchPattern=simplify(graft(null_27.InvalidFlags)))  # -> ListA, ListB
pt_30 = Point(dispatch_87.ListB)
ln_42 = Line(StartPoint=pt_30, EndPoint=pt_29)
len_9 = Length(Curve=ln_42)
larger_11 = LargerThan(FirstNumber=len_9, SecondNumber=Slider(350, range=0..1000))  # -> LargerThan, OrEqualTo
dispatch_88 = Dispatch(List=pln_89, DispatchPattern=larger_11.LargerThan)  # -> ListA, ListB
dispatch_89 = Dispatch(List=pt_30, DispatchPattern=larger_11.LargerThan)  # -> ListA, ListB
pln_90 = Plane(dispatch_88.ListA)
pt_31 = Point(dispatch_89.ListA)

ccx_31 = CurveCurve(CurveA=graft(move_44.Geometry), CurveB=flatten(crv_79))  # -> Points, ParamsA, ParamsB
shift_13 = ShiftPaths(Data=ccx_31.Points, Offset=-1)
sort_38 = SortList(Keys=shift_13, ValuesA=shift_13)  # -> Keys, ValuesA
pull_36 = PullPoint(Point=sort_38.ValuesA, Geometry=graft(pln_88), ClosestOnly=True)  # -> ClosestPoint, Distance
sort_39 = SortList(Keys=pull_36.Distance, ValuesA=sort_38.ValuesA)  # -> Keys, ValuesA
item_58 = ListItem(List=sort_39.ValuesA, Index="-1", Wrap=True)
null_28 = NullItem(Item=flatten(item_58))  # -> NullFlags, InvalidFlags, Description
end_9 = EndPoints(Curve=move_44.Geometry)  # -> Start, End
dispatch_90 = Dispatch(List=simplify(item_58), DispatchPattern=simplify(graft(null_28.InvalidFlags)))  # -> ListA, ListB
dispatch_91 = Dispatch(List=graft(pln_88), DispatchPattern=flatten(null_28.InvalidFlags))  # -> ListA, ListB
dispatch_92 = Dispatch(List=simplify(graft(end_9.End)), DispatchPattern=simplify(graft(null_28.InvalidFlags)))  # -> ListA, ListB
pln_91 = Plane(dispatch_91.ListB)
pt_32 = Point(dispatch_90.ListB)
pt_33 = Point(dispatch_92.ListB)
ln_43 = Line(StartPoint=pt_33, EndPoint=pt_29)
len_10 = Length(Curve=ln_43)
larger_12 = LargerThan(FirstNumber=len_10, SecondNumber=Slider(350, range=0..1000))  # -> LargerThan, OrEqualTo
dispatch_93 = Dispatch(List=pln_91, DispatchPattern=larger_12.LargerThan)  # -> ListA, ListB
dispatch_94 = Dispatch(List=pt_33, DispatchPattern=larger_12.LargerThan)  # -> ListA, ListB
pln_92 = Plane(dispatch_93.ListA)
pt_34 = Point(dispatch_94.ListA)

# ----
# 按照梁分类定位点
pln_93 = Plane(pln_90)
pt_35 = Point(pt_31)
incurves_23 = PointInCurves(Point=flatten(pt_35), Curves=crv_39)  # -> Relationship, Index, Point
equals_25 = Equality(FirstNumber=incurves_23.Relationship, SecondNumber="0")  # -> Equality, Inequality
dispatch_95 = Dispatch(List=flatten(pln_93), DispatchPattern=equals_25.Inequality)  # -> ListA, ListB
data_75 = Data(dispatch_95.ListA)

# ----
# 按照梁分类定位点
pln_94 = Plane(pln_92)
pt_36 = Point(pt_34)
incurves_24 = PointInCurves(Point=flatten(pt_36), Curves=crv_39)  # -> Relationship, Index, Point
equals_26 = Equality(FirstNumber=incurves_24.Relationship, SecondNumber="0")  # -> Equality, Inequality
dispatch_96 = Dispatch(List=flatten(pln_94), DispatchPattern=equals_26.Inequality)  # -> ListA, ListB
data_76 = Data(dispatch_96.ListA)

incurves_25 = PointInCurves(Point=flatten(pt_36), Curves=crv_39)  # -> Relationship, Index, Point
equals_27 = Equality(FirstNumber=incurves_25.Relationship, SecondNumber="0")  # -> Equality, Inequality
dispatch_97 = Dispatch(List=flatten(pt_36), DispatchPattern=equals_27.Inequality)  # -> ListA, ListB
data_77 = Data(dispatch_97.ListA)

incurves_26 = PointInCurves(Point=flatten(pt_35), Curves=crv_39)  # -> Relationship, Index, Point
equals_28 = Equality(FirstNumber=incurves_26.Relationship, SecondNumber="0")  # -> Equality, Inequality
dispatch_98 = Dispatch(List=flatten(pt_35), DispatchPattern=equals_28.Inequality)  # -> ListA, ListB
data_78 = Data(dispatch_98.ListA)

move2pt_30 = MoveToPoint(Geometry=data_75, PointA=data_75, PointB=data_78)  # -> Moved, Vector, Transform
null_29 = NullItem(Item=move2pt_30.Moved)  # -> NullFlags, InvalidFlags, Description
dispatch_99 = Dispatch(List=move2pt_30.Moved, DispatchPattern=null_29.InvalidFlags)  # -> ListA, ListB
pln_95 = Plane(dispatch_99.ListB)

move2pt_31 = MoveToPoint(Geometry=data_76, PointA=data_76, PointB=data_77)  # -> Moved, Vector, Transform
null_30 = NullItem(Item=move2pt_31.Moved)  # -> NullFlags, InvalidFlags, Description
dispatch_100 = Dispatch(List=move2pt_31.Moved, DispatchPattern=null_30.InvalidFlags)  # -> ListA, ListB
pln_96 = Plane(dispatch_100.ListB)

# ----
# 撞到梁交点
merge_21 = Merge(Data1=pln_95, Data2=pln_96)

merge_22 = Merge(Data1=pln_87, Data2=merge_21)
orient_4 = Orient(Geometry=item_17, Source=rotate_4.Geometry, Target=merge_22)  # -> Geometry, Transform

data_79 = Data(orient_4.Geometry)
bake_4 = BakeObjects(Geometry=data_79, Attributes=attributes_3, BakeName="2-1-03钢板焊埋件", Bake=False)

# ----
# 3.1 Missing Point
# 埋件定位点Offset，没有找到和梁的交点
number_slider_43 = Slider(5000, range=0..10000)
deplane_40 = DeconstructPlane(Plane=pln_59)  # -> Origin, XAxis, YAxis, ZAxis
amp_40 = Amplitude(Vector=deplane_40.YAxis, Amplitude=number_slider_43)
crv_80 = Curve(scx.Curves)
move_45 = Move(Geometry=deplane_40.Origin, Motion=amp_40)  # -> Geometry, Transform
ln_44 = Line(StartPoint=move_45.Geometry, EndPoint=deplane_40.Origin)
amp_41 = Amplitude(Vector=deplane_40.XAxis, Amplitude=expr("-x", number_slider_6))
amp_42 = Amplitude(Vector=deplane_40.XAxis, Amplitude=number_slider_6)
move_46 = Move(Geometry=ln_44, Motion=amp_42)  # -> Geometry, Transform
move_47 = Move(Geometry=ln_44, Motion=amp_41)  # -> Geometry, Transform
pln_97 = Plane(pln_48)

ccx_32 = CurveCurve(CurveA=graft(move_47.Geometry), CurveB=flatten(crv_80))  # -> Points, ParamsA, ParamsB
shift_14 = ShiftPaths(Data=ccx_32.Points, Offset=-1)
sort_40 = SortList(Keys=shift_14, ValuesA=shift_14)  # -> Keys, ValuesA
pull_37 = PullPoint(Point=sort_40.ValuesA, Geometry=graft(pln_59), ClosestOnly=True)  # -> ClosestPoint, Distance
sort_41 = SortList(Keys=pull_37.Distance, ValuesA=sort_40.ValuesA)  # -> Keys, ValuesA
item_59 = ListItem(List=sort_41.ValuesA, Index="-1", Wrap=True)
null_31 = NullItem(Item=flatten(item_59))  # -> NullFlags, InvalidFlags, Description
dispatch_101 = Dispatch(List=flatten(item_59), DispatchPattern=null_31.InvalidFlags)  # -> ListA, ListB
dispatch_102 = Dispatch(List=pln_59, DispatchPattern=null_31.InvalidFlags)  # -> ListA, ListB
pt_37 = Point(dispatch_101.ListB)
pln_98 = Plane(dispatch_102.ListB)

ccx_33 = CurveCurve(CurveA=graft(move_46.Geometry), CurveB=flatten(crv_80))  # -> Points, ParamsA, ParamsB
shift_15 = ShiftPaths(Data=ccx_33.Points, Offset=-1)
sort_42 = SortList(Keys=shift_15, ValuesA=shift_15)  # -> Keys, ValuesA
pull_38 = PullPoint(Point=sort_42.ValuesA, Geometry=graft(pln_59), ClosestOnly=True)  # -> ClosestPoint, Distance
sort_43 = SortList(Keys=pull_38.Distance, ValuesA=sort_42.ValuesA)  # -> Keys, ValuesA
item_60 = ListItem(List=sort_43.ValuesA, Index="-1", Wrap=True)
null_32 = NullItem(Item=flatten(item_60))  # -> NullFlags, InvalidFlags, Description
dispatch_103 = Dispatch(List=flatten(item_60), DispatchPattern=null_32.InvalidFlags)  # -> ListA, ListB
dispatch_104 = Dispatch(List=pln_59, DispatchPattern=null_32.InvalidFlags)  # -> ListA, ListB
pln_99 = Plane(dispatch_104.ListB)
pt_38 = Point(dispatch_103.ListB)

merge_23 = Merge(Data1=pln_99, Data2=pln_98)  # -> flatten(Result)
check_same_points_7 = CheckSamePoints(archPoint=flatten(pln_97), crvPoint=merge_23)  # -> out, specialPt; inputs archPoint: list of Point3d, crvPoint: list of Point3d; same code as testpoint

# ----
# pass
cull_i_17 = CullIndex(List=flatten(pln_97), Indices=check_same_points_7.specialPt, Wrap=True)

# ----
# 按照梁分类定位点
pln_100 = Plane(pln_99)
pt_39 = Point(pt_38)
incurves_27 = PointInCurves(Point=flatten(pt_39), Curves=crv_42)  # -> Relationship, Index, Point
equals_29 = Equality(FirstNumber=incurves_27.Relationship, SecondNumber="0")  # -> Equality, Inequality
dispatch_105 = Dispatch(List=flatten(pln_100), DispatchPattern=equals_29.Inequality)  # -> ListA, ListB
data_80 = Data(dispatch_105.ListA)

# ----
# 按照梁分类定位点
pln_101 = Plane(pln_98)
pt_40 = Point(pt_37)
incurves_28 = PointInCurves(Point=flatten(pt_40), Curves=crv_42)  # -> Relationship, Index, Point
equals_30 = Equality(FirstNumber=incurves_28.Relationship, SecondNumber="0")  # -> Equality, Inequality
dispatch_106 = Dispatch(List=flatten(pln_101), DispatchPattern=equals_30.Inequality)  # -> ListA, ListB
data_81 = Data(dispatch_106.ListA)

incurves_29 = PointInCurves(Point=flatten(pt_40), Curves=crv_42)  # -> Relationship, Index, Point
equals_31 = Equality(FirstNumber=incurves_29.Relationship, SecondNumber="0")  # -> Equality, Inequality
dispatch_107 = Dispatch(List=flatten(pt_40), DispatchPattern=equals_31.Inequality)  # -> ListA, ListB
data_82 = Data(dispatch_107.ListA)

incurves_30 = PointInCurves(Point=flatten(pt_39), Curves=crv_42)  # -> Relationship, Index, Point
equals_32 = Equality(FirstNumber=incurves_30.Relationship, SecondNumber="0")  # -> Equality, Inequality
dispatch_108 = Dispatch(List=flatten(pt_39), DispatchPattern=equals_32.Inequality)  # -> ListA, ListB
data_83 = Data(dispatch_108.ListA)

move2pt_32 = MoveToPoint(Geometry=data_80, PointA=data_80, PointB=data_83)  # -> Moved, Vector, Transform
null_33 = NullItem(Item=move2pt_32.Moved)  # -> NullFlags, InvalidFlags, Description
dispatch_109 = Dispatch(List=move2pt_32.Moved, DispatchPattern=null_33.InvalidFlags)  # -> ListA, ListB
pln_102 = Plane(dispatch_109.ListB)

move2pt_33 = MoveToPoint(Geometry=data_81, PointA=data_81, PointB=data_82)  # -> Moved, Vector, Transform
null_34 = NullItem(Item=move2pt_33.Moved)  # -> NullFlags, InvalidFlags, Description
dispatch_110 = Dispatch(List=move2pt_33.Moved, DispatchPattern=null_34.InvalidFlags)  # -> ListA, ListB
pln_103 = Plane(dispatch_110.ListB)

# ----
# 撞到梁交点
merge_24 = Merge(Data1=pln_102, Data2=pln_103)

merge_25 = Merge(Data1=pln_61, Data2=merge_24)
orient_5 = Orient(Geometry=item_19, Source=rotate_5.Geometry, Target=merge_25)  # -> Geometry, Transform

data_84 = Data(orient_5.Geometry)
bake_5 = BakeObjects(Geometry=data_84, Attributes=attributes_4, BakeName="3-1-03钢板焊埋件", Bake=False)

# ----
# 3.2  Missing Point
# 埋件定位点Offset，没有找到和梁的交点
number_slider_44 = Slider(5000, range=0..10000)
crv_81 = Curve(scx_2.Curves)
deplane_41 = DeconstructPlane(Plane=pln_60)  # -> Origin, XAxis, YAxis, ZAxis
amp_43 = Amplitude(Vector=deplane_41.YAxis, Amplitude=number_slider_44)
move_48 = Move(Geometry=deplane_41.Origin, Motion=amp_43)  # -> Geometry, Transform
ln_45 = Line(StartPoint=move_48.Geometry, EndPoint=deplane_41.Origin)
amp_44 = Amplitude(Vector=deplane_41.XAxis, Amplitude=number_slider_6)
amp_45 = Amplitude(Vector=deplane_41.XAxis, Amplitude=expr("-x", number_slider_6))
move_49 = Move(Geometry=ln_45, Motion=amp_44)  # -> Geometry, Transform
move_50 = Move(Geometry=ln_45, Motion=amp_45)  # -> Geometry, Transform
pln_104 = Plane(pln_52)

ccx_34 = CurveCurve(CurveA=graft(move_50.Geometry), CurveB=flatten(crv_81))  # -> Points, ParamsA, ParamsB
shift_16 = ShiftPaths(Data=ccx_34.Points, Offset=-1)
sort_44 = SortList(Keys=shift_16, ValuesA=shift_16)  # -> Keys, ValuesA
pull_39 = PullPoint(Point=sort_44.ValuesA, Geometry=graft(pln_60), ClosestOnly=True)  # -> ClosestPoint, Distance
sort_45 = SortList(Keys=pull_39.Distance, ValuesA=sort_44.ValuesA)  # -> Keys, ValuesA
item_61 = ListItem(List=sort_45.ValuesA, Index="-1", Wrap=True)
null_35 = NullItem(Item=flatten(item_61))  # -> NullFlags, InvalidFlags, Description
dispatch_111 = Dispatch(List=flatten(item_61), DispatchPattern=null_35.InvalidFlags)  # -> ListA, ListB
dispatch_112 = Dispatch(List=pln_60, DispatchPattern=null_35.InvalidFlags)  # -> ListA, ListB
pt_41 = Point(dispatch_111.ListB)
pln_105 = Plane(dispatch_112.ListB)

ccx_35 = CurveCurve(CurveA=graft(move_49.Geometry), CurveB=flatten(crv_81))  # -> Points, ParamsA, ParamsB
shift_17 = ShiftPaths(Data=ccx_35.Points, Offset=-1)
sort_46 = SortList(Keys=shift_17, ValuesA=shift_17)  # -> Keys, ValuesA
pull_40 = PullPoint(Point=sort_46.ValuesA, Geometry=graft(pln_60), ClosestOnly=True)  # -> ClosestPoint, Distance
sort_47 = SortList(Keys=pull_40.Distance, ValuesA=sort_46.ValuesA)  # -> Keys, ValuesA
item_62 = ListItem(List=sort_47.ValuesA, Index="-1", Wrap=True)
null_36 = NullItem(Item=flatten(item_62))  # -> NullFlags, InvalidFlags, Description
dispatch_113 = Dispatch(List=flatten(item_62), DispatchPattern=null_36.InvalidFlags)  # -> ListA, ListB
dispatch_114 = Dispatch(List=pln_60, DispatchPattern=null_36.InvalidFlags)  # -> ListA, ListB
pln_106 = Plane(dispatch_114.ListB)
pt_42 = Point(dispatch_113.ListB)

merge_26 = Merge(Data1=pln_106, Data2=pln_105)  # -> flatten(Result)
check_same_points_8 = CheckSamePoints(archPoint=flatten(pln_104), crvPoint=merge_26)  # -> out, specialPt; inputs archPoint: list of Point3d, crvPoint: list of Point3d; same code as testpoint

# ----
# pass
cull_i_18 = CullIndex(List=flatten(pln_104), Indices=check_same_points_8.specialPt, Wrap=True)

# ----
# 按照梁分类定位点
pln_107 = Plane(pln_106)
pt_43 = Point(pt_42)
incurves_31 = PointInCurves(Point=flatten(pt_43), Curves=crv_43)  # -> Relationship, Index, Point
equals_33 = Equality(FirstNumber=incurves_31.Relationship, SecondNumber="0")  # -> Equality, Inequality
dispatch_115 = Dispatch(List=flatten(pln_107), DispatchPattern=equals_33.Inequality)  # -> ListA, ListB
data_85 = Data(dispatch_115.ListA)

# ----
# 按照梁分类定位点
pln_108 = Plane(pln_105)
pt_44 = Point(pt_41)
incurves_32 = PointInCurves(Point=flatten(pt_44), Curves=crv_43)  # -> Relationship, Index, Point
equals_34 = Equality(FirstNumber=incurves_32.Relationship, SecondNumber="0")  # -> Equality, Inequality
dispatch_116 = Dispatch(List=flatten(pln_108), DispatchPattern=equals_34.Inequality)  # -> ListA, ListB
data_86 = Data(dispatch_116.ListA)

incurves_33 = PointInCurves(Point=flatten(pt_44), Curves=crv_43)  # -> Relationship, Index, Point
equals_35 = Equality(FirstNumber=incurves_33.Relationship, SecondNumber="0")  # -> Equality, Inequality
dispatch_117 = Dispatch(List=flatten(pt_44), DispatchPattern=equals_35.Inequality)  # -> ListA, ListB
data_87 = Data(dispatch_117.ListA)

incurves_34 = PointInCurves(Point=flatten(pt_43), Curves=crv_43)  # -> Relationship, Index, Point
equals_36 = Equality(FirstNumber=incurves_34.Relationship, SecondNumber="0")  # -> Equality, Inequality
dispatch_118 = Dispatch(List=flatten(pt_43), DispatchPattern=equals_36.Inequality)  # -> ListA, ListB
data_88 = Data(dispatch_118.ListA)

move2pt_34 = MoveToPoint(Geometry=data_85, PointA=data_85, PointB=data_88)  # -> Moved, Vector, Transform
null_37 = NullItem(Item=move2pt_34.Moved)  # -> NullFlags, InvalidFlags, Description
dispatch_119 = Dispatch(List=move2pt_34.Moved, DispatchPattern=null_37.InvalidFlags)  # -> ListA, ListB
pln_109 = Plane(dispatch_119.ListB)

move2pt_35 = MoveToPoint(Geometry=data_86, PointA=data_86, PointB=data_87)  # -> Moved, Vector, Transform
null_38 = NullItem(Item=move2pt_35.Moved)  # -> NullFlags, InvalidFlags, Description
dispatch_120 = Dispatch(List=move2pt_35.Moved, DispatchPattern=null_38.InvalidFlags)  # -> ListA, ListB
pln_110 = Plane(dispatch_120.ListB)

# ----
# 撞到梁交点
merge_27 = Merge(Data1=pln_109, Data2=pln_110)

# ----
# 定位点中可能遗漏
# 上一层筛选中
# 和结构交叉出的点
pln_111 = Plane(cull_i_17)
pln_112 = Plane(cull_i_18)

merge_28 = Merge(Data1=pln_62, Data2=merge_27)

# ----
# 3.1下层建筑内侧到300到外侧50内是否有钢结构
deplane_42 = DeconstructPlane(Plane=pln_111)  # -> Origin, XAxis, YAxis, ZAxis
deplane_43 = DeconstructPlane(Plane=pln_112)  # -> Origin, XAxis, YAxis, ZAxis
check_same_points_9 = CheckSamePoints(archPoint=deplane_43.Origin, crvPoint=deplane_42.Origin)  # -> out, specialPt; inputs archPoint: list of Point3d, crvPoint: list of Point3d; same code as testpoint

orient_6 = Orient(Geometry=item_21, Source=item_22, Target=merge_28)  # -> Geometry, Transform

data_89 = Data(orient_6.Geometry)
bake_6 = BakeObjects(Geometry=data_89, Attributes=attributes_5, BakeName="3-2-03钢板焊埋件", Bake=False)

# ----
# 同时满足N
item_63 = ListItem(List=pln_112, Index=check_same_points_9.specialPt, Wrap=True)

pln_113 = Plane(item_63)
flatten_16 = FlattenTree(Tree=crv_33, Path="{0}")
number_slider_45 = Slider(3584, range=0..10000)
deplane_44 = DeconstructPlane(Plane=pln_113)  # -> Origin, XAxis, YAxis, ZAxis
boundary_6 = BoundarySurfaces(Edges=[offset_7, offset_6])
crv_82 = Curve(flatten_16)
amp_46 = Amplitude(Vector=deplane_44.YAxis, Amplitude=number_slider_45)
amp_47 = Amplitude(Vector=deplane_44.YAxis, Amplitude=expr("-x", number_slider_45))
scx_3 = SurfaceCurve(Surface=boundary_6, Curve=crv_82)  # -> flatten(Curves), Points, UVPoints, Normals, Parameters, Tangents
move_51 = Move(Geometry=deplane_44.Origin, Motion=amp_47)  # -> Geometry, Transform
move_52 = Move(Geometry=deplane_44.Origin, Motion=amp_46)  # -> Geometry, Transform
ln_46 = Line(StartPoint=move_51.Geometry, EndPoint=move_52.Geometry)
ccx_36 = CurveCurve(CurveA=graft(ln_46), CurveB=scx_3.Curves)  # -> Points, ParamsA, ParamsB
shift_18 = ShiftPaths(Data=ccx_36.Points, Offset=-1)
pull_41 = PullPoint(Point=graft(pln_113), Geometry=shift_18, ClosestOnly=True)  # -> ClosestPoint, Distance
sort_48 = SortList(Keys=pull_41.Distance, ValuesA=pull_41.ClosestPoint)  # -> Keys, ValuesA
item_64 = ListItem(List=sort_48.ValuesA, Index=0, Wrap=True)
null_39 = NullItem(Item=sort_48.ValuesA)  # -> NullFlags, simplify(InvalidFlags), Description
dispatch_121 = Dispatch(List=simplify(graft(pln_113)), DispatchPattern=null_39.InvalidFlags)  # -> ListA, ListB
pln_114 = Plane(dispatch_121.ListA)
pln_115 = Plane(dispatch_121.ListB)

dispatch_122 = Dispatch(List=simplify(graft(item_64)), DispatchPattern=null_39.InvalidFlags)  # -> ListA, ListB
pt_45 = Point(dispatch_122.ListB)

# ----
# 按照梁分类定位点
pt_46 = Point(pt_45)
pln_116 = Plane(pln_115)
incurves_35 = PointInCurves(Point=flatten(pt_46), Curves=crv_44)  # -> Relationship, Index, Point
equals_37 = Equality(FirstNumber=incurves_35.Relationship, SecondNumber="0")  # -> Equality, Inequality
dispatch_123 = Dispatch(List=flatten(pln_116), DispatchPattern=equals_37.Inequality)  # -> ListA, ListB
data_90 = Data(dispatch_123.ListA)

incurves_36 = PointInCurves(Point=flatten(pt_46), Curves=crv_44)  # -> Relationship, Index, Point
equals_38 = Equality(FirstNumber=incurves_36.Relationship, SecondNumber="0")  # -> Equality, Inequality
dispatch_124 = Dispatch(List=flatten(pt_46), DispatchPattern=equals_38.Inequality)  # -> ListA, ListB
data_91 = Data(dispatch_124.ListA)

move2pt_36 = MoveToPoint(Geometry=data_90, PointA=data_90, PointB=data_91)  # -> Moved, Vector, Transform
null_40 = NullItem(Item=move2pt_36.Moved)  # -> NullFlags, InvalidFlags, Description
dispatch_125 = Dispatch(List=move2pt_36.Moved, DispatchPattern=null_40.InvalidFlags)  # -> ListA, ListB
pln_117 = Plane(dispatch_125.ListB)

# ----
# 可能的结构交点-大量
pln_118 = Plane(pln_114)

# ----
# 0 檐口出定位点
# 与结构无交点
pln_119 = Plane(flatten(pln_118))

# ----
# 4.1下层建筑内侧300到外侧50内
# 03底埋，钢板焊
pln_120 = Plane(pln_117)

# ----
# 4 Missing Point
# 埋件定位点Offset，没有找到和梁的交点
number_slider_46 = Slider(5000, range=0..10000)
deplane_45 = DeconstructPlane(Plane=pln_119)  # -> Origin, XAxis, YAxis, ZAxis
crv_83 = Curve(scx_3.Curves)
amp_48 = Amplitude(Vector=deplane_45.YAxis, Amplitude=number_slider_46)
move_53 = Move(Geometry=deplane_45.Origin, Motion=amp_48)  # -> Geometry, Transform
ln_47 = Line(StartPoint=move_53.Geometry, EndPoint=deplane_45.Origin)
amp_49 = Amplitude(Vector=deplane_45.XAxis, Amplitude=number_slider_6)
amp_50 = Amplitude(Vector=deplane_45.XAxis, Amplitude=expr("-x", number_slider_6))
move_54 = Move(Geometry=ln_47, Motion=amp_49)  # -> Geometry, Transform
move_55 = Move(Geometry=ln_47, Motion=amp_50)  # -> Geometry, Transform
pln_121 = Plane(pln_119)

ccx_37 = CurveCurve(CurveA=graft(move_55.Geometry), CurveB=flatten(crv_83))  # -> Points, ParamsA, ParamsB
shift_19 = ShiftPaths(Data=ccx_37.Points, Offset=-1)
sort_49 = SortList(Keys=shift_19, ValuesA=shift_19)  # -> Keys, ValuesA
pull_42 = PullPoint(Point=sort_49.ValuesA, Geometry=graft(pln_119), ClosestOnly=True)  # -> ClosestPoint, Distance
sort_50 = SortList(Keys=pull_42.Distance, ValuesA=sort_49.ValuesA)  # -> Keys, ValuesA
item_65 = ListItem(List=sort_50.ValuesA, Index="-1", Wrap=True)
null_41 = NullItem(Item=flatten(item_65))  # -> NullFlags, InvalidFlags, Description
dispatch_126 = Dispatch(List=flatten(item_65), DispatchPattern=null_41.InvalidFlags)  # -> ListA, ListB
dispatch_127 = Dispatch(List=pln_119, DispatchPattern=null_41.InvalidFlags)  # -> ListA, ListB
pln_122 = Plane(dispatch_127.ListB)
pt_47 = Point(dispatch_126.ListB)

ccx_38 = CurveCurve(CurveA=graft(move_54.Geometry), CurveB=flatten(crv_83))  # -> Points, ParamsA, ParamsB
shift_20 = ShiftPaths(Data=ccx_38.Points, Offset=-1)
sort_51 = SortList(Keys=shift_20, ValuesA=shift_20)  # -> Keys, ValuesA
pull_43 = PullPoint(Point=sort_51.ValuesA, Geometry=graft(pln_119), ClosestOnly=True)  # -> ClosestPoint, Distance
sort_52 = SortList(Keys=pull_43.Distance, ValuesA=sort_51.ValuesA)  # -> Keys, ValuesA
item_66 = ListItem(List=sort_52.ValuesA, Index="-1", Wrap=True)
null_42 = NullItem(Item=flatten(item_66))  # -> NullFlags, InvalidFlags, Description
dispatch_128 = Dispatch(List=pln_119, DispatchPattern=null_42.InvalidFlags)  # -> ListA, ListB
dispatch_129 = Dispatch(List=flatten(item_66), DispatchPattern=null_42.InvalidFlags)  # -> ListA, ListB
pt_48 = Point(dispatch_129.ListB)
pln_123 = Plane(dispatch_128.ListB)

merge_29 = Merge(Data1=pln_123, Data2=pln_122)  # -> flatten(Result)
check_same_points_10 = CheckSamePoints(archPoint=flatten(pln_121), crvPoint=merge_29)  # -> out, specialPt; inputs archPoint: list of Point3d, crvPoint: list of Point3d; same code as testpoint

# ----
# pass
cull_i_19 = CullIndex(List=flatten(pln_121), Indices=check_same_points_10.specialPt, Wrap=True)  # -> simplify(graft(List))

# ----
# 按照梁分类定位点
pln_124 = Plane(pln_123)
pt_49 = Point(pt_48)
incurves_37 = PointInCurves(Point=flatten(pt_49), Curves=crv_45)  # -> Relationship, Index, Point
equals_39 = Equality(FirstNumber=incurves_37.Relationship, SecondNumber="0")  # -> Equality, Inequality
dispatch_130 = Dispatch(List=flatten(pln_124), DispatchPattern=equals_39.Inequality)  # -> ListA, ListB
data_92 = Data(dispatch_130.ListA)

# ----
# 按照梁分类定位点
pln_125 = Plane(pln_122)
pt_50 = Point(pt_47)
incurves_38 = PointInCurves(Point=flatten(pt_50), Curves=crv_45)  # -> Relationship, Index, Point
equals_40 = Equality(FirstNumber=incurves_38.Relationship, SecondNumber="0")  # -> Equality, Inequality
dispatch_131 = Dispatch(List=flatten(pln_125), DispatchPattern=equals_40.Inequality)  # -> ListA, ListB
data_93 = Data(dispatch_131.ListA)

incurves_39 = PointInCurves(Point=flatten(pt_50), Curves=crv_45)  # -> Relationship, Index, Point
equals_41 = Equality(FirstNumber=incurves_39.Relationship, SecondNumber="0")  # -> Equality, Inequality
dispatch_132 = Dispatch(List=flatten(pt_50), DispatchPattern=equals_41.Inequality)  # -> ListA, ListB
data_94 = Data(dispatch_132.ListA)

incurves_40 = PointInCurves(Point=flatten(pt_49), Curves=crv_45)  # -> Relationship, Index, Point
equals_42 = Equality(FirstNumber=incurves_40.Relationship, SecondNumber="0")  # -> Equality, Inequality
dispatch_133 = Dispatch(List=flatten(pt_49), DispatchPattern=equals_42.Inequality)  # -> ListA, ListB
data_95 = Data(dispatch_133.ListA)

move2pt_37 = MoveToPoint(Geometry=data_92, PointA=data_92, PointB=data_95)  # -> Moved, Vector, Transform
null_43 = NullItem(Item=move2pt_37.Moved)  # -> NullFlags, InvalidFlags, Description
dispatch_134 = Dispatch(List=move2pt_37.Moved, DispatchPattern=null_43.InvalidFlags)  # -> ListA, ListB
pln_126 = Plane(dispatch_134.ListB)

move2pt_38 = MoveToPoint(Geometry=data_93, PointA=data_93, PointB=data_94)  # -> Moved, Vector, Transform
null_44 = NullItem(Item=move2pt_38.Moved)  # -> NullFlags, InvalidFlags, Description
dispatch_135 = Dispatch(List=move2pt_38.Moved, DispatchPattern=null_44.InvalidFlags)  # -> ListA, ListB
pln_127 = Plane(dispatch_135.ListB)

# ----
# 4.0下层建筑内侧到300到外侧50内
# 无钢结构
# 要求主体结构提供钢结构梁，默认位置为建筑边线向内300mm
number_slider_47 = Slider(300, range=0..1000)
crv_84 = Curve(crv_18)
pln_128 = Plane(cull_i_19)
offset_14 = OffsetCurve(Curve=crv_84, Distance=expr("-x", number_slider_47), Corners=1)
pull_44 = PullPoint(Point=pln_128, Geometry=offset_14, ClosestOnly=True)  # -> ClosestPoint, Distance
sort_53 = SortList(Keys=pull_44.Distance)  # -> Keys, ValuesA
larger_13 = LargerThan(FirstNumber=pull_44.Distance, SecondNumber=Slider(400, range=0..1000))  # -> LargerThan, OrEqualTo
dispatch_136 = Dispatch(List=pln_128, DispatchPattern=larger_13.LargerThan)  # -> ListA, ListB
panel_63 = Panel(sort_53.Keys)
pln_129 = Plane(flatten(dispatch_136.ListB))
number_slider_48 = Slider(3584, range=0..10000)
deplane_46 = DeconstructPlane(Plane=pln_129)  # -> Origin, XAxis, YAxis, ZAxis
amp_51 = Amplitude(Vector=deplane_46.YAxis, Amplitude=number_slider_48)
amp_52 = Amplitude(Vector=deplane_46.YAxis, Amplitude=expr("-x", number_slider_48))
move_56 = Move(Geometry=deplane_46.Origin, Motion=amp_52)  # -> Geometry, Transform
move_57 = Move(Geometry=deplane_46.Origin, Motion=amp_51)  # -> Geometry, Transform
ln_48 = Line(StartPoint=move_56.Geometry, EndPoint=move_57.Geometry)
ccx_39 = CurveCurve(CurveA=ln_48, CurveB=offset_14)  # -> Points, ParamsA, ParamsB
null_45 = NullItem(Item=simplify(ccx_39.Points))  # -> NullFlags, InvalidFlags, Description
flatten_17 = FlattenTree(Tree=ccx_39.Points, Path="{0}")
dispatch_137 = Dispatch(List=simplify(graft(pln_129)), DispatchPattern=null_45.NullFlags)  # -> ListA, ListB
pull_45 = PullPoint(Point=deplane_46.Origin, Geometry=flatten_17, ClosestOnly=True)  # -> ClosestPoint, Distance

# ----
# 撞到梁交点
merge_30 = Merge(Data1=pln_126, Data2=pln_127)

merge_31 = Merge(Data1=flatten(pln_120), Data2=flatten(merge_30))
# Sort Text
orient_7 = Orient(Geometry=item_2, Source=item, Target=merge_31)  # -> Geometry, Transform

data_96 = Data(orient_7.Geometry)
bake_7 = BakeObjects(Geometry=data_96, Attributes=attributes_6, BakeName="4-1钢板焊底埋", Bake=False)

# ----
# 可能的双点
pln_130 = Plane(dispatch_137.ListA)

# ----
# 离结构太远
pln_131 = Plane(dispatch_136.ListA)

merge_32 = Merge(Data1=pln_131, Data2=pln_130)

# ----
# 0 檐口出定位点
# 与结构无交点
pln_132 = Plane(flatten(merge_32))

# ----
# 4.0 默认位置为建筑边线向内300mm
# 侧埋，钢板焊
# 03：钢板焊埋件[钢梁外侧]@钢边梁宽@钢边梁高
move2pt_39 = MoveToPoint(Geometry=pln_129, PointA=deplane_46.Origin, PointB=pull_45.ClosestPoint)  # -> Moved, Vector, Transform

# ----
# 5  Missing Point
# 埋件定位点Offset，没有找到和梁的交点
number_slider_49 = Slider(5000, range=0..10000)
deplane_47 = DeconstructPlane(Plane=pln_65)  # -> Origin, XAxis, YAxis, ZAxis
crv_85 = Curve(crv_74)
amp_53 = Amplitude(Vector=deplane_47.YAxis, Amplitude=number_slider_49)
move_58 = Move(Geometry=deplane_47.Origin, Motion=amp_53)  # -> Geometry, Transform
ln_49 = Line(StartPoint=move_58.Geometry, EndPoint=deplane_47.Origin)
amp_54 = Amplitude(Vector=deplane_47.XAxis, Amplitude=number_slider_6)
amp_55 = Amplitude(Vector=deplane_47.XAxis, Amplitude=expr("-x", number_slider_6))
move_59 = Move(Geometry=ln_49, Motion=amp_54)  # -> Geometry, Transform
move_60 = Move(Geometry=ln_49, Motion=amp_55)  # -> Geometry, Transform
pln_133 = Plane(pln_65)

ccx_40 = CurveCurve(CurveA=graft(move_60.Geometry), CurveB=flatten(crv_85))  # -> Points, ParamsA, ParamsB
shift_21 = ShiftPaths(Data=ccx_40.Points, Offset=-1)
sort_54 = SortList(Keys=shift_21, ValuesA=shift_21)  # -> Keys, ValuesA
pull_46 = PullPoint(Point=sort_54.ValuesA, Geometry=graft(pln_65), ClosestOnly=True)  # -> ClosestPoint, Distance
sort_55 = SortList(Keys=pull_46.Distance, ValuesA=sort_54.ValuesA)  # -> Keys, ValuesA
item_67 = ListItem(List=sort_55.ValuesA, Index="-1", Wrap=True)
null_46 = NullItem(Item=flatten(item_67))  # -> NullFlags, InvalidFlags, Description
dispatch_138 = Dispatch(List=simplify(item_67), DispatchPattern=simplify(graft(null_46.InvalidFlags)))  # -> ListA, ListB
dispatch_139 = Dispatch(List=pln_65, DispatchPattern=null_46.InvalidFlags)  # -> ListA, ListB
pln_134 = Plane(dispatch_139.ListB)
pt_51 = Point(dispatch_138.ListB)

ccx_41 = CurveCurve(CurveA=graft(move_59.Geometry), CurveB=flatten(crv_85))  # -> Points, ParamsA, ParamsB
shift_22 = ShiftPaths(Data=ccx_41.Points, Offset=-1)
sort_56 = SortList(Keys=shift_22, ValuesA=shift_22)  # -> Keys, ValuesA
pull_47 = PullPoint(Point=sort_56.ValuesA, Geometry=graft(pln_65), ClosestOnly=True)  # -> ClosestPoint, Distance
sort_57 = SortList(Keys=pull_47.Distance, ValuesA=sort_56.ValuesA)  # -> Keys, ValuesA
item_68 = ListItem(List=sort_57.ValuesA, Index="-1", Wrap=True)
null_47 = NullItem(Item=flatten(item_68))  # -> NullFlags, InvalidFlags, Description
dispatch_140 = Dispatch(List=simplify(item_68), DispatchPattern=simplify(graft(null_47.InvalidFlags)))  # -> ListA, ListB
dispatch_141 = Dispatch(List=pln_65, DispatchPattern=null_47.InvalidFlags)  # -> ListA, ListB
pln_135 = Plane(dispatch_141.ListB)
pt_52 = Point(dispatch_140.ListB)

merge_33 = Merge(Data1=pln_135, Data2=pln_134)  # -> flatten(Result)
check_same_points_11 = CheckSamePoints(archPoint=flatten(pln_133), crvPoint=merge_33)  # -> out, specialPt; inputs archPoint: list of Point3d, crvPoint: list of Point3d; same code as testpoint

# ----
# 撞到结构
move2pt_40 = MoveToPoint(Geometry=flatten(pln_135), PointA=flatten(pln_135), PointB=flatten(pt_52))  # -> Moved, Vector, Transform
move2pt_41 = MoveToPoint(Geometry=flatten(pln_134), PointA=flatten(pln_134), PointB=flatten(pt_51))  # -> Moved, Vector, Transform

# ----
# pass
cull_i_20 = CullIndex(List=flatten(pln_133), Indices=check_same_points_11.specialPt, Wrap=True)  # -> simplify(graft(List))

# ----
# 撞到梁交点
merge_34 = Merge(Data1=move2pt_40.Moved, Data2=move2pt_41.Moved)

merge_35 = Merge(Data1=move2pt_24.Moved, Data2=merge_34)
orient_8 = Orient(Geometry=item_41, Source=item_42, Target=merge_35)  # -> Geometry, Transform

data_97 = Data(orient_8.Geometry)
bake_8 = BakeObjects(Geometry=data_97, Attributes=attributes_8, BakeName="5-04板埋", Bake=False)

# ----
# 4.0  Missing Point
# 埋件定位点Offset，没有找到和梁的交点
number_slider_50 = Slider(5000, range=0..10000)
deplane_48 = DeconstructPlane(Plane=pln_132)  # -> Origin, XAxis, YAxis, ZAxis
crv_86 = Curve(scx_3.Curves)
amp_56 = Amplitude(Vector=deplane_48.YAxis, Amplitude=number_slider_50)
move_61 = Move(Geometry=deplane_48.Origin, Motion=amp_56)  # -> Geometry, Transform
ln_50 = Line(StartPoint=move_61.Geometry, EndPoint=deplane_48.Origin)
amp_57 = Amplitude(Vector=deplane_48.XAxis, Amplitude=number_slider_6)
amp_58 = Amplitude(Vector=deplane_48.XAxis, Amplitude=expr("-x", number_slider_6))
move_62 = Move(Geometry=ln_50, Motion=amp_57)  # -> Geometry, Transform
move_63 = Move(Geometry=ln_50, Motion=amp_58)  # -> Geometry, Transform
pln_136 = Plane(pln_132)

ccx_42 = CurveCurve(CurveA=graft(move_63.Geometry), CurveB=flatten(crv_86))  # -> Points, ParamsA, ParamsB
shift_23 = ShiftPaths(Data=ccx_42.Points, Offset=-1)
sort_58 = SortList(Keys=shift_23, ValuesA=shift_23)  # -> Keys, ValuesA
pull_48 = PullPoint(Point=sort_58.ValuesA, Geometry=graft(pln_132), ClosestOnly=True)  # -> ClosestPoint, Distance
sort_59 = SortList(Keys=pull_48.Distance, ValuesA=sort_58.ValuesA)  # -> Keys, ValuesA
item_69 = ListItem(List=sort_59.ValuesA, Index="-1", Wrap=True)
null_48 = NullItem(Item=flatten(item_69))  # -> NullFlags, InvalidFlags, Description
dispatch_142 = Dispatch(List=simplify(item_69), DispatchPattern=simplify(graft(null_48.InvalidFlags)))  # -> ListA, ListB
dispatch_143 = Dispatch(List=pln_132, DispatchPattern=null_48.InvalidFlags)  # -> ListA, ListB
pln_137 = Plane(dispatch_143.ListB)
pt_53 = Point(dispatch_142.ListB)

ccx_43 = CurveCurve(CurveA=graft(move_62.Geometry), CurveB=flatten(crv_86))  # -> Points, ParamsA, ParamsB
shift_24 = ShiftPaths(Data=ccx_43.Points, Offset=-1)
sort_60 = SortList(Keys=shift_24, ValuesA=shift_24)  # -> Keys, ValuesA
pull_49 = PullPoint(Point=sort_60.ValuesA, Geometry=graft(pln_132), ClosestOnly=True)  # -> ClosestPoint, Distance
sort_61 = SortList(Keys=pull_49.Distance, ValuesA=sort_60.ValuesA)  # -> Keys, ValuesA
item_70 = ListItem(List=sort_61.ValuesA, Index="-1", Wrap=True)
null_49 = NullItem(Item=flatten(item_70))  # -> NullFlags, InvalidFlags, Description
dispatch_144 = Dispatch(List=simplify(item_70), DispatchPattern=simplify(graft(null_49.InvalidFlags)))  # -> ListA, ListB
dispatch_145 = Dispatch(List=pln_132, DispatchPattern=null_49.InvalidFlags)  # -> ListA, ListB
pln_138 = Plane(dispatch_145.ListB)
pt_54 = Point(dispatch_144.ListB)

merge_36 = Merge(Data1=pln_138, Data2=pln_137)  # -> flatten(Result)
check_same_points_12 = CheckSamePoints(archPoint=flatten(pln_136), crvPoint=merge_36)  # -> out, specialPt; inputs archPoint: list of Point3d, crvPoint: list of Point3d; same code as testpoint

# ----
# 撞到结构
move2pt_42 = MoveToPoint(Geometry=flatten(pln_138), PointA=flatten(pln_138), PointB=flatten(pt_54))  # -> Moved, Vector, Transform
move2pt_43 = MoveToPoint(Geometry=flatten(pln_137), PointA=flatten(pln_137), PointB=flatten(pt_53))  # -> Moved, Vector, Transform

# ----
# 撞到梁交点
merge_37 = Merge(Data1=move2pt_42.Moved, Data2=move2pt_43.Moved)

merge_38 = Merge(Data1=move2pt_39.Moved, Data2=merge_37)

# ----
# pass
cull_i_21 = CullIndex(List=flatten(pln_136), Indices=check_same_points_12.specialPt, Wrap=True)  # -> simplify(graft(List))

orient_9 = Orient(Geometry=item_3, Source=item_4, Target=merge_38)  # -> Geometry, Transform

data_98 = Data(orient_9.Geometry)
bake_9 = BakeObjects(Geometry=data_98, Attributes=attributes_7, BakeName="4-0-03默认钢板焊", Bake=False)

merge_39 = Merge(Data1=merge_22, Data2=merge_25, Data3=merge_28, Data4=merge_31, Data5=merge_38)
null_50 = NullItem(Item=merge_39)  # -> NullFlags, InvalidFlags, Description
dispatch_146 = Dispatch(List=merge_39, DispatchPattern=null_50.InvalidFlags)  # -> ListA, ListB
pt_55 = Point(dispatch_146.ListB)

crv_87 = Curve(project.Geometry)
crv_88 = Curve([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])
merge_40 = Merge(Data1=crv_87, Data2=crv_88)  # -> flatten(Result)

# ----
# curve
crv_89 = Curve(merge_40)

angle_3 = Angle(VectorA=crv_89, VectorB="1,0,0")  # -> Angle, Reflex
deg_6 = Degrees(Radians=angle_3.Angle)
number_2 = NumberGroups(Number=deg_6, Difference="0.2")  # -> Groups, Indices
item_71 = ListItem(List=crv_89, Index=number_2.Indices, Wrap=True)  # -> simplify(Item)
panel_64 = Panel(number_2.Groups)
item_72 = ListItem(List=item_71, Index=0, Wrap=True)  # -> flatten(Item)
item_73 = ListItem(List=item_71, Index=0, Wrap=True)
bang_3 = ExplodeTree(Data=item_71)  # -> Branch0, Branch1, Branch2, Branch3, Branch4, Branch5
crv_90 = Curve(bang_3.Branch0)
crv_91 = Curve(bang_3.Branch1)
crv_92 = Curve(bang_3.Branch2)
crv_93 = Curve(bang_3.Branch3)
angle_4 = Angle(VectorA=item_73, VectorB=item_72)  # -> Angle, Reflex
deg_7 = Degrees(Radians=angle_4.Angle)
round_3 = Round(Number=deg_7, DecimalPlace="0")  # -> Nearest, Floor, Ceiling
equals_43 = Equality(FirstNumber=round_3.Nearest, SecondNumber="90")  # -> Equality, Inequality
panel_65 = Panel(round_3.Nearest)
dispatch_147 = Dispatch(List=item_72, DispatchPattern=equals_43.Equality)  # -> ListA, ListB
crv_94 = Curve(flatten(dispatch_147.ListA))
index = ItemIndex(List=item_72, Item=crv_94)
concat = Concatenate(FragmentA="{", FragmentB=index)
concat_2 = Concatenate(FragmentA=concat, FragmentB="}")
tstat_2 = TreeStatistics(Tree=item_71)  # -> Paths, Length, Count
item_74 = ListItem(List=tstat_2.Paths, Index=0, Wrap=True)  # -> Item, Item1
item_75 = ListItem(List=concat_2, Index=0, Wrap=True)
branch_2 = TreeBranch(Tree=item_71, Path=item_74.Item, MaintainPaths=True)
branch_3 = TreeBranch(Tree=item_71, Path=item_75, MaintainPaths=True)

number_slider_51 = Slider(2000, range=0..10000)
number_slider_52 = Slider(1000, range=0..1000)
crv_95 = Curve(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)
crv_96 = Curve(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)
number_slider_53 = Slider(0.991, range=0..1)
crv_97 = Curve(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)
seam = Seam(Curve=reparameterize(crv_97), Seam=number_slider_53)
eval_5 = EvaluateCurve(Curve=reparameterize(crv_97), Parameter=number_slider_53)  # -> Point, Tangent, Angle
cluster_9 = Cluster_5(
    f2_arch_outline=crv_22,
    location_point=pt_55,
    dim_style="图例2-地上$0$XD100$0",
    directed_outline=seam,
    dim_offset_1=number_slider_51,
    dim_offset_2=number_slider_52,
    outline_curve=crv_95,
    axis_direction_crv1=crv_23,
    axis_direction_crv2=crv_24)  # -> D_3, D_4, D, D_2
cluster_10 = Cluster_6(
    f2_arch_outline=crv_22,
    location_point=pt_55,
    dim_style="图例2-地上$0$XD100$0",
    directed_outline=seam,
    dim_offset_1=number_slider_51,
    dim_offset_2=number_slider_52,
    outline_curve=crv_96,
    axis_direction_crv1=crv_25,
    axis_direction_crv2=crv_26)  # -> D_3, D_4, D, D_2
data_99 = Data(cluster_9.D_3)
data_100 = Data(cluster_9.D_4)
data_101 = Data(cluster_9.D)
data_102 = Data(cluster_9.D_2)
merge_41 = Merge(Data1=data_99, Data2=data_100, Data3=data_101, Data4=data_102)  # -> flatten(Result)
dam = DataDam(DataA=merge_41, BufferDelay=10000000, BufferMode=0)

data_103 = Data(cluster_10.D_3)
data_104 = Data(cluster_10.D_4)
data_105 = Data(cluster_10.D)
data_106 = Data(cluster_10.D_2)

dedim = DeconstructDimension(DimensionObject=dam)  # -> Value, Text, Plane, Points, Style
shift_25 = ShiftPaths(Data=dedim.Text, Offset=-1)
smaller_10 = SmallerThan(FirstNumber=shift_25, SecondNumber=Slider(1, range=0..10))  # -> SmallerThan, OrEqualTo
dispatch_148 = Dispatch(List=dam, DispatchPattern=smaller_10.SmallerThan)  # -> ListA, ListB

merge_42 = Merge(Data1=data_103, Data2=data_104, Data3=data_105, Data4=data_106)  # -> flatten(Result)
dam_2 = DataDam(DataA=merge_42, BufferDelay=10000000, BufferMode=0)
data_107 = Data(dispatch_148.ListB)

dedim_2 = DeconstructDimension(DimensionObject=dam_2)  # -> Value, Text, Plane, Points, Style
shift_26 = ShiftPaths(Data=dedim_2.Text, Offset=-1)
smaller_11 = SmallerThan(FirstNumber=shift_26, SecondNumber=Slider(1, range=0..10))  # -> SmallerThan, OrEqualTo
dispatch_149 = Dispatch(List=dam_2, DispatchPattern=smaller_11.SmallerThan)  # -> ListA, ListB

data_108 = Data(dispatch_149.ListB)

# ==== cluster Cluster
G = ClusterInput()
rotate = Rotate(Geometry=G, Angle=3.141592654, Plane=PlaneXY(0, 0, 0))  # -> Geometry, Transform
boxprop = BoxProperties(Box=rotate.Geometry)  # -> Center, Diagonal, Area, Volume, Degeneracy
bbox = BoundingBox(Content=rotate.Geometry, Plane=PlaneXY(0, 0, 0))  # -> Box, Box_2
debox = DeconstructBox(Box=bbox.Box)  # -> Plane, X, Y, Z
pdecon = Deconstruct(Point=boxprop.Center)  # -> XComponent, YComponent, ZComponent
dedomain = DeconstructDomain(Domain=debox.Y)  # -> Start, End
pt = ConstructPoint(XCoordinate=pdecon.XComponent, YCoordinate=dedomain.Start, ZCoordinate=pdecon.ZComponent)
xy = XYPlane(Origin=Point(0, 0, 0))
pl_origin = PlaneOrigin(Base=xy, Origin=pt)
orient = Orient(Geometry=rotate.Geometry, Source=pl_origin, Target=xy)  # -> Geometry, Transform
G_2 = ClusterOutput(orient.Geometry)

# ==== cluster Cluster_4
A = ClusterInput()
A_2 = ClusterInput()
T = ClusterInput()

# ----
# 列表文字以空格进行分割
panel = Panel(" ")
split = TextSplit(Text=T, Separators=panel)

A_3 = ClusterInput()

钢埋板长度_2 = Division(A=A, B=2)
neg = Negative(Value=钢埋板长度_2)
dom = ConstructDomain(DomainStart=neg, DomainEnd=钢埋板长度_2)
panel_2 = Panel(dom)

钢埋板厚度_2 = Division(A=A_2, B=2)
neg_2 = Negative(Value=钢埋板厚度_2)
dom_2 = ConstructDomain(DomainStart=neg_2, DomainEnd=钢埋板厚度_2)
panel_3 = Panel(dom_2)

# ----
# 钢埋板肋板位置 1/4处
panel_4 = Panel("4")
division = Division(A=A_3, B=panel_4)

# ----
# 编号和截面尺寸分区
panel_5 = Panel("1")
split_2 = SplitList(List=split, Index=panel_5)  # -> flatten(ListA), flatten(ListB)

D = ClusterInput()

# ----
# 求出对应输入编号的钢结构截面尺寸
fsim = FindSimilarMember(Data=D, Set=split_2.ListA)  # -> Hit, Index
item = ListItem(List=split_2.ListB, Index=fsim.Index, Wrap=True)

addition = Addition(A=neg_2, B=division)
addition_2 = Addition(A=钢埋板厚度_2, B=division)
panel_6 = Panel(split_2.ListB)
dom_3 = ConstructDomain(DomainStart=addition, DomainEnd=addition_2)
钢结构截面尺寸 = 钢结构截面尺寸(T=item)
cluster = Cluster_2(L=钢结构截面尺寸, L_2=钢结构截面尺寸, L_4=钢结构截面尺寸, L_3=钢结构截面尺寸)  # -> i, i_2, i_4, i_3
B = ClusterInput()
B_2 = ClusterInput()
B_3 = ClusterInput()
B_4 = ClusterInput()
B_5 = ClusterInput()

# ----
# 钢埋板高度，工字钢尺寸决定
panel_7 = Panel("2")
division_2 = Division(A=cluster.i, B=panel_7)
subtraction = Subtraction(A=division_2, B=cluster.i_3)

钢肋板_侧视图 = 钢肋板侧视图_2(
    B_11=B,
    A_7=cluster.i_2,
    Y=dom_3,
    B_12=cluster.i_4,
    B_13=钢埋板厚度_2,
    B=B_2,
    A=addition,
    B_2=addition_2,
    A_2=division,
    B_3=钢埋板厚度_2,
    x=钢埋板厚度_2,
    A_3=division,
    B_4=B_3,
    B_5=钢埋板厚度_2,
    x_2=钢埋板厚度_2,
    A_4=division,
    B_6=B_4,
    B_7=钢埋板厚度_2,
    x_3=钢埋板厚度_2,
    B_8=B_5,
    x_4=钢埋板厚度_2,
    A_5=division,
    B_9=钢埋板厚度_2,
    A_6=division,
    B_10=钢埋板厚度_2,
    x_5=钢埋板厚度_2)  # -> R, G, R_2
钢埋板_侧视图 = Rectangle(Plane=PlaneXY(0, 0, 0), XSize=dom_2, YSize=dom, Radius=0)  # -> Rectangle, Length
division_3 = Division(A=cluster.i_2, B=2)

侧视图 = Entwine(Branch00=钢埋板_侧视图.Rectangle, Branch01=钢肋板_侧视图.R_2, Branch02=钢肋板_侧视图.G, FlattenInputs=True)
cluster_2 = Cluster_3(G=侧视图, A=subtraction, B=Slider(200, range=0..1000), B_2=钢肋板_侧视图.R)

R = ClusterOutput(division_3)
split_tree = SplitTree(Data=cluster_2, Masks=flatten("{0;0}"))  # -> Positive, Negative
dispatch = Dispatch(List=split_tree.Negative, DispatchPattern=[True, False])  # -> flatten(ListA), ListB
merge = Merge(Data1=split_tree.Positive, Data2=dispatch.ListA)
entwine = Entwine(Branch00=merge, Branch01=dispatch.ListB, FlattenInputs=True)
flatten = FlattenTree(Tree=entwine, Path="{0}")
group = Group(Objects=flatten)
cluster_3 = Cluster(G=group)
ungroup = Ungroup(Group=cluster_3)

# ---- group: Block
layer = DefineLayer(Name="Embeded::Embeded Steel", Color=ColourSwatch(SwatchColor=RGB(255, 140, 140)))
attributes = DefineObjectAttributes(Layer=layer)
block = DefineBlock(Geometry=ungroup, Attributes=attributes, BlockName="Steel Plate", BasePlane=PlaneXY(0, 0, 0))

# ----
deblock = DeconstructBlock(Block=block)  # -> Name, flatten(Plane), flatten(Geometry)
group_2 = Group(Objects=deblock.Geometry)
B_6 = ClusterOutput(block)
bbox = BoundingBox(Content=group_2, Plane=PlaneXY(0, 0, 0))  # -> Box, Box_2
deplane = DeconstructPlane(Plane=deblock.Plane)  # -> Origin, XAxis, YAxis, ZAxis
area = Area(Geometry=bbox.Box)  # -> Area, Centroid
move2pt = MoveToPoint(Geometry=flatten(deplane.Origin), PointA=flatten(deplane.Origin), PointB=flatten(area.Centroid))  # -> Moved, Vector, Transform
pl = ConstructPlane(Origin=move2pt.Moved, XAxis=deplane.YAxis, YAxis=deplane.XAxis)  # -> graft(Plane)
deplane_2 = DeconstructPlane(Plane=pl)  # -> Origin, XAxis, YAxis, ZAxis
rotate = Rotate(Geometry=pl, Angle="Pi", Plane=pl)  # -> Geometry, Transform
dedomain = DeconstructDomain(Domain=dom)  # -> Start, End
multiplication = Multiplication(A=dedomain.Start, B=dedomain.Start)
amp = Amplitude(Vector=deplane_2.YAxis, Amplitude=multiplication)
move = Move(Geometry=deplane_2.Origin, Motion=amp)  # -> Geometry, Transform
srf = Surface(bbox.Box)
crv = Curve(srf)
ln = Line(StartPoint=move.Geometry, EndPoint=deplane_2.Origin)
ccx = CurveCurve(CurveA=ln, CurveB=crv)  # -> Points, ParamsA, ParamsB
ln_2 = Line(StartPoint=deplane_2.Origin, EndPoint=ccx.Points)
move_2 = Move(Geometry=rotate.Geometry, Motion=ln_2)  # -> Geometry, Transform
G = ClusterOutput(move_2.Geometry)

# ==== cluster Cluster_5
directed_outline = ClusterInput()
f2_arch_outline = ClusterInput()
axis_direction_crv2 = ClusterInput()
location_point = ClusterInput()
dim_style = ClusterInput()
dim_offset_1 = ClusterInput()
axis_direction_crv1 = ClusterInput()
dim_offset_2 = ClusterInput()
outline_curve = ClusterInput()

pt = Point(location_point)
crv = Curve(f2_arch_outline)
merge = Merge(Data1=axis_direction_crv1, Data2=axis_direction_crv2)
incurve = PointInCurve(Point=flatten(pt), Curve=outline_curve)  # -> Relationship, Point
equals = Equality(FirstNumber=incurve.Relationship, SecondNumber="0")  # -> Equality, Inequality
dispatch = Dispatch(List=flatten(pt), DispatchPattern=equals.Inequality)  # -> ListA, ListB
pt_2 = Point(dispatch.ListA)
crv_cp = CurveClosestPoint(Point=pt_2, Curve=directed_outline)  # -> Point, Parameter, Distance
sort = SortList(Keys=crv_cp.Parameter, ValuesA=pt_2)  # -> Keys, ValuesA

pt_3 = Point(sort.ValuesA)
shift = ShiftList(List=pt_3, Shift=1, Wrap=invert(True))
dispatch_2 = Dispatch(List=shift, DispatchPattern=[True, False])  # -> ListA, ListB
item = ListItem(List=merge, Index=0, Wrap=True)  # -> Item, Item1
pt_4 = Point(dispatch_2.ListB)
pt_5 = Point(dispatch_2.ListA)
pl = ConstructPlane(Origin=pt_5, XAxis=item.Item1, YAxis=item.Item)
pl_2 = ConstructPlane(Origin=pt_5, XAxis=item.Item, YAxis=item.Item1)

pt_6 = Point(sort.ValuesA)
dispatch_3 = Dispatch(List=pt_6, DispatchPattern=[True, False])  # -> ListA, ListB
item_2 = ListItem(List=merge, Index=0, Wrap=True)  # -> Item, Item1
pt_7 = Point(dispatch_3.ListB)
pt_8 = Point(dispatch_3.ListA)
pl_3 = ConstructPlane(Origin=pt_8, XAxis=item_2.Item1, YAxis=item_2.Item)
pl_4 = ConstructPlane(Origin=pt_8, XAxis=item_2.Item, YAxis=item_2.Item1)

crv_2 = Curve(crv)
deplane = DeconstructPlane(Plane=pl)  # -> Origin, XAxis, YAxis, ZAxis
amp = Amplitude(Vector=deplane.YAxis, Amplitude=Slider(3000, range=0..10000))
move = Move(Geometry=deplane.Origin, Motion=amp)  # -> Geometry, Transform
clscrv = CloseCurve(Curve=crv_2, CloseType=0, Bulge=0.5, Tolerance=0)  # -> Closed, R
pt_9 = Point(move.Geometry)
incurve_2 = PointInCurve(Point=pt_9, Curve=clscrv.Closed)  # -> Relationship, Point
equals_2 = Equality(FirstNumber=incurve_2.Relationship, SecondNumber="2")  # -> Equality, Inequality
lng = ListLength(List=equals_2.Equality)
neg = Negative(Value=dim_offset_1)
lng_2 = ListLength(List=equals_2.Equality)
repeat = RepeatData(Data=graft(neg), Length=lng_2)
repeat_2 = RepeatData(Data=graft(dim_offset_1), Length=lng)
panel = Panel(equals_2.Equality)
dispatch_4 = Dispatch(List=graft(repeat_2), DispatchPattern=graft(equals_2.Equality))  # -> ListA, ListB
dispatch_5 = Dispatch(List=graft(repeat), DispatchPattern=graft(equals_2.Equality))  # -> ListA, ListB
merge_2 = Merge(Data1=dispatch_4.ListA, Data2=dispatch_5.ListB)  # -> flatten(Result)

crv_3 = Curve(crv)
deplane_2 = DeconstructPlane(Plane=pl_3)  # -> Origin, XAxis, YAxis, ZAxis
amp_2 = Amplitude(Vector=deplane_2.YAxis, Amplitude=Slider(3000, range=0..10000))
move_2 = Move(Geometry=deplane_2.Origin, Motion=amp_2)  # -> Geometry, Transform
clscrv_2 = CloseCurve(Curve=crv_3, CloseType=0, Bulge=0.5, Tolerance=0)  # -> Closed, R
pt_10 = Point(move_2.Geometry)
incurve_3 = PointInCurve(Point=pt_10, Curve=clscrv_2.Closed)  # -> Relationship, Point
equals_3 = Equality(FirstNumber=incurve_3.Relationship, SecondNumber="2")  # -> Equality, Inequality
neg_2 = Negative(Value=dim_offset_2)
lng_3 = ListLength(List=equals_3.Equality)
lng_4 = ListLength(List=equals_3.Equality)
repeat_3 = RepeatData(Data=graft(neg_2), Length=lng_4)
repeat_4 = RepeatData(Data=graft(dim_offset_2), Length=lng_3)
panel_2 = Panel(equals_3.Equality)
dispatch_6 = Dispatch(List=graft(repeat_4), DispatchPattern=graft(equals_3.Equality))  # -> ListA, ListB
dispatch_7 = Dispatch(List=graft(repeat_3), DispatchPattern=graft(equals_3.Equality))  # -> ListA, ListB
merge_3 = Merge(Data1=dispatch_6.ListA, Data2=dispatch_7.ListB)  # -> flatten(Result)

crv_4 = Curve(crv)
deplane_3 = DeconstructPlane(Plane=pl_2)  # -> Origin, XAxis, YAxis, ZAxis
amp_3 = Amplitude(Vector=deplane_3.YAxis, Amplitude=Slider(3000, range=0..10000))
move_3 = Move(Geometry=deplane_3.Origin, Motion=amp_3)  # -> Geometry, Transform
clscrv_3 = CloseCurve(Curve=crv_4, CloseType=0, Bulge=0.5, Tolerance=0)  # -> Closed, R
pt_11 = Point(move_3.Geometry)
incurve_4 = PointInCurve(Point=pt_11, Curve=clscrv_3.Closed)  # -> Relationship, Point
equals_4 = Equality(FirstNumber=incurve_4.Relationship, SecondNumber="2")  # -> Equality, Inequality
lng_5 = ListLength(List=equals_4.Equality)
neg_3 = Negative(Value=dim_offset_1)
lng_6 = ListLength(List=equals_4.Equality)
repeat_5 = RepeatData(Data=graft(neg_3), Length=lng_6)
repeat_6 = RepeatData(Data=graft(dim_offset_1), Length=lng_5)
panel_3 = Panel(equals_4.Equality)
dispatch_8 = Dispatch(List=graft(repeat_6), DispatchPattern=graft(equals_4.Equality))  # -> ListA, ListB
dispatch_9 = Dispatch(List=graft(repeat_5), DispatchPattern=graft(equals_4.Equality))  # -> ListA, ListB
merge_4 = Merge(Data1=dispatch_8.ListA, Data2=dispatch_9.ListB)  # -> flatten(Result)

crv_5 = Curve(crv)
deplane_4 = DeconstructPlane(Plane=pl_4)  # -> Origin, XAxis, YAxis, ZAxis
amp_4 = Amplitude(Vector=deplane_4.YAxis, Amplitude=Slider(3000, range=0..10000))
move_4 = Move(Geometry=deplane_4.Origin, Motion=amp_4)  # -> Geometry, Transform
clscrv_4 = CloseCurve(Curve=crv_5, CloseType=0, Bulge=0.5, Tolerance=0)  # -> Closed, R
pt_12 = Point(move_4.Geometry)
incurve_5 = PointInCurve(Point=pt_12, Curve=clscrv_4.Closed)  # -> Relationship, Point
equals_5 = Equality(FirstNumber=incurve_5.Relationship, SecondNumber="2")  # -> Equality, Inequality
lng_7 = ListLength(List=equals_5.Equality)
neg_4 = Negative(Value=dim_offset_2)
lng_8 = ListLength(List=equals_5.Equality)
repeat_7 = RepeatData(Data=graft(neg_4), Length=lng_8)
repeat_8 = RepeatData(Data=graft(dim_offset_2), Length=lng_7)
panel_4 = Panel(equals_5.Equality)
dispatch_10 = Dispatch(List=graft(repeat_8), DispatchPattern=graft(equals_5.Equality))  # -> ListA, ListB
dispatch_11 = Dispatch(List=graft(repeat_7), DispatchPattern=graft(equals_5.Equality))  # -> ListA, ListB
merge_5 = Merge(Data1=dispatch_10.ListA, Data2=dispatch_11.ListB)  # -> flatten(Result)

lineardim = DefineLinearDimension(
    Point1=simplify(pt_5),
    Point2=simplify(pt_4),
    DimensionPlane=simplify(pl),
    Offset=expr("-x", merge_2),
    DimensionStyle=dim_style)
D = ClusterOutput(lineardim)
lineardim_2 = DefineLinearDimension(
    Point1=simplify(pt_5),
    Point2=simplify(pt_4),
    DimensionPlane=simplify(pl_2),
    Offset=expr("-x", merge_4),
    DimensionStyle=dim_style)
D_2 = ClusterOutput(lineardim_2)
lineardim_3 = DefineLinearDimension(
    Point1=simplify(pt_8),
    Point2=simplify(pt_7),
    DimensionPlane=simplify(pl_3),
    Offset=expr("-x", merge_3),
    DimensionStyle=dim_style)
D_3 = ClusterOutput(lineardim_3)
lineardim_4 = DefineLinearDimension(
    Point1=simplify(pt_8),
    Point2=simplify(pt_7),
    DimensionPlane=simplify(pl_4),
    Offset=expr("-x", merge_5),
    DimensionStyle=dim_style)
D_4 = ClusterOutput(lineardim_4)

# ==== cluster Cluster_6
directed_outline = ClusterInput()
f2_arch_outline = ClusterInput()
axis_direction_crv2 = ClusterInput()
location_point = ClusterInput()
dim_style = ClusterInput()
dim_offset_1 = ClusterInput()
axis_direction_crv1 = ClusterInput()
dim_offset_2 = ClusterInput()
outline_curve = ClusterInput()

pt = Point(location_point)
crv = Curve(f2_arch_outline)
merge = Merge(Data1=axis_direction_crv1, Data2=axis_direction_crv2)
incurve = PointInCurve(Point=flatten(pt), Curve=outline_curve)  # -> Relationship, Point
equals = Equality(FirstNumber=incurve.Relationship, SecondNumber="0")  # -> Equality, Inequality
dispatch = Dispatch(List=flatten(pt), DispatchPattern=equals.Inequality)  # -> ListA, ListB
pt_2 = Point(dispatch.ListA)
crv_cp = CurveClosestPoint(Point=pt_2, Curve=directed_outline)  # -> Point, Parameter, Distance
sort = SortList(Keys=crv_cp.Parameter, ValuesA=pt_2)  # -> Keys, ValuesA

pt_3 = Point(sort.ValuesA)
shift = ShiftList(List=pt_3, Shift=1, Wrap=invert(True))
dispatch_2 = Dispatch(List=shift, DispatchPattern=[True, False])  # -> ListA, ListB
item = ListItem(List=merge, Index=0, Wrap=True)  # -> Item, Item1
pt_4 = Point(dispatch_2.ListB)
pt_5 = Point(dispatch_2.ListA)
pl = ConstructPlane(Origin=pt_5, XAxis=item.Item1, YAxis=item.Item)
pl_2 = ConstructPlane(Origin=pt_5, XAxis=item.Item, YAxis=item.Item1)

pt_6 = Point(sort.ValuesA)
dispatch_3 = Dispatch(List=pt_6, DispatchPattern=[True, False])  # -> ListA, ListB
item_2 = ListItem(List=merge, Index=0, Wrap=True)  # -> Item, Item1
pt_7 = Point(dispatch_3.ListB)
pt_8 = Point(dispatch_3.ListA)
pl_3 = ConstructPlane(Origin=pt_8, XAxis=item_2.Item1, YAxis=item_2.Item)
pl_4 = ConstructPlane(Origin=pt_8, XAxis=item_2.Item, YAxis=item_2.Item1)

crv_2 = Curve(crv)
deplane = DeconstructPlane(Plane=pl)  # -> Origin, XAxis, YAxis, ZAxis
amp = Amplitude(Vector=deplane.YAxis, Amplitude=Slider(3000, range=0..10000))
move = Move(Geometry=deplane.Origin, Motion=amp)  # -> Geometry, Transform
clscrv = CloseCurve(Curve=crv_2, CloseType=0, Bulge=0.5, Tolerance=0)  # -> Closed, R
pt_9 = Point(move.Geometry)
incurve_2 = PointInCurve(Point=pt_9, Curve=clscrv.Closed)  # -> Relationship, Point
equals_2 = Equality(FirstNumber=incurve_2.Relationship, SecondNumber="2")  # -> Equality, Inequality
lng = ListLength(List=equals_2.Equality)
neg = Negative(Value=dim_offset_1)
lng_2 = ListLength(List=equals_2.Equality)
repeat = RepeatData(Data=graft(neg), Length=lng_2)
repeat_2 = RepeatData(Data=graft(dim_offset_1), Length=lng)
panel = Panel(equals_2.Equality)
dispatch_4 = Dispatch(List=graft(repeat_2), DispatchPattern=graft(equals_2.Equality))  # -> ListA, ListB
dispatch_5 = Dispatch(List=graft(repeat), DispatchPattern=graft(equals_2.Equality))  # -> ListA, ListB
merge_2 = Merge(Data1=dispatch_4.ListA, Data2=dispatch_5.ListB)  # -> flatten(Result)

crv_3 = Curve(crv)
deplane_2 = DeconstructPlane(Plane=pl_3)  # -> Origin, XAxis, YAxis, ZAxis
amp_2 = Amplitude(Vector=deplane_2.YAxis, Amplitude=Slider(3000, range=0..10000))
move_2 = Move(Geometry=deplane_2.Origin, Motion=amp_2)  # -> Geometry, Transform
clscrv_2 = CloseCurve(Curve=crv_3, CloseType=0, Bulge=0.5, Tolerance=0)  # -> Closed, R
pt_10 = Point(move_2.Geometry)
incurve_3 = PointInCurve(Point=pt_10, Curve=clscrv_2.Closed)  # -> Relationship, Point
equals_3 = Equality(FirstNumber=incurve_3.Relationship, SecondNumber="2")  # -> Equality, Inequality
neg_2 = Negative(Value=dim_offset_2)
lng_3 = ListLength(List=equals_3.Equality)
lng_4 = ListLength(List=equals_3.Equality)
repeat_3 = RepeatData(Data=graft(neg_2), Length=lng_4)
repeat_4 = RepeatData(Data=graft(dim_offset_2), Length=lng_3)
panel_2 = Panel(equals_3.Equality)
dispatch_6 = Dispatch(List=graft(repeat_4), DispatchPattern=graft(equals_3.Equality))  # -> ListA, ListB
dispatch_7 = Dispatch(List=graft(repeat_3), DispatchPattern=graft(equals_3.Equality))  # -> ListA, ListB
merge_3 = Merge(Data1=dispatch_6.ListA, Data2=dispatch_7.ListB)  # -> flatten(Result)

crv_4 = Curve(crv)
deplane_3 = DeconstructPlane(Plane=pl_2)  # -> Origin, XAxis, YAxis, ZAxis
amp_3 = Amplitude(Vector=deplane_3.YAxis, Amplitude=Slider(3000, range=0..10000))
move_3 = Move(Geometry=deplane_3.Origin, Motion=amp_3)  # -> Geometry, Transform
clscrv_3 = CloseCurve(Curve=crv_4, CloseType=0, Bulge=0.5, Tolerance=0)  # -> Closed, R
pt_11 = Point(move_3.Geometry)
incurve_4 = PointInCurve(Point=pt_11, Curve=clscrv_3.Closed)  # -> Relationship, Point
equals_4 = Equality(FirstNumber=incurve_4.Relationship, SecondNumber="2")  # -> Equality, Inequality
lng_5 = ListLength(List=equals_4.Equality)
neg_3 = Negative(Value=dim_offset_1)
lng_6 = ListLength(List=equals_4.Equality)
repeat_5 = RepeatData(Data=graft(neg_3), Length=lng_6)
repeat_6 = RepeatData(Data=graft(dim_offset_1), Length=lng_5)
panel_3 = Panel(equals_4.Equality)
dispatch_8 = Dispatch(List=graft(repeat_6), DispatchPattern=graft(equals_4.Equality))  # -> ListA, ListB
dispatch_9 = Dispatch(List=graft(repeat_5), DispatchPattern=graft(equals_4.Equality))  # -> ListA, ListB
merge_4 = Merge(Data1=dispatch_8.ListA, Data2=dispatch_9.ListB)  # -> flatten(Result)

crv_5 = Curve(crv)
deplane_4 = DeconstructPlane(Plane=pl_4)  # -> Origin, XAxis, YAxis, ZAxis
amp_4 = Amplitude(Vector=deplane_4.YAxis, Amplitude=Slider(3000, range=0..10000))
move_4 = Move(Geometry=deplane_4.Origin, Motion=amp_4)  # -> Geometry, Transform
clscrv_4 = CloseCurve(Curve=crv_5, CloseType=0, Bulge=0.5, Tolerance=0)  # -> Closed, R
pt_12 = Point(move_4.Geometry)
incurve_5 = PointInCurve(Point=pt_12, Curve=clscrv_4.Closed)  # -> Relationship, Point
equals_5 = Equality(FirstNumber=incurve_5.Relationship, SecondNumber="2")  # -> Equality, Inequality
lng_7 = ListLength(List=equals_5.Equality)
neg_4 = Negative(Value=dim_offset_2)
lng_8 = ListLength(List=equals_5.Equality)
repeat_7 = RepeatData(Data=graft(neg_4), Length=lng_8)
repeat_8 = RepeatData(Data=graft(dim_offset_2), Length=lng_7)
panel_4 = Panel(equals_5.Equality)
dispatch_10 = Dispatch(List=graft(repeat_8), DispatchPattern=graft(equals_5.Equality))  # -> ListA, ListB
dispatch_11 = Dispatch(List=graft(repeat_7), DispatchPattern=graft(equals_5.Equality))  # -> ListA, ListB
merge_5 = Merge(Data1=dispatch_10.ListA, Data2=dispatch_11.ListB)  # -> flatten(Result)

lineardim = DefineLinearDimension(
    Point1=simplify(pt_5),
    Point2=simplify(pt_4),
    DimensionPlane=simplify(pl),
    Offset=expr("-x", merge_2),
    DimensionStyle=dim_style)
lineardim_2 = DefineLinearDimension(
    Point1=simplify(pt_5),
    Point2=simplify(pt_4),
    DimensionPlane=simplify(pl_2),
    Offset=expr("-x", merge_4),
    DimensionStyle=dim_style)
lineardim_3 = DefineLinearDimension(
    Point1=simplify(pt_8),
    Point2=simplify(pt_7),
    DimensionPlane=simplify(pl_3),
    Offset=expr("-x", merge_3),
    DimensionStyle=dim_style)
lineardim_4 = DefineLinearDimension(
    Point1=simplify(pt_8),
    Point2=simplify(pt_7),
    DimensionPlane=simplify(pl_4),
    Offset=expr("-x", merge_5),
    DimensionStyle=dim_style)
D = ClusterOutput(lineardim)
D_2 = ClusterOutput(lineardim_2)
D_3 = ClusterOutput(lineardim_3)
D_4 = ClusterOutput(lineardim_4)

# ==== cluster Cluster_7
G = ClusterInput()
T = ClusterInput()
A = ClusterInput()
A_2 = ClusterInput()
A_3 = ClusterInput()
dimension_style = ClusterInput()
B = ClusterInput()
B_2 = ClusterInput()
B_3 = ClusterInput()
B_4 = ClusterInput()
B_5 = ClusterInput()
structure_number = ClusterInput()
text_offset = ClusterInput()

# ----
# 列表文字以空格进行分割
panel = Panel(" ")
split = TextSplit(Text=T, Separators=panel)

钢埋板长度_2 = Division(A=A, B=2)
neg = Negative(Value=钢埋板长度_2)
dom = ConstructDomain(DomainStart=neg, DomainEnd=钢埋板长度_2)
panel_2 = Panel(dom)

钢埋板厚度_2 = Division(A=A_2, B=2)
neg_2 = Negative(Value=钢埋板厚度_2)
dom_2 = ConstructDomain(DomainStart=neg_2, DomainEnd=钢埋板厚度_2)
panel_3 = Panel(dom_2)

# ----
# 钢埋板肋板位置 1/4处
panel_4 = Panel("4")
division = Division(A=A_3, B=panel_4)

# ----
# 编号和截面尺寸分区
panel_5 = Panel("1")
split_2 = SplitList(List=split, Index=panel_5)  # -> flatten(ListA), flatten(ListB)

# ----
# 求出对应输入编号的钢结构截面尺寸
fsim = FindSimilarMember(Data=structure_number, Set=split_2.ListA)  # -> Hit, Index
item = ListItem(List=split_2.ListB, Index=fsim.Index, Wrap=True)

addition = Addition(A=neg_2, B=division)
addition_2 = Addition(A=钢埋板厚度_2, B=division)
dom_3 = ConstructDomain(DomainStart=addition, DomainEnd=addition_2)
panel_6 = Panel(split_2.ListB)
split_3 = TextSplit(Text=item, Separators="x")
split_4 = TextSplit(Text=split_3, Separators="Q")
item_2 = ListItem(List=split_4, Index="0", Wrap=True)  # -> flatten(Item)
subtraction = Subtraction(A=division, B=钢埋板厚度_2)
subtraction_2 = Subtraction(A=division, B=钢埋板厚度_2)
subtraction_3 = Subtraction(A=division, B=钢埋板厚度_2)
neg_3 = Negative(Value=钢埋板厚度_2)
neg_4 = Negative(Value=钢埋板厚度_2)
neg_5 = Negative(Value=钢埋板厚度_2)
subtraction_4 = Subtraction(A=division, B=钢埋板厚度_2)
addition_3 = Addition(A=subtraction, B=B_3)
addition_4 = Addition(A=subtraction_2, B=B_4)
subtraction_5 = Subtraction(A=neg_3, B=B_5)
subtraction_6 = Subtraction(A=neg_4, B="2")
subtraction_7 = Subtraction(A=division, B=钢埋板厚度_2)
addition_5 = Addition(A=subtraction_3, B="2")
subtraction_8 = Subtraction(A=neg_5, B="2")
neg_6 = Negative(Value=钢埋板厚度_2)
neg_7 = Negative(Value=钢埋板厚度_2)
工字钢_h = ListItem(List=item_2, Index=0, Wrap=True)
工字钢_b = ListItem(List=item_2, Index=1, Wrap=True)
工字钢_tf = ListItem(List=item_2, Index=3, Wrap=True)
工字钢_tw = ListItem(List=item_2, Index=2, Wrap=True)
pt = ConstructPoint(XCoordinate=neg_6, YCoordinate=subtraction_4, ZCoordinate=0)
pt_2 = ConstructPoint(XCoordinate=neg_7, YCoordinate=addition_3, ZCoordinate=0)
pt_3 = ConstructPoint(XCoordinate=subtraction_5, YCoordinate=addition_4, ZCoordinate=0)
pt_4 = ConstructPoint(XCoordinate=subtraction_6, YCoordinate=subtraction_7, ZCoordinate=0)
pt_5 = ConstructPoint(XCoordinate=subtraction_8, YCoordinate=addition_5, ZCoordinate=0)
subtraction_9 = Subtraction(A=工字钢_b, B=工字钢_tw)
division_2 = Division(A=subtraction_9, B="2")
merge = Merge(Data1=pt, Data2=pt_2, Data3=pt_3, Data4=pt_5, Data5=pt_4)
pline = PolyLine(Vertices=merge, Closed=True)
division_3 = Division(A=division_2, B="2")
subtraction_10 = Subtraction(A=division_3, B=B)
subtraction_11 = Subtraction(A=division_3, B=钢埋板厚度_2)
neg_8 = Negative(Value=division_3)
subtraction_12 = Subtraction(A=neg_8, B=subtraction_11)
addition_6 = Addition(A=subtraction_12, B=B_2)
dom_4 = ConstructDomain(DomainStart=addition_6, DomainEnd=subtraction_12)
dom_5 = ConstructDomain(DomainStart=addition, DomainEnd=addition_2)
钢肋板倒角_侧视图 = Rectangle(Plane=PlaneXY(0, 0, 0), XSize=dom_4, YSize=dom_5, Radius=0)  # -> Rectangle, Length
subtraction_13 = Subtraction(A=subtraction_10, B=subtraction_11)
subtraction_14 = Subtraction(A=neg_8, B=subtraction_11)
dom_6 = ConstructDomain(DomainStart=subtraction_13, DomainEnd=subtraction_14)
钢肋板_侧视图 = Rectangle(Plane=PlaneXY(0, 0, 0), XSize=dom_6, YSize=dom_3, Radius=0)  # -> Rectangle, Length
merge_2 = Merge(Data1=钢肋板_侧视图.Rectangle, Data2=pline, Data3=钢肋板倒角_侧视图.Rectangle)
xz = XZPlane(Origin=Point(0, 0, 0))
mirror = Mirror(Geometry=merge_2, Plane=xz)  # -> Geometry, Transform
钢埋板_侧视图 = Rectangle(Plane=PlaneXY(0, 0, 0), XSize=dom_2, YSize=dom, Radius=0)  # -> Rectangle, Length
division_4 = Division(A=工字钢_b, B=2)
R = ClusterOutput(division_4)
侧视图 = Entwine(Branch00=钢埋板_侧视图.Rectangle, Branch01=merge_2, Branch02=mirror.Geometry, FlattenInputs=True)
division_5 = Division(A=工字钢_h, B="2")
subtraction_15 = Subtraction(A=division_5, B=工字钢_tf)
addition_7 = Addition(A=subtraction_15, B=Slider(200, range=0..1000))
addition_8 = Addition(A=addition_7, B=division_2)
X = UnitX(Factor=addition_8)
move = Move(Geometry=侧视图, Motion=X)  # -> Geometry, Transform
split_tree = SplitTree(Data=move.Geometry, Masks=flatten("{0;0}"))  # -> Positive, Negative
dispatch = Dispatch(List=split_tree.Negative, DispatchPattern=[True, False])  # -> flatten(ListA), ListB
merge_3 = Merge(Data1=split_tree.Positive, Data2=dispatch.ListA)
entwine = Entwine(Branch00=merge_3, Branch01=dispatch.ListB, FlattenInputs=True)
flatten = FlattenTree(Tree=entwine, Path="{0}")
group = Group(Objects=flatten)
rotate = Rotate(Geometry=group, Angle=3.141592654, Plane=PlaneXY(0, 0, 0))  # -> Geometry, Transform
boxprop = BoxProperties(Box=rotate.Geometry)  # -> Center, Diagonal, Area, Volume, Degeneracy
bbox = BoundingBox(Content=rotate.Geometry, Plane=PlaneXY(0, 0, 0))  # -> Box, Box_2
debox = DeconstructBox(Box=bbox.Box)  # -> Plane, X, Y, Z
pdecon = Deconstruct(Point=boxprop.Center)  # -> XComponent, YComponent, ZComponent
dedomain = DeconstructDomain(Domain=debox.Y)  # -> Start, End
pt_6 = ConstructPoint(XCoordinate=pdecon.XComponent, YCoordinate=dedomain.Start, ZCoordinate=pdecon.ZComponent)
xy = XYPlane(Origin=Point(0, 0, 0))
pl_origin = PlaneOrigin(Base=xy, Origin=pt_6)
orient = Orient(Geometry=rotate.Geometry, Source=pl_origin, Target=xy)  # -> Geometry, Transform
xy_2 = XYPlane(Origin=Point(0, 0, 0))
ungroup = Ungroup(Group=orient.Geometry)

# ---- group: Block
layer = DefineLayer(Name="Embeded::Embeded Steel", Color=ColourSwatch(SwatchColor=RGB(255, 140, 140)))
attributes = DefineObjectAttributes(Layer=layer)
block = DefineBlock(Geometry=ungroup, Attributes=attributes, BlockName="Steel Plate", BasePlane=PlaneXY(0, 0, 0))

# ----
deblock = DeconstructBlock(Block=block)  # -> Name, flatten(Plane), flatten(Geometry)
group_2 = Group(Objects=deblock.Geometry)
bbox_2 = BoundingBox(Content=group_2, Plane=PlaneXY(0, 0, 0))  # -> Box, Box_2
deplane = DeconstructPlane(Plane=deblock.Plane)  # -> Origin, XAxis, YAxis, ZAxis
area = Area(Geometry=bbox_2.Box)  # -> Area, Centroid
move2pt = MoveToPoint(Geometry=flatten(deplane.Origin), PointA=flatten(deplane.Origin), PointB=flatten(area.Centroid))  # -> Moved, Vector, Transform
pl = ConstructPlane(Origin=move2pt.Moved, XAxis=deplane.YAxis, YAxis=deplane.XAxis)  # -> graft(Plane)
deplane_2 = DeconstructPlane(Plane=pl)  # -> Origin, XAxis, YAxis, ZAxis
rotate_2 = Rotate(Geometry=pl, Angle="Pi", Plane=pl)  # -> Geometry, Transform
dedomain_2 = DeconstructDomain(Domain=dom)  # -> Start, End
multiplication = Multiplication(A=dedomain_2.Start, B=dedomain_2.Start)
amp = Amplitude(Vector=deplane_2.YAxis, Amplitude=multiplication)
move_2 = Move(Geometry=deplane_2.Origin, Motion=amp)  # -> Geometry, Transform
srf = Surface(bbox_2.Box)
crv = Curve(srf)
ln = Line(StartPoint=move_2.Geometry, EndPoint=deplane_2.Origin)
ccx = CurveCurve(CurveA=ln, CurveB=crv)  # -> Points, ParamsA, ParamsB
ln_2 = Line(StartPoint=deplane_2.Origin, EndPoint=ccx.Points)
move_3 = Move(Geometry=rotate_2.Geometry, Motion=ln_2)  # -> Geometry, Transform

ln_3 = Line(StartPoint=ccx.Points, EndPoint=deplane_2.Origin)
amp_2 = Amplitude(Vector=ln_3, Amplitude=text_offset)
move_4 = Move(Geometry=rotate_2.Geometry, Motion=amp_2)  # -> Geometry, Transform
text = DefineTextObject(Text="1-1", Plane=move_4.Geometry, DimensionStyle=dimension_style, OutputType="Text")
group_3 = Group(Objects=[block, text])

entwine_2 = Entwine(Branch00=group_3, Branch01=move_3.Geometry, FlattenInputs=True)
R_2 = ClusterOutput(entwine_2)
project = Project(Geometry=G, Plane=xy_2)  # -> Geometry, Transform
G_2 = ClusterOutput(project.Geometry)

# ==== cluster 钢结构截面尺寸
T = ClusterInput()
split = TextSplit(Text=T, Separators="x")
split_2 = TextSplit(Text=split, Separators="Q")
item = ListItem(List=split_2, Index="0", Wrap=True)  # -> flatten(Item)
i = ClusterOutput(item)

# ==== cluster Cluster_2
L = ClusterInput()
L_2 = ClusterInput()
L_3 = ClusterInput()
L_4 = ClusterInput()
工字钢_h = ListItem(List=L, Index=0, Wrap=True)
工字钢_b = ListItem(List=L_2, Index=1, Wrap=True)
工字钢_tf = ListItem(List=L_3, Index=3, Wrap=True)
工字钢_tw = ListItem(List=L_4, Index=2, Wrap=True)
i = ClusterOutput(工字钢_h)
i_2 = ClusterOutput(工字钢_b)
i_3 = ClusterOutput(工字钢_tf)
i_4 = ClusterOutput(工字钢_tw)

# ==== cluster 钢肋板侧视图_2
B = ClusterInput()
A = ClusterInput()
B_2 = ClusterInput()
A_2 = ClusterInput()
B_3 = ClusterInput()
x = ClusterInput()
A_3 = ClusterInput()
B_4 = ClusterInput()
B_5 = ClusterInput()
x_2 = ClusterInput()
A_4 = ClusterInput()
B_6 = ClusterInput()
B_7 = ClusterInput()
x_3 = ClusterInput()
B_8 = ClusterInput()
x_4 = ClusterInput()
A_5 = ClusterInput()
B_9 = ClusterInput()
A_6 = ClusterInput()
B_10 = ClusterInput()
x_5 = ClusterInput()
B_11 = ClusterInput()
A_7 = ClusterInput()
Y = ClusterInput()
B_12 = ClusterInput()
B_13 = ClusterInput()
侧视图_焊缝截面 = 侧视图焊缝截面(
    A_4=A_2,
    B_4=B_3,
    x_4=x,
    A=A_3,
    B_5=B_4,
    B=B_5,
    x_5=x_2,
    A_2=A_4,
    B_6=B_6,
    B_2=B_7,
    x=x_3,
    B_7=B_8,
    x_2=x_4,
    A_5=A_5,
    B_8=B_9,
    A_3=A_6,
    B_3=B_10,
    x_3=x_5)
钢肋板_侧视图 = 钢肋板侧视图(B_2=B_11, A=A_7, Y=Y, B=B_12, B_3=B_13)  # -> R_3, R, y, R_2
钢肋板倒角_侧视图 = 钢肋板倒角侧视图(A=钢肋板_侧视图.y, B=钢肋板_侧视图.R_2, B_2=B, A_2=A, B_3=B_2)
R = ClusterOutput(钢肋板_侧视图.R)
merge = Merge(Data1=钢肋板_侧视图.R_3, Data2=侧视图_焊缝截面, Data3=钢肋板倒角_侧视图)
xz = XZPlane(Origin=Point(0, 0, 0))
mirror = Mirror(Geometry=merge, Plane=xz)  # -> Geometry, Transform
R_2 = ClusterOutput(merge)
G = ClusterOutput(mirror.Geometry)

# ==== cluster Cluster_3
A = ClusterInput()
B = ClusterInput()
B_2 = ClusterInput()
addition = Addition(A=A, B=B)
addition_2 = Addition(A=addition, B=B_2)
G = ClusterInput()
X = UnitX(Factor=addition_2)
move = Move(Geometry=G, Motion=X)  # -> Geometry, Transform
G_2 = ClusterOutput(move.Geometry)

# ==== cluster 钢肋板侧视图
A = ClusterInput()
B = ClusterInput()
subtraction = Subtraction(A=A, B=B)
division = Division(A=subtraction, B="2")
R = ClusterOutput(division)
division_2 = Division(A=division, B="2")
B_2 = ClusterInput()
B_3 = ClusterInput()
subtraction_2 = Subtraction(A=division_2, B=B_2)
subtraction_3 = Subtraction(A=division_2, B=B_3)
neg = Negative(Value=division_2)
y = ClusterOutput(neg)
R_2 = ClusterOutput(subtraction_3)
subtraction_4 = Subtraction(A=subtraction_2, B=subtraction_3)
subtraction_5 = Subtraction(A=neg, B=subtraction_3)
dom = ConstructDomain(DomainStart=subtraction_4, DomainEnd=subtraction_5)
Y = ClusterInput()
钢肋板_侧视图 = Rectangle(Plane=PlaneXY(0, 0, 0), XSize=dom, YSize=Y, Radius=0)  # -> Rectangle, Length
R_3 = ClusterOutput(钢肋板_侧视图.Rectangle)

# ==== cluster 侧视图焊缝截面
A = ClusterInput()
B = ClusterInput()
A_2 = ClusterInput()
B_2 = ClusterInput()
A_3 = ClusterInput()
B_3 = ClusterInput()
x = ClusterInput()
x_2 = ClusterInput()
x_3 = ClusterInput()
A_4 = ClusterInput()
B_4 = ClusterInput()
B_5 = ClusterInput()
B_6 = ClusterInput()
B_7 = ClusterInput()
A_5 = ClusterInput()
B_8 = ClusterInput()
x_4 = ClusterInput()
x_5 = ClusterInput()
subtraction = Subtraction(A=A, B=B)
subtraction_2 = Subtraction(A=A_2, B=B_2)
subtraction_3 = Subtraction(A=A_3, B=B_3)
neg = Negative(Value=x)
neg_2 = Negative(Value=x_2)
neg_3 = Negative(Value=x_3)
subtraction_4 = Subtraction(A=A_4, B=B_4)
addition = Addition(A=subtraction, B=B_5)
addition_2 = Addition(A=subtraction_2, B=B_6)
subtraction_5 = Subtraction(A=neg, B=B_7)
subtraction_6 = Subtraction(A=neg_2, B="2")
subtraction_7 = Subtraction(A=A_5, B=B_8)
addition_3 = Addition(A=subtraction_3, B="2")
subtraction_8 = Subtraction(A=neg_3, B="2")
neg_4 = Negative(Value=x_4)
neg_5 = Negative(Value=x_5)
pt = ConstructPoint(XCoordinate=neg_4, YCoordinate=subtraction_4, ZCoordinate=0)
pt_2 = ConstructPoint(XCoordinate=neg_5, YCoordinate=addition, ZCoordinate=0)
pt_3 = ConstructPoint(XCoordinate=subtraction_5, YCoordinate=addition_2, ZCoordinate=0)
pt_4 = ConstructPoint(XCoordinate=subtraction_6, YCoordinate=subtraction_7, ZCoordinate=0)
pt_5 = ConstructPoint(XCoordinate=subtraction_8, YCoordinate=addition_3, ZCoordinate=0)
merge = Merge(Data1=pt, Data2=pt_2, Data3=pt_3, Data4=pt_5, Data5=pt_4)
pline = PolyLine(Vertices=merge, Closed=True)
pl = ClusterOutput(pline)

# ==== cluster 钢肋板倒角侧视图
A = ClusterInput()
B = ClusterInput()
B_2 = ClusterInput()
subtraction = Subtraction(A=A, B=B)
A_2 = ClusterInput()
B_3 = ClusterInput()
addition = Addition(A=subtraction, B=B_2)
dom = ConstructDomain(DomainStart=addition, DomainEnd=subtraction)
dom_2 = ConstructDomain(DomainStart=A_2, DomainEnd=B_3)
钢肋板倒角_侧视图 = Rectangle(Plane=PlaneXY(0, 0, 0), XSize=dom, YSize=dom_2, Radius=0)  # -> Rectangle, Length
R = ClusterOutput(钢肋板倒角_侧视图.Rectangle)
