# Grasshopper definition FacadeEmbed_JinQiao_Podium1121.gh (Grasshopper 1.0.7)
# plug-ins: EleFront, TT Toolbox, Pufferfish, Hare, treesloth01

# ----
# 线段延长长度
number_slider = Slider(1001, range=0..10000)  # disabled

# ----
# remove duplicate curves
geo = Geometry()  # disabled
number_slider_2 = Slider(0.1, range=0..0.1)  # disabled
boundary = BoundarySurfaces(Edges=geo)  # disabled
area = Area(Geometry=boundary)  # -> Area, Centroid; disabled
cullduppoints = RemoveDuplicatePoints(InputPoints=area.Centroid, Tolerance=number_slider_2)  # -> OutputPoints, FirstPointIndexes; disabled
null = NullItem(Item=cullduppoints.FirstPointIndexes)  # -> NullFlags, InvalidFlags, Description; disabled
dispatch = Dispatch(List=boundary, DispatchPattern=null.NullFlags)  # -> ListA, ListB; disabled
geo_2 = Geometry(dispatch.ListA)  # disabled

# ----
# 调换阴阳角设定
toggle = BooleanToggle(False)  # disabled

# ---- group: 檐口定位点
circle = Curve(<curve referenced from the Rhino model>)

# ---- group: 上层定位点的circle
circle_2 = Curve(<curve referenced from the Rhino model>)

# ---- group: 下层定位点的circle
circle_3 = Curve(<curve referenced from the Rhino model>)

# ----
# (1) 导入代表埋件定位点的circle
# 注意：
# 1.请将上下两层的定位点所对应的circle分别放在2个不同Rhino图层
# 2.导入完之后可能需要都点一下Update
layer = ObjectLayer(Guid=circle_2)  # -> LayerIndex, LayerPathName
layer_2 = ObjectLayer(Guid=circle_3)  # -> LayerIndex, LayerPathName
layer_3 = ObjectLayer(Guid=circle)  # -> LayerIndex, LayerPathName
reflay = ReferenceByLayer(LayerName=layer_3.LayerPathName)

# ---- group: Click Me after Input
reflay_2 = ReferenceByLayer(LayerName=layer_2.LayerPathName)

reflay_3 = ReferenceByLayer(LayerName=layer.LayerPathName)

# ----
# Step1.输入block names
# Step2:点击Update按钮
data = Data(["PX-GLAZ-F2$0$PX-GLAZ-F2$0$fin", "PX-GLAZ-F2$0$PX-GLAZ-F1$0$fin"])
panel = Panel(data)
# （1）导入埋件定位点
panel_2 = Panel("")
refblock = ReferenceBlockByName(BlockName=panel)

# ----
# Input Curves
# 
# Step1：选中其中一个curve,得到该图层所有curves
# Step2：点击Update按钮
crv = Curve(<curve referenced from the Rhino model>)

# ----
# (Block & Curve的形式)
# Input Blocks (Plane的Y轴向外)
# 
# Step1.输入Block所在图层
# Step2:点击Update按钮
data_2 = Data(["PX-GLAZ-F2$0$PX-GLAZ-F1$0$标准块", "PX-GLAZ-F2$0$PX-GLAZ-F2$0$标准块", "PX-GLAZ-F2$0$PX-GLAZ-F3$0$标准块"])

# ----
# block names
listblockd = ListBlockDocument()

# ----
# Input Blocks (Plane的Y轴向内)
# 
# Step1:输入Block所在图层
# Step2:点击Update按钮
data_3 = Data("PX-GLAZ-F2$0$T3T")

# ---- group: 楼板线
# （2）导入单体建筑的参考线
# 导入上层幕墙线
crv_2 = Curve(<curve referenced from the Rhino model>)

# ---- group: 檐口线-外侧
crv_3 = Curve(<curve referenced from the Rhino model>)

# ---- group: 檐口线-内侧
crv_4 = Curve([<curve referenced from the Rhino model> x2])

# ---- group: 下层All幕墙线
# 导入檐口线
# 注意：如果没有檐口线或没有内测檐口线，一定要确保对应需要导入檐口线curve的区域为空data
crv_5 = Curve([<curve referenced from the Rhino model> x3])

# ---- group: 导入下层单体幕墙线
# 导入下层幕墙线
crv_6 = Curve(<curve referenced from the Rhino model>)

# ----
# 输入
# 
# Embed的Tag命名
# 埋件编号
panel_3 = Panel("5-5")

# ----
# 长
panel_4 = Panel("-175 To 175")

# ---- group: 导入上层单体幕墙线
crv_7 = Curve(<curve referenced from the Rhino model>)

# ----
# 宽
panel_5 = Panel("-125 To 125")

# ----
# 输入标注样式
panel_6 = Panel("图例2-地上$0$XD100$0")

# ---- group: 导入上层All-外部幕墙线
crv_8 = Curve([<curve referenced from the Rhino model> x3])

# ---- group: 上层-内部幕墙线
crv_9 = Curve(<curve referenced from the Rhino model>)

# ----
# 埋件编号tag的Offset
number_slider_3 = Slider(190, range=0..1000)

# ----
# 钢埋板长度（按需设定）
number_slider_4 = Slider(350, range=0..1000)

# ----
# 钢埋板厚度（按需设定）
number_slider_5 = Slider(16, range=0..100)

# ----
# 肋板倒角距离（按需设定）
number_slider_6 = Slider(30, range=0..100)

# ----
# Dimension Style
panel_7 = Panel("图例2-地上$0$XD100$0")

# ----
# （5）导入Default Embed
# 输入
# 
# 1.Embed的结构编号
# 2.Embed的Tag命名
# 需要出图的钢结构编号
panel_8 = Panel("GL3-3H")

# ----
# Embed Layer Color
swatch = ColourSwatch(SwatchColor=RGB(136, 235, 148))

# ----
# Dimension Style
panel_9 = Panel("图例2-地上$0$XD100$0")

# ----
# (8) 撞到梁交点-Offset
number_slider_7 = Slider(450, range=0..1000)

# ----
# 埋件编号tag的Offset
number_slider_8 = Slider(353, range=0..1000)

# ----
# 埋件编号tag
panel_10 = Panel("6-6")

# ---- group: 混凝土
# 板埋几何INPUT
list = ValueList({"C15": 0, "C20": 1, "C25": 2, "C30": 3, "C35": 4, "C40": 5}, selected="C35")

# ---- group: 钢筋牌号
list_2 = ValueList({"HPB300": 0, "HRB400": 1}, selected="HPB300")

# ---- group: 直径
list_3 = ValueList({"10": 0, "12": 1, "16": 2, "18": 3, "20": 4, "25": 5}, selected="12")

# ---- group: 锚筋间距
s_y = Slider(22, range=14..60, expression="X*5")
s_x = Slider(22, range=14..60, expression="X*5")

# ---- group: 列
list_4 = ValueList({"2X": 0, "3X": 1, "4X": 2}, selected="3X")

# ---- group: 行
# （7）生成底埋钢埋件
list_5 = ValueList({"2Y": 0, "3Y": 1, "4Y": 2}, selected="2Y")

# ----
# 钢结构截面列表
txt = Text(["GKL4-1\tH 400x250x16x20", "GKL4-2\tH 400x350x12x30", "GKL4-3\tH 400x350x16x35", "GKL5-1\tH 500x200x14x25", "GKL5-2\tH 500x300x14x20", "GKL5a-1\tH 550x250x12x25", "GKL6-1\tH 600x200x12x18", "GKL6-2\tH 600x300x14x20", "GKL6-3\tH 600x350x12x25", "GKL6-4\tH 600x350x16x35", "GKL7-1\tH 700x300x16x25", "GKL7-2\tH 700x350x14x25", "GKL7-3\tH 700x350x14x30", "GKL7-4\tH 700x350x14x35", "GKL8-1\tH 800x300x20x25", "GKL8-2\tH 800x300x20x40", "GKL8-3\tH 800x400x25x30", "GKL8-4\tH 800x400x25x35", "GKL9-1\tH 900x300x20x30", "GKL9-2\tH 900x400x20x40", "GKL9-3\tH 900x500x20x40", "GKL9-4\tH 900x300x20x40", "GKL10-1\tH 1000x500x20x30", "GKL10-2\tH 1000x500x20x40", "GKL10-3\tH 1000x500x20x35", "GKL10-4\tH 1000x600x20x40", "GKL12-1\tH 1200x400x20x50", "GKL12-2\tH 1200x600x25x50", "GL2A-1\tHN 250x125x6x9", "GL3-1\tHN 300x150x6.5x9", "GL3-2\tH 300x100x8x10", "GL3-3\tH 300x200x8x16", "GL3-4\tHW 300x300x10x15", "GL4-1\tHN 400x200x8x13", "GL4-2\tH 400x200x10x16", "GL4-3\tH 400x250x10x20", "GL4-4\tH 400x350x16x35", "GL4a-1\tH 450x200x9x14", "GL5-1\tHN 500x200x10x16", "GL5-2\tH 500x200x10x20", "GL5-3\tH 500x300x14x20", "GL5a-1\tH 550x250x10x25", "GL5a-2\tH 550x300x14x25", "GL6-1\tHN 600x200x11x17", "GL6-2\tH 600x300x12x20", "GL6-3\tH 600x350x12x25", "GL6-4\tH 600x350x16x35", "GL7-1\tHN 700x300x13x24", "GL7-2\tH 700x350x14x30", "GL7-3\tH 700x350x14x35", "GL8-1\tHN 800x300x14x26", "GL8-2\tH 800x300x20x40", "GL9-1\tH 900x300x20x30", "GL9-2\tH 900x400x20x40", "GL10-1\tH 1000x400x20x30", "GL10-2\tH 1000x500x20x30", "GL10-3\tH 1000x500x20x35", "GL10-4\tH 1000x400x20x40", "GL10-5\tH 1000x500x20x40", "GL12-1\tH 1200x400x25x50"])

# ----
# 钢埋板长度（按需设定）
number_slider_9 = Slider(350, range=0..1000)

# ----
# 钢埋板厚度（按需设定）
number_slider_10 = Slider(16, range=0..100)

# ----
# 肋板倒角距离（按需设定）
number_slider_11 = Slider(30, range=0..100)

# ----
# 埋件编号tag
panel_11 = Panel("0-0")

# ----
# 埋件编号tag的Offset
number_slider_12 = Slider(300, range=0..1000)

# ----
# 钢结构截面列表
txt_2 = Text(txt)

# ---- group: 输入梁编号Texts所在图层
panel_12 = Panel("text-def")

# ---- group: 导入一条梁中线
# （4）导入梁中线+结构编号，生成对应的钢板焊埋件
crv_10 = Curve(<curve referenced from the Rhino model>)

# ----
# 手动输入埋件Tag
panel_13 = Panel("""1-1
2-2""")

# ---- group: 参考线起点
number_slider_13 = Slider(0.806, range=0..1)

# ---- group: Dimension Offset Input 2
number_slider_14 = Slider(1000, range=0..1000)

# ---- group: 移除重复位置点-容差
number_slider_15 = Slider(200, range=0..1000)

# ---- group: Dimension Offset Input 1
number_slider_16 = Slider(2000, range=0..10000)

# ---- group: 标注区域-单一轴网
标准范围_符合单一轴网方向 = Curve(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)

# ---- group: 轴网XY2个方向的线
crv_11 = Curve(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)
crv_12 = Curve(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)

# ---- group: 参考线: 符合轴网方向+囊括整个建筑
# (9)Bake Me!!
# 下层图纸-单一区域
crv_13 = Curve(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)

# ---- group: 移除重复位置点-容差
number_slider_17 = Slider(200, range=0..1000)

# ---- group: 参考线起点
number_slider_18 = Slider(0.548, range=0..1)

# ---- group: Dimension Offset Input 2
number_slider_19 = Slider(1000, range=0..1000)

# ---- group: Dimension Offset Input 1
number_slider_20 = Slider(2000, range=0..10000)

# ---- group: 标注区域-单一轴网
标准范围_符合单一轴网方向_2 = Curve(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)

# ---- group: 轴网XY2个方向的线
crv_14 = Curve(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)
crv_15 = Curve(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)

# ----
layer_4 = ObjectLayer(Guid=crv)  # -> LayerIndex, LayerPathName
panel_14 = Panel(data_2)
panel_16 = Panel(layer_4.LayerPathName)
panel_17 = Panel(data_3)
refblock_2 = ReferenceBlockByName(BlockName=panel_14)
refblock_3 = ReferenceBlockByName(BlockName=panel_17)
reflay_4 = ReferenceByLayer(LayerName=panel_16)

# ---- group: 参考线: 符合轴网方向+囊括整个建筑
# (9)Bake Me!!
# 上层图纸-单一区域
crv_16 = Curve(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)

# ----
# 导入梁中线+结构编号
# 注意：
# 导入完之后可能要点一下Update确保导入成功
layer_5 = ObjectLayer(Guid=crv_10)  # -> LayerIndex, LayerPathName
reflay_5 = ReferenceByLayer(LayerName=layer_5.LayerPathName)
reflay_6 = ReferenceByLayer(LayerName=panel_12)

panel_18 = Panel(txt)

clscrv = CloseCurve(Curve=crv_6, CloseType=0, Bulge=0.5, Tolerance=0)  # -> Closed, R
clscrv_2 = CloseCurve(Curve=crv_7, CloseType=0, Bulge=0.5, Tolerance=0)  # -> Closed, R

panel_19 = Panel(txt_2)

clscrv_3 = CloseCurve(Curve=crv_2, CloseType=0, Bulge=0.5, Tolerance=0)  # -> Closed, R

# ----
# （0）准备阶段
# 检测各个图层Block的Plane
panel_20 = Panel(listblockd)
deblock = DeconstructBlock(Block=refblock)  # -> Name, Plane, Geometry

# ----
# Step3.检测plane是否存在+查看Plane的Y轴方向
pln = Plane(deblock.Plane)

deblock_2 = DeconstructBlock(Block=refblock_3)  # -> Name, Plane, Geometry
deblock_3 = DeconstructBlock(Block=refblock_2)  # -> Name, Plane, Geometry

# ----
# Step4.如果不存在则Blake geometry
# 并在rhino里面清理线段
geo_3 = Geometry(deblock.Geometry)

# ---- group: the Dimension Reference Curve
seam = Seam(Curve=reparameterize(crv_13), Seam=number_slider_13)

# ---- group: The Start Point of the Dimension Reference Curve
eval = EvaluateCurve(Curve=reparameterize(crv_13), Parameter=number_slider_13)  # -> Point, Tangent, Angle

# ---- group: Dimension Style
panel_21 = Panel("图例2-地上$0$XD100$0")

# ---- group: The Start Point of the Dimension Reference Curve
eval_2 = EvaluateCurve(Curve=reparameterize(crv_16), Parameter=number_slider_18)  # -> Point, Tangent, Angle

# ---- group: the Dimension Reference Curve
seam_2 = Seam(Curve=reparameterize(crv_16), Seam=number_slider_18)

# ---- group: Dimension Style
panel_22 = Panel("图例2-地上$0$XD100$0")

# ----
xy = XYPlane(Origin=Point(0, 0, 0))
xy_2 = XYPlane(Origin=Point(0, 0, 0))
xy_3 = XYPlane(Origin=Point(0, 0, 0))
xy_4 = XYPlane(Origin=Point(0, 0, 0))
xy_5 = XYPlane(Origin=Point(0, 0, 0))
xy_6 = XYPlane(Origin=Point(0, 0, 0))
xy_7 = XYPlane(Origin=Point(0, 0, 0))
xy_8 = XYPlane(Origin=Point(0, 0, 0))
xy_9 = XYPlane(Origin=Point(0, 0, 0))
project = Project(Geometry=clscrv_3.Closed, Plane=xy_7)  # -> Geometry, Transform
project_2 = Project(Geometry=clscrv_2.Closed, Plane=xy_4)  # -> Geometry, Transform
project_3 = Project(Geometry=crv_3, Plane=xy_5)  # -> Geometry, Transform
project_4 = Project(Geometry=clscrv.Closed, Plane=xy_6)  # -> Geometry, Transform
project_5 = Project(Geometry=crv_8, Plane=xy_9)  # -> Geometry, Transform
project_6 = Project(Geometry=crv_5, Plane=xy_8)  # -> Geometry, Transform

# ---- group: All-下-幕墙线
crv_17 = Curve(project_6.Geometry)

# ----
crv_18 = Curve(project_2.Geometry)
crv_19 = Curve(project_4.Geometry)
crv_20 = Curve(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)
crv_21 = Curve(project_3.Geometry)

# ---- group: All-上-幕墙线
crv_22 = Curve(project_5.Geometry)

# ----
merge = Merge(Data1=crv_3, Data2=crv_4)
merge_2 = Merge(Data1=crv_8, Data2=crv_9)
merge_3 = Merge(Data1=crv_3, Data2=crv_4)
project_7 = Project(Geometry=refblock_2, Plane=xy)  # -> Geometry, Transform
project_8 = Project(Geometry=refblock_3, Plane=xy_2)  # -> Geometry, Transform
project_9 = Project(Geometry=reflay_4, Plane=xy_3)  # -> Geometry, Transform

# ---- group: Smoothed Curve-Site
crv_23 = Curve(crv_17)

# ---- group: Boundary Curve-Site
clscrv_4 = CloseCurve(Curve=crv_17, CloseType=0, Bulge=0.5, Tolerance=0)  # -> Closed, R

# ---- group: 制作上层定位平面 / Smoothed Curve-Site
crv_24 = Curve(crv_22)

# ---- group: 制作上层定位平面 / Boundary Curve-Site
clscrv_5 = CloseCurve(Curve=merge_2, CloseType=0, Bulge=0.5, Tolerance=0)  # -> Closed, R

# ---- group: 制作上层定位平面 / Smoothed Curve-Site
crv_25 = Curve(merge)

# ---- group: 制作上层定位平面 / Boundary Curve-Site
clscrv_6 = CloseCurve(Curve=merge_3, CloseType=0, Bulge=0.5, Tolerance=0)  # -> Closed, R

# ----
cluster = Cluster_3(
    structure_number=panel_8,
    tag_text=panel_11,
    text_offset=number_slider_3,
    embed_color=swatch,
    T=txt,
    A=number_slider_4,
    A_2=number_slider_5,
    B=number_slider_6,
    dimension_style=panel_7)  # -> R, G_2, R_2
data_4 = Data(flatten(cluster.R_2))
item = ListItem(List=data_4, Index=0, Wrap=True)  # -> Item, Item1
merge_4 = Merge(Data1=item.Item, Data2=item.Item1)

# ----
# 生成下层定位平面
disc = Discontinuity(Curve=graft(crv_23), Level=1)  # -> Points, Parameters
crv_cp = CurveClosestPoint(Point=disc.Points, Curve=graft(crv_23))  # -> Point, Parameter, Distance
eval_3 = EvaluateCurve(Curve=graft(crv_23), Parameter=crv_cp.Parameter)  # -> flatten(Point), Tangent, flatten(Angle)
deg = Degrees(Radians=eval_3.Angle)
offset = OffsetCurve(Curve=clscrv_4.Closed, Distance=expr("-X", Slider(300, range=0..1000)), Corners=1)
larger = LargerThan(FirstNumber=deg, SecondNumber=Slider(70, range=0..100))  # -> LargerThan, OrEqualTo
disc_2 = Discontinuity(Curve=offset, Level=1)  # -> flatten(Points), Parameters
dispatch_2 = Dispatch(List=deg, DispatchPattern=larger.LargerThan)  # -> ListA, ListB
dispatch_3 = Dispatch(List=eval_3.Point, DispatchPattern=larger.LargerThan)  # -> ListA, ListB
data_5 = Data(dispatch_3.ListA)
smaller = SmallerThan(FirstNumber=dispatch_2.ListA, SecondNumber=Slider(100, range=0..100))  # -> SmallerThan, OrEqualTo
dispatch_4 = Dispatch(List=data_5, DispatchPattern=smaller.SmallerThan)  # -> ListA, ListB
data_6 = Data(dispatch_4.ListA)
pull = PullPoint(Point=data_6, Geometry=flatten(offset), ClosestOnly=True)  # -> ClosestPoint, Distance
testpoint = TestPoint(archPoint=pull.ClosestPoint, crvPoint=disc_2.Points)  # -> out, specialPt; inputs archPoint: list of Point3d, crvPoint: list of Point3d
# ---------- testpoint: C# ----------
    List<int> passIndex = new List<int>();

    for(int i = 0; i < archPoint.Count; i++){
      foreach(Point3d t in crvPoint){
        if(archPoint[i].X == t.X && archPoint[i].Y == t.Y && archPoint[i].Z == t.Z){
          Print("pass");
          passIndex.Add(i);}
      }
    }

    specialPt = passIndex;
# ---------- end testpoint ----------
cull_i = CullIndex(List=data_6, Indices=testpoint.specialPt, Wrap=True)
# 阳角
# 阴角
item_2 = ListItem(List=data_6, Index=testpoint.specialPt, Wrap=True)

# ---- group: 制作上层定位平面
disc_3 = Discontinuity(Curve=graft(crv_24), Level=1)  # -> Points, Parameters
crv_cp_2 = CurveClosestPoint(Point=disc_3.Points, Curve=graft(crv_24))  # -> Point, Parameter, Distance
eval_4 = EvaluateCurve(Curve=graft(crv_24), Parameter=crv_cp_2.Parameter)  # -> flatten(Point), Tangent, flatten(Angle)
deg_2 = Degrees(Radians=eval_4.Angle)
offset_2 = OffsetCurve(Curve=clscrv_5.Closed, Distance=expr("-X", Slider(300, range=0..1000)), Corners=1)
larger_2 = LargerThan(FirstNumber=deg_2, SecondNumber=Slider(70, range=0..100))  # -> LargerThan, OrEqualTo
disc_4 = Discontinuity(Curve=offset_2, Level=1)  # -> flatten(Points), Parameters
dispatch_5 = Dispatch(List=deg_2, DispatchPattern=larger_2.LargerThan)  # -> ListA, ListB
dispatch_6 = Dispatch(List=eval_4.Point, DispatchPattern=larger_2.LargerThan)  # -> ListA, ListB
data_7 = Data(dispatch_6.ListA)
smaller_2 = SmallerThan(FirstNumber=dispatch_5.ListA, SecondNumber=Slider(100, range=0..100))  # -> SmallerThan, OrEqualTo
dispatch_7 = Dispatch(List=data_7, DispatchPattern=smaller_2.SmallerThan)  # -> ListA, ListB
data_8 = Data(dispatch_7.ListA)
pull_2 = PullPoint(Point=data_8, Geometry=flatten(offset_2), ClosestOnly=True)  # -> ClosestPoint, Distance
testpoint_2 = TestPoint(archPoint=pull_2.ClosestPoint, crvPoint=disc_4.Points)  # -> out, specialPt; inputs archPoint: list of Point3d, crvPoint: list of Point3d; same code as testpoint

disc_5 = Discontinuity(Curve=graft(crv_25), Level=1)  # -> Points, Parameters
crv_cp_3 = CurveClosestPoint(Point=disc_5.Points, Curve=graft(crv_25))  # -> Point, Parameter, Distance
eval_5 = EvaluateCurve(Curve=graft(crv_25), Parameter=crv_cp_3.Parameter)  # -> flatten(Point), Tangent, flatten(Angle)
deg_3 = Degrees(Radians=eval_5.Angle)
offset_3 = OffsetCurve(Curve=clscrv_6.Closed, Distance=expr("-X", Slider(300, range=0..1000)), Corners=1)
larger_3 = LargerThan(FirstNumber=deg_3, SecondNumber=Slider(70, range=0..100))  # -> LargerThan, OrEqualTo
disc_6 = Discontinuity(Curve=offset_3, Level=1)  # -> flatten(Points), Parameters
dispatch_8 = Dispatch(List=deg_3, DispatchPattern=larger_3.LargerThan)  # -> ListA, ListB
dispatch_9 = Dispatch(List=eval_5.Point, DispatchPattern=larger_3.LargerThan)  # -> ListA, ListB
data_9 = Data(dispatch_9.ListA)
smaller_3 = SmallerThan(FirstNumber=dispatch_8.ListA, SecondNumber=Slider(100, range=0..100))  # -> SmallerThan, OrEqualTo
dispatch_10 = Dispatch(List=data_9, DispatchPattern=smaller_3.SmallerThan)  # -> ListA, ListB
data_10 = Data(dispatch_10.ListA)
pull_3 = PullPoint(Point=data_10, Geometry=flatten(offset_3), ClosestOnly=True)  # -> ClosestPoint, Distance
testpoint_3 = TestPoint(archPoint=pull_3.ClosestPoint, crvPoint=disc_6.Points)  # -> out, specialPt; inputs archPoint: list of Point3d, crvPoint: list of Point3d; same code as testpoint

# ----
钢埋板长度_2 = Division(A=number_slider_9, B=2)
neg = Negative(Value=钢埋板长度_2)
dom = ConstructDomain(DomainStart=neg, DomainEnd=钢埋板长度_2)
panel_23 = Panel(dom)

钢埋板厚度_2 = Division(A=number_slider_10, B=2)
neg_2 = Negative(Value=钢埋板厚度_2)
dom_2 = ConstructDomain(DomainStart=neg_2, DomainEnd=钢埋板厚度_2)
panel_24 = Panel(dom_2)

# ----
# 钢埋板肋板位置 1/4处
panel_25 = Panel("4")
division = Division(A=number_slider_9, B=panel_25)

# ----
# 列表文字以空格进行分割
panel_26 = Panel(" ")
split = TextSplit(Text=txt_2, Separators=panel_26)

# ----
# 编号和截面尺寸分区
panel_27 = Panel("1")
split_2 = SplitList(List=split, Index=panel_27)  # -> flatten(ListA), flatten(ListB)

# ---- group: 制作上层定位平面
# 阴角
cull_i_2 = CullIndex(List=data_8, Indices=testpoint_2.specialPt, Wrap=True)

# 阳角
item_3 = ListItem(List=data_8, Index=testpoint_2.specialPt, Wrap=True)

# 阴角
cull_i_3 = CullIndex(List=data_10, Indices=testpoint_3.specialPt, Wrap=True)

# 阳角
item_4 = ListItem(List=data_10, Index=testpoint_3.specialPt, Wrap=True)

# ----
merge_5 = Merge(Data1=item_2, Data2=cull_i)  # -> flatten(Result)

# ---- group: 下-阴阳角
data_11 = Data(merge_5)

# ---- group: 制作上层定位平面
# 生成上层定位平面
merge_6 = Merge(Data1=item_3, Data2=cull_i_2)  # -> flatten(Result)

# 生成檐口定位平面
merge_7 = Merge(Data1=item_4, Data2=cull_i_3)  # -> flatten(Result)

# ----
movetoplane = MoveToPlane(Geometry=reflay_2, Plane=PlaneXY(0, 0, 0), Above=True, Below=True)  # -> Geometry, Transform
area_2 = Area(Geometry=movetoplane.Geometry)  # -> Area, Centroid
pt = Point(area_2.Centroid)

# ---- group: 制作上层定位平面
movetoplane_2 = MoveToPlane(Geometry=reflay_3, Plane=PlaneXY(0, 0, 0), Above=True, Below=True)  # -> Geometry, Transform
area_3 = Area(Geometry=movetoplane_2.Geometry)  # -> Area, Centroid
pt_2 = Point(area_3.Centroid)

movetoplane_3 = MoveToPlane(Geometry=reflay, Plane=PlaneXY(0, 0, 0), Above=True, Below=True)  # -> Geometry, Transform
area_4 = Area(Geometry=movetoplane_3.Geometry)  # -> Area, Centroid
pt_3 = Point(area_4.Centroid)

# ----
xy_10 = XYPlane(Origin=Point(0, 0, 0))
xy_11 = XYPlane(Origin=Point(0, 0, 0))
xy_12 = XYPlane(Origin=Point(0, 0, 0))

# ----
# 单体选型
list_6 = ValueList({"顶埋": 0, "侧埋": 1}, selected="顶埋")

# ---- group: F2 Arch Outline
crv_26 = Curve(crv_18)

# ----
# 选要重塑的线段长度
number_slider_21 = Slider(1200, range=0..10000)

# ---- group: 车道区域 / 檐口线Input
crv_27 = Curve(crv_21)

# ---- group: 檐口线Input
crv_28 = Curve(crv_21)

crv_29 = Curve(crv_21)

# ----
# 调整重塑线段的平滑度
number_slider_22 = Slider(11, range=0..11)

# ----
# 区分内外梁边线
# 1.根据F2建筑线制作轮廓线
explode = Explode(Curve=crv_26, Recursive=True)  # -> Segments, Vertices
len = Length(Curve=explode.Segments)
sort = SortList(Keys=len)  # -> Keys, ValuesA
larger_4 = LargerThan(FirstNumber=len, SecondNumber=number_slider_21)  # -> LargerThan, OrEqualTo
panel_28 = Panel(sort.Keys)
dispatch_11 = Dispatch(List=explode.Segments, DispatchPattern=larger_4.LargerThan)  # -> ListA, ListB
data_12 = Data(dispatch_11.ListA)
data_13 = Data(dispatch_11.ListB)
join = JoinCurves(Curves=data_13, Preserve=False)
disc_7 = Discontinuity(Curve=join, Level=1)  # -> Points, Parameters
nurbs = NurbsCurve(Vertices=disc_7.Points, Degree=number_slider_22, Periodic=False)  # -> flatten(Curve), Length, Domain
join_2 = JoinCurves(Curves=flatten([data_12, nurbs.Curve]), Preserve=False)
offset_4 = OffsetCurve(Curve=join_2, Distance=Slider(10000, range=0..10000), Corners=1)

# ---- group: F2 Archline - Smoothed
reb = RebuildCurve(Curve=offset_4, Count=Slider(17, range=0..100), Tangents=invert(False))

# ----
# InputCurve
crv_30 = Curve()

# ----
# Curve-框住要分析的建筑单体
# 如果要用自己导入Curve作为分析线，
# 请在InputCurve那里导入curve,
# 然后在上方的选型列表选择Input Curve。
# 
# 如果要用Grasshopper自动生成的Curve,
# 请在上方的选型列表选择Default Curve。
list_7 = ValueList({"Default Curve": 0, "Input Curve": 1}, selected="Default Curve")
filter = StreamFilter(Gate=list_7, Stream0=reb, Stream1=crv_30)

crv_31 = Curve(filter)

# ----
# 要连接的梁中线Offest值
# 要连接的梁中线curve
# 要连接的embed
# 埋件向内探索最远出的梁的距离
number_slider_23 = Slider(500, range=0..10000)

# ---- group: 楼板线
crv_32 = Curve(project.Geometry)

# ----
project_10 = Project(Geometry=crv_32, Plane=PlaneXY(0, 0, 0))  # -> Geometry, Transform

# ----
# 埋件向外探索最远出的梁的距离
number_slider_24 = Slider(0, range=0..10000)

reb_2 = RebuildCurve(Curve=project_10.Geometry, Count=Slider(5000, range=0..10000), Tangents=False)

# ---- group: 檐口线内测
crv_33 = Curve(crv_4)

# ---- group: 檐口线外侧
crv_34 = Curve(crv_21)

# ---- group: 下层交点-除重 / 上层幕墙线
crv_35 = Curve(crv_18)

# ---- group: 下层交点-除重 / 下层幕墙线
crv_36 = Curve(crv_19)

# ---- group: 下层交点-除重 / 容差
number_slider_25 = Slider(100, range=0..200)

# ---- group: 上层幕墙线
crv_37 = Curve(crv_35)

# 钢埋板高度，工字钢尺寸决定
crv_38 = Curve(crv_35)

# ----
panel_29 = Panel("1种梁对应了多种埋件")

# ----
# 是否有吊顶：
# 下层幕墙边线在结构边梁以内>350
# 
# （最外层结构线）
number_slider_26 = Slider(350, range=0..1000)

merge_8 = Merge(Data1=crv_3, Data2=crv_4)

# ---- group: All檐口线
crv_39 = Curve(merge_8)

# ----
merge_9 = Merge(Data1=crv_3, Data2=crv_4)

# ---- group: All檐口线
crv_40 = Curve(merge_9)

# ---- group: 下层Arch Line
crv_41 = Curve(crv_19)

# ----
# 3.2下层建筑边线内侧300-600mm范围内
number_slider_27 = Slider(600, range=0..1000)
crv_42 = Curve(crv_41)
offset_5 = OffsetCurve(Curve=crv_42, Distance=expr("-x", Slider(300, range=0..1000)), Corners=1)
offset_6 = OffsetCurve(Curve=crv_42, Distance=expr("-x", number_slider_27), Corners=1)

# ----
# 3.1下层建筑边线外侧50-350mm范围内
number_slider_28 = Slider(350, range=0..1000)
crv_43 = Curve(crv_41)
offset_7 = OffsetCurve(Curve=crv_43, Distance=number_slider_28, Corners=1)
offset_8 = OffsetCurve(Curve=crv_43, Distance=Slider(50, range=0..100), Corners=1)

# ---- group: All檐口线
crv_44 = Curve(crv_40)

crv_45 = Curve(crv_40)

crv_46 = Curve(crv_40)

crv_47 = Curve(crv_40)

# ----
# 4下层建筑内侧到300到外侧50内
# 有钢结构
number_slider_29 = Slider(50, range=0..1000)
crv_48 = Curve(crv_41)
offset_9 = OffsetCurve(Curve=crv_48, Distance=expr("-x", Slider(300, range=0..1000)), Corners=1)
offset_10 = OffsetCurve(Curve=crv_48, Distance=number_slider_29, Corners=1)

# ---- group: 建筑线
crv_49 = Curve(filter)

crv_50 = Curve(filter)

# ---- group: 上层幕墙线
crv_51 = Curve(crv_18)

# ----
data_14 = Data(flatten(merge_4))
item_5 = ListItem(List=data_14, Index=0, Wrap=True)
item_6 = ListItem(List=data_14, Index="-1", Wrap=True)
crv_52 = Curve(crv_51)

# ----
# （3.1）导入轴线
crv_53 = Curve(<curve referenced from the Rhino model>)
layer_6 = ObjectLayer(Guid=crv_53)  # -> LayerIndex, LayerPathName
panel_30 = Panel(layer_6.LayerPathName)
reflay_7 = ReferenceByLayer(LayerName=panel_30)
xy_13 = XYPlane(Origin=Point(0, 0, 0))
project_11 = Project(Geometry=reflay_7, Plane=xy_13)  # -> Geometry, Transform

# ----
# 求内部曲线转折点
crv_54 = Curve()  # disabled
number_slider_30 = Slider(300, range=0..1000)  # disabled
neg_3 = Negative(Value=number_slider_30)  # disabled
filter_2 = StreamFilter(Gate=toggle, Stream0=number_slider_30, Stream1=neg_3)  # disabled
number_slider_31 = Slider(60, range=0..100)  # disabled

ext = ExtendCurve(Curve=crv_54, Type=0, Start=number_slider, End=number_slider)  # disabled

# ----
# 第二层
# 
# Curves(location point)+ Smooth Curves(architecture line)
# 第二层-区分阴阳角
area_5 = Area(Geometry=geo_2)  # -> Area, Centroid; disabled
crv_55 = Curve(crv_54)  # disabled
pull_4 = PullPoint(Point=area_5.Centroid, Geometry=crv_55, ClosestOnly=True)  # -> ClosestPoint, Distance; disabled
number_slider_32 = Slider(200, range=0..1000)  # disabled
number_slider_33 = Slider(100, range=0..300)  # disabled

# ----
# 第二层-阴阳角
panel_31 = Panel("0.5 * Pi")  # disabled
toggle_2 = BooleanToggle(True)  # disabled
neg_4 = Negative(Value=panel_31)  # disabled
filter_3 = StreamFilter(Gate=toggle_2, Stream0=panel_31, Stream1=neg_4)  # disabled

# ----
# 第二层-大面定位
panel_32 = Panel("0.5 * Pi")  # disabled
toggle_3 = BooleanToggle(True)  # disabled
neg_5 = Negative(Value=panel_32)  # disabled
filter_4 = StreamFilter(Gate=toggle_3, Stream0=panel_32, Stream1=neg_5)  # disabled

number_slider_34 = Slider(300, range=0..1000)  # disabled
number_slider_35 = Slider(1.5, range=0..10)  # disabled

number_slider_36 = Slider(300, range=0..1000)  # disabled
number_slider_37 = Slider(1.5, range=0..10)  # disabled

number_slider_38 = Slider(300, range=0..1000)  # disabled
number_slider_39 = Slider(1.5, range=0..10)  # disabled

# ----
# 显示"False"时要选择线段延长
list_8 = ValueList({"线段不延长": 0, "线段延长": 1}, selected="线段延长")  # disabled

filter_5 = StreamFilter(Gate=list_8, Stream0=crv_54, Stream1=ext)  # disabled

disc_8 = Discontinuity(Curve=graft(filter_5), Level=1)  # -> Points, Parameters; disabled
crv_cp_4 = CurveClosestPoint(Point=disc_8.Points, Curve=graft(filter_5))  # -> Point, Parameter, Distance; disabled
eval_6 = EvaluateCurve(Curve=graft(filter_5), Parameter=crv_cp_4.Parameter)  # -> flatten(Point), Tangent, flatten(Angle); disabled
deg_4 = Degrees(Radians=eval_6.Angle)  # disabled
offset_11 = OffsetCurve(Curve=filter_5, Distance=expr("-X", filter_2), Corners=1)  # disabled
panel_33 = Panel(deg_4)  # disabled
larger_5 = LargerThan(FirstNumber=deg_4, SecondNumber=number_slider_31)  # -> LargerThan, OrEqualTo; disabled
disc_9 = Discontinuity(Curve=offset_11, Level=1)  # -> flatten(Points), Parameters; disabled
dispatch_12 = Dispatch(List=eval_6.Point, DispatchPattern=larger_5.LargerThan)  # -> ListA, ListB; disabled
end = EndPoints(Curve=filter_5)  # -> Start, End; disabled
data_15 = Data(dispatch_12.ListA)  # disabled
pull_5 = PullPoint(Point=data_15, Geometry=flatten(offset_11), ClosestOnly=True)  # -> ClosestPoint, Distance; disabled
testpoint_4 = TestPoint(archPoint=pull_5.ClosestPoint, crvPoint=disc_9.Points)  # -> out, specialPt; inputs archPoint: list of Point3d, crvPoint: list of Point3d; disabled; same code as testpoint

# ----
# 阴角
item_7 = ListItem(List=data_15, Index=testpoint_4.specialPt, Wrap=True)  # disabled

# ----
# SmoothCurve-阴角&阳角
# 阳角
cull_i_4 = CullIndex(List=data_15, Indices=testpoint_4.specialPt, Wrap=True)  # disabled

dist = Distance(PointA=pull_4.ClosestPoint, PointB=data_15)  # disabled
sort_2 = SortList(Keys=dist)  # -> Keys, ValuesA; disabled
panel_34 = Panel(sort_2.Keys)  # disabled
smaller_4 = SmallerThan(FirstNumber=dist, SecondNumber=number_slider_32)  # -> SmallerThan, OrEqualTo; disabled
dispatch_13 = Dispatch(List=geo_2, DispatchPattern=smaller_4.SmallerThan)  # -> ListA, ListB; disabled
crv_56 = Curve(filter_5)  # disabled

data_16 = Data(dispatch_13.ListA)  # disabled
explode_2 = Explode(Curve=data_16, Recursive=True)  # -> Segments, Vertices; disabled
len_2 = Length(Curve=explode_2.Segments)  # disabled
sort_3 = SortList(Keys=reverse(len_2), ValuesA=explode_2.Segments)  # -> Keys, ValuesA; disabled
item_8 = ListItem(List=sort_3.ValuesA, Index=0, Wrap=True)  # -> flatten(Item); disabled
area_6 = Area(Geometry=data_16)  # -> Area, Centroid; disabled
midpt = CurveMiddle(Curve=item_8)  # disabled
move2pt = MoveToPoint(Geometry=item_8, PointA=midpt, PointB=area_6.Centroid)  # -> Moved, Vector, Transform; disabled
end_2 = EndPoints(Curve=move2pt.Moved)  # -> Start, End; disabled
ln = Line(StartPoint=end_2.Start, EndPoint=end_2.End)  # disabled
xy_14 = XYPlane(Origin=end_2.End)  # disabled
rotate = Rotate(Geometry=ln, Angle=filter_3, Plane=xy_14)  # -> Geometry, Transform; disabled
pl = ConstructPlane(Origin=end_2.End, XAxis=rotate.Geometry, YAxis=ln)  # disabled

data_17 = Data(dispatch_13.ListB)  # disabled
explode_3 = Explode(Curve=data_17, Recursive=True)  # -> Segments, Vertices; disabled
len_3 = Length(Curve=explode_3.Segments)  # disabled
sort_4 = SortList(Keys=reverse(len_3), ValuesA=explode_3.Segments)  # -> Keys, ValuesA; disabled
item_9 = ListItem(List=sort_4.ValuesA, Index=0, Wrap=True)  # -> flatten(Item); disabled
area_7 = Area(Geometry=data_17)  # -> Area, Centroid; disabled
midpt_2 = CurveMiddle(Curve=item_9)  # disabled
move2pt_2 = MoveToPoint(Geometry=item_9, PointA=midpt_2, PointB=area_7.Centroid)  # -> Moved, Vector, Transform; disabled
end_3 = EndPoints(Curve=move2pt_2.Moved)  # -> Start, End; disabled
ln_2 = Line(StartPoint=end_3.Start, EndPoint=end_3.End)  # disabled
xy_15 = XYPlane(Origin=end_3.End)  # disabled
rotate_2 = Rotate(Geometry=ln_2, Angle=filter_4, Plane=xy_15)  # -> Geometry, Transform; disabled
pl_2 = ConstructPlane(Origin=end_3.End, XAxis=rotate_2.Geometry, YAxis=ln_2)  # disabled

data_18 = Data(flatten(pl_2))  # disabled
deplane = DeconstructPlane(Plane=data_18)  # -> Origin, XAxis, YAxis, ZAxis; disabled
amp = Amplitude(Vector=deplane.YAxis, Amplitude=number_slider_36)  # disabled
move = Move(Geometry=deplane.Origin, Motion=amp)  # -> Geometry, Transform; disabled
ln_3 = Line(StartPoint=deplane.Origin, EndPoint=move.Geometry)  # disabled
midpt_3 = CurveMiddle(Curve=ln_3)  # disabled
scale = Scale(Geometry=ln_3, Center=midpt_3, Factor=number_slider_37)  # -> Geometry, Transform; disabled
ccx = CurveCurve(CurveA=scale.Geometry, CurveB=crv_56)  # -> Points, ParamsA, ParamsB; disabled

dist_2 = Distance(PointA=graft(end_2.End), PointB=cull_i_4)  # disabled
sort_5 = SortList(Keys=dist_2)  # -> Keys, ValuesA; disabled
item_10 = ListItem(List=sort_5.Keys, Index=0, Wrap=True)  # disabled
smaller_5 = SmallerThan(FirstNumber=item_10, SecondNumber=number_slider_33)  # -> SmallerThan, OrEqualTo; disabled
flatten = FlattenTree(Tree=item_10, Path="{0}")  # disabled
dispatch_14 = Dispatch(List=graft(pl), DispatchPattern=smaller_5.SmallerThan)  # -> ListA, ListB; disabled
panel_35 = Panel(flatten)  # disabled
flatten_2 = FlattenTree(Tree=ccx.Points, Path="{0}")  # disabled
lng = ListLength(List=scale.Geometry)  # disabled
lng_2 = ListLength(List=flatten_2)  # disabled

data_19 = Data(flatten(dispatch_14.ListA))  # disabled
deplane_2 = DeconstructPlane(Plane=data_19)  # -> Origin, XAxis, YAxis, ZAxis; disabled
amp_2 = Amplitude(Vector=deplane_2.YAxis, Amplitude=number_slider_34)  # disabled
move_2 = Move(Geometry=deplane_2.Origin, Motion=amp_2)  # -> Geometry, Transform; disabled
ln_4 = Line(StartPoint=deplane_2.Origin, EndPoint=move_2.Geometry)  # disabled
midpt_4 = CurveMiddle(Curve=ln_4)  # disabled
scale_2 = Scale(Geometry=ln_4, Center=midpt_4, Factor=number_slider_35)  # -> Geometry, Transform; disabled
ccx_2 = CurveCurve(CurveA=scale_2.Geometry, CurveB=crv_56)  # -> Points, ParamsA, ParamsB; disabled

data_20 = Data(flatten(dispatch_14.ListB))  # disabled
deplane_3 = DeconstructPlane(Plane=data_20)  # -> Origin, XAxis, YAxis, ZAxis; disabled
amp_3 = Amplitude(Vector=deplane_3.YAxis, Amplitude=number_slider_38)  # disabled
move_3 = Move(Geometry=deplane_3.Origin, Motion=amp_3)  # -> Geometry, Transform; disabled
ln_5 = Line(StartPoint=deplane_3.Origin, EndPoint=move_3.Geometry)  # disabled
midpt_5 = CurveMiddle(Curve=ln_5)  # disabled
scale_3 = Scale(Geometry=ln_5, Center=midpt_5, Factor=number_slider_39)  # -> Geometry, Transform; disabled
ccx_3 = CurveCurve(CurveA=scale_3.Geometry, CurveB=crv_56)  # -> Points, ParamsA, ParamsB; disabled

equals = Equality(FirstNumber=lng, SecondNumber=lng_2)  # -> Equality, Inequality; disabled
panel_36 = Panel(equals.Equality)  # disabled

# ----
# InsideCurve-大面
move2pt_3 = MoveToPoint(Geometry=data_18, PointA=flatten(deplane.Origin), PointB=flatten(ccx.Points))  # -> Moved, Vector, Transform; disabled

# ----
# InsideCurve-阳角
move2pt_4 = MoveToPoint(Geometry=data_19, PointA=deplane_2.Origin, PointB=ccx_2.Points)  # -> Moved, Vector, Transform; disabled

# ----
# InsideCurve-阴角
move2pt_5 = MoveToPoint(Geometry=data_20, PointA=deplane_3.Origin, PointB=ccx_3.Points)  # -> Moved, Vector, Transform; disabled

swatch_2 = ColourSwatch(SwatchColor=RGB(140, 140, 140))
# (9)Bake Me!!
# 埋件和阴阳角定位
panel_37 = Panel("阴阳角定位-F1+F2")

layer_7 = DefineLayer(Name=panel_37, Color=swatch_2)
attributes = DefineObjectAttributes(Layer=layer_7, Color=swatch_2)

# ---- group: 檐口埋件
panel_38 = Panel("Embed::1-1-02钢板焊埋件")
panel_39 = Panel("Tag::1-1-02钢板焊埋件")
swatch_3 = ColourSwatch(SwatchColor=RGB(255, 212, 0))

# ---- group: 上下幕墙连续
panel_40 = Panel("Tag::1-0-01钢板焊埋件")
swatch_4 = ColourSwatch(SwatchColor=RGB(255, 242, 66))
panel_41 = Panel("Embed::1-0-01钢板焊埋件")

# ---- group: 有吊顶的范围，檐口处内侧埋件
panel_42 = Panel("Embed::2-1-03钢板焊埋件")
panel_43 = Panel("Tag::2-1-03钢板焊埋件")
swatch_5 = ColourSwatch(SwatchColor=RGB(255, 242, 66))

# ---- group: 框架顶部，埋件在幕墙线外侧
panel_44 = Panel("Embed::3-1-03钢板焊埋件")
panel_45 = Panel("Tag::3-1-03钢板焊埋件")
swatch_6 = ColourSwatch(SwatchColor=RGB(180, 255, 66))

# ---- group: 框架顶部，埋件在幕墙线内侧
panel_46 = Panel("Embed::3-2-03钢板焊埋件")
panel_47 = Panel("Tag::3-2-03钢板焊埋件")
swatch_7 = ColourSwatch(SwatchColor=RGB(66, 255, 69))

# ---- group: 钢结构下底埋
panel_48 = Panel("Embed::4-1钢板焊底埋")
panel_49 = Panel("Tag::4-1钢板焊底埋")
swatch_8 = ColourSwatch(SwatchColor=RGB(66, 255, 236))

# ---- group: 范围内没有钢梁，默认幕墙线向内300有一个埋件
panel_50 = Panel("Embed::4-0-03默认钢板焊")
panel_51 = Panel("Tag::4-0-03默认钢板焊")
swatch_9 = ColourSwatch(SwatchColor=RGB(66, 167, 255))

# ---- group: 幕墙底部接地埋件
panel_52 = Panel("Embed::5-04板埋")
panel_53 = Panel("Tag::5-04板埋")
swatch_10 = ColourSwatch(SwatchColor=RGB(66, 98, 255))

# ----
# 1.1-掩口出侧埋遗漏
panel_54 = Panel("1.1-掩口出侧埋遗漏")
layer_8 = DefineLayer(Name=panel_54)
attributes_2 = DefineObjectAttributes(Layer=layer_8)

# ----
# 生成埋件编号
# 注意：
# 可以选择机动生成or手动输入埋件Tag可以参考下方右侧的”涉及到的梁编号“来手动输入对应的埋件编号
list_9 = ValueList({"机动生成埋件Tags": 0, "手动输入埋件Tags": 1}, selected="机动生成埋件Tags")

layer_9 = DefineLayer(Name=panel_39, Color=swatch_3)
layer_10 = DefineLayer(Name=panel_38, Color=swatch_3)
entwine = Entwine(Branch00=layer_10, Branch01=layer_9, FlattenInputs=True)
attributes_3 = DefineObjectAttributes(Layer=entwine, Color=swatch_3)

layer_11 = DefineLayer(Name=panel_43, Color=swatch_5)
layer_12 = DefineLayer(Name=panel_42, Color=swatch_5)
entwine_2 = Entwine(Branch00=layer_12, Branch01=layer_11, FlattenInputs=True)
attributes_4 = DefineObjectAttributes(Layer=entwine_2, Color=swatch_5)

layer_13 = DefineLayer(Name=panel_40, Color=swatch_4)
layer_14 = DefineLayer(Name=panel_41, Color=swatch_4)
entwine_3 = Entwine(Branch00=layer_14, Branch01=layer_13, FlattenInputs=True)
attributes_5 = DefineObjectAttributes(Layer=entwine_3, Color=swatch_4)

layer_15 = DefineLayer(Name=panel_45, Color=swatch_6)
layer_16 = DefineLayer(Name=panel_44, Color=swatch_6)
entwine_4 = Entwine(Branch00=layer_16, Branch01=layer_15, FlattenInputs=True)
attributes_6 = DefineObjectAttributes(Layer=entwine_4, Color=swatch_6)

layer_17 = DefineLayer(Name=panel_47, Color=swatch_7)
layer_18 = DefineLayer(Name=panel_46, Color=swatch_7)
entwine_5 = Entwine(Branch00=layer_18, Branch01=layer_17, FlattenInputs=True)
attributes_7 = DefineObjectAttributes(Layer=entwine_5, Color=swatch_7)

layer_19 = DefineLayer(Name=panel_49, Color=swatch_8)
layer_20 = DefineLayer(Name=panel_48, Color=swatch_8)
entwine_6 = Entwine(Branch00=layer_20, Branch01=layer_19, FlattenInputs=True)
attributes_8 = DefineObjectAttributes(Layer=entwine_6, Color=swatch_8)

layer_21 = DefineLayer(Name=panel_53, Color=swatch_10)
layer_22 = DefineLayer(Name=panel_52, Color=swatch_10)
entwine_7 = Entwine(Branch00=layer_22, Branch01=layer_21, FlattenInputs=True)
attributes_9 = DefineObjectAttributes(Layer=entwine_7, Color=swatch_10)

layer_23 = DefineLayer(Name=panel_51, Color=swatch_9)
layer_24 = DefineLayer(Name=panel_50, Color=swatch_9)
entwine_8 = Entwine(Branch00=layer_24, Branch01=layer_23, FlattenInputs=True)
attributes_10 = DefineObjectAttributes(Layer=entwine_8, Color=swatch_9)

crv_57 = Curve(project_2.Geometry)
panel_55 = Panel("""Dimension::Dim1
Dimension::Dim2
Dimension::Dim3
Dimension::Dim4""")
layer_25 = DefineLayer(Name=panel_55)  # -> graft(Layer)
attributes_11 = DefineObjectAttributes(Layer=layer_25)

# ----
# 生成底埋钢埋件
rectangle = Rectangle(Plane=PlaneXY(0, 0, 0), XSize=panel_4, YSize=panel_5, Radius=0)  # -> Rectangle, Length
rec = Rectangle(rectangle.Rectangle)
pln_2 = Plane(rectangle.Rectangle)

deplane_4 = DeconstructPlane(Plane=pln_2)  # -> Origin, XAxis, YAxis, ZAxis
dedomain = DeconstructDomain(Domain=panel_5)  # -> Start, End
amp_4 = Amplitude(Vector=deplane_4.YAxis, Amplitude=dedomain.End)
move_4 = Move(Geometry=deplane_4.Origin, Motion=amp_4)  # -> Geometry, Transform
ln_6 = Line(StartPoint=deplane_4.Origin, EndPoint=move_4.Geometry)
amp_5 = Amplitude(Vector=ln_6, Amplitude=Slider(190, range=0..1000))
move_5 = Move(Geometry=deplane_4.Origin, Motion=amp_5)  # -> Geometry, Transform

text = DefineTextObject(Text=panel_3, Plane=move_5.Geometry, DimensionStyle=panel_6, OutputType="Text")
group = Group(Objects=[rec, text])
merge_10 = Merge(Data1=group, Data2=pln_2)

# ----
# 板埋：制作板埋三视图
max = Maximum(A=s_x, B=s_y)
filter_6 = StreamFilter(Gate=list, Stream0=7.2, Stream1=9.6, Stream2=11.9, Stream3=14.3, Stream4=16.7, Stream5=19.1)
filter_7 = StreamFilter(Gate=list_2, Stream0=270, Stream1=360)
filter_8 = StreamFilter(Gate=list_3, Stream0=10, Stream1=12, Stream2=16, Stream3=18, Stream4=20, Stream5=25)
filter_9 = StreamFilter(Gate=list, Stream0=0.91, Stream1=1.1, Stream2=1.27, Stream3=1.43, Stream4=1.57, Stream5=1.71)
filter_10 = StreamFilter(Gate=list_2, Stream0=0.16, Stream1=0.14)
addition = Addition(A=list_4, B=1)
addition_2 = Addition(A=list_5, B=1)
division_2 = Division(A=max, B=8)
t = Integer(division_2)
panel_56 = Panel(filter_9)
panel_57 = Panel(filter_6)
panel_58 = Panel(filter_10)
min = Minimum(A=filter_7, B=300)
panel_59 = Panel(min)
expression = Expression(A=filter_10, fy=filter_7, ft=filter_9, d=filter_8, Expression="(int((0.6*1.1*A*fy/ft*d)/5)+1)*5")

crv_58 = Curve(project_2.Geometry)
panel_60 = Panel("""Dimension::Dim1
Dimension::Dim2
Dimension::Dim3
Dimension::Dim4""")
layer_26 = DefineLayer(Name=panel_60)  # -> graft(Layer)
attributes_12 = DefineObjectAttributes(Layer=layer_26)

rhatt = GetRhinoAttributes(Geometry=reflay_5)  # -> Name, Layer, Color
split_3 = TextSplit(Text=rhatt.Color, Separators=",")  # -> simplify(Result)
item_11 = ListItem(List=split_3, Index=0, Wrap=True)  # -> flatten(Item), flatten(Item1), flatten(Item2)
pt_4 = ConstructPoint(XCoordinate=item_11.Item, YCoordinate=item_11.Item1, ZCoordinate=item_11.Item2)
cullpt = CullDuplicates(Points=pt_4, Tolerance=0.1, CullMode=3)  # -> Points, Indices, Valence
pdecon = Deconstruct(Point=cullpt.Points)  # -> XComponent, YComponent, ZComponent
rgb = ColourRGB(Alpha=255, Red=pdecon.XComponent, Green=pdecon.YComponent, Blue=pdecon.ZComponent)
filtercolor = FilterByColor(Geometry=reflay_6, Color=rgb)  # -> simplify(Geometry)
detext = DeconstructText(TextObject=filtercolor)  # -> Text, Plane, Height, Justification
addition_3 = Addition(A=neg_2, B=division)
addition_4 = Addition(A=钢埋板厚度_2, B=division)
dom_3 = ConstructDomain(DomainStart=addition_3, DomainEnd=addition_4)
panel_61 = Panel(split_2.ListB)
钢埋板_侧视图 = Rectangle(Plane=PlaneXY(0, 0, 0), XSize=dom_2, YSize=dom, Radius=0)  # -> Rectangle, Length
xz = XZPlane(Origin=Point(0, 0, 0))
col = Colour(simplify(graft(rgb)))
attributes_13 = DefineObjectAttributes(Color=col)
xy_16 = XYPlane(Origin=Point(0, 0, 0))
dedomain_2 = DeconstructDomain(Domain=dom)  # -> Start, End
multiplication = Multiplication(A=dedomain_2.Start, B=dedomain_2.Start)

# ---- group: Beam
filtercolor_2 = FilterByColor(Geometry=reflay_5, Color=rgb)  # -> simplify(Geometry)

# ---- group: Text
item_12 = ListItem(List=detext.Text, Index=0, Wrap=True)

# ----
# 涉及到的梁编号
panel_62 = Panel(item_12)

# ---- group: Create Tags
tstat = TreeStatistics(Tree=detext.Text)  # -> Paths, Length, Count
series = Series(Start="1", Step=1, Count=tstat.Count)
concat = Concatenate(FragmentA=series, FragmentB="-")
concat_2 = Concatenate(FragmentA=concat, FragmentB=series)  # -> simplify(graft(Result))

# ----
filter_11 = StreamFilter(Gate=list_9, Stream0=concat_2, Stream1=simplify(graft(panel_13)))

# ----
# 埋件Tag预览
panel_63 = Panel(filter_11)

crv_59 = Curve(filtercolor_2)
layer_27 = ObjectLayer(Guid=crv_59)  # -> LayerIndex, LayerPathName
panel_64 = Panel(layer_27.LayerPathName)
reflay_8 = ReferenceByLayer(LayerName=panel_64)
flatten_3 = FlattenTree(Tree=item_12, Path="{0}")
txt_3 = Text(item_12)
concat_3 = Concatenate(FragmentA="Embed", FragmentB=txt_3)
txt_4 = Text(filter_11)
project_12 = Project(Geometry=crv_59, Plane=xy_16)  # -> Geometry, Transform

# ----
# 求出对应输入编号的钢结构截面尺寸
fsim = FindSimilarMember(Data=flatten_3, Set=split_2.ListA)  # -> Hit, Index
item_13 = ListItem(List=split_2.ListB, Index=fsim.Index, Wrap=True)

# ----
# 要连接的梁中线curve
crv_60 = Curve(project_12.Geometry)

# ----
# 板埋Modeling
multiplication_2 = Multiplication(A=s_x, B=addition)
multiplication_3 = Multiplication(A=s_y, B=addition_2)
recgrid = Rectangular(Plane=PlaneXY(0, 0, 0), SizeX=s_x, SizeY=s_y, ExtentX=addition, ExtentY=addition_2)  # -> Cells, Points
直径 = Text(filter_8)
division_3 = Division(A=multiplication_2, B=2)
division_4 = Division(A=multiplication_3, B=2)
vec = VectorXYZ(XComponent=expr("-x", division_3), YComponent=expr("-x", division_4), ZComponent=0)  # -> Vector, Length
move_6 = Move(Geometry=recgrid.Points, Motion=vec.Vector)  # -> Geometry, Transform
division_5 = Division(A=直径, B=2)
cyl = Cylinder(Base=move_6.Geometry, Radius=division_5, Length=expr("-x", expression))
X = UnitX(Factor=直径)
multiplication_4 = Multiplication(A=直径, B=6)
edges = BrepEdges(Brep=cyl)  # -> Naked, Interior, NonManifold
item_14 = ListItem(List=edges.Naked, Index=0, Wrap=True)
max_2 = Maximum(A=multiplication_4, B=70)
move_7 = Move(Geometry=item_14, Motion=X)  # -> Geometry, Transform
multiplication_5 = Multiplication(A=max_2, B=2)
addition_5 = Addition(A=multiplication_2, B=multiplication_5)
addition_6 = Addition(A=multiplication_3, B=multiplication_5)
division_6 = Division(A=t, B=2)
expression_2 = Expression(x=addition_6, Expression="Ceiling(x/10)*10/2")
expression_3 = Expression(x=addition_5, Expression="Ceiling(x/10)*10/2")
round = Round(Number=division_6)  # -> Nearest, Floor, Ceiling
multiplication_6 = Multiplication(A=round.Ceiling, B=2)
dom_4 = ConstructDomain(DomainStart=expr("-x", expression_2), DomainEnd=expression_2)
dom_5 = ConstructDomain(DomainStart=expr("-x", expression_3), DomainEnd=expression_3)
box = DomainBox(Base=PlaneXY(0, 0, 0), X=dom_5, Y=dom_4, Z=multiplication_6)
Z = UnitZ(Factor=expr("-x", multiplication_6))

multiplication_7 = Multiplication(A=直径, B=5)

Z_2 = UnitZ(Factor=multiplication_7)
extr = Extrude(Base=move_7.Geometry, Direction=Z_2)
cap = CapHoles(Brep=[extr, cyl])
merge_11 = Merge(Data1=cap, Data2=box)
flatten_4 = FlattenTree(Tree=merge_11, Path="{0}")
move_8 = Move(Geometry=flatten_4, Motion=Z)  # -> Geometry, Transform

split_4 = TextSplit(Text=item_13, Separators="x")
split_5 = TextSplit(Text=split_4, Separators="Q")
item_15 = ListItem(List=split_5, Index="0", Wrap=True)

shift = ShiftPaths(Data=item_15, Offset=-1)
subtraction = Subtraction(A=division, B=钢埋板厚度_2)
subtraction_2 = Subtraction(A=division, B=钢埋板厚度_2)
subtraction_3 = Subtraction(A=division, B=钢埋板厚度_2)
neg_6 = Negative(Value=钢埋板厚度_2)
neg_7 = Negative(Value=钢埋板厚度_2)
neg_8 = Negative(Value=钢埋板厚度_2)
subtraction_4 = Subtraction(A=division, B=钢埋板厚度_2)
addition_7 = Addition(A=subtraction, B=number_slider_10)
addition_8 = Addition(A=subtraction_2, B=number_slider_10)
subtraction_5 = Subtraction(A=neg_6, B=number_slider_10)
subtraction_6 = Subtraction(A=neg_7, B="2")
subtraction_7 = Subtraction(A=division, B=钢埋板厚度_2)
addition_9 = Addition(A=subtraction_3, B="2")
subtraction_8 = Subtraction(A=neg_8, B="2")
neg_9 = Negative(Value=钢埋板厚度_2)
neg_10 = Negative(Value=钢埋板厚度_2)
工字钢_h = ListItem(List=shift, Index=0, Wrap=True)
工字钢_b = ListItem(List=shift, Index=1, Wrap=True)
工字钢_tf = ListItem(List=shift, Index=3, Wrap=True)
工字钢_tw = ListItem(List=shift, Index=2, Wrap=True)
pt_5 = ConstructPoint(XCoordinate=neg_9, YCoordinate=subtraction_4, ZCoordinate=0)
pt_6 = ConstructPoint(XCoordinate=neg_10, YCoordinate=addition_7, ZCoordinate=0)
pt_7 = ConstructPoint(XCoordinate=subtraction_5, YCoordinate=addition_8, ZCoordinate=0)
pt_8 = ConstructPoint(XCoordinate=subtraction_6, YCoordinate=subtraction_7, ZCoordinate=0)
pt_9 = ConstructPoint(XCoordinate=subtraction_8, YCoordinate=addition_9, ZCoordinate=0)
subtraction_9 = Subtraction(A=工字钢_b, B=工字钢_tw)
merge_12 = Merge(Data1=pt_5, Data2=pt_6, Data3=pt_7, Data4=pt_9, Data5=pt_8)
division_7 = Division(A=subtraction_9, B="2")
pline = PolyLine(Vertices=merge_12, Closed=True)
division_8 = Division(A=division_7, B="2")
subtraction_10 = Subtraction(A=division_8, B=number_slider_10)
subtraction_11 = Subtraction(A=division_8, B=钢埋板厚度_2)
neg_11 = Negative(Value=division_8)
subtraction_12 = Subtraction(A=neg_11, B=subtraction_11)
addition_10 = Addition(A=subtraction_12, B=number_slider_11)
dom_6 = ConstructDomain(DomainStart=addition_10, DomainEnd=subtraction_12)
dom_7 = ConstructDomain(DomainStart=addition_3, DomainEnd=addition_4)
subtraction_13 = Subtraction(A=subtraction_10, B=subtraction_11)
subtraction_14 = Subtraction(A=neg_11, B=subtraction_11)
dom_8 = ConstructDomain(DomainStart=subtraction_13, DomainEnd=subtraction_14)

# ---- group: 筛选阴阳角
pull_6 = PullPoint(Point=flatten(pt), Geometry=graft(merge_5), ClosestOnly=True)  # -> ClosestPoint, Distance
sort_6 = SortList(Keys=pull_6.Distance, ValuesA=flatten(pt))  # -> Keys, ValuesA
item_16 = ListItem(List=sort_6.Keys, Index=0, Wrap=True)  # -> Item, Item1
item_17 = ListItem(List=sort_6.ValuesA, Index=0, Wrap=True)  # -> Item, Item1
merge_13 = Merge(Data1=item_16.Item, Data2=item_16.Item1)
merge_14 = Merge(Data1=item_17.Item, Data2=item_17.Item1)
panel_65 = Panel(merge_13)
smaller_6 = SmallerThan(FirstNumber=merge_13, SecondNumber="100")  # -> SmallerThan, OrEqualTo
dispatch_15 = Dispatch(List=merge_14, DispatchPattern=smaller_6.SmallerThan)  # -> ListA, ListB
crv_61 = Curve(flatten(offset))

# ---- group: 筛选阴阳角 / F1-阴阳角-点
data_21 = Data(dispatch_15.ListA)

# ---- group: 筛选阴阳角 (continued)
check_same_points = CheckSamePoints(archPoint=flatten(pt), crvPoint=flatten(data_21))  # -> out, specialPt; inputs archPoint: list of Point3d, crvPoint: list of Point3d; same code as testpoint
cull_i_5 = CullIndex(List=flatten(pt), Indices=check_same_points.specialPt, Wrap=True)
pull_7 = PullPoint(Point=cull_i_5, Geometry=crv_61, ClosestOnly=True)  # -> ClosestPoint, Distance
ln_7 = Line(StartPoint=pull_7.ClosestPoint, EndPoint=cull_i_5)
rotate_3 = Rotate(Geometry=ln_7, Angle=1.570796327, Plane=cull_i_5)  # -> Geometry, Transform
pl_3 = ConstructPlane(Origin=cull_i_5, XAxis=rotate_3.Geometry, YAxis=ln_7)

# ----
project_13 = Project(Geometry=pl_3, Plane=xy_12)  # -> Geometry, Transform

# ---- group: 下层定位点Plane-去阴阳角
pln_3 = Plane(project_13.Geometry)

# ---- group: 下层定位平面-All
pln_4 = Plane(pln_3)

# ---- group: 制作上层定位平面 / 筛选阴阳角
pull_8 = PullPoint(Point=flatten(pt_2), Geometry=graft(merge_6), ClosestOnly=True)  # -> ClosestPoint, Distance
sort_7 = SortList(Keys=pull_8.Distance, ValuesA=flatten(pt_2))  # -> Keys, ValuesA
item_18 = ListItem(List=sort_7.Keys, Index=0, Wrap=True)  # -> Item, Item1
item_19 = ListItem(List=sort_7.ValuesA, Index=0, Wrap=True)  # -> Item, Item1
merge_15 = Merge(Data1=item_18.Item, Data2=item_18.Item1)
merge_16 = Merge(Data1=item_19.Item, Data2=item_19.Item1)
panel_66 = Panel(merge_15)
smaller_7 = SmallerThan(FirstNumber=merge_15, SecondNumber="100")  # -> SmallerThan, OrEqualTo
dispatch_16 = Dispatch(List=merge_16, DispatchPattern=smaller_7.SmallerThan)  # -> ListA, ListB
crv_62 = Curve(flatten(offset_2))

# ---- group: 制作上层定位平面 / 筛选阴阳角 / F1-阴阳角-点
data_22 = Data(dispatch_16.ListA)

# ---- group: 上-阴阳角
pt_10 = Point(data_22)

# ----
merge_17 = Merge(Data1=data_11, Data2=pt_10)

bake = BakeObjects(Geometry=merge_17, Attributes=attributes, BakeName=panel_37, Bake=False)

# ---- group: 制作上层定位平面 / 筛选阴阳角 (continued)
check_same_points_2 = CheckSamePoints(archPoint=flatten(pt_2), crvPoint=flatten(data_22))  # -> out, specialPt; inputs archPoint: list of Point3d, crvPoint: list of Point3d; same code as testpoint
cull_i_6 = CullIndex(List=flatten(pt_2), Indices=check_same_points_2.specialPt, Wrap=True)
pull_9 = PullPoint(Point=cull_i_6, Geometry=crv_62, ClosestOnly=True)  # -> ClosestPoint, Distance
ln_8 = Line(StartPoint=pull_9.ClosestPoint, EndPoint=cull_i_6)
rotate_4 = Rotate(Geometry=ln_8, Angle=1.570796327, Plane=cull_i_6)  # -> Geometry, Transform
pl_4 = ConstructPlane(Origin=cull_i_6, XAxis=rotate_4.Geometry, YAxis=ln_8)

# ----
project_14 = Project(Geometry=pl_4, Plane=xy_11)  # -> Geometry, Transform

# ---- group: 上层定位点Plane-去阴阳角
pln_5 = Plane(project_14.Geometry)

# ---- group: 上层定位平面-All
pln_6 = Plane(pln_5)

# ---- group: 制作上层定位平面 / 筛选阴阳角
pull_10 = PullPoint(Point=flatten(pt_3), Geometry=graft(merge_7), ClosestOnly=True)  # -> ClosestPoint, Distance
sort_8 = SortList(Keys=pull_10.Distance, ValuesA=flatten(pt_3))  # -> Keys, ValuesA
item_20 = ListItem(List=sort_8.Keys, Index=0, Wrap=True)  # -> Item, Item1
item_21 = ListItem(List=sort_8.ValuesA, Index=0, Wrap=True)  # -> Item, Item1
merge_18 = Merge(Data1=item_20.Item, Data2=item_20.Item1)
merge_19 = Merge(Data1=item_21.Item, Data2=item_21.Item1)
panel_67 = Panel(merge_18)
smaller_8 = SmallerThan(FirstNumber=merge_18, SecondNumber="100")  # -> SmallerThan, OrEqualTo
dispatch_17 = Dispatch(List=merge_19, DispatchPattern=smaller_8.SmallerThan)  # -> ListA, ListB
crv_63 = Curve(flatten(offset_3))

# ---- group: 制作上层定位平面 / 筛选阴阳角 / F1-阴阳角-点
data_23 = Data(dispatch_17.ListA)

# ---- group: 制作上层定位平面 / 筛选阴阳角 (continued)
check_same_points_3 = CheckSamePoints(archPoint=flatten(pt_3), crvPoint=flatten(data_23))  # -> out, specialPt; inputs archPoint: list of Point3d, crvPoint: list of Point3d; same code as testpoint
cull_i_7 = CullIndex(List=flatten(pt_3), Indices=check_same_points_3.specialPt, Wrap=True)
pull_11 = PullPoint(Point=cull_i_7, Geometry=crv_63, ClosestOnly=True)  # -> ClosestPoint, Distance
ln_9 = Line(StartPoint=pull_11.ClosestPoint, EndPoint=cull_i_7)
rotate_5 = Rotate(Geometry=ln_9, Angle=1.570796327, Plane=cull_i_7)  # -> Geometry, Transform
pl_5 = ConstructPlane(Origin=cull_i_7, XAxis=rotate_5.Geometry, YAxis=ln_9)

# ----
project_15 = Project(Geometry=pl_5, Plane=xy_10)  # -> Geometry, Transform

# ---- group: 上层定位点Plane-去阴阳角
pln_7 = Plane(project_15.Geometry)

# ---- group: 檐口定位平面-All
pln_8 = Plane(pln_7)

# ----
# 三视图
# hidden lines of top+pers view
# move to center
# 如果无法完整的生成埋件的三视图，
# 建议选择埋件的3D在Rhino中将
# Top/Perspective/Front/Right 试图缩放至合适大小后重新运行
panel_68 = Panel("""Top
Perspective
Front
Right""")
m2d_rhino = Make2DRhinoView(Name=panel_68, Clip=True)
number_slider_40 = Slider(1, range=0..10)
pt_11 = Point(Point(957.9296072, 367.7685097, 0))
pt_12 = Point("0,0,0")
recgrid_2 = Rectangular(
    Plane=pt_11,
    SizeX=Slider(12, range=1..20, expression="X*50"),
    SizeY=Slider(10, range=1..20, expression="X*50"),
    ExtentX=number_slider_40,
    ExtentY=number_slider_40)  # -> Cells, Points
flatten_5 = FlattenTree(Tree=recgrid_2.Points, Path="{0}")

# ----
# （6）生成板埋埋件
# 注意：
# 1.记得点一下Compute按钮
# 2.如果无法完整的生成埋件的三视图，
# 建议选择埋件的3D在Rhino中将
# Top/Perspective/Front/Right 试图缩放至合适大小后重新运行
make2d = Make2D(Geometry=move_8.Geometry, View=m2d_rhino, TangentEdges=False, TangentSeams=False, AutoComputeMake2D=False)  # -> VisibleCurves, VisibleIndex, VisibleType, HiddenCurves, HiddenIndex, HiddenType

bang = ExplodeTree(Data=make2d.VisibleCurves)  # -> Branch0, Branch1, Branch2, Branch3, Branch4, Branch5, Branch6, Branch7
divdist = DivideDistance(Curve=make2d.HiddenCurves, Distance=Slider(1, range=0..10))  # -> Points, Tangents, Parameters
graft = GraftTree(Tree=make2d.HiddenCurves, IncludeEmptyLists=True, IncludeNullItems=True)
shatter = Shatter(Curve=graft, Parameters=divdist.Parameters)
dispatch_18 = Dispatch(List=shatter, DispatchPattern=[True, False])  # -> ListA, ListB
crv_64 = Curve(dispatch_18.ListA)
pshift = ShiftPaths(Data=crv_64, Offset=-1)
pshift_2 = ShiftPaths(Data=pshift, Offset=-1)
bang_2 = ExplodeTree(Data=pshift_2)  # -> Branch0, Branch1, Branch2, Branch3, Branch4, Branch5, Branch6, Branch7
entwine_9 = Entwine(Branch00=bang_2.Branch0, Branch01=bang.Branch0, FlattenInputs=True)  # -> flatten(Result)
entwine_10 = Entwine(Branch00=bang_2.Branch1, Branch01=bang.Branch1, FlattenInputs=True)  # -> flatten(Result)
entwine_11 = Entwine(Branch00=entwine_9, Branch01=entwine_10, Branch02=bang.Branch2, Branch03=bang.Branch3, FlattenInputs=True)
group_2 = Group(Objects=entwine_11)
pshift_3 = ShiftPaths(Data=group_2, Offset=-1)
pshift_4 = ShiftPaths(Data=group_2, Offset=-1)
boxprop = BoxProperties(Box=pshift_3)  # -> Center, Diagonal, Area, Volume, Degeneracy
vec2pt = Vector2Pt(PointA=boxprop.Center, PointB=pt_12, Unitize=False)  # -> Vector, Length
move_9 = Move(Geometry=pshift_4, Motion=vec2pt.Vector)  # -> flatten(Geometry), Transform
orient = Orient(Geometry=flatten(move_9.Geometry), Source=PlaneXY(0, 0, 0), Target=flatten_5)  # -> Geometry, Transform
cull_i_8 = CullIndex(List=orient.Geometry, Indices="-1", Wrap=True)
split_6 = SplitList(List=cull_i_8, Index="4")  # -> ListA, ListB
geo_4 = Geometry(split_6.ListA)

# ---- group: 单体定Top/Side
item_22 = ListItem(List=geo_4, Index=Slider(0, range=0..10), Wrap=True)
item_23 = ListItem(List=geo_4, Index=2, Wrap=True)
cluster_2 = Cluster(G=item_22)
cluster_3 = Cluster(G=item_23)

# ----
钢肋板_侧视图 = Rectangle(Plane=PlaneXY(0, 0, 0), XSize=dom_8, YSize=dom_3, Radius=0)  # -> Rectangle, Length
tstat_2 = TreeStatistics(Tree=工字钢_h)  # -> Paths, Length, Count
钢肋板倒角_侧视图 = Rectangle(Plane=PlaneXY(0, 0, 0), XSize=dom_6, YSize=dom_7, Radius=0)  # -> Rectangle, Length
repeat = RepeatData(Data=pline, Length=tstat_2.Length)  # -> simplify(Data)
merge_20 = Merge(Data1=simplify(钢肋板_侧视图.Rectangle), Data2=simplify(repeat), Data3=simplify(钢肋板倒角_侧视图.Rectangle))
division_9 = Division(A=工字钢_h, B="2")
division_10 = Division(A=工字钢_b, B=2)
subtraction_15 = Subtraction(A=division_9, B=工字钢_tf)
repeat_2 = RepeatData(Data=钢埋板_侧视图.Rectangle, Length=tstat_2.Length)  # -> simplify(Data)
mirror = Mirror(Geometry=merge_20, Plane=xz)  # -> Geometry, Transform
addition_11 = Addition(A=subtraction_15, B=Slider(200, range=0..1000))
merge_21 = Merge(Data1=repeat_2, Data2=merge_20, Data3=mirror.Geometry)
addition_12 = Addition(A=addition_11, B=division_7)
X_2 = UnitX(Factor=addition_12)
move_10 = Move(Geometry=merge_21, Motion=X_2)  # -> Geometry, Transform

group_3 = Group(Objects=move_10.Geometry)
rotate_6 = Rotate(Geometry=group_3, Angle=3.141592654, Plane=PlaneXY(0, 0, 0))  # -> Geometry, Transform
boxprop_2 = BoxProperties(Box=rotate_6.Geometry)  # -> Center, Diagonal, Area, Volume, Degeneracy
bbox = BoundingBox(Content=rotate_6.Geometry, Plane=PlaneXY(0, 0, 0))  # -> Box, Box_2
debox = DeconstructBox(Box=bbox.Box)  # -> Plane, X, Y, Z
pdecon_2 = Deconstruct(Point=boxprop_2.Center)  # -> XComponent, YComponent, ZComponent
dedomain_3 = DeconstructDomain(Domain=debox.Y)  # -> Start, End
pt_13 = ConstructPoint(XCoordinate=pdecon_2.XComponent, YCoordinate=dedomain_3.Start, ZCoordinate=pdecon_2.ZComponent)
xy_17 = XYPlane(Origin=Point(0, 0, 0))
pl_origin = PlaneOrigin(Base=xy_17, Origin=pt_13)
orient_2 = Orient(Geometry=rotate_6.Geometry, Source=pl_origin, Target=xy_17)  # -> Geometry, Transform
ungroup = Ungroup(Group=orient_2.Geometry)  # -> simplify(Objects)

# ----
# 要连接的梁中线Offest值
num = Number(simplify(division_10))

block = DefineBlock(Geometry=ungroup, Attributes=attributes_13, BlockName=concat_3, BasePlane=PlaneXY(0, 0, 0))
deblock_4 = DeconstructBlock(Block=block)  # -> Name, Plane, Geometry
group_4 = Group(Objects=deblock_4.Geometry)
bbox_2 = BoundingBox(Content=group_4, Plane=PlaneXY(0, 0, 0))  # -> Box, Box_2
deplane_5 = DeconstructPlane(Plane=deblock_4.Plane)  # -> Origin, XAxis, YAxis, ZAxis
area_8 = Area(Geometry=bbox_2.Box)  # -> Area, Centroid
move2pt_6 = MoveToPoint(Geometry=deplane_5.Origin, PointA=deplane_5.Origin, PointB=area_8.Centroid)  # -> Moved, Vector, Transform
pl_6 = ConstructPlane(Origin=move2pt_6.Moved, XAxis=deplane_5.YAxis, YAxis=deplane_5.XAxis)
deplane_6 = DeconstructPlane(Plane=pl_6)  # -> Origin, XAxis, YAxis, ZAxis
rotate_7 = Rotate(Geometry=pl_6, Angle="Pi", Plane=pl_6)  # -> Geometry, Transform
amp_6 = Amplitude(Vector=deplane_6.YAxis, Amplitude=multiplication)
move_11 = Move(Geometry=deplane_6.Origin, Motion=amp_6)  # -> Geometry, Transform
srf = Surface(bbox_2.Box)
crv_65 = Curve(srf)
ln_10 = Line(StartPoint=move_11.Geometry, EndPoint=deplane_6.Origin)
ccx_4 = CurveCurve(CurveA=ln_10, CurveB=crv_65)  # -> Points, ParamsA, ParamsB
ln_11 = Line(StartPoint=deplane_6.Origin, EndPoint=ccx_4.Points)
move_12 = Move(Geometry=rotate_7.Geometry, Motion=ln_11)  # -> simplify(Geometry), Transform
amp_7 = Amplitude(Vector=ln_11, Amplitude=expr("-x", number_slider_12))
move_13 = Move(Geometry=move_12.Geometry, Motion=amp_7)  # -> Geometry, Transform

text_2 = DefineTextObject(Text=txt_4, Plane=simplify(move_13.Geometry), DimensionStyle=panel_6, OutputType="Text")
group_5 = Group(Objects=[block, text_2])

merge_22 = Merge(Data1=group_5, Data2=move_12.Geometry)

# ----
# 要连接的embed
data_24 = Data(merge_22)

item_24 = ListItem(List=data_24, Index=0, Wrap=True)
flip = FlipMatrix(Data=item_24)
item_25 = ListItem(List=flip, Index=Slider(9, range=0..15), Wrap=True)
data_25 = Data(data_24)
item_26 = ListItem(List=data_25, Index="-1", Wrap=True)
# 阴阳角
item_27 = ListItem(List=data_25, Index=0, Wrap=True)
data_26 = Data(data_24)
item_28 = ListItem(List=data_26, Index=0, Wrap=True)
item_29 = ListItem(List=data_26, Index="-1", Wrap=True)
rotate_8 = Rotate(Geometry=item_29, Angle="Pi", Plane=item_29)  # -> Geometry, Transform
data_27 = Data(data_24)
data_28 = Data(data_24)
item_30 = ListItem(List=data_27, Index=0, Wrap=True)
item_31 = ListItem(List=data_27, Index="-1", Wrap=True)
item_32 = ListItem(List=data_28, Index=0, Wrap=True)
item_33 = ListItem(List=data_28, Index="-1", Wrap=True)
rotate_9 = Rotate(Geometry=item_31, Angle="Pi", Plane=item_31)  # -> Geometry, Transform

ungroup_2 = Ungroup(Group=cluster_3)
ungroup_3 = Ungroup(Group=cluster_2)

# ---- group: Top/Side
filter_12 = StreamFilter(Gate=list_6, Stream0=ungroup_3, Stream1=ungroup_2)

# ---- group: Block
attributes_14 = DefineObjectAttributes(Color=ColourSwatch(SwatchColor=RGB(255, 0, 0)))
block_2 = DefineBlock(Geometry=ungroup_3, Attributes=attributes_14, BlockName="Board Plate", BasePlane=PlaneXY(0, 0, 0))

# ----
deblock_5 = DeconstructBlock(Block=block_2)  # -> Name, flatten(Plane), flatten(Geometry)
boundary_2 = BoundarySurfaces(Edges=deblock_5.Geometry)
deplane_7 = DeconstructPlane(Plane=deblock_5.Plane)  # -> Origin, XAxis, YAxis, ZAxis
area_9 = Area(Geometry=boundary_2)  # -> Area, Centroid
move2pt_7 = MoveToPoint(Geometry=flatten(deplane_7.Origin), PointA=flatten(deplane_7.Origin), PointB=flatten(area_9.Centroid))  # -> Moved, Vector, Transform
pl_7 = ConstructPlane(Origin=move2pt_7.Moved, XAxis=deplane_7.XAxis, YAxis=deplane_7.YAxis)  # -> graft(Plane)

deplane_8 = DeconstructPlane(Plane=deblock_5.Plane)  # -> Origin, XAxis, YAxis, ZAxis
amp_8 = Amplitude(Vector=deplane_8.YAxis, Amplitude=number_slider_8)
move_14 = Move(Geometry=deplane_8.Origin, Motion=amp_8)  # -> Geometry, Transform

text_3 = DefineTextObject(Text=panel_10, Plane=move_14.Geometry, DimensionStyle=panel_9, OutputType="Text")
group_6 = Group(Objects=flatten([block_2, text_3]))
entwine_12 = Entwine(Branch00=group_6, Branch01=pl_7, FlattenInputs=True)

data_29 = Data(flatten(entwine_12))
item_34 = ListItem(List=data_29, Index=0, Wrap=True)
item_35 = ListItem(List=data_29, Index="-1", Wrap=True)

ungroup_4 = Ungroup(Group=item_34)
item_36 = ListItem(List=ungroup_4, Index="-1", Wrap=True)
deblock_6 = DeconstructBlock(Block=item_36)  # -> Name, Plane, Geometry
boundary_3 = BoundarySurfaces(Edges=deblock_6.Geometry)
debrep = DeconstructBrep(Brep=boundary_3)  # -> Faces, Edges, Vertices
len_4 = Length(Curve=debrep.Edges)
sort_9 = SortList(Keys=len_4, ValuesA=debrep.Edges)  # -> Keys, ValuesA
item_37 = ListItem(List=sort_9.ValuesA, Index=0, Wrap=True)
len_5 = Length(Curve=item_37)  # -> expr("x/2", Length)

# ---- group: 车道区域
# 1.是否有檐口线-下层定位点
toggle_4 = BooleanToggle(True)
clean = CleanTree(RemoveNulls=True, RemoveInvalid=True, RemoveEmpty=toggle_4, Tree=pln_4)

# ---- group: 车道区域 / Input ???
deplane_9 = DeconstructPlane(Plane=clean)  # -> Origin, XAxis, YAxis, ZAxis

# ---- group: 车道区域 (continued)
incurve = PointInCurve(Point=deplane_9.Origin, Curve=crv_27)  # -> Relationship, Point
equals_2 = Equality(FirstNumber=incurve.Relationship, SecondNumber="2")  # -> Equality, Inequality
dispatch_19 = Dispatch(List=clean, DispatchPattern=equals_2.Equality)  # -> ListA, ListB

# Site - 有檐口线的定位点
pln_9 = Plane(dispatch_19.ListA)

# Site - 无檐口线的定位点
pln_10 = Plane(dispatch_19.ListB)

# ---- group: 车道区域 / 檐口线-Site
pln_11 = Plane(pln_9)

# ----
incurve_2 = PointInCurve(Point=pln_11, Curve=crv_31)  # -> Relationship, Point
equals_3 = Equality(FirstNumber=incurve_2.Relationship, SecondNumber="2")  # -> Equality, Inequality
dispatch_20 = Dispatch(List=pln_11, DispatchPattern=equals_3.Equality)  # -> ListA, ListB
pln_12 = Plane(dispatch_20.ListA)

incurve_3 = PointInCurve(Point=pln_10, Curve=crv_31)  # -> Relationship, Point
equals_4 = Equality(FirstNumber=incurve_3.Relationship, SecondNumber="2")  # -> Equality, Inequality
dispatch_21 = Dispatch(List=pln_10, DispatchPattern=equals_4.Equality)  # -> ListA, ListB
pln_13 = Plane(dispatch_21.ListA)

# ----
# 1.0无檐口线初筛-下层定位点
pln_14 = Plane(pln_13)

project_16 = Project(Geometry=pln_14, Plane=PlaneXY(0, 0, 0))  # -> Geometry, Transform

# ---- group: All-下层定位点
# 1.1有檐口线
pln_15 = Plane(pln_12)

# ----
pln_16 = Plane(pln_15)

# ----
# 1.是否有檐口线-檐口线定位点
toggle_5 = BooleanToggle(True)
clean_2 = CleanTree(RemoveNulls=True, RemoveInvalid=True, RemoveEmpty=toggle_5, Tree=pln_8)

# ---- group: Input ???
deplane_10 = DeconstructPlane(Plane=clean_2)  # -> Origin, XAxis, YAxis, ZAxis

# ----
incurve_4 = PointInCurve(Point=deplane_10.Origin, Curve=crv_28)  # -> Relationship, Point
equals_5 = Equality(FirstNumber=incurve_4.Relationship, SecondNumber="2")  # -> Equality, Inequality
dispatch_22 = Dispatch(List=clean_2, DispatchPattern=equals_5.Equality)  # -> ListA, ListB

# ----
# Site - 檐口线的定位点
pln_17 = Plane(dispatch_22.ListB)

incurve_5 = PointInCurve(Point=pln_17, Curve=crv_31)  # -> Relationship, Point
equals_6 = Equality(FirstNumber=incurve_5.Relationship, SecondNumber="2")  # -> Equality, Inequality
dispatch_23 = Dispatch(List=pln_17, DispatchPattern=equals_6.Equality)  # -> ListA, ListB
pln_18 = Plane(dispatch_23.ListB)
pln_19 = Plane(dispatch_23.ListA)

# ----
# 1.是否有檐口线-上层定位点
toggle_6 = BooleanToggle(True)
clean_3 = CleanTree(RemoveNulls=True, RemoveInvalid=True, RemoveEmpty=toggle_6, Tree=pln_6)

# ---- group: Input ???
deplane_11 = DeconstructPlane(Plane=clean_3)  # -> Origin, XAxis, YAxis, ZAxis

# ----
incurve_6 = PointInCurve(Point=deplane_11.Origin, Curve=crv_29)  # -> Relationship, Point
equals_7 = Equality(FirstNumber=incurve_6.Relationship, SecondNumber="2")  # -> Equality, Inequality
dispatch_24 = Dispatch(List=clean_3, DispatchPattern=equals_7.Equality)  # -> ListA, ListB

# ----
# Site - 无檐口线的定位点
pln_20 = Plane(dispatch_24.ListB)

incurve_7 = PointInCurve(Point=pln_20, Curve=crv_31)  # -> Relationship, Point
equals_8 = Equality(FirstNumber=incurve_7.Relationship, SecondNumber="2")  # -> Equality, Inequality
dispatch_25 = Dispatch(List=pln_20, DispatchPattern=equals_8.Equality)  # -> ListA, ListB
pln_21 = Plane(dispatch_25.ListA)
pln_22 = Plane(dispatch_25.ListB)

# ----
# 1.0无檐口线初筛-上层定位点
pln_23 = Plane(pln_21)

deplane_12 = DeconstructPlane(Plane=pln_23)  # -> Origin, XAxis, YAxis, ZAxis
incurves = PointInCurves(Point=deplane_12.Origin, Curves=flatten(reb_2))  # -> Relationship, Index, Point
equals_9 = Equality(FirstNumber=incurves.Relationship, SecondNumber="2")  # -> Equality, Inequality
dispatch_26 = Dispatch(List=pln_23, DispatchPattern=equals_9.Equality)  # -> ListA, ListB
data_30 = Data(dispatch_26.ListB)

pln_24 = Plane(dispatch_26.ListA)

# ---- group: 下层交点-除重
# 1.0无檐口线-上层定位点
pln_25 = Plane(data_30)

# ----
# 区分内外梁边线
# 2.根据是否相交判定内外梁(平行于建筑边线方向）
crv_66 = Curve(crv_60)
num_2 = Number(num)
crv_67 = Curve(filter)
offcrv = OffsetCurve(Curve=crv_66, Plane=PlaneXY(0, 0, 0), Distance=num_2, BothSides=expr("-x", num_2), Kinks=0, CapType="0")
midpt_6 = CurveMiddle(Curve=offcrv)
offcrv_2 = OffsetCurve(Curve=crv_66, Plane=PlaneXY(0, 0, 0), Distance=num_2, BothSides=expr("-x", num_2), Kinks=0, CapType="1")
crv_68 = Curve(offcrv)
item_38 = ListItem(List=midpt_6, Index=0, Wrap=True)
item_39 = ListItem(List=crv_68, Index=0, Wrap=True)
item_40 = ListItem(List=crv_68, Index="-1", Wrap=True)
graft_2 = GraftTree(Tree=crv_66, IncludeEmptyLists=True, IncludeNullItems=True)

# ---- group: 梁中线-中点
midpt_7 = CurveMiddle(Curve=crv_66)

# ---- group: Pull到轮廓线
pull_12 = PullPoint(Point=midpt_7, Geometry=flatten(crv_67), ClosestOnly=True)  # -> ClosestPoint, Distance

# ----
# 梁线闭合
shift_2 = ShiftPaths(Data=offcrv_2, Offset=-1)

# ---- group: 和某组梁边线相连
ln_12 = Line(StartPoint=item_38, EndPoint=graft(pull_12.ClosestPoint))

# ----
panel_69 = Panel(num_2)

# ---- group: 有交点为内
ccx_5 = CurveCurve(CurveA=ln_12, CurveB=graft_2)  # -> Points, ParamsA, ParamsB

# ----
null_2 = NullItem(Item=ccx_5.Points)  # -> NullFlags, InvalidFlags, Description
dispatch_27 = Dispatch(List=item_39, DispatchPattern=null_2.InvalidFlags)  # -> ListA, ListB
dispatch_28 = Dispatch(List=item_40, DispatchPattern=null_2.InvalidFlags)  # -> ListA, ListB

# ----
# 梁边线-内
merge_23 = Merge(Data1=dispatch_27.ListB, Data2=dispatch_28.ListA)

# ----
# 梁边线-外
merge_24 = Merge(Data1=dispatch_27.ListA, Data2=dispatch_28.ListB)

# ---- group: 梁-外侧
crv_69 = Curve(merge_24)

# ---- group: 下层交点-除重 / 梁外侧
crv_70 = Curve(merge_24)

# ----
crv_71 = Curve(shift_2)

# ---- group: 梁内侧
crv_72 = Curve(merge_23)

crv_73 = Curve(merge_23)

# ---- group: 梁内测
crv_74 = Curve(merge_23)

# ---- group: 梁外侧
crv_75 = Curve(merge_24)

# ----
crv_76 = Curve(shift_2)

# ---- group: 梁外侧
crv_77 = Curve(merge_24)

# ---- group: 内侧梁线
crv_78 = Curve(merge_23)

# ---- group: 梁外侧
crv_79 = Curve(merge_24)

crv_80 = Curve(crv_75)

# ---- group: 梁内侧
crv_81 = Curve(crv_78)

# ----
crv_82 = Curve(shift_2)

# ---- group: 梁外侧
crv_83 = Curve(crv_75)

# ---- group: 梁内侧
crv_84 = Curve(crv_78)

# ---- group: 梁中线
crv_85 = Curve(crv_66)

# ---- group: 梁内侧
crv_86 = Curve(crv_78)

crv_87 = Curve(crv_78)

# ----
# 1.1 有檐口-整个site一起处理
data_31 = Data(pln_19)
pln_26 = Plane(data_31)
deplane_13 = DeconstructPlane(Plane=pln_26)  # -> Origin, XAxis, YAxis, ZAxis
amp_9 = Amplitude(Vector=deplane_13.YAxis, Amplitude=number_slider_24)
amp_10 = Amplitude(Vector=deplane_13.YAxis, Amplitude=number_slider_23)
move_15 = Move(Geometry=deplane_13.Origin, Motion=expr("-x", amp_10))  # -> Geometry, Transform
move_16 = Move(Geometry=deplane_13.Origin, Motion=amp_9)  # -> Geometry, Transform
ln_13 = Line(StartPoint=move_15.Geometry, EndPoint=move_16.Geometry)
project_17 = Project(Geometry=crv_69, Plane=PlaneXY(0, 0, 0))  # -> Geometry, Transform
project_18 = Project(Geometry=ln_13, Plane=PlaneXY(0, 0, 0))  # -> Geometry, Transform
merge_25 = Merge(Data1=crv_34, Data2=crv_33)
ccx_6 = CurveCurve(CurveA=graft(project_18.Geometry), CurveB=flatten(project_17.Geometry))  # -> Points, ParamsA, ParamsB
project_19 = Project(Geometry=merge_25, Plane=PlaneXY(0, 0, 0))  # -> Geometry, Transform
shift_3 = ShiftPaths(Data=ccx_6.Points, Offset=-1)
pull_13 = PullPoint(Point=shift_3, Geometry=flatten(project_19.Geometry), ClosestOnly=True)  # -> ClosestPoint, Distance
sort_10 = SortList(Keys=pull_13.Distance, ValuesA=shift_3)  # -> Keys, ValuesA
item_41 = ListItem(List=sort_10.ValuesA, Index=0, Wrap=True)
null_3 = NullItem(Item=flatten(item_41))  # -> NullFlags, InvalidFlags, Description
dispatch_29 = Dispatch(List=flatten(item_41), DispatchPattern=null_3.InvalidFlags)  # -> ListA, ListB
dispatch_30 = Dispatch(List=pln_26, DispatchPattern=null_3.InvalidFlags)  # -> ListA, ListB
crv_88 = Curve(shift_2)

# ---- group: 交点对应的初始Plane
data_32 = Data(dispatch_30.ListB)

# ---- group: 交点Point
data_33 = Data(dispatch_29.ListB)

# ----
# 按照梁分类定位点
pt_14 = Point(data_33)
incurves_2 = PointInCurves(Point=flatten(pt_14), Curves=crv_88)  # -> Relationship, Index, Point
equals_10 = Equality(FirstNumber=incurves_2.Relationship, SecondNumber="0")  # -> Equality, Inequality
dispatch_31 = Dispatch(List=flatten(pt_14), DispatchPattern=equals_10.Inequality)  # -> ListA, ListB

# ---- group: 交点-属于哪个梁
data_34 = Data(dispatch_31.ListA)

# ----
cullduppoints_2 = RemoveDuplicatePoints(InputPoints=data_34, Tolerance=0.001)  # -> OutputPoints, FirstPointIndexes

check_same_points_4 = CheckSamePoints(archPoint=pln_26, crvPoint=data_32)  # -> out, specialPt; inputs archPoint: list of Point3d, crvPoint: list of Point3d; same code as testpoint

# ----
# 0无檐口线
# 与梁不相交
cull_i_9 = CullIndex(List=pln_26, Indices=check_same_points_4.specialPt, Wrap=True)

# ----
# 0 檐口出定位点
# 与结构无交点
pln_27 = Plane(cull_i_9)

# ----
# 0.Missing Point-二次筛选檐口处
# 埋件定位点Offset，没有找到和梁的交点
deplane_14 = DeconstructPlane(Plane=pln_27)  # -> Origin, XAxis, YAxis, ZAxis
amp_11 = Amplitude(Vector=deplane_14.YAxis, Amplitude=expr("-X", number_slider_23))
move_17 = Move(Geometry=deplane_14.Origin, Motion=amp_11)  # -> Geometry, Transform
ln_14 = Line(StartPoint=move_17.Geometry, EndPoint=deplane_14.Origin)
amp_12 = Amplitude(Vector=deplane_14.XAxis, Amplitude=number_slider_7)
amp_13 = Amplitude(Vector=deplane_14.XAxis, Amplitude=expr("-x", number_slider_7))

# ---- group: 2条Offset的探针找交点
move_18 = Move(Geometry=ln_14, Motion=amp_13)  # -> Geometry, Transform
move_19 = Move(Geometry=ln_14, Motion=amp_12)  # -> Geometry, Transform

# ----
deplane_15 = DeconstructPlane(Plane=project_16.Geometry)  # -> Origin, XAxis, YAxis, ZAxis

pt_15 = Point(deplane_15.Origin)

incurves_3 = PointInCurves(Point=pt_15, Curves=flatten(reb_2))  # -> Relationship, Index, Point
equals_11 = Equality(FirstNumber=incurves_3.Relationship, SecondNumber="2")  # -> Equality, Inequality
dispatch_32 = Dispatch(List=project_16.Geometry, DispatchPattern=equals_11.Equality)  # -> ListA, ListB
data_35 = Data(dispatch_32.ListB)

pln_28 = Plane(dispatch_32.ListA)

data_36 = Data(dispatch_32.ListA)

# ---- group: 下层交点-除重
# 1.0无檐口线-下层定位点
pln_29 = Plane(data_35)

# ----
# 按照梁分类定位PLANE
crv_89 = Curve(merge_23)
shift_4 = ShiftPaths(Data=crv_89, Offset=-1)
shift_5 = ShiftPaths(Data=shift_4, Offset=-1)
pull_14 = PullPoint(Point=cullduppoints_2.OutputPoints, Geometry=simplify(shift_5), ClosestOnly=True)  # -> ClosestPoint, Distance
ln_15 = Line(StartPoint=pull_14.ClosestPoint, EndPoint=cullduppoints_2.OutputPoints)
crv_90 = Curve(crv_28)
movetoplane_4 = MoveToPlane(Geometry=crv_90, Plane=PlaneXY(0, 0, 0), Above=True, Below=True)  # -> Geometry, Transform

# ---- group: Y Axis Line-All
crv_91 = Curve(ln_15)

# ---- group: 下层交点-除重
# 1.0 无檐口线+上下层幕墙边线连续
pln_30 = Plane(pln_25)
pln_31 = Plane(pln_29)
deplane_16 = DeconstructPlane(Plane=pln_30)  # -> Origin, XAxis, YAxis, ZAxis
deplane_17 = DeconstructPlane(Plane=pln_31)  # -> Origin, XAxis, YAxis, ZAxis
number_slider_41 = Slider(3584, range=0..10000)
number_slider_42 = Slider(3584, range=0..10000)
amp_14 = Amplitude(Vector=deplane_17.YAxis, Amplitude=expr("-x", number_slider_42))
amp_15 = Amplitude(Vector=deplane_17.YAxis, Amplitude=number_slider_42)
amp_16 = Amplitude(Vector=deplane_16.YAxis, Amplitude=expr("-x", number_slider_41))
amp_17 = Amplitude(Vector=deplane_16.YAxis, Amplitude=number_slider_41)
move_20 = Move(Geometry=deplane_17.Origin, Motion=amp_14)  # -> Geometry, Transform
move_21 = Move(Geometry=deplane_17.Origin, Motion=amp_15)  # -> Geometry, Transform
move_22 = Move(Geometry=deplane_16.Origin, Motion=amp_16)  # -> Geometry, Transform
move_23 = Move(Geometry=deplane_16.Origin, Motion=amp_17)  # -> Geometry, Transform
ln_16 = Line(StartPoint=move_22.Geometry, EndPoint=move_23.Geometry)
ln_17 = Line(StartPoint=move_20.Geometry, EndPoint=move_21.Geometry)
pln_32 = Plane(pln_31)
pt_16 = Point(deplane_16.Origin)

# ---- group: 下层交点-除重 / F1-交点
ccx_7 = CurveCurve(CurveA=graft(ln_17), CurveB=crv_36)  # -> Points, ParamsA, ParamsB

# ---- group: 下层交点-除重 / F2-交点
ccx_8 = CurveCurve(CurveA=graft(ln_16), CurveB=crv_35)  # -> Points, ParamsA, ParamsB

# ----
end_4 = EndPoints(Curve=graft(crv_91))  # -> Start, End
merge_26 = Merge(Data1=end_4.Start, Data2=end_4.End)
pull_15 = PullPoint(Point=merge_26, Geometry=movetoplane_4.Geometry, ClosestOnly=True)  # -> ClosestPoint, Distance
sort_11 = SortList(Keys=pull_15.Distance, ValuesA=merge_26)  # -> Keys, ValuesA
item_42 = ListItem(List=sort_11.ValuesA, Index="-1", Wrap=True)
item_43 = ListItem(List=sort_11.ValuesA, Index=0, Wrap=True)

null_4 = NullItem(Item=item_42)  # -> NullFlags, InvalidFlags, Description
null_5 = NullItem(Item=item_43)  # -> NullFlags, InvalidFlags, Description
dispatch_33 = Dispatch(List=item_43, DispatchPattern=null_5.NullFlags)  # -> ListA, ListB
dispatch_34 = Dispatch(List=item_42, DispatchPattern=null_4.NullFlags)  # -> ListA, ListB
panel_70 = Panel(dispatch_33.ListB)

pt_17 = Point(dispatch_33.ListB)
pt_18 = Point(dispatch_34.ListB)
ln_18 = Line(StartPoint=pt_18, EndPoint=pt_17)
rotate_10 = Rotate(Geometry=ln_18, Angle=1.570796327, Plane=pt_17)  # -> Geometry, Transform

end_5 = EndPoints(Curve=graft(ln_18))  # -> Start, End
pt_19 = Point(end_5.End)
flatten_6 = FlattenTree(Tree=pt_19, Path="{0}")

pl_8 = ConstructPlane(Origin=pt_19, XAxis=rotate_10.Geometry, YAxis=ln_18)
null_6 = NullItem(Item=pl_8)  # -> NullFlags, InvalidFlags, Description
dispatch_35 = Dispatch(List=pl_8, DispatchPattern=null_6.NullFlags)  # -> ListA, ListB
pln_33 = Plane(dispatch_35.ListB)

item_44 = ListItem(List=flatten_6, Index=Slider(30, range=0..30), Wrap=True)
shift_6 = ShiftPaths(Data=pln_33, Offset=-1)
shift_7 = ShiftPaths(Data=shift_6, Offset=-1)  # -> simplify(Data)

# ---- group: 檐口-首次筛选的有效起始Plane
data_37 = Data(shift_7)

# ----
# 1.1 檐口处侧埋，钢板焊
# 02：钢板焊埋件[钢梁外侧]
# @钢边梁宽@钢边梁高
pln_34 = Plane(data_37)

# ---- group: 下层交点-除重 (continued)
pull_16 = PullPoint(Point=ccx_8.Points, Geometry=deplane_16.Origin, ClosestOnly=True)  # -> ClosestPoint, Distance
pull_17 = PullPoint(Point=ccx_7.Points, Geometry=deplane_17.Origin, ClosestOnly=True)  # -> ClosestPoint, Distance
sort_12 = SortList(Keys=pull_17.Distance, ValuesA=ccx_7.Points)  # -> Keys, ValuesA
sort_13 = SortList(Keys=pull_16.Distance, ValuesA=ccx_8.Points)  # -> Keys, ValuesA
item_45 = ListItem(List=sort_12.ValuesA, Index=0, Wrap=True)  # -> flatten(Item)
item_46 = ListItem(List=sort_13.ValuesA, Index=0, Wrap=True)  # -> flatten(Item)
null_7 = NullItem(Item=item_45)  # -> NullFlags, InvalidFlags, Description
null_8 = NullItem(Item=item_46)  # -> NullFlags, InvalidFlags, Description
dispatch_36 = Dispatch(List=item_45, DispatchPattern=null_7.NullFlags)  # -> ListA, ListB
dispatch_37 = Dispatch(List=item_46, DispatchPattern=null_8.NullFlags)  # -> ListA, ListB

pt_20 = Point(dispatch_36.ListB)

# ---- group: 下层交点-除重 / 上层交点-除重
pt_21 = Point(dispatch_37.ListB)

# ---- group: 下层交点-除重 (continued)
pull_18 = PullPoint(Point=pt_20, Geometry=pt_21, ClosestOnly=True)  # -> ClosestPoint, Distance
sort_14 = SortList(Keys=pull_18.Distance, ValuesA=pull_18.ClosestPoint)  # -> Keys, ValuesA
panel_71 = Panel(sort_14.Keys)
larger_6 = LargerThan(FirstNumber=pull_18.Distance, SecondNumber=number_slider_25)  # -> LargerThan, OrEqualTo
dispatch_38 = Dispatch(List=pt_20, DispatchPattern=larger_6.LargerThan)  # -> ListA, ListB
pull_19 = PullPoint(Point=deplane_17.Origin, Geometry=graft(pt_20), ClosestOnly=True)  # -> ClosestPoint, Distance
sort_15 = SortList(Keys=pull_19.Distance, ValuesA=pln_32)  # -> Keys, ValuesA
item_47 = ListItem(List=sort_15.ValuesA, Index=0, Wrap=True)
check_same_points_5 = CheckSamePoints(archPoint=pln_32, crvPoint=flatten(item_47))  # -> out, specialPt; inputs archPoint: list of Point3d, crvPoint: list of Point3d; same code as testpoint

# ---- group: 下层交点-除重 / 2组交点距离大于容差-默认不同点
dispatch_39 = Dispatch(List=pull_18.ClosestPoint, DispatchPattern=larger_6.LargerThan)  # -> ListA, ListB

# ---- group: 下层交点-除重 / 大于容差算作新点
pt_22 = Point(dispatch_39.ListA)

# ---- group: 下层交点-除重 / 有效Plane-下层建筑线在该处连续
item_48 = ListItem(List=pln_32, Index=check_same_points_5.specialPt, Wrap=True)

# ----
cull_i_10 = CullIndex(List=pln_32, Indices=check_same_points_5.specialPt, Wrap=True)
merge_27 = Merge(Data1=cull_i_10, Data2=pln_16)  # -> flatten(Result)

# ----
# 和下层楼板发生关系的定位点
pln_35 = Plane(merge_27)

# ---- group: 起始Plane
pln_36 = Plane(pln_35)

# ----
pln_37 = Plane(pln_36)
number_slider_43 = Slider(3584, range=0..10000)
deplane_18 = DeconstructPlane(Plane=pln_37)  # -> Origin, XAxis, YAxis, ZAxis
boundary_4 = BoundarySurfaces(Edges=[offset_6, offset_5])
scx = SurfaceCurve(Surface=boundary_4, Curve=crv_79)  # -> flatten(Curves), Points, UVPoints, Normals, Parameters, Tangents
amp_18 = Amplitude(Vector=deplane_18.YAxis, Amplitude=number_slider_43)
amp_19 = Amplitude(Vector=deplane_18.YAxis, Amplitude=expr("-x", number_slider_43))
move_24 = Move(Geometry=deplane_18.Origin, Motion=amp_19)  # -> Geometry, Transform
move_25 = Move(Geometry=deplane_18.Origin, Motion=amp_18)  # -> Geometry, Transform
ln_19 = Line(StartPoint=move_24.Geometry, EndPoint=move_25.Geometry)
ccx_9 = CurveCurve(CurveA=graft(ln_19), CurveB=scx.Curves)  # -> Points, ParamsA, ParamsB
shift_8 = ShiftPaths(Data=ccx_9.Points, Offset=-1)
pull_20 = PullPoint(Point=graft(pln_37), Geometry=shift_8, ClosestOnly=True)  # -> ClosestPoint, Distance
sort_16 = SortList(Keys=pull_20.Distance, ValuesA=pull_20.ClosestPoint)  # -> Keys, ValuesA
item_49 = ListItem(List=sort_16.ValuesA, Index=0, Wrap=True)
null_9 = NullItem(Item=item_49)  # -> NullFlags, simplify(InvalidFlags), Description
null_10 = NullItem(Item=sort_16.ValuesA)  # -> NullFlags, simplify(InvalidFlags), Description
dispatch_40 = Dispatch(List=simplify(graft(pln_37)), DispatchPattern=null_10.InvalidFlags)  # -> ListA, ListB
dispatch_41 = Dispatch(List=simplify(graft(item_49)), DispatchPattern=null_9.InvalidFlags)  # -> ListA, ListB
pln_38 = Plane(dispatch_40.ListB)
pln_39 = Plane(dispatch_40.ListA)
pt_23 = Point(dispatch_41.ListB)

# ----
# 按照梁分类定位点
crv_92 = Curve(shift_2)
pt_24 = Point(pt_23)
incurves_4 = PointInCurves(Point=flatten(pt_24), Curves=crv_92)  # -> Relationship, Index, Point
equals_12 = Equality(FirstNumber=incurves_4.Relationship, SecondNumber="0")  # -> Equality, Inequality
dispatch_42 = Dispatch(List=flatten(pt_24), DispatchPattern=equals_12.Inequality)  # -> ListA, ListB

# ---- group: 交点-属于哪个梁
data_38 = Data(dispatch_42.ListA)

# ----
# 可能的结构交点-大量
pln_40 = Plane(pln_39)

# ----
# 0 檐口出定位点
# 与结构无交点
pln_41 = Plane(flatten(pln_40))

# ---- group: 下层交点-除重 (continued)
pull_21 = PullPoint(Point=pt_22, Geometry=pt_16, ClosestOnly=True)  # -> ClosestPoint, Distance
check_same_points_6 = CheckSamePoints(archPoint=pt_16, crvPoint=flatten(pull_21.ClosestPoint))  # -> out, specialPt; inputs archPoint: list of Point3d, crvPoint: list of Point3d; same code as testpoint

# ---- group: 下层交点-除重 / 有效Plane-上层建筑线在该处连续
item_50 = ListItem(List=pln_25, Index=check_same_points_6.specialPt, Wrap=True)

# ----
ccx_10 = CurveCurve(CurveA=graft(move_18.Geometry), CurveB=flatten(merge_24))  # -> Points, ParamsA, ParamsB
shift_9 = ShiftPaths(Data=ccx_10.Points, Offset=-1)
pull_22 = PullPoint(Point=shift_9, Geometry=graft(pln_27), ClosestOnly=True)  # -> ClosestPoint, Distance
sort_17 = SortList(Keys=pull_22.Distance, ValuesA=pull_22.ClosestPoint)  # -> Keys, ValuesA

# ---- group: 最远交点
item_51 = ListItem(List=sort_17.ValuesA, Index="-1", Wrap=True)

# ----
null_11 = NullItem(Item=flatten(item_51))  # -> NullFlags, InvalidFlags, Description
dispatch_43 = Dispatch(List=simplify(item_51), DispatchPattern=simplify(graft(null_11.InvalidFlags)))  # -> ListA, ListB
dispatch_44 = Dispatch(List=pln_27, DispatchPattern=null_11.InvalidFlags)  # -> ListA, ListB
pt_25 = Point(dispatch_43.ListB)
pln_42 = Plane(dispatch_44.ListB)
move2pt_8 = MoveToPoint(Geometry=pln_42, PointA=pln_42, PointB=flatten(pt_25))  # -> Moved, Vector, Transform

pln_43 = Plane(dispatch_44.ListA)

# ----
# 按照梁分类定位点
pt_26 = Point(pt_25)
incurves_5 = PointInCurves(Point=flatten(pt_26), Curves=crv_71)  # -> Relationship, Index, Point
equals_13 = Equality(FirstNumber=incurves_5.Relationship, SecondNumber="0")  # -> Equality, Inequality
dispatch_45 = Dispatch(List=flatten(pt_26), DispatchPattern=equals_13.Inequality)  # -> ListA, ListB

# ---- group: 交点-属于哪个梁
data_39 = Data(dispatch_45.ListA)

# ----
ccx_11 = CurveCurve(CurveA=graft(move_19.Geometry), CurveB=flatten(merge_24))  # -> Points, ParamsA, ParamsB
shift_10 = ShiftPaths(Data=ccx_11.Points, Offset=-1)
pull_23 = PullPoint(Point=shift_10, Geometry=graft(pln_27), ClosestOnly=True)  # -> ClosestPoint, Distance
sort_18 = SortList(Keys=pull_23.Distance, ValuesA=pull_23.ClosestPoint)  # -> Keys, ValuesA

# ---- group: 最远交点
item_52 = ListItem(List=sort_18.ValuesA, Index="-1", Wrap=True)

# ----
null_12 = NullItem(Item=flatten(item_52))  # -> NullFlags, InvalidFlags, Description
dispatch_46 = Dispatch(List=simplify(item_52), DispatchPattern=simplify(graft(null_12.InvalidFlags)))  # -> ListA, ListB
dispatch_47 = Dispatch(List=pln_27, DispatchPattern=null_12.InvalidFlags)  # -> ListA, ListB
pt_27 = Point(dispatch_46.ListB)
pln_44 = Plane(dispatch_47.ListB)
move2pt_9 = MoveToPoint(Geometry=pln_44, PointA=pln_44, PointB=flatten(pt_27))  # -> Moved, Vector, Transform

pln_45 = Plane(dispatch_47.ListA)
check_same_points_7 = CheckSamePoints(archPoint=pln_45, crvPoint=pln_43)  # -> out, specialPt; inputs archPoint: list of Point3d, crvPoint: list of Point3d; same code as testpoint
cset = CreateSet(List=check_same_points_7.specialPt)  # -> Set, Map

# ----
# 按照梁分类定位点
pt_28 = Point(pt_27)
incurves_6 = PointInCurves(Point=flatten(pt_28), Curves=crv_71)  # -> Relationship, Index, Point
equals_14 = Equality(FirstNumber=incurves_6.Relationship, SecondNumber="0")  # -> Equality, Inequality
dispatch_48 = Dispatch(List=flatten(pt_28), DispatchPattern=equals_14.Inequality)  # -> ListA, ListB

item_53 = ListItem(List=pln_45, Index=cset.Set, Wrap=True)

# ---- group: 交点-属于哪个梁
data_40 = Data(dispatch_48.ListA)

# ----
# 未生成檐口线
pt_29 = Point(item_53)

# ----
# （10）需人工排布
pt_30 = Point(pt_29)
bake_2 = BakeObjects(Geometry=pt_30, Attributes=attributes_2, BakeName=panel_54, Bake=False)

# ---- group: 下层交点-除重 (continued)
merge_28 = Merge(Data1=item_48, Data2=item_50)  # -> flatten(Result)
deplane_19 = DeconstructPlane(Plane=merge_28)  # -> Origin, XAxis, YAxis, ZAxis
amp_20 = Amplitude(Vector=deplane_19.YAxis, Amplitude=expr("-x", Slider(2756, range=0..10000)))
move_26 = Move(Geometry=deplane_19.Origin, Motion=amp_20)  # -> Geometry, Transform

# ---- group: 下层交点-除重 / 相内探索
ln_20 = Line(StartPoint=deplane_19.Origin, EndPoint=move_26.Geometry)

# ---- group: 下层交点-除重 (continued)
ccx_12 = CurveCurve(CurveA=graft(ln_20), CurveB=flatten(crv_70))  # -> Points, ParamsA, ParamsB
shift_11 = ShiftPaths(Data=ccx_12.Points, Offset=-1)
pull_24 = PullPoint(Point=deplane_19.Origin, Geometry=shift_11, ClosestOnly=True)  # -> ClosestPoint, Distance
sort_19 = SortList(Keys=pull_24.Distance, ValuesA=pull_24.ClosestPoint)  # -> Keys, ValuesA

# ---- group: 下层交点-除重 / 与梁最近交点
item_54 = ListItem(List=sort_19.ValuesA, Index=0, Wrap=True)

# ---- group: 下层交点-除重 (continued)
null_13 = NullItem(Item=flatten(item_54))  # -> NullFlags, InvalidFlags, Description
dispatch_49 = Dispatch(List=merge_28, DispatchPattern=null_13.InvalidFlags)  # -> ListA, ListB
dispatch_50 = Dispatch(List=flatten(item_54), DispatchPattern=null_13.InvalidFlags)  # -> ListA, ListB

# ---- group: 下层交点-除重 / 有效起始Plane
data_41 = Data(dispatch_49.ListB)

# ---- group: 下层交点-除重 / 去除Null的交点
data_42 = Data(dispatch_50.ListB)

# ---- group: 下层交点-除重 (continued)
flatten_7 = FlattenTree(Tree=data_42, Path="{0}")
ln_21 = Line(StartPoint=data_41, EndPoint=flatten_7)

# ----
# 1.0
data_43 = Data(data_42)
crv_93 = Curve(shift_2)

pt_31 = Point(data_43)
incurves_7 = PointInCurves(Point=flatten(pt_31), Curves=crv_93)  # -> Relationship, Index, Point
equals_15 = Equality(FirstNumber=incurves_7.Relationship, SecondNumber="0")  # -> Equality, Inequality
dispatch_51 = Dispatch(List=flatten(pt_31), DispatchPattern=equals_15.Inequality)  # -> ListA, ListB

panel_72 = Panel(dispatch_51.ListA)

# ---- group: 交点-属于哪个梁
data_44 = Data(dispatch_51.ListA)

# ----
# 1.0无檐口线
# 与梁不相交
# 与梁无交点的定位点
pln_46 = Plane(dispatch_49.ListA)

# ----
# 0 檐口出定位点
# 与结构无交点
pln_47 = Plane(flatten(pln_46))

# ----
# 按照梁分类定位PLANE
crv_94 = Curve(merge_23)
shift_12 = ShiftPaths(Data=crv_94, Offset=-1)
shift_13 = ShiftPaths(Data=shift_12, Offset=-1)
pull_25 = PullPoint(Point=data_39, Geometry=simplify(shift_13), ClosestOnly=True)  # -> ClosestPoint, Distance
ln_22 = Line(StartPoint=pull_25.ClosestPoint, EndPoint=data_39)
crv_95 = Curve(crv_28)
movetoplane_5 = MoveToPlane(Geometry=crv_95, Plane=PlaneXY(0, 0, 0), Above=True, Below=True)  # -> Geometry, Transform

# ---- group: Y Axis Line-All
crv_96 = Curve(ln_22)

# ----
# 按照梁分类定位PLANE
crv_97 = Curve(merge_23)
shift_14 = ShiftPaths(Data=crv_97, Offset=-1)
shift_15 = ShiftPaths(Data=shift_14, Offset=-1)
pull_26 = PullPoint(Point=data_40, Geometry=simplify(shift_15), ClosestOnly=True)  # -> ClosestPoint, Distance
ln_23 = Line(StartPoint=pull_26.ClosestPoint, EndPoint=data_40)
crv_98 = Curve(crv_28)
movetoplane_6 = MoveToPlane(Geometry=crv_98, Plane=PlaneXY(0, 0, 0), Above=True, Below=True)  # -> Geometry, Transform

# ---- group: Y Axis Line-All
crv_99 = Curve(ln_23)

# ----
end_6 = EndPoints(Curve=graft(crv_96))  # -> Start, End
merge_29 = Merge(Data1=end_6.Start, Data2=end_6.End)
pull_27 = PullPoint(Point=merge_29, Geometry=movetoplane_5.Geometry, ClosestOnly=True)  # -> ClosestPoint, Distance
sort_20 = SortList(Keys=pull_27.Distance, ValuesA=merge_29)  # -> Keys, ValuesA
item_55 = ListItem(List=sort_20.ValuesA, Index="-1", Wrap=True)
item_56 = ListItem(List=sort_20.ValuesA, Index=0, Wrap=True)
pt_32 = Point(item_56)
pt_33 = Point(item_55)
ln_24 = Line(StartPoint=pt_33, EndPoint=pt_32)
rotate_11 = Rotate(Geometry=ln_24, Angle=1.570796327, Plane=pt_32)  # -> Geometry, Transform

pt_34 = Point(end_6.End)

pl_9 = ConstructPlane(Origin=pt_34, XAxis=rotate_11.Geometry, YAxis=ln_24)
null_14 = NullItem(Item=pl_9)  # -> NullFlags, InvalidFlags, Description
dispatch_52 = Dispatch(List=pl_9, DispatchPattern=null_14.NullFlags)  # -> ListA, ListB

pln_48 = Plane(dispatch_52.ListB)
shift_16 = ShiftPaths(Data=pln_48, Offset=-1)  # -> simplify(Data)

end_7 = EndPoints(Curve=graft(crv_99))  # -> Start, End
merge_30 = Merge(Data1=end_7.Start, Data2=end_7.End)
pull_28 = PullPoint(Point=merge_30, Geometry=movetoplane_6.Geometry, ClosestOnly=True)  # -> ClosestPoint, Distance
sort_21 = SortList(Keys=pull_28.Distance, ValuesA=merge_30)  # -> Keys, ValuesA
item_57 = ListItem(List=sort_21.ValuesA, Index="-1", Wrap=True)
item_58 = ListItem(List=sort_21.ValuesA, Index=0, Wrap=True)
pt_35 = Point(item_58)
pt_36 = Point(item_57)
ln_25 = Line(StartPoint=pt_36, EndPoint=pt_35)
rotate_12 = Rotate(Geometry=ln_25, Angle=1.570796327, Plane=pt_35)  # -> Geometry, Transform

pt_37 = Point(end_7.End)

pl_10 = ConstructPlane(Origin=pt_37, XAxis=rotate_12.Geometry, YAxis=ln_25)
null_15 = NullItem(Item=pl_10)  # -> NullFlags, InvalidFlags, Description
dispatch_53 = Dispatch(List=pl_10, DispatchPattern=null_15.NullFlags)  # -> ListA, ListB

pln_49 = Plane(dispatch_53.ListB)
shift_17 = ShiftPaths(Data=pln_49, Offset=-1)  # -> simplify(Data)

# ----
# 撞到梁交点
pln_50 = Plane(shift_16)
pln_51 = Plane(shift_17)

merge_31 = Merge(Data1=pln_34, Data2=pln_51, Data3=pln_50)

# ----
# 第一层
# 
# Curves(location point)+ Smooth Curves(architecture line)
# 测试Smooth Curve是否与每个Block相切
# blocks + smooth curves
# remove duplicate blocks
# blocks + special curves
# 测试Smooth Curve是否与每个Block相切
# blocks + smooth curves
# remove duplicate blocks
# blocks + special curves
# 第一层
# 
# Angular Curves(architecture line)
# 第一层
# 
# Special Curves(architecture line)
# 第一层
# 
# Angular Curves(architecture line)
data_45 = Data(data_24)
item_59 = ListItem(List=data_45, Index=0, Wrap=True)
item_60 = ListItem(List=data_45, Index="-1", Wrap=True)
ungroup_5 = Ungroup(Group=item_59)
item_61 = ListItem(List=ungroup_5, Index=0, Wrap=True)
bbox_3 = BoundingBox(Content=item_61, Plane=PlaneXY(0, 0, 0))  # -> Box, Box_2
# 阳角
# 阴角
# 转角点
orient_3 = Orient(Geometry=item_59, Source=item_60, Target=merge_31)  # -> Geometry, Transform
debrep_2 = DeconstructBrep(Brep=bbox_3.Box)  # -> Faces, Edges, Vertices
len_6 = Length(Curve=debrep_2.Edges)
sort_22 = SortList(Keys=len_6, ValuesA=debrep_2.Edges)  # -> Keys, ValuesA
item_62 = ListItem(List=sort_22.ValuesA, Index=0, Wrap=True)

deplane_20 = DeconstructPlane(Plane=merge_31)  # -> Origin, XAxis, YAxis, ZAxis
panel_73 = Panel(merge_31)
flatten_8 = FlattenTree(Tree=merge_31, Path="{0}")
amp_21 = Amplitude(Vector=deplane_20.YAxis, Amplitude=expr("-x", simplify(item_62)))
panel_74 = Panel(flatten_8)
move_27 = Move(Geometry=simplify(orient_3.Geometry), Motion=simplify(amp_21))  # -> Geometry, Transform

data_46 = Data(move_27.Geometry)
ungroup_6 = Ungroup(Group=data_46)
item_63 = ListItem(List=ungroup_6, Index=0, Wrap=True)  # -> flatten(Item)
item_64 = ListItem(List=ungroup_6, Index="-1", Wrap=True)  # -> flatten(Item)

# ---- group: 檐口埋件 (continued)
entwine_13 = Entwine(Branch00=item_63, Branch01=item_64, FlattenInputs=True)
bake_3 = BakeObjects(Geometry=entwine_13, Attributes=attributes_3, BakeName=panel_38, Bake=False)
# ----
# 按照梁分类定位PLANE
shift_18 = ShiftPaths(Data=crv_72, Offset=-1)
shift_19 = ShiftPaths(Data=shift_18, Offset=-1)
pull_29 = PullPoint(Point=data_44, Geometry=simplify(shift_19), ClosestOnly=True)  # -> ClosestPoint, Distance
ln_26 = Line(StartPoint=pull_29.ClosestPoint, EndPoint=data_44)
movetoplane_7 = MoveToPlane(Geometry=crv_37, Plane=PlaneXY(0, 0, 0), Above=True, Below=True)  # -> Geometry, Transform

# ---- group: Y Axis Line-All
crv_100 = Curve(ln_26)

# ----
end_8 = EndPoints(Curve=graft(crv_100))  # -> Start, End
merge_32 = Merge(Data1=end_8.Start, Data2=end_8.End)
pull_30 = PullPoint(Point=merge_32, Geometry=movetoplane_7.Geometry, ClosestOnly=True)  # -> ClosestPoint, Distance
sort_23 = SortList(Keys=pull_30.Distance, ValuesA=merge_32)  # -> Keys, ValuesA
item_65 = ListItem(List=sort_23.ValuesA, Index="-1", Wrap=True)
item_66 = ListItem(List=sort_23.ValuesA, Index=0, Wrap=True)
pt_38 = Point(item_66)
pt_39 = Point(item_65)
ln_27 = Line(StartPoint=pt_39, EndPoint=pt_38)
rotate_13 = Rotate(Geometry=ln_27, Angle=1.570796327, Plane=pt_38)  # -> Geometry, Transform

pt_40 = Point(end_8.End)

pl_11 = ConstructPlane(Origin=pt_40, XAxis=rotate_13.Geometry, YAxis=ln_27)
null_16 = NullItem(Item=pl_11)  # -> NullFlags, InvalidFlags, Description
dispatch_54 = Dispatch(List=pl_11, DispatchPattern=null_16.NullFlags)  # -> ListA, ListB
pln_52 = Plane(dispatch_54.ListB)

# ---- group: 檐口-首次筛选的有效起始Plane
data_47 = Data(pln_52)

# ----
shift_20 = ShiftPaths(Data=data_47, Offset=-1)

# ----
# 1.0无檐口线+上下层幕墙边线连续
# 01：钢板焊埋件[钢梁外侧]
# @钢边梁宽@钢边梁高
pln_53 = Plane(shift_20)

# ----
# 1.0.Missing Point
# 埋件定位点Offset，没有找到和梁的交点
number_slider_44 = Slider(5000, range=0..10000)
deplane_21 = DeconstructPlane(Plane=pln_47)  # -> Origin, XAxis, YAxis, ZAxis
amp_22 = Amplitude(Vector=deplane_21.YAxis, Amplitude=expr("-x", number_slider_44))
move_28 = Move(Geometry=deplane_21.Origin, Motion=amp_22)  # -> Geometry, Transform
ln_28 = Line(StartPoint=move_28.Geometry, EndPoint=deplane_21.Origin)
crv_101 = Curve(crv_70)
amp_23 = Amplitude(Vector=deplane_21.XAxis, Amplitude=number_slider_7)
amp_24 = Amplitude(Vector=deplane_21.XAxis, Amplitude=expr("-x", number_slider_7))

# ---- group: 2组探索针
move_29 = Move(Geometry=ln_28, Motion=amp_24)  # -> Geometry, Transform
move_30 = Move(Geometry=ln_28, Motion=amp_23)  # -> Geometry, Transform

# ----
ccx_13 = CurveCurve(CurveA=graft(move_29.Geometry), CurveB=flatten(crv_101))  # -> Points, ParamsA, ParamsB
shift_21 = ShiftPaths(Data=ccx_13.Points, Offset=-1)
sort_24 = SortList(Keys=shift_21, ValuesA=shift_21)  # -> Keys, ValuesA
pull_31 = PullPoint(Point=sort_24.ValuesA, Geometry=graft(pln_47), ClosestOnly=True)  # -> ClosestPoint, Distance
sort_25 = SortList(Keys=pull_31.Distance, ValuesA=sort_24.ValuesA)  # -> Keys, ValuesA
item_67 = ListItem(List=sort_25.ValuesA, Index="0", Wrap=True)
null_17 = NullItem(Item=flatten(item_67))  # -> NullFlags, InvalidFlags, Description
dispatch_55 = Dispatch(List=simplify(item_67), DispatchPattern=simplify(graft(null_17.InvalidFlags)))  # -> ListA, ListB
dispatch_56 = Dispatch(List=pln_47, DispatchPattern=null_17.InvalidFlags)  # -> ListA, ListB
pln_54 = Plane(dispatch_56.ListB)
pt_41 = Point(dispatch_55.ListB)
move2pt_10 = MoveToPoint(Geometry=pln_54, PointA=pln_54, PointB=pt_41)  # -> Moved, Vector, Transform

ccx_14 = CurveCurve(CurveA=graft(move_30.Geometry), CurveB=flatten(crv_101))  # -> Points, ParamsA, ParamsB
shift_22 = ShiftPaths(Data=ccx_14.Points, Offset=-1)
sort_26 = SortList(Keys=shift_22, ValuesA=shift_22)  # -> Keys, ValuesA
pull_32 = PullPoint(Point=sort_26.ValuesA, Geometry=graft(pln_47), ClosestOnly=True)  # -> ClosestPoint, Distance
sort_27 = SortList(Keys=pull_32.Distance, ValuesA=sort_26.ValuesA)  # -> Keys, ValuesA
item_68 = ListItem(List=sort_27.ValuesA, Index="0", Wrap=True)
null_18 = NullItem(Item=flatten(item_68))  # -> NullFlags, InvalidFlags, Description
dispatch_57 = Dispatch(List=simplify(item_68), DispatchPattern=simplify(graft(null_18.InvalidFlags)))  # -> ListA, ListB
dispatch_58 = Dispatch(List=pln_47, DispatchPattern=null_18.InvalidFlags)  # -> ListA, ListB
pt_42 = Point(dispatch_57.ListB)
pln_55 = Plane(dispatch_58.ListB)
move2pt_11 = MoveToPoint(Geometry=pln_55, PointA=pln_55, PointB=pt_42)  # -> Moved, Vector, Transform

pln_56 = Plane([dispatch_58.ListA, dispatch_56.ListA])

# ----
# 按照梁分类定位点
merge_33 = Merge(Data1=move2pt_11.Moved, Data2=move2pt_10.Moved)
crv_102 = Curve(crv_93)
pt_43 = Point(merge_33)
incurves_8 = PointInCurves(Point=flatten(pt_43), Curves=crv_102)  # -> Relationship, Index, Point
equals_16 = Equality(FirstNumber=incurves_8.Relationship, SecondNumber="0")  # -> Equality, Inequality
dispatch_59 = Dispatch(List=flatten(pt_43), DispatchPattern=equals_16.Inequality)  # -> ListA, ListB

# ---- group: 交点-属于哪个梁
data_48 = Data(dispatch_59.ListA)

# ----
# 按照梁分类定位PLANE
shift_23 = ShiftPaths(Data=crv_73, Offset=-1)
shift_24 = ShiftPaths(Data=shift_23, Offset=-1)
pull_33 = PullPoint(Point=data_48, Geometry=simplify(shift_24), ClosestOnly=True)  # -> ClosestPoint, Distance
ln_29 = Line(StartPoint=pull_33.ClosestPoint, EndPoint=data_48)
movetoplane_8 = MoveToPlane(Geometry=crv_38, Plane=PlaneXY(0, 0, 0), Above=True, Below=True)  # -> Geometry, Transform

# ---- group: Y Axis Line-All
crv_103 = Curve(ln_29)

# ----
end_9 = EndPoints(Curve=graft(crv_103))  # -> Start, End
merge_34 = Merge(Data1=end_9.Start, Data2=end_9.End)
pull_34 = PullPoint(Point=merge_34, Geometry=movetoplane_8.Geometry, ClosestOnly=True)  # -> ClosestPoint, Distance
sort_28 = SortList(Keys=pull_34.Distance, ValuesA=merge_34)  # -> Keys, ValuesA
item_69 = ListItem(List=sort_28.ValuesA, Index="-1", Wrap=True)
item_70 = ListItem(List=sort_28.ValuesA, Index=0, Wrap=True)
pt_44 = Point(item_70)
pt_45 = Point(item_69)
ln_30 = Line(StartPoint=pt_45, EndPoint=pt_44)
rotate_14 = Rotate(Geometry=ln_30, Angle=1.570796327, Plane=pt_44)  # -> Geometry, Transform

pt_46 = Point(end_9.End)

pl_12 = ConstructPlane(Origin=pt_46, XAxis=rotate_14.Geometry, YAxis=ln_30)
null_19 = NullItem(Item=pl_12)  # -> NullFlags, InvalidFlags, Description
dispatch_60 = Dispatch(List=pl_12, DispatchPattern=null_19.NullFlags)  # -> ListA, ListB
pln_57 = Plane(dispatch_60.ListB)

shift_25 = ShiftPaths(Data=pln_57, Offset=-1)

# ---- group: 檐口-首次筛选的有效起始Plane
data_49 = Data(shift_25)

# ----
# 撞到梁交点
data_50 = Data(data_49)

merge_35 = Merge(Data1=pln_53, Data2=data_50)
orient_4 = Orient(Geometry=item_27, Source=item_26, Target=merge_35)  # -> Geometry, Transform

data_51 = Data(orient_4.Geometry)
ungroup_7 = Ungroup(Group=data_51)
item_71 = ListItem(List=ungroup_7, Index=0, Wrap=True)  # -> flatten(Item)
item_72 = ListItem(List=ungroup_7, Index="-1", Wrap=True)  # -> flatten(Item)

# ---- group: 上下幕墙连续 (continued)
entwine_14 = Entwine(Branch00=item_71, Branch01=item_72, FlattenInputs=True)
bake_4 = BakeObjects(Geometry=entwine_14, Attributes=attributes_5, BakeName=panel_41, Bake=False)

# ----
# 2是否有吊顶
# 梁以内>350
deplane_22 = DeconstructPlane(Plane=pln_35)  # -> Origin, XAxis, YAxis, ZAxis
number_slider_45 = Slider(5000, range=0..10000)
amp_25 = Amplitude(Vector=deplane_22.YAxis, Amplitude=expr("-x", number_slider_45))
amp_26 = Amplitude(Vector=deplane_22.YAxis, Amplitude=number_slider_45)
move_31 = Move(Geometry=deplane_22.Origin, Motion=amp_26)  # -> Geometry, Transform
move_32 = Move(Geometry=deplane_22.Origin, Motion=amp_25)  # -> Geometry, Transform
ln_31 = Line(StartPoint=move_31.Geometry, EndPoint=move_32.Geometry)
crv_104 = Curve(crv_19)

# ---- group: 和下层建筑的交点
ccx_15 = CurveCurve(CurveA=ln_31, CurveB=crv_104)  # -> Points, ParamsA, ParamsB

# ----
null_20 = NullItem(Item=ccx_15.Points)  # -> NullFlags, InvalidFlags, Description
dispatch_61 = Dispatch(List=simplify(ccx_15.Points), DispatchPattern=simplify(null_20.NullFlags))  # -> ListA, ListB
dispatch_62 = Dispatch(List=simplify(graft(pln_35)), DispatchPattern=simplify(null_20.NullFlags))  # -> ListA, ListB
pt_47 = Point(dispatch_61.ListB)
pln_58 = Plane(flatten(dispatch_62.ListB))
pt_48 = Point(pln_58)
pull_35 = PullPoint(Point=flatten(pt_48), Geometry=flatten(pt_47), ClosestOnly=True)  # -> ClosestPoint, Distance
ln_32 = Line(StartPoint=pln_58, EndPoint=pull_35.ClosestPoint)

# ----
# 定位点Project到下层建筑线
move2pt_12 = MoveToPoint(Geometry=pln_58, PointA=pln_58, PointB=pull_35.ClosestPoint)  # -> Moved, Vector, Transform

# ----
# 可能的点-离结构很远
pln_59 = Plane(dispatch_62.ListA)

deplane_23 = DeconstructPlane(Plane=move2pt_12.Moved)  # -> Origin, XAxis, YAxis, ZAxis
amp_27 = Amplitude(Vector=deplane_23.YAxis, Amplitude=Slider(5000, range=0..10000))
move_33 = Move(Geometry=deplane_23.Origin, Motion=amp_27)  # -> Geometry, Transform
ln_33 = Line(StartPoint=move_33.Geometry, EndPoint=deplane_23.Origin)

# ---- group: 和内测梁交点
ccx_16 = CurveCurve(CurveA=graft(ln_33), CurveB=flatten(crv_74))  # -> simplify(Points), ParamsA, ParamsB

# ----
shift_26 = ShiftPaths(Data=ccx_16.Points, Offset=-1)
null_21 = NullItem(Item=shift_26)  # -> NullFlags, InvalidFlags, Description
dispatch_63 = Dispatch(List=simplify(graft(move2pt_12.Moved)), DispatchPattern=null_21.NullFlags)  # -> ListA, ListB
dispatch_64 = Dispatch(List=simplify(graft(ln_33)), DispatchPattern=null_21.NullFlags)  # -> ListA, ListB
pln_60 = Plane(dispatch_63.ListA)
crv_105 = Curve(dispatch_64.ListB)
pln_61 = Plane(dispatch_63.ListB)
ccx_17 = CurveCurve(CurveA=graft(crv_105), CurveB=flatten(crv_74))  # -> Points, ParamsA, ParamsB
shift_27 = ShiftPaths(Data=simplify(ccx_17.Points), Offset=-1)
pull_36 = PullPoint(Point=pln_61, Geometry=shift_27, ClosestOnly=True)  # -> ClosestPoint, Distance
sort_29 = SortList(Keys=pull_36.Distance, ValuesA=pull_36.ClosestPoint)  # -> Keys, ValuesA

# ---- group: 交点对应的起始定位点
item_73 = ListItem(List=sort_29.ValuesA, Index=0, Wrap=True)

# ----
ln_34 = Line(StartPoint=pln_61, EndPoint=item_73)
len_7 = Length(Curve=ln_34)
larger_7 = LargerThan(FirstNumber=len_7, SecondNumber=number_slider_26)  # -> LargerThan, OrEqualTo
panel_75 = Panel(len_7)
dispatch_65 = Dispatch(List=pln_61, DispatchPattern=larger_7.LargerThan)  # -> ListA, ListB
dispatch_66 = Dispatch(List=item_73, DispatchPattern=larger_7.LargerThan)  # -> ListA, ListB
pln_62 = Plane(dispatch_65.ListB)

# ---- group: 起始点
pt_49 = Point(dispatch_66.ListA)

# ---- group: 最终Plane
pln_63 = Plane(dispatch_65.ListA)

# ----
# 按照梁分类定位点
pt_50 = Point(pt_49)
crv_106 = Curve(shift_2)
incurves_9 = PointInCurves(Point=flatten(pt_50), Curves=crv_106)  # -> Relationship, Index, Point
equals_17 = Equality(FirstNumber=incurves_9.Relationship, SecondNumber="0")  # -> Equality, Inequality
dispatch_67 = Dispatch(List=flatten(pt_50), DispatchPattern=equals_17.Inequality)  # -> ListA, ListB

# ---- group: 交点-属于哪个梁
data_52 = Data(dispatch_67.ListA)

# ----
# 可能的结构交点-大量
pln_64 = Plane(pln_60)

# ----
# 可能的结构交点
pln_65 = Plane(pln_62)

# ----
# 按照梁分类定位PLANE
shift_28 = ShiftPaths(Data=crv_75, Offset=-1)
shift_29 = ShiftPaths(Data=shift_28, Offset=-1)
pull_37 = PullPoint(Point=data_52, Geometry=simplify(shift_29), ClosestOnly=True)  # -> ClosestPoint, Distance
ln_35 = Line(StartPoint=pull_37.ClosestPoint, EndPoint=data_52)
movetoplane_9 = MoveToPlane(Geometry=crv_39, Plane=PlaneXY(0, 0, 0), Above=True, Below=True)  # -> Geometry, Transform

# ---- group: Y Axis Line-All
crv_107 = Curve(ln_35)

# ----
end_10 = EndPoints(Curve=graft(crv_107))  # -> Start, End
merge_36 = Merge(Data1=end_10.Start, Data2=end_10.End)
pull_38 = PullPoint(Point=merge_36, Geometry=movetoplane_9.Geometry, ClosestOnly=True)  # -> ClosestPoint, Distance
sort_30 = SortList(Keys=pull_38.Distance, ValuesA=merge_36)  # -> Keys, ValuesA
item_74 = ListItem(List=sort_30.ValuesA, Index="-1", Wrap=True)
item_75 = ListItem(List=sort_30.ValuesA, Index=0, Wrap=True)
pt_51 = Point(item_75)
pt_52 = Point(item_74)
ln_36 = Line(StartPoint=pt_52, EndPoint=pt_51)
rotate_15 = Rotate(Geometry=ln_36, Angle=1.570796327, Plane=pt_51)  # -> Geometry, Transform

pt_53 = Point(end_10.End)

pl_13 = ConstructPlane(Origin=pt_53, XAxis=rotate_15.Geometry, YAxis=ln_36)
null_22 = NullItem(Item=pl_13)  # -> NullFlags, InvalidFlags, Description
dispatch_68 = Dispatch(List=pl_13, DispatchPattern=null_22.NullFlags)  # -> ListA, ListB
pln_66 = Plane(dispatch_68.ListB)

shift_30 = ShiftPaths(Data=pln_66, Offset=-1)

# ---- group: 檐口-首次筛选的有效起始Plane
data_53 = Data(simplify(shift_30))

# ----
# 2.1 梁以内>350
# 
# 侧埋，钢板焊
# 03：钢板焊埋件[钢梁内侧]
# @钢边梁宽@钢边梁高
pln_67 = Plane(data_53)

# ----
# 2.1 Missing Point
# 埋件定位点Offset，没有找到和梁的交点
merge_37 = Merge(Data1=pln_59, Data2=pln_65, Data3=pln_64)
crv_108 = Curve(crv_74)

# ----
# 0 檐口出定位点
# 与结构无交点
pln_68 = Plane(flatten(merge_37))

deplane_24 = DeconstructPlane(Plane=pln_68)  # -> Origin, XAxis, YAxis, ZAxis
amp_28 = Amplitude(Vector=deplane_24.YAxis, Amplitude=Slider(5000, range=0..10000))
move_34 = Move(Geometry=deplane_24.Origin, Motion=amp_28)  # -> Geometry, Transform
ln_37 = Line(StartPoint=move_34.Geometry, EndPoint=deplane_24.Origin)
amp_29 = Amplitude(Vector=deplane_24.XAxis, Amplitude=number_slider_7)
amp_30 = Amplitude(Vector=deplane_24.XAxis, Amplitude=expr("-x", number_slider_7))
move_35 = Move(Geometry=ln_37, Motion=amp_29)  # -> Geometry, Transform
move_36 = Move(Geometry=ln_37, Motion=amp_30)  # -> Geometry, Transform

ccx_18 = CurveCurve(CurveA=graft(move_35.Geometry), CurveB=flatten(crv_108))  # -> Points, ParamsA, ParamsB
shift_31 = ShiftPaths(Data=ccx_18.Points, Offset=-1)
sort_31 = SortList(Keys=shift_31, ValuesA=shift_31)  # -> Keys, ValuesA
pull_39 = PullPoint(Point=sort_31.ValuesA, Geometry=graft(pln_68), ClosestOnly=True)  # -> ClosestPoint, Distance
sort_32 = SortList(Keys=pull_39.Distance, ValuesA=sort_31.ValuesA)  # -> Keys, ValuesA
item_76 = ListItem(List=sort_32.ValuesA, Index="-1", Wrap=True)
null_23 = NullItem(Item=flatten(item_76))  # -> NullFlags, InvalidFlags, Description
end_11 = EndPoints(Curve=move_35.Geometry)  # -> Start, End
dispatch_69 = Dispatch(List=graft(pln_68), DispatchPattern=graft(null_23.InvalidFlags))  # -> ListA, ListB
dispatch_70 = Dispatch(List=simplify(item_76), DispatchPattern=simplify(graft(null_23.InvalidFlags)))  # -> ListA, ListB
pln_69 = Plane(dispatch_69.ListB)
pt_54 = Point(dispatch_70.ListB)
dispatch_71 = Dispatch(List=simplify(graft(end_11.End)), DispatchPattern=simplify(graft(null_23.InvalidFlags)))  # -> ListA, ListB
pt_55 = Point(dispatch_71.ListB)
ln_38 = Line(StartPoint=pt_55, EndPoint=pt_54)
len_8 = Length(Curve=ln_38)
larger_8 = LargerThan(FirstNumber=len_8, SecondNumber=Slider(350, range=0..1000))  # -> LargerThan, OrEqualTo
dispatch_72 = Dispatch(List=pln_69, DispatchPattern=larger_8.LargerThan)  # -> ListA, ListB
dispatch_73 = Dispatch(List=pt_54, DispatchPattern=larger_8.LargerThan)  # -> ListA, ListB
pln_70 = Plane(dispatch_72.ListA)
pt_56 = Point(dispatch_73.ListA)
move2pt_13 = MoveToPoint(Geometry=pln_70, PointA=pln_70, PointB=pt_56)  # -> Moved, Vector, Transform

ccx_19 = CurveCurve(CurveA=graft(move_36.Geometry), CurveB=flatten(crv_108))  # -> Points, ParamsA, ParamsB
shift_32 = ShiftPaths(Data=ccx_19.Points, Offset=-1)
sort_33 = SortList(Keys=shift_32, ValuesA=shift_32)  # -> Keys, ValuesA
pull_40 = PullPoint(Point=sort_33.ValuesA, Geometry=graft(pln_68), ClosestOnly=True)  # -> ClosestPoint, Distance
sort_34 = SortList(Keys=pull_40.Distance, ValuesA=sort_33.ValuesA)  # -> Keys, ValuesA
item_77 = ListItem(List=sort_34.ValuesA, Index="-1", Wrap=True)
null_24 = NullItem(Item=flatten(item_77))  # -> NullFlags, InvalidFlags, Description
end_12 = EndPoints(Curve=move_36.Geometry)  # -> Start, End
dispatch_74 = Dispatch(List=simplify(item_77), DispatchPattern=simplify(graft(null_24.InvalidFlags)))  # -> ListA, ListB
dispatch_75 = Dispatch(List=graft(pln_68), DispatchPattern=flatten(null_24.InvalidFlags))  # -> ListA, ListB
dispatch_76 = Dispatch(List=simplify(graft(end_12.End)), DispatchPattern=simplify(graft(null_24.InvalidFlags)))  # -> ListA, ListB
pln_71 = Plane(dispatch_75.ListB)
pt_57 = Point(dispatch_74.ListB)
pt_58 = Point(dispatch_76.ListB)
ln_39 = Line(StartPoint=pt_58, EndPoint=pt_57)
len_9 = Length(Curve=ln_39)
larger_9 = LargerThan(FirstNumber=len_9, SecondNumber=Slider(350, range=0..1000))  # -> LargerThan, OrEqualTo
dispatch_77 = Dispatch(List=pln_71, DispatchPattern=larger_9.LargerThan)  # -> ListA, ListB
dispatch_78 = Dispatch(List=pt_57, DispatchPattern=larger_9.LargerThan)  # -> ListA, ListB
pln_72 = Plane(dispatch_77.ListA)
pt_59 = Point(dispatch_78.ListA)
move2pt_14 = MoveToPoint(Geometry=pln_72, PointA=pln_72, PointB=pt_59)  # -> Moved, Vector, Transform

merge_38 = Merge(Data1=move2pt_13.Moved, Data2=move2pt_14.Moved)

# ----
# 按照梁分类定位点
pt_60 = Point(pt_56)
incurves_10 = PointInCurves(Point=flatten(merge_38), Curves=crv_76)  # -> Relationship, Index, Point
equals_18 = Equality(FirstNumber=incurves_10.Relationship, SecondNumber="0")  # -> Equality, Inequality
dispatch_79 = Dispatch(List=flatten(pt_60), DispatchPattern=equals_18.Inequality)  # -> ListA, ListB

# ---- group: 交点-属于哪个梁
data_54 = Data(dispatch_79.ListA)

# ----
# 按照梁分类定位PLANE
shift_33 = ShiftPaths(Data=crv_77, Offset=-1)
shift_34 = ShiftPaths(Data=shift_33, Offset=-1)
pull_41 = PullPoint(Point=data_54, Geometry=simplify(shift_34), ClosestOnly=True)  # -> ClosestPoint, Distance
ln_40 = Line(StartPoint=pull_41.ClosestPoint, EndPoint=data_54)
movetoplane_10 = MoveToPlane(Geometry=crv_40, Plane=PlaneXY(0, 0, 0), Above=True, Below=True)  # -> Geometry, Transform

# ---- group: Y Axis Line-All
crv_109 = Curve(ln_40)

# ----
end_13 = EndPoints(Curve=graft(crv_109))  # -> Start, End
merge_39 = Merge(Data1=end_13.Start, Data2=end_13.End)
pull_42 = PullPoint(Point=merge_39, Geometry=movetoplane_10.Geometry, ClosestOnly=True)  # -> ClosestPoint, Distance
sort_35 = SortList(Keys=pull_42.Distance, ValuesA=merge_39)  # -> Keys, ValuesA
item_78 = ListItem(List=sort_35.ValuesA, Index="-1", Wrap=True)
item_79 = ListItem(List=sort_35.ValuesA, Index=0, Wrap=True)
pt_61 = Point(item_79)
pt_62 = Point(item_78)
ln_41 = Line(StartPoint=pt_62, EndPoint=pt_61)
rotate_16 = Rotate(Geometry=ln_41, Angle=1.570796327, Plane=pt_61)  # -> Geometry, Transform

pt_63 = Point(end_13.End)

pl_14 = ConstructPlane(Origin=pt_63, XAxis=rotate_16.Geometry, YAxis=ln_41)
null_25 = NullItem(Item=pl_14)  # -> NullFlags, InvalidFlags, Description
dispatch_80 = Dispatch(List=pl_14, DispatchPattern=null_25.NullFlags)  # -> ListA, ListB
pln_73 = Plane(dispatch_80.ListB)

shift_35 = ShiftPaths(Data=pln_73, Offset=-1)

# ---- group: 檐口-首次筛选的有效起始Plane
data_55 = Data(shift_35)

# ----
# 撞到梁交点
merge_40 = Merge(Data1=data_55)

merge_41 = Merge(Data1=pln_67, Data2=merge_40)
orient_5 = Orient(Geometry=item_28, Source=rotate_8.Geometry, Target=merge_41)  # -> Geometry, Transform

data_56 = Data(orient_5.Geometry)
ungroup_8 = Ungroup(Group=data_56)
item_80 = ListItem(List=ungroup_8, Index=0, Wrap=True)  # -> flatten(Item)
item_81 = ListItem(List=ungroup_8, Index="-1", Wrap=True)  # -> flatten(Item)

# ---- group: 有吊顶的范围，檐口处内侧埋件 (continued)
entwine_15 = Entwine(Branch00=item_80, Branch01=item_81, FlattenInputs=True)
bake_5 = BakeObjects(Geometry=entwine_15, Attributes=attributes_4, BakeName=panel_42, Bake=False)

# ----
deplane_25 = DeconstructPlane(Plane=pln_36)  # -> Origin, XAxis, YAxis, ZAxis
number_slider_46 = Slider(3584, range=0..10000)
amp_31 = Amplitude(Vector=deplane_25.YAxis, Amplitude=number_slider_46)
amp_32 = Amplitude(Vector=deplane_25.YAxis, Amplitude=expr("-x", number_slider_46))
boundary_5 = BoundarySurfaces(Edges=[offset_8, offset_7])
move_37 = Move(Geometry=deplane_25.Origin, Motion=amp_32)  # -> Geometry, Transform
move_38 = Move(Geometry=deplane_25.Origin, Motion=amp_31)  # -> Geometry, Transform
ln_42 = Line(StartPoint=move_37.Geometry, EndPoint=move_38.Geometry)

# ---- group: 50-350建筑结构交点
scx_2 = SurfaceCurve(Surface=boundary_5, Curve=crv_78)  # -> flatten(Curves), Points, UVPoints, Normals, Parameters, Tangents

# ---- group: 该区间的定位点
ccx_20 = CurveCurve(CurveA=graft(ln_42), CurveB=scx_2.Curves)  # -> Points, ParamsA, ParamsB

# ----
shift_36 = ShiftPaths(Data=ccx_20.Points, Offset=-1)
pull_43 = PullPoint(Point=graft(pln_36), Geometry=shift_36, ClosestOnly=True)  # -> ClosestPoint, Distance
sort_36 = SortList(Keys=pull_43.Distance, ValuesA=pull_43.ClosestPoint)  # -> Keys, ValuesA
null_26 = NullItem(Item=sort_36.ValuesA)  # -> NullFlags, simplify(InvalidFlags), Description
item_82 = ListItem(List=sort_36.ValuesA, Index=0, Wrap=True)
dispatch_81 = Dispatch(List=simplify(graft(pln_36)), DispatchPattern=null_26.InvalidFlags)  # -> ListA, ListB
dispatch_82 = Dispatch(List=simplify(graft(item_82)), DispatchPattern=null_26.InvalidFlags)  # -> ListA, ListB
pln_74 = Plane(dispatch_81.ListB)
pln_75 = Plane(dispatch_81.ListA)
pt_64 = Point(dispatch_82.ListB)

# ----
# 按照梁分类定位点
crv_110 = Curve(shift_2)
pt_65 = Point(pt_64)
incurves_11 = PointInCurves(Point=flatten(pt_65), Curves=crv_110)  # -> Relationship, Index, Point
equals_19 = Equality(FirstNumber=incurves_11.Relationship, SecondNumber="0")  # -> Equality, Inequality
dispatch_83 = Dispatch(List=flatten(pt_65), DispatchPattern=equals_19.Inequality)  # -> ListA, ListB

# ---- group: 交点-属于哪个梁
data_57 = Data(dispatch_83.ListA)

# ----
# 可能的结构交点-大量
pln_76 = Plane(pln_75)

# ----
# 0 檐口出定位点
# 与结构无交点
pln_77 = Plane(flatten(pln_76))

# ----
# 按照梁分类定位PLANE
shift_37 = ShiftPaths(Data=crv_80, Offset=-1)
shift_38 = ShiftPaths(Data=shift_37, Offset=-1)
pull_44 = PullPoint(Point=data_57, Geometry=simplify(shift_38), ClosestOnly=True)  # -> ClosestPoint, Distance
ln_43 = Line(StartPoint=pull_44.ClosestPoint, EndPoint=data_57)
movetoplane_11 = MoveToPlane(Geometry=crv_44, Plane=PlaneXY(0, 0, 0), Above=True, Below=True)  # -> Geometry, Transform

# ---- group: Y Axis Line-All
crv_111 = Curve(ln_43)

# ----
# 按照梁分类定位PLANE
shift_39 = ShiftPaths(Data=crv_81, Offset=-1)
shift_40 = ShiftPaths(Data=shift_39, Offset=-1)
pull_45 = PullPoint(Point=data_38, Geometry=simplify(shift_40), ClosestOnly=True)  # -> ClosestPoint, Distance
ln_44 = Line(StartPoint=pull_45.ClosestPoint, EndPoint=data_38)
movetoplane_12 = MoveToPlane(Geometry=crv_45, Plane=PlaneXY(0, 0, 0), Above=True, Below=True)  # -> Geometry, Transform

# ---- group: Y Axis Line-All
crv_112 = Curve(ln_44)

# ----
end_14 = EndPoints(Curve=graft(crv_111))  # -> Start, End
merge_42 = Merge(Data1=end_14.Start, Data2=end_14.End)
pull_46 = PullPoint(Point=merge_42, Geometry=movetoplane_11.Geometry, ClosestOnly=True)  # -> ClosestPoint, Distance
sort_37 = SortList(Keys=pull_46.Distance, ValuesA=merge_42)  # -> Keys, ValuesA
item_83 = ListItem(List=sort_37.ValuesA, Index="-1", Wrap=True)
item_84 = ListItem(List=sort_37.ValuesA, Index=0, Wrap=True)
pt_66 = Point(item_84)
pt_67 = Point(item_83)
ln_45 = Line(StartPoint=pt_67, EndPoint=pt_66)
rotate_17 = Rotate(Geometry=ln_45, Angle=1.570796327, Plane=pt_66)  # -> Geometry, Transform

pt_68 = Point(end_14.End)

pl_15 = ConstructPlane(Origin=pt_68, XAxis=rotate_17.Geometry, YAxis=ln_45)
null_27 = NullItem(Item=pl_15)  # -> NullFlags, InvalidFlags, Description
dispatch_84 = Dispatch(List=pl_15, DispatchPattern=null_27.NullFlags)  # -> ListA, ListB
pln_78 = Plane(dispatch_84.ListB)

shift_41 = ShiftPaths(Data=pln_78, Offset=-1)

# ---- group: 檐口-首次筛选的有效起始Plane
data_58 = Data(shift_41)

# ----
# Rhino 文件中导入的块名
# 3.1
# 下层建筑边线外侧50-350mm
# 03：钢板焊埋件[钢梁内侧]
# @钢边梁宽@钢边梁高
pln_79 = Plane(data_58)

end_15 = EndPoints(Curve=graft(crv_112))  # -> Start, End
merge_43 = Merge(Data1=end_15.Start, Data2=end_15.End)
pull_47 = PullPoint(Point=merge_43, Geometry=movetoplane_12.Geometry, ClosestOnly=True)  # -> ClosestPoint, Distance
sort_38 = SortList(Keys=pull_47.Distance, ValuesA=merge_43)  # -> Keys, ValuesA
item_85 = ListItem(List=sort_38.ValuesA, Index="-1", Wrap=True)
item_86 = ListItem(List=sort_38.ValuesA, Index=0, Wrap=True)
pt_69 = Point(item_86)
pt_70 = Point(item_85)
ln_46 = Line(StartPoint=pt_70, EndPoint=pt_69)
rotate_18 = Rotate(Geometry=ln_46, Angle=1.570796327, Plane=pt_69)  # -> Geometry, Transform

pt_71 = Point(end_15.End)

pl_16 = ConstructPlane(Origin=pt_71, XAxis=rotate_18.Geometry, YAxis=ln_46)
null_28 = NullItem(Item=pl_16)  # -> NullFlags, InvalidFlags, Description
dispatch_85 = Dispatch(List=pl_16, DispatchPattern=null_28.NullFlags)  # -> ListA, ListB
pln_80 = Plane(dispatch_85.ListB)

shift_42 = ShiftPaths(Data=pln_80, Offset=-1)

# ---- group: 檐口-首次筛选的有效起始Plane
data_59 = Data(shift_42)

# ----
# 3.2
# 下层建筑边线内侧300-600mm范围
# 03：钢板焊埋件[钢梁外侧]
# @钢边梁宽@钢边梁高
pln_81 = Plane(data_59)

# ----
# 3.1 Missing Point
# 埋件定位点Offset，没有找到和梁的交点
number_slider_47 = Slider(5000, range=0..10000)
deplane_26 = DeconstructPlane(Plane=pln_77)  # -> Origin, XAxis, YAxis, ZAxis
amp_33 = Amplitude(Vector=deplane_26.YAxis, Amplitude=number_slider_47)
crv_113 = Curve(scx_2.Curves)
move_39 = Move(Geometry=deplane_26.Origin, Motion=amp_33)  # -> Geometry, Transform
ln_47 = Line(StartPoint=move_39.Geometry, EndPoint=deplane_26.Origin)
amp_34 = Amplitude(Vector=deplane_26.XAxis, Amplitude=expr("-x", number_slider_7))
amp_35 = Amplitude(Vector=deplane_26.XAxis, Amplitude=number_slider_7)
move_40 = Move(Geometry=ln_47, Motion=amp_35)  # -> Geometry, Transform
move_41 = Move(Geometry=ln_47, Motion=amp_34)  # -> Geometry, Transform
move_42 = Move(Geometry=pln_77, Motion=amp_34)  # -> Geometry, Transform
move_43 = Move(Geometry=pln_77, Motion=amp_35)  # -> Geometry, Transform
pln_82 = Plane(pln_75)

ccx_21 = CurveCurve(CurveA=graft(move_41.Geometry), CurveB=flatten(crv_113))  # -> Points, ParamsA, ParamsB
shift_43 = ShiftPaths(Data=ccx_21.Points, Offset=-1)
sort_39 = SortList(Keys=shift_43, ValuesA=shift_43)  # -> Keys, ValuesA
pull_48 = PullPoint(Point=sort_39.ValuesA, Geometry=graft(pln_77), ClosestOnly=True)  # -> ClosestPoint, Distance
sort_40 = SortList(Keys=pull_48.Distance, ValuesA=sort_39.ValuesA)  # -> Keys, ValuesA
item_87 = ListItem(List=sort_40.ValuesA, Index="-1", Wrap=True)
null_29 = NullItem(Item=flatten(item_87))  # -> NullFlags, InvalidFlags, Description
dispatch_86 = Dispatch(List=flatten(item_87), DispatchPattern=null_29.InvalidFlags)  # -> ListA, ListB
dispatch_87 = Dispatch(List=move_42.Geometry, DispatchPattern=null_29.InvalidFlags)  # -> ListA, ListB
pt_72 = Point(dispatch_86.ListB)
pln_83 = Plane(dispatch_87.ListB)

ccx_22 = CurveCurve(CurveA=graft(move_40.Geometry), CurveB=flatten(crv_113))  # -> Points, ParamsA, ParamsB
shift_44 = ShiftPaths(Data=ccx_22.Points, Offset=-1)
sort_41 = SortList(Keys=shift_44, ValuesA=shift_44)  # -> Keys, ValuesA
pull_49 = PullPoint(Point=sort_41.ValuesA, Geometry=graft(pln_77), ClosestOnly=True)  # -> ClosestPoint, Distance
sort_42 = SortList(Keys=pull_49.Distance, ValuesA=sort_41.ValuesA)  # -> Keys, ValuesA
item_88 = ListItem(List=sort_42.ValuesA, Index="-1", Wrap=True)
null_30 = NullItem(Item=flatten(item_88))  # -> NullFlags, InvalidFlags, Description
dispatch_88 = Dispatch(List=flatten(item_88), DispatchPattern=null_30.InvalidFlags)  # -> ListA, ListB
dispatch_89 = Dispatch(List=move_43.Geometry, DispatchPattern=null_30.InvalidFlags)  # -> ListA, ListB
pln_84 = Plane(dispatch_89.ListB)
pt_73 = Point(dispatch_88.ListB)

merge_44 = Merge(Data1=pln_84, Data2=pln_83)  # -> flatten(Result)
check_same_points_8 = CheckSamePoints(archPoint=flatten(pln_82), crvPoint=merge_44)  # -> out, specialPt; inputs archPoint: list of Point3d, crvPoint: list of Point3d; same code as testpoint

# ----
# pass
cull_i_11 = CullIndex(List=flatten(pln_82), Indices=check_same_points_8.specialPt, Wrap=True)

merge_45 = Merge(Data1=pt_73, Data2=pt_72)

# ----
# 按照梁分类定位点
incurves_12 = PointInCurves(Point=flatten(merge_45), Curves=crv_82)  # -> Relationship, Index, Point
equals_20 = Equality(FirstNumber=incurves_12.Relationship, SecondNumber="0")  # -> Equality, Inequality
dispatch_90 = Dispatch(List=flatten(merge_45), DispatchPattern=equals_20.Inequality)  # -> ListA, ListB

# ---- group: 交点-属于哪个梁
data_60 = Data(dispatch_90.ListA)

# ----
# 3.2  Missing Point
# 埋件定位点Offset，没有找到和梁的交点
number_slider_48 = Slider(5000, range=0..10000)
crv_114 = Curve(scx.Curves)
deplane_27 = DeconstructPlane(Plane=pln_41)  # -> Origin, XAxis, YAxis, ZAxis
amp_36 = Amplitude(Vector=deplane_27.YAxis, Amplitude=number_slider_48)
move_44 = Move(Geometry=deplane_27.Origin, Motion=amp_36)  # -> Geometry, Transform
ln_48 = Line(StartPoint=move_44.Geometry, EndPoint=deplane_27.Origin)
amp_37 = Amplitude(Vector=deplane_27.XAxis, Amplitude=number_slider_7)
amp_38 = Amplitude(Vector=deplane_27.XAxis, Amplitude=expr("-x", number_slider_7))
move_45 = Move(Geometry=ln_48, Motion=amp_37)  # -> Geometry, Transform
move_46 = Move(Geometry=ln_48, Motion=amp_38)  # -> Geometry, Transform
pln_85 = Plane(pln_39)

ccx_23 = CurveCurve(CurveA=graft(move_46.Geometry), CurveB=flatten(crv_114))  # -> Points, ParamsA, ParamsB
shift_45 = ShiftPaths(Data=ccx_23.Points, Offset=-1)
sort_43 = SortList(Keys=shift_45, ValuesA=shift_45)  # -> Keys, ValuesA
pull_50 = PullPoint(Point=sort_43.ValuesA, Geometry=graft(pln_41), ClosestOnly=True)  # -> ClosestPoint, Distance
sort_44 = SortList(Keys=pull_50.Distance, ValuesA=sort_43.ValuesA)  # -> Keys, ValuesA
item_89 = ListItem(List=sort_44.ValuesA, Index="-1", Wrap=True)
null_31 = NullItem(Item=flatten(item_89))  # -> NullFlags, InvalidFlags, Description
dispatch_91 = Dispatch(List=flatten(item_89), DispatchPattern=null_31.InvalidFlags)  # -> ListA, ListB
dispatch_92 = Dispatch(List=pln_41, DispatchPattern=null_31.InvalidFlags)  # -> ListA, ListB
pln_86 = Plane(dispatch_92.ListB)
# 阳角
# 阴角
# 阳角
# 阴角
pt_74 = Point(dispatch_91.ListB)
move2pt_15 = MoveToPoint(Geometry=pln_86, PointA=pln_86, PointB=pt_74)  # -> Moved, Vector, Transform

ccx_24 = CurveCurve(CurveA=graft(move_45.Geometry), CurveB=flatten(crv_114))  # -> Points, ParamsA, ParamsB
shift_46 = ShiftPaths(Data=ccx_24.Points, Offset=-1)
sort_45 = SortList(Keys=shift_46, ValuesA=shift_46)  # -> Keys, ValuesA
pull_51 = PullPoint(Point=sort_45.ValuesA, Geometry=graft(pln_41), ClosestOnly=True)  # -> ClosestPoint, Distance
sort_46 = SortList(Keys=pull_51.Distance, ValuesA=sort_45.ValuesA)  # -> Keys, ValuesA
item_90 = ListItem(List=sort_46.ValuesA, Index="-1", Wrap=True)
null_32 = NullItem(Item=flatten(item_90))  # -> NullFlags, InvalidFlags, Description
dispatch_93 = Dispatch(List=flatten(item_90), DispatchPattern=null_32.InvalidFlags)  # -> ListA, ListB
dispatch_94 = Dispatch(List=pln_41, DispatchPattern=null_32.InvalidFlags)  # -> ListA, ListB
pln_87 = Plane(dispatch_94.ListB)
pt_75 = Point(dispatch_93.ListB)
move2pt_16 = MoveToPoint(Geometry=pln_87, PointA=pln_87, PointB=pt_75)  # -> Moved, Vector, Transform

merge_46 = Merge(Data1=pln_87, Data2=pln_86)  # -> flatten(Result)
check_same_points_9 = CheckSamePoints(archPoint=flatten(pln_85), crvPoint=merge_46)  # -> out, specialPt; inputs archPoint: list of Point3d, crvPoint: list of Point3d; same code as testpoint

# ----
# pass
cull_i_12 = CullIndex(List=flatten(pln_85), Indices=check_same_points_9.specialPt, Wrap=True)

merge_47 = Merge(Data1=pt_75, Data2=pt_74)

# ----
# 按照梁分类定位点
crv_115 = Curve(shift_2)
incurves_13 = PointInCurves(Point=flatten(merge_47), Curves=crv_115)  # -> Relationship, Index, Point
equals_21 = Equality(FirstNumber=incurves_13.Relationship, SecondNumber="0")  # -> Equality, Inequality
dispatch_95 = Dispatch(List=flatten(merge_47), DispatchPattern=equals_21.Inequality)  # -> ListA, ListB
data_61 = Data(dispatch_95.ListA)

# ---- group: 交点-属于哪个梁
data_62 = Data(data_61)

# ----
pln_88 = Plane(cull_i_11)
pln_89 = Plane(cull_i_12)

# ----
# 3.1下层建筑内侧到300到外侧50内是否有钢结构
deplane_28 = DeconstructPlane(Plane=pln_88)  # -> Origin, XAxis, YAxis, ZAxis
deplane_29 = DeconstructPlane(Plane=pln_89)  # -> Origin, XAxis, YAxis, ZAxis
check_same_points_10 = CheckSamePoints(archPoint=deplane_29.Origin, crvPoint=deplane_28.Origin)  # -> out, specialPt; inputs archPoint: list of Point3d, crvPoint: list of Point3d; same code as testpoint

# ----
# 同时满足N
item_91 = ListItem(List=pln_89, Index=check_same_points_10.specialPt, Wrap=True)

# ----
# SmoothCurve-阴角
# SmoothCurve-阳角
# SmoothCurve-阴角
# SmoothCurve-正常
# Angular Curve - All
# Special Curve(with location)- All
# Curve for this project only - All
pln_90 = Plane(item_91)
flatten_9 = FlattenTree(Tree=crv_85, Path="{0}")
number_slider_49 = Slider(3584, range=0..10000)
deplane_30 = DeconstructPlane(Plane=pln_90)  # -> Origin, XAxis, YAxis, ZAxis
boundary_6 = BoundarySurfaces(Edges=[offset_10, offset_9])
amp_39 = Amplitude(Vector=deplane_30.YAxis, Amplitude=number_slider_49)
amp_40 = Amplitude(Vector=deplane_30.YAxis, Amplitude=expr("-x", number_slider_49))
scx_3 = SurfaceCurve(Surface=boundary_6, Curve=flatten_9)  # -> flatten(Curves), Points, UVPoints, Normals, Parameters, Tangents
move_47 = Move(Geometry=deplane_30.Origin, Motion=amp_40)  # -> Geometry, Transform
move_48 = Move(Geometry=deplane_30.Origin, Motion=amp_39)  # -> Geometry, Transform
ln_49 = Line(StartPoint=move_47.Geometry, EndPoint=move_48.Geometry)
ccx_25 = CurveCurve(CurveA=graft(ln_49), CurveB=scx_3.Curves)  # -> Points, ParamsA, ParamsB
shift_47 = ShiftPaths(Data=ccx_25.Points, Offset=-1)
pull_52 = PullPoint(Point=graft(pln_90), Geometry=shift_47, ClosestOnly=True)  # -> ClosestPoint, Distance
sort_47 = SortList(Keys=pull_52.Distance, ValuesA=pull_52.ClosestPoint)  # -> Keys, ValuesA
item_92 = ListItem(List=sort_47.ValuesA, Index=0, Wrap=True)
null_33 = NullItem(Item=sort_47.ValuesA)  # -> NullFlags, simplify(InvalidFlags), Description
dispatch_96 = Dispatch(List=simplify(graft(pln_90)), DispatchPattern=null_33.InvalidFlags)  # -> ListA, ListB
pln_91 = Plane(dispatch_96.ListB)
pln_92 = Plane(dispatch_96.ListA)
move2pt_17 = MoveToPoint(Geometry=pln_91, PointA=pln_91, PointB=simplify(shift_47))  # -> flatten(Moved), Vector, Transform

# ---- group: 交点-属于哪个梁
data_63 = Data(move2pt_17.Moved)

# ----
# 按照梁分类定位点
crv_116 = Curve(shift_2)
incurves_14 = PointInCurves(Point=flatten(data_63), Curves=crv_116)  # -> Relationship, Index, Point
equals_22 = Equality(FirstNumber=incurves_14.Relationship, SecondNumber="0")  # -> Equality, Inequality
dispatch_97 = Dispatch(List=flatten(data_63), DispatchPattern=equals_22.Inequality)  # -> ListA, ListB

pt_76 = Point(dispatch_97.ListA)

# ----
# 可能的结构交点-大量
pln_93 = Plane(pln_92)

# ----
# 0 檐口出定位点
# 与结构无交点
pln_94 = Plane(flatten(pln_93))

# ----
# 4 Missing Point
# 埋件定位点Offset，没有找到和梁的交点
number_slider_50 = Slider(5000, range=0..10000)
deplane_31 = DeconstructPlane(Plane=pln_94)  # -> Origin, XAxis, YAxis, ZAxis
amp_41 = Amplitude(Vector=deplane_31.YAxis, Amplitude=number_slider_50)
move_49 = Move(Geometry=deplane_31.Origin, Motion=amp_41)  # -> Geometry, Transform
ln_50 = Line(StartPoint=move_49.Geometry, EndPoint=deplane_31.Origin)
amp_42 = Amplitude(Vector=deplane_31.XAxis, Amplitude=number_slider_7)
amp_43 = Amplitude(Vector=deplane_31.XAxis, Amplitude=expr("-x", number_slider_7))
move_50 = Move(Geometry=ln_50, Motion=amp_42)  # -> Geometry, Transform
move_51 = Move(Geometry=ln_50, Motion=amp_43)  # -> Geometry, Transform

# ---- group: 梁中线
crv_117 = Curve(scx_3.Curves)

# ----
ccx_26 = CurveCurve(CurveA=graft(move_51.Geometry), CurveB=flatten(crv_117))  # -> Points, ParamsA, ParamsB
shift_48 = ShiftPaths(Data=ccx_26.Points, Offset=-1)
sort_48 = SortList(Keys=shift_48, ValuesA=shift_48)  # -> Keys, ValuesA
pull_53 = PullPoint(Point=sort_48.ValuesA, Geometry=graft(pln_94), ClosestOnly=True)  # -> ClosestPoint, Distance
sort_49 = SortList(Keys=pull_53.Distance, ValuesA=sort_48.ValuesA)  # -> Keys, ValuesA
item_93 = ListItem(List=sort_49.ValuesA, Index="-1", Wrap=True)
null_34 = NullItem(Item=flatten(item_93))  # -> NullFlags, InvalidFlags, Description
dispatch_98 = Dispatch(List=flatten(item_93), DispatchPattern=null_34.InvalidFlags)  # -> ListA, ListB
dispatch_99 = Dispatch(List=pln_94, DispatchPattern=null_34.InvalidFlags)  # -> ListA, ListB
pt_77 = Point(dispatch_98.ListB)
pln_95 = Plane(dispatch_99.ListB)
move2pt_18 = MoveToPoint(Geometry=pln_95, PointA=pln_95, PointB=pt_77)  # -> Moved, Vector, Transform

ccx_27 = CurveCurve(CurveA=graft(move_50.Geometry), CurveB=flatten(crv_117))  # -> Points, ParamsA, ParamsB
shift_49 = ShiftPaths(Data=ccx_27.Points, Offset=-1)
sort_50 = SortList(Keys=shift_49, ValuesA=shift_49)  # -> Keys, ValuesA
pull_54 = PullPoint(Point=sort_50.ValuesA, Geometry=graft(pln_94), ClosestOnly=True)  # -> ClosestPoint, Distance
sort_51 = SortList(Keys=pull_54.Distance, ValuesA=sort_50.ValuesA)  # -> Keys, ValuesA
item_94 = ListItem(List=sort_51.ValuesA, Index="-1", Wrap=True)
null_35 = NullItem(Item=flatten(item_94))  # -> NullFlags, InvalidFlags, Description
dispatch_100 = Dispatch(List=pln_94, DispatchPattern=null_35.InvalidFlags)  # -> ListA, ListB
dispatch_101 = Dispatch(List=flatten(item_94), DispatchPattern=null_35.InvalidFlags)  # -> ListA, ListB
pln_96 = Plane(dispatch_100.ListB)
pt_78 = Point(dispatch_101.ListB)
move2pt_19 = MoveToPoint(Geometry=pln_96, PointA=pln_96, PointB=pt_78)  # -> Moved, Vector, Transform

merge_48 = Merge(Data1=move2pt_19.Moved, Data2=move2pt_18.Moved)

# ---- group: 交点-属于哪个梁
data_64 = Data(merge_48)

# ----
# 按照梁分类定位点
crv_118 = Curve(shift_2)
incurves_15 = PointInCurves(Point=flatten(data_64), Curves=crv_118)  # -> Relationship, Index, Point
equals_23 = Equality(FirstNumber=incurves_15.Relationship, SecondNumber="0")  # -> Equality, Inequality
dispatch_102 = Dispatch(List=flatten(data_64), DispatchPattern=equals_23.Inequality)  # -> ListA, ListB

pt_79 = Point(dispatch_102.ListA)
merge_49 = Merge(Data1=flatten(pln_96), Data2=flatten(pln_95))
check_same_points_11 = CheckSamePoints(archPoint=pln_93, crvPoint=flatten(merge_49))  # -> out, specialPt; inputs archPoint: list of Point3d, crvPoint: list of Point3d; same code as testpoint
cull_i_13 = CullIndex(List=pln_93, Indices=check_same_points_11.specialPt, Wrap=True)

# ----
# 按照梁分类定位PLANE
shift_50 = ShiftPaths(Data=crv_83, Offset=-1)
shift_51 = ShiftPaths(Data=shift_50, Offset=-1)
pull_55 = PullPoint(Point=data_60, Geometry=simplify(shift_51), ClosestOnly=True)  # -> ClosestPoint, Distance
ln_51 = Line(StartPoint=pull_55.ClosestPoint, EndPoint=data_60)
movetoplane_13 = MoveToPlane(Geometry=crv_46, Plane=PlaneXY(0, 0, 0), Above=True, Below=True)  # -> Geometry, Transform

# ---- group: Y Axis Line-All
crv_119 = Curve(ln_51)

# ----
# 按照梁分类定位PLANE
shift_52 = ShiftPaths(Data=crv_84, Offset=-1)
shift_53 = ShiftPaths(Data=shift_52, Offset=-1)
pull_56 = PullPoint(Point=data_62, Geometry=simplify(shift_53), ClosestOnly=True)  # -> ClosestPoint, Distance
ln_52 = Line(StartPoint=pull_56.ClosestPoint, EndPoint=data_62)
movetoplane_14 = MoveToPlane(Geometry=crv_47, Plane=PlaneXY(0, 0, 0), Above=True, Below=True)  # -> Geometry, Transform

# ---- group: Y Axis Line-All
crv_120 = Curve(ln_52)

# ----
end_16 = EndPoints(Curve=graft(crv_119))  # -> Start, End
merge_50 = Merge(Data1=end_16.Start, Data2=end_16.End)
pull_57 = PullPoint(Point=merge_50, Geometry=movetoplane_13.Geometry, ClosestOnly=True)  # -> ClosestPoint, Distance
sort_52 = SortList(Keys=pull_57.Distance, ValuesA=merge_50)  # -> Keys, ValuesA
item_95 = ListItem(List=sort_52.ValuesA, Index="-1", Wrap=True)
item_96 = ListItem(List=sort_52.ValuesA, Index=0, Wrap=True)
pt_80 = Point(item_96)
pt_81 = Point(item_95)
ln_53 = Line(StartPoint=pt_81, EndPoint=pt_80)
rotate_19 = Rotate(Geometry=ln_53, Angle=1.570796327, Plane=pt_80)  # -> Geometry, Transform

pt_82 = Point(end_16.End)

pl_17 = ConstructPlane(Origin=pt_82, XAxis=rotate_19.Geometry, YAxis=ln_53)
null_36 = NullItem(Item=pl_17)  # -> NullFlags, InvalidFlags, Description
dispatch_103 = Dispatch(List=pl_17, DispatchPattern=null_36.NullFlags)  # -> ListA, ListB
pln_97 = Plane(dispatch_103.ListB)

shift_54 = ShiftPaths(Data=pln_97, Offset=-1)
data_65 = Data(shift_54)

# ----
# 撞到梁交点
merge_51 = Merge(Data1=data_65)

merge_52 = Merge(Data1=pln_79, Data2=merge_51)
# 这里如果跑红也不要紧，
# 说明单体没有出现相撞的情况
orient_6 = Orient(Geometry=item_30, Source=rotate_9.Geometry, Target=merge_52)  # -> Geometry, Transform

data_66 = Data(orient_6.Geometry)
ungroup_9 = Ungroup(Group=data_66)
item_97 = ListItem(List=ungroup_9, Index=0, Wrap=True)  # -> flatten(Item)
item_98 = ListItem(List=ungroup_9, Index="-1", Wrap=True)  # -> flatten(Item)

# ---- group: 框架顶部，埋件在幕墙线外侧 (continued)
entwine_16 = Entwine(Branch00=item_97, Branch01=item_98, FlattenInputs=True)
bake_6 = BakeObjects(Geometry=entwine_16, Attributes=attributes_6, BakeName=panel_44, Bake=False)

# ----
end_17 = EndPoints(Curve=graft(crv_120))  # -> Start, End
merge_53 = Merge(Data1=end_17.Start, Data2=end_17.End)
pull_58 = PullPoint(Point=merge_53, Geometry=movetoplane_14.Geometry, ClosestOnly=True)  # -> ClosestPoint, Distance
sort_53 = SortList(Keys=pull_58.Distance, ValuesA=merge_53)  # -> Keys, ValuesA
item_99 = ListItem(List=sort_53.ValuesA, Index="-1", Wrap=True)
item_100 = ListItem(List=sort_53.ValuesA, Index=0, Wrap=True)
pt_83 = Point(item_100)
pt_84 = Point(item_99)
ln_54 = Line(StartPoint=pt_84, EndPoint=pt_83)
rotate_20 = Rotate(Geometry=ln_54, Angle=1.570796327, Plane=pt_83)  # -> Geometry, Transform

pt_85 = Point(end_17.End)

pl_18 = ConstructPlane(Origin=pt_85, XAxis=rotate_20.Geometry, YAxis=ln_54)
null_37 = NullItem(Item=pl_18)  # -> NullFlags, InvalidFlags, Description
dispatch_104 = Dispatch(List=pl_18, DispatchPattern=null_37.NullFlags)  # -> ListA, ListB
pln_98 = Plane(dispatch_104.ListB)

shift_55 = ShiftPaths(Data=pln_98, Offset=-1)

# ---- group: 檐口-首次筛选的有效起始Plane
data_67 = Data(shift_55)

# ----
# 撞到梁交点
merge_54 = Merge(Data1=data_67)

merge_55 = Merge(Data1=pln_81, Data2=merge_54)
orient_7 = Orient(Geometry=item_32, Source=item_33, Target=merge_55)  # -> Geometry, Transform

data_68 = Data(orient_7.Geometry)
ungroup_10 = Ungroup(Group=data_68)
item_101 = ListItem(List=ungroup_10, Index=0, Wrap=True)  # -> flatten(Item)
item_102 = ListItem(List=ungroup_10, Index="-1", Wrap=True)  # -> flatten(Item)

# ---- group: 框架顶部，埋件在幕墙线内侧 (continued)
entwine_17 = Entwine(Branch00=item_101, Branch01=item_102, FlattenInputs=True)
bake_7 = BakeObjects(Geometry=entwine_17, Attributes=attributes_7, BakeName=panel_46, Bake=False)

# ----
# 按照梁分类定位PLANE
shift_56 = ShiftPaths(Data=crv_86, Offset=-1)
shift_57 = ShiftPaths(Data=shift_56, Offset=-1)
pull_59 = PullPoint(Point=pt_76, Geometry=simplify(shift_57), ClosestOnly=True)  # -> ClosestPoint, Distance
ln_55 = Line(StartPoint=pull_59.ClosestPoint, EndPoint=pt_76)
movetoplane_15 = MoveToPlane(Geometry=crv_49, Plane=PlaneXY(0, 0, 0), Above=True, Below=True)  # -> Geometry, Transform

# ---- group: Y Axis Line-All
crv_121 = Curve(ln_55)

# ----
end_18 = EndPoints(Curve=graft(crv_121))  # -> Start, End
merge_56 = Merge(Data1=end_18.Start, Data2=end_18.End)
pull_60 = PullPoint(Point=merge_56, Geometry=movetoplane_15.Geometry, ClosestOnly=True)  # -> ClosestPoint, Distance
sort_54 = SortList(Keys=pull_60.Distance, ValuesA=merge_56)  # -> Keys, ValuesA
item_103 = ListItem(List=sort_54.ValuesA, Index="-1", Wrap=True)
item_104 = ListItem(List=sort_54.ValuesA, Index=0, Wrap=True)
pt_86 = Point(item_104)
pt_87 = Point(item_103)
ln_56 = Line(StartPoint=pt_87, EndPoint=pt_86)
rotate_21 = Rotate(Geometry=ln_56, Angle=1.570796327, Plane=pt_86)  # -> Geometry, Transform

pt_88 = Point(end_18.End)

pl_19 = ConstructPlane(Origin=pt_88, XAxis=rotate_21.Geometry, YAxis=ln_56)
null_38 = NullItem(Item=pl_19)  # -> NullFlags, InvalidFlags, Description
dispatch_105 = Dispatch(List=pl_19, DispatchPattern=null_38.NullFlags)  # -> ListA, ListB
pln_99 = Plane(dispatch_105.ListB)

shift_58 = ShiftPaths(Data=pln_99, Offset=-1)

# ---- group: 檐口-首次筛选的有效起始Plane
data_69 = Data(shift_58)

# ----
# 按照梁分类定位PLANE
shift_59 = ShiftPaths(Data=crv_87, Offset=-1)
shift_60 = ShiftPaths(Data=shift_59, Offset=-1)
pull_61 = PullPoint(Point=pt_79, Geometry=simplify(shift_60), ClosestOnly=True)  # -> ClosestPoint, Distance
ln_57 = Line(StartPoint=pull_61.ClosestPoint, EndPoint=pt_79)
movetoplane_16 = MoveToPlane(Geometry=crv_50, Plane=PlaneXY(0, 0, 0), Above=True, Below=True)  # -> Geometry, Transform

# ---- group: Y Axis Line-All
crv_122 = Curve(ln_57)

# ----
end_19 = EndPoints(Curve=graft(crv_122))  # -> Start, End
merge_57 = Merge(Data1=end_19.Start, Data2=end_19.End)
pull_62 = PullPoint(Point=merge_57, Geometry=movetoplane_16.Geometry, ClosestOnly=True)  # -> ClosestPoint, Distance
sort_55 = SortList(Keys=pull_62.Distance, ValuesA=merge_57)  # -> Keys, ValuesA
item_105 = ListItem(List=sort_55.ValuesA, Index="-1", Wrap=True)
item_106 = ListItem(List=sort_55.ValuesA, Index=0, Wrap=True)
pt_89 = Point(item_106)
pt_90 = Point(item_105)
ln_58 = Line(StartPoint=pt_90, EndPoint=pt_89)
rotate_22 = Rotate(Geometry=ln_58, Angle=1.570796327, Plane=pt_89)  # -> Geometry, Transform

pt_91 = Point(end_19.End)

pl_20 = ConstructPlane(Origin=pt_91, XAxis=rotate_22.Geometry, YAxis=ln_58)
null_39 = NullItem(Item=pl_20)  # -> NullFlags, InvalidFlags, Description
dispatch_106 = Dispatch(List=pl_20, DispatchPattern=null_39.NullFlags)  # -> ListA, ListB
pln_100 = Plane(dispatch_106.ListB)

shift_61 = ShiftPaths(Data=pln_100, Offset=-1)

# ---- group: 檐口-首次筛选的有效起始Plane
data_70 = Data(shift_61)

# ----
# 撞到梁交点
pln_101 = Plane(data_70)

# ----
# 4.1下层建筑内侧300到外侧50内
# 03底埋，钢板焊
pln_102 = Plane(data_69)
data_71 = Data(data_24)
item_107 = ListItem(List=data_71, Index="-1", Wrap=True)
item_108 = ListItem(List=data_71, Index=0, Wrap=True)
merge_58 = Merge(Data1=pln_102, Data2=pln_101)

orient_8 = Orient(Geometry=item_108, Source=item_107, Target=merge_58)  # -> Geometry, Transform

data_72 = Data(orient_8.Geometry)
ungroup_11 = Ungroup(Group=data_72)
item_109 = ListItem(List=ungroup_11, Index=0, Wrap=True)  # -> flatten(Item)
item_110 = ListItem(List=ungroup_11, Index="-1", Wrap=True)  # -> flatten(Item)

# ---- group: 钢结构下底埋 (continued)
entwine_18 = Entwine(Branch00=item_109, Branch01=item_110, FlattenInputs=True)
bake_8 = BakeObjects(Geometry=entwine_18, Attributes=attributes_8, BakeName=panel_48, Bake=False)

# ----
# 1.0无檐口线初筛-上层定位点
crv_123 = Curve(reb_2)
pln_103 = Plane(pln_6)
project_20 = Project(Geometry=crv_123, Plane=PlaneXY(0, 0, 0))  # -> Geometry, Transform
clscrv_7 = CloseCurve(Curve=project_20.Geometry, CloseType=0, Bulge=0.5, Tolerance=0)  # -> Closed, R

deplane_32 = DeconstructPlane(Plane=pln_103)  # -> Origin, XAxis, YAxis, ZAxis

pt_92 = Point(deplane_32.Origin)
incurve_8 = PointInCurve(Point=pt_92, Curve=clscrv_7.Closed)  # -> Relationship, Point

equals_24 = Equality(FirstNumber=incurve_8.Relationship, SecondNumber="2")  # -> Equality, Inequality
dispatch_107 = Dispatch(List=pln_103, DispatchPattern=equals_24.Equality)  # -> ListA, ListB
data_73 = Data(dispatch_107.ListB)

panel_76 = Panel(incurve_8.Relationship)

pln_104 = Plane(dispatch_107.ListA)

# ---- group: 1.0N的情况的Plane
pln_105 = Plane(pln_104)

# ----
# 5 上层建筑边线,
# 默认建筑提供上翻，如主结构提供示意则使用结构定位【该项目无】，
# 如无则使用建筑边线向内50mm作为埋件定位
deplane_33 = DeconstructPlane(Plane=pln_105)  # -> Origin, XAxis, YAxis, ZAxis
number_slider_51 = Slider(3584, range=0..10000)
amp_44 = Amplitude(Vector=deplane_33.YAxis, Amplitude=number_slider_51)
amp_45 = Amplitude(Vector=deplane_33.YAxis, Amplitude=expr("-x", number_slider_51))
move_52 = Move(Geometry=deplane_33.Origin, Motion=amp_45)  # -> Geometry, Transform
move_53 = Move(Geometry=deplane_33.Origin, Motion=amp_44)  # -> Geometry, Transform
ln_59 = Line(StartPoint=move_52.Geometry, EndPoint=move_53.Geometry)
ccx_28 = CurveCurve(CurveA=ln_59, CurveB=crv_51)  # -> simplify(Points), ParamsA, ParamsB
ln_60 = Line(StartPoint=ccx_28.Points, EndPoint=simplify(graft(pln_105)))
len_10 = Length(Curve=ln_60)
null_40 = NullItem(Item=ccx_28.Points)  # -> NullFlags, InvalidFlags, Description
sort_56 = SortList(Keys=len_10, ValuesA=simplify(ccx_28.Points))  # -> Keys, ValuesA
dispatch_108 = Dispatch(List=simplify(graft(pln_105)), DispatchPattern=null_40.NullFlags)  # -> ListA, ListB
item_111 = ListItem(List=sort_56.ValuesA, Index=0, Wrap=True)

# ----
# 可能的双点
pln_106 = Plane(dispatch_108.ListA)

# ----
# 0 檐口出定位点
# 与结构无交点
pln_107 = Plane(flatten(pln_106))

# ----
# 5 上层建筑边线,
# 默认建筑提供上翻
# 04：板埋埋件[混凝土楼板上侧]
# @板埋参数xn
move2pt_20 = MoveToPoint(Geometry=simplify(graft(pln_105)), PointA=simplify(graft(pln_105)), PointB=item_111)  # -> flatten(Moved), Vector, Transform

# ----
# 4.0下层建筑内侧到300到外侧50内
# 无钢结构
# 要求主体结构提供钢结构梁，默认位置为建筑边线向内300mm
number_slider_52 = Slider(300, range=0..1000)
crv_124 = Curve(crv_41)
pln_108 = Plane(cull_i_13)
offset_12 = OffsetCurve(Curve=crv_124, Distance=expr("-x", number_slider_52), Corners=1)
pull_63 = PullPoint(Point=pln_108, Geometry=offset_12, ClosestOnly=True)  # -> ClosestPoint, Distance
sort_57 = SortList(Keys=pull_63.Distance)  # -> Keys, ValuesA
larger_10 = LargerThan(FirstNumber=pull_63.Distance, SecondNumber=Slider(400, range=0..1000))  # -> LargerThan, OrEqualTo
panel_77 = Panel(sort_57.Keys)
number_slider_53 = Slider(3584, range=0..10000)

# ---- group: 删除反常线
dispatch_109 = Dispatch(List=pln_108, DispatchPattern=larger_10.LargerThan)  # -> ListA, ListB

# ----
pln_109 = Plane(flatten(dispatch_109.ListB))
deplane_34 = DeconstructPlane(Plane=pln_109)  # -> Origin, XAxis, YAxis, ZAxis
amp_46 = Amplitude(Vector=deplane_34.YAxis, Amplitude=number_slider_53)
amp_47 = Amplitude(Vector=deplane_34.YAxis, Amplitude=expr("-x", number_slider_53))
move_54 = Move(Geometry=deplane_34.Origin, Motion=amp_47)  # -> Geometry, Transform
move_55 = Move(Geometry=deplane_34.Origin, Motion=amp_46)  # -> Geometry, Transform
ln_61 = Line(StartPoint=move_54.Geometry, EndPoint=move_55.Geometry)
ccx_29 = CurveCurve(CurveA=ln_61, CurveB=offset_12)  # -> Points, ParamsA, ParamsB
flatten_10 = FlattenTree(Tree=ccx_29.Points, Path="{0}")
null_41 = NullItem(Item=simplify(ccx_29.Points))  # -> NullFlags, InvalidFlags, Description
dispatch_110 = Dispatch(List=simplify(graft(pln_109)), DispatchPattern=null_41.NullFlags)  # -> ListA, ListB

# ---- group: 有效点
pull_64 = PullPoint(Point=deplane_34.Origin, Geometry=flatten_10, ClosestOnly=True)  # -> ClosestPoint, Distance

# ----
# 离结构太远
pln_110 = Plane(dispatch_109.ListA)

# ----
# 可能的双点
pln_111 = Plane(dispatch_110.ListA)

merge_59 = Merge(Data1=pln_110, Data2=pln_111)

# ----
# 0 檐口出定位点
# 与结构无交点
pln_112 = Plane(flatten(merge_59))

# ----
# 4.0  Missing Point
# 埋件定位点Offset，没有找到和梁的交点
number_slider_54 = Slider(5000, range=0..10000)
deplane_35 = DeconstructPlane(Plane=pln_112)  # -> Origin, XAxis, YAxis, ZAxis
crv_125 = Curve(scx_3.Curves)
amp_48 = Amplitude(Vector=deplane_35.YAxis, Amplitude=number_slider_54)
move_56 = Move(Geometry=deplane_35.Origin, Motion=amp_48)  # -> Geometry, Transform
ln_62 = Line(StartPoint=move_56.Geometry, EndPoint=deplane_35.Origin)
amp_49 = Amplitude(Vector=deplane_35.XAxis, Amplitude=number_slider_7)
amp_50 = Amplitude(Vector=deplane_35.XAxis, Amplitude=expr("-x", number_slider_7))
move_57 = Move(Geometry=ln_62, Motion=amp_49)  # -> Geometry, Transform
move_58 = Move(Geometry=ln_62, Motion=amp_50)  # -> Geometry, Transform

ccx_30 = CurveCurve(CurveA=graft(move_58.Geometry), CurveB=flatten(crv_125))  # -> Points, ParamsA, ParamsB
shift_62 = ShiftPaths(Data=ccx_30.Points, Offset=-1)
sort_58 = SortList(Keys=shift_62, ValuesA=shift_62)  # -> Keys, ValuesA
pull_65 = PullPoint(Point=sort_58.ValuesA, Geometry=graft(pln_112), ClosestOnly=True)  # -> ClosestPoint, Distance
sort_59 = SortList(Keys=pull_65.Distance, ValuesA=sort_58.ValuesA)  # -> Keys, ValuesA
item_112 = ListItem(List=sort_59.ValuesA, Index="-1", Wrap=True)
null_42 = NullItem(Item=flatten(item_112))  # -> NullFlags, InvalidFlags, Description
dispatch_111 = Dispatch(List=simplify(item_112), DispatchPattern=simplify(graft(null_42.InvalidFlags)))  # -> ListA, ListB
dispatch_112 = Dispatch(List=pln_112, DispatchPattern=null_42.InvalidFlags)  # -> ListA, ListB
pln_113 = Plane(dispatch_112.ListB)
pt_93 = Point(dispatch_111.ListB)

ccx_31 = CurveCurve(CurveA=graft(move_57.Geometry), CurveB=flatten(crv_125))  # -> Points, ParamsA, ParamsB
shift_63 = ShiftPaths(Data=ccx_31.Points, Offset=-1)
sort_60 = SortList(Keys=shift_63, ValuesA=shift_63)  # -> Keys, ValuesA
pull_66 = PullPoint(Point=sort_60.ValuesA, Geometry=graft(pln_112), ClosestOnly=True)  # -> ClosestPoint, Distance
sort_61 = SortList(Keys=pull_66.Distance, ValuesA=sort_60.ValuesA)  # -> Keys, ValuesA
item_113 = ListItem(List=sort_61.ValuesA, Index="-1", Wrap=True)
null_43 = NullItem(Item=flatten(item_113))  # -> NullFlags, InvalidFlags, Description
dispatch_113 = Dispatch(List=simplify(item_113), DispatchPattern=simplify(graft(null_43.InvalidFlags)))  # -> ListA, ListB
dispatch_114 = Dispatch(List=pln_112, DispatchPattern=null_43.InvalidFlags)  # -> ListA, ListB
pln_114 = Plane(dispatch_114.ListB)
pt_94 = Point(dispatch_113.ListB)

# ----
# 撞到结构
move2pt_21 = MoveToPoint(Geometry=flatten(pln_113), PointA=flatten(pln_113), PointB=flatten(pt_93))  # -> Moved, Vector, Transform
move2pt_22 = MoveToPoint(Geometry=flatten(pln_114), PointA=flatten(pln_114), PointB=flatten(pt_94))  # -> Moved, Vector, Transform

# ----
# 撞到梁交点
merge_60 = Merge(Data1=move2pt_22.Moved, Data2=move2pt_21.Moved)

# ----
# 4.0 默认位置为建筑边线向内300mm
# 侧埋，钢板焊
# 03：钢板焊埋件[钢梁外侧]@钢边梁宽@钢边梁高
move2pt_23 = MoveToPoint(Geometry=pln_109, PointA=deplane_34.Origin, PointB=pull_64.ClosestPoint)  # -> Moved, Vector, Transform

merge_61 = Merge(Data1=move2pt_23.Moved, Data2=merge_60)

# ---- group: All Location Point
merge_62 = Merge(Data1=merge_41, Data2=merge_52, Data3=merge_55, Data4=merge_58, Data5=merge_61)

# ----
orient_9 = Orient(Geometry=item_5, Source=item_6, Target=merge_61)  # -> Geometry, Transform

data_74 = Data(orient_9.Geometry)
ungroup_12 = Ungroup(Group=data_74)
item_114 = ListItem(List=ungroup_12, Index=0, Wrap=True)  # -> flatten(Item)
item_115 = ListItem(List=ungroup_12, Index="-1", Wrap=True)  # -> flatten(Item)

# ---- group: 范围内没有钢梁，默认幕墙线向内300有一个埋件 (continued)
entwine_19 = Entwine(Branch00=item_114, Branch01=item_115, FlattenInputs=True)
bake_9 = BakeObjects(Geometry=entwine_19, Attributes=attributes_10, BakeName=panel_50, Bake=False)

# ----
null_44 = NullItem(Item=merge_62)  # -> NullFlags, InvalidFlags, Description
dispatch_115 = Dispatch(List=merge_62, DispatchPattern=null_44.InvalidFlags)  # -> ListA, ListB

# ---- group: 下层图纸-标注定位点
pt_95 = Point(dispatch_115.ListB)

# ----
cluster_4 = Cluster_2(
    outline_curve=标准范围_符合单一轴网方向,
    dim_offset_1=number_slider_16,
    dim_offset_2=number_slider_14,
    axis_direction_crv1=crv_11,
    axis_direction_crv2=crv_12,
    f2_arch_outline=crv_57,
    location_point=pt_95,
    dim_style=panel_21,
    directed_outline=seam,
    移除重复位置点_容差=number_slider_15)  # -> D_3, D_4, D, D_2
dimension1 = Data(cluster_4.D_3)

# ---- group: Dimension4
data_75 = Data(cluster_4.D_2)

# ---- group: Dimension2
data_76 = Data(cluster_4.D_4)

# ---- group: Dimension3
data_77 = Data(cluster_4.D)

# ----
entwine_20 = Entwine(Branch00=dimension1, Branch01=data_76, Branch02=data_77, Branch03=data_75, FlattenInputs=True)

# ---- group: Refrash Data
# 将所有Input都输入完后要Refresh data
dam = DataDam(DataA=entwine_20, BufferDelay=10000000, BufferMode=0)

# ----
dedim = DeconstructDimension(DimensionObject=dam)  # -> Value, Text, Plane, Points, Style
shift_64 = ShiftPaths(Data=dedim.Text, Offset=-1)
smaller_9 = SmallerThan(FirstNumber=shift_64, SecondNumber=Slider(1, range=0..10))  # -> SmallerThan, OrEqualTo
dispatch_116 = Dispatch(List=dam, DispatchPattern=smaller_9.SmallerThan)  # -> ListA, ListB

# ---- group: Bake Me
bake_10 = BakeObjects(Geometry=dispatch_116.ListB, Attributes=attributes_11, Bake=False)

# ----
data_78 = Data(dispatch_116.ListB)

# ----
# 5  Missing Point
# 埋件定位点Offset，没有找到和梁的交点
number_slider_55 = Slider(5000, range=0..10000)
deplane_36 = DeconstructPlane(Plane=pln_107)  # -> Origin, XAxis, YAxis, ZAxis
crv_126 = Curve(crv_51)
amp_51 = Amplitude(Vector=deplane_36.YAxis, Amplitude=number_slider_55)
move_59 = Move(Geometry=deplane_36.Origin, Motion=amp_51)  # -> Geometry, Transform
ln_63 = Line(StartPoint=move_59.Geometry, EndPoint=deplane_36.Origin)
amp_52 = Amplitude(Vector=deplane_36.XAxis, Amplitude=number_slider_7)
amp_53 = Amplitude(Vector=deplane_36.XAxis, Amplitude=expr("-x", number_slider_7))
move_60 = Move(Geometry=ln_63, Motion=amp_52)  # -> Geometry, Transform
move_61 = Move(Geometry=ln_63, Motion=amp_53)  # -> Geometry, Transform
pln_115 = Plane(pln_107)

ccx_32 = CurveCurve(CurveA=graft(move_61.Geometry), CurveB=flatten(crv_126))  # -> Points, ParamsA, ParamsB
shift_65 = ShiftPaths(Data=ccx_32.Points, Offset=-1)
sort_62 = SortList(Keys=shift_65, ValuesA=shift_65)  # -> Keys, ValuesA
pull_67 = PullPoint(Point=sort_62.ValuesA, Geometry=graft(pln_107), ClosestOnly=True)  # -> ClosestPoint, Distance
sort_63 = SortList(Keys=pull_67.Distance, ValuesA=sort_62.ValuesA)  # -> Keys, ValuesA
item_116 = ListItem(List=sort_63.ValuesA, Index="-1", Wrap=True)
null_45 = NullItem(Item=flatten(item_116))  # -> NullFlags, InvalidFlags, Description
dispatch_117 = Dispatch(List=simplify(item_116), DispatchPattern=simplify(graft(null_45.InvalidFlags)))  # -> ListA, ListB
dispatch_118 = Dispatch(List=pln_107, DispatchPattern=null_45.InvalidFlags)  # -> ListA, ListB
pln_116 = Plane(dispatch_118.ListB)
pt_96 = Point(dispatch_117.ListB)

ccx_33 = CurveCurve(CurveA=graft(move_60.Geometry), CurveB=flatten(crv_126))  # -> Points, ParamsA, ParamsB
shift_66 = ShiftPaths(Data=ccx_33.Points, Offset=-1)
sort_64 = SortList(Keys=shift_66, ValuesA=shift_66)  # -> Keys, ValuesA
pull_68 = PullPoint(Point=sort_64.ValuesA, Geometry=graft(pln_107), ClosestOnly=True)  # -> ClosestPoint, Distance
sort_65 = SortList(Keys=pull_68.Distance, ValuesA=sort_64.ValuesA)  # -> Keys, ValuesA
item_117 = ListItem(List=sort_65.ValuesA, Index="-1", Wrap=True)
null_46 = NullItem(Item=flatten(item_117))  # -> NullFlags, InvalidFlags, Description
dispatch_119 = Dispatch(List=simplify(item_117), DispatchPattern=simplify(graft(null_46.InvalidFlags)))  # -> ListA, ListB
dispatch_120 = Dispatch(List=pln_107, DispatchPattern=null_46.InvalidFlags)  # -> ListA, ListB
pln_117 = Plane(dispatch_120.ListB)
pt_97 = Point(dispatch_119.ListB)

merge_63 = Merge(Data1=pln_117, Data2=pln_116)  # -> flatten(Result)
check_same_points_12 = CheckSamePoints(archPoint=flatten(pln_115), crvPoint=merge_63)  # -> out, specialPt; inputs archPoint: list of Point3d, crvPoint: list of Point3d; same code as testpoint

# ----
# 撞到结构
move2pt_24 = MoveToPoint(Geometry=flatten(pln_117), PointA=flatten(pln_117), PointB=flatten(pt_97))  # -> Moved, Vector, Transform
move2pt_25 = MoveToPoint(Geometry=flatten(pln_116), PointA=flatten(pln_116), PointB=flatten(pt_96))  # -> Moved, Vector, Transform

# ----
# pass
cull_i_14 = CullIndex(List=flatten(pln_115), Indices=check_same_points_12.specialPt, Wrap=True)  # -> simplify(graft(List))

# ----
# 撞到梁交点
merge_64 = Merge(Data1=flatten(move2pt_24.Moved), Data2=flatten(move2pt_25.Moved))

merge_65 = Merge(Data1=flatten(move2pt_20.Moved), Data2=flatten(merge_64))

# ---- group: All Location Point
merge_66 = Merge(Data1=merge_31, Data2=merge_35, Data3=merge_65)

# ----
deplane_37 = DeconstructPlane(Plane=merge_65)  # -> Origin, XAxis, YAxis, ZAxis
amp_54 = Amplitude(Vector=deplane_37.YAxis, Amplitude=len_5)
move_62 = Move(Geometry=merge_65, Motion=amp_54)  # -> Geometry, Transform
incurve_9 = PointInCurve(Point=move_62.Geometry, Curve=crv_52)  # -> Relationship, Point
panel_78 = Panel(incurve_9.Relationship)
equals_25 = Equality(FirstNumber=incurve_9.Relationship, SecondNumber="0")  # -> Equality, Inequality
dispatch_121 = Dispatch(List=move_62.Geometry, DispatchPattern=equals_25.Equality)  # -> ListA, ListB
data_79 = Data(dispatch_121.ListA)
data_80 = Data(dispatch_121.ListB)
amp_55 = Amplitude(Vector=deplane_37.YAxis, Amplitude=len_5)
move_63 = Move(Geometry=data_79, Motion=expr("-X", amp_55))  # -> Geometry, Transform
move_64 = Move(Geometry=move_63.Geometry, Motion=expr("-X", amp_55))  # -> Geometry, Transform
merge_67 = Merge(Data1=move_64.Geometry, Data2=data_80)
orient_10 = Orient(Geometry=item_34, Source=item_35, Target=merge_67)  # -> Geometry, Transform

data_81 = Data(orient_10.Geometry)
ungroup_13 = Ungroup(Group=data_81)
item_118 = ListItem(List=ungroup_13, Index=0, Wrap=True)  # -> flatten(Item)
item_119 = ListItem(List=ungroup_13, Index="-1", Wrap=True)  # -> flatten(Item)

# ---- group: 幕墙底部接地埋件 (continued)
entwine_21 = Entwine(Branch00=item_118, Branch01=item_119, FlattenInputs=True)
bake_11 = BakeObjects(Geometry=entwine_21, Attributes=attributes_9, BakeName=panel_52, Bake=False)

# ----
null_47 = NullItem(Item=merge_66)  # -> NullFlags, InvalidFlags, Description
dispatch_122 = Dispatch(List=merge_66, DispatchPattern=null_47.InvalidFlags)  # -> ListA, ListB

# ---- group: 下层图纸-标注定位点
pt_98 = Point(dispatch_122.ListB)

# ----
cluster_5 = Cluster_2(
    outline_curve=标准范围_符合单一轴网方向_2,
    dim_offset_1=number_slider_20,
    dim_offset_2=number_slider_19,
    axis_direction_crv1=crv_14,
    axis_direction_crv2=crv_15,
    f2_arch_outline=crv_58,
    location_point=pt_98,
    dim_style=panel_22,
    directed_outline=seam_2,
    移除重复位置点_容差=number_slider_17)  # -> D_3, D_4, D, D_2
dimension1_2 = Data(cluster_5.D_3)

# ---- group: Dimension2
data_82 = Data(cluster_5.D_4)

# ---- group: Dimension4
data_83 = Data(cluster_5.D_2)

# ---- group: Dimension3
data_84 = Data(cluster_5.D)

# ----
entwine_22 = Entwine(Branch00=dimension1_2, Branch01=data_82, Branch02=data_84, Branch03=data_83, FlattenInputs=True)

# ---- group: Refrash Data
# 将所有Input都输入完后要Refresh data
dam_2 = DataDam(DataA=entwine_22, BufferDelay=10000000, BufferMode=0)

# ----
dedim_2 = DeconstructDimension(DimensionObject=dam_2)  # -> Value, Text, Plane, Points, Style
shift_67 = ShiftPaths(Data=dedim_2.Text, Offset=-1)
smaller_10 = SmallerThan(FirstNumber=shift_67, SecondNumber=Slider(1, range=0..10))  # -> SmallerThan, OrEqualTo
dispatch_123 = Dispatch(List=dam_2, DispatchPattern=smaller_10.SmallerThan)  # -> ListA, ListB

# ---- group: Bake Me
bake_12 = BakeObjects(Geometry=dispatch_123.ListB, Attributes=attributes_12, Bake=False)

# ----
data_85 = Data(dispatch_123.ListB)

crv_127 = Curve(project_11.Geometry)
crv_128 = Curve([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])
merge_68 = Merge(Data1=crv_127, Data2=crv_128)  # -> flatten(Result)

# ----
# curve
crv_129 = Curve(merge_68)

angle = Angle(VectorA=crv_129, VectorB="1,0,0")  # -> Angle, Reflex
deg_5 = Degrees(Radians=angle.Angle)
number = NumberGroups(Number=deg_5, Difference="0.2")  # -> Groups, Indices
item_120 = ListItem(List=crv_129, Index=number.Indices, Wrap=True)  # -> simplify(Item)
panel_79 = Panel(number.Groups)
item_121 = ListItem(List=item_120, Index=0, Wrap=True)  # -> flatten(Item)
item_122 = ListItem(List=item_120, Index=0, Wrap=True)
bang_3 = ExplodeTree(Data=item_120)  # -> Branch0, Branch1, Branch2, Branch3, Branch4, Branch5
crv_130 = Curve(bang_3.Branch0)
crv_131 = Curve(bang_3.Branch1)
crv_132 = Curve(bang_3.Branch2)
crv_133 = Curve(bang_3.Branch3)
angle_2 = Angle(VectorA=item_122, VectorB=item_121)  # -> Angle, Reflex
deg_6 = Degrees(Radians=angle_2.Angle)
round_2 = Round(Number=deg_6, DecimalPlace="0")  # -> Nearest, Floor, Ceiling
equals_26 = Equality(FirstNumber=round_2.Nearest, SecondNumber="90")  # -> Equality, Inequality
panel_80 = Panel(round_2.Nearest)
dispatch_124 = Dispatch(List=item_121, DispatchPattern=equals_26.Equality)  # -> ListA, ListB
crv_134 = Curve(flatten(dispatch_124.ListA))
index = ItemIndex(List=item_121, Item=crv_134)
concat_4 = Concatenate(FragmentA="{", FragmentB=index)
concat_5 = Concatenate(FragmentA=concat_4, FragmentB="}")
tstat_3 = TreeStatistics(Tree=item_120)  # -> Paths, Length, Count
item_123 = ListItem(List=tstat_3.Paths, Index=0, Wrap=True)  # -> Item, Item1
item_124 = ListItem(List=concat_5, Index=0, Wrap=True)
# Sort Text
branch = TreeBranch(Tree=item_120, Path=item_123.Item, MaintainPaths=True)
branch_2 = TreeBranch(Tree=item_120, Path=item_124, MaintainPaths=True)

# ==== cluster Cluster
G = ClusterInput()
rotate = Rotate(Geometry=G, Angle=3.141592654, Plane=PlaneXY(0, 0, 0))  # -> Geometry, Transform
boxprop = BoxProperties(Box=rotate.Geometry)  # -> Center, Diagonal, Area, Volume, Degeneracy
bbox = BoundingBox(Content=rotate.Geometry, Plane=PlaneXY(0, 0, 0))  # -> Box, Box_2
debox = DeconstructBox(Box=bbox.Box)  # -> Plane, X, Y, Z
pdecon = Deconstruct(Point=boxprop.Center)  # -> XComponent, YComponent, ZComponent
dedomain = DeconstructDomain(Domain=debox.Y)  # -> Start, End
pt = ConstructPoint(XCoordinate=pdecon.XComponent, YCoordinate=dedomain.Start, ZCoordinate=pdecon.ZComponent)
xy = XYPlane(Origin=Point(0, 0, 0))
pl_origin = PlaneOrigin(Base=xy, Origin=pt)
orient = Orient(Geometry=rotate.Geometry, Source=pl_origin, Target=xy)  # -> Geometry, Transform
G_2 = ClusterOutput(orient.Geometry)

# ==== cluster Cluster_2
f2_arch_outline = ClusterInput()
directed_outline = ClusterInput()
location_point = ClusterInput()
移除重复位置点_容差 = ClusterInput()
dim_offset_1 = ClusterInput()
dim_offset_2 = ClusterInput()
axis_direction_crv1 = ClusterInput()
axis_direction_crv2 = ClusterInput()
dim_style = ClusterInput()
outline_curve = ClusterInput()
pt = Point(location_point)
merge = Merge(Data1=axis_direction_crv1, Data2=axis_direction_crv2)
crv = Curve(f2_arch_outline)
number_slider = Slider(61, range=0..100)

incurve = PointInCurve(Point=flatten(pt), Curve=outline_curve)  # -> Relationship, Point
equals = Equality(FirstNumber=incurve.Relationship, SecondNumber="0")  # -> Equality, Inequality
dispatch = Dispatch(List=flatten(pt), DispatchPattern=equals.Inequality)  # -> ListA, ListB
pt_2 = Point(dispatch.ListA)
crv_cp = CurveClosestPoint(Point=pt_2, Curve=directed_outline)  # -> Point, Parameter, Distance
sort = SortList(Keys=crv_cp.Parameter, ValuesA=pt_2)  # -> Keys, ValuesA
pt_3 = Point(sort.ValuesA)
item = ListItem(List=merge, Index=0, Wrap=True)  # -> Item, Item1

# ----
# remove重复定位点生成的2个点
pt_4 = Point(pt_3)
shift = ShiftList(List=pt_4, Shift=1, Wrap=invert(True))
pt_5 = Point(pt_3)
pt_6 = Point(shift)
dist = Distance(PointA=pt_5, PointB=pt_6)
larger = LargerThan(FirstNumber=dist, SecondNumber=移除重复位置点_容差)  # -> LargerThan, OrEqualTo
dispatch_2 = Dispatch(List=pt_5, DispatchPattern=larger.LargerThan)  # -> ListA, ListB
pt_7 = Point(dispatch_2.ListA)
pt_8 = Point(dispatch_2.ListB)

dispatch_3 = Dispatch(List=pt_7, DispatchPattern=[True, False])  # -> ListA, ListB
pt_9 = Point(dispatch_3.ListB)
pt_10 = Point(dispatch_3.ListA)
pl = ConstructPlane(Origin=pt_10, XAxis=item.Item1, YAxis=item.Item)
pl_2 = ConstructPlane(Origin=pt_10, XAxis=item.Item, YAxis=item.Item1)

item_2 = ListItem(List=pt_7, Index=number_slider, Wrap=True)
shift_2 = ShiftList(List=pt_7, Shift=1, Wrap=invert(True))
item_3 = ListItem(List=shift_2, Index=number_slider, Wrap=True)

dispatch_4 = Dispatch(List=shift_2, DispatchPattern=[True, False])  # -> ListA, ListB
item_4 = ListItem(List=merge, Index=0, Wrap=True)  # -> Item, Item1
pt_11 = Point(dispatch_4.ListB)
pt_12 = Point(dispatch_4.ListA)
pl_3 = ConstructPlane(Origin=pt_12, XAxis=item_4.Item1, YAxis=item_4.Item)
pl_4 = ConstructPlane(Origin=pt_12, XAxis=item_4.Item, YAxis=item_4.Item1)

ln = Line(StartPoint=pt_10, EndPoint=pt_9)
ln_2 = Line(StartPoint=pt_12, EndPoint=pt_11)

crv_2 = Curve(crv)
deplane = DeconstructPlane(Plane=pl_3)  # -> Origin, XAxis, YAxis, ZAxis
amp = Amplitude(Vector=deplane.YAxis, Amplitude=Slider(3000, range=0..10000))
move = Move(Geometry=deplane.Origin, Motion=amp)  # -> Geometry, Transform
clscrv = CloseCurve(Curve=crv_2, CloseType=0, Bulge=0.5, Tolerance=0)  # -> Closed, R
pt_13 = Point(move.Geometry)
incurve_2 = PointInCurve(Point=pt_13, Curve=clscrv.Closed)  # -> Relationship, Point
equals_2 = Equality(FirstNumber=incurve_2.Relationship, SecondNumber="2")  # -> Equality, Inequality
lng = ListLength(List=equals_2.Equality)
lng_2 = ListLength(List=equals_2.Equality)
neg = Negative(Value=dim_offset_1)
repeat = RepeatData(Data=graft(neg), Length=lng)
repeat_2 = RepeatData(Data=graft(dim_offset_1), Length=lng_2)
panel = Panel(equals_2.Equality)
dispatch_5 = Dispatch(List=graft(repeat_2), DispatchPattern=graft(equals_2.Equality))  # -> ListA, ListB
dispatch_6 = Dispatch(List=graft(repeat), DispatchPattern=graft(equals_2.Equality))  # -> ListA, ListB
merge_2 = Merge(Data1=dispatch_5.ListA, Data2=dispatch_6.ListB)  # -> flatten(Result)

crv_3 = Curve(crv)
deplane_2 = DeconstructPlane(Plane=pl_4)  # -> Origin, XAxis, YAxis, ZAxis
amp_2 = Amplitude(Vector=deplane_2.YAxis, Amplitude=Slider(3000, range=0..10000))
move_2 = Move(Geometry=deplane_2.Origin, Motion=amp_2)  # -> Geometry, Transform
clscrv_2 = CloseCurve(Curve=crv_3, CloseType=0, Bulge=0.5, Tolerance=0)  # -> Closed, R
pt_14 = Point(move_2.Geometry)
incurve_3 = PointInCurve(Point=pt_14, Curve=clscrv_2.Closed)  # -> Relationship, Point
equals_3 = Equality(FirstNumber=incurve_3.Relationship, SecondNumber="2")  # -> Equality, Inequality
lng_3 = ListLength(List=equals_3.Equality)
neg_2 = Negative(Value=dim_offset_1)
lng_4 = ListLength(List=equals_3.Equality)
repeat_3 = RepeatData(Data=graft(neg_2), Length=lng_4)
repeat_4 = RepeatData(Data=graft(dim_offset_1), Length=lng_3)
panel_2 = Panel(equals_3.Equality)
dispatch_7 = Dispatch(List=graft(repeat_4), DispatchPattern=graft(equals_3.Equality))  # -> ListA, ListB
dispatch_8 = Dispatch(List=graft(repeat_3), DispatchPattern=graft(equals_3.Equality))  # -> ListA, ListB
merge_3 = Merge(Data1=dispatch_7.ListA, Data2=dispatch_8.ListB)  # -> flatten(Result)

crv_4 = Curve(crv)
deplane_3 = DeconstructPlane(Plane=pl)  # -> Origin, XAxis, YAxis, ZAxis
amp_3 = Amplitude(Vector=deplane_3.YAxis, Amplitude=Slider(3000, range=0..10000))
move_3 = Move(Geometry=deplane_3.Origin, Motion=amp_3)  # -> Geometry, Transform
clscrv_3 = CloseCurve(Curve=crv_4, CloseType=0, Bulge=0.5, Tolerance=0)  # -> Closed, R
pt_15 = Point(move_3.Geometry)
incurve_4 = PointInCurve(Point=pt_15, Curve=clscrv_3.Closed)  # -> Relationship, Point
equals_4 = Equality(FirstNumber=incurve_4.Relationship, SecondNumber="2")  # -> Equality, Inequality
lng_5 = ListLength(List=equals_4.Equality)
neg_3 = Negative(Value=dim_offset_2)
lng_6 = ListLength(List=equals_4.Equality)
repeat_5 = RepeatData(Data=graft(neg_3), Length=lng_6)
repeat_6 = RepeatData(Data=graft(dim_offset_2), Length=lng_5)
panel_3 = Panel(equals_4.Equality)
dispatch_9 = Dispatch(List=graft(repeat_6), DispatchPattern=graft(equals_4.Equality))  # -> ListA, ListB
dispatch_10 = Dispatch(List=graft(repeat_5), DispatchPattern=graft(equals_4.Equality))  # -> ListA, ListB
merge_4 = Merge(Data1=dispatch_9.ListA, Data2=dispatch_10.ListB)  # -> flatten(Result)

crv_5 = Curve(crv)
deplane_4 = DeconstructPlane(Plane=pl_2)  # -> Origin, XAxis, YAxis, ZAxis
amp_4 = Amplitude(Vector=deplane_4.YAxis, Amplitude=Slider(3000, range=0..10000))
move_4 = Move(Geometry=deplane_4.Origin, Motion=amp_4)  # -> Geometry, Transform
clscrv_4 = CloseCurve(Curve=crv_5, CloseType=0, Bulge=0.5, Tolerance=0)  # -> Closed, R
pt_16 = Point(move_4.Geometry)
incurve_5 = PointInCurve(Point=pt_16, Curve=clscrv_4.Closed)  # -> Relationship, Point
equals_5 = Equality(FirstNumber=incurve_5.Relationship, SecondNumber="2")  # -> Equality, Inequality
lng_7 = ListLength(List=equals_5.Equality)
neg_4 = Negative(Value=dim_offset_2)
lng_8 = ListLength(List=equals_5.Equality)
repeat_7 = RepeatData(Data=graft(neg_4), Length=lng_8)
repeat_8 = RepeatData(Data=graft(dim_offset_2), Length=lng_7)
panel_4 = Panel(equals_5.Equality)
dispatch_11 = Dispatch(List=graft(repeat_8), DispatchPattern=graft(equals_5.Equality))  # -> ListA, ListB
dispatch_12 = Dispatch(List=graft(repeat_7), DispatchPattern=graft(equals_5.Equality))  # -> ListA, ListB
merge_5 = Merge(Data1=dispatch_11.ListA, Data2=dispatch_12.ListB)  # -> flatten(Result)

lineardim = DefineLinearDimension(
    Point1=simplify(pt_12),
    Point2=simplify(pt_11),
    DimensionPlane=simplify(pl_3),
    Offset=expr("-x", merge_2),
    DimensionStyle=dim_style)
lineardim_2 = DefineLinearDimension(
    Point1=simplify(pt_12),
    Point2=simplify(pt_11),
    DimensionPlane=simplify(pl_4),
    Offset=expr("-x", merge_3),
    DimensionStyle=dim_style)
lineardim_3 = DefineLinearDimension(
    Point1=simplify(pt_10),
    Point2=simplify(pt_9),
    DimensionPlane=simplify(pl),
    Offset=expr("-x", merge_4),
    DimensionStyle=dim_style)
lineardim_4 = DefineLinearDimension(
    Point1=simplify(pt_10),
    Point2=simplify(pt_9),
    DimensionPlane=simplify(pl_2),
    Offset=expr("-x", merge_5),
    DimensionStyle=dim_style)
D = ClusterOutput(lineardim)
D_2 = ClusterOutput(lineardim_2)
D_3 = ClusterOutput(lineardim_3)
D_4 = ClusterOutput(lineardim_4)

# ==== cluster Cluster_3
structure_number = ClusterInput()
tag_text = ClusterInput()
text_offset = ClusterInput()
embed_color = ClusterInput()
T = ClusterInput()
G = ClusterInput()
A = ClusterInput()
A_2 = ClusterInput()
B = ClusterInput()
dimension_style = ClusterInput()

# ----
# 列表文字以空格进行分割
panel = Panel(" ")
split = TextSplit(Text=T, Separators=panel)

钢埋板长度_2 = Division(A=A, B=2)
neg = Negative(Value=钢埋板长度_2)
dom = ConstructDomain(DomainStart=neg, DomainEnd=钢埋板长度_2)
panel_2 = Panel(dom)

钢埋板厚度_2 = Division(A=A_2, B=2)
neg_2 = Negative(Value=钢埋板厚度_2)
dom_2 = ConstructDomain(DomainStart=neg_2, DomainEnd=钢埋板厚度_2)
panel_3 = Panel(dom_2)

# ----
# 钢埋板肋板位置 1/4处
panel_4 = Panel("4")
division = Division(A=A, B=panel_4)

# ----
# 编号和截面尺寸分区
panel_5 = Panel("1")
split_2 = SplitList(List=split, Index=panel_5)  # -> flatten(ListA), flatten(ListB)

# ----
# 求出对应输入编号的钢结构截面尺寸
fsim = FindSimilarMember(Data=structure_number, Set=split_2.ListA)  # -> Hit, Index
item = ListItem(List=split_2.ListB, Index=fsim.Index, Wrap=True)

addition = Addition(A=neg_2, B=division)
addition_2 = Addition(A=钢埋板厚度_2, B=division)
dom_3 = ConstructDomain(DomainStart=addition, DomainEnd=addition_2)
panel_6 = Panel(split_2.ListB)
split_3 = TextSplit(Text=item, Separators="x")
split_4 = TextSplit(Text=split_3, Separators="Q")
item_2 = ListItem(List=split_4, Index="0", Wrap=True)  # -> flatten(Item)
subtraction = Subtraction(A=division, B=钢埋板厚度_2)
subtraction_2 = Subtraction(A=division, B=钢埋板厚度_2)
subtraction_3 = Subtraction(A=division, B=钢埋板厚度_2)
neg_3 = Negative(Value=钢埋板厚度_2)
neg_4 = Negative(Value=钢埋板厚度_2)
neg_5 = Negative(Value=钢埋板厚度_2)
subtraction_4 = Subtraction(A=division, B=钢埋板厚度_2)
addition_3 = Addition(A=subtraction, B=A_2)
addition_4 = Addition(A=subtraction_2, B=A_2)
subtraction_5 = Subtraction(A=neg_3, B=A_2)
subtraction_6 = Subtraction(A=neg_4, B="2")
subtraction_7 = Subtraction(A=division, B=钢埋板厚度_2)
addition_5 = Addition(A=subtraction_3, B="2")
subtraction_8 = Subtraction(A=neg_5, B="2")
neg_6 = Negative(Value=钢埋板厚度_2)
neg_7 = Negative(Value=钢埋板厚度_2)
工字钢_h = ListItem(List=item_2, Index=0, Wrap=True)
工字钢_b = ListItem(List=item_2, Index=1, Wrap=True)
工字钢_tf = ListItem(List=item_2, Index=3, Wrap=True)
工字钢_tw = ListItem(List=item_2, Index=2, Wrap=True)
pt = ConstructPoint(XCoordinate=neg_6, YCoordinate=subtraction_4, ZCoordinate=0)
pt_2 = ConstructPoint(XCoordinate=neg_7, YCoordinate=addition_3, ZCoordinate=0)
pt_3 = ConstructPoint(XCoordinate=subtraction_5, YCoordinate=addition_4, ZCoordinate=0)
pt_4 = ConstructPoint(XCoordinate=subtraction_6, YCoordinate=subtraction_7, ZCoordinate=0)
pt_5 = ConstructPoint(XCoordinate=subtraction_8, YCoordinate=addition_5, ZCoordinate=0)
subtraction_9 = Subtraction(A=工字钢_b, B=工字钢_tw)
division_2 = Division(A=subtraction_9, B="2")
merge = Merge(Data1=pt, Data2=pt_2, Data3=pt_3, Data4=pt_5, Data5=pt_4)
pline = PolyLine(Vertices=merge, Closed=True)
division_3 = Division(A=division_2, B="2")
subtraction_10 = Subtraction(A=division_3, B=A_2)
subtraction_11 = Subtraction(A=division_3, B=钢埋板厚度_2)
neg_8 = Negative(Value=division_3)
subtraction_12 = Subtraction(A=neg_8, B=subtraction_11)
addition_6 = Addition(A=subtraction_12, B=B)
dom_4 = ConstructDomain(DomainStart=addition_6, DomainEnd=subtraction_12)
dom_5 = ConstructDomain(DomainStart=addition, DomainEnd=addition_2)
钢肋板倒角_侧视图 = Rectangle(Plane=PlaneXY(0, 0, 0), XSize=dom_4, YSize=dom_5, Radius=0)  # -> Rectangle, Length
subtraction_13 = Subtraction(A=subtraction_10, B=subtraction_11)
subtraction_14 = Subtraction(A=neg_8, B=subtraction_11)
dom_6 = ConstructDomain(DomainStart=subtraction_13, DomainEnd=subtraction_14)
钢肋板_侧视图 = Rectangle(Plane=PlaneXY(0, 0, 0), XSize=dom_6, YSize=dom_3, Radius=0)  # -> Rectangle, Length
merge_2 = Merge(Data1=钢肋板_侧视图.Rectangle, Data2=pline, Data3=钢肋板倒角_侧视图.Rectangle)
xz = XZPlane(Origin=Point(0, 0, 0))
mirror = Mirror(Geometry=merge_2, Plane=xz)  # -> Geometry, Transform
钢埋板_侧视图 = Rectangle(Plane=PlaneXY(0, 0, 0), XSize=dom_2, YSize=dom, Radius=0)  # -> Rectangle, Length
division_4 = Division(A=工字钢_b, B=2)
侧视图 = Entwine(Branch00=钢埋板_侧视图.Rectangle, Branch01=merge_2, Branch02=mirror.Geometry, FlattenInputs=True)
R = ClusterOutput(division_4)
division_5 = Division(A=工字钢_h, B="2")
subtraction_15 = Subtraction(A=division_5, B=工字钢_tf)
addition_7 = Addition(A=subtraction_15, B=Slider(200, range=0..1000))
addition_8 = Addition(A=addition_7, B=division_2)
X = UnitX(Factor=addition_8)
move = Move(Geometry=侧视图, Motion=X)  # -> Geometry, Transform
split_tree = SplitTree(Data=move.Geometry, Masks=flatten("{0;0}"))  # -> Positive, Negative
dispatch = Dispatch(List=split_tree.Negative, DispatchPattern=[True, False])  # -> flatten(ListA), ListB
merge_3 = Merge(Data1=split_tree.Positive, Data2=dispatch.ListA)
entwine = Entwine(Branch00=merge_3, Branch01=dispatch.ListB, FlattenInputs=True)
flatten = FlattenTree(Tree=entwine, Path="{0}")
group = Group(Objects=flatten)
rotate = Rotate(Geometry=group, Angle=3.141592654, Plane=PlaneXY(0, 0, 0))  # -> Geometry, Transform
boxprop = BoxProperties(Box=rotate.Geometry)  # -> Center, Diagonal, Area, Volume, Degeneracy
bbox = BoundingBox(Content=rotate.Geometry, Plane=PlaneXY(0, 0, 0))  # -> Box, Box_2
debox = DeconstructBox(Box=bbox.Box)  # -> Plane, X, Y, Z
pdecon = Deconstruct(Point=boxprop.Center)  # -> XComponent, YComponent, ZComponent
dedomain = DeconstructDomain(Domain=debox.Y)  # -> Start, End
pt_6 = ConstructPoint(XCoordinate=pdecon.XComponent, YCoordinate=dedomain.Start, ZCoordinate=pdecon.ZComponent)
xy = XYPlane(Origin=Point(0, 0, 0))
concat = Concatenate(FragmentA="Embed", FragmentB=tag_text)
pl_origin = PlaneOrigin(Base=xy, Origin=pt_6)
orient = Orient(Geometry=rotate.Geometry, Source=pl_origin, Target=xy)  # -> Geometry, Transform
xy_2 = XYPlane(Origin=Point(0, 0, 0))
attributes = DefineObjectAttributes(Color=embed_color)
ungroup = Ungroup(Group=orient.Geometry)
block = DefineBlock(Geometry=ungroup, Attributes=attributes, BlockName=concat, BasePlane=PlaneXY(0, 0, 0))
deblock = DeconstructBlock(Block=block)  # -> Name, flatten(Plane), flatten(Geometry)
group_2 = Group(Objects=deblock.Geometry)
bbox_2 = BoundingBox(Content=group_2, Plane=PlaneXY(0, 0, 0))  # -> Box, Box_2
deplane = DeconstructPlane(Plane=deblock.Plane)  # -> Origin, XAxis, YAxis, ZAxis
area = Area(Geometry=bbox_2.Box)  # -> Area, Centroid
move2pt = MoveToPoint(Geometry=flatten(deplane.Origin), PointA=flatten(deplane.Origin), PointB=flatten(area.Centroid))  # -> Moved, Vector, Transform
pl = ConstructPlane(Origin=move2pt.Moved, XAxis=deplane.YAxis, YAxis=deplane.XAxis)  # -> graft(Plane)
deplane_2 = DeconstructPlane(Plane=pl)  # -> Origin, XAxis, YAxis, ZAxis
rotate_2 = Rotate(Geometry=pl, Angle="Pi", Plane=pl)  # -> Geometry, Transform
dedomain_2 = DeconstructDomain(Domain=dom)  # -> Start, End
multiplication = Multiplication(A=dedomain_2.Start, B=dedomain_2.Start)
amp = Amplitude(Vector=deplane_2.YAxis, Amplitude=multiplication)
move_2 = Move(Geometry=deplane_2.Origin, Motion=amp)  # -> Geometry, Transform
srf = Surface(bbox_2.Box)
crv = Curve(srf)
ln = Line(StartPoint=move_2.Geometry, EndPoint=deplane_2.Origin)
ccx = CurveCurve(CurveA=ln, CurveB=crv)  # -> Points, ParamsA, ParamsB
ln_2 = Line(StartPoint=deplane_2.Origin, EndPoint=ccx.Points)
move_3 = Move(Geometry=rotate_2.Geometry, Motion=ln_2)  # -> Geometry, Transform

ln_3 = Line(StartPoint=ccx.Points, EndPoint=deplane_2.Origin)
amp_2 = Amplitude(Vector=ln_3, Amplitude=text_offset)
move_4 = Move(Geometry=rotate_2.Geometry, Motion=amp_2)  # -> Geometry, Transform
text = DefineTextObject(Text=tag_text, Plane=move_4.Geometry, DimensionStyle=dimension_style, OutputType="Text")
group_3 = Group(Objects=[block, text])

entwine_2 = Entwine(Branch00=group_3, Branch01=move_3.Geometry, FlattenInputs=True)
project = Project(Geometry=G, Plane=xy_2)  # -> Geometry, Transform
R_2 = ClusterOutput(entwine_2)
G_2 = ClusterOutput(project.Geometry)
