# Grasshopper definition FacadeEmbed_JinQiao_Podium1123.gh (Grasshopper 1.0.7)
# plug-ins: EleFront, TT Toolbox, Pufferfish, Hare, treesloth01

# ----
# 线段延长长度
number_slider = Slider(1001, range=0..10000)  # disabled

# ----
# remove duplicate curves
geo = Geometry()  # disabled
number_slider_2 = Slider(0.1, range=0..0.1)  # disabled
boundary = BoundarySurfaces(Edges=geo)  # disabled
area = Area(Geometry=boundary)  # -> Area, Centroid; disabled
cullduppoints = RemoveDuplicatePoints(InputPoints=area.Centroid, Tolerance=number_slider_2)  # -> OutputPoints, FirstPointIndexes; disabled
null = NullItem(Item=cullduppoints.FirstPointIndexes)  # -> NullFlags, InvalidFlags, Description; disabled
dispatch = Dispatch(List=boundary, DispatchPattern=null.NullFlags)  # -> ListA, ListB; disabled
geo_2 = Geometry(dispatch.ListA)  # disabled

# ----
# 调换阴阳角设定
toggle = BooleanToggle(False)  # disabled

# ---- group: 下层定位点颜色
panel = Panel("Magenta")

# ---- group: 檐口定位点颜色
panel_2 = Panel("Cyan")

# ---- group: 上层定位点颜色
panel_3 = Panel("Yellow")

# ----
# (1) 导入代表埋件定位点的circle
# 注意：
# 1.请将上下两层的定位点所对应的circle分别放在2个不同Rhino图层
# 2.导入完之后可能需要都点一下Update
refcol = ReferenceByColor(Color=panel)
area_2 = Area(Geometry=refcol)  # -> Area, Centroid
refcol_2 = ReferenceByColor(Color=panel_3)
area_3 = Area(Geometry=refcol_2)  # -> Area, Centroid
refcol_3 = ReferenceByColor(Color=panel_2)
null_2 = NullItem(Item=area_2.Area)  # -> NullFlags, InvalidFlags, Description
area_4 = Area(Geometry=refcol_3)  # -> Area, Centroid
null_3 = NullItem(Item=area_3.Area)  # -> NullFlags, InvalidFlags, Description
dispatch_2 = Dispatch(List=refcol, DispatchPattern=null_2.NullFlags)  # -> ListA, ListB
null_4 = NullItem(Item=area_4.Area)  # -> NullFlags, InvalidFlags, Description
dispatch_3 = Dispatch(List=refcol_2, DispatchPattern=null_3.NullFlags)  # -> ListA, ListB
dispatch_4 = Dispatch(List=refcol_3, DispatchPattern=null_4.NullFlags)  # -> ListA, ListB
data = Data(dispatch_2.ListB)
data_2 = Data(dispatch_3.ListB)
data_3 = Data(dispatch_4.ListB)

# ----
# Step1.输入block names
# Step2:点击Update按钮
data_4 = Data(["PX-GLAZ-F2$0$PX-GLAZ-F2$0$fin", "PX-GLAZ-F2$0$PX-GLAZ-F1$0$fin"])
panel_4 = Panel(data_4)
# （1）导入埋件定位点
panel_5 = Panel("")
refblock = ReferenceBlockByName(BlockName=panel_4)

# ----
# Input Curves
# 
# Step1：选中其中一个curve,得到该图层所有curves
# Step2：点击Update按钮
crv = Curve(<curve referenced from the Rhino model>)

# ----
# (Block & Curve的形式)
# Input Blocks (Plane的Y轴向外)
# 
# Step1.输入Block所在图层
# Step2:点击Update按钮
data_5 = Data(["PX-GLAZ-F2$0$PX-GLAZ-F1$0$标准块", "PX-GLAZ-F2$0$PX-GLAZ-F2$0$标准块", "PX-GLAZ-F2$0$PX-GLAZ-F3$0$标准块"])

# ----
# block names
listblockd = ListBlockDocument()

# ----
# Input Blocks (Plane的Y轴向内)
# 
# Step1:输入Block所在图层
# Step2:点击Update按钮
data_6 = Data("PX-GLAZ-F2$0$T3T")

# ---- group: 楼板线
# （2）导入单体建筑的参考线
# 导入上层幕墙线
crv_2 = Curve(<curve referenced from the Rhino model>)

# ---- group: 檐口线-外侧
crv_3 = Curve(<curve referenced from the Rhino model>)

# ---- group: 檐口线-内侧
crv_4 = Curve([<curve referenced from the Rhino model> x2])

# ---- group: 下层All幕墙线
# 导入檐口线
# 注意：如果没有檐口线或没有内测檐口线，一定要确保对应需要导入檐口线curve的区域为空data
crv_5 = Curve([<curve referenced from the Rhino model> x3])

# ---- group: 檐口定位点
circle = Curve(<curve referenced from the Rhino model>)

# ---- group: 导入下层单体幕墙线
# 导入下层幕墙线
crv_6 = Curve(<curve referenced from the Rhino model>)

# ---- group: 下层定位点的circle
circle_2 = Curve(<curve referenced from the Rhino model>)

# ---- group: 上层定位点的circle
circle_3 = Curve(<curve referenced from the Rhino model>)

# ----
# 输入
# 
# Embed的Tag命名
# 埋件编号
panel_6 = Panel("5-5")

# ----
# 长
panel_7 = Panel("-175 To 175")

# ---- group: 导入上层单体幕墙线
crv_7 = Curve(<curve referenced from the Rhino model>)

# ----
# 宽
panel_8 = Panel("-125 To 125")

# ----
# 输入标注样式
panel_9 = Panel("图例2-地上$0$XD100$0")

# ---- group: 导入上层All-外部幕墙线
crv_8 = Curve([<curve referenced from the Rhino model> x3])

# ---- group: 上层-内部幕墙线
crv_9 = Curve(<curve referenced from the Rhino model>)

# ----
# 埋件编号tag的Offset - 所有钢埋件
number_slider_3 = Slider(190, range=0..1000)

# ----
# 钢埋板长度（按需设定）
number_slider_4 = Slider(350, range=0..1000)

# ----
# 钢埋板厚度（按需设定）
number_slider_5 = Slider(16, range=0..100)

# ----
# 肋板倒角距离（按需设定）
number_slider_6 = Slider(30, range=0..100)

# ----
# Dimension Style
panel_10 = Panel("图例2-地上$0$XD100$0")

# ----
# （5）导入Default Embed
# 输入
# 
# 1.Embed的结构编号
# 2.Embed的Tag命名
# 需要出图的钢结构编号
panel_11 = Panel("GL3-3H")

# ----
# Embed Layer Color
swatch = ColourSwatch(SwatchColor=RGB(136, 235, 148))

# ----
# (8) 撞到梁交点-Offset
number_slider_7 = Slider(450, range=0..1000)

# ----
# 钢结构截面列表
txt = Text(["GKL4-1\tH 400x250x16x20", "GKL4-2\tH 400x350x12x30", "GKL4-3\tH 400x350x16x35", "GKL5-1\tH 500x200x14x25", "GKL5-2\tH 500x300x14x20", "GKL5a-1\tH 550x250x12x25", "GKL6-1\tH 600x200x12x18", "GKL6-2\tH 600x300x14x20", "GKL6-3\tH 600x350x12x25", "GKL6-4\tH 600x350x16x35", "GKL7-1\tH 700x300x16x25", "GKL7-2\tH 700x350x14x25", "GKL7-3\tH 700x350x14x30", "GKL7-4\tH 700x350x14x35", "GKL8-1\tH 800x300x20x25", "GKL8-2\tH 800x300x20x40", "GKL8-3\tH 800x400x25x30", "GKL8-4\tH 800x400x25x35", "GKL9-1\tH 900x300x20x30", "GKL9-2\tH 900x400x20x40", "GKL9-3\tH 900x500x20x40", "GKL9-4\tH 900x300x20x40", "GKL10-1\tH 1000x500x20x30", "GKL10-2\tH 1000x500x20x40", "GKL10-3\tH 1000x500x20x35", "GKL10-4\tH 1000x600x20x40", "GKL12-1\tH 1200x400x20x50", "GKL12-2\tH 1200x600x25x50", "GL2A-1\tHN 250x125x6x9", "GL3-1\tHN 300x150x6.5x9", "GL3-2\tH 300x100x8x10", "GL3-3\tH 300x200x8x16", "GL3-4\tHW 300x300x10x15", "GL4-1\tHN 400x200x8x13", "GL4-2\tH 400x200x10x16", "GL4-3\tH 400x250x10x20", "GL4-4\tH 400x350x16x35", "GL4a-1\tH 450x200x9x14", "GL5-1\tHN 500x200x10x16", "GL5-2\tH 500x200x10x20", "GL5-3\tH 500x300x14x20", "GL5a-1\tH 550x250x10x25", "GL5a-2\tH 550x300x14x25", "GL6-1\tHN 600x200x11x17", "GL6-2\tH 600x300x12x20", "GL6-3\tH 600x350x12x25", "GL6-4\tH 600x350x16x35", "GL7-1\tHN 700x300x13x24", "GL7-2\tH 700x350x14x30", "GL7-3\tH 700x350x14x35", "GL8-1\tHN 800x300x14x26", "GL8-2\tH 800x300x20x40", "GL9-1\tH 900x300x20x30", "GL9-2\tH 900x400x20x40", "GL10-1\tH 1000x400x20x30", "GL10-2\tH 1000x500x20x30", "GL10-3\tH 1000x500x20x35", "GL10-4\tH 1000x400x20x40", "GL10-5\tH 1000x500x20x40", "GL12-1\tH 1200x400x25x50"])

# ----
# 钢埋板长度（按需设定）
number_slider_8 = Slider(350, range=0..1000)

# ----
# 钢埋板厚度（按需设定）
number_slider_9 = Slider(16, range=0..100)

# ----
# 肋板倒角距离（按需设定）
number_slider_10 = Slider(30, range=0..100)

# ----
# 埋件编号tag
panel_12 = Panel("0-0")

# ----
# 钢结构截面列表
txt_2 = Text(txt)

# ----
# Dimension Style
panel_13 = Panel("图例2-地上$0$XD100$0")

# ----
# 埋件编号tag
panel_14 = Panel("6-6")

# ---- group: 输入梁编号Texts所在图层
panel_15 = Panel("text-def")

# ----
# 埋件编号tag的Offset
number_slider_11 = Slider(353, range=0..1000)

# ---- group: 混凝土
# 板埋几何INPUT
list = ValueList({"C15": 0, "C20": 1, "C25": 2, "C30": 3, "C35": 4, "C40": 5}, selected="C35")

# ---- group: 钢筋牌号
list_2 = ValueList({"HPB300": 0, "HRB400": 1}, selected="HPB300")

# ---- group: 直径
list_3 = ValueList({"10": 0, "12": 1, "16": 2, "18": 3, "20": 4, "25": 5}, selected="12")

# ---- group: 列
list_4 = ValueList({"2X": 0, "3X": 1, "4X": 2}, selected="3X")

# ---- group: 行
# （7）生成底埋钢埋件
list_5 = ValueList({"2Y": 0, "3Y": 1, "4Y": 2}, selected="2Y")

# ---- group: 导入一条梁中线
# （4）导入梁中线+结构编号，生成对应的钢板焊埋件
crv_10 = Curve(<curve referenced from the Rhino model>)

# ---- group: 锚筋间距
s_y = Slider(22, range=14..60, expression="X*5")
s_x = Slider(22, range=14..60, expression="X*5")

# ----
# 手动输入埋件Tag
panel_16 = Panel("""1-1
2-2""")

layer = ObjectLayer(Guid=circle_2)  # -> LayerIndex, LayerPathName

# ---- group: 参考线起点
number_slider_12 = Slider(0.806, range=0..1)

# ---- group: Dimension Offset Input 2
number_slider_13 = Slider(1000, range=0..1000)

# ---- group: 移除重复位置点-容差
number_slider_14 = Slider(200, range=0..1000)

# ---- group: Dimension Offset Input 1
number_slider_15 = Slider(2000, range=0..10000)

# ---- group: 标注区域-单一轴网
标准范围_符合单一轴网方向 = Curve(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)

# ---- group: 轴网XY2个方向的线
crv_11 = Curve(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)
crv_12 = Curve(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)

# ---- group: 参考线: 符合轴网方向+囊括整个建筑
# (9)Bake Me!!
# 下层图纸-单一区域
crv_13 = Curve(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)

# ----
layer_2 = ObjectLayer(Guid=circle_3)  # -> LayerIndex, LayerPathName

# ---- group: 移除重复位置点-容差
number_slider_16 = Slider(200, range=0..1000)

# ----
layer_3 = ObjectLayer(Guid=circle)  # -> LayerIndex, LayerPathName
reflay = ReferenceByLayer(LayerName=layer_3.LayerPathName)

# ---- group: 参考线起点
number_slider_17 = Slider(0.548, range=0..1)

# ---- group: Dimension Offset Input 2
number_slider_18 = Slider(1000, range=0..1000)

# ---- group: Dimension Offset Input 1
number_slider_19 = Slider(2000, range=0..10000)

# ---- group: 标注区域-单一轴网
标准范围_符合单一轴网方向_2 = Curve(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)

# ---- group: 轴网XY2个方向的线
crv_14 = Curve(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)
crv_15 = Curve(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)

# ----
layer_4 = ObjectLayer(Guid=crv)  # -> LayerIndex, LayerPathName
panel_17 = Panel(data_5)
panel_19 = Panel(layer_4.LayerPathName)
panel_20 = Panel(data_6)
refblock_2 = ReferenceBlockByName(BlockName=panel_17)
refblock_3 = ReferenceBlockByName(BlockName=panel_20)
reflay_2 = ReferenceByLayer(LayerName=panel_19)

# ---- group: 参考线: 符合轴网方向+囊括整个建筑
# (9)Bake Me!!
# 上层图纸-单一区域
crv_16 = Curve(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)

# ----
# 导入梁中线+结构编号
# 注意：
# 导入完之后可能要点一下Update确保导入成功
layer_5 = ObjectLayer(Guid=crv_10)  # -> LayerIndex, LayerPathName
reflay_3 = ReferenceByLayer(LayerName=layer_5.LayerPathName)
reflay_4 = ReferenceByLayer(LayerName=panel_15)

# ---- group: Click Me after Input
reflay_5 = ReferenceByLayer(LayerName=layer.LayerPathName)

# ----
clscrv = CloseCurve(Curve=crv_7, CloseType=0, Bulge=0.5, Tolerance=0)  # -> Closed, R

# ---- group: Click Me after Input
reflay_6 = ReferenceByLayer(LayerName=layer_2.LayerPathName)

# ----
panel_21 = Panel(txt)

clscrv_2 = CloseCurve(Curve=crv_6, CloseType=0, Bulge=0.5, Tolerance=0)  # -> Closed, R

panel_22 = Panel(txt_2)

clscrv_3 = CloseCurve(Curve=crv_2, CloseType=0, Bulge=0.5, Tolerance=0)  # -> Closed, R

# ----
# （0）准备阶段
# 检测各个图层Block的Plane
panel_23 = Panel(listblockd)
deblock = DeconstructBlock(Block=refblock)  # -> Name, Plane, Geometry

# ----
# Step3.检测plane是否存在+查看Plane的Y轴方向
pln = Plane(deblock.Plane)

deblock_2 = DeconstructBlock(Block=refblock_3)  # -> Name, Plane, Geometry
deblock_3 = DeconstructBlock(Block=refblock_2)  # -> Name, Plane, Geometry

# ----
# Step4.如果不存在则Blake geometry
# 并在rhino里面清理线段
geo_3 = Geometry(deblock.Geometry)

# ---- group: the Dimension Reference Curve
seam = Seam(Curve=reparameterize(crv_13), Seam=number_slider_12)

# ---- group: The Start Point of the Dimension Reference Curve
eval = EvaluateCurve(Curve=reparameterize(crv_13), Parameter=number_slider_12)  # -> Point, Tangent, Angle

# ---- group: Dimension Style
panel_24 = Panel("图例2-地上$0$XD100$0")

# ---- group: The Start Point of the Dimension Reference Curve
eval_2 = EvaluateCurve(Curve=reparameterize(crv_16), Parameter=number_slider_17)  # -> Point, Tangent, Angle

# ---- group: the Dimension Reference Curve
seam_2 = Seam(Curve=reparameterize(crv_16), Seam=number_slider_17)

# ---- group: Dimension Style
panel_25 = Panel("图例2-地上$0$XD100$0")

# ----
xy = XYPlane(Origin=Point(0, 0, 0))
xy_2 = XYPlane(Origin=Point(0, 0, 0))
xy_3 = XYPlane(Origin=Point(0, 0, 0))
xy_4 = XYPlane(Origin=Point(0, 0, 0))
xy_5 = XYPlane(Origin=Point(0, 0, 0))
xy_6 = XYPlane(Origin=Point(0, 0, 0))
xy_7 = XYPlane(Origin=Point(0, 0, 0))
xy_8 = XYPlane(Origin=Point(0, 0, 0))
xy_9 = XYPlane(Origin=Point(0, 0, 0))
project = Project(Geometry=clscrv_3.Closed, Plane=xy_7)  # -> Geometry, Transform
project_2 = Project(Geometry=clscrv.Closed, Plane=xy_4)  # -> Geometry, Transform
project_3 = Project(Geometry=crv_3, Plane=xy_5)  # -> Geometry, Transform
project_4 = Project(Geometry=clscrv_2.Closed, Plane=xy_6)  # -> Geometry, Transform
project_5 = Project(Geometry=crv_8, Plane=xy_9)  # -> Geometry, Transform
project_6 = Project(Geometry=crv_5, Plane=xy_8)  # -> Geometry, Transform

# ---- group: All-下-幕墙线
crv_17 = Curve(project_6.Geometry)

# ----
crv_18 = Curve(project_2.Geometry)
crv_19 = Curve(project_4.Geometry)
crv_20 = Curve(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)
crv_21 = Curve(project_3.Geometry)

# ---- group: All-上-幕墙线
crv_22 = Curve(project_5.Geometry)

# ----
merge = Merge(Data1=crv_3, Data2=crv_4)
merge_2 = Merge(Data1=crv_8, Data2=crv_9)
merge_3 = Merge(Data1=crv_3, Data2=crv_4)
project_7 = Project(Geometry=refblock_2, Plane=xy)  # -> Geometry, Transform
project_8 = Project(Geometry=refblock_3, Plane=xy_2)  # -> Geometry, Transform
project_9 = Project(Geometry=reflay_2, Plane=xy_3)  # -> Geometry, Transform

# ---- group: Smoothed Curve-Site
crv_23 = Curve(crv_17)

# ---- group: Boundary Curve-Site
clscrv_4 = CloseCurve(Curve=crv_17, CloseType=0, Bulge=0.5, Tolerance=0)  # -> Closed, R

# ---- group: 制作上层定位平面 / Smoothed Curve-Site
crv_24 = Curve(crv_22)

# ---- group: 制作上层定位平面 / Boundary Curve-Site
clscrv_5 = CloseCurve(Curve=merge_2, CloseType=0, Bulge=0.5, Tolerance=0)  # -> Closed, R

# ---- group: 制作上层定位平面 / Smoothed Curve-Site
crv_25 = Curve(merge)

# ---- group: 制作上层定位平面 / Boundary Curve-Site
clscrv_6 = CloseCurve(Curve=merge_3, CloseType=0, Bulge=0.5, Tolerance=0)  # -> Closed, R

# ----
cluster = Cluster_3(
    structure_number=panel_11,
    tag_text=panel_12,
    text_offset=number_slider_3,
    embed_color=swatch,
    T=txt,
    A=number_slider_4,
    A_2=number_slider_5,
    B=number_slider_6,
    dimension_style=panel_10)  # -> R, G_2, R_2
data_7 = Data(flatten(cluster.R_2))
item = ListItem(List=data_7, Index=0, Wrap=True)  # -> Item, Item1
ungroup = Ungroup(Group=item.Item)
item_2 = ListItem(List=ungroup, Index=0, Wrap=True)
bbox = BoundingBox(Content=item_2, Plane=PlaneXY(0, 0, 0))  # -> Box, Box_2
debrep = DeconstructBrep(Brep=bbox.Box)  # -> Faces, Edges, Vertices
len = Length(Curve=debrep.Edges)
sort = SortList(Keys=len, ValuesA=debrep.Edges)  # -> Keys, ValuesA
pln_2 = Plane(item.Item1)
item_3 = ListItem(List=sort.ValuesA, Index=0, Wrap=True)
deplane = DeconstructPlane(Plane=pln_2)  # -> Origin, XAxis, YAxis, ZAxis
amp = Amplitude(Vector=deplane.YAxis, Amplitude=item_3)
move = Move(Geometry=deplane.Origin, Motion=amp)  # -> Geometry, Transform
move2pt = MoveToPoint(Geometry=pln_2, PointA=deplane.Origin, PointB=move.Geometry)  # -> Moved, Vector, Transform
merge_4 = Merge(Data1=item.Item, Data2=move2pt.Moved)

# ----
# 生成下层定位平面
disc = Discontinuity(Curve=graft(crv_23), Level=1)  # -> Points, Parameters
crv_cp = CurveClosestPoint(Point=disc.Points, Curve=graft(crv_23))  # -> Point, Parameter, Distance
eval_3 = EvaluateCurve(Curve=graft(crv_23), Parameter=crv_cp.Parameter)  # -> flatten(Point), Tangent, flatten(Angle)
deg = Degrees(Radians=eval_3.Angle)
offset = OffsetCurve(Curve=clscrv_4.Closed, Distance=expr("-X", Slider(300, range=0..1000)), Corners=1)
larger = LargerThan(FirstNumber=deg, SecondNumber=Slider(70, range=0..100))  # -> LargerThan, OrEqualTo
disc_2 = Discontinuity(Curve=offset, Level=1)  # -> flatten(Points), Parameters
dispatch_5 = Dispatch(List=deg, DispatchPattern=larger.LargerThan)  # -> ListA, ListB
dispatch_6 = Dispatch(List=eval_3.Point, DispatchPattern=larger.LargerThan)  # -> ListA, ListB
data_8 = Data(dispatch_6.ListA)
smaller = SmallerThan(FirstNumber=dispatch_5.ListA, SecondNumber=Slider(100, range=0..100))  # -> SmallerThan, OrEqualTo
dispatch_7 = Dispatch(List=data_8, DispatchPattern=smaller.SmallerThan)  # -> ListA, ListB
data_9 = Data(dispatch_7.ListA)
pull = PullPoint(Point=data_9, Geometry=flatten(offset), ClosestOnly=True)  # -> ClosestPoint, Distance
testpoint = TestPoint(archPoint=pull.ClosestPoint, crvPoint=disc_2.Points)  # -> out, specialPt; inputs archPoint: list of Point3d, crvPoint: list of Point3d
# ---------- testpoint: C# ----------
    List<int> passIndex = new List<int>();

    for(int i = 0; i < archPoint.Count; i++){
      foreach(Point3d t in crvPoint){
        if(archPoint[i].X == t.X && archPoint[i].Y == t.Y && archPoint[i].Z == t.Z){
          Print("pass");
          passIndex.Add(i);}
      }
    }

    specialPt = passIndex;
# ---------- end testpoint ----------
cull_i = CullIndex(List=data_9, Indices=testpoint.specialPt, Wrap=True)
# 阳角
# 阴角
item_4 = ListItem(List=data_9, Index=testpoint.specialPt, Wrap=True)

# ---- group: 制作上层定位平面
disc_3 = Discontinuity(Curve=graft(crv_24), Level=1)  # -> Points, Parameters
crv_cp_2 = CurveClosestPoint(Point=disc_3.Points, Curve=graft(crv_24))  # -> Point, Parameter, Distance
eval_4 = EvaluateCurve(Curve=graft(crv_24), Parameter=crv_cp_2.Parameter)  # -> flatten(Point), Tangent, flatten(Angle)
deg_2 = Degrees(Radians=eval_4.Angle)
offset_2 = OffsetCurve(Curve=clscrv_5.Closed, Distance=expr("-X", Slider(300, range=0..1000)), Corners=1)
larger_2 = LargerThan(FirstNumber=deg_2, SecondNumber=Slider(70, range=0..100))  # -> LargerThan, OrEqualTo
disc_4 = Discontinuity(Curve=offset_2, Level=1)  # -> flatten(Points), Parameters
dispatch_8 = Dispatch(List=deg_2, DispatchPattern=larger_2.LargerThan)  # -> ListA, ListB
dispatch_9 = Dispatch(List=eval_4.Point, DispatchPattern=larger_2.LargerThan)  # -> ListA, ListB
data_10 = Data(dispatch_9.ListA)
smaller_2 = SmallerThan(FirstNumber=dispatch_8.ListA, SecondNumber=Slider(100, range=0..100))  # -> SmallerThan, OrEqualTo
dispatch_10 = Dispatch(List=data_10, DispatchPattern=smaller_2.SmallerThan)  # -> ListA, ListB
data_11 = Data(dispatch_10.ListA)
pull_2 = PullPoint(Point=data_11, Geometry=flatten(offset_2), ClosestOnly=True)  # -> ClosestPoint, Distance
testpoint_2 = TestPoint(archPoint=pull_2.ClosestPoint, crvPoint=disc_4.Points)  # -> out, specialPt; inputs archPoint: list of Point3d, crvPoint: list of Point3d; same code as testpoint

disc_5 = Discontinuity(Curve=graft(crv_25), Level=1)  # -> Points, Parameters
crv_cp_3 = CurveClosestPoint(Point=disc_5.Points, Curve=graft(crv_25))  # -> Point, Parameter, Distance
eval_5 = EvaluateCurve(Curve=graft(crv_25), Parameter=crv_cp_3.Parameter)  # -> flatten(Point), Tangent, flatten(Angle)
deg_3 = Degrees(Radians=eval_5.Angle)
offset_3 = OffsetCurve(Curve=clscrv_6.Closed, Distance=expr("-X", Slider(300, range=0..1000)), Corners=1)
larger_3 = LargerThan(FirstNumber=deg_3, SecondNumber=Slider(70, range=0..100))  # -> LargerThan, OrEqualTo
disc_6 = Discontinuity(Curve=offset_3, Level=1)  # -> flatten(Points), Parameters
dispatch_11 = Dispatch(List=deg_3, DispatchPattern=larger_3.LargerThan)  # -> ListA, ListB
dispatch_12 = Dispatch(List=eval_5.Point, DispatchPattern=larger_3.LargerThan)  # -> ListA, ListB
data_12 = Data(dispatch_12.ListA)
smaller_3 = SmallerThan(FirstNumber=dispatch_11.ListA, SecondNumber=Slider(100, range=0..100))  # -> SmallerThan, OrEqualTo
dispatch_13 = Dispatch(List=data_12, DispatchPattern=smaller_3.SmallerThan)  # -> ListA, ListB
data_13 = Data(dispatch_13.ListA)
pull_3 = PullPoint(Point=data_13, Geometry=flatten(offset_3), ClosestOnly=True)  # -> ClosestPoint, Distance
testpoint_3 = TestPoint(archPoint=pull_3.ClosestPoint, crvPoint=disc_6.Points)  # -> out, specialPt; inputs archPoint: list of Point3d, crvPoint: list of Point3d; same code as testpoint

# ----
钢埋板长度_2 = Division(A=number_slider_8, B=2)
neg = Negative(Value=钢埋板长度_2)
dom = ConstructDomain(DomainStart=neg, DomainEnd=钢埋板长度_2)
panel_26 = Panel(dom)

钢埋板厚度_2 = Division(A=number_slider_9, B=2)
neg_2 = Negative(Value=钢埋板厚度_2)
dom_2 = ConstructDomain(DomainStart=neg_2, DomainEnd=钢埋板厚度_2)
panel_27 = Panel(dom_2)

# ----
# 钢埋板肋板位置 1/4处
panel_28 = Panel("4")
division = Division(A=number_slider_8, B=panel_28)

# ----
# 列表文字以空格进行分割
panel_29 = Panel(" ")
split = TextSplit(Text=txt_2, Separators=panel_29)

# ----
# 编号和截面尺寸分区
panel_30 = Panel("1")
split_2 = SplitList(List=split, Index=panel_30)  # -> flatten(ListA), flatten(ListB)

# ---- group: 制作上层定位平面
# 阴角
cull_i_2 = CullIndex(List=data_11, Indices=testpoint_2.specialPt, Wrap=True)

# 阳角
item_5 = ListItem(List=data_11, Index=testpoint_2.specialPt, Wrap=True)

# 阴角
cull_i_3 = CullIndex(List=data_13, Indices=testpoint_3.specialPt, Wrap=True)

# 阳角
item_6 = ListItem(List=data_13, Index=testpoint_3.specialPt, Wrap=True)

# ----
merge_5 = Merge(Data1=item_4, Data2=cull_i)  # -> flatten(Result)

# ---- group: 下-阴阳角
data_14 = Data(merge_5)

# ---- group: 制作上层定位平面
# 生成上层定位平面
merge_6 = Merge(Data1=item_5, Data2=cull_i_2)  # -> flatten(Result)

# 生成檐口定位平面
merge_7 = Merge(Data1=item_6, Data2=cull_i_3)  # -> flatten(Result)

# ----
movetoplane = MoveToPlane(Geometry=data, Plane=PlaneXY(0, 0, 0), Above=True, Below=True)  # -> Geometry, Transform
area_5 = Area(Geometry=movetoplane.Geometry)  # -> Area, Centroid
pt = Point(area_5.Centroid)

# ---- group: 制作上层定位平面
movetoplane_2 = MoveToPlane(Geometry=data_2, Plane=PlaneXY(0, 0, 0), Above=True, Below=True)  # -> Geometry, Transform
area_6 = Area(Geometry=movetoplane_2.Geometry)  # -> Area, Centroid
pt_2 = Point(area_6.Centroid)

movetoplane_3 = MoveToPlane(Geometry=data_3, Plane=PlaneXY(0, 0, 0), Above=True, Below=True)  # -> Geometry, Transform
area_7 = Area(Geometry=movetoplane_3.Geometry)  # -> Area, Centroid
pt_3 = Point(area_7.Centroid)

# ----
xy_10 = XYPlane(Origin=Point(0, 0, 0))
xy_11 = XYPlane(Origin=Point(0, 0, 0))
xy_12 = XYPlane(Origin=Point(0, 0, 0))

# ----
# 单体选型
list_6 = ValueList({"顶埋": 0, "侧埋": 1}, selected="顶埋")

# ---- group: F2 Arch Outline
crv_26 = Curve(crv_18)

# ----
# 选要重塑的线段长度
number_slider_20 = Slider(1200, range=0..10000)

# ---- group: 车道区域 / 檐口线Input
crv_27 = Curve(crv_21)

# ---- group: 檐口线Input
crv_28 = Curve(crv_21)

crv_29 = Curve(crv_21)

# ----
# 调整重塑线段的平滑度
number_slider_21 = Slider(11, range=0..11)

# ----
# 区分内外梁边线
# 1.根据F2建筑线制作轮廓线
explode = Explode(Curve=crv_26, Recursive=True)  # -> Segments, Vertices
len_2 = Length(Curve=explode.Segments)
sort_2 = SortList(Keys=len_2)  # -> Keys, ValuesA
larger_4 = LargerThan(FirstNumber=len_2, SecondNumber=number_slider_20)  # -> LargerThan, OrEqualTo
panel_31 = Panel(sort_2.Keys)
dispatch_14 = Dispatch(List=explode.Segments, DispatchPattern=larger_4.LargerThan)  # -> ListA, ListB
data_15 = Data(dispatch_14.ListA)
data_16 = Data(dispatch_14.ListB)
join = JoinCurves(Curves=data_16, Preserve=False)
disc_7 = Discontinuity(Curve=join, Level=1)  # -> Points, Parameters
nurbs = NurbsCurve(Vertices=disc_7.Points, Degree=number_slider_21, Periodic=False)  # -> flatten(Curve), Length, Domain
join_2 = JoinCurves(Curves=flatten([data_15, nurbs.Curve]), Preserve=False)
offset_4 = OffsetCurve(Curve=join_2, Distance=Slider(10000, range=0..10000), Corners=1)

# ---- group: F2 Archline - Smoothed
reb = RebuildCurve(Curve=offset_4, Count=Slider(17, range=0..100), Tangents=invert(False))

# ----
# InputCurve
crv_30 = Curve()

# ----
# Curve-框住要分析的建筑单体
# 如果要用自己导入Curve作为分析线，
# 请在InputCurve那里导入curve,
# 然后在上方的选型列表选择Input Curve。
# 
# 如果要用Grasshopper自动生成的Curve,
# 请在上方的选型列表选择Default Curve。
list_7 = ValueList({"Default Curve": 0, "Input Curve": 1}, selected="Default Curve")
filter = StreamFilter(Gate=list_7, Stream0=reb, Stream1=crv_30)

crv_31 = Curve(filter)

# ----
# 要连接的梁中线Offest值
# 要连接的梁中线curve
# 要连接的embed
# 埋件向内探索最远出的梁的距离
number_slider_22 = Slider(500, range=0..10000)

# ---- group: 楼板线
crv_32 = Curve(project.Geometry)

# ----
project_10 = Project(Geometry=crv_32, Plane=PlaneXY(0, 0, 0))  # -> Geometry, Transform

# ----
# 埋件向外探索最远出的梁的距离
number_slider_23 = Slider(0, range=0..10000)

reb_2 = RebuildCurve(Curve=project_10.Geometry, Count=Slider(5000, range=0..10000), Tangents=False)

# ---- group: 檐口线内测
crv_33 = Curve(crv_4)

# ---- group: 檐口线外侧
crv_34 = Curve(crv_21)

# ---- group: 下层交点-除重 / 上层幕墙线
crv_35 = Curve(crv_18)

# ---- group: 下层交点-除重 / 下层幕墙线
crv_36 = Curve(crv_19)

# ---- group: 下层交点-除重 / 容差
number_slider_24 = Slider(100, range=0..200)

# ---- group: 上层幕墙线
crv_37 = Curve(crv_35)

# 钢埋板高度，工字钢尺寸决定
crv_38 = Curve(crv_35)

# ----
panel_32 = Panel("1种梁对应了多种埋件")

# ----
# 是否有吊顶：
# 下层幕墙边线在结构边梁以内>350
# 
# （最外层结构线）
number_slider_25 = Slider(350, range=0..1000)

merge_8 = Merge(Data1=crv_3, Data2=crv_4)

# ---- group: All檐口线
crv_39 = Curve(merge_8)

# ----
merge_9 = Merge(Data1=crv_3, Data2=crv_4)

# ---- group: All檐口线
crv_40 = Curve(merge_9)

# ---- group: 下层Arch Line
crv_41 = Curve(crv_19)

# ----
# 3.2下层建筑边线内侧300-600mm范围内
number_slider_26 = Slider(600, range=0..1000)
crv_42 = Curve(crv_41)
offset_5 = OffsetCurve(Curve=crv_42, Distance=expr("-x", Slider(300, range=0..1000)), Corners=1)
offset_6 = OffsetCurve(Curve=crv_42, Distance=expr("-x", number_slider_26), Corners=1)

# ----
# 3.1下层建筑边线外侧50-350mm范围内
number_slider_27 = Slider(350, range=0..1000)
crv_43 = Curve(crv_41)
offset_7 = OffsetCurve(Curve=crv_43, Distance=number_slider_27, Corners=1)
offset_8 = OffsetCurve(Curve=crv_43, Distance=Slider(50, range=0..100), Corners=1)

# ---- group: All檐口线
crv_44 = Curve(crv_40)

crv_45 = Curve(crv_40)

crv_46 = Curve(crv_40)

crv_47 = Curve(crv_40)

# ----
# 4.0 -初筛： 下层建筑边线内侧600mm到外侧350内没有钢梁
number_slider_28 = Slider(600, range=0..1000)
crv_48 = Curve(crv_41)
offset_9 = OffsetCurve(Curve=crv_48, Distance=expr("-x", number_slider_28), Corners=1)
offset_10 = OffsetCurve(Curve=crv_48, Distance=Slider(300, range=0..1000), Corners=1)

# ----
# 4下层建筑内侧到300到外侧50内
# 有钢结构
number_slider_29 = Slider(50, range=0..1000)
crv_49 = Curve(crv_41)
offset_11 = OffsetCurve(Curve=crv_49, Distance=expr("-x", Slider(300, range=0..1000)), Corners=1)
offset_12 = OffsetCurve(Curve=crv_49, Distance=number_slider_29, Corners=1)

# ---- group: 建筑线
crv_50 = Curve(filter)

# ----
# 这里如果跑红也不要紧，
# 说明单体没有出现相撞的情况
data_17 = Data(flatten(merge_4))
item_7 = ListItem(List=data_17, Index=0, Wrap=True)
item_8 = ListItem(List=data_17, Index="-1", Wrap=True)

# ---- group: 建筑线
crv_51 = Curve(filter)

# ---- group: 上层幕墙线
crv_52 = Curve(crv_18)

# ----
crv_53 = Curve(crv_52)

# ----
# （3.1）导入轴线
crv_54 = Curve(<curve referenced from the Rhino model>)
layer_6 = ObjectLayer(Guid=crv_54)  # -> LayerIndex, LayerPathName
panel_33 = Panel(layer_6.LayerPathName)
reflay_7 = ReferenceByLayer(LayerName=panel_33)
xy_13 = XYPlane(Origin=Point(0, 0, 0))
project_11 = Project(Geometry=reflay_7, Plane=xy_13)  # -> Geometry, Transform

# ----
# 求内部曲线转折点
crv_55 = Curve()  # disabled
number_slider_30 = Slider(300, range=0..1000)  # disabled
neg_3 = Negative(Value=number_slider_30)  # disabled
filter_2 = StreamFilter(Gate=toggle, Stream0=number_slider_30, Stream1=neg_3)  # disabled
number_slider_31 = Slider(60, range=0..100)  # disabled

ext = ExtendCurve(Curve=crv_55, Type=0, Start=number_slider, End=number_slider)  # disabled

# ----
# 第二层
# 
# Curves(location point)+ Smooth Curves(architecture line)
# 第二层-区分阴阳角
area_8 = Area(Geometry=geo_2)  # -> Area, Centroid; disabled
crv_56 = Curve(crv_55)  # disabled
pull_4 = PullPoint(Point=area_8.Centroid, Geometry=crv_56, ClosestOnly=True)  # -> ClosestPoint, Distance; disabled
number_slider_32 = Slider(200, range=0..1000)  # disabled
number_slider_33 = Slider(100, range=0..300)  # disabled

# ----
# 第二层-阴阳角
panel_34 = Panel("0.5 * Pi")  # disabled
toggle_2 = BooleanToggle(True)  # disabled
neg_4 = Negative(Value=panel_34)  # disabled
filter_3 = StreamFilter(Gate=toggle_2, Stream0=panel_34, Stream1=neg_4)  # disabled

# ----
# 第二层-大面定位
panel_35 = Panel("0.5 * Pi")  # disabled
toggle_3 = BooleanToggle(True)  # disabled
neg_5 = Negative(Value=panel_35)  # disabled
filter_4 = StreamFilter(Gate=toggle_3, Stream0=panel_35, Stream1=neg_5)  # disabled

number_slider_34 = Slider(300, range=0..1000)  # disabled
number_slider_35 = Slider(1.5, range=0..10)  # disabled

number_slider_36 = Slider(300, range=0..1000)  # disabled
number_slider_37 = Slider(1.5, range=0..10)  # disabled

number_slider_38 = Slider(300, range=0..1000)  # disabled
number_slider_39 = Slider(1.5, range=0..10)  # disabled

# ----
# 显示"False"时要选择线段延长
list_8 = ValueList({"线段不延长": 0, "线段延长": 1}, selected="线段延长")  # disabled

filter_5 = StreamFilter(Gate=list_8, Stream0=crv_55, Stream1=ext)  # disabled

disc_8 = Discontinuity(Curve=graft(filter_5), Level=1)  # -> Points, Parameters; disabled
crv_cp_4 = CurveClosestPoint(Point=disc_8.Points, Curve=graft(filter_5))  # -> Point, Parameter, Distance; disabled
eval_6 = EvaluateCurve(Curve=graft(filter_5), Parameter=crv_cp_4.Parameter)  # -> flatten(Point), Tangent, flatten(Angle); disabled
deg_4 = Degrees(Radians=eval_6.Angle)  # disabled
offset_13 = OffsetCurve(Curve=filter_5, Distance=expr("-X", filter_2), Corners=1)  # disabled
panel_36 = Panel(deg_4)  # disabled
larger_5 = LargerThan(FirstNumber=deg_4, SecondNumber=number_slider_31)  # -> LargerThan, OrEqualTo; disabled
disc_9 = Discontinuity(Curve=offset_13, Level=1)  # -> flatten(Points), Parameters; disabled
dispatch_15 = Dispatch(List=eval_6.Point, DispatchPattern=larger_5.LargerThan)  # -> ListA, ListB; disabled
end = EndPoints(Curve=filter_5)  # -> Start, End; disabled
data_18 = Data(dispatch_15.ListA)  # disabled
pull_5 = PullPoint(Point=data_18, Geometry=flatten(offset_13), ClosestOnly=True)  # -> ClosestPoint, Distance; disabled
testpoint_4 = TestPoint(archPoint=pull_5.ClosestPoint, crvPoint=disc_9.Points)  # -> out, specialPt; inputs archPoint: list of Point3d, crvPoint: list of Point3d; disabled; same code as testpoint

# ----
# 阴角
item_9 = ListItem(List=data_18, Index=testpoint_4.specialPt, Wrap=True)  # disabled

# ----
# SmoothCurve-阴角&阳角
# 阳角
cull_i_4 = CullIndex(List=data_18, Indices=testpoint_4.specialPt, Wrap=True)  # disabled

dist = Distance(PointA=pull_4.ClosestPoint, PointB=data_18)  # disabled
sort_3 = SortList(Keys=dist)  # -> Keys, ValuesA; disabled
panel_37 = Panel(sort_3.Keys)  # disabled
smaller_4 = SmallerThan(FirstNumber=dist, SecondNumber=number_slider_32)  # -> SmallerThan, OrEqualTo; disabled
dispatch_16 = Dispatch(List=geo_2, DispatchPattern=smaller_4.SmallerThan)  # -> ListA, ListB; disabled
crv_57 = Curve(filter_5)  # disabled

data_19 = Data(dispatch_16.ListA)  # disabled
explode_2 = Explode(Curve=data_19, Recursive=True)  # -> Segments, Vertices; disabled
len_3 = Length(Curve=explode_2.Segments)  # disabled
sort_4 = SortList(Keys=reverse(len_3), ValuesA=explode_2.Segments)  # -> Keys, ValuesA; disabled
item_10 = ListItem(List=sort_4.ValuesA, Index=0, Wrap=True)  # -> flatten(Item); disabled
area_9 = Area(Geometry=data_19)  # -> Area, Centroid; disabled
midpt = CurveMiddle(Curve=item_10)  # disabled
move2pt_2 = MoveToPoint(Geometry=item_10, PointA=midpt, PointB=area_9.Centroid)  # -> Moved, Vector, Transform; disabled
end_2 = EndPoints(Curve=move2pt_2.Moved)  # -> Start, End; disabled
ln = Line(StartPoint=end_2.Start, EndPoint=end_2.End)  # disabled
xy_14 = XYPlane(Origin=end_2.End)  # disabled
rotate = Rotate(Geometry=ln, Angle=filter_3, Plane=xy_14)  # -> Geometry, Transform; disabled
pl = ConstructPlane(Origin=end_2.End, XAxis=rotate.Geometry, YAxis=ln)  # disabled

data_20 = Data(dispatch_16.ListB)  # disabled
explode_3 = Explode(Curve=data_20, Recursive=True)  # -> Segments, Vertices; disabled
len_4 = Length(Curve=explode_3.Segments)  # disabled
sort_5 = SortList(Keys=reverse(len_4), ValuesA=explode_3.Segments)  # -> Keys, ValuesA; disabled
item_11 = ListItem(List=sort_5.ValuesA, Index=0, Wrap=True)  # -> flatten(Item); disabled
area_10 = Area(Geometry=data_20)  # -> Area, Centroid; disabled
midpt_2 = CurveMiddle(Curve=item_11)  # disabled
move2pt_3 = MoveToPoint(Geometry=item_11, PointA=midpt_2, PointB=area_10.Centroid)  # -> Moved, Vector, Transform; disabled
end_3 = EndPoints(Curve=move2pt_3.Moved)  # -> Start, End; disabled
ln_2 = Line(StartPoint=end_3.Start, EndPoint=end_3.End)  # disabled
xy_15 = XYPlane(Origin=end_3.End)  # disabled
rotate_2 = Rotate(Geometry=ln_2, Angle=filter_4, Plane=xy_15)  # -> Geometry, Transform; disabled
pl_2 = ConstructPlane(Origin=end_3.End, XAxis=rotate_2.Geometry, YAxis=ln_2)  # disabled

data_21 = Data(flatten(pl_2))  # disabled
deplane_2 = DeconstructPlane(Plane=data_21)  # -> Origin, XAxis, YAxis, ZAxis; disabled
amp_2 = Amplitude(Vector=deplane_2.YAxis, Amplitude=number_slider_36)  # disabled
move_2 = Move(Geometry=deplane_2.Origin, Motion=amp_2)  # -> Geometry, Transform; disabled
ln_3 = Line(StartPoint=deplane_2.Origin, EndPoint=move_2.Geometry)  # disabled
midpt_3 = CurveMiddle(Curve=ln_3)  # disabled
scale = Scale(Geometry=ln_3, Center=midpt_3, Factor=number_slider_37)  # -> Geometry, Transform; disabled
ccx = CurveCurve(CurveA=scale.Geometry, CurveB=crv_57)  # -> Points, ParamsA, ParamsB; disabled

dist_2 = Distance(PointA=graft(end_2.End), PointB=cull_i_4)  # disabled
sort_6 = SortList(Keys=dist_2)  # -> Keys, ValuesA; disabled
item_12 = ListItem(List=sort_6.Keys, Index=0, Wrap=True)  # disabled
smaller_5 = SmallerThan(FirstNumber=item_12, SecondNumber=number_slider_33)  # -> SmallerThan, OrEqualTo; disabled
flatten = FlattenTree(Tree=item_12, Path="{0}")  # disabled
dispatch_17 = Dispatch(List=graft(pl), DispatchPattern=smaller_5.SmallerThan)  # -> ListA, ListB; disabled
panel_38 = Panel(flatten)  # disabled
flatten_2 = FlattenTree(Tree=ccx.Points, Path="{0}")  # disabled
lng = ListLength(List=scale.Geometry)  # disabled
lng_2 = ListLength(List=flatten_2)  # disabled

data_22 = Data(flatten(dispatch_17.ListA))  # disabled
deplane_3 = DeconstructPlane(Plane=data_22)  # -> Origin, XAxis, YAxis, ZAxis; disabled
amp_3 = Amplitude(Vector=deplane_3.YAxis, Amplitude=number_slider_34)  # disabled
move_3 = Move(Geometry=deplane_3.Origin, Motion=amp_3)  # -> Geometry, Transform; disabled
ln_4 = Line(StartPoint=deplane_3.Origin, EndPoint=move_3.Geometry)  # disabled
midpt_4 = CurveMiddle(Curve=ln_4)  # disabled
scale_2 = Scale(Geometry=ln_4, Center=midpt_4, Factor=number_slider_35)  # -> Geometry, Transform; disabled
ccx_2 = CurveCurve(CurveA=scale_2.Geometry, CurveB=crv_57)  # -> Points, ParamsA, ParamsB; disabled

data_23 = Data(flatten(dispatch_17.ListB))  # disabled
deplane_4 = DeconstructPlane(Plane=data_23)  # -> Origin, XAxis, YAxis, ZAxis; disabled
amp_4 = Amplitude(Vector=deplane_4.YAxis, Amplitude=number_slider_38)  # disabled
move_4 = Move(Geometry=deplane_4.Origin, Motion=amp_4)  # -> Geometry, Transform; disabled
ln_5 = Line(StartPoint=deplane_4.Origin, EndPoint=move_4.Geometry)  # disabled
midpt_5 = CurveMiddle(Curve=ln_5)  # disabled
scale_3 = Scale(Geometry=ln_5, Center=midpt_5, Factor=number_slider_39)  # -> Geometry, Transform; disabled
ccx_3 = CurveCurve(CurveA=scale_3.Geometry, CurveB=crv_57)  # -> Points, ParamsA, ParamsB; disabled

equals = Equality(FirstNumber=lng, SecondNumber=lng_2)  # -> Equality, Inequality; disabled
panel_39 = Panel(equals.Equality)  # disabled

# ----
# InsideCurve-大面
move2pt_4 = MoveToPoint(Geometry=data_21, PointA=flatten(deplane_2.Origin), PointB=flatten(ccx.Points))  # -> Moved, Vector, Transform; disabled

# ----
# InsideCurve-阳角
move2pt_5 = MoveToPoint(Geometry=data_22, PointA=deplane_3.Origin, PointB=ccx_2.Points)  # -> Moved, Vector, Transform; disabled

# ----
# InsideCurve-阴角
move2pt_6 = MoveToPoint(Geometry=data_23, PointA=deplane_4.Origin, PointB=ccx_3.Points)  # -> Moved, Vector, Transform; disabled

swatch_2 = ColourSwatch(SwatchColor=RGB(140, 140, 140))
# (9)Bake Me!!
# 埋件和阴阳角定位
panel_40 = Panel("阴阳角定位-F1+F2")

layer_7 = DefineLayer(Name=panel_40, Color=swatch_2)
attributes = DefineObjectAttributes(Layer=layer_7, Color=swatch_2)

# ---- group: 檐口埋件
panel_41 = Panel("Embed::1-1-02钢板焊埋件")
panel_42 = Panel("Tag::1-1-02钢板焊埋件")
swatch_3 = ColourSwatch(SwatchColor=RGB(255, 212, 0))

# ---- group: 上下幕墙连续
panel_43 = Panel("Tag::1-0-01钢板焊埋件")
swatch_4 = ColourSwatch(SwatchColor=RGB(255, 242, 66))
panel_44 = Panel("Embed::1-0-01钢板焊埋件")

# ---- group: 有吊顶的范围，檐口处内侧埋件
panel_45 = Panel("Embed::2-1-03钢板焊埋件")
panel_46 = Panel("Tag::2-1-03钢板焊埋件")
swatch_5 = ColourSwatch(SwatchColor=RGB(255, 242, 66))

# ---- group: 框架顶部，埋件在幕墙线外侧
panel_47 = Panel("Embed::3-1-03钢板焊埋件")
panel_48 = Panel("Tag::3-1-03钢板焊埋件")
swatch_6 = ColourSwatch(SwatchColor=RGB(180, 255, 66))

# ---- group: 框架顶部，埋件在幕墙线内侧
panel_49 = Panel("Embed::3-2-03钢板焊埋件")
panel_50 = Panel("Tag::3-2-03钢板焊埋件")
swatch_7 = ColourSwatch(SwatchColor=RGB(66, 255, 69))

# ---- group: 钢结构下底埋
panel_51 = Panel("Embed::4-1钢板焊底埋")
panel_52 = Panel("Tag::4-1钢板焊底埋")
swatch_8 = ColourSwatch(SwatchColor=RGB(66, 255, 236))

# ---- group: 范围内没有钢梁，默认幕墙线向内300有一个埋件
panel_53 = Panel("Embed::4-0-03默认钢板焊")
panel_54 = Panel("Tag::4-0-03默认钢板焊")
swatch_9 = ColourSwatch(SwatchColor=RGB(66, 167, 255))

# ---- group: 幕墙底部接地埋件
panel_55 = Panel("Embed::5-04板埋")
panel_56 = Panel("Tag::5-04板埋")
swatch_10 = ColourSwatch(SwatchColor=RGB(66, 98, 255))

# ----
# 1.1-掩口出侧埋遗漏
panel_57 = Panel("1.1-掩口出侧埋遗漏")
layer_8 = DefineLayer(Name=panel_57)
attributes_2 = DefineObjectAttributes(Layer=layer_8)

# ----
# 生成埋件编号
# 注意：
# 可以选择机动生成or手动输入埋件Tag可以参考下方右侧的”涉及到的梁编号“来手动输入对应的埋件编号
list_9 = ValueList({"机动生成埋件Tags": 0, "手动输入埋件Tags": 1}, selected="机动生成埋件Tags")

layer_9 = DefineLayer(Name=panel_42, Color=swatch_3)
layer_10 = DefineLayer(Name=panel_41, Color=swatch_3)
entwine = Entwine(Branch00=layer_10, Branch01=layer_9, FlattenInputs=True)
attributes_3 = DefineObjectAttributes(Layer=entwine, Color=swatch_3)

layer_11 = DefineLayer(Name=panel_46, Color=swatch_5)
layer_12 = DefineLayer(Name=panel_45, Color=swatch_5)
entwine_2 = Entwine(Branch00=layer_12, Branch01=layer_11, FlattenInputs=True)
attributes_4 = DefineObjectAttributes(Layer=entwine_2, Color=swatch_5)

layer_13 = DefineLayer(Name=panel_43, Color=swatch_4)
layer_14 = DefineLayer(Name=panel_44, Color=swatch_4)
entwine_3 = Entwine(Branch00=layer_14, Branch01=layer_13, FlattenInputs=True)
attributes_5 = DefineObjectAttributes(Layer=entwine_3, Color=swatch_4)

layer_15 = DefineLayer(Name=panel_48, Color=swatch_6)
layer_16 = DefineLayer(Name=panel_47, Color=swatch_6)
entwine_4 = Entwine(Branch00=layer_16, Branch01=layer_15, FlattenInputs=True)
attributes_6 = DefineObjectAttributes(Layer=entwine_4, Color=swatch_6)

layer_17 = DefineLayer(Name=panel_50, Color=swatch_7)
layer_18 = DefineLayer(Name=panel_49, Color=swatch_7)
entwine_5 = Entwine(Branch00=layer_18, Branch01=layer_17, FlattenInputs=True)
attributes_7 = DefineObjectAttributes(Layer=entwine_5, Color=swatch_7)

layer_19 = DefineLayer(Name=panel_52, Color=swatch_8)
layer_20 = DefineLayer(Name=panel_51, Color=swatch_8)
entwine_6 = Entwine(Branch00=layer_20, Branch01=layer_19, FlattenInputs=True)
attributes_8 = DefineObjectAttributes(Layer=entwine_6, Color=swatch_8)

layer_21 = DefineLayer(Name=panel_56, Color=swatch_10)
layer_22 = DefineLayer(Name=panel_55, Color=swatch_10)
entwine_7 = Entwine(Branch00=layer_22, Branch01=layer_21, FlattenInputs=True)
attributes_9 = DefineObjectAttributes(Layer=entwine_7, Color=swatch_10)

layer_23 = DefineLayer(Name=panel_54, Color=swatch_9)
layer_24 = DefineLayer(Name=panel_53, Color=swatch_9)
entwine_8 = Entwine(Branch00=layer_24, Branch01=layer_23, FlattenInputs=True)
attributes_10 = DefineObjectAttributes(Layer=entwine_8, Color=swatch_9)

crv_58 = Curve(project_2.Geometry)
panel_58 = Panel("""Dimension::Dim1
Dimension::Dim2
Dimension::Dim3
Dimension::Dim4""")
layer_25 = DefineLayer(Name=panel_58)  # -> graft(Layer)
attributes_11 = DefineObjectAttributes(Layer=layer_25)

# ----
# 生成底埋钢埋件
rectangle = Rectangle(Plane=PlaneXY(0, 0, 0), XSize=panel_7, YSize=panel_8, Radius=0)  # -> Rectangle, Length
rec = Rectangle(rectangle.Rectangle)
pln_3 = Plane(rectangle.Rectangle)

deplane_5 = DeconstructPlane(Plane=pln_3)  # -> Origin, XAxis, YAxis, ZAxis
dedomain = DeconstructDomain(Domain=panel_8)  # -> Start, End
amp_5 = Amplitude(Vector=deplane_5.YAxis, Amplitude=dedomain.End)
move_5 = Move(Geometry=deplane_5.Origin, Motion=amp_5)  # -> Geometry, Transform
ln_6 = Line(StartPoint=deplane_5.Origin, EndPoint=move_5.Geometry)
amp_6 = Amplitude(Vector=ln_6, Amplitude=Slider(190, range=0..1000))
move_6 = Move(Geometry=deplane_5.Origin, Motion=amp_6)  # -> Geometry, Transform

text = DefineTextObject(Text=panel_6, Plane=move_6.Geometry, DimensionStyle=panel_9, OutputType="Text")
group = Group(Objects=[rec, text])
merge_10 = Merge(Data1=group, Data2=pln_3)

data_24 = Data(merge_10)
item_13 = ListItem(List=data_24, Index=0, Wrap=True)  # -> Item, Item1

# ----
# 板埋：制作板埋三视图
max = Maximum(A=s_x, B=s_y)
filter_6 = StreamFilter(Gate=list, Stream0=7.2, Stream1=9.6, Stream2=11.9, Stream3=14.3, Stream4=16.7, Stream5=19.1)
filter_7 = StreamFilter(Gate=list_2, Stream0=270, Stream1=360)
filter_8 = StreamFilter(Gate=list_3, Stream0=10, Stream1=12, Stream2=16, Stream3=18, Stream4=20, Stream5=25)
filter_9 = StreamFilter(Gate=list, Stream0=0.91, Stream1=1.1, Stream2=1.27, Stream3=1.43, Stream4=1.57, Stream5=1.71)
filter_10 = StreamFilter(Gate=list_2, Stream0=0.16, Stream1=0.14)
addition = Addition(A=list_4, B=1)
addition_2 = Addition(A=list_5, B=1)
division_2 = Division(A=max, B=8)
t = Integer(division_2)
panel_59 = Panel(filter_9)
panel_60 = Panel(filter_6)
panel_61 = Panel(filter_10)
min = Minimum(A=filter_7, B=300)
panel_62 = Panel(min)
expression = Expression(A=filter_10, fy=filter_7, ft=filter_9, d=filter_8, Expression="(int((0.6*1.1*A*fy/ft*d)/5)+1)*5")

crv_59 = Curve(project_2.Geometry)
panel_63 = Panel("""Dimension::Dim1
Dimension::Dim2
Dimension::Dim3
Dimension::Dim4""")
layer_26 = DefineLayer(Name=panel_63)  # -> graft(Layer)
attributes_12 = DefineObjectAttributes(Layer=layer_26)

rhatt = GetRhinoAttributes(Geometry=reflay_3)  # -> Name, Layer, Color
split_3 = TextSplit(Text=rhatt.Color, Separators=",")  # -> simplify(Result)
item_14 = ListItem(List=split_3, Index=0, Wrap=True)  # -> flatten(Item), flatten(Item1), flatten(Item2)
pt_4 = ConstructPoint(XCoordinate=item_14.Item, YCoordinate=item_14.Item1, ZCoordinate=item_14.Item2)
cullpt = CullDuplicates(Points=pt_4, Tolerance=0.1, CullMode=3)  # -> Points, Indices, Valence
pdecon = Deconstruct(Point=cullpt.Points)  # -> XComponent, YComponent, ZComponent
rgb = ColourRGB(Alpha=255, Red=pdecon.XComponent, Green=pdecon.YComponent, Blue=pdecon.ZComponent)
filtercolor = FilterByColor(Geometry=reflay_4, Color=rgb)  # -> simplify(Geometry)
detext = DeconstructText(TextObject=filtercolor)  # -> Text, Plane, Height, Justification
addition_3 = Addition(A=neg_2, B=division)
addition_4 = Addition(A=钢埋板厚度_2, B=division)
dom_3 = ConstructDomain(DomainStart=addition_3, DomainEnd=addition_4)
panel_64 = Panel(split_2.ListB)
钢埋板_侧视图 = Rectangle(Plane=PlaneXY(0, 0, 0), XSize=dom_2, YSize=dom, Radius=0)  # -> Rectangle, Length
xz = XZPlane(Origin=Point(0, 0, 0))
col = Colour(simplify(graft(rgb)))
attributes_13 = DefineObjectAttributes(Color=col)
xy_16 = XYPlane(Origin=Point(0, 0, 0))
dedomain_2 = DeconstructDomain(Domain=dom)  # -> Start, End
multiplication = Multiplication(A=dedomain_2.Start, B=dedomain_2.Start)

# ---- group: Beam
filtercolor_2 = FilterByColor(Geometry=reflay_3, Color=rgb)  # -> simplify(Geometry)

# ---- group: Text
item_15 = ListItem(List=detext.Text, Index=0, Wrap=True)

# ----
# 涉及到的梁编号
panel_65 = Panel(item_15)

# ---- group: Create Tags
tstat = TreeStatistics(Tree=detext.Text)  # -> Paths, Length, Count
series = Series(Start="1", Step=1, Count=tstat.Count)
concat = Concatenate(FragmentA=series, FragmentB="-")
concat_2 = Concatenate(FragmentA=concat, FragmentB=series)  # -> simplify(graft(Result))

# ----
filter_11 = StreamFilter(Gate=list_9, Stream0=concat_2, Stream1=simplify(graft(panel_16)))

# ----
# 埋件Tag预览
panel_66 = Panel(filter_11)

crv_60 = Curve(filtercolor_2)
layer_27 = ObjectLayer(Guid=crv_60)  # -> LayerIndex, LayerPathName
panel_67 = Panel(layer_27.LayerPathName)
reflay_8 = ReferenceByLayer(LayerName=panel_67)
flatten_3 = FlattenTree(Tree=item_15, Path="{0}")
txt_3 = Text(item_15)
concat_3 = Concatenate(FragmentA="Embed", FragmentB=txt_3)
txt_4 = Text(filter_11)
project_12 = Project(Geometry=crv_60, Plane=xy_16)  # -> Geometry, Transform

# ----
# 求出对应输入编号的钢结构截面尺寸
fsim = FindSimilarMember(Data=flatten_3, Set=split_2.ListA)  # -> Hit, Index
item_16 = ListItem(List=split_2.ListB, Index=fsim.Index, Wrap=True)

# ----
# 要连接的梁中线curve
crv_61 = Curve(project_12.Geometry)

# ----
# 板埋Modeling
multiplication_2 = Multiplication(A=s_x, B=addition)
multiplication_3 = Multiplication(A=s_y, B=addition_2)
recgrid = Rectangular(Plane=PlaneXY(0, 0, 0), SizeX=s_x, SizeY=s_y, ExtentX=addition, ExtentY=addition_2)  # -> Cells, Points
直径 = Text(filter_8)
division_3 = Division(A=multiplication_2, B=2)
division_4 = Division(A=multiplication_3, B=2)
vec = VectorXYZ(XComponent=expr("-x", division_3), YComponent=expr("-x", division_4), ZComponent=0)  # -> Vector, Length
move_7 = Move(Geometry=recgrid.Points, Motion=vec.Vector)  # -> Geometry, Transform
division_5 = Division(A=直径, B=2)
cyl = Cylinder(Base=move_7.Geometry, Radius=division_5, Length=expr("-x", expression))
X = UnitX(Factor=直径)
multiplication_4 = Multiplication(A=直径, B=6)
edges = BrepEdges(Brep=cyl)  # -> Naked, Interior, NonManifold
item_17 = ListItem(List=edges.Naked, Index=0, Wrap=True)
max_2 = Maximum(A=multiplication_4, B=70)
move_8 = Move(Geometry=item_17, Motion=X)  # -> Geometry, Transform
multiplication_5 = Multiplication(A=max_2, B=2)
addition_5 = Addition(A=multiplication_2, B=multiplication_5)
addition_6 = Addition(A=multiplication_3, B=multiplication_5)
division_6 = Division(A=t, B=2)
expression_2 = Expression(x=addition_6, Expression="Ceiling(x/10)*10/2")
expression_3 = Expression(x=addition_5, Expression="Ceiling(x/10)*10/2")
round = Round(Number=division_6)  # -> Nearest, Floor, Ceiling
multiplication_6 = Multiplication(A=round.Ceiling, B=2)
dom_4 = ConstructDomain(DomainStart=expr("-x", expression_2), DomainEnd=expression_2)
dom_5 = ConstructDomain(DomainStart=expr("-x", expression_3), DomainEnd=expression_3)
box = DomainBox(Base=PlaneXY(0, 0, 0), X=dom_5, Y=dom_4, Z=multiplication_6)
Z = UnitZ(Factor=expr("-x", multiplication_6))

multiplication_7 = Multiplication(A=直径, B=5)

Z_2 = UnitZ(Factor=multiplication_7)
extr = Extrude(Base=move_8.Geometry, Direction=Z_2)
cap = CapHoles(Brep=[extr, cyl])
merge_11 = Merge(Data1=cap, Data2=box)
flatten_4 = FlattenTree(Tree=merge_11, Path="{0}")
move_9 = Move(Geometry=flatten_4, Motion=Z)  # -> Geometry, Transform

split_4 = TextSplit(Text=item_16, Separators="x")
split_5 = TextSplit(Text=split_4, Separators="Q")
item_18 = ListItem(List=split_5, Index="0", Wrap=True)

shift = ShiftPaths(Data=item_18, Offset=-1)
subtraction = Subtraction(A=division, B=钢埋板厚度_2)
subtraction_2 = Subtraction(A=division, B=钢埋板厚度_2)
subtraction_3 = Subtraction(A=division, B=钢埋板厚度_2)
neg_6 = Negative(Value=钢埋板厚度_2)
neg_7 = Negative(Value=钢埋板厚度_2)
neg_8 = Negative(Value=钢埋板厚度_2)
subtraction_4 = Subtraction(A=division, B=钢埋板厚度_2)
addition_7 = Addition(A=subtraction, B=number_slider_9)
addition_8 = Addition(A=subtraction_2, B=number_slider_9)
subtraction_5 = Subtraction(A=neg_6, B=number_slider_9)
subtraction_6 = Subtraction(A=neg_7, B="2")
subtraction_7 = Subtraction(A=division, B=钢埋板厚度_2)
addition_9 = Addition(A=subtraction_3, B="2")
subtraction_8 = Subtraction(A=neg_8, B="2")
neg_9 = Negative(Value=钢埋板厚度_2)
neg_10 = Negative(Value=钢埋板厚度_2)
工字钢_h = ListItem(List=shift, Index=0, Wrap=True)
工字钢_b = ListItem(List=shift, Index=1, Wrap=True)
工字钢_tf = ListItem(List=shift, Index=3, Wrap=True)
工字钢_tw = ListItem(List=shift, Index=2, Wrap=True)
pt_5 = ConstructPoint(XCoordinate=neg_9, YCoordinate=subtraction_4, ZCoordinate=0)
pt_6 = ConstructPoint(XCoordinate=neg_10, YCoordinate=addition_7, ZCoordinate=0)
pt_7 = ConstructPoint(XCoordinate=subtraction_5, YCoordinate=addition_8, ZCoordinate=0)
pt_8 = ConstructPoint(XCoordinate=subtraction_6, YCoordinate=subtraction_7, ZCoordinate=0)
pt_9 = ConstructPoint(XCoordinate=subtraction_8, YCoordinate=addition_9, ZCoordinate=0)
subtraction_9 = Subtraction(A=工字钢_b, B=工字钢_tw)
merge_12 = Merge(Data1=pt_5, Data2=pt_6, Data3=pt_7, Data4=pt_9, Data5=pt_8)
division_7 = Division(A=subtraction_9, B="2")
pline = PolyLine(Vertices=merge_12, Closed=True)
division_8 = Division(A=division_7, B="2")
subtraction_10 = Subtraction(A=division_8, B=number_slider_9)
subtraction_11 = Subtraction(A=division_8, B=钢埋板厚度_2)
neg_11 = Negative(Value=division_8)
subtraction_12 = Subtraction(A=neg_11, B=subtraction_11)
addition_10 = Addition(A=subtraction_12, B=number_slider_10)
dom_6 = ConstructDomain(DomainStart=addition_10, DomainEnd=subtraction_12)
dom_7 = ConstructDomain(DomainStart=addition_3, DomainEnd=addition_4)
subtraction_13 = Subtraction(A=subtraction_10, B=subtraction_11)
subtraction_14 = Subtraction(A=neg_11, B=subtraction_11)
dom_8 = ConstructDomain(DomainStart=subtraction_13, DomainEnd=subtraction_14)

panel_68 = Panel(工字钢_b)

# ---- group: 筛选阴阳角
pull_6 = PullPoint(Point=flatten(pt), Geometry=graft(merge_5), ClosestOnly=True)  # -> ClosestPoint, Distance
sort_7 = SortList(Keys=pull_6.Distance, ValuesA=flatten(pt))  # -> Keys, ValuesA
item_19 = ListItem(List=sort_7.Keys, Index=0, Wrap=True)  # -> Item, Item1
item_20 = ListItem(List=sort_7.ValuesA, Index=0, Wrap=True)  # -> Item, Item1
merge_13 = Merge(Data1=item_19.Item, Data2=item_19.Item1)
merge_14 = Merge(Data1=item_20.Item, Data2=item_20.Item1)
panel_69 = Panel(merge_13)
smaller_6 = SmallerThan(FirstNumber=merge_13, SecondNumber="100")  # -> SmallerThan, OrEqualTo
dispatch_18 = Dispatch(List=merge_14, DispatchPattern=smaller_6.SmallerThan)  # -> ListA, ListB
crv_62 = Curve(flatten(offset))

# ---- group: 筛选阴阳角 / F1-阴阳角-点
data_25 = Data(dispatch_18.ListA)

# ---- group: 筛选阴阳角 (continued)
check_same_points = CheckSamePoints(archPoint=flatten(pt), crvPoint=flatten(data_25))  # -> out, specialPt; inputs archPoint: list of Point3d, crvPoint: list of Point3d; same code as testpoint
cull_i_5 = CullIndex(List=flatten(pt), Indices=check_same_points.specialPt, Wrap=True)
pull_7 = PullPoint(Point=cull_i_5, Geometry=crv_62, ClosestOnly=True)  # -> ClosestPoint, Distance
ln_7 = Line(StartPoint=pull_7.ClosestPoint, EndPoint=cull_i_5)
rotate_3 = Rotate(Geometry=ln_7, Angle=1.570796327, Plane=cull_i_5)  # -> Geometry, Transform
pl_3 = ConstructPlane(Origin=cull_i_5, XAxis=rotate_3.Geometry, YAxis=ln_7)

# ----
project_13 = Project(Geometry=pl_3, Plane=xy_12)  # -> Geometry, Transform

# ---- group: 下层定位点Plane-去阴阳角
pln_4 = Plane(project_13.Geometry)

# ---- group: 下层定位平面-All
pln_5 = Plane(pln_4)

# ---- group: 制作上层定位平面 / 筛选阴阳角
pull_8 = PullPoint(Point=flatten(pt_2), Geometry=graft(merge_6), ClosestOnly=True)  # -> ClosestPoint, Distance
sort_8 = SortList(Keys=pull_8.Distance, ValuesA=flatten(pt_2))  # -> Keys, ValuesA
item_21 = ListItem(List=sort_8.Keys, Index=0, Wrap=True)  # -> Item, Item1
item_22 = ListItem(List=sort_8.ValuesA, Index=0, Wrap=True)  # -> Item, Item1
merge_15 = Merge(Data1=item_21.Item, Data2=item_21.Item1)
merge_16 = Merge(Data1=item_22.Item, Data2=item_22.Item1)
panel_70 = Panel(merge_15)
smaller_7 = SmallerThan(FirstNumber=merge_15, SecondNumber="100")  # -> SmallerThan, OrEqualTo
dispatch_19 = Dispatch(List=merge_16, DispatchPattern=smaller_7.SmallerThan)  # -> ListA, ListB
crv_63 = Curve(flatten(offset_2))

# ---- group: 制作上层定位平面 / 筛选阴阳角 / F1-阴阳角-点
data_26 = Data(dispatch_19.ListA)

# ---- group: 上-阴阳角
pt_10 = Point(data_26)

# ----
merge_17 = Merge(Data1=data_14, Data2=pt_10)

bake = BakeObjects(Geometry=merge_17, Attributes=attributes, BakeName=panel_40, Bake=False)

# ---- group: 制作上层定位平面 / 筛选阴阳角 (continued)
check_same_points_2 = CheckSamePoints(archPoint=flatten(pt_2), crvPoint=flatten(data_26))  # -> out, specialPt; inputs archPoint: list of Point3d, crvPoint: list of Point3d; same code as testpoint
cull_i_6 = CullIndex(List=flatten(pt_2), Indices=check_same_points_2.specialPt, Wrap=True)
pull_9 = PullPoint(Point=cull_i_6, Geometry=crv_63, ClosestOnly=True)  # -> ClosestPoint, Distance
ln_8 = Line(StartPoint=pull_9.ClosestPoint, EndPoint=cull_i_6)
rotate_4 = Rotate(Geometry=ln_8, Angle=1.570796327, Plane=cull_i_6)  # -> Geometry, Transform
pl_4 = ConstructPlane(Origin=cull_i_6, XAxis=rotate_4.Geometry, YAxis=ln_8)

# ----
project_14 = Project(Geometry=pl_4, Plane=xy_11)  # -> Geometry, Transform

# ---- group: 上层定位点Plane-去阴阳角
pln_6 = Plane(project_14.Geometry)

# ---- group: 上层定位平面-All
pln_7 = Plane(pln_6)

# ---- group: 制作上层定位平面 / 筛选阴阳角
pull_10 = PullPoint(Point=flatten(pt_3), Geometry=graft(merge_7), ClosestOnly=True)  # -> ClosestPoint, Distance
sort_9 = SortList(Keys=pull_10.Distance, ValuesA=flatten(pt_3))  # -> Keys, ValuesA
item_23 = ListItem(List=sort_9.Keys, Index=0, Wrap=True)  # -> Item, Item1
item_24 = ListItem(List=sort_9.ValuesA, Index=0, Wrap=True)  # -> Item, Item1
merge_18 = Merge(Data1=item_23.Item, Data2=item_23.Item1)
merge_19 = Merge(Data1=item_24.Item, Data2=item_24.Item1)
panel_71 = Panel(merge_18)
smaller_8 = SmallerThan(FirstNumber=merge_18, SecondNumber="100")  # -> SmallerThan, OrEqualTo
dispatch_20 = Dispatch(List=merge_19, DispatchPattern=smaller_8.SmallerThan)  # -> ListA, ListB
crv_64 = Curve(flatten(offset_3))

# ---- group: 制作上层定位平面 / 筛选阴阳角 / F1-阴阳角-点
data_27 = Data(dispatch_20.ListA)

# ---- group: 制作上层定位平面 / 筛选阴阳角 (continued)
check_same_points_3 = CheckSamePoints(archPoint=flatten(pt_3), crvPoint=flatten(data_27))  # -> out, specialPt; inputs archPoint: list of Point3d, crvPoint: list of Point3d; same code as testpoint
cull_i_7 = CullIndex(List=flatten(pt_3), Indices=check_same_points_3.specialPt, Wrap=True)
pull_11 = PullPoint(Point=cull_i_7, Geometry=crv_64, ClosestOnly=True)  # -> ClosestPoint, Distance
ln_9 = Line(StartPoint=pull_11.ClosestPoint, EndPoint=cull_i_7)
rotate_5 = Rotate(Geometry=ln_9, Angle=1.570796327, Plane=cull_i_7)  # -> Geometry, Transform
pl_5 = ConstructPlane(Origin=cull_i_7, XAxis=rotate_5.Geometry, YAxis=ln_9)

# ----
project_15 = Project(Geometry=pl_5, Plane=xy_10)  # -> Geometry, Transform

# ---- group: 上层定位点Plane-去阴阳角
pln_8 = Plane(project_15.Geometry)

# ---- group: 檐口定位平面-All
pln_9 = Plane(pln_8)

# ----
# 三视图
# hidden lines of top+pers view
# move to center
# 如果无法完整的生成埋件的三视图，
# 建议选择埋件的3D在Rhino中将
# Top/Perspective/Front/Right 试图缩放至合适大小后重新运行
panel_72 = Panel("""Top
Perspective
Front
Right""")
m2d_rhino = Make2DRhinoView(Name=panel_72, Clip=True)
number_slider_40 = Slider(1, range=0..10)
pt_11 = Point(Point(957.9296072, 367.7685097, 0))
pt_12 = Point("0,0,0")
recgrid_2 = Rectangular(
    Plane=pt_11,
    SizeX=Slider(12, range=1..20, expression="X*50"),
    SizeY=Slider(10, range=1..20, expression="X*50"),
    ExtentX=number_slider_40,
    ExtentY=number_slider_40)  # -> Cells, Points
flatten_5 = FlattenTree(Tree=recgrid_2.Points, Path="{0}")

# ----
# （6）生成板埋埋件
# 注意：
# 1.记得点一下Compute按钮
# 2.如果无法完整的生成埋件的三视图，
# 建议选择埋件的3D在Rhino中将
# Top/Perspective/Front/Right 试图缩放至合适大小后重新运行
make2d = Make2D(Geometry=move_9.Geometry, View=m2d_rhino, TangentEdges=False, TangentSeams=False, AutoComputeMake2D=False)  # -> VisibleCurves, VisibleIndex, VisibleType, HiddenCurves, HiddenIndex, HiddenType

bang = ExplodeTree(Data=make2d.VisibleCurves)  # -> Branch0, Branch1, Branch2, Branch3, Branch4, Branch5, Branch6, Branch7
divdist = DivideDistance(Curve=make2d.HiddenCurves, Distance=Slider(1, range=0..10))  # -> Points, Tangents, Parameters
graft = GraftTree(Tree=make2d.HiddenCurves, IncludeEmptyLists=True, IncludeNullItems=True)
shatter = Shatter(Curve=graft, Parameters=divdist.Parameters)
dispatch_21 = Dispatch(List=shatter, DispatchPattern=[True, False])  # -> ListA, ListB
crv_65 = Curve(dispatch_21.ListA)
pshift = ShiftPaths(Data=crv_65, Offset=-1)
pshift_2 = ShiftPaths(Data=pshift, Offset=-1)
bang_2 = ExplodeTree(Data=pshift_2)  # -> Branch0, Branch1, Branch2, Branch3, Branch4, Branch5, Branch6, Branch7
entwine_9 = Entwine(Branch00=bang_2.Branch0, Branch01=bang.Branch0, FlattenInputs=True)  # -> flatten(Result)
entwine_10 = Entwine(Branch00=bang_2.Branch1, Branch01=bang.Branch1, FlattenInputs=True)  # -> flatten(Result)
entwine_11 = Entwine(Branch00=entwine_9, Branch01=entwine_10, Branch02=bang.Branch2, Branch03=bang.Branch3, FlattenInputs=True)
group_2 = Group(Objects=entwine_11)
pshift_3 = ShiftPaths(Data=group_2, Offset=-1)
pshift_4 = ShiftPaths(Data=group_2, Offset=-1)
boxprop = BoxProperties(Box=pshift_3)  # -> Center, Diagonal, Area, Volume, Degeneracy
vec2pt = Vector2Pt(PointA=boxprop.Center, PointB=pt_12, Unitize=False)  # -> Vector, Length
move_10 = Move(Geometry=pshift_4, Motion=vec2pt.Vector)  # -> flatten(Geometry), Transform
orient = Orient(Geometry=flatten(move_10.Geometry), Source=PlaneXY(0, 0, 0), Target=flatten_5)  # -> Geometry, Transform
cull_i_8 = CullIndex(List=orient.Geometry, Indices="-1", Wrap=True)
split_6 = SplitList(List=cull_i_8, Index="4")  # -> ListA, ListB
geo_4 = Geometry(split_6.ListA)

# ---- group: 单体定Top/Side
item_25 = ListItem(List=geo_4, Index=Slider(0, range=0..10), Wrap=True)
item_26 = ListItem(List=geo_4, Index=2, Wrap=True)
cluster_2 = Cluster(G=item_25)
cluster_3 = Cluster(G=item_26)

# ----
钢肋板_侧视图 = Rectangle(Plane=PlaneXY(0, 0, 0), XSize=dom_8, YSize=dom_3, Radius=0)  # -> Rectangle, Length
tstat_2 = TreeStatistics(Tree=工字钢_h)  # -> Paths, Length, Count
钢肋板倒角_侧视图 = Rectangle(Plane=PlaneXY(0, 0, 0), XSize=dom_6, YSize=dom_7, Radius=0)  # -> Rectangle, Length
repeat = RepeatData(Data=pline, Length=tstat_2.Length)  # -> simplify(Data)
merge_20 = Merge(Data1=simplify(钢肋板_侧视图.Rectangle), Data2=simplify(repeat), Data3=simplify(钢肋板倒角_侧视图.Rectangle))
division_9 = Division(A=工字钢_h, B="2")
division_10 = Division(A=工字钢_b, B=2)
subtraction_15 = Subtraction(A=division_9, B=工字钢_tf)
repeat_2 = RepeatData(Data=钢埋板_侧视图.Rectangle, Length=tstat_2.Length)  # -> simplify(Data)
mirror = Mirror(Geometry=merge_20, Plane=xz)  # -> Geometry, Transform
addition_11 = Addition(A=subtraction_15, B=Slider(200, range=0..1000))
merge_21 = Merge(Data1=repeat_2, Data2=merge_20, Data3=mirror.Geometry)
addition_12 = Addition(A=addition_11, B=division_7)
X_2 = UnitX(Factor=addition_12)
move_11 = Move(Geometry=merge_21, Motion=X_2)  # -> Geometry, Transform

group_3 = Group(Objects=move_11.Geometry)
rotate_6 = Rotate(Geometry=group_3, Angle=3.141592654, Plane=PlaneXY(0, 0, 0))  # -> Geometry, Transform
boxprop_2 = BoxProperties(Box=rotate_6.Geometry)  # -> Center, Diagonal, Area, Volume, Degeneracy
bbox_2 = BoundingBox(Content=rotate_6.Geometry, Plane=PlaneXY(0, 0, 0))  # -> Box, Box_2
debox = DeconstructBox(Box=bbox_2.Box)  # -> Plane, X, Y, Z
pdecon_2 = Deconstruct(Point=boxprop_2.Center)  # -> XComponent, YComponent, ZComponent
dedomain_3 = DeconstructDomain(Domain=debox.Y)  # -> Start, End
pt_13 = ConstructPoint(XCoordinate=pdecon_2.XComponent, YCoordinate=dedomain_3.Start, ZCoordinate=pdecon_2.ZComponent)
xy_17 = XYPlane(Origin=Point(0, 0, 0))
pl_origin = PlaneOrigin(Base=xy_17, Origin=pt_13)
orient_2 = Orient(Geometry=rotate_6.Geometry, Source=pl_origin, Target=xy_17)  # -> Geometry, Transform
ungroup_2 = Ungroup(Group=orient_2.Geometry)  # -> simplify(Objects)

# ----
# 要连接的梁中线Offest值
num = Number(simplify(division_10))

block = DefineBlock(Geometry=ungroup_2, Attributes=attributes_13, BlockName=concat_3, BasePlane=PlaneXY(0, 0, 0))
deblock_4 = DeconstructBlock(Block=block)  # -> Name, Plane, Geometry
group_4 = Group(Objects=deblock_4.Geometry)
bbox_3 = BoundingBox(Content=group_4, Plane=PlaneXY(0, 0, 0))  # -> Box, Box_2
deplane_6 = DeconstructPlane(Plane=deblock_4.Plane)  # -> Origin, XAxis, YAxis, ZAxis
area_11 = Area(Geometry=bbox_3.Box)  # -> Area, Centroid
move2pt_7 = MoveToPoint(Geometry=deplane_6.Origin, PointA=deplane_6.Origin, PointB=area_11.Centroid)  # -> Moved, Vector, Transform
pl_6 = ConstructPlane(Origin=move2pt_7.Moved, XAxis=deplane_6.YAxis, YAxis=deplane_6.XAxis)
deplane_7 = DeconstructPlane(Plane=pl_6)  # -> Origin, XAxis, YAxis, ZAxis
rotate_7 = Rotate(Geometry=pl_6, Angle="Pi", Plane=pl_6)  # -> Geometry, Transform
amp_7 = Amplitude(Vector=deplane_7.YAxis, Amplitude=multiplication)
move_12 = Move(Geometry=deplane_7.Origin, Motion=amp_7)  # -> Geometry, Transform
srf = Surface(bbox_3.Box)
crv_66 = Curve(srf)
ln_10 = Line(StartPoint=move_12.Geometry, EndPoint=deplane_7.Origin)
ccx_4 = CurveCurve(CurveA=ln_10, CurveB=crv_66)  # -> Points, ParamsA, ParamsB
ln_11 = Line(StartPoint=deplane_7.Origin, EndPoint=ccx_4.Points)
move_13 = Move(Geometry=rotate_7.Geometry, Motion=ln_11)  # -> simplify(Geometry), Transform
amp_8 = Amplitude(Vector=ln_11, Amplitude=expr("-x", number_slider_3))
move_14 = Move(Geometry=move_13.Geometry, Motion=amp_8)  # -> Geometry, Transform

neg_12 = Negative(Value=multiplication)
amp_9 = Amplitude(Vector=deplane_7.YAxis, Amplitude=neg_12)
move_15 = Move(Geometry=deplane_7.Origin, Motion=amp_9)  # -> Geometry, Transform
ln_12 = Line(StartPoint=move_15.Geometry, EndPoint=deplane_7.Origin)
ccx_5 = CurveCurve(CurveA=ln_12, CurveB=crv_66)  # -> Points, ParamsA, ParamsB
ln_13 = Line(StartPoint=deplane_7.Origin, EndPoint=ccx_5.Points)
move_16 = Move(Geometry=rotate_7.Geometry, Motion=ln_13)  # -> simplify(Geometry), Transform

text_2 = DefineTextObject(Text=txt_4, Plane=simplify(move_14.Geometry), DimensionStyle=panel_9, OutputType="Text")
group_5 = Group(Objects=[block, text_2])

merge_22 = Merge(Data1=group_5, Data2=move_16.Geometry)

# ----
# 要连接的embed
data_28 = Data(merge_22)

item_27 = ListItem(List=data_28, Index=0, Wrap=True)
flip = FlipMatrix(Data=item_27)
item_28 = ListItem(List=flip, Index=Slider(9, range=0..15), Wrap=True)
# 第一层
# 
# Curves(location point)+ Smooth Curves(architecture line)
# 测试Smooth Curve是否与每个Block相切
# blocks + smooth curves
# remove duplicate blocks
# blocks + special curves
# 测试Smooth Curve是否与每个Block相切
# blocks + smooth curves
# remove duplicate blocks
# blocks + special curves
# 第一层
# 
# Angular Curves(architecture line)
# 第一层
# 
# Special Curves(architecture line)
# 第一层
# 
# Angular Curves(architecture line)
data_29 = Data(data_28)
# 阳角
# 阴角
# 转角点
item_29 = ListItem(List=data_29, Index=0, Wrap=True)
item_30 = ListItem(List=data_29, Index="-1", Wrap=True)
data_30 = Data(data_28)
item_31 = ListItem(List=data_30, Index="-1", Wrap=True)
# 阴阳角
item_32 = ListItem(List=data_30, Index=0, Wrap=True)
data_31 = Data(data_28)
item_33 = ListItem(List=data_31, Index=0, Wrap=True)
item_34 = ListItem(List=data_31, Index="-1", Wrap=True)
rotate_8 = Rotate(Geometry=item_34, Angle="Pi", Plane=item_34)  # -> Geometry, Transform
data_32 = Data(data_28)
data_33 = Data(data_28)
item_35 = ListItem(List=data_32, Index=0, Wrap=True)
item_36 = ListItem(List=data_32, Index="-1", Wrap=True)
item_37 = ListItem(List=data_33, Index=0, Wrap=True)
item_38 = ListItem(List=data_33, Index="-1", Wrap=True)
rotate_9 = Rotate(Geometry=item_36, Angle="Pi", Plane=item_36)  # -> Geometry, Transform

ungroup_3 = Ungroup(Group=cluster_3)
ungroup_4 = Ungroup(Group=cluster_2)

# ---- group: Top/Side
filter_12 = StreamFilter(Gate=list_6, Stream0=ungroup_4, Stream1=ungroup_3)

# ---- group: Block
attributes_14 = DefineObjectAttributes(Color=ColourSwatch(SwatchColor=RGB(255, 0, 0)))
block_2 = DefineBlock(Geometry=ungroup_4, Attributes=attributes_14, BlockName="Board Plate", BasePlane=PlaneXY(0, 0, 0))

# ----
deblock_5 = DeconstructBlock(Block=block_2)  # -> Name, flatten(Plane), flatten(Geometry)
boundary_2 = BoundarySurfaces(Edges=deblock_5.Geometry)
deplane_8 = DeconstructPlane(Plane=deblock_5.Plane)  # -> Origin, XAxis, YAxis, ZAxis
area_12 = Area(Geometry=boundary_2)  # -> Area, Centroid
move2pt_8 = MoveToPoint(Geometry=flatten(deplane_8.Origin), PointA=flatten(deplane_8.Origin), PointB=flatten(area_12.Centroid))  # -> Moved, Vector, Transform
pl_7 = ConstructPlane(Origin=move2pt_8.Moved, XAxis=deplane_8.XAxis, YAxis=deplane_8.YAxis)  # -> graft(Plane)

deplane_9 = DeconstructPlane(Plane=deblock_5.Plane)  # -> Origin, XAxis, YAxis, ZAxis
amp_10 = Amplitude(Vector=deplane_9.YAxis, Amplitude=number_slider_11)
move_17 = Move(Geometry=deplane_9.Origin, Motion=amp_10)  # -> Geometry, Transform

text_3 = DefineTextObject(Text=panel_14, Plane=move_17.Geometry, DimensionStyle=panel_13, OutputType="Text")
group_6 = Group(Objects=flatten([block_2, text_3]))
entwine_12 = Entwine(Branch00=group_6, Branch01=pl_7, FlattenInputs=True)

data_34 = Data(flatten(entwine_12))
item_39 = ListItem(List=data_34, Index=0, Wrap=True)
item_40 = ListItem(List=data_34, Index="-1", Wrap=True)

ungroup_5 = Ungroup(Group=item_39)
item_41 = ListItem(List=ungroup_5, Index="-1", Wrap=True)
deblock_6 = DeconstructBlock(Block=item_41)  # -> Name, Plane, Geometry
boundary_3 = BoundarySurfaces(Edges=deblock_6.Geometry)
debrep_2 = DeconstructBrep(Brep=boundary_3)  # -> Faces, Edges, Vertices
len_5 = Length(Curve=debrep_2.Edges)
sort_10 = SortList(Keys=len_5, ValuesA=debrep_2.Edges)  # -> Keys, ValuesA
item_42 = ListItem(List=sort_10.ValuesA, Index=0, Wrap=True)
len_6 = Length(Curve=item_42)  # -> expr("x/2", Length)

# ---- group: 车道区域
# 1.是否有檐口线-下层定位点
toggle_4 = BooleanToggle(True)
clean = CleanTree(RemoveNulls=True, RemoveInvalid=True, RemoveEmpty=toggle_4, Tree=pln_5)

# ---- group: 车道区域 / Input ???
deplane_10 = DeconstructPlane(Plane=clean)  # -> Origin, XAxis, YAxis, ZAxis

# ---- group: 车道区域 (continued)
incurve = PointInCurve(Point=deplane_10.Origin, Curve=crv_27)  # -> Relationship, Point
equals_2 = Equality(FirstNumber=incurve.Relationship, SecondNumber="2")  # -> Equality, Inequality
dispatch_22 = Dispatch(List=clean, DispatchPattern=equals_2.Equality)  # -> ListA, ListB

# Site - 有檐口线的定位点
pln_10 = Plane(dispatch_22.ListA)

# Site - 无檐口线的定位点
pln_11 = Plane(dispatch_22.ListB)

# ---- group: 车道区域 / 檐口线-Site
pln_12 = Plane(pln_10)

# ----
incurve_2 = PointInCurve(Point=pln_12, Curve=crv_31)  # -> Relationship, Point
equals_3 = Equality(FirstNumber=incurve_2.Relationship, SecondNumber="2")  # -> Equality, Inequality
dispatch_23 = Dispatch(List=pln_12, DispatchPattern=equals_3.Equality)  # -> ListA, ListB
pln_13 = Plane(dispatch_23.ListA)

incurve_3 = PointInCurve(Point=pln_11, Curve=crv_31)  # -> Relationship, Point
equals_4 = Equality(FirstNumber=incurve_3.Relationship, SecondNumber="2")  # -> Equality, Inequality
dispatch_24 = Dispatch(List=pln_11, DispatchPattern=equals_4.Equality)  # -> ListA, ListB
pln_14 = Plane(dispatch_24.ListA)

# ----
# 1.0无檐口线初筛-下层定位点
pln_15 = Plane(pln_14)

project_16 = Project(Geometry=pln_15, Plane=PlaneXY(0, 0, 0))  # -> Geometry, Transform

# ---- group: All-下层定位点
# 1.1有檐口线
pln_16 = Plane(pln_13)

# ----
pln_17 = Plane(pln_16)

# ----
# 1.是否有檐口线-檐口线定位点
toggle_5 = BooleanToggle(True)
clean_2 = CleanTree(RemoveNulls=True, RemoveInvalid=True, RemoveEmpty=toggle_5, Tree=pln_9)

# ---- group: Input ???
deplane_11 = DeconstructPlane(Plane=clean_2)  # -> Origin, XAxis, YAxis, ZAxis

# ----
incurve_4 = PointInCurve(Point=deplane_11.Origin, Curve=crv_28)  # -> Relationship, Point
equals_5 = Equality(FirstNumber=incurve_4.Relationship, SecondNumber="2")  # -> Equality, Inequality
dispatch_25 = Dispatch(List=clean_2, DispatchPattern=equals_5.Equality)  # -> ListA, ListB

# ----
# Site - 檐口线的定位点
pln_18 = Plane(dispatch_25.ListB)

incurve_5 = PointInCurve(Point=pln_18, Curve=crv_31)  # -> Relationship, Point
equals_6 = Equality(FirstNumber=incurve_5.Relationship, SecondNumber="2")  # -> Equality, Inequality
dispatch_26 = Dispatch(List=pln_18, DispatchPattern=equals_6.Equality)  # -> ListA, ListB
pln_19 = Plane(dispatch_26.ListB)
pln_20 = Plane(dispatch_26.ListA)

# ----
# 1.是否有檐口线-上层定位点
toggle_6 = BooleanToggle(True)
clean_3 = CleanTree(RemoveNulls=True, RemoveInvalid=True, RemoveEmpty=toggle_6, Tree=pln_7)

# ---- group: Input ???
deplane_12 = DeconstructPlane(Plane=clean_3)  # -> Origin, XAxis, YAxis, ZAxis

# ----
incurve_6 = PointInCurve(Point=deplane_12.Origin, Curve=crv_29)  # -> Relationship, Point
equals_7 = Equality(FirstNumber=incurve_6.Relationship, SecondNumber="2")  # -> Equality, Inequality
dispatch_27 = Dispatch(List=clean_3, DispatchPattern=equals_7.Equality)  # -> ListA, ListB

# ----
# Site - 无檐口线的定位点
pln_21 = Plane(dispatch_27.ListB)

incurve_7 = PointInCurve(Point=pln_21, Curve=crv_31)  # -> Relationship, Point
equals_8 = Equality(FirstNumber=incurve_7.Relationship, SecondNumber="2")  # -> Equality, Inequality
dispatch_28 = Dispatch(List=pln_21, DispatchPattern=equals_8.Equality)  # -> ListA, ListB
pln_22 = Plane(dispatch_28.ListA)
pln_23 = Plane(dispatch_28.ListB)

# ----
# 1.0无檐口线初筛-上层定位点
pln_24 = Plane(pln_22)

deplane_13 = DeconstructPlane(Plane=pln_24)  # -> Origin, XAxis, YAxis, ZAxis
incurves = PointInCurves(Point=deplane_13.Origin, Curves=flatten(reb_2))  # -> Relationship, Index, Point
equals_9 = Equality(FirstNumber=incurves.Relationship, SecondNumber="2")  # -> Equality, Inequality
dispatch_29 = Dispatch(List=pln_24, DispatchPattern=equals_9.Equality)  # -> ListA, ListB
data_35 = Data(dispatch_29.ListB)

pln_25 = Plane(dispatch_29.ListA)

# ---- group: 下层交点-除重
# 1.0无檐口线-上层定位点
pln_26 = Plane(data_35)

# ----
# 区分内外梁边线
# 2.根据是否相交判定内外梁(平行于建筑边线方向）
crv_67 = Curve(crv_61)
num_2 = Number(num)
crv_68 = Curve(filter)
offcrv = OffsetCurve(Curve=crv_67, Plane=PlaneXY(0, 0, 0), Distance=num_2, BothSides=expr("-x", num_2), Kinks=0, CapType="0")
midpt_6 = CurveMiddle(Curve=offcrv)
offcrv_2 = OffsetCurve(Curve=crv_67, Plane=PlaneXY(0, 0, 0), Distance=num_2, BothSides=expr("-x", num_2), Kinks=0, CapType="1")
crv_69 = Curve(offcrv)
item_43 = ListItem(List=midpt_6, Index=0, Wrap=True)
item_44 = ListItem(List=crv_69, Index=0, Wrap=True)
item_45 = ListItem(List=crv_69, Index="-1", Wrap=True)
graft_2 = GraftTree(Tree=crv_67, IncludeEmptyLists=True, IncludeNullItems=True)

# ---- group: 梁中线-中点
midpt_7 = CurveMiddle(Curve=crv_67)

# ---- group: Pull到轮廓线
pull_12 = PullPoint(Point=midpt_7, Geometry=flatten(crv_68), ClosestOnly=True)  # -> ClosestPoint, Distance

# ----
# 梁线闭合
shift_2 = ShiftPaths(Data=offcrv_2, Offset=-1)

# ---- group: 和某组梁边线相连
ln_14 = Line(StartPoint=item_43, EndPoint=graft(pull_12.ClosestPoint))

# ----
panel_73 = Panel(num_2)

# ---- group: 有交点为内
ccx_6 = CurveCurve(CurveA=ln_14, CurveB=graft_2)  # -> Points, ParamsA, ParamsB

# ----
null_5 = NullItem(Item=ccx_6.Points)  # -> NullFlags, InvalidFlags, Description
dispatch_30 = Dispatch(List=item_44, DispatchPattern=null_5.InvalidFlags)  # -> ListA, ListB
dispatch_31 = Dispatch(List=item_45, DispatchPattern=null_5.InvalidFlags)  # -> ListA, ListB

# ----
# 梁边线-内
merge_23 = Merge(Data1=dispatch_30.ListB, Data2=dispatch_31.ListA)

# ----
# 梁边线-外
merge_24 = Merge(Data1=dispatch_30.ListA, Data2=dispatch_31.ListB)

# ---- group: 梁-外侧
crv_70 = Curve(merge_24)

# ---- group: 下层交点-除重 / 梁外侧
crv_71 = Curve(merge_24)

# ----
crv_72 = Curve(shift_2)

# ---- group: 梁内侧
crv_73 = Curve(merge_23)

crv_74 = Curve(merge_23)

# ---- group: 梁内测
crv_75 = Curve(merge_23)

# ---- group: 梁外侧
crv_76 = Curve(merge_24)

# ----
crv_77 = Curve(shift_2)

# ---- group: 梁外侧
crv_78 = Curve(merge_24)

crv_79 = Curve(merge_24)

crv_80 = Curve(merge_24)

# ---- group: 内侧梁线
crv_81 = Curve(merge_23)

# ---- group: 梁外侧
crv_82 = Curve(crv_76)

# ---- group: 梁内侧
crv_83 = Curve(crv_81)

# ---- group: 梁外侧
crv_84 = Curve(merge_24)

crv_85 = Curve(merge_24)

# ----
crv_86 = Curve(shift_2)

# ---- group: 梁外侧
crv_87 = Curve(crv_76)

# ---- group: 梁内侧
crv_88 = Curve(crv_81)

# ----
merge_25 = Merge(Data1=merge_23, Data2=merge_24)

# ---- group: 内侧梁线
crv_89 = Curve(merge_23)

# ---- group: 梁外侧
crv_90 = Curve(merge_24)

# ----
crv_91 = Curve([crv_90, crv_89])
flatten_6 = FlattenTree(Tree=crv_91, Path="{0}")
boundary_4 = BoundarySurfaces(Edges=[offset_9, offset_10])
scx = SurfaceCurve(Surface=boundary_4, Curve=flatten_6)  # -> simplify(Curves), Points, UVPoints, Normals, Parameters, Tangents

# ---- group: 梁中线
crv_92 = Curve(crv_67)

# ---- group: 梁内侧
crv_93 = Curve(crv_81)

crv_94 = Curve(crv_81)

# ----
# 1.1 有檐口-整个site一起处理
data_36 = Data(pln_20)
pln_27 = Plane(data_36)
deplane_14 = DeconstructPlane(Plane=pln_27)  # -> Origin, XAxis, YAxis, ZAxis
amp_11 = Amplitude(Vector=deplane_14.YAxis, Amplitude=number_slider_23)
amp_12 = Amplitude(Vector=deplane_14.YAxis, Amplitude=number_slider_22)
move_18 = Move(Geometry=deplane_14.Origin, Motion=expr("-x", amp_12))  # -> Geometry, Transform
move_19 = Move(Geometry=deplane_14.Origin, Motion=amp_11)  # -> Geometry, Transform
ln_15 = Line(StartPoint=move_18.Geometry, EndPoint=move_19.Geometry)
project_17 = Project(Geometry=crv_70, Plane=PlaneXY(0, 0, 0))  # -> Geometry, Transform
project_18 = Project(Geometry=ln_15, Plane=PlaneXY(0, 0, 0))  # -> Geometry, Transform
merge_26 = Merge(Data1=crv_34, Data2=crv_33)
ccx_7 = CurveCurve(CurveA=graft(project_18.Geometry), CurveB=flatten(project_17.Geometry))  # -> Points, ParamsA, ParamsB
project_19 = Project(Geometry=merge_26, Plane=PlaneXY(0, 0, 0))  # -> Geometry, Transform
shift_3 = ShiftPaths(Data=ccx_7.Points, Offset=-1)
pull_13 = PullPoint(Point=shift_3, Geometry=flatten(project_19.Geometry), ClosestOnly=True)  # -> ClosestPoint, Distance
sort_11 = SortList(Keys=pull_13.Distance, ValuesA=shift_3)  # -> Keys, ValuesA
item_46 = ListItem(List=sort_11.ValuesA, Index=0, Wrap=True)
null_6 = NullItem(Item=flatten(item_46))  # -> NullFlags, InvalidFlags, Description
dispatch_32 = Dispatch(List=flatten(item_46), DispatchPattern=null_6.InvalidFlags)  # -> ListA, ListB
dispatch_33 = Dispatch(List=pln_27, DispatchPattern=null_6.InvalidFlags)  # -> ListA, ListB
crv_95 = Curve(shift_2)

# ---- group: 交点对应的初始Plane
data_37 = Data(dispatch_33.ListB)

# ---- group: 交点Point
data_38 = Data(dispatch_32.ListB)

# ----
# 按照梁分类定位点
pt_14 = Point(data_38)
incurves_2 = PointInCurves(Point=flatten(pt_14), Curves=crv_95)  # -> Relationship, Index, Point
equals_10 = Equality(FirstNumber=incurves_2.Relationship, SecondNumber="0")  # -> Equality, Inequality
dispatch_34 = Dispatch(List=flatten(pt_14), DispatchPattern=equals_10.Inequality)  # -> ListA, ListB

# ---- group: 交点-属于哪个梁
data_39 = Data(dispatch_34.ListA)

# ----
cullduppoints_2 = RemoveDuplicatePoints(InputPoints=data_39, Tolerance=0.001)  # -> OutputPoints, FirstPointIndexes

check_same_points_4 = CheckSamePoints(archPoint=pln_27, crvPoint=data_37)  # -> out, specialPt; inputs archPoint: list of Point3d, crvPoint: list of Point3d; same code as testpoint

# ----
# 0无檐口线
# 与梁不相交
cull_i_9 = CullIndex(List=pln_27, Indices=check_same_points_4.specialPt, Wrap=True)

# ----
# 0 檐口出定位点
# 与结构无交点
pln_28 = Plane(cull_i_9)

# ----
# 0.Missing Point-二次筛选檐口处
# 埋件定位点Offset，没有找到和梁的交点
deplane_15 = DeconstructPlane(Plane=pln_28)  # -> Origin, XAxis, YAxis, ZAxis
amp_13 = Amplitude(Vector=deplane_15.YAxis, Amplitude=expr("-X", number_slider_22))
move_20 = Move(Geometry=deplane_15.Origin, Motion=amp_13)  # -> Geometry, Transform
ln_16 = Line(StartPoint=move_20.Geometry, EndPoint=deplane_15.Origin)
amp_14 = Amplitude(Vector=deplane_15.XAxis, Amplitude=number_slider_7)
amp_15 = Amplitude(Vector=deplane_15.XAxis, Amplitude=expr("-x", number_slider_7))

# ---- group: 2条Offset的探针找交点
move_21 = Move(Geometry=ln_16, Motion=amp_15)  # -> Geometry, Transform
move_22 = Move(Geometry=ln_16, Motion=amp_14)  # -> Geometry, Transform

# ----
deplane_16 = DeconstructPlane(Plane=project_16.Geometry)  # -> Origin, XAxis, YAxis, ZAxis

pt_15 = Point(deplane_16.Origin)

incurves_3 = PointInCurves(Point=pt_15, Curves=flatten(reb_2))  # -> Relationship, Index, Point
equals_11 = Equality(FirstNumber=incurves_3.Relationship, SecondNumber="2")  # -> Equality, Inequality
dispatch_35 = Dispatch(List=project_16.Geometry, DispatchPattern=equals_11.Equality)  # -> ListA, ListB
data_40 = Data(dispatch_35.ListB)

pln_29 = Plane(dispatch_35.ListA)

data_41 = Data(dispatch_35.ListA)

# ---- group: 下层交点-除重
# 1.0无檐口线-下层定位点
pln_30 = Plane(data_40)

# ----
# 按照梁分类定位PLANE
crv_96 = Curve(merge_23)
shift_4 = ShiftPaths(Data=crv_96, Offset=-1)
shift_5 = ShiftPaths(Data=shift_4, Offset=-1)
pull_14 = PullPoint(Point=cullduppoints_2.OutputPoints, Geometry=simplify(shift_5), ClosestOnly=True)  # -> ClosestPoint, Distance
ln_17 = Line(StartPoint=pull_14.ClosestPoint, EndPoint=cullduppoints_2.OutputPoints)
crv_97 = Curve(crv_28)
movetoplane_4 = MoveToPlane(Geometry=crv_97, Plane=PlaneXY(0, 0, 0), Above=True, Below=True)  # -> Geometry, Transform

# ---- group: Y Axis Line-All
crv_98 = Curve(ln_17)

# ---- group: 下层交点-除重
# 1.0 无檐口线+上下层幕墙边线连续
pln_31 = Plane(pln_26)
pln_32 = Plane(pln_30)
deplane_17 = DeconstructPlane(Plane=pln_31)  # -> Origin, XAxis, YAxis, ZAxis
deplane_18 = DeconstructPlane(Plane=pln_32)  # -> Origin, XAxis, YAxis, ZAxis
number_slider_41 = Slider(3584, range=0..10000)
number_slider_42 = Slider(3584, range=0..10000)
amp_16 = Amplitude(Vector=deplane_18.YAxis, Amplitude=expr("-x", number_slider_42))
amp_17 = Amplitude(Vector=deplane_18.YAxis, Amplitude=number_slider_42)
amp_18 = Amplitude(Vector=deplane_17.YAxis, Amplitude=expr("-x", number_slider_41))
amp_19 = Amplitude(Vector=deplane_17.YAxis, Amplitude=number_slider_41)
move_23 = Move(Geometry=deplane_18.Origin, Motion=amp_16)  # -> Geometry, Transform
move_24 = Move(Geometry=deplane_18.Origin, Motion=amp_17)  # -> Geometry, Transform
move_25 = Move(Geometry=deplane_17.Origin, Motion=amp_18)  # -> Geometry, Transform
move_26 = Move(Geometry=deplane_17.Origin, Motion=amp_19)  # -> Geometry, Transform
ln_18 = Line(StartPoint=move_25.Geometry, EndPoint=move_26.Geometry)
ln_19 = Line(StartPoint=move_23.Geometry, EndPoint=move_24.Geometry)
pln_33 = Plane(pln_32)
pt_16 = Point(deplane_17.Origin)

# ---- group: 下层交点-除重 / F1-交点
ccx_8 = CurveCurve(CurveA=graft(ln_19), CurveB=crv_36)  # -> Points, ParamsA, ParamsB

# ---- group: 下层交点-除重 / F2-交点
ccx_9 = CurveCurve(CurveA=graft(ln_18), CurveB=crv_35)  # -> Points, ParamsA, ParamsB

# ----
end_4 = EndPoints(Curve=graft(crv_98))  # -> Start, End
merge_27 = Merge(Data1=end_4.Start, Data2=end_4.End)
pull_15 = PullPoint(Point=merge_27, Geometry=movetoplane_4.Geometry, ClosestOnly=True)  # -> ClosestPoint, Distance
sort_12 = SortList(Keys=pull_15.Distance, ValuesA=merge_27)  # -> Keys, ValuesA
item_47 = ListItem(List=sort_12.ValuesA, Index="-1", Wrap=True)
item_48 = ListItem(List=sort_12.ValuesA, Index=0, Wrap=True)

null_7 = NullItem(Item=item_47)  # -> NullFlags, InvalidFlags, Description
null_8 = NullItem(Item=item_48)  # -> NullFlags, InvalidFlags, Description
dispatch_36 = Dispatch(List=item_48, DispatchPattern=null_8.NullFlags)  # -> ListA, ListB
dispatch_37 = Dispatch(List=item_47, DispatchPattern=null_7.NullFlags)  # -> ListA, ListB
panel_74 = Panel(dispatch_36.ListB)

pt_17 = Point(dispatch_36.ListB)
pt_18 = Point(dispatch_37.ListB)
ln_20 = Line(StartPoint=pt_18, EndPoint=pt_17)
rotate_10 = Rotate(Geometry=ln_20, Angle=1.570796327, Plane=pt_17)  # -> Geometry, Transform

end_5 = EndPoints(Curve=graft(ln_20))  # -> Start, End
pt_19 = Point(end_5.End)
flatten_7 = FlattenTree(Tree=pt_19, Path="{0}")

pl_8 = ConstructPlane(Origin=pt_19, XAxis=rotate_10.Geometry, YAxis=ln_20)
null_9 = NullItem(Item=pl_8)  # -> NullFlags, InvalidFlags, Description
dispatch_38 = Dispatch(List=pl_8, DispatchPattern=null_9.NullFlags)  # -> ListA, ListB
pln_34 = Plane(dispatch_38.ListB)

item_49 = ListItem(List=flatten_7, Index=Slider(30, range=0..30), Wrap=True)
shift_6 = ShiftPaths(Data=pln_34, Offset=-1)
shift_7 = ShiftPaths(Data=shift_6, Offset=-1)  # -> simplify(Data)

# ---- group: 檐口-首次筛选的有效起始Plane
data_42 = Data(shift_7)

# ----
# 1.1 檐口处侧埋，钢板焊
# 02：钢板焊埋件[钢梁外侧]
# @钢边梁宽@钢边梁高
pln_35 = Plane(data_42)

# ---- group: 下层交点-除重 (continued)
pull_16 = PullPoint(Point=ccx_9.Points, Geometry=deplane_17.Origin, ClosestOnly=True)  # -> ClosestPoint, Distance
pull_17 = PullPoint(Point=ccx_8.Points, Geometry=deplane_18.Origin, ClosestOnly=True)  # -> ClosestPoint, Distance
sort_13 = SortList(Keys=pull_17.Distance, ValuesA=ccx_8.Points)  # -> Keys, ValuesA
sort_14 = SortList(Keys=pull_16.Distance, ValuesA=ccx_9.Points)  # -> Keys, ValuesA
item_50 = ListItem(List=sort_13.ValuesA, Index=0, Wrap=True)  # -> flatten(Item)
item_51 = ListItem(List=sort_14.ValuesA, Index=0, Wrap=True)  # -> flatten(Item)
null_10 = NullItem(Item=item_50)  # -> NullFlags, InvalidFlags, Description
null_11 = NullItem(Item=item_51)  # -> NullFlags, InvalidFlags, Description
dispatch_39 = Dispatch(List=item_50, DispatchPattern=null_10.NullFlags)  # -> ListA, ListB
dispatch_40 = Dispatch(List=item_51, DispatchPattern=null_11.NullFlags)  # -> ListA, ListB

pt_20 = Point(dispatch_39.ListB)

# ---- group: 下层交点-除重 / 上层交点-除重
pt_21 = Point(dispatch_40.ListB)

# ---- group: 下层交点-除重 (continued)
pull_18 = PullPoint(Point=pt_20, Geometry=pt_21, ClosestOnly=True)  # -> ClosestPoint, Distance
sort_15 = SortList(Keys=pull_18.Distance, ValuesA=pull_18.ClosestPoint)  # -> Keys, ValuesA
panel_75 = Panel(sort_15.Keys)
larger_6 = LargerThan(FirstNumber=pull_18.Distance, SecondNumber=number_slider_24)  # -> LargerThan, OrEqualTo
dispatch_41 = Dispatch(List=pt_20, DispatchPattern=larger_6.LargerThan)  # -> ListA, ListB
pull_19 = PullPoint(Point=deplane_18.Origin, Geometry=graft(pt_20), ClosestOnly=True)  # -> ClosestPoint, Distance
sort_16 = SortList(Keys=pull_19.Distance, ValuesA=pln_33)  # -> Keys, ValuesA
item_52 = ListItem(List=sort_16.ValuesA, Index=0, Wrap=True)
check_same_points_5 = CheckSamePoints(archPoint=pln_33, crvPoint=flatten(item_52))  # -> out, specialPt; inputs archPoint: list of Point3d, crvPoint: list of Point3d; same code as testpoint

# ---- group: 下层交点-除重 / 2组交点距离大于容差-默认不同点
dispatch_42 = Dispatch(List=pull_18.ClosestPoint, DispatchPattern=larger_6.LargerThan)  # -> ListA, ListB

# ---- group: 下层交点-除重 / 大于容差算作新点
pt_22 = Point(dispatch_42.ListA)

# ---- group: 下层交点-除重 / 有效Plane-下层建筑线在该处连续
item_53 = ListItem(List=pln_33, Index=check_same_points_5.specialPt, Wrap=True)

# ----
cull_i_10 = CullIndex(List=pln_33, Indices=check_same_points_5.specialPt, Wrap=True)
merge_28 = Merge(Data1=cull_i_10, Data2=pln_17)  # -> flatten(Result)

# ----
# 和下层楼板发生关系的定位点
pln_36 = Plane(merge_28)

# ---- group: 起始Plane
pln_37 = Plane(pln_36)

# ----
# 初筛： 最近的梁到定位点距离在300-600间保留
pln_38 = Plane(pln_37)
deplane_19 = DeconstructPlane(Plane=pln_38)  # -> Origin, XAxis, YAxis, ZAxis
amp_20 = Amplitude(Vector=deplane_19.YAxis, Amplitude=expr("-x", Slider(2000, range=0..10000)))
move_27 = Move(Geometry=deplane_19.Origin, Motion=amp_20)  # -> Geometry, Transform
ln_21 = Line(StartPoint=deplane_19.Origin, EndPoint=move_27.Geometry)
ccx_10 = CurveCurve(CurveA=flatten(crv_79), CurveB=simplify(graft(ln_21)))  # -> Points, ParamsA, ParamsB
shift_8 = ShiftPaths(Data=ccx_10.Points, Offset=-1)
graft_3 = GraftTree(Tree=deplane_19.Origin, IncludeEmptyLists=True, IncludeNullItems=True)  # -> simplify(Tree)
pull_20 = PullPoint(Point=shift_8, Geometry=graft_3, ClosestOnly=True)  # -> ClosestPoint, Distance
sort_17 = SortList(Keys=pull_20.Distance, ValuesA=shift_8)  # -> Keys, ValuesA
graft_4 = GraftTree(Tree=pln_38, IncludeEmptyLists=True, IncludeNullItems=True)  # -> flatten(Tree)
item_54 = ListItem(List=sort_17.Keys, Index=0, Wrap=True)  # -> flatten(Item)
c_script = CSharpScript(num=item_54, Max="600", Min="300")  # -> out, A, Distance; inputs num: list of Double, Max: Double
# ---------- c_script: C# ----------
    for(int i = 0; i < num.Count; i++){
      if(num[i] > 300 && num[i] < 600){
        Print(i.ToString());
        index.Add(i);
        dist.Add(num[i]);

      }
    }

    A = index;
    Distance = dist;
# ---------- c_script: C# additional code ----------
  List<double> index = new List<double>();
  List<double> dist = new List<double>();
# ---------- end c_script ----------
item_55 = ListItem(List=graft_4, Index=c_script.A, Wrap=True)

item_56 = ListItem(List=sort_17.ValuesA, Index=0, Wrap=True)  # -> flatten(Item)
item_57 = ListItem(List=item_56, Index=c_script.A, Wrap=True)

pln_39 = Plane(item_55)
boundary_5 = BoundarySurfaces(Edges=[offset_6, offset_5])
number_slider_43 = Slider(3584, range=0..10000)
deplane_20 = DeconstructPlane(Plane=pln_39)  # -> Origin, XAxis, YAxis, ZAxis
scx_2 = SurfaceCurve(Surface=boundary_5, Curve=crv_80)  # -> flatten(Curves), Points, UVPoints, Normals, Parameters, Tangents
amp_21 = Amplitude(Vector=deplane_20.YAxis, Amplitude=number_slider_43)
amp_22 = Amplitude(Vector=deplane_20.YAxis, Amplitude=expr("-x", number_slider_43))
move_28 = Move(Geometry=deplane_20.Origin, Motion=amp_22)  # -> Geometry, Transform
move_29 = Move(Geometry=deplane_20.Origin, Motion=amp_21)  # -> Geometry, Transform
ln_22 = Line(StartPoint=move_28.Geometry, EndPoint=move_29.Geometry)
ccx_11 = CurveCurve(CurveA=graft(ln_22), CurveB=scx_2.Curves)  # -> Points, ParamsA, ParamsB
shift_9 = ShiftPaths(Data=ccx_11.Points, Offset=-1)
pull_21 = PullPoint(Point=graft(pln_39), Geometry=shift_9, ClosestOnly=True)  # -> ClosestPoint, Distance
sort_18 = SortList(Keys=pull_21.Distance, ValuesA=pull_21.ClosestPoint)  # -> Keys, ValuesA
item_58 = ListItem(List=sort_18.ValuesA, Index=0, Wrap=True)
null_12 = NullItem(Item=item_58)  # -> NullFlags, simplify(InvalidFlags), Description
null_13 = NullItem(Item=sort_18.ValuesA)  # -> NullFlags, simplify(InvalidFlags), Description
dispatch_43 = Dispatch(List=simplify(graft(pln_39)), DispatchPattern=null_13.InvalidFlags)  # -> ListA, ListB
dispatch_44 = Dispatch(List=simplify(graft(item_58)), DispatchPattern=null_12.InvalidFlags)  # -> ListA, ListB
pt_23 = Point(item_57)
pln_40 = Plane(dispatch_43.ListB)
pln_41 = Plane(dispatch_43.ListA)

# ----
# 按照梁分类定位点
crv_99 = Curve(shift_2)
pt_24 = Point(pt_23)
incurves_4 = PointInCurves(Point=flatten(pt_24), Curves=crv_99)  # -> Relationship, Index, Point
equals_12 = Equality(FirstNumber=incurves_4.Relationship, SecondNumber="0")  # -> Equality, Inequality
dispatch_45 = Dispatch(List=flatten(pt_24), DispatchPattern=equals_12.Inequality)  # -> ListA, ListB

# ---- group: 交点-属于哪个梁
data_43 = Data(dispatch_45.ListA)

# ----
# 可能的结构交点-大量
null_14 = NullItem(Item=item_56)  # -> NullFlags, InvalidFlags, Description
dispatch_46 = Dispatch(List=pln_38, DispatchPattern=null_14.NullFlags)  # -> ListA, ListB
pln_42 = Plane(dispatch_46.ListA)

# ----
# 0 檐口出定位点
# 与结构无交点
pln_43 = Plane(flatten(pln_42))

# ---- group: 下层交点-除重 (continued)
pull_22 = PullPoint(Point=pt_22, Geometry=pt_16, ClosestOnly=True)  # -> ClosestPoint, Distance
check_same_points_6 = CheckSamePoints(archPoint=pt_16, crvPoint=flatten(pull_22.ClosestPoint))  # -> out, specialPt; inputs archPoint: list of Point3d, crvPoint: list of Point3d; same code as testpoint

# ---- group: 下层交点-除重 / 有效Plane-上层建筑线在该处连续
item_59 = ListItem(List=pln_26, Index=check_same_points_6.specialPt, Wrap=True)

# ----
ccx_12 = CurveCurve(CurveA=graft(move_21.Geometry), CurveB=flatten(merge_24))  # -> Points, ParamsA, ParamsB
shift_10 = ShiftPaths(Data=ccx_12.Points, Offset=-1)
pull_23 = PullPoint(Point=shift_10, Geometry=graft(pln_28), ClosestOnly=True)  # -> ClosestPoint, Distance
sort_19 = SortList(Keys=pull_23.Distance, ValuesA=pull_23.ClosestPoint)  # -> Keys, ValuesA

# ---- group: 最远交点
item_60 = ListItem(List=sort_19.ValuesA, Index="-1", Wrap=True)

# ----
null_15 = NullItem(Item=flatten(item_60))  # -> NullFlags, InvalidFlags, Description
dispatch_47 = Dispatch(List=simplify(item_60), DispatchPattern=simplify(graft(null_15.InvalidFlags)))  # -> ListA, ListB
dispatch_48 = Dispatch(List=pln_28, DispatchPattern=null_15.InvalidFlags)  # -> ListA, ListB
pt_25 = Point(dispatch_47.ListB)
pln_44 = Plane(dispatch_48.ListB)
move2pt_9 = MoveToPoint(Geometry=pln_44, PointA=pln_44, PointB=flatten(pt_25))  # -> Moved, Vector, Transform

pln_45 = Plane(dispatch_48.ListA)

# ----
# 按照梁分类定位点
pt_26 = Point(pt_25)
incurves_5 = PointInCurves(Point=flatten(pt_26), Curves=crv_72)  # -> Relationship, Index, Point
equals_13 = Equality(FirstNumber=incurves_5.Relationship, SecondNumber="0")  # -> Equality, Inequality
dispatch_49 = Dispatch(List=flatten(pt_26), DispatchPattern=equals_13.Inequality)  # -> ListA, ListB

# ---- group: 交点-属于哪个梁
data_44 = Data(dispatch_49.ListA)

# ----
ccx_13 = CurveCurve(CurveA=graft(move_22.Geometry), CurveB=flatten(merge_24))  # -> Points, ParamsA, ParamsB
shift_11 = ShiftPaths(Data=ccx_13.Points, Offset=-1)
pull_24 = PullPoint(Point=shift_11, Geometry=graft(pln_28), ClosestOnly=True)  # -> ClosestPoint, Distance
sort_20 = SortList(Keys=pull_24.Distance, ValuesA=pull_24.ClosestPoint)  # -> Keys, ValuesA

# ---- group: 最远交点
item_61 = ListItem(List=sort_20.ValuesA, Index="-1", Wrap=True)

# ----
null_16 = NullItem(Item=flatten(item_61))  # -> NullFlags, InvalidFlags, Description
dispatch_50 = Dispatch(List=simplify(item_61), DispatchPattern=simplify(graft(null_16.InvalidFlags)))  # -> ListA, ListB
dispatch_51 = Dispatch(List=pln_28, DispatchPattern=null_16.InvalidFlags)  # -> ListA, ListB
pt_27 = Point(dispatch_50.ListB)
pln_46 = Plane(dispatch_51.ListB)
move2pt_10 = MoveToPoint(Geometry=pln_46, PointA=pln_46, PointB=flatten(pt_27))  # -> Moved, Vector, Transform

pln_47 = Plane(dispatch_51.ListA)
check_same_points_7 = CheckSamePoints(archPoint=pln_47, crvPoint=pln_45)  # -> out, specialPt; inputs archPoint: list of Point3d, crvPoint: list of Point3d; same code as testpoint
cset = CreateSet(List=check_same_points_7.specialPt)  # -> Set, Map

# ----
# 按照梁分类定位点
pt_28 = Point(pt_27)
incurves_6 = PointInCurves(Point=flatten(pt_28), Curves=crv_72)  # -> Relationship, Index, Point
equals_14 = Equality(FirstNumber=incurves_6.Relationship, SecondNumber="0")  # -> Equality, Inequality
dispatch_52 = Dispatch(List=flatten(pt_28), DispatchPattern=equals_14.Inequality)  # -> ListA, ListB

item_62 = ListItem(List=pln_47, Index=cset.Set, Wrap=True)

# ---- group: 交点-属于哪个梁
data_45 = Data(dispatch_52.ListA)

# ----
# 未生成檐口线
pt_29 = Point(item_62)

# ----
# （10）需人工排布
pt_30 = Point(pt_29)
bake_2 = BakeObjects(Geometry=pt_30, Attributes=attributes_2, BakeName=panel_57, Bake=False)

# ---- group: 下层交点-除重 (continued)
merge_29 = Merge(Data1=item_53, Data2=item_59)  # -> flatten(Result)
deplane_21 = DeconstructPlane(Plane=merge_29)  # -> Origin, XAxis, YAxis, ZAxis
amp_23 = Amplitude(Vector=deplane_21.YAxis, Amplitude=expr("-x", Slider(2756, range=0..10000)))
move_30 = Move(Geometry=deplane_21.Origin, Motion=amp_23)  # -> Geometry, Transform

# ---- group: 下层交点-除重 / 相内探索
ln_23 = Line(StartPoint=deplane_21.Origin, EndPoint=move_30.Geometry)

# ---- group: 下层交点-除重 (continued)
ccx_14 = CurveCurve(CurveA=graft(ln_23), CurveB=flatten(crv_71))  # -> Points, ParamsA, ParamsB
shift_12 = ShiftPaths(Data=ccx_14.Points, Offset=-1)
pull_25 = PullPoint(Point=deplane_21.Origin, Geometry=shift_12, ClosestOnly=True)  # -> ClosestPoint, Distance
sort_21 = SortList(Keys=pull_25.Distance, ValuesA=pull_25.ClosestPoint)  # -> Keys, ValuesA

# ---- group: 下层交点-除重 / 与梁最近交点
item_63 = ListItem(List=sort_21.ValuesA, Index=0, Wrap=True)

# ---- group: 下层交点-除重 (continued)
null_17 = NullItem(Item=flatten(item_63))  # -> NullFlags, InvalidFlags, Description
dispatch_53 = Dispatch(List=merge_29, DispatchPattern=null_17.InvalidFlags)  # -> ListA, ListB
dispatch_54 = Dispatch(List=flatten(item_63), DispatchPattern=null_17.InvalidFlags)  # -> ListA, ListB

# ---- group: 下层交点-除重 / 有效起始Plane
data_46 = Data(dispatch_53.ListB)

# ---- group: 下层交点-除重 / 去除Null的交点
data_47 = Data(dispatch_54.ListB)

# ---- group: 下层交点-除重 (continued)
flatten_8 = FlattenTree(Tree=data_47, Path="{0}")
ln_24 = Line(StartPoint=data_46, EndPoint=flatten_8)

# ----
# 1.0
data_48 = Data(data_47)
crv_100 = Curve(shift_2)

pt_31 = Point(data_48)
incurves_7 = PointInCurves(Point=flatten(pt_31), Curves=crv_100)  # -> Relationship, Index, Point
equals_15 = Equality(FirstNumber=incurves_7.Relationship, SecondNumber="0")  # -> Equality, Inequality
dispatch_55 = Dispatch(List=flatten(pt_31), DispatchPattern=equals_15.Inequality)  # -> ListA, ListB

panel_76 = Panel(dispatch_55.ListA)

# ---- group: 交点-属于哪个梁
data_49 = Data(dispatch_55.ListA)

# ----
# 1.0无檐口线
# 与梁不相交
# 与梁无交点的定位点
pln_48 = Plane(dispatch_53.ListA)

# ----
# 0 檐口出定位点
# 与结构无交点
pln_49 = Plane(flatten(pln_48))

# ----
# 按照梁分类定位PLANE
crv_101 = Curve(merge_23)
shift_13 = ShiftPaths(Data=crv_101, Offset=-1)
shift_14 = ShiftPaths(Data=shift_13, Offset=-1)
pull_26 = PullPoint(Point=data_44, Geometry=simplify(shift_14), ClosestOnly=True)  # -> ClosestPoint, Distance
ln_25 = Line(StartPoint=pull_26.ClosestPoint, EndPoint=data_44)
crv_102 = Curve(crv_28)
movetoplane_5 = MoveToPlane(Geometry=crv_102, Plane=PlaneXY(0, 0, 0), Above=True, Below=True)  # -> Geometry, Transform

# ---- group: Y Axis Line-All
crv_103 = Curve(ln_25)

# ----
# 按照梁分类定位PLANE
crv_104 = Curve(merge_23)
shift_15 = ShiftPaths(Data=crv_104, Offset=-1)
shift_16 = ShiftPaths(Data=shift_15, Offset=-1)
pull_27 = PullPoint(Point=data_45, Geometry=simplify(shift_16), ClosestOnly=True)  # -> ClosestPoint, Distance
ln_26 = Line(StartPoint=pull_27.ClosestPoint, EndPoint=data_45)
crv_105 = Curve(crv_28)
movetoplane_6 = MoveToPlane(Geometry=crv_105, Plane=PlaneXY(0, 0, 0), Above=True, Below=True)  # -> Geometry, Transform

# ---- group: Y Axis Line-All
crv_106 = Curve(ln_26)

# ----
end_6 = EndPoints(Curve=graft(crv_103))  # -> Start, End
merge_30 = Merge(Data1=end_6.Start, Data2=end_6.End)
pull_28 = PullPoint(Point=merge_30, Geometry=movetoplane_5.Geometry, ClosestOnly=True)  # -> ClosestPoint, Distance
sort_22 = SortList(Keys=pull_28.Distance, ValuesA=merge_30)  # -> Keys, ValuesA
item_64 = ListItem(List=sort_22.ValuesA, Index="-1", Wrap=True)
item_65 = ListItem(List=sort_22.ValuesA, Index=0, Wrap=True)
pt_32 = Point(item_65)
pt_33 = Point(item_64)
ln_27 = Line(StartPoint=pt_33, EndPoint=pt_32)
rotate_11 = Rotate(Geometry=ln_27, Angle=1.570796327, Plane=pt_32)  # -> Geometry, Transform
pt_34 = Point(end_6.End)

pl_9 = ConstructPlane(Origin=pt_34, XAxis=rotate_11.Geometry, YAxis=ln_27)
null_18 = NullItem(Item=pl_9)  # -> NullFlags, InvalidFlags, Description
dispatch_56 = Dispatch(List=pl_9, DispatchPattern=null_18.NullFlags)  # -> ListA, ListB

pln_50 = Plane(dispatch_56.ListB)
shift_17 = ShiftPaths(Data=pln_50, Offset=-1)  # -> simplify(Data)

end_7 = EndPoints(Curve=graft(crv_106))  # -> Start, End
merge_31 = Merge(Data1=end_7.Start, Data2=end_7.End)
pull_29 = PullPoint(Point=merge_31, Geometry=movetoplane_6.Geometry, ClosestOnly=True)  # -> ClosestPoint, Distance
sort_23 = SortList(Keys=pull_29.Distance, ValuesA=merge_31)  # -> Keys, ValuesA
item_66 = ListItem(List=sort_23.ValuesA, Index="-1", Wrap=True)
item_67 = ListItem(List=sort_23.ValuesA, Index=0, Wrap=True)
pt_35 = Point(item_67)
pt_36 = Point(item_66)
ln_28 = Line(StartPoint=pt_36, EndPoint=pt_35)
rotate_12 = Rotate(Geometry=ln_28, Angle=1.570796327, Plane=pt_35)  # -> Geometry, Transform

pt_37 = Point(end_7.End)

pl_10 = ConstructPlane(Origin=pt_37, XAxis=rotate_12.Geometry, YAxis=ln_28)
null_19 = NullItem(Item=pl_10)  # -> NullFlags, InvalidFlags, Description
dispatch_57 = Dispatch(List=pl_10, DispatchPattern=null_19.NullFlags)  # -> ListA, ListB

pln_51 = Plane(dispatch_57.ListB)
shift_18 = ShiftPaths(Data=pln_51, Offset=-1)  # -> simplify(Data)

# ----
# 撞到梁交点
pln_52 = Plane(shift_17)
pln_53 = Plane(shift_18)

merge_32 = Merge(Data1=pln_35, Data2=pln_53, Data3=pln_52)
orient_3 = Orient(Geometry=item_29, Source=item_30, Target=merge_32)  # -> Geometry, Transform

data_50 = Data(orient_3.Geometry)
ungroup_6 = Ungroup(Group=data_50)
item_68 = ListItem(List=ungroup_6, Index=0, Wrap=True)  # -> flatten(Item)
item_69 = ListItem(List=ungroup_6, Index="-1", Wrap=True)  # -> flatten(Item)

# ---- group: 檐口埋件 (continued)
entwine_13 = Entwine(Branch00=item_68, Branch01=item_69, FlattenInputs=True)
bake_3 = BakeObjects(Geometry=entwine_13, Attributes=attributes_3, BakeName=panel_41, Bake=False)

# ----
# 按照梁分类定位PLANE
shift_19 = ShiftPaths(Data=crv_73, Offset=-1)
shift_20 = ShiftPaths(Data=shift_19, Offset=-1)
pull_30 = PullPoint(Point=data_49, Geometry=simplify(shift_20), ClosestOnly=True)  # -> ClosestPoint, Distance
ln_29 = Line(StartPoint=pull_30.ClosestPoint, EndPoint=data_49)
movetoplane_7 = MoveToPlane(Geometry=crv_37, Plane=PlaneXY(0, 0, 0), Above=True, Below=True)  # -> Geometry, Transform

# ---- group: Y Axis Line-All
crv_107 = Curve(ln_29)

# ----
end_8 = EndPoints(Curve=graft(crv_107))  # -> Start, End
merge_33 = Merge(Data1=end_8.Start, Data2=end_8.End)
pull_31 = PullPoint(Point=merge_33, Geometry=movetoplane_7.Geometry, ClosestOnly=True)  # -> ClosestPoint, Distance
sort_24 = SortList(Keys=pull_31.Distance, ValuesA=merge_33)  # -> Keys, ValuesA
item_70 = ListItem(List=sort_24.ValuesA, Index="-1", Wrap=True)
item_71 = ListItem(List=sort_24.ValuesA, Index=0, Wrap=True)
pt_38 = Point(item_71)
pt_39 = Point(item_70)
ln_30 = Line(StartPoint=pt_39, EndPoint=pt_38)
rotate_13 = Rotate(Geometry=ln_30, Angle=1.570796327, Plane=pt_38)  # -> Geometry, Transform

pt_40 = Point(end_8.End)

pl_11 = ConstructPlane(Origin=pt_40, XAxis=rotate_13.Geometry, YAxis=ln_30)
null_20 = NullItem(Item=pl_11)  # -> NullFlags, InvalidFlags, Description
dispatch_58 = Dispatch(List=pl_11, DispatchPattern=null_20.NullFlags)  # -> ListA, ListB
pln_54 = Plane(dispatch_58.ListB)

# ---- group: 檐口-首次筛选的有效起始Plane
data_51 = Data(pln_54)

# ----
shift_21 = ShiftPaths(Data=data_51, Offset=-1)

# ----
# 1.0无檐口线+上下层幕墙边线连续
# 01：钢板焊埋件[钢梁外侧]
# @钢边梁宽@钢边梁高
pln_55 = Plane(shift_21)

# ----
# 1.0.Missing Point
# 埋件定位点Offset，没有找到和梁的交点
number_slider_44 = Slider(5000, range=0..10000)
deplane_22 = DeconstructPlane(Plane=pln_49)  # -> Origin, XAxis, YAxis, ZAxis
amp_24 = Amplitude(Vector=deplane_22.YAxis, Amplitude=expr("-x", number_slider_44))
move_31 = Move(Geometry=deplane_22.Origin, Motion=amp_24)  # -> Geometry, Transform
ln_31 = Line(StartPoint=move_31.Geometry, EndPoint=deplane_22.Origin)
crv_108 = Curve(crv_71)
amp_25 = Amplitude(Vector=deplane_22.XAxis, Amplitude=number_slider_7)
amp_26 = Amplitude(Vector=deplane_22.XAxis, Amplitude=expr("-x", number_slider_7))

# ---- group: 2组探索针
move_32 = Move(Geometry=ln_31, Motion=amp_26)  # -> Geometry, Transform
move_33 = Move(Geometry=ln_31, Motion=amp_25)  # -> Geometry, Transform

# ----
ccx_15 = CurveCurve(CurveA=graft(move_32.Geometry), CurveB=flatten(crv_108))  # -> Points, ParamsA, ParamsB
shift_22 = ShiftPaths(Data=ccx_15.Points, Offset=-1)
sort_25 = SortList(Keys=shift_22, ValuesA=shift_22)  # -> Keys, ValuesA
pull_32 = PullPoint(Point=sort_25.ValuesA, Geometry=graft(pln_49), ClosestOnly=True)  # -> ClosestPoint, Distance
sort_26 = SortList(Keys=pull_32.Distance, ValuesA=sort_25.ValuesA)  # -> Keys, ValuesA
item_72 = ListItem(List=sort_26.ValuesA, Index="0", Wrap=True)
null_21 = NullItem(Item=flatten(item_72))  # -> NullFlags, InvalidFlags, Description
dispatch_59 = Dispatch(List=simplify(item_72), DispatchPattern=simplify(graft(null_21.InvalidFlags)))  # -> ListA, ListB
dispatch_60 = Dispatch(List=pln_49, DispatchPattern=null_21.InvalidFlags)  # -> ListA, ListB
pln_56 = Plane(dispatch_60.ListB)
pt_41 = Point(dispatch_59.ListB)
move2pt_11 = MoveToPoint(Geometry=pln_56, PointA=pln_56, PointB=pt_41)  # -> Moved, Vector, Transform

ccx_16 = CurveCurve(CurveA=graft(move_33.Geometry), CurveB=flatten(crv_108))  # -> Points, ParamsA, ParamsB
shift_23 = ShiftPaths(Data=ccx_16.Points, Offset=-1)
sort_27 = SortList(Keys=shift_23, ValuesA=shift_23)  # -> Keys, ValuesA
pull_33 = PullPoint(Point=sort_27.ValuesA, Geometry=graft(pln_49), ClosestOnly=True)  # -> ClosestPoint, Distance
sort_28 = SortList(Keys=pull_33.Distance, ValuesA=sort_27.ValuesA)  # -> Keys, ValuesA
item_73 = ListItem(List=sort_28.ValuesA, Index="0", Wrap=True)
null_22 = NullItem(Item=flatten(item_73))  # -> NullFlags, InvalidFlags, Description
dispatch_61 = Dispatch(List=simplify(item_73), DispatchPattern=simplify(graft(null_22.InvalidFlags)))  # -> ListA, ListB
dispatch_62 = Dispatch(List=pln_49, DispatchPattern=null_22.InvalidFlags)  # -> ListA, ListB
pt_42 = Point(dispatch_61.ListB)
pln_57 = Plane(dispatch_62.ListB)
move2pt_12 = MoveToPoint(Geometry=pln_57, PointA=pln_57, PointB=pt_42)  # -> Moved, Vector, Transform

pln_58 = Plane([dispatch_62.ListA, dispatch_60.ListA])

# ----
# 按照梁分类定位点
merge_34 = Merge(Data1=move2pt_12.Moved, Data2=move2pt_11.Moved)
crv_109 = Curve(crv_100)
pt_43 = Point(merge_34)
incurves_8 = PointInCurves(Point=flatten(pt_43), Curves=crv_109)  # -> Relationship, Index, Point
equals_16 = Equality(FirstNumber=incurves_8.Relationship, SecondNumber="0")  # -> Equality, Inequality
dispatch_63 = Dispatch(List=flatten(pt_43), DispatchPattern=equals_16.Inequality)  # -> ListA, ListB

# ---- group: 交点-属于哪个梁
data_52 = Data(dispatch_63.ListA)

# ----
# 按照梁分类定位PLANE
shift_24 = ShiftPaths(Data=crv_74, Offset=-1)
shift_25 = ShiftPaths(Data=shift_24, Offset=-1)
pull_34 = PullPoint(Point=data_52, Geometry=simplify(shift_25), ClosestOnly=True)  # -> ClosestPoint, Distance
ln_32 = Line(StartPoint=pull_34.ClosestPoint, EndPoint=data_52)
movetoplane_8 = MoveToPlane(Geometry=crv_38, Plane=PlaneXY(0, 0, 0), Above=True, Below=True)  # -> Geometry, Transform

# ---- group: Y Axis Line-All
crv_110 = Curve(ln_32)

# ----
end_9 = EndPoints(Curve=graft(crv_110))  # -> Start, End
merge_35 = Merge(Data1=end_9.Start, Data2=end_9.End)
pull_35 = PullPoint(Point=merge_35, Geometry=movetoplane_8.Geometry, ClosestOnly=True)  # -> ClosestPoint, Distance
sort_29 = SortList(Keys=pull_35.Distance, ValuesA=merge_35)  # -> Keys, ValuesA
item_74 = ListItem(List=sort_29.ValuesA, Index="-1", Wrap=True)
item_75 = ListItem(List=sort_29.ValuesA, Index=0, Wrap=True)
pt_44 = Point(item_75)
pt_45 = Point(item_74)
ln_33 = Line(StartPoint=pt_45, EndPoint=pt_44)
rotate_14 = Rotate(Geometry=ln_33, Angle=1.570796327, Plane=pt_44)  # -> Geometry, Transform

pt_46 = Point(end_9.End)

pl_12 = ConstructPlane(Origin=pt_46, XAxis=rotate_14.Geometry, YAxis=ln_33)
null_23 = NullItem(Item=pl_12)  # -> NullFlags, InvalidFlags, Description
dispatch_64 = Dispatch(List=pl_12, DispatchPattern=null_23.NullFlags)  # -> ListA, ListB
pln_59 = Plane(dispatch_64.ListB)

shift_26 = ShiftPaths(Data=pln_59, Offset=-1)

# ---- group: 檐口-首次筛选的有效起始Plane
data_53 = Data(shift_26)

# ----
# 撞到梁交点
data_54 = Data(data_53)

merge_36 = Merge(Data1=pln_55, Data2=data_54)
orient_4 = Orient(Geometry=item_32, Source=item_31, Target=merge_36)  # -> Geometry, Transform

data_55 = Data(orient_4.Geometry)
ungroup_7 = Ungroup(Group=data_55)
item_76 = ListItem(List=ungroup_7, Index=0, Wrap=True)  # -> flatten(Item)
item_77 = ListItem(List=ungroup_7, Index="-1", Wrap=True)  # -> flatten(Item)

# ---- group: 上下幕墙连续 (continued)
entwine_14 = Entwine(Branch00=item_76, Branch01=item_77, FlattenInputs=True)
bake_4 = BakeObjects(Geometry=entwine_14, Attributes=attributes_5, BakeName=panel_44, Bake=False)

# ----
# 2是否有吊顶
# 梁以内>350
deplane_23 = DeconstructPlane(Plane=pln_36)  # -> Origin, XAxis, YAxis, ZAxis
number_slider_45 = Slider(5000, range=0..10000)
amp_27 = Amplitude(Vector=deplane_23.YAxis, Amplitude=expr("-x", number_slider_45))
amp_28 = Amplitude(Vector=deplane_23.YAxis, Amplitude=number_slider_45)
move_34 = Move(Geometry=deplane_23.Origin, Motion=amp_28)  # -> Geometry, Transform
move_35 = Move(Geometry=deplane_23.Origin, Motion=amp_27)  # -> Geometry, Transform
ln_34 = Line(StartPoint=move_34.Geometry, EndPoint=move_35.Geometry)
crv_111 = Curve(crv_19)

# ---- group: 和下层建筑的交点
ccx_17 = CurveCurve(CurveA=ln_34, CurveB=crv_111)  # -> Points, ParamsA, ParamsB

# ----
null_24 = NullItem(Item=ccx_17.Points)  # -> NullFlags, InvalidFlags, Description
dispatch_65 = Dispatch(List=simplify(ccx_17.Points), DispatchPattern=simplify(null_24.NullFlags))  # -> ListA, ListB
dispatch_66 = Dispatch(List=simplify(graft(pln_36)), DispatchPattern=simplify(null_24.NullFlags))  # -> ListA, ListB
pt_47 = Point(dispatch_65.ListB)
pln_60 = Plane(flatten(dispatch_66.ListB))
pt_48 = Point(pln_60)
pull_36 = PullPoint(Point=flatten(pt_48), Geometry=flatten(pt_47), ClosestOnly=True)  # -> ClosestPoint, Distance
ln_35 = Line(StartPoint=pln_60, EndPoint=pull_36.ClosestPoint)

# ----
# 定位点Project到下层建筑线
move2pt_13 = MoveToPoint(Geometry=pln_60, PointA=pln_60, PointB=pull_36.ClosestPoint)  # -> Moved, Vector, Transform

# ----
# 可能的点-离结构很远
pln_61 = Plane(dispatch_66.ListA)

deplane_24 = DeconstructPlane(Plane=move2pt_13.Moved)  # -> Origin, XAxis, YAxis, ZAxis
amp_29 = Amplitude(Vector=deplane_24.YAxis, Amplitude=Slider(5000, range=0..10000))
move_36 = Move(Geometry=deplane_24.Origin, Motion=amp_29)  # -> Geometry, Transform
ln_36 = Line(StartPoint=move_36.Geometry, EndPoint=deplane_24.Origin)

# ---- group: 和内测梁交点
ccx_18 = CurveCurve(CurveA=graft(ln_36), CurveB=flatten(crv_75))  # -> simplify(Points), ParamsA, ParamsB

# ----
shift_27 = ShiftPaths(Data=ccx_18.Points, Offset=-1)
null_25 = NullItem(Item=shift_27)  # -> NullFlags, InvalidFlags, Description
dispatch_67 = Dispatch(List=simplify(graft(move2pt_13.Moved)), DispatchPattern=null_25.NullFlags)  # -> ListA, ListB
dispatch_68 = Dispatch(List=simplify(graft(ln_36)), DispatchPattern=null_25.NullFlags)  # -> ListA, ListB
pln_62 = Plane(dispatch_67.ListA)
crv_112 = Curve(dispatch_68.ListB)
pln_63 = Plane(dispatch_67.ListB)
ccx_19 = CurveCurve(CurveA=graft(crv_112), CurveB=flatten(crv_75))  # -> Points, ParamsA, ParamsB
shift_28 = ShiftPaths(Data=simplify(ccx_19.Points), Offset=-1)
pull_37 = PullPoint(Point=pln_63, Geometry=shift_28, ClosestOnly=True)  # -> ClosestPoint, Distance
sort_30 = SortList(Keys=pull_37.Distance, ValuesA=pull_37.ClosestPoint)  # -> Keys, ValuesA

# ---- group: 交点对应的起始定位点
item_78 = ListItem(List=sort_30.ValuesA, Index=0, Wrap=True)

# ----
ln_37 = Line(StartPoint=pln_63, EndPoint=item_78)
len_7 = Length(Curve=ln_37)
larger_7 = LargerThan(FirstNumber=len_7, SecondNumber=number_slider_25)  # -> LargerThan, OrEqualTo
panel_77 = Panel(len_7)
dispatch_69 = Dispatch(List=pln_63, DispatchPattern=larger_7.LargerThan)  # -> ListA, ListB
dispatch_70 = Dispatch(List=item_78, DispatchPattern=larger_7.LargerThan)  # -> ListA, ListB
pln_64 = Plane(dispatch_69.ListB)

# ---- group: 起始点
pt_49 = Point(dispatch_70.ListA)

# ---- group: 最终Plane
pln_65 = Plane(dispatch_69.ListA)

# ----
# 按照梁分类定位点
pt_50 = Point(pt_49)
crv_113 = Curve(shift_2)
incurves_9 = PointInCurves(Point=flatten(pt_50), Curves=crv_113)  # -> Relationship, Index, Point
equals_17 = Equality(FirstNumber=incurves_9.Relationship, SecondNumber="0")  # -> Equality, Inequality
dispatch_71 = Dispatch(List=flatten(pt_50), DispatchPattern=equals_17.Inequality)  # -> ListA, ListB

# ---- group: 交点-属于哪个梁
data_56 = Data(dispatch_71.ListA)

# ----
# 可能的结构交点-大量
pln_66 = Plane(pln_62)

# ----
# 可能的结构交点
pln_67 = Plane(pln_64)

# ----
# 按照梁分类定位PLANE
shift_29 = ShiftPaths(Data=crv_76, Offset=-1)
shift_30 = ShiftPaths(Data=shift_29, Offset=-1)
pull_38 = PullPoint(Point=data_56, Geometry=simplify(shift_30), ClosestOnly=True)  # -> ClosestPoint, Distance
ln_38 = Line(StartPoint=pull_38.ClosestPoint, EndPoint=data_56)
movetoplane_9 = MoveToPlane(Geometry=crv_39, Plane=PlaneXY(0, 0, 0), Above=True, Below=True)  # -> Geometry, Transform

# ---- group: Y Axis Line-All
crv_114 = Curve(ln_38)

# ----
end_10 = EndPoints(Curve=graft(crv_114))  # -> Start, End
merge_37 = Merge(Data1=end_10.Start, Data2=end_10.End)
pull_39 = PullPoint(Point=merge_37, Geometry=movetoplane_9.Geometry, ClosestOnly=True)  # -> ClosestPoint, Distance
sort_31 = SortList(Keys=pull_39.Distance, ValuesA=merge_37)  # -> Keys, ValuesA
item_79 = ListItem(List=sort_31.ValuesA, Index="-1", Wrap=True)
item_80 = ListItem(List=sort_31.ValuesA, Index=0, Wrap=True)
pt_51 = Point(item_80)
pt_52 = Point(item_79)
ln_39 = Line(StartPoint=pt_52, EndPoint=pt_51)
rotate_15 = Rotate(Geometry=ln_39, Angle=1.570796327, Plane=pt_51)  # -> Geometry, Transform

pt_53 = Point(end_10.End)

pl_13 = ConstructPlane(Origin=pt_53, XAxis=rotate_15.Geometry, YAxis=ln_39)
null_26 = NullItem(Item=pl_13)  # -> NullFlags, InvalidFlags, Description
dispatch_72 = Dispatch(List=pl_13, DispatchPattern=null_26.NullFlags)  # -> ListA, ListB
pln_68 = Plane(dispatch_72.ListB)

shift_31 = ShiftPaths(Data=pln_68, Offset=-1)

# ---- group: 檐口-首次筛选的有效起始Plane
data_57 = Data(simplify(shift_31))

# ----
# 2.1 梁以内>350
# 
# 侧埋，钢板焊
# 03：钢板焊埋件[钢梁内侧]
# @钢边梁宽@钢边梁高
pln_69 = Plane(data_57)

# ----
# 2.1 Missing Point
# 埋件定位点Offset，没有找到和梁的交点
merge_38 = Merge(Data1=pln_61, Data2=pln_67, Data3=pln_66)
crv_115 = Curve(crv_75)

# ----
# 0 檐口出定位点
# 与结构无交点
pln_70 = Plane(flatten(merge_38))

deplane_25 = DeconstructPlane(Plane=pln_70)  # -> Origin, XAxis, YAxis, ZAxis
amp_30 = Amplitude(Vector=deplane_25.YAxis, Amplitude=Slider(5000, range=0..10000))
move_37 = Move(Geometry=deplane_25.Origin, Motion=amp_30)  # -> Geometry, Transform
ln_40 = Line(StartPoint=move_37.Geometry, EndPoint=deplane_25.Origin)
amp_31 = Amplitude(Vector=deplane_25.XAxis, Amplitude=number_slider_7)
amp_32 = Amplitude(Vector=deplane_25.XAxis, Amplitude=expr("-x", number_slider_7))
move_38 = Move(Geometry=ln_40, Motion=amp_31)  # -> Geometry, Transform
move_39 = Move(Geometry=ln_40, Motion=amp_32)  # -> Geometry, Transform

ccx_20 = CurveCurve(CurveA=graft(move_38.Geometry), CurveB=flatten(crv_115))  # -> Points, ParamsA, ParamsB
shift_32 = ShiftPaths(Data=ccx_20.Points, Offset=-1)
sort_32 = SortList(Keys=shift_32, ValuesA=shift_32)  # -> Keys, ValuesA
pull_40 = PullPoint(Point=sort_32.ValuesA, Geometry=graft(pln_70), ClosestOnly=True)  # -> ClosestPoint, Distance
sort_33 = SortList(Keys=pull_40.Distance, ValuesA=sort_32.ValuesA)  # -> Keys, ValuesA
item_81 = ListItem(List=sort_33.ValuesA, Index="-1", Wrap=True)
null_27 = NullItem(Item=flatten(item_81))  # -> NullFlags, InvalidFlags, Description
end_11 = EndPoints(Curve=move_38.Geometry)  # -> Start, End
dispatch_73 = Dispatch(List=graft(pln_70), DispatchPattern=graft(null_27.InvalidFlags))  # -> ListA, ListB
dispatch_74 = Dispatch(List=simplify(item_81), DispatchPattern=simplify(graft(null_27.InvalidFlags)))  # -> ListA, ListB
pln_71 = Plane(dispatch_73.ListB)
pt_54 = Point(dispatch_74.ListB)
dispatch_75 = Dispatch(List=simplify(graft(end_11.End)), DispatchPattern=simplify(graft(null_27.InvalidFlags)))  # -> ListA, ListB
pt_55 = Point(dispatch_75.ListB)
ln_41 = Line(StartPoint=pt_55, EndPoint=pt_54)
len_8 = Length(Curve=ln_41)
larger_8 = LargerThan(FirstNumber=len_8, SecondNumber=Slider(350, range=0..1000))  # -> LargerThan, OrEqualTo
dispatch_76 = Dispatch(List=pln_71, DispatchPattern=larger_8.LargerThan)  # -> ListA, ListB
dispatch_77 = Dispatch(List=pt_54, DispatchPattern=larger_8.LargerThan)  # -> ListA, ListB
pln_72 = Plane(dispatch_76.ListA)
pt_56 = Point(dispatch_77.ListA)
move2pt_14 = MoveToPoint(Geometry=pln_72, PointA=pln_72, PointB=pt_56)  # -> Moved, Vector, Transform

ccx_21 = CurveCurve(CurveA=graft(move_39.Geometry), CurveB=flatten(crv_115))  # -> Points, ParamsA, ParamsB
shift_33 = ShiftPaths(Data=ccx_21.Points, Offset=-1)
sort_34 = SortList(Keys=shift_33, ValuesA=shift_33)  # -> Keys, ValuesA
pull_41 = PullPoint(Point=sort_34.ValuesA, Geometry=graft(pln_70), ClosestOnly=True)  # -> ClosestPoint, Distance
sort_35 = SortList(Keys=pull_41.Distance, ValuesA=sort_34.ValuesA)  # -> Keys, ValuesA
item_82 = ListItem(List=sort_35.ValuesA, Index="-1", Wrap=True)
null_28 = NullItem(Item=flatten(item_82))  # -> NullFlags, InvalidFlags, Description
end_12 = EndPoints(Curve=move_39.Geometry)  # -> Start, End
dispatch_78 = Dispatch(List=simplify(item_82), DispatchPattern=simplify(graft(null_28.InvalidFlags)))  # -> ListA, ListB
dispatch_79 = Dispatch(List=graft(pln_70), DispatchPattern=flatten(null_28.InvalidFlags))  # -> ListA, ListB
dispatch_80 = Dispatch(List=simplify(graft(end_12.End)), DispatchPattern=simplify(graft(null_28.InvalidFlags)))  # -> ListA, ListB
pln_73 = Plane(dispatch_79.ListB)
pt_57 = Point(dispatch_78.ListB)
pt_58 = Point(dispatch_80.ListB)
ln_42 = Line(StartPoint=pt_58, EndPoint=pt_57)
len_9 = Length(Curve=ln_42)
larger_9 = LargerThan(FirstNumber=len_9, SecondNumber=Slider(350, range=0..1000))  # -> LargerThan, OrEqualTo
dispatch_81 = Dispatch(List=pln_73, DispatchPattern=larger_9.LargerThan)  # -> ListA, ListB
dispatch_82 = Dispatch(List=pt_57, DispatchPattern=larger_9.LargerThan)  # -> ListA, ListB
pln_74 = Plane(dispatch_81.ListA)
pt_59 = Point(dispatch_82.ListA)
move2pt_15 = MoveToPoint(Geometry=pln_74, PointA=pln_74, PointB=pt_59)  # -> Moved, Vector, Transform

merge_39 = Merge(Data1=move2pt_14.Moved, Data2=move2pt_15.Moved)

# ----
# 按照梁分类定位点
pt_60 = Point(pt_56)
incurves_10 = PointInCurves(Point=flatten(merge_39), Curves=crv_77)  # -> Relationship, Index, Point
equals_18 = Equality(FirstNumber=incurves_10.Relationship, SecondNumber="0")  # -> Equality, Inequality
dispatch_83 = Dispatch(List=flatten(pt_60), DispatchPattern=equals_18.Inequality)  # -> ListA, ListB

# ---- group: 交点-属于哪个梁
data_58 = Data(dispatch_83.ListA)

# ----
# 按照梁分类定位PLANE
shift_34 = ShiftPaths(Data=crv_78, Offset=-1)
shift_35 = ShiftPaths(Data=shift_34, Offset=-1)
pull_42 = PullPoint(Point=data_58, Geometry=simplify(shift_35), ClosestOnly=True)  # -> ClosestPoint, Distance
ln_43 = Line(StartPoint=pull_42.ClosestPoint, EndPoint=data_58)
movetoplane_10 = MoveToPlane(Geometry=crv_40, Plane=PlaneXY(0, 0, 0), Above=True, Below=True)  # -> Geometry, Transform

# ---- group: Y Axis Line-All
crv_116 = Curve(ln_43)

# ----
end_13 = EndPoints(Curve=graft(crv_116))  # -> Start, End
merge_40 = Merge(Data1=end_13.Start, Data2=end_13.End)
pull_43 = PullPoint(Point=merge_40, Geometry=movetoplane_10.Geometry, ClosestOnly=True)  # -> ClosestPoint, Distance
sort_36 = SortList(Keys=pull_43.Distance, ValuesA=merge_40)  # -> Keys, ValuesA
item_83 = ListItem(List=sort_36.ValuesA, Index="-1", Wrap=True)
item_84 = ListItem(List=sort_36.ValuesA, Index=0, Wrap=True)
pt_61 = Point(item_84)
pt_62 = Point(item_83)
ln_44 = Line(StartPoint=pt_62, EndPoint=pt_61)
rotate_16 = Rotate(Geometry=ln_44, Angle=1.570796327, Plane=pt_61)  # -> Geometry, Transform

pt_63 = Point(end_13.End)

pl_14 = ConstructPlane(Origin=pt_63, XAxis=rotate_16.Geometry, YAxis=ln_44)
null_29 = NullItem(Item=pl_14)  # -> NullFlags, InvalidFlags, Description
dispatch_84 = Dispatch(List=pl_14, DispatchPattern=null_29.NullFlags)  # -> ListA, ListB
pln_75 = Plane(dispatch_84.ListB)

shift_36 = ShiftPaths(Data=pln_75, Offset=-1)

# ---- group: 檐口-首次筛选的有效起始Plane
data_59 = Data(shift_36)

# ----
# 撞到梁交点
merge_41 = Merge(Data1=data_59)

merge_42 = Merge(Data1=pln_69, Data2=merge_41)
orient_5 = Orient(Geometry=item_33, Source=rotate_8.Geometry, Target=merge_42)  # -> Geometry, Transform

data_60 = Data(orient_5.Geometry)
ungroup_8 = Ungroup(Group=data_60)
item_85 = ListItem(List=ungroup_8, Index=0, Wrap=True)  # -> flatten(Item)
item_86 = ListItem(List=ungroup_8, Index="-1", Wrap=True)  # -> flatten(Item)

# ---- group: 有吊顶的范围，檐口处内侧埋件 (continued)
entwine_15 = Entwine(Branch00=item_85, Branch01=item_86, FlattenInputs=True)
bake_5 = BakeObjects(Geometry=entwine_15, Attributes=attributes_4, BakeName=panel_45, Bake=False)

# ----
deplane_26 = DeconstructPlane(Plane=pln_37)  # -> Origin, XAxis, YAxis, ZAxis
number_slider_46 = Slider(3584, range=0..10000)
amp_33 = Amplitude(Vector=deplane_26.YAxis, Amplitude=number_slider_46)
amp_34 = Amplitude(Vector=deplane_26.YAxis, Amplitude=expr("-x", number_slider_46))
boundary_6 = BoundarySurfaces(Edges=[offset_8, offset_7])
move_40 = Move(Geometry=deplane_26.Origin, Motion=amp_34)  # -> Geometry, Transform
move_41 = Move(Geometry=deplane_26.Origin, Motion=amp_33)  # -> Geometry, Transform
ln_45 = Line(StartPoint=move_40.Geometry, EndPoint=move_41.Geometry)

# ---- group: 50-350建筑结构交点
scx_3 = SurfaceCurve(Surface=boundary_6, Curve=crv_81)  # -> flatten(Curves), Points, UVPoints, Normals, Parameters, Tangents

# ---- group: 该区间的定位点
ccx_22 = CurveCurve(CurveA=graft(ln_45), CurveB=scx_3.Curves)  # -> Points, ParamsA, ParamsB

# ----
shift_37 = ShiftPaths(Data=ccx_22.Points, Offset=-1)
pull_44 = PullPoint(Point=graft(pln_37), Geometry=shift_37, ClosestOnly=True)  # -> ClosestPoint, Distance
sort_37 = SortList(Keys=pull_44.Distance, ValuesA=pull_44.ClosestPoint)  # -> Keys, ValuesA
null_30 = NullItem(Item=sort_37.ValuesA)  # -> NullFlags, simplify(InvalidFlags), Description
item_87 = ListItem(List=sort_37.ValuesA, Index=0, Wrap=True)
dispatch_85 = Dispatch(List=simplify(graft(pln_37)), DispatchPattern=null_30.InvalidFlags)  # -> ListA, ListB
dispatch_86 = Dispatch(List=simplify(graft(item_87)), DispatchPattern=null_30.InvalidFlags)  # -> ListA, ListB
pln_76 = Plane(dispatch_85.ListB)
pln_77 = Plane(dispatch_85.ListA)
pt_64 = Point(dispatch_86.ListB)

# ----
# 按照梁分类定位点
crv_117 = Curve(shift_2)
pt_65 = Point(pt_64)
incurves_11 = PointInCurves(Point=flatten(pt_65), Curves=crv_117)  # -> Relationship, Index, Point
equals_19 = Equality(FirstNumber=incurves_11.Relationship, SecondNumber="0")  # -> Equality, Inequality
dispatch_87 = Dispatch(List=flatten(pt_65), DispatchPattern=equals_19.Inequality)  # -> ListA, ListB

# ---- group: 交点-属于哪个梁
data_61 = Data(dispatch_87.ListA)

# ----
# 可能的结构交点-大量
pln_78 = Plane(pln_77)

# ----
# 0 檐口出定位点
# 与结构无交点
pln_79 = Plane(flatten(pln_78))

# ----
# 按照梁分类定位PLANE
shift_38 = ShiftPaths(Data=crv_82, Offset=-1)
shift_39 = ShiftPaths(Data=shift_38, Offset=-1)
pull_45 = PullPoint(Point=data_61, Geometry=simplify(shift_39), ClosestOnly=True)  # -> ClosestPoint, Distance
ln_46 = Line(StartPoint=pull_45.ClosestPoint, EndPoint=data_61)
movetoplane_11 = MoveToPlane(Geometry=crv_44, Plane=PlaneXY(0, 0, 0), Above=True, Below=True)  # -> Geometry, Transform

# ---- group: Y Axis Line-All
crv_118 = Curve(ln_46)

# ----
# 按照梁分类定位PLANE
shift_40 = ShiftPaths(Data=crv_83, Offset=-1)
shift_41 = ShiftPaths(Data=shift_40, Offset=-1)
pull_46 = PullPoint(Point=data_43, Geometry=simplify(shift_41), ClosestOnly=True)  # -> ClosestPoint, Distance
ln_47 = Line(StartPoint=pull_46.ClosestPoint, EndPoint=data_43)
movetoplane_12 = MoveToPlane(Geometry=crv_45, Plane=PlaneXY(0, 0, 0), Above=True, Below=True)  # -> Geometry, Transform

# ---- group: Y Axis Line-All
crv_119 = Curve(ln_47)

# ----
end_14 = EndPoints(Curve=graft(crv_118))  # -> Start, End
merge_43 = Merge(Data1=end_14.Start, Data2=end_14.End)
pull_47 = PullPoint(Point=merge_43, Geometry=movetoplane_11.Geometry, ClosestOnly=True)  # -> ClosestPoint, Distance
sort_38 = SortList(Keys=pull_47.Distance, ValuesA=merge_43)  # -> Keys, ValuesA
item_88 = ListItem(List=sort_38.ValuesA, Index="-1", Wrap=True)
item_89 = ListItem(List=sort_38.ValuesA, Index=0, Wrap=True)
pt_66 = Point(item_89)
pt_67 = Point(item_88)
ln_48 = Line(StartPoint=pt_67, EndPoint=pt_66)
rotate_17 = Rotate(Geometry=ln_48, Angle=1.570796327, Plane=pt_66)  # -> Geometry, Transform

pt_68 = Point(end_14.End)

pl_15 = ConstructPlane(Origin=pt_68, XAxis=rotate_17.Geometry, YAxis=ln_48)
null_31 = NullItem(Item=pl_15)  # -> NullFlags, InvalidFlags, Description
dispatch_88 = Dispatch(List=pl_15, DispatchPattern=null_31.NullFlags)  # -> ListA, ListB
pln_80 = Plane(dispatch_88.ListB)

shift_42 = ShiftPaths(Data=pln_80, Offset=-1)

# ---- group: 檐口-首次筛选的有效起始Plane
data_62 = Data(shift_42)

# ----
# Rhino 文件中导入的块名
# 3.1
# 下层建筑边线外侧50-350mm
# 03：钢板焊埋件[钢梁内侧]
# @钢边梁宽@钢边梁高
pln_81 = Plane(data_62)

end_15 = EndPoints(Curve=graft(crv_119))  # -> Start, End
merge_44 = Merge(Data1=end_15.Start, Data2=end_15.End)
pull_48 = PullPoint(Point=merge_44, Geometry=movetoplane_12.Geometry, ClosestOnly=True)  # -> ClosestPoint, Distance
sort_39 = SortList(Keys=pull_48.Distance, ValuesA=merge_44)  # -> Keys, ValuesA
item_90 = ListItem(List=sort_39.ValuesA, Index="-1", Wrap=True)
item_91 = ListItem(List=sort_39.ValuesA, Index=0, Wrap=True)
pt_69 = Point(item_91)
pt_70 = Point(item_90)
ln_49 = Line(StartPoint=pt_70, EndPoint=pt_69)
rotate_18 = Rotate(Geometry=ln_49, Angle=1.570796327, Plane=pt_69)  # -> Geometry, Transform

pt_71 = Point(end_15.End)

pl_16 = ConstructPlane(Origin=pt_71, XAxis=rotate_18.Geometry, YAxis=ln_49)
null_32 = NullItem(Item=pl_16)  # -> NullFlags, InvalidFlags, Description
dispatch_89 = Dispatch(List=pl_16, DispatchPattern=null_32.NullFlags)  # -> ListA, ListB
pln_82 = Plane(dispatch_89.ListB)

shift_43 = ShiftPaths(Data=pln_82, Offset=-1)

# ---- group: 檐口-首次筛选的有效起始Plane
data_63 = Data(shift_43)

# ----
# 3.2
# 下层建筑边线内侧300-600mm范围
# 03：钢板焊埋件[钢梁外侧]
# @钢边梁宽@钢边梁高
pln_83 = Plane(data_63)

# ----
# 3.1 Missing Point
# 埋件定位点Offset，没有找到和梁的交点
number_slider_47 = Slider(5000, range=0..10000)
deplane_27 = DeconstructPlane(Plane=pln_79)  # -> Origin, XAxis, YAxis, ZAxis
amp_35 = Amplitude(Vector=deplane_27.YAxis, Amplitude=number_slider_47)
crv_120 = Curve(scx_3.Curves)
move_42 = Move(Geometry=deplane_27.Origin, Motion=amp_35)  # -> Geometry, Transform
ln_50 = Line(StartPoint=move_42.Geometry, EndPoint=deplane_27.Origin)
amp_36 = Amplitude(Vector=deplane_27.XAxis, Amplitude=expr("-x", number_slider_7))
amp_37 = Amplitude(Vector=deplane_27.XAxis, Amplitude=number_slider_7)
move_43 = Move(Geometry=ln_50, Motion=amp_37)  # -> Geometry, Transform
move_44 = Move(Geometry=ln_50, Motion=amp_36)  # -> Geometry, Transform
move_45 = Move(Geometry=pln_79, Motion=amp_36)  # -> Geometry, Transform
move_46 = Move(Geometry=pln_79, Motion=amp_37)  # -> Geometry, Transform
pln_84 = Plane(pln_77)

ccx_23 = CurveCurve(CurveA=graft(move_44.Geometry), CurveB=flatten(crv_120))  # -> Points, ParamsA, ParamsB
shift_44 = ShiftPaths(Data=ccx_23.Points, Offset=-1)
sort_40 = SortList(Keys=shift_44, ValuesA=shift_44)  # -> Keys, ValuesA
pull_49 = PullPoint(Point=sort_40.ValuesA, Geometry=graft(pln_79), ClosestOnly=True)  # -> ClosestPoint, Distance
sort_41 = SortList(Keys=pull_49.Distance, ValuesA=sort_40.ValuesA)  # -> Keys, ValuesA
item_92 = ListItem(List=sort_41.ValuesA, Index="-1", Wrap=True)
null_33 = NullItem(Item=flatten(item_92))  # -> NullFlags, InvalidFlags, Description
dispatch_90 = Dispatch(List=flatten(item_92), DispatchPattern=null_33.InvalidFlags)  # -> ListA, ListB
dispatch_91 = Dispatch(List=move_45.Geometry, DispatchPattern=null_33.InvalidFlags)  # -> ListA, ListB
pt_72 = Point(dispatch_90.ListB)
pln_85 = Plane(dispatch_91.ListB)

ccx_24 = CurveCurve(CurveA=graft(move_43.Geometry), CurveB=flatten(crv_120))  # -> Points, ParamsA, ParamsB
shift_45 = ShiftPaths(Data=ccx_24.Points, Offset=-1)
sort_42 = SortList(Keys=shift_45, ValuesA=shift_45)  # -> Keys, ValuesA
pull_50 = PullPoint(Point=sort_42.ValuesA, Geometry=graft(pln_79), ClosestOnly=True)  # -> ClosestPoint, Distance
sort_43 = SortList(Keys=pull_50.Distance, ValuesA=sort_42.ValuesA)  # -> Keys, ValuesA
item_93 = ListItem(List=sort_43.ValuesA, Index="-1", Wrap=True)
null_34 = NullItem(Item=flatten(item_93))  # -> NullFlags, InvalidFlags, Description
dispatch_92 = Dispatch(List=flatten(item_93), DispatchPattern=null_34.InvalidFlags)  # -> ListA, ListB
dispatch_93 = Dispatch(List=move_46.Geometry, DispatchPattern=null_34.InvalidFlags)  # -> ListA, ListB
pln_86 = Plane(dispatch_93.ListB)
pt_73 = Point(dispatch_92.ListB)

merge_45 = Merge(Data1=pln_86, Data2=pln_85)  # -> flatten(Result)
check_same_points_8 = CheckSamePoints(archPoint=flatten(pln_84), crvPoint=merge_45)  # -> out, specialPt; inputs archPoint: list of Point3d, crvPoint: list of Point3d; same code as testpoint

# ----
# pass
cull_i_11 = CullIndex(List=flatten(pln_84), Indices=check_same_points_8.specialPt, Wrap=True)

merge_46 = Merge(Data1=pt_73, Data2=pt_72)

# ----
# 按照梁分类定位点
incurves_12 = PointInCurves(Point=flatten(merge_46), Curves=crv_86)  # -> Relationship, Index, Point
equals_20 = Equality(FirstNumber=incurves_12.Relationship, SecondNumber="0")  # -> Equality, Inequality
dispatch_94 = Dispatch(List=flatten(merge_46), DispatchPattern=equals_20.Inequality)  # -> ListA, ListB

# ---- group: 交点-属于哪个梁
data_64 = Data(dispatch_94.ListA)

# ----
pln_87 = Plane(cull_i_11)
pln_88 = Plane()

# ----
# 3.1下层建筑内侧到300到外侧50内是否有钢结构
deplane_28 = DeconstructPlane(Plane=pln_87)  # -> Origin, XAxis, YAxis, ZAxis
deplane_29 = DeconstructPlane(Plane=pln_88)  # -> Origin, XAxis, YAxis, ZAxis
check_same_points_9 = CheckSamePoints(archPoint=deplane_29.Origin, crvPoint=deplane_28.Origin)  # -> out, specialPt; inputs archPoint: list of Point3d, crvPoint: list of Point3d; same code as testpoint

# ----
# 同时满足N
item_94 = ListItem(List=pln_88, Index=check_same_points_9.specialPt, Wrap=True)

# ----
# SmoothCurve-阴角
# SmoothCurve-阳角
# SmoothCurve-阴角
# SmoothCurve-正常
# Angular Curve - All
# Special Curve(with location)- All
pln_89 = Plane(item_94)
flatten_9 = FlattenTree(Tree=crv_92, Path="{0}")
number_slider_48 = Slider(3584, range=0..10000)
deplane_30 = DeconstructPlane(Plane=pln_89)  # -> Origin, XAxis, YAxis, ZAxis
boundary_7 = BoundarySurfaces(Edges=[offset_12, offset_11])
amp_38 = Amplitude(Vector=deplane_30.YAxis, Amplitude=number_slider_48)
amp_39 = Amplitude(Vector=deplane_30.YAxis, Amplitude=expr("-x", number_slider_48))
scx_4 = SurfaceCurve(Surface=boundary_7, Curve=flatten_9)  # -> flatten(Curves), Points, UVPoints, Normals, Parameters, Tangents
move_47 = Move(Geometry=deplane_30.Origin, Motion=amp_39)  # -> Geometry, Transform
move_48 = Move(Geometry=deplane_30.Origin, Motion=amp_38)  # -> Geometry, Transform
ln_51 = Line(StartPoint=move_47.Geometry, EndPoint=move_48.Geometry)
ccx_25 = CurveCurve(CurveA=graft(ln_51), CurveB=scx_4.Curves)  # -> Points, ParamsA, ParamsB
shift_46 = ShiftPaths(Data=ccx_25.Points, Offset=-1)
pull_51 = PullPoint(Point=graft(pln_89), Geometry=shift_46, ClosestOnly=True)  # -> ClosestPoint, Distance
sort_44 = SortList(Keys=pull_51.Distance, ValuesA=pull_51.ClosestPoint)  # -> Keys, ValuesA
item_95 = ListItem(List=sort_44.ValuesA, Index=0, Wrap=True)
null_35 = NullItem(Item=sort_44.ValuesA)  # -> NullFlags, simplify(InvalidFlags), Description
dispatch_95 = Dispatch(List=simplify(graft(pln_89)), DispatchPattern=null_35.InvalidFlags)  # -> ListA, ListB
pln_90 = Plane(dispatch_95.ListB)
pln_91 = Plane(dispatch_95.ListA)
move2pt_16 = MoveToPoint(Geometry=pln_90, PointA=pln_90, PointB=simplify(shift_46))  # -> flatten(Moved), Vector, Transform

# ---- group: 交点-属于哪个梁
data_65 = Data(move2pt_16.Moved)

# ----
# 按照梁分类定位点
crv_121 = Curve(shift_2)
incurves_13 = PointInCurves(Point=flatten(data_65), Curves=crv_121)  # -> Relationship, Index, Point
equals_21 = Equality(FirstNumber=incurves_13.Relationship, SecondNumber="0")  # -> Equality, Inequality
dispatch_96 = Dispatch(List=flatten(data_65), DispatchPattern=equals_21.Inequality)  # -> ListA, ListB

pt_74 = Point(dispatch_96.ListA)

# ----
# 可能的结构交点-大量
pln_92 = Plane(pln_91)

# ----
# 0 檐口出定位点
# 与结构无交点
pln_93 = Plane(flatten(pln_92))

# ----
# 4 Missing Point
# 埋件定位点Offset，没有找到和梁的交点
number_slider_49 = Slider(5000, range=0..10000)
deplane_31 = DeconstructPlane(Plane=pln_93)  # -> Origin, XAxis, YAxis, ZAxis
amp_40 = Amplitude(Vector=deplane_31.YAxis, Amplitude=number_slider_49)
move_49 = Move(Geometry=deplane_31.Origin, Motion=amp_40)  # -> Geometry, Transform
ln_52 = Line(StartPoint=move_49.Geometry, EndPoint=deplane_31.Origin)
amp_41 = Amplitude(Vector=deplane_31.XAxis, Amplitude=number_slider_7)
amp_42 = Amplitude(Vector=deplane_31.XAxis, Amplitude=expr("-x", number_slider_7))
move_50 = Move(Geometry=ln_52, Motion=amp_41)  # -> Geometry, Transform
move_51 = Move(Geometry=ln_52, Motion=amp_42)  # -> Geometry, Transform

# ---- group: 梁中线
crv_122 = Curve(scx_4.Curves)

# ----
ccx_26 = CurveCurve(CurveA=graft(move_51.Geometry), CurveB=flatten(crv_122))  # -> Points, ParamsA, ParamsB
shift_47 = ShiftPaths(Data=ccx_26.Points, Offset=-1)
sort_45 = SortList(Keys=shift_47, ValuesA=shift_47)  # -> Keys, ValuesA
pull_52 = PullPoint(Point=sort_45.ValuesA, Geometry=graft(pln_93), ClosestOnly=True)  # -> ClosestPoint, Distance
sort_46 = SortList(Keys=pull_52.Distance, ValuesA=sort_45.ValuesA)  # -> Keys, ValuesA
item_96 = ListItem(List=sort_46.ValuesA, Index="-1", Wrap=True)
null_36 = NullItem(Item=flatten(item_96))  # -> NullFlags, InvalidFlags, Description
dispatch_97 = Dispatch(List=flatten(item_96), DispatchPattern=null_36.InvalidFlags)  # -> ListA, ListB
dispatch_98 = Dispatch(List=pln_93, DispatchPattern=null_36.InvalidFlags)  # -> ListA, ListB
pt_75 = Point(dispatch_97.ListB)
pln_94 = Plane(dispatch_98.ListB)
move2pt_17 = MoveToPoint(Geometry=pln_94, PointA=pln_94, PointB=pt_75)  # -> Moved, Vector, Transform

ccx_27 = CurveCurve(CurveA=graft(move_50.Geometry), CurveB=flatten(crv_122))  # -> Points, ParamsA, ParamsB
shift_48 = ShiftPaths(Data=ccx_27.Points, Offset=-1)
sort_47 = SortList(Keys=shift_48, ValuesA=shift_48)  # -> Keys, ValuesA
pull_53 = PullPoint(Point=sort_47.ValuesA, Geometry=graft(pln_93), ClosestOnly=True)  # -> ClosestPoint, Distance
sort_48 = SortList(Keys=pull_53.Distance, ValuesA=sort_47.ValuesA)  # -> Keys, ValuesA
item_97 = ListItem(List=sort_48.ValuesA, Index="-1", Wrap=True)
null_37 = NullItem(Item=flatten(item_97))  # -> NullFlags, InvalidFlags, Description
dispatch_99 = Dispatch(List=pln_93, DispatchPattern=null_37.InvalidFlags)  # -> ListA, ListB
dispatch_100 = Dispatch(List=flatten(item_97), DispatchPattern=null_37.InvalidFlags)  # -> ListA, ListB
pln_95 = Plane(dispatch_99.ListB)
pt_76 = Point(dispatch_100.ListB)
move2pt_18 = MoveToPoint(Geometry=pln_95, PointA=pln_95, PointB=pt_76)  # -> Moved, Vector, Transform

merge_47 = Merge(Data1=move2pt_18.Moved, Data2=move2pt_17.Moved)

# ---- group: 交点-属于哪个梁
data_66 = Data(merge_47)

# ----
# 按照梁分类定位点
crv_123 = Curve(shift_2)
incurves_14 = PointInCurves(Point=flatten(data_66), Curves=crv_123)  # -> Relationship, Index, Point
equals_22 = Equality(FirstNumber=incurves_14.Relationship, SecondNumber="0")  # -> Equality, Inequality
dispatch_101 = Dispatch(List=flatten(data_66), DispatchPattern=equals_22.Inequality)  # -> ListA, ListB

pt_77 = Point(dispatch_101.ListA)
merge_48 = Merge(Data1=flatten(pln_95), Data2=flatten(pln_94))
check_same_points_10 = CheckSamePoints(archPoint=pln_92, crvPoint=flatten(merge_48))  # -> out, specialPt; inputs archPoint: list of Point3d, crvPoint: list of Point3d; same code as testpoint
cull_i_12 = CullIndex(List=pln_92, Indices=check_same_points_10.specialPt, Wrap=True)

# ----
# 3.2  Missing Point
# 埋件定位点Offset，没有找到和梁的交点
number_slider_50 = Slider(5000, range=0..10000)
deplane_32 = DeconstructPlane(Plane=pln_43)  # -> Origin, XAxis, YAxis, ZAxis
amp_43 = Amplitude(Vector=deplane_32.YAxis, Amplitude=expr("-x", number_slider_50))
move_52 = Move(Geometry=deplane_32.Origin, Motion=amp_43)  # -> Geometry, Transform
ln_53 = Line(StartPoint=move_52.Geometry, EndPoint=deplane_32.Origin)
amp_44 = Amplitude(Vector=deplane_32.XAxis, Amplitude=number_slider_7)
amp_45 = Amplitude(Vector=deplane_32.XAxis, Amplitude=expr("-x", number_slider_7))
move_53 = Move(Geometry=ln_53, Motion=amp_45)  # -> Geometry, Transform
move_54 = Move(Geometry=ln_53, Motion=amp_44)  # -> Geometry, Transform
move_55 = Move(Geometry=pln_43, Motion=amp_45)  # -> Geometry, Transform
move_56 = Move(Geometry=pln_43, Motion=amp_44)  # -> Geometry, Transform

pln_96 = Plane(move_56.Geometry)
deplane_33 = DeconstructPlane(Plane=pln_96)  # -> Origin, XAxis, YAxis, ZAxis
amp_46 = Amplitude(Vector=deplane_33.YAxis, Amplitude=expr("-x", Slider(2000, range=0..10000)))
move_57 = Move(Geometry=deplane_33.Origin, Motion=amp_46)  # -> Geometry, Transform
ln_54 = Line(StartPoint=deplane_33.Origin, EndPoint=move_57.Geometry)
ccx_28 = CurveCurve(CurveA=flatten(crv_84), CurveB=simplify(graft(move_54.Geometry)))  # -> Points, ParamsA, ParamsB
shift_49 = ShiftPaths(Data=ccx_28.Points, Offset=-1)
graft_5 = GraftTree(Tree=deplane_33.Origin, IncludeEmptyLists=True, IncludeNullItems=True)  # -> simplify(Tree)
pull_54 = PullPoint(Point=shift_49, Geometry=graft_5, ClosestOnly=True)  # -> ClosestPoint, Distance
sort_49 = SortList(Keys=pull_54.Distance, ValuesA=shift_49)  # -> Keys, ValuesA
graft_6 = GraftTree(Tree=pln_96, IncludeEmptyLists=True, IncludeNullItems=True)  # -> flatten(Tree)
item_98 = ListItem(List=sort_49.Keys, Index=0, Wrap=True)  # -> flatten(Item)
c_script_2 = CSharpScript(num=item_98, Max="600", Min="300")  # -> out, A, Distance; inputs num: list of Double, Max: Double; same code as c_script
item_99 = ListItem(List=graft_6, Index=c_script_2.out, Wrap=True)

pln_97 = Plane(move_55.Geometry)
# 阳角
# 阴角
# 阳角
# 阴角
number_slider_51 = Slider(2000, range=0..10000)
deplane_34 = DeconstructPlane(Plane=pln_97)  # -> Origin, XAxis, YAxis, ZAxis
amp_47 = Amplitude(Vector=deplane_34.YAxis, Amplitude=expr("-x", number_slider_51))
move_58 = Move(Geometry=deplane_34.Origin, Motion=amp_47)  # -> Geometry, Transform
ln_55 = Line(StartPoint=deplane_34.Origin, EndPoint=move_58.Geometry)
ccx_29 = CurveCurve(CurveA=flatten(crv_85), CurveB=simplify(graft(move_53.Geometry)))  # -> Points, ParamsA, ParamsB
shift_50 = ShiftPaths(Data=ccx_29.Points, Offset=-1)
graft_7 = GraftTree(Tree=deplane_34.Origin, IncludeEmptyLists=True, IncludeNullItems=True)  # -> simplify(Tree)
pull_55 = PullPoint(Point=shift_50, Geometry=graft_7, ClosestOnly=True)  # -> ClosestPoint, Distance
sort_50 = SortList(Keys=pull_55.Distance, ValuesA=shift_50)  # -> Keys, ValuesA
graft_8 = GraftTree(Tree=pln_97, IncludeEmptyLists=True, IncludeNullItems=True)  # -> flatten(Tree)
item_100 = ListItem(List=sort_50.Keys, Index=0, Wrap=True)  # -> flatten(Item)
c_script_3 = CSharpScript(num=item_100, Max="600", Min="300")  # -> out, A, Distance; inputs num: list of Double, Max: Double; same code as c_script
item_101 = ListItem(List=graft_8, Index=c_script_3.out, Wrap=True)

item_102 = ListItem(List=sort_49.ValuesA, Index=0, Wrap=True)  # -> flatten(Item)
item_103 = ListItem(List=sort_50.ValuesA, Index=0, Wrap=True)  # -> flatten(Item)
item_104 = ListItem(List=item_102, Index=c_script_2.out, Wrap=True)
item_105 = ListItem(List=item_103, Index=c_script_3.out, Wrap=True)

merge_49 = Merge(Data1=item_104, Data2=item_105)

# ----
# 按照梁分类定位点
crv_124 = Curve(shift_2)
incurves_15 = PointInCurves(Point=flatten(merge_49), Curves=crv_124)  # -> Relationship, Index, Point
equals_23 = Equality(FirstNumber=incurves_15.Relationship, SecondNumber="0")  # -> Equality, Inequality
dispatch_102 = Dispatch(List=flatten(merge_49), DispatchPattern=equals_23.Inequality)  # -> ListA, ListB
data_67 = Data(dispatch_102.ListA)

# ---- group: 交点-属于哪个梁
data_68 = Data(data_67)

# ----
# 按照梁分类定位PLANE
shift_51 = ShiftPaths(Data=crv_87, Offset=-1)
shift_52 = ShiftPaths(Data=shift_51, Offset=-1)
pull_56 = PullPoint(Point=data_64, Geometry=simplify(shift_52), ClosestOnly=True)  # -> ClosestPoint, Distance
ln_56 = Line(StartPoint=pull_56.ClosestPoint, EndPoint=data_64)
movetoplane_13 = MoveToPlane(Geometry=crv_46, Plane=PlaneXY(0, 0, 0), Above=True, Below=True)  # -> Geometry, Transform

# ---- group: Y Axis Line-All
crv_125 = Curve(ln_56)

# ----
# 按照梁分类定位PLANE
shift_53 = ShiftPaths(Data=crv_88, Offset=-1)
shift_54 = ShiftPaths(Data=shift_53, Offset=-1)
pull_57 = PullPoint(Point=data_68, Geometry=simplify(shift_54), ClosestOnly=True)  # -> ClosestPoint, Distance
ln_57 = Line(StartPoint=pull_57.ClosestPoint, EndPoint=data_68)
movetoplane_14 = MoveToPlane(Geometry=crv_47, Plane=PlaneXY(0, 0, 0), Above=True, Below=True)  # -> Geometry, Transform

# ---- group: Y Axis Line-All
crv_126 = Curve(ln_57)

# ----
end_16 = EndPoints(Curve=graft(crv_125))  # -> Start, End
merge_50 = Merge(Data1=end_16.Start, Data2=end_16.End)
pull_58 = PullPoint(Point=merge_50, Geometry=movetoplane_13.Geometry, ClosestOnly=True)  # -> ClosestPoint, Distance
sort_51 = SortList(Keys=pull_58.Distance, ValuesA=merge_50)  # -> Keys, ValuesA
item_106 = ListItem(List=sort_51.ValuesA, Index="-1", Wrap=True)
item_107 = ListItem(List=sort_51.ValuesA, Index=0, Wrap=True)
pt_78 = Point(item_107)
pt_79 = Point(item_106)
ln_58 = Line(StartPoint=pt_79, EndPoint=pt_78)
rotate_19 = Rotate(Geometry=ln_58, Angle=1.570796327, Plane=pt_78)  # -> Geometry, Transform

pt_80 = Point(end_16.End)

pl_17 = ConstructPlane(Origin=pt_80, XAxis=rotate_19.Geometry, YAxis=ln_58)
null_38 = NullItem(Item=pl_17)  # -> NullFlags, InvalidFlags, Description
dispatch_103 = Dispatch(List=pl_17, DispatchPattern=null_38.NullFlags)  # -> ListA, ListB
pln_98 = Plane(dispatch_103.ListB)

shift_55 = ShiftPaths(Data=pln_98, Offset=-1)
data_69 = Data(shift_55)

# ----
# 撞到梁交点
merge_51 = Merge(Data1=data_69)

merge_52 = Merge(Data1=pln_81, Data2=merge_51)
orient_6 = Orient(Geometry=item_35, Source=rotate_9.Geometry, Target=merge_52)  # -> Geometry, Transform

data_70 = Data(orient_6.Geometry)
ungroup_9 = Ungroup(Group=data_70)
item_108 = ListItem(List=ungroup_9, Index=0, Wrap=True)  # -> flatten(Item)
item_109 = ListItem(List=ungroup_9, Index="-1", Wrap=True)  # -> flatten(Item)

# ---- group: 框架顶部，埋件在幕墙线外侧 (continued)
entwine_16 = Entwine(Branch00=item_108, Branch01=item_109, FlattenInputs=True)
bake_6 = BakeObjects(Geometry=entwine_16, Attributes=attributes_6, BakeName=panel_47, Bake=False)

# ----
end_17 = EndPoints(Curve=graft(crv_126))  # -> Start, End
merge_53 = Merge(Data1=end_17.Start, Data2=end_17.End)
pull_59 = PullPoint(Point=merge_53, Geometry=movetoplane_14.Geometry, ClosestOnly=True)  # -> ClosestPoint, Distance
sort_52 = SortList(Keys=pull_59.Distance, ValuesA=merge_53)  # -> Keys, ValuesA
item_110 = ListItem(List=sort_52.ValuesA, Index="-1", Wrap=True)
item_111 = ListItem(List=sort_52.ValuesA, Index=0, Wrap=True)
pt_81 = Point(item_111)
pt_82 = Point(item_110)
ln_59 = Line(StartPoint=pt_82, EndPoint=pt_81)
rotate_20 = Rotate(Geometry=ln_59, Angle=1.570796327, Plane=pt_81)  # -> Geometry, Transform

pt_83 = Point(end_17.End)

pl_18 = ConstructPlane(Origin=pt_83, XAxis=rotate_20.Geometry, YAxis=ln_59)
null_39 = NullItem(Item=pl_18)  # -> NullFlags, InvalidFlags, Description
dispatch_104 = Dispatch(List=pl_18, DispatchPattern=null_39.NullFlags)  # -> ListA, ListB
pln_99 = Plane(dispatch_104.ListB)

shift_56 = ShiftPaths(Data=pln_99, Offset=-1)

# ---- group: 檐口-首次筛选的有效起始Plane
# Curve for this project only - All
data_71 = Data(shift_56)

# ----
# 撞到梁交点
merge_54 = Merge(Data1=data_71)

merge_55 = Merge(Data1=pln_83, Data2=merge_54)
orient_7 = Orient(Geometry=item_37, Source=item_38, Target=merge_55)  # -> Geometry, Transform

data_72 = Data(orient_7.Geometry)
ungroup_10 = Ungroup(Group=data_72)
item_112 = ListItem(List=ungroup_10, Index=0, Wrap=True)  # -> flatten(Item)
item_113 = ListItem(List=ungroup_10, Index="-1", Wrap=True)  # -> flatten(Item)

# ---- group: 框架顶部，埋件在幕墙线内侧 (continued)
entwine_17 = Entwine(Branch00=item_112, Branch01=item_113, FlattenInputs=True)
bake_7 = BakeObjects(Geometry=entwine_17, Attributes=attributes_7, BakeName=panel_49, Bake=False)

# ----
# 4.0下层建筑内侧到300到外侧50内
# 无钢结构
# 要求主体结构提供钢结构梁，默认位置为建筑边线向内300mm
pln_100 = Plane(pln_16)
crv_127 = Curve(crv_41)
offset_14 = OffsetCurve(Curve=crv_127, Distance=expr("-x", Slider(300, range=0..1000)), Corners=1)
pull_60 = PullPoint(Point=pln_100, Geometry=offset_14, ClosestOnly=True)  # -> ClosestPoint, Distance
sort_53 = SortList(Keys=pull_60.Distance)  # -> Keys, ValuesA
larger_10 = LargerThan(FirstNumber=pull_60.Distance, SecondNumber=Slider(400, range=0..1000))  # -> LargerThan, OrEqualTo
panel_78 = Panel(sort_53.Keys)
number_slider_52 = Slider(3584, range=0..10000)

# ---- group: 删除反常线
dispatch_105 = Dispatch(List=pln_100, DispatchPattern=larger_10.LargerThan)  # -> ListA, ListB

# ----
pln_101 = Plane(flatten(dispatch_105.ListB))
deplane_35 = DeconstructPlane(Plane=pln_101)  # -> Origin, XAxis, YAxis, ZAxis
amp_48 = Amplitude(Vector=deplane_35.YAxis, Amplitude=number_slider_52)
amp_49 = Amplitude(Vector=deplane_35.YAxis, Amplitude=expr("-x", number_slider_52))
move_59 = Move(Geometry=deplane_35.Origin, Motion=amp_49)  # -> Geometry, Transform
move_60 = Move(Geometry=deplane_35.Origin, Motion=amp_48)  # -> Geometry, Transform
ln_60 = Line(StartPoint=move_59.Geometry, EndPoint=move_60.Geometry)
ccx_30 = CurveCurve(CurveA=ln_60, CurveB=offset_14)  # -> Points, ParamsA, ParamsB
flatten_10 = FlattenTree(Tree=ccx_30.Points, Path="{0}")
null_40 = NullItem(Item=simplify(ccx_30.Points))  # -> NullFlags, InvalidFlags, Description
dispatch_106 = Dispatch(List=simplify(graft(pln_101)), DispatchPattern=null_40.NullFlags)  # -> ListA, ListB

# ---- group: 有效点
pull_61 = PullPoint(Point=deplane_35.Origin, Geometry=flatten_10, ClosestOnly=True)  # -> ClosestPoint, Distance

# ----
# 离结构太远
pln_102 = Plane(dispatch_105.ListA)

# ----
# 可能的双点
pln_103 = Plane(dispatch_106.ListA)

merge_56 = Merge(Data1=pln_102, Data2=pln_103)

# ----
# 0 檐口出定位点
# 与结构无交点
pln_104 = Plane(flatten(merge_56))

# ----
# 4.0  Missing Point
# 埋件定位点Offset，没有找到和梁的交点
number_slider_53 = Slider(5000, range=0..10000)
deplane_36 = DeconstructPlane(Plane=pln_104)  # -> Origin, XAxis, YAxis, ZAxis
crv_128 = Curve(scx_4.Curves)
amp_50 = Amplitude(Vector=deplane_36.YAxis, Amplitude=number_slider_53)
move_61 = Move(Geometry=deplane_36.Origin, Motion=amp_50)  # -> Geometry, Transform
ln_61 = Line(StartPoint=move_61.Geometry, EndPoint=deplane_36.Origin)
amp_51 = Amplitude(Vector=deplane_36.XAxis, Amplitude=number_slider_7)
amp_52 = Amplitude(Vector=deplane_36.XAxis, Amplitude=expr("-x", number_slider_7))
move_62 = Move(Geometry=ln_61, Motion=amp_51)  # -> Geometry, Transform
move_63 = Move(Geometry=ln_61, Motion=amp_52)  # -> Geometry, Transform

ccx_31 = CurveCurve(CurveA=graft(move_63.Geometry), CurveB=flatten(crv_128))  # -> Points, ParamsA, ParamsB
shift_57 = ShiftPaths(Data=ccx_31.Points, Offset=-1)
sort_54 = SortList(Keys=shift_57, ValuesA=shift_57)  # -> Keys, ValuesA
pull_62 = PullPoint(Point=sort_54.ValuesA, Geometry=graft(pln_104), ClosestOnly=True)  # -> ClosestPoint, Distance
sort_55 = SortList(Keys=pull_62.Distance, ValuesA=sort_54.ValuesA)  # -> Keys, ValuesA
item_114 = ListItem(List=sort_55.ValuesA, Index="-1", Wrap=True)
null_41 = NullItem(Item=flatten(item_114))  # -> NullFlags, InvalidFlags, Description
dispatch_107 = Dispatch(List=simplify(item_114), DispatchPattern=simplify(graft(null_41.InvalidFlags)))  # -> ListA, ListB
dispatch_108 = Dispatch(List=pln_104, DispatchPattern=null_41.InvalidFlags)  # -> ListA, ListB
pln_105 = Plane(dispatch_108.ListB)
pt_84 = Point(dispatch_107.ListB)

ccx_32 = CurveCurve(CurveA=graft(move_62.Geometry), CurveB=flatten(crv_128))  # -> Points, ParamsA, ParamsB
shift_58 = ShiftPaths(Data=ccx_32.Points, Offset=-1)
sort_56 = SortList(Keys=shift_58, ValuesA=shift_58)  # -> Keys, ValuesA
pull_63 = PullPoint(Point=sort_56.ValuesA, Geometry=graft(pln_104), ClosestOnly=True)  # -> ClosestPoint, Distance
sort_57 = SortList(Keys=pull_63.Distance, ValuesA=sort_56.ValuesA)  # -> Keys, ValuesA
item_115 = ListItem(List=sort_57.ValuesA, Index="-1", Wrap=True)
null_42 = NullItem(Item=flatten(item_115))  # -> NullFlags, InvalidFlags, Description
dispatch_109 = Dispatch(List=simplify(item_115), DispatchPattern=simplify(graft(null_42.InvalidFlags)))  # -> ListA, ListB
dispatch_110 = Dispatch(List=pln_104, DispatchPattern=null_42.InvalidFlags)  # -> ListA, ListB
pln_106 = Plane(dispatch_110.ListB)
pt_85 = Point(dispatch_109.ListB)

# ----
# 撞到结构
move2pt_19 = MoveToPoint(Geometry=flatten(pln_105), PointA=flatten(pln_105), PointB=flatten(pt_84))  # -> Moved, Vector, Transform
move2pt_20 = MoveToPoint(Geometry=flatten(pln_106), PointA=flatten(pln_106), PointB=flatten(pt_85))  # -> Moved, Vector, Transform

# ----
# 撞到梁交点
merge_57 = Merge(Data1=move2pt_20.Moved, Data2=move2pt_19.Moved)

# ----
# 4.0 默认位置为建筑边线向内300mm
# 侧埋，钢板焊
# 03：钢板焊埋件[钢梁外侧]@钢边梁宽@钢边梁高
move2pt_21 = MoveToPoint(Geometry=pln_101, PointA=deplane_35.Origin, PointB=pull_61.ClosestPoint)  # -> Moved, Vector, Transform

merge_58 = Merge(Data1=move2pt_21.Moved, Data2=merge_57)
orient_8 = Orient(Geometry=item_7, Source=item_8, Target=merge_58)  # -> Geometry, Transform

data_73 = Data(orient_8.Geometry)
ungroup_11 = Ungroup(Group=data_73)
item_116 = ListItem(List=ungroup_11, Index=0, Wrap=True)  # -> flatten(Item)
item_117 = ListItem(List=ungroup_11, Index="-1", Wrap=True)  # -> flatten(Item)

# ---- group: 范围内没有钢梁，默认幕墙线向内300有一个埋件 (continued)
entwine_18 = Entwine(Branch00=item_116, Branch01=item_117, FlattenInputs=True)
bake_8 = BakeObjects(Geometry=entwine_18, Attributes=attributes_10, BakeName=panel_53, Bake=False)

# ----
# 按照梁分类定位PLANE
shift_59 = ShiftPaths(Data=crv_93, Offset=-1)
shift_60 = ShiftPaths(Data=shift_59, Offset=-1)
pull_64 = PullPoint(Point=pt_74, Geometry=simplify(shift_60), ClosestOnly=True)  # -> ClosestPoint, Distance
ln_62 = Line(StartPoint=pull_64.ClosestPoint, EndPoint=pt_74)
movetoplane_15 = MoveToPlane(Geometry=crv_50, Plane=PlaneXY(0, 0, 0), Above=True, Below=True)  # -> Geometry, Transform

# ---- group: Y Axis Line-All
crv_129 = Curve(ln_62)

# ----
end_18 = EndPoints(Curve=graft(crv_129))  # -> Start, End
merge_59 = Merge(Data1=end_18.Start, Data2=end_18.End)
pull_65 = PullPoint(Point=merge_59, Geometry=movetoplane_15.Geometry, ClosestOnly=True)  # -> ClosestPoint, Distance
sort_58 = SortList(Keys=pull_65.Distance, ValuesA=merge_59)  # -> Keys, ValuesA
item_118 = ListItem(List=sort_58.ValuesA, Index="-1", Wrap=True)
item_119 = ListItem(List=sort_58.ValuesA, Index=0, Wrap=True)
pt_86 = Point(item_119)
pt_87 = Point(item_118)
ln_63 = Line(StartPoint=pt_87, EndPoint=pt_86)
rotate_21 = Rotate(Geometry=ln_63, Angle=1.570796327, Plane=pt_86)  # -> Geometry, Transform

pt_88 = Point(end_18.End)

pl_19 = ConstructPlane(Origin=pt_88, XAxis=rotate_21.Geometry, YAxis=ln_63)
null_43 = NullItem(Item=pl_19)  # -> NullFlags, InvalidFlags, Description
dispatch_111 = Dispatch(List=pl_19, DispatchPattern=null_43.NullFlags)  # -> ListA, ListB
pln_107 = Plane(dispatch_111.ListB)

shift_61 = ShiftPaths(Data=pln_107, Offset=-1)

# ---- group: 檐口-首次筛选的有效起始Plane
data_74 = Data(shift_61)

# ----
# 按照梁分类定位PLANE
shift_62 = ShiftPaths(Data=crv_94, Offset=-1)
shift_63 = ShiftPaths(Data=shift_62, Offset=-1)
pull_66 = PullPoint(Point=pt_77, Geometry=simplify(shift_63), ClosestOnly=True)  # -> ClosestPoint, Distance
ln_64 = Line(StartPoint=pull_66.ClosestPoint, EndPoint=pt_77)
movetoplane_16 = MoveToPlane(Geometry=crv_51, Plane=PlaneXY(0, 0, 0), Above=True, Below=True)  # -> Geometry, Transform

# ---- group: Y Axis Line-All
crv_130 = Curve(ln_64)

# ----
end_19 = EndPoints(Curve=graft(crv_130))  # -> Start, End
merge_60 = Merge(Data1=end_19.Start, Data2=end_19.End)
pull_67 = PullPoint(Point=merge_60, Geometry=movetoplane_16.Geometry, ClosestOnly=True)  # -> ClosestPoint, Distance
sort_59 = SortList(Keys=pull_67.Distance, ValuesA=merge_60)  # -> Keys, ValuesA
item_120 = ListItem(List=sort_59.ValuesA, Index="-1", Wrap=True)
item_121 = ListItem(List=sort_59.ValuesA, Index=0, Wrap=True)
pt_89 = Point(item_121)
pt_90 = Point(item_120)
ln_65 = Line(StartPoint=pt_90, EndPoint=pt_89)
rotate_22 = Rotate(Geometry=ln_65, Angle=1.570796327, Plane=pt_89)  # -> Geometry, Transform

pt_91 = Point(end_19.End)

pl_20 = ConstructPlane(Origin=pt_91, XAxis=rotate_22.Geometry, YAxis=ln_65)
null_44 = NullItem(Item=pl_20)  # -> NullFlags, InvalidFlags, Description
dispatch_112 = Dispatch(List=pl_20, DispatchPattern=null_44.NullFlags)  # -> ListA, ListB
pln_108 = Plane(dispatch_112.ListB)

shift_64 = ShiftPaths(Data=pln_108, Offset=-1)

# ---- group: 檐口-首次筛选的有效起始Plane
data_75 = Data(shift_64)

# ----
# 撞到梁交点
pln_109 = Plane(data_75)

# ----
# 4.1下层建筑内侧300到外侧50内
# 03底埋，钢板焊
pln_110 = Plane(data_74)
data_76 = Data(data_28)
item_122 = ListItem(List=data_76, Index="-1", Wrap=True)
item_123 = ListItem(List=data_76, Index=0, Wrap=True)
merge_61 = Merge(Data1=pln_110, Data2=pln_109)

# ---- group: All Location Point
merge_62 = Merge(Data1=merge_42, Data2=merge_52, Data3=merge_55, Data4=merge_61, Data5=merge_58)

# ----
orient_9 = Orient(Geometry=item_13.Item, Source=item_13.Item1, Target=merge_61)  # -> Geometry, Transform

data_77 = Data(orient_9.Geometry)
ungroup_12 = Ungroup(Group=data_77)
item_124 = ListItem(List=ungroup_12, Index=0, Wrap=True)  # -> flatten(Item)
item_125 = ListItem(List=ungroup_12, Index="-1", Wrap=True)  # -> flatten(Item)

# ---- group: 钢结构下底埋 (continued)
entwine_19 = Entwine(Branch00=item_124, Branch01=item_125, FlattenInputs=True)
bake_9 = BakeObjects(Geometry=entwine_19, Attributes=attributes_8, BakeName=panel_51, Bake=False)

# ----
null_45 = NullItem(Item=merge_62)  # -> NullFlags, InvalidFlags, Description
dispatch_113 = Dispatch(List=merge_62, DispatchPattern=null_45.InvalidFlags)  # -> ListA, ListB

# ---- group: 下层图纸-标注定位点
pt_92 = Point(dispatch_113.ListB)

# ----
cluster_4 = Cluster_2(
    outline_curve=标准范围_符合单一轴网方向,
    dim_offset_1=number_slider_15,
    dim_offset_2=number_slider_13,
    axis_direction_crv1=crv_11,
    axis_direction_crv2=crv_12,
    f2_arch_outline=crv_58,
    location_point=pt_92,
    dim_style=panel_24,
    directed_outline=seam,
    移除重复位置点_容差=number_slider_14)  # -> D_3, D_4, D, D_2
dimension1 = Data(cluster_4.D_3)

# ---- group: Dimension4
data_78 = Data(cluster_4.D_2)

# ---- group: Dimension2
data_79 = Data(cluster_4.D_4)

# ---- group: Dimension3
data_80 = Data(cluster_4.D)

# ----
entwine_20 = Entwine(Branch00=dimension1, Branch01=data_79, Branch02=data_80, Branch03=data_78, FlattenInputs=True)

# ---- group: Refrash Data
# 将所有Input都输入完后要Refresh data
dam = DataDam(DataA=entwine_20, BufferDelay=10000000, BufferMode=0)

# ----
dedim = DeconstructDimension(DimensionObject=dam)  # -> Value, Text, Plane, Points, Style
shift_65 = ShiftPaths(Data=dedim.Text, Offset=-1)
smaller_9 = SmallerThan(FirstNumber=shift_65, SecondNumber=Slider(1, range=0..10))  # -> SmallerThan, OrEqualTo
dispatch_114 = Dispatch(List=dam, DispatchPattern=smaller_9.SmallerThan)  # -> ListA, ListB

# ---- group: Bake Me
bake_10 = BakeObjects(Geometry=dispatch_114.ListB, Attributes=attributes_11, Bake=False)

# ----
data_81 = Data(dispatch_114.ListB)

# ----
# 1.0无檐口线初筛-上层定位点
crv_131 = Curve(reb_2)
pln_111 = Plane(pln_7)
project_20 = Project(Geometry=crv_131, Plane=PlaneXY(0, 0, 0))  # -> Geometry, Transform
clscrv_7 = CloseCurve(Curve=project_20.Geometry, CloseType=0, Bulge=0.5, Tolerance=0)  # -> Closed, R

deplane_37 = DeconstructPlane(Plane=pln_111)  # -> Origin, XAxis, YAxis, ZAxis

pt_93 = Point(deplane_37.Origin)
incurve_8 = PointInCurve(Point=pt_93, Curve=clscrv_7.Closed)  # -> Relationship, Point

equals_24 = Equality(FirstNumber=incurve_8.Relationship, SecondNumber="2")  # -> Equality, Inequality
dispatch_115 = Dispatch(List=pln_111, DispatchPattern=equals_24.Equality)  # -> ListA, ListB
data_82 = Data(dispatch_115.ListB)

panel_79 = Panel(incurve_8.Relationship)

pln_112 = Plane(dispatch_115.ListA)

# ---- group: 1.0N的情况的Plane
pln_113 = Plane(pln_112)

# ----
# 5 上层建筑边线,
# 默认建筑提供上翻，如主结构提供示意则使用结构定位【该项目无】，
# 如无则使用建筑边线向内50mm作为埋件定位
deplane_38 = DeconstructPlane(Plane=pln_113)  # -> Origin, XAxis, YAxis, ZAxis
number_slider_54 = Slider(3584, range=0..10000)
amp_53 = Amplitude(Vector=deplane_38.YAxis, Amplitude=number_slider_54)
amp_54 = Amplitude(Vector=deplane_38.YAxis, Amplitude=expr("-x", number_slider_54))
move_64 = Move(Geometry=deplane_38.Origin, Motion=amp_54)  # -> Geometry, Transform
move_65 = Move(Geometry=deplane_38.Origin, Motion=amp_53)  # -> Geometry, Transform
ln_66 = Line(StartPoint=move_64.Geometry, EndPoint=move_65.Geometry)
ccx_33 = CurveCurve(CurveA=ln_66, CurveB=crv_52)  # -> simplify(Points), ParamsA, ParamsB
ln_67 = Line(StartPoint=ccx_33.Points, EndPoint=simplify(graft(pln_113)))
len_10 = Length(Curve=ln_67)
null_46 = NullItem(Item=ccx_33.Points)  # -> NullFlags, InvalidFlags, Description
sort_60 = SortList(Keys=len_10, ValuesA=simplify(ccx_33.Points))  # -> Keys, ValuesA
dispatch_116 = Dispatch(List=simplify(graft(pln_113)), DispatchPattern=null_46.NullFlags)  # -> ListA, ListB
item_126 = ListItem(List=sort_60.ValuesA, Index=0, Wrap=True)

# ----
# 可能的双点
pln_114 = Plane(dispatch_116.ListA)

# ----
# 0 檐口出定位点
# 与结构无交点
pln_115 = Plane(flatten(pln_114))

# ----
# 5 上层建筑边线,
# 默认建筑提供上翻
# 04：板埋埋件[混凝土楼板上侧]
# @板埋参数xn
move2pt_22 = MoveToPoint(Geometry=simplify(graft(pln_113)), PointA=simplify(graft(pln_113)), PointB=item_126)  # -> flatten(Moved), Vector, Transform

# ----
# 5  Missing Point
# 埋件定位点Offset，没有找到和梁的交点
number_slider_55 = Slider(5000, range=0..10000)
deplane_39 = DeconstructPlane(Plane=pln_115)  # -> Origin, XAxis, YAxis, ZAxis
crv_132 = Curve(crv_52)
amp_55 = Amplitude(Vector=deplane_39.YAxis, Amplitude=number_slider_55)
move_66 = Move(Geometry=deplane_39.Origin, Motion=amp_55)  # -> Geometry, Transform
ln_68 = Line(StartPoint=move_66.Geometry, EndPoint=deplane_39.Origin)
amp_56 = Amplitude(Vector=deplane_39.XAxis, Amplitude=number_slider_7)
amp_57 = Amplitude(Vector=deplane_39.XAxis, Amplitude=expr("-x", number_slider_7))
move_67 = Move(Geometry=ln_68, Motion=amp_56)  # -> Geometry, Transform
move_68 = Move(Geometry=ln_68, Motion=amp_57)  # -> Geometry, Transform
pln_116 = Plane(pln_115)

ccx_34 = CurveCurve(CurveA=graft(move_68.Geometry), CurveB=flatten(crv_132))  # -> Points, ParamsA, ParamsB
shift_66 = ShiftPaths(Data=ccx_34.Points, Offset=-1)
sort_61 = SortList(Keys=shift_66, ValuesA=shift_66)  # -> Keys, ValuesA
pull_68 = PullPoint(Point=sort_61.ValuesA, Geometry=graft(pln_115), ClosestOnly=True)  # -> ClosestPoint, Distance
sort_62 = SortList(Keys=pull_68.Distance, ValuesA=sort_61.ValuesA)  # -> Keys, ValuesA
item_127 = ListItem(List=sort_62.ValuesA, Index="-1", Wrap=True)
null_47 = NullItem(Item=flatten(item_127))  # -> NullFlags, InvalidFlags, Description
dispatch_117 = Dispatch(List=simplify(item_127), DispatchPattern=simplify(graft(null_47.InvalidFlags)))  # -> ListA, ListB
dispatch_118 = Dispatch(List=pln_115, DispatchPattern=null_47.InvalidFlags)  # -> ListA, ListB
pln_117 = Plane(dispatch_118.ListB)
pt_94 = Point(dispatch_117.ListB)

ccx_35 = CurveCurve(CurveA=graft(move_67.Geometry), CurveB=flatten(crv_132))  # -> Points, ParamsA, ParamsB
shift_67 = ShiftPaths(Data=ccx_35.Points, Offset=-1)
sort_63 = SortList(Keys=shift_67, ValuesA=shift_67)  # -> Keys, ValuesA
pull_69 = PullPoint(Point=sort_63.ValuesA, Geometry=graft(pln_115), ClosestOnly=True)  # -> ClosestPoint, Distance
sort_64 = SortList(Keys=pull_69.Distance, ValuesA=sort_63.ValuesA)  # -> Keys, ValuesA
item_128 = ListItem(List=sort_64.ValuesA, Index="-1", Wrap=True)
null_48 = NullItem(Item=flatten(item_128))  # -> NullFlags, InvalidFlags, Description
dispatch_119 = Dispatch(List=simplify(item_128), DispatchPattern=simplify(graft(null_48.InvalidFlags)))  # -> ListA, ListB
dispatch_120 = Dispatch(List=pln_115, DispatchPattern=null_48.InvalidFlags)  # -> ListA, ListB
pln_118 = Plane(dispatch_120.ListB)
pt_95 = Point(dispatch_119.ListB)

merge_63 = Merge(Data1=pln_118, Data2=pln_117)  # -> flatten(Result)
check_same_points_11 = CheckSamePoints(archPoint=flatten(pln_116), crvPoint=merge_63)  # -> out, specialPt; inputs archPoint: list of Point3d, crvPoint: list of Point3d; same code as testpoint

# ----
# 撞到结构
move2pt_23 = MoveToPoint(Geometry=flatten(pln_118), PointA=flatten(pln_118), PointB=flatten(pt_95))  # -> Moved, Vector, Transform
move2pt_24 = MoveToPoint(Geometry=flatten(pln_117), PointA=flatten(pln_117), PointB=flatten(pt_94))  # -> Moved, Vector, Transform

# ----
# pass
cull_i_13 = CullIndex(List=flatten(pln_116), Indices=check_same_points_11.specialPt, Wrap=True)  # -> simplify(graft(List))

# ----
# 撞到梁交点
merge_64 = Merge(Data1=flatten(move2pt_23.Moved), Data2=flatten(move2pt_24.Moved))

merge_65 = Merge(Data1=flatten(move2pt_22.Moved), Data2=flatten(merge_64))

# ---- group: All Location Point
merge_66 = Merge(Data1=merge_32, Data2=merge_36, Data3=merge_65)

# ----
deplane_40 = DeconstructPlane(Plane=merge_65)  # -> Origin, XAxis, YAxis, ZAxis
amp_58 = Amplitude(Vector=deplane_40.YAxis, Amplitude=len_6)
move_69 = Move(Geometry=merge_65, Motion=amp_58)  # -> Geometry, Transform
incurve_9 = PointInCurve(Point=move_69.Geometry, Curve=crv_53)  # -> Relationship, Point
panel_80 = Panel(incurve_9.Relationship)
equals_25 = Equality(FirstNumber=incurve_9.Relationship, SecondNumber="0")  # -> Equality, Inequality
dispatch_121 = Dispatch(List=move_69.Geometry, DispatchPattern=equals_25.Equality)  # -> ListA, ListB
data_83 = Data(dispatch_121.ListA)
data_84 = Data(dispatch_121.ListB)
amp_59 = Amplitude(Vector=deplane_40.YAxis, Amplitude=len_6)
move_70 = Move(Geometry=data_83, Motion=expr("-X", amp_59))  # -> Geometry, Transform
move_71 = Move(Geometry=move_70.Geometry, Motion=expr("-X", amp_59))  # -> Geometry, Transform
merge_67 = Merge(Data1=move_71.Geometry, Data2=data_84)
orient_10 = Orient(Geometry=item_39, Source=item_40, Target=merge_67)  # -> Geometry, Transform

data_85 = Data(orient_10.Geometry)
ungroup_13 = Ungroup(Group=data_85)
item_129 = ListItem(List=ungroup_13, Index=0, Wrap=True)  # -> flatten(Item)
item_130 = ListItem(List=ungroup_13, Index="-1", Wrap=True)  # -> flatten(Item)

# ---- group: 幕墙底部接地埋件 (continued)
entwine_21 = Entwine(Branch00=item_129, Branch01=item_130, FlattenInputs=True)
bake_11 = BakeObjects(Geometry=entwine_21, Attributes=attributes_9, BakeName=panel_55, Bake=False)

# ----
null_49 = NullItem(Item=merge_66)  # -> NullFlags, InvalidFlags, Description
dispatch_122 = Dispatch(List=merge_66, DispatchPattern=null_49.InvalidFlags)  # -> ListA, ListB

# ---- group: 下层图纸-标注定位点
pt_96 = Point(dispatch_122.ListB)

# ----
cluster_5 = Cluster_2(
    outline_curve=标准范围_符合单一轴网方向_2,
    dim_offset_1=number_slider_19,
    dim_offset_2=number_slider_18,
    axis_direction_crv1=crv_14,
    axis_direction_crv2=crv_15,
    f2_arch_outline=crv_59,
    location_point=pt_96,
    dim_style=panel_25,
    directed_outline=seam_2,
    移除重复位置点_容差=number_slider_16)  # -> D_3, D_4, D, D_2
dimension1_2 = Data(cluster_5.D_3)

# ---- group: Dimension2
data_86 = Data(cluster_5.D_4)

# ---- group: Dimension4
data_87 = Data(cluster_5.D_2)

# ---- group: Dimension3
data_88 = Data(cluster_5.D)

# ----
entwine_22 = Entwine(Branch00=dimension1_2, Branch01=data_86, Branch02=data_88, Branch03=data_87, FlattenInputs=True)

# ---- group: Refrash Data
# 将所有Input都输入完后要Refresh data
dam_2 = DataDam(DataA=entwine_22, BufferDelay=10000000, BufferMode=0)

# ----
dedim_2 = DeconstructDimension(DimensionObject=dam_2)  # -> Value, Text, Plane, Points, Style
shift_68 = ShiftPaths(Data=dedim_2.Text, Offset=-1)
smaller_10 = SmallerThan(FirstNumber=shift_68, SecondNumber=Slider(1, range=0..10))  # -> SmallerThan, OrEqualTo
dispatch_123 = Dispatch(List=dam_2, DispatchPattern=smaller_10.SmallerThan)  # -> ListA, ListB

# ---- group: Bake Me
bake_12 = BakeObjects(Geometry=dispatch_123.ListB, Attributes=attributes_12, Bake=False)

# ----
data_89 = Data(dispatch_123.ListB)

crv_133 = Curve(project_11.Geometry)
crv_134 = Curve([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])
merge_68 = Merge(Data1=crv_133, Data2=crv_134)  # -> flatten(Result)

# ----
# curve
crv_135 = Curve(merge_68)

angle = Angle(VectorA=crv_135, VectorB="1,0,0")  # -> Angle, Reflex
deg_5 = Degrees(Radians=angle.Angle)
number = NumberGroups(Number=deg_5, Difference="0.2")  # -> Groups, Indices
item_131 = ListItem(List=crv_135, Index=number.Indices, Wrap=True)  # -> simplify(Item)
panel_81 = Panel(number.Groups)
item_132 = ListItem(List=item_131, Index=0, Wrap=True)  # -> flatten(Item)
item_133 = ListItem(List=item_131, Index=0, Wrap=True)
bang_3 = ExplodeTree(Data=item_131)  # -> Branch0, Branch1, Branch2, Branch3, Branch4, Branch5
crv_136 = Curve(bang_3.Branch0)
crv_137 = Curve(bang_3.Branch1)
crv_138 = Curve(bang_3.Branch2)
crv_139 = Curve(bang_3.Branch3)
angle_2 = Angle(VectorA=item_133, VectorB=item_132)  # -> Angle, Reflex
deg_6 = Degrees(Radians=angle_2.Angle)
round_2 = Round(Number=deg_6, DecimalPlace="0")  # -> Nearest, Floor, Ceiling
equals_26 = Equality(FirstNumber=round_2.Nearest, SecondNumber="90")  # -> Equality, Inequality
panel_82 = Panel(round_2.Nearest)
dispatch_124 = Dispatch(List=item_132, DispatchPattern=equals_26.Equality)  # -> ListA, ListB
crv_140 = Curve(flatten(dispatch_124.ListA))
index = ItemIndex(List=item_132, Item=crv_140)
concat_4 = Concatenate(FragmentA="{", FragmentB=index)
concat_5 = Concatenate(FragmentA=concat_4, FragmentB="}")
tstat_3 = TreeStatistics(Tree=item_131)  # -> Paths, Length, Count
item_134 = ListItem(List=tstat_3.Paths, Index=0, Wrap=True)  # -> Item, Item1
item_135 = ListItem(List=concat_5, Index=0, Wrap=True)
# Sort Text
branch = TreeBranch(Tree=item_131, Path=item_134.Item, MaintainPaths=True)
branch_2 = TreeBranch(Tree=item_131, Path=item_135, MaintainPaths=True)

# ==== cluster Cluster
G = ClusterInput()
rotate = Rotate(Geometry=G, Angle=3.141592654, Plane=PlaneXY(0, 0, 0))  # -> Geometry, Transform
boxprop = BoxProperties(Box=rotate.Geometry)  # -> Center, Diagonal, Area, Volume, Degeneracy
bbox = BoundingBox(Content=rotate.Geometry, Plane=PlaneXY(0, 0, 0))  # -> Box, Box_2
debox = DeconstructBox(Box=bbox.Box)  # -> Plane, X, Y, Z
pdecon = Deconstruct(Point=boxprop.Center)  # -> XComponent, YComponent, ZComponent
dedomain = DeconstructDomain(Domain=debox.Y)  # -> Start, End
pt = ConstructPoint(XCoordinate=pdecon.XComponent, YCoordinate=dedomain.Start, ZCoordinate=pdecon.ZComponent)
xy = XYPlane(Origin=Point(0, 0, 0))
pl_origin = PlaneOrigin(Base=xy, Origin=pt)
orient = Orient(Geometry=rotate.Geometry, Source=pl_origin, Target=xy)  # -> Geometry, Transform
G_2 = ClusterOutput(orient.Geometry)

# ==== cluster Cluster_2
f2_arch_outline = ClusterInput()
directed_outline = ClusterInput()
location_point = ClusterInput()
移除重复位置点_容差 = ClusterInput()
dim_offset_1 = ClusterInput()
dim_offset_2 = ClusterInput()
axis_direction_crv1 = ClusterInput()
axis_direction_crv2 = ClusterInput()
dim_style = ClusterInput()
outline_curve = ClusterInput()
pt = Point(location_point)
merge = Merge(Data1=axis_direction_crv1, Data2=axis_direction_crv2)
crv = Curve(f2_arch_outline)
number_slider = Slider(61, range=0..100)

incurve = PointInCurve(Point=flatten(pt), Curve=outline_curve)  # -> Relationship, Point
equals = Equality(FirstNumber=incurve.Relationship, SecondNumber="0")  # -> Equality, Inequality
dispatch = Dispatch(List=flatten(pt), DispatchPattern=equals.Inequality)  # -> ListA, ListB
pt_2 = Point(dispatch.ListA)
crv_cp = CurveClosestPoint(Point=pt_2, Curve=directed_outline)  # -> Point, Parameter, Distance
sort = SortList(Keys=crv_cp.Parameter, ValuesA=pt_2)  # -> Keys, ValuesA
pt_3 = Point(sort.ValuesA)
item = ListItem(List=merge, Index=0, Wrap=True)  # -> Item, Item1

# ----
# remove重复定位点生成的2个点
pt_4 = Point(pt_3)
shift = ShiftList(List=pt_4, Shift=1, Wrap=invert(True))
pt_5 = Point(pt_3)
pt_6 = Point(shift)
dist = Distance(PointA=pt_5, PointB=pt_6)
larger = LargerThan(FirstNumber=dist, SecondNumber=移除重复位置点_容差)  # -> LargerThan, OrEqualTo
dispatch_2 = Dispatch(List=pt_5, DispatchPattern=larger.LargerThan)  # -> ListA, ListB
pt_7 = Point(dispatch_2.ListA)
pt_8 = Point(dispatch_2.ListB)

dispatch_3 = Dispatch(List=pt_7, DispatchPattern=[True, False])  # -> ListA, ListB
pt_9 = Point(dispatch_3.ListB)
pt_10 = Point(dispatch_3.ListA)
pl = ConstructPlane(Origin=pt_10, XAxis=item.Item1, YAxis=item.Item)
pl_2 = ConstructPlane(Origin=pt_10, XAxis=item.Item, YAxis=item.Item1)

item_2 = ListItem(List=pt_7, Index=number_slider, Wrap=True)
shift_2 = ShiftList(List=pt_7, Shift=1, Wrap=invert(True))
item_3 = ListItem(List=shift_2, Index=number_slider, Wrap=True)

dispatch_4 = Dispatch(List=shift_2, DispatchPattern=[True, False])  # -> ListA, ListB
item_4 = ListItem(List=merge, Index=0, Wrap=True)  # -> Item, Item1
pt_11 = Point(dispatch_4.ListB)
pt_12 = Point(dispatch_4.ListA)
pl_3 = ConstructPlane(Origin=pt_12, XAxis=item_4.Item1, YAxis=item_4.Item)
pl_4 = ConstructPlane(Origin=pt_12, XAxis=item_4.Item, YAxis=item_4.Item1)

ln = Line(StartPoint=pt_10, EndPoint=pt_9)
ln_2 = Line(StartPoint=pt_12, EndPoint=pt_11)

crv_2 = Curve(crv)
deplane = DeconstructPlane(Plane=pl_3)  # -> Origin, XAxis, YAxis, ZAxis
amp = Amplitude(Vector=deplane.YAxis, Amplitude=Slider(3000, range=0..10000))
move = Move(Geometry=deplane.Origin, Motion=amp)  # -> Geometry, Transform
clscrv = CloseCurve(Curve=crv_2, CloseType=0, Bulge=0.5, Tolerance=0)  # -> Closed, R
pt_13 = Point(move.Geometry)
incurve_2 = PointInCurve(Point=pt_13, Curve=clscrv.Closed)  # -> Relationship, Point
equals_2 = Equality(FirstNumber=incurve_2.Relationship, SecondNumber="2")  # -> Equality, Inequality
lng = ListLength(List=equals_2.Equality)
lng_2 = ListLength(List=equals_2.Equality)
neg = Negative(Value=dim_offset_1)
repeat = RepeatData(Data=graft(neg), Length=lng)
repeat_2 = RepeatData(Data=graft(dim_offset_1), Length=lng_2)
panel = Panel(equals_2.Equality)
dispatch_5 = Dispatch(List=graft(repeat_2), DispatchPattern=graft(equals_2.Equality))  # -> ListA, ListB
dispatch_6 = Dispatch(List=graft(repeat), DispatchPattern=graft(equals_2.Equality))  # -> ListA, ListB
merge_2 = Merge(Data1=dispatch_5.ListA, Data2=dispatch_6.ListB)  # -> flatten(Result)

crv_3 = Curve(crv)
deplane_2 = DeconstructPlane(Plane=pl_4)  # -> Origin, XAxis, YAxis, ZAxis
amp_2 = Amplitude(Vector=deplane_2.YAxis, Amplitude=Slider(3000, range=0..10000))
move_2 = Move(Geometry=deplane_2.Origin, Motion=amp_2)  # -> Geometry, Transform
clscrv_2 = CloseCurve(Curve=crv_3, CloseType=0, Bulge=0.5, Tolerance=0)  # -> Closed, R
pt_14 = Point(move_2.Geometry)
incurve_3 = PointInCurve(Point=pt_14, Curve=clscrv_2.Closed)  # -> Relationship, Point
equals_3 = Equality(FirstNumber=incurve_3.Relationship, SecondNumber="2")  # -> Equality, Inequality
lng_3 = ListLength(List=equals_3.Equality)
neg_2 = Negative(Value=dim_offset_1)
lng_4 = ListLength(List=equals_3.Equality)
repeat_3 = RepeatData(Data=graft(neg_2), Length=lng_4)
repeat_4 = RepeatData(Data=graft(dim_offset_1), Length=lng_3)
panel_2 = Panel(equals_3.Equality)
dispatch_7 = Dispatch(List=graft(repeat_4), DispatchPattern=graft(equals_3.Equality))  # -> ListA, ListB
dispatch_8 = Dispatch(List=graft(repeat_3), DispatchPattern=graft(equals_3.Equality))  # -> ListA, ListB
merge_3 = Merge(Data1=dispatch_7.ListA, Data2=dispatch_8.ListB)  # -> flatten(Result)

crv_4 = Curve(crv)
deplane_3 = DeconstructPlane(Plane=pl)  # -> Origin, XAxis, YAxis, ZAxis
amp_3 = Amplitude(Vector=deplane_3.YAxis, Amplitude=Slider(3000, range=0..10000))
move_3 = Move(Geometry=deplane_3.Origin, Motion=amp_3)  # -> Geometry, Transform
clscrv_3 = CloseCurve(Curve=crv_4, CloseType=0, Bulge=0.5, Tolerance=0)  # -> Closed, R
pt_15 = Point(move_3.Geometry)
incurve_4 = PointInCurve(Point=pt_15, Curve=clscrv_3.Closed)  # -> Relationship, Point
equals_4 = Equality(FirstNumber=incurve_4.Relationship, SecondNumber="2")  # -> Equality, Inequality
lng_5 = ListLength(List=equals_4.Equality)
neg_3 = Negative(Value=dim_offset_2)
lng_6 = ListLength(List=equals_4.Equality)
repeat_5 = RepeatData(Data=graft(neg_3), Length=lng_6)
repeat_6 = RepeatData(Data=graft(dim_offset_2), Length=lng_5)
panel_3 = Panel(equals_4.Equality)
dispatch_9 = Dispatch(List=graft(repeat_6), DispatchPattern=graft(equals_4.Equality))  # -> ListA, ListB
dispatch_10 = Dispatch(List=graft(repeat_5), DispatchPattern=graft(equals_4.Equality))  # -> ListA, ListB
merge_4 = Merge(Data1=dispatch_9.ListA, Data2=dispatch_10.ListB)  # -> flatten(Result)

crv_5 = Curve(crv)
deplane_4 = DeconstructPlane(Plane=pl_2)  # -> Origin, XAxis, YAxis, ZAxis
amp_4 = Amplitude(Vector=deplane_4.YAxis, Amplitude=Slider(3000, range=0..10000))
move_4 = Move(Geometry=deplane_4.Origin, Motion=amp_4)  # -> Geometry, Transform
clscrv_4 = CloseCurve(Curve=crv_5, CloseType=0, Bulge=0.5, Tolerance=0)  # -> Closed, R
pt_16 = Point(move_4.Geometry)
incurve_5 = PointInCurve(Point=pt_16, Curve=clscrv_4.Closed)  # -> Relationship, Point
equals_5 = Equality(FirstNumber=incurve_5.Relationship, SecondNumber="2")  # -> Equality, Inequality
lng_7 = ListLength(List=equals_5.Equality)
neg_4 = Negative(Value=dim_offset_2)
lng_8 = ListLength(List=equals_5.Equality)
repeat_7 = RepeatData(Data=graft(neg_4), Length=lng_8)
repeat_8 = RepeatData(Data=graft(dim_offset_2), Length=lng_7)
panel_4 = Panel(equals_5.Equality)
dispatch_11 = Dispatch(List=graft(repeat_8), DispatchPattern=graft(equals_5.Equality))  # -> ListA, ListB
dispatch_12 = Dispatch(List=graft(repeat_7), DispatchPattern=graft(equals_5.Equality))  # -> ListA, ListB
merge_5 = Merge(Data1=dispatch_11.ListA, Data2=dispatch_12.ListB)  # -> flatten(Result)

lineardim = DefineLinearDimension(
    Point1=simplify(pt_12),
    Point2=simplify(pt_11),
    DimensionPlane=simplify(pl_3),
    Offset=expr("-x", merge_2),
    DimensionStyle=dim_style)
lineardim_2 = DefineLinearDimension(
    Point1=simplify(pt_12),
    Point2=simplify(pt_11),
    DimensionPlane=simplify(pl_4),
    Offset=expr("-x", merge_3),
    DimensionStyle=dim_style)
lineardim_3 = DefineLinearDimension(
    Point1=simplify(pt_10),
    Point2=simplify(pt_9),
    DimensionPlane=simplify(pl),
    Offset=expr("-x", merge_4),
    DimensionStyle=dim_style)
lineardim_4 = DefineLinearDimension(
    Point1=simplify(pt_10),
    Point2=simplify(pt_9),
    DimensionPlane=simplify(pl_2),
    Offset=expr("-x", merge_5),
    DimensionStyle=dim_style)
D = ClusterOutput(lineardim)
D_2 = ClusterOutput(lineardim_2)
D_3 = ClusterOutput(lineardim_3)
D_4 = ClusterOutput(lineardim_4)

# ==== cluster Cluster_3
structure_number = ClusterInput()
tag_text = ClusterInput()
text_offset = ClusterInput()
embed_color = ClusterInput()
T = ClusterInput()
G = ClusterInput()
A = ClusterInput()
A_2 = ClusterInput()
B = ClusterInput()
dimension_style = ClusterInput()

# ----
# 列表文字以空格进行分割
panel = Panel(" ")
split = TextSplit(Text=T, Separators=panel)

钢埋板长度_2 = Division(A=A, B=2)
neg = Negative(Value=钢埋板长度_2)
dom = ConstructDomain(DomainStart=neg, DomainEnd=钢埋板长度_2)
panel_2 = Panel(dom)

钢埋板厚度_2 = Division(A=A_2, B=2)
neg_2 = Negative(Value=钢埋板厚度_2)
dom_2 = ConstructDomain(DomainStart=neg_2, DomainEnd=钢埋板厚度_2)
panel_3 = Panel(dom_2)

# ----
# 钢埋板肋板位置 1/4处
panel_4 = Panel("4")
division = Division(A=A, B=panel_4)

# ----
# 编号和截面尺寸分区
panel_5 = Panel("1")
split_2 = SplitList(List=split, Index=panel_5)  # -> flatten(ListA), flatten(ListB)

# ----
# 求出对应输入编号的钢结构截面尺寸
fsim = FindSimilarMember(Data=structure_number, Set=split_2.ListA)  # -> Hit, Index
item = ListItem(List=split_2.ListB, Index=fsim.Index, Wrap=True)

addition = Addition(A=neg_2, B=division)
addition_2 = Addition(A=钢埋板厚度_2, B=division)
dom_3 = ConstructDomain(DomainStart=addition, DomainEnd=addition_2)
panel_6 = Panel(split_2.ListB)
split_3 = TextSplit(Text=item, Separators="x")
split_4 = TextSplit(Text=split_3, Separators="Q")
item_2 = ListItem(List=split_4, Index="0", Wrap=True)  # -> flatten(Item)
subtraction = Subtraction(A=division, B=钢埋板厚度_2)
subtraction_2 = Subtraction(A=division, B=钢埋板厚度_2)
subtraction_3 = Subtraction(A=division, B=钢埋板厚度_2)
neg_3 = Negative(Value=钢埋板厚度_2)
neg_4 = Negative(Value=钢埋板厚度_2)
neg_5 = Negative(Value=钢埋板厚度_2)
subtraction_4 = Subtraction(A=division, B=钢埋板厚度_2)
addition_3 = Addition(A=subtraction, B=A_2)
addition_4 = Addition(A=subtraction_2, B=A_2)
subtraction_5 = Subtraction(A=neg_3, B=A_2)
subtraction_6 = Subtraction(A=neg_4, B="2")
subtraction_7 = Subtraction(A=division, B=钢埋板厚度_2)
addition_5 = Addition(A=subtraction_3, B="2")
subtraction_8 = Subtraction(A=neg_5, B="2")
neg_6 = Negative(Value=钢埋板厚度_2)
neg_7 = Negative(Value=钢埋板厚度_2)
工字钢_h = ListItem(List=item_2, Index=0, Wrap=True)
工字钢_b = ListItem(List=item_2, Index=1, Wrap=True)
工字钢_tf = ListItem(List=item_2, Index=3, Wrap=True)
工字钢_tw = ListItem(List=item_2, Index=2, Wrap=True)
pt = ConstructPoint(XCoordinate=neg_6, YCoordinate=subtraction_4, ZCoordinate=0)
pt_2 = ConstructPoint(XCoordinate=neg_7, YCoordinate=addition_3, ZCoordinate=0)
pt_3 = ConstructPoint(XCoordinate=subtraction_5, YCoordinate=addition_4, ZCoordinate=0)
pt_4 = ConstructPoint(XCoordinate=subtraction_6, YCoordinate=subtraction_7, ZCoordinate=0)
pt_5 = ConstructPoint(XCoordinate=subtraction_8, YCoordinate=addition_5, ZCoordinate=0)
subtraction_9 = Subtraction(A=工字钢_b, B=工字钢_tw)
division_2 = Division(A=subtraction_9, B="2")
merge = Merge(Data1=pt, Data2=pt_2, Data3=pt_3, Data4=pt_5, Data5=pt_4)
pline = PolyLine(Vertices=merge, Closed=True)
division_3 = Division(A=division_2, B="2")
subtraction_10 = Subtraction(A=division_3, B=A_2)
subtraction_11 = Subtraction(A=division_3, B=钢埋板厚度_2)
neg_8 = Negative(Value=division_3)
subtraction_12 = Subtraction(A=neg_8, B=subtraction_11)
addition_6 = Addition(A=subtraction_12, B=B)
dom_4 = ConstructDomain(DomainStart=addition_6, DomainEnd=subtraction_12)
dom_5 = ConstructDomain(DomainStart=addition, DomainEnd=addition_2)
钢肋板倒角_侧视图 = Rectangle(Plane=PlaneXY(0, 0, 0), XSize=dom_4, YSize=dom_5, Radius=0)  # -> Rectangle, Length
subtraction_13 = Subtraction(A=subtraction_10, B=subtraction_11)
subtraction_14 = Subtraction(A=neg_8, B=subtraction_11)
dom_6 = ConstructDomain(DomainStart=subtraction_13, DomainEnd=subtraction_14)
钢肋板_侧视图 = Rectangle(Plane=PlaneXY(0, 0, 0), XSize=dom_6, YSize=dom_3, Radius=0)  # -> Rectangle, Length
merge_2 = Merge(Data1=钢肋板_侧视图.Rectangle, Data2=pline, Data3=钢肋板倒角_侧视图.Rectangle)
xz = XZPlane(Origin=Point(0, 0, 0))
mirror = Mirror(Geometry=merge_2, Plane=xz)  # -> Geometry, Transform
钢埋板_侧视图 = Rectangle(Plane=PlaneXY(0, 0, 0), XSize=dom_2, YSize=dom, Radius=0)  # -> Rectangle, Length
division_4 = Division(A=工字钢_b, B=2)
侧视图 = Entwine(Branch00=钢埋板_侧视图.Rectangle, Branch01=merge_2, Branch02=mirror.Geometry, FlattenInputs=True)
R = ClusterOutput(division_4)
division_5 = Division(A=工字钢_h, B="2")
subtraction_15 = Subtraction(A=division_5, B=工字钢_tf)
addition_7 = Addition(A=subtraction_15, B=Slider(200, range=0..1000))
addition_8 = Addition(A=addition_7, B=division_2)
X = UnitX(Factor=addition_8)
move = Move(Geometry=侧视图, Motion=X)  # -> Geometry, Transform
split_tree = SplitTree(Data=move.Geometry, Masks=flatten("{0;0}"))  # -> Positive, Negative
dispatch = Dispatch(List=split_tree.Negative, DispatchPattern=[True, False])  # -> flatten(ListA), ListB
merge_3 = Merge(Data1=split_tree.Positive, Data2=dispatch.ListA)
entwine = Entwine(Branch00=merge_3, Branch01=dispatch.ListB, FlattenInputs=True)
flatten = FlattenTree(Tree=entwine, Path="{0}")
group = Group(Objects=flatten)
rotate = Rotate(Geometry=group, Angle=3.141592654, Plane=PlaneXY(0, 0, 0))  # -> Geometry, Transform
boxprop = BoxProperties(Box=rotate.Geometry)  # -> Center, Diagonal, Area, Volume, Degeneracy
bbox = BoundingBox(Content=rotate.Geometry, Plane=PlaneXY(0, 0, 0))  # -> Box, Box_2
debox = DeconstructBox(Box=bbox.Box)  # -> Plane, X, Y, Z
pdecon = Deconstruct(Point=boxprop.Center)  # -> XComponent, YComponent, ZComponent
dedomain = DeconstructDomain(Domain=debox.Y)  # -> Start, End
pt_6 = ConstructPoint(XCoordinate=pdecon.XComponent, YCoordinate=dedomain.Start, ZCoordinate=pdecon.ZComponent)
xy = XYPlane(Origin=Point(0, 0, 0))
concat = Concatenate(FragmentA="Embed", FragmentB=tag_text)
pl_origin = PlaneOrigin(Base=xy, Origin=pt_6)
orient = Orient(Geometry=rotate.Geometry, Source=pl_origin, Target=xy)  # -> Geometry, Transform
xy_2 = XYPlane(Origin=Point(0, 0, 0))
attributes = DefineObjectAttributes(Color=embed_color)
ungroup = Ungroup(Group=orient.Geometry)
block = DefineBlock(Geometry=ungroup, Attributes=attributes, BlockName=concat, BasePlane=PlaneXY(0, 0, 0))
deblock = DeconstructBlock(Block=block)  # -> Name, flatten(Plane), flatten(Geometry)
group_2 = Group(Objects=deblock.Geometry)
bbox_2 = BoundingBox(Content=group_2, Plane=PlaneXY(0, 0, 0))  # -> Box, Box_2
deplane = DeconstructPlane(Plane=deblock.Plane)  # -> Origin, XAxis, YAxis, ZAxis
area = Area(Geometry=bbox_2.Box)  # -> Area, Centroid
move2pt = MoveToPoint(Geometry=flatten(deplane.Origin), PointA=flatten(deplane.Origin), PointB=flatten(area.Centroid))  # -> Moved, Vector, Transform
pl = ConstructPlane(Origin=move2pt.Moved, XAxis=deplane.YAxis, YAxis=deplane.XAxis)  # -> graft(Plane)
deplane_2 = DeconstructPlane(Plane=pl)  # -> Origin, XAxis, YAxis, ZAxis
rotate_2 = Rotate(Geometry=pl, Angle="Pi", Plane=pl)  # -> Geometry, Transform
dedomain_2 = DeconstructDomain(Domain=dom)  # -> Start, End
multiplication = Multiplication(A=dedomain_2.Start, B=dedomain_2.Start)
amp = Amplitude(Vector=deplane_2.YAxis, Amplitude=multiplication)
move_2 = Move(Geometry=deplane_2.Origin, Motion=amp)  # -> Geometry, Transform
srf = Surface(bbox_2.Box)
crv = Curve(srf)
ln = Line(StartPoint=move_2.Geometry, EndPoint=deplane_2.Origin)
ccx = CurveCurve(CurveA=ln, CurveB=crv)  # -> Points, ParamsA, ParamsB
ln_2 = Line(StartPoint=deplane_2.Origin, EndPoint=ccx.Points)
move_3 = Move(Geometry=rotate_2.Geometry, Motion=ln_2)  # -> Geometry, Transform

ln_3 = Line(StartPoint=ccx.Points, EndPoint=deplane_2.Origin)
amp_2 = Amplitude(Vector=ln_3, Amplitude=text_offset)
move_4 = Move(Geometry=rotate_2.Geometry, Motion=amp_2)  # -> Geometry, Transform
text = DefineTextObject(Text=tag_text, Plane=move_4.Geometry, DimensionStyle=dimension_style, OutputType="Text")
group_3 = Group(Objects=[block, text])

entwine_2 = Entwine(Branch00=group_3, Branch01=move_3.Geometry, FlattenInputs=True)
project = Project(Geometry=G, Plane=xy_2)  # -> Geometry, Transform
R_2 = ClusterOutput(entwine_2)
G_2 = ClusterOutput(project.Geometry)
