# Grasshopper definition FacadeEmbed_JinQiao_PodiumNew.gh (Grasshopper 1.0.7)
# plug-ins: EleFront, TT Toolbox, Pufferfish, Hare, treesloth01

# ----
# 线段延长长度
number_slider = Slider(1001, range=0..10000)  # disabled

# ----
# remove duplicate curves
geo = Geometry()  # disabled
number_slider_2 = Slider(0.1, range=0..0.1)  # disabled
boundary = BoundarySurfaces(Edges=geo)  # disabled
area = Area(Geometry=boundary)  # -> Area, Centroid; disabled
cullduppoints = RemoveDuplicatePoints(InputPoints=area.Centroid, Tolerance=number_slider_2)  # -> OutputPoints, FirstPointIndexes; disabled
null = NullItem(Item=cullduppoints.FirstPointIndexes)  # -> NullFlags, InvalidFlags, Description; disabled
dispatch = Dispatch(List=boundary, DispatchPattern=null.NullFlags)  # -> ListA, ListB; disabled
geo_2 = Geometry(dispatch.ListA)  # disabled

# ----
# 调换阴阳角设定
toggle = BooleanToggle(False)  # disabled

crv = Curve(<curve referenced from the Rhino model>)

# ----
# 导入下层建筑线
# 格式：Line-0-建筑
panel = Panel("Line-0-建筑-Whole")
reflay = ReferenceByLayer(LayerName=panel)

# ----
# 导入上层建筑线+檐口线
# 格式：Line-1-
panel_2 = Panel("Line-1-檐口")
# （3）导入单体建筑的参考线
# 按照图层导入建筑、檐口线、特殊区域线
# 
# Step1:将不同类型的curve按照以下图层分类放入Rhino中
# Step2:依次点击每个Update按钮
panel_3 = Panel("Line-1-建筑-Whole")
reflay_2 = ReferenceByLayer(LayerName=panel_3)
reflay_3 = ReferenceByLayer(LayerName=panel_2)

# ----
# 导入檐口出特殊区域参考线
# 格式：Line-1-
panel_4 = Panel("Line-1-檐口-车道等灰空间区域")
reflay_4 = ReferenceByLayer(LayerName=panel_4)
reflay_5 = ReferenceByLayer(LayerName="Line-1-檐口-吊顶处理区域")

# ----
# 5特殊区域线
# 上层建筑边线,
# 默认建筑提供上翻
# 如主结构提供示意则使用结构定位【该项目无】
# 如无则使用建筑边线向内50mm作为埋件定位
# （4）导入结构线+生成对应的钢板焊埋件
# 操作步骤如下
# 
# Step1:依次根据结构编号在Rhino中按照图层分类结构线
# Step2:按照结构编号依次建立 梁中线+Offset值+埋件单体组合包
# Step3:导入对应结构编号图层中的梁线Curve
# Step4:埋件编号Tag命名
# Step5:依次将每个组合包中的Curve,Offset值和Embed连接到右侧的3个Entwine组件上
crv_2 = Curve(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)

# ----
# Step1.输入block names
# Step2:点击Update按钮
data = Data(["PX-GLAZ-F2$0$PX-GLAZ-F2$0$fin", "PX-GLAZ-F2$0$PX-GLAZ-F1$0$fin"])
panel_5 = Panel(data)
# （1）导入埋件定位点
panel_6 = Panel("")
refblock = ReferenceBlockByName(BlockName=panel_5)

# ----
# Input Curves
# 
# Step1：选中其中一个curve,得到该图层所有curves
# Step2：点击Update按钮
crv_3 = Curve(<curve referenced from the Rhino model>)

# ----
# 埋件编号tag的Offset
number_slider_3 = Slider(190, range=0..1000)

# ----
# Embed Layer Color
swatch = ColourSwatch(SwatchColor=RGB(255, 132, 79))

# ----
# 钢结构截面列表
txt = Text(["GL2A-1\tHN 250x125x6x9\t\tQ235B\t热轧", "GL3-1\tHN 300x150x6.5x9\t\tQ235B\t热轧", "GL3-2\tH 300x100x8x10\t\tQ235B\t焊接H型", "GL3-3\tH 300x200x8x16\t\tQ355B\t焊接H型", "GL3-4\tHW 300x300x10x15\t\tQ355B\t热轧", "GL4-1\tHN 400x200x8x13\t\tQ355B\t热轧", "GL4-2\tH 400x200x10x16\t\tQ355B\t焊接H型", "GL4-3\tH 400x250x10x20\t\tQ355B\t焊接H型", "GL4-4\tH 400x350x16x35\t\tQ355B\t焊接H型", "GL4a-1\tH 450x200x9x14\t\tQ355B\t热轧", "GL5-1\tHN 500x200x10x16\t\tQ355B\t热轧", "GL5-2\tH 500x200x10x20\t\tQ355B\t焊接H型", "GL5-3\tH 500x300x14x20\t\tQ355B\t焊接H型", "GL5a-1\tH 550x250x10x25\t\tQ355B\t焊接H型", "GL5a-2\tH 550x300x14x25\t\tQ355B\t焊接H型", "GL6-1\tHN 600x200x11x17\t\tQ355B\t热轧", "GL6-2\tH 600x300x12x20\t\tQ355B\t焊接H型", "GL6-3\tH 600x350x12x25\t\tQ355B\t焊接H型", "GL6-4\tH 600x350x16x35\t\tQ355B\t焊接H型", "GL7-1\tHN 700x300x13x24\t\tQ355B\t热轧", "GL7-2\tH 700x350x14x30\t\tQ355B\t焊接H型", "GL7-3\tH 700x350x14x35\t\tQ355B\t焊接H型", "GL8-1\tHN 800x300x14x26\t\tQ355B\t热轧", "GL8-2\tH 800x300x20x40\t\tQ345GJB\t焊接H型", "GL9-1\tH 900x300x20x30\t\tQ355B\t焊接H型", "GL9-2\tH 900x400x20x40\t\tQ345GJB\t焊接H型", "GL10-1\tH 1000x400x20x30\t\tQ355B\t焊接H型", "GL10-2\tH 1000x500x20x30\t\tQ355B\t焊接H型", "GL10-3\tH 1000x500x20x35\t\tQ355B\t焊接H型", "GL10-4\tH 1000x400x20x40\t\tQ345GJB\t焊接H型", "GL10-5\tH 1000x500x20x40\t\tQ345GJB\t焊接H型", "GL10-6\t□ 1000x400x20x40\t\tQ345GJB\t焊接箱型", "GL12-1\tH 1200x400x25x50\t\tQ345GJB\t焊接H型"])

# ----
# Dimension Style
# （5）导入Default Embed
panel_7 = Panel("图例2-地上$0$XD100$0")

# ----
# 埋件编号tag
panel_8 = Panel("3-3")

# ----
# 钢埋板长度（按需设定）
number_slider_4 = Slider(350, range=0..1000)

# ----
# 钢埋板厚度（按需设定）
number_slider_5 = Slider(16, range=0..100)

# ----
# (Block & Curve的形式)
# Input Blocks (Plane的Y轴向外)
# 
# Step1.输入Block所在图层
# Step2:点击Update按钮
data_2 = Data(["PX-GLAZ-F2$0$PX-GLAZ-F1$0$标准块", "PX-GLAZ-F2$0$PX-GLAZ-F2$0$标准块", "PX-GLAZ-F2$0$PX-GLAZ-F3$0$标准块"])

# ----
# 埋件编号tag的Offset
number_slider_6 = Slider(190, range=0..1000)

# ----
# Embed Layer Color
swatch_2 = ColourSwatch(SwatchColor=RGB(255, 196, 79))

# ----
# 钢结构截面列表
txt_2 = Text(["GL2A-1\tHN 250x125x6x9\t\tQ235B\t热轧", "GL3-1\tHN 300x150x6.5x9\t\tQ235B\t热轧", "GL3-2\tH 300x100x8x10\t\tQ235B\t焊接H型", "GL3-3\tH 300x200x8x16\t\tQ355B\t焊接H型", "GL3-4\tHW 300x300x10x15\t\tQ355B\t热轧", "GL4-1\tHN 400x200x8x13\t\tQ355B\t热轧", "GL4-2\tH 400x200x10x16\t\tQ355B\t焊接H型", "GL4-3\tH 400x250x10x20\t\tQ355B\t焊接H型", "GL4-4\tH 400x350x16x35\t\tQ355B\t焊接H型", "GL4a-1\tH 450x200x9x14\t\tQ355B\t热轧", "GL5-1\tHN 500x200x10x16\t\tQ355B\t热轧", "GL5-2\tH 500x200x10x20\t\tQ355B\t焊接H型", "GL5-3\tH 500x300x14x20\t\tQ355B\t焊接H型", "GL5a-1\tH 550x250x10x25\t\tQ355B\t焊接H型", "GL5a-2\tH 550x300x14x25\t\tQ355B\t焊接H型", "GL6-1\tHN 600x200x11x17\t\tQ355B\t热轧", "GL6-2\tH 600x300x12x20\t\tQ355B\t焊接H型", "GL6-3\tH 600x350x12x25\t\tQ355B\t焊接H型", "GL6-4\tH 600x350x16x35\t\tQ355B\t焊接H型", "GL7-1\tHN 700x300x13x24\t\tQ355B\t热轧", "GL7-2\tH 700x350x14x30\t\tQ355B\t焊接H型", "GL7-3\tH 700x350x14x35\t\tQ355B\t焊接H型", "GL8-1\tHN 800x300x14x26\t\tQ355B\t热轧", "GL8-2\tH 800x300x20x40\t\tQ345GJB\t焊接H型", "GL9-1\tH 900x300x20x30\t\tQ355B\t焊接H型", "GL9-2\tH 900x400x20x40\t\tQ345GJB\t焊接H型", "GL10-1\tH 1000x400x20x30\t\tQ355B\t焊接H型", "GL10-2\tH 1000x500x20x30\t\tQ355B\t焊接H型", "GL10-3\tH 1000x500x20x35\t\tQ355B\t焊接H型", "GL10-4\tH 1000x400x20x40\t\tQ345GJB\t焊接H型", "GL10-5\tH 1000x500x20x40\t\tQ345GJB\t焊接H型", "GL10-6\t□ 1000x400x20x40\t\tQ345GJB\t焊接箱型", "GL12-1\tH 1200x400x25x50\t\tQ345GJB\t焊接H型"])

# ----
# 钢埋板长度（按需设定）
number_slider_7 = Slider(350, range=0..1000)

# ----
# 钢埋板厚度（按需设定）
number_slider_8 = Slider(16, range=0..100)

# ----
# 肋板倒角距离（按需设定）
number_slider_9 = Slider(30, range=0..100)

# ----
# Dimension Style
panel_9 = Panel("图例2-地上$0$XD100$0")

# ----
# 埋件编号tag
panel_10 = Panel("2-2")

# ----
# 输入
# 
# 1.Embed的结构编号
# 2.Embed的Tag命名
# 需要出图的钢结构编号
panel_11 = Panel("GL3-3H")

# ----
# 埋件编号tag的Offset
number_slider_10 = Slider(190, range=0..1000)

# ----
# Embed Layer Color
swatch_3 = ColourSwatch(SwatchColor=RGB(136, 235, 148))

# ----
# 钢结构截面列表
txt_3 = Text(["GL2A-1\tHN 250x125x6x9\t\tQ235B\t热轧", "GL3-1\tHN 300x150x6.5x9\t\tQ235B\t热轧", "GL3-2\tH 300x100x8x10\t\tQ235B\t焊接H型", "GL3-3\tH 300x200x8x16\t\tQ355B\t焊接H型", "GL3-4\tHW 300x300x10x15\t\tQ355B\t热轧", "GL4-1\tHN 400x200x8x13\t\tQ355B\t热轧", "GL4-2\tH 400x200x10x16\t\tQ355B\t焊接H型", "GL4-3\tH 400x250x10x20\t\tQ355B\t焊接H型", "GL4-4\tH 400x350x16x35\t\tQ355B\t焊接H型", "GL4a-1\tH 450x200x9x14\t\tQ355B\t热轧", "GL5-1\tHN 500x200x10x16\t\tQ355B\t热轧", "GL5-2\tH 500x200x10x20\t\tQ355B\t焊接H型", "GL5-3\tH 500x300x14x20\t\tQ355B\t焊接H型", "GL5a-1\tH 550x250x10x25\t\tQ355B\t焊接H型", "GL5a-2\tH 550x300x14x25\t\tQ355B\t焊接H型", "GL6-1\tHN 600x200x11x17\t\tQ355B\t热轧", "GL6-2\tH 600x300x12x20\t\tQ355B\t焊接H型", "GL6-3\tH 600x350x12x25\t\tQ355B\t焊接H型", "GL6-4\tH 600x350x16x35\t\tQ355B\t焊接H型", "GL7-1\tHN 700x300x13x24\t\tQ355B\t热轧", "GL7-2\tH 700x350x14x30\t\tQ355B\t焊接H型", "GL7-3\tH 700x350x14x35\t\tQ355B\t焊接H型", "GL8-1\tHN 800x300x14x26\t\tQ355B\t热轧", "GL8-2\tH 800x300x20x40\t\tQ345GJB\t焊接H型", "GL9-1\tH 900x300x20x30\t\tQ355B\t焊接H型", "GL9-2\tH 900x400x20x40\t\tQ345GJB\t焊接H型", "GL10-1\tH 1000x400x20x30\t\tQ355B\t焊接H型", "GL10-2\tH 1000x500x20x30\t\tQ355B\t焊接H型", "GL10-3\tH 1000x500x20x35\t\tQ355B\t焊接H型", "GL10-4\tH 1000x400x20x40\t\tQ345GJB\t焊接H型", "GL10-5\tH 1000x500x20x40\t\tQ345GJB\t焊接H型", "GL10-6\t□ 1000x400x20x40\t\tQ345GJB\t焊接箱型", "GL12-1\tH 1200x400x25x50\t\tQ345GJB\t焊接H型"])

# ----
# 钢埋板长度（按需设定）
number_slider_11 = Slider(350, range=0..1000)

# ----
# 钢埋板厚度（按需设定）
number_slider_12 = Slider(16, range=0..100)

# ----
# 肋板倒角距离（按需设定）
number_slider_13 = Slider(30, range=0..100)

# ----
# Dimension Style
panel_12 = Panel("图例2-地上$0$XD100$0")

# ----
# block names
listblockd = ListBlockDocument()

# ----
# Input Blocks (Plane的Y轴向内)
# 
# Step1:输入Block所在图层
# Step2:点击Update按钮
data_3 = Data("PX-GLAZ-F2$0$T3T")

# ----
# 肋板倒角距离（按需设定）
number_slider_14 = Slider(30, range=0..100)

txt_4 = Text(["GL2A-1\tHN 250x125x6x9\t\tQ235B\t热轧", "GL3-1\tHN 300x150x6.5x9\t\tQ235B\t热轧", "GL3-2\tH 300x100x8x10\t\tQ235B\t焊接H型", "GL3-3\tH 300x200x8x16\t\tQ355B\t焊接H型", "GL3-4\tHW 300x300x10x15\t\tQ355B\t热轧", "GL4-1\tHN 400x200x8x13\t\tQ355B\t热轧", "GL4-2\tH 400x200x10x16\t\tQ355B\t焊接H型", "GL4-3\tH 400x250x10x20\t\tQ355B\t焊接H型", "GL4-4\tH 400x350x16x35\t\tQ355B\t焊接H型", "GL4a-1\tH 450x200x9x14\t\tQ355B\t热轧", "GL5-1\tHN 500x200x10x16\t\tQ355B\t热轧", "GL5-2\tH 500x200x10x20\t\tQ355B\t焊接H型", "GL5-3\tH 500x300x14x20\t\tQ355B\t焊接H型", "GL5a-1\tH 550x250x10x25\t\tQ355B\t焊接H型", "GL5a-2\tH 550x300x14x25\t\tQ355B\t焊接H型", "GL6-1\tHN 600x200x11x17\t\tQ355B\t热轧", "GL6-2\tH 600x300x12x20\t\tQ355B\t焊接H型", "GL6-3\tH 600x350x12x25\t\tQ355B\t焊接H型", "GL6-4\tH 600x350x16x35\t\tQ355B\t焊接H型", "GL7-1\tHN 700x300x13x24\t\tQ355B\t热轧", "GL7-2\tH 700x350x14x30\t\tQ355B\t焊接H型", "GL7-3\tH 700x350x14x35\t\tQ355B\t焊接H型", "GL8-1\tHN 800x300x14x26\t\tQ355B\t热轧", "GL8-2\tH 800x300x20x40\t\tQ345GJB\t焊接H型", "GL9-1\tH 900x300x20x30\t\tQ355B\t焊接H型", "GL9-2\tH 900x400x20x40\t\tQ345GJB\t焊接H型", "GL10-1\tH 1000x400x20x30\t\tQ355B\t焊接H型", "GL10-2\tH 1000x500x20x30\t\tQ355B\t焊接H型", "GL10-3\tH 1000x500x20x35\t\tQ355B\t焊接H型", "GL10-4\tH 1000x400x20x40\t\tQ345GJB\t焊接H型", "GL10-5\tH 1000x500x20x40\t\tQ345GJB\t焊接H型", "GL10-6\t□ 1000x400x20x40\t\tQ345GJB\t焊接箱型", "GL12-1\tH 1200x400x25x50\t\tQ345GJB\t焊接H型"])

# ----
# 埋件编号tag
panel_13 = Panel("4-4")

# ----
# 输入
# 
# Embed的Tag命名
# 埋件编号
panel_14 = Panel("5-5")

# ----
# 长
panel_15 = Panel("-175 To 175")

# ----
# 宽
panel_16 = Panel("-125 To 125")

# ----
# Dimension Style
panel_17 = Panel("图例2-地上$0$XD100$0")

# ----
# Dimension Style
panel_18 = Panel("图例2-地上$0$XD100$0")

# ----
# 埋件编号tag的Offset
number_slider_15 = Slider(353, range=0..1000)

# ----
# 埋件编号tag
panel_19 = Panel("6-6")

# ---- group: 混凝土
# 板埋几何INPUT
list = ValueList({"C15": 0, "C20": 1, "C25": 2, "C30": 3, "C35": 4, "C40": 5}, selected="C35")

# ---- group: 钢筋牌号
list_2 = ValueList({"HPB300": 0, "HRB400": 1}, selected="HPB300")

# ---- group: 直径
list_3 = ValueList({"10": 0, "12": 1, "16": 2, "18": 3, "20": 4, "25": 5}, selected="12")

# ---- group: 锚筋间距
s_y = Slider(22, range=14..60, expression="X*5")
s_x = Slider(22, range=14..60, expression="X*5")

# ---- group: 列
list_4 = ValueList({"2X": 0, "3X": 1, "4X": 2}, selected="3X")

# ---- group: 行
# （7）生成底埋钢埋件
list_5 = ValueList({"2Y": 0, "3Y": 1, "4Y": 2}, selected="2Y")

# ---- group: 参考线起点
number_slider_16 = Slider(0.806, range=0..1)

# ---- group: Dimension Offset Input 2
number_slider_17 = Slider(1000, range=0..1000)

# ---- group: 移除重复位置点-容差
number_slider_18 = Slider(200, range=0..1000)

# ---- group: Dimension Offset Input 1
number_slider_19 = Slider(2000, range=0..10000)

# ---- group: 标注区域-单一轴网
标准范围_符合单一轴网方向 = Curve(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)

# ---- group: 轴网XY2个方向的线
crv_4 = Curve(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)
crv_5 = Curve(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)

# ----
crv_6 = Curve(<curve referenced from the Rhino model>)
layer = ObjectLayer(Guid=crv_6)  # -> LayerIndex, LayerPathName
reflay_6 = ReferenceByLayer(LayerName="text-def")
reflay_7 = ReferenceByLayer(LayerName=layer.LayerPathName)
rhatt = GetRhinoAttributes(Geometry=reflay_7)  # -> Name, Layer, Color
split = TextSplit(Text=rhatt.Color, Separators=",")  # -> simplify(Result)
item = ListItem(List=split, Index=0, Wrap=True)  # -> flatten(Item), flatten(Item1), flatten(Item2)
pt = ConstructPoint(XCoordinate=item.Item, YCoordinate=item.Item1, ZCoordinate=item.Item2)
cullpt = CullDuplicates(Points=pt, Tolerance=0.1, CullMode=3)  # -> Points, Indices, Valence
pdecon = Deconstruct(Point=cullpt.Points)  # -> XComponent, YComponent, ZComponent
rgb = ColourRGB(Alpha=255, Red=pdecon.XComponent, Green=pdecon.YComponent, Blue=pdecon.ZComponent)
filtercolor = FilterByColor(Geometry=reflay_6, Color=rgb)  # -> simplify(Geometry)
detext = DeconstructText(TextObject=filtercolor)  # -> Text, Plane, Height, Justification
filtercolor_2 = FilterByColor(Geometry=reflay_7, Color=rgb)  # -> simplify(Geometry)
item_2 = ListItem(List=detext.Text, Index=0, Wrap=True)

# ---- group: 参考线: 符合轴网方向+囊括整个建筑
# (9)Bake Me!!
# 下层图纸-单一区域
crv_7 = Curve(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)

# ----
# (8) 撞到梁交点-Offset
number_slider_20 = Slider(450, range=0..1000)

# ----
# 梁中线+Offset值+埋件单体组合包
layer_2 = ObjectLayer(Guid=crv)  # -> LayerIndex, LayerPathName

# ---- group: 移除重复位置点-容差
number_slider_21 = Slider(200, range=0..1000)

# ---- group: 参考线起点
number_slider_22 = Slider(0.548, range=0..1)

# ---- group: Dimension Offset Input 2
number_slider_23 = Slider(1000, range=0..1000)

# ---- group: Dimension Offset Input 1
number_slider_24 = Slider(2000, range=0..10000)

# ---- group: 标注区域-单一轴网
标准范围_符合单一轴网方向_2 = Curve(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)

# ---- group: 轴网XY2个方向的线
crv_8 = Curve(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)
crv_9 = Curve(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)

# ----
layer_3 = ObjectLayer(Guid=crv_3)  # -> LayerIndex, LayerPathName
panel_20 = Panel(data_2)
panel_22 = Panel(layer_3.LayerPathName)
panel_23 = Panel(data_3)
refblock_2 = ReferenceBlockByName(BlockName=panel_20)
refblock_3 = ReferenceBlockByName(BlockName=panel_23)
reflay_8 = ReferenceByLayer(LayerName=panel_22)

# ---- group: 参考线: 符合轴网方向+囊括整个建筑
# (9)Bake Me!!
# 上层图纸-单一区域
crv_10 = Curve(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)

# ----
panel_24 = Panel(txt_3)

panel_25 = Panel(txt_4)
panel_26 = Panel(layer_2.LayerPathName)

# ----
# （0）准备阶段
# 检测各个图层Block的Plane
panel_27 = Panel(listblockd)
deblock = DeconstructBlock(Block=refblock)  # -> Name, Plane, Geometry

# ---- group: Beam-Middle
crv_11 = Curve(flatten([<curve referenced from the Rhino model> x350]))

# ---- group: Closed Outline Curve
crv_12 = Curve([<curve referenced from the Rhino model> x4])

# ----
# 生成F1层定位平面
# Step 1 : input埋件定位点+梁线+闭合的轮廓线
circle = Curve(<curve referenced from the Rhino model>)

# ----
# Step 3（Optional) :
# 调整参考轴线的位置和方向
# 然后点击Update
panel_28 = Panel("Embed-YAxis-F2")
reflay_9 = ReferenceByLayer(LayerName=panel_28)

# ---- group: Beam-Middle
crv_13 = Curve(flatten([<curve referenced from the Rhino model> x349]))

# ----
# 最终生成的定位点Plane
pln = Plane()

# ----
# 生成F2层定位平面
# Step 1 : input埋件定位点+梁线+闭合的轮廓线
circle_2 = Curve(<curve referenced from the Rhino model>)

# ---- group: Closed Outline Curve
crv_14 = Curve([<curve referenced from the Rhino model> x3])

# ----
# Step 2 :点击Bake
# 生成参考轴线在Embed-YAxis图层
bake = BakeObjects(BakeName=panel_28, Bake=False)

# ----
# Step3.检测plane是否存在+查看Plane的Y轴方向
pln_2 = Plane(deblock.Plane)

reflay_10 = ReferenceByLayer(LayerName=panel_26)
deblock_2 = DeconstructBlock(Block=refblock_3)  # -> Name, Plane, Geometry
deblock_3 = DeconstructBlock(Block=refblock_2)  # -> Name, Plane, Geometry
cluster = Cluster_3(
    structure_number=panel_26,
    tag_text="1-1",
    text_offset=Slider(190, range=0..1000),
    embed_color=ColourSwatch(SwatchColor=RGB(221, 255, 0)),
    T=txt_4,
    G=reflay_10,
    A=Slider(350, range=0..1000),
    A_2=Slider(16, range=0..100),
    B=Slider(30, range=0..100),
    dimension_style="图例2-地上$0$XD100$0")  # -> R, G_2, R_2

# ----
# Step4.如果不存在则Blake geometry
# 并在rhino里面清理线段
geo_3 = Geometry(deblock.Geometry)

# ---- group: the Dimension Reference Curve
seam = Seam(Curve=reparameterize(crv_7), Seam=number_slider_16)

# ---- group: The Start Point of the Dimension Reference Curve
eval = EvaluateCurve(Curve=reparameterize(crv_7), Parameter=number_slider_16)  # -> Point, Tangent, Angle

# ---- group: Dimension Style
panel_29 = Panel("图例2-地上$0$XD100$0")

# ---- group: The Start Point of the Dimension Reference Curve
eval_2 = EvaluateCurve(Curve=reparameterize(crv_10), Parameter=number_slider_22)  # -> Point, Tangent, Angle

# ---- group: the Dimension Reference Curve
seam_2 = Seam(Curve=reparameterize(crv_10), Seam=number_slider_22)

# ---- group: Dimension Style
panel_30 = Panel("图例2-地上$0$XD100$0")

# ----
xy = XYPlane(Origin=Point(0, 0, 0))
xy_2 = XYPlane(Origin=Point(0, 0, 0))
xy_3 = XYPlane(Origin=Point(0, 0, 0))
number_slider_25 = Slider(350, range=0..1000)
number_slider_26 = Slider(16, range=0..100)
txt_5 = Text(["GL2A-1\tHN 250x125x6x9\t\tQ235B\t热轧", "GL3-1\tHN 300x150x6.5x9\t\tQ235B\t热轧", "GL3-2\tH 300x100x8x10\t\tQ235B\t焊接H型", "GL3-3\tH 300x200x8x16\t\tQ355B\t焊接H型", "GL3-4\tHW 300x300x10x15\t\tQ355B\t热轧", "GL4-1\tHN 400x200x8x13\t\tQ355B\t热轧", "GL4-2\tH 400x200x10x16\t\tQ355B\t焊接H型", "GL4-3\tH 400x250x10x20\t\tQ355B\t焊接H型", "GL4-4\tH 400x350x16x35\t\tQ355B\t焊接H型", "GL4a-1\tH 450x200x9x14\t\tQ355B\t热轧", "GL5-1\tHN 500x200x10x16\t\tQ355B\t热轧", "GL5-2\tH 500x200x10x20\t\tQ355B\t焊接H型", "GL5-3\tH 500x300x14x20\t\tQ355B\t焊接H型", "GL5a-1\tH 550x250x10x25\t\tQ355B\t焊接H型", "GL5a-2\tH 550x300x14x25\t\tQ355B\t焊接H型", "GL6-1\tHN 600x200x11x17\t\tQ355B\t热轧", "GL6-2\tH 600x300x12x20\t\tQ355B\t焊接H型", "GL6-3\tH 600x350x12x25\t\tQ355B\t焊接H型", "GL6-4\tH 600x350x16x35\t\tQ355B\t焊接H型", "GL7-1\tHN 700x300x13x24\t\tQ355B\t热轧", "GL7-2\tH 700x350x14x30\t\tQ355B\t焊接H型", "GL7-3\tH 700x350x14x35\t\tQ355B\t焊接H型", "GL8-1\tHN 800x300x14x26\t\tQ355B\t热轧", "GL8-2\tH 800x300x20x40\t\tQ345GJB\t焊接H型", "GL9-1\tH 900x300x20x30\t\tQ355B\t焊接H型", "GL9-2\tH 900x400x20x40\t\tQ345GJB\t焊接H型", "GL10-1\tH 1000x400x20x30\t\tQ355B\t焊接H型", "GL10-2\tH 1000x500x20x30\t\tQ355B\t焊接H型", "GL10-3\tH 1000x500x20x35\t\tQ355B\t焊接H型", "GL10-4\tH 1000x400x20x40\t\tQ345GJB\t焊接H型", "GL10-5\tH 1000x500x20x40\t\tQ345GJB\t焊接H型", "GL10-6\t□ 1000x400x20x40\t\tQ345GJB\t焊接箱型", "GL12-1\tH 1200x400x25x50\t\tQ345GJB\t焊接H型"])
# 梁中线+Offset值+埋件单体组合包
crv_15 = Curve(<curve referenced from the Rhino model>)
txt_6 = Text(["GL2A-1\tHN 250x125x6x9\t\tQ235B\t热轧", "GL3-1\tHN 300x150x6.5x9\t\tQ235B\t热轧", "GL3-2\tH 300x100x8x10\t\tQ235B\t焊接H型", "GL3-3\tH 300x200x8x16\t\tQ355B\t焊接H型", "GL3-4\tHW 300x300x10x15\t\tQ355B\t热轧", "GL4-1\tHN 400x200x8x13\t\tQ355B\t热轧", "GL4-2\tH 400x200x10x16\t\tQ355B\t焊接H型", "GL4-3\tH 400x250x10x20\t\tQ355B\t焊接H型", "GL4-4\tH 400x350x16x35\t\tQ355B\t焊接H型", "GL4a-1\tH 450x200x9x14\t\tQ355B\t热轧", "GL5-1\tHN 500x200x10x16\t\tQ355B\t热轧", "GL5-2\tH 500x200x10x20\t\tQ355B\t焊接H型", "GL5-3\tH 500x300x14x20\t\tQ355B\t焊接H型", "GL5a-1\tH 550x250x10x25\t\tQ355B\t焊接H型", "GL5a-2\tH 550x300x14x25\t\tQ355B\t焊接H型", "GL6-1\tHN 600x200x11x17\t\tQ355B\t热轧", "GL6-2\tH 600x300x12x20\t\tQ355B\t焊接H型", "GL6-3\tH 600x350x12x25\t\tQ355B\t焊接H型", "GL6-4\tH 600x350x16x35\t\tQ355B\t焊接H型", "GL7-1\tHN 700x300x13x24\t\tQ355B\t热轧", "GL7-2\tH 700x350x14x30\t\tQ355B\t焊接H型", "GL7-3\tH 700x350x14x35\t\tQ355B\t焊接H型", "GL8-1\tHN 800x300x14x26\t\tQ355B\t热轧", "GL8-2\tH 800x300x20x40\t\tQ345GJB\t焊接H型", "GL9-1\tH 900x300x20x30\t\tQ355B\t焊接H型", "GL9-2\tH 900x400x20x40\t\tQ345GJB\t焊接H型", "GL10-1\tH 1000x400x20x30\t\tQ355B\t焊接H型", "GL10-2\tH 1000x500x20x30\t\tQ355B\t焊接H型", "GL10-3\tH 1000x500x20x35\t\tQ355B\t焊接H型", "GL10-4\tH 1000x400x20x40\t\tQ345GJB\t焊接H型", "GL10-5\tH 1000x500x20x40\t\tQ345GJB\t焊接H型", "GL10-6\t□ 1000x400x20x40\t\tQ345GJB\t焊接箱型", "GL12-1\tH 1200x400x25x50\t\tQ345GJB\t焊接H型"])
number_slider_27 = Slider(350, range=0..1000)
number_slider_28 = Slider(16, range=0..100)
layer_4 = ObjectLayer(Guid=crv_15)  # -> LayerIndex, LayerPathName
# 梁中线+Offset值+埋件单体组合包
crv_16 = Curve(<curve referenced from the Rhino model>)

# ---- group: 制作上层定位平面 / Smoothed Curve-Site
crv_17 = Curve(crv_14)

# ----
project = Project(Geometry=refblock_2, Plane=xy)  # -> Geometry, Transform
project_2 = Project(Geometry=refblock_3, Plane=xy_2)  # -> Geometry, Transform
project_3 = Project(Geometry=reflay_8, Plane=xy_3)  # -> Geometry, Transform

# ---- group: 制作上层定位平面 / Boundary Curve-Site
clscrv = CloseCurve(Curve=crv_14, CloseType=0, Bulge=0.5, Tolerance=0)  # -> Closed, R

# ----
# 要连接的embed
data_4 = Data(cluster.R_2)

# ----
# 要连接的梁中线Offest值
num = Number(cluster.R)

layer_5 = ObjectLayer(Guid=crv_16)  # -> LayerIndex, LayerPathName

# ---- group: 制作下层定位平面
layer_6 = ObjectLayer(Guid=circle)  # -> LayerIndex, LayerPathName
reflay_11 = ReferenceByLayer(LayerName=layer_6.LayerPathName)
movetoplane = MoveToPlane(Geometry=reflay_11, Plane=PlaneXY(0, 0, 0), Above=True, Below=True)  # -> Geometry, Transform
movetoplane_2 = MoveToPlane(Geometry=crv_11, Plane=PlaneXY(0, 0, 0), Above=True, Below=True)  # -> Geometry, Transform
area_2 = Area(Geometry=movetoplane.Geometry)  # -> Area, Centroid
pull = PullPoint(Point=area_2.Centroid, Geometry=movetoplane_2.Geometry, ClosestOnly=True)  # -> ClosestPoint, Distance
larger = LargerThan(FirstNumber=pull.Distance, SecondNumber="800")  # -> LargerThan, OrEqualTo
dispatch_2 = Dispatch(List=area_2.Centroid, DispatchPattern=larger.LargerThan)  # -> ListA, ListB

# ----
# 要连接的梁中线curve
crv_18 = Curve(cluster.G_2)

# ---- group: 制作下层定位平面 / Smoothed Curve-Site
crv_19 = Curve(crv_12)

# ---- group: 制作下层定位平面 / Boundary Curve-Site
clscrv_2 = CloseCurve(Curve=crv_12, CloseType=0, Bulge=0.5, Tolerance=0)  # -> Closed, R

# ----
panel_31 = Panel(txt_5)
panel_32 = Panel(layer_4.LayerPathName)
panel_33 = Panel(txt_6)

cluster_2 = Cluster_3(
    structure_number=panel_11,
    tag_text=panel_13,
    text_offset=number_slider_10,
    embed_color=swatch_3,
    T=txt_3,
    A=number_slider_11,
    A_2=number_slider_12,
    B=number_slider_13,
    dimension_style=panel_12)  # -> R, G_2, R_2
data_5 = Data(flatten(cluster_2.R_2))
item_3 = ListItem(List=data_5, Index=0, Wrap=True)  # -> Item, Item1
merge = Merge(Data1=item_3.Item, Data2=item_3.Item1)

panel_34 = Panel(layer_5.LayerPathName)

# ---- group: 制作上层定位平面
disc = Discontinuity(Curve=graft(crv_17), Level=1)  # -> Points, Parameters
crv_cp = CurveClosestPoint(Point=disc.Points, Curve=graft(crv_17))  # -> Point, Parameter, Distance
eval_3 = EvaluateCurve(Curve=graft(crv_17), Parameter=crv_cp.Parameter)  # -> flatten(Point), Tangent, flatten(Angle)
deg = Degrees(Radians=eval_3.Angle)
offset = OffsetCurve(Curve=clscrv.Closed, Distance=expr("-X", Slider(300, range=0..1000)), Corners=1)
larger_2 = LargerThan(FirstNumber=deg, SecondNumber=Slider(70, range=0..100))  # -> LargerThan, OrEqualTo
disc_2 = Discontinuity(Curve=offset, Level=1)  # -> flatten(Points), Parameters
dispatch_3 = Dispatch(List=deg, DispatchPattern=larger_2.LargerThan)  # -> ListA, ListB
dispatch_4 = Dispatch(List=eval_3.Point, DispatchPattern=larger_2.LargerThan)  # -> ListA, ListB
data_6 = Data(dispatch_4.ListA)
smaller = SmallerThan(FirstNumber=dispatch_3.ListA, SecondNumber=Slider(100, range=0..100))  # -> SmallerThan, OrEqualTo
dispatch_5 = Dispatch(List=data_6, DispatchPattern=smaller.SmallerThan)  # -> ListA, ListB
data_7 = Data(dispatch_5.ListA)
pull_2 = PullPoint(Point=data_7, Geometry=flatten(offset), ClosestOnly=True)  # -> ClosestPoint, Distance
testpoint = TestPoint(archPoint=pull_2.ClosestPoint, crvPoint=disc_2.Points)  # -> out, specialPt; inputs archPoint: list of Point3d, crvPoint: list of Point3d
# ---------- testpoint: C# ----------
    List<int> passIndex = new List<int>();

    for(int i = 0; i < archPoint.Count; i++){
      foreach(Point3d t in crvPoint){
        if(archPoint[i].X == t.X && archPoint[i].Y == t.Y && archPoint[i].Z == t.Z){
          Print("pass");
          passIndex.Add(i);}
      }
    }

    specialPt = passIndex;
# ---------- end testpoint ----------

# ----
xy_4 = XYPlane(Origin=Point(0, 0, 0))
xy_5 = XYPlane(Origin=Point(0, 0, 0))
xy_6 = XYPlane(Origin=Point(0, 0, 0))
xy_7 = XYPlane(Origin=Point(0, 0, 0))
xy_8 = XYPlane(Origin=Point(0, 0, 0))

# ---- group: 制作下层定位平面
disc_3 = Discontinuity(Curve=graft(crv_19), Level=1)  # -> Points, Parameters
crv_cp_2 = CurveClosestPoint(Point=disc_3.Points, Curve=graft(crv_19))  # -> Point, Parameter, Distance
eval_4 = EvaluateCurve(Curve=graft(crv_19), Parameter=crv_cp_2.Parameter)  # -> flatten(Point), Tangent, flatten(Angle)
deg_2 = Degrees(Radians=eval_4.Angle)
offset_2 = OffsetCurve(Curve=clscrv_2.Closed, Distance=expr("-X", Slider(300, range=0..1000)), Corners=1)
larger_3 = LargerThan(FirstNumber=deg_2, SecondNumber=Slider(70, range=0..100))  # -> LargerThan, OrEqualTo
disc_4 = Discontinuity(Curve=offset_2, Level=1)  # -> flatten(Points), Parameters
dispatch_6 = Dispatch(List=deg_2, DispatchPattern=larger_3.LargerThan)  # -> ListA, ListB
dispatch_7 = Dispatch(List=eval_4.Point, DispatchPattern=larger_3.LargerThan)  # -> ListA, ListB
data_8 = Data(dispatch_7.ListA)
smaller_2 = SmallerThan(FirstNumber=dispatch_6.ListA, SecondNumber=Slider(100, range=0..100))  # -> SmallerThan, OrEqualTo
dispatch_8 = Dispatch(List=data_8, DispatchPattern=smaller_2.SmallerThan)  # -> ListA, ListB
# 要连接的梁中线Offest值
# 要连接的梁中线curve
# 要连接的embed
data_9 = Data(dispatch_8.ListA)
pull_3 = PullPoint(Point=data_9, Geometry=flatten(offset_2), ClosestOnly=True)  # -> ClosestPoint, Distance
testpoint_2 = TestPoint(archPoint=pull_3.ClosestPoint, crvPoint=disc_4.Points)  # -> out, specialPt; inputs archPoint: list of Point3d, crvPoint: list of Point3d; same code as testpoint

# ----
project_4 = Project(Geometry=reflay_2, Plane=xy_4)  # -> Geometry, Transform
project_5 = Project(Geometry=reflay_3, Plane=xy_5)  # -> Geometry, Transform
project_6 = Project(Geometry=reflay_5, Plane=xy_6)  # -> Geometry, Transform
project_7 = Project(Geometry=reflay_4, Plane=xy_7)  # -> Geometry, Transform
project_8 = Project(Geometry=reflay, Plane=xy_8)  # -> Geometry, Transform
reflay_12 = ReferenceByLayer(LayerName=panel_32)
reflay_13 = ReferenceByLayer(LayerName=panel_34)

# ----
# 列表文字以空格进行分割
panel_35 = Panel(" ")
split_2 = TextSplit(Text=txt_5, Separators=panel_35)

钢埋板长度_2 = Division(A=number_slider_25, B=2)
neg = Negative(Value=钢埋板长度_2)
dom = ConstructDomain(DomainStart=neg, DomainEnd=钢埋板长度_2)
panel_36 = Panel(dom)

钢埋板厚度_2 = Division(A=number_slider_26, B=2)
neg_2 = Negative(Value=钢埋板厚度_2)
dom_2 = ConstructDomain(DomainStart=neg_2, DomainEnd=钢埋板厚度_2)
panel_37 = Panel(dom_2)

# ----
# 钢埋板肋板位置 1/4处
panel_38 = Panel("4")
division = Division(A=number_slider_25, B=panel_38)

# ----
# 列表文字以空格进行分割
panel_39 = Panel(" ")
split_3 = TextSplit(Text=txt_6, Separators=panel_39)

# ----
# 编号和截面尺寸分区
panel_40 = Panel("1")
split_4 = SplitList(List=split_2, Index=panel_40)  # -> flatten(ListA), flatten(ListB)

钢埋板长度_2_2 = Division(A=number_slider_27, B=2)
neg_3 = Negative(Value=钢埋板长度_2_2)
dom_3 = ConstructDomain(DomainStart=neg_3, DomainEnd=钢埋板长度_2_2)
panel_41 = Panel(dom_3)

钢埋板厚度_2_2 = Division(A=number_slider_28, B=2)
neg_4 = Negative(Value=钢埋板厚度_2_2)
dom_4 = ConstructDomain(DomainStart=neg_4, DomainEnd=钢埋板厚度_2_2)
panel_42 = Panel(dom_4)

# ----
# 钢埋板肋板位置 1/4处
panel_43 = Panel("4")
division_2 = Division(A=number_slider_27, B=panel_43)

# ----
# 编号和截面尺寸分区
panel_44 = Panel("1")
split_5 = SplitList(List=split_3, Index=panel_44)  # -> flatten(ListA), flatten(ListB)

# ----
# 求出对应输入编号的钢结构截面尺寸
fsim = FindSimilarMember(Data=panel_32, Set=split_4.ListA)  # -> Hit, Index
item_4 = ListItem(List=split_4.ListB, Index=fsim.Index, Wrap=True)

flatten = FlattenTree(Tree=item_2, Path="{0}")
addition = Addition(A=neg_2, B=division)
addition_2 = Addition(A=钢埋板厚度_2, B=division)

# ----
# 求出对应输入编号的钢结构截面尺寸
fsim_2 = FindSimilarMember(Data=flatten, Set=split_5.ListA)  # -> Hit, Index
item_5 = ListItem(List=split_5.ListB, Index=fsim_2.Index, Wrap=True)

dom_5 = ConstructDomain(DomainStart=addition, DomainEnd=addition_2)
addition_3 = Addition(A=neg_4, B=division_2)
addition_4 = Addition(A=钢埋板厚度_2_2, B=division_2)
panel_45 = Panel(split_4.ListB)
dom_6 = ConstructDomain(DomainStart=addition_3, DomainEnd=addition_4)
panel_46 = Panel(split_5.ListB)
split_6 = TextSplit(Text=item_4, Separators="x")
split_7 = TextSplit(Text=split_6, Separators="Q")
split_8 = TextSplit(Text=item_5, Separators="x")
split_9 = TextSplit(Text=split_8, Separators="Q")
item_6 = ListItem(List=split_7, Index="0", Wrap=True)  # -> flatten(Item)
item_7 = ListItem(List=split_9, Index="0", Wrap=True)
shift = ShiftPaths(Data=item_7, Offset=-1)
subtraction = Subtraction(A=division, B=钢埋板厚度_2)
subtraction_2 = Subtraction(A=division, B=钢埋板厚度_2)
subtraction_3 = Subtraction(A=division, B=钢埋板厚度_2)
neg_5 = Negative(Value=钢埋板厚度_2)
neg_6 = Negative(Value=钢埋板厚度_2)
neg_7 = Negative(Value=钢埋板厚度_2)
subtraction_4 = Subtraction(A=division, B=钢埋板厚度_2)
addition_5 = Addition(A=subtraction, B=number_slider_26)
addition_6 = Addition(A=subtraction_2, B=number_slider_26)
subtraction_5 = Subtraction(A=neg_5, B=number_slider_26)
subtraction_6 = Subtraction(A=neg_6, B="2")
subtraction_7 = Subtraction(A=division, B=钢埋板厚度_2)
addition_7 = Addition(A=subtraction_3, B="2")
subtraction_8 = Subtraction(A=neg_7, B="2")
neg_8 = Negative(Value=钢埋板厚度_2)
neg_9 = Negative(Value=钢埋板厚度_2)
工字钢_h = ListItem(List=item_6, Index=0, Wrap=True)
工字钢_b = ListItem(List=item_6, Index=1, Wrap=True)
工字钢_tf = ListItem(List=item_6, Index=3, Wrap=True)
subtraction_9 = Subtraction(A=division_2, B=钢埋板厚度_2_2)
subtraction_10 = Subtraction(A=division_2, B=钢埋板厚度_2_2)
subtraction_11 = Subtraction(A=division_2, B=钢埋板厚度_2_2)
工字钢_tw = ListItem(List=item_6, Index=2, Wrap=True)
neg_10 = Negative(Value=钢埋板厚度_2_2)
neg_11 = Negative(Value=钢埋板厚度_2_2)
neg_12 = Negative(Value=钢埋板厚度_2_2)
subtraction_12 = Subtraction(A=division_2, B=钢埋板厚度_2_2)
addition_8 = Addition(A=subtraction_9, B=number_slider_28)
addition_9 = Addition(A=subtraction_10, B=number_slider_28)
subtraction_13 = Subtraction(A=neg_10, B=number_slider_28)
subtraction_14 = Subtraction(A=neg_11, B="2")
subtraction_15 = Subtraction(A=division_2, B=钢埋板厚度_2_2)
addition_10 = Addition(A=subtraction_11, B="2")
subtraction_16 = Subtraction(A=neg_12, B="2")
neg_13 = Negative(Value=钢埋板厚度_2_2)
neg_14 = Negative(Value=钢埋板厚度_2_2)
pt_2 = ConstructPoint(XCoordinate=neg_8, YCoordinate=subtraction_4, ZCoordinate=0)
pt_3 = ConstructPoint(XCoordinate=neg_9, YCoordinate=addition_5, ZCoordinate=0)
pt_4 = ConstructPoint(XCoordinate=subtraction_5, YCoordinate=addition_6, ZCoordinate=0)
pt_5 = ConstructPoint(XCoordinate=subtraction_6, YCoordinate=subtraction_7, ZCoordinate=0)
pt_6 = ConstructPoint(XCoordinate=subtraction_8, YCoordinate=addition_7, ZCoordinate=0)
工字钢_h_2 = ListItem(List=shift, Index=0, Wrap=True)
工字钢_b_2 = ListItem(List=shift, Index=1, Wrap=True)
工字钢_tf_2 = ListItem(List=shift, Index=3, Wrap=True)
工字钢_tw_2 = ListItem(List=shift, Index=2, Wrap=True)
subtraction_17 = Subtraction(A=工字钢_b, B=工字钢_tw)
pt_7 = ConstructPoint(XCoordinate=neg_13, YCoordinate=subtraction_12, ZCoordinate=0)
pt_8 = ConstructPoint(XCoordinate=neg_14, YCoordinate=addition_8, ZCoordinate=0)
pt_9 = ConstructPoint(XCoordinate=subtraction_13, YCoordinate=addition_9, ZCoordinate=0)
pt_10 = ConstructPoint(XCoordinate=subtraction_14, YCoordinate=subtraction_15, ZCoordinate=0)
pt_11 = ConstructPoint(XCoordinate=subtraction_16, YCoordinate=addition_10, ZCoordinate=0)
division_3 = Division(A=subtraction_17, B="2")
merge_2 = Merge(Data1=pt_2, Data2=pt_3, Data3=pt_4, Data4=pt_6, Data5=pt_5)
subtraction_18 = Subtraction(A=工字钢_b_2, B=工字钢_tw_2)
division_4 = Division(A=subtraction_18, B="2")
pline = PolyLine(Vertices=merge_2, Closed=True)
merge_3 = Merge(Data1=pt_7, Data2=pt_8, Data3=pt_9, Data4=pt_11, Data5=pt_10)
pline_2 = PolyLine(Vertices=merge_3, Closed=True)
division_5 = Division(A=division_3, B="2")
subtraction_19 = Subtraction(A=division_5, B=number_slider_26)
subtraction_20 = Subtraction(A=division_5, B=钢埋板厚度_2)
neg_15 = Negative(Value=division_5)
division_6 = Division(A=division_4, B="2")
subtraction_21 = Subtraction(A=neg_15, B=subtraction_20)
subtraction_22 = Subtraction(A=division_6, B=number_slider_28)
subtraction_23 = Subtraction(A=division_6, B=钢埋板厚度_2_2)
neg_16 = Negative(Value=division_6)
addition_11 = Addition(A=subtraction_21, B=Slider(30, range=0..100))
subtraction_24 = Subtraction(A=neg_16, B=subtraction_23)
dom_7 = ConstructDomain(DomainStart=addition_11, DomainEnd=subtraction_21)
dom_8 = ConstructDomain(DomainStart=addition, DomainEnd=addition_2)
addition_12 = Addition(A=subtraction_24, B=Slider(30, range=0..100))
subtraction_25 = Subtraction(A=subtraction_19, B=subtraction_20)
subtraction_26 = Subtraction(A=neg_15, B=subtraction_20)
dom_9 = ConstructDomain(DomainStart=addition_12, DomainEnd=subtraction_24)
dom_10 = ConstructDomain(DomainStart=addition_3, DomainEnd=addition_4)
钢肋板倒角_侧视图 = Rectangle(Plane=PlaneXY(0, 0, 0), XSize=dom_7, YSize=dom_8, Radius=0)  # -> Rectangle, Length
dom_11 = ConstructDomain(DomainStart=subtraction_25, DomainEnd=subtraction_26)
subtraction_27 = Subtraction(A=subtraction_22, B=subtraction_23)
subtraction_28 = Subtraction(A=neg_16, B=subtraction_23)
钢肋板倒角_侧视图_2 = Rectangle(Plane=PlaneXY(0, 0, 0), XSize=dom_9, YSize=dom_10, Radius=0)  # -> Rectangle, Length
dom_12 = ConstructDomain(DomainStart=subtraction_27, DomainEnd=subtraction_28)
钢肋板_侧视图 = Rectangle(Plane=PlaneXY(0, 0, 0), XSize=dom_11, YSize=dom_5, Radius=0)  # -> Rectangle, Length
钢肋板_侧视图_2 = Rectangle(Plane=PlaneXY(0, 0, 0), XSize=dom_12, YSize=dom_6, Radius=0)  # -> Rectangle, Length
tstat = TreeStatistics(Tree=工字钢_h_2)  # -> Paths, Length, Count
repeat = RepeatData(Data=pline_2, Length=tstat.Length)  # -> simplify(Data)
merge_4 = Merge(Data1=钢肋板_侧视图.Rectangle, Data2=pline, Data3=钢肋板倒角_侧视图.Rectangle)
xz = XZPlane(Origin=Point(0, 0, 0))
merge_5 = Merge(Data1=simplify(钢肋板_侧视图_2.Rectangle), Data2=simplify(repeat), Data3=simplify(钢肋板倒角_侧视图_2.Rectangle))
xz_2 = XZPlane(Origin=Point(0, 0, 0))
mirror = Mirror(Geometry=merge_4, Plane=xz)  # -> Geometry, Transform
钢埋板_侧视图 = Rectangle(Plane=PlaneXY(0, 0, 0), XSize=dom_2, YSize=dom, Radius=0)  # -> Rectangle, Length
mirror_2 = Mirror(Geometry=merge_5, Plane=xz_2)  # -> Geometry, Transform
钢埋板_侧视图_2 = Rectangle(Plane=PlaneXY(0, 0, 0), XSize=dom_4, YSize=dom_3, Radius=0)  # -> Rectangle, Length
division_7 = Division(A=工字钢_b, B=2)
repeat_2 = RepeatData(Data=钢埋板_侧视图_2.Rectangle, Length=tstat.Length)  # -> simplify(Data)
侧视图 = Entwine(Branch00=钢埋板_侧视图.Rectangle, Branch01=merge_4, Branch02=mirror.Geometry, FlattenInputs=True)
division_8 = Division(A=工字钢_b_2, B=2)
division_9 = Division(A=工字钢_h, B="2")
merge_6 = Merge(Data1=repeat_2, Data2=merge_5, Data3=mirror_2.Geometry)
division_10 = Division(A=工字钢_h_2, B="2")
subtraction_29 = Subtraction(A=division_9, B=工字钢_tf)
addition_13 = Addition(A=subtraction_29, B=Slider(200, range=0..1000))
addition_14 = Addition(A=addition_13, B=division_3)
X = UnitX(Factor=addition_14)
move = Move(Geometry=侧视图, Motion=X)  # -> Geometry, Transform
flip = FlipMatrix(Data=merge_6)
split_tree = SplitTree(Data=move.Geometry, Masks=flatten("{0;0}"))  # -> Positive, Negative
subtraction_30 = Subtraction(A=division_10, B=工字钢_tf_2)
addition_15 = Addition(A=subtraction_30, B=Slider(200, range=0..1000))
addition_16 = Addition(A=addition_15, B=division_4)
X_2 = UnitX(Factor=addition_16)
move_2 = Move(Geometry=merge_6, Motion=X_2)  # -> Geometry, Transform
split_tree_2 = SplitTree(Data=move_2.Geometry, Masks=flatten("{0;0}"))  # -> Positive, Negative
dispatch_9 = Dispatch(List=split_tree.Negative, DispatchPattern=[True, False])  # -> flatten(ListA), ListB
item_8 = ListItem(List=flip, Index="-1", Wrap=True)
item_9 = ListItem(List=flip, Index=0, Wrap=True)
dispatch_10 = Dispatch(List=split_tree_2.Negative, DispatchPattern=[True, False])  # -> flatten(ListA), ListB
merge_7 = Merge(Data1=split_tree.Positive, Data2=dispatch_9.ListA)
merge_8 = Merge(Data1=split_tree_2.Positive, Data2=dispatch_10.ListA)
entwine = Entwine(Branch00=merge_7, Branch01=dispatch_9.ListB, FlattenInputs=True)
entwine_2 = Entwine(Branch00=merge_8, Branch01=dispatch_10.ListB, FlattenInputs=True)
flatten_2 = FlattenTree(Tree=entwine, Path="{0}")
group = Group(Objects=flatten_2)
flatten_3 = FlattenTree(Tree=entwine_2, Path="{0}")
rotate = Rotate(Geometry=group, Angle=3.141592654, Plane=PlaneXY(0, 0, 0))  # -> Geometry, Transform
group_2 = Group(Objects=flatten_3)
rotate_2 = Rotate(Geometry=group_2, Angle=3.141592654, Plane=PlaneXY(0, 0, 0))  # -> Geometry, Transform
boxprop = BoxProperties(Box=rotate.Geometry)  # -> Center, Diagonal, Area, Volume, Degeneracy
bbox = BoundingBox(Content=rotate.Geometry, Plane=PlaneXY(0, 0, 0))  # -> Box, Box_2
debox = DeconstructBox(Box=bbox.Box)  # -> Plane, X, Y, Z
pdecon_2 = Deconstruct(Point=boxprop.Center)  # -> XComponent, YComponent, ZComponent
boxprop_2 = BoxProperties(Box=rotate_2.Geometry)  # -> Center, Diagonal, Area, Volume, Degeneracy
bbox_2 = BoundingBox(Content=rotate_2.Geometry, Plane=PlaneXY(0, 0, 0))  # -> Box, Box_2
dedomain = DeconstructDomain(Domain=debox.Y)  # -> Start, End
debox_2 = DeconstructBox(Box=bbox_2.Box)  # -> Plane, X, Y, Z
pdecon_3 = Deconstruct(Point=boxprop_2.Center)  # -> XComponent, YComponent, ZComponent
pt_12 = ConstructPoint(XCoordinate=pdecon_2.XComponent, YCoordinate=dedomain.Start, ZCoordinate=pdecon_2.ZComponent)
xy_9 = XYPlane(Origin=Point(0, 0, 0))
dedomain_2 = DeconstructDomain(Domain=debox_2.Y)  # -> Start, End
concat = Concatenate(FragmentA="Embed", FragmentB="1-1")
pl_origin = PlaneOrigin(Base=xy_9, Origin=pt_12)
pt_13 = ConstructPoint(XCoordinate=pdecon_3.XComponent, YCoordinate=dedomain_2.Start, ZCoordinate=pdecon_3.ZComponent)
xy_10 = XYPlane(Origin=Point(0, 0, 0))
concat_2 = Concatenate(FragmentA="Embed", FragmentB="1-1")
pl_origin_2 = PlaneOrigin(Base=xy_10, Origin=pt_13)
orient = Orient(Geometry=rotate.Geometry, Source=pl_origin, Target=xy_9)  # -> Geometry, Transform
xy_11 = XYPlane(Origin=Point(0, 0, 0))
attributes = DefineObjectAttributes(Color=ColourSwatch(SwatchColor=RGB(221, 255, 0)))
ungroup = Ungroup(Group=orient.Geometry)
orient_2 = Orient(Geometry=rotate_2.Geometry, Source=pl_origin_2, Target=xy_10)  # -> Geometry, Transform
xy_12 = XYPlane(Origin=Point(0, 0, 0))
attributes_2 = DefineObjectAttributes(Color=ColourSwatch(SwatchColor=RGB(221, 255, 0)))
ungroup_2 = Ungroup(Group=orient_2.Geometry)
block = DefineBlock(Geometry=ungroup, Attributes=attributes, BlockName=concat, BasePlane=PlaneXY(0, 0, 0))
block_2 = DefineBlock(Geometry=ungroup_2, Attributes=attributes_2, BlockName=concat_2, BasePlane=PlaneXY(0, 0, 0))
deblock_4 = DeconstructBlock(Block=block)  # -> Name, flatten(Plane), flatten(Geometry)
deblock_5 = DeconstructBlock(Block=block_2)  # -> Name, flatten(Plane), flatten(Geometry)
group_3 = Group(Objects=deblock_4.Geometry)
group_4 = Group(Objects=deblock_5.Geometry)
bbox_3 = BoundingBox(Content=group_3, Plane=PlaneXY(0, 0, 0))  # -> Box, Box_2
deplane = DeconstructPlane(Plane=deblock_4.Plane)  # -> Origin, XAxis, YAxis, ZAxis
area_3 = Area(Geometry=bbox_3.Box)  # -> Area, Centroid
bbox_4 = BoundingBox(Content=group_4, Plane=PlaneXY(0, 0, 0))  # -> Box, Box_2

# ----
# 要连接的梁中线Offest值
num_2 = Number(division_8)

deplane_2 = DeconstructPlane(Plane=deblock_5.Plane)  # -> Origin, XAxis, YAxis, ZAxis
move2pt = MoveToPoint(Geometry=flatten(deplane.Origin), PointA=flatten(deplane.Origin), PointB=flatten(area_3.Centroid))  # -> Moved, Vector, Transform
area_4 = Area(Geometry=bbox_4.Box)  # -> Area, Centroid
move2pt_2 = MoveToPoint(Geometry=flatten(deplane_2.Origin), PointA=flatten(deplane_2.Origin), PointB=flatten(area_4.Centroid))  # -> Moved, Vector, Transform
pl = ConstructPlane(Origin=move2pt.Moved, XAxis=deplane.YAxis, YAxis=deplane.XAxis)  # -> graft(Plane)
pl_2 = ConstructPlane(Origin=move2pt_2.Moved, XAxis=deplane_2.YAxis, YAxis=deplane_2.XAxis)  # -> graft(Plane)
deplane_3 = DeconstructPlane(Plane=pl)  # -> Origin, XAxis, YAxis, ZAxis
rotate_3 = Rotate(Geometry=pl, Angle="Pi", Plane=pl)  # -> Geometry, Transform
deplane_4 = DeconstructPlane(Plane=pl_2)  # -> Origin, XAxis, YAxis, ZAxis
dedomain_3 = DeconstructDomain(Domain=dom)  # -> Start, End
rotate_4 = Rotate(Geometry=pl_2, Angle="Pi", Plane=pl_2)  # -> Geometry, Transform
multiplication = Multiplication(A=dedomain_3.Start, B=dedomain_3.Start)
dedomain_4 = DeconstructDomain(Domain=dom_3)  # -> Start, End
amp = Amplitude(Vector=deplane_3.YAxis, Amplitude=multiplication)
multiplication_2 = Multiplication(A=dedomain_4.Start, B=dedomain_4.Start)
amp_2 = Amplitude(Vector=deplane_4.YAxis, Amplitude=multiplication_2)
move_3 = Move(Geometry=deplane_3.Origin, Motion=amp)  # -> Geometry, Transform
srf = Surface(bbox_3.Box)
crv_20 = Curve(srf)
ln = Line(StartPoint=move_3.Geometry, EndPoint=deplane_3.Origin)
move_4 = Move(Geometry=deplane_4.Origin, Motion=amp_2)  # -> Geometry, Transform
srf_2 = Surface(bbox_4.Box)
crv_21 = Curve(srf_2)
ln_2 = Line(StartPoint=move_4.Geometry, EndPoint=deplane_4.Origin)
ccx = CurveCurve(CurveA=ln, CurveB=crv_20)  # -> Points, ParamsA, ParamsB
ccx_2 = CurveCurve(CurveA=ln_2, CurveB=crv_21)  # -> Points, ParamsA, ParamsB
ln_3 = Line(StartPoint=deplane_3.Origin, EndPoint=ccx.Points)
move_5 = Move(Geometry=rotate_3.Geometry, Motion=ln_3)  # -> Geometry, Transform
ln_4 = Line(StartPoint=deplane_4.Origin, EndPoint=ccx_2.Points)

ln_5 = Line(StartPoint=ccx.Points, EndPoint=deplane_3.Origin)
amp_3 = Amplitude(Vector=ln_5, Amplitude=Slider(190, range=0..1000))
move_6 = Move(Geometry=rotate_3.Geometry, Motion=amp_3)  # -> Geometry, Transform
text = DefineTextObject(Text="1-1", Plane=move_6.Geometry, DimensionStyle="图例2-地上$0$XD100$0", OutputType="Text")
group_5 = Group(Objects=[block, text])

move_7 = Move(Geometry=rotate_4.Geometry, Motion=ln_4)  # -> Geometry, Transform

ln_6 = Line(StartPoint=ccx_2.Points, EndPoint=deplane_4.Origin)
amp_4 = Amplitude(Vector=ln_6, Amplitude=Slider(190, range=0..1000))
move_8 = Move(Geometry=rotate_4.Geometry, Motion=amp_4)  # -> Geometry, Transform
text_2 = DefineTextObject(Text="1-1", Plane=move_8.Geometry, DimensionStyle="图例2-地上$0$XD100$0", OutputType="Text")
group_6 = Group(Objects=[block_2, text_2])

entwine_3 = Entwine(Branch00=group_5, Branch01=move_5.Geometry, FlattenInputs=True)
project_9 = Project(Geometry=reflay_12, Plane=xy_11)  # -> Geometry, Transform
entwine_4 = Entwine(Branch00=group_6, Branch01=move_7.Geometry, FlattenInputs=True)
project_10 = Project(Geometry=reflay_13, Plane=xy_12)  # -> Geometry, Transform
data_10 = Data(entwine_3)
num_3 = Number(division_7)
crv_22 = Curve(project_9.Geometry)

# ----
# 要连接的embed
data_11 = Data(entwine_4)

# ----
# 要连接的梁中线curve
crv_23 = Curve(project_10.Geometry)

crv_24 = Curve(project_5.Geometry)
crv_25 = Curve(project_6.Geometry)
crv_26 = Curve(project_7.Geometry)
crv_27 = Curve(project_8.Geometry)
crv_28 = Curve(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)
crv_29 = Curve(project_4.Geometry)

# ---- group: 制作下层定位平面 / 与梁中线距离小于800的点
pt_14 = Point(dispatch_2.ListB)

# ---- group: 制作下层定位平面 / 定位点Offset450后二次筛选是否与梁有交点
pull_4 = PullPoint(Point=pt_14, Geometry=movetoplane_2.Geometry, ClosestOnly=True)  # -> ClosestPoint, Distance
end = EndPoints(Curve=crv_11)  # -> Start, End
merge_9 = Merge(Data1=end.Start, Data2=end.End)  # -> flatten(Result)
pull_5 = PullPoint(Point=pull_4.ClosestPoint, Geometry=merge_9, ClosestOnly=True)  # -> ClosestPoint, Distance
larger_4 = LargerThan(FirstNumber=pull_5.Distance, SecondNumber="1")  # -> LargerThan, OrEqualTo
dispatch_11 = Dispatch(List=pt_14, DispatchPattern=larger_4.LargerThan)  # -> ListA, ListB

# ---- group: 制作上层定位平面
# 阴角
cull_i = CullIndex(List=data_7, Indices=testpoint.specialPt, Wrap=True)

# 阳角
item_10 = ListItem(List=data_7, Index=testpoint.specialPt, Wrap=True)

# ---- group: 制作下层定位平面
# 阴角
cull_i_2 = CullIndex(List=data_9, Indices=testpoint_2.specialPt, Wrap=True)

# 阳角
item_11 = ListItem(List=data_9, Index=testpoint_2.specialPt, Wrap=True)

# ---- group: 制作上层定位平面
merge_10 = Merge(Data1=item_10, Data2=cull_i)  # -> flatten(Result)

# ---- group: 制作下层定位平面 / 定位点Offset450后二次筛选是否与梁有交点 / 与梁直接由交点
pt_15 = Point(dispatch_11.ListA)

# ---- group: 制作下层定位平面
merge_11 = Merge(Data1=item_11, Data2=cull_i_2)  # -> flatten(Result)

# ---- group: 制作上层定位平面
layer_7 = ObjectLayer(Guid=circle_2)  # -> LayerIndex, LayerPathName
reflay_14 = ReferenceByLayer(LayerName=layer_7.LayerPathName)
movetoplane_3 = MoveToPlane(Geometry=reflay_14, Plane=PlaneXY(0, 0, 0), Above=True, Below=True)  # -> Geometry, Transform
movetoplane_4 = MoveToPlane(Geometry=crv_13, Plane=PlaneXY(0, 0, 0), Above=True, Below=True)  # -> Geometry, Transform
area_5 = Area(Geometry=movetoplane_3.Geometry)  # -> Area, Centroid
pt_16 = Point(area_5.Centroid)

# ---- group: 制作下层定位平面 / 与梁距离大于800的点
pt_17 = Point(dispatch_2.ListA)

# ---- group: 制作下层定位平面 / 筛选阴阳角 / 阴阳角的点
pt_18 = Point(merge_11)

# ----
# 单体选型
list_6 = ValueList({"顶埋": 0, "侧埋": 1}, selected="顶埋")

# ---- group: F2 Arch Outline
crv_30 = Curve(crv_29)

# ---- group: 车道区域 / 檐口线Input
crv_31 = Curve(crv_28)

# ---- group: 檐口线Input
crv_32 = Curve(crv_28)

# ----
# 选要重塑的线段长度
number_slider_29 = Slider(1200, range=0..10000)

# ---- group: 车道区域 / 吊顶区域
crv_33 = Curve(crv_25)

# ----
# 调整重塑线段的平滑度
number_slider_30 = Slider(11, range=0..11)

# ----
# 区分内外梁边线
# 1.根据F2建筑线制作轮廓线
explode = Explode(Curve=crv_30, Recursive=True)  # -> Segments, Vertices
len = Length(Curve=explode.Segments)
sort = SortList(Keys=len)  # -> Keys, ValuesA
larger_5 = LargerThan(FirstNumber=len, SecondNumber=number_slider_29)  # -> LargerThan, OrEqualTo
panel_47 = Panel(sort.Keys)
dispatch_12 = Dispatch(List=explode.Segments, DispatchPattern=larger_5.LargerThan)  # -> ListA, ListB
data_12 = Data(dispatch_12.ListA)
data_13 = Data(dispatch_12.ListB)
join = JoinCurves(Curves=data_13, Preserve=False)
disc_5 = Discontinuity(Curve=join, Level=1)  # -> Points, Parameters
nurbs = NurbsCurve(Vertices=disc_5.Points, Degree=number_slider_30, Periodic=False)  # -> flatten(Curve), Length, Domain
join_2 = JoinCurves(Curves=flatten([data_12, nurbs.Curve]), Preserve=False)
offset_3 = OffsetCurve(Curve=join_2, Distance=Slider(6859, range=0..10000), Corners=1)

# ---- group: F2 Archline - Smoothed
reb = RebuildCurve(Curve=offset_3, Count=Slider(17, range=0..100), Tangents=invert(False))

# ----
# InputCurve
crv_34 = Curve()

# ----
# Curve-框住要分析的建筑单体
# 如果要用自己导入Curve作为分析线，
# 请在InputCurve那里导入curve,
# 然后在上方的选型列表选择Input Curve。
# 
# 如果要用Grasshopper自动生成的Curve,
# 请在上方的选型列表选择Default Curve。
list_7 = ValueList({"Default Curve": 0, "Input Curve": 1}, selected="Default Curve")
filter = StreamFilter(Gate=list_7, Stream0=reb, Stream1=crv_34)

# ----
# 埋件向外探索最远出的梁的距离
number_slider_31 = Slider(5000, range=0..10000)

# ---- group: 下层交点-除重 / 下层Arch Line
crv_35 = Curve(crv_27)

# ---- group: 下层交点-除重 / 上层 Arch Line
crv_36 = Curve(crv_29)

# ---- group: 下层交点-除重 / 容差
number_slider_32 = Slider(100, range=0..200)

# ----
# 是否有吊顶：
# 下层幕墙边线在结构边梁以内>350
# 
# （最外层结构线）
number_slider_33 = Slider(350, range=0..1000)

# ---- group: 下层Arch Line
crv_37 = Curve(crv_27)

# ----
# 3.2下层建筑边线内侧300-600mm范围内
number_slider_34 = Slider(600, range=0..1000)
crv_38 = Curve(crv_37)
offset_4 = OffsetCurve(Curve=crv_38, Distance=expr("-x", Slider(300, range=0..1000)), Corners=1)
offset_5 = OffsetCurve(Curve=crv_38, Distance=expr("-x", number_slider_34), Corners=1)

# ----
# 3.1下层建筑边线外侧50-350mm范围内
number_slider_35 = Slider(350, range=0..1000)
crv_39 = Curve(crv_37)
offset_6 = OffsetCurve(Curve=crv_39, Distance=Slider(50, range=0..100), Corners=1)
offset_7 = OffsetCurve(Curve=crv_39, Distance=number_slider_35, Corners=1)

# ----
# 4下层建筑内侧到300到外侧50内
# 有钢结构
number_slider_36 = Slider(50, range=0..1000)
crv_40 = Curve(crv_37)
offset_8 = OffsetCurve(Curve=crv_40, Distance=expr("-x", Slider(300, range=0..1000)), Corners=1)
offset_9 = OffsetCurve(Curve=crv_40, Distance=number_slider_36, Corners=1)

# ----
# （3.1）导入轴线
crv_41 = Curve(<curve referenced from the Rhino model>)
layer_8 = ObjectLayer(Guid=crv_41)  # -> LayerIndex, LayerPathName
panel_48 = Panel(layer_8.LayerPathName)
reflay_15 = ReferenceByLayer(LayerName=panel_48)
xy_13 = XYPlane(Origin=Point(0, 0, 0))
project_11 = Project(Geometry=reflay_15, Plane=xy_13)  # -> Geometry, Transform

data_14 = Data(flatten(merge))
item_12 = ListItem(List=data_14, Index=0, Wrap=True)
item_13 = ListItem(List=data_14, Index="-1", Wrap=True)

# ----
# 求内部曲线转折点
crv_42 = Curve()  # disabled
number_slider_37 = Slider(300, range=0..1000)  # disabled
neg_17 = Negative(Value=number_slider_37)  # disabled
filter_2 = StreamFilter(Gate=toggle, Stream0=number_slider_37, Stream1=neg_17)  # disabled
number_slider_38 = Slider(60, range=0..100)  # disabled

ext = ExtendCurve(Curve=crv_42, Type=0, Start=number_slider, End=number_slider)  # disabled

# ----
# 第二层
# 
# Curves(location point)+ Smooth Curves(architecture line)
# 第二层-区分阴阳角
area_6 = Area(Geometry=geo_2)  # -> Area, Centroid; disabled
crv_43 = Curve(crv_42)  # disabled
pull_6 = PullPoint(Point=area_6.Centroid, Geometry=crv_43, ClosestOnly=True)  # -> ClosestPoint, Distance; disabled
number_slider_39 = Slider(200, range=0..1000)  # disabled
number_slider_40 = Slider(100, range=0..300)  # disabled

# ----
# 第二层-阴阳角
panel_49 = Panel("0.5 * Pi")  # disabled
toggle_2 = BooleanToggle(True)  # disabled
neg_18 = Negative(Value=panel_49)  # disabled
filter_3 = StreamFilter(Gate=toggle_2, Stream0=panel_49, Stream1=neg_18)  # disabled

# ----
# 第二层-大面定位
panel_50 = Panel("0.5 * Pi")  # disabled
toggle_3 = BooleanToggle(True)  # disabled
neg_19 = Negative(Value=panel_50)  # disabled
filter_4 = StreamFilter(Gate=toggle_3, Stream0=panel_50, Stream1=neg_19)  # disabled

number_slider_41 = Slider(300, range=0..1000)  # disabled
number_slider_42 = Slider(1.5, range=0..10)  # disabled

number_slider_43 = Slider(300, range=0..1000)  # disabled
number_slider_44 = Slider(1.5, range=0..10)  # disabled

number_slider_45 = Slider(300, range=0..1000)  # disabled
number_slider_46 = Slider(1.5, range=0..10)  # disabled

# ----
# 显示"False"时要选择线段延长
list_8 = ValueList({"线段不延长": 0, "线段延长": 1}, selected="线段延长")  # disabled

filter_5 = StreamFilter(Gate=list_8, Stream0=crv_42, Stream1=ext)  # disabled

disc_6 = Discontinuity(Curve=graft(filter_5), Level=1)  # -> Points, Parameters; disabled
crv_cp_3 = CurveClosestPoint(Point=disc_6.Points, Curve=graft(filter_5))  # -> Point, Parameter, Distance; disabled
eval_5 = EvaluateCurve(Curve=graft(filter_5), Parameter=crv_cp_3.Parameter)  # -> flatten(Point), Tangent, flatten(Angle); disabled
deg_3 = Degrees(Radians=eval_5.Angle)  # disabled
offset_10 = OffsetCurve(Curve=filter_5, Distance=expr("-X", filter_2), Corners=1)  # disabled
panel_51 = Panel(deg_3)  # disabled
larger_6 = LargerThan(FirstNumber=deg_3, SecondNumber=number_slider_38)  # -> LargerThan, OrEqualTo; disabled
disc_7 = Discontinuity(Curve=offset_10, Level=1)  # -> flatten(Points), Parameters; disabled
dispatch_13 = Dispatch(List=eval_5.Point, DispatchPattern=larger_6.LargerThan)  # -> ListA, ListB; disabled
end_2 = EndPoints(Curve=filter_5)  # -> Start, End; disabled
data_15 = Data(dispatch_13.ListA)  # disabled
pull_7 = PullPoint(Point=data_15, Geometry=flatten(offset_10), ClosestOnly=True)  # -> ClosestPoint, Distance; disabled
testpoint_3 = TestPoint(archPoint=pull_7.ClosestPoint, crvPoint=disc_7.Points)  # -> out, specialPt; inputs archPoint: list of Point3d, crvPoint: list of Point3d; disabled; same code as testpoint

# ----
# 阴角
item_14 = ListItem(List=data_15, Index=testpoint_3.specialPt, Wrap=True)  # disabled

# ----
# SmoothCurve-阴角&阳角
# 阳角
cull_i_3 = CullIndex(List=data_15, Indices=testpoint_3.specialPt, Wrap=True)  # disabled

dist = Distance(PointA=pull_6.ClosestPoint, PointB=data_15)  # disabled
sort_2 = SortList(Keys=dist)  # -> Keys, ValuesA; disabled
panel_52 = Panel(sort_2.Keys)  # disabled
smaller_3 = SmallerThan(FirstNumber=dist, SecondNumber=number_slider_39)  # -> SmallerThan, OrEqualTo; disabled
dispatch_14 = Dispatch(List=geo_2, DispatchPattern=smaller_3.SmallerThan)  # -> ListA, ListB; disabled
crv_44 = Curve(filter_5)  # disabled

data_16 = Data(dispatch_14.ListA)  # disabled
explode_2 = Explode(Curve=data_16, Recursive=True)  # -> Segments, Vertices; disabled
len_2 = Length(Curve=explode_2.Segments)  # disabled
sort_3 = SortList(Keys=reverse(len_2), ValuesA=explode_2.Segments)  # -> Keys, ValuesA; disabled
item_15 = ListItem(List=sort_3.ValuesA, Index=0, Wrap=True)  # -> flatten(Item); disabled
area_7 = Area(Geometry=data_16)  # -> Area, Centroid; disabled
midpt = CurveMiddle(Curve=item_15)  # disabled
move2pt_3 = MoveToPoint(Geometry=item_15, PointA=midpt, PointB=area_7.Centroid)  # -> Moved, Vector, Transform; disabled
end_3 = EndPoints(Curve=move2pt_3.Moved)  # -> Start, End; disabled
ln_7 = Line(StartPoint=end_3.Start, EndPoint=end_3.End)  # disabled
xy_14 = XYPlane(Origin=end_3.End)  # disabled
rotate_5 = Rotate(Geometry=ln_7, Angle=filter_3, Plane=xy_14)  # -> Geometry, Transform; disabled
pl_3 = ConstructPlane(Origin=end_3.End, XAxis=rotate_5.Geometry, YAxis=ln_7)  # disabled

data_17 = Data(dispatch_14.ListB)  # disabled
explode_3 = Explode(Curve=data_17, Recursive=True)  # -> Segments, Vertices; disabled
len_3 = Length(Curve=explode_3.Segments)  # disabled
sort_4 = SortList(Keys=reverse(len_3), ValuesA=explode_3.Segments)  # -> Keys, ValuesA; disabled
item_16 = ListItem(List=sort_4.ValuesA, Index=0, Wrap=True)  # -> flatten(Item); disabled
area_8 = Area(Geometry=data_17)  # -> Area, Centroid; disabled
midpt_2 = CurveMiddle(Curve=item_16)  # disabled
move2pt_4 = MoveToPoint(Geometry=item_16, PointA=midpt_2, PointB=area_8.Centroid)  # -> Moved, Vector, Transform; disabled
end_4 = EndPoints(Curve=move2pt_4.Moved)  # -> Start, End; disabled
ln_8 = Line(StartPoint=end_4.Start, EndPoint=end_4.End)  # disabled
xy_15 = XYPlane(Origin=end_4.End)  # disabled
rotate_6 = Rotate(Geometry=ln_8, Angle=filter_4, Plane=xy_15)  # -> Geometry, Transform; disabled
pl_4 = ConstructPlane(Origin=end_4.End, XAxis=rotate_6.Geometry, YAxis=ln_8)  # disabled

data_18 = Data(flatten(pl_4))  # disabled
deplane_5 = DeconstructPlane(Plane=data_18)  # -> Origin, XAxis, YAxis, ZAxis; disabled
amp_5 = Amplitude(Vector=deplane_5.YAxis, Amplitude=number_slider_43)  # disabled
move_9 = Move(Geometry=deplane_5.Origin, Motion=amp_5)  # -> Geometry, Transform; disabled
ln_9 = Line(StartPoint=deplane_5.Origin, EndPoint=move_9.Geometry)  # disabled
midpt_3 = CurveMiddle(Curve=ln_9)  # disabled
scale = Scale(Geometry=ln_9, Center=midpt_3, Factor=number_slider_44)  # -> Geometry, Transform; disabled
ccx_3 = CurveCurve(CurveA=scale.Geometry, CurveB=crv_44)  # -> Points, ParamsA, ParamsB; disabled

dist_2 = Distance(PointA=graft(end_3.End), PointB=cull_i_3)  # disabled
sort_5 = SortList(Keys=dist_2)  # -> Keys, ValuesA; disabled
item_17 = ListItem(List=sort_5.Keys, Index=0, Wrap=True)  # disabled
smaller_4 = SmallerThan(FirstNumber=item_17, SecondNumber=number_slider_40)  # -> SmallerThan, OrEqualTo; disabled
flatten_4 = FlattenTree(Tree=item_17, Path="{0}")  # disabled
dispatch_15 = Dispatch(List=graft(pl_3), DispatchPattern=smaller_4.SmallerThan)  # -> ListA, ListB; disabled
panel_53 = Panel(flatten_4)  # disabled
flatten_5 = FlattenTree(Tree=ccx_3.Points, Path="{0}")  # disabled
lng = ListLength(List=scale.Geometry)  # disabled
lng_2 = ListLength(List=flatten_5)  # disabled

data_19 = Data(flatten(dispatch_15.ListA))  # disabled
deplane_6 = DeconstructPlane(Plane=data_19)  # -> Origin, XAxis, YAxis, ZAxis; disabled
amp_6 = Amplitude(Vector=deplane_6.YAxis, Amplitude=number_slider_41)  # disabled
move_10 = Move(Geometry=deplane_6.Origin, Motion=amp_6)  # -> Geometry, Transform; disabled
ln_10 = Line(StartPoint=deplane_6.Origin, EndPoint=move_10.Geometry)  # disabled
midpt_4 = CurveMiddle(Curve=ln_10)  # disabled
scale_2 = Scale(Geometry=ln_10, Center=midpt_4, Factor=number_slider_42)  # -> Geometry, Transform; disabled
ccx_4 = CurveCurve(CurveA=scale_2.Geometry, CurveB=crv_44)  # -> Points, ParamsA, ParamsB; disabled

data_20 = Data(flatten(dispatch_15.ListB))  # disabled
deplane_7 = DeconstructPlane(Plane=data_20)  # -> Origin, XAxis, YAxis, ZAxis; disabled
amp_7 = Amplitude(Vector=deplane_7.YAxis, Amplitude=number_slider_45)  # disabled
move_11 = Move(Geometry=deplane_7.Origin, Motion=amp_7)  # -> Geometry, Transform; disabled
ln_11 = Line(StartPoint=deplane_7.Origin, EndPoint=move_11.Geometry)  # disabled
midpt_5 = CurveMiddle(Curve=ln_11)  # disabled
scale_3 = Scale(Geometry=ln_11, Center=midpt_5, Factor=number_slider_46)  # -> Geometry, Transform; disabled
ccx_5 = CurveCurve(CurveA=scale_3.Geometry, CurveB=crv_44)  # -> Points, ParamsA, ParamsB; disabled

equals = Equality(FirstNumber=lng, SecondNumber=lng_2)  # -> Equality, Inequality; disabled
panel_54 = Panel(equals.Equality)  # disabled

# ----
# InsideCurve-大面
move2pt_5 = MoveToPoint(Geometry=data_18, PointA=flatten(deplane_5.Origin), PointB=flatten(ccx_3.Points))  # -> Moved, Vector, Transform; disabled

# ----
# InsideCurve-阳角
move2pt_6 = MoveToPoint(Geometry=data_19, PointA=deplane_6.Origin, PointB=ccx_4.Points)  # -> Moved, Vector, Transform; disabled

# ----
# InsideCurve-阴角
move2pt_7 = MoveToPoint(Geometry=data_20, PointA=deplane_7.Origin, PointB=ccx_5.Points)  # -> Moved, Vector, Transform; disabled

# ----
# 梁中线+Offset值+埋件单体组合包
crv_45 = Curve(<curve referenced from the Rhino model>)
layer_9 = ObjectLayer(Guid=crv_45)  # -> LayerIndex, LayerPathName
panel_55 = Panel(txt)

# ----
# 需要出图的钢结构编号
panel_56 = Panel(layer_9.LayerPathName)

reflay_16 = ReferenceByLayer(LayerName=panel_56)
cluster_3 = Cluster_3(
    structure_number=panel_56,
    tag_text=panel_8,
    text_offset=number_slider_3,
    T=txt,
    G=reflay_16,
    A=number_slider_4,
    A_2=number_slider_5,
    B=number_slider_14,
    dimension_style=panel_7)  # -> R, G_2, R_2

# ----
# 要连接的梁中线Offest值
num_4 = Number(cluster_3.R)

# ----
# 要连接的embed
data_21 = Data(cluster_3.R_2)

# ----
# 要连接的梁中线curve
crv_46 = Curve(cluster_3.G_2)

# ----
# 梁中线+Offset值+埋件单体组合包
crv_47 = Curve(<curve referenced from the Rhino model>)
layer_10 = ObjectLayer(Guid=crv_47)  # -> LayerIndex, LayerPathName
panel_57 = Panel(txt_2)

# ----
# 需要出图的钢结构编号
panel_58 = Panel(layer_10.LayerPathName)

reflay_17 = ReferenceByLayer(LayerName=panel_58)
cluster_4 = Cluster_3(
    structure_number=panel_58,
    tag_text=panel_10,
    text_offset=number_slider_6,
    T=txt_2,
    G=reflay_17,
    A=number_slider_7,
    A_2=number_slider_8,
    B=number_slider_9,
    dimension_style=panel_9)  # -> R, G_2, R_2

# ----
# 要连接的梁中线Offest值
num_5 = Number(cluster_4.R)

# ----
# 要连接的梁中线curve
crv_48 = Curve(cluster_4.G_2)

# ----
# 要连接的embed
data_22 = Data(cluster_4.R_2)

# ----
# 依次连接
# 梁中线Offest值
entwine_5 = Entwine(Branch00=num, Branch01=num_5, Branch02=num_4, FlattenInputs=True)

# ----
# 依次连接
# curve
entwine_6 = Entwine(Branch00=crv_18, Branch01=crv_48, Branch02=crv_46, FlattenInputs=True)

# ----
# 依次连接
# embed
entwine_7 = Entwine(Branch00=data_4, Branch01=data_22, Branch02=data_21, FlattenInputs=True)

data_23 = Data(entwine_7)
item_18 = ListItem(List=data_23, Index=0, Wrap=True)
item_19 = ListItem(List=data_23, Index="-1", Wrap=True)
data_24 = Data(entwine_7)
# Rhino 文件中导入的块名
item_20 = ListItem(List=data_24, Index=0, Wrap=True)
item_21 = ListItem(List=data_24, Index="-1", Wrap=True)
data_25 = Data(entwine_7)
item_22 = ListItem(List=data_25, Index=0, Wrap=True)
item_23 = ListItem(List=data_25, Index="-1", Wrap=True)
rotate_7 = Rotate(Geometry=item_23, Angle="Pi", Plane=item_23)  # -> Geometry, Transform
data_26 = Data(entwine_7)
data_27 = Data(entwine_7)
item_24 = ListItem(List=data_26, Index=0, Wrap=True)
item_25 = ListItem(List=data_26, Index="-1", Wrap=True)
item_26 = ListItem(List=data_27, Index=0, Wrap=True)
item_27 = ListItem(List=data_27, Index="-1", Wrap=True)
rotate_8 = Rotate(Geometry=item_25, Angle="Pi", Plane=item_25)  # -> Geometry, Transform

# ----
# 1.1-掩口出侧埋遗漏
panel_59 = Panel("1.1-掩口出侧埋遗漏")
layer_11 = DefineLayer(Name=panel_59)
attributes_3 = DefineObjectAttributes(Layer=layer_11)

data_28 = Data(merge_11)
swatch_4 = ColourSwatch(SwatchColor=RGB(140, 140, 140))

layer_12 = DefineLayer(Name="阴阳角定位-F1", Color=swatch_4)
attributes_4 = DefineObjectAttributes(Layer=layer_12, Color=swatch_4)

bake_2 = BakeObjects(Geometry=data_28, Attributes=attributes_4, BakeName="阴阳角定位-F1", Bake=False)

swatch_5 = ColourSwatch(SwatchColor=RGB(255, 212, 0))

swatch_6 = ColourSwatch(SwatchColor=RGB(255, 242, 66))

swatch_7 = ColourSwatch(SwatchColor=RGB(180, 255, 66))

swatch_8 = ColourSwatch(SwatchColor=RGB(66, 255, 236))

swatch_9 = ColourSwatch(SwatchColor=RGB(66, 167, 255))

swatch_10 = ColourSwatch(SwatchColor=RGB(66, 98, 255))

swatch_11 = ColourSwatch(SwatchColor=RGB(255, 242, 66))

swatch_12 = ColourSwatch(SwatchColor=RGB(66, 255, 69))

layer_13 = DefineLayer(Name="Tag::1-1-02钢板焊埋件", Color=swatch_5)
layer_14 = DefineLayer(Name="Embed::1-1-02钢板焊埋件", Color=swatch_5)
entwine_8 = Entwine(Branch00=layer_14, Branch01=layer_13, FlattenInputs=True)
attributes_5 = DefineObjectAttributes(Layer=entwine_8, Color=swatch_5)

layer_15 = DefineLayer(Name="Tag::2-1-03钢板焊埋件", Color=swatch_11)
layer_16 = DefineLayer(Name="Embed::2-1-03钢板焊埋件", Color=swatch_11)
entwine_9 = Entwine(Branch00=layer_16, Branch01=layer_15, FlattenInputs=True)
attributes_6 = DefineObjectAttributes(Layer=entwine_9, Color=swatch_11)

layer_17 = DefineLayer(Name="Tag::1-0-01钢板焊埋件", Color=swatch_6)
layer_18 = DefineLayer(Name="Embed::1-0-01钢板焊埋件", Color=swatch_6)
entwine_10 = Entwine(Branch00=layer_18, Branch01=layer_17, FlattenInputs=True)
attributes_7 = DefineObjectAttributes(Layer=entwine_10, Color=swatch_6)

layer_19 = DefineLayer(Name="Tag::3-1-03钢板焊埋件", Color=swatch_7)
layer_20 = DefineLayer(Name="Embed::3-1-03钢板焊埋件", Color=swatch_7)
entwine_11 = Entwine(Branch00=layer_20, Branch01=layer_19, FlattenInputs=True)
attributes_8 = DefineObjectAttributes(Layer=entwine_11, Color=swatch_7)

layer_21 = DefineLayer(Name="Tag::3-2-03钢板焊埋件", Color=swatch_12)
layer_22 = DefineLayer(Name="Embed::3-2-03钢板焊埋件", Color=swatch_12)
entwine_12 = Entwine(Branch00=layer_22, Branch01=layer_21, FlattenInputs=True)
attributes_9 = DefineObjectAttributes(Layer=entwine_12, Color=swatch_12)

layer_23 = DefineLayer(Name="Tag::4-1钢板焊底埋", Color=swatch_8)
layer_24 = DefineLayer(Name="Embed::4-1钢板焊底埋", Color=swatch_8)
entwine_13 = Entwine(Branch00=layer_24, Branch01=layer_23, FlattenInputs=True)
attributes_10 = DefineObjectAttributes(Layer=entwine_13, Color=swatch_8)

layer_25 = DefineLayer(Name="Tag::5-04板埋", Color=swatch_10)
layer_26 = DefineLayer(Name="Embed::5-04板埋", Color=swatch_10)
entwine_14 = Entwine(Branch00=layer_26, Branch01=layer_25, FlattenInputs=True)
attributes_11 = DefineObjectAttributes(Layer=entwine_14, Color=swatch_10)

layer_27 = DefineLayer(Name="Tag::4-0-03默认钢板焊", Color=swatch_9)
layer_28 = DefineLayer(Name="Embed::4-0-03默认钢板焊", Color=swatch_9)
entwine_15 = Entwine(Branch00=layer_28, Branch01=layer_27, FlattenInputs=True)
attributes_12 = DefineObjectAttributes(Layer=entwine_15, Color=swatch_9)

crv_49 = Curve(join_2)
panel_60 = Panel("""Dimension::Dim1
Dimension::Dim2
Dimension::Dim3
Dimension::Dim4""")
layer_29 = DefineLayer(Name=panel_60)  # -> graft(Layer)
attributes_13 = DefineObjectAttributes(Layer=layer_29)

# ----
# 生成底埋钢埋件
rectangle = Rectangle(Plane=PlaneXY(0, 0, 0), XSize=panel_15, YSize=panel_16, Radius=0)  # -> Rectangle, Length
rec = Rectangle(rectangle.Rectangle)
pln_3 = Plane(rectangle.Rectangle)

deplane_8 = DeconstructPlane(Plane=pln_3)  # -> Origin, XAxis, YAxis, ZAxis
dedomain_5 = DeconstructDomain(Domain=panel_16)  # -> Start, End
amp_8 = Amplitude(Vector=deplane_8.YAxis, Amplitude=dedomain_5.End)
move_12 = Move(Geometry=deplane_8.Origin, Motion=amp_8)  # -> Geometry, Transform
ln_12 = Line(StartPoint=deplane_8.Origin, EndPoint=move_12.Geometry)
amp_9 = Amplitude(Vector=ln_12, Amplitude=Slider(190, range=0..1000))
move_13 = Move(Geometry=deplane_8.Origin, Motion=amp_9)  # -> Geometry, Transform

text_3 = DefineTextObject(Text=panel_14, Plane=move_13.Geometry, DimensionStyle=panel_17, OutputType="Text")
group_7 = Group(Objects=[rec, text_3])
merge_12 = Merge(Data1=group_7, Data2=pln_3)

data_29 = Data(merge_12)
item_28 = ListItem(List=data_29, Index="-1", Wrap=True)
item_29 = ListItem(List=data_29, Index=0, Wrap=True)

crv_50 = Curve(join_2)
panel_61 = Panel("""Dimension::Dim1
Dimension::Dim2
Dimension::Dim3
Dimension::Dim4""")
layer_30 = DefineLayer(Name=panel_61)  # -> graft(Layer)
attributes_14 = DefineObjectAttributes(Layer=layer_30)

# ---- group: 制作下层定位平面 / 定位点Offset450后二次筛选是否与梁有交点
pt_19 = Point(dispatch_11.ListB)
num_6 = Number(number_slider_20)
cir = Circle(Plane=pt_19, Radius=num_6)
movetoplane_5 = MoveToPlane(Geometry=crv_12, Plane=PlaneXY(0, 0, 0), Above=True, Below=True)  # -> Geometry, Transform
movetoplane_6 = MoveToPlane(Geometry=cir, Plane=PlaneXY(0, 0, 0), Above=True, Below=True)  # -> Geometry, Transform
ccx_6 = CurveCurve(CurveA=flatten(movetoplane_6.Geometry), CurveB=graft(movetoplane_5.Geometry))  # -> Points, ParamsA, ParamsB
pull_8 = PullPoint(Point=ccx_6.Points, Geometry=movetoplane_2.Geometry, ClosestOnly=True)  # -> ClosestPoint, Distance
pt_20 = Point(merge_9)
pull_9 = PullPoint(Point=pull_8.ClosestPoint, Geometry=pt_20, ClosestOnly=True)  # -> ClosestPoint, Distance
larger_7 = LargerThan(FirstNumber=pull_9.Distance, SecondNumber="1")  # -> LargerThan, OrEqualTo
dispatch_16 = Dispatch(List=ccx_6.Points, DispatchPattern=larger_7.LargerThan)  # -> ListA, ListB

# ---- group: 制作下层定位平面 / 定位点Offset450后二次筛选是否与梁有交点 / Offset450后与梁有交点
pt_21 = Point(dispatch_16.ListA)

# ---- group: 制作下层定位平面 / 定位点Offset450后二次筛选是否与梁有交点 (continued)
incurves = PointInCurves(Point=flatten(pt_21), Curves=cir)  # -> Relationship, Index, Point
cull_i_4 = CullIndex(List=pt_19, Indices=incurves.Index, Wrap=True)
cullduppoints_2 = RemoveDuplicatePoints(InputPoints=cull_i_4, Tolerance=0.001)  # -> OutputPoints, FirstPointIndexes
null_2 = NullItem(Item=cullduppoints_2.OutputPoints)  # -> NullFlags, InvalidFlags, Description
dispatch_17 = Dispatch(List=cull_i_4, DispatchPattern=null_2.InvalidFlags)  # -> ListA, ListB
merge_13 = Merge(Data1=pt_15, Data2=pt_21)

# ---- group: 制作下层定位平面 / Offset450后与梁没有交点
pt_22 = Point(dispatch_17.ListB)

# ---- group: 制作下层定位平面 / 定位平面-垂直于梁中线
pt_23 = Point(merge_13)

# ---- group: 制作下层定位平面 / 定位平面-幕墙线法线
merge_14 = Merge(Data1=pt_22, Data2=pt_17)  # -> flatten(Result)

# ---- group: 制作上层定位平面 / 筛选阴阳角
pull_10 = PullPoint(Point=flatten(pt_16), Geometry=graft(merge_10), ClosestOnly=True)  # -> ClosestPoint, Distance
sort_6 = SortList(Keys=pull_10.Distance, ValuesA=flatten(pt_16))  # -> Keys, ValuesA
item_30 = ListItem(List=sort_6.Keys, Index=0, Wrap=True)  # -> Item, Item1
item_31 = ListItem(List=sort_6.ValuesA, Index=0, Wrap=True)  # -> Item, Item1
merge_15 = Merge(Data1=item_30.Item, Data2=item_30.Item1)
merge_16 = Merge(Data1=item_31.Item, Data2=item_31.Item1)
panel_62 = Panel(merge_15)
smaller_5 = SmallerThan(FirstNumber=merge_15, SecondNumber="100")  # -> SmallerThan, OrEqualTo
dispatch_18 = Dispatch(List=merge_16, DispatchPattern=smaller_5.SmallerThan)  # -> ListA, ListB
crv_51 = Curve(flatten(offset))

# ---- group: 制作上层定位平面 / 筛选阴阳角 / F1-阴阳角-点
data_30 = Data(dispatch_18.ListA)

# ---- group: F2阴阳角的点
# (9)Bake Me!!
# 埋件和阴阳角定位
pt_24 = Point(data_30)

# ---- group: 制作上层定位平面 / 筛选阴阳角 (continued)
check_same_points = CheckSamePoints(archPoint=flatten(pt_16), crvPoint=flatten(data_30))  # -> out, specialPt; inputs archPoint: list of Point3d, crvPoint: list of Point3d; same code as testpoint
cull_i_5 = CullIndex(List=flatten(pt_16), Indices=check_same_points.specialPt, Wrap=True)
pull_11 = PullPoint(Point=cull_i_5, Geometry=crv_51, ClosestOnly=True)  # -> ClosestPoint, Distance
ln_13 = Line(StartPoint=pull_11.ClosestPoint, EndPoint=cull_i_5)
rotate_9 = Rotate(Geometry=ln_13, Angle=1.570796327, Plane=cull_i_5)  # -> Geometry, Transform
pl_5 = ConstructPlane(Origin=cull_i_5, XAxis=rotate_9.Geometry, YAxis=ln_13)

# ---- group: 上层定位点Plane-去阴阳角
pln_4 = Plane(pl_5)

# ---- group: 上层定位平面-All
pln_5 = Plane(pln_4)

# ---- group: 制作下层定位平面
pull_12 = PullPoint(Point=pt_23, Geometry=movetoplane_2.Geometry, ClosestOnly=True)  # -> ClosestPoint, Distance
crv_52 = Curve(crv_12)
offset_11 = OffsetCurve(Curve=crv_52, Distance=Slider(500, range=0..1000), Corners=1)
pull_13 = PullPoint(Point=merge_14, Geometry=flatten(offset_11), ClosestOnly=True)  # -> ClosestPoint, Distance
pull_14 = PullPoint(Point=merge_14, Geometry=crv_52, ClosestOnly=True)  # -> ClosestPoint, Distance

# ---- group: 制作下层定位平面 / Y Axis Line-垂直梁中线
ln_14 = Line(StartPoint=pt_23, EndPoint=pull_12.ClosestPoint)

# ---- group: 制作下层定位平面 / Y Aixs Line-幕墙法线
ln_15 = Line(StartPoint=pull_14.ClosestPoint, EndPoint=pull_13.ClosestPoint)

# ---- group: 制作下层定位平面 (continued)
merge_17 = Merge(Data1=ln_14, Data2=ln_15)

# ---- group: 制作下层定位平面 / Y Axis Line-All
crv_53 = Curve(merge_17)

# ---- group: 制作下层定位平面 / 统一Y Axis向幕墙线外
end_5 = EndPoints(Curve=graft(crv_53))  # -> Start, End
movetoplane_7 = MoveToPlane(Geometry=crv_12, Plane=PlaneXY(0, 0, 0), Above=True, Below=True)  # -> Geometry, Transform
merge_18 = Merge(Data1=end_5.Start, Data2=end_5.End)
pull_15 = PullPoint(Point=merge_18, Geometry=movetoplane_7.Geometry, ClosestOnly=True)  # -> ClosestPoint, Distance
sort_7 = SortList(Keys=pull_15.Distance, ValuesA=merge_18)  # -> Keys, ValuesA
item_32 = ListItem(List=sort_7.ValuesA, Index="-1", Wrap=True)
item_33 = ListItem(List=sort_7.ValuesA, Index=0, Wrap=True)
pt_25 = Point(item_32)
pt_26 = Point(item_33)
ln_16 = Line(StartPoint=pt_26, EndPoint=pt_25)
rotate_10 = Rotate(Geometry=ln_16, Angle=1.570796327, Plane=pt_26)  # -> Geometry, Transform

# ---- group: 制作下层定位平面 / 统一Y Axis向幕墙线外 / F1-定位Plane-未筛选阴阳角
pl_6 = ConstructPlane(Origin=pt_26, XAxis=rotate_10.Geometry, YAxis=ln_16)  # -> flatten(Plane)

# ---- group: 制作下层定位平面 / 统一Y Axis向幕墙线外 (continued)
null_3 = NullItem(Item=pl_6)  # -> NullFlags, InvalidFlags, Description
dispatch_19 = Dispatch(List=pl_6, DispatchPattern=null_3.NullFlags)  # -> ListA, ListB

# ---- group: 制作下层定位平面 / 筛选阴阳角
pln_6 = Plane(dispatch_19.ListB)
pull_16 = PullPoint(Point=flatten(pln_6), Geometry=graft(pt_18), ClosestOnly=True)  # -> ClosestPoint, Distance
sort_8 = SortList(Keys=pull_16.Distance, ValuesA=flatten(pln_6))  # -> Keys, ValuesA
item_34 = ListItem(List=sort_8.Keys, Index=0, Wrap=True)  # -> Item, Item1
item_35 = ListItem(List=sort_8.ValuesA, Index=0, Wrap=True)  # -> Item, Item1
merge_19 = Merge(Data1=item_34.Item, Data2=item_34.Item1)
merge_20 = Merge(Data1=item_35.Item, Data2=item_35.Item1)
panel_63 = Panel(merge_19)
smaller_6 = SmallerThan(FirstNumber=merge_19, SecondNumber="100")  # -> SmallerThan, OrEqualTo
dispatch_20 = Dispatch(List=merge_20, DispatchPattern=smaller_6.SmallerThan)  # -> ListA, ListB
pln_7 = Plane(pln_6)
crv_54 = Curve(movetoplane_7.Geometry)
movetoplane_8 = MoveToPlane(Geometry=crv_54, Plane=PlaneXY(0, 0, 0), Above=True, Below=True)  # -> Geometry, Transform
clscrv_3 = CloseCurve(Curve=movetoplane_8.Geometry, CloseType=0, Bulge=0.5, Tolerance=0)  # -> Closed, R

# ---- group: 制作下层定位平面 / 筛选阴阳角 / F1-阴阳角-Plane
data_31 = Data(dispatch_20.ListA)

# ---- group: 制作下层定位平面 / 筛选阴阳角 (continued)
check_same_points_2 = CheckSamePoints(archPoint=flatten(pln_6), crvPoint=flatten(data_31))  # -> out, specialPt; inputs archPoint: list of Point3d, crvPoint: list of Point3d; same code as testpoint
cull_i_6 = CullIndex(List=flatten(pln_7), Indices=check_same_points_2.specialPt, Wrap=True)
deplane_9 = DeconstructPlane(Plane=cull_i_6)  # -> Origin, XAxis, YAxis, ZAxis
movetoplane_9 = MoveToPlane(Geometry=deplane_9.Origin, Plane=PlaneXY(0, 0, 0), Above=True, Below=True)  # -> Geometry, Transform
amp_10 = Amplitude(Vector=deplane_9.YAxis, Amplitude=Slider(300, range=0..1000))
move_14 = Move(Geometry=movetoplane_9.Geometry, Motion=amp_10)  # -> flatten(Geometry), Transform
incurves_2 = PointInCurves(Point=move_14.Geometry, Curves=clscrv_3.Closed)  # -> Relationship, Index, Point
equals_2 = Equality(FirstNumber=incurves_2.Relationship, SecondNumber="2")  # -> Equality, Inequality
dispatch_21 = Dispatch(List=flatten(cull_i_6), DispatchPattern=equals_2.Equality)  # -> ListA, ListB
data_32 = Data(dispatch_21.ListB)
data_33 = Data(dispatch_21.ListA)
deplane_10 = DeconstructPlane(Plane=data_33)  # -> Origin, XAxis, YAxis, ZAxis
rev = Reverse(Vector=deplane_10.YAxis)
# 测试Smooth Curve是否与每个Block相切
# blocks + smooth curves
# remove duplicate blocks
# blocks + special curves
# 测试Smooth Curve是否与每个Block相切
# remove duplicate blocks
pl_7 = ConstructPlane(Origin=deplane_10.Origin, XAxis=deplane_10.XAxis, YAxis=rev)
merge_21 = Merge(Data1=pl_7, Data2=data_32)

# ---- group: 下层定位点Plane-去阴阳角
# 第一层
# 
# Curves(location point)+ Smooth Curves(architecture line)
# 阳角
# 阴角
# blocks + smooth curves
# blocks + special curves
# 阴阳角
# 转角点
# 第一层
# 
# Angular Curves(architecture line)
# 第一层
# 
# Special Curves(architecture line)
# 第一层
# 
# Angular Curves(architecture line)
pln_8 = Plane(merge_21)

# ---- group: 下层定位平面-All
pln_9 = Plane(pln_8)

# ---- group: 上层定位plane
pln_10 = Plane(pln_8)

# ----
# 板埋：制作板埋三视图
max = Maximum(A=s_x, B=s_y)
filter_6 = StreamFilter(Gate=list, Stream0=7.2, Stream1=9.6, Stream2=11.9, Stream3=14.3, Stream4=16.7, Stream5=19.1)
filter_7 = StreamFilter(Gate=list_2, Stream0=270, Stream1=360)
filter_8 = StreamFilter(Gate=list_3, Stream0=10, Stream1=12, Stream2=16, Stream3=18, Stream4=20, Stream5=25)
filter_9 = StreamFilter(Gate=list, Stream0=0.91, Stream1=1.1, Stream2=1.27, Stream3=1.43, Stream4=1.57, Stream5=1.71)
filter_10 = StreamFilter(Gate=list_2, Stream0=0.16, Stream1=0.14)
addition_17 = Addition(A=list_4, B=1)
addition_18 = Addition(A=list_5, B=1)
division_11 = Division(A=max, B=8)
t = Integer(division_11)
panel_64 = Panel(filter_9)
panel_65 = Panel(filter_6)
panel_66 = Panel(filter_10)
min = Minimum(A=filter_7, B=300)
panel_67 = Panel(min)
expression = Expression(A=filter_10, fy=filter_7, ft=filter_9, d=filter_8, Expression="(int((0.6*1.1*A*fy/ft*d)/5)+1)*5")

# ----
# 板埋Modeling
multiplication_3 = Multiplication(A=s_x, B=addition_17)
multiplication_4 = Multiplication(A=s_y, B=addition_18)
recgrid = Rectangular(Plane=PlaneXY(0, 0, 0), SizeX=s_x, SizeY=s_y, ExtentX=addition_17, ExtentY=addition_18)  # -> Cells, Points
直径 = Text(filter_8)
division_12 = Division(A=multiplication_3, B=2)
division_13 = Division(A=multiplication_4, B=2)
vec = VectorXYZ(XComponent=expr("-x", division_12), YComponent=expr("-x", division_13), ZComponent=0)  # -> Vector, Length
move_15 = Move(Geometry=recgrid.Points, Motion=vec.Vector)  # -> Geometry, Transform
division_14 = Division(A=直径, B=2)
cyl = Cylinder(Base=move_15.Geometry, Radius=division_14, Length=expr("-x", expression))
X_3 = UnitX(Factor=直径)
multiplication_5 = Multiplication(A=直径, B=6)
edges = BrepEdges(Brep=cyl)  # -> Naked, Interior, NonManifold
item_36 = ListItem(List=edges.Naked, Index=0, Wrap=True)
max_2 = Maximum(A=multiplication_5, B=70)
move_16 = Move(Geometry=item_36, Motion=X_3)  # -> Geometry, Transform
multiplication_6 = Multiplication(A=max_2, B=2)
addition_19 = Addition(A=multiplication_3, B=multiplication_6)
addition_20 = Addition(A=multiplication_4, B=multiplication_6)
division_15 = Division(A=t, B=2)
expression_2 = Expression(x=addition_20, Expression="Ceiling(x/10)*10/2")
expression_3 = Expression(x=addition_19, Expression="Ceiling(x/10)*10/2")
round = Round(Number=division_15)  # -> Nearest, Floor, Ceiling
multiplication_7 = Multiplication(A=round.Ceiling, B=2)
dom_13 = ConstructDomain(DomainStart=expr("-x", expression_2), DomainEnd=expression_2)
dom_14 = ConstructDomain(DomainStart=expr("-x", expression_3), DomainEnd=expression_3)
box = DomainBox(Base=PlaneXY(0, 0, 0), X=dom_14, Y=dom_13, Z=multiplication_7)
Z = UnitZ(Factor=expr("-x", multiplication_7))

multiplication_8 = Multiplication(A=直径, B=5)

Z_2 = UnitZ(Factor=multiplication_8)
extr = Extrude(Base=move_16.Geometry, Direction=Z_2)
cap = CapHoles(Brep=[extr, cyl])
merge_22 = Merge(Data1=cap, Data2=box)
flatten_6 = FlattenTree(Tree=merge_22, Path="{0}")
move_17 = Move(Geometry=flatten_6, Motion=Z)  # -> Geometry, Transform

# ----
# 三视图
# hidden lines of top+pers view
# move to center
# 如果无法完整的生成埋件的三视图，
# 建议选择埋件的3D在Rhino中将
# Top/Perspective/Front/Right 试图缩放至合适大小后重新运行
panel_68 = Panel("""Top
Perspective
Front
Right""")
m2d_rhino = Make2DRhinoView(Name=panel_68, Clip=True)
number_slider_47 = Slider(1, range=0..10)
pt_27 = Point(Point(957.9296072, 367.7685097, 0))
pt_28 = Point("0,0,0")
recgrid_2 = Rectangular(
    Plane=pt_27,
    SizeX=Slider(12, range=1..20, expression="X*50"),
    SizeY=Slider(10, range=1..20, expression="X*50"),
    ExtentX=number_slider_47,
    ExtentY=number_slider_47)  # -> Cells, Points
flatten_7 = FlattenTree(Tree=recgrid_2.Points, Path="{0}")

# ----
# （6）生成板埋埋件
# 注意：
# 1.记得点一下Compute按钮
# 2.如果无法完整的生成埋件的三视图，
# 建议选择埋件的3D在Rhino中将
# Top/Perspective/Front/Right 试图缩放至合适大小后重新运行
make2d = Make2D(Geometry=move_17.Geometry, View=m2d_rhino, TangentEdges=False, TangentSeams=False, AutoComputeMake2D=False)  # -> VisibleCurves, VisibleIndex, VisibleType, HiddenCurves, HiddenIndex, HiddenType

bang = ExplodeTree(Data=make2d.VisibleCurves)  # -> Branch0, Branch1, Branch2, Branch3, Branch4, Branch5, Branch6, Branch7
divdist = DivideDistance(Curve=make2d.HiddenCurves, Distance=Slider(1, range=0..10))  # -> Points, Tangents, Parameters
graft = GraftTree(Tree=make2d.HiddenCurves, IncludeEmptyLists=True, IncludeNullItems=True)
shatter = Shatter(Curve=graft, Parameters=divdist.Parameters)
dispatch_22 = Dispatch(List=shatter, DispatchPattern=[True, False])  # -> ListA, ListB
crv_55 = Curve(dispatch_22.ListA)
pshift = ShiftPaths(Data=crv_55, Offset=-1)
pshift_2 = ShiftPaths(Data=pshift, Offset=-1)
bang_2 = ExplodeTree(Data=pshift_2)  # -> Branch0, Branch1, Branch2, Branch3, Branch4, Branch5, Branch6, Branch7
entwine_16 = Entwine(Branch00=bang_2.Branch0, Branch01=bang.Branch0, FlattenInputs=True)  # -> flatten(Result)
entwine_17 = Entwine(Branch00=bang_2.Branch1, Branch01=bang.Branch1, FlattenInputs=True)  # -> flatten(Result)
entwine_18 = Entwine(Branch00=entwine_16, Branch01=entwine_17, Branch02=bang.Branch2, Branch03=bang.Branch3, FlattenInputs=True)
group_8 = Group(Objects=entwine_18)
pshift_3 = ShiftPaths(Data=group_8, Offset=-1)
pshift_4 = ShiftPaths(Data=group_8, Offset=-1)
boxprop_3 = BoxProperties(Box=pshift_3)  # -> Center, Diagonal, Area, Volume, Degeneracy
vec2pt = Vector2Pt(PointA=boxprop_3.Center, PointB=pt_28, Unitize=False)  # -> Vector, Length
move_18 = Move(Geometry=pshift_4, Motion=vec2pt.Vector)  # -> flatten(Geometry), Transform
orient_3 = Orient(Geometry=flatten(move_18.Geometry), Source=PlaneXY(0, 0, 0), Target=flatten_7)  # -> Geometry, Transform
cull_i_7 = CullIndex(List=orient_3.Geometry, Indices="-1", Wrap=True)
split_10 = SplitList(List=cull_i_7, Index="4")  # -> ListA, ListB
geo_4 = Geometry(split_10.ListA)

# ---- group: 单体定Top/Side
item_37 = ListItem(List=geo_4, Index=Slider(0, range=0..10), Wrap=True)
item_38 = ListItem(List=geo_4, Index=2, Wrap=True)
cluster_5 = Cluster(G=item_37)
cluster_6 = Cluster(G=item_38)

# ----
# 钢埋板高度，工字钢尺寸决定
ungroup_3 = Ungroup(Group=cluster_6)
ungroup_4 = Ungroup(Group=cluster_5)

# ---- group: Top/Side
filter_11 = StreamFilter(Gate=list_6, Stream0=ungroup_4, Stream1=ungroup_3)

# ---- group: Block
attributes_15 = DefineObjectAttributes(Color=ColourSwatch(SwatchColor=RGB(255, 0, 0)))
block_3 = DefineBlock(Geometry=ungroup_4, Attributes=attributes_15, BlockName="Board Plate", BasePlane=PlaneXY(0, 0, 0))

# ----
deblock_6 = DeconstructBlock(Block=block_3)  # -> Name, flatten(Plane), flatten(Geometry)
boundary_2 = BoundarySurfaces(Edges=deblock_6.Geometry)
deplane_11 = DeconstructPlane(Plane=deblock_6.Plane)  # -> Origin, XAxis, YAxis, ZAxis
area_9 = Area(Geometry=boundary_2)  # -> Area, Centroid
move2pt_8 = MoveToPoint(Geometry=flatten(deplane_11.Origin), PointA=flatten(deplane_11.Origin), PointB=flatten(area_9.Centroid))  # -> Moved, Vector, Transform
pl_8 = ConstructPlane(Origin=move2pt_8.Moved, XAxis=deplane_11.XAxis, YAxis=deplane_11.YAxis)  # -> graft(Plane)

deplane_12 = DeconstructPlane(Plane=deblock_6.Plane)  # -> Origin, XAxis, YAxis, ZAxis
amp_11 = Amplitude(Vector=deplane_12.YAxis, Amplitude=number_slider_15)
move_19 = Move(Geometry=deplane_12.Origin, Motion=amp_11)  # -> Geometry, Transform

text_4 = DefineTextObject(Text=panel_19, Plane=move_19.Geometry, DimensionStyle=panel_18, OutputType="Text")
group_9 = Group(Objects=flatten([block_3, text_4]))
entwine_19 = Entwine(Branch00=group_9, Branch01=pl_8, FlattenInputs=True)

data_34 = Data(flatten(entwine_19))
item_39 = ListItem(List=data_34, Index=0, Wrap=True)
item_40 = ListItem(List=data_34, Index="-1", Wrap=True)

# ---- group: 车道区域
# 1.是否有檐口线-下层定位点
toggle_4 = BooleanToggle(True)
clean = CleanTree(RemoveNulls=True, RemoveInvalid=True, RemoveEmpty=toggle_4, Tree=pln_9)
crv_56 = Curve(crv_26)
merge_23 = Merge(Data1=crv_33, Data2=crv_56)

# ---- group: 车道区域 / Input ???
deplane_13 = DeconstructPlane(Plane=clean)  # -> Origin, XAxis, YAxis, ZAxis

# ----
# 1.是否有檐口线-上层定位点
toggle_5 = BooleanToggle(True)
clean_2 = CleanTree(RemoveNulls=True, RemoveInvalid=True, RemoveEmpty=toggle_5, Tree=pln_5)

# ---- group: Input ???
deplane_14 = DeconstructPlane(Plane=clean_2)  # -> Origin, XAxis, YAxis, ZAxis

# ----
incurve = PointInCurve(Point=deplane_14.Origin, Curve=crv_32)  # -> Relationship, Point
equals_3 = Equality(FirstNumber=incurve.Relationship, SecondNumber="2")  # -> Equality, Inequality
dispatch_23 = Dispatch(List=clean_2, DispatchPattern=equals_3.Equality)  # -> ListA, ListB

# ----
# Site - 无檐口线的定位点
pln_11 = Plane(dispatch_23.ListB)

# ----
# 1.0无檐口线初筛-上层定位点
pln_12 = Plane(pln_11)

# ---- group: 车道区域 (continued)
incurve_2 = PointInCurve(Point=deplane_13.Origin, Curve=crv_31)  # -> Relationship, Point
equals_4 = Equality(FirstNumber=incurve_2.Relationship, SecondNumber="2")  # -> Equality, Inequality
dispatch_24 = Dispatch(List=clean, DispatchPattern=equals_4.Equality)  # -> ListA, ListB

# Site - 有檐口线的定位点
pln_13 = Plane(dispatch_24.ListA)

# Site - 无檐口线的定位点
pln_14 = Plane(dispatch_24.ListB)

incurves_3 = PointInCurves(Point=pln_13, Curves=crv_56)  # -> Relationship, Index, Point
incurves_4 = PointInCurves(Point=pln_13, Curves=merge_23)  # -> Relationship, Index, Point
equals_5 = Equality(FirstNumber=incurves_4.Relationship, SecondNumber="2")  # -> Equality, Inequality
equals_6 = Equality(FirstNumber=incurves_3.Relationship, SecondNumber="0")  # -> Equality, Inequality
dispatch_25 = Dispatch(List=pln_13, DispatchPattern=equals_5.Equality)  # -> ListA, ListB
dispatch_26 = Dispatch(List=pln_13, DispatchPattern=equals_6.Inequality)  # -> ListA, ListB

# ---- group: 车道区域 / 檐口线-Site
pln_15 = Plane(dispatch_25.ListB)

# ---- group: 车道区域
# 檐口出特殊处理:
# 比如作为吊顶处理
# +车道处特殊处理
pln_16 = Plane(dispatch_25.ListA)

# 车道处特殊处理
pln_17 = Plane(dispatch_26.ListA)

# ---- group: All-下层定位点
# 1.1有檐口线
pln_18 = Plane(pln_15)

# ----
# 1.0无檐口线初筛-下层定位点
pln_19 = Plane(pln_14)

# ----
# 0 檐口出特殊处理
# 比如作为吊顶处理
pln_20 = Plane(pln_16)
pt_29 = Point(pln_20)

pln_21 = Plane(pln_18)

# ----
# 区分内外梁边线
# 2.根据是否相交判定内外梁(平行于建筑边线方向）
crv_57 = Curve(entwine_6)
num_7 = Number(entwine_5)
crv_58 = Curve(filter)
offcrv = OffsetCurve(Curve=crv_57, Plane=PlaneXY(0, 0, 0), Distance=num_7, BothSides=expr("-x", num_7), Kinks=0, CapType="0")
midpt_6 = CurveMiddle(Curve=offcrv)
offcrv_2 = OffsetCurve(Curve=crv_57, Plane=PlaneXY(0, 0, 0), Distance=num_7, BothSides=expr("-x", num_7), Kinks=0, CapType="1")
crv_59 = Curve(offcrv)
item_41 = ListItem(List=midpt_6, Index=0, Wrap=True)
item_42 = ListItem(List=crv_59, Index=0, Wrap=True)
item_43 = ListItem(List=crv_59, Index="-1", Wrap=True)
graft_2 = GraftTree(Tree=crv_57, IncludeEmptyLists=True, IncludeNullItems=True)

# ---- group: 梁中线-中点
midpt_7 = CurveMiddle(Curve=crv_57)

# ---- group: Pull到轮廓线
pull_17 = PullPoint(Point=midpt_7, Geometry=crv_58, ClosestOnly=True)  # -> ClosestPoint, Distance

# ----
# 梁线闭合
shift_2 = ShiftPaths(Data=offcrv_2, Offset=-1)

# ---- group: 和某组梁边线相连
ln_17 = Line(StartPoint=item_41, EndPoint=graft(pull_17.ClosestPoint))

# ---- group: 有交点为内
ccx_7 = CurveCurve(CurveA=ln_17, CurveB=graft_2)  # -> Points, ParamsA, ParamsB

# ----
null_4 = NullItem(Item=ccx_7.Points)  # -> NullFlags, InvalidFlags, Description
dispatch_27 = Dispatch(List=item_42, DispatchPattern=null_4.InvalidFlags)  # -> ListA, ListB
dispatch_28 = Dispatch(List=item_43, DispatchPattern=null_4.InvalidFlags)  # -> ListA, ListB

# ----
# 梁边线-内
merge_24 = Merge(Data1=dispatch_27.ListB, Data2=dispatch_28.ListA)

# ----
# 梁边线-外
merge_25 = Merge(Data1=dispatch_27.ListA, Data2=dispatch_28.ListB)

# ---- group: 梁-外侧
crv_60 = Curve(merge_25)

# ----
deplane_15 = DeconstructPlane(Plane=pln_19)  # -> Origin, XAxis, YAxis, ZAxis
crv_61 = Curve(crv_58)
incurves_5 = PointInCurves(Point=deplane_15.Origin, Curves=flatten(crv_61))  # -> Relationship, Index, Point
equals_7 = Equality(FirstNumber=incurves_5.Relationship, SecondNumber="2")  # -> Equality, Inequality
dispatch_29 = Dispatch(List=pln_19, DispatchPattern=equals_7.Equality)  # -> ListA, ListB
crv_62 = Curve(crv_33)
data_35 = Data(dispatch_29.ListB)

deplane_16 = DeconstructPlane(Plane=pln_12)  # -> Origin, XAxis, YAxis, ZAxis
crv_63 = Curve(crv_58)
incurves_6 = PointInCurves(Point=deplane_16.Origin, Curves=flatten(crv_63))  # -> Relationship, Index, Point
equals_8 = Equality(FirstNumber=incurves_6.Relationship, SecondNumber="2")  # -> Equality, Inequality
dispatch_30 = Dispatch(List=pln_12, DispatchPattern=equals_8.Equality)  # -> ListA, ListB
crv_64 = Curve(crv_33)
data_36 = Data(dispatch_30.ListB)

pln_22 = Plane(dispatch_29.ListA)
incurves_7 = PointInCurves(Point=pln_22, Curves=flatten(crv_62))  # -> Relationship, Index, Point
equals_9 = Equality(FirstNumber=incurves_7.Relationship, SecondNumber="0")  # -> Equality, Inequality
dispatch_31 = Dispatch(List=pln_22, DispatchPattern=equals_9.Equality)  # -> ListA, ListB
pln_23 = Plane(dispatch_31.ListB)

pln_24 = Plane(dispatch_30.ListA)
incurves_8 = PointInCurves(Point=pln_24, Curves=flatten(crv_64))  # -> Relationship, Index, Point
equals_10 = Equality(FirstNumber=incurves_8.Relationship, SecondNumber="0")  # -> Equality, Inequality
dispatch_32 = Dispatch(List=pln_24, DispatchPattern=equals_10.Equality)  # -> ListA, ListB
pln_25 = Plane(dispatch_32.ListB)

# ---- group: 下层交点-除重
# 1.0无檐口线-下层定位点
pln_26 = Plane(dispatch_31.ListA)

# 1.0无檐口线-上层定位点
pln_27 = Plane(dispatch_32.ListA)

# ----
crv_65 = Curve(shift_2)

# ---- group: 下层交点-除重 / 梁外侧
crv_66 = Curve(merge_25)

# ----
# 1.0
crv_67 = Curve(shift_2)

crv_68 = Curve(shift_2)

crv_69 = Curve(shift_2)

crv_70 = Curve(shift_2)

crv_71 = Curve(shift_2)

crv_72 = Curve(shift_2)

crv_73 = Curve(shift_2)

crv_74 = Curve(shift_2)

# ----
# 1.1 有檐口-整个site一起处理
pln_28 = Plane(pln_18)
deplane_17 = DeconstructPlane(Plane=pln_28)  # -> Origin, XAxis, YAxis, ZAxis
amp_12 = Amplitude(Vector=deplane_17.YAxis, Amplitude=number_slider_31)
move_20 = Move(Geometry=deplane_17.Origin, Motion=amp_12)  # -> Geometry, Transform
ln_18 = Line(StartPoint=deplane_17.Origin, EndPoint=move_20.Geometry)
ccx_8 = CurveCurve(CurveA=graft(ln_18), CurveB=flatten(crv_60))  # -> Points, ParamsA, ParamsB
shift_3 = ShiftPaths(Data=ccx_8.Points, Offset=-1)
sort_9 = SortList(Keys=shift_3, ValuesA=shift_3)  # -> Keys, ValuesA
pull_18 = PullPoint(Point=sort_9.ValuesA, Geometry=graft(deplane_17.Origin), ClosestOnly=True)  # -> ClosestPoint, Distance
sort_10 = SortList(Keys=pull_18.Distance, ValuesA=sort_9.ValuesA)  # -> Keys, ValuesA
crv_75 = Curve(shift_2)

# ---- group: 最外侧的交点
item_44 = ListItem(List=sort_10.ValuesA, Index="-1", Wrap=True)

# ----
null_5 = NullItem(Item=flatten(item_44))  # -> NullFlags, InvalidFlags, Description
dispatch_33 = Dispatch(List=item_44, DispatchPattern=item_44)  # -> ListA, ListB
dispatch_34 = Dispatch(List=pln_28, DispatchPattern=null_5.InvalidFlags)  # -> ListA, ListB

# ---- group: 交点对应的初始Plane
data_37 = Data(dispatch_34.ListB)

# ---- group: 交点Point
data_38 = Data(dispatch_33.ListA)

# ----
# 按照梁分类定位点
pt_30 = Point(data_38)
incurves_9 = PointInCurves(Point=flatten(pt_30), Curves=crv_75)  # -> Relationship, Index, Point
equals_11 = Equality(FirstNumber=incurves_9.Relationship, SecondNumber="0")  # -> Equality, Inequality
dispatch_35 = Dispatch(List=flatten(pt_30), DispatchPattern=equals_11.Inequality)  # -> ListA, ListB

# ----
# 按照梁分类定位点
pt_31 = Point(data_38)
incurves_10 = PointInCurves(Point=flatten(pt_31), Curves=crv_75)  # -> Relationship, Index, Point
equals_12 = Equality(FirstNumber=incurves_10.Relationship, SecondNumber="0")  # -> Equality, Inequality
dispatch_36 = Dispatch(List=flatten(data_37), DispatchPattern=equals_12.Inequality)  # -> ListA, ListB

# ---- group: Plane-属于那个梁
data_39 = Data(dispatch_36.ListA)

# ---- group: 交点-属于哪个梁
data_40 = Data(dispatch_35.ListA)

# ----
move2pt_9 = MoveToPoint(Geometry=data_39, PointA=data_39, PointB=data_40)  # -> Moved, Vector, Transform
null_6 = NullItem(Item=move2pt_9.Moved)  # -> NullFlags, InvalidFlags, Description
dispatch_37 = Dispatch(List=move2pt_9.Moved, DispatchPattern=null_6.InvalidFlags)  # -> ListA, ListB

check_same_points_3 = CheckSamePoints(archPoint=pln_28, crvPoint=data_37)  # -> out, specialPt; inputs archPoint: list of Point3d, crvPoint: list of Point3d; same code as testpoint

# ---- group: 檐口-首次筛选的有效起始Plane
data_41 = Data(dispatch_37.ListB)

# ----
# 0无檐口线
# 与梁不相交
cull_i_8 = CullIndex(List=pln_28, Indices=check_same_points_3.specialPt, Wrap=True)

# ----
# 0 檐口出定位点
# 与结构无交点
pln_29 = Plane(cull_i_8)

# ----
# 0.Missing Point-二次筛选檐口处
# 埋件定位点Offset，没有找到和梁的交点
number_slider_48 = Slider(5000, range=0..10000)
deplane_18 = DeconstructPlane(Plane=pln_29)  # -> Origin, XAxis, YAxis, ZAxis
amp_13 = Amplitude(Vector=deplane_18.YAxis, Amplitude=number_slider_48)
move_21 = Move(Geometry=deplane_18.Origin, Motion=amp_13)  # -> Geometry, Transform
ln_19 = Line(StartPoint=move_21.Geometry, EndPoint=deplane_18.Origin)
amp_14 = Amplitude(Vector=deplane_18.XAxis, Amplitude=number_slider_20)
amp_15 = Amplitude(Vector=deplane_18.XAxis, Amplitude=expr("-x", number_slider_20))

# ---- group: 2条Offset的探针找交点
move_22 = Move(Geometry=ln_19, Motion=amp_14)  # -> Geometry, Transform
move_23 = Move(Geometry=ln_19, Motion=amp_15)  # -> Geometry, Transform

# ----
# 1.1 檐口处侧埋，钢板焊
# 02：钢板焊埋件[钢梁外侧]
# @钢边梁宽@钢边梁高
pln_30 = Plane(data_41)

# ---- group: 下层交点-除重
# 1.0 无檐口线+上下层幕墙边线连续
pln_31 = Plane(pln_27)
pln_32 = Plane(pln_26)
deplane_19 = DeconstructPlane(Plane=pln_31)  # -> Origin, XAxis, YAxis, ZAxis
deplane_20 = DeconstructPlane(Plane=pln_32)  # -> Origin, XAxis, YAxis, ZAxis
number_slider_49 = Slider(3584, range=0..10000)
number_slider_50 = Slider(3584, range=0..10000)
amp_16 = Amplitude(Vector=deplane_20.YAxis, Amplitude=expr("-x", number_slider_50))
amp_17 = Amplitude(Vector=deplane_20.YAxis, Amplitude=number_slider_50)
amp_18 = Amplitude(Vector=deplane_19.YAxis, Amplitude=expr("-x", number_slider_49))
amp_19 = Amplitude(Vector=deplane_19.YAxis, Amplitude=number_slider_49)
move_24 = Move(Geometry=deplane_20.Origin, Motion=amp_16)  # -> Geometry, Transform
move_25 = Move(Geometry=deplane_20.Origin, Motion=amp_17)  # -> Geometry, Transform
move_26 = Move(Geometry=deplane_19.Origin, Motion=amp_18)  # -> Geometry, Transform
move_27 = Move(Geometry=deplane_19.Origin, Motion=amp_19)  # -> Geometry, Transform
ln_20 = Line(StartPoint=move_26.Geometry, EndPoint=move_27.Geometry)
ln_21 = Line(StartPoint=move_24.Geometry, EndPoint=move_25.Geometry)
pt_32 = Point(deplane_19.Origin)
pln_33 = Plane(pln_32)
# 结构线是否分上下层？？？
number_slider_51 = Slider(2756, range=0..10000)

# ---- group: 下层交点-除重 / F1-交点
ccx_9 = CurveCurve(CurveA=ln_21, CurveB=crv_35)  # -> Points, ParamsA, ParamsB

# ---- group: 下层交点-除重 / F2-交点
ccx_10 = CurveCurve(CurveA=ln_20, CurveB=crv_36)  # -> Points, ParamsA, ParamsB

# ----
ccx_11 = CurveCurve(CurveA=graft(move_23.Geometry), CurveB=flatten(merge_25))  # -> Points, ParamsA, ParamsB
shift_4 = ShiftPaths(Data=ccx_11.Points, Offset=-1)
sort_11 = SortList(Keys=shift_4, ValuesA=shift_4)  # -> Keys, ValuesA
pull_19 = PullPoint(Point=sort_11.ValuesA, Geometry=graft(pln_29), ClosestOnly=True)  # -> ClosestPoint, Distance
sort_12 = SortList(Keys=pull_19.Distance, ValuesA=sort_11.ValuesA)  # -> Keys, ValuesA

# ---- group: 最远交点
item_45 = ListItem(List=sort_12.ValuesA, Index="-1", Wrap=True)

# ----
null_7 = NullItem(Item=flatten(item_45))  # -> NullFlags, InvalidFlags, Description
dispatch_38 = Dispatch(List=simplify(item_45), DispatchPattern=simplify(graft(null_7.InvalidFlags)))  # -> ListA, ListB
dispatch_39 = Dispatch(List=pln_29, DispatchPattern=null_7.InvalidFlags)  # -> ListA, ListB
pt_33 = Point(dispatch_38.ListB)
pln_34 = Plane(dispatch_39.ListB)

# ----
# 按照梁分类定位点
pln_35 = Plane(pln_34)
pt_34 = Point(pt_33)
incurves_11 = PointInCurves(Point=flatten(pt_34), Curves=crv_65)  # -> Relationship, Index, Point
equals_13 = Equality(FirstNumber=incurves_11.Relationship, SecondNumber="0")  # -> Equality, Inequality
dispatch_40 = Dispatch(List=flatten(pln_35), DispatchPattern=equals_13.Inequality)  # -> ListA, ListB
data_42 = Data(dispatch_40.ListA)

# ----
# 按照梁分类定位点
pt_35 = Point(pt_33)
incurves_12 = PointInCurves(Point=flatten(pt_35), Curves=crv_65)  # -> Relationship, Index, Point
equals_14 = Equality(FirstNumber=incurves_12.Relationship, SecondNumber="0")  # -> Equality, Inequality
dispatch_41 = Dispatch(List=flatten(pt_35), DispatchPattern=equals_14.Inequality)  # -> ListA, ListB
data_43 = Data(dispatch_41.ListA)

move2pt_10 = MoveToPoint(Geometry=data_42, PointA=data_42, PointB=data_43)  # -> Moved, Vector, Transform
null_8 = NullItem(Item=move2pt_10.Moved)  # -> NullFlags, InvalidFlags, Description
dispatch_42 = Dispatch(List=move2pt_10.Moved, DispatchPattern=null_8.InvalidFlags)  # -> ListA, ListB
pln_36 = Plane(dispatch_42.ListB)

ccx_12 = CurveCurve(CurveA=graft(move_22.Geometry), CurveB=flatten(merge_25))  # -> Points, ParamsA, ParamsB
shift_5 = ShiftPaths(Data=ccx_12.Points, Offset=-1)
sort_13 = SortList(Keys=shift_5, ValuesA=shift_5)  # -> Keys, ValuesA
pull_20 = PullPoint(Point=sort_13.ValuesA, Geometry=graft(pln_29), ClosestOnly=True)  # -> ClosestPoint, Distance
sort_14 = SortList(Keys=pull_20.Distance, ValuesA=sort_13.ValuesA)  # -> Keys, ValuesA

# ---- group: 最远交点
item_46 = ListItem(List=sort_14.ValuesA, Index="-1", Wrap=True)

# ----
null_9 = NullItem(Item=flatten(item_46))  # -> NullFlags, InvalidFlags, Description
dispatch_43 = Dispatch(List=simplify(item_46), DispatchPattern=simplify(graft(null_9.InvalidFlags)))  # -> ListA, ListB
dispatch_44 = Dispatch(List=pln_29, DispatchPattern=null_9.InvalidFlags)  # -> ListA, ListB
pln_37 = Plane(dispatch_44.ListB)
pt_36 = Point(dispatch_43.ListB)

# ----
# 按照梁分类定位点
pln_38 = Plane(pln_37)
pt_37 = Point(pt_36)
incurves_13 = PointInCurves(Point=flatten(pt_37), Curves=crv_65)  # -> Relationship, Index, Point
equals_15 = Equality(FirstNumber=incurves_13.Relationship, SecondNumber="0")  # -> Equality, Inequality
dispatch_45 = Dispatch(List=flatten(pln_38), DispatchPattern=equals_15.Inequality)  # -> ListA, ListB
data_44 = Data(dispatch_45.ListA)

# ----
# 按照梁分类定位点
pt_38 = Point(pt_36)
incurves_14 = PointInCurves(Point=flatten(pt_38), Curves=crv_65)  # -> Relationship, Index, Point
equals_16 = Equality(FirstNumber=incurves_14.Relationship, SecondNumber="0")  # -> Equality, Inequality
dispatch_46 = Dispatch(List=flatten(pt_38), DispatchPattern=equals_16.Inequality)  # -> ListA, ListB
data_45 = Data(dispatch_46.ListA)

move2pt_11 = MoveToPoint(Geometry=data_44, PointA=data_44, PointB=data_45)  # -> Moved, Vector, Transform
null_10 = NullItem(Item=move2pt_11.Moved)  # -> NullFlags, InvalidFlags, Description
dispatch_47 = Dispatch(List=move2pt_11.Moved, DispatchPattern=null_10.InvalidFlags)  # -> ListA, ListB
pln_39 = Plane(dispatch_47.ListB)

# ----
# 撞到梁交点
pln_40 = Plane(pln_39)
pln_41 = Plane(pln_36)

merge_26 = Merge(Data1=pln_30, Data2=pln_40, Data3=pln_41)
pln_42 = Plane(dispatch_44.ListA)
orient_4 = Orient(Geometry=item_18, Source=item_19, Target=merge_26)  # -> Geometry, Transform

data_46 = Data(orient_4.Geometry)
ungroup_5 = Ungroup(Group=data_46)
item_47 = ListItem(List=ungroup_5, Index=0, Wrap=True)  # -> flatten(Item)
item_48 = ListItem(List=ungroup_5, Index="-1", Wrap=True)  # -> flatten(Item)

entwine_20 = Entwine(Branch00=item_47, Branch01=item_48, FlattenInputs=True)
bake_3 = BakeObjects(Geometry=entwine_20, Attributes=attributes_5, BakeName="Embed::1-1-02钢板焊埋件", Bake=False)

# ----
# 未生成檐口线
pt_39 = Point(pln_42)

# ----
# （10）需人工排布
pt_40 = Point(pt_39)
bake_4 = BakeObjects(Geometry=pt_40, Attributes=attributes_3, BakeName=panel_59, Bake=False)

# ---- group: 下层交点-除重 (continued)
pull_21 = PullPoint(Point=ccx_10.Points, Geometry=deplane_19.Origin, ClosestOnly=True)  # -> ClosestPoint, Distance
pull_22 = PullPoint(Point=ccx_9.Points, Geometry=deplane_20.Origin, ClosestOnly=True)  # -> ClosestPoint, Distance
sort_15 = SortList(Keys=pull_22.Distance, ValuesA=ccx_9.Points)  # -> Keys, ValuesA
sort_16 = SortList(Keys=pull_21.Distance, ValuesA=ccx_10.Points)  # -> Keys, ValuesA
item_49 = ListItem(List=sort_15.ValuesA, Index=0, Wrap=True)  # -> flatten(Item)
item_50 = ListItem(List=sort_16.ValuesA, Index=0, Wrap=True)  # -> flatten(Item)
null_11 = NullItem(Item=item_49)  # -> NullFlags, InvalidFlags, Description
null_12 = NullItem(Item=item_50)  # -> NullFlags, InvalidFlags, Description
dispatch_48 = Dispatch(List=item_49, DispatchPattern=null_11.NullFlags)  # -> ListA, ListB
dispatch_49 = Dispatch(List=item_50, DispatchPattern=null_12.NullFlags)  # -> ListA, ListB

pt_41 = Point(dispatch_48.ListB)

# ---- group: 下层交点-除重 / 上层交点-除重
pt_42 = Point(dispatch_49.ListB)

# ---- group: 下层交点-除重 (continued)
pull_23 = PullPoint(Point=pt_41, Geometry=pt_42, ClosestOnly=True)  # -> ClosestPoint, Distance
sort_17 = SortList(Keys=pull_23.Distance, ValuesA=pull_23.ClosestPoint)  # -> Keys, ValuesA
panel_69 = Panel(sort_17.Keys)
larger_8 = LargerThan(FirstNumber=pull_23.Distance, SecondNumber=number_slider_32)  # -> LargerThan, OrEqualTo
dispatch_50 = Dispatch(List=pt_41, DispatchPattern=larger_8.LargerThan)  # -> ListA, ListB
pull_24 = PullPoint(Point=deplane_20.Origin, Geometry=graft(pt_41), ClosestOnly=True)  # -> ClosestPoint, Distance
sort_18 = SortList(Keys=pull_24.Distance, ValuesA=pln_33)  # -> Keys, ValuesA
item_51 = ListItem(List=sort_18.ValuesA, Index=0, Wrap=True)
check_same_points_4 = CheckSamePoints(archPoint=pln_33, crvPoint=flatten(item_51))  # -> out, specialPt; inputs archPoint: list of Point3d, crvPoint: list of Point3d; same code as testpoint
cull_i_9 = CullIndex(List=pln_33, Indices=check_same_points_4.specialPt, Wrap=True)

# ---- group: 下层交点-除重 / 2组交点距离大于容差-默认不同点
dispatch_51 = Dispatch(List=pull_23.ClosestPoint, DispatchPattern=larger_8.LargerThan)  # -> ListA, ListB

# ---- group: 下层交点-除重 / 大于容差算作新点
pt_43 = Point(dispatch_51.ListA)

# ---- group: 下层交点-除重 / 有效Plane-下层建筑线在该处连续
item_52 = ListItem(List=pln_33, Index=check_same_points_4.specialPt, Wrap=True)

# ----
cull_i_10 = CullIndex(List=pln_33, Indices=check_same_points_4.specialPt, Wrap=True)
merge_27 = Merge(Data1=cull_i_10, Data2=pln_21)  # -> flatten(Result)

# ----
# 和下层楼板发生关系的定位点
pln_43 = Plane(merge_27)

# ---- group: 起始Plane
pln_44 = Plane(pln_43)

# ----
pln_45 = Plane(pln_44)
number_slider_52 = Slider(3584, range=0..10000)
deplane_21 = DeconstructPlane(Plane=pln_45)  # -> Origin, XAxis, YAxis, ZAxis
crv_76 = Curve(merge_25)
boundary_3 = BoundarySurfaces(Edges=[offset_5, offset_4])
scx = SurfaceCurve(Surface=boundary_3, Curve=crv_76)  # -> flatten(Curves), Points, UVPoints, Normals, Parameters, Tangents
amp_20 = Amplitude(Vector=deplane_21.YAxis, Amplitude=number_slider_52)
amp_21 = Amplitude(Vector=deplane_21.YAxis, Amplitude=expr("-x", number_slider_52))
move_28 = Move(Geometry=deplane_21.Origin, Motion=amp_21)  # -> Geometry, Transform
move_29 = Move(Geometry=deplane_21.Origin, Motion=amp_20)  # -> Geometry, Transform
ln_22 = Line(StartPoint=move_28.Geometry, EndPoint=move_29.Geometry)
ccx_13 = CurveCurve(CurveA=graft(ln_22), CurveB=scx.Curves)  # -> Points, ParamsA, ParamsB
shift_6 = ShiftPaths(Data=ccx_13.Points, Offset=-1)
pull_25 = PullPoint(Point=graft(pln_45), Geometry=shift_6, ClosestOnly=True)  # -> ClosestPoint, Distance
sort_19 = SortList(Keys=pull_25.Distance, ValuesA=pull_25.ClosestPoint)  # -> Keys, ValuesA
item_53 = ListItem(List=sort_19.ValuesA, Index=0, Wrap=True)
null_13 = NullItem(Item=item_53)  # -> NullFlags, simplify(InvalidFlags), Description
null_14 = NullItem(Item=sort_19.ValuesA)  # -> NullFlags, simplify(InvalidFlags), Description
dispatch_52 = Dispatch(List=simplify(graft(pln_45)), DispatchPattern=null_14.InvalidFlags)  # -> ListA, ListB
dispatch_53 = Dispatch(List=simplify(graft(item_53)), DispatchPattern=null_13.InvalidFlags)  # -> ListA, ListB
pln_46 = Plane(dispatch_52.ListB)
pln_47 = Plane(dispatch_52.ListA)
pt_44 = Point(dispatch_53.ListB)

# ----
# 可能的结构交点-大量
pln_48 = Plane(pln_47)

# ----
# 0 檐口出定位点
# 与结构无交点
pln_49 = Plane(flatten(pln_48))

# ---- group: 下层交点-除重 (continued)
pull_26 = PullPoint(Point=pt_43, Geometry=pt_32, ClosestOnly=True)  # -> ClosestPoint, Distance
check_same_points_5 = CheckSamePoints(archPoint=pt_32, crvPoint=flatten(pull_26.ClosestPoint))  # -> out, specialPt; inputs archPoint: list of Point3d, crvPoint: list of Point3d; same code as testpoint

# ---- group: 下层交点-除重 / 有效Plane-上层建筑线在该处连续
item_54 = ListItem(List=pln_27, Index=check_same_points_5.specialPt, Wrap=True)

# ---- group: 下层交点-除重 (continued)
merge_28 = Merge(Data1=item_52, Data2=item_54)
deplane_22 = DeconstructPlane(Plane=merge_28)  # -> Origin, XAxis, YAxis, ZAxis
amp_22 = Amplitude(Vector=deplane_22.YAxis, Amplitude=expr("-x", number_slider_51))
move_30 = Move(Geometry=deplane_22.Origin, Motion=amp_22)  # -> Geometry, Transform

# ---- group: 下层交点-除重 / 相内探索
ln_23 = Line(StartPoint=deplane_22.Origin, EndPoint=move_30.Geometry)

# ---- group: 下层交点-除重 (continued)
ccx_14 = CurveCurve(CurveA=graft(ln_23), CurveB=flatten(crv_66))  # -> Points, ParamsA, ParamsB
shift_7 = ShiftPaths(Data=ccx_14.Points, Offset=-1)
pull_27 = PullPoint(Point=deplane_22.Origin, Geometry=shift_7, ClosestOnly=True)  # -> ClosestPoint, Distance
sort_20 = SortList(Keys=pull_27.Distance, ValuesA=pull_27.ClosestPoint)  # -> Keys, ValuesA

# ---- group: 下层交点-除重 / 与梁最近交点
item_55 = ListItem(List=sort_20.ValuesA, Index=0, Wrap=True)

# ---- group: 下层交点-除重 (continued)
null_15 = NullItem(Item=flatten(item_55))  # -> NullFlags, InvalidFlags, Description
dispatch_54 = Dispatch(List=merge_28, DispatchPattern=null_15.InvalidFlags)  # -> ListA, ListB
dispatch_55 = Dispatch(List=flatten(item_55), DispatchPattern=null_15.InvalidFlags)  # -> ListA, ListB

# ---- group: 下层交点-除重 / 有效起始Plane
data_47 = Data(dispatch_54.ListB)

# ---- group: 下层交点-除重 / 去除Null的交点
data_48 = Data(dispatch_55.ListB)

# ---- group: 下层交点-除重 (continued)
flatten_8 = FlattenTree(Tree=data_48, Path="{0}")
move2pt_12 = MoveToPoint(Geometry=data_47, PointA=data_47, PointB=flatten(data_48))  # -> Moved, Vector, Transform
ln_24 = Line(StartPoint=data_47, EndPoint=flatten_8)
len_4 = Length(Curve=ln_24)
sort_21 = SortList(Keys=len_4)  # -> reverse(Keys), ValuesA

# ----
# 与梁无交点的定位点
pln_50 = Plane(dispatch_54.ListA)

# ----
# 1.0
number_slider_53 = Slider(50, range=0..100)
number = NumberGroups(Number=sort_21.Keys, Difference=number_slider_53)  # -> simplify(Groups), Indices
panel_70 = Panel(number.Groups)
tstat_2 = TreeStatistics(Tree=number.Groups)  # -> Paths, Length, Count
lng_3 = ListLength(List=tstat_2.Paths)
smaller_7 = SmallerThan(FirstNumber=lng_3, SecondNumber="2")  # -> SmallerThan, OrEqualTo
dispatch_56 = Dispatch(List=smaller_7.SmallerThan, DispatchPattern=[True, False])  # -> ListA, ListB
filter_12 = StreamFilter(Gate=dispatch_56.ListA, Stream0="-2", Stream1="-1")
item_56 = ListItem(List=tstat_2.Paths, Index=filter_12, Wrap=True)
branch = TreeBranch(Tree=number.Groups, Path=item_56, MaintainPaths=True)
sort_22 = SortList(Keys=branch)  # -> reverse(Keys), ValuesA
round_2 = Round(Number=sort_22.Keys)  # -> Nearest, Floor, Ceiling
item_57 = ListItem(List=round_2.Ceiling, Index=0, Wrap=True)

# ----
# 挑出反常点-交点距离起始点过远
list_9 = ValueList({"自己输入Value": 0, "GH Defaut Value": 1}, selected="GH Defaut Value")
panel_71 = Panel(item_57)
filter_13 = StreamFilter(Gate=list_9, Stream0=Slider(1000, range=0..10000), Stream1=panel_71)

larger_9 = LargerThan(FirstNumber=len_4, SecondNumber=filter_13)  # -> LargerThan, OrEqualTo
dispatch_57 = Dispatch(List=flatten_8, DispatchPattern=larger_9.LargerThan)  # -> ListA, ListB
dispatch_58 = Dispatch(List=data_47, DispatchPattern=larger_9.LargerThan)  # -> ListA, ListB
data_49 = Data(dispatch_58.ListB)
data_50 = Data(dispatch_57.ListB)

# ----
# 按照梁分类定位点
pt_45 = Point(data_50)
pln_51 = Plane(data_49)
incurves_15 = PointInCurves(Point=flatten(pt_45), Curves=crv_67)  # -> Relationship, Index, Point
equals_17 = Equality(FirstNumber=incurves_15.Relationship, SecondNumber="0")  # -> Equality, Inequality
dispatch_59 = Dispatch(List=flatten(pln_51), DispatchPattern=equals_17.Inequality)  # -> ListA, ListB
data_51 = Data(dispatch_59.ListA)

incurves_16 = PointInCurves(Point=flatten(pt_45), Curves=crv_67)  # -> Relationship, Index, Point
equals_18 = Equality(FirstNumber=incurves_16.Relationship, SecondNumber="0")  # -> Equality, Inequality
dispatch_60 = Dispatch(List=flatten(pt_45), DispatchPattern=equals_18.Inequality)  # -> ListA, ListB
data_52 = Data(dispatch_60.ListA)

move2pt_13 = MoveToPoint(Geometry=data_51, PointA=data_51, PointB=data_52)  # -> Moved, Vector, Transform
null_16 = NullItem(Item=move2pt_13.Moved)  # -> NullFlags, InvalidFlags, Description
dispatch_61 = Dispatch(List=move2pt_13.Moved, DispatchPattern=null_16.InvalidFlags)  # -> ListA, ListB
pln_52 = Plane(dispatch_61.ListB)

# ----
# 离梁过远的定位点
pln_53 = Plane(dispatch_58.ListA)

# ----
# 1.0无檐口线
# 与梁不相交
merge_29 = Merge(Data1=pln_50, Data2=pln_53)

# ----
# 0 檐口出定位点
# 与结构无交点
pln_54 = Plane(flatten(merge_29))

# ----
# 1.0.Missing Point
# 埋件定位点Offset，没有找到和梁的交点
number_slider_54 = Slider(5000, range=0..10000)
deplane_23 = DeconstructPlane(Plane=pln_54)  # -> Origin, XAxis, YAxis, ZAxis
amp_23 = Amplitude(Vector=deplane_23.YAxis, Amplitude=expr("-x", number_slider_54))
move_31 = Move(Geometry=deplane_23.Origin, Motion=amp_23)  # -> Geometry, Transform
ln_25 = Line(StartPoint=move_31.Geometry, EndPoint=deplane_23.Origin)
crv_77 = Curve(crv_66)
amp_24 = Amplitude(Vector=deplane_23.XAxis, Amplitude=number_slider_20)
amp_25 = Amplitude(Vector=deplane_23.XAxis, Amplitude=expr("-x", number_slider_20))

# ---- group: 2组探索针
move_32 = Move(Geometry=ln_25, Motion=amp_25)  # -> Geometry, Transform
move_33 = Move(Geometry=ln_25, Motion=amp_24)  # -> Geometry, Transform

# ----
ccx_15 = CurveCurve(CurveA=graft(move_32.Geometry), CurveB=flatten(crv_77))  # -> Points, ParamsA, ParamsB
shift_8 = ShiftPaths(Data=ccx_15.Points, Offset=-1)
sort_23 = SortList(Keys=shift_8, ValuesA=shift_8)  # -> Keys, ValuesA
pull_28 = PullPoint(Point=sort_23.ValuesA, Geometry=graft(pln_54), ClosestOnly=True)  # -> ClosestPoint, Distance
sort_24 = SortList(Keys=pull_28.Distance, ValuesA=sort_23.ValuesA)  # -> Keys, ValuesA
item_58 = ListItem(List=sort_24.ValuesA, Index="0", Wrap=True)
null_17 = NullItem(Item=flatten(item_58))  # -> NullFlags, InvalidFlags, Description
dispatch_62 = Dispatch(List=simplify(item_58), DispatchPattern=simplify(graft(null_17.InvalidFlags)))  # -> ListA, ListB
dispatch_63 = Dispatch(List=pln_54, DispatchPattern=null_17.InvalidFlags)  # -> ListA, ListB
pln_55 = Plane(dispatch_63.ListB)
pt_46 = Point(dispatch_62.ListB)

ccx_16 = CurveCurve(CurveA=graft(move_33.Geometry), CurveB=flatten(crv_77))  # -> Points, ParamsA, ParamsB
shift_9 = ShiftPaths(Data=ccx_16.Points, Offset=-1)
sort_25 = SortList(Keys=shift_9, ValuesA=shift_9)  # -> Keys, ValuesA
pull_29 = PullPoint(Point=sort_25.ValuesA, Geometry=graft(pln_54), ClosestOnly=True)  # -> ClosestPoint, Distance
sort_26 = SortList(Keys=pull_29.Distance, ValuesA=sort_25.ValuesA)  # -> Keys, ValuesA
item_59 = ListItem(List=sort_26.ValuesA, Index="0", Wrap=True)
null_18 = NullItem(Item=flatten(item_59))  # -> NullFlags, InvalidFlags, Description
dispatch_64 = Dispatch(List=simplify(item_59), DispatchPattern=simplify(graft(null_18.InvalidFlags)))  # -> ListA, ListB
dispatch_65 = Dispatch(List=pln_54, DispatchPattern=null_18.InvalidFlags)  # -> ListA, ListB
pt_47 = Point(dispatch_64.ListB)
pln_56 = Plane(dispatch_65.ListB)

# ----
# 按照梁分类定位点
pln_57 = Plane(pln_56)
pt_48 = Point(pt_47)
incurves_17 = PointInCurves(Point=flatten(pt_48), Curves=crv_68)  # -> Relationship, Index, Point
equals_19 = Equality(FirstNumber=incurves_17.Relationship, SecondNumber="0")  # -> Equality, Inequality
dispatch_66 = Dispatch(List=flatten(pln_57), DispatchPattern=equals_19.Inequality)  # -> ListA, ListB
data_53 = Data(dispatch_66.ListA)

# ----
# 按照梁分类定位点
pln_58 = Plane(pln_55)
pt_49 = Point(pt_46)
incurves_18 = PointInCurves(Point=flatten(pt_49), Curves=crv_68)  # -> Relationship, Index, Point
equals_20 = Equality(FirstNumber=incurves_18.Relationship, SecondNumber="0")  # -> Equality, Inequality
dispatch_67 = Dispatch(List=flatten(pln_58), DispatchPattern=equals_20.Inequality)  # -> ListA, ListB
data_54 = Data(dispatch_67.ListA)

incurves_19 = PointInCurves(Point=flatten(pt_49), Curves=crv_68)  # -> Relationship, Index, Point
# 阳角
# 阴角
panel_72 = Panel("0")
equals_21 = Equality(FirstNumber=incurves_19.Relationship, SecondNumber=panel_72)  # -> Equality, Inequality
dispatch_68 = Dispatch(List=flatten(pt_49), DispatchPattern=equals_21.Inequality)  # -> ListA, ListB
# 阳角
# 阴角
data_55 = Data(dispatch_68.ListA)

incurves_20 = PointInCurves(Point=flatten(pt_48), Curves=crv_68)  # -> Relationship, Index, Point
equals_22 = Equality(FirstNumber=incurves_20.Relationship, SecondNumber="0")  # -> Equality, Inequality
dispatch_69 = Dispatch(List=flatten(pt_48), DispatchPattern=equals_22.Inequality)  # -> ListA, ListB
data_56 = Data(dispatch_69.ListA)

move2pt_14 = MoveToPoint(Geometry=data_53, PointA=data_53, PointB=data_56)  # -> Moved, Vector, Transform
null_19 = NullItem(Item=move2pt_14.Moved)  # -> NullFlags, InvalidFlags, Description
dispatch_70 = Dispatch(List=move2pt_14.Moved, DispatchPattern=null_19.InvalidFlags)  # -> ListA, ListB
pln_59 = Plane(dispatch_70.ListB)

move2pt_15 = MoveToPoint(Geometry=data_54, PointA=data_54, PointB=data_55)  # -> Moved, Vector, Transform
null_20 = NullItem(Item=move2pt_15.Moved)  # -> NullFlags, InvalidFlags, Description
dispatch_71 = Dispatch(List=move2pt_15.Moved, DispatchPattern=null_20.InvalidFlags)  # -> ListA, ListB
pln_60 = Plane(dispatch_71.ListB)

# ----
# 撞到梁交点
merge_30 = Merge(Data1=pln_59, Data2=pln_60)

# ----
# 1.0无檐口线+上下层幕墙边线连续
# 01：钢板焊埋件[钢梁外侧]
# @钢边梁宽@钢边梁高
pln_61 = Plane(pln_52)

merge_31 = Merge(Data1=pln_61, Data2=merge_30)
orient_5 = Orient(Geometry=item_20, Source=item_21, Target=merge_31)  # -> Geometry, Transform

data_57 = Data(orient_5.Geometry)
ungroup_6 = Ungroup(Group=data_57)
item_60 = ListItem(List=ungroup_6, Index=0, Wrap=True)  # -> flatten(Item)
item_61 = ListItem(List=ungroup_6, Index="-1", Wrap=True)  # -> flatten(Item)

entwine_21 = Entwine(Branch00=item_60, Branch01=item_61, FlattenInputs=True)
bake_5 = BakeObjects(Geometry=entwine_21, Attributes=attributes_7, BakeName="Embed::1-0-01钢板焊埋件", Bake=False)

# ----
# 2是否有吊顶
# 梁以内>350
deplane_24 = DeconstructPlane(Plane=pln_43)  # -> Origin, XAxis, YAxis, ZAxis
number_slider_55 = Slider(5000, range=0..10000)
amp_26 = Amplitude(Vector=deplane_24.YAxis, Amplitude=expr("-x", number_slider_55))
amp_27 = Amplitude(Vector=deplane_24.YAxis, Amplitude=number_slider_55)
move_34 = Move(Geometry=deplane_24.Origin, Motion=amp_27)  # -> Geometry, Transform
move_35 = Move(Geometry=deplane_24.Origin, Motion=amp_26)  # -> Geometry, Transform
ln_26 = Line(StartPoint=move_34.Geometry, EndPoint=move_35.Geometry)
crv_78 = Curve(crv_27)
crv_79 = Curve(merge_24)

# ---- group: 和下层建筑的交点
ccx_17 = CurveCurve(CurveA=ln_26, CurveB=crv_78)  # -> Points, ParamsA, ParamsB

# ----
null_21 = NullItem(Item=ccx_17.Points)  # -> NullFlags, InvalidFlags, Description
dispatch_72 = Dispatch(List=simplify(ccx_17.Points), DispatchPattern=simplify(null_21.NullFlags))  # -> ListA, ListB
dispatch_73 = Dispatch(List=simplify(graft(pln_43)), DispatchPattern=simplify(null_21.NullFlags))  # -> ListA, ListB
pt_50 = Point(dispatch_72.ListB)
pln_62 = Plane(flatten(dispatch_73.ListB))
pt_51 = Point(pln_62)
pull_30 = PullPoint(Point=flatten(pt_51), Geometry=flatten(pt_50), ClosestOnly=True)  # -> ClosestPoint, Distance
ln_27 = Line(StartPoint=pln_62, EndPoint=pull_30.ClosestPoint)

# ----
# 定位点Project到下层建筑线
move2pt_16 = MoveToPoint(Geometry=pln_62, PointA=pln_62, PointB=pull_30.ClosestPoint)  # -> Moved, Vector, Transform

# ----
# 可能的点-离结构很远
pln_63 = Plane(dispatch_73.ListA)

deplane_25 = DeconstructPlane(Plane=move2pt_16.Moved)  # -> Origin, XAxis, YAxis, ZAxis
amp_28 = Amplitude(Vector=deplane_25.YAxis, Amplitude=Slider(5000, range=0..10000))
move_36 = Move(Geometry=deplane_25.Origin, Motion=amp_28)  # -> Geometry, Transform
ln_28 = Line(StartPoint=move_36.Geometry, EndPoint=deplane_25.Origin)

# ---- group: 和内测梁交点
ccx_18 = CurveCurve(CurveA=graft(ln_28), CurveB=flatten(crv_79))  # -> simplify(Points), ParamsA, ParamsB

# ----
shift_10 = ShiftPaths(Data=ccx_18.Points, Offset=-1)
null_22 = NullItem(Item=shift_10)  # -> NullFlags, InvalidFlags, Description
dispatch_74 = Dispatch(List=simplify(graft(move2pt_16.Moved)), DispatchPattern=null_22.NullFlags)  # -> ListA, ListB
dispatch_75 = Dispatch(List=simplify(graft(ln_28)), DispatchPattern=null_22.NullFlags)  # -> ListA, ListB
pln_64 = Plane(dispatch_74.ListA)
crv_80 = Curve(dispatch_75.ListB)
pln_65 = Plane(dispatch_74.ListB)
ccx_19 = CurveCurve(CurveA=graft(crv_80), CurveB=flatten(crv_79))  # -> Points, ParamsA, ParamsB
shift_11 = ShiftPaths(Data=simplify(ccx_19.Points), Offset=-1)
pull_31 = PullPoint(Point=pln_65, Geometry=shift_11, ClosestOnly=True)  # -> ClosestPoint, Distance
sort_27 = SortList(Keys=pull_31.Distance, ValuesA=pull_31.ClosestPoint)  # -> Keys, ValuesA

# ---- group: 交点对应的起始定位点
item_62 = ListItem(List=sort_27.ValuesA, Index=0, Wrap=True)

# ----
ln_29 = Line(StartPoint=pln_65, EndPoint=item_62)
len_5 = Length(Curve=ln_29)
larger_10 = LargerThan(FirstNumber=len_5, SecondNumber=number_slider_33)  # -> LargerThan, OrEqualTo
panel_73 = Panel(len_5)
dispatch_76 = Dispatch(List=item_62, DispatchPattern=larger_10.LargerThan)  # -> ListA, ListB
dispatch_77 = Dispatch(List=pln_65, DispatchPattern=larger_10.LargerThan)  # -> ListA, ListB
pln_66 = Plane(dispatch_77.ListB)

# ---- group: 起始点
pt_52 = Point(dispatch_76.ListA)

# ---- group: 最终Plane
pln_67 = Plane(dispatch_77.ListA)

# ---- group: 分类后的Plane
# 按照梁分类定位点
pln_68 = Plane(pln_67)
pt_53 = Point(pt_52)
incurves_21 = PointInCurves(Point=flatten(pt_53), Curves=crv_69)  # -> Relationship, Index, Point
equals_23 = Equality(FirstNumber=incurves_21.Relationship, SecondNumber="0")  # -> Equality, Inequality
dispatch_78 = Dispatch(List=flatten(pln_68), DispatchPattern=equals_23.Inequality)  # -> ListA, ListB
data_58 = Data(dispatch_78.ListA)

incurves_22 = PointInCurves(Point=flatten(pt_53), Curves=crv_69)  # -> Relationship, Index, Point
# SmoothCurve-阴角
# SmoothCurve-阳角
# SmoothCurve-阴角
# SmoothCurve-正常
# Angular Curve - All
# Special Curve(with location)- All
# Curve for this project only - All
panel_74 = Panel("0")
equals_24 = Equality(FirstNumber=incurves_22.Relationship, SecondNumber=panel_74)  # -> Equality, Inequality
dispatch_79 = Dispatch(List=flatten(pt_53), DispatchPattern=equals_24.Inequality)  # -> ListA, ListB
data_59 = Data(dispatch_79.ListA)

move2pt_17 = MoveToPoint(Geometry=data_58, PointA=data_58, PointB=data_59)  # -> Moved, Vector, Transform
null_23 = NullItem(Item=move2pt_17.Moved)  # -> NullFlags, InvalidFlags, Description
dispatch_80 = Dispatch(List=move2pt_17.Moved, DispatchPattern=null_23.InvalidFlags)  # -> ListA, ListB

pln_69 = Plane(dispatch_80.ListB)

# ----
# 可能的结构交点-大量
pln_70 = Plane(pln_64)

# ----
# 可能的结构交点
pln_71 = Plane(pln_66)

# ----
# 这里如果跑红也不要紧，
# 说明单体没有出现相撞的情况
# 2.1 梁以内>350
# 
# 侧埋，钢板焊
# 03：钢板焊埋件[钢梁内侧]
# @钢边梁宽@钢边梁高
pln_72 = Plane(pln_69)

# ----
# 2.1 Missing Point
# 埋件定位点Offset，没有找到和梁的交点
merge_32 = Merge(Data1=pln_63, Data2=pln_71, Data3=pln_70)
crv_81 = Curve(crv_79)

# ----
# 0 檐口出定位点
# 与结构无交点
pln_73 = Plane(flatten(merge_32))

deplane_26 = DeconstructPlane(Plane=pln_73)  # -> Origin, XAxis, YAxis, ZAxis
amp_29 = Amplitude(Vector=deplane_26.YAxis, Amplitude=Slider(5000, range=0..10000))
move_37 = Move(Geometry=deplane_26.Origin, Motion=amp_29)  # -> Geometry, Transform
ln_30 = Line(StartPoint=move_37.Geometry, EndPoint=deplane_26.Origin)
amp_30 = Amplitude(Vector=deplane_26.XAxis, Amplitude=number_slider_20)
amp_31 = Amplitude(Vector=deplane_26.XAxis, Amplitude=expr("-x", number_slider_20))
move_38 = Move(Geometry=ln_30, Motion=amp_30)  # -> Geometry, Transform
move_39 = Move(Geometry=ln_30, Motion=amp_31)  # -> Geometry, Transform

ccx_20 = CurveCurve(CurveA=graft(move_38.Geometry), CurveB=flatten(crv_81))  # -> Points, ParamsA, ParamsB
shift_12 = ShiftPaths(Data=ccx_20.Points, Offset=-1)
sort_28 = SortList(Keys=shift_12, ValuesA=shift_12)  # -> Keys, ValuesA
pull_32 = PullPoint(Point=sort_28.ValuesA, Geometry=graft(pln_73), ClosestOnly=True)  # -> ClosestPoint, Distance
sort_29 = SortList(Keys=pull_32.Distance, ValuesA=sort_28.ValuesA)  # -> Keys, ValuesA
item_63 = ListItem(List=sort_29.ValuesA, Index="-1", Wrap=True)
null_24 = NullItem(Item=flatten(item_63))  # -> NullFlags, InvalidFlags, Description
end_6 = EndPoints(Curve=move_38.Geometry)  # -> Start, End
dispatch_81 = Dispatch(List=graft(pln_73), DispatchPattern=graft(null_24.InvalidFlags))  # -> ListA, ListB
dispatch_82 = Dispatch(List=simplify(item_63), DispatchPattern=simplify(graft(null_24.InvalidFlags)))  # -> ListA, ListB
pt_54 = Point(dispatch_82.ListB)
pln_74 = Plane(dispatch_81.ListB)
dispatch_83 = Dispatch(List=simplify(graft(end_6.End)), DispatchPattern=simplify(graft(null_24.InvalidFlags)))  # -> ListA, ListB
pt_55 = Point(dispatch_83.ListB)
ln_31 = Line(StartPoint=pt_55, EndPoint=pt_54)
len_6 = Length(Curve=ln_31)
larger_11 = LargerThan(FirstNumber=len_6, SecondNumber=Slider(350, range=0..1000))  # -> LargerThan, OrEqualTo
dispatch_84 = Dispatch(List=pln_74, DispatchPattern=larger_11.LargerThan)  # -> ListA, ListB
dispatch_85 = Dispatch(List=pt_55, DispatchPattern=larger_11.LargerThan)  # -> ListA, ListB
pln_75 = Plane(dispatch_84.ListA)
pt_56 = Point(dispatch_85.ListA)

ccx_21 = CurveCurve(CurveA=graft(move_39.Geometry), CurveB=flatten(crv_81))  # -> Points, ParamsA, ParamsB
shift_13 = ShiftPaths(Data=ccx_21.Points, Offset=-1)
sort_30 = SortList(Keys=shift_13, ValuesA=shift_13)  # -> Keys, ValuesA
pull_33 = PullPoint(Point=sort_30.ValuesA, Geometry=graft(pln_73), ClosestOnly=True)  # -> ClosestPoint, Distance
sort_31 = SortList(Keys=pull_33.Distance, ValuesA=sort_30.ValuesA)  # -> Keys, ValuesA
item_64 = ListItem(List=sort_31.ValuesA, Index="-1", Wrap=True)
null_25 = NullItem(Item=flatten(item_64))  # -> NullFlags, InvalidFlags, Description
end_7 = EndPoints(Curve=move_39.Geometry)  # -> Start, End
dispatch_86 = Dispatch(List=simplify(item_64), DispatchPattern=simplify(graft(null_25.InvalidFlags)))  # -> ListA, ListB
dispatch_87 = Dispatch(List=graft(pln_73), DispatchPattern=flatten(null_25.InvalidFlags))  # -> ListA, ListB
dispatch_88 = Dispatch(List=simplify(graft(end_7.End)), DispatchPattern=simplify(graft(null_25.InvalidFlags)))  # -> ListA, ListB
pln_76 = Plane(dispatch_87.ListB)
pt_57 = Point(dispatch_86.ListB)
pt_58 = Point(dispatch_88.ListB)
ln_32 = Line(StartPoint=pt_58, EndPoint=pt_54)
len_7 = Length(Curve=ln_32)
larger_12 = LargerThan(FirstNumber=len_7, SecondNumber=Slider(350, range=0..1000))  # -> LargerThan, OrEqualTo
dispatch_89 = Dispatch(List=pln_76, DispatchPattern=larger_12.LargerThan)  # -> ListA, ListB
dispatch_90 = Dispatch(List=pt_58, DispatchPattern=larger_12.LargerThan)  # -> ListA, ListB
pln_77 = Plane(dispatch_89.ListA)
pt_59 = Point(dispatch_90.ListA)

# ----
# 按照梁分类定位点
pln_78 = Plane(pln_75)
pt_60 = Point(pt_56)
incurves_23 = PointInCurves(Point=flatten(pt_60), Curves=crv_70)  # -> Relationship, Index, Point
equals_25 = Equality(FirstNumber=incurves_23.Relationship, SecondNumber="0")  # -> Equality, Inequality
dispatch_91 = Dispatch(List=flatten(pln_78), DispatchPattern=equals_25.Inequality)  # -> ListA, ListB
data_60 = Data(dispatch_91.ListA)

# ----
# 按照梁分类定位点
pln_79 = Plane(pln_77)
pt_61 = Point(pt_59)
incurves_24 = PointInCurves(Point=flatten(pt_61), Curves=crv_70)  # -> Relationship, Index, Point
equals_26 = Equality(FirstNumber=incurves_24.Relationship, SecondNumber="0")  # -> Equality, Inequality
dispatch_92 = Dispatch(List=flatten(pln_79), DispatchPattern=equals_26.Inequality)  # -> ListA, ListB
data_61 = Data(dispatch_92.ListA)

incurves_25 = PointInCurves(Point=flatten(pt_61), Curves=crv_70)  # -> Relationship, Index, Point
equals_27 = Equality(FirstNumber=incurves_25.Relationship, SecondNumber="0")  # -> Equality, Inequality
dispatch_93 = Dispatch(List=flatten(pt_61), DispatchPattern=equals_27.Inequality)  # -> ListA, ListB
data_62 = Data(dispatch_93.ListA)

incurves_26 = PointInCurves(Point=flatten(pt_60), Curves=crv_70)  # -> Relationship, Index, Point
equals_28 = Equality(FirstNumber=incurves_26.Relationship, SecondNumber="0")  # -> Equality, Inequality
dispatch_94 = Dispatch(List=flatten(pt_60), DispatchPattern=equals_28.Inequality)  # -> ListA, ListB
data_63 = Data(dispatch_94.ListA)

move2pt_18 = MoveToPoint(Geometry=data_60, PointA=data_60, PointB=data_63)  # -> Moved, Vector, Transform
null_26 = NullItem(Item=move2pt_18.Moved)  # -> NullFlags, InvalidFlags, Description
dispatch_95 = Dispatch(List=move2pt_18.Moved, DispatchPattern=null_26.InvalidFlags)  # -> ListA, ListB

move2pt_19 = MoveToPoint(Geometry=data_61, PointA=data_61, PointB=data_62)  # -> Moved, Vector, Transform
null_27 = NullItem(Item=move2pt_19.Moved)  # -> NullFlags, InvalidFlags, Description
dispatch_96 = Dispatch(List=move2pt_19.Moved, DispatchPattern=null_27.InvalidFlags)  # -> ListA, ListB
pln_80 = Plane(dispatch_96.ListB)

# ---- group: 2次筛选所得
pln_81 = Plane(dispatch_95.ListB)

# ----
# 撞到梁交点
merge_33 = Merge(Data1=pln_81, Data2=pln_80)

merge_34 = Merge(Data1=pln_72, Data2=merge_33)
orient_6 = Orient(Geometry=item_22, Source=rotate_7.Geometry, Target=merge_34)  # -> Geometry, Transform

data_64 = Data(orient_6.Geometry)
ungroup_7 = Ungroup(Group=data_64)
item_65 = ListItem(List=ungroup_7, Index=0, Wrap=True)  # -> flatten(Item)
item_66 = ListItem(List=ungroup_7, Index="-1", Wrap=True)  # -> flatten(Item)

entwine_22 = Entwine(Branch00=item_65, Branch01=item_66, FlattenInputs=True)
bake_6 = BakeObjects(Geometry=entwine_22, Attributes=attributes_6, BakeName="Embed::2-1-03钢板焊埋件", Bake=False)

number_slider_56 = Slider(3584, range=0..10000)
deplane_27 = DeconstructPlane(Plane=pln_44)  # -> Origin, XAxis, YAxis, ZAxis
amp_32 = Amplitude(Vector=deplane_27.YAxis, Amplitude=number_slider_56)
amp_33 = Amplitude(Vector=deplane_27.YAxis, Amplitude=expr("-x", number_slider_56))
boundary_4 = BoundarySurfaces(Edges=[offset_6, offset_7])
crv_82 = Curve(merge_24)
move_40 = Move(Geometry=deplane_27.Origin, Motion=amp_33)  # -> Geometry, Transform
move_41 = Move(Geometry=deplane_27.Origin, Motion=amp_32)  # -> Geometry, Transform
ln_33 = Line(StartPoint=move_40.Geometry, EndPoint=move_41.Geometry)

# ---- group: 50-350建筑结构交点
scx_2 = SurfaceCurve(Surface=boundary_4, Curve=crv_82)  # -> flatten(Curves), Points, UVPoints, Normals, Parameters, Tangents

# ---- group: 该区间的定位点
ccx_22 = CurveCurve(CurveA=graft(ln_33), CurveB=scx_2.Curves)  # -> Points, ParamsA, ParamsB

# ----
shift_14 = ShiftPaths(Data=ccx_22.Points, Offset=-1)
pull_34 = PullPoint(Point=graft(pln_44), Geometry=shift_14, ClosestOnly=True)  # -> ClosestPoint, Distance
sort_32 = SortList(Keys=pull_34.Distance, ValuesA=pull_34.ClosestPoint)  # -> Keys, ValuesA
null_28 = NullItem(Item=sort_32.ValuesA)  # -> NullFlags, simplify(InvalidFlags), Description
item_67 = ListItem(List=sort_32.ValuesA, Index=0, Wrap=True)
dispatch_97 = Dispatch(List=simplify(graft(pln_44)), DispatchPattern=null_28.InvalidFlags)  # -> ListA, ListB
dispatch_98 = Dispatch(List=simplify(graft(item_67)), DispatchPattern=null_28.InvalidFlags)  # -> ListA, ListB
pln_82 = Plane(dispatch_97.ListB)
pln_83 = Plane(dispatch_97.ListA)
pt_62 = Point(dispatch_98.ListB)

# ----
# 可能的结构交点-大量
pln_84 = Plane(pln_83)

# ----
# 0 檐口出定位点
# 与结构无交点
pln_85 = Plane(flatten(pln_84))

crv_83 = Curve(shift_2)

# ----
# 按照梁分类定位点
pt_63 = Point(pt_62)
pln_86 = Plane(pln_82)
incurves_27 = PointInCurves(Point=flatten(pt_63), Curves=crv_83)  # -> Relationship, Index, Point
equals_29 = Equality(FirstNumber=incurves_27.Relationship, SecondNumber="0")  # -> Equality, Inequality
dispatch_99 = Dispatch(List=flatten(pln_86), DispatchPattern=equals_29.Inequality)  # -> ListA, ListB
data_65 = Data(dispatch_99.ListA)

incurves_28 = PointInCurves(Point=flatten(pt_63), Curves=crv_83)  # -> Relationship, Index, Point
equals_30 = Equality(FirstNumber=incurves_28.Relationship, SecondNumber="0")  # -> Equality, Inequality
dispatch_100 = Dispatch(List=flatten(pt_63), DispatchPattern=equals_30.Inequality)  # -> ListA, ListB
data_66 = Data(dispatch_100.ListA)

move2pt_20 = MoveToPoint(Geometry=data_65, PointA=data_65, PointB=data_66)  # -> Moved, Vector, Transform
null_29 = NullItem(Item=move2pt_20.Moved)  # -> NullFlags, InvalidFlags, Description
dispatch_101 = Dispatch(List=move2pt_20.Moved, DispatchPattern=null_29.InvalidFlags)  # -> ListA, ListB
pln_87 = Plane(dispatch_101.ListB)

# ----
# 3.1
# 下层建筑边线外侧50-350mm
# 03：钢板焊埋件[钢梁内侧]
# @钢边梁宽@钢边梁高
pln_88 = Plane(pln_87)

crv_84 = Curve(shift_2)

# ----
# 按照梁分类定位点
pt_64 = Point(pt_44)
pln_89 = Plane(pln_46)
incurves_29 = PointInCurves(Point=flatten(pt_64), Curves=crv_84)  # -> Relationship, Index, Point
equals_31 = Equality(FirstNumber=incurves_29.Relationship, SecondNumber="0")  # -> Equality, Inequality
dispatch_102 = Dispatch(List=flatten(pln_89), DispatchPattern=equals_31.Inequality)  # -> ListA, ListB
data_67 = Data(dispatch_102.ListA)

incurves_30 = PointInCurves(Point=flatten(pt_64), Curves=crv_84)  # -> Relationship, Index, Point
equals_32 = Equality(FirstNumber=incurves_30.Relationship, SecondNumber="0")  # -> Equality, Inequality
dispatch_103 = Dispatch(List=flatten(pt_64), DispatchPattern=equals_32.Inequality)  # -> ListA, ListB
data_68 = Data(dispatch_103.ListA)

move2pt_21 = MoveToPoint(Geometry=data_67, PointA=data_67, PointB=data_68)  # -> Moved, Vector, Transform
null_30 = NullItem(Item=move2pt_21.Moved)  # -> NullFlags, InvalidFlags, Description
dispatch_104 = Dispatch(List=move2pt_21.Moved, DispatchPattern=null_30.InvalidFlags)  # -> ListA, ListB
pln_90 = Plane(dispatch_104.ListB)

# ----
# 3.2
# 下层建筑边线内侧300-600mm范围
# 03：钢板焊埋件[钢梁外侧]
# @钢边梁宽@钢边梁高
pln_91 = Plane(pln_90)

# ----
# 3.1 Missing Point
# 埋件定位点Offset，没有找到和梁的交点
number_slider_57 = Slider(5000, range=0..10000)
deplane_28 = DeconstructPlane(Plane=pln_85)  # -> Origin, XAxis, YAxis, ZAxis
amp_34 = Amplitude(Vector=deplane_28.YAxis, Amplitude=number_slider_57)
crv_85 = Curve(scx_2.Curves)
move_42 = Move(Geometry=deplane_28.Origin, Motion=amp_34)  # -> Geometry, Transform
ln_34 = Line(StartPoint=move_42.Geometry, EndPoint=deplane_28.Origin)
amp_35 = Amplitude(Vector=deplane_28.XAxis, Amplitude=expr("-x", number_slider_20))
amp_36 = Amplitude(Vector=deplane_28.XAxis, Amplitude=number_slider_20)
move_43 = Move(Geometry=ln_34, Motion=amp_36)  # -> Geometry, Transform
move_44 = Move(Geometry=ln_34, Motion=amp_35)  # -> Geometry, Transform
pln_92 = Plane(pln_83)

ccx_23 = CurveCurve(CurveA=graft(move_44.Geometry), CurveB=flatten(crv_85))  # -> Points, ParamsA, ParamsB
shift_15 = ShiftPaths(Data=ccx_23.Points, Offset=-1)
sort_33 = SortList(Keys=shift_15, ValuesA=shift_15)  # -> Keys, ValuesA
pull_35 = PullPoint(Point=sort_33.ValuesA, Geometry=graft(pln_85), ClosestOnly=True)  # -> ClosestPoint, Distance
sort_34 = SortList(Keys=pull_35.Distance, ValuesA=sort_33.ValuesA)  # -> Keys, ValuesA
item_68 = ListItem(List=sort_34.ValuesA, Index="-1", Wrap=True)
null_31 = NullItem(Item=flatten(item_68))  # -> NullFlags, InvalidFlags, Description
dispatch_105 = Dispatch(List=flatten(item_68), DispatchPattern=null_31.InvalidFlags)  # -> ListA, ListB
dispatch_106 = Dispatch(List=pln_85, DispatchPattern=null_31.InvalidFlags)  # -> ListA, ListB
pt_65 = Point(dispatch_105.ListB)
pln_93 = Plane(dispatch_106.ListB)

ccx_24 = CurveCurve(CurveA=graft(move_43.Geometry), CurveB=flatten(crv_85))  # -> Points, ParamsA, ParamsB
shift_16 = ShiftPaths(Data=ccx_24.Points, Offset=-1)
sort_35 = SortList(Keys=shift_16, ValuesA=shift_16)  # -> Keys, ValuesA
pull_36 = PullPoint(Point=sort_35.ValuesA, Geometry=graft(pln_85), ClosestOnly=True)  # -> ClosestPoint, Distance
sort_36 = SortList(Keys=pull_36.Distance, ValuesA=sort_35.ValuesA)  # -> Keys, ValuesA
item_69 = ListItem(List=sort_36.ValuesA, Index="-1", Wrap=True)
null_32 = NullItem(Item=flatten(item_69))  # -> NullFlags, InvalidFlags, Description
dispatch_107 = Dispatch(List=flatten(item_69), DispatchPattern=null_32.InvalidFlags)  # -> ListA, ListB
dispatch_108 = Dispatch(List=pln_85, DispatchPattern=null_32.InvalidFlags)  # -> ListA, ListB
pln_94 = Plane(dispatch_108.ListB)
pt_66 = Point(dispatch_107.ListB)

merge_35 = Merge(Data1=pln_94, Data2=pln_93)  # -> flatten(Result)
check_same_points_6 = CheckSamePoints(archPoint=flatten(pln_92), crvPoint=merge_35)  # -> out, specialPt; inputs archPoint: list of Point3d, crvPoint: list of Point3d; same code as testpoint

# ----
# pass
cull_i_11 = CullIndex(List=flatten(pln_92), Indices=check_same_points_6.specialPt, Wrap=True)

# ----
# 按照梁分类定位点
pln_95 = Plane(pln_94)
pt_67 = Point(pt_66)
incurves_31 = PointInCurves(Point=flatten(pt_67), Curves=crv_71)  # -> Relationship, Index, Point
equals_33 = Equality(FirstNumber=incurves_31.Relationship, SecondNumber="0")  # -> Equality, Inequality
dispatch_109 = Dispatch(List=flatten(pln_95), DispatchPattern=equals_33.Inequality)  # -> ListA, ListB
data_69 = Data(dispatch_109.ListA)

# ----
# 按照梁分类定位点
pln_96 = Plane(pln_93)
pt_68 = Point(pt_65)
incurves_32 = PointInCurves(Point=flatten(pt_68), Curves=crv_71)  # -> Relationship, Index, Point
equals_34 = Equality(FirstNumber=incurves_32.Relationship, SecondNumber="0")  # -> Equality, Inequality
dispatch_110 = Dispatch(List=flatten(pln_96), DispatchPattern=equals_34.Inequality)  # -> ListA, ListB
data_70 = Data(dispatch_110.ListA)

incurves_33 = PointInCurves(Point=flatten(pt_68), Curves=crv_71)  # -> Relationship, Index, Point
equals_35 = Equality(FirstNumber=incurves_33.Relationship, SecondNumber="0")  # -> Equality, Inequality
dispatch_111 = Dispatch(List=flatten(pt_68), DispatchPattern=equals_35.Inequality)  # -> ListA, ListB
data_71 = Data(dispatch_111.ListA)

incurves_34 = PointInCurves(Point=flatten(pt_67), Curves=crv_71)  # -> Relationship, Index, Point
equals_36 = Equality(FirstNumber=incurves_34.Relationship, SecondNumber="0")  # -> Equality, Inequality
dispatch_112 = Dispatch(List=flatten(pt_67), DispatchPattern=equals_36.Inequality)  # -> ListA, ListB
data_72 = Data(dispatch_112.ListA)

move2pt_22 = MoveToPoint(Geometry=data_69, PointA=data_69, PointB=data_72)  # -> Moved, Vector, Transform
null_33 = NullItem(Item=move2pt_22.Moved)  # -> NullFlags, InvalidFlags, Description
dispatch_113 = Dispatch(List=move2pt_22.Moved, DispatchPattern=null_33.InvalidFlags)  # -> ListA, ListB
pln_97 = Plane(dispatch_113.ListB)

move2pt_23 = MoveToPoint(Geometry=data_70, PointA=data_70, PointB=data_71)  # -> Moved, Vector, Transform
null_34 = NullItem(Item=move2pt_23.Moved)  # -> NullFlags, InvalidFlags, Description
dispatch_114 = Dispatch(List=move2pt_23.Moved, DispatchPattern=null_34.InvalidFlags)  # -> ListA, ListB
pln_98 = Plane(dispatch_114.ListB)

# ----
# 撞到梁交点
merge_36 = Merge(Data1=pln_97, Data2=pln_98)

merge_37 = Merge(Data1=pln_88, Data2=merge_36)
orient_7 = Orient(Geometry=item_24, Source=rotate_8.Geometry, Target=merge_37)  # -> Geometry, Transform

data_73 = Data(orient_7.Geometry)
ungroup_8 = Ungroup(Group=data_73)
item_70 = ListItem(List=ungroup_8, Index=0, Wrap=True)  # -> flatten(Item)
item_71 = ListItem(List=ungroup_8, Index="-1", Wrap=True)  # -> flatten(Item)

entwine_23 = Entwine(Branch00=item_70, Branch01=item_71, FlattenInputs=True)
bake_7 = BakeObjects(Geometry=entwine_23, Attributes=attributes_8, BakeName="Embed::3-1-03钢板焊埋件", Bake=False)

# ----
# 3.2  Missing Point
# 埋件定位点Offset，没有找到和梁的交点
number_slider_58 = Slider(5000, range=0..10000)
crv_86 = Curve(scx.Curves)
deplane_29 = DeconstructPlane(Plane=pln_49)  # -> Origin, XAxis, YAxis, ZAxis
amp_37 = Amplitude(Vector=deplane_29.YAxis, Amplitude=number_slider_58)
move_45 = Move(Geometry=deplane_29.Origin, Motion=amp_37)  # -> Geometry, Transform
ln_35 = Line(StartPoint=move_45.Geometry, EndPoint=deplane_29.Origin)
amp_38 = Amplitude(Vector=deplane_29.XAxis, Amplitude=number_slider_20)
amp_39 = Amplitude(Vector=deplane_29.XAxis, Amplitude=expr("-x", number_slider_20))
move_46 = Move(Geometry=ln_35, Motion=amp_38)  # -> Geometry, Transform
move_47 = Move(Geometry=ln_35, Motion=amp_39)  # -> Geometry, Transform
pln_99 = Plane(pln_47)

ccx_25 = CurveCurve(CurveA=graft(move_47.Geometry), CurveB=flatten(crv_86))  # -> Points, ParamsA, ParamsB
shift_17 = ShiftPaths(Data=ccx_25.Points, Offset=-1)
sort_37 = SortList(Keys=shift_17, ValuesA=shift_17)  # -> Keys, ValuesA
pull_37 = PullPoint(Point=sort_37.ValuesA, Geometry=graft(pln_49), ClosestOnly=True)  # -> ClosestPoint, Distance
sort_38 = SortList(Keys=pull_37.Distance, ValuesA=sort_37.ValuesA)  # -> Keys, ValuesA
item_72 = ListItem(List=sort_38.ValuesA, Index="-1", Wrap=True)
null_35 = NullItem(Item=flatten(item_72))  # -> NullFlags, InvalidFlags, Description
dispatch_115 = Dispatch(List=flatten(item_72), DispatchPattern=null_35.InvalidFlags)  # -> ListA, ListB
dispatch_116 = Dispatch(List=pln_49, DispatchPattern=null_35.InvalidFlags)  # -> ListA, ListB
pt_69 = Point(dispatch_115.ListB)
pln_100 = Plane(dispatch_116.ListB)

ccx_26 = CurveCurve(CurveA=graft(move_46.Geometry), CurveB=flatten(crv_86))  # -> Points, ParamsA, ParamsB
shift_18 = ShiftPaths(Data=ccx_26.Points, Offset=-1)
sort_39 = SortList(Keys=shift_18, ValuesA=shift_18)  # -> Keys, ValuesA
pull_38 = PullPoint(Point=sort_39.ValuesA, Geometry=graft(pln_49), ClosestOnly=True)  # -> ClosestPoint, Distance
sort_40 = SortList(Keys=pull_38.Distance, ValuesA=sort_39.ValuesA)  # -> Keys, ValuesA
item_73 = ListItem(List=sort_40.ValuesA, Index="-1", Wrap=True)
null_36 = NullItem(Item=flatten(item_73))  # -> NullFlags, InvalidFlags, Description
dispatch_117 = Dispatch(List=flatten(item_73), DispatchPattern=null_36.InvalidFlags)  # -> ListA, ListB
dispatch_118 = Dispatch(List=pln_49, DispatchPattern=null_36.InvalidFlags)  # -> ListA, ListB
pln_101 = Plane(dispatch_118.ListB)
pt_70 = Point(dispatch_117.ListB)

merge_38 = Merge(Data1=pln_101, Data2=pln_100)  # -> flatten(Result)
check_same_points_7 = CheckSamePoints(archPoint=flatten(pln_99), crvPoint=merge_38)  # -> out, specialPt; inputs archPoint: list of Point3d, crvPoint: list of Point3d; same code as testpoint

# ----
# pass
cull_i_12 = CullIndex(List=flatten(pln_99), Indices=check_same_points_7.specialPt, Wrap=True)

# ----
# 按照梁分类定位点
pln_102 = Plane(pln_101)
pt_71 = Point(pt_70)
incurves_35 = PointInCurves(Point=flatten(pt_71), Curves=crv_72)  # -> Relationship, Index, Point
equals_37 = Equality(FirstNumber=incurves_35.Relationship, SecondNumber="0")  # -> Equality, Inequality
dispatch_119 = Dispatch(List=flatten(pln_102), DispatchPattern=equals_37.Inequality)  # -> ListA, ListB
data_74 = Data(dispatch_119.ListA)

# ----
# 按照梁分类定位点
pln_103 = Plane(pln_100)
pt_72 = Point(pt_69)
incurves_36 = PointInCurves(Point=flatten(pt_72), Curves=crv_72)  # -> Relationship, Index, Point
equals_38 = Equality(FirstNumber=incurves_36.Relationship, SecondNumber="0")  # -> Equality, Inequality
dispatch_120 = Dispatch(List=flatten(pln_103), DispatchPattern=equals_38.Inequality)  # -> ListA, ListB
data_75 = Data(dispatch_120.ListA)

incurves_37 = PointInCurves(Point=flatten(pt_72), Curves=crv_72)  # -> Relationship, Index, Point
equals_39 = Equality(FirstNumber=incurves_37.Relationship, SecondNumber="0")  # -> Equality, Inequality
dispatch_121 = Dispatch(List=flatten(pt_72), DispatchPattern=equals_39.Inequality)  # -> ListA, ListB
data_76 = Data(dispatch_121.ListA)

incurves_38 = PointInCurves(Point=flatten(pt_71), Curves=crv_72)  # -> Relationship, Index, Point
equals_40 = Equality(FirstNumber=incurves_38.Relationship, SecondNumber="0")  # -> Equality, Inequality
dispatch_122 = Dispatch(List=flatten(pt_71), DispatchPattern=equals_40.Inequality)  # -> ListA, ListB
data_77 = Data(dispatch_122.ListA)

move2pt_24 = MoveToPoint(Geometry=data_74, PointA=data_74, PointB=data_77)  # -> Moved, Vector, Transform
null_37 = NullItem(Item=move2pt_24.Moved)  # -> NullFlags, InvalidFlags, Description
dispatch_123 = Dispatch(List=move2pt_24.Moved, DispatchPattern=null_37.InvalidFlags)  # -> ListA, ListB
pln_104 = Plane(dispatch_123.ListB)

move2pt_25 = MoveToPoint(Geometry=data_75, PointA=data_75, PointB=data_76)  # -> Moved, Vector, Transform
null_38 = NullItem(Item=move2pt_25.Moved)  # -> NullFlags, InvalidFlags, Description
dispatch_124 = Dispatch(List=move2pt_25.Moved, DispatchPattern=null_38.InvalidFlags)  # -> ListA, ListB
pln_105 = Plane(dispatch_124.ListB)

# ----
# 撞到梁交点
merge_39 = Merge(Data1=pln_104, Data2=pln_105)

pln_106 = Plane(cull_i_11)
pln_107 = Plane(cull_i_12)

# ----
# 3.1下层建筑内侧到300到外侧50内是否有钢结构
deplane_30 = DeconstructPlane(Plane=pln_106)  # -> Origin, XAxis, YAxis, ZAxis
deplane_31 = DeconstructPlane(Plane=pln_107)  # -> Origin, XAxis, YAxis, ZAxis
check_same_points_8 = CheckSamePoints(archPoint=deplane_31.Origin, crvPoint=deplane_30.Origin)  # -> out, specialPt; inputs archPoint: list of Point3d, crvPoint: list of Point3d; same code as testpoint

merge_40 = Merge(Data1=pln_91, Data2=merge_39)
orient_8 = Orient(Geometry=item_26, Source=item_27, Target=merge_40)  # -> Geometry, Transform

data_78 = Data(orient_8.Geometry)
ungroup_9 = Ungroup(Group=data_78)
item_74 = ListItem(List=ungroup_9, Index=0, Wrap=True)  # -> flatten(Item)
item_75 = ListItem(List=ungroup_9, Index="-1", Wrap=True)  # -> flatten(Item)

entwine_24 = Entwine(Branch00=item_74, Branch01=item_75, FlattenInputs=True)
bake_8 = BakeObjects(Geometry=entwine_24, Attributes=attributes_9, BakeName="Embed::3-2-03钢板焊埋件", Bake=False)

# ----
# 同时满足N
item_76 = ListItem(List=pln_107, Index=check_same_points_8.specialPt, Wrap=True)

pln_108 = Plane(item_76)
flatten_9 = FlattenTree(Tree=crv_57, Path="{0}")
number_slider_59 = Slider(3584, range=0..10000)
deplane_32 = DeconstructPlane(Plane=pln_108)  # -> Origin, XAxis, YAxis, ZAxis
boundary_5 = BoundarySurfaces(Edges=[offset_9, offset_8])
crv_87 = Curve(flatten_9)
amp_40 = Amplitude(Vector=deplane_32.YAxis, Amplitude=number_slider_59)
amp_41 = Amplitude(Vector=deplane_32.YAxis, Amplitude=expr("-x", number_slider_59))
scx_3 = SurfaceCurve(Surface=boundary_5, Curve=crv_87)  # -> flatten(Curves), Points, UVPoints, Normals, Parameters, Tangents
move_48 = Move(Geometry=deplane_32.Origin, Motion=amp_41)  # -> Geometry, Transform
move_49 = Move(Geometry=deplane_32.Origin, Motion=amp_40)  # -> Geometry, Transform
ln_36 = Line(StartPoint=move_48.Geometry, EndPoint=move_49.Geometry)
ccx_27 = CurveCurve(CurveA=graft(ln_36), CurveB=scx_3.Curves)  # -> Points, ParamsA, ParamsB
shift_19 = ShiftPaths(Data=ccx_27.Points, Offset=-1)
pull_39 = PullPoint(Point=graft(pln_108), Geometry=shift_19, ClosestOnly=True)  # -> ClosestPoint, Distance
sort_41 = SortList(Keys=pull_39.Distance, ValuesA=pull_39.ClosestPoint)  # -> Keys, ValuesA
item_77 = ListItem(List=sort_41.ValuesA, Index=0, Wrap=True)
null_39 = NullItem(Item=sort_41.ValuesA)  # -> NullFlags, simplify(InvalidFlags), Description
dispatch_125 = Dispatch(List=simplify(graft(pln_108)), DispatchPattern=null_39.InvalidFlags)  # -> ListA, ListB
pln_109 = Plane(dispatch_125.ListB)
pln_110 = Plane(dispatch_125.ListA)

dispatch_126 = Dispatch(List=simplify(graft(item_77)), DispatchPattern=null_39.InvalidFlags)  # -> ListA, ListB
pt_73 = Point(dispatch_126.ListB)

# ----
# 按照梁分类定位点
pt_74 = Point(pt_73)
pln_111 = Plane(pln_109)
incurves_39 = PointInCurves(Point=flatten(pt_74), Curves=crv_73)  # -> Relationship, Index, Point
equals_41 = Equality(FirstNumber=incurves_39.Relationship, SecondNumber="0")  # -> Equality, Inequality
dispatch_127 = Dispatch(List=flatten(pln_111), DispatchPattern=equals_41.Inequality)  # -> ListA, ListB
data_79 = Data(dispatch_127.ListA)

incurves_40 = PointInCurves(Point=flatten(pt_74), Curves=crv_73)  # -> Relationship, Index, Point
equals_42 = Equality(FirstNumber=incurves_40.Relationship, SecondNumber="0")  # -> Equality, Inequality
dispatch_128 = Dispatch(List=flatten(pt_74), DispatchPattern=equals_42.Inequality)  # -> ListA, ListB
data_80 = Data(dispatch_128.ListA)

move2pt_26 = MoveToPoint(Geometry=data_79, PointA=data_79, PointB=data_80)  # -> Moved, Vector, Transform
null_40 = NullItem(Item=move2pt_26.Moved)  # -> NullFlags, InvalidFlags, Description
dispatch_129 = Dispatch(List=move2pt_26.Moved, DispatchPattern=null_40.InvalidFlags)  # -> ListA, ListB
pln_112 = Plane(dispatch_129.ListB)

# ----
# 可能的结构交点-大量
pln_113 = Plane(pln_110)

# ----
# 0 檐口出定位点
# 与结构无交点
pln_114 = Plane(flatten(pln_113))

# ----
# 4.1下层建筑内侧300到外侧50内
# 03底埋，钢板焊
pln_115 = Plane(pln_112)

# ----
# 4 Missing Point
# 埋件定位点Offset，没有找到和梁的交点
number_slider_60 = Slider(5000, range=0..10000)
deplane_33 = DeconstructPlane(Plane=pln_114)  # -> Origin, XAxis, YAxis, ZAxis
crv_88 = Curve(scx_3.Curves)
amp_42 = Amplitude(Vector=deplane_33.YAxis, Amplitude=number_slider_60)
move_50 = Move(Geometry=deplane_33.Origin, Motion=amp_42)  # -> Geometry, Transform
ln_37 = Line(StartPoint=move_50.Geometry, EndPoint=deplane_33.Origin)
amp_43 = Amplitude(Vector=deplane_33.XAxis, Amplitude=number_slider_20)
amp_44 = Amplitude(Vector=deplane_33.XAxis, Amplitude=expr("-x", number_slider_20))
move_51 = Move(Geometry=ln_37, Motion=amp_43)  # -> Geometry, Transform
move_52 = Move(Geometry=ln_37, Motion=amp_44)  # -> Geometry, Transform
pln_116 = Plane(pln_114)

ccx_28 = CurveCurve(CurveA=graft(move_52.Geometry), CurveB=flatten(crv_88))  # -> Points, ParamsA, ParamsB
shift_20 = ShiftPaths(Data=ccx_28.Points, Offset=-1)
sort_42 = SortList(Keys=shift_20, ValuesA=shift_20)  # -> Keys, ValuesA
pull_40 = PullPoint(Point=sort_42.ValuesA, Geometry=graft(pln_114), ClosestOnly=True)  # -> ClosestPoint, Distance
sort_43 = SortList(Keys=pull_40.Distance, ValuesA=sort_42.ValuesA)  # -> Keys, ValuesA
item_78 = ListItem(List=sort_43.ValuesA, Index="-1", Wrap=True)
null_41 = NullItem(Item=flatten(item_78))  # -> NullFlags, InvalidFlags, Description
dispatch_130 = Dispatch(List=flatten(item_78), DispatchPattern=null_41.InvalidFlags)  # -> ListA, ListB
dispatch_131 = Dispatch(List=pln_114, DispatchPattern=null_41.InvalidFlags)  # -> ListA, ListB
pln_117 = Plane(dispatch_131.ListB)
pt_75 = Point(dispatch_130.ListB)

ccx_29 = CurveCurve(CurveA=graft(move_51.Geometry), CurveB=flatten(crv_88))  # -> Points, ParamsA, ParamsB
shift_21 = ShiftPaths(Data=ccx_29.Points, Offset=-1)
sort_44 = SortList(Keys=shift_21, ValuesA=shift_21)  # -> Keys, ValuesA
pull_41 = PullPoint(Point=sort_44.ValuesA, Geometry=graft(pln_114), ClosestOnly=True)  # -> ClosestPoint, Distance
sort_45 = SortList(Keys=pull_41.Distance, ValuesA=sort_44.ValuesA)  # -> Keys, ValuesA
item_79 = ListItem(List=sort_45.ValuesA, Index="-1", Wrap=True)
null_42 = NullItem(Item=flatten(item_79))  # -> NullFlags, InvalidFlags, Description
dispatch_132 = Dispatch(List=pln_114, DispatchPattern=null_42.InvalidFlags)  # -> ListA, ListB
dispatch_133 = Dispatch(List=flatten(item_79), DispatchPattern=null_42.InvalidFlags)  # -> ListA, ListB
pt_76 = Point(dispatch_133.ListB)
pln_118 = Plane(dispatch_132.ListB)

merge_41 = Merge(Data1=pln_118, Data2=pln_117)  # -> flatten(Result)
check_same_points_9 = CheckSamePoints(archPoint=flatten(pln_116), crvPoint=merge_41)  # -> out, specialPt; inputs archPoint: list of Point3d, crvPoint: list of Point3d; same code as testpoint

# ----
# pass
cull_i_13 = CullIndex(List=flatten(pln_116), Indices=check_same_points_9.specialPt, Wrap=True)  # -> simplify(graft(List))

# ----
# 按照梁分类定位点
pln_119 = Plane(pln_118)
pt_77 = Point(pt_76)
incurves_41 = PointInCurves(Point=flatten(pt_77), Curves=crv_74)  # -> Relationship, Index, Point
equals_43 = Equality(FirstNumber=incurves_41.Relationship, SecondNumber="0")  # -> Equality, Inequality
dispatch_134 = Dispatch(List=flatten(pln_119), DispatchPattern=equals_43.Inequality)  # -> ListA, ListB
data_81 = Data(dispatch_134.ListA)

# ----
# 按照梁分类定位点
pln_120 = Plane(pln_117)
pt_78 = Point(pt_75)
incurves_42 = PointInCurves(Point=flatten(pt_78), Curves=crv_74)  # -> Relationship, Index, Point
equals_44 = Equality(FirstNumber=incurves_42.Relationship, SecondNumber="0")  # -> Equality, Inequality
dispatch_135 = Dispatch(List=flatten(pln_120), DispatchPattern=equals_44.Inequality)  # -> ListA, ListB
data_82 = Data(dispatch_135.ListA)

incurves_43 = PointInCurves(Point=flatten(pt_78), Curves=crv_74)  # -> Relationship, Index, Point
equals_45 = Equality(FirstNumber=incurves_43.Relationship, SecondNumber="0")  # -> Equality, Inequality
dispatch_136 = Dispatch(List=flatten(pt_78), DispatchPattern=equals_45.Inequality)  # -> ListA, ListB
data_83 = Data(dispatch_136.ListA)

incurves_44 = PointInCurves(Point=flatten(pt_77), Curves=crv_74)  # -> Relationship, Index, Point
equals_46 = Equality(FirstNumber=incurves_44.Relationship, SecondNumber="0")  # -> Equality, Inequality
dispatch_137 = Dispatch(List=flatten(pt_77), DispatchPattern=equals_46.Inequality)  # -> ListA, ListB
data_84 = Data(dispatch_137.ListA)

move2pt_27 = MoveToPoint(Geometry=data_81, PointA=data_81, PointB=data_84)  # -> Moved, Vector, Transform
null_43 = NullItem(Item=move2pt_27.Moved)  # -> NullFlags, InvalidFlags, Description
dispatch_138 = Dispatch(List=move2pt_27.Moved, DispatchPattern=null_43.InvalidFlags)  # -> ListA, ListB
pln_121 = Plane(dispatch_138.ListB)

move2pt_28 = MoveToPoint(Geometry=data_82, PointA=data_82, PointB=data_83)  # -> Moved, Vector, Transform
null_44 = NullItem(Item=move2pt_28.Moved)  # -> NullFlags, InvalidFlags, Description
dispatch_139 = Dispatch(List=move2pt_28.Moved, DispatchPattern=null_44.InvalidFlags)  # -> ListA, ListB
pln_122 = Plane(dispatch_139.ListB)

# ----
# 撞到梁交点
merge_42 = Merge(Data1=pln_121, Data2=pln_122)

merge_43 = Merge(Data1=flatten(pln_115), Data2=flatten(merge_42))
orient_9 = Orient(Geometry=item_29, Source=item_28, Target=merge_43)  # -> Geometry, Transform

data_85 = Data(orient_9.Geometry)
ungroup_10 = Ungroup(Group=data_85)
item_80 = ListItem(List=ungroup_10, Index=0, Wrap=True)  # -> flatten(Item)
item_81 = ListItem(List=ungroup_10, Index="-1", Wrap=True)  # -> flatten(Item)

entwine_25 = Entwine(Branch00=item_80, Branch01=item_81, FlattenInputs=True)
bake_9 = BakeObjects(Geometry=entwine_25, Attributes=attributes_10, BakeName="Embed::4-1钢板焊底埋", Bake=False)

# ----
# 5 上层建筑边线,
# 默认建筑提供上翻，如主结构提供示意则使用结构定位【该项目无】，
# 如无则使用建筑边线向内50mm作为埋件定位
# 筛选区域用什么input？？？
movetoplane_10 = MoveToPlane(Geometry=crv_2, Plane=PlaneXY(0, 0, 0), Above=True, Below=True)  # -> Geometry, Transform
movetoplane_11 = MoveToPlane(Geometry=pln_10, Plane=PlaneXY(0, 0, 0), Above=True, Below=True)  # -> Geometry, Transform
crv_89 = Curve(crv_29)
incurves_45 = PointInCurves(Point=movetoplane_11.Geometry, Curves=flatten(movetoplane_10.Geometry))  # -> Relationship, Index, Point
equals_47 = Equality(FirstNumber=incurves_45.Relationship, SecondNumber="2")  # -> Equality, Inequality
dispatch_140 = Dispatch(List=pln_10, DispatchPattern=equals_47.Equality)  # -> ListA, ListB
number_slider_61 = Slider(3584, range=0..10000)

# ---- group: Plane二次筛选
pln_123 = Plane(dispatch_140.ListA)

# ----
# 4.0下层建筑内侧到300到外侧50内
# 无钢结构
# 要求主体结构提供钢结构梁，默认位置为建筑边线向内300mm
number_slider_62 = Slider(300, range=0..1000)
crv_90 = Curve(crv_37)
pln_124 = Plane(cull_i_13)
offset_12 = OffsetCurve(Curve=crv_90, Distance=expr("-x", number_slider_62), Corners=1)
pull_42 = PullPoint(Point=pln_124, Geometry=offset_12, ClosestOnly=True)  # -> ClosestPoint, Distance
sort_46 = SortList(Keys=pull_42.Distance)  # -> Keys, ValuesA
larger_13 = LargerThan(FirstNumber=pull_42.Distance, SecondNumber=Slider(400, range=0..1000))  # -> LargerThan, OrEqualTo
panel_75 = Panel(sort_46.Keys)
number_slider_63 = Slider(3584, range=0..10000)

# ---- group: 删除反常线
dispatch_141 = Dispatch(List=pln_124, DispatchPattern=larger_13.LargerThan)  # -> ListA, ListB

# ----
pln_125 = Plane(flatten(dispatch_141.ListB))
deplane_34 = DeconstructPlane(Plane=pln_125)  # -> Origin, XAxis, YAxis, ZAxis
amp_45 = Amplitude(Vector=deplane_34.YAxis, Amplitude=number_slider_63)
amp_46 = Amplitude(Vector=deplane_34.YAxis, Amplitude=expr("-x", number_slider_63))
move_53 = Move(Geometry=deplane_34.Origin, Motion=amp_46)  # -> Geometry, Transform
move_54 = Move(Geometry=deplane_34.Origin, Motion=amp_45)  # -> Geometry, Transform
ln_38 = Line(StartPoint=move_53.Geometry, EndPoint=move_54.Geometry)
ccx_30 = CurveCurve(CurveA=ln_38, CurveB=offset_12)  # -> Points, ParamsA, ParamsB
flatten_10 = FlattenTree(Tree=ccx_30.Points, Path="{0}")
null_45 = NullItem(Item=simplify(ccx_30.Points))  # -> NullFlags, InvalidFlags, Description
dispatch_142 = Dispatch(List=simplify(graft(pln_125)), DispatchPattern=null_45.NullFlags)  # -> ListA, ListB

# ---- group: 有效点
pull_43 = PullPoint(Point=deplane_34.Origin, Geometry=flatten_10, ClosestOnly=True)  # -> ClosestPoint, Distance

# ----
# 可能的双点
pln_126 = Plane(dispatch_142.ListA)

# ----
# 离结构太远
pln_127 = Plane(dispatch_141.ListA)

merge_44 = Merge(Data1=pln_127, Data2=pln_126)

# ----
# 0 檐口出定位点
# 与结构无交点
pln_128 = Plane(flatten(merge_44))

# ----
# 4.0 默认位置为建筑边线向内300mm
# 侧埋，钢板焊
# 03：钢板焊埋件[钢梁外侧]@钢边梁宽@钢边梁高
move2pt_29 = MoveToPoint(Geometry=pln_125, PointA=deplane_34.Origin, PointB=pull_43.ClosestPoint)  # -> Moved, Vector, Transform

deplane_35 = DeconstructPlane(Plane=pln_123)  # -> Origin, XAxis, YAxis, ZAxis
amp_47 = Amplitude(Vector=deplane_35.YAxis, Amplitude=number_slider_61)
amp_48 = Amplitude(Vector=deplane_35.YAxis, Amplitude=expr("-x", number_slider_61))
move_55 = Move(Geometry=deplane_35.Origin, Motion=amp_48)  # -> Geometry, Transform
move_56 = Move(Geometry=deplane_35.Origin, Motion=amp_47)  # -> Geometry, Transform
ln_39 = Line(StartPoint=move_55.Geometry, EndPoint=move_56.Geometry)

offset_13 = OffsetCurve(Curve=crv_89, Distance=expr("-x", Slider(50, range=0..100)), Corners=1)
ccx_31 = CurveCurve(CurveA=ln_39, CurveB=offset_13)  # -> simplify(Points), ParamsA, ParamsB

ln_40 = Line(StartPoint=ccx_31.Points, EndPoint=simplify(graft(pln_123)))
len_8 = Length(Curve=ln_40)
null_46 = NullItem(Item=ccx_31.Points)  # -> NullFlags, InvalidFlags, Description
sort_47 = SortList(Keys=len_8, ValuesA=simplify(ccx_31.Points))  # -> Keys, ValuesA
dispatch_143 = Dispatch(List=simplify(graft(pln_123)), DispatchPattern=null_46.NullFlags)  # -> ListA, ListB
item_82 = ListItem(List=sort_47.ValuesA, Index=0, Wrap=True)

# ----
# 可能的双点
pln_129 = Plane(dispatch_143.ListA)

# ----
# 0 檐口出定位点
# 与结构无交点
pln_130 = Plane(flatten(pln_129))

# ----
# 5 上层建筑边线,
# 默认建筑提供上翻
# 04：板埋埋件[混凝土楼板上侧]
# @板埋参数xn
move2pt_30 = MoveToPoint(Geometry=simplify(graft(pln_123)), PointA=simplify(graft(pln_123)), PointB=item_82)  # -> flatten(Moved), Vector, Transform

# ----
# 5  Missing Point
# 埋件定位点Offset，没有找到和梁的交点
number_slider_64 = Slider(5000, range=0..10000)
deplane_36 = DeconstructPlane(Plane=pln_130)  # -> Origin, XAxis, YAxis, ZAxis
crv_91 = Curve(crv_89)
amp_49 = Amplitude(Vector=deplane_36.YAxis, Amplitude=number_slider_64)
move_57 = Move(Geometry=deplane_36.Origin, Motion=amp_49)  # -> Geometry, Transform
ln_41 = Line(StartPoint=move_57.Geometry, EndPoint=deplane_36.Origin)
amp_50 = Amplitude(Vector=deplane_36.XAxis, Amplitude=number_slider_20)
amp_51 = Amplitude(Vector=deplane_36.XAxis, Amplitude=expr("-x", number_slider_20))
move_58 = Move(Geometry=ln_41, Motion=amp_50)  # -> Geometry, Transform
move_59 = Move(Geometry=ln_41, Motion=amp_51)  # -> Geometry, Transform
pln_131 = Plane(pln_130)

ccx_32 = CurveCurve(CurveA=graft(move_59.Geometry), CurveB=flatten(crv_91))  # -> Points, ParamsA, ParamsB
shift_22 = ShiftPaths(Data=ccx_32.Points, Offset=-1)
sort_48 = SortList(Keys=shift_22, ValuesA=shift_22)  # -> Keys, ValuesA
pull_44 = PullPoint(Point=sort_48.ValuesA, Geometry=graft(pln_130), ClosestOnly=True)  # -> ClosestPoint, Distance
sort_49 = SortList(Keys=pull_44.Distance, ValuesA=sort_48.ValuesA)  # -> Keys, ValuesA
item_83 = ListItem(List=sort_49.ValuesA, Index="-1", Wrap=True)
null_47 = NullItem(Item=flatten(item_83))  # -> NullFlags, InvalidFlags, Description
dispatch_144 = Dispatch(List=simplify(item_83), DispatchPattern=simplify(graft(null_47.InvalidFlags)))  # -> ListA, ListB
dispatch_145 = Dispatch(List=pln_130, DispatchPattern=null_47.InvalidFlags)  # -> ListA, ListB
pln_132 = Plane(dispatch_145.ListB)
pt_79 = Point(dispatch_144.ListB)

ccx_33 = CurveCurve(CurveA=graft(move_58.Geometry), CurveB=flatten(crv_91))  # -> Points, ParamsA, ParamsB
shift_23 = ShiftPaths(Data=ccx_33.Points, Offset=-1)
sort_50 = SortList(Keys=shift_23, ValuesA=shift_23)  # -> Keys, ValuesA
pull_45 = PullPoint(Point=sort_50.ValuesA, Geometry=graft(pln_130), ClosestOnly=True)  # -> ClosestPoint, Distance
sort_51 = SortList(Keys=pull_45.Distance, ValuesA=sort_50.ValuesA)  # -> Keys, ValuesA
item_84 = ListItem(List=sort_51.ValuesA, Index="-1", Wrap=True)
null_48 = NullItem(Item=flatten(item_84))  # -> NullFlags, InvalidFlags, Description
dispatch_146 = Dispatch(List=simplify(item_84), DispatchPattern=simplify(graft(null_48.InvalidFlags)))  # -> ListA, ListB
dispatch_147 = Dispatch(List=pln_130, DispatchPattern=null_48.InvalidFlags)  # -> ListA, ListB
pln_133 = Plane(dispatch_147.ListB)
pt_80 = Point(dispatch_146.ListB)

merge_45 = Merge(Data1=pln_133, Data2=pln_132)  # -> flatten(Result)
check_same_points_10 = CheckSamePoints(archPoint=flatten(pln_131), crvPoint=merge_45)  # -> out, specialPt; inputs archPoint: list of Point3d, crvPoint: list of Point3d; same code as testpoint

# ----
# 撞到结构
move2pt_31 = MoveToPoint(Geometry=flatten(pln_133), PointA=flatten(pln_133), PointB=flatten(pt_80))  # -> Moved, Vector, Transform
move2pt_32 = MoveToPoint(Geometry=flatten(pln_132), PointA=flatten(pln_132), PointB=flatten(pt_79))  # -> Moved, Vector, Transform

# ----
# pass
cull_i_14 = CullIndex(List=flatten(pln_131), Indices=check_same_points_10.specialPt, Wrap=True)  # -> simplify(graft(List))

# ----
# 撞到梁交点
merge_46 = Merge(Data1=move2pt_31.Moved, Data2=move2pt_32.Moved)

merge_47 = Merge(Data1=move2pt_30.Moved, Data2=merge_46)

# ---- group: All Location Point
merge_48 = Merge(Data1=merge_26, Data2=merge_31, Data3=merge_47)

# ----
orient_10 = Orient(Geometry=item_39, Source=item_40, Target=merge_47)  # -> Geometry, Transform

data_86 = Data(orient_10.Geometry)
ungroup_11 = Ungroup(Group=data_86)
item_85 = ListItem(List=ungroup_11, Index=0, Wrap=True)  # -> flatten(Item)
item_86 = ListItem(List=ungroup_11, Index="-1", Wrap=True)  # -> flatten(Item)

entwine_26 = Entwine(Branch00=item_85, Branch01=item_86, FlattenInputs=True)
bake_10 = BakeObjects(Geometry=entwine_26, Attributes=attributes_11, BakeName="Embed::5-04板埋", Bake=False)

null_49 = NullItem(Item=merge_48)  # -> NullFlags, InvalidFlags, Description
dispatch_148 = Dispatch(List=merge_48, DispatchPattern=null_49.InvalidFlags)  # -> ListA, ListB

# ---- group: 下层图纸-标注定位点
pt_81 = Point(dispatch_148.ListB)

# ----
cluster_7 = Cluster_2(
    outline_curve=标准范围_符合单一轴网方向_2,
    dim_offset_1=number_slider_24,
    dim_offset_2=number_slider_23,
    axis_direction_crv1=crv_8,
    axis_direction_crv2=crv_9,
    f2_arch_outline=crv_50,
    location_point=pt_81,
    dim_style=panel_30,
    directed_outline=seam_2,
    移除重复位置点_容差=number_slider_21)  # -> D_3, D_4, D, D_2
dimension1 = Data(cluster_7.D_3)

# ---- group: Dimension2
data_87 = Data(cluster_7.D_4)

# ---- group: Dimension4
data_88 = Data(cluster_7.D_2)

# ---- group: Dimension3
data_89 = Data(cluster_7.D)

# ----
entwine_27 = Entwine(Branch00=dimension1, Branch01=data_87, Branch02=data_89, Branch03=data_88, FlattenInputs=True)

# ---- group: Refrash Data
# 将所有Input都输入完后要Refresh data
dam = DataDam(DataA=entwine_27, BufferDelay=10000000, BufferMode=0)

# ----
dedim = DeconstructDimension(DimensionObject=dam)  # -> Value, Text, Plane, Points, Style
shift_24 = ShiftPaths(Data=dedim.Text, Offset=-1)
smaller_8 = SmallerThan(FirstNumber=shift_24, SecondNumber=Slider(1, range=0..10))  # -> SmallerThan, OrEqualTo
dispatch_149 = Dispatch(List=dam, DispatchPattern=smaller_8.SmallerThan)  # -> ListA, ListB

# ---- group: Bake Me
bake_11 = BakeObjects(Geometry=dispatch_149.ListB, Attributes=attributes_14, Bake=False)

# ----
data_90 = Data(dispatch_149.ListB)

# ----
# 4.0  Missing Point
# 埋件定位点Offset，没有找到和梁的交点
number_slider_65 = Slider(5000, range=0..10000)
deplane_37 = DeconstructPlane(Plane=pln_128)  # -> Origin, XAxis, YAxis, ZAxis
crv_92 = Curve(scx_3.Curves)
amp_52 = Amplitude(Vector=deplane_37.YAxis, Amplitude=number_slider_65)
move_60 = Move(Geometry=deplane_37.Origin, Motion=amp_52)  # -> Geometry, Transform
ln_42 = Line(StartPoint=move_60.Geometry, EndPoint=deplane_37.Origin)
amp_53 = Amplitude(Vector=deplane_37.XAxis, Amplitude=number_slider_20)
amp_54 = Amplitude(Vector=deplane_37.XAxis, Amplitude=expr("-x", number_slider_20))
move_61 = Move(Geometry=ln_42, Motion=amp_53)  # -> Geometry, Transform
move_62 = Move(Geometry=ln_42, Motion=amp_54)  # -> Geometry, Transform
pln_134 = Plane(pln_128)

ccx_34 = CurveCurve(CurveA=graft(move_62.Geometry), CurveB=flatten(crv_92))  # -> Points, ParamsA, ParamsB
shift_25 = ShiftPaths(Data=ccx_34.Points, Offset=-1)
sort_52 = SortList(Keys=shift_25, ValuesA=shift_25)  # -> Keys, ValuesA
pull_46 = PullPoint(Point=sort_52.ValuesA, Geometry=graft(pln_128), ClosestOnly=True)  # -> ClosestPoint, Distance
sort_53 = SortList(Keys=pull_46.Distance, ValuesA=sort_52.ValuesA)  # -> Keys, ValuesA
item_87 = ListItem(List=sort_53.ValuesA, Index="-1", Wrap=True)
null_50 = NullItem(Item=flatten(item_87))  # -> NullFlags, InvalidFlags, Description
dispatch_150 = Dispatch(List=simplify(item_87), DispatchPattern=simplify(graft(null_50.InvalidFlags)))  # -> ListA, ListB
dispatch_151 = Dispatch(List=pln_128, DispatchPattern=null_50.InvalidFlags)  # -> ListA, ListB
pln_135 = Plane(dispatch_151.ListB)
pt_82 = Point(dispatch_150.ListB)

ccx_35 = CurveCurve(CurveA=graft(move_61.Geometry), CurveB=flatten(crv_92))  # -> Points, ParamsA, ParamsB
shift_26 = ShiftPaths(Data=ccx_35.Points, Offset=-1)
sort_54 = SortList(Keys=shift_26, ValuesA=shift_26)  # -> Keys, ValuesA
pull_47 = PullPoint(Point=sort_54.ValuesA, Geometry=graft(pln_128), ClosestOnly=True)  # -> ClosestPoint, Distance
sort_55 = SortList(Keys=pull_47.Distance, ValuesA=sort_54.ValuesA)  # -> Keys, ValuesA
item_88 = ListItem(List=sort_55.ValuesA, Index="-1", Wrap=True)
null_51 = NullItem(Item=flatten(item_88))  # -> NullFlags, InvalidFlags, Description
dispatch_152 = Dispatch(List=simplify(item_88), DispatchPattern=simplify(graft(null_51.InvalidFlags)))  # -> ListA, ListB
dispatch_153 = Dispatch(List=pln_128, DispatchPattern=null_51.InvalidFlags)  # -> ListA, ListB
pln_136 = Plane(dispatch_153.ListB)
pt_83 = Point(dispatch_152.ListB)

merge_49 = Merge(Data1=pln_136, Data2=pln_135)  # -> flatten(Result)
check_same_points_11 = CheckSamePoints(archPoint=flatten(pln_134), crvPoint=merge_49)  # -> out, specialPt; inputs archPoint: list of Point3d, crvPoint: list of Point3d; same code as testpoint

# ----
# 撞到结构
move2pt_33 = MoveToPoint(Geometry=flatten(pln_136), PointA=flatten(pln_136), PointB=flatten(pt_83))  # -> Moved, Vector, Transform
move2pt_34 = MoveToPoint(Geometry=flatten(pln_135), PointA=flatten(pln_135), PointB=flatten(pt_82))  # -> Moved, Vector, Transform

# ----
# pass
cull_i_15 = CullIndex(List=flatten(pln_134), Indices=check_same_points_11.specialPt, Wrap=True)  # -> simplify(graft(List))

# ----
# 撞到梁交点
merge_50 = Merge(Data1=move2pt_33.Moved, Data2=move2pt_34.Moved)

merge_51 = Merge(Data1=move2pt_29.Moved, Data2=merge_50)

# ---- group: All Location Point
merge_52 = Merge(Data1=merge_34, Data2=merge_37, Data3=merge_40, Data4=merge_43, Data5=merge_51)

# ----
orient_11 = Orient(Geometry=item_12, Source=item_13, Target=merge_51)  # -> Geometry, Transform

data_91 = Data(orient_11.Geometry)
ungroup_12 = Ungroup(Group=data_91)
item_89 = ListItem(List=ungroup_12, Index=0, Wrap=True)  # -> flatten(Item)
item_90 = ListItem(List=ungroup_12, Index="-1", Wrap=True)  # -> flatten(Item)

entwine_28 = Entwine(Branch00=item_89, Branch01=item_90, FlattenInputs=True)
bake_12 = BakeObjects(Geometry=entwine_28, Attributes=attributes_12, BakeName="Embed::4-0-03默认钢板焊", Bake=False)

null_52 = NullItem(Item=merge_52)  # -> NullFlags, InvalidFlags, Description
dispatch_154 = Dispatch(List=merge_52, DispatchPattern=null_52.InvalidFlags)  # -> ListA, ListB

# ---- group: 下层图纸-标注定位点
pt_84 = Point(dispatch_154.ListB)

# ----
cluster_8 = Cluster_2(
    outline_curve=标准范围_符合单一轴网方向,
    dim_offset_1=number_slider_19,
    dim_offset_2=number_slider_17,
    axis_direction_crv1=crv_4,
    axis_direction_crv2=crv_5,
    f2_arch_outline=crv_49,
    location_point=pt_84,
    dim_style=panel_29,
    directed_outline=seam,
    移除重复位置点_容差=number_slider_18)  # -> D_3, D_4, D, D_2
dimension1_2 = Data(cluster_8.D_3)

# ---- group: Dimension2
data_92 = Data(cluster_8.D_4)

# ---- group: Dimension4
data_93 = Data(cluster_8.D_2)

# ---- group: Dimension3
data_94 = Data(cluster_8.D)

# ----
entwine_29 = Entwine(Branch00=dimension1_2, Branch01=data_92, Branch02=data_94, Branch03=data_93, FlattenInputs=True)

# ---- group: Refrash Data
# 将所有Input都输入完后要Refresh data
dam_2 = DataDam(DataA=entwine_29, BufferDelay=10000000, BufferMode=0)

# ----
dedim_2 = DeconstructDimension(DimensionObject=dam_2)  # -> Value, Text, Plane, Points, Style
shift_27 = ShiftPaths(Data=dedim_2.Text, Offset=-1)
smaller_9 = SmallerThan(FirstNumber=shift_27, SecondNumber=Slider(1, range=0..10))  # -> SmallerThan, OrEqualTo
dispatch_155 = Dispatch(List=dam_2, DispatchPattern=smaller_9.SmallerThan)  # -> ListA, ListB

# ---- group: Bake Me
bake_13 = BakeObjects(Geometry=dispatch_155.ListB, Attributes=attributes_13, Bake=False)

# ----
data_95 = Data(dispatch_155.ListB)

crv_93 = Curve(project_11.Geometry)
crv_94 = Curve([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])
merge_53 = Merge(Data1=crv_93, Data2=crv_94)  # -> flatten(Result)

# ----
# curve
crv_95 = Curve(merge_53)

angle = Angle(VectorA=crv_95, VectorB="1,0,0")  # -> Angle, Reflex
deg_4 = Degrees(Radians=angle.Angle)
number_2 = NumberGroups(Number=deg_4, Difference="0.2")  # -> Groups, Indices
item_91 = ListItem(List=crv_95, Index=number_2.Indices, Wrap=True)  # -> simplify(Item)
panel_76 = Panel(number_2.Groups)
item_92 = ListItem(List=item_91, Index=0, Wrap=True)  # -> flatten(Item)
item_93 = ListItem(List=item_91, Index=0, Wrap=True)
bang_3 = ExplodeTree(Data=item_91)  # -> Branch0, Branch1, Branch2, Branch3, Branch4, Branch5
crv_96 = Curve(bang_3.Branch0)
crv_97 = Curve(bang_3.Branch1)
crv_98 = Curve(bang_3.Branch2)
crv_99 = Curve(bang_3.Branch3)
angle_2 = Angle(VectorA=item_93, VectorB=item_92)  # -> Angle, Reflex
deg_5 = Degrees(Radians=angle_2.Angle)
round_3 = Round(Number=deg_5, DecimalPlace="0")  # -> Nearest, Floor, Ceiling
equals_48 = Equality(FirstNumber=round_3.Nearest, SecondNumber="90")  # -> Equality, Inequality
panel_77 = Panel(round_3.Nearest)
dispatch_156 = Dispatch(List=item_92, DispatchPattern=equals_48.Equality)  # -> ListA, ListB
crv_100 = Curve(flatten(dispatch_156.ListA))
index = ItemIndex(List=item_92, Item=crv_100)
concat_3 = Concatenate(FragmentA="{", FragmentB=index)
concat_4 = Concatenate(FragmentA=concat_3, FragmentB="}")
tstat_3 = TreeStatistics(Tree=item_91)  # -> Paths, Length, Count
item_94 = ListItem(List=tstat_3.Paths, Index=0, Wrap=True)  # -> Item, Item1
item_95 = ListItem(List=concat_4, Index=0, Wrap=True)
# Sort Text
branch_2 = TreeBranch(Tree=item_91, Path=item_94.Item, MaintainPaths=True)
branch_3 = TreeBranch(Tree=item_91, Path=item_95, MaintainPaths=True)

# ==== cluster Cluster
G = ClusterInput()
rotate = Rotate(Geometry=G, Angle=3.141592654, Plane=PlaneXY(0, 0, 0))  # -> Geometry, Transform
boxprop = BoxProperties(Box=rotate.Geometry)  # -> Center, Diagonal, Area, Volume, Degeneracy
bbox = BoundingBox(Content=rotate.Geometry, Plane=PlaneXY(0, 0, 0))  # -> Box, Box_2
debox = DeconstructBox(Box=bbox.Box)  # -> Plane, X, Y, Z
pdecon = Deconstruct(Point=boxprop.Center)  # -> XComponent, YComponent, ZComponent
dedomain = DeconstructDomain(Domain=debox.Y)  # -> Start, End
pt = ConstructPoint(XCoordinate=pdecon.XComponent, YCoordinate=dedomain.Start, ZCoordinate=pdecon.ZComponent)
xy = XYPlane(Origin=Point(0, 0, 0))
pl_origin = PlaneOrigin(Base=xy, Origin=pt)
orient = Orient(Geometry=rotate.Geometry, Source=pl_origin, Target=xy)  # -> Geometry, Transform
G_2 = ClusterOutput(orient.Geometry)

# ==== cluster Cluster_2
f2_arch_outline = ClusterInput()
directed_outline = ClusterInput()
location_point = ClusterInput()
移除重复位置点_容差 = ClusterInput()
dim_offset_1 = ClusterInput()
dim_offset_2 = ClusterInput()
axis_direction_crv1 = ClusterInput()
axis_direction_crv2 = ClusterInput()
dim_style = ClusterInput()
outline_curve = ClusterInput()
pt = Point(location_point)
merge = Merge(Data1=axis_direction_crv1, Data2=axis_direction_crv2)
crv = Curve(f2_arch_outline)
number_slider = Slider(61, range=0..100)

incurve = PointInCurve(Point=flatten(pt), Curve=outline_curve)  # -> Relationship, Point
equals = Equality(FirstNumber=incurve.Relationship, SecondNumber="0")  # -> Equality, Inequality
dispatch = Dispatch(List=flatten(pt), DispatchPattern=equals.Inequality)  # -> ListA, ListB
pt_2 = Point(dispatch.ListA)
crv_cp = CurveClosestPoint(Point=pt_2, Curve=directed_outline)  # -> Point, Parameter, Distance
sort = SortList(Keys=crv_cp.Parameter, ValuesA=pt_2)  # -> Keys, ValuesA
pt_3 = Point(sort.ValuesA)
item = ListItem(List=merge, Index=0, Wrap=True)  # -> Item, Item1

# ----
# remove重复定位点生成的2个点
pt_4 = Point(pt_3)
shift = ShiftList(List=pt_4, Shift=1, Wrap=invert(True))
pt_5 = Point(pt_3)
pt_6 = Point(shift)
dist = Distance(PointA=pt_5, PointB=pt_6)
larger = LargerThan(FirstNumber=dist, SecondNumber=移除重复位置点_容差)  # -> LargerThan, OrEqualTo
dispatch_2 = Dispatch(List=pt_5, DispatchPattern=larger.LargerThan)  # -> ListA, ListB
pt_7 = Point(dispatch_2.ListA)
pt_8 = Point(dispatch_2.ListB)

dispatch_3 = Dispatch(List=pt_7, DispatchPattern=[True, False])  # -> ListA, ListB
pt_9 = Point(dispatch_3.ListB)
pt_10 = Point(dispatch_3.ListA)
pl = ConstructPlane(Origin=pt_10, XAxis=item.Item1, YAxis=item.Item)
pl_2 = ConstructPlane(Origin=pt_10, XAxis=item.Item, YAxis=item.Item1)

item_2 = ListItem(List=pt_7, Index=number_slider, Wrap=True)
shift_2 = ShiftList(List=pt_7, Shift=1, Wrap=invert(True))
item_3 = ListItem(List=shift_2, Index=number_slider, Wrap=True)

dispatch_4 = Dispatch(List=shift_2, DispatchPattern=[True, False])  # -> ListA, ListB
item_4 = ListItem(List=merge, Index=0, Wrap=True)  # -> Item, Item1
pt_11 = Point(dispatch_4.ListB)
pt_12 = Point(dispatch_4.ListA)
pl_3 = ConstructPlane(Origin=pt_12, XAxis=item_4.Item1, YAxis=item_4.Item)
pl_4 = ConstructPlane(Origin=pt_12, XAxis=item_4.Item, YAxis=item_4.Item1)

ln = Line(StartPoint=pt_10, EndPoint=pt_9)
ln_2 = Line(StartPoint=pt_12, EndPoint=pt_11)

crv_2 = Curve(crv)
deplane = DeconstructPlane(Plane=pl_3)  # -> Origin, XAxis, YAxis, ZAxis
amp = Amplitude(Vector=deplane.YAxis, Amplitude=Slider(3000, range=0..10000))
move = Move(Geometry=deplane.Origin, Motion=amp)  # -> Geometry, Transform
clscrv = CloseCurve(Curve=crv_2, CloseType=0, Bulge=0.5, Tolerance=0)  # -> Closed, R
pt_13 = Point(move.Geometry)
incurve_2 = PointInCurve(Point=pt_13, Curve=clscrv.Closed)  # -> Relationship, Point
equals_2 = Equality(FirstNumber=incurve_2.Relationship, SecondNumber="2")  # -> Equality, Inequality
lng = ListLength(List=equals_2.Equality)
lng_2 = ListLength(List=equals_2.Equality)
neg = Negative(Value=dim_offset_1)
repeat = RepeatData(Data=graft(neg), Length=lng)
repeat_2 = RepeatData(Data=graft(dim_offset_1), Length=lng_2)
panel = Panel(equals_2.Equality)
dispatch_5 = Dispatch(List=graft(repeat_2), DispatchPattern=graft(equals_2.Equality))  # -> ListA, ListB
dispatch_6 = Dispatch(List=graft(repeat), DispatchPattern=graft(equals_2.Equality))  # -> ListA, ListB
merge_2 = Merge(Data1=dispatch_5.ListA, Data2=dispatch_6.ListB)  # -> flatten(Result)

crv_3 = Curve(crv)
deplane_2 = DeconstructPlane(Plane=pl_4)  # -> Origin, XAxis, YAxis, ZAxis
amp_2 = Amplitude(Vector=deplane_2.YAxis, Amplitude=Slider(3000, range=0..10000))
move_2 = Move(Geometry=deplane_2.Origin, Motion=amp_2)  # -> Geometry, Transform
clscrv_2 = CloseCurve(Curve=crv_3, CloseType=0, Bulge=0.5, Tolerance=0)  # -> Closed, R
pt_14 = Point(move_2.Geometry)
incurve_3 = PointInCurve(Point=pt_14, Curve=clscrv_2.Closed)  # -> Relationship, Point
equals_3 = Equality(FirstNumber=incurve_3.Relationship, SecondNumber="2")  # -> Equality, Inequality
lng_3 = ListLength(List=equals_3.Equality)
neg_2 = Negative(Value=dim_offset_1)
lng_4 = ListLength(List=equals_3.Equality)
repeat_3 = RepeatData(Data=graft(neg_2), Length=lng_4)
repeat_4 = RepeatData(Data=graft(dim_offset_1), Length=lng_3)
panel_2 = Panel(equals_3.Equality)
dispatch_7 = Dispatch(List=graft(repeat_4), DispatchPattern=graft(equals_3.Equality))  # -> ListA, ListB
dispatch_8 = Dispatch(List=graft(repeat_3), DispatchPattern=graft(equals_3.Equality))  # -> ListA, ListB
merge_3 = Merge(Data1=dispatch_7.ListA, Data2=dispatch_8.ListB)  # -> flatten(Result)

crv_4 = Curve(crv)
deplane_3 = DeconstructPlane(Plane=pl)  # -> Origin, XAxis, YAxis, ZAxis
amp_3 = Amplitude(Vector=deplane_3.YAxis, Amplitude=Slider(3000, range=0..10000))
move_3 = Move(Geometry=deplane_3.Origin, Motion=amp_3)  # -> Geometry, Transform
clscrv_3 = CloseCurve(Curve=crv_4, CloseType=0, Bulge=0.5, Tolerance=0)  # -> Closed, R
pt_15 = Point(move_3.Geometry)
incurve_4 = PointInCurve(Point=pt_15, Curve=clscrv_3.Closed)  # -> Relationship, Point
equals_4 = Equality(FirstNumber=incurve_4.Relationship, SecondNumber="2")  # -> Equality, Inequality
lng_5 = ListLength(List=equals_4.Equality)
neg_3 = Negative(Value=dim_offset_2)
lng_6 = ListLength(List=equals_4.Equality)
repeat_5 = RepeatData(Data=graft(neg_3), Length=lng_6)
repeat_6 = RepeatData(Data=graft(dim_offset_2), Length=lng_5)
panel_3 = Panel(equals_4.Equality)
dispatch_9 = Dispatch(List=graft(repeat_6), DispatchPattern=graft(equals_4.Equality))  # -> ListA, ListB
dispatch_10 = Dispatch(List=graft(repeat_5), DispatchPattern=graft(equals_4.Equality))  # -> ListA, ListB
merge_4 = Merge(Data1=dispatch_9.ListA, Data2=dispatch_10.ListB)  # -> flatten(Result)

crv_5 = Curve(crv)
deplane_4 = DeconstructPlane(Plane=pl_2)  # -> Origin, XAxis, YAxis, ZAxis
amp_4 = Amplitude(Vector=deplane_4.YAxis, Amplitude=Slider(3000, range=0..10000))
move_4 = Move(Geometry=deplane_4.Origin, Motion=amp_4)  # -> Geometry, Transform
clscrv_4 = CloseCurve(Curve=crv_5, CloseType=0, Bulge=0.5, Tolerance=0)  # -> Closed, R
pt_16 = Point(move_4.Geometry)
incurve_5 = PointInCurve(Point=pt_16, Curve=clscrv_4.Closed)  # -> Relationship, Point
equals_5 = Equality(FirstNumber=incurve_5.Relationship, SecondNumber="2")  # -> Equality, Inequality
lng_7 = ListLength(List=equals_5.Equality)
neg_4 = Negative(Value=dim_offset_2)
lng_8 = ListLength(List=equals_5.Equality)
repeat_7 = RepeatData(Data=graft(neg_4), Length=lng_8)
repeat_8 = RepeatData(Data=graft(dim_offset_2), Length=lng_7)
panel_4 = Panel(equals_5.Equality)
dispatch_11 = Dispatch(List=graft(repeat_8), DispatchPattern=graft(equals_5.Equality))  # -> ListA, ListB
dispatch_12 = Dispatch(List=graft(repeat_7), DispatchPattern=graft(equals_5.Equality))  # -> ListA, ListB
merge_5 = Merge(Data1=dispatch_11.ListA, Data2=dispatch_12.ListB)  # -> flatten(Result)

lineardim = DefineLinearDimension(
    Point1=simplify(pt_12),
    Point2=simplify(pt_11),
    DimensionPlane=simplify(pl_3),
    Offset=expr("-x", merge_2),
    DimensionStyle=dim_style)
lineardim_2 = DefineLinearDimension(
    Point1=simplify(pt_12),
    Point2=simplify(pt_11),
    DimensionPlane=simplify(pl_4),
    Offset=expr("-x", merge_3),
    DimensionStyle=dim_style)
lineardim_3 = DefineLinearDimension(
    Point1=simplify(pt_10),
    Point2=simplify(pt_9),
    DimensionPlane=simplify(pl),
    Offset=expr("-x", merge_4),
    DimensionStyle=dim_style)
lineardim_4 = DefineLinearDimension(
    Point1=simplify(pt_10),
    Point2=simplify(pt_9),
    DimensionPlane=simplify(pl_2),
    Offset=expr("-x", merge_5),
    DimensionStyle=dim_style)
D = ClusterOutput(lineardim)
D_2 = ClusterOutput(lineardim_2)
D_3 = ClusterOutput(lineardim_3)
D_4 = ClusterOutput(lineardim_4)

# ==== cluster Cluster_3
structure_number = ClusterInput()
tag_text = ClusterInput()
text_offset = ClusterInput()
embed_color = ClusterInput()
T = ClusterInput()
G = ClusterInput()
A = ClusterInput()
A_2 = ClusterInput()
B = ClusterInput()
dimension_style = ClusterInput()

# ----
# 列表文字以空格进行分割
panel = Panel(" ")
split = TextSplit(Text=T, Separators=panel)

钢埋板长度_2 = Division(A=A, B=2)
neg = Negative(Value=钢埋板长度_2)
dom = ConstructDomain(DomainStart=neg, DomainEnd=钢埋板长度_2)
panel_2 = Panel(dom)

钢埋板厚度_2 = Division(A=A_2, B=2)
neg_2 = Negative(Value=钢埋板厚度_2)
dom_2 = ConstructDomain(DomainStart=neg_2, DomainEnd=钢埋板厚度_2)
panel_3 = Panel(dom_2)

# ----
# 钢埋板肋板位置 1/4处
panel_4 = Panel("4")
division = Division(A=A, B=panel_4)

# ----
# 编号和截面尺寸分区
panel_5 = Panel("1")
split_2 = SplitList(List=split, Index=panel_5)  # -> flatten(ListA), flatten(ListB)

# ----
# 求出对应输入编号的钢结构截面尺寸
fsim = FindSimilarMember(Data=structure_number, Set=split_2.ListA)  # -> Hit, Index
item = ListItem(List=split_2.ListB, Index=fsim.Index, Wrap=True)

addition = Addition(A=neg_2, B=division)
addition_2 = Addition(A=钢埋板厚度_2, B=division)
dom_3 = ConstructDomain(DomainStart=addition, DomainEnd=addition_2)
panel_6 = Panel(split_2.ListB)
split_3 = TextSplit(Text=item, Separators="x")
split_4 = TextSplit(Text=split_3, Separators="Q")
item_2 = ListItem(List=split_4, Index="0", Wrap=True)  # -> flatten(Item)
subtraction = Subtraction(A=division, B=钢埋板厚度_2)
subtraction_2 = Subtraction(A=division, B=钢埋板厚度_2)
subtraction_3 = Subtraction(A=division, B=钢埋板厚度_2)
neg_3 = Negative(Value=钢埋板厚度_2)
neg_4 = Negative(Value=钢埋板厚度_2)
neg_5 = Negative(Value=钢埋板厚度_2)
subtraction_4 = Subtraction(A=division, B=钢埋板厚度_2)
addition_3 = Addition(A=subtraction, B=A_2)
addition_4 = Addition(A=subtraction_2, B=A_2)
subtraction_5 = Subtraction(A=neg_3, B=A_2)
subtraction_6 = Subtraction(A=neg_4, B="2")
subtraction_7 = Subtraction(A=division, B=钢埋板厚度_2)
addition_5 = Addition(A=subtraction_3, B="2")
subtraction_8 = Subtraction(A=neg_5, B="2")
neg_6 = Negative(Value=钢埋板厚度_2)
neg_7 = Negative(Value=钢埋板厚度_2)
工字钢_h = ListItem(List=item_2, Index=0, Wrap=True)
工字钢_b = ListItem(List=item_2, Index=1, Wrap=True)
工字钢_tf = ListItem(List=item_2, Index=3, Wrap=True)
工字钢_tw = ListItem(List=item_2, Index=2, Wrap=True)
pt = ConstructPoint(XCoordinate=neg_6, YCoordinate=subtraction_4, ZCoordinate=0)
pt_2 = ConstructPoint(XCoordinate=neg_7, YCoordinate=addition_3, ZCoordinate=0)
pt_3 = ConstructPoint(XCoordinate=subtraction_5, YCoordinate=addition_4, ZCoordinate=0)
pt_4 = ConstructPoint(XCoordinate=subtraction_6, YCoordinate=subtraction_7, ZCoordinate=0)
pt_5 = ConstructPoint(XCoordinate=subtraction_8, YCoordinate=addition_5, ZCoordinate=0)
subtraction_9 = Subtraction(A=工字钢_b, B=工字钢_tw)
division_2 = Division(A=subtraction_9, B="2")
merge = Merge(Data1=pt, Data2=pt_2, Data3=pt_3, Data4=pt_5, Data5=pt_4)
pline = PolyLine(Vertices=merge, Closed=True)
division_3 = Division(A=division_2, B="2")
subtraction_10 = Subtraction(A=division_3, B=A_2)
subtraction_11 = Subtraction(A=division_3, B=钢埋板厚度_2)
neg_8 = Negative(Value=division_3)
subtraction_12 = Subtraction(A=neg_8, B=subtraction_11)
addition_6 = Addition(A=subtraction_12, B=B)
dom_4 = ConstructDomain(DomainStart=addition_6, DomainEnd=subtraction_12)
dom_5 = ConstructDomain(DomainStart=addition, DomainEnd=addition_2)
钢肋板倒角_侧视图 = Rectangle(Plane=PlaneXY(0, 0, 0), XSize=dom_4, YSize=dom_5, Radius=0)  # -> Rectangle, Length
subtraction_13 = Subtraction(A=subtraction_10, B=subtraction_11)
subtraction_14 = Subtraction(A=neg_8, B=subtraction_11)
dom_6 = ConstructDomain(DomainStart=subtraction_13, DomainEnd=subtraction_14)
钢肋板_侧视图 = Rectangle(Plane=PlaneXY(0, 0, 0), XSize=dom_6, YSize=dom_3, Radius=0)  # -> Rectangle, Length
merge_2 = Merge(Data1=钢肋板_侧视图.Rectangle, Data2=pline, Data3=钢肋板倒角_侧视图.Rectangle)
xz = XZPlane(Origin=Point(0, 0, 0))
mirror = Mirror(Geometry=merge_2, Plane=xz)  # -> Geometry, Transform
钢埋板_侧视图 = Rectangle(Plane=PlaneXY(0, 0, 0), XSize=dom_2, YSize=dom, Radius=0)  # -> Rectangle, Length
division_4 = Division(A=工字钢_b, B=2)
侧视图 = Entwine(Branch00=钢埋板_侧视图.Rectangle, Branch01=merge_2, Branch02=mirror.Geometry, FlattenInputs=True)
R = ClusterOutput(division_4)
division_5 = Division(A=工字钢_h, B="2")
subtraction_15 = Subtraction(A=division_5, B=工字钢_tf)
addition_7 = Addition(A=subtraction_15, B=Slider(200, range=0..1000))
addition_8 = Addition(A=addition_7, B=division_2)
X = UnitX(Factor=addition_8)
move = Move(Geometry=侧视图, Motion=X)  # -> Geometry, Transform
split_tree = SplitTree(Data=move.Geometry, Masks=flatten("{0;0}"))  # -> Positive, Negative
dispatch = Dispatch(List=split_tree.Negative, DispatchPattern=[True, False])  # -> flatten(ListA), ListB
merge_3 = Merge(Data1=split_tree.Positive, Data2=dispatch.ListA)
entwine = Entwine(Branch00=merge_3, Branch01=dispatch.ListB, FlattenInputs=True)
flatten = FlattenTree(Tree=entwine, Path="{0}")
group = Group(Objects=flatten)
rotate = Rotate(Geometry=group, Angle=3.141592654, Plane=PlaneXY(0, 0, 0))  # -> Geometry, Transform
boxprop = BoxProperties(Box=rotate.Geometry)  # -> Center, Diagonal, Area, Volume, Degeneracy
bbox = BoundingBox(Content=rotate.Geometry, Plane=PlaneXY(0, 0, 0))  # -> Box, Box_2
debox = DeconstructBox(Box=bbox.Box)  # -> Plane, X, Y, Z
pdecon = Deconstruct(Point=boxprop.Center)  # -> XComponent, YComponent, ZComponent
dedomain = DeconstructDomain(Domain=debox.Y)  # -> Start, End
pt_6 = ConstructPoint(XCoordinate=pdecon.XComponent, YCoordinate=dedomain.Start, ZCoordinate=pdecon.ZComponent)
xy = XYPlane(Origin=Point(0, 0, 0))
concat = Concatenate(FragmentA="Embed", FragmentB=tag_text)
pl_origin = PlaneOrigin(Base=xy, Origin=pt_6)
orient = Orient(Geometry=rotate.Geometry, Source=pl_origin, Target=xy)  # -> Geometry, Transform
xy_2 = XYPlane(Origin=Point(0, 0, 0))
attributes = DefineObjectAttributes(Color=embed_color)
ungroup = Ungroup(Group=orient.Geometry)
block = DefineBlock(Geometry=ungroup, Attributes=attributes, BlockName=concat, BasePlane=PlaneXY(0, 0, 0))
deblock = DeconstructBlock(Block=block)  # -> Name, flatten(Plane), flatten(Geometry)
group_2 = Group(Objects=deblock.Geometry)
bbox_2 = BoundingBox(Content=group_2, Plane=PlaneXY(0, 0, 0))  # -> Box, Box_2
deplane = DeconstructPlane(Plane=deblock.Plane)  # -> Origin, XAxis, YAxis, ZAxis
area = Area(Geometry=bbox_2.Box)  # -> Area, Centroid
move2pt = MoveToPoint(Geometry=flatten(deplane.Origin), PointA=flatten(deplane.Origin), PointB=flatten(area.Centroid))  # -> Moved, Vector, Transform
pl = ConstructPlane(Origin=move2pt.Moved, XAxis=deplane.YAxis, YAxis=deplane.XAxis)  # -> graft(Plane)
deplane_2 = DeconstructPlane(Plane=pl)  # -> Origin, XAxis, YAxis, ZAxis
rotate_2 = Rotate(Geometry=pl, Angle="Pi", Plane=pl)  # -> Geometry, Transform
dedomain_2 = DeconstructDomain(Domain=dom)  # -> Start, End
multiplication = Multiplication(A=dedomain_2.Start, B=dedomain_2.Start)
amp = Amplitude(Vector=deplane_2.YAxis, Amplitude=multiplication)
move_2 = Move(Geometry=deplane_2.Origin, Motion=amp)  # -> Geometry, Transform
srf = Surface(bbox_2.Box)
crv = Curve(srf)
ln = Line(StartPoint=move_2.Geometry, EndPoint=deplane_2.Origin)
ccx = CurveCurve(CurveA=ln, CurveB=crv)  # -> Points, ParamsA, ParamsB
ln_2 = Line(StartPoint=deplane_2.Origin, EndPoint=ccx.Points)
move_3 = Move(Geometry=rotate_2.Geometry, Motion=ln_2)  # -> Geometry, Transform

ln_3 = Line(StartPoint=ccx.Points, EndPoint=deplane_2.Origin)
amp_2 = Amplitude(Vector=ln_3, Amplitude=text_offset)
move_4 = Move(Geometry=rotate_2.Geometry, Motion=amp_2)  # -> Geometry, Transform
text = DefineTextObject(Text=tag_text, Plane=move_4.Geometry, DimensionStyle=dimension_style, OutputType="Text")
group_3 = Group(Objects=[block, text])

entwine_2 = Entwine(Branch00=group_3, Branch01=move_3.Geometry, FlattenInputs=True)
project = Project(Geometry=G, Plane=xy_2)  # -> Geometry, Transform
R_2 = ClusterOutput(entwine_2)
G_2 = ClusterOutput(project.Geometry)
