# Grasshopper definition FacadeEmbed_JinQiao_PodiumOLD.gh (Grasshopper 1.0.7)
# plug-ins: EleFront, TT Toolbox, Pufferfish, Hare, treesloth01

# ----
# 线段延长长度
number_slider = Slider(1001, range=0..10000)  # disabled

# ----
# remove duplicate curves
geo = Geometry()  # disabled
number_slider_2 = Slider(0.1, range=0..0.1)  # disabled
boundary = BoundarySurfaces(Edges=geo)  # disabled
area = Area(Geometry=boundary)  # -> Area, Centroid; disabled
cullduppoints = RemoveDuplicatePoints(InputPoints=area.Centroid, Tolerance=number_slider_2)  # -> OutputPoints, FirstPointIndexes; disabled
null = NullItem(Item=cullduppoints.FirstPointIndexes)  # -> NullFlags, InvalidFlags, Description; disabled
dispatch = Dispatch(List=boundary, DispatchPattern=null.NullFlags)  # -> ListA, ListB; disabled
geo_2 = Geometry(dispatch.ListA)  # disabled

# ----
# 调换阴阳角设定
toggle = BooleanToggle(False)  # disabled

# ---- group: 檐口定位点
circle = Curve(<curve referenced from the Rhino model>)

# ---- group: 上层定位点的circle
circle_2 = Curve(<curve referenced from the Rhino model>)

# ---- group: 下层定位点的circle
circle_3 = Curve(<curve referenced from the Rhino model>)

# ----
# (1) 导入代表埋件定位点的circle
# 注意：
# 1.请将上下两层的定位点所对应的circle分别放在2个不同Rhino图层
# 2.导入完之后可能需要都点一下Update
layer = ObjectLayer(Guid=circle_2)  # -> LayerIndex, LayerPathName
layer_2 = ObjectLayer(Guid=circle_3)  # -> LayerIndex, LayerPathName
layer_3 = ObjectLayer(Guid=circle)  # -> LayerIndex, LayerPathName
reflay = ReferenceByLayer(LayerName=layer_3.LayerPathName)

# ---- group: Click Me after Input
reflay_2 = ReferenceByLayer(LayerName=layer_2.LayerPathName)

reflay_3 = ReferenceByLayer(LayerName=layer.LayerPathName)

# ----
# Step1.输入block names
# Step2:点击Update按钮
data = Data(["PX-GLAZ-F2$0$PX-GLAZ-F2$0$fin", "PX-GLAZ-F2$0$PX-GLAZ-F1$0$fin"])
panel = Panel(data)
# （1）导入埋件定位点
panel_2 = Panel("")
refblock = ReferenceBlockByName(BlockName=panel)

# ----
# Input Curves
# 
# Step1：选中其中一个curve,得到该图层所有curves
# Step2：点击Update按钮
crv = Curve(<curve referenced from the Rhino model>)

# ----
# (Block & Curve的形式)
# Input Blocks (Plane的Y轴向外)
# 
# Step1.输入Block所在图层
# Step2:点击Update按钮
data_2 = Data(["PX-GLAZ-F2$0$PX-GLAZ-F1$0$标准块", "PX-GLAZ-F2$0$PX-GLAZ-F2$0$标准块", "PX-GLAZ-F2$0$PX-GLAZ-F3$0$标准块"])

# ----
# block names
listblockd = ListBlockDocument()

# ----
# Input Blocks (Plane的Y轴向内)
# 
# Step1:输入Block所在图层
# Step2:点击Update按钮
data_3 = Data("PX-GLAZ-F2$0$T3T")

# ---- group: 楼板线
# （2）导入单体建筑的参考线
# 导入上层幕墙线
crv_2 = Curve(<curve referenced from the Rhino model>)

# ---- group: 檐口线-外侧
crv_3 = Curve(<curve referenced from the Rhino model>)

# ---- group: 檐口线-内侧
crv_4 = Curve([<curve referenced from the Rhino model> x2])

# ---- group: 下层All幕墙线
# 导入檐口线
# 注意：如果没有檐口线或没有内测檐口线，一定要确保对应需要导入檐口线curve的区域为空data
crv_5 = Curve([<curve referenced from the Rhino model> x3])

# ---- group: 导入下层单体幕墙线
# 导入下层幕墙线
crv_6 = Curve(<curve referenced from the Rhino model>)

# ---- group: 上层-内部幕墙线
crv_7 = Curve(<curve referenced from the Rhino model>)

# ----
# 输入
# 
# Embed的Tag命名
# 埋件编号
panel_3 = Panel("5-5")

# ----
# 长
panel_4 = Panel("-175 To 175")

# ---- group: 导入上层单体幕墙线
crv_8 = Curve(<curve referenced from the Rhino model>)

# ---- group: 导入上层All-外部幕墙线
crv_9 = Curve([<curve referenced from the Rhino model> x3])

# ----
# 宽
panel_5 = Panel("-125 To 125")

# ----
# 输入标注样式
panel_6 = Panel("图例2-地上$0$XD100$0")

# ----
# 埋件编号tag的Offset
number_slider_3 = Slider(190, range=0..1000)

# ----
# 钢埋板长度（按需设定）
number_slider_4 = Slider(350, range=0..1000)

# ----
# 钢埋板厚度（按需设定）
number_slider_5 = Slider(16, range=0..100)

# ----
# 肋板倒角距离（按需设定）
number_slider_6 = Slider(30, range=0..100)

# ----
# Dimension Style
panel_7 = Panel("图例2-地上$0$XD100$0")

# ----
# （5）导入Default Embed
# 输入
# 
# 1.Embed的结构编号
# 2.Embed的Tag命名
# 需要出图的钢结构编号
panel_8 = Panel("GL3-3H")

# ----
# Embed Layer Color
swatch = ColourSwatch(SwatchColor=RGB(136, 235, 148))

# ----
# 钢结构截面列表
txt = Text(["GL2A-1\tHN 250x125x6x9\t\tQ235B\t热轧", "GL3-1\tHN 300x150x6.5x9\t\tQ235B\t热轧", "GL3-2\tH 300x100x8x10\t\tQ235B\t焊接H型", "GL3-3\tH 300x200x8x16\t\tQ355B\t焊接H型", "GL3-4\tHW 300x300x10x15\t\tQ355B\t热轧", "GL4-1\tHN 400x200x8x13\t\tQ355B\t热轧", "GL4-2\tH 400x200x10x16\t\tQ355B\t焊接H型", "GL4-3\tH 400x250x10x20\t\tQ355B\t焊接H型", "GL4-4\tH 400x350x16x35\t\tQ355B\t焊接H型", "GL4a-1\tH 450x200x9x14\t\tQ355B\t热轧", "GL5-1\tHN 500x200x10x16\t\tQ355B\t热轧", "GL5-2\tH 500x200x10x20\t\tQ355B\t焊接H型", "GL5-3\tH 500x300x14x20\t\tQ355B\t焊接H型", "GL5a-1\tH 550x250x10x25\t\tQ355B\t焊接H型", "GL5a-2\tH 550x300x14x25\t\tQ355B\t焊接H型", "GL6-1\tHN 600x200x11x17\t\tQ355B\t热轧", "GL6-2\tH 600x300x12x20\t\tQ355B\t焊接H型", "GL6-3\tH 600x350x12x25\t\tQ355B\t焊接H型", "GL6-4\tH 600x350x16x35\t\tQ355B\t焊接H型", "GL7-1\tHN 700x300x13x24\t\tQ355B\t热轧", "GL7-2\tH 700x350x14x30\t\tQ355B\t焊接H型", "GL7-3\tH 700x350x14x35\t\tQ355B\t焊接H型", "GL8-1\tHN 800x300x14x26\t\tQ355B\t热轧", "GL8-2\tH 800x300x20x40\t\tQ345GJB\t焊接H型", "GL9-1\tH 900x300x20x30\t\tQ355B\t焊接H型", "GL9-2\tH 900x400x20x40\t\tQ345GJB\t焊接H型", "GL10-1\tH 1000x400x20x30\t\tQ355B\t焊接H型", "GL10-2\tH 1000x500x20x30\t\tQ355B\t焊接H型", "GL10-3\tH 1000x500x20x35\t\tQ355B\t焊接H型", "GL10-4\tH 1000x400x20x40\t\tQ345GJB\t焊接H型", "GL10-5\tH 1000x500x20x40\t\tQ345GJB\t焊接H型", "GL10-6\t□ 1000x400x20x40\t\tQ345GJB\t焊接箱型", "GL12-1\tH 1200x400x25x50\t\tQ345GJB\t焊接H型"])

# ----
# Dimension Style
panel_9 = Panel("图例2-地上$0$XD100$0")

# ----
# (8) 撞到梁交点-Offset
number_slider_7 = Slider(450, range=0..1000)

# ----
# 埋件编号tag的Offset
number_slider_8 = Slider(353, range=0..1000)

# ----
# 埋件编号tag
panel_10 = Panel("6-6")

# ---- group: 混凝土
# 板埋几何INPUT
list = ValueList({"C15": 0, "C20": 1, "C25": 2, "C30": 3, "C35": 4, "C40": 5}, selected="C35")

# ---- group: 钢筋牌号
list_2 = ValueList({"HPB300": 0, "HRB400": 1}, selected="HPB300")

# ---- group: 直径
list_3 = ValueList({"10": 0, "12": 1, "16": 2, "18": 3, "20": 4, "25": 5}, selected="12")

# ---- group: 锚筋间距
s_y = Slider(22, range=14..60, expression="X*5")
s_x = Slider(22, range=14..60, expression="X*5")

# ---- group: 列
list_4 = ValueList({"2X": 0, "3X": 1, "4X": 2}, selected="3X")

# ---- group: 行
# （7）生成底埋钢埋件
list_5 = ValueList({"2Y": 0, "3Y": 1, "4Y": 2}, selected="2Y")

# ----
# 钢埋板长度（按需设定）
number_slider_9 = Slider(350, range=0..1000)

# ----
# 钢埋板厚度（按需设定）
number_slider_10 = Slider(16, range=0..100)

# ----
# 肋板倒角距离（按需设定）
number_slider_11 = Slider(30, range=0..100)

# ----
# 埋件编号tag
panel_11 = Panel("0-0")

# ----
# 埋件编号tag的Offset
number_slider_12 = Slider(300, range=0..1000)

# ----
# 钢结构截面列表
txt_2 = Text(["GL2A-1\tHN 250x125x6x9\t\tQ235B\t热轧", "GL3-1\tHN 300x150x6.5x9\t\tQ235B\t热轧", "GL3-2\tH 300x100x8x10\t\tQ235B\t焊接H型", "GL3-3\tH 300x200x8x16\t\tQ355B\t焊接H型", "GL3-4\tHW 300x300x10x15\t\tQ355B\t热轧", "GL4-1\tHN 400x200x8x13\t\tQ355B\t热轧", "GL4-2\tH 400x200x10x16\t\tQ355B\t焊接H型", "GL4-3\tH 400x250x10x20\t\tQ355B\t焊接H型", "GL4-4\tH 400x350x16x35\t\tQ355B\t焊接H型", "GL4a-1\tH 450x200x9x14\t\tQ355B\t热轧", "GL5-1\tHN 500x200x10x16\t\tQ355B\t热轧", "GL5-2\tH 500x200x10x20\t\tQ355B\t焊接H型", "GL5-3\tH 500x300x14x20\t\tQ355B\t焊接H型", "GL5a-1\tH 550x250x10x25\t\tQ355B\t焊接H型", "GL5a-2\tH 550x300x14x25\t\tQ355B\t焊接H型", "GL6-1\tHN 600x200x11x17\t\tQ355B\t热轧", "GL6-2\tH 600x300x12x20\t\tQ355B\t焊接H型", "GL6-3\tH 600x350x12x25\t\tQ355B\t焊接H型", "GL6-4\tH 600x350x16x35\t\tQ355B\t焊接H型", "GL7-1\tHN 700x300x13x24\t\tQ355B\t热轧", "GL7-2\tH 700x350x14x30\t\tQ355B\t焊接H型", "GL7-3\tH 700x350x14x35\t\tQ355B\t焊接H型", "GL8-1\tHN 800x300x14x26\t\tQ355B\t热轧", "GL8-2\tH 800x300x20x40\t\tQ345GJB\t焊接H型", "GL9-1\tH 900x300x20x30\t\tQ355B\t焊接H型", "GL9-2\tH 900x400x20x40\t\tQ345GJB\t焊接H型", "GL10-1\tH 1000x400x20x30\t\tQ355B\t焊接H型", "GL10-2\tH 1000x500x20x30\t\tQ355B\t焊接H型", "GL10-3\tH 1000x500x20x35\t\tQ355B\t焊接H型", "GL10-4\tH 1000x400x20x40\t\tQ345GJB\t焊接H型", "GL10-5\tH 1000x500x20x40\t\tQ345GJB\t焊接H型", "GL10-6\t□ 1000x400x20x40\t\tQ345GJB\t焊接箱型", "GL12-1\tH 1200x400x25x50\t\tQ345GJB\t焊接H型"])

# ---- group: 输入梁编号Texts所在图层
panel_12 = Panel("text-def")

# ---- group: 导入一条梁中线
# （4）导入梁中线+结构编号，生成对应的钢板焊埋件
crv_10 = Curve(<curve referenced from the Rhino model>)

# ----
# 手动输入埋件Tag
panel_13 = Panel("""1-1
2-2""")

# ---- group: 参考线起点
number_slider_13 = Slider(0.806, range=0..1)

# ---- group: Dimension Offset Input 2
number_slider_14 = Slider(1000, range=0..1000)

# ---- group: 移除重复位置点-容差
number_slider_15 = Slider(200, range=0..1000)

# ---- group: Dimension Offset Input 1
number_slider_16 = Slider(2000, range=0..10000)

# ---- group: 标注区域-单一轴网
标准范围_符合单一轴网方向 = Curve(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)

# ---- group: 轴网XY2个方向的线
crv_11 = Curve(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)
crv_12 = Curve(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)

# ---- group: 参考线: 符合轴网方向+囊括整个建筑
# (9)Bake Me!!
# 下层图纸-单一区域
crv_13 = Curve(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)

# ---- group: 移除重复位置点-容差
number_slider_17 = Slider(200, range=0..1000)

# ---- group: 参考线起点
number_slider_18 = Slider(0.548, range=0..1)

# ---- group: Dimension Offset Input 2
number_slider_19 = Slider(1000, range=0..1000)

# ---- group: Dimension Offset Input 1
number_slider_20 = Slider(2000, range=0..10000)

# ---- group: 标注区域-单一轴网
标准范围_符合单一轴网方向_2 = Curve(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)

# ---- group: 轴网XY2个方向的线
crv_14 = Curve(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)
crv_15 = Curve(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)

# ----
layer_4 = ObjectLayer(Guid=crv)  # -> LayerIndex, LayerPathName
panel_14 = Panel(data_2)
panel_16 = Panel(layer_4.LayerPathName)
panel_17 = Panel(data_3)
refblock_2 = ReferenceBlockByName(BlockName=panel_14)
refblock_3 = ReferenceBlockByName(BlockName=panel_17)
reflay_4 = ReferenceByLayer(LayerName=panel_16)

# ---- group: 参考线: 符合轴网方向+囊括整个建筑
# (9)Bake Me!!
# 上层图纸-单一区域
crv_16 = Curve(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)

# ----
# 导入梁中线+结构编号
# 注意：
# 导入完之后可能要点一下Update确保导入成功
layer_5 = ObjectLayer(Guid=crv_10)  # -> LayerIndex, LayerPathName
reflay_5 = ReferenceByLayer(LayerName=layer_5.LayerPathName)
reflay_6 = ReferenceByLayer(LayerName=panel_12)

panel_18 = Panel(txt)

panel_19 = Panel(txt_2)

# ----
# （0）准备阶段
# 检测各个图层Block的Plane
panel_20 = Panel(listblockd)
deblock = DeconstructBlock(Block=refblock)  # -> Name, Plane, Geometry

# ----
# Step3.检测plane是否存在+查看Plane的Y轴方向
pln = Plane(deblock.Plane)

deblock_2 = DeconstructBlock(Block=refblock_3)  # -> Name, Plane, Geometry
deblock_3 = DeconstructBlock(Block=refblock_2)  # -> Name, Plane, Geometry

# ----
# Step4.如果不存在则Blake geometry
# 并在rhino里面清理线段
geo_3 = Geometry(deblock.Geometry)

# ---- group: the Dimension Reference Curve
seam = Seam(Curve=reparameterize(crv_13), Seam=number_slider_13)

# ---- group: The Start Point of the Dimension Reference Curve
eval = EvaluateCurve(Curve=reparameterize(crv_13), Parameter=number_slider_13)  # -> Point, Tangent, Angle

# ---- group: Dimension Style
panel_21 = Panel("图例2-地上$0$XD100$0")

# ---- group: The Start Point of the Dimension Reference Curve
eval_2 = EvaluateCurve(Curve=reparameterize(crv_16), Parameter=number_slider_18)  # -> Point, Tangent, Angle

# ---- group: the Dimension Reference Curve
seam_2 = Seam(Curve=reparameterize(crv_16), Seam=number_slider_18)

# ---- group: Dimension Style
panel_22 = Panel("图例2-地上$0$XD100$0")

# ----
xy = XYPlane(Origin=Point(0, 0, 0))
xy_2 = XYPlane(Origin=Point(0, 0, 0))
xy_3 = XYPlane(Origin=Point(0, 0, 0))
xy_4 = XYPlane(Origin=Point(0, 0, 0))
xy_5 = XYPlane(Origin=Point(0, 0, 0))
xy_6 = XYPlane(Origin=Point(0, 0, 0))
xy_7 = XYPlane(Origin=Point(0, 0, 0))
xy_8 = XYPlane(Origin=Point(0, 0, 0))
project = Project(Geometry=crv_8, Plane=xy_4)  # -> Geometry, Transform
project_2 = Project(Geometry=crv_3, Plane=xy_5)  # -> Geometry, Transform
project_3 = Project(Geometry=crv_6, Plane=xy_6)  # -> Geometry, Transform
project_4 = Project(Geometry=crv_9, Plane=xy_8)  # -> Geometry, Transform
project_5 = Project(Geometry=crv_5, Plane=xy_7)  # -> Geometry, Transform

# ---- group: All-下-幕墙线
crv_17 = Curve(project_5.Geometry)

# ----
crv_18 = Curve(project.Geometry)
crv_19 = Curve(project_3.Geometry)
crv_20 = Curve(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)
crv_21 = Curve(project_2.Geometry)

# ---- group: All-上-幕墙线
crv_22 = Curve(project_4.Geometry)

# ----
merge = Merge(Data1=crv_3, Data2=crv_4)
merge_2 = Merge(Data1=crv_9, Data2=crv_7)
merge_3 = Merge(Data1=crv_3, Data2=crv_4)
project_6 = Project(Geometry=refblock_2, Plane=xy)  # -> Geometry, Transform
project_7 = Project(Geometry=refblock_3, Plane=xy_2)  # -> Geometry, Transform
project_8 = Project(Geometry=reflay_4, Plane=xy_3)  # -> Geometry, Transform

# ---- group: Smoothed Curve-Site
crv_23 = Curve(crv_17)

# ---- group: Boundary Curve-Site
clscrv = CloseCurve(Curve=crv_17, CloseType=0, Bulge=0.5, Tolerance=0)  # -> Closed, R

# ---- group: 制作上层定位平面 / Smoothed Curve-Site
crv_24 = Curve(crv_22)

# ---- group: 制作上层定位平面 / Boundary Curve-Site
clscrv_2 = CloseCurve(Curve=merge_2, CloseType=0, Bulge=0.5, Tolerance=0)  # -> Closed, R

# ---- group: 制作上层定位平面 / Smoothed Curve-Site
crv_25 = Curve(merge)

# ---- group: 制作上层定位平面 / Boundary Curve-Site
clscrv_3 = CloseCurve(Curve=merge_3, CloseType=0, Bulge=0.5, Tolerance=0)  # -> Closed, R

# ----
cluster = Cluster_3(
    structure_number=panel_8,
    tag_text=panel_11,
    text_offset=number_slider_3,
    embed_color=swatch,
    T=txt,
    A=number_slider_4,
    A_2=number_slider_5,
    B=number_slider_6,
    dimension_style=panel_7)  # -> R, G_2, R_2
data_4 = Data(flatten(cluster.R_2))
item = ListItem(List=data_4, Index=0, Wrap=True)  # -> Item, Item1
merge_4 = Merge(Data1=item.Item, Data2=item.Item1)

# ----
# 生成下层定位平面
disc = Discontinuity(Curve=graft(crv_23), Level=1)  # -> Points, Parameters
crv_cp = CurveClosestPoint(Point=disc.Points, Curve=graft(crv_23))  # -> Point, Parameter, Distance
eval_3 = EvaluateCurve(Curve=graft(crv_23), Parameter=crv_cp.Parameter)  # -> flatten(Point), Tangent, flatten(Angle)
deg = Degrees(Radians=eval_3.Angle)
offset = OffsetCurve(Curve=clscrv.Closed, Distance=expr("-X", Slider(300, range=0..1000)), Corners=1)
larger = LargerThan(FirstNumber=deg, SecondNumber=Slider(70, range=0..100))  # -> LargerThan, OrEqualTo
disc_2 = Discontinuity(Curve=offset, Level=1)  # -> flatten(Points), Parameters
dispatch_2 = Dispatch(List=deg, DispatchPattern=larger.LargerThan)  # -> ListA, ListB
dispatch_3 = Dispatch(List=eval_3.Point, DispatchPattern=larger.LargerThan)  # -> ListA, ListB
data_5 = Data(dispatch_3.ListA)
smaller = SmallerThan(FirstNumber=dispatch_2.ListA, SecondNumber=Slider(100, range=0..100))  # -> SmallerThan, OrEqualTo
dispatch_4 = Dispatch(List=data_5, DispatchPattern=smaller.SmallerThan)  # -> ListA, ListB
data_6 = Data(dispatch_4.ListA)
pull = PullPoint(Point=data_6, Geometry=flatten(offset), ClosestOnly=True)  # -> ClosestPoint, Distance
testpoint = TestPoint(archPoint=pull.ClosestPoint, crvPoint=disc_2.Points)  # -> out, specialPt; inputs archPoint: list of Point3d, crvPoint: list of Point3d
# ---------- testpoint: C# ----------
    List<int> passIndex = new List<int>();

    for(int i = 0; i < archPoint.Count; i++){
      foreach(Point3d t in crvPoint){
        if(archPoint[i].X == t.X && archPoint[i].Y == t.Y && archPoint[i].Z == t.Z){
          Print("pass");
          passIndex.Add(i);}
      }
    }

    specialPt = passIndex;
# ---------- end testpoint ----------
cull_i = CullIndex(List=data_6, Indices=testpoint.specialPt, Wrap=True)
item_2 = ListItem(List=data_6, Index=testpoint.specialPt, Wrap=True)

# ---- group: 制作下层定位平面 / Smoothed Curve-Site
crv_26 = Curve(crv_17)

# ---- group: 制作下层定位平面 / Boundary Curve-Site
clscrv_4 = CloseCurve(Curve=crv_17, CloseType=0, Bulge=0.5, Tolerance=0)  # -> Closed, R

# ---- group: 制作下层定位平面
crv_27 = Curve(flatten(reflay_5))
movetoplane = MoveToPlane(Geometry=reflay_2, Plane=PlaneXY(0, 0, 0), Above=True, Below=True)  # -> Geometry, Transform
movetoplane_2 = MoveToPlane(Geometry=crv_27, Plane=PlaneXY(0, 0, 0), Above=True, Below=True)  # -> Geometry, Transform
area_2 = Area(Geometry=movetoplane.Geometry)  # -> Area, Centroid
pull_2 = PullPoint(Point=area_2.Centroid, Geometry=movetoplane_2.Geometry, ClosestOnly=True)  # -> ClosestPoint, Distance
larger_2 = LargerThan(FirstNumber=pull_2.Distance, SecondNumber="800")  # -> LargerThan, OrEqualTo
dispatch_5 = Dispatch(List=area_2.Centroid, DispatchPattern=larger_2.LargerThan)  # -> ListA, ListB

# ---- group: 制作上层定位平面
disc_3 = Discontinuity(Curve=graft(crv_24), Level=1)  # -> Points, Parameters
crv_cp_2 = CurveClosestPoint(Point=disc_3.Points, Curve=graft(crv_24))  # -> Point, Parameter, Distance
eval_4 = EvaluateCurve(Curve=graft(crv_24), Parameter=crv_cp_2.Parameter)  # -> flatten(Point), Tangent, flatten(Angle)
deg_2 = Degrees(Radians=eval_4.Angle)
offset_2 = OffsetCurve(Curve=clscrv_2.Closed, Distance=expr("-X", Slider(300, range=0..1000)), Corners=1)
larger_3 = LargerThan(FirstNumber=deg_2, SecondNumber=Slider(70, range=0..100))  # -> LargerThan, OrEqualTo
disc_4 = Discontinuity(Curve=offset_2, Level=1)  # -> flatten(Points), Parameters
dispatch_6 = Dispatch(List=deg_2, DispatchPattern=larger_3.LargerThan)  # -> ListA, ListB
dispatch_7 = Dispatch(List=eval_4.Point, DispatchPattern=larger_3.LargerThan)  # -> ListA, ListB
data_7 = Data(dispatch_7.ListA)
smaller_2 = SmallerThan(FirstNumber=dispatch_6.ListA, SecondNumber=Slider(100, range=0..100))  # -> SmallerThan, OrEqualTo
dispatch_8 = Dispatch(List=data_7, DispatchPattern=smaller_2.SmallerThan)  # -> ListA, ListB
data_8 = Data(dispatch_8.ListA)
pull_3 = PullPoint(Point=data_8, Geometry=flatten(offset_2), ClosestOnly=True)  # -> ClosestPoint, Distance
testpoint_2 = TestPoint(archPoint=pull_3.ClosestPoint, crvPoint=disc_4.Points)  # -> out, specialPt; inputs archPoint: list of Point3d, crvPoint: list of Point3d; same code as testpoint

disc_5 = Discontinuity(Curve=graft(crv_25), Level=1)  # -> Points, Parameters
crv_cp_3 = CurveClosestPoint(Point=disc_5.Points, Curve=graft(crv_25))  # -> Point, Parameter, Distance
eval_5 = EvaluateCurve(Curve=graft(crv_25), Parameter=crv_cp_3.Parameter)  # -> flatten(Point), Tangent, flatten(Angle)
deg_3 = Degrees(Radians=eval_5.Angle)
offset_3 = OffsetCurve(Curve=clscrv_3.Closed, Distance=expr("-X", Slider(300, range=0..1000)), Corners=1)
larger_4 = LargerThan(FirstNumber=deg_3, SecondNumber=Slider(70, range=0..100))  # -> LargerThan, OrEqualTo
disc_6 = Discontinuity(Curve=offset_3, Level=1)  # -> flatten(Points), Parameters
dispatch_9 = Dispatch(List=deg_3, DispatchPattern=larger_4.LargerThan)  # -> ListA, ListB
dispatch_10 = Dispatch(List=eval_5.Point, DispatchPattern=larger_4.LargerThan)  # -> ListA, ListB
data_9 = Data(dispatch_10.ListA)
smaller_3 = SmallerThan(FirstNumber=dispatch_9.ListA, SecondNumber=Slider(100, range=0..100))  # -> SmallerThan, OrEqualTo
dispatch_11 = Dispatch(List=data_9, DispatchPattern=smaller_3.SmallerThan)  # -> ListA, ListB
data_10 = Data(dispatch_11.ListA)
pull_4 = PullPoint(Point=data_10, Geometry=flatten(offset_3), ClosestOnly=True)  # -> ClosestPoint, Distance
testpoint_3 = TestPoint(archPoint=pull_4.ClosestPoint, crvPoint=disc_6.Points)  # -> out, specialPt; inputs archPoint: list of Point3d, crvPoint: list of Point3d; same code as testpoint

# ---- group: 制作下层定位平面
disc_7 = Discontinuity(Curve=graft(crv_26), Level=1)  # -> Points, Parameters
crv_cp_4 = CurveClosestPoint(Point=disc_7.Points, Curve=graft(crv_26))  # -> Point, Parameter, Distance
eval_6 = EvaluateCurve(Curve=graft(crv_26), Parameter=crv_cp_4.Parameter)  # -> flatten(Point), Tangent, flatten(Angle)
deg_4 = Degrees(Radians=eval_6.Angle)
offset_4 = OffsetCurve(Curve=clscrv_4.Closed, Distance=expr("-X", Slider(300, range=0..1000)), Corners=1)
larger_5 = LargerThan(FirstNumber=deg_4, SecondNumber=Slider(70, range=0..100))  # -> LargerThan, OrEqualTo
disc_8 = Discontinuity(Curve=offset_4, Level=1)  # -> flatten(Points), Parameters
dispatch_12 = Dispatch(List=deg_4, DispatchPattern=larger_5.LargerThan)  # -> ListA, ListB
dispatch_13 = Dispatch(List=eval_6.Point, DispatchPattern=larger_5.LargerThan)  # -> ListA, ListB
data_11 = Data(dispatch_13.ListA)
smaller_4 = SmallerThan(FirstNumber=dispatch_12.ListA, SecondNumber=Slider(100, range=0..100))  # -> SmallerThan, OrEqualTo
dispatch_14 = Dispatch(List=data_11, DispatchPattern=smaller_4.SmallerThan)  # -> ListA, ListB
data_12 = Data(dispatch_14.ListA)
pull_5 = PullPoint(Point=data_12, Geometry=flatten(offset_4), ClosestOnly=True)  # -> ClosestPoint, Distance
testpoint_4 = TestPoint(archPoint=pull_5.ClosestPoint, crvPoint=disc_8.Points)  # -> out, specialPt; inputs archPoint: list of Point3d, crvPoint: list of Point3d; same code as testpoint

# ---- group: 制作下层定位平面 / 与梁中线距离小于800的点
pt = Point(dispatch_5.ListB)

# ---- group: 制作下层定位平面 / 定位点Offset450后二次筛选是否与梁有交点
pull_6 = PullPoint(Point=pt, Geometry=movetoplane_2.Geometry, ClosestOnly=True)  # -> ClosestPoint, Distance
end = EndPoints(Curve=crv_27)  # -> Start, End
merge_5 = Merge(Data1=end.Start, Data2=end.End)  # -> flatten(Result)
pull_7 = PullPoint(Point=pull_6.ClosestPoint, Geometry=merge_5, ClosestOnly=True)  # -> ClosestPoint, Distance
larger_6 = LargerThan(FirstNumber=pull_7.Distance, SecondNumber="1")  # -> LargerThan, OrEqualTo
dispatch_15 = Dispatch(List=pt, DispatchPattern=larger_6.LargerThan)  # -> ListA, ListB

# ----
钢埋板长度_2 = Division(A=number_slider_9, B=2)
neg = Negative(Value=钢埋板长度_2)
dom = ConstructDomain(DomainStart=neg, DomainEnd=钢埋板长度_2)
panel_23 = Panel(dom)

钢埋板厚度_2 = Division(A=number_slider_10, B=2)
neg_2 = Negative(Value=钢埋板厚度_2)
dom_2 = ConstructDomain(DomainStart=neg_2, DomainEnd=钢埋板厚度_2)
panel_24 = Panel(dom_2)

# ----
# 钢埋板肋板位置 1/4处
panel_25 = Panel("4")
division = Division(A=number_slider_9, B=panel_25)

# ----
# 列表文字以空格进行分割
panel_26 = Panel(" ")
split = TextSplit(Text=txt_2, Separators=panel_26)

# ----
# 编号和截面尺寸分区
panel_27 = Panel("1")
split_2 = SplitList(List=split, Index=panel_27)  # -> flatten(ListA), flatten(ListB)

# ---- group: 制作上层定位平面
# 阴角
cull_i_2 = CullIndex(List=data_8, Indices=testpoint_2.specialPt, Wrap=True)

# 阳角
item_3 = ListItem(List=data_8, Index=testpoint_2.specialPt, Wrap=True)

# 阴角
cull_i_3 = CullIndex(List=data_10, Indices=testpoint_3.specialPt, Wrap=True)

# 阳角
item_4 = ListItem(List=data_10, Index=testpoint_3.specialPt, Wrap=True)

# ----
merge_6 = Merge(Data1=item_2, Data2=cull_i)  # -> flatten(Result)

# ---- group: 制作上层定位平面
# 生成上层定位平面
merge_7 = Merge(Data1=item_3, Data2=cull_i_2)  # -> flatten(Result)

# 生成檐口定位平面
merge_8 = Merge(Data1=item_4, Data2=cull_i_3)  # -> flatten(Result)

# ---- group: 制作下层定位平面
# 阴角
cull_i_4 = CullIndex(List=data_12, Indices=testpoint_4.specialPt, Wrap=True)

# 阳角
item_5 = ListItem(List=data_12, Index=testpoint_4.specialPt, Wrap=True)

# ---- group: 制作下层定位平面 / 定位点Offset450后二次筛选是否与梁有交点 / 与梁直接由交点
pt_2 = Point(dispatch_15.ListA)

# ---- group: 制作下层定位平面
# 生成下层定位平面-old
merge_9 = Merge(Data1=item_5, Data2=cull_i_4)  # -> flatten(Result)

# ---- group: 下-阴阳角
data_13 = Data(merge_9)

# ----
movetoplane_3 = MoveToPlane(Geometry=reflay_2, Plane=PlaneXY(0, 0, 0), Above=True, Below=True)  # -> Geometry, Transform
area_3 = Area(Geometry=movetoplane_3.Geometry)  # -> Area, Centroid
pt_3 = Point(area_3.Centroid)

# ---- group: 制作上层定位平面
movetoplane_4 = MoveToPlane(Geometry=reflay_3, Plane=PlaneXY(0, 0, 0), Above=True, Below=True)  # -> Geometry, Transform
area_4 = Area(Geometry=movetoplane_4.Geometry)  # -> Area, Centroid
pt_4 = Point(area_4.Centroid)

movetoplane_5 = MoveToPlane(Geometry=reflay, Plane=PlaneXY(0, 0, 0), Above=True, Below=True)  # -> Geometry, Transform
area_5 = Area(Geometry=movetoplane_5.Geometry)  # -> Area, Centroid
pt_5 = Point(area_5.Centroid)

# ---- group: 制作下层定位平面 / 与梁距离大于800的点
pt_6 = Point(dispatch_5.ListA)

# ----
xy_9 = XYPlane(Origin=Point(0, 0, 0))
xy_10 = XYPlane(Origin=Point(0, 0, 0))
xy_11 = XYPlane(Origin=Point(0, 0, 0))

# ---- group: 制作下层定位平面 / 筛选阴阳角 / 阴阳角的点
pt_7 = Point(merge_9)

# ----
# 单体选型
list_6 = ValueList({"顶埋": 0, "侧埋": 1}, selected="顶埋")

# ---- group: F2 Arch Outline
crv_28 = Curve(crv_18)

# ----
# 选要重塑的线段长度
number_slider_21 = Slider(1200, range=0..10000)

# ---- group: 车道区域 / 檐口线Input
crv_29 = Curve(crv_21)

# ---- group: 檐口线Input
crv_30 = Curve(crv_21)

crv_31 = Curve(crv_21)

# ----
# 调整重塑线段的平滑度
number_slider_22 = Slider(11, range=0..11)

# ----
# 区分内外梁边线
# 1.根据F2建筑线制作轮廓线
explode = Explode(Curve=crv_28, Recursive=True)  # -> Segments, Vertices
len = Length(Curve=explode.Segments)
sort = SortList(Keys=len)  # -> Keys, ValuesA
larger_7 = LargerThan(FirstNumber=len, SecondNumber=number_slider_21)  # -> LargerThan, OrEqualTo
panel_28 = Panel(sort.Keys)
dispatch_16 = Dispatch(List=explode.Segments, DispatchPattern=larger_7.LargerThan)  # -> ListA, ListB
data_14 = Data(dispatch_16.ListA)
data_15 = Data(dispatch_16.ListB)
join = JoinCurves(Curves=data_15, Preserve=False)
disc_9 = Discontinuity(Curve=join, Level=1)  # -> Points, Parameters
nurbs = NurbsCurve(Vertices=disc_9.Points, Degree=number_slider_22, Periodic=False)  # -> flatten(Curve), Length, Domain
join_2 = JoinCurves(Curves=flatten([data_14, nurbs.Curve]), Preserve=False)
offset_5 = OffsetCurve(Curve=join_2, Distance=Slider(6859, range=0..10000), Corners=1)

# ---- group: F2 Archline - Smoothed
reb = RebuildCurve(Curve=offset_5, Count=Slider(17, range=0..100), Tangents=invert(False))

# ----
# InputCurve
crv_32 = Curve()

# ----
# Curve-框住要分析的建筑单体
# 如果要用自己导入Curve作为分析线，
# 请在InputCurve那里导入curve,
# 然后在上方的选型列表选择Input Curve。
# 
# 如果要用Grasshopper自动生成的Curve,
# 请在上方的选型列表选择Default Curve。
list_7 = ValueList({"Default Curve": 0, "Input Curve": 1}, selected="Default Curve")
filter = StreamFilter(Gate=list_7, Stream0=reb, Stream1=crv_32)

crv_33 = Curve(filter)

# ----
# 要连接的梁中线Offest值
# 要连接的梁中线curve
# 要连接的embed
# 埋件向内探索最远出的梁的距离
number_slider_23 = Slider(500, range=0..10000)

# ----
# 埋件向外探索最远出的梁的距离
number_slider_24 = Slider(0, range=0..10000)

# ---- group: 楼板线
crv_34 = Curve(crv_2)

# ---- group: 檐口线内测
crv_35 = Curve(crv_4)

# ---- group: 檐口线外侧
crv_36 = Curve(crv_21)

# ---- group: 下层幕墙线
crv_37 = Curve(crv_18)

# ---- group: 上层幕墙线
crv_38 = Curve(crv_19)

# ---- group: 下层交点-除重 / 上层幕墙线
crv_39 = Curve(crv_18)

# ---- group: 下层交点-除重 / 下层幕墙线
crv_40 = Curve(crv_19)

# ---- group: 下层交点-除重 / 容差
number_slider_25 = Slider(100, range=0..200)

# ----
# 是否有吊顶：
# 下层幕墙边线在结构边梁以内>350
# 
# （最外层结构线）
number_slider_26 = Slider(350, range=0..1000)

# ---- group: 下层Arch Line
crv_41 = Curve(crv_19)

# ----
# 3.2下层建筑边线内侧300-600mm范围内
number_slider_27 = Slider(600, range=0..1000)
crv_42 = Curve(crv_41)
offset_6 = OffsetCurve(Curve=crv_42, Distance=expr("-x", Slider(300, range=0..1000)), Corners=1)
offset_7 = OffsetCurve(Curve=crv_42, Distance=expr("-x", number_slider_27), Corners=1)

# ----
# 3.1下层建筑边线外侧50-350mm范围内
number_slider_28 = Slider(350, range=0..1000)
crv_43 = Curve(crv_41)
offset_8 = OffsetCurve(Curve=crv_43, Distance=number_slider_28, Corners=1)
offset_9 = OffsetCurve(Curve=crv_43, Distance=Slider(50, range=0..100), Corners=1)

# ----
# 4下层建筑内侧到300到外侧50内
# 有钢结构
number_slider_29 = Slider(50, range=0..1000)
crv_44 = Curve(crv_41)
offset_10 = OffsetCurve(Curve=crv_44, Distance=expr("-x", Slider(300, range=0..1000)), Corners=1)
offset_11 = OffsetCurve(Curve=crv_44, Distance=number_slider_29, Corners=1)

# ---- group: 上层幕墙线
crv_45 = Curve(crv_18)

# ----
# 这里如果跑红也不要紧，
# 说明单体没有出现相撞的情况
data_16 = Data(flatten(merge_4))
item_6 = ListItem(List=data_16, Index=0, Wrap=True)
item_7 = ListItem(List=data_16, Index="-1", Wrap=True)

# ----
# （3.1）导入轴线
crv_46 = Curve(<curve referenced from the Rhino model>)
layer_6 = ObjectLayer(Guid=crv_46)  # -> LayerIndex, LayerPathName
panel_29 = Panel(layer_6.LayerPathName)
reflay_7 = ReferenceByLayer(LayerName=panel_29)
xy_12 = XYPlane(Origin=Point(0, 0, 0))
project_9 = Project(Geometry=reflay_7, Plane=xy_12)  # -> Geometry, Transform

# ----
# 求内部曲线转折点
crv_47 = Curve()  # disabled
number_slider_30 = Slider(300, range=0..1000)  # disabled
neg_3 = Negative(Value=number_slider_30)  # disabled
filter_2 = StreamFilter(Gate=toggle, Stream0=number_slider_30, Stream1=neg_3)  # disabled
number_slider_31 = Slider(60, range=0..100)  # disabled

ext = ExtendCurve(Curve=crv_47, Type=0, Start=number_slider, End=number_slider)  # disabled

# ----
# 第二层
# 
# Curves(location point)+ Smooth Curves(architecture line)
# 第二层-区分阴阳角
area_6 = Area(Geometry=geo_2)  # -> Area, Centroid; disabled
crv_48 = Curve(crv_47)  # disabled
pull_8 = PullPoint(Point=area_6.Centroid, Geometry=crv_48, ClosestOnly=True)  # -> ClosestPoint, Distance; disabled
number_slider_32 = Slider(200, range=0..1000)  # disabled
number_slider_33 = Slider(100, range=0..300)  # disabled

# ----
# 第二层-阴阳角
panel_30 = Panel("0.5 * Pi")  # disabled
toggle_2 = BooleanToggle(True)  # disabled
neg_4 = Negative(Value=panel_30)  # disabled
filter_3 = StreamFilter(Gate=toggle_2, Stream0=panel_30, Stream1=neg_4)  # disabled

# ----
# 第二层-大面定位
panel_31 = Panel("0.5 * Pi")  # disabled
toggle_3 = BooleanToggle(True)  # disabled
neg_5 = Negative(Value=panel_31)  # disabled
filter_4 = StreamFilter(Gate=toggle_3, Stream0=panel_31, Stream1=neg_5)  # disabled

number_slider_34 = Slider(300, range=0..1000)  # disabled
number_slider_35 = Slider(1.5, range=0..10)  # disabled

number_slider_36 = Slider(300, range=0..1000)  # disabled
number_slider_37 = Slider(1.5, range=0..10)  # disabled

number_slider_38 = Slider(300, range=0..1000)  # disabled
number_slider_39 = Slider(1.5, range=0..10)  # disabled

# ----
# 显示"False"时要选择线段延长
list_8 = ValueList({"线段不延长": 0, "线段延长": 1}, selected="线段延长")  # disabled

filter_5 = StreamFilter(Gate=list_8, Stream0=crv_47, Stream1=ext)  # disabled

disc_10 = Discontinuity(Curve=graft(filter_5), Level=1)  # -> Points, Parameters; disabled
crv_cp_5 = CurveClosestPoint(Point=disc_10.Points, Curve=graft(filter_5))  # -> Point, Parameter, Distance; disabled
eval_7 = EvaluateCurve(Curve=graft(filter_5), Parameter=crv_cp_5.Parameter)  # -> flatten(Point), Tangent, flatten(Angle); disabled
deg_5 = Degrees(Radians=eval_7.Angle)  # disabled
offset_12 = OffsetCurve(Curve=filter_5, Distance=expr("-X", filter_2), Corners=1)  # disabled
panel_32 = Panel(deg_5)  # disabled
larger_8 = LargerThan(FirstNumber=deg_5, SecondNumber=number_slider_31)  # -> LargerThan, OrEqualTo; disabled
disc_11 = Discontinuity(Curve=offset_12, Level=1)  # -> flatten(Points), Parameters; disabled
dispatch_17 = Dispatch(List=eval_7.Point, DispatchPattern=larger_8.LargerThan)  # -> ListA, ListB; disabled
end_2 = EndPoints(Curve=filter_5)  # -> Start, End; disabled
data_17 = Data(dispatch_17.ListA)  # disabled
pull_9 = PullPoint(Point=data_17, Geometry=flatten(offset_12), ClosestOnly=True)  # -> ClosestPoint, Distance; disabled
testpoint_5 = TestPoint(archPoint=pull_9.ClosestPoint, crvPoint=disc_11.Points)  # -> out, specialPt; inputs archPoint: list of Point3d, crvPoint: list of Point3d; disabled; same code as testpoint

# ----
# 阴角
item_8 = ListItem(List=data_17, Index=testpoint_5.specialPt, Wrap=True)  # disabled

# ----
# SmoothCurve-阴角&阳角
# 阳角
cull_i_5 = CullIndex(List=data_17, Indices=testpoint_5.specialPt, Wrap=True)  # disabled

dist = Distance(PointA=pull_8.ClosestPoint, PointB=data_17)  # disabled
sort_2 = SortList(Keys=dist)  # -> Keys, ValuesA; disabled
panel_33 = Panel(sort_2.Keys)  # disabled
smaller_5 = SmallerThan(FirstNumber=dist, SecondNumber=number_slider_32)  # -> SmallerThan, OrEqualTo; disabled
dispatch_18 = Dispatch(List=geo_2, DispatchPattern=smaller_5.SmallerThan)  # -> ListA, ListB; disabled
crv_49 = Curve(filter_5)  # disabled

data_18 = Data(dispatch_18.ListA)  # disabled
explode_2 = Explode(Curve=data_18, Recursive=True)  # -> Segments, Vertices; disabled
len_2 = Length(Curve=explode_2.Segments)  # disabled
sort_3 = SortList(Keys=reverse(len_2), ValuesA=explode_2.Segments)  # -> Keys, ValuesA; disabled
item_9 = ListItem(List=sort_3.ValuesA, Index=0, Wrap=True)  # -> flatten(Item); disabled
area_7 = Area(Geometry=data_18)  # -> Area, Centroid; disabled
midpt = CurveMiddle(Curve=item_9)  # disabled
move2pt = MoveToPoint(Geometry=item_9, PointA=midpt, PointB=area_7.Centroid)  # -> Moved, Vector, Transform; disabled
end_3 = EndPoints(Curve=move2pt.Moved)  # -> Start, End; disabled
ln = Line(StartPoint=end_3.Start, EndPoint=end_3.End)  # disabled
xy_13 = XYPlane(Origin=end_3.End)  # disabled
rotate = Rotate(Geometry=ln, Angle=filter_3, Plane=xy_13)  # -> Geometry, Transform; disabled
pl = ConstructPlane(Origin=end_3.End, XAxis=rotate.Geometry, YAxis=ln)  # disabled

data_19 = Data(dispatch_18.ListB)  # disabled
explode_3 = Explode(Curve=data_19, Recursive=True)  # -> Segments, Vertices; disabled
len_3 = Length(Curve=explode_3.Segments)  # disabled
sort_4 = SortList(Keys=reverse(len_3), ValuesA=explode_3.Segments)  # -> Keys, ValuesA; disabled
item_10 = ListItem(List=sort_4.ValuesA, Index=0, Wrap=True)  # -> flatten(Item); disabled
area_8 = Area(Geometry=data_19)  # -> Area, Centroid; disabled
midpt_2 = CurveMiddle(Curve=item_10)  # disabled
move2pt_2 = MoveToPoint(Geometry=item_10, PointA=midpt_2, PointB=area_8.Centroid)  # -> Moved, Vector, Transform; disabled
end_4 = EndPoints(Curve=move2pt_2.Moved)  # -> Start, End; disabled
ln_2 = Line(StartPoint=end_4.Start, EndPoint=end_4.End)  # disabled
xy_14 = XYPlane(Origin=end_4.End)  # disabled
rotate_2 = Rotate(Geometry=ln_2, Angle=filter_4, Plane=xy_14)  # -> Geometry, Transform; disabled
pl_2 = ConstructPlane(Origin=end_4.End, XAxis=rotate_2.Geometry, YAxis=ln_2)  # disabled

data_20 = Data(flatten(pl_2))  # disabled
deplane = DeconstructPlane(Plane=data_20)  # -> Origin, XAxis, YAxis, ZAxis; disabled
amp = Amplitude(Vector=deplane.YAxis, Amplitude=number_slider_36)  # disabled
move = Move(Geometry=deplane.Origin, Motion=amp)  # -> Geometry, Transform; disabled
ln_3 = Line(StartPoint=deplane.Origin, EndPoint=move.Geometry)  # disabled
midpt_3 = CurveMiddle(Curve=ln_3)  # disabled
scale = Scale(Geometry=ln_3, Center=midpt_3, Factor=number_slider_37)  # -> Geometry, Transform; disabled
ccx = CurveCurve(CurveA=scale.Geometry, CurveB=crv_49)  # -> Points, ParamsA, ParamsB; disabled

dist_2 = Distance(PointA=graft(end_3.End), PointB=cull_i_5)  # disabled
sort_5 = SortList(Keys=dist_2)  # -> Keys, ValuesA; disabled
item_11 = ListItem(List=sort_5.Keys, Index=0, Wrap=True)  # disabled
smaller_6 = SmallerThan(FirstNumber=item_11, SecondNumber=number_slider_33)  # -> SmallerThan, OrEqualTo; disabled
flatten = FlattenTree(Tree=item_11, Path="{0}")  # disabled
dispatch_19 = Dispatch(List=graft(pl), DispatchPattern=smaller_6.SmallerThan)  # -> ListA, ListB; disabled
panel_34 = Panel(flatten)  # disabled
flatten_2 = FlattenTree(Tree=ccx.Points, Path="{0}")  # disabled
lng = ListLength(List=scale.Geometry)  # disabled
lng_2 = ListLength(List=flatten_2)  # disabled

data_21 = Data(flatten(dispatch_19.ListA))  # disabled
deplane_2 = DeconstructPlane(Plane=data_21)  # -> Origin, XAxis, YAxis, ZAxis; disabled
amp_2 = Amplitude(Vector=deplane_2.YAxis, Amplitude=number_slider_34)  # disabled
move_2 = Move(Geometry=deplane_2.Origin, Motion=amp_2)  # -> Geometry, Transform; disabled
ln_4 = Line(StartPoint=deplane_2.Origin, EndPoint=move_2.Geometry)  # disabled
midpt_4 = CurveMiddle(Curve=ln_4)  # disabled
scale_2 = Scale(Geometry=ln_4, Center=midpt_4, Factor=number_slider_35)  # -> Geometry, Transform; disabled
ccx_2 = CurveCurve(CurveA=scale_2.Geometry, CurveB=crv_49)  # -> Points, ParamsA, ParamsB; disabled

data_22 = Data(flatten(dispatch_19.ListB))  # disabled
deplane_3 = DeconstructPlane(Plane=data_22)  # -> Origin, XAxis, YAxis, ZAxis; disabled
amp_3 = Amplitude(Vector=deplane_3.YAxis, Amplitude=number_slider_38)  # disabled
move_3 = Move(Geometry=deplane_3.Origin, Motion=amp_3)  # -> Geometry, Transform; disabled
ln_5 = Line(StartPoint=deplane_3.Origin, EndPoint=move_3.Geometry)  # disabled
midpt_5 = CurveMiddle(Curve=ln_5)  # disabled
scale_3 = Scale(Geometry=ln_5, Center=midpt_5, Factor=number_slider_39)  # -> Geometry, Transform; disabled
ccx_3 = CurveCurve(CurveA=scale_3.Geometry, CurveB=crv_49)  # -> Points, ParamsA, ParamsB; disabled

equals = Equality(FirstNumber=lng, SecondNumber=lng_2)  # -> Equality, Inequality; disabled
panel_35 = Panel(equals.Equality)  # disabled

# ----
# InsideCurve-大面
move2pt_3 = MoveToPoint(Geometry=data_20, PointA=flatten(deplane.Origin), PointB=flatten(ccx.Points))  # -> Moved, Vector, Transform; disabled

# ----
# InsideCurve-阳角
move2pt_4 = MoveToPoint(Geometry=data_21, PointA=deplane_2.Origin, PointB=ccx_2.Points)  # -> Moved, Vector, Transform; disabled

# ----
# InsideCurve-阴角
move2pt_5 = MoveToPoint(Geometry=data_22, PointA=deplane_3.Origin, PointB=ccx_3.Points)  # -> Moved, Vector, Transform; disabled

swatch_2 = ColourSwatch(SwatchColor=RGB(140, 140, 140))
# (9)Bake Me!!
# 埋件和阴阳角定位
panel_36 = Panel("阴阳角定位-F1+F2")

layer_7 = DefineLayer(Name=panel_36, Color=swatch_2)
attributes = DefineObjectAttributes(Layer=layer_7, Color=swatch_2)

swatch_3 = ColourSwatch(SwatchColor=RGB(255, 212, 0))

swatch_4 = ColourSwatch(SwatchColor=RGB(255, 242, 66))

swatch_5 = ColourSwatch(SwatchColor=RGB(255, 242, 66))

swatch_6 = ColourSwatch(SwatchColor=RGB(180, 255, 66))

swatch_7 = ColourSwatch(SwatchColor=RGB(66, 255, 69))

swatch_8 = ColourSwatch(SwatchColor=RGB(66, 255, 236))

swatch_9 = ColourSwatch(SwatchColor=RGB(66, 167, 255))

swatch_10 = ColourSwatch(SwatchColor=RGB(66, 98, 255))

# ----
# 1.1-掩口出侧埋遗漏
panel_37 = Panel("1.1-掩口出侧埋遗漏")
layer_8 = DefineLayer(Name=panel_37)
attributes_2 = DefineObjectAttributes(Layer=layer_8)

# ----
# 生成埋件编号
# 注意：
# 可以选择机动生成or手动输入埋件Tag可以参考下方右侧的”涉及到的梁编号“来手动输入对应的埋件编号
list_9 = ValueList({"机动生成埋件Tags": 0, "手动输入埋件Tags": 1}, selected="机动生成埋件Tags")

layer_9 = DefineLayer(Name="Tag::1-1-02钢板焊埋件", Color=swatch_3)
layer_10 = DefineLayer(Name="Embed::1-1-02钢板焊埋件", Color=swatch_3)
entwine = Entwine(Branch00=layer_10, Branch01=layer_9, FlattenInputs=True)
attributes_3 = DefineObjectAttributes(Layer=entwine, Color=swatch_3)

layer_11 = DefineLayer(Name="Tag::2-1-03钢板焊埋件", Color=swatch_5)
layer_12 = DefineLayer(Name="Embed::2-1-03钢板焊埋件", Color=swatch_5)
entwine_2 = Entwine(Branch00=layer_12, Branch01=layer_11, FlattenInputs=True)
attributes_4 = DefineObjectAttributes(Layer=entwine_2, Color=swatch_5)

layer_13 = DefineLayer(Name="Tag::1-0-01钢板焊埋件", Color=swatch_4)
layer_14 = DefineLayer(Name="Embed::1-0-01钢板焊埋件", Color=swatch_4)
entwine_3 = Entwine(Branch00=layer_14, Branch01=layer_13, FlattenInputs=True)
attributes_5 = DefineObjectAttributes(Layer=entwine_3, Color=swatch_4)

layer_15 = DefineLayer(Name="Tag::3-1-03钢板焊埋件", Color=swatch_6)
layer_16 = DefineLayer(Name="Embed::3-1-03钢板焊埋件", Color=swatch_6)
entwine_4 = Entwine(Branch00=layer_16, Branch01=layer_15, FlattenInputs=True)
attributes_6 = DefineObjectAttributes(Layer=entwine_4, Color=swatch_6)

layer_17 = DefineLayer(Name="Tag::3-2-03钢板焊埋件", Color=swatch_7)
layer_18 = DefineLayer(Name="Embed::3-2-03钢板焊埋件", Color=swatch_7)
entwine_5 = Entwine(Branch00=layer_18, Branch01=layer_17, FlattenInputs=True)
attributes_7 = DefineObjectAttributes(Layer=entwine_5, Color=swatch_7)

layer_19 = DefineLayer(Name="Tag::4-1钢板焊底埋", Color=swatch_8)
layer_20 = DefineLayer(Name="Embed::4-1钢板焊底埋", Color=swatch_8)
entwine_6 = Entwine(Branch00=layer_20, Branch01=layer_19, FlattenInputs=True)
attributes_8 = DefineObjectAttributes(Layer=entwine_6, Color=swatch_8)

layer_21 = DefineLayer(Name="Tag::5-04板埋", Color=swatch_10)
layer_22 = DefineLayer(Name="Embed::5-04板埋", Color=swatch_10)
entwine_7 = Entwine(Branch00=layer_22, Branch01=layer_21, FlattenInputs=True)
attributes_9 = DefineObjectAttributes(Layer=entwine_7, Color=swatch_10)

layer_23 = DefineLayer(Name="Tag::4-0-03默认钢板焊", Color=swatch_9)
layer_24 = DefineLayer(Name="Embed::4-0-03默认钢板焊", Color=swatch_9)
entwine_8 = Entwine(Branch00=layer_24, Branch01=layer_23, FlattenInputs=True)
attributes_10 = DefineObjectAttributes(Layer=entwine_8, Color=swatch_9)

crv_50 = Curve(project.Geometry)
panel_38 = Panel("""Dimension::Dim1
Dimension::Dim2
Dimension::Dim3
Dimension::Dim4""")
layer_25 = DefineLayer(Name=panel_38)  # -> graft(Layer)
attributes_11 = DefineObjectAttributes(Layer=layer_25)

# ----
# 生成底埋钢埋件
rectangle = Rectangle(Plane=PlaneXY(0, 0, 0), XSize=panel_4, YSize=panel_5, Radius=0)  # -> Rectangle, Length
rec = Rectangle(rectangle.Rectangle)
pln_2 = Plane(rectangle.Rectangle)

deplane_4 = DeconstructPlane(Plane=pln_2)  # -> Origin, XAxis, YAxis, ZAxis
dedomain = DeconstructDomain(Domain=panel_5)  # -> Start, End
amp_4 = Amplitude(Vector=deplane_4.YAxis, Amplitude=dedomain.End)
move_4 = Move(Geometry=deplane_4.Origin, Motion=amp_4)  # -> Geometry, Transform
ln_6 = Line(StartPoint=deplane_4.Origin, EndPoint=move_4.Geometry)
amp_5 = Amplitude(Vector=ln_6, Amplitude=Slider(190, range=0..1000))
move_5 = Move(Geometry=deplane_4.Origin, Motion=amp_5)  # -> Geometry, Transform

text = DefineTextObject(Text=panel_3, Plane=move_5.Geometry, DimensionStyle=panel_6, OutputType="Text")
group = Group(Objects=[rec, text])
merge_10 = Merge(Data1=group, Data2=pln_2)

data_23 = Data(merge_10)
item_12 = ListItem(List=data_23, Index="-1", Wrap=True)
item_13 = ListItem(List=data_23, Index=0, Wrap=True)

# ----
# 板埋：制作板埋三视图
max = Maximum(A=s_x, B=s_y)
filter_6 = StreamFilter(Gate=list, Stream0=7.2, Stream1=9.6, Stream2=11.9, Stream3=14.3, Stream4=16.7, Stream5=19.1)
filter_7 = StreamFilter(Gate=list_2, Stream0=270, Stream1=360)
filter_8 = StreamFilter(Gate=list_3, Stream0=10, Stream1=12, Stream2=16, Stream3=18, Stream4=20, Stream5=25)
filter_9 = StreamFilter(Gate=list, Stream0=0.91, Stream1=1.1, Stream2=1.27, Stream3=1.43, Stream4=1.57, Stream5=1.71)
filter_10 = StreamFilter(Gate=list_2, Stream0=0.16, Stream1=0.14)
addition = Addition(A=list_4, B=1)
addition_2 = Addition(A=list_5, B=1)
division_2 = Division(A=max, B=8)
t = Integer(division_2)
panel_39 = Panel(filter_9)
panel_40 = Panel(filter_6)
panel_41 = Panel(filter_10)
min = Minimum(A=filter_7, B=300)
panel_42 = Panel(min)
expression = Expression(A=filter_10, fy=filter_7, ft=filter_9, d=filter_8, Expression="(int((0.6*1.1*A*fy/ft*d)/5)+1)*5")

crv_51 = Curve(project.Geometry)
panel_43 = Panel("""Dimension::Dim1
Dimension::Dim2
Dimension::Dim3
Dimension::Dim4""")
layer_26 = DefineLayer(Name=panel_43)  # -> graft(Layer)
attributes_12 = DefineObjectAttributes(Layer=layer_26)

rhatt = GetRhinoAttributes(Geometry=reflay_5)  # -> Name, Layer, Color
split_3 = TextSplit(Text=rhatt.Color, Separators=",")  # -> simplify(Result)
item_14 = ListItem(List=split_3, Index=0, Wrap=True)  # -> flatten(Item), flatten(Item1), flatten(Item2)
pt_8 = ConstructPoint(XCoordinate=item_14.Item, YCoordinate=item_14.Item1, ZCoordinate=item_14.Item2)
cullpt = CullDuplicates(Points=pt_8, Tolerance=0.1, CullMode=3)  # -> Points, Indices, Valence
pdecon = Deconstruct(Point=cullpt.Points)  # -> XComponent, YComponent, ZComponent
rgb = ColourRGB(Alpha=255, Red=pdecon.XComponent, Green=pdecon.YComponent, Blue=pdecon.ZComponent)
filtercolor = FilterByColor(Geometry=reflay_6, Color=rgb)  # -> simplify(Geometry)
detext = DeconstructText(TextObject=filtercolor)  # -> Text, Plane, Height, Justification
addition_3 = Addition(A=neg_2, B=division)
addition_4 = Addition(A=钢埋板厚度_2, B=division)
dom_3 = ConstructDomain(DomainStart=addition_3, DomainEnd=addition_4)
panel_44 = Panel(split_2.ListB)
钢埋板_侧视图 = Rectangle(Plane=PlaneXY(0, 0, 0), XSize=dom_2, YSize=dom, Radius=0)  # -> Rectangle, Length
xz = XZPlane(Origin=Point(0, 0, 0))
col = Colour(simplify(graft(rgb)))
attributes_13 = DefineObjectAttributes(Color=col)
xy_15 = XYPlane(Origin=Point(0, 0, 0))
dedomain_2 = DeconstructDomain(Domain=dom)  # -> Start, End
multiplication = Multiplication(A=dedomain_2.Start, B=dedomain_2.Start)

# ---- group: Beam
filtercolor_2 = FilterByColor(Geometry=reflay_5, Color=rgb)  # -> simplify(Geometry)

# ---- group: Text
item_15 = ListItem(List=detext.Text, Index=0, Wrap=True)

# ----
# 涉及到的梁编号
panel_45 = Panel(item_15)

# ---- group: Create Tags
tstat = TreeStatistics(Tree=detext.Text)  # -> Paths, Length, Count
series = Series(Start="1", Step=1, Count=tstat.Count)
concat = Concatenate(FragmentA=series, FragmentB="-")
concat_2 = Concatenate(FragmentA=concat, FragmentB=series)  # -> simplify(graft(Result))

# ----
filter_11 = StreamFilter(Gate=list_9, Stream0=concat_2, Stream1=simplify(graft(panel_13)))

# ----
# 埋件Tag预览
panel_46 = Panel(filter_11)

crv_52 = Curve(filtercolor_2)
layer_27 = ObjectLayer(Guid=crv_52)  # -> LayerIndex, LayerPathName
panel_47 = Panel(layer_27.LayerPathName)
reflay_8 = ReferenceByLayer(LayerName=panel_47)
flatten_3 = FlattenTree(Tree=item_15, Path="{0}")
txt_3 = Text(item_15)
concat_3 = Concatenate(FragmentA="Embed", FragmentB=txt_3)
txt_4 = Text(filter_11)
project_10 = Project(Geometry=crv_52, Plane=xy_15)  # -> Geometry, Transform

# ----
# 求出对应输入编号的钢结构截面尺寸
fsim = FindSimilarMember(Data=flatten_3, Set=split_2.ListA)  # -> Hit, Index
item_16 = ListItem(List=split_2.ListB, Index=fsim.Index, Wrap=True)

# ----
# 要连接的梁中线curve
crv_53 = Curve(project_10.Geometry)

# ----
# 板埋Modeling
multiplication_2 = Multiplication(A=s_x, B=addition)
multiplication_3 = Multiplication(A=s_y, B=addition_2)
recgrid = Rectangular(Plane=PlaneXY(0, 0, 0), SizeX=s_x, SizeY=s_y, ExtentX=addition, ExtentY=addition_2)  # -> Cells, Points
直径 = Text(filter_8)
division_3 = Division(A=multiplication_2, B=2)
division_4 = Division(A=multiplication_3, B=2)
vec = VectorXYZ(XComponent=expr("-x", division_3), YComponent=expr("-x", division_4), ZComponent=0)  # -> Vector, Length
move_6 = Move(Geometry=recgrid.Points, Motion=vec.Vector)  # -> Geometry, Transform
division_5 = Division(A=直径, B=2)
cyl = Cylinder(Base=move_6.Geometry, Radius=division_5, Length=expr("-x", expression))
X = UnitX(Factor=直径)
multiplication_4 = Multiplication(A=直径, B=6)
edges = BrepEdges(Brep=cyl)  # -> Naked, Interior, NonManifold
item_17 = ListItem(List=edges.Naked, Index=0, Wrap=True)
max_2 = Maximum(A=multiplication_4, B=70)
move_7 = Move(Geometry=item_17, Motion=X)  # -> Geometry, Transform
multiplication_5 = Multiplication(A=max_2, B=2)
addition_5 = Addition(A=multiplication_2, B=multiplication_5)
addition_6 = Addition(A=multiplication_3, B=multiplication_5)
division_6 = Division(A=t, B=2)
expression_2 = Expression(x=addition_6, Expression="Ceiling(x/10)*10/2")
expression_3 = Expression(x=addition_5, Expression="Ceiling(x/10)*10/2")
round = Round(Number=division_6)  # -> Nearest, Floor, Ceiling
multiplication_6 = Multiplication(A=round.Ceiling, B=2)
dom_4 = ConstructDomain(DomainStart=expr("-x", expression_2), DomainEnd=expression_2)
dom_5 = ConstructDomain(DomainStart=expr("-x", expression_3), DomainEnd=expression_3)
box = DomainBox(Base=PlaneXY(0, 0, 0), X=dom_5, Y=dom_4, Z=multiplication_6)
Z = UnitZ(Factor=expr("-x", multiplication_6))

# ---- group: 制作下层定位平面 / 定位点Offset450后二次筛选是否与梁有交点
pt_9 = Point(dispatch_15.ListB)
num = Number(number_slider_7)
cir = Circle(Plane=pt_9, Radius=num)
movetoplane_6 = MoveToPlane(Geometry=crv_17, Plane=PlaneXY(0, 0, 0), Above=True, Below=True)  # -> Geometry, Transform
movetoplane_7 = MoveToPlane(Geometry=cir, Plane=PlaneXY(0, 0, 0), Above=True, Below=True)  # -> Geometry, Transform
ccx_4 = CurveCurve(CurveA=flatten(movetoplane_7.Geometry), CurveB=graft(movetoplane_6.Geometry))  # -> Points, ParamsA, ParamsB
pull_10 = PullPoint(Point=ccx_4.Points, Geometry=movetoplane_2.Geometry, ClosestOnly=True)  # -> ClosestPoint, Distance
pt_10 = Point(merge_5)
pull_11 = PullPoint(Point=pull_10.ClosestPoint, Geometry=pt_10, ClosestOnly=True)  # -> ClosestPoint, Distance
larger_9 = LargerThan(FirstNumber=pull_11.Distance, SecondNumber="1")  # -> LargerThan, OrEqualTo
dispatch_20 = Dispatch(List=ccx_4.Points, DispatchPattern=larger_9.LargerThan)  # -> ListA, ListB

# ---- group: 制作下层定位平面 / 定位点Offset450后二次筛选是否与梁有交点 / Offset450后与梁有交点
pt_11 = Point(dispatch_20.ListA)

# ---- group: 制作下层定位平面 / 定位点Offset450后二次筛选是否与梁有交点 (continued)
incurves = PointInCurves(Point=flatten(pt_11), Curves=cir)  # -> Relationship, Index, Point
cull_i_6 = CullIndex(List=pt_9, Indices=incurves.Index, Wrap=True)
cullduppoints_2 = RemoveDuplicatePoints(InputPoints=cull_i_6, Tolerance=0.001)  # -> OutputPoints, FirstPointIndexes
null_2 = NullItem(Item=cullduppoints_2.OutputPoints)  # -> NullFlags, InvalidFlags, Description
dispatch_21 = Dispatch(List=cull_i_6, DispatchPattern=null_2.InvalidFlags)  # -> ListA, ListB
merge_11 = Merge(Data1=pt_2, Data2=pt_11)

# ---- group: 制作下层定位平面 / Offset450后与梁没有交点
pt_12 = Point(dispatch_21.ListB)

# ---- group: 制作下层定位平面 / 定位平面-垂直于梁中线
pt_13 = Point(merge_11)

# ---- group: 制作下层定位平面 / 定位平面-幕墙线法线
merge_12 = Merge(Data1=pt_12, Data2=pt_6)  # -> flatten(Result)

# ----
multiplication_7 = Multiplication(A=直径, B=5)

Z_2 = UnitZ(Factor=multiplication_7)
extr = Extrude(Base=move_7.Geometry, Direction=Z_2)
cap = CapHoles(Brep=[extr, cyl])
merge_13 = Merge(Data1=cap, Data2=box)
flatten_4 = FlattenTree(Tree=merge_13, Path="{0}")
move_8 = Move(Geometry=flatten_4, Motion=Z)  # -> Geometry, Transform

split_4 = TextSplit(Text=item_16, Separators="x")
split_5 = TextSplit(Text=split_4, Separators="Q")
item_18 = ListItem(List=split_5, Index="0", Wrap=True)

shift = ShiftPaths(Data=item_18, Offset=-1)
subtraction = Subtraction(A=division, B=钢埋板厚度_2)
subtraction_2 = Subtraction(A=division, B=钢埋板厚度_2)
subtraction_3 = Subtraction(A=division, B=钢埋板厚度_2)
neg_6 = Negative(Value=钢埋板厚度_2)
neg_7 = Negative(Value=钢埋板厚度_2)
neg_8 = Negative(Value=钢埋板厚度_2)
subtraction_4 = Subtraction(A=division, B=钢埋板厚度_2)
addition_7 = Addition(A=subtraction, B=number_slider_10)
addition_8 = Addition(A=subtraction_2, B=number_slider_10)
subtraction_5 = Subtraction(A=neg_6, B=number_slider_10)
subtraction_6 = Subtraction(A=neg_7, B="2")
subtraction_7 = Subtraction(A=division, B=钢埋板厚度_2)
addition_9 = Addition(A=subtraction_3, B="2")
subtraction_8 = Subtraction(A=neg_8, B="2")
neg_9 = Negative(Value=钢埋板厚度_2)
neg_10 = Negative(Value=钢埋板厚度_2)
工字钢_h = ListItem(List=shift, Index=0, Wrap=True)
工字钢_b = ListItem(List=shift, Index=1, Wrap=True)
工字钢_tf = ListItem(List=shift, Index=3, Wrap=True)
工字钢_tw = ListItem(List=shift, Index=2, Wrap=True)
pt_14 = ConstructPoint(XCoordinate=neg_9, YCoordinate=subtraction_4, ZCoordinate=0)
pt_15 = ConstructPoint(XCoordinate=neg_10, YCoordinate=addition_7, ZCoordinate=0)
pt_16 = ConstructPoint(XCoordinate=subtraction_5, YCoordinate=addition_8, ZCoordinate=0)
pt_17 = ConstructPoint(XCoordinate=subtraction_6, YCoordinate=subtraction_7, ZCoordinate=0)
pt_18 = ConstructPoint(XCoordinate=subtraction_8, YCoordinate=addition_9, ZCoordinate=0)
subtraction_9 = Subtraction(A=工字钢_b, B=工字钢_tw)
merge_14 = Merge(Data1=pt_14, Data2=pt_15, Data3=pt_16, Data4=pt_18, Data5=pt_17)
division_7 = Division(A=subtraction_9, B="2")
pline = PolyLine(Vertices=merge_14, Closed=True)
division_8 = Division(A=division_7, B="2")
subtraction_10 = Subtraction(A=division_8, B=number_slider_10)
subtraction_11 = Subtraction(A=division_8, B=钢埋板厚度_2)
neg_11 = Negative(Value=division_8)
subtraction_12 = Subtraction(A=neg_11, B=subtraction_11)
addition_10 = Addition(A=subtraction_12, B=number_slider_11)
dom_6 = ConstructDomain(DomainStart=addition_10, DomainEnd=subtraction_12)
dom_7 = ConstructDomain(DomainStart=addition_3, DomainEnd=addition_4)
subtraction_13 = Subtraction(A=subtraction_10, B=subtraction_11)
subtraction_14 = Subtraction(A=neg_11, B=subtraction_11)
dom_8 = ConstructDomain(DomainStart=subtraction_13, DomainEnd=subtraction_14)

# ---- group: 筛选阴阳角
pull_12 = PullPoint(Point=flatten(pt_3), Geometry=graft(merge_6), ClosestOnly=True)  # -> ClosestPoint, Distance
sort_6 = SortList(Keys=pull_12.Distance, ValuesA=flatten(pt_3))  # -> Keys, ValuesA
item_19 = ListItem(List=sort_6.Keys, Index=0, Wrap=True)  # -> Item, Item1
item_20 = ListItem(List=sort_6.ValuesA, Index=0, Wrap=True)  # -> Item, Item1
merge_15 = Merge(Data1=item_19.Item, Data2=item_19.Item1)
merge_16 = Merge(Data1=item_20.Item, Data2=item_20.Item1)
panel_48 = Panel(merge_15)
smaller_7 = SmallerThan(FirstNumber=merge_15, SecondNumber="100")  # -> SmallerThan, OrEqualTo
dispatch_22 = Dispatch(List=merge_16, DispatchPattern=smaller_7.SmallerThan)  # -> ListA, ListB
crv_54 = Curve(flatten(offset))

# ---- group: 筛选阴阳角 / F1-阴阳角-点
data_24 = Data(dispatch_22.ListA)

# ---- group: 筛选阴阳角 (continued)
check_same_points = CheckSamePoints(archPoint=flatten(pt_3), crvPoint=flatten(data_24))  # -> out, specialPt; inputs archPoint: list of Point3d, crvPoint: list of Point3d; same code as testpoint
cull_i_7 = CullIndex(List=flatten(pt_3), Indices=check_same_points.specialPt, Wrap=True)
pull_13 = PullPoint(Point=cull_i_7, Geometry=crv_54, ClosestOnly=True)  # -> ClosestPoint, Distance
ln_7 = Line(StartPoint=pull_13.ClosestPoint, EndPoint=cull_i_7)
rotate_3 = Rotate(Geometry=ln_7, Angle=1.570796327, Plane=cull_i_7)  # -> Geometry, Transform
pl_3 = ConstructPlane(Origin=cull_i_7, XAxis=rotate_3.Geometry, YAxis=ln_7)

# ----
project_11 = Project(Geometry=pl_3, Plane=xy_11)  # -> Geometry, Transform

# ---- group: 下层定位点Plane-去阴阳角
pln_3 = Plane(project_11.Geometry)

# ---- group: 下层定位平面-All
pln_4 = Plane(pln_3)

# ---- group: 制作上层定位平面 / 筛选阴阳角
pull_14 = PullPoint(Point=flatten(pt_4), Geometry=graft(merge_7), ClosestOnly=True)  # -> ClosestPoint, Distance
sort_7 = SortList(Keys=pull_14.Distance, ValuesA=flatten(pt_4))  # -> Keys, ValuesA
item_21 = ListItem(List=sort_7.Keys, Index=0, Wrap=True)  # -> Item, Item1
item_22 = ListItem(List=sort_7.ValuesA, Index=0, Wrap=True)  # -> Item, Item1
merge_17 = Merge(Data1=item_21.Item, Data2=item_21.Item1)
merge_18 = Merge(Data1=item_22.Item, Data2=item_22.Item1)
panel_49 = Panel(merge_17)
smaller_8 = SmallerThan(FirstNumber=merge_17, SecondNumber="100")  # -> SmallerThan, OrEqualTo
dispatch_23 = Dispatch(List=merge_18, DispatchPattern=smaller_8.SmallerThan)  # -> ListA, ListB
crv_55 = Curve(flatten(offset_2))

# ---- group: 制作上层定位平面 / 筛选阴阳角 / F1-阴阳角-点
data_25 = Data(dispatch_23.ListA)

# ---- group: 上-阴阳角
pt_19 = Point(data_25)

# ----
merge_19 = Merge(Data1=data_13, Data2=pt_19)

bake = BakeObjects(Geometry=merge_19, Attributes=attributes, BakeName=panel_36, Bake=False)

# ---- group: 制作上层定位平面 / 筛选阴阳角 (continued)
check_same_points_2 = CheckSamePoints(archPoint=flatten(pt_4), crvPoint=flatten(data_25))  # -> out, specialPt; inputs archPoint: list of Point3d, crvPoint: list of Point3d; same code as testpoint
cull_i_8 = CullIndex(List=flatten(pt_4), Indices=check_same_points_2.specialPt, Wrap=True)
pull_15 = PullPoint(Point=cull_i_8, Geometry=crv_55, ClosestOnly=True)  # -> ClosestPoint, Distance
ln_8 = Line(StartPoint=pull_15.ClosestPoint, EndPoint=cull_i_8)
rotate_4 = Rotate(Geometry=ln_8, Angle=1.570796327, Plane=cull_i_8)  # -> Geometry, Transform
pl_4 = ConstructPlane(Origin=cull_i_8, XAxis=rotate_4.Geometry, YAxis=ln_8)

# ----
project_12 = Project(Geometry=pl_4, Plane=xy_10)  # -> Geometry, Transform

# ---- group: 上层定位点Plane-去阴阳角
pln_5 = Plane(project_12.Geometry)

# ---- group: 上层定位平面-All
pln_6 = Plane(pln_5)

# ---- group: 制作上层定位平面 / 筛选阴阳角
pull_16 = PullPoint(Point=flatten(pt_5), Geometry=graft(merge_8), ClosestOnly=True)  # -> ClosestPoint, Distance
sort_8 = SortList(Keys=pull_16.Distance, ValuesA=flatten(pt_5))  # -> Keys, ValuesA
item_23 = ListItem(List=sort_8.Keys, Index=0, Wrap=True)  # -> Item, Item1
item_24 = ListItem(List=sort_8.ValuesA, Index=0, Wrap=True)  # -> Item, Item1
merge_20 = Merge(Data1=item_23.Item, Data2=item_23.Item1)
merge_21 = Merge(Data1=item_24.Item, Data2=item_24.Item1)
panel_50 = Panel(merge_20)
smaller_9 = SmallerThan(FirstNumber=merge_20, SecondNumber="100")  # -> SmallerThan, OrEqualTo
dispatch_24 = Dispatch(List=merge_21, DispatchPattern=smaller_9.SmallerThan)  # -> ListA, ListB
crv_56 = Curve(flatten(offset_3))

# ---- group: 制作上层定位平面 / 筛选阴阳角 / F1-阴阳角-点
data_26 = Data(dispatch_24.ListA)

# ---- group: 制作上层定位平面 / 筛选阴阳角 (continued)
check_same_points_3 = CheckSamePoints(archPoint=flatten(pt_5), crvPoint=flatten(data_26))  # -> out, specialPt; inputs archPoint: list of Point3d, crvPoint: list of Point3d; same code as testpoint
cull_i_9 = CullIndex(List=flatten(pt_5), Indices=check_same_points_3.specialPt, Wrap=True)
pull_17 = PullPoint(Point=cull_i_9, Geometry=crv_56, ClosestOnly=True)  # -> ClosestPoint, Distance
ln_9 = Line(StartPoint=pull_17.ClosestPoint, EndPoint=cull_i_9)
rotate_5 = Rotate(Geometry=ln_9, Angle=1.570796327, Plane=cull_i_9)  # -> Geometry, Transform
pl_5 = ConstructPlane(Origin=cull_i_9, XAxis=rotate_5.Geometry, YAxis=ln_9)

# ----
project_13 = Project(Geometry=pl_5, Plane=xy_9)  # -> Geometry, Transform

# ---- group: 上层定位点Plane-去阴阳角
pln_7 = Plane(project_13.Geometry)

# ---- group: 檐口定位平面-All
pln_8 = Plane(pln_7)

# ---- group: 制作下层定位平面
pull_18 = PullPoint(Point=pt_13, Geometry=movetoplane_2.Geometry, ClosestOnly=True)  # -> ClosestPoint, Distance
crv_57 = Curve(crv_17)
offset_13 = OffsetCurve(Curve=crv_57, Distance=Slider(500, range=0..1000), Corners=1)
pull_19 = PullPoint(Point=merge_12, Geometry=flatten(offset_13), ClosestOnly=True)  # -> ClosestPoint, Distance
pull_20 = PullPoint(Point=merge_12, Geometry=crv_57, ClosestOnly=True)  # -> ClosestPoint, Distance

# ---- group: 制作下层定位平面 / Y Axis Line-垂直梁中线
ln_10 = Line(StartPoint=pt_13, EndPoint=pull_18.ClosestPoint)

# ---- group: 制作下层定位平面 / Y Aixs Line-幕墙法线
ln_11 = Line(StartPoint=pull_20.ClosestPoint, EndPoint=pull_19.ClosestPoint)

# ---- group: 制作下层定位平面 (continued)
merge_22 = Merge(Data1=ln_10, Data2=ln_11)

# ---- group: 制作下层定位平面 / Y Axis Line-All
crv_58 = Curve(merge_22)

# ---- group: 制作下层定位平面 / 统一Y Axis向幕墙线外
end_5 = EndPoints(Curve=graft(crv_58))  # -> Start, End
movetoplane_8 = MoveToPlane(Geometry=crv_17, Plane=PlaneXY(0, 0, 0), Above=True, Below=True)  # -> Geometry, Transform
merge_23 = Merge(Data1=end_5.Start, Data2=end_5.End)
pull_21 = PullPoint(Point=merge_23, Geometry=movetoplane_8.Geometry, ClosestOnly=True)  # -> ClosestPoint, Distance
sort_9 = SortList(Keys=pull_21.Distance, ValuesA=merge_23)  # -> Keys, ValuesA
item_25 = ListItem(List=sort_9.ValuesA, Index="-1", Wrap=True)
item_26 = ListItem(List=sort_9.ValuesA, Index=0, Wrap=True)
pt_20 = Point(item_25)
pt_21 = Point(item_26)
ln_12 = Line(StartPoint=pt_21, EndPoint=pt_20)
rotate_6 = Rotate(Geometry=ln_12, Angle=1.570796327, Plane=pt_21)  # -> Geometry, Transform

# ---- group: 制作下层定位平面 / 统一Y Axis向幕墙线外 / F1-定位Plane-未筛选阴阳角
pl_6 = ConstructPlane(Origin=pt_21, XAxis=rotate_6.Geometry, YAxis=ln_12)  # -> flatten(Plane)

# ---- group: 制作下层定位平面 / 统一Y Axis向幕墙线外 (continued)
null_3 = NullItem(Item=pl_6)  # -> NullFlags, InvalidFlags, Description
dispatch_25 = Dispatch(List=pl_6, DispatchPattern=null_3.NullFlags)  # -> ListA, ListB

# ----
# 三视图
# hidden lines of top+pers view
# move to center
# 如果无法完整的生成埋件的三视图，
# 建议选择埋件的3D在Rhino中将
# Top/Perspective/Front/Right 试图缩放至合适大小后重新运行
panel_51 = Panel("""Top
Perspective
Front
Right""")
m2d_rhino = Make2DRhinoView(Name=panel_51, Clip=True)
number_slider_40 = Slider(1, range=0..10)
pt_22 = Point(Point(957.9296072, 367.7685097, 0))
pt_23 = Point("0,0,0")
recgrid_2 = Rectangular(
    Plane=pt_22,
    SizeX=Slider(12, range=1..20, expression="X*50"),
    SizeY=Slider(10, range=1..20, expression="X*50"),
    ExtentX=number_slider_40,
    ExtentY=number_slider_40)  # -> Cells, Points
flatten_5 = FlattenTree(Tree=recgrid_2.Points, Path="{0}")

# ----
# （6）生成板埋埋件
# 注意：
# 1.记得点一下Compute按钮
# 2.如果无法完整的生成埋件的三视图，
# 建议选择埋件的3D在Rhino中将
# Top/Perspective/Front/Right 试图缩放至合适大小后重新运行
make2d = Make2D(Geometry=move_8.Geometry, View=m2d_rhino, TangentEdges=False, TangentSeams=False, AutoComputeMake2D=False)  # -> VisibleCurves, VisibleIndex, VisibleType, HiddenCurves, HiddenIndex, HiddenType

bang = ExplodeTree(Data=make2d.VisibleCurves)  # -> Branch0, Branch1, Branch2, Branch3, Branch4, Branch5, Branch6, Branch7
divdist = DivideDistance(Curve=make2d.HiddenCurves, Distance=Slider(1, range=0..10))  # -> Points, Tangents, Parameters
graft = GraftTree(Tree=make2d.HiddenCurves, IncludeEmptyLists=True, IncludeNullItems=True)
shatter = Shatter(Curve=graft, Parameters=divdist.Parameters)
dispatch_26 = Dispatch(List=shatter, DispatchPattern=[True, False])  # -> ListA, ListB
crv_59 = Curve(dispatch_26.ListA)
pshift = ShiftPaths(Data=crv_59, Offset=-1)
pshift_2 = ShiftPaths(Data=pshift, Offset=-1)
bang_2 = ExplodeTree(Data=pshift_2)  # -> Branch0, Branch1, Branch2, Branch3, Branch4, Branch5, Branch6, Branch7
entwine_9 = Entwine(Branch00=bang_2.Branch0, Branch01=bang.Branch0, FlattenInputs=True)  # -> flatten(Result)
entwine_10 = Entwine(Branch00=bang_2.Branch1, Branch01=bang.Branch1, FlattenInputs=True)  # -> flatten(Result)
entwine_11 = Entwine(Branch00=entwine_9, Branch01=entwine_10, Branch02=bang.Branch2, Branch03=bang.Branch3, FlattenInputs=True)
group_2 = Group(Objects=entwine_11)
pshift_3 = ShiftPaths(Data=group_2, Offset=-1)
pshift_4 = ShiftPaths(Data=group_2, Offset=-1)
boxprop = BoxProperties(Box=pshift_3)  # -> Center, Diagonal, Area, Volume, Degeneracy
vec2pt = Vector2Pt(PointA=boxprop.Center, PointB=pt_23, Unitize=False)  # -> Vector, Length
move_9 = Move(Geometry=pshift_4, Motion=vec2pt.Vector)  # -> flatten(Geometry), Transform
orient = Orient(Geometry=flatten(move_9.Geometry), Source=PlaneXY(0, 0, 0), Target=flatten_5)  # -> Geometry, Transform
cull_i_10 = CullIndex(List=orient.Geometry, Indices="-1", Wrap=True)
split_6 = SplitList(List=cull_i_10, Index="4")  # -> ListA, ListB
geo_4 = Geometry(split_6.ListA)

# ---- group: 单体定Top/Side
item_27 = ListItem(List=geo_4, Index=Slider(0, range=0..10), Wrap=True)
item_28 = ListItem(List=geo_4, Index=2, Wrap=True)
cluster_2 = Cluster(G=item_27)
cluster_3 = Cluster(G=item_28)

# ----
钢肋板_侧视图 = Rectangle(Plane=PlaneXY(0, 0, 0), XSize=dom_8, YSize=dom_3, Radius=0)  # -> Rectangle, Length
tstat_2 = TreeStatistics(Tree=工字钢_h)  # -> Paths, Length, Count
钢肋板倒角_侧视图 = Rectangle(Plane=PlaneXY(0, 0, 0), XSize=dom_6, YSize=dom_7, Radius=0)  # -> Rectangle, Length
repeat = RepeatData(Data=pline, Length=tstat_2.Length)  # -> simplify(Data)
merge_24 = Merge(Data1=simplify(钢肋板_侧视图.Rectangle), Data2=simplify(repeat), Data3=simplify(钢肋板倒角_侧视图.Rectangle))
division_9 = Division(A=工字钢_h, B="2")
division_10 = Division(A=工字钢_b, B=2)
subtraction_15 = Subtraction(A=division_9, B=工字钢_tf)
repeat_2 = RepeatData(Data=钢埋板_侧视图.Rectangle, Length=tstat_2.Length)  # -> simplify(Data)
mirror = Mirror(Geometry=merge_24, Plane=xz)  # -> Geometry, Transform
addition_11 = Addition(A=subtraction_15, B=Slider(200, range=0..1000))
merge_25 = Merge(Data1=repeat_2, Data2=merge_24, Data3=mirror.Geometry)
addition_12 = Addition(A=addition_11, B=division_7)
X_2 = UnitX(Factor=addition_12)
move_10 = Move(Geometry=merge_25, Motion=X_2)  # -> Geometry, Transform

group_3 = Group(Objects=move_10.Geometry)
rotate_7 = Rotate(Geometry=group_3, Angle=3.141592654, Plane=PlaneXY(0, 0, 0))  # -> Geometry, Transform
boxprop_2 = BoxProperties(Box=rotate_7.Geometry)  # -> Center, Diagonal, Area, Volume, Degeneracy
bbox = BoundingBox(Content=rotate_7.Geometry, Plane=PlaneXY(0, 0, 0))  # -> Box, Box_2
debox = DeconstructBox(Box=bbox.Box)  # -> Plane, X, Y, Z
pdecon_2 = Deconstruct(Point=boxprop_2.Center)  # -> XComponent, YComponent, ZComponent
dedomain_3 = DeconstructDomain(Domain=debox.Y)  # -> Start, End
pt_24 = ConstructPoint(XCoordinate=pdecon_2.XComponent, YCoordinate=dedomain_3.Start, ZCoordinate=pdecon_2.ZComponent)
xy_16 = XYPlane(Origin=Point(0, 0, 0))
pl_origin = PlaneOrigin(Base=xy_16, Origin=pt_24)
orient_2 = Orient(Geometry=rotate_7.Geometry, Source=pl_origin, Target=xy_16)  # -> Geometry, Transform
ungroup = Ungroup(Group=orient_2.Geometry)  # -> simplify(Objects)

# ----
# 要连接的梁中线Offest值
num_2 = Number(simplify(division_10))

# ---- group: 制作下层定位平面 / 筛选阴阳角
pln_9 = Plane(dispatch_25.ListB)
pull_22 = PullPoint(Point=flatten(pln_9), Geometry=graft(pt_7), ClosestOnly=True)  # -> ClosestPoint, Distance
sort_10 = SortList(Keys=pull_22.Distance, ValuesA=flatten(pln_9))  # -> Keys, ValuesA
item_29 = ListItem(List=sort_10.Keys, Index=0, Wrap=True)  # -> Item, Item1
item_30 = ListItem(List=sort_10.ValuesA, Index=0, Wrap=True)  # -> Item, Item1
merge_26 = Merge(Data1=item_29.Item, Data2=item_29.Item1)
merge_27 = Merge(Data1=item_30.Item, Data2=item_30.Item1)
panel_52 = Panel(merge_26)
smaller_10 = SmallerThan(FirstNumber=merge_26, SecondNumber="100")  # -> SmallerThan, OrEqualTo
dispatch_27 = Dispatch(List=merge_27, DispatchPattern=smaller_10.SmallerThan)  # -> ListA, ListB
pln_10 = Plane(pln_9)
crv_60 = Curve(movetoplane_8.Geometry)
movetoplane_9 = MoveToPlane(Geometry=crv_60, Plane=PlaneXY(0, 0, 0), Above=True, Below=True)  # -> Geometry, Transform
clscrv_5 = CloseCurve(Curve=movetoplane_9.Geometry, CloseType=0, Bulge=0.5, Tolerance=0)  # -> Closed, R

# ---- group: 制作下层定位平面 / 筛选阴阳角 / F1-阴阳角-Plane
data_27 = Data(dispatch_27.ListA)

# ---- group: 制作下层定位平面 / 筛选阴阳角 (continued)
check_same_points_4 = CheckSamePoints(archPoint=flatten(pln_9), crvPoint=flatten(data_27))  # -> out, specialPt; inputs archPoint: list of Point3d, crvPoint: list of Point3d; same code as testpoint
cull_i_11 = CullIndex(List=flatten(pln_10), Indices=check_same_points_4.specialPt, Wrap=True)
deplane_5 = DeconstructPlane(Plane=cull_i_11)  # -> Origin, XAxis, YAxis, ZAxis
movetoplane_10 = MoveToPlane(Geometry=deplane_5.Origin, Plane=PlaneXY(0, 0, 0), Above=True, Below=True)  # -> Geometry, Transform
amp_6 = Amplitude(Vector=deplane_5.YAxis, Amplitude=Slider(300, range=0..1000))
move_11 = Move(Geometry=movetoplane_10.Geometry, Motion=amp_6)  # -> flatten(Geometry), Transform
incurves_2 = PointInCurves(Point=move_11.Geometry, Curves=clscrv_5.Closed)  # -> Relationship, Index, Point
equals_2 = Equality(FirstNumber=incurves_2.Relationship, SecondNumber="2")  # -> Equality, Inequality
dispatch_28 = Dispatch(List=flatten(cull_i_11), DispatchPattern=equals_2.Equality)  # -> ListA, ListB
data_28 = Data(dispatch_28.ListB)
data_29 = Data(dispatch_28.ListA)
deplane_6 = DeconstructPlane(Plane=data_29)  # -> Origin, XAxis, YAxis, ZAxis
rev = Reverse(Vector=deplane_6.YAxis)
pl_7 = ConstructPlane(Origin=deplane_6.Origin, XAxis=deplane_6.XAxis, YAxis=rev)
merge_28 = Merge(Data1=pl_7, Data2=data_28)

# ----
xy_17 = XYPlane(Origin=Point(0, 0, 0))
project_14 = Project(Geometry=merge_28, Plane=xy_17)  # -> Geometry, Transform

# ---- group: 下层定位点Plane-去阴阳角
pln_11 = Plane(project_14.Geometry)

# ----
block = DefineBlock(Geometry=ungroup, Attributes=attributes_13, BlockName=concat_3, BasePlane=PlaneXY(0, 0, 0))
deblock_4 = DeconstructBlock(Block=block)  # -> Name, Plane, Geometry
group_4 = Group(Objects=deblock_4.Geometry)
bbox_2 = BoundingBox(Content=group_4, Plane=PlaneXY(0, 0, 0))  # -> Box, Box_2
deplane_7 = DeconstructPlane(Plane=deblock_4.Plane)  # -> Origin, XAxis, YAxis, ZAxis
area_9 = Area(Geometry=bbox_2.Box)  # -> Area, Centroid
move2pt_6 = MoveToPoint(Geometry=deplane_7.Origin, PointA=deplane_7.Origin, PointB=area_9.Centroid)  # -> Moved, Vector, Transform
pl_8 = ConstructPlane(Origin=move2pt_6.Moved, XAxis=deplane_7.YAxis, YAxis=deplane_7.XAxis)
deplane_8 = DeconstructPlane(Plane=pl_8)  # -> Origin, XAxis, YAxis, ZAxis
rotate_8 = Rotate(Geometry=pl_8, Angle="Pi", Plane=pl_8)  # -> Geometry, Transform
amp_7 = Amplitude(Vector=deplane_8.YAxis, Amplitude=multiplication)
move_12 = Move(Geometry=deplane_8.Origin, Motion=amp_7)  # -> Geometry, Transform
srf = Surface(bbox_2.Box)
crv_61 = Curve(srf)
ln_13 = Line(StartPoint=move_12.Geometry, EndPoint=deplane_8.Origin)
ccx_5 = CurveCurve(CurveA=ln_13, CurveB=crv_61)  # -> Points, ParamsA, ParamsB
ln_14 = Line(StartPoint=deplane_8.Origin, EndPoint=ccx_5.Points)
move_13 = Move(Geometry=rotate_8.Geometry, Motion=ln_14)  # -> simplify(Geometry), Transform
amp_8 = Amplitude(Vector=ln_14, Amplitude=expr("-x", number_slider_12))
move_14 = Move(Geometry=move_13.Geometry, Motion=amp_8)  # -> Geometry, Transform

text_2 = DefineTextObject(Text=txt_4, Plane=simplify(move_14.Geometry), DimensionStyle=panel_6, OutputType="Text")
group_5 = Group(Objects=[block, text_2])

merge_29 = Merge(Data1=group_5, Data2=move_13.Geometry)

# ----
# 要连接的embed
data_30 = Data(merge_29)

item_31 = ListItem(List=data_30, Index=0, Wrap=True)
flip = FlipMatrix(Data=item_31)
item_32 = ListItem(List=flip, Index=Slider(9, range=0..15), Wrap=True)
# 第一层
# 
# Curves(location point)+ Smooth Curves(architecture line)
# 测试Smooth Curve是否与每个Block相切
# blocks + smooth curves
# remove duplicate blocks
# blocks + special curves
# 测试Smooth Curve是否与每个Block相切
# blocks + smooth curves
# remove duplicate blocks
# blocks + special curves
# 第一层
# 
# Angular Curves(architecture line)
# 第一层
# 
# Special Curves(architecture line)
# 第一层
# 
# Angular Curves(architecture line)
data_31 = Data(data_30)
item_33 = ListItem(List=data_31, Index=0, Wrap=True)
item_34 = ListItem(List=data_31, Index="-1", Wrap=True)
data_32 = Data(data_30)
# 阴阳角
item_35 = ListItem(List=data_32, Index=0, Wrap=True)
item_36 = ListItem(List=data_32, Index="-1", Wrap=True)
data_33 = Data(data_30)
item_37 = ListItem(List=data_33, Index=0, Wrap=True)
item_38 = ListItem(List=data_33, Index="-1", Wrap=True)
rotate_9 = Rotate(Geometry=item_38, Angle="Pi", Plane=item_38)  # -> Geometry, Transform
data_34 = Data(data_30)
data_35 = Data(data_30)
# Rhino 文件中导入的块名
item_39 = ListItem(List=data_34, Index=0, Wrap=True)
item_40 = ListItem(List=data_34, Index="-1", Wrap=True)
item_41 = ListItem(List=data_35, Index=0, Wrap=True)
item_42 = ListItem(List=data_35, Index="-1", Wrap=True)
rotate_10 = Rotate(Geometry=item_40, Angle="Pi", Plane=item_40)  # -> Geometry, Transform

ungroup_2 = Ungroup(Group=cluster_3)
ungroup_3 = Ungroup(Group=cluster_2)

# ---- group: Top/Side
filter_12 = StreamFilter(Gate=list_6, Stream0=ungroup_3, Stream1=ungroup_2)

# ---- group: Block
attributes_14 = DefineObjectAttributes(Color=ColourSwatch(SwatchColor=RGB(255, 0, 0)))
block_2 = DefineBlock(Geometry=ungroup_3, Attributes=attributes_14, BlockName="Board Plate", BasePlane=PlaneXY(0, 0, 0))

# ----
deblock_5 = DeconstructBlock(Block=block_2)  # -> Name, flatten(Plane), flatten(Geometry)
boundary_2 = BoundarySurfaces(Edges=deblock_5.Geometry)
deplane_9 = DeconstructPlane(Plane=deblock_5.Plane)  # -> Origin, XAxis, YAxis, ZAxis
area_10 = Area(Geometry=boundary_2)  # -> Area, Centroid
move2pt_7 = MoveToPoint(Geometry=flatten(deplane_9.Origin), PointA=flatten(deplane_9.Origin), PointB=flatten(area_10.Centroid))  # -> Moved, Vector, Transform
pl_9 = ConstructPlane(Origin=move2pt_7.Moved, XAxis=deplane_9.XAxis, YAxis=deplane_9.YAxis)  # -> graft(Plane)

deplane_10 = DeconstructPlane(Plane=deblock_5.Plane)  # -> Origin, XAxis, YAxis, ZAxis
amp_9 = Amplitude(Vector=deplane_10.YAxis, Amplitude=number_slider_8)
move_15 = Move(Geometry=deplane_10.Origin, Motion=amp_9)  # -> Geometry, Transform

text_3 = DefineTextObject(Text=panel_10, Plane=move_15.Geometry, DimensionStyle=panel_9, OutputType="Text")
group_6 = Group(Objects=flatten([block_2, text_3]))
entwine_12 = Entwine(Branch00=group_6, Branch01=pl_9, FlattenInputs=True)

data_36 = Data(flatten(entwine_12))
item_43 = ListItem(List=data_36, Index=0, Wrap=True)
item_44 = ListItem(List=data_36, Index="-1", Wrap=True)

ungroup_4 = Ungroup(Group=item_43)
item_45 = ListItem(List=ungroup_4, Index="-1", Wrap=True)
deblock_6 = DeconstructBlock(Block=item_45)  # -> Name, Plane, Geometry
boundary_3 = BoundarySurfaces(Edges=deblock_6.Geometry)
debrep = DeconstructBrep(Brep=boundary_3)  # -> Faces, Edges, Vertices
len_4 = Length(Curve=debrep.Edges)
sort_11 = SortList(Keys=len_4, ValuesA=debrep.Edges)  # -> Keys, ValuesA
item_46 = ListItem(List=sort_11.ValuesA, Index=0, Wrap=True)
len_5 = Length(Curve=item_46)  # -> expr("x/2", Length)

# ---- group: 车道区域
# 1.是否有檐口线-下层定位点
toggle_4 = BooleanToggle(True)
clean = CleanTree(RemoveNulls=True, RemoveInvalid=True, RemoveEmpty=toggle_4, Tree=pln_4)

# ---- group: 车道区域 / Input ???
deplane_11 = DeconstructPlane(Plane=clean)  # -> Origin, XAxis, YAxis, ZAxis

# ---- group: 车道区域 (continued)
incurve = PointInCurve(Point=deplane_11.Origin, Curve=crv_29)  # -> Relationship, Point
equals_3 = Equality(FirstNumber=incurve.Relationship, SecondNumber="2")  # -> Equality, Inequality
dispatch_29 = Dispatch(List=clean, DispatchPattern=equals_3.Equality)  # -> ListA, ListB

# Site - 有檐口线的定位点
pln_12 = Plane(dispatch_29.ListA)

# Site - 无檐口线的定位点
pln_13 = Plane(dispatch_29.ListB)

# ---- group: 车道区域 / 檐口线-Site
pln_14 = Plane(pln_12)

# ----
incurve_2 = PointInCurve(Point=pln_14, Curve=crv_33)  # -> Relationship, Point
equals_4 = Equality(FirstNumber=incurve_2.Relationship, SecondNumber="2")  # -> Equality, Inequality
dispatch_30 = Dispatch(List=pln_14, DispatchPattern=equals_4.Equality)  # -> ListA, ListB
pln_15 = Plane(dispatch_30.ListA)

incurve_3 = PointInCurve(Point=pln_13, Curve=crv_33)  # -> Relationship, Point
equals_5 = Equality(FirstNumber=incurve_3.Relationship, SecondNumber="2")  # -> Equality, Inequality
dispatch_31 = Dispatch(List=pln_13, DispatchPattern=equals_5.Equality)  # -> ListA, ListB
pln_16 = Plane(dispatch_31.ListA)

# ----
# 1.0无檐口线初筛-下层定位点
pln_17 = Plane(pln_16)

deplane_12 = DeconstructPlane(Plane=pln_17)  # -> Origin, XAxis, YAxis, ZAxis
incurves_3 = PointInCurves(Point=deplane_12.Origin, Curves=flatten(crv_34))  # -> Relationship, Index, Point
equals_6 = Equality(FirstNumber=incurves_3.Relationship, SecondNumber="2")  # -> Equality, Inequality
dispatch_32 = Dispatch(List=pln_17, DispatchPattern=equals_6.Equality)  # -> ListA, ListB
data_37 = Data(dispatch_32.ListB)

pln_18 = Plane(dispatch_32.ListA)

# ---- group: 下层交点-除重
# 1.0无檐口线-下层定位点
pln_19 = Plane(data_37)

# ---- group: All-下层定位点
# 1.1有檐口线
pln_20 = Plane(pln_15)

# ----
pln_21 = Plane(pln_20)

# ----
# 1.是否有檐口线-檐口线定位点
toggle_5 = BooleanToggle(True)
clean_2 = CleanTree(RemoveNulls=True, RemoveInvalid=True, RemoveEmpty=toggle_5, Tree=pln_8)

# ---- group: Input ???
deplane_13 = DeconstructPlane(Plane=clean_2)  # -> Origin, XAxis, YAxis, ZAxis

# ----
incurve_4 = PointInCurve(Point=deplane_13.Origin, Curve=crv_30)  # -> Relationship, Point
equals_7 = Equality(FirstNumber=incurve_4.Relationship, SecondNumber="2")  # -> Equality, Inequality
dispatch_33 = Dispatch(List=clean_2, DispatchPattern=equals_7.Equality)  # -> ListA, ListB

# ----
# Site - 檐口线的定位点
pln_22 = Plane(dispatch_33.ListB)

# ----
# 1.是否有檐口线-上层定位点
toggle_6 = BooleanToggle(True)
clean_3 = CleanTree(RemoveNulls=True, RemoveInvalid=True, RemoveEmpty=toggle_6, Tree=pln_6)

# ---- group: Input ???
deplane_14 = DeconstructPlane(Plane=clean_3)  # -> Origin, XAxis, YAxis, ZAxis

# ----
incurve_5 = PointInCurve(Point=deplane_14.Origin, Curve=crv_31)  # -> Relationship, Point
equals_8 = Equality(FirstNumber=incurve_5.Relationship, SecondNumber="2")  # -> Equality, Inequality
dispatch_34 = Dispatch(List=clean_3, DispatchPattern=equals_8.Equality)  # -> ListA, ListB

# ----
# Site - 无檐口线的定位点
pln_23 = Plane(dispatch_34.ListB)

incurve_6 = PointInCurve(Point=pln_23, Curve=crv_33)  # -> Relationship, Point
equals_9 = Equality(FirstNumber=incurve_6.Relationship, SecondNumber="2")  # -> Equality, Inequality
dispatch_35 = Dispatch(List=pln_23, DispatchPattern=equals_9.Equality)  # -> ListA, ListB
pln_24 = Plane(dispatch_35.ListA)
pln_25 = Plane(dispatch_35.ListB)

# ----
# 1.0无檐口线初筛-上层定位点
pln_26 = Plane(pln_24)

deplane_15 = DeconstructPlane(Plane=pln_26)  # -> Origin, XAxis, YAxis, ZAxis
incurves_4 = PointInCurves(Point=deplane_15.Origin, Curves=flatten(crv_34))  # -> Relationship, Index, Point
equals_10 = Equality(FirstNumber=incurves_4.Relationship, SecondNumber="2")  # -> Equality, Inequality
dispatch_36 = Dispatch(List=pln_26, DispatchPattern=equals_10.Equality)  # -> ListA, ListB
data_38 = Data(dispatch_36.ListB)

pln_27 = Plane(dispatch_36.ListA)

# ---- group: 下层交点-除重
# 1.0无檐口线-上层定位点
pln_28 = Plane(data_38)

# ----
# 区分内外梁边线
# 2.根据是否相交判定内外梁(平行于建筑边线方向）
crv_62 = Curve(filter)
crv_63 = Curve(crv_53)
num_3 = Number(num_2)
offcrv = OffsetCurve(Curve=crv_63, Plane=PlaneXY(0, 0, 0), Distance=num_3, BothSides=expr("-x", num_3), Kinks=0, CapType="0")
midpt_6 = CurveMiddle(Curve=offcrv)
offcrv_2 = OffsetCurve(Curve=crv_63, Plane=PlaneXY(0, 0, 0), Distance=num_3, BothSides=expr("-x", num_3), Kinks=0, CapType="1")
crv_64 = Curve(offcrv)
item_47 = ListItem(List=midpt_6, Index=0, Wrap=True)
item_48 = ListItem(List=crv_64, Index=0, Wrap=True)
item_49 = ListItem(List=crv_64, Index="-1", Wrap=True)
graft_2 = GraftTree(Tree=crv_63, IncludeEmptyLists=True, IncludeNullItems=True)

# ---- group: 梁中线-中点
midpt_7 = CurveMiddle(Curve=crv_63)

# ---- group: Pull到轮廓线
pull_23 = PullPoint(Point=midpt_7, Geometry=flatten(crv_62), ClosestOnly=True)  # -> ClosestPoint, Distance

# ----
# 梁线闭合
shift_2 = ShiftPaths(Data=offcrv_2, Offset=-1)

# ---- group: 和某组梁边线相连
ln_15 = Line(StartPoint=item_47, EndPoint=graft(pull_23.ClosestPoint))

# ---- group: 有交点为内
ccx_6 = CurveCurve(CurveA=ln_15, CurveB=graft_2)  # -> Points, ParamsA, ParamsB

# ----
null_4 = NullItem(Item=ccx_6.Points)  # -> NullFlags, InvalidFlags, Description
dispatch_37 = Dispatch(List=item_48, DispatchPattern=null_4.InvalidFlags)  # -> ListA, ListB
dispatch_38 = Dispatch(List=item_49, DispatchPattern=null_4.InvalidFlags)  # -> ListA, ListB

# ----
# 梁边线-内
merge_30 = Merge(Data1=dispatch_37.ListB, Data2=dispatch_38.ListA)

# ----
# 梁边线-外
merge_31 = Merge(Data1=dispatch_37.ListA, Data2=dispatch_38.ListB)

# ---- group: 梁-外侧
crv_65 = Curve(merge_31)

# ----
crv_66 = Curve(shift_2)

# ---- group: 下层交点-除重 / 梁外侧
crv_67 = Curve(merge_31)

# ---- group: 梁内测
crv_68 = Curve(merge_30)

# ----
crv_69 = Curve(shift_2)

crv_70 = Curve(shift_2)

# ---- group: 内侧梁线
crv_71 = Curve(merge_30)

# ----
crv_72 = Curve(shift_2)

crv_73 = Curve(shift_2)

# ---- group: 梁中线
crv_74 = Curve(crv_63)

# ----
# 1.1 有檐口-整个site一起处理
data_39 = Data(pln_22)
pln_29 = Plane(data_39)
deplane_16 = DeconstructPlane(Plane=pln_29)  # -> Origin, XAxis, YAxis, ZAxis
amp_10 = Amplitude(Vector=deplane_16.YAxis, Amplitude=number_slider_24)
amp_11 = Amplitude(Vector=deplane_16.YAxis, Amplitude=number_slider_23)
move_16 = Move(Geometry=deplane_16.Origin, Motion=expr("-x", amp_11))  # -> Geometry, Transform
move_17 = Move(Geometry=deplane_16.Origin, Motion=amp_10)  # -> Geometry, Transform
ln_16 = Line(StartPoint=move_16.Geometry, EndPoint=move_17.Geometry)
project_15 = Project(Geometry=crv_65, Plane=PlaneXY(0, 0, 0))  # -> Geometry, Transform
project_16 = Project(Geometry=ln_16, Plane=PlaneXY(0, 0, 0))  # -> Geometry, Transform
merge_32 = Merge(Data1=crv_36, Data2=crv_35)
ccx_7 = CurveCurve(CurveA=graft(project_16.Geometry), CurveB=flatten(project_15.Geometry))  # -> Points, ParamsA, ParamsB
project_17 = Project(Geometry=merge_32, Plane=PlaneXY(0, 0, 0))  # -> Geometry, Transform
shift_3 = ShiftPaths(Data=ccx_7.Points, Offset=-1)
pull_24 = PullPoint(Point=shift_3, Geometry=flatten(project_17.Geometry), ClosestOnly=True)  # -> ClosestPoint, Distance
sort_12 = SortList(Keys=pull_24.Distance, ValuesA=shift_3)  # -> Keys, ValuesA
item_50 = ListItem(List=sort_12.ValuesA, Index=0, Wrap=True)
null_5 = NullItem(Item=flatten(item_50))  # -> NullFlags, InvalidFlags, Description
dispatch_39 = Dispatch(List=flatten(item_50), DispatchPattern=null_5.InvalidFlags)  # -> ListA, ListB
dispatch_40 = Dispatch(List=pln_29, DispatchPattern=null_5.InvalidFlags)  # -> ListA, ListB
crv_75 = Curve(shift_2)

# ---- group: 交点对应的初始Plane
data_40 = Data(dispatch_40.ListB)

# ---- group: 交点Point
data_41 = Data(dispatch_39.ListB)

# ----
# 按照梁分类定位点
pt_25 = Point(data_41)
incurves_5 = PointInCurves(Point=flatten(pt_25), Curves=crv_75)  # -> Relationship, Index, Point
equals_11 = Equality(FirstNumber=incurves_5.Relationship, SecondNumber="0")  # -> Equality, Inequality
dispatch_41 = Dispatch(List=flatten(pt_25), DispatchPattern=equals_11.Inequality)  # -> ListA, ListB

# ---- group: 交点-属于哪个梁
data_42 = Data(dispatch_41.ListA)

# ----
check_same_points_5 = CheckSamePoints(archPoint=pln_29, crvPoint=data_40)  # -> out, specialPt; inputs archPoint: list of Point3d, crvPoint: list of Point3d; same code as testpoint

# ----
# 0无檐口线
# 与梁不相交
cull_i_12 = CullIndex(List=pln_29, Indices=check_same_points_5.specialPt, Wrap=True)

# ----
# 0 檐口出定位点
# 与结构无交点
pln_30 = Plane(cull_i_12)

# ----
# 0.Missing Point-二次筛选檐口处
# 埋件定位点Offset，没有找到和梁的交点
deplane_17 = DeconstructPlane(Plane=pln_30)  # -> Origin, XAxis, YAxis, ZAxis
amp_12 = Amplitude(Vector=deplane_17.YAxis, Amplitude=expr("-X", number_slider_23))
move_18 = Move(Geometry=deplane_17.Origin, Motion=amp_12)  # -> Geometry, Transform
ln_17 = Line(StartPoint=move_18.Geometry, EndPoint=deplane_17.Origin)
amp_13 = Amplitude(Vector=deplane_17.XAxis, Amplitude=number_slider_7)
amp_14 = Amplitude(Vector=deplane_17.XAxis, Amplitude=expr("-x", number_slider_7))

# ---- group: 2条Offset的探针找交点
move_19 = Move(Geometry=ln_17, Motion=amp_14)  # -> Geometry, Transform
move_20 = Move(Geometry=ln_17, Motion=amp_13)  # -> Geometry, Transform

# ----
# 按照梁分类定位PLANE
crv_76 = Curve(merge_30)
shift_4 = ShiftPaths(Data=crv_76, Offset=-1)
shift_5 = ShiftPaths(Data=shift_4, Offset=-1)
pull_25 = PullPoint(Point=data_42, Geometry=simplify(shift_5), ClosestOnly=True)  # -> ClosestPoint, Distance
ln_18 = Line(StartPoint=pull_25.ClosestPoint, EndPoint=data_42)
crv_77 = Curve(crv_30)
movetoplane_11 = MoveToPlane(Geometry=crv_77, Plane=PlaneXY(0, 0, 0), Above=True, Below=True)  # -> Geometry, Transform

# ---- group: Y Axis Line-All
crv_78 = Curve(ln_18)

# ----
end_6 = EndPoints(Curve=graft(crv_78))  # -> Start, End
merge_33 = Merge(Data1=end_6.Start, Data2=end_6.End)
pull_26 = PullPoint(Point=merge_33, Geometry=movetoplane_11.Geometry, ClosestOnly=True)  # -> ClosestPoint, Distance
sort_13 = SortList(Keys=pull_26.Distance, ValuesA=merge_33)  # -> Keys, ValuesA
item_51 = ListItem(List=sort_13.ValuesA, Index="-1", Wrap=True)
item_52 = ListItem(List=sort_13.ValuesA, Index=0, Wrap=True)
pt_26 = Point(item_52)
pt_27 = Point(item_51)
ln_19 = Line(StartPoint=pt_27, EndPoint=pt_26)
rotate_11 = Rotate(Geometry=ln_19, Angle=1.570796327, Plane=pt_26)  # -> Geometry, Transform

pt_28 = Point(end_6.End)

pl_10 = ConstructPlane(Origin=pt_28, XAxis=rotate_11.Geometry, YAxis=ln_19)
null_6 = NullItem(Item=pl_10)  # -> NullFlags, InvalidFlags, Description
dispatch_42 = Dispatch(List=pl_10, DispatchPattern=null_6.NullFlags)  # -> ListA, ListB
pln_31 = Plane(dispatch_42.ListB)

# ---- group: 檐口-首次筛选的有效起始Plane
data_43 = Data(pln_31)

# ----
# 1.1 檐口处侧埋，钢板焊
# 02：钢板焊埋件[钢梁外侧]
# @钢边梁宽@钢边梁高
pln_32 = Plane(data_43)

# ---- group: 下层交点-除重
# 1.0 无檐口线+上下层幕墙边线连续
pln_33 = Plane(pln_28)
pln_34 = Plane(pln_19)
deplane_18 = DeconstructPlane(Plane=pln_33)  # -> Origin, XAxis, YAxis, ZAxis
deplane_19 = DeconstructPlane(Plane=pln_34)  # -> Origin, XAxis, YAxis, ZAxis
number_slider_41 = Slider(3584, range=0..10000)
number_slider_42 = Slider(3584, range=0..10000)
amp_15 = Amplitude(Vector=deplane_19.YAxis, Amplitude=expr("-x", number_slider_42))
amp_16 = Amplitude(Vector=deplane_19.YAxis, Amplitude=number_slider_42)
amp_17 = Amplitude(Vector=deplane_18.YAxis, Amplitude=expr("-x", number_slider_41))
amp_18 = Amplitude(Vector=deplane_18.YAxis, Amplitude=number_slider_41)
move_21 = Move(Geometry=deplane_19.Origin, Motion=amp_15)  # -> Geometry, Transform
move_22 = Move(Geometry=deplane_19.Origin, Motion=amp_16)  # -> Geometry, Transform
move_23 = Move(Geometry=deplane_18.Origin, Motion=amp_17)  # -> Geometry, Transform
move_24 = Move(Geometry=deplane_18.Origin, Motion=amp_18)  # -> Geometry, Transform
ln_20 = Line(StartPoint=move_23.Geometry, EndPoint=move_24.Geometry)
ln_21 = Line(StartPoint=move_21.Geometry, EndPoint=move_22.Geometry)
pt_29 = Point(deplane_18.Origin)
pln_35 = Plane(pln_34)

# ---- group: 下层交点-除重 / F1-交点
ccx_8 = CurveCurve(CurveA=graft(ln_21), CurveB=crv_40)  # -> Points, ParamsA, ParamsB

# ---- group: 下层交点-除重 / F2-交点
ccx_9 = CurveCurve(CurveA=graft(ln_20), CurveB=crv_39)  # -> Points, ParamsA, ParamsB

# ---- group: 下层交点-除重 (continued)
pull_27 = PullPoint(Point=ccx_9.Points, Geometry=deplane_18.Origin, ClosestOnly=True)  # -> ClosestPoint, Distance
pull_28 = PullPoint(Point=ccx_8.Points, Geometry=deplane_19.Origin, ClosestOnly=True)  # -> ClosestPoint, Distance
sort_14 = SortList(Keys=pull_28.Distance, ValuesA=ccx_8.Points)  # -> Keys, ValuesA
sort_15 = SortList(Keys=pull_27.Distance, ValuesA=ccx_9.Points)  # -> Keys, ValuesA
item_53 = ListItem(List=sort_14.ValuesA, Index=0, Wrap=True)  # -> flatten(Item)
item_54 = ListItem(List=sort_15.ValuesA, Index=0, Wrap=True)  # -> flatten(Item)
null_7 = NullItem(Item=item_53)  # -> NullFlags, InvalidFlags, Description
null_8 = NullItem(Item=item_54)  # -> NullFlags, InvalidFlags, Description
dispatch_43 = Dispatch(List=item_53, DispatchPattern=null_7.NullFlags)  # -> ListA, ListB
dispatch_44 = Dispatch(List=item_54, DispatchPattern=null_8.NullFlags)  # -> ListA, ListB

pt_30 = Point(dispatch_43.ListB)

# ---- group: 下层交点-除重 / 上层交点-除重
pt_31 = Point(dispatch_44.ListB)

# ---- group: 下层交点-除重 (continued)
pull_29 = PullPoint(Point=pt_30, Geometry=pt_31, ClosestOnly=True)  # -> ClosestPoint, Distance
sort_16 = SortList(Keys=pull_29.Distance, ValuesA=pull_29.ClosestPoint)  # -> Keys, ValuesA
panel_53 = Panel(sort_16.Keys)
larger_10 = LargerThan(FirstNumber=pull_29.Distance, SecondNumber=number_slider_25)  # -> LargerThan, OrEqualTo
dispatch_45 = Dispatch(List=pt_30, DispatchPattern=larger_10.LargerThan)  # -> ListA, ListB
pull_30 = PullPoint(Point=deplane_19.Origin, Geometry=graft(pt_30), ClosestOnly=True)  # -> ClosestPoint, Distance
sort_17 = SortList(Keys=pull_30.Distance, ValuesA=pln_35)  # -> Keys, ValuesA
item_55 = ListItem(List=sort_17.ValuesA, Index=0, Wrap=True)
check_same_points_6 = CheckSamePoints(archPoint=pln_35, crvPoint=flatten(item_55))  # -> out, specialPt; inputs archPoint: list of Point3d, crvPoint: list of Point3d; same code as testpoint

# ---- group: 下层交点-除重 / 2组交点距离大于容差-默认不同点
dispatch_46 = Dispatch(List=pull_29.ClosestPoint, DispatchPattern=larger_10.LargerThan)  # -> ListA, ListB

# ---- group: 下层交点-除重 / 大于容差算作新点
pt_32 = Point(dispatch_46.ListA)

# ---- group: 下层交点-除重 / 有效Plane-下层建筑线在该处连续
item_56 = ListItem(List=pln_35, Index=check_same_points_6.specialPt, Wrap=True)

# ----
cull_i_13 = CullIndex(List=pln_35, Indices=check_same_points_6.specialPt, Wrap=True)
merge_34 = Merge(Data1=cull_i_13, Data2=pln_21)  # -> flatten(Result)

# ----
# 和下层楼板发生关系的定位点
pln_36 = Plane(merge_34)

# ---- group: 起始Plane
pln_37 = Plane(pln_36)

# ----
pln_38 = Plane(pln_37)
number_slider_43 = Slider(3584, range=0..10000)
deplane_20 = DeconstructPlane(Plane=pln_38)  # -> Origin, XAxis, YAxis, ZAxis
crv_79 = Curve(merge_31)
boundary_4 = BoundarySurfaces(Edges=[offset_7, offset_6])
scx = SurfaceCurve(Surface=boundary_4, Curve=crv_79)  # -> flatten(Curves), Points, UVPoints, Normals, Parameters, Tangents
amp_19 = Amplitude(Vector=deplane_20.YAxis, Amplitude=number_slider_43)
amp_20 = Amplitude(Vector=deplane_20.YAxis, Amplitude=expr("-x", number_slider_43))
move_25 = Move(Geometry=deplane_20.Origin, Motion=amp_20)  # -> Geometry, Transform
move_26 = Move(Geometry=deplane_20.Origin, Motion=amp_19)  # -> Geometry, Transform
ln_22 = Line(StartPoint=move_25.Geometry, EndPoint=move_26.Geometry)
ccx_10 = CurveCurve(CurveA=graft(ln_22), CurveB=scx.Curves)  # -> Points, ParamsA, ParamsB
shift_6 = ShiftPaths(Data=ccx_10.Points, Offset=-1)
pull_31 = PullPoint(Point=graft(pln_38), Geometry=shift_6, ClosestOnly=True)  # -> ClosestPoint, Distance
sort_18 = SortList(Keys=pull_31.Distance, ValuesA=pull_31.ClosestPoint)  # -> Keys, ValuesA
item_57 = ListItem(List=sort_18.ValuesA, Index=0, Wrap=True)
null_9 = NullItem(Item=item_57)  # -> NullFlags, simplify(InvalidFlags), Description
null_10 = NullItem(Item=sort_18.ValuesA)  # -> NullFlags, simplify(InvalidFlags), Description
dispatch_47 = Dispatch(List=simplify(graft(pln_38)), DispatchPattern=null_10.InvalidFlags)  # -> ListA, ListB
dispatch_48 = Dispatch(List=simplify(graft(item_57)), DispatchPattern=null_9.InvalidFlags)  # -> ListA, ListB
pln_39 = Plane(dispatch_47.ListB)
pln_40 = Plane(dispatch_47.ListA)
pt_33 = Point(dispatch_48.ListB)

# ----
# 可能的结构交点-大量
pln_41 = Plane(pln_40)

# ----
# 0 檐口出定位点
# 与结构无交点
pln_42 = Plane(flatten(pln_41))

ccx_11 = CurveCurve(CurveA=graft(move_19.Geometry), CurveB=flatten(merge_31))  # -> Points, ParamsA, ParamsB
shift_7 = ShiftPaths(Data=ccx_11.Points, Offset=-1)
pull_32 = PullPoint(Point=shift_7, Geometry=graft(pln_30), ClosestOnly=True)  # -> ClosestPoint, Distance
sort_19 = SortList(Keys=pull_32.Distance, ValuesA=pull_32.ClosestPoint)  # -> Keys, ValuesA

# ---- group: 最远交点
item_58 = ListItem(List=sort_19.ValuesA, Index="-1", Wrap=True)

# ----
null_11 = NullItem(Item=flatten(item_58))  # -> NullFlags, InvalidFlags, Description
dispatch_49 = Dispatch(List=simplify(item_58), DispatchPattern=simplify(graft(null_11.InvalidFlags)))  # -> ListA, ListB
dispatch_50 = Dispatch(List=pln_30, DispatchPattern=null_11.InvalidFlags)  # -> ListA, ListB
pt_34 = Point(dispatch_49.ListB)
pln_43 = Plane(dispatch_50.ListB)
move2pt_8 = MoveToPoint(Geometry=pln_43, PointA=pln_43, PointB=flatten(pt_34))  # -> Moved, Vector, Transform

pln_44 = Plane(dispatch_50.ListA)

# ----
# 按照梁分类定位点
pt_35 = Point(pt_34)
incurves_6 = PointInCurves(Point=flatten(pt_35), Curves=crv_66)  # -> Relationship, Index, Point
equals_12 = Equality(FirstNumber=incurves_6.Relationship, SecondNumber="0")  # -> Equality, Inequality
dispatch_51 = Dispatch(List=flatten(pt_35), DispatchPattern=equals_12.Inequality)  # -> ListA, ListB

# ---- group: 交点-属于哪个梁
data_44 = Data(dispatch_51.ListA)

# ----
ccx_12 = CurveCurve(CurveA=graft(move_20.Geometry), CurveB=flatten(merge_31))  # -> Points, ParamsA, ParamsB
shift_8 = ShiftPaths(Data=ccx_12.Points, Offset=-1)
pull_33 = PullPoint(Point=shift_8, Geometry=graft(pln_30), ClosestOnly=True)  # -> ClosestPoint, Distance
sort_20 = SortList(Keys=pull_33.Distance, ValuesA=pull_33.ClosestPoint)  # -> Keys, ValuesA

# ---- group: 最远交点
item_59 = ListItem(List=sort_20.ValuesA, Index="-1", Wrap=True)

# ----
null_12 = NullItem(Item=flatten(item_59))  # -> NullFlags, InvalidFlags, Description
dispatch_52 = Dispatch(List=simplify(item_59), DispatchPattern=simplify(graft(null_12.InvalidFlags)))  # -> ListA, ListB
dispatch_53 = Dispatch(List=pln_30, DispatchPattern=null_12.InvalidFlags)  # -> ListA, ListB
pt_36 = Point(dispatch_52.ListB)
pln_45 = Plane(dispatch_53.ListB)
move2pt_9 = MoveToPoint(Geometry=pln_45, PointA=pln_45, PointB=flatten(pt_36))  # -> Moved, Vector, Transform

pln_46 = Plane(dispatch_53.ListA)
check_same_points_7 = CheckSamePoints(archPoint=pln_46, crvPoint=pln_44)  # -> out, specialPt; inputs archPoint: list of Point3d, crvPoint: list of Point3d; same code as testpoint
cset = CreateSet(List=check_same_points_7.specialPt)  # -> Set, Map

# ----
# 按照梁分类定位点
pt_37 = Point(pt_36)
incurves_7 = PointInCurves(Point=flatten(pt_37), Curves=crv_66)  # -> Relationship, Index, Point
equals_13 = Equality(FirstNumber=incurves_7.Relationship, SecondNumber="0")  # -> Equality, Inequality
dispatch_54 = Dispatch(List=flatten(pt_37), DispatchPattern=equals_13.Inequality)  # -> ListA, ListB

item_60 = ListItem(List=pln_46, Index=cset.Set, Wrap=True)

# ---- group: 交点-属于哪个梁
data_45 = Data(dispatch_54.ListA)

# ----
# 未生成檐口线
pt_38 = Point(item_60)

# ----
# （10）需人工排布
pt_39 = Point(pt_38)
bake_2 = BakeObjects(Geometry=pt_39, Attributes=attributes_2, BakeName=panel_37, Bake=False)

# ---- group: 下层交点-除重 (continued)
pull_34 = PullPoint(Point=pt_32, Geometry=pt_29, ClosestOnly=True)  # -> ClosestPoint, Distance
check_same_points_8 = CheckSamePoints(archPoint=pt_29, crvPoint=flatten(pull_34.ClosestPoint))  # -> out, specialPt; inputs archPoint: list of Point3d, crvPoint: list of Point3d; same code as testpoint

# ---- group: 下层交点-除重 / 有效Plane-上层建筑线在该处连续
item_61 = ListItem(List=pln_28, Index=check_same_points_8.specialPt, Wrap=True)

# ---- group: 下层交点-除重 (continued)
merge_35 = Merge(Data1=item_56, Data2=item_61)  # -> flatten(Result)
deplane_21 = DeconstructPlane(Plane=merge_35)  # -> Origin, XAxis, YAxis, ZAxis
amp_21 = Amplitude(Vector=deplane_21.YAxis, Amplitude=expr("-x", Slider(2756, range=0..10000)))
move_27 = Move(Geometry=deplane_21.Origin, Motion=amp_21)  # -> Geometry, Transform

# ---- group: 下层交点-除重 / 相内探索
ln_23 = Line(StartPoint=deplane_21.Origin, EndPoint=move_27.Geometry)

# ---- group: 下层交点-除重 (continued)
ccx_13 = CurveCurve(CurveA=graft(ln_23), CurveB=flatten(crv_67))  # -> Points, ParamsA, ParamsB
shift_9 = ShiftPaths(Data=ccx_13.Points, Offset=-1)
pull_35 = PullPoint(Point=deplane_21.Origin, Geometry=shift_9, ClosestOnly=True)  # -> ClosestPoint, Distance
sort_21 = SortList(Keys=pull_35.Distance, ValuesA=pull_35.ClosestPoint)  # -> Keys, ValuesA

# ---- group: 下层交点-除重 / 与梁最近交点
item_62 = ListItem(List=sort_21.ValuesA, Index=0, Wrap=True)

# ----
# 按照梁分类定位PLANE
crv_80 = Curve(merge_30)
shift_10 = ShiftPaths(Data=crv_80, Offset=-1)
shift_11 = ShiftPaths(Data=shift_10, Offset=-1)
pull_36 = PullPoint(Point=data_44, Geometry=simplify(shift_11), ClosestOnly=True)  # -> ClosestPoint, Distance
ln_24 = Line(StartPoint=pull_36.ClosestPoint, EndPoint=data_44)
crv_81 = Curve(crv_30)
movetoplane_12 = MoveToPlane(Geometry=crv_81, Plane=PlaneXY(0, 0, 0), Above=True, Below=True)  # -> Geometry, Transform

# ---- group: Y Axis Line-All
crv_82 = Curve(ln_24)

# ----
# 按照梁分类定位PLANE
crv_83 = Curve(merge_30)
shift_12 = ShiftPaths(Data=crv_83, Offset=-1)
shift_13 = ShiftPaths(Data=shift_12, Offset=-1)
pull_37 = PullPoint(Point=data_45, Geometry=simplify(shift_13), ClosestOnly=True)  # -> ClosestPoint, Distance
ln_25 = Line(StartPoint=pull_37.ClosestPoint, EndPoint=data_45)
crv_84 = Curve(crv_30)
movetoplane_13 = MoveToPlane(Geometry=crv_84, Plane=PlaneXY(0, 0, 0), Above=True, Below=True)  # -> Geometry, Transform

# ---- group: Y Axis Line-All
crv_85 = Curve(ln_25)

# ---- group: 下层交点-除重 (continued)
null_13 = NullItem(Item=flatten(item_62))  # -> NullFlags, InvalidFlags, Description
dispatch_55 = Dispatch(List=merge_35, DispatchPattern=null_13.InvalidFlags)  # -> ListA, ListB
dispatch_56 = Dispatch(List=flatten(item_62), DispatchPattern=null_13.InvalidFlags)  # -> ListA, ListB

# ---- group: 下层交点-除重 / 有效起始Plane
data_46 = Data(dispatch_55.ListB)

# ---- group: 下层交点-除重 / 去除Null的交点
data_47 = Data(dispatch_56.ListB)

# ---- group: 下层交点-除重 (continued)
flatten_6 = FlattenTree(Tree=data_47, Path="{0}")
ln_26 = Line(StartPoint=data_46, EndPoint=flatten_6)

# ----
# 1.0
data_48 = Data(data_46)
data_49 = Data(data_47)
crv_86 = Curve(shift_2)

# ----
# 按照梁分类定位点
pt_40 = Point(data_49)
pln_47 = Plane(data_48)
incurves_8 = PointInCurves(Point=flatten(pt_40), Curves=crv_86)  # -> Relationship, Index, Point
equals_14 = Equality(FirstNumber=incurves_8.Relationship, SecondNumber="0")  # -> Equality, Inequality
dispatch_57 = Dispatch(List=flatten(pln_47), DispatchPattern=equals_14.Inequality)  # -> ListA, ListB
data_50 = Data(dispatch_57.ListA)

incurves_9 = PointInCurves(Point=flatten(pt_40), Curves=crv_86)  # -> Relationship, Index, Point
equals_15 = Equality(FirstNumber=incurves_9.Relationship, SecondNumber="0")  # -> Equality, Inequality
dispatch_58 = Dispatch(List=flatten(pt_40), DispatchPattern=equals_15.Inequality)  # -> ListA, ListB
data_51 = Data(dispatch_58.ListA)

move2pt_10 = MoveToPoint(Geometry=data_50, PointA=data_50, PointB=data_51)  # -> Moved, Vector, Transform
null_14 = NullItem(Item=move2pt_10.Moved)  # -> NullFlags, InvalidFlags, Description
dispatch_59 = Dispatch(List=move2pt_10.Moved, DispatchPattern=null_14.InvalidFlags)  # -> ListA, ListB
pln_48 = Plane(dispatch_59.ListB)

# ----
# 1.0无檐口线
# 与梁不相交
# 与梁无交点的定位点
pln_49 = Plane(dispatch_55.ListA)

# ----
# 0 檐口出定位点
# 与结构无交点
pln_50 = Plane(flatten(pln_49))

crv_87 = Curve(crv_86)

# ----
# 1.0无檐口线+上下层幕墙边线连续
# 01：钢板焊埋件[钢梁外侧]
# @钢边梁宽@钢边梁高
pln_51 = Plane(pln_48)

end_7 = EndPoints(Curve=graft(crv_82))  # -> Start, End
merge_36 = Merge(Data1=end_7.Start, Data2=end_7.End)
pull_38 = PullPoint(Point=merge_36, Geometry=movetoplane_12.Geometry, ClosestOnly=True)  # -> ClosestPoint, Distance
sort_22 = SortList(Keys=pull_38.Distance, ValuesA=merge_36)  # -> Keys, ValuesA
item_63 = ListItem(List=sort_22.ValuesA, Index="-1", Wrap=True)
item_64 = ListItem(List=sort_22.ValuesA, Index=0, Wrap=True)
pt_41 = Point(item_64)
pt_42 = Point(item_63)
ln_27 = Line(StartPoint=pt_42, EndPoint=pt_41)
rotate_12 = Rotate(Geometry=ln_27, Angle=1.570796327, Plane=pt_41)  # -> Geometry, Transform

pt_43 = Point(end_7.End)

pl_11 = ConstructPlane(Origin=pt_43, XAxis=rotate_12.Geometry, YAxis=ln_27)
null_15 = NullItem(Item=pl_11)  # -> NullFlags, InvalidFlags, Description
dispatch_60 = Dispatch(List=pl_11, DispatchPattern=null_15.NullFlags)  # -> ListA, ListB

pln_52 = Plane(dispatch_60.ListB)

end_8 = EndPoints(Curve=graft(crv_85))  # -> Start, End
merge_37 = Merge(Data1=end_8.Start, Data2=end_8.End)
pull_39 = PullPoint(Point=merge_37, Geometry=movetoplane_13.Geometry, ClosestOnly=True)  # -> ClosestPoint, Distance
sort_23 = SortList(Keys=pull_39.Distance, ValuesA=merge_37)  # -> Keys, ValuesA
item_65 = ListItem(List=sort_23.ValuesA, Index="-1", Wrap=True)
item_66 = ListItem(List=sort_23.ValuesA, Index=0, Wrap=True)
pt_44 = Point(item_66)
pt_45 = Point(item_65)
ln_28 = Line(StartPoint=pt_45, EndPoint=pt_44)
rotate_13 = Rotate(Geometry=ln_28, Angle=1.570796327, Plane=pt_44)  # -> Geometry, Transform

pt_46 = Point(end_8.End)

pl_12 = ConstructPlane(Origin=pt_46, XAxis=rotate_13.Geometry, YAxis=ln_28)
null_16 = NullItem(Item=pl_12)  # -> NullFlags, InvalidFlags, Description
dispatch_61 = Dispatch(List=pl_12, DispatchPattern=null_16.NullFlags)  # -> ListA, ListB

pln_53 = Plane(dispatch_61.ListB)

# ----
# 撞到梁交点
pln_54 = Plane(pln_52)
pln_55 = Plane(pln_53)

merge_38 = Merge(Data1=pln_32, Data2=pln_55, Data3=pln_54)
# 阳角
# 阴角
# 转角点
orient_3 = Orient(Geometry=item_33, Source=item_34, Target=merge_38)  # -> Geometry, Transform

data_52 = Data(orient_3.Geometry)
ungroup_5 = Ungroup(Group=data_52)
item_67 = ListItem(List=ungroup_5, Index=0, Wrap=True)  # -> flatten(Item)
item_68 = ListItem(List=ungroup_5, Index="-1", Wrap=True)  # -> flatten(Item)

entwine_13 = Entwine(Branch00=item_67, Branch01=item_68, FlattenInputs=True)
bake_3 = BakeObjects(Geometry=entwine_13, Attributes=attributes_3, BakeName="Embed::1-1-02钢板焊埋件", Bake=False)

# ----
# 1.0.Missing Point
# 埋件定位点Offset，没有找到和梁的交点
number_slider_44 = Slider(5000, range=0..10000)
deplane_22 = DeconstructPlane(Plane=pln_50)  # -> Origin, XAxis, YAxis, ZAxis
amp_22 = Amplitude(Vector=deplane_22.YAxis, Amplitude=expr("-x", number_slider_44))
move_28 = Move(Geometry=deplane_22.Origin, Motion=amp_22)  # -> Geometry, Transform
ln_29 = Line(StartPoint=move_28.Geometry, EndPoint=deplane_22.Origin)
crv_88 = Curve(crv_67)
amp_23 = Amplitude(Vector=deplane_22.XAxis, Amplitude=number_slider_7)
amp_24 = Amplitude(Vector=deplane_22.XAxis, Amplitude=expr("-x", number_slider_7))

# ---- group: 2组探索针
move_29 = Move(Geometry=ln_29, Motion=amp_24)  # -> Geometry, Transform
move_30 = Move(Geometry=ln_29, Motion=amp_23)  # -> Geometry, Transform

# ----
ccx_14 = CurveCurve(CurveA=graft(move_29.Geometry), CurveB=flatten(crv_88))  # -> Points, ParamsA, ParamsB
shift_14 = ShiftPaths(Data=ccx_14.Points, Offset=-1)
sort_24 = SortList(Keys=shift_14, ValuesA=shift_14)  # -> Keys, ValuesA
pull_40 = PullPoint(Point=sort_24.ValuesA, Geometry=graft(pln_50), ClosestOnly=True)  # -> ClosestPoint, Distance
sort_25 = SortList(Keys=pull_40.Distance, ValuesA=sort_24.ValuesA)  # -> Keys, ValuesA
item_69 = ListItem(List=sort_25.ValuesA, Index="0", Wrap=True)
null_17 = NullItem(Item=flatten(item_69))  # -> NullFlags, InvalidFlags, Description
dispatch_62 = Dispatch(List=simplify(item_69), DispatchPattern=simplify(graft(null_17.InvalidFlags)))  # -> ListA, ListB
dispatch_63 = Dispatch(List=pln_50, DispatchPattern=null_17.InvalidFlags)  # -> ListA, ListB
pln_56 = Plane(dispatch_63.ListB)
pt_47 = Point(dispatch_62.ListB)
move2pt_11 = MoveToPoint(Geometry=pln_56, PointA=pln_56, PointB=pt_47)  # -> Moved, Vector, Transform

ccx_15 = CurveCurve(CurveA=graft(move_30.Geometry), CurveB=flatten(crv_88))  # -> Points, ParamsA, ParamsB
shift_15 = ShiftPaths(Data=ccx_15.Points, Offset=-1)
sort_26 = SortList(Keys=shift_15, ValuesA=shift_15)  # -> Keys, ValuesA
pull_41 = PullPoint(Point=sort_26.ValuesA, Geometry=graft(pln_50), ClosestOnly=True)  # -> ClosestPoint, Distance
sort_27 = SortList(Keys=pull_41.Distance, ValuesA=sort_26.ValuesA)  # -> Keys, ValuesA
item_70 = ListItem(List=sort_27.ValuesA, Index="0", Wrap=True)
null_18 = NullItem(Item=flatten(item_70))  # -> NullFlags, InvalidFlags, Description
dispatch_64 = Dispatch(List=simplify(item_70), DispatchPattern=simplify(graft(null_18.InvalidFlags)))  # -> ListA, ListB
dispatch_65 = Dispatch(List=pln_50, DispatchPattern=null_18.InvalidFlags)  # -> ListA, ListB
pln_57 = Plane(dispatch_65.ListB)
pt_48 = Point(dispatch_64.ListB)
move2pt_12 = MoveToPoint(Geometry=pln_57, PointA=pln_57, PointB=pt_48)  # -> Moved, Vector, Transform

# ----
# 钢埋板高度，工字钢尺寸决定
pln_58 = Plane([dispatch_65.ListA, dispatch_63.ListA])

# ----
# 按照梁分类定位点
pln_59 = Plane(move2pt_12.Moved)
pt_49 = Point(pt_48)
incurves_10 = PointInCurves(Point=flatten(pt_49), Curves=crv_87)  # -> Relationship, Index, Point
equals_16 = Equality(FirstNumber=incurves_10.Relationship, SecondNumber="0")  # -> Equality, Inequality
dispatch_66 = Dispatch(List=flatten(pln_59), DispatchPattern=equals_16.Inequality)  # -> ListA, ListB
data_53 = Data(dispatch_66.ListA)

# ----
# 按照梁分类定位点
pln_60 = Plane(move2pt_11.Moved)
pt_50 = Point(pt_47)
incurves_11 = PointInCurves(Point=flatten(pt_50), Curves=crv_87)  # -> Relationship, Index, Point
equals_17 = Equality(FirstNumber=incurves_11.Relationship, SecondNumber="0")  # -> Equality, Inequality
dispatch_67 = Dispatch(List=flatten(pln_60), DispatchPattern=equals_17.Inequality)  # -> ListA, ListB
data_54 = Data(dispatch_67.ListA)

incurves_12 = PointInCurves(Point=flatten(pt_50), Curves=crv_87)  # -> Relationship, Index, Point
equals_18 = Equality(FirstNumber=incurves_12.Relationship, SecondNumber="0")  # -> Equality, Inequality
dispatch_68 = Dispatch(List=flatten(pt_50), DispatchPattern=equals_18.Inequality)  # -> ListA, ListB
data_55 = Data(dispatch_68.ListA)

incurves_13 = PointInCurves(Point=flatten(pt_49), Curves=crv_87)  # -> Relationship, Index, Point
equals_19 = Equality(FirstNumber=incurves_13.Relationship, SecondNumber="0")  # -> Equality, Inequality
dispatch_69 = Dispatch(List=flatten(pt_49), DispatchPattern=equals_19.Inequality)  # -> ListA, ListB
data_56 = Data(dispatch_69.ListA)

move2pt_13 = MoveToPoint(Geometry=data_53, PointA=data_53, PointB=data_56)  # -> Moved, Vector, Transform
null_19 = NullItem(Item=move2pt_13.Moved)  # -> NullFlags, InvalidFlags, Description
dispatch_70 = Dispatch(List=move2pt_13.Moved, DispatchPattern=null_19.InvalidFlags)  # -> ListA, ListB
pln_61 = Plane(dispatch_70.ListB)

move2pt_14 = MoveToPoint(Geometry=data_54, PointA=data_54, PointB=data_55)  # -> Moved, Vector, Transform
null_20 = NullItem(Item=move2pt_14.Moved)  # -> NullFlags, InvalidFlags, Description
dispatch_71 = Dispatch(List=move2pt_14.Moved, DispatchPattern=null_20.InvalidFlags)  # -> ListA, ListB
pln_62 = Plane(dispatch_71.ListB)

# ----
# 撞到梁交点
merge_39 = Merge(Data1=pln_61, Data2=pln_62)

merge_40 = Merge(Data1=pln_51, Data2=merge_39)
orient_4 = Orient(Geometry=item_35, Source=item_36, Target=merge_40)  # -> Geometry, Transform

data_57 = Data(orient_4.Geometry)
ungroup_6 = Ungroup(Group=data_57)
item_71 = ListItem(List=ungroup_6, Index=0, Wrap=True)  # -> flatten(Item)
item_72 = ListItem(List=ungroup_6, Index="-1", Wrap=True)  # -> flatten(Item)

entwine_14 = Entwine(Branch00=item_71, Branch01=item_72, FlattenInputs=True)
bake_4 = BakeObjects(Geometry=entwine_14, Attributes=attributes_5, BakeName="Embed::1-0-01钢板焊埋件", Bake=False)

# ---- group: 1.0N的情况的Plane
pln_63 = Plane(pln_58)

# ----
# 5 上层建筑边线,
# 默认建筑提供上翻，如主结构提供示意则使用结构定位【该项目无】，
# 如无则使用建筑边线向内50mm作为埋件定位
deplane_23 = DeconstructPlane(Plane=pln_63)  # -> Origin, XAxis, YAxis, ZAxis
number_slider_45 = Slider(3584, range=0..10000)
# SmoothCurve-阴角
# SmoothCurve-阳角
# SmoothCurve-阴角
# SmoothCurve-正常
# Angular Curve - All
# Special Curve(with location)- All
# Curve for this project only - All
amp_25 = Amplitude(Vector=deplane_23.YAxis, Amplitude=number_slider_45)
amp_26 = Amplitude(Vector=deplane_23.YAxis, Amplitude=expr("-x", number_slider_45))
move_31 = Move(Geometry=deplane_23.Origin, Motion=amp_26)  # -> Geometry, Transform
move_32 = Move(Geometry=deplane_23.Origin, Motion=amp_25)  # -> Geometry, Transform
ln_30 = Line(StartPoint=move_31.Geometry, EndPoint=move_32.Geometry)
ccx_16 = CurveCurve(CurveA=ln_30, CurveB=crv_45)  # -> simplify(Points), ParamsA, ParamsB
ln_31 = Line(StartPoint=ccx_16.Points, EndPoint=simplify(graft(pln_63)))
len_6 = Length(Curve=ln_31)
null_21 = NullItem(Item=ccx_16.Points)  # -> NullFlags, InvalidFlags, Description
sort_28 = SortList(Keys=len_6, ValuesA=simplify(ccx_16.Points))  # -> Keys, ValuesA
dispatch_72 = Dispatch(List=simplify(graft(pln_63)), DispatchPattern=null_21.NullFlags)  # -> ListA, ListB
item_73 = ListItem(List=sort_28.ValuesA, Index=0, Wrap=True)

# ----
# 可能的双点
pln_64 = Plane(dispatch_72.ListA)

# ----
# 0 檐口出定位点
# 与结构无交点
pln_65 = Plane(flatten(pln_64))

# ----
# 5 上层建筑边线,
# 默认建筑提供上翻
# 04：板埋埋件[混凝土楼板上侧]
# @板埋参数xn
move2pt_15 = MoveToPoint(Geometry=simplify(graft(pln_63)), PointA=simplify(graft(pln_63)), PointB=item_73)  # -> flatten(Moved), Vector, Transform

# ----
# 2是否有吊顶
# 梁以内>350
deplane_24 = DeconstructPlane(Plane=pln_36)  # -> Origin, XAxis, YAxis, ZAxis
number_slider_46 = Slider(5000, range=0..10000)
amp_27 = Amplitude(Vector=deplane_24.YAxis, Amplitude=expr("-x", number_slider_46))
amp_28 = Amplitude(Vector=deplane_24.YAxis, Amplitude=number_slider_46)
move_33 = Move(Geometry=deplane_24.Origin, Motion=amp_28)  # -> Geometry, Transform
move_34 = Move(Geometry=deplane_24.Origin, Motion=amp_27)  # -> Geometry, Transform
ln_32 = Line(StartPoint=move_33.Geometry, EndPoint=move_34.Geometry)
crv_89 = Curve(crv_19)

# ---- group: 和下层建筑的交点
ccx_17 = CurveCurve(CurveA=ln_32, CurveB=crv_89)  # -> Points, ParamsA, ParamsB

# ----
null_22 = NullItem(Item=ccx_17.Points)  # -> NullFlags, InvalidFlags, Description
dispatch_73 = Dispatch(List=simplify(ccx_17.Points), DispatchPattern=simplify(null_22.NullFlags))  # -> ListA, ListB
dispatch_74 = Dispatch(List=simplify(graft(pln_36)), DispatchPattern=simplify(null_22.NullFlags))  # -> ListA, ListB
pt_51 = Point(dispatch_73.ListB)
pln_66 = Plane(flatten(dispatch_74.ListB))
pt_52 = Point(pln_66)
pull_42 = PullPoint(Point=flatten(pt_52), Geometry=flatten(pt_51), ClosestOnly=True)  # -> ClosestPoint, Distance
ln_33 = Line(StartPoint=pln_66, EndPoint=pull_42.ClosestPoint)

# ----
# 定位点Project到下层建筑线
move2pt_16 = MoveToPoint(Geometry=pln_66, PointA=pln_66, PointB=pull_42.ClosestPoint)  # -> Moved, Vector, Transform

# ----
# 可能的点-离结构很远
pln_67 = Plane(dispatch_74.ListA)

deplane_25 = DeconstructPlane(Plane=move2pt_16.Moved)  # -> Origin, XAxis, YAxis, ZAxis
amp_29 = Amplitude(Vector=deplane_25.YAxis, Amplitude=Slider(5000, range=0..10000))
move_35 = Move(Geometry=deplane_25.Origin, Motion=amp_29)  # -> Geometry, Transform
ln_34 = Line(StartPoint=move_35.Geometry, EndPoint=deplane_25.Origin)

# ---- group: 和内测梁交点
ccx_18 = CurveCurve(CurveA=graft(ln_34), CurveB=flatten(crv_68))  # -> simplify(Points), ParamsA, ParamsB

# ----
shift_16 = ShiftPaths(Data=ccx_18.Points, Offset=-1)
null_23 = NullItem(Item=shift_16)  # -> NullFlags, InvalidFlags, Description
dispatch_75 = Dispatch(List=simplify(graft(move2pt_16.Moved)), DispatchPattern=null_23.NullFlags)  # -> ListA, ListB
dispatch_76 = Dispatch(List=simplify(graft(ln_34)), DispatchPattern=null_23.NullFlags)  # -> ListA, ListB
pln_68 = Plane(dispatch_75.ListA)
crv_90 = Curve(dispatch_76.ListB)
pln_69 = Plane(dispatch_75.ListB)
ccx_19 = CurveCurve(CurveA=graft(crv_90), CurveB=flatten(crv_68))  # -> Points, ParamsA, ParamsB
shift_17 = ShiftPaths(Data=simplify(ccx_19.Points), Offset=-1)
pull_43 = PullPoint(Point=pln_69, Geometry=shift_17, ClosestOnly=True)  # -> ClosestPoint, Distance
sort_29 = SortList(Keys=pull_43.Distance, ValuesA=pull_43.ClosestPoint)  # -> Keys, ValuesA

# ---- group: 交点对应的起始定位点
item_74 = ListItem(List=sort_29.ValuesA, Index=0, Wrap=True)

# ----
ln_35 = Line(StartPoint=pln_69, EndPoint=item_74)
len_7 = Length(Curve=ln_35)
larger_11 = LargerThan(FirstNumber=len_7, SecondNumber=number_slider_26)  # -> LargerThan, OrEqualTo
panel_54 = Panel(len_7)
dispatch_77 = Dispatch(List=pln_69, DispatchPattern=larger_11.LargerThan)  # -> ListA, ListB
dispatch_78 = Dispatch(List=item_74, DispatchPattern=larger_11.LargerThan)  # -> ListA, ListB
pln_70 = Plane(dispatch_77.ListB)

# ---- group: 起始点
pt_53 = Point(dispatch_78.ListA)

# ---- group: 最终Plane
pln_71 = Plane(dispatch_77.ListA)

# ---- group: 分类后的Plane
# 按照梁分类定位点
pln_72 = Plane(pln_71)
pt_54 = Point(pt_53)
incurves_14 = PointInCurves(Point=flatten(pt_54), Curves=crv_69)  # -> Relationship, Index, Point
equals_20 = Equality(FirstNumber=incurves_14.Relationship, SecondNumber="0")  # -> Equality, Inequality
dispatch_79 = Dispatch(List=flatten(pln_72), DispatchPattern=equals_20.Inequality)  # -> ListA, ListB
data_58 = Data(dispatch_79.ListA)

incurves_15 = PointInCurves(Point=flatten(pt_54), Curves=crv_69)  # -> Relationship, Index, Point
equals_21 = Equality(FirstNumber=incurves_15.Relationship, SecondNumber="0")  # -> Equality, Inequality
dispatch_80 = Dispatch(List=flatten(pt_54), DispatchPattern=equals_21.Inequality)  # -> ListA, ListB
data_59 = Data(dispatch_80.ListA)

move2pt_17 = MoveToPoint(Geometry=data_58, PointA=data_58, PointB=data_59)  # -> Moved, Vector, Transform
null_24 = NullItem(Item=move2pt_17.Moved)  # -> NullFlags, InvalidFlags, Description
dispatch_81 = Dispatch(List=move2pt_17.Moved, DispatchPattern=null_24.InvalidFlags)  # -> ListA, ListB

pln_73 = Plane(dispatch_81.ListB)

# ----
# 可能的结构交点-大量
pln_74 = Plane(pln_68)

# ----
# 可能的结构交点
pln_75 = Plane(pln_70)

# ----
# 2.1 梁以内>350
# 
# 侧埋，钢板焊
# 03：钢板焊埋件[钢梁内侧]
# @钢边梁宽@钢边梁高
pln_76 = Plane(pln_73)

# ----
# 2.1 Missing Point
# 埋件定位点Offset，没有找到和梁的交点
merge_41 = Merge(Data1=pln_67, Data2=pln_75, Data3=pln_74)
crv_91 = Curve(crv_68)

# ----
# 0 檐口出定位点
# 与结构无交点
pln_77 = Plane(flatten(merge_41))

deplane_26 = DeconstructPlane(Plane=pln_77)  # -> Origin, XAxis, YAxis, ZAxis
amp_30 = Amplitude(Vector=deplane_26.YAxis, Amplitude=Slider(5000, range=0..10000))
move_36 = Move(Geometry=deplane_26.Origin, Motion=amp_30)  # -> Geometry, Transform
ln_36 = Line(StartPoint=move_36.Geometry, EndPoint=deplane_26.Origin)
amp_31 = Amplitude(Vector=deplane_26.XAxis, Amplitude=number_slider_7)
amp_32 = Amplitude(Vector=deplane_26.XAxis, Amplitude=expr("-x", number_slider_7))
move_37 = Move(Geometry=ln_36, Motion=amp_31)  # -> Geometry, Transform
move_38 = Move(Geometry=ln_36, Motion=amp_32)  # -> Geometry, Transform

ccx_20 = CurveCurve(CurveA=graft(move_37.Geometry), CurveB=flatten(crv_91))  # -> Points, ParamsA, ParamsB
shift_18 = ShiftPaths(Data=ccx_20.Points, Offset=-1)
sort_30 = SortList(Keys=shift_18, ValuesA=shift_18)  # -> Keys, ValuesA
pull_44 = PullPoint(Point=sort_30.ValuesA, Geometry=graft(pln_77), ClosestOnly=True)  # -> ClosestPoint, Distance
sort_31 = SortList(Keys=pull_44.Distance, ValuesA=sort_30.ValuesA)  # -> Keys, ValuesA
item_75 = ListItem(List=sort_31.ValuesA, Index="-1", Wrap=True)
null_25 = NullItem(Item=flatten(item_75))  # -> NullFlags, InvalidFlags, Description
end_9 = EndPoints(Curve=move_37.Geometry)  # -> Start, End
dispatch_82 = Dispatch(List=graft(pln_77), DispatchPattern=graft(null_25.InvalidFlags))  # -> ListA, ListB
dispatch_83 = Dispatch(List=simplify(item_75), DispatchPattern=simplify(graft(null_25.InvalidFlags)))  # -> ListA, ListB
pt_55 = Point(dispatch_83.ListB)
pln_78 = Plane(dispatch_82.ListB)
dispatch_84 = Dispatch(List=simplify(graft(end_9.End)), DispatchPattern=simplify(graft(null_25.InvalidFlags)))  # -> ListA, ListB
pt_56 = Point(dispatch_84.ListB)
ln_37 = Line(StartPoint=pt_56, EndPoint=pt_55)
len_8 = Length(Curve=ln_37)
larger_12 = LargerThan(FirstNumber=len_8, SecondNumber=Slider(350, range=0..1000))  # -> LargerThan, OrEqualTo
dispatch_85 = Dispatch(List=pln_78, DispatchPattern=larger_12.LargerThan)  # -> ListA, ListB
dispatch_86 = Dispatch(List=pt_56, DispatchPattern=larger_12.LargerThan)  # -> ListA, ListB
pln_79 = Plane(dispatch_85.ListA)
pt_57 = Point(dispatch_86.ListA)
move2pt_18 = MoveToPoint(Geometry=pln_79, PointA=pln_79, PointB=pt_57)  # -> Moved, Vector, Transform

ccx_21 = CurveCurve(CurveA=graft(move_38.Geometry), CurveB=flatten(crv_91))  # -> Points, ParamsA, ParamsB
shift_19 = ShiftPaths(Data=ccx_21.Points, Offset=-1)
sort_32 = SortList(Keys=shift_19, ValuesA=shift_19)  # -> Keys, ValuesA
pull_45 = PullPoint(Point=sort_32.ValuesA, Geometry=graft(pln_77), ClosestOnly=True)  # -> ClosestPoint, Distance
sort_33 = SortList(Keys=pull_45.Distance, ValuesA=sort_32.ValuesA)  # -> Keys, ValuesA
item_76 = ListItem(List=sort_33.ValuesA, Index="-1", Wrap=True)
null_26 = NullItem(Item=flatten(item_76))  # -> NullFlags, InvalidFlags, Description
end_10 = EndPoints(Curve=move_38.Geometry)  # -> Start, End
dispatch_87 = Dispatch(List=simplify(item_76), DispatchPattern=simplify(graft(null_26.InvalidFlags)))  # -> ListA, ListB
dispatch_88 = Dispatch(List=graft(pln_77), DispatchPattern=flatten(null_26.InvalidFlags))  # -> ListA, ListB
dispatch_89 = Dispatch(List=simplify(graft(end_10.End)), DispatchPattern=simplify(graft(null_26.InvalidFlags)))  # -> ListA, ListB
pln_80 = Plane(dispatch_88.ListB)
pt_58 = Point(dispatch_87.ListB)
pt_59 = Point(dispatch_89.ListB)
ln_38 = Line(StartPoint=pt_59, EndPoint=pt_55)
len_9 = Length(Curve=ln_38)
larger_13 = LargerThan(FirstNumber=len_9, SecondNumber=Slider(350, range=0..1000))  # -> LargerThan, OrEqualTo
dispatch_90 = Dispatch(List=pln_80, DispatchPattern=larger_13.LargerThan)  # -> ListA, ListB
dispatch_91 = Dispatch(List=pt_59, DispatchPattern=larger_13.LargerThan)  # -> ListA, ListB
pln_81 = Plane(dispatch_90.ListA)
pt_60 = Point(dispatch_91.ListA)
move2pt_19 = MoveToPoint(Geometry=pln_81, PointA=pln_81, PointB=pt_60)  # -> Moved, Vector, Transform

# ----
# 按照梁分类定位点
pln_82 = Plane(move2pt_18.Moved)
pt_61 = Point(pt_57)
incurves_16 = PointInCurves(Point=flatten(pt_61), Curves=crv_70)  # -> Relationship, Index, Point
equals_22 = Equality(FirstNumber=incurves_16.Relationship, SecondNumber="0")  # -> Equality, Inequality
dispatch_92 = Dispatch(List=flatten(pln_82), DispatchPattern=equals_22.Inequality)  # -> ListA, ListB
data_60 = Data(dispatch_92.ListA)

# ----
# 按照梁分类定位点
pln_83 = Plane(move2pt_19.Moved)
pt_62 = Point(pt_60)
incurves_17 = PointInCurves(Point=flatten(pt_62), Curves=crv_70)  # -> Relationship, Index, Point
equals_23 = Equality(FirstNumber=incurves_17.Relationship, SecondNumber="0")  # -> Equality, Inequality
dispatch_93 = Dispatch(List=flatten(pln_83), DispatchPattern=equals_23.Inequality)  # -> ListA, ListB
data_61 = Data(dispatch_93.ListA)

incurves_18 = PointInCurves(Point=flatten(pt_62), Curves=crv_70)  # -> Relationship, Index, Point
equals_24 = Equality(FirstNumber=incurves_18.Relationship, SecondNumber="0")  # -> Equality, Inequality
dispatch_94 = Dispatch(List=flatten(pt_62), DispatchPattern=equals_24.Inequality)  # -> ListA, ListB
data_62 = Data(dispatch_94.ListA)

incurves_19 = PointInCurves(Point=flatten(pt_61), Curves=crv_70)  # -> Relationship, Index, Point
equals_25 = Equality(FirstNumber=incurves_19.Relationship, SecondNumber="0")  # -> Equality, Inequality
dispatch_95 = Dispatch(List=flatten(pt_61), DispatchPattern=equals_25.Inequality)  # -> ListA, ListB
data_63 = Data(dispatch_95.ListA)

move2pt_20 = MoveToPoint(Geometry=data_60, PointA=data_60, PointB=data_63)  # -> Moved, Vector, Transform
null_27 = NullItem(Item=move2pt_20.Moved)  # -> NullFlags, InvalidFlags, Description
dispatch_96 = Dispatch(List=move2pt_20.Moved, DispatchPattern=null_27.InvalidFlags)  # -> ListA, ListB

move2pt_21 = MoveToPoint(Geometry=data_61, PointA=data_61, PointB=data_62)  # -> Moved, Vector, Transform
null_28 = NullItem(Item=move2pt_21.Moved)  # -> NullFlags, InvalidFlags, Description
dispatch_97 = Dispatch(List=move2pt_21.Moved, DispatchPattern=null_28.InvalidFlags)  # -> ListA, ListB
pln_84 = Plane(dispatch_97.ListB)

# ---- group: 2次筛选所得
pln_85 = Plane(dispatch_96.ListB)

# ----
# 撞到梁交点
merge_42 = Merge(Data1=pln_85, Data2=pln_84)

merge_43 = Merge(Data1=pln_76, Data2=merge_42)
orient_5 = Orient(Geometry=item_37, Source=rotate_9.Geometry, Target=merge_43)  # -> Geometry, Transform

data_64 = Data(orient_5.Geometry)
ungroup_7 = Ungroup(Group=data_64)
item_77 = ListItem(List=ungroup_7, Index=0, Wrap=True)  # -> flatten(Item)
item_78 = ListItem(List=ungroup_7, Index="-1", Wrap=True)  # -> flatten(Item)

entwine_15 = Entwine(Branch00=item_77, Branch01=item_78, FlattenInputs=True)
bake_5 = BakeObjects(Geometry=entwine_15, Attributes=attributes_4, BakeName="Embed::2-1-03钢板焊埋件", Bake=False)

number_slider_47 = Slider(3584, range=0..10000)
deplane_27 = DeconstructPlane(Plane=pln_37)  # -> Origin, XAxis, YAxis, ZAxis
amp_33 = Amplitude(Vector=deplane_27.YAxis, Amplitude=number_slider_47)
amp_34 = Amplitude(Vector=deplane_27.YAxis, Amplitude=expr("-x", number_slider_47))
boundary_5 = BoundarySurfaces(Edges=[offset_9, offset_8])
move_39 = Move(Geometry=deplane_27.Origin, Motion=amp_34)  # -> Geometry, Transform
move_40 = Move(Geometry=deplane_27.Origin, Motion=amp_33)  # -> Geometry, Transform
ln_39 = Line(StartPoint=move_39.Geometry, EndPoint=move_40.Geometry)

# ---- group: 50-350建筑结构交点
scx_2 = SurfaceCurve(Surface=boundary_5, Curve=crv_71)  # -> flatten(Curves), Points, UVPoints, Normals, Parameters, Tangents

# ---- group: 该区间的定位点
ccx_22 = CurveCurve(CurveA=graft(ln_39), CurveB=scx_2.Curves)  # -> Points, ParamsA, ParamsB

# ----
shift_20 = ShiftPaths(Data=ccx_22.Points, Offset=-1)
pull_46 = PullPoint(Point=graft(pln_37), Geometry=shift_20, ClosestOnly=True)  # -> ClosestPoint, Distance
sort_34 = SortList(Keys=pull_46.Distance, ValuesA=pull_46.ClosestPoint)  # -> Keys, ValuesA
null_29 = NullItem(Item=sort_34.ValuesA)  # -> NullFlags, simplify(InvalidFlags), Description
item_79 = ListItem(List=sort_34.ValuesA, Index=0, Wrap=True)
dispatch_98 = Dispatch(List=simplify(graft(pln_37)), DispatchPattern=null_29.InvalidFlags)  # -> ListA, ListB
dispatch_99 = Dispatch(List=simplify(graft(item_79)), DispatchPattern=null_29.InvalidFlags)  # -> ListA, ListB
pln_86 = Plane(dispatch_98.ListB)
pln_87 = Plane(dispatch_98.ListA)
pt_63 = Point(dispatch_99.ListB)

# ----
# 可能的结构交点-大量
pln_88 = Plane(pln_87)

# ----
# 0 檐口出定位点
# 与结构无交点
pln_89 = Plane(flatten(pln_88))

crv_92 = Curve(shift_2)

# ----
# 按照梁分类定位点
pt_64 = Point(pt_63)
pln_90 = Plane(pln_86)
incurves_20 = PointInCurves(Point=flatten(pt_64), Curves=crv_92)  # -> Relationship, Index, Point
equals_26 = Equality(FirstNumber=incurves_20.Relationship, SecondNumber="0")  # -> Equality, Inequality
dispatch_100 = Dispatch(List=flatten(pln_90), DispatchPattern=equals_26.Inequality)  # -> ListA, ListB
data_65 = Data(dispatch_100.ListA)

incurves_21 = PointInCurves(Point=flatten(pt_64), Curves=crv_92)  # -> Relationship, Index, Point
equals_27 = Equality(FirstNumber=incurves_21.Relationship, SecondNumber="0")  # -> Equality, Inequality
dispatch_101 = Dispatch(List=flatten(pt_64), DispatchPattern=equals_27.Inequality)  # -> ListA, ListB
data_66 = Data(dispatch_101.ListA)

move2pt_22 = MoveToPoint(Geometry=data_65, PointA=data_65, PointB=data_66)  # -> Moved, Vector, Transform
null_30 = NullItem(Item=move2pt_22.Moved)  # -> NullFlags, InvalidFlags, Description
dispatch_102 = Dispatch(List=move2pt_22.Moved, DispatchPattern=null_30.InvalidFlags)  # -> ListA, ListB
pln_91 = Plane(dispatch_102.ListB)

# ----
# 3.1
# 下层建筑边线外侧50-350mm
# 03：钢板焊埋件[钢梁内侧]
# @钢边梁宽@钢边梁高
pln_92 = Plane(pln_91)

crv_93 = Curve(shift_2)

# ----
# 按照梁分类定位点
pt_65 = Point(pt_33)
pln_93 = Plane(pln_39)
incurves_22 = PointInCurves(Point=flatten(pt_65), Curves=crv_93)  # -> Relationship, Index, Point
equals_28 = Equality(FirstNumber=incurves_22.Relationship, SecondNumber="0")  # -> Equality, Inequality
dispatch_103 = Dispatch(List=flatten(pln_93), DispatchPattern=equals_28.Inequality)  # -> ListA, ListB
data_67 = Data(dispatch_103.ListA)

incurves_23 = PointInCurves(Point=flatten(pt_65), Curves=crv_93)  # -> Relationship, Index, Point
equals_29 = Equality(FirstNumber=incurves_23.Relationship, SecondNumber="0")  # -> Equality, Inequality
dispatch_104 = Dispatch(List=flatten(pt_65), DispatchPattern=equals_29.Inequality)  # -> ListA, ListB
data_68 = Data(dispatch_104.ListA)

move2pt_23 = MoveToPoint(Geometry=data_67, PointA=data_67, PointB=data_68)  # -> Moved, Vector, Transform
null_31 = NullItem(Item=move2pt_23.Moved)  # -> NullFlags, InvalidFlags, Description
dispatch_105 = Dispatch(List=move2pt_23.Moved, DispatchPattern=null_31.InvalidFlags)  # -> ListA, ListB
pln_94 = Plane(dispatch_105.ListB)

# ----
# 3.2
# 下层建筑边线内侧300-600mm范围
# 03：钢板焊埋件[钢梁外侧]
# @钢边梁宽@钢边梁高
pln_95 = Plane(pln_94)

# ----
# 3.1 Missing Point
# 埋件定位点Offset，没有找到和梁的交点
number_slider_48 = Slider(5000, range=0..10000)
deplane_28 = DeconstructPlane(Plane=pln_89)  # -> Origin, XAxis, YAxis, ZAxis
amp_35 = Amplitude(Vector=deplane_28.YAxis, Amplitude=number_slider_48)
crv_94 = Curve(scx_2.Curves)
move_41 = Move(Geometry=deplane_28.Origin, Motion=amp_35)  # -> Geometry, Transform
ln_40 = Line(StartPoint=move_41.Geometry, EndPoint=deplane_28.Origin)
amp_36 = Amplitude(Vector=deplane_28.XAxis, Amplitude=expr("-x", number_slider_7))
amp_37 = Amplitude(Vector=deplane_28.XAxis, Amplitude=number_slider_7)
move_42 = Move(Geometry=ln_40, Motion=amp_37)  # -> Geometry, Transform
move_43 = Move(Geometry=ln_40, Motion=amp_36)  # -> Geometry, Transform
move_44 = Move(Geometry=pln_89, Motion=amp_36)  # -> Geometry, Transform
move_45 = Move(Geometry=pln_89, Motion=amp_37)  # -> Geometry, Transform
pln_96 = Plane(pln_87)

ccx_23 = CurveCurve(CurveA=graft(move_43.Geometry), CurveB=flatten(crv_94))  # -> Points, ParamsA, ParamsB
shift_21 = ShiftPaths(Data=ccx_23.Points, Offset=-1)
sort_35 = SortList(Keys=shift_21, ValuesA=shift_21)  # -> Keys, ValuesA
pull_47 = PullPoint(Point=sort_35.ValuesA, Geometry=graft(pln_89), ClosestOnly=True)  # -> ClosestPoint, Distance
sort_36 = SortList(Keys=pull_47.Distance, ValuesA=sort_35.ValuesA)  # -> Keys, ValuesA
item_80 = ListItem(List=sort_36.ValuesA, Index="-1", Wrap=True)
null_32 = NullItem(Item=flatten(item_80))  # -> NullFlags, InvalidFlags, Description
dispatch_106 = Dispatch(List=flatten(item_80), DispatchPattern=null_32.InvalidFlags)  # -> ListA, ListB
dispatch_107 = Dispatch(List=move_44.Geometry, DispatchPattern=null_32.InvalidFlags)  # -> ListA, ListB
pt_66 = Point(dispatch_106.ListB)
pln_97 = Plane(dispatch_107.ListB)

ccx_24 = CurveCurve(CurveA=graft(move_42.Geometry), CurveB=flatten(crv_94))  # -> Points, ParamsA, ParamsB
shift_22 = ShiftPaths(Data=ccx_24.Points, Offset=-1)
sort_37 = SortList(Keys=shift_22, ValuesA=shift_22)  # -> Keys, ValuesA
pull_48 = PullPoint(Point=sort_37.ValuesA, Geometry=graft(pln_89), ClosestOnly=True)  # -> ClosestPoint, Distance
sort_38 = SortList(Keys=pull_48.Distance, ValuesA=sort_37.ValuesA)  # -> Keys, ValuesA
item_81 = ListItem(List=sort_38.ValuesA, Index="-1", Wrap=True)
null_33 = NullItem(Item=flatten(item_81))  # -> NullFlags, InvalidFlags, Description
dispatch_108 = Dispatch(List=flatten(item_81), DispatchPattern=null_33.InvalidFlags)  # -> ListA, ListB
dispatch_109 = Dispatch(List=move_45.Geometry, DispatchPattern=null_33.InvalidFlags)  # -> ListA, ListB
pln_98 = Plane(dispatch_109.ListB)
pt_67 = Point(dispatch_108.ListB)

merge_44 = Merge(Data1=pln_98, Data2=pln_97)  # -> flatten(Result)
check_same_points_9 = CheckSamePoints(archPoint=flatten(pln_96), crvPoint=merge_44)  # -> out, specialPt; inputs archPoint: list of Point3d, crvPoint: list of Point3d; same code as testpoint

# ----
# pass
cull_i_14 = CullIndex(List=flatten(pln_96), Indices=check_same_points_9.specialPt, Wrap=True)

# ----
# 按照梁分类定位点
pln_99 = Plane(pln_98)
pt_68 = Point(pt_67)
incurves_24 = PointInCurves(Point=flatten(pt_68), Curves=crv_72)  # -> Relationship, Index, Point
equals_30 = Equality(FirstNumber=incurves_24.Relationship, SecondNumber="0")  # -> Equality, Inequality
dispatch_110 = Dispatch(List=flatten(pln_99), DispatchPattern=equals_30.Inequality)  # -> ListA, ListB
data_69 = Data(dispatch_110.ListA)

# ----
# 按照梁分类定位点
pln_100 = Plane(pln_97)
pt_69 = Point(pt_66)
incurves_25 = PointInCurves(Point=flatten(pt_69), Curves=crv_72)  # -> Relationship, Index, Point
equals_31 = Equality(FirstNumber=incurves_25.Relationship, SecondNumber="0")  # -> Equality, Inequality
dispatch_111 = Dispatch(List=flatten(pln_100), DispatchPattern=equals_31.Inequality)  # -> ListA, ListB
data_70 = Data(dispatch_111.ListA)

incurves_26 = PointInCurves(Point=flatten(pt_69), Curves=crv_72)  # -> Relationship, Index, Point
equals_32 = Equality(FirstNumber=incurves_26.Relationship, SecondNumber="0")  # -> Equality, Inequality
dispatch_112 = Dispatch(List=flatten(pt_69), DispatchPattern=equals_32.Inequality)  # -> ListA, ListB
data_71 = Data(dispatch_112.ListA)

incurves_27 = PointInCurves(Point=flatten(pt_68), Curves=crv_72)  # -> Relationship, Index, Point
equals_33 = Equality(FirstNumber=incurves_27.Relationship, SecondNumber="0")  # -> Equality, Inequality
dispatch_113 = Dispatch(List=flatten(pt_68), DispatchPattern=equals_33.Inequality)  # -> ListA, ListB
data_72 = Data(dispatch_113.ListA)

move2pt_24 = MoveToPoint(Geometry=data_69, PointA=data_69, PointB=data_72)  # -> Moved, Vector, Transform
null_34 = NullItem(Item=move2pt_24.Moved)  # -> NullFlags, InvalidFlags, Description
dispatch_114 = Dispatch(List=move2pt_24.Moved, DispatchPattern=null_34.InvalidFlags)  # -> ListA, ListB
pln_101 = Plane(dispatch_114.ListB)

move2pt_25 = MoveToPoint(Geometry=data_70, PointA=data_70, PointB=data_71)  # -> Moved, Vector, Transform
null_35 = NullItem(Item=move2pt_25.Moved)  # -> NullFlags, InvalidFlags, Description
dispatch_115 = Dispatch(List=move2pt_25.Moved, DispatchPattern=null_35.InvalidFlags)  # -> ListA, ListB
pln_102 = Plane(dispatch_115.ListB)

# ----
# 撞到梁交点
merge_45 = Merge(Data1=pln_101, Data2=pln_102)

merge_46 = Merge(Data1=pln_92, Data2=merge_45)
orient_6 = Orient(Geometry=item_39, Source=rotate_10.Geometry, Target=merge_46)  # -> Geometry, Transform

data_73 = Data(orient_6.Geometry)
ungroup_8 = Ungroup(Group=data_73)
item_82 = ListItem(List=ungroup_8, Index=0, Wrap=True)  # -> flatten(Item)
item_83 = ListItem(List=ungroup_8, Index="-1", Wrap=True)  # -> flatten(Item)

entwine_16 = Entwine(Branch00=item_82, Branch01=item_83, FlattenInputs=True)
bake_6 = BakeObjects(Geometry=entwine_16, Attributes=attributes_6, BakeName="Embed::3-1-03钢板焊埋件", Bake=False)

# ----
# 3.2  Missing Point
# 埋件定位点Offset，没有找到和梁的交点
number_slider_49 = Slider(5000, range=0..10000)
crv_95 = Curve(scx.Curves)
deplane_29 = DeconstructPlane(Plane=pln_42)  # -> Origin, XAxis, YAxis, ZAxis
amp_38 = Amplitude(Vector=deplane_29.YAxis, Amplitude=number_slider_49)
move_46 = Move(Geometry=deplane_29.Origin, Motion=amp_38)  # -> Geometry, Transform
ln_41 = Line(StartPoint=move_46.Geometry, EndPoint=deplane_29.Origin)
amp_39 = Amplitude(Vector=deplane_29.XAxis, Amplitude=number_slider_7)
amp_40 = Amplitude(Vector=deplane_29.XAxis, Amplitude=expr("-x", number_slider_7))
move_47 = Move(Geometry=ln_41, Motion=amp_39)  # -> Geometry, Transform
move_48 = Move(Geometry=ln_41, Motion=amp_40)  # -> Geometry, Transform
pln_103 = Plane(pln_40)

ccx_25 = CurveCurve(CurveA=graft(move_48.Geometry), CurveB=flatten(crv_95))  # -> Points, ParamsA, ParamsB
shift_23 = ShiftPaths(Data=ccx_25.Points, Offset=-1)
sort_39 = SortList(Keys=shift_23, ValuesA=shift_23)  # -> Keys, ValuesA
pull_49 = PullPoint(Point=sort_39.ValuesA, Geometry=graft(pln_42), ClosestOnly=True)  # -> ClosestPoint, Distance
sort_40 = SortList(Keys=pull_49.Distance, ValuesA=sort_39.ValuesA)  # -> Keys, ValuesA
item_84 = ListItem(List=sort_40.ValuesA, Index="-1", Wrap=True)
null_36 = NullItem(Item=flatten(item_84))  # -> NullFlags, InvalidFlags, Description
dispatch_116 = Dispatch(List=flatten(item_84), DispatchPattern=null_36.InvalidFlags)  # -> ListA, ListB
dispatch_117 = Dispatch(List=pln_42, DispatchPattern=null_36.InvalidFlags)  # -> ListA, ListB
pln_104 = Plane(dispatch_117.ListB)
pt_70 = Point(dispatch_116.ListB)
move2pt_26 = MoveToPoint(Geometry=pln_104, PointA=pln_104, PointB=pt_70)  # -> Moved, Vector, Transform

ccx_26 = CurveCurve(CurveA=graft(move_47.Geometry), CurveB=flatten(crv_95))  # -> Points, ParamsA, ParamsB
shift_24 = ShiftPaths(Data=ccx_26.Points, Offset=-1)
sort_41 = SortList(Keys=shift_24, ValuesA=shift_24)  # -> Keys, ValuesA
pull_50 = PullPoint(Point=sort_41.ValuesA, Geometry=graft(pln_42), ClosestOnly=True)  # -> ClosestPoint, Distance
sort_42 = SortList(Keys=pull_50.Distance, ValuesA=sort_41.ValuesA)  # -> Keys, ValuesA
item_85 = ListItem(List=sort_42.ValuesA, Index="-1", Wrap=True)
null_37 = NullItem(Item=flatten(item_85))  # -> NullFlags, InvalidFlags, Description
dispatch_118 = Dispatch(List=flatten(item_85), DispatchPattern=null_37.InvalidFlags)  # -> ListA, ListB
dispatch_119 = Dispatch(List=pln_42, DispatchPattern=null_37.InvalidFlags)  # -> ListA, ListB
pln_105 = Plane(dispatch_119.ListB)
pt_71 = Point(dispatch_118.ListB)
move2pt_27 = MoveToPoint(Geometry=pln_105, PointA=pln_105, PointB=pt_71)  # -> Moved, Vector, Transform

merge_47 = Merge(Data1=pln_105, Data2=pln_104)  # -> flatten(Result)
check_same_points_10 = CheckSamePoints(archPoint=flatten(pln_103), crvPoint=merge_47)  # -> out, specialPt; inputs archPoint: list of Point3d, crvPoint: list of Point3d; same code as testpoint

# ----
# pass
cull_i_15 = CullIndex(List=flatten(pln_103), Indices=check_same_points_10.specialPt, Wrap=True)

# ----
# 按照梁分类定位点
pln_106 = Plane(move2pt_27.Moved)
pt_72 = Point(pt_71)
incurves_28 = PointInCurves(Point=flatten(pt_72), Curves=crv_73)  # -> Relationship, Index, Point
equals_34 = Equality(FirstNumber=incurves_28.Relationship, SecondNumber="0")  # -> Equality, Inequality
dispatch_120 = Dispatch(List=flatten(pln_106), DispatchPattern=equals_34.Inequality)  # -> ListA, ListB
data_74 = Data(dispatch_120.ListA)

# ----
# 按照梁分类定位点
pln_107 = Plane(move2pt_26.Moved)
pt_73 = Point(pt_70)
incurves_29 = PointInCurves(Point=flatten(pt_73), Curves=crv_73)  # -> Relationship, Index, Point
equals_35 = Equality(FirstNumber=incurves_29.Relationship, SecondNumber="0")  # -> Equality, Inequality
dispatch_121 = Dispatch(List=flatten(pln_107), DispatchPattern=equals_35.Inequality)  # -> ListA, ListB
data_75 = Data(dispatch_121.ListA)

incurves_30 = PointInCurves(Point=flatten(pt_73), Curves=crv_73)  # -> Relationship, Index, Point
equals_36 = Equality(FirstNumber=incurves_30.Relationship, SecondNumber="0")  # -> Equality, Inequality
dispatch_122 = Dispatch(List=flatten(pt_73), DispatchPattern=equals_36.Inequality)  # -> ListA, ListB
data_76 = Data(dispatch_122.ListA)

incurves_31 = PointInCurves(Point=flatten(pt_72), Curves=crv_73)  # -> Relationship, Index, Point
equals_37 = Equality(FirstNumber=incurves_31.Relationship, SecondNumber="0")  # -> Equality, Inequality
dispatch_123 = Dispatch(List=flatten(pt_72), DispatchPattern=equals_37.Inequality)  # -> ListA, ListB
data_77 = Data(dispatch_123.ListA)

move2pt_28 = MoveToPoint(Geometry=data_74, PointA=data_74, PointB=data_77)  # -> Moved, Vector, Transform
null_38 = NullItem(Item=move2pt_28.Moved)  # -> NullFlags, InvalidFlags, Description
dispatch_124 = Dispatch(List=move2pt_28.Moved, DispatchPattern=null_38.InvalidFlags)  # -> ListA, ListB
pln_108 = Plane(dispatch_124.ListB)

move2pt_29 = MoveToPoint(Geometry=data_75, PointA=data_75, PointB=data_76)  # -> Moved, Vector, Transform
null_39 = NullItem(Item=move2pt_29.Moved)  # -> NullFlags, InvalidFlags, Description
dispatch_125 = Dispatch(List=move2pt_29.Moved, DispatchPattern=null_39.InvalidFlags)  # -> ListA, ListB
pln_109 = Plane(dispatch_125.ListB)

# ----
# 撞到梁交点
merge_48 = Merge(Data1=pln_108, Data2=pln_109)

pln_110 = Plane(cull_i_14)
# 阳角
# 阴角
pln_111 = Plane(cull_i_15)

# ----
# 3.1下层建筑内侧到300到外侧50内是否有钢结构
deplane_30 = DeconstructPlane(Plane=pln_110)  # -> Origin, XAxis, YAxis, ZAxis
# 阳角
# 阴角
deplane_31 = DeconstructPlane(Plane=pln_111)  # -> Origin, XAxis, YAxis, ZAxis
check_same_points_11 = CheckSamePoints(archPoint=deplane_31.Origin, crvPoint=deplane_30.Origin)  # -> out, specialPt; inputs archPoint: list of Point3d, crvPoint: list of Point3d; same code as testpoint

merge_49 = Merge(Data1=pln_95, Data2=merge_48)
orient_7 = Orient(Geometry=item_41, Source=item_42, Target=merge_49)  # -> Geometry, Transform

data_78 = Data(orient_7.Geometry)
ungroup_9 = Ungroup(Group=data_78)
item_86 = ListItem(List=ungroup_9, Index=0, Wrap=True)  # -> flatten(Item)
item_87 = ListItem(List=ungroup_9, Index="-1", Wrap=True)  # -> flatten(Item)

entwine_17 = Entwine(Branch00=item_86, Branch01=item_87, FlattenInputs=True)
bake_7 = BakeObjects(Geometry=entwine_17, Attributes=attributes_7, BakeName="Embed::3-2-03钢板焊埋件", Bake=False)

# ----
# 同时满足N
item_88 = ListItem(List=pln_111, Index=check_same_points_11.specialPt, Wrap=True)

pln_112 = Plane(item_88)
flatten_7 = FlattenTree(Tree=crv_74, Path="{0}")
number_slider_50 = Slider(3584, range=0..10000)
deplane_32 = DeconstructPlane(Plane=pln_112)  # -> Origin, XAxis, YAxis, ZAxis
boundary_6 = BoundarySurfaces(Edges=[offset_11, offset_10])
amp_41 = Amplitude(Vector=deplane_32.YAxis, Amplitude=number_slider_50)
amp_42 = Amplitude(Vector=deplane_32.YAxis, Amplitude=expr("-x", number_slider_50))
scx_3 = SurfaceCurve(Surface=boundary_6, Curve=flatten_7)  # -> flatten(Curves), Points, UVPoints, Normals, Parameters, Tangents
move_49 = Move(Geometry=deplane_32.Origin, Motion=amp_42)  # -> Geometry, Transform
move_50 = Move(Geometry=deplane_32.Origin, Motion=amp_41)  # -> Geometry, Transform
ln_42 = Line(StartPoint=move_49.Geometry, EndPoint=move_50.Geometry)
ccx_27 = CurveCurve(CurveA=graft(ln_42), CurveB=scx_3.Curves)  # -> Points, ParamsA, ParamsB
shift_25 = ShiftPaths(Data=ccx_27.Points, Offset=-1)
pull_51 = PullPoint(Point=graft(pln_112), Geometry=shift_25, ClosestOnly=True)  # -> ClosestPoint, Distance
sort_43 = SortList(Keys=pull_51.Distance, ValuesA=pull_51.ClosestPoint)  # -> Keys, ValuesA
item_89 = ListItem(List=sort_43.ValuesA, Index=0, Wrap=True)
null_40 = NullItem(Item=sort_43.ValuesA)  # -> NullFlags, simplify(InvalidFlags), Description
dispatch_126 = Dispatch(List=simplify(graft(pln_112)), DispatchPattern=null_40.InvalidFlags)  # -> ListA, ListB
pln_113 = Plane(dispatch_126.ListA)
pln_114 = Plane(dispatch_126.ListB)

move2pt_30 = MoveToPoint(Geometry=pln_114, PointA=pln_114, PointB=simplify(shift_25))  # -> Moved, Vector, Transform

# ----
# 可能的结构交点-大量
pln_115 = Plane(pln_113)

# ----
# 0 檐口出定位点
# 与结构无交点
pln_116 = Plane(flatten(pln_115))

# ----
# 4 Missing Point
# 埋件定位点Offset，没有找到和梁的交点
number_slider_51 = Slider(5000, range=0..10000)
deplane_33 = DeconstructPlane(Plane=pln_116)  # -> Origin, XAxis, YAxis, ZAxis
amp_43 = Amplitude(Vector=deplane_33.YAxis, Amplitude=number_slider_51)
move_51 = Move(Geometry=deplane_33.Origin, Motion=amp_43)  # -> Geometry, Transform
ln_43 = Line(StartPoint=move_51.Geometry, EndPoint=deplane_33.Origin)
amp_44 = Amplitude(Vector=deplane_33.XAxis, Amplitude=number_slider_7)
amp_45 = Amplitude(Vector=deplane_33.XAxis, Amplitude=expr("-x", number_slider_7))
move_52 = Move(Geometry=ln_43, Motion=amp_44)  # -> Geometry, Transform
move_53 = Move(Geometry=ln_43, Motion=amp_45)  # -> Geometry, Transform

# ---- group: 梁中线
crv_96 = Curve(scx_3.Curves)

# ----
ccx_28 = CurveCurve(CurveA=graft(move_53.Geometry), CurveB=flatten(crv_96))  # -> Points, ParamsA, ParamsB
shift_26 = ShiftPaths(Data=ccx_28.Points, Offset=-1)
sort_44 = SortList(Keys=shift_26, ValuesA=shift_26)  # -> Keys, ValuesA
pull_52 = PullPoint(Point=sort_44.ValuesA, Geometry=graft(pln_116), ClosestOnly=True)  # -> ClosestPoint, Distance
sort_45 = SortList(Keys=pull_52.Distance, ValuesA=sort_44.ValuesA)  # -> Keys, ValuesA
item_90 = ListItem(List=sort_45.ValuesA, Index="-1", Wrap=True)
null_41 = NullItem(Item=flatten(item_90))  # -> NullFlags, InvalidFlags, Description
dispatch_127 = Dispatch(List=flatten(item_90), DispatchPattern=null_41.InvalidFlags)  # -> ListA, ListB
dispatch_128 = Dispatch(List=pln_116, DispatchPattern=null_41.InvalidFlags)  # -> ListA, ListB
pt_74 = Point(dispatch_127.ListB)
pln_117 = Plane(dispatch_128.ListB)
move2pt_31 = MoveToPoint(Geometry=pln_117, PointA=pln_117, PointB=pt_74)  # -> Moved, Vector, Transform

ccx_29 = CurveCurve(CurveA=graft(move_52.Geometry), CurveB=flatten(crv_96))  # -> Points, ParamsA, ParamsB
shift_27 = ShiftPaths(Data=ccx_29.Points, Offset=-1)
sort_46 = SortList(Keys=shift_27, ValuesA=shift_27)  # -> Keys, ValuesA
pull_53 = PullPoint(Point=sort_46.ValuesA, Geometry=graft(pln_116), ClosestOnly=True)  # -> ClosestPoint, Distance
sort_47 = SortList(Keys=pull_53.Distance, ValuesA=sort_46.ValuesA)  # -> Keys, ValuesA
item_91 = ListItem(List=sort_47.ValuesA, Index="-1", Wrap=True)
null_42 = NullItem(Item=flatten(item_91))  # -> NullFlags, InvalidFlags, Description
dispatch_129 = Dispatch(List=pln_116, DispatchPattern=null_42.InvalidFlags)  # -> ListA, ListB
dispatch_130 = Dispatch(List=flatten(item_91), DispatchPattern=null_42.InvalidFlags)  # -> ListA, ListB
pln_118 = Plane(dispatch_129.ListB)
pt_75 = Point(dispatch_130.ListB)
move2pt_32 = MoveToPoint(Geometry=pln_118, PointA=pln_118, PointB=pt_75)  # -> Moved, Vector, Transform

merge_50 = Merge(Data1=flatten(pln_118), Data2=flatten(pln_117))
check_same_points_12 = CheckSamePoints(archPoint=pln_115, crvPoint=flatten(merge_50))  # -> out, specialPt; inputs archPoint: list of Point3d, crvPoint: list of Point3d; same code as testpoint
cull_i_16 = CullIndex(List=pln_115, Indices=check_same_points_12.specialPt, Wrap=True)

# ----
# 撞到梁交点
merge_51 = Merge(Data1=move2pt_32.Moved, Data2=move2pt_31.Moved)

# ----
# 4.1下层建筑内侧300到外侧50内
# 03底埋，钢板焊
pln_119 = Plane(move2pt_30.Moved)

merge_52 = Merge(Data1=flatten(pln_119), Data2=flatten(merge_51))
orient_8 = Orient(Geometry=item_13, Source=item_12, Target=merge_52)  # -> Geometry, Transform

data_79 = Data(orient_8.Geometry)
ungroup_10 = Ungroup(Group=data_79)
item_92 = ListItem(List=ungroup_10, Index=0, Wrap=True)  # -> flatten(Item)
item_93 = ListItem(List=ungroup_10, Index="-1", Wrap=True)  # -> flatten(Item)

entwine_18 = Entwine(Branch00=item_92, Branch01=item_93, FlattenInputs=True)
bake_8 = BakeObjects(Geometry=entwine_18, Attributes=attributes_8, BakeName="Embed::4-1钢板焊底埋", Bake=False)

# ----
# 4.0下层建筑内侧到300到外侧50内
# 无钢结构
# 要求主体结构提供钢结构梁，默认位置为建筑边线向内300mm
number_slider_52 = Slider(300, range=0..1000)
crv_97 = Curve(crv_41)
pln_120 = Plane(cull_i_16)
offset_14 = OffsetCurve(Curve=crv_97, Distance=expr("-x", number_slider_52), Corners=1)
pull_54 = PullPoint(Point=pln_120, Geometry=offset_14, ClosestOnly=True)  # -> ClosestPoint, Distance
sort_48 = SortList(Keys=pull_54.Distance)  # -> Keys, ValuesA
larger_14 = LargerThan(FirstNumber=pull_54.Distance, SecondNumber=Slider(400, range=0..1000))  # -> LargerThan, OrEqualTo
panel_55 = Panel(sort_48.Keys)
number_slider_53 = Slider(3584, range=0..10000)

# ---- group: 删除反常线
dispatch_131 = Dispatch(List=pln_120, DispatchPattern=larger_14.LargerThan)  # -> ListA, ListB

# ----
pln_121 = Plane(flatten(dispatch_131.ListB))
deplane_34 = DeconstructPlane(Plane=pln_121)  # -> Origin, XAxis, YAxis, ZAxis
amp_46 = Amplitude(Vector=deplane_34.YAxis, Amplitude=number_slider_53)
amp_47 = Amplitude(Vector=deplane_34.YAxis, Amplitude=expr("-x", number_slider_53))
move_54 = Move(Geometry=deplane_34.Origin, Motion=amp_47)  # -> Geometry, Transform
move_55 = Move(Geometry=deplane_34.Origin, Motion=amp_46)  # -> Geometry, Transform
ln_44 = Line(StartPoint=move_54.Geometry, EndPoint=move_55.Geometry)
ccx_30 = CurveCurve(CurveA=ln_44, CurveB=offset_14)  # -> Points, ParamsA, ParamsB
flatten_8 = FlattenTree(Tree=ccx_30.Points, Path="{0}")
null_43 = NullItem(Item=simplify(ccx_30.Points))  # -> NullFlags, InvalidFlags, Description
dispatch_132 = Dispatch(List=simplify(graft(pln_121)), DispatchPattern=null_43.NullFlags)  # -> ListA, ListB

# ---- group: 有效点
pull_55 = PullPoint(Point=deplane_34.Origin, Geometry=flatten_8, ClosestOnly=True)  # -> ClosestPoint, Distance

# ----
# 离结构太远
pln_122 = Plane(dispatch_131.ListA)

# ----
# 可能的双点
pln_123 = Plane(dispatch_132.ListA)

merge_53 = Merge(Data1=pln_122, Data2=pln_123)

# ----
# 0 檐口出定位点
# 与结构无交点
pln_124 = Plane(flatten(merge_53))

# ----
# 4.0  Missing Point
# 埋件定位点Offset，没有找到和梁的交点
number_slider_54 = Slider(5000, range=0..10000)
deplane_35 = DeconstructPlane(Plane=pln_124)  # -> Origin, XAxis, YAxis, ZAxis
crv_98 = Curve(scx_3.Curves)
amp_48 = Amplitude(Vector=deplane_35.YAxis, Amplitude=number_slider_54)
move_56 = Move(Geometry=deplane_35.Origin, Motion=amp_48)  # -> Geometry, Transform
ln_45 = Line(StartPoint=move_56.Geometry, EndPoint=deplane_35.Origin)
amp_49 = Amplitude(Vector=deplane_35.XAxis, Amplitude=number_slider_7)
amp_50 = Amplitude(Vector=deplane_35.XAxis, Amplitude=expr("-x", number_slider_7))
move_57 = Move(Geometry=ln_45, Motion=amp_49)  # -> Geometry, Transform
move_58 = Move(Geometry=ln_45, Motion=amp_50)  # -> Geometry, Transform

ccx_31 = CurveCurve(CurveA=graft(move_58.Geometry), CurveB=flatten(crv_98))  # -> Points, ParamsA, ParamsB
shift_28 = ShiftPaths(Data=ccx_31.Points, Offset=-1)
sort_49 = SortList(Keys=shift_28, ValuesA=shift_28)  # -> Keys, ValuesA
pull_56 = PullPoint(Point=sort_49.ValuesA, Geometry=graft(pln_124), ClosestOnly=True)  # -> ClosestPoint, Distance
sort_50 = SortList(Keys=pull_56.Distance, ValuesA=sort_49.ValuesA)  # -> Keys, ValuesA
item_94 = ListItem(List=sort_50.ValuesA, Index="-1", Wrap=True)
null_44 = NullItem(Item=flatten(item_94))  # -> NullFlags, InvalidFlags, Description
dispatch_133 = Dispatch(List=simplify(item_94), DispatchPattern=simplify(graft(null_44.InvalidFlags)))  # -> ListA, ListB
dispatch_134 = Dispatch(List=pln_124, DispatchPattern=null_44.InvalidFlags)  # -> ListA, ListB
pln_125 = Plane(dispatch_134.ListB)
pt_76 = Point(dispatch_133.ListB)

ccx_32 = CurveCurve(CurveA=graft(move_57.Geometry), CurveB=flatten(crv_98))  # -> Points, ParamsA, ParamsB
shift_29 = ShiftPaths(Data=ccx_32.Points, Offset=-1)
sort_51 = SortList(Keys=shift_29, ValuesA=shift_29)  # -> Keys, ValuesA
pull_57 = PullPoint(Point=sort_51.ValuesA, Geometry=graft(pln_124), ClosestOnly=True)  # -> ClosestPoint, Distance
sort_52 = SortList(Keys=pull_57.Distance, ValuesA=sort_51.ValuesA)  # -> Keys, ValuesA
item_95 = ListItem(List=sort_52.ValuesA, Index="-1", Wrap=True)
null_45 = NullItem(Item=flatten(item_95))  # -> NullFlags, InvalidFlags, Description
dispatch_135 = Dispatch(List=simplify(item_95), DispatchPattern=simplify(graft(null_45.InvalidFlags)))  # -> ListA, ListB
dispatch_136 = Dispatch(List=pln_124, DispatchPattern=null_45.InvalidFlags)  # -> ListA, ListB
pln_126 = Plane(dispatch_136.ListB)
pt_77 = Point(dispatch_135.ListB)

# ----
# 撞到结构
move2pt_33 = MoveToPoint(Geometry=flatten(pln_125), PointA=flatten(pln_125), PointB=flatten(pt_76))  # -> Moved, Vector, Transform
move2pt_34 = MoveToPoint(Geometry=flatten(pln_126), PointA=flatten(pln_126), PointB=flatten(pt_77))  # -> Moved, Vector, Transform

# ----
# 撞到梁交点
merge_54 = Merge(Data1=move2pt_34.Moved, Data2=move2pt_33.Moved)

# ----
# 4.0 默认位置为建筑边线向内300mm
# 侧埋，钢板焊
# 03：钢板焊埋件[钢梁外侧]@钢边梁宽@钢边梁高
move2pt_35 = MoveToPoint(Geometry=pln_121, PointA=deplane_34.Origin, PointB=pull_55.ClosestPoint)  # -> Moved, Vector, Transform

merge_55 = Merge(Data1=move2pt_35.Moved, Data2=merge_54)

# ---- group: All Location Point
merge_56 = Merge(Data1=merge_43, Data2=merge_46, Data3=merge_49, Data4=merge_52, Data5=merge_55)

# ----
orient_9 = Orient(Geometry=item_6, Source=item_7, Target=merge_55)  # -> Geometry, Transform

data_80 = Data(orient_9.Geometry)
ungroup_11 = Ungroup(Group=data_80)
item_96 = ListItem(List=ungroup_11, Index=0, Wrap=True)  # -> flatten(Item)
item_97 = ListItem(List=ungroup_11, Index="-1", Wrap=True)  # -> flatten(Item)

entwine_19 = Entwine(Branch00=item_96, Branch01=item_97, FlattenInputs=True)
bake_9 = BakeObjects(Geometry=entwine_19, Attributes=attributes_10, BakeName="Embed::4-0-03默认钢板焊", Bake=False)

null_46 = NullItem(Item=merge_56)  # -> NullFlags, InvalidFlags, Description
dispatch_137 = Dispatch(List=merge_56, DispatchPattern=null_46.InvalidFlags)  # -> ListA, ListB

# ---- group: 下层图纸-标注定位点
pt_78 = Point(dispatch_137.ListB)

# ----
cluster_4 = Cluster_2(
    outline_curve=标准范围_符合单一轴网方向,
    dim_offset_1=number_slider_16,
    dim_offset_2=number_slider_14,
    axis_direction_crv1=crv_11,
    axis_direction_crv2=crv_12,
    f2_arch_outline=crv_50,
    location_point=pt_78,
    dim_style=panel_21,
    directed_outline=seam,
    移除重复位置点_容差=number_slider_15)  # -> D_3, D_4, D, D_2
dimension1 = Data(cluster_4.D_3)

# ---- group: Dimension4
data_81 = Data(cluster_4.D_2)

# ---- group: Dimension2
data_82 = Data(cluster_4.D_4)

# ---- group: Dimension3
data_83 = Data(cluster_4.D)

# ----
entwine_20 = Entwine(Branch00=dimension1, Branch01=data_82, Branch02=data_83, Branch03=data_81, FlattenInputs=True)

# ---- group: Refrash Data
# 将所有Input都输入完后要Refresh data
dam = DataDam(DataA=entwine_20, BufferDelay=10000000, BufferMode=0)

# ----
dedim = DeconstructDimension(DimensionObject=dam)  # -> Value, Text, Plane, Points, Style
shift_30 = ShiftPaths(Data=dedim.Text, Offset=-1)
smaller_11 = SmallerThan(FirstNumber=shift_30, SecondNumber=Slider(1, range=0..10))  # -> SmallerThan, OrEqualTo
dispatch_138 = Dispatch(List=dam, DispatchPattern=smaller_11.SmallerThan)  # -> ListA, ListB

# ---- group: Bake Me
bake_10 = BakeObjects(Geometry=dispatch_138.ListB, Attributes=attributes_11, Bake=False)

# ----
data_84 = Data(dispatch_138.ListB)

# ----
# 5  Missing Point
# 埋件定位点Offset，没有找到和梁的交点
number_slider_55 = Slider(5000, range=0..10000)
deplane_36 = DeconstructPlane(Plane=pln_65)  # -> Origin, XAxis, YAxis, ZAxis
crv_99 = Curve(crv_45)
amp_51 = Amplitude(Vector=deplane_36.YAxis, Amplitude=number_slider_55)
move_59 = Move(Geometry=deplane_36.Origin, Motion=amp_51)  # -> Geometry, Transform
ln_46 = Line(StartPoint=move_59.Geometry, EndPoint=deplane_36.Origin)
amp_52 = Amplitude(Vector=deplane_36.XAxis, Amplitude=number_slider_7)
amp_53 = Amplitude(Vector=deplane_36.XAxis, Amplitude=expr("-x", number_slider_7))
move_60 = Move(Geometry=ln_46, Motion=amp_52)  # -> Geometry, Transform
move_61 = Move(Geometry=ln_46, Motion=amp_53)  # -> Geometry, Transform
pln_127 = Plane(pln_65)

ccx_33 = CurveCurve(CurveA=graft(move_61.Geometry), CurveB=flatten(crv_99))  # -> Points, ParamsA, ParamsB
shift_31 = ShiftPaths(Data=ccx_33.Points, Offset=-1)
sort_53 = SortList(Keys=shift_31, ValuesA=shift_31)  # -> Keys, ValuesA
pull_58 = PullPoint(Point=sort_53.ValuesA, Geometry=graft(pln_65), ClosestOnly=True)  # -> ClosestPoint, Distance
sort_54 = SortList(Keys=pull_58.Distance, ValuesA=sort_53.ValuesA)  # -> Keys, ValuesA
item_98 = ListItem(List=sort_54.ValuesA, Index="-1", Wrap=True)
null_47 = NullItem(Item=flatten(item_98))  # -> NullFlags, InvalidFlags, Description
dispatch_139 = Dispatch(List=simplify(item_98), DispatchPattern=simplify(graft(null_47.InvalidFlags)))  # -> ListA, ListB
dispatch_140 = Dispatch(List=pln_65, DispatchPattern=null_47.InvalidFlags)  # -> ListA, ListB
pln_128 = Plane(dispatch_140.ListB)
pt_79 = Point(dispatch_139.ListB)

ccx_34 = CurveCurve(CurveA=graft(move_60.Geometry), CurveB=flatten(crv_99))  # -> Points, ParamsA, ParamsB
shift_32 = ShiftPaths(Data=ccx_34.Points, Offset=-1)
sort_55 = SortList(Keys=shift_32, ValuesA=shift_32)  # -> Keys, ValuesA
pull_59 = PullPoint(Point=sort_55.ValuesA, Geometry=graft(pln_65), ClosestOnly=True)  # -> ClosestPoint, Distance
sort_56 = SortList(Keys=pull_59.Distance, ValuesA=sort_55.ValuesA)  # -> Keys, ValuesA
item_99 = ListItem(List=sort_56.ValuesA, Index="-1", Wrap=True)
null_48 = NullItem(Item=flatten(item_99))  # -> NullFlags, InvalidFlags, Description
dispatch_141 = Dispatch(List=simplify(item_99), DispatchPattern=simplify(graft(null_48.InvalidFlags)))  # -> ListA, ListB
dispatch_142 = Dispatch(List=pln_65, DispatchPattern=null_48.InvalidFlags)  # -> ListA, ListB
pln_129 = Plane(dispatch_142.ListB)
pt_80 = Point(dispatch_141.ListB)

merge_57 = Merge(Data1=pln_129, Data2=pln_128)  # -> flatten(Result)
check_same_points_13 = CheckSamePoints(archPoint=flatten(pln_127), crvPoint=merge_57)  # -> out, specialPt; inputs archPoint: list of Point3d, crvPoint: list of Point3d; same code as testpoint

# ----
# 撞到结构
move2pt_36 = MoveToPoint(Geometry=flatten(pln_129), PointA=flatten(pln_129), PointB=flatten(pt_80))  # -> Moved, Vector, Transform
move2pt_37 = MoveToPoint(Geometry=flatten(pln_128), PointA=flatten(pln_128), PointB=flatten(pt_79))  # -> Moved, Vector, Transform

# ----
# pass
cull_i_17 = CullIndex(List=flatten(pln_127), Indices=check_same_points_13.specialPt, Wrap=True)  # -> simplify(graft(List))

# ----
# 撞到梁交点
merge_58 = Merge(Data1=flatten(move2pt_36.Moved), Data2=flatten(move2pt_37.Moved))

merge_59 = Merge(Data1=flatten(move2pt_15.Moved), Data2=flatten(merge_58))

# ---- group: All Location Point
merge_60 = Merge(Data1=merge_38, Data2=merge_40, Data3=merge_59)

# ----
deplane_37 = DeconstructPlane(Plane=merge_59)  # -> Origin, XAxis, YAxis, ZAxis
amp_54 = Amplitude(Vector=deplane_37.YAxis, Amplitude=expr("-x", len_5))
move_62 = Move(Geometry=merge_59, Motion=amp_54)  # -> Geometry, Transform
orient_10 = Orient(Geometry=item_43, Source=item_44, Target=move_62.Geometry)  # -> Geometry, Transform

data_85 = Data(orient_10.Geometry)
ungroup_12 = Ungroup(Group=data_85)
item_100 = ListItem(List=ungroup_12, Index=0, Wrap=True)  # -> flatten(Item)
item_101 = ListItem(List=ungroup_12, Index="-1", Wrap=True)  # -> flatten(Item)

entwine_21 = Entwine(Branch00=item_100, Branch01=item_101, FlattenInputs=True)
bake_11 = BakeObjects(Geometry=entwine_21, Attributes=attributes_9, BakeName="Embed::5-04板埋", Bake=False)

null_49 = NullItem(Item=merge_60)  # -> NullFlags, InvalidFlags, Description
dispatch_143 = Dispatch(List=merge_60, DispatchPattern=null_49.InvalidFlags)  # -> ListA, ListB

# ---- group: 下层图纸-标注定位点
pt_81 = Point(dispatch_143.ListB)

# ----
cluster_5 = Cluster_2(
    outline_curve=标准范围_符合单一轴网方向_2,
    dim_offset_1=number_slider_20,
    dim_offset_2=number_slider_19,
    axis_direction_crv1=crv_14,
    axis_direction_crv2=crv_15,
    f2_arch_outline=crv_51,
    location_point=pt_81,
    dim_style=panel_22,
    directed_outline=seam_2,
    移除重复位置点_容差=number_slider_17)  # -> D_3, D_4, D, D_2
dimension1_2 = Data(cluster_5.D_3)

# ---- group: Dimension2
data_86 = Data(cluster_5.D_4)

# ---- group: Dimension4
data_87 = Data(cluster_5.D_2)

# ---- group: Dimension3
data_88 = Data(cluster_5.D)

# ----
entwine_22 = Entwine(Branch00=dimension1_2, Branch01=data_86, Branch02=data_88, Branch03=data_87, FlattenInputs=True)

# ---- group: Refrash Data
# 将所有Input都输入完后要Refresh data
dam_2 = DataDam(DataA=entwine_22, BufferDelay=10000000, BufferMode=0)

# ----
dedim_2 = DeconstructDimension(DimensionObject=dam_2)  # -> Value, Text, Plane, Points, Style
shift_33 = ShiftPaths(Data=dedim_2.Text, Offset=-1)
smaller_12 = SmallerThan(FirstNumber=shift_33, SecondNumber=Slider(1, range=0..10))  # -> SmallerThan, OrEqualTo
dispatch_144 = Dispatch(List=dam_2, DispatchPattern=smaller_12.SmallerThan)  # -> ListA, ListB

# ---- group: Bake Me
bake_12 = BakeObjects(Geometry=dispatch_144.ListB, Attributes=attributes_12, Bake=False)

# ----
data_89 = Data(dispatch_144.ListB)

crv_100 = Curve(project_9.Geometry)
crv_101 = Curve([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])
merge_61 = Merge(Data1=crv_100, Data2=crv_101)  # -> flatten(Result)

# ----
# curve
crv_102 = Curve(merge_61)

angle = Angle(VectorA=crv_102, VectorB="1,0,0")  # -> Angle, Reflex
deg_6 = Degrees(Radians=angle.Angle)
number = NumberGroups(Number=deg_6, Difference="0.2")  # -> Groups, Indices
item_102 = ListItem(List=crv_102, Index=number.Indices, Wrap=True)  # -> simplify(Item)
panel_56 = Panel(number.Groups)
item_103 = ListItem(List=item_102, Index=0, Wrap=True)  # -> flatten(Item)
item_104 = ListItem(List=item_102, Index=0, Wrap=True)
bang_3 = ExplodeTree(Data=item_102)  # -> Branch0, Branch1, Branch2, Branch3, Branch4, Branch5
crv_103 = Curve(bang_3.Branch0)
crv_104 = Curve(bang_3.Branch1)
crv_105 = Curve(bang_3.Branch2)
crv_106 = Curve(bang_3.Branch3)
angle_2 = Angle(VectorA=item_104, VectorB=item_103)  # -> Angle, Reflex
deg_7 = Degrees(Radians=angle_2.Angle)
round_2 = Round(Number=deg_7, DecimalPlace="0")  # -> Nearest, Floor, Ceiling
equals_38 = Equality(FirstNumber=round_2.Nearest, SecondNumber="90")  # -> Equality, Inequality
panel_57 = Panel(round_2.Nearest)
dispatch_145 = Dispatch(List=item_103, DispatchPattern=equals_38.Equality)  # -> ListA, ListB
crv_107 = Curve(flatten(dispatch_145.ListA))
index = ItemIndex(List=item_103, Item=crv_107)
concat_4 = Concatenate(FragmentA="{", FragmentB=index)
concat_5 = Concatenate(FragmentA=concat_4, FragmentB="}")
tstat_3 = TreeStatistics(Tree=item_102)  # -> Paths, Length, Count
item_105 = ListItem(List=tstat_3.Paths, Index=0, Wrap=True)  # -> Item, Item1
item_106 = ListItem(List=concat_5, Index=0, Wrap=True)
# Sort Text
branch = TreeBranch(Tree=item_102, Path=item_105.Item, MaintainPaths=True)
branch_2 = TreeBranch(Tree=item_102, Path=item_106, MaintainPaths=True)

# ==== cluster Cluster
G = ClusterInput()
rotate = Rotate(Geometry=G, Angle=3.141592654, Plane=PlaneXY(0, 0, 0))  # -> Geometry, Transform
boxprop = BoxProperties(Box=rotate.Geometry)  # -> Center, Diagonal, Area, Volume, Degeneracy
bbox = BoundingBox(Content=rotate.Geometry, Plane=PlaneXY(0, 0, 0))  # -> Box, Box_2
debox = DeconstructBox(Box=bbox.Box)  # -> Plane, X, Y, Z
pdecon = Deconstruct(Point=boxprop.Center)  # -> XComponent, YComponent, ZComponent
dedomain = DeconstructDomain(Domain=debox.Y)  # -> Start, End
pt = ConstructPoint(XCoordinate=pdecon.XComponent, YCoordinate=dedomain.Start, ZCoordinate=pdecon.ZComponent)
xy = XYPlane(Origin=Point(0, 0, 0))
pl_origin = PlaneOrigin(Base=xy, Origin=pt)
orient = Orient(Geometry=rotate.Geometry, Source=pl_origin, Target=xy)  # -> Geometry, Transform
G_2 = ClusterOutput(orient.Geometry)

# ==== cluster Cluster_2
f2_arch_outline = ClusterInput()
directed_outline = ClusterInput()
location_point = ClusterInput()
移除重复位置点_容差 = ClusterInput()
dim_offset_1 = ClusterInput()
dim_offset_2 = ClusterInput()
axis_direction_crv1 = ClusterInput()
axis_direction_crv2 = ClusterInput()
dim_style = ClusterInput()
outline_curve = ClusterInput()
pt = Point(location_point)
merge = Merge(Data1=axis_direction_crv1, Data2=axis_direction_crv2)
crv = Curve(f2_arch_outline)
number_slider = Slider(61, range=0..100)

incurve = PointInCurve(Point=flatten(pt), Curve=outline_curve)  # -> Relationship, Point
equals = Equality(FirstNumber=incurve.Relationship, SecondNumber="0")  # -> Equality, Inequality
dispatch = Dispatch(List=flatten(pt), DispatchPattern=equals.Inequality)  # -> ListA, ListB
pt_2 = Point(dispatch.ListA)
crv_cp = CurveClosestPoint(Point=pt_2, Curve=directed_outline)  # -> Point, Parameter, Distance
sort = SortList(Keys=crv_cp.Parameter, ValuesA=pt_2)  # -> Keys, ValuesA
pt_3 = Point(sort.ValuesA)
item = ListItem(List=merge, Index=0, Wrap=True)  # -> Item, Item1

# ----
# remove重复定位点生成的2个点
pt_4 = Point(pt_3)
shift = ShiftList(List=pt_4, Shift=1, Wrap=invert(True))
pt_5 = Point(pt_3)
pt_6 = Point(shift)
dist = Distance(PointA=pt_5, PointB=pt_6)
larger = LargerThan(FirstNumber=dist, SecondNumber=移除重复位置点_容差)  # -> LargerThan, OrEqualTo
dispatch_2 = Dispatch(List=pt_5, DispatchPattern=larger.LargerThan)  # -> ListA, ListB
pt_7 = Point(dispatch_2.ListA)
pt_8 = Point(dispatch_2.ListB)

dispatch_3 = Dispatch(List=pt_7, DispatchPattern=[True, False])  # -> ListA, ListB
pt_9 = Point(dispatch_3.ListB)
pt_10 = Point(dispatch_3.ListA)
pl = ConstructPlane(Origin=pt_10, XAxis=item.Item1, YAxis=item.Item)
pl_2 = ConstructPlane(Origin=pt_10, XAxis=item.Item, YAxis=item.Item1)

item_2 = ListItem(List=pt_7, Index=number_slider, Wrap=True)
shift_2 = ShiftList(List=pt_7, Shift=1, Wrap=invert(True))
item_3 = ListItem(List=shift_2, Index=number_slider, Wrap=True)

dispatch_4 = Dispatch(List=shift_2, DispatchPattern=[True, False])  # -> ListA, ListB
item_4 = ListItem(List=merge, Index=0, Wrap=True)  # -> Item, Item1
pt_11 = Point(dispatch_4.ListB)
pt_12 = Point(dispatch_4.ListA)
pl_3 = ConstructPlane(Origin=pt_12, XAxis=item_4.Item1, YAxis=item_4.Item)
pl_4 = ConstructPlane(Origin=pt_12, XAxis=item_4.Item, YAxis=item_4.Item1)

ln = Line(StartPoint=pt_10, EndPoint=pt_9)
ln_2 = Line(StartPoint=pt_12, EndPoint=pt_11)

crv_2 = Curve(crv)
deplane = DeconstructPlane(Plane=pl_3)  # -> Origin, XAxis, YAxis, ZAxis
amp = Amplitude(Vector=deplane.YAxis, Amplitude=Slider(3000, range=0..10000))
move = Move(Geometry=deplane.Origin, Motion=amp)  # -> Geometry, Transform
clscrv = CloseCurve(Curve=crv_2, CloseType=0, Bulge=0.5, Tolerance=0)  # -> Closed, R
pt_13 = Point(move.Geometry)
incurve_2 = PointInCurve(Point=pt_13, Curve=clscrv.Closed)  # -> Relationship, Point
equals_2 = Equality(FirstNumber=incurve_2.Relationship, SecondNumber="2")  # -> Equality, Inequality
lng = ListLength(List=equals_2.Equality)
lng_2 = ListLength(List=equals_2.Equality)
neg = Negative(Value=dim_offset_1)
repeat = RepeatData(Data=graft(neg), Length=lng)
repeat_2 = RepeatData(Data=graft(dim_offset_1), Length=lng_2)
panel = Panel(equals_2.Equality)
dispatch_5 = Dispatch(List=graft(repeat_2), DispatchPattern=graft(equals_2.Equality))  # -> ListA, ListB
dispatch_6 = Dispatch(List=graft(repeat), DispatchPattern=graft(equals_2.Equality))  # -> ListA, ListB
merge_2 = Merge(Data1=dispatch_5.ListA, Data2=dispatch_6.ListB)  # -> flatten(Result)

crv_3 = Curve(crv)
deplane_2 = DeconstructPlane(Plane=pl_4)  # -> Origin, XAxis, YAxis, ZAxis
amp_2 = Amplitude(Vector=deplane_2.YAxis, Amplitude=Slider(3000, range=0..10000))
move_2 = Move(Geometry=deplane_2.Origin, Motion=amp_2)  # -> Geometry, Transform
clscrv_2 = CloseCurve(Curve=crv_3, CloseType=0, Bulge=0.5, Tolerance=0)  # -> Closed, R
pt_14 = Point(move_2.Geometry)
incurve_3 = PointInCurve(Point=pt_14, Curve=clscrv_2.Closed)  # -> Relationship, Point
equals_3 = Equality(FirstNumber=incurve_3.Relationship, SecondNumber="2")  # -> Equality, Inequality
lng_3 = ListLength(List=equals_3.Equality)
neg_2 = Negative(Value=dim_offset_1)
lng_4 = ListLength(List=equals_3.Equality)
repeat_3 = RepeatData(Data=graft(neg_2), Length=lng_4)
repeat_4 = RepeatData(Data=graft(dim_offset_1), Length=lng_3)
panel_2 = Panel(equals_3.Equality)
dispatch_7 = Dispatch(List=graft(repeat_4), DispatchPattern=graft(equals_3.Equality))  # -> ListA, ListB
dispatch_8 = Dispatch(List=graft(repeat_3), DispatchPattern=graft(equals_3.Equality))  # -> ListA, ListB
merge_3 = Merge(Data1=dispatch_7.ListA, Data2=dispatch_8.ListB)  # -> flatten(Result)

crv_4 = Curve(crv)
deplane_3 = DeconstructPlane(Plane=pl)  # -> Origin, XAxis, YAxis, ZAxis
amp_3 = Amplitude(Vector=deplane_3.YAxis, Amplitude=Slider(3000, range=0..10000))
move_3 = Move(Geometry=deplane_3.Origin, Motion=amp_3)  # -> Geometry, Transform
clscrv_3 = CloseCurve(Curve=crv_4, CloseType=0, Bulge=0.5, Tolerance=0)  # -> Closed, R
pt_15 = Point(move_3.Geometry)
incurve_4 = PointInCurve(Point=pt_15, Curve=clscrv_3.Closed)  # -> Relationship, Point
equals_4 = Equality(FirstNumber=incurve_4.Relationship, SecondNumber="2")  # -> Equality, Inequality
lng_5 = ListLength(List=equals_4.Equality)
neg_3 = Negative(Value=dim_offset_2)
lng_6 = ListLength(List=equals_4.Equality)
repeat_5 = RepeatData(Data=graft(neg_3), Length=lng_6)
repeat_6 = RepeatData(Data=graft(dim_offset_2), Length=lng_5)
panel_3 = Panel(equals_4.Equality)
dispatch_9 = Dispatch(List=graft(repeat_6), DispatchPattern=graft(equals_4.Equality))  # -> ListA, ListB
dispatch_10 = Dispatch(List=graft(repeat_5), DispatchPattern=graft(equals_4.Equality))  # -> ListA, ListB
merge_4 = Merge(Data1=dispatch_9.ListA, Data2=dispatch_10.ListB)  # -> flatten(Result)

crv_5 = Curve(crv)
deplane_4 = DeconstructPlane(Plane=pl_2)  # -> Origin, XAxis, YAxis, ZAxis
amp_4 = Amplitude(Vector=deplane_4.YAxis, Amplitude=Slider(3000, range=0..10000))
move_4 = Move(Geometry=deplane_4.Origin, Motion=amp_4)  # -> Geometry, Transform
clscrv_4 = CloseCurve(Curve=crv_5, CloseType=0, Bulge=0.5, Tolerance=0)  # -> Closed, R
pt_16 = Point(move_4.Geometry)
incurve_5 = PointInCurve(Point=pt_16, Curve=clscrv_4.Closed)  # -> Relationship, Point
equals_5 = Equality(FirstNumber=incurve_5.Relationship, SecondNumber="2")  # -> Equality, Inequality
lng_7 = ListLength(List=equals_5.Equality)
neg_4 = Negative(Value=dim_offset_2)
lng_8 = ListLength(List=equals_5.Equality)
repeat_7 = RepeatData(Data=graft(neg_4), Length=lng_8)
repeat_8 = RepeatData(Data=graft(dim_offset_2), Length=lng_7)
panel_4 = Panel(equals_5.Equality)
dispatch_11 = Dispatch(List=graft(repeat_8), DispatchPattern=graft(equals_5.Equality))  # -> ListA, ListB
dispatch_12 = Dispatch(List=graft(repeat_7), DispatchPattern=graft(equals_5.Equality))  # -> ListA, ListB
merge_5 = Merge(Data1=dispatch_11.ListA, Data2=dispatch_12.ListB)  # -> flatten(Result)

lineardim = DefineLinearDimension(
    Point1=simplify(pt_12),
    Point2=simplify(pt_11),
    DimensionPlane=simplify(pl_3),
    Offset=expr("-x", merge_2),
    DimensionStyle=dim_style)
lineardim_2 = DefineLinearDimension(
    Point1=simplify(pt_12),
    Point2=simplify(pt_11),
    DimensionPlane=simplify(pl_4),
    Offset=expr("-x", merge_3),
    DimensionStyle=dim_style)
lineardim_3 = DefineLinearDimension(
    Point1=simplify(pt_10),
    Point2=simplify(pt_9),
    DimensionPlane=simplify(pl),
    Offset=expr("-x", merge_4),
    DimensionStyle=dim_style)
lineardim_4 = DefineLinearDimension(
    Point1=simplify(pt_10),
    Point2=simplify(pt_9),
    DimensionPlane=simplify(pl_2),
    Offset=expr("-x", merge_5),
    DimensionStyle=dim_style)
D = ClusterOutput(lineardim)
D_2 = ClusterOutput(lineardim_2)
D_3 = ClusterOutput(lineardim_3)
D_4 = ClusterOutput(lineardim_4)

# ==== cluster Cluster_3
structure_number = ClusterInput()
tag_text = ClusterInput()
text_offset = ClusterInput()
embed_color = ClusterInput()
T = ClusterInput()
G = ClusterInput()
A = ClusterInput()
A_2 = ClusterInput()
B = ClusterInput()
dimension_style = ClusterInput()

# ----
# 列表文字以空格进行分割
panel = Panel(" ")
split = TextSplit(Text=T, Separators=panel)

钢埋板长度_2 = Division(A=A, B=2)
neg = Negative(Value=钢埋板长度_2)
dom = ConstructDomain(DomainStart=neg, DomainEnd=钢埋板长度_2)
panel_2 = Panel(dom)

钢埋板厚度_2 = Division(A=A_2, B=2)
neg_2 = Negative(Value=钢埋板厚度_2)
dom_2 = ConstructDomain(DomainStart=neg_2, DomainEnd=钢埋板厚度_2)
panel_3 = Panel(dom_2)

# ----
# 钢埋板肋板位置 1/4处
panel_4 = Panel("4")
division = Division(A=A, B=panel_4)

# ----
# 编号和截面尺寸分区
panel_5 = Panel("1")
split_2 = SplitList(List=split, Index=panel_5)  # -> flatten(ListA), flatten(ListB)

# ----
# 求出对应输入编号的钢结构截面尺寸
fsim = FindSimilarMember(Data=structure_number, Set=split_2.ListA)  # -> Hit, Index
item = ListItem(List=split_2.ListB, Index=fsim.Index, Wrap=True)

addition = Addition(A=neg_2, B=division)
addition_2 = Addition(A=钢埋板厚度_2, B=division)
dom_3 = ConstructDomain(DomainStart=addition, DomainEnd=addition_2)
panel_6 = Panel(split_2.ListB)
split_3 = TextSplit(Text=item, Separators="x")
split_4 = TextSplit(Text=split_3, Separators="Q")
item_2 = ListItem(List=split_4, Index="0", Wrap=True)  # -> flatten(Item)
subtraction = Subtraction(A=division, B=钢埋板厚度_2)
subtraction_2 = Subtraction(A=division, B=钢埋板厚度_2)
subtraction_3 = Subtraction(A=division, B=钢埋板厚度_2)
neg_3 = Negative(Value=钢埋板厚度_2)
neg_4 = Negative(Value=钢埋板厚度_2)
neg_5 = Negative(Value=钢埋板厚度_2)
subtraction_4 = Subtraction(A=division, B=钢埋板厚度_2)
addition_3 = Addition(A=subtraction, B=A_2)
addition_4 = Addition(A=subtraction_2, B=A_2)
subtraction_5 = Subtraction(A=neg_3, B=A_2)
subtraction_6 = Subtraction(A=neg_4, B="2")
subtraction_7 = Subtraction(A=division, B=钢埋板厚度_2)
addition_5 = Addition(A=subtraction_3, B="2")
subtraction_8 = Subtraction(A=neg_5, B="2")
neg_6 = Negative(Value=钢埋板厚度_2)
neg_7 = Negative(Value=钢埋板厚度_2)
工字钢_h = ListItem(List=item_2, Index=0, Wrap=True)
工字钢_b = ListItem(List=item_2, Index=1, Wrap=True)
工字钢_tf = ListItem(List=item_2, Index=3, Wrap=True)
工字钢_tw = ListItem(List=item_2, Index=2, Wrap=True)
pt = ConstructPoint(XCoordinate=neg_6, YCoordinate=subtraction_4, ZCoordinate=0)
pt_2 = ConstructPoint(XCoordinate=neg_7, YCoordinate=addition_3, ZCoordinate=0)
pt_3 = ConstructPoint(XCoordinate=subtraction_5, YCoordinate=addition_4, ZCoordinate=0)
pt_4 = ConstructPoint(XCoordinate=subtraction_6, YCoordinate=subtraction_7, ZCoordinate=0)
pt_5 = ConstructPoint(XCoordinate=subtraction_8, YCoordinate=addition_5, ZCoordinate=0)
subtraction_9 = Subtraction(A=工字钢_b, B=工字钢_tw)
division_2 = Division(A=subtraction_9, B="2")
merge = Merge(Data1=pt, Data2=pt_2, Data3=pt_3, Data4=pt_5, Data5=pt_4)
pline = PolyLine(Vertices=merge, Closed=True)
division_3 = Division(A=division_2, B="2")
subtraction_10 = Subtraction(A=division_3, B=A_2)
subtraction_11 = Subtraction(A=division_3, B=钢埋板厚度_2)
neg_8 = Negative(Value=division_3)
subtraction_12 = Subtraction(A=neg_8, B=subtraction_11)
addition_6 = Addition(A=subtraction_12, B=B)
dom_4 = ConstructDomain(DomainStart=addition_6, DomainEnd=subtraction_12)
dom_5 = ConstructDomain(DomainStart=addition, DomainEnd=addition_2)
钢肋板倒角_侧视图 = Rectangle(Plane=PlaneXY(0, 0, 0), XSize=dom_4, YSize=dom_5, Radius=0)  # -> Rectangle, Length
subtraction_13 = Subtraction(A=subtraction_10, B=subtraction_11)
subtraction_14 = Subtraction(A=neg_8, B=subtraction_11)
dom_6 = ConstructDomain(DomainStart=subtraction_13, DomainEnd=subtraction_14)
钢肋板_侧视图 = Rectangle(Plane=PlaneXY(0, 0, 0), XSize=dom_6, YSize=dom_3, Radius=0)  # -> Rectangle, Length
merge_2 = Merge(Data1=钢肋板_侧视图.Rectangle, Data2=pline, Data3=钢肋板倒角_侧视图.Rectangle)
xz = XZPlane(Origin=Point(0, 0, 0))
mirror = Mirror(Geometry=merge_2, Plane=xz)  # -> Geometry, Transform
钢埋板_侧视图 = Rectangle(Plane=PlaneXY(0, 0, 0), XSize=dom_2, YSize=dom, Radius=0)  # -> Rectangle, Length
division_4 = Division(A=工字钢_b, B=2)
侧视图 = Entwine(Branch00=钢埋板_侧视图.Rectangle, Branch01=merge_2, Branch02=mirror.Geometry, FlattenInputs=True)
R = ClusterOutput(division_4)
division_5 = Division(A=工字钢_h, B="2")
subtraction_15 = Subtraction(A=division_5, B=工字钢_tf)
addition_7 = Addition(A=subtraction_15, B=Slider(200, range=0..1000))
addition_8 = Addition(A=addition_7, B=division_2)
X = UnitX(Factor=addition_8)
move = Move(Geometry=侧视图, Motion=X)  # -> Geometry, Transform
split_tree = SplitTree(Data=move.Geometry, Masks=flatten("{0;0}"))  # -> Positive, Negative
dispatch = Dispatch(List=split_tree.Negative, DispatchPattern=[True, False])  # -> flatten(ListA), ListB
merge_3 = Merge(Data1=split_tree.Positive, Data2=dispatch.ListA)
entwine = Entwine(Branch00=merge_3, Branch01=dispatch.ListB, FlattenInputs=True)
flatten = FlattenTree(Tree=entwine, Path="{0}")
group = Group(Objects=flatten)
rotate = Rotate(Geometry=group, Angle=3.141592654, Plane=PlaneXY(0, 0, 0))  # -> Geometry, Transform
boxprop = BoxProperties(Box=rotate.Geometry)  # -> Center, Diagonal, Area, Volume, Degeneracy
bbox = BoundingBox(Content=rotate.Geometry, Plane=PlaneXY(0, 0, 0))  # -> Box, Box_2
debox = DeconstructBox(Box=bbox.Box)  # -> Plane, X, Y, Z
pdecon = Deconstruct(Point=boxprop.Center)  # -> XComponent, YComponent, ZComponent
dedomain = DeconstructDomain(Domain=debox.Y)  # -> Start, End
pt_6 = ConstructPoint(XCoordinate=pdecon.XComponent, YCoordinate=dedomain.Start, ZCoordinate=pdecon.ZComponent)
xy = XYPlane(Origin=Point(0, 0, 0))
concat = Concatenate(FragmentA="Embed", FragmentB=tag_text)
pl_origin = PlaneOrigin(Base=xy, Origin=pt_6)
orient = Orient(Geometry=rotate.Geometry, Source=pl_origin, Target=xy)  # -> Geometry, Transform
xy_2 = XYPlane(Origin=Point(0, 0, 0))
attributes = DefineObjectAttributes(Color=embed_color)
ungroup = Ungroup(Group=orient.Geometry)
block = DefineBlock(Geometry=ungroup, Attributes=attributes, BlockName=concat, BasePlane=PlaneXY(0, 0, 0))
deblock = DeconstructBlock(Block=block)  # -> Name, flatten(Plane), flatten(Geometry)
group_2 = Group(Objects=deblock.Geometry)
bbox_2 = BoundingBox(Content=group_2, Plane=PlaneXY(0, 0, 0))  # -> Box, Box_2
deplane = DeconstructPlane(Plane=deblock.Plane)  # -> Origin, XAxis, YAxis, ZAxis
area = Area(Geometry=bbox_2.Box)  # -> Area, Centroid
move2pt = MoveToPoint(Geometry=flatten(deplane.Origin), PointA=flatten(deplane.Origin), PointB=flatten(area.Centroid))  # -> Moved, Vector, Transform
pl = ConstructPlane(Origin=move2pt.Moved, XAxis=deplane.YAxis, YAxis=deplane.XAxis)  # -> graft(Plane)
deplane_2 = DeconstructPlane(Plane=pl)  # -> Origin, XAxis, YAxis, ZAxis
rotate_2 = Rotate(Geometry=pl, Angle="Pi", Plane=pl)  # -> Geometry, Transform
dedomain_2 = DeconstructDomain(Domain=dom)  # -> Start, End
multiplication = Multiplication(A=dedomain_2.Start, B=dedomain_2.Start)
amp = Amplitude(Vector=deplane_2.YAxis, Amplitude=multiplication)
move_2 = Move(Geometry=deplane_2.Origin, Motion=amp)  # -> Geometry, Transform
srf = Surface(bbox_2.Box)
crv = Curve(srf)
ln = Line(StartPoint=move_2.Geometry, EndPoint=deplane_2.Origin)
ccx = CurveCurve(CurveA=ln, CurveB=crv)  # -> Points, ParamsA, ParamsB
ln_2 = Line(StartPoint=deplane_2.Origin, EndPoint=ccx.Points)
move_3 = Move(Geometry=rotate_2.Geometry, Motion=ln_2)  # -> Geometry, Transform

ln_3 = Line(StartPoint=ccx.Points, EndPoint=deplane_2.Origin)
amp_2 = Amplitude(Vector=ln_3, Amplitude=text_offset)
move_4 = Move(Geometry=rotate_2.Geometry, Motion=amp_2)  # -> Geometry, Transform
text = DefineTextObject(Text=tag_text, Plane=move_4.Geometry, DimensionStyle=dimension_style, OutputType="Text")
group_3 = Group(Objects=[block, text])

entwine_2 = Entwine(Branch00=group_3, Branch01=move_3.Geometry, FlattenInputs=True)
project = Project(Geometry=G, Plane=xy_2)  # -> Geometry, Transform
R_2 = ClusterOutput(entwine_2)
G_2 = ClusterOutput(project.Geometry)
