# Grasshopper definition FacadeEmbed_JinQiao_Podium_檐口.gh (Grasshopper 1.0.7)
# plug-ins: EleFront, Pufferfish, TT Toolbox, Hare

# ----
# （1）导入埋件定位点
# Block & Curve的形式
# block names
listblockd = ListBlockDocument()
panel = Panel(listblockd)

# ----
# Input Blocks (Correct Plan)
# 主体定位点
data = Data(["PX-GLAZ-F2$0$PX-GLAZ-F1$0$标准块", "PX-GLAZ-F2$0$PX-GLAZ-F2$0$标准块", "PX-GLAZ-F2$0$PX-GLAZ-F3$0$标准块"])

# ----
# Input Curves
# 主体定位点（按图层导入）
crv = Curve(<curve referenced from the Rhino model>)

# ----
# Input Blocks (Wrong Plan)
# 主体定位点
data_2 = Data("PX-GLAZ-F2$0$T3T")

# ----
# 按图层整理curves
# 2.Line-0-建筑
# 3.Line-1-结构
# 第二层-阴阳角
# 第二层
# 
# Curves(location point)+ Smooth Curves(architecture line)
# 第二层-区分阴阳角
# InsideCurve-阳角
# remove duplicate curves
# 第二层-大面定位
# InsideCurve-阴角
# InsideCurve-大面
# 求内部曲线转折点
# 显示"False"时要选择线段延长
# SmoothCurve-阴角&阳角
# 阳角
# 线段延长长度
# 阴角
# 调换阴阳角设定
panel_2 = Panel("Line-1-结构-All")
reflay = ReferenceByLayer(LayerName=panel_2)

# ----
# 按图层整理curves
# 1.Line-1-建筑-
panel_3 = Panel("Arch_curve_smooth")
reflay_2 = ReferenceByLayer(LayerName="Arch_curve_Whole")
reflay_3 = ReferenceByLayer(LayerName=panel_3)
reflay_4 = ReferenceByLayer(LayerName="Arch_curve_withLocation")
reflay_5 = ReferenceByLayer(LayerName="Arch_curve_angular")

# ----
# This Project Only
panel_4 = Panel("Arch_curve_other")
reflay_6 = ReferenceByLayer(LayerName=panel_4)

# ----
# 第一层
layer = ObjectLayer(Guid=crv)  # -> LayerIndex, LayerPathName
panel_5 = Panel(data)
panel_7 = Panel(data_2)
panel_8 = Panel(layer.LayerPathName)
refblock = ReferenceBlockByName(BlockName=panel_5)
reflay_7 = ReferenceByLayer(LayerName=panel_8)
refblock_2 = ReferenceBlockByName(BlockName=panel_7)
xy = XYPlane(Origin=Point(0, 0, 0))
xy_2 = XYPlane(Origin=Point(0, 0, 0))
xy_3 = XYPlane(Origin=Point(0, 0, 0))
# 导入槽埋模型
project = Project(Geometry=refblock, Plane=xy_2)  # -> Geometry, Transform
project_2 = Project(Geometry=reflay_7, Plane=xy)  # -> Geometry, Transform
project_3 = Project(Geometry=refblock_2, Plane=xy_3)  # -> Geometry, Transform

# ----
# （2）导入参考线
# 按照图层导入建筑、结构、檐口线
xy_4 = XYPlane(Origin=Point(0, 0, 0))
xy_5 = XYPlane(Origin=Point(0, 0, 0))
xy_6 = XYPlane(Origin=Point(0, 0, 0))
xy_7 = XYPlane(Origin=Point(0, 0, 0))
xy_8 = XYPlane(Origin=Point(0, 0, 0))
xy_9 = XYPlane(Origin=Point(0, 0, 0))
project_4 = Project(Geometry=reflay_2, Plane=xy_4)  # -> Geometry, Transform
project_5 = Project(Geometry=reflay_3, Plane=xy_5)  # -> Geometry, Transform
project_6 = Project(Geometry=reflay_4, Plane=xy_6)  # -> Geometry, Transform
project_7 = Project(Geometry=reflay_5, Plane=xy_7)  # -> Geometry, Transform
project_8 = Project(Geometry=reflay_6, Plane=xy_8)  # -> Geometry, Transform
project_9 = Project(Geometry=reflay, Plane=xy_9)  # -> Geometry, Transform
crv_2 = Curve(project_5.Geometry)
crv_3 = Curve(project_6.Geometry)
crv_4 = Curve(project_7.Geometry)
crv_5 = Curve(project_4.Geometry)
crv_6 = Curve(project_8.Geometry)
crv_7 = Curve(project_9.Geometry)

# ----
# 测试Smooth Curve是否与每个Block相切
# remove duplicate blocks
deblock = DeconstructBlock(Block=project.Geometry)  # -> Name, Plane, Geometry
pln = Plane(flatten(deblock.Plane))
deplane = DeconstructPlane(Plane=pln)  # -> Origin, XAxis, YAxis, ZAxis
cullduppoints = RemoveDuplicatePoints(InputPoints=deplane.Origin, Tolerance=0.001)  # -> OutputPoints, FirstPointIndexes
null = NullItem(Item=cullduppoints.FirstPointIndexes)  # -> NullFlags, InvalidFlags, Description
dispatch = Dispatch(List=pln, DispatchPattern=null.InvalidFlags)  # -> ListA, ListB
dispatch_2 = Dispatch(List=flatten(project.Geometry), DispatchPattern=null.InvalidFlags)  # -> ListA, ListB
pln_2 = Plane(dispatch.ListA)

# ----
# 测试Smooth Curve是否与每个Block相切
# remove duplicate blocks
deblock_2 = DeconstructBlock(Block=project_3.Geometry)  # -> Name, Plane, Geometry
pln_3 = Plane(flatten(deblock_2.Plane))
deplane_2 = DeconstructPlane(Plane=pln_3)  # -> Origin, XAxis, YAxis, ZAxis
cullduppoints_2 = RemoveDuplicatePoints(InputPoints=deplane_2.Origin, Tolerance=0.001)  # -> OutputPoints, FirstPointIndexes
null_2 = NullItem(Item=cullduppoints_2.FirstPointIndexes)  # -> NullFlags, InvalidFlags, Description
dispatch_3 = Dispatch(List=pln_3, DispatchPattern=null_2.InvalidFlags)  # -> ListA, ListB
dispatch_4 = Dispatch(List=flatten(project_3.Geometry), DispatchPattern=null_2.InvalidFlags)  # -> ListA, ListB
pln_4 = Plane(dispatch_3.ListA)

deblock_3 = DeconstructBlock(Block=dispatch_2.ListA)  # -> Name, Plane, Geometry
data_3 = Data(dispatch_2.ListA)

deblock_4 = DeconstructBlock(Block=dispatch_4.ListA)  # -> Name, Plane, Geometry
data_4 = Data(dispatch_4.ListA)

data_5 = Data(flatten(pln_2))
deplane_3 = DeconstructPlane(Plane=data_5)  # -> Origin, XAxis, YAxis, ZAxis
pln_5 = Plane(data_5)
amp = Amplitude(Vector=deplane_3.YAxis, Amplitude=Slider(300, range=0..1000))
move = Move(Geometry=deplane_3.Origin, Motion=amp)  # -> Geometry, Transform
ln = Line(StartPoint=deplane_3.Origin, EndPoint=move.Geometry)
crv_8 = Curve(crv_2)
midpt = CurveMiddle(Curve=ln)
scale = Scale(Geometry=ln, Center=midpt, Factor=Slider(7.8, range=0..10))  # -> Geometry, Transform
merge = Merge(Data1=scale.Geometry, Data2=crv_8)
mcx = MultipleCurves(Curves=flatten(merge))  # -> Points, IndexA, IndexB, ParamA, ParamB

data_6 = Data(flatten(pln_4))
deplane_4 = DeconstructPlane(Plane=data_6)  # -> Origin, XAxis, YAxis, ZAxis
pln_6 = Plane(data_6)
amp_2 = Amplitude(Vector=deplane_4.YAxis, Amplitude=Slider(300, range=0..1000))
move_2 = Move(Geometry=deplane_4.Origin, Motion=amp_2)  # -> Geometry, Transform
ln_2 = Line(StartPoint=deplane_4.Origin, EndPoint=move_2.Geometry)
crv_9 = Curve(crv_2)
midpt_2 = CurveMiddle(Curve=ln_2)
scale_2 = Scale(Geometry=ln_2, Center=midpt_2, Factor=Slider(7.8, range=0..10))  # -> Geometry, Transform
merge_2 = Merge(Data1=scale_2.Geometry, Data2=crv_9)
mcx_2 = MultipleCurves(Curves=flatten(merge_2))  # -> Points, IndexA, IndexB, ParamA, ParamB

# ----
# blocks + special curves
cull_i = CullIndex(List=flatten(pln_5), Indices=mcx.IndexA, Wrap=True)
cull_i_2 = CullIndex(List=flatten(data_3), Indices=mcx.IndexA, Wrap=True)
pln_7 = Plane(cull_i)
data_7 = Data(cull_i_2)

# ----
# blocks + special curves
cull_i_3 = CullIndex(List=flatten(pln_6), Indices=mcx_2.IndexA, Wrap=True)
cull_i_4 = CullIndex(List=flatten(data_4), Indices=mcx_2.IndexA, Wrap=True)
pln_8 = Plane(cull_i_3)
data_8 = Data(cull_i_4)

# ----
# blocks + smooth curves
item = ListItem(List=pln_5, Index=mcx.IndexA, Wrap=True)
item_2 = ListItem(List=flatten(data_3), Index=mcx.IndexA, Wrap=True)
data_9 = Data(item_2)
pln_9 = Plane(item)

# ----
# blocks + smooth curves
item_3 = ListItem(List=pln_6, Index=mcx_2.IndexA, Wrap=True)
item_4 = ListItem(List=flatten(data_4), Index=mcx_2.IndexA, Wrap=True)
data_10 = Data(item_4)
pln_10 = Plane(item_3)

# ----
# remove duplicate curves
geo = Geometry(project_2.Geometry)
boundary = BoundarySurfaces(Edges=geo)
area = Area(Geometry=boundary)  # -> Area, Centroid
cullduppoints_3 = RemoveDuplicatePoints(InputPoints=area.Centroid, Tolerance=Slider(0.1, range=0..0.1))  # -> OutputPoints, FirstPointIndexes
null_3 = NullItem(Item=cullduppoints_3.FirstPointIndexes)  # -> NullFlags, InvalidFlags, Description
dispatch_5 = Dispatch(List=boundary, DispatchPattern=null_3.NullFlags)  # -> ListA, ListB
geo_2 = Geometry(dispatch_5.ListA)

# ----
# 第一层
# 
# Special Curves(architecture line)
crv_10 = Curve(crv_3)
pln_11 = Plane(pln_7)
deplane_5 = DeconstructPlane(Plane=pln_11)  # -> Origin, XAxis, YAxis, ZAxis
disc = Discontinuity(Curve=crv_10, Level=1)  # -> Points, Parameters
pull = PullPoint(Point=deplane_5.Origin, Geometry=disc.Points, ClosestOnly=True)  # -> ClosestPoint, Distance
sort = SortList(Keys=pull.Distance)  # -> reverse(Keys), ValuesA
panel_9 = Panel(sort.Keys)
larger = LargerThan(FirstNumber=pull.Distance, SecondNumber=Slider(300, range=0..1000))  # -> LargerThan, OrEqualTo
dispatch_6 = Dispatch(List=pln_11, DispatchPattern=larger.LargerThan)  # -> ListA, ListB
data_11 = Data(dispatch_6.ListB)
deplane_6 = DeconstructPlane(Plane=data_11)  # -> Origin, XAxis, YAxis, ZAxis
pull_2 = PullPoint(Point=deplane_6.Origin, Geometry=disc.Points, ClosestOnly=True)  # -> ClosestPoint, Distance

# ----
# Special Curve(with location)- All
pl = ConstructPlane(Origin=pull_2.ClosestPoint, XAxis=deplane_6.XAxis, YAxis=deplane_6.YAxis)

# ----
# 求主体曲线转折点
clscrv = CloseCurve(Curve=crv_5, CloseType=0, Bulge=0.5, Tolerance=0)  # -> Closed, R
crv_11 = Curve(crv_2)
disc_2 = Discontinuity(Curve=graft(crv_11), Level=1)  # -> Points, Parameters
crv_cp = CurveClosestPoint(Point=disc_2.Points, Curve=graft(crv_11))  # -> Point, Parameter, Distance
eval = EvaluateCurve(Curve=graft(crv_11), Parameter=crv_cp.Parameter)  # -> flatten(Point), Tangent, flatten(Angle)
deg = Degrees(Radians=eval.Angle)
offset = OffsetCurve(Curve=clscrv.Closed, Distance=expr("-X", Slider(300, range=0..1000)), Corners=1)
panel_10 = Panel(deg)
larger_2 = LargerThan(FirstNumber=deg, SecondNumber=Slider(60, range=0..100))  # -> LargerThan, OrEqualTo
disc_3 = Discontinuity(Curve=offset, Level=1)  # -> flatten(Points), Parameters
dispatch_7 = Dispatch(List=eval.Point, DispatchPattern=larger_2.LargerThan)  # -> ListA, ListB

# ----
# 第一层
# 
# Angular Curves(architecture line)
# 测试Smooth Curve是否与每个Block相切
# blocks + smooth curves
# （2）导入参考线
# 按照图层导入建筑、结构、檐口线
# 按图层整理curves
# 1.Line-1-建筑-
# remove duplicate blocks
# blocks + special curves
# This Project Only
# 按图层整理curves
# 2.Line-0-建筑
# 3.Line-1-结构
# 测试Smooth Curve是否与每个Block相切
# blocks + smooth curves
# remove duplicate blocks
# blocks + special curves
number_slider = Slider(84, range=0..1000)
crv_12 = Curve(crv_6)
crv_13 = Curve(clscrv.Closed)
offset_2 = OffsetCurve(Curve=crv_13, Distance=expr("-x", number_slider), Corners=1)  # -> flatten(Curve)
disc_4 = Discontinuity(Curve=crv_12, Level=1)  # -> Points, Parameters
pull_3 = PullPoint(Point=disc_4.Points, Geometry=offset_2, ClosestOnly=True)  # -> ClosestPoint, Distance
disc_5 = Discontinuity(Curve=offset_2, Level=1)  # -> Points, Parameters
pull_4 = PullPoint(Point=flatten(pull_3.ClosestPoint), Geometry=flatten(disc_5.Points), ClosestOnly=True)  # -> ClosestPoint, Distance
check_same_points = CheckSamePoints(archPoint=flatten(pull_3.ClosestPoint), crvPoint=flatten(pull_4.ClosestPoint))  # -> out, specialPt; inputs archPoint: list of Point3d, crvPoint: list of Point3d
# ---------- check_same_points: C# ----------
    List<int> passIndex = new List<int>();

    for(int i = 0; i < archPoint.Count; i++){
      foreach(Point3d t in crvPoint){
        if(archPoint[i].X == t.X && archPoint[i].Y == t.Y && archPoint[i].Z == t.Z){
          Print("pass");
          passIndex.Add(i);}
      }
    }

    specialPt = passIndex;
# ---------- end check_same_points ----------
cull_i_5 = CullIndex(List=flatten(disc_4.Points), Indices=check_same_points.specialPt, Wrap=True)
end = EndPoints(Curve=crv_12)  # -> Start, End
merge_3 = Merge(Data1=end.Start, Data2=end.End, Data3=cull_i_5)
flatten = FlattenTree(Tree=disc_4.Points, Path="{0}")
check_same_points_2 = CheckSamePoints(archPoint=flatten(flatten), crvPoint=flatten(merge_3))  # -> out, specialPt; inputs archPoint: list of Point3d, crvPoint: list of Point3d; same code as check_same_points
cull_i_6 = CullIndex(List=flatten(flatten), Indices=check_same_points_2.specialPt, Wrap=True)
pull_5 = PullPoint(Point=cull_i_6, Geometry=offset_2, ClosestOnly=True)  # -> ClosestPoint, Distance
ln_3 = Line(StartPoint=cull_i_6, EndPoint=pull_5.ClosestPoint)
rotate = Rotate(Geometry=ln_3, Angle="Pi", Plane=cull_i_6)  # -> Geometry, Transform
rotate_2 = Rotate(Geometry=ln_3, Angle=1.570796327, Plane=cull_i_6)  # -> Geometry, Transform

# ----
# 第一层
# 
# Angular Curves(architecture line)
crv_14 = Curve(crv_4)
crv_15 = Curve(clscrv.Closed)
offset_3 = OffsetCurve(Curve=crv_15, Distance=expr("-x", Slider(84, range=0..1000)), Corners=1)  # -> flatten(Curve)
disc_6 = Discontinuity(Curve=crv_14, Level=1)  # -> Points, Parameters
pull_6 = PullPoint(Point=disc_6.Points, Geometry=offset_3, ClosestOnly=True)  # -> ClosestPoint, Distance
disc_7 = Discontinuity(Curve=offset_3, Level=1)  # -> Points, Parameters
pull_7 = PullPoint(Point=flatten(pull_6.ClosestPoint), Geometry=flatten(disc_7.Points), ClosestOnly=True)  # -> ClosestPoint, Distance
check_same_points_3 = CheckSamePoints(archPoint=flatten(pull_6.ClosestPoint), crvPoint=flatten(pull_7.ClosestPoint))  # -> out, specialPt; inputs archPoint: list of Point3d, crvPoint: list of Point3d; same code as check_same_points
cull_i_7 = CullIndex(List=flatten(disc_6.Points), Indices=check_same_points_3.specialPt, Wrap=True)
end_2 = EndPoints(Curve=crv_14)  # -> Start, End
merge_4 = Merge(Data1=end_2.Start, Data2=end_2.End, Data3=cull_i_7)
flatten_2 = FlattenTree(Tree=disc_6.Points, Path="{0}")
check_same_points_4 = CheckSamePoints(archPoint=flatten(flatten_2), crvPoint=flatten(merge_4))  # -> out, specialPt; inputs archPoint: list of Point3d, crvPoint: list of Point3d; same code as check_same_points
cull_i_8 = CullIndex(List=flatten(flatten_2), Indices=check_same_points_4.specialPt, Wrap=True)
pull_8 = PullPoint(Point=cull_i_8, Geometry=offset_3, ClosestOnly=True)  # -> ClosestPoint, Distance
ln_4 = Line(StartPoint=cull_i_8, EndPoint=pull_8.ClosestPoint)
rotate_3 = Rotate(Geometry=ln_4, Angle="Pi", Plane=cull_i_8)  # -> Geometry, Transform
rotate_4 = Rotate(Geometry=rotate_3.Geometry, Angle=-1.570796327, Plane=cull_i_8)  # -> Geometry, Transform

# ----
# 转角点
data_12 = Data(dispatch_7.ListA)

pull_9 = PullPoint(Point=data_12, Geometry=flatten(offset), ClosestOnly=True)  # -> ClosestPoint, Distance
testpoint = TestPoint(archPoint=pull_9.ClosestPoint, crvPoint=disc_3.Points)  # -> out, specialPt; inputs archPoint: list of Point3d, crvPoint: list of Point3d; same code as check_same_points

# ----
# 找阴阳角所在corners
pull_10 = PullPoint(Point=flatten(pln_9), Geometry=crv_11, ClosestOnly=True)  # -> ClosestPoint, Distance
pull_11 = PullPoint(Point=pull_10.ClosestPoint, Geometry=data_12, ClosestOnly=True)  # -> ClosestPoint, Distance
flatten_3 = FlattenTree(Tree=data_9, Path="{0}")
sort_2 = SortList(Keys=pull_11.Distance, ValuesA=flatten_3)  # -> Keys, ValuesA
# 导入槽埋模型
panel_11 = Panel(sort_2.Keys)
smaller = SmallerThan(FirstNumber=sort_2.Keys, SecondNumber=Slider(100, range=0..100))  # -> SmallerThan, OrEqualTo
dispatch_8 = Dispatch(List=sort_2.ValuesA, DispatchPattern=smaller.SmallerThan)  # -> ListA, ListB
data_13 = Data(dispatch_8.ListA)
deblock_5 = DeconstructBlock(Block=data_13)  # -> Name, Plane, Geometry
deplane_7 = DeconstructPlane(Plane=deblock_5.Plane)  # -> Origin, XAxis, YAxis, ZAxis
pt = Point(data_12)
pull_12 = PullPoint(Point=deplane_7.Origin, Geometry=pt, ClosestOnly=True)  # -> ClosestPoint, Distance
cir = Circle(Plane=pull_12.ClosestPoint, Radius=Slider(300, range=0..1000))
crv_16 = Curve(crv_11)
amp_3 = Amplitude(Vector=deplane_7.YAxis, Amplitude=Slider(200, range=0..1000))
ccx = CurveCurve(CurveA=cir, CurveB=crv_16)  # -> Points, ParamsA, ParamsB
move_3 = Move(Geometry=pull_12.ClosestPoint, Motion=amp_3)  # -> Geometry, Transform
item_5 = ListItem(List=ccx.Points, Index=0, Wrap=True)
clean = CleanTree(RemoveNulls=True, RemoveInvalid=True, RemoveEmpty=Toggle(True), Tree=item_5)
ln_5 = Line(StartPoint=pull_12.ClosestPoint, EndPoint=clean)
ln_6 = Line(StartPoint=pull_12.ClosestPoint, EndPoint=move_3.Geometry)
angle = Angle(VectorA=ln_6, VectorB=ln_5)  # -> Angle, Reflex
deg_2 = Degrees(Radians=angle.Angle)
flatten_4 = FlattenTree(Tree=deg_2, Path="{0}")
panel_12 = Panel(flatten_4)
c_script = CSharpScript(angle=flatten_4, minus=Slider(80, range=0..100))  # -> out, results; inputs angle: list of Double, minus: Double
# ---------- c_script: C# ----------
    List<double> MyAngle = new List<double>();
    for(int i = 0; i < angle.Count; i++){
      if (angle[i] > minus){
        angleEach = angle[i] - 90;
        Print("!!!!!!!!");
        MyAngle.Add(angleEach);
      }
      else{
        angleEach = angle[i];
        Print("00000");
        MyAngle.Add(angleEach);
      }

    }

    results = MyAngle;
# ---------- c_script: C# additional code ----------
  double angleEach = 0;
# ---------- end c_script ----------
larger_3 = LargerThan(FirstNumber=c_script.results, SecondNumber=Slider(30, range=0..100))  # -> LargerThan, OrEqualTo
# hidden lines of top+pers view
panel_13 = Panel(c_script.results)
dispatch_9 = Dispatch(List=flatten(data_13), DispatchPattern=flatten(larger_3.LargerThan))  # -> ListA, ListB
data_14 = Data(dispatch_9.ListA)

# ----
# SmoothCurve-阴角&阳角
# 阳角
item_6 = ListItem(List=data_12, Index=testpoint.specialPt, Wrap=True)

# ----
# 阴角
cull_i_9 = CullIndex(List=data_12, Indices=testpoint.specialPt, Wrap=True)

# ----
# remove duplicate block and reconstruct plane
deblock_6 = DeconstructBlock(Block=data_14)  # -> Name, Plane, Geometry
deplane_8 = DeconstructPlane(Plane=flatten(deblock_6.Plane))  # -> Origin, XAxis, YAxis, ZAxis

# ----
# 第一层
# 
# Block(location point) + Smooth Curves(architecture line)
# For Correct Plane
pln_12 = Plane(flatten(pln_9))
deplane_9 = DeconstructPlane(Plane=pln_12)  # -> Origin, XAxis, YAxis, ZAxis
# move to center
# Rhino 文件中导入的块名
testpoint_2 = TestPoint(archPoint=deplane_9.Origin, crvPoint=deplane_8.Origin)  # -> out, specialPt; inputs archPoint: list of Point3d, crvPoint: list of Point3d; same code as check_same_points
cull_i_10 = CullIndex(List=pln_12, Indices=testpoint_2.specialPt, Wrap=True)
pln_13 = Plane(deblock_6.Plane)
dist = Distance(PointA=graft(deplane_8.Origin), PointB=item_6)
sort_3 = SortList(Keys=dist)  # -> Keys, ValuesA
item_7 = ListItem(List=sort_3.Keys, Index=0, Wrap=True)
flatten_5 = FlattenTree(Tree=item_7, Path="{0}")
smaller_2 = SmallerThan(FirstNumber=item_7, SecondNumber=Slider(100, range=0..300))  # -> SmallerThan, OrEqualTo
panel_14 = Panel(flatten_5)
dispatch_10 = Dispatch(List=graft(pln_13), DispatchPattern=smaller_2.SmallerThan)  # -> ListA, ListB

# ----
# Angular Curve - All
pl_2 = ConstructPlane(Origin=cull_i_8, XAxis=rotate_3.Geometry, YAxis=rotate_4.Geometry)

# ----
# Curve for this project only - All
pl_3 = ConstructPlane(Origin=cull_i_6, XAxis=rotate.Geometry, YAxis=rotate_2.Geometry)

# ----
# 求主体曲线转折点
clscrv_2 = CloseCurve(Curve=crv_5, CloseType=0, Bulge=0.5, Tolerance=0)  # -> Closed, R
crv_17 = Curve(crv_2)
disc_8 = Discontinuity(Curve=graft(crv_17), Level=1)  # -> Points, Parameters
crv_cp_2 = CurveClosestPoint(Point=disc_8.Points, Curve=graft(crv_17))  # -> Point, Parameter, Distance
eval_2 = EvaluateCurve(Curve=graft(crv_17), Parameter=crv_cp_2.Parameter)  # -> flatten(Point), Tangent, flatten(Angle)
deg_3 = Degrees(Radians=eval_2.Angle)
offset_4 = OffsetCurve(Curve=clscrv_2.Closed, Distance=expr("-X", Slider(300, range=0..1000)), Corners=1)
panel_15 = Panel(deg_3)
larger_4 = LargerThan(FirstNumber=deg_3, SecondNumber=Slider(60, range=0..100))  # -> LargerThan, OrEqualTo
disc_9 = Discontinuity(Curve=offset_4, Level=1)  # -> flatten(Points), Parameters
dispatch_11 = Dispatch(List=eval_2.Point, DispatchPattern=larger_4.LargerThan)  # -> ListA, ListB

# ----
# 转角点
data_15 = Data(dispatch_11.ListA)

pull_13 = PullPoint(Point=data_15, Geometry=flatten(offset_4), ClosestOnly=True)  # -> ClosestPoint, Distance
testpoint_3 = TestPoint(archPoint=pull_13.ClosestPoint, crvPoint=disc_9.Points)  # -> out, specialPt; inputs archPoint: list of Point3d, crvPoint: list of Point3d; same code as check_same_points

# ----
# 找阴阳角所在corners
pull_14 = PullPoint(Point=flatten(pln_10), Geometry=crv_17, ClosestOnly=True)  # -> ClosestPoint, Distance
pull_15 = PullPoint(Point=pull_14.ClosestPoint, Geometry=data_15, ClosestOnly=True)  # -> ClosestPoint, Distance
flatten_6 = FlattenTree(Tree=data_10, Path="{0}")
sort_4 = SortList(Keys=pull_15.Distance, ValuesA=flatten_6)  # -> Keys, ValuesA
panel_16 = Panel(sort_4.Keys)
smaller_3 = SmallerThan(FirstNumber=sort_4.Keys, SecondNumber=Slider(100, range=0..100))  # -> SmallerThan, OrEqualTo
dispatch_12 = Dispatch(List=sort_4.ValuesA, DispatchPattern=smaller_3.SmallerThan)  # -> ListA, ListB
data_16 = Data(dispatch_12.ListA)
deblock_7 = DeconstructBlock(Block=data_16)  # -> Name, Plane, Geometry
deplane_10 = DeconstructPlane(Plane=deblock_7.Plane)  # -> Origin, XAxis, YAxis, ZAxis
pt_2 = Point(data_15)
pull_16 = PullPoint(Point=deplane_10.Origin, Geometry=pt_2, ClosestOnly=True)  # -> ClosestPoint, Distance
cir_2 = Circle(Plane=pull_16.ClosestPoint, Radius=Slider(300, range=0..1000))
crv_18 = Curve(crv_17)
amp_4 = Amplitude(Vector=deplane_10.YAxis, Amplitude=Slider(200, range=0..1000))
ccx_2 = CurveCurve(CurveA=cir_2, CurveB=crv_18)  # -> Points, ParamsA, ParamsB
move_4 = Move(Geometry=pull_16.ClosestPoint, Motion=amp_4)  # -> Geometry, Transform
item_8 = ListItem(List=ccx_2.Points, Index=0, Wrap=True)
clean_2 = CleanTree(RemoveNulls=True, RemoveInvalid=True, RemoveEmpty=Toggle(True), Tree=item_8)
ln_7 = Line(StartPoint=pull_16.ClosestPoint, EndPoint=clean_2)
ln_8 = Line(StartPoint=pull_16.ClosestPoint, EndPoint=move_4.Geometry)
angle_2 = Angle(VectorA=ln_8, VectorB=ln_7)  # -> Angle, Reflex
deg_4 = Degrees(Radians=angle_2.Angle)
flatten_7 = FlattenTree(Tree=deg_4, Path="{0}")
panel_17 = Panel(flatten_7)
c_script_2 = CSharpScript(angle=flatten_7, minus=Slider(80, range=0..100))  # -> out, results; inputs angle: list of Double, minus: Double; same code as c_script
larger_5 = LargerThan(FirstNumber=c_script_2.results, SecondNumber=Slider(30, range=0..100))  # -> LargerThan, OrEqualTo
panel_18 = Panel(c_script_2.results)
dispatch_13 = Dispatch(List=flatten(data_16), DispatchPattern=flatten(larger_5.LargerThan))  # -> ListA, ListB
data_17 = Data(dispatch_13.ListA)

# ----
# SmoothCurve-阴角&阳角
# 阳角
item_9 = ListItem(List=data_15, Index=testpoint_3.specialPt, Wrap=True)

# ----
# 阴角
cull_i_11 = CullIndex(List=data_15, Indices=testpoint_3.specialPt, Wrap=True)

# ----
# remove duplicate block and reconstruct plane
deblock_8 = DeconstructBlock(Block=data_17)  # -> Name, Plane, Geometry
deplane_11 = DeconstructPlane(Plane=flatten(deblock_8.Plane))  # -> Origin, XAxis, YAxis, ZAxis

# ----
# 第一层
# 
# Block(location point) + Smooth Curves(architecture line)
# 
# For Wrong Plane
pln_14 = Plane(flatten(pln_10))
deplane_12 = DeconstructPlane(Plane=pln_14)  # -> Origin, XAxis, YAxis, ZAxis
testpoint_4 = TestPoint(archPoint=deplane_12.Origin, crvPoint=deplane_11.Origin)  # -> out, specialPt; inputs archPoint: list of Point3d, crvPoint: list of Point3d; same code as check_same_points
cull_i_12 = CullIndex(List=pln_14, Indices=testpoint_4.specialPt, Wrap=True)
pln_15 = Plane(deblock_8.Plane)
dist_2 = Distance(PointA=graft(deplane_11.Origin), PointB=item_9)
sort_5 = SortList(Keys=dist_2)  # -> Keys, ValuesA
item_10 = ListItem(List=sort_5.Keys, Index=0, Wrap=True)
flatten_8 = FlattenTree(Tree=item_10, Path="{0}")
smaller_4 = SmallerThan(FirstNumber=item_10, SecondNumber=Slider(100, range=0..300))  # -> SmallerThan, OrEqualTo
panel_19 = Panel(flatten_8)
dispatch_14 = Dispatch(List=graft(pln_15), DispatchPattern=smaller_4.SmallerThan)  # -> ListA, ListB

crv_19 = Curve(crv_2)
crv_20 = Curve(crv_2)
pln_16 = Plane(cull_i_10)
crv_21 = Curve(crv_2)
pln_17 = Plane(cull_i_12)

data_18 = Data(flatten(dispatch_10.ListA))
deplane_13 = DeconstructPlane(Plane=data_18)  # -> Origin, XAxis, YAxis, ZAxis
amp_5 = Amplitude(Vector=deplane_13.YAxis, Amplitude=Slider(300, range=0..1000))
move_5 = Move(Geometry=deplane_13.Origin, Motion=amp_5)  # -> Geometry, Transform
ln_9 = Line(StartPoint=deplane_13.Origin, EndPoint=move_5.Geometry)
midpt_3 = CurveMiddle(Curve=ln_9)
scale_3 = Scale(Geometry=ln_9, Center=midpt_3, Factor=Slider(1.5, range=0..10))  # -> Geometry, Transform
ccx_3 = CurveCurve(CurveA=graft(scale_3.Geometry), CurveB=crv_20)  # -> flatten(Points), ParamsA, ParamsB

data_19 = Data(flatten(dispatch_10.ListB))
deplane_14 = DeconstructPlane(Plane=data_19)  # -> Origin, XAxis, YAxis, ZAxis
amp_6 = Amplitude(Vector=deplane_14.YAxis, Amplitude=Slider(300, range=0..1000))
move_6 = Move(Geometry=deplane_14.Origin, Motion=amp_6)  # -> Geometry, Transform
ln_10 = Line(StartPoint=deplane_14.Origin, EndPoint=move_6.Geometry)
midpt_4 = CurveMiddle(Curve=ln_10)
scale_4 = Scale(Geometry=ln_10, Center=midpt_4, Factor=Slider(1.5, range=0..10))  # -> Geometry, Transform
ccx_4 = CurveCurve(CurveA=graft(scale_4.Geometry), CurveB=crv_20)  # -> flatten(Points), ParamsA, ParamsB

data_20 = Data(flatten(pln_16))
deplane_15 = DeconstructPlane(Plane=data_20)  # -> Origin, XAxis, YAxis, ZAxis
amp_7 = Amplitude(Vector=deplane_15.YAxis, Amplitude=Slider(300, range=0..1000))
move_7 = Move(Geometry=deplane_15.Origin, Motion=amp_7)  # -> Geometry, Transform
ln_11 = Line(StartPoint=deplane_15.Origin, EndPoint=move_7.Geometry)
midpt_5 = CurveMiddle(Curve=ln_11)
scale_5 = Scale(Geometry=ln_11, Center=midpt_5, Factor=Slider(4.7, range=0..10))  # -> Geometry, Transform
ccx_5 = CurveCurve(CurveA=graft(scale_5.Geometry), CurveB=crv_20)  # -> flatten(Points), ParamsA, ParamsB

data_21 = Data(flatten(dispatch_14.ListA))
deplane_16 = DeconstructPlane(Plane=data_21)  # -> Origin, XAxis, YAxis, ZAxis
amp_8 = Amplitude(Vector=deplane_16.YAxis, Amplitude=Slider(300, range=0..1000))
move_8 = Move(Geometry=deplane_16.Origin, Motion=amp_8)  # -> Geometry, Transform
ln_12 = Line(StartPoint=deplane_16.Origin, EndPoint=move_8.Geometry)
midpt_6 = CurveMiddle(Curve=ln_12)
scale_6 = Scale(Geometry=ln_12, Center=midpt_6, Factor=Slider(1.5, range=0..10))  # -> Geometry, Transform
ccx_6 = CurveCurve(CurveA=graft(scale_6.Geometry), CurveB=crv_21)  # -> flatten(Points), ParamsA, ParamsB

data_22 = Data(flatten(dispatch_14.ListB))
deplane_17 = DeconstructPlane(Plane=data_22)  # -> Origin, XAxis, YAxis, ZAxis
amp_9 = Amplitude(Vector=deplane_17.YAxis, Amplitude=Slider(300, range=0..1000))
move_9 = Move(Geometry=deplane_17.Origin, Motion=amp_9)  # -> Geometry, Transform
ln_13 = Line(StartPoint=deplane_17.Origin, EndPoint=move_9.Geometry)
midpt_7 = CurveMiddle(Curve=ln_13)
scale_7 = Scale(Geometry=ln_13, Center=midpt_7, Factor=Slider(1.5, range=0..10))  # -> Geometry, Transform
ccx_7 = CurveCurve(CurveA=graft(scale_7.Geometry), CurveB=crv_21)  # -> flatten(Points), ParamsA, ParamsB

data_23 = Data(flatten(pln_17))
deplane_18 = DeconstructPlane(Plane=data_23)  # -> Origin, XAxis, YAxis, ZAxis
amp_10 = Amplitude(Vector=deplane_18.YAxis, Amplitude=Slider(300, range=0..1000))
move_10 = Move(Geometry=deplane_18.Origin, Motion=amp_10)  # -> Geometry, Transform
ln_14 = Line(StartPoint=deplane_18.Origin, EndPoint=move_10.Geometry)
midpt_8 = CurveMiddle(Curve=ln_14)
scale_8 = Scale(Geometry=ln_14, Center=midpt_8, Factor=Slider(4.7, range=0..10))  # -> Geometry, Transform
ccx_8 = CurveCurve(CurveA=graft(scale_8.Geometry), CurveB=crv_21)  # -> flatten(Points), ParamsA, ParamsB

move2pt = MoveToPoint(Geometry=data_23, PointA=deplane_18.Origin, PointB=ccx_8.Points)  # -> Moved, Vector, Transform
move2pt_2 = MoveToPoint(Geometry=data_21, PointA=deplane_16.Origin, PointB=ccx_6.Points)  # -> Moved, Vector, Transform
move2pt_3 = MoveToPoint(Geometry=data_22, PointA=deplane_17.Origin, PointB=ccx_7.Points)  # -> Moved, Vector, Transform
xy_10 = XYPlane(Origin=move2pt.Moved)
xy_11 = XYPlane(Origin=move2pt_2.Moved)
xy_12 = XYPlane(Origin=move2pt_3.Moved)
rotate_5 = Rotate(Geometry=move2pt.Moved, Angle="Pi", Plane=xy_10)  # -> Geometry, Transform
rotate_6 = Rotate(Geometry=move2pt_2.Moved, Angle="Pi", Plane=xy_11)  # -> Geometry, Transform
rotate_7 = Rotate(Geometry=move2pt_3.Moved, Angle="Pi", Plane=xy_12)  # -> Geometry, Transform

# ----
# SmoothCurve-正常
toggle = BooleanToggle(True)
filter = StreamFilter(Gate=toggle, Stream0=move2pt.Moved, Stream1=rotate_5.Geometry)

# ----
# SmoothCurve-阳角
toggle_2 = BooleanToggle(True)
filter_2 = StreamFilter(Gate=toggle_2, Stream0=move2pt_2.Moved, Stream1=rotate_6.Geometry)

# ----
# SmoothCurve-阴角
toggle_3 = BooleanToggle(True)
filter_3 = StreamFilter(Gate=toggle_3, Stream0=move2pt_3.Moved, Stream1=rotate_7.Geometry)

# ----
# 这里如果跑红也不要紧，
# 说明单体没有出现相撞的情况
# SmoothCurve-正常
move2pt_4 = MoveToPoint(Geometry=data_20, PointA=deplane_15.Origin, PointB=ccx_5.Points)  # -> Moved, Vector, Transform

# ----
# SmoothCurve-阳角
move2pt_5 = MoveToPoint(Geometry=data_18, PointA=deplane_13.Origin, PointB=ccx_3.Points)  # -> Moved, Vector, Transform

# ----
# SmoothCurve-阴角
move2pt_6 = MoveToPoint(Geometry=data_19, PointA=deplane_14.Origin, PointB=ccx_4.Points)  # -> Moved, Vector, Transform

# ----
# 第一层
# 
# Curves(location point)+ Smooth Curves(architecture line)
# 第二层-大面定位
area_2 = Area(Geometry=geo_2)  # -> Area, Centroid
pull_17 = PullPoint(Point=area_2.Centroid, Geometry=crv_19, ClosestOnly=True)  # -> ClosestPoint, Distance
dist_3 = Distance(PointA=pull_17.ClosestPoint, PointB=data_12)
sort_6 = SortList(Keys=dist_3)  # -> Keys, ValuesA
panel_20 = Panel(sort_6.Keys)
smaller_5 = SmallerThan(FirstNumber=dist_3, SecondNumber=Slider(200, range=0..1000))  # -> SmallerThan, OrEqualTo
dispatch_15 = Dispatch(List=geo_2, DispatchPattern=smaller_5.SmallerThan)  # -> ListA, ListB
data_24 = Data(dispatch_15.ListB)
explode = Explode(Curve=data_24, Recursive=True)  # -> Segments, Vertices
len = Length(Curve=explode.Segments)
sort_7 = SortList(Keys=reverse(len), ValuesA=explode.Segments)  # -> Keys, ValuesA
item_11 = ListItem(List=sort_7.ValuesA, Index=0, Wrap=True)  # -> flatten(Item)
area_3 = Area(Geometry=data_24)  # -> Area, Centroid
midpt_9 = CurveMiddle(Curve=item_11)
move2pt_7 = MoveToPoint(Geometry=item_11, PointA=midpt_9, PointB=area_3.Centroid)  # -> Moved, Vector, Transform
end_3 = EndPoints(Curve=move2pt_7.Moved)  # -> Start, End
pull_18 = PullPoint(Point=end_3.Start, Geometry=crv_19, ClosestOnly=True)  # -> ClosestPoint, Distance
neg = Negative(Value="1.5 * Pi")
crv_cp_3 = CurveClosestPoint(Point=graft(pull_18.ClosestPoint), Curve=crv_19)  # -> Point, Parameter, Distance
filter_4 = StreamFilter(Gate=Toggle(True), Stream0="1.5 * Pi", Stream1=neg)
eval_3 = EvaluateCurve(Curve=crv_19, Parameter=crv_cp_3.Parameter)  # -> Point, Tangent, Angle
pull_19 = PullPoint(Point=eval_3.Point, Geometry=pull_18.ClosestPoint, ClosestOnly=True)  # -> ClosestPoint, Distance
sort_8 = SortList(Keys=pull_19.Distance, ValuesA=eval_3.Point)  # -> Keys, ValuesA
sort_9 = SortList(Keys=pull_19.Distance, ValuesA=eval_3.Tangent)  # -> Keys, ValuesA
item_12 = ListItem(List=sort_9.ValuesA, Index="0", Wrap=True)
item_13 = ListItem(List=sort_8.ValuesA, Index="0", Wrap=True)
amp_11 = Amplitude(Vector=item_12, Amplitude=Slider(100, range=0..100))
move_11 = Move(Geometry=item_13, Motion=amp_11)  # -> Geometry, Transform
xy_13 = XYPlane(Origin=item_13)
rotate_8 = Rotate(Geometry=move_11.Geometry, Angle="1 * Pi", Plane=xy_13)  # -> Geometry, Transform
ln_15 = Line(StartPoint=item_13, EndPoint=rotate_8.Geometry)
crv_22 = Curve(crv_2)
rotate_9 = Rotate(Geometry=ln_15, Angle=filter_4, Plane=xy_13)  # -> Geometry, Transform

# ----
# 第二层-阴阳角
data_25 = Data(dispatch_15.ListA)
explode_2 = Explode(Curve=data_25, Recursive=True)  # -> Segments, Vertices
len_2 = Length(Curve=explode_2.Segments)
sort_10 = SortList(Keys=reverse(len_2), ValuesA=explode_2.Segments)  # -> Keys, ValuesA
item_14 = ListItem(List=sort_10.ValuesA, Index=0, Wrap=True)  # -> flatten(Item)
area_4 = Area(Geometry=data_25)  # -> Area, Centroid
midpt_10 = CurveMiddle(Curve=item_14)
move2pt_8 = MoveToPoint(Geometry=item_14, PointA=midpt_10, PointB=area_4.Centroid)  # -> Moved, Vector, Transform
end_4 = EndPoints(Curve=move2pt_8.Moved)  # -> Start, End
ln_16 = Line(StartPoint=end_4.Start, EndPoint=end_4.End)
neg_2 = Negative(Value="0.5 * Pi")
filter_5 = StreamFilter(Gate=Toggle(True), Stream0="0.5 * Pi", Stream1=neg_2)
xy_14 = XYPlane(Origin=end_4.End)
rotate_10 = Rotate(Geometry=ln_16, Angle=filter_5, Plane=xy_14)  # -> Geometry, Transform
pl_4 = ConstructPlane(Origin=end_4.End, XAxis=rotate_10.Geometry, YAxis=ln_16)

dist_4 = Distance(PointA=graft(end_4.End), PointB=item_6)
sort_11 = SortList(Keys=dist_4)  # -> Keys, ValuesA
item_15 = ListItem(List=sort_11.Keys, Index=0, Wrap=True)
smaller_6 = SmallerThan(FirstNumber=item_15, SecondNumber=Slider(100, range=0..300))  # -> SmallerThan, OrEqualTo
flatten_9 = FlattenTree(Tree=item_15, Path="{0}")
dispatch_16 = Dispatch(List=graft(pl_4), DispatchPattern=smaller_6.SmallerThan)  # -> ListA, ListB
panel_21 = Panel(flatten_9)

data_26 = Data(flatten(dispatch_16.ListA))
deplane_19 = DeconstructPlane(Plane=data_26)  # -> Origin, XAxis, YAxis, ZAxis
amp_12 = Amplitude(Vector=deplane_19.YAxis, Amplitude=Slider(300, range=0..1000))
move_12 = Move(Geometry=deplane_19.Origin, Motion=amp_12)  # -> Geometry, Transform
ln_17 = Line(StartPoint=deplane_19.Origin, EndPoint=move_12.Geometry)
midpt_11 = CurveMiddle(Curve=ln_17)
scale_9 = Scale(Geometry=ln_17, Center=midpt_11, Factor=Slider(1.5, range=0..10))  # -> Geometry, Transform
ccx_9 = CurveCurve(CurveA=graft(scale_9.Geometry), CurveB=crv_22)  # -> flatten(Points), ParamsA, ParamsB

data_27 = Data(flatten(dispatch_16.ListB))
deplane_20 = DeconstructPlane(Plane=data_27)  # -> Origin, XAxis, YAxis, ZAxis
amp_13 = Amplitude(Vector=deplane_20.YAxis, Amplitude=Slider(300, range=0..1000))
move_13 = Move(Geometry=deplane_20.Origin, Motion=amp_13)  # -> Geometry, Transform
ln_18 = Line(StartPoint=deplane_20.Origin, EndPoint=move_13.Geometry)
midpt_12 = CurveMiddle(Curve=ln_18)
scale_10 = Scale(Geometry=ln_18, Center=midpt_12, Factor=Slider(1.5, range=0..10))  # -> Geometry, Transform
ccx_10 = CurveCurve(CurveA=graft(scale_10.Geometry), CurveB=crv_22)  # -> flatten(Points), ParamsA, ParamsB

# ----
# SmoothCurve-阳角
move2pt_9 = MoveToPoint(Geometry=data_26, PointA=deplane_19.Origin, PointB=ccx_9.Points)  # -> Moved, Vector, Transform

# ----
# SmoothCurve-阴角
move2pt_10 = MoveToPoint(Geometry=data_27, PointA=deplane_20.Origin, PointB=ccx_10.Points)  # -> Moved, Vector, Transform

# ----
# SmoothCurve-正常
pl_5 = ConstructPlane(Origin=move_11.Geometry, XAxis=ln_15, YAxis=rotate_9.Geometry)

# ----
# Sort Text
# 1.2.1梁以内>350
# 
# 侧埋，钢板焊
# 1.2.2
# 下层建筑边线外侧50-350mm
# 03：钢板焊埋件[钢梁内侧]
# @钢边梁宽@钢边梁高
# 1.2.3
# 下层建筑边线内侧300-600mm范围
# 03：钢板焊埋件[钢梁外侧]
# @钢边梁宽@钢边梁高
# 3.3上层建筑边线,
# 默认建筑提供上翻
# 04：板埋埋件[混凝土楼板上侧]@板埋参数xn
# 3.2默认位置为建筑边线向内300mm
# 侧埋，钢板焊
# 03：钢板焊埋件[钢梁外侧]@钢边梁宽@钢边梁高
# 3.1下层建筑内侧到300到外侧50内
# 底埋，钢板焊
# 内测梁边线
# 2.1下层建筑边线外侧50-350mm范围内
# 做吊顶，不处理？？
# remove wrong lines
# 3.1下层建筑内侧到300到外侧50内是否有钢结构
# 下层建筑内侧到300到外侧50内
# 有钢结构
# 3.2下层建筑内侧到300到外侧50内
# 无钢结构
# 要求主体结构提供钢结构梁，默认位置为建筑边线向内300mm
# 同时满足N
# 3.3上层建筑边线,
# 默认建筑提供上翻，如主结构提供示意则使用结构定位【该项目无】，
# 如无则使用建筑边线向内50mm作为埋件定位
# 2.2下层建筑边线内侧300-600mm范围内
# 不同时满足N
# remove wrong lines
merge_5 = Merge(
    Data1=move2pt_4.Moved,
    Data2=move2pt_5.Moved,
    Data3=move2pt_6.Moved,
    Data4=filter,
    Data5=filter_2,
    Data6=filter_3,
    Data7=move2pt_9.Moved,
    Data8=move2pt_10.Moved,
    Data9=pl_5,
    Data10=pl_2,
    Data11=pl,
    Data12=pl_3)  # -> flatten(Result)
