# Grasshopper definition FacadeEmbed_jinqiao - Copy.gh (Grasshopper 1.0.7)
# plug-ins: EleFront, Hare

# ---- group: 锚筋间距
s_x = Slider(25, range=14..60, expression="X*5")
s_y = Slider(20, range=14..60, expression="X*5")

s_x_2 = Slider(25, range=14..60, expression="X*5")
s_y_2 = Slider(20, range=14..60, expression="X*5")

# ---- group: 螺栓直径
list = ValueList({"10": 0, "12": 1, "16": 2, "18": 3, "20": 4, "25": 5}, selected="16")

# ---- group: 锚筋直径
list_2 = ValueList({"10": 0, "12": 1, "16": 2, "18": 3, "20": 4, "25": 5}, selected="12")

# ---- group: 列
list_3 = ValueList({"2X": 0, "3X": 1, "4X": 2}, selected="3X")

# ---- group: 行
list_4 = ValueList({"2Y": 0, "3Y": 1, "4Y": 2}, selected="2Y")

# ----
锚筋末端焊板厚度 = Slider(12, range=0..100)
锚筋长度 = Slider(12, range=0..30, expression="x*10")
锚筋末端焊板边长 = Slider(40, range=0..100)
锚板厚度 = Slider(12, range=0..100)
槽长 = Slider(270, range=0..1000)
value_list = ValueList({"锚筋": 0, "锚焊": 1}, selected="锚焊")
锚筋到边 = Panel("75")
curve = Curve(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)
subtraction = Subtraction(A=锚筋长度, B=锚板厚度)
filter = StreamFilter(Gate=list_2, Stream0=10, Stream1=12, Stream2=16, Stream3=18, Stream4=20, Stream5=25)
filter_2 = StreamFilter(Gate=list, Stream0=10, Stream1=12, Stream2=16, Stream3=18, Stream4=20, Stream5=25)
addition = Addition(A=list_4, B=1)
addition_2 = Addition(A=list_3, B=1)

# ---- group: 螺栓直径
list_5 = ValueList({"10": 0, "12": 1, "16": 2, "18": 3, "20": 4, "25": 5}, selected="16")

# ---- group: 锚筋直径
list_6 = ValueList({"10": 0, "12": 1, "16": 2, "18": 3, "20": 4, "25": 5}, selected="12")

# ---- group: 列
list_7 = ValueList({"2X": 0, "3X": 1, "4X": 2}, selected="3X")

# ---- group: 行
list_8 = ValueList({"2Y": 0, "3Y": 1, "4Y": 2}, selected="2Y")

# ----
锚筋末端焊板厚度_2 = Slider(12, range=0..100)
锚筋长度_2 = Slider(12, range=0..30, expression="x*10")
锚筋末端焊板边长_2 = Slider(40, range=0..100)
锚板厚度_2 = Slider(12, range=0..100)
板凳厚度 = Slider(16, range=0..100)
槽长_2 = Slider(270, range=0..1000)
value_list_2 = ValueList({"锚筋": 0, "锚焊": 1}, selected="锚焊")
锚筋到边_2 = Panel("75")
list_9 = ValueList({"板埋": 0, "槽埋": 1}, selected="板埋")
list_10 = ValueList({"顶埋": 0, "侧埋": 1}, selected="顶埋")
curve_2 = Curve(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)
subtraction_2 = Subtraction(A=锚筋长度_2, B=锚板厚度_2)
filter_3 = StreamFilter(Gate=list_6, Stream0=10, Stream1=12, Stream2=16, Stream3=18, Stream4=20, Stream5=25)
filter_4 = StreamFilter(Gate=list_5, Stream0=10, Stream1=12, Stream2=16, Stream3=18, Stream4=20, Stream5=25)
addition_3 = Addition(A=list_8, B=1)
addition_4 = Addition(A=list_7, B=1)

# ---- group: 混凝土
# 板埋几何INPUT
list_11 = ValueList({"C15": 0, "C20": 1, "C25": 2, "C30": 3, "C35": 4, "C40": 5}, selected="C35")

# ---- group: 钢筋牌号
list_12 = ValueList({"HPB300": 0, "HRB400": 1}, selected="HPB300")

# ---- group: 直径
list_13 = ValueList({"10": 0, "12": 1, "16": 2, "18": 3, "20": 4, "25": 5}, selected="12")

# ---- group: 列
list_14 = ValueList({"2X": 0, "3X": 1, "4X": 2}, selected="3X")

# ---- group: 行
list_15 = ValueList({"2Y": 0, "3Y": 1, "4Y": 2}, selected="2Y")

# ---- group: 锚筋间距
s_x_3 = Slider(22, range=14..60, expression="X*5")
s_y_3 = Slider(22, range=14..60, expression="X*5")

# ----
max = Maximum(A=s_x_3, B=s_y_3)
filter_5 = StreamFilter(Gate=list_11, Stream0=7.2, Stream1=9.6, Stream2=11.9, Stream3=14.3, Stream4=16.7, Stream5=19.1)
filter_6 = StreamFilter(Gate=list_12, Stream0=270, Stream1=360)
filter_7 = StreamFilter(Gate=list_13, Stream0=10, Stream1=12, Stream2=16, Stream3=18, Stream4=20, Stream5=25)
filter_8 = StreamFilter(Gate=list_11, Stream0=0.91, Stream1=1.1, Stream2=1.27, Stream3=1.43, Stream4=1.57, Stream5=1.71)
filter_9 = StreamFilter(Gate=list_12, Stream0=0.16, Stream1=0.14)
addition_5 = Addition(A=list_14, B=1)
addition_6 = Addition(A=list_15, B=1)
division = Division(A=max, B=8)
t = Integer(division)
panel = Panel(filter_8)
panel_2 = Panel(filter_5)
panel_3 = Panel(filter_9)
min = Minimum(A=filter_6, B=300)
panel_4 = Panel(min)

yz_plane = YZPlane(Origin=Point(0, 0, 0))
orient = Orient(Geometry=curve, Source=PlaneXY(0, 0, 0), Target=yz_plane)  # -> Geometry, Transform
unit_x = UnitX(Factor=槽长)
division_2 = Division(A=槽长, B=2)
extrude = Extrude(Base=orient.Geometry, Direction=unit_x)
unit_x_2 = UnitX(Factor=division_2)
move = Move(Geometry=extrude, Motion=expr("-x", unit_x_2))  # -> Geometry, Transform
cap_holes = CapHoles(Brep=move.Geometry)

expression = Expression(A=filter_9, fy=filter_6, ft=filter_8, d=filter_7, Expression="(int((0.6*1.1*A*fy/ft*d)/5)+1)*5")

# ----
# 导入槽埋模型
brep = Brep(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)  # disabled

# ----
# 槽埋Modeling
brep_2 = Brep(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)  # disabled
bbox = BoundingBox(Content=brep, Plane=PlaneXY(0, 0, 0))  # -> Box, Box_2; disabled
debox = DeconstructBox(Box=bbox.Box)  # -> Plane, X, Y, Z; disabled
area = Area(Geometry=brep)  # -> Area, Centroid; disabled
edges = BrepEdges(Brep=bbox.Box)  # -> Naked, Interior, NonManifold; disabled
panel_5 = Panel("5")  # disabled
panel_6 = Panel("4")  # disabled
item = ListItem(List=edges.Interior, Index=panel_5, Wrap=True)  # disabled
item_2 = ListItem(List=edges.Interior, Index=panel_6, Wrap=True)  # disabled
pdecon = Deconstruct(Point=area.Centroid)  # -> XComponent, YComponent, ZComponent; disabled
dedomain = DeconstructDomain(Domain=debox.Z)  # -> Start, End; disabled
clx = CurveLine(Curve=item_2, Line=item)  # -> Points, Params, Count; disabled
Y = UnitY(Factor=item)  # disabled
xy = XYPlane(Origin=Point(0, 0, 0))  # disabled
pt = ConstructPoint(XCoordinate=pdecon.XComponent, YCoordinate=pdecon.YComponent, ZCoordinate=dedomain.End)  # disabled
rotate = Rotate(Geometry=brep, Angle=1.570796327, Plane=clx.Points)  # -> Geometry, Transform; disabled
move_2 = Move(Geometry=rotate.Geometry, Motion=Y)  # -> Geometry, Transform; disabled
pl_origin = PlaneOrigin(Base=xy, Origin=pt)  # disabled
merge = Merge(Data1=brep, Data2=move_2.Geometry)  # -> flatten(Result); disabled
sunion = SolidUnion(Breps=merge)  # disabled
bbox_2 = BoundingBox(Content=sunion, Plane=PlaneXY(0, 0, 0))  # -> Box, Box_2; disabled
area_2 = Area(Geometry=sunion)  # -> Area, Centroid; disabled
xy_2 = XYPlane(Origin=Point(0, 0, 0))  # disabled
debox_2 = DeconstructBox(Box=bbox_2.Box)  # -> Plane, X, Y, Z; disabled
pdecon_2 = Deconstruct(Point=area_2.Centroid)  # -> XComponent, YComponent, ZComponent; disabled
orient_2 = Orient(Geometry=brep, Source=pl_origin, Target=xy_2)  # -> Geometry, Transform; disabled
dedomain_2 = DeconstructDomain(Domain=debox_2.Z)  # -> Start, End; disabled
pt_2 = ConstructPoint(XCoordinate=pdecon_2.XComponent, YCoordinate=pdecon_2.YComponent, ZCoordinate=dedomain_2.End)  # disabled
xy_3 = XYPlane(Origin=Point(0, 0, 0))  # disabled
pl_origin_2 = PlaneOrigin(Base=xy_3, Origin=pt_2)  # disabled
xy_4 = XYPlane(Origin=Point(0, 0, 0))  # disabled
orient_3 = Orient(Geometry=sunion, Source=pl_origin_2, Target=xy_4)  # -> Geometry, Transform; disabled

filter_10 = StreamFilter(Gate=0, Stream0=orient_3.Geometry, Stream1=orient_2.Geometry)  # disabled
entwine = Entwine(Branch00=orient_2.Geometry, Branch01=filter_10, FlattenInputs=True)  # disabled
# 如果无法完整的生成埋件的三视图，
# 建议选择埋件的3D在Rhino中将
# Top/Perspective/Front/Right 试图缩放至合适大小后重新运行
panel_7 = Panel("""Top
Perspective
Front
Right""")
m2d_rhino = Make2DRhinoView(Name=panel_7, Clip=True)
# 三视图
number_slider = Slider(1, range=0..10)
pt_3 = Point(Point(957.9296072, 367.7685097, 0))
pt_4 = Point("0,0,0")
recgrid = Rectangular(
    Plane=pt_3,
    SizeX=Slider(12, range=1..20, expression="X*50"),
    SizeY=Slider(10, range=1..20, expression="X*50"),
    ExtentX=Slider(3, range=0..10),
    ExtentY=Slider(3, range=0..10))  # -> Cells, Points

# ---- group: 结构线
crv = Curve(<curve referenced from the Rhino model>)

# ----
# 平面定位INPUT
number_slider_2 = Slider(341, range=0..1000)

# ----
# beam lines
crv_2 = Curve(<curve referenced from the Rhino model>)

flatten = FlattenTree(Tree=recgrid.Points, Path="{0}")

# ----
# arch lines
crv_3 = Curve(<curve referenced from the Rhino model>)

flip = FlipCurve(Curve=crv_2)  # -> Curve, Flag
filter_11 = StreamFilter(Gate=Toggle(False), Stream0=crv_2, Stream1=flip.Curve)
offset = OffsetCurve(Curve=filter_11, Distance=Slider(100, range=0..100), Corners=1)
disc = Discontinuity(Curve=offset, Level=1)  # -> Points, Parameters

panel_8 = Panel("""false
false
true
false""")
panel_9 = Panel("""true
false
false
false""")
panel_10 = Panel("""false
false
false
true""")
disc_2 = Discontinuity(Curve=crv_3, Level=1)  # -> Points, Parameters
flip_2 = FlipCurve(Curve=crv_3)  # -> Curve, Flag
filter_12 = StreamFilter(Gate=Toggle(False), Stream0=crv_3, Stream1=flip_2.Curve)
pull = PullPoint(Point=disc_2.Points, Geometry=disc.Points, ClosestOnly=True)  # -> ClosestPoint, Distance
entwine_2 = Entwine(Branch00=pull.ClosestPoint, Branch01=disc_2.Points, FlattenInputs=True)
offset_2 = OffsetCurve(Curve=filter_12, Distance=expr("-x", number_slider_2), Corners=1)
flip_3 = FlipMatrix(Data=entwine_2)
crv_4 = Curve(offset_2)
item_3 = ListItem(List=flip_3, Index="0", Wrap=True)  # -> flatten(Item)
item_4 = ListItem(List=flip_3, Index="1", Wrap=True)  # -> flatten(Item)

# ---- group: Arch Points
pt_5 = Point(item_4)

# ----
disc_3 = Discontinuity(Curve=crv_4, Level=1)  # -> Points, Parameters
crv_cp = CurveClosestPoint(Point=pt_5, Curve=crv_4)  # -> Point, Parameter, Distance
c_script = CSharpScript(archPoint=crv_cp.Point, crvPoint=disc_3.Points)  # -> out, specialPt; inputs archPoint: list of Point3d, crvPoint: list of Point3d
# ---------- c_script: C# ----------
    List<int> passIndex = new List<int>();

    for(int i = 0; i < archPoint.Count; i++){
      foreach(Point3d t in crvPoint){
        if(archPoint[i].X == t.X && archPoint[i].Y == t.Y && archPoint[i].Z == t.Z){
          Print("pass");
          passIndex.Add(i);}
      }
    }

    specialPt = passIndex;
# ---------- end c_script ----------
item_5 = ListItem(List=pt_5, Index=c_script.specialPt, Wrap=True)
item_6 = ListItem(List=item_3, Index=c_script.specialPt, Wrap=True)
cull_i = CullIndex(List=pt_5, Indices=c_script.specialPt, Wrap=True)
cull_i_2 = CullIndex(List=item_3, Indices=c_script.specialPt, Wrap=True)
item_7 = ListItem(List=pt_5, Index=c_script.specialPt, Wrap=True)

# ---- group: Block
panel_11 = Panel("embed1")
layer = DefineLayer(Name="Embeded::Embeded", Color=ColourSwatch(SwatchColor=RGB(255, 0, 0)))
attributes = DefineObjectAttributes(Layer=layer)

# ----
# board lines
crv_5 = Curve(<curve referenced from the Rhino model>)

shift = ShiftList(List=item_5, Shift="1", Wrap=True)
panel_12 = Panel("1")
pt_6 = Point(graft(item_5))
pt_7 = Point(graft(shift))
pt_8 = Point(graft(cull_i))
panel_13 = Panel("""0
-1""")
disc_4 = Discontinuity(Curve=crv_5, Level=1)  # -> Points, Parameters
pt_9 = Point(item_3)
cull_i_3 = CullIndex(List=disc_4.Points, Indices=panel_13, Wrap=True)
ln = Line(StartPoint=pt_7, EndPoint=pt_8)
ln_2 = Line(StartPoint=pt_6, EndPoint=pt_8)
pull_2 = PullPoint(Point=pt_9, Geometry=cull_i_3, ClosestOnly=True)  # -> ClosestPoint, Distance
angle = Angle(VectorA=ln, VectorB=ln_2)  # -> flatten(Angle), Reflex
larger = LargerThan(FirstNumber=pull_2.Distance, SecondNumber=Slider(1, range=0..10))  # -> LargerThan, OrEqualTo
deg = Degrees(Radians=angle.Angle)
dispatch = Dispatch(List=pt_9, DispatchPattern=larger.LargerThan)  # -> ListA, ListB
pt_10 = Point(dispatch.ListA)
pt_11 = Point(dispatch.ListB)
larger_2 = LargerThan(FirstNumber=deg, SecondNumber="96")  # -> LargerThan, OrEqualTo
dispatch_2 = Dispatch(List=flatten(cull_i_2), DispatchPattern=larger_2.LargerThan)  # -> ListA, ListB
dispatch_3 = Dispatch(List=flatten(pt_8), DispatchPattern=larger_2.LargerThan)  # -> ListA, ListB

pt_12 = Point(item_6)
pt_13 = Point(dispatch_2.ListA)
pt_14 = Point(dispatch_2.ListB)

pt_15 = Point(item_7)
pt_16 = Point(dispatch_3.ListA)
pt_17 = Point(dispatch_3.ListB)

c_script_2 = CSharpScript(archPoint=pt_10, crvPoint=pt_13)  # -> out, specialPt; inputs archPoint: list of Point3d, crvPoint: list of Point3d; same code as c_script
c_script_3 = CSharpScript(archPoint=pt_10, crvPoint=pt_14)  # -> out, specialPt; inputs archPoint: list of Point3d, crvPoint: list of Point3d; same code as c_script
c_script_4 = CSharpScript(archPoint=pt_10, crvPoint=pt_12)  # -> out, specialPt; inputs archPoint: list of Point3d, crvPoint: list of Point3d; same code as c_script
c_script_5 = CSharpScript(archPoint=pt_11, crvPoint=pt_12)  # -> out, specialPt; inputs archPoint: list of Point3d, crvPoint: list of Point3d; same code as c_script
c_script_6 = CSharpScript(archPoint=pt_11, crvPoint=pt_13)  # -> out, specialPt; inputs archPoint: list of Point3d, crvPoint: list of Point3d; same code as c_script
c_script_7 = CSharpScript(archPoint=pt_11, crvPoint=pt_14)  # -> out, specialPt; inputs archPoint: list of Point3d, crvPoint: list of Point3d; same code as c_script

item_8 = ListItem(List=pt_10, Index=c_script_2.specialPt, Wrap=True)
item_9 = ListItem(List=pt_10, Index=c_script_3.specialPt, Wrap=True)
item_10 = ListItem(List=pt_10, Index=c_script_4.specialPt, Wrap=True)  # -> graft(Item)

item_11 = ListItem(List=pt_11, Index=c_script_5.specialPt, Wrap=True)  # -> graft(Item)
item_12 = ListItem(List=pt_11, Index=c_script_6.specialPt, Wrap=True)
item_13 = ListItem(List=pt_11, Index=c_script_7.specialPt, Wrap=True)

panel_14 = Panel("""0
-1""")
item_14 = ListItem(List=pt_9, Index=panel_14, Wrap=True)
cull_i_4 = CullIndex(List=pt_9, Indices=panel_14, Wrap=True)
dispatch_4 = Dispatch(List=cull_i_4, DispatchPattern=[True, False])  # -> ListA, ListB
dispatch_5 = Dispatch(List=item_14, DispatchPattern=[True, False])  # -> ListA, ListB
pt_18 = Point(dispatch_4.ListA)
pt_19 = Point(dispatch_4.ListB)
pt_20 = Point(pt_8)
ln_3 = Line(StartPoint=pt_18, EndPoint=pt_19)
ln_4 = Line(StartPoint=dispatch_5.ListA, EndPoint=dispatch_5.ListB)
merge_2 = Merge(Data1=ln_4, Data2=ln_3)  # -> flatten(Result)
shift_2 = ShiftList(List=merge_2, Shift=1, Wrap=True)
crv_cp_2 = CurveClosestPoint(Point=graft(pt_20), Curve=graft(shift_2))  # -> flatten(Point), Parameter, Distance

# ----
# column lines
crv_6 = Curve([<curve referenced from the Rhino model> x16])

# ----
# 钢板槽Modeling
recgrid_2 = Rectangular(Plane=PlaneXY(0, 0, 0), SizeX=s_x_2, SizeY=s_y_2, ExtentX=addition_4, ExtentY=addition_3)  # -> Cells, Points
multiplication = Multiplication(A=s_x_2, B=addition_4)
multiplication_2 = Multiplication(A=s_y_2, B=addition_3)
division_3 = Division(A=multiplication, B=2)
division_4 = Division(A=multiplication_2, B=2)
vec = VectorXYZ(XComponent=expr("-x", division_3), YComponent=expr("-x", division_4), ZComponent=0)  # -> Vector, Length
division_5 = Division(A=filter_3, B=2)
move_3 = Move(Geometry=recgrid_2.Points, Motion=vec.Vector)  # -> Geometry, Transform
multiplication_3 = Multiplication(A=division_5, B=2)
yz_plane_2 = YZPlane(Origin=Point(0, 0, 0))
orient_4 = Orient(Geometry=curve_2, Source=PlaneXY(0, 0, 0), Target=yz_plane_2)  # -> Geometry, Transform
divide_curve = DivideCurve(Curve=orient_4.Geometry, Count=Slider(50, range=0..100), Kinks=False)  # -> Points, Tangents, Parameters
unit_x_3 = UnitX(Factor=槽长_2)
division_6 = Division(A=槽长_2, B=2)
extrude_2 = Extrude(Base=orient_4.Geometry, Direction=unit_x_3)
unit_x_4 = UnitX(Factor=division_6)
convex_hull = ConvexHull(Points=divide_curve.Points, Plane=yz_plane_2)  # -> Hull, HullZ, Indices
move_4 = Move(Geometry=extrude_2, Motion=expr("-x", unit_x_4))  # -> Geometry, Transform
boundary_surfaces = BoundarySurfaces(Edges=convex_hull.Hull)
multiplication_4 = Multiplication(A=Slider(10, range=0..100), B=2)
subtraction_3 = Subtraction(A=槽长_2, B=multiplication_4)
unit_z = UnitZ(Factor=expr("-X", subtraction_2))
cap_holes_2 = CapHoles(Brep=move_4.Geometry)
unit_x_5 = UnitX(Factor=subtraction_3)
extrude_3 = Extrude(Base=boundary_surfaces, Direction=unit_x_5)
division_7 = Division(A=unit_x_5, B=2)
extrude_4 = Extrude(Base=boundary_surfaces, Direction=unit_x_3)
move_5 = Move(Geometry=extrude_3, Motion=expr("-x", division_7))  # -> Geometry, Transform
move_6 = Move(Geometry=extrude_4, Motion=expr("-x", unit_x_4))  # -> Geometry, Transform
solid_difference = SolidDifference(BrepsA=move_6.Geometry, BrepsB=move_5.Geometry)
Z = UnitZ(Factor=expr("-x", 锚板厚度_2))
xy_plane = XYPlane(Origin=Point(0, 0, 0))
deconstruct_plane = DeconstructPlane(Plane=xy_plane)  # -> Origin, XAxis, YAxis, ZAxis

multiplication_5 = Multiplication(A=multiplication_3, B=6)
max_2 = Maximum(A=multiplication_5, B=70)
multiplication_6 = Multiplication(A=锚筋到边_2, B=2)
addition_7 = Addition(A=multiplication, B=multiplication_6)
addition_8 = Addition(A=multiplication_2, B=multiplication_6)
expression_2 = Expression(x=addition_7, Expression="Ceiling(x/10)*10/2")
expression_3 = Expression(x=addition_8, Expression="Ceiling(x/10)*10/2")
dom = ConstructDomain(DomainStart=expr("-x", expression_2), DomainEnd=expression_2)
dom_2 = ConstructDomain(DomainStart=expr("-x", expression_3), DomainEnd=expression_3)
box = DomainBox(Base=PlaneXY(0, 0, 0), X=dom, Y=dom_2, Z=锚板厚度_2)

flip_matrix = FlipMatrix(Data=move_3.Geometry)
cull_first_last = CullFirstLast(List=flip_matrix)  # -> CullFirst, CullLast, CullFirstAndEnd
point = Point(cull_first_last.CullFirstAndEnd)
flip_matrix_2 = FlipMatrix(Data=point)
number_slider_3 = Slider(50, range=0..100)
polyline = PolyLine(Vertices=flip_matrix_2, Closed=False)
extend_curve = ExtendCurve(Curve=polyline, Type=0, Start=number_slider_3, End=number_slider_3)
xy_plane_2 = XYPlane(Origin=Point(0, 0, 0))
average = Average(Input=move_3.Geometry)
addition_9 = Addition(A=filter_4, B=Slider(1, range=0..1))
multiplication_7 = Multiplication(A=filter_3, B=2.5)
division_8 = Division(A=addition_9, B=2)
polyline_2 = PolyLine(Vertices=flatten(average), Closed=False)
negative = Negative(Value=division_8)
offset_curve = OffsetCurve(
    Curve=extend_curve,
    Distance=[Slider(25, range=0..100), Slider(25, range=0..100, expression="-x")],
    Plane=xy_plane_2,
    Corners=1)
circle = Circle(Plane=move_3.Geometry, Radius=multiplication_7)
shift_paths = ShiftPaths(Data=offset_curve, Offset=-1)
region_union = RegionUnion(Curves=circle)
offset_curve_2 = OffsetCurve(Curve=polyline_2, Distance=[division_8, negative], Plane=xy_plane_2, Corners=1)
boundary_surfaces_2 = BoundarySurfaces(Edges=region_union)
loft = Loft(Curves=shift_paths, Options={Adjust=False, Closed=False, LoftEnds=0, LoftSimp=0, LoftType=0, Rebuild=10, Refit=0.01})
trim_with_regions = TrimWithRegions(Curve=offset_curve_2, Regions=flatten(boundary_surfaces_2))  # -> Inside, Outside
trim_with_regions_2 = TrimWithRegions(Curve=trim_with_regions.Outside, Regions=flatten(loft))  # -> Inside, Outside
curve_3 = Curve(trim_with_regions_2.Outside)
flip_matrix_3 = FlipMatrix(Data=curve_3)
loft_2 = Loft(Curves=flip_matrix_3, Options={Adjust=False, Closed=False, LoftEnds=0, LoftSimp=0, LoftType=0, Rebuild=10, Refit=0.01})
length = Length(Curve=flip_matrix_3)  # -> flatten(Length)
brep_edges = BrepEdges(Brep=loft_2)  # -> Naked, Interior, NonManifold
max_min = MaxMin(Numbers=length)  # -> Max, MaxIndex, Min, MinIndex
join_curves = JoinCurves(Curves=brep_edges.Naked, Preserve=False)
number_slider_4 = Slider(100, range=0..100)
subtraction_4 = Subtraction(A=max_min.Min, B=filter_4)
fillet = Fillet(Curve=join_curves, Radius=division_8)
unit_z_2 = UnitZ(Factor=expr("-x", number_slider_4))
unit_z_3 = UnitZ(Factor=number_slider_4)
boundary_surfaces_3 = BoundarySurfaces(Edges=fillet)
extrude_5 = Extrude(Base=boundary_surfaces_3, Direction=[unit_z_3, unit_z_2])
solid_difference_2 = SolidDifference(BrepsA=box, BrepsB=flatten(extrude_5))

subtraction_5 = Subtraction(A=expression_3, B=板凳厚度)
dom_3 = ConstructDomain(DomainStart=expr("-x", subtraction_5), DomainEnd=subtraction_5)
rectangle = Rectangle(Plane=PlaneXY(0, 0, 0), XSize=dom, YSize=dom_3, Radius=0)  # -> Rectangle, Length
rectangle_2 = Rectangle(Plane=PlaneXY(0, 0, 0), XSize=dom, YSize=dom_2, Radius=0)  # -> Rectangle, Length
region_difference = RegionDifference(CurvesA=rectangle_2.Rectangle, CurvesB=rectangle.Rectangle)
boundary_surfaces_4 = BoundarySurfaces(Edges=region_difference)
extrude_6 = Extrude(Base=boundary_surfaces_4, Direction=unit_z)
merge_3 = Merge(Data1=extrude_6, Data2=solid_difference_2, Data3=cap_holes_2, Data4=solid_difference)
flatten_2 = FlattenTree(Tree=merge_3, Path="{0}")

move_7 = Move(Geometry=flatten_2, Motion=Z)  # -> Geometry, Transform
centre_point = Point(deconstruct_plane.Origin)

# ----
# 板槽Modeling
recgrid_3 = Rectangular(Plane=PlaneXY(0, 0, 0), SizeX=s_x, SizeY=s_y, ExtentX=addition_2, ExtentY=addition)  # -> Cells, Points
multiplication_8 = Multiplication(A=s_x, B=addition_2)
multiplication_9 = Multiplication(A=s_y, B=addition)
division_9 = Division(A=multiplication_8, B=2)
division_10 = Division(A=multiplication_9, B=2)
vec_2 = VectorXYZ(XComponent=expr("-x", division_9), YComponent=expr("-x", division_10), ZComponent=0)  # -> Vector, Length
move_8 = Move(Geometry=recgrid_3.Points, Motion=vec_2.Vector)  # -> Geometry, Transform
division_11 = Division(A=filter, B=2)
divide_curve_2 = DivideCurve(Curve=orient.Geometry, Count=Slider(50, range=0..100), Kinks=False)  # -> Points, Tangents, Parameters
convex_hull_2 = ConvexHull(Points=divide_curve_2.Points, Plane=yz_plane)  # -> Hull, HullZ, Indices
boundary_surfaces_5 = BoundarySurfaces(Edges=convex_hull_2.Hull)
multiplication_10 = Multiplication(A=Slider(10, range=0..100), B=2)
subtraction_6 = Subtraction(A=槽长, B=multiplication_10)
unit_x_6 = UnitX(Factor=subtraction_6)
extrude_7 = Extrude(Base=boundary_surfaces_5, Direction=unit_x_6)
division_12 = Division(A=unit_x_6, B=2)
extrude_8 = Extrude(Base=boundary_surfaces_5, Direction=unit_x)
move_9 = Move(Geometry=extrude_7, Motion=expr("-x", division_12))  # -> Geometry, Transform
move_10 = Move(Geometry=extrude_8, Motion=expr("-x", unit_x_2))  # -> Geometry, Transform
solid_difference_3 = SolidDifference(BrepsA=move_10.Geometry, BrepsB=move_9.Geometry)
Z_2 = UnitZ(Factor=expr("-x", 锚板厚度))
xy_plane_3 = XYPlane(Origin=Point(0, 0, 0))
deconstruct_plane_2 = DeconstructPlane(Plane=xy_plane_3)  # -> Origin, XAxis, YAxis, ZAxis

unit_z_4 = UnitZ(Factor=expr("x", 锚筋末端焊板厚度))
unit_z_5 = UnitZ(Factor=expr("-x", subtraction))
division_13 = Division(A=锚筋末端焊板边长, B=2)
construct_domain = ConstructDomain(DomainStart=expr("-x", division_13), DomainEnd=division_13)
move_11 = Move(Geometry=move_8.Geometry, Motion=unit_z_5)  # -> Geometry, Transform
rectangle_3 = Rectangle(Plane=move_11.Geometry, XSize=construct_domain, YSize=construct_domain, Radius=0)  # -> Rectangle, Length
extrude_9 = Extrude(Base=rectangle_3.Rectangle, Direction=unit_z_4)

multiplication_11 = Multiplication(A=division_11, B=2)
cyl = Cylinder(Base=move_8.Geometry, Radius=division_11, Length=expr("-x", subtraction))
edges_2 = BrepEdges(Brep=cyl)  # -> Naked, Interior, NonManifold
multiplication_12 = Multiplication(A=multiplication_11, B=5)
item_15 = ListItem(List=edges_2.Naked, Index=0, Wrap=True)
X = UnitX(Factor=multiplication_11)
Z_3 = UnitZ(Factor=multiplication_12)
move_12 = Move(Geometry=item_15, Motion=X)  # -> Geometry, Transform
extr = Extrude(Base=move_12.Geometry, Direction=Z_3)

multiplication_13 = Multiplication(A=multiplication_11, B=6)
max_3 = Maximum(A=multiplication_13, B=70)
multiplication_14 = Multiplication(A=锚筋到边, B=2)
addition_10 = Addition(A=multiplication_8, B=multiplication_14)
addition_11 = Addition(A=multiplication_9, B=multiplication_14)
expression_4 = Expression(x=addition_10, Expression="Ceiling(x/10)*10/2")
expression_5 = Expression(x=addition_11, Expression="Ceiling(x/10)*10/2")
dom_4 = ConstructDomain(DomainStart=expr("-x", expression_4), DomainEnd=expression_4)
dom_5 = ConstructDomain(DomainStart=expr("-x", expression_5), DomainEnd=expression_5)
box_2 = DomainBox(Base=PlaneXY(0, 0, 0), X=dom_4, Y=dom_5, Z=锚板厚度)

flip_matrix_4 = FlipMatrix(Data=move_8.Geometry)
cull_first_last_2 = CullFirstLast(List=flip_matrix_4)  # -> CullFirst, CullLast, CullFirstAndEnd
point_2 = Point(cull_first_last_2.CullFirstAndEnd)
flip_matrix_5 = FlipMatrix(Data=point_2)
number_slider_5 = Slider(50, range=0..100)
polyline_3 = PolyLine(Vertices=flip_matrix_5, Closed=False)
extend_curve_2 = ExtendCurve(Curve=polyline_3, Type=0, Start=number_slider_5, End=number_slider_5)
xy_plane_4 = XYPlane(Origin=Point(0, 0, 0))
average_2 = Average(Input=move_8.Geometry)
addition_12 = Addition(A=filter_2, B=Slider(1, range=0..1))
multiplication_15 = Multiplication(A=filter, B=2.5)
division_14 = Division(A=addition_12, B=2)
polyline_4 = PolyLine(Vertices=flatten(average_2), Closed=False)
negative_2 = Negative(Value=division_14)
offset_curve_3 = OffsetCurve(
    Curve=extend_curve_2,
    Distance=[Slider(25, range=0..100), Slider(25, range=0..100, expression="-x")],
    Plane=xy_plane_4,
    Corners=1)
circle_2 = Circle(Plane=move_8.Geometry, Radius=multiplication_15)
shift_paths_2 = ShiftPaths(Data=offset_curve_3, Offset=-1)
region_union_2 = RegionUnion(Curves=circle_2)
offset_curve_4 = OffsetCurve(Curve=polyline_4, Distance=[division_14, negative_2], Plane=xy_plane_4, Corners=1)
boundary_surfaces_6 = BoundarySurfaces(Edges=region_union_2)
loft_3 = Loft(Curves=shift_paths_2, Options={Adjust=False, Closed=False, LoftEnds=0, LoftSimp=0, LoftType=0, Rebuild=10, Refit=0.01})
trim_with_regions_3 = TrimWithRegions(Curve=offset_curve_4, Regions=flatten(boundary_surfaces_6))  # -> Inside, Outside
trim_with_regions_4 = TrimWithRegions(Curve=trim_with_regions_3.Outside, Regions=flatten(loft_3))  # -> Inside, Outside
curve_4 = Curve(trim_with_regions_4.Outside)
flip_matrix_6 = FlipMatrix(Data=curve_4)
loft_4 = Loft(Curves=flip_matrix_6, Options={Adjust=False, Closed=False, LoftEnds=0, LoftSimp=0, LoftType=0, Rebuild=10, Refit=0.01})
length_2 = Length(Curve=flip_matrix_6)  # -> flatten(Length)
brep_edges_2 = BrepEdges(Brep=loft_4)  # -> Naked, Interior, NonManifold
max_min_2 = MaxMin(Numbers=length_2)  # -> Max, MaxIndex, Min, MinIndex
join_curves_2 = JoinCurves(Curves=brep_edges_2.Naked, Preserve=False)
number_slider_6 = Slider(100, range=0..100)
subtraction_7 = Subtraction(A=max_min_2.Min, B=filter_2)
fillet_2 = Fillet(Curve=join_curves_2, Radius=division_14)
unit_z_6 = UnitZ(Factor=expr("-x", number_slider_6))
unit_z_7 = UnitZ(Factor=number_slider_6)
boundary_surfaces_7 = BoundarySurfaces(Edges=fillet_2)
extrude_10 = Extrude(Base=boundary_surfaces_7, Direction=[unit_z_7, unit_z_6])
solid_difference_4 = SolidDifference(BrepsA=box_2, BrepsB=flatten(extrude_10))

stream_filter = StreamFilter(Gate=value_list, Stream0=extr, Stream1=extrude_9)
cap = CapHoles(Brep=[cyl, stream_filter])
merge_4 = Merge(Data1=cap, Data2=solid_difference_4, Data3=cap_holes, Data4=solid_difference_3)
flatten_3 = FlattenTree(Tree=merge_4, Path="{0}")

move_13 = Move(Geometry=flatten_3, Motion=Z_2)  # -> Geometry, Transform
centre_point_2 = Point(deconstruct_plane_2.Origin)

geo = Geometry(box_2)

# ----
# 板埋Modeling
multiplication_16 = Multiplication(A=s_x_3, B=addition_5)
multiplication_17 = Multiplication(A=s_y_3, B=addition_6)
recgrid_4 = Rectangular(Plane=PlaneXY(0, 0, 0), SizeX=s_x_3, SizeY=s_y_3, ExtentX=addition_5, ExtentY=addition_6)  # -> Cells, Points
直径 = Text(filter_7)
division_15 = Division(A=multiplication_16, B=2)
division_16 = Division(A=multiplication_17, B=2)
vec_3 = VectorXYZ(XComponent=expr("-x", division_15), YComponent=expr("-x", division_16), ZComponent=0)  # -> Vector, Length
move_14 = Move(Geometry=recgrid_4.Points, Motion=vec_3.Vector)  # -> Geometry, Transform
division_17 = Division(A=直径, B=2)
cyl_2 = Cylinder(Base=move_14.Geometry, Radius=division_17, Length=expr("-x", expression))
X_2 = UnitX(Factor=直径)
multiplication_18 = Multiplication(A=直径, B=6)
edges_3 = BrepEdges(Brep=cyl_2)  # -> Naked, Interior, NonManifold
item_16 = ListItem(List=edges_3.Naked, Index=0, Wrap=True)
max_4 = Maximum(A=multiplication_18, B=70)
move_15 = Move(Geometry=item_16, Motion=X_2)  # -> Geometry, Transform
multiplication_19 = Multiplication(A=max_4, B=2)
addition_13 = Addition(A=multiplication_16, B=multiplication_19)
addition_14 = Addition(A=multiplication_17, B=multiplication_19)
division_18 = Division(A=t, B=2)
expression_6 = Expression(x=addition_14, Expression="Ceiling(x/10)*10/2")
expression_7 = Expression(x=addition_13, Expression="Ceiling(x/10)*10/2")
round = Round(Number=division_18)  # -> Nearest, Floor, Ceiling
multiplication_20 = Multiplication(A=round.Ceiling, B=2)
dom_6 = ConstructDomain(DomainStart=expr("-x", expression_6), DomainEnd=expression_6)
dom_7 = ConstructDomain(DomainStart=expr("-x", expression_7), DomainEnd=expression_7)
box_3 = DomainBox(Base=PlaneXY(0, 0, 0), X=dom_7, Y=dom_6, Z=multiplication_20)
Z_4 = UnitZ(Factor=expr("-x", multiplication_20))
move_16 = Move(Geometry=box_3, Motion=Z_4)  # -> Geometry, Transform
Z_5 = UnitZ(Factor=expr("-x", multiplication_20))

multiplication_21 = Multiplication(A=直径, B=5)

Z_6 = UnitZ(Factor=multiplication_21)
extr_2 = Extrude(Base=move_15.Geometry, Direction=Z_6)
cap_2 = CapHoles(Brep=[extr_2, cyl_2])
merge_5 = Merge(Data1=cap_2, Data2=box_3)
flatten_4 = FlattenTree(Tree=merge_5, Path="{0}")
move_17 = Move(Geometry=flatten_4, Motion=Z_5)  # -> Geometry, Transform

box_4 = DomainBox(Base=PlaneXY(0, 0, 0), X=dom_7, Y=dom_7, Z=multiplication_20)
merge_6 = Merge(Data1=cap_2, Data2=box_4)
flatten_5 = FlattenTree(Tree=merge_6, Path="{0}")
move_18 = Move(Geometry=flatten_5, Motion=Z_5)  # -> Geometry, Transform
# Rhino 文件中导入的块名
entwine_3 = Entwine(Branch00=move_17.Geometry, Branch01=move_18.Geometry, FlattenInputs=True)
entwine_4 = Entwine(Branch00=move_13.Geometry, Branch01=move_7.Geometry, Branch02=geo, Branch03=move_17.Geometry, FlattenInputs=True)
make2d = Make2D(Geometry=entwine_4, View=m2d_rhino, TangentEdges=False, TangentSeams=False, AutoComputeMake2D=False)  # -> VisibleCurves, VisibleIndex, VisibleType, HiddenCurves, HiddenIndex, HiddenType
bang = ExplodeTree(Data=make2d.VisibleCurves)  # -> Branch0, Branch1, Branch2, Branch3, Branch4, Branch5, Branch6, Branch7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
bang_2 = ExplodeTree(Data=make2d.VisibleCurves)  # -> Branch0, Branch1, Branch2, Branch3, Branch4, Branch5, Branch6, Branch7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
bang_3 = ExplodeTree(Data=make2d.VisibleCurves)  # -> Branch0, Branch1, Branch2, Branch3, Branch4, Branch5, Branch6, Branch7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
bang_4 = ExplodeTree(Data=make2d.VisibleCurves)  # -> Branch0, Branch1, Branch2, Branch3, Branch4, Branch5, Branch6, Branch7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
divdist = DivideDistance(Curve=make2d.HiddenCurves, Distance=number_slider)  # -> Points, Tangents, Parameters
graft = GraftTree(Tree=make2d.HiddenCurves, IncludeEmptyLists=True, IncludeNullItems=True)
shatter = Shatter(Curve=graft, Parameters=divdist.Parameters)
dispatch_6 = Dispatch(List=shatter, DispatchPattern=[True, False])  # -> ListA, ListB
crv_7 = Curve(dispatch_6.ListA)
# hidden lines of top+pers view
pshift = ShiftPaths(Data=crv_7, Offset=-1)
pshift_2 = ShiftPaths(Data=pshift, Offset=-1)
bang_5 = ExplodeTree(Data=pshift_2)  # -> Branch0, Branch1, Branch2, Branch3, Branch4, Branch5, Branch6, Branch7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
bang_6 = ExplodeTree(Data=pshift_2)  # -> Branch0, Branch1, Branch2, Branch3, Branch4, Branch5, Branch6, Branch7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
bang_7 = ExplodeTree(Data=pshift_2)  # -> Branch0, Branch1, Branch2, Branch3, Branch4, Branch5, Branch6, Branch7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
bang_8 = ExplodeTree(Data=pshift_2)  # -> Branch0, Branch1, Branch2, Branch3, Branch4, Branch5, Branch6, Branch7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
entwine_5 = Entwine(Branch00=bang_7.Branch0, Branch01=bang_2.Branch0, FlattenInputs=True)  # -> flatten(Result)
entwine_6 = Entwine(Branch00=bang_7.Branch1, Branch01=bang_2.Branch1, FlattenInputs=True)  # -> flatten(Result)
entwine_7 = Entwine(Branch00=bang_5.Branch13, Branch01=bang_4.Branch13, FlattenInputs=True)  # -> flatten(Result); disabled
entwine_8 = Entwine(Branch00=bang_5.Branch12, Branch01=bang_4.Branch12, FlattenInputs=True)  # -> flatten(Result)
entwine_9 = Entwine(Branch00=bang_8.Branch4, Branch01=bang.Branch4, FlattenInputs=True)  # -> flatten(Result)
entwine_10 = Entwine(Branch00=bang_8.Branch5, Branch01=bang.Branch5, FlattenInputs=True)  # -> flatten(Result)
entwine_11 = Entwine(Branch00=bang_6.Branch8, Branch01=bang_3.Branch8, FlattenInputs=True)  # -> flatten(Result)
entwine_12 = Entwine(Branch00=bang_6.Branch9, Branch01=bang_3.Branch9, FlattenInputs=True)  # -> flatten(Result)
entwine_13 = Entwine(Branch00=entwine_5, Branch01=entwine_6, Branch02=bang_2.Branch2, Branch03=bang_2.Branch3, FlattenInputs=True)
entwine_14 = Entwine(Branch00=entwine_9, Branch01=entwine_10, Branch02=bang.Branch6, Branch03=bang.Branch7, FlattenInputs=True)
entwine_15 = Entwine(Branch00=entwine_8, Branch01=entwine_7, Branch02=bang_4.Branch14, Branch03=bang_4.Branch15, FlattenInputs=True)
entwine_16 = Entwine(Branch00=entwine_11, Branch01=entwine_12, Branch02=bang_3.Branch10, Branch03=bang_3.Branch11, FlattenInputs=True)
group = Group(Objects=entwine_14)
group_2 = Group(Objects=entwine_13)
group_3 = Group(Objects=entwine_15)
group_4 = Group(Objects=entwine_16)
entwine_17 = Entwine(Branch00=group_2, Branch01=group, Branch02=group_4, Branch03=group_3, FlattenInputs=True)
pshift_3 = ShiftPaths(Data=entwine_17, Offset=-1)
pshift_4 = ShiftPaths(Data=entwine_17, Offset=-1)
boxprop = BoxProperties(Box=pshift_3)  # -> Center, Diagonal, Area, Volume, Degeneracy
vec2pt = Vector2Pt(PointA=boxprop.Center, PointB=pt_4, Unitize=False)  # -> Vector, Length
move_19 = Move(Geometry=pshift_4, Motion=vec2pt.Vector)  # -> flatten(Geometry), Transform
# move to center
orient_5 = Orient(Geometry=move_19.Geometry, Source=PlaneXY(0, 0, 0), Target=flatten)  # -> Geometry, Transform
cull = CullPattern(List=orient_5.Geometry, CullPattern=panel_10)
cull_2 = CullPattern(List=orient_5.Geometry, CullPattern=panel_8)
cull_3 = CullPattern(List=orient_5.Geometry, CullPattern=panel_9)
cull_i_5 = CullIndex(List=orient_5.Geometry, Indices="-1", Wrap=True)
entwine_18 = Entwine(Branch00=cull_3, Branch01=cull_2, Branch02=cull, FlattenInputs=True)
flip_4 = FlipMatrix(Data=entwine_18)
split = SplitList(List=cull_i_5, Index="4")  # -> ListA, ListB
data = Data(split.ListA)
data_2 = Data(split.ListB)
tstat = TreeStatistics(Tree=flip_4)  # -> Paths, Length, Count
branch = TreeBranch(Tree=flip_4, Path="{0;0}", MaintainPaths=True)
branch_2 = TreeBranch(Tree=flip_4, Path="{0;1}", MaintainPaths=True)
branch_3 = TreeBranch(Tree=flip_4, Path="{0;2}", MaintainPaths=True)
branch_4 = TreeBranch(Tree=flip_4, Path="{0;3}", MaintainPaths=True)
entwine_19 = Entwine(Branch00=data, Branch01=data_2, FlattenInputs=True)
cluster = Cluster(G=branch_3)
cluster_2 = Cluster(G=branch_2)
cluster_3 = Cluster(G=branch)
cluster_4 = Cluster(G=branch_4)
geo_2 = Geometry(flip_4)
entwine_20 = Entwine(Branch00=cluster_3, Branch01=cluster_2, Branch02=cluster, Branch03=cluster_4, FlattenInputs=True)

# ---- group: side
item_17 = ListItem(List=entwine_20, Index="1", Wrap=True)  # -> flatten(Item)

# ---- group: side-short
item_18 = ListItem(List=entwine_20, Index="2", Wrap=True)  # -> flatten(Item)

# ---- group: top
item_19 = ListItem(List=entwine_20, Index=0, Wrap=True)  # -> flatten(Item)

# ----
item_20 = ListItem(List=item_19, Index=0, Wrap=True)
item_21 = ListItem(List=item_17, Index="2", Wrap=True)
item_22 = ListItem(List=item_19, Index="1", Wrap=True)
item_23 = ListItem(List=item_17, Index="3", Wrap=True)
item_24 = ListItem(List=item_18, Index="3", Wrap=True)
item_25 = ListItem(List=geo_2, Index=Slider(3, range=0..4), Wrap=True)  # -> flatten(Item)
item_26 = ListItem(List=item_25, Index="-1", Wrap=True)
cluster_5 = Cluster(G=item_26)
block = DefineBlock(Geometry=item_20, Attributes=attributes, BlockName="embed2", BasePlane=PlaneXY(0, 0, 0))
block_2 = DefineBlock(Geometry=item_21, Attributes=attributes, BlockName="embed3", BasePlane=PlaneXY(0, 0, 0))
block_3 = DefineBlock(Geometry=item_23, Attributes=attributes, BlockName="embed4", BasePlane=PlaneXY(0, 0, 0))
block_4 = DefineBlock(Geometry=item_24, Attributes=attributes, BlockName="embed5", BasePlane=PlaneXY(0, 0, 0))
block_5 = DefineBlock(Geometry=item_22, Attributes=attributes, BlockName=panel_11, BasePlane=PlaneXY(0, 0, 0))
merge_7 = Merge(Data1=block_5, Data2=block, Data3=block_2, Data4=block_3, Data5=block_4)

cull_i_6 = CullIndex(List=pt_10, Indices=c_script_4.specialPt, Wrap=True)  # -> graft(List)
ln_5 = Line(StartPoint=item_10, EndPoint=cull_i_6)
item_27 = ListItem(List=flatten(merge_7), Index=0, Wrap=True)
rotate_2 = Rotate(Geometry=ln_5, Angle=-1.570796327, Plane=item_10)  # -> Geometry, Transform
line = Line(flatten(ln_5))
line_2 = Line(flatten(rotate_2.Geometry))
bbox_3 = BoundingBox(Content=graft(item_27), Plane=PlaneXY(0, 0, 0))  # -> Box, Box_2
srf = Surface(bbox_3.Box)
pl = ConstructPlane(Origin=flatten(item_10), XAxis=line_2, YAxis=line)
explode = Explode(Curve=srf, Recursive=True)  # -> Segments, Vertices
item_28 = ListItem(List=explode.Vertices, Index=0, Wrap=True)  # -> Item, Item1, Item2
# 这里如果跑红也不要紧，
# 说明单体没有出现相撞的情况
ln_6 = Line(StartPoint=graft(item_28.Item1), EndPoint=graft(item_28.Item))
ln_7 = Line(StartPoint=graft(item_28.Item1), EndPoint=graft(item_28.Item2))
pt_21 = Point(item_28.Item1)
pl_2 = ConstructPlane(Origin=item_28.Item1, XAxis=ln_6, YAxis=ln_7)
orient_6 = Orient(Geometry=item_27, Source=pl_2, Target=pl)  # -> Geometry, Transform
data_3 = Data(orient_6.Geometry)

pt_22 = Point(item_9)
pull_3 = PullPoint(Point=item_9, Geometry=crv_cp_2.Point, ClosestOnly=True)  # -> ClosestPoint, Distance
ln_8 = Line(StartPoint=pull_3.ClosestPoint, EndPoint=pt_22)
amp = Amplitude(Vector=ln_8, Amplitude=Slider(140, range=0..1000))
move_20 = Move(Geometry=pull_3.ClosestPoint, Motion=amp)  # -> Geometry, Transform
ln_9 = Line(StartPoint=move_20.Geometry, EndPoint=pull_3.ClosestPoint)
rotate_3 = Rotate(Geometry=ln_9, Angle=-1.570796327, Plane=move_20.Geometry)  # -> Geometry, Transform
line_3 = Line(flatten(ln_9))
line_4 = Line(flatten(rotate_3.Geometry))
item_29 = ListItem(List=flatten(merge_7), Index=0, Wrap=True)
pl_3 = ConstructPlane(Origin=flatten(move_20.Geometry), XAxis=line_3, YAxis=line_4)
bbox_4 = BoundingBox(Content=graft(item_29), Plane=PlaneXY(0, 0, 0))  # -> Box, Box_2
srf_2 = Surface(bbox_4.Box)
explode_2 = Explode(Curve=srf_2, Recursive=True)  # -> Segments, Vertices
item_30 = ListItem(List=explode_2.Vertices, Index=0, Wrap=True)  # -> Item, Item1, Item2
ln_10 = Line(StartPoint=graft(item_30.Item1), EndPoint=graft(item_30.Item2))
midpt = CurveMiddle(Curve=ln_10)
ln_11 = Line(StartPoint=midpt, EndPoint=item_30.Item1)
rotate_4 = Rotate(Geometry=ln_11, Angle=-1.570796327, Plane=PlaneXY(0, 0, 0))  # -> Geometry, Transform
pl_4 = ConstructPlane(Origin=midpt, XAxis=ln_11, YAxis=rotate_4.Geometry)
orient_7 = Orient(Geometry=item_29, Source=pl_4, Target=pl_3)  # -> Geometry, Transform
data_4 = Data(orient_7.Geometry)

pull_4 = PullPoint(Point=item_13, Geometry=crv_cp_2.Point, ClosestOnly=True)  # -> ClosestPoint, Distance
pt_23 = Point(item_13)
ln_12 = Line(StartPoint=pull_4.ClosestPoint, EndPoint=pt_23)
amp_2 = Amplitude(Vector=ln_12, Amplitude=Slider(140, range=0..1000))
move_21 = Move(Geometry=pull_4.ClosestPoint, Motion=amp_2)  # -> Geometry, Transform
ln_13 = Line(StartPoint=move_21.Geometry, EndPoint=pull_4.ClosestPoint)
rotate_5 = Rotate(Geometry=ln_13, Angle=-1.570796327, Plane=move_21.Geometry)  # -> Geometry, Transform
item_31 = ListItem(List=flatten(merge_7), Index="1", Wrap=True)
line_5 = Line(flatten(ln_13))
line_6 = Line(flatten(rotate_5.Geometry))
bbox_5 = BoundingBox(Content=graft(item_31), Plane=PlaneXY(0, 0, 0))  # -> Box, Box_2
srf_3 = Surface(bbox_5.Box)
pl_5 = ConstructPlane(Origin=flatten(move_21.Geometry), XAxis=line_5, YAxis=line_6)
explode_3 = Explode(Curve=srf_3, Recursive=True)  # -> Segments, Vertices
item_32 = ListItem(List=explode_3.Vertices, Index=0, Wrap=True)  # -> Item, Item1, Item2
ln_14 = Line(StartPoint=graft(item_32.Item1), EndPoint=graft(item_32.Item2))
midpt_2 = CurveMiddle(Curve=ln_14)
ln_15 = Line(StartPoint=midpt_2, EndPoint=item_32.Item1)
rotate_6 = Rotate(Geometry=ln_15, Angle=-1.570796327, Plane=PlaneXY(0, 0, 0))  # -> Geometry, Transform
pl_6 = ConstructPlane(Origin=midpt_2, XAxis=ln_15, YAxis=rotate_6.Geometry)
orient_8 = Orient(Geometry=item_31, Source=pl_6, Target=pl_5)  # -> Geometry, Transform
data_5 = Data(orient_8.Geometry)

pull_5 = PullPoint(Point=item_8, Geometry=crv_cp_2.Point, ClosestOnly=True)  # -> ClosestPoint, Distance
pt_24 = Point(item_8)
ln_16 = Line(StartPoint=pull_5.ClosestPoint, EndPoint=pt_24)
amp_3 = Amplitude(Vector=ln_16, Amplitude=Slider(87, range=0..1000))
move_22 = Move(Geometry=pull_5.ClosestPoint, Motion=amp_3)  # -> Geometry, Transform
ln_17 = Line(StartPoint=move_22.Geometry, EndPoint=pull_5.ClosestPoint)
rotate_7 = Rotate(Geometry=ln_17, Angle=-1.570796327, Plane=move_22.Geometry)  # -> Geometry, Transform
line_7 = Line(flatten(ln_17))
line_8 = Line(flatten(rotate_7.Geometry))
item_33 = ListItem(List=flatten(merge_7), Index=0, Wrap=True)
pl_7 = ConstructPlane(Origin=flatten(move_22.Geometry), XAxis=line_7, YAxis=line_8)
bbox_6 = BoundingBox(Content=graft(item_33), Plane=PlaneXY(0, 0, 0))  # -> Box, Box_2
srf_4 = Surface(bbox_6.Box)
explode_4 = Explode(Curve=srf_4, Recursive=True)  # -> Segments, Vertices
item_34 = ListItem(List=explode_4.Vertices, Index=0, Wrap=True)  # -> Item, Item1, Item2
ln_18 = Line(StartPoint=graft(item_34.Item1), EndPoint=graft(item_34.Item2))
midpt_3 = CurveMiddle(Curve=ln_18)
ln_19 = Line(StartPoint=midpt_3, EndPoint=item_34.Item1)
rotate_8 = Rotate(Geometry=ln_19, Angle=-1.570796327, Plane=PlaneXY(0, 0, 0))  # -> Geometry, Transform
pl_8 = ConstructPlane(Origin=midpt_3, XAxis=ln_19, YAxis=rotate_8.Geometry)
orient_9 = Orient(Geometry=item_33, Source=pl_8, Target=pl_7)  # -> Geometry, Transform
data_6 = Data(orient_9.Geometry)

cull_i_7 = CullIndex(List=pt_11, Indices=c_script_5.specialPt, Wrap=True)  # -> graft(List)
ln_20 = Line(StartPoint=item_11, EndPoint=cull_i_7)
item_35 = ListItem(List=flatten(merge_7), Index="1", Wrap=True)
bbox_7 = BoundingBox(Content=graft(item_35), Plane=PlaneXY(0, 0, 0))  # -> Box, Box_2
rotate_9 = Rotate(Geometry=ln_20, Angle=-1.570796327, Plane=item_11)  # -> Geometry, Transform
line_9 = Line(flatten(ln_20))
line_10 = Line(flatten(rotate_9.Geometry))
srf_5 = Surface(bbox_7.Box)
pl_9 = ConstructPlane(Origin=flatten(item_11), XAxis=line_10, YAxis=line_9)
explode_5 = Explode(Curve=srf_5, Recursive=True)  # -> Segments, Vertices
item_36 = ListItem(List=explode_5.Vertices, Index=0, Wrap=True)  # -> Item, Item1, Item2
ln_21 = Line(StartPoint=graft(item_36.Item1), EndPoint=graft(item_36.Item))
ln_22 = Line(StartPoint=graft(item_36.Item1), EndPoint=graft(item_36.Item2))
pt_25 = Point(item_36.Item1)
pl_10 = ConstructPlane(Origin=item_36.Item1, XAxis=ln_21, YAxis=ln_22)
orient_10 = Orient(Geometry=item_35, Source=pl_10, Target=pl_9)  # -> Geometry, Transform
data_7 = Data(orient_10.Geometry)

pull_6 = PullPoint(Point=item_12, Geometry=crv_cp_2.Point, ClosestOnly=True)  # -> ClosestPoint, Distance
pt_26 = Point(item_12)
ln_23 = Line(StartPoint=pull_6.ClosestPoint, EndPoint=pt_26)
amp_4 = Amplitude(Vector=ln_23, Amplitude=Slider(87, range=0..1000))
move_23 = Move(Geometry=pull_6.ClosestPoint, Motion=amp_4)  # -> Geometry, Transform
ln_24 = Line(StartPoint=move_23.Geometry, EndPoint=pull_6.ClosestPoint)
rotate_10 = Rotate(Geometry=ln_24, Angle=-1.570796327, Plane=move_23.Geometry)  # -> Geometry, Transform
item_37 = ListItem(List=flatten(merge_7), Index="1", Wrap=True)
line_11 = Line(flatten(ln_24))
line_12 = Line(flatten(rotate_10.Geometry))
bbox_8 = BoundingBox(Content=graft(item_37), Plane=PlaneXY(0, 0, 0))  # -> Box, Box_2
pl_11 = ConstructPlane(Origin=flatten(move_23.Geometry), XAxis=line_11, YAxis=line_12)
srf_6 = Surface(bbox_8.Box)
explode_6 = Explode(Curve=srf_6, Recursive=True)  # -> Segments, Vertices
item_38 = ListItem(List=explode_6.Vertices, Index=0, Wrap=True)  # -> Item, Item1, Item2
ln_25 = Line(StartPoint=graft(item_38.Item1), EndPoint=graft(item_38.Item2))
midpt_4 = CurveMiddle(Curve=ln_25)
ln_26 = Line(StartPoint=midpt_4, EndPoint=item_38.Item1)
rotate_11 = Rotate(Geometry=ln_26, Angle=-1.570796327, Plane=PlaneXY(0, 0, 0))  # -> Geometry, Transform
pl_12 = ConstructPlane(Origin=midpt_4, XAxis=ln_26, YAxis=rotate_11.Geometry)
orient_11 = Orient(Geometry=item_37, Source=pl_12, Target=pl_11)  # -> Geometry, Transform
data_8 = Data(orient_11.Geometry)

orient_12 = Orient(Geometry=srf_4, Source=pl_8, Target=pl_7)  # -> Geometry, Transform
orient_13 = Orient(Geometry=srf_2, Source=pl_4, Target=pl_3)  # -> Geometry, Transform
orient_14 = Orient(Geometry=srf_3, Source=pl_6, Target=pl_5)  # -> Geometry, Transform
orient_15 = Orient(Geometry=srf_6, Source=pl_12, Target=pl_11)  # -> Geometry, Transform

item_39 = ListItem(List=flatten(merge_7), Index="2", Wrap=True)
bbox_9 = BoundingBox(Content=graft(item_39), Plane=PlaneXY(0, 0, 0))  # -> Box, Box_2
srf_7 = Surface(bbox_9.Box)
explode_7 = Explode(Curve=srf_7, Recursive=True)  # -> Segments, Vertices
item_40 = ListItem(List=explode_7.Vertices, Index=0, Wrap=True)  # -> Item, Item1, Item2
ln_27 = Line(StartPoint=graft(item_40.Item), EndPoint=graft(item_40.Item1))
ln_28 = Line(StartPoint=graft(item_40.Item1), EndPoint=graft(item_40.Item2))
midpt_5 = CurveMiddle(Curve=ln_28)
move_24 = Move(Geometry=ln_27, Motion=ln_27)  # -> Geometry, Transform
pl_13 = ConstructPlane(Origin=midpt_5, XAxis=move_24.Geometry, YAxis=ln_28)

boundary = BoundarySurfaces(Edges=crv_6)  # -> simplify(Surfaces)
boundary_2 = BoundarySurfaces(Edges=orient_13.Geometry)  # -> simplify(graft(Surfaces))
graft_2 = GraftTree(Tree=data_4, IncludeEmptyLists=True, IncludeNullItems=True)  # -> simplify(Tree)
graft_3 = GraftTree(Tree=pt_22, IncludeEmptyLists=True, IncludeNullItems=True)  # -> simplify(Tree)
findbrepintersect = FindBrepIntersect(BrepMain=boundary_2, BrepStay=boundary)  # -> out, BrepInters, BrepRemain; inputs BrepMain: list of Brep, BrepStay: list of Brep
# ---------- findbrepintersect: C# ----------
    List<Brep> BrepI = new List<Brep>();
    List<Brep> BrepR = new List<Brep>();
    


    double tolr = Rhino.RhinoDoc.ActiveDoc.ModelAbsoluteTolerance;

    for(int j = 0; j < BrepMain.Count;j++){
      foreach(Brep b in BrepStay) {
        bool test = Rhino.Geometry.Intersect.Intersection.BrepBrep(BrepMain[j], b, tolr, out crv, out pts);
        if(test && crv.Length != 0){
          tryThis = true;
          break;}
        else{
          tryThis = false;}
      }
      if(tryThis){
        BrepI.Add(BrepMain[j]);
      }
      else{
        BrepR.Add(BrepMain[j]);
      }
    }



    BrepInters = BrepI;
    BrepRemain = BrepR;
# ---------- findbrepintersect: C# additional code ----------
  Rhino.Geometry.Curve[] crv;
  Rhino.Geometry.Point3d[] pts;
  bool tryThis;
# ---------- end findbrepintersect ----------
pt_27 = Point(pt_5)
item_41 = ListItem(List=graft_3, Index=findbrepintersect.BrepInters, Wrap=True)
pull_7 = PullPoint(Point=item_41, Geometry=pt_27, ClosestOnly=True)  # -> ClosestPoint, Distance
pull_8 = PullPoint(Point=pull_7.ClosestPoint, Geometry=boundary, ClosestOnly=True)  # -> ClosestPoint, Distance
ln_29 = Line(StartPoint=pull_7.ClosestPoint, EndPoint=pull_8.ClosestPoint)
rotate_12 = Rotate(Geometry=ln_29, Angle=1.570796327, Plane=pull_8.ClosestPoint)  # -> Geometry, Transform
pl_14 = ConstructPlane(Origin=pull_8.ClosestPoint, XAxis=ln_29, YAxis=rotate_12.Geometry)
orient_16 = Orient(Geometry=item_39, Source=pl_13, Target=pl_14)  # -> Geometry, Transform
cull_i_8 = CullIndex(List=graft_2, Indices=findbrepintersect.BrepInters, Wrap=True)

boundary_3 = BoundarySurfaces(Edges=crv_6)  # -> simplify(Surfaces)
boundary_4 = BoundarySurfaces(Edges=orient_12.Geometry)  # -> simplify(graft(Surfaces))
graft_4 = GraftTree(Tree=move_22.Geometry, IncludeEmptyLists=True, IncludeNullItems=True)  # -> simplify(Tree)
graft_5 = GraftTree(Tree=data_6, IncludeEmptyLists=True, IncludeNullItems=True)  # -> simplify(Tree)
findbrepintersect_2 = FindBrepIntersect(BrepMain=boundary_4, BrepStay=boundary_3)  # -> out, BrepInters, BrepRemain; inputs BrepMain: list of Brep, BrepStay: list of Brep; same code as findbrepintersect
pt_28 = Point(pt_5)
item_42 = ListItem(List=graft_4, Index=findbrepintersect_2.BrepInters, Wrap=True)
pull_9 = PullPoint(Point=item_42, Geometry=pt_28, ClosestOnly=True)  # -> ClosestPoint, Distance
pull_10 = PullPoint(Point=pull_9.ClosestPoint, Geometry=boundary_3, ClosestOnly=True)  # -> ClosestPoint, Distance
ln_30 = Line(StartPoint=pull_9.ClosestPoint, EndPoint=pull_10.ClosestPoint)
rotate_13 = Rotate(Geometry=ln_30, Angle=1.570796327, Plane=pull_10.ClosestPoint)  # -> Geometry, Transform
pl_15 = ConstructPlane(Origin=pull_10.ClosestPoint, XAxis=ln_30, YAxis=rotate_13.Geometry)
orient_17 = Orient(Geometry=item_39, Source=pl_13, Target=pl_15)  # -> Geometry, Transform
cull_i_9 = CullIndex(List=graft_5, Indices=findbrepintersect_2.BrepInters, Wrap=True)

boundary_5 = BoundarySurfaces(Edges=crv_6)  # -> simplify(Surfaces)
boundary_6 = BoundarySurfaces(Edges=orient_14.Geometry)  # -> simplify(graft(Surfaces))
graft_6 = GraftTree(Tree=data_5, IncludeEmptyLists=True, IncludeNullItems=True)  # -> simplify(Tree)
graft_7 = GraftTree(Tree=move_21.Geometry, IncludeEmptyLists=True, IncludeNullItems=True)  # -> simplify(Tree)
pt_29 = Point(pt_5)
findbrepintersect_3 = FindBrepIntersect(BrepMain=boundary_6, BrepStay=boundary_5)  # -> out, BrepInters, BrepRemain; inputs BrepMain: list of Brep, BrepStay: list of Brep; same code as findbrepintersect
item_43 = ListItem(List=graft_7, Index=findbrepintersect_3.BrepInters, Wrap=True)
pull_11 = PullPoint(Point=item_43, Geometry=pt_29, ClosestOnly=True)  # -> ClosestPoint, Distance
pull_12 = PullPoint(Point=pull_11.ClosestPoint, Geometry=boundary_5, ClosestOnly=True)  # -> ClosestPoint, Distance
ln_31 = Line(StartPoint=pull_11.ClosestPoint, EndPoint=pull_12.ClosestPoint)
rotate_14 = Rotate(Geometry=ln_31, Angle=1.570796327, Plane=pull_12.ClosestPoint)  # -> Geometry, Transform
pl_16 = ConstructPlane(Origin=pull_12.ClosestPoint, XAxis=ln_31, YAxis=rotate_14.Geometry)
orient_18 = Orient(Geometry=item_39, Source=pl_13, Target=pl_16)  # -> Geometry, Transform
cull_i_10 = CullIndex(List=graft_6, Indices=findbrepintersect_3.BrepInters, Wrap=True)

boundary_7 = BoundarySurfaces(Edges=crv_6)  # -> simplify(Surfaces)
boundary_8 = BoundarySurfaces(Edges=orient_15.Geometry)  # -> simplify(graft(Surfaces))
graft_8 = GraftTree(Tree=data_8, IncludeEmptyLists=True, IncludeNullItems=True)  # -> simplify(Tree)
graft_9 = GraftTree(Tree=move_23.Geometry, IncludeEmptyLists=True, IncludeNullItems=True)  # -> simplify(Tree)
pt_30 = Point(pt_5)
findbrepintersect_4 = FindBrepIntersect(BrepMain=boundary_8, BrepStay=boundary_7)  # -> out, BrepInters, BrepRemain; inputs BrepMain: list of Brep, BrepStay: list of Brep; same code as findbrepintersect
item_44 = ListItem(List=graft_9, Index=findbrepintersect_4.BrepInters, Wrap=True)
pull_13 = PullPoint(Point=item_44, Geometry=pt_30, ClosestOnly=True)  # -> ClosestPoint, Distance
pull_14 = PullPoint(Point=pull_13.ClosestPoint, Geometry=boundary_7, ClosestOnly=True)  # -> ClosestPoint, Distance
ln_32 = Line(StartPoint=pull_13.ClosestPoint, EndPoint=pull_14.ClosestPoint)
rotate_15 = Rotate(Geometry=ln_32, Angle=1.570796327, Plane=pull_14.ClosestPoint)  # -> Geometry, Transform
pl_17 = ConstructPlane(Origin=pull_14.ClosestPoint, XAxis=ln_32, YAxis=rotate_15.Geometry)
orient_19 = Orient(Geometry=item_39, Source=pl_13, Target=pl_17)  # -> Geometry, Transform
cull_i_11 = CullIndex(List=graft_8, Indices=findbrepintersect_4.BrepInters, Wrap=True)

merge_8 = Merge(Data1=cull_i_8, Data2=orient_16.Geometry)
merge_9 = Merge(Data1=cull_i_9, Data2=orient_17.Geometry)
merge_10 = Merge(Data1=cull_i_10, Data2=orient_18.Geometry)
merge_11 = Merge(Data1=cull_i_11, Data2=orient_19.Geometry)
merge_12 = Merge(Data1=data_3, Data2=merge_8, Data3=merge_9)
merge_13 = Merge(Data1=data_7, Data2=merge_10, Data3=merge_11)
merge_14 = Merge(Data1=merge_12, Data2=merge_13)

# ---- group: 单体定Top/Side
item_45 = ListItem(List=geo_2, Index=2, Wrap=True)
item_46 = ListItem(List=geo_2, Index=Slider(0, range=0..10), Wrap=True)
cluster_6 = Cluster(G=item_45)

# ----
flatten_6 = FlattenTree(Tree=item_46, Path="{0}")
item_47 = ListItem(List=flatten_6, Index="1", Wrap=True)
item_48 = ListItem(List=flatten_6, Index=0, Wrap=True)

# ---- group: 单体定Top/Side (continued)
cluster_7 = Cluster(G=item_48)

# ---- group: 单体定Top/Side / Top/Side
filter_13 = StreamFilter(Gate=0, Stream0=0.91, Stream1=cluster_6)

# ----
cluster_8 = Cluster(G=item_47)
merge_15 = Merge(Data1=cluster_8, Data2=cluster_7, Data3=cluster_5)

# ==== cluster Cluster
G = ClusterInput()
rotate = Rotate(Geometry=G, Angle=3.141592654, Plane=PlaneXY(0, 0, 0))  # -> Geometry, Transform
boxprop = BoxProperties(Box=rotate.Geometry)  # -> Center, Diagonal, Area, Volume, Degeneracy
bbox = BoundingBox(Content=rotate.Geometry, Plane=PlaneXY(0, 0, 0))  # -> Box, Box_2
debox = DeconstructBox(Box=bbox.Box)  # -> Plane, X, Y, Z
pdecon = Deconstruct(Point=boxprop.Center)  # -> XComponent, YComponent, ZComponent
dedomain = DeconstructDomain(Domain=debox.Y)  # -> Start, End
pt = ConstructPoint(XCoordinate=pdecon.XComponent, YCoordinate=dedomain.Start, ZCoordinate=pdecon.ZComponent)
xy = XYPlane(Origin=Point(0, 0, 0))
pl_origin = PlaneOrigin(Base=xy, Origin=pt)
orient = Orient(Geometry=rotate.Geometry, Source=pl_origin, Target=xy)  # -> Geometry, Transform
G_2 = ClusterOutput(orient.Geometry)
