# Grasshopper definition FacadeEmbed_jinqiao-3D.gh (Grasshopper 1.0.7)
# plug-ins: EleFront, Hare, Pufferfish

# ---- group: 混凝土
# 板埋几何INPUT
list = ValueList({"C15": 0, "C20": 1, "C25": 2, "C30": 3, "C35": 4, "C40": 5}, selected="C35")

# ---- group: 钢筋牌号
list_2 = ValueList({"HPB300": 0, "HRB400": 1}, selected="HPB300")

# ---- group: 直径
list_3 = ValueList({"10": 0, "12": 1, "16": 2, "18": 3, "20": 4, "25": 5}, selected="12")

# ---- group: 锚筋间距
s_y = Slider(22, range=14..60, expression="X*5")
s_x = Slider(22, range=14..60, expression="X*5")

# ---- group: 列
list_4 = ValueList({"2X": 0, "3X": 1, "4X": 2}, selected="3X")

# ---- group: 行
list_5 = ValueList({"2Y": 0, "3Y": 1, "4Y": 2}, selected="2Y")

# ---- group: 螺栓直径
list_6 = ValueList({"10": 0, "12": 1, "16": 2, "18": 3, "20": 4, "25": 5}, selected="16")

# ---- group: 锚筋直径
list_7 = ValueList({"10": 0, "12": 1, "16": 2, "18": 3, "20": 4, "25": 5}, selected="12")

# ---- group: 锚筋间距
s_x_2 = Slider(25, range=14..60, expression="X*5")
s_y_2 = Slider(20, range=14..60, expression="X*5")

# ---- group: 列
list_8 = ValueList({"2X": 0, "3X": 1, "4X": 2}, selected="3X")

# ---- group: 行
list_9 = ValueList({"2Y": 0, "3Y": 1, "4Y": 2}, selected="2Y")

# ----
# 板槽几何input
addition = Addition(A=list_8, B=1)
addition_2 = Addition(A=list_9, B=1)
锚板厚度 = Slider(12, range=0..100)
value_list = ValueList({"锚筋": 0, "锚焊": 1}, selected="锚焊")
锚筋末端焊板厚度 = Slider(12, range=0..100)
curve = Curve(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)
槽长 = Slider(270, range=0..1000)
锚筋到边 = Panel("75")
锚筋长度 = Slider(12, range=0..30, expression="x*10")
subtraction = Subtraction(A=锚筋长度, B=锚板厚度)
锚筋末端焊板边长 = Slider(40, range=0..100)
filter = StreamFilter(Gate=list_6, Stream0=10, Stream1=12, Stream2=16, Stream3=18, Stream4=20, Stream5=25)
filter_2 = StreamFilter(Gate=list_7, Stream0=10, Stream1=12, Stream2=16, Stream3=18, Stream4=20, Stream5=25)

# ---- group: 螺栓直径
list_10 = ValueList({"10": 0, "12": 1, "16": 2, "18": 3, "20": 4, "25": 5}, selected="16")

# ---- group: 锚筋直径
list_11 = ValueList({"10": 0, "12": 1, "16": 2, "18": 3, "20": 4, "25": 5}, selected="12")

# ---- group: 锚筋间距
s_x_3 = Slider(25, range=14..60, expression="X*5")
s_y_3 = Slider(20, range=14..60, expression="X*5")

# ---- group: 列
list_12 = ValueList({"2X": 0, "3X": 1, "4X": 2}, selected="3X")

# ---- group: 行
list_13 = ValueList({"2Y": 0, "3Y": 1, "4Y": 2}, selected="2Y")

# ----
# 钢板槽几何input
list_14 = ValueList({"板埋": 0, "槽埋": 1}, selected="板埋")
list_15 = ValueList({"顶埋": 0, "侧埋": 1}, selected="顶埋")
addition_3 = Addition(A=list_12, B=1)
addition_4 = Addition(A=list_13, B=1)
板凳厚度 = Slider(16, range=0..100)
value_list_2 = ValueList({"锚筋": 0, "锚焊": 1}, selected="锚焊")
锚筋末端焊板厚度_2 = Slider(12, range=0..100)
锚筋到边_2 = Panel("75")
锚筋长度_2 = Slider(12, range=0..30, expression="x*10")
锚板厚度_2 = Slider(12, range=0..100)
subtraction_2 = Subtraction(A=锚筋长度_2, B=锚板厚度_2)
锚筋末端焊板边长_2 = Slider(40, range=0..100)
curve_2 = Curve(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)
槽长_2 = Slider(270, range=0..1000)
filter_3 = StreamFilter(Gate=list_11, Stream0=10, Stream1=12, Stream2=16, Stream3=18, Stream4=20, Stream5=25)
filter_4 = StreamFilter(Gate=list_10, Stream0=10, Stream1=12, Stream2=16, Stream3=18, Stream4=20, Stream5=25)

max = Maximum(A=s_x, B=s_y)
filter_5 = StreamFilter(Gate=list, Stream0=7.2, Stream1=9.6, Stream2=11.9, Stream3=14.3, Stream4=16.7, Stream5=19.1)
filter_6 = StreamFilter(Gate=list_2, Stream0=270, Stream1=360)
filter_7 = StreamFilter(Gate=list_3, Stream0=10, Stream1=12, Stream2=16, Stream3=18, Stream4=20, Stream5=25)
filter_8 = StreamFilter(Gate=list, Stream0=0.91, Stream1=1.1, Stream2=1.27, Stream3=1.43, Stream4=1.57, Stream5=1.71)
filter_9 = StreamFilter(Gate=list_2, Stream0=0.16, Stream1=0.14)
addition_5 = Addition(A=list_4, B=1)
addition_6 = Addition(A=list_5, B=1)
division = Division(A=max, B=8)
t = Integer(division)
panel = Panel(filter_8)
panel_2 = Panel(filter_5)
panel_3 = Panel(filter_9)
min = Minimum(A=filter_6, B=300)
panel_4 = Panel(min)
expression = Expression(A=filter_9, fy=filter_6, ft=filter_8, d=filter_7, Expression="(int((0.6*1.1*A*fy/ft*d)/5)+1)*5")

yz_plane = YZPlane(Origin=Point(0, 0, 0))
orient = Orient(Geometry=curve, Source=PlaneXY(0, 0, 0), Target=yz_plane)  # -> Geometry, Transform
unit_x = UnitX(Factor=槽长)
division_2 = Division(A=槽长, B=2)
extrude = Extrude(Base=orient.Geometry, Direction=unit_x)
unit_x_2 = UnitX(Factor=division_2)
move = Move(Geometry=extrude, Motion=expr("-x", unit_x_2))  # -> Geometry, Transform
cap_holes = CapHoles(Brep=move.Geometry)

# ----
# 导入槽埋模型
brep = Brep(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)  # disabled

# ----
# 槽埋Modeling
brep_2 = Brep(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)  # disabled
bbox = BoundingBox(Content=brep, Plane=PlaneXY(0, 0, 0))  # -> Box, Box_2; disabled
debox = DeconstructBox(Box=bbox.Box)  # -> Plane, X, Y, Z; disabled
area = Area(Geometry=brep)  # -> Area, Centroid; disabled
edges = BrepEdges(Brep=bbox.Box)  # -> Naked, Interior, NonManifold; disabled
panel_5 = Panel("5")  # disabled
panel_6 = Panel("4")  # disabled
item = ListItem(List=edges.Interior, Index=panel_5, Wrap=True)  # disabled
item_2 = ListItem(List=edges.Interior, Index=panel_6, Wrap=True)  # disabled
pdecon = Deconstruct(Point=area.Centroid)  # -> XComponent, YComponent, ZComponent; disabled
dedomain = DeconstructDomain(Domain=debox.Z)  # -> Start, End; disabled
clx = CurveLine(Curve=item_2, Line=item)  # -> Points, Params, Count; disabled
Y = UnitY(Factor=item)  # disabled
xy = XYPlane(Origin=Point(0, 0, 0))  # disabled
pt = ConstructPoint(XCoordinate=pdecon.XComponent, YCoordinate=pdecon.YComponent, ZCoordinate=dedomain.End)  # disabled
rotate = Rotate(Geometry=brep, Angle=1.570796327, Plane=clx.Points)  # -> Geometry, Transform; disabled
move_2 = Move(Geometry=rotate.Geometry, Motion=Y)  # -> Geometry, Transform; disabled
pl_origin = PlaneOrigin(Base=xy, Origin=pt)  # disabled
merge = Merge(Data1=brep, Data2=move_2.Geometry)  # -> flatten(Result); disabled
sunion = SolidUnion(Breps=merge)  # disabled
bbox_2 = BoundingBox(Content=sunion, Plane=PlaneXY(0, 0, 0))  # -> Box, Box_2; disabled
area_2 = Area(Geometry=sunion)  # -> Area, Centroid; disabled
xy_2 = XYPlane(Origin=Point(0, 0, 0))  # disabled
debox_2 = DeconstructBox(Box=bbox_2.Box)  # -> Plane, X, Y, Z; disabled
pdecon_2 = Deconstruct(Point=area_2.Centroid)  # -> XComponent, YComponent, ZComponent; disabled
orient_2 = Orient(Geometry=brep, Source=pl_origin, Target=xy_2)  # -> Geometry, Transform; disabled
dedomain_2 = DeconstructDomain(Domain=debox_2.Z)  # -> Start, End; disabled
pt_2 = ConstructPoint(XCoordinate=pdecon_2.XComponent, YCoordinate=pdecon_2.YComponent, ZCoordinate=dedomain_2.End)  # disabled
xy_3 = XYPlane(Origin=Point(0, 0, 0))  # disabled
pl_origin_2 = PlaneOrigin(Base=xy_3, Origin=pt_2)  # disabled
xy_4 = XYPlane(Origin=Point(0, 0, 0))  # disabled
orient_3 = Orient(Geometry=sunion, Source=pl_origin_2, Target=xy_4)  # -> Geometry, Transform; disabled

filter_10 = StreamFilter(Gate=0, Stream0=orient_3.Geometry, Stream1=orient_2.Geometry)  # disabled
entwine = Entwine(Branch00=orient_2.Geometry, Branch01=filter_10, FlattenInputs=True)  # disabled

# ----
# 平面类型INPUT
list_16 = ValueList({"楼板部分挑空": 0, "纯楼板": 1, "纯挑空/塔冠": 2, "女儿墙": 3}, selected="楼板部分挑空")

# ----
# 柱线-所有type
crv = Curve([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])
crv_2 = Curve([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])

# ----
# 建筑线-所有type
crv_3 = Curve(<curve referenced from the Rhino model>)
crv_4 = Curve(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)
crv_5 = Curve(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)

# ----
# 定位线/梁中线-所有type
crv_6 = Curve(<curve referenced from the Rhino model>)
crv_7 = Curve(<curve referenced from the Rhino model>)
crv_8 = Curve(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)

# ----
# 平面定位INPUT
crv_9 = Curve([<curve referenced from the Rhino model> x16])

# ----
# 板边线-只有部分贯通的时候导入
crv_10 = Curve(<curve referenced from the Rhino model>)

crv_11 = Curve(<curve referenced from the Rhino model>)

# ----
# 埋件offset-常规input1
number_slider = Slider(100, range=0..1000)

# ----
# 埋件offset-常规input2
number_slider_2 = Slider(500, range=0..1000)

# ----
# 埋件offset-女儿墙input
number_slider_3 = Slider(245, range=0..1000)

filter_11 = StreamFilter(Gate=list_16, Stream0=number_slider, Stream1=number_slider, Stream2=number_slider, Stream3=number_slider_3)

# ----
# 简化线段
disc = Discontinuity(Curve=crv_3, Level=1)  # -> Points, Parameters
shift = ShiftList(List=disc.Points, Shift=1, Wrap=True)
ln = Line(StartPoint=disc.Points, EndPoint=shift)
len = Length(Curve=ln)
sort = SortList(Keys=len)  # -> Keys, ValuesA
panel_7 = Panel(sort.Keys)
smaller = SmallerThan(FirstNumber=len, SecondNumber=Slider(20, range=0..100))  # -> SmallerThan, OrEqualTo
dispatch = Dispatch(List=disc.Points, DispatchPattern=smaller.SmallerThan)  # -> ListA, ListB
pt_3 = Point(dispatch.ListA)
pt_4 = Point(dispatch.ListB)

filter_12 = StreamFilter(Gate=list_16, Stream0=number_slider_2, Stream1=number_slider_2, Stream2=number_slider_2, Stream3=number_slider_3)

disc_2 = Discontinuity(Curve=crv_6, Level=1)  # -> Points, Parameters
shift_2 = ShiftList(List=disc_2.Points, Shift=1, Wrap=True)
ln_2 = Line(StartPoint=disc_2.Points, EndPoint=shift_2)
len_2 = Length(Curve=ln_2)
sort_2 = SortList(Keys=len_2)  # -> Keys, ValuesA
panel_8 = Panel(sort_2.Keys)
smaller_2 = SmallerThan(FirstNumber=len_2, SecondNumber=Slider(130, range=0..1000))  # -> SmallerThan, OrEqualTo
dispatch_2 = Dispatch(List=disc_2.Points, DispatchPattern=smaller_2.SmallerThan)  # -> ListA, ListB
pt_5 = Point(dispatch_2.ListA)
pt_6 = Point(dispatch_2.ListB)

pline = PolyLine(Vertices=pt_4, Closed=invert(False))
pline_2 = PolyLine(Vertices=pt_6, Closed=invert(False))
filter_13 = StreamFilter(Gate=list_16, Stream0=crv_11, Stream1=pline_2, Stream2=pline_2, Stream3=pline_2)

flip = FlipCurve(Curve=pline_2)  # -> Curve, Flag
filter_14 = StreamFilter(Gate=Toggle(False), Stream0=pline_2, Stream1=flip.Curve)
offset = OffsetCurve(Curve=filter_14, Distance=Slider(100, range=0..100), Corners=1)
disc_3 = Discontinuity(Curve=offset, Level=1)  # -> Points, Parameters

# ---- group: Block
panel_9 = Panel("embed1")
layer = DefineLayer(Name="Embeded::Embeded", Color=ColourSwatch(SwatchColor=RGB(255, 0, 0)))
attributes = DefineObjectAttributes(Layer=layer)

# ----
filter_15 = StreamFilter(Gate="0.5*Pi", Stream0="-0.5*Pi", Stream1="-0.5*Pi", Stream2="-0.5*Pi", Stream3="-0.5*Pi")
panel_10 = Panel("0.5*Pi")
filter_16 = StreamFilter(Gate=list_16, Stream0="-0.5*Pi", Stream1="-0.5*Pi", Stream2="-0.5*Pi", Stream3="-0.5*Pi")

panel_11 = Panel("-0.5 * Pi")
filter_17 = StreamFilter(Gate=list_16, Stream0="0.5 * Pi", Stream1="0.5 * Pi", Stream2="0.5 * Pi", Stream3="0.5 * Pi")

filter_18 = StreamFilter(Gate=list_16, Stream0="0.5 * Pi", Stream1="0.5 * Pi", Stream2="0.5 * Pi", Stream3="0.5 * Pi")

filter_19 = StreamFilter(Gate=list_16, Stream0="0.5 * Pi", Stream1="0.5 * Pi", Stream2="0.5 * Pi", Stream3="0.5 * Pi")

boundary = BoundarySurfaces(Edges=crv_9)  # -> simplify(Surfaces)
swatch = ColourSwatch(SwatchColor=RGB(0, 76, 255))
swatch_2 = ColourSwatch(SwatchColor=RGB(255, 77, 243))
swatch_3 = ColourSwatch(SwatchColor=RGB(255, 77, 77))
swatch_4 = ColourSwatch(SwatchColor=RGB(255, 241, 135))
col = Colour(swatch_4)
col_2 = Colour(swatch_2)
col_3 = Colour(swatch)
col_4 = Colour(swatch)
col_5 = Colour(swatch_3)
col_6 = Colour(swatch)
col_7 = Colour(swatch_4)
col_8 = Colour(swatch_2)
col_9 = Colour(swatch_4)
col_10 = Colour(swatch_2)
col_11 = Colour(swatch_3)
filter_20 = StreamFilter(Gate=list_16, Stream0=col_9, Stream1=swatch, Stream2=col_9, Stream3=col_10)
filter_21 = StreamFilter(Gate=list_16, Stream0=col, Stream1=swatch, Stream2=col, Stream3=col_2)
filter_22 = StreamFilter(Gate=list_16, Stream0=col_7, Stream1=swatch, Stream2=col_7, Stream3=col_8)
filter_23 = StreamFilter(Gate=list_16, Stream0=col_11, Stream1=swatch, Stream2=col_11, Stream3=col_11)
brep_3 = Brep([<brep referenced from the Rhino model> x23])
brep_4 = Brep([<brep referenced from the Rhino model> x16])
brep_5 = Brep([<brep referenced from the Rhino model> x6])
brep_6 = Brep([<brep referenced from the Rhino model> x4324])
material = CreateMaterial(
    Diffuse=ColourSwatch(SwatchColor=RGB(255, 255, 255)),
    Specular=RGB(255, 255, 255),
    Emission=RGB(0, 0, 0),
    Transparency=Slider(0.7, range=0..1),
    Shine=0)
material_2 = CreateMaterial(
    Diffuse=ColourSwatch(SwatchColor=RGB(242, 242, 242)),
    Specular=RGB(255, 255, 255),
    Emission=RGB(0, 0, 0),
    Transparency=Slider(0.7, range=0..1),
    Shine=0)
material_3 = CreateMaterial(
    Diffuse=ColourSwatch(SwatchColor=RGB(255, 255, 255)),
    Specular=RGB(255, 255, 255),
    Emission=RGB(0, 0, 0),
    Transparency=Slider(0.6, range=0..1),
    Shine=0)
material_4 = CreateMaterial(
    Diffuse=ColourSwatch(SwatchColor=RGB(186, 186, 186)),
    Specular=RGB(255, 255, 255),
    Emission=RGB(0, 0, 0),
    Transparency=Slider(0.97, range=0..1),
    Shine=0)
preview = CustomPreview(Geometry=brep_3, Material=material)
preview_2 = CustomPreview(Geometry=brep_5, Material=material_2)
preview_3 = CustomPreview(Geometry=brep_4, Material=material_3)
preview_4 = CustomPreview(Geometry=brep_6, Material=material_4)
layer_2 = DefineLayer(Name="half")
layer_3 = DefineLayer(Name="half")
layer_4 = DefineLayer(Name="half")
layer_5 = DefineLayer(Name="half")
layer_6 = DefineLayer(Name="half")
layer_7 = DefineLayer(Name="half")
layer_8 = DefineLayer(Name="half")
layer_9 = DefineLayer(Name="half")
layer_10 = DefineLayer(Name="half")
attributes_2 = DefineObjectAttributes(Layer=layer_2, Material=filter_21)
attributes_3 = DefineObjectAttributes(Layer=layer_3, Material=col_5)
attributes_4 = DefineObjectAttributes(Layer=layer_4, Material=col_4)
attributes_5 = DefineObjectAttributes(Layer=layer_5, Material=swatch_3)
attributes_6 = DefineObjectAttributes(Layer=layer_6, Material=col_3)
attributes_7 = DefineObjectAttributes(Layer=layer_7, Material=filter_23)
attributes_8 = DefineObjectAttributes(Layer=layer_8, Material=col_6)
attributes_9 = DefineObjectAttributes(Layer=layer_9, Material=filter_20)
attributes_10 = DefineObjectAttributes(Layer=layer_10, Material=filter_22)

# ----
# 钢板槽Modeling
recgrid = Rectangular(Plane=PlaneXY(0, 0, 0), SizeX=s_x_3, SizeY=s_y_3, ExtentX=addition_3, ExtentY=addition_4)  # -> Cells, Points
multiplication = Multiplication(A=s_x_3, B=addition_3)
multiplication_2 = Multiplication(A=s_y_3, B=addition_4)
division_3 = Division(A=multiplication, B=2)
division_4 = Division(A=multiplication_2, B=2)
vec = VectorXYZ(XComponent=expr("-x", division_3), YComponent=expr("-x", division_4), ZComponent=0)  # -> Vector, Length
division_5 = Division(A=filter_3, B=2)
move_3 = Move(Geometry=recgrid.Points, Motion=vec.Vector)  # -> Geometry, Transform
multiplication_3 = Multiplication(A=division_5, B=2)
yz_plane_2 = YZPlane(Origin=Point(0, 0, 0))
orient_4 = Orient(Geometry=curve_2, Source=PlaneXY(0, 0, 0), Target=yz_plane_2)  # -> Geometry, Transform
divide_curve = DivideCurve(Curve=orient_4.Geometry, Count=Slider(50, range=0..100), Kinks=False)  # -> Points, Tangents, Parameters
unit_x_3 = UnitX(Factor=槽长_2)
division_6 = Division(A=槽长_2, B=2)
extrude_2 = Extrude(Base=orient_4.Geometry, Direction=unit_x_3)
unit_x_4 = UnitX(Factor=division_6)
convex_hull = ConvexHull(Points=divide_curve.Points, Plane=yz_plane_2)  # -> Hull, HullZ, Indices
move_4 = Move(Geometry=extrude_2, Motion=expr("-x", unit_x_4))  # -> Geometry, Transform
boundary_surfaces = BoundarySurfaces(Edges=convex_hull.Hull)
multiplication_4 = Multiplication(A=Slider(10, range=0..100), B=2)
subtraction_3 = Subtraction(A=槽长_2, B=multiplication_4)
unit_z = UnitZ(Factor=expr("-X", subtraction_2))
cap_holes_2 = CapHoles(Brep=move_4.Geometry)
unit_x_5 = UnitX(Factor=subtraction_3)
extrude_3 = Extrude(Base=boundary_surfaces, Direction=unit_x_5)
division_7 = Division(A=unit_x_5, B=2)
extrude_4 = Extrude(Base=boundary_surfaces, Direction=unit_x_3)
move_5 = Move(Geometry=extrude_3, Motion=expr("-x", division_7))  # -> Geometry, Transform
move_6 = Move(Geometry=extrude_4, Motion=expr("-x", unit_x_4))  # -> Geometry, Transform
solid_difference = SolidDifference(BrepsA=move_6.Geometry, BrepsB=move_5.Geometry)
Z = UnitZ(Factor=expr("-x", 锚板厚度_2))
xy_plane = XYPlane(Origin=Point(0, 0, 0))
deconstruct_plane = DeconstructPlane(Plane=xy_plane)  # -> Origin, XAxis, YAxis, ZAxis

multiplication_5 = Multiplication(A=multiplication_3, B=6)
max_2 = Maximum(A=multiplication_5, B=70)
multiplication_6 = Multiplication(A=锚筋到边_2, B=2)
addition_7 = Addition(A=multiplication, B=multiplication_6)
addition_8 = Addition(A=multiplication_2, B=multiplication_6)
expression_2 = Expression(x=addition_7, Expression="Ceiling(x/10)*10/2")
expression_3 = Expression(x=addition_8, Expression="Ceiling(x/10)*10/2")
dom = ConstructDomain(DomainStart=expr("-x", expression_2), DomainEnd=expression_2)
dom_2 = ConstructDomain(DomainStart=expr("-x", expression_3), DomainEnd=expression_3)
box = DomainBox(Base=PlaneXY(0, 0, 0), X=dom, Y=dom_2, Z=锚板厚度_2)

flip_matrix = FlipMatrix(Data=move_3.Geometry)
cull_first_last = CullFirstLast(List=flip_matrix)  # -> CullFirst, CullLast, CullFirstAndEnd
point = Point(cull_first_last.CullFirstAndEnd)
flip_matrix_2 = FlipMatrix(Data=point)
number_slider_4 = Slider(50, range=0..100)
polyline = PolyLine(Vertices=flip_matrix_2, Closed=False)
extend_curve = ExtendCurve(Curve=polyline, Type=0, Start=number_slider_4, End=number_slider_4)
xy_plane_2 = XYPlane(Origin=Point(0, 0, 0))
average = Average(Input=move_3.Geometry)
addition_9 = Addition(A=filter_4, B=Slider(1, range=0..1))
multiplication_7 = Multiplication(A=filter_3, B=2.5)
division_8 = Division(A=addition_9, B=2)
polyline_2 = PolyLine(Vertices=flatten(average), Closed=False)
negative = Negative(Value=division_8)
offset_curve = OffsetCurve(
    Curve=extend_curve,
    Distance=[Slider(25, range=0..100), Slider(25, range=0..100, expression="-x")],
    Plane=xy_plane_2,
    Corners=1)
circle = Circle(Plane=move_3.Geometry, Radius=multiplication_7)
shift_paths = ShiftPaths(Data=offset_curve, Offset=-1)
region_union = RegionUnion(Curves=circle)
offset_curve_2 = OffsetCurve(Curve=polyline_2, Distance=[division_8, negative], Plane=xy_plane_2, Corners=1)
boundary_surfaces_2 = BoundarySurfaces(Edges=region_union)
loft = Loft(Curves=shift_paths, Options={Adjust=False, Closed=False, LoftEnds=0, LoftSimp=0, LoftType=0, Rebuild=10, Refit=0.01})
trim_with_regions = TrimWithRegions(Curve=offset_curve_2, Regions=flatten(boundary_surfaces_2))  # -> Inside, Outside
trim_with_regions_2 = TrimWithRegions(Curve=trim_with_regions.Outside, Regions=flatten(loft))  # -> Inside, Outside
curve_3 = Curve(trim_with_regions_2.Outside)
flip_matrix_3 = FlipMatrix(Data=curve_3)
loft_2 = Loft(Curves=flip_matrix_3, Options={Adjust=False, Closed=False, LoftEnds=0, LoftSimp=0, LoftType=0, Rebuild=10, Refit=0.01})
length = Length(Curve=flip_matrix_3)  # -> flatten(Length)
brep_edges = BrepEdges(Brep=loft_2)  # -> Naked, Interior, NonManifold
max_min = MaxMin(Numbers=length)  # -> Max, MaxIndex, Min, MinIndex
join_curves = JoinCurves(Curves=brep_edges.Naked, Preserve=False)
number_slider_5 = Slider(100, range=0..100)
subtraction_4 = Subtraction(A=max_min.Min, B=filter_4)
fillet = Fillet(Curve=join_curves, Radius=division_8)
unit_z_2 = UnitZ(Factor=expr("-x", number_slider_5))
unit_z_3 = UnitZ(Factor=number_slider_5)
boundary_surfaces_3 = BoundarySurfaces(Edges=fillet)
extrude_5 = Extrude(Base=boundary_surfaces_3, Direction=[unit_z_3, unit_z_2])
solid_difference_2 = SolidDifference(BrepsA=box, BrepsB=flatten(extrude_5))

subtraction_5 = Subtraction(A=expression_3, B=板凳厚度)
dom_3 = ConstructDomain(DomainStart=expr("-x", subtraction_5), DomainEnd=subtraction_5)
rectangle = Rectangle(Plane=PlaneXY(0, 0, 0), XSize=dom, YSize=dom_3, Radius=0)  # -> Rectangle, Length
rectangle_2 = Rectangle(Plane=PlaneXY(0, 0, 0), XSize=dom, YSize=dom_2, Radius=0)  # -> Rectangle, Length
region_difference = RegionDifference(CurvesA=rectangle_2.Rectangle, CurvesB=rectangle.Rectangle)
boundary_surfaces_4 = BoundarySurfaces(Edges=region_difference)
extrude_6 = Extrude(Base=boundary_surfaces_4, Direction=unit_z)
merge_2 = Merge(Data1=extrude_6, Data2=solid_difference_2, Data3=cap_holes_2, Data4=solid_difference)
flatten = FlattenTree(Tree=merge_2, Path="{0}")

move_7 = Move(Geometry=flatten, Motion=Z)  # -> Geometry, Transform
centre_point = Point(deconstruct_plane.Origin)

geo = Geometry(move_7.Geometry)
group = Group(Objects=geo)
bbox_3 = BoundingBox(Content=group, Plane=PlaneXY(0, 0, 0))  # -> Box, Box_2
A = Area(Geometry=bbox_3.Box)  # -> Area, Centroid
xz = XZPlane(Origin=A.Centroid)
xy_5 = XYPlane(Origin=A.Centroid)
rotate_2 = Rotate(Geometry=group, Angle=degrees(Slider(180, range=0..1000)), Plane=xz)  # -> Geometry, Transform
rotate_3 = Rotate(Geometry=rotate_2.Geometry, Angle=degrees(Slider(0, range=0..270)), Plane=xy_5)  # -> Geometry, Transform
yz = YZPlane(Origin=A.Centroid)
rotate_4 = Rotate(Geometry=rotate_3.Geometry, Angle=degrees(Slider(0, range=0..270)), Plane=yz)  # -> Geometry, Transform
cluster = Cluster(G=rotate_4.Geometry)

# ----
# 板槽Modeling
recgrid_2 = Rectangular(Plane=PlaneXY(0, 0, 0), SizeX=s_x_2, SizeY=s_y_2, ExtentX=addition, ExtentY=addition_2)  # -> Cells, Points
multiplication_8 = Multiplication(A=s_x_2, B=addition)
multiplication_9 = Multiplication(A=s_y_2, B=addition_2)
division_9 = Division(A=multiplication_8, B=2)
division_10 = Division(A=multiplication_9, B=2)
vec_2 = VectorXYZ(XComponent=expr("-x", division_9), YComponent=expr("-x", division_10), ZComponent=0)  # -> Vector, Length
move_8 = Move(Geometry=recgrid_2.Points, Motion=vec_2.Vector)  # -> Geometry, Transform
division_11 = Division(A=filter_2, B=2)
divide_curve_2 = DivideCurve(Curve=orient.Geometry, Count=Slider(50, range=0..100), Kinks=False)  # -> Points, Tangents, Parameters
convex_hull_2 = ConvexHull(Points=divide_curve_2.Points, Plane=yz_plane)  # -> Hull, HullZ, Indices
boundary_surfaces_5 = BoundarySurfaces(Edges=convex_hull_2.Hull)
multiplication_10 = Multiplication(A=Slider(10, range=0..100), B=2)
subtraction_6 = Subtraction(A=槽长, B=multiplication_10)
unit_x_6 = UnitX(Factor=subtraction_6)
extrude_7 = Extrude(Base=boundary_surfaces_5, Direction=unit_x_6)
division_12 = Division(A=unit_x_6, B=2)
extrude_8 = Extrude(Base=boundary_surfaces_5, Direction=unit_x)
move_9 = Move(Geometry=extrude_7, Motion=expr("-x", division_12))  # -> Geometry, Transform
move_10 = Move(Geometry=extrude_8, Motion=expr("-x", unit_x_2))  # -> Geometry, Transform
solid_difference_3 = SolidDifference(BrepsA=move_10.Geometry, BrepsB=move_9.Geometry)
Z_2 = UnitZ(Factor=expr("-x", 锚板厚度))
xy_plane_3 = XYPlane(Origin=Point(0, 0, 0))
deconstruct_plane_2 = DeconstructPlane(Plane=xy_plane_3)  # -> Origin, XAxis, YAxis, ZAxis

unit_z_4 = UnitZ(Factor=expr("x", 锚筋末端焊板厚度))
unit_z_5 = UnitZ(Factor=expr("-x", subtraction))
division_13 = Division(A=锚筋末端焊板边长, B=2)
construct_domain = ConstructDomain(DomainStart=expr("-x", division_13), DomainEnd=division_13)
move_11 = Move(Geometry=move_8.Geometry, Motion=unit_z_5)  # -> Geometry, Transform
rectangle_3 = Rectangle(Plane=move_11.Geometry, XSize=construct_domain, YSize=construct_domain, Radius=0)  # -> Rectangle, Length
extrude_9 = Extrude(Base=rectangle_3.Rectangle, Direction=unit_z_4)

multiplication_11 = Multiplication(A=division_11, B=2)
cyl = Cylinder(Base=move_8.Geometry, Radius=division_11, Length=expr("-x", subtraction))
edges_2 = BrepEdges(Brep=cyl)  # -> Naked, Interior, NonManifold
multiplication_12 = Multiplication(A=multiplication_11, B=5)
item_3 = ListItem(List=edges_2.Naked, Index=0, Wrap=True)
X = UnitX(Factor=multiplication_11)
Z_3 = UnitZ(Factor=multiplication_12)
move_12 = Move(Geometry=item_3, Motion=X)  # -> Geometry, Transform
extr = Extrude(Base=move_12.Geometry, Direction=Z_3)

multiplication_13 = Multiplication(A=multiplication_11, B=6)
max_3 = Maximum(A=multiplication_13, B=70)
multiplication_14 = Multiplication(A=锚筋到边, B=2)
addition_10 = Addition(A=multiplication_8, B=multiplication_14)
addition_11 = Addition(A=multiplication_9, B=multiplication_14)
expression_4 = Expression(x=addition_10, Expression="Ceiling(x/10)*10/2")
expression_5 = Expression(x=addition_11, Expression="Ceiling(x/10)*10/2")
dom_4 = ConstructDomain(DomainStart=expr("-x", expression_4), DomainEnd=expression_4)
dom_5 = ConstructDomain(DomainStart=expr("-x", expression_5), DomainEnd=expression_5)
box_2 = DomainBox(Base=PlaneXY(0, 0, 0), X=dom_4, Y=dom_5, Z=锚板厚度)

flip_matrix_4 = FlipMatrix(Data=move_8.Geometry)
cull_first_last_2 = CullFirstLast(List=flip_matrix_4)  # -> CullFirst, CullLast, CullFirstAndEnd
point_2 = Point(cull_first_last_2.CullFirstAndEnd)
flip_matrix_5 = FlipMatrix(Data=point_2)
number_slider_6 = Slider(50, range=0..100)
polyline_3 = PolyLine(Vertices=flip_matrix_5, Closed=False)
extend_curve_2 = ExtendCurve(Curve=polyline_3, Type=0, Start=number_slider_6, End=number_slider_6)
xy_plane_4 = XYPlane(Origin=Point(0, 0, 0))
average_2 = Average(Input=move_8.Geometry)
addition_12 = Addition(A=filter, B=Slider(1, range=0..1))
multiplication_15 = Multiplication(A=filter_2, B=2.5)
division_14 = Division(A=addition_12, B=2)
polyline_4 = PolyLine(Vertices=flatten(average_2), Closed=False)
negative_2 = Negative(Value=division_14)
offset_curve_3 = OffsetCurve(
    Curve=extend_curve_2,
    Distance=[Slider(25, range=0..100), Slider(25, range=0..100, expression="-x")],
    Plane=xy_plane_4,
    Corners=1)
circle_2 = Circle(Plane=move_8.Geometry, Radius=multiplication_15)
shift_paths_2 = ShiftPaths(Data=offset_curve_3, Offset=-1)
region_union_2 = RegionUnion(Curves=circle_2)
offset_curve_4 = OffsetCurve(Curve=polyline_4, Distance=[division_14, negative_2], Plane=xy_plane_4, Corners=1)
boundary_surfaces_6 = BoundarySurfaces(Edges=region_union_2)
loft_3 = Loft(Curves=shift_paths_2, Options={Adjust=False, Closed=False, LoftEnds=0, LoftSimp=0, LoftType=0, Rebuild=10, Refit=0.01})
trim_with_regions_3 = TrimWithRegions(Curve=offset_curve_4, Regions=flatten(boundary_surfaces_6))  # -> Inside, Outside
trim_with_regions_4 = TrimWithRegions(Curve=trim_with_regions_3.Outside, Regions=flatten(loft_3))  # -> Inside, Outside
curve_4 = Curve(trim_with_regions_4.Outside)
flip_matrix_6 = FlipMatrix(Data=curve_4)
loft_4 = Loft(Curves=flip_matrix_6, Options={Adjust=False, Closed=False, LoftEnds=0, LoftSimp=0, LoftType=0, Rebuild=10, Refit=0.01})
length_2 = Length(Curve=flip_matrix_6)  # -> flatten(Length)
brep_edges_2 = BrepEdges(Brep=loft_4)  # -> Naked, Interior, NonManifold
max_min_2 = MaxMin(Numbers=length_2)  # -> Max, MaxIndex, Min, MinIndex
join_curves_2 = JoinCurves(Curves=brep_edges_2.Naked, Preserve=False)
number_slider_7 = Slider(100, range=0..100)
subtraction_7 = Subtraction(A=max_min_2.Min, B=filter)
fillet_2 = Fillet(Curve=join_curves_2, Radius=division_14)
unit_z_6 = UnitZ(Factor=expr("-x", number_slider_7))
unit_z_7 = UnitZ(Factor=number_slider_7)
boundary_surfaces_7 = BoundarySurfaces(Edges=fillet_2)
extrude_10 = Extrude(Base=boundary_surfaces_7, Direction=[unit_z_7, unit_z_6])
solid_difference_4 = SolidDifference(BrepsA=box_2, BrepsB=flatten(extrude_10))

stream_filter = StreamFilter(Gate=value_list, Stream0=extr, Stream1=extrude_9)
cap = CapHoles(Brep=[cyl, stream_filter])
merge_3 = Merge(Data1=cap, Data2=solid_difference_4, Data3=cap_holes, Data4=solid_difference_3)
flatten_2 = FlattenTree(Tree=merge_3, Path="{0}")

move_13 = Move(Geometry=flatten_2, Motion=Z_2)  # -> Geometry, Transform
centre_point_2 = Point(deconstruct_plane_2.Origin)

geo_2 = Geometry(box_2)

geo_3 = Geometry(move_13.Geometry)
group_2 = Group(Objects=geo_3)
bbox_4 = BoundingBox(Content=group_2, Plane=PlaneXY(0, 0, 0))  # -> Box, Box_2
A_2 = Area(Geometry=bbox_4.Box)  # -> Area, Centroid
xz_2 = XZPlane(Origin=A_2.Centroid)
xy_6 = XYPlane(Origin=A_2.Centroid)
rotate_5 = Rotate(Geometry=group_2, Angle=degrees(Slider(180, range=0..1000)), Plane=xz_2)  # -> Geometry, Transform
rotate_6 = Rotate(Geometry=rotate_5.Geometry, Angle=degrees(Slider(0, range=0..270)), Plane=xy_6)  # -> Geometry, Transform
yz_2 = YZPlane(Origin=A_2.Centroid)
rotate_7 = Rotate(Geometry=rotate_6.Geometry, Angle=degrees(Slider(0, range=0..270)), Plane=yz_2)  # -> Geometry, Transform
cluster_2 = Cluster(G=rotate_7.Geometry)

geo_4 = Geometry(geo_2)
group_3 = Group(Objects=geo_4)
bbox_5 = BoundingBox(Content=group_3, Plane=PlaneXY(0, 0, 0))  # -> Box, Box_2
A_3 = Area(Geometry=bbox_5.Box)  # -> Area, Centroid
xz_3 = XZPlane(Origin=A_3.Centroid)
xy_7 = XYPlane(Origin=A_3.Centroid)
rotate_8 = Rotate(Geometry=group_3, Angle=degrees(Slider(180, range=0..1000)), Plane=xz_3)  # -> Geometry, Transform
rotate_9 = Rotate(Geometry=rotate_8.Geometry, Angle=degrees(Slider(0, range=0..270)), Plane=xy_7)  # -> Geometry, Transform
yz_3 = YZPlane(Origin=A_3.Centroid)
rotate_10 = Rotate(Geometry=rotate_9.Geometry, Angle=degrees(Slider(90, range=0..270)), Plane=yz_3)  # -> Geometry, Transform
cluster_3 = Cluster(G=rotate_10.Geometry)

# ----
# 板埋Modeling
multiplication_16 = Multiplication(A=s_x, B=addition_5)
multiplication_17 = Multiplication(A=s_y, B=addition_6)
recgrid_3 = Rectangular(Plane=PlaneXY(0, 0, 0), SizeX=s_x, SizeY=s_y, ExtentX=addition_5, ExtentY=addition_6)  # -> Cells, Points
直径 = Text(filter_7)
division_15 = Division(A=multiplication_16, B=2)
division_16 = Division(A=multiplication_17, B=2)
vec_3 = VectorXYZ(XComponent=expr("-x", division_15), YComponent=expr("-x", division_16), ZComponent=0)  # -> Vector, Length
move_14 = Move(Geometry=recgrid_3.Points, Motion=vec_3.Vector)  # -> Geometry, Transform
division_17 = Division(A=直径, B=2)
cyl_2 = Cylinder(Base=move_14.Geometry, Radius=division_17, Length=expr("-x", expression))
X_2 = UnitX(Factor=直径)
multiplication_18 = Multiplication(A=直径, B=6)
edges_3 = BrepEdges(Brep=cyl_2)  # -> Naked, Interior, NonManifold
item_4 = ListItem(List=edges_3.Naked, Index=0, Wrap=True)
max_4 = Maximum(A=multiplication_18, B=70)
move_15 = Move(Geometry=item_4, Motion=X_2)  # -> Geometry, Transform
multiplication_19 = Multiplication(A=max_4, B=2)
addition_13 = Addition(A=multiplication_16, B=multiplication_19)
addition_14 = Addition(A=multiplication_17, B=multiplication_19)
division_18 = Division(A=t, B=2)
expression_6 = Expression(x=addition_14, Expression="Ceiling(x/10)*10/2")
expression_7 = Expression(x=addition_13, Expression="Ceiling(x/10)*10/2")
round = Round(Number=division_18)  # -> Nearest, Floor, Ceiling
multiplication_20 = Multiplication(A=round.Ceiling, B=2)
dom_6 = ConstructDomain(DomainStart=expr("-x", expression_6), DomainEnd=expression_6)
dom_7 = ConstructDomain(DomainStart=expr("-x", expression_7), DomainEnd=expression_7)
box_3 = DomainBox(Base=PlaneXY(0, 0, 0), X=dom_7, Y=dom_6, Z=multiplication_20)
Z_4 = UnitZ(Factor=expr("-x", multiplication_20))
move_16 = Move(Geometry=box_3, Motion=Z_4)  # -> Geometry, Transform
Z_5 = UnitZ(Factor=expr("-x", multiplication_20))

multiplication_21 = Multiplication(A=直径, B=5)

Z_6 = UnitZ(Factor=multiplication_21)
extr_2 = Extrude(Base=move_15.Geometry, Direction=Z_6)
cap_2 = CapHoles(Brep=[extr_2, cyl_2])
merge_4 = Merge(Data1=cap_2, Data2=box_3)
flatten_3 = FlattenTree(Tree=merge_4, Path="{0}")
move_17 = Move(Geometry=flatten_3, Motion=Z_5)  # -> Geometry, Transform

box_4 = DomainBox(Base=PlaneXY(0, 0, 0), X=dom_7, Y=dom_7, Z=multiplication_20)
merge_5 = Merge(Data1=cap_2, Data2=box_4)
flatten_4 = FlattenTree(Tree=merge_5, Path="{0}")
move_18 = Move(Geometry=flatten_4, Motion=Z_5)  # -> Geometry, Transform
entwine_2 = Entwine(Branch00=move_17.Geometry, Branch01=move_18.Geometry, FlattenInputs=True)
entwine_3 = Entwine(Branch00=move_13.Geometry, Branch01=move_7.Geometry, Branch02=geo_2, Branch03=move_17.Geometry, FlattenInputs=True)

geo_5 = Geometry(move_17.Geometry)
group_4 = Group(Objects=geo_5)
bbox_6 = BoundingBox(Content=group_4, Plane=PlaneXY(0, 0, 0))  # -> Box, Box_2
A_4 = Area(Geometry=bbox_6.Box)  # -> Area, Centroid
xz_4 = XZPlane(Origin=A_4.Centroid)
xy_8 = XYPlane(Origin=A_4.Centroid)
rotate_11 = Rotate(Geometry=group_4, Angle=degrees(Slider(180, range=0..1000)), Plane=xz_4)  # -> Geometry, Transform
rotate_12 = Rotate(Geometry=rotate_11.Geometry, Angle=degrees(Slider(0, range=0..270)), Plane=xy_8)  # -> Geometry, Transform
yz_4 = YZPlane(Origin=A_4.Centroid)
rotate_13 = Rotate(Geometry=rotate_12.Geometry, Angle=degrees(Slider(90, range=0..270)), Plane=yz_4)  # -> Geometry, Transform
cluster_4 = Cluster(G=rotate_13.Geometry)

geo_6 = Geometry(move_17.Geometry)
group_5 = Group(Objects=geo_6)
bbox_7 = BoundingBox(Content=group_5, Plane=PlaneXY(0, 0, 0))  # -> Box, Box_2
A_5 = Area(Geometry=bbox_7.Box)  # -> Area, Centroid
xz_5 = XZPlane(Origin=A_5.Centroid)
xy_9 = XYPlane(Origin=A_5.Centroid)
rotate_14 = Rotate(Geometry=group_5, Angle=degrees(Slider(90, range=0..100)), Plane=xz_5)  # -> Geometry, Transform
rotate_15 = Rotate(Geometry=rotate_14.Geometry, Angle=degrees("-90"), Plane=xy_9)  # -> Geometry, Transform
cluster_5 = Cluster(G=rotate_15.Geometry)

merge_6 = Merge(Data1=cluster, Data2=cluster_2, Data3=cluster_3, Data4=cluster_4, Data5=cluster_5)

item_5 = ListItem(List=flatten(merge_6), Index="1", Wrap=True)
item_6 = ListItem(List=flatten(merge_6), Index=0, Wrap=True)
item_7 = ListItem(List=flatten(merge_6), Index="3", Wrap=True)
filter_24 = StreamFilter(Gate=list_16, Stream0=item_6, Stream1=item_5, Stream2=item_6, Stream3=item_7)
bbox_8 = BoundingBox(Content=graft(filter_24), Plane=PlaneXY(0, 0, 0))  # -> Box, Box_2

debrep = DeconstructBrep(Brep=bbox_8.Box)  # -> Faces, Edges, Vertices
item_8 = ListItem(List=debrep.Faces, Index=Slider(5, range=0..10), Wrap=True)

srf = Surface(bbox_8.Box)
explode = Explode(Curve=item_8, Recursive=True)  # -> Segments, Vertices
item_9 = ListItem(List=explode.Vertices, Index=0, Wrap=True)  # -> Item, Item1, Item2
ln_3 = Line(StartPoint=graft(item_9.Item1), EndPoint=graft(item_9.Item2))
midpt = CurveMiddle(Curve=ln_3)
ln_4 = Line(StartPoint=midpt, EndPoint=item_9.Item1)
rotate_16 = Rotate(Geometry=ln_4, Angle=filter_17, Plane=PlaneXY(0, 0, 0))  # -> Geometry, Transform
pl = ConstructPlane(Origin=midpt, XAxis=ln_4, YAxis=rotate_16.Geometry)
item_10 = ListItem(List=debrep.Edges, Index=0, Wrap=True)  # -> Item, Item1

# ----
# 三视图
# hidden lines of top+pers view
# move to center
# 如果无法完整的生成埋件的三视图，
# 建议选择埋件的3D在Rhino中将
# Top/Perspective/Front/Right 试图缩放至合适大小后重新运行
panel_14 = Panel("""Top
Perspective
Front
Right""")
m2d_rhino = Make2DRhinoView(Name=panel_14, Clip=True)
make2d = Make2D(Geometry=entwine_3, View=m2d_rhino, TangentEdges=False, TangentSeams=False, AutoComputeMake2D=False)  # -> VisibleCurves, VisibleIndex, VisibleType, HiddenCurves, HiddenIndex, HiddenType
bang = ExplodeTree(Data=make2d.VisibleCurves)  # -> Branch0, Branch1, Branch2, Branch3, Branch4, Branch5, Branch6, Branch7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
bang_2 = ExplodeTree(Data=make2d.VisibleCurves)  # -> Branch0, Branch1, Branch2, Branch3, Branch4, Branch5, Branch6, Branch7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
bang_3 = ExplodeTree(Data=make2d.VisibleCurves)  # -> Branch0, Branch1, Branch2, Branch3, Branch4, Branch5, Branch6, Branch7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
bang_4 = ExplodeTree(Data=make2d.VisibleCurves)  # -> Branch0, Branch1, Branch2, Branch3, Branch4, Branch5, Branch6, Branch7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
divdist = DivideDistance(Curve=make2d.HiddenCurves, Distance=Slider(1, range=0..10))  # -> Points, Tangents, Parameters
graft = GraftTree(Tree=make2d.HiddenCurves, IncludeEmptyLists=True, IncludeNullItems=True)
shatter = Shatter(Curve=graft, Parameters=divdist.Parameters)
dispatch_3 = Dispatch(List=shatter, DispatchPattern=[True, False])  # -> ListA, ListB
crv_12 = Curve(dispatch_3.ListA)
pshift = ShiftPaths(Data=crv_12, Offset=-1)
pshift_2 = ShiftPaths(Data=pshift, Offset=-1)
bang_5 = ExplodeTree(Data=pshift_2)  # -> Branch0, Branch1, Branch2, Branch3, Branch4, Branch5, Branch6, Branch7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
bang_6 = ExplodeTree(Data=pshift_2)  # -> Branch0, Branch1, Branch2, Branch3, Branch4, Branch5, Branch6, Branch7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
bang_7 = ExplodeTree(Data=pshift_2)  # -> Branch0, Branch1, Branch2, Branch3, Branch4, Branch5, Branch6, Branch7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
bang_8 = ExplodeTree(Data=pshift_2)  # -> Branch0, Branch1, Branch2, Branch3, Branch4, Branch5, Branch6, Branch7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
entwine_4 = Entwine(Branch00=bang_7.Branch0, Branch01=bang_2.Branch0, FlattenInputs=True)  # -> flatten(Result)
entwine_5 = Entwine(Branch00=bang_7.Branch1, Branch01=bang_2.Branch1, FlattenInputs=True)  # -> flatten(Result)
entwine_6 = Entwine(Branch00=bang_5.Branch13, Branch01=bang_4.Branch13, FlattenInputs=True)  # -> flatten(Result); disabled
entwine_7 = Entwine(Branch00=bang_5.Branch12, Branch01=bang_4.Branch12, FlattenInputs=True)  # -> flatten(Result)
entwine_8 = Entwine(Branch00=bang_8.Branch4, Branch01=bang.Branch4, FlattenInputs=True)  # -> flatten(Result)
entwine_9 = Entwine(Branch00=bang_8.Branch5, Branch01=bang.Branch5, FlattenInputs=True)  # -> flatten(Result)
entwine_10 = Entwine(Branch00=bang_6.Branch8, Branch01=bang_3.Branch8, FlattenInputs=True)  # -> flatten(Result)
entwine_11 = Entwine(Branch00=bang_6.Branch9, Branch01=bang_3.Branch9, FlattenInputs=True)  # -> flatten(Result)
entwine_12 = Entwine(Branch00=entwine_4, Branch01=entwine_5, Branch02=bang_2.Branch2, Branch03=bang_2.Branch3, FlattenInputs=True)
entwine_13 = Entwine(Branch00=entwine_8, Branch01=entwine_9, Branch02=bang.Branch6, Branch03=bang.Branch7, FlattenInputs=True)
entwine_14 = Entwine(Branch00=entwine_7, Branch01=entwine_6, Branch02=bang_4.Branch14, Branch03=bang_4.Branch15, FlattenInputs=True)
entwine_15 = Entwine(Branch00=entwine_10, Branch01=entwine_11, Branch02=bang_3.Branch10, Branch03=bang_3.Branch11, FlattenInputs=True)
group_6 = Group(Objects=entwine_13)
group_7 = Group(Objects=entwine_12)
group_8 = Group(Objects=entwine_14)
group_9 = Group(Objects=entwine_15)
entwine_16 = Entwine(Branch00=group_7, Branch01=group_6, Branch02=group_9, Branch03=group_8, FlattenInputs=True)
pshift_3 = ShiftPaths(Data=entwine_16, Offset=-1)
pshift_4 = ShiftPaths(Data=entwine_16, Offset=-1)
# Rhino 文件中导入的块名
boxprop = BoxProperties(Box=pshift_3)  # -> Center, Diagonal, Area, Volume, Degeneracy
pt_7 = Point(Point(957.9296072, 367.7685097, 0))
pt_8 = Point("0,0,0")
recgrid_4 = Rectangular(
    Plane=pt_7,
    SizeX=Slider(12, range=1..20, expression="X*50"),
    SizeY=Slider(10, range=1..20, expression="X*50"),
    ExtentX=Slider(3, range=0..10),
    ExtentY=Slider(3, range=0..10))  # -> Cells, Points
vec2pt = Vector2Pt(PointA=boxprop.Center, PointB=pt_8, Unitize=False)  # -> Vector, Length
flatten_5 = FlattenTree(Tree=recgrid_4.Points, Path="{0}")
move_19 = Move(Geometry=pshift_4, Motion=vec2pt.Vector)  # -> flatten(Geometry), Transform
orient_5 = Orient(Geometry=move_19.Geometry, Source=PlaneXY(0, 0, 0), Target=flatten_5)  # -> Geometry, Transform
panel_15 = Panel("""false
false
true
false""")
panel_16 = Panel("""true
false
false
false""")
panel_17 = Panel("""false
false
false
true""")
cull = CullPattern(List=orient_5.Geometry, CullPattern=panel_17)
cull_2 = CullPattern(List=orient_5.Geometry, CullPattern=panel_15)
cull_3 = CullPattern(List=orient_5.Geometry, CullPattern=panel_16)
entwine_17 = Entwine(Branch00=cull_3, Branch01=cull_2, Branch02=cull, FlattenInputs=True)
flip_2 = FlipMatrix(Data=entwine_17)
branch = TreeBranch(Tree=flip_2, Path="{0;0}", MaintainPaths=True)
branch_2 = TreeBranch(Tree=flip_2, Path="{0;1}", MaintainPaths=True)
branch_3 = TreeBranch(Tree=flip_2, Path="{0;2}", MaintainPaths=True)
branch_4 = TreeBranch(Tree=flip_2, Path="{0;3}", MaintainPaths=True)
cluster_6 = Cluster(G=branch_3)
cluster_7 = Cluster(G=branch_2)
cluster_8 = Cluster(G=branch)
cluster_9 = Cluster(G=branch_4)
entwine_18 = Entwine(Branch00=cluster_8, Branch01=cluster_7, Branch02=cluster_6, Branch03=cluster_9, FlattenInputs=True)

# ---- group: side
item_11 = ListItem(List=entwine_18, Index="1", Wrap=True)  # -> flatten(Item)

# ---- group: side-short
item_12 = ListItem(List=entwine_18, Index="2", Wrap=True)  # -> flatten(Item)

# ---- group: top
item_13 = ListItem(List=entwine_18, Index=0, Wrap=True)  # -> flatten(Item)

# ----
item_14 = ListItem(List=item_13, Index=0, Wrap=True)
item_15 = ListItem(List=item_11, Index="2", Wrap=True)
item_16 = ListItem(List=item_13, Index="1", Wrap=True)
item_17 = ListItem(List=item_11, Index="3", Wrap=True)
item_18 = ListItem(List=item_12, Index="3", Wrap=True)
# 这里如果跑红也不要紧，
# 说明单体没有出现相撞的情况
block = DefineBlock(Geometry=item_16, Attributes=attributes, BlockName=panel_9, BasePlane=PlaneXY(0, 0, 0))
block_2 = DefineBlock(Geometry=item_14, Attributes=attributes, BlockName="embed2", BasePlane=PlaneXY(0, 0, 0))
block_3 = DefineBlock(Geometry=item_15, Attributes=attributes, BlockName="embed3", BasePlane=PlaneXY(0, 0, 0))
block_4 = DefineBlock(Geometry=item_17, Attributes=attributes, BlockName="embed4", BasePlane=PlaneXY(0, 0, 0))
block_5 = DefineBlock(Geometry=item_18, Attributes=attributes, BlockName="embed5", BasePlane=PlaneXY(0, 0, 0))
merge_7 = Merge(Data1=block, Data2=block_2, Data3=block_3, Data4=block_4, Data5=block_5)

disc_4 = Discontinuity(Curve=pline, Level=1)  # -> Points, Parameters
flip_3 = FlipCurve(Curve=pline)  # -> Curve, Flag
filter_25 = StreamFilter(Gate=Toggle(False), Stream0=pline, Stream1=flip_3.Curve)
pull = PullPoint(Point=disc_4.Points, Geometry=disc_3.Points, ClosestOnly=True)  # -> ClosestPoint, Distance
entwine_19 = Entwine(Branch00=pull.ClosestPoint, Branch01=disc_4.Points, FlattenInputs=True)
offset_2 = OffsetCurve(Curve=filter_25, Distance=expr("-x", Slider(341, range=0..1000)), Corners=1)
flip_4 = FlipMatrix(Data=entwine_19)
crv_13 = Curve(offset_2)
item_19 = ListItem(List=flip_4, Index="0", Wrap=True)  # -> flatten(Item)
item_20 = ListItem(List=flip_4, Index="1", Wrap=True)  # -> flatten(Item)
disc_5 = Discontinuity(Curve=crv_13, Level=1)  # -> Points, Parameters
panel_18 = Panel("1")
disc_6 = Discontinuity(Curve=filter_13, Level=1)  # -> Points, Parameters
panel_19 = Panel("""0
-1""")
pt_9 = Point(item_19)
cull_i = CullIndex(List=disc_6.Points, Indices=panel_19, Wrap=True)
pull_2 = PullPoint(Point=pt_9, Geometry=cull_i, ClosestOnly=True)  # -> ClosestPoint, Distance
larger = LargerThan(FirstNumber=pull_2.Distance, SecondNumber=Slider(50, range=0..100))  # -> LargerThan, OrEqualTo
dispatch_4 = Dispatch(List=pt_9, DispatchPattern=larger.LargerThan)  # -> ListA, ListB
pt_10 = Point(dispatch_4.ListB)
pt_11 = Point(dispatch_4.ListA)

# ---- group: Arch Points
pt_12 = Point(item_20)

# ----
sort_3 = SortList(Keys=pull_2.Distance)  # -> Keys, ValuesA
panel_20 = Panel(sort_3.Keys)
pt_13 = Point(pt_12)

crv_cp = CurveClosestPoint(Point=pt_12, Curve=crv_13)  # -> Point, Parameter, Distance
c_script = CSharpScript(archPoint=crv_cp.Point, crvPoint=disc_5.Points)  # -> out, specialPt; inputs archPoint: list of Point3d, crvPoint: list of Point3d
# ---------- c_script: C# ----------
    List<int> passIndex = new List<int>();

    for(int i = 0; i < archPoint.Count; i++){
      foreach(Point3d t in crvPoint){
        if(archPoint[i].X == t.X && archPoint[i].Y == t.Y && archPoint[i].Z == t.Z){
          Print("pass");
          passIndex.Add(i);}
      }
    }

    specialPt = passIndex;
# ---------- end c_script ----------
item_21 = ListItem(List=pt_12, Index=c_script.specialPt, Wrap=True)
item_22 = ListItem(List=item_19, Index=c_script.specialPt, Wrap=True)
cull_i_2 = CullIndex(List=pt_12, Indices=c_script.specialPt, Wrap=True)
cull_i_3 = CullIndex(List=item_19, Indices=c_script.specialPt, Wrap=True)
item_23 = ListItem(List=pt_12, Index=c_script.specialPt, Wrap=True)
shift_3 = ShiftList(List=item_21, Shift="1", Wrap=True)
pt_14 = Point(graft(item_21))
pt_15 = Point(graft(shift_3))
pt_16 = Point(graft(cull_i_2))
ln_5 = Line(StartPoint=pt_15, EndPoint=pt_16)
ln_6 = Line(StartPoint=pt_14, EndPoint=pt_16)
angle = Angle(VectorA=ln_5, VectorB=ln_6)  # -> flatten(Angle), Reflex
deg = Degrees(Radians=angle.Angle)
larger_2 = LargerThan(FirstNumber=deg, SecondNumber="96")  # -> LargerThan, OrEqualTo
dispatch_5 = Dispatch(List=flatten(cull_i_3), DispatchPattern=larger_2.LargerThan)  # -> ListA, ListB
dispatch_6 = Dispatch(List=flatten(pt_16), DispatchPattern=larger_2.LargerThan)  # -> ListA, ListB

pt_17 = Point(item_22)
pt_18 = Point(dispatch_5.ListA)
pt_19 = Point(dispatch_5.ListB)

pt_20 = Point(item_23)
pt_21 = Point(dispatch_6.ListA)
pt_22 = Point(dispatch_6.ListB)

c_script_2 = CSharpScript(archPoint=pt_11, crvPoint=pt_18)  # -> out, specialPt; inputs archPoint: list of Point3d, crvPoint: list of Point3d; same code as c_script
c_script_3 = CSharpScript(archPoint=pt_11, crvPoint=pt_19)  # -> out, specialPt; inputs archPoint: list of Point3d, crvPoint: list of Point3d; same code as c_script
c_script_4 = CSharpScript(archPoint=pt_11, crvPoint=pt_17)  # -> out, specialPt; inputs archPoint: list of Point3d, crvPoint: list of Point3d; same code as c_script
c_script_5 = CSharpScript(archPoint=pt_10, crvPoint=pt_17)  # -> out, specialPt; inputs archPoint: list of Point3d, crvPoint: list of Point3d; same code as c_script
c_script_6 = CSharpScript(archPoint=pt_10, crvPoint=pt_18)  # -> out, specialPt; inputs archPoint: list of Point3d, crvPoint: list of Point3d; same code as c_script
c_script_7 = CSharpScript(archPoint=pt_10, crvPoint=pt_19)  # -> out, specialPt; inputs archPoint: list of Point3d, crvPoint: list of Point3d; same code as c_script

item_24 = ListItem(List=pt_11, Index=c_script_2.specialPt, Wrap=True)
item_25 = ListItem(List=pt_11, Index=c_script_3.specialPt, Wrap=True)
item_26 = ListItem(List=pt_11, Index=c_script_4.specialPt, Wrap=True)  # -> graft(Item)

item_27 = ListItem(List=pt_10, Index=c_script_5.specialPt, Wrap=True)  # -> graft(Item)
item_28 = ListItem(List=pt_10, Index=c_script_6.specialPt, Wrap=True)
item_29 = ListItem(List=pt_10, Index=c_script_7.specialPt, Wrap=True)

panel_21 = Panel("""0
-1""")
item_30 = ListItem(List=pt_9, Index=panel_21, Wrap=True)
cull_i_4 = CullIndex(List=pt_9, Indices=panel_21, Wrap=True)
dispatch_7 = Dispatch(List=cull_i_4, DispatchPattern=[True, False])  # -> ListA, ListB
dispatch_8 = Dispatch(List=item_30, DispatchPattern=[True, False])  # -> ListA, ListB
pt_23 = Point(dispatch_7.ListA)
pt_24 = Point(dispatch_7.ListB)
pt_25 = Point(pt_16)
ln_7 = Line(StartPoint=pt_23, EndPoint=pt_24)
ln_8 = Line(StartPoint=dispatch_8.ListA, EndPoint=dispatch_8.ListB)
merge_8 = Merge(Data1=ln_8, Data2=ln_7)  # -> flatten(Result)
shift_4 = ShiftList(List=merge_8, Shift=1, Wrap=True)
crv_cp_2 = CurveClosestPoint(Point=graft(pt_25), Curve=graft(shift_4))  # -> flatten(Point), Parameter, Distance

pull_3 = PullPoint(Point=item_25, Geometry=crv_cp_2.Point, ClosestOnly=True)  # -> ClosestPoint, Distance
pt_26 = Point(item_25)
ln_9 = Line(StartPoint=pull_3.ClosestPoint, EndPoint=pt_26)
amp = Amplitude(Vector=ln_9, Amplitude=filter_11)
move_20 = Move(Geometry=pull_3.ClosestPoint, Motion=amp)  # -> Geometry, Transform

ln_10 = Line(StartPoint=move_20.Geometry, EndPoint=pull_3.ClosestPoint)
rotate_17 = Rotate(Geometry=ln_10, Angle=degrees(Slider(180, range=0..1000)), Plane=move_20.Geometry)  # -> Geometry, Transform
rotate_18 = Rotate(Geometry=rotate_17.Geometry, Angle=-1.570796327, Plane=move_20.Geometry)  # -> Geometry, Transform
line = Line(flatten(rotate_17.Geometry))
line_2 = Line(flatten(rotate_18.Geometry))

pl_2 = ConstructPlane(Origin=flatten(move_20.Geometry), XAxis=line, YAxis=line_2)
orient_6 = Orient(Geometry=filter_24, Source=pl, Target=pl_2)  # -> Geometry, Transform
move_21 = Move(Geometry=orient_6.Geometry, Motion=item_10.Item1)  # -> Geometry, Transform
data = Data(orient_6.Geometry)

item_31 = ListItem(List=debrep.Edges, Index=Slider(8, range=0..10), Wrap=True)
end = EndPoints(Curve=item_31)  # -> Start, End
ln_11 = Line(StartPoint=end.Start, EndPoint=end.End)
move_22 = Move(Geometry=data, Motion=ln_11)  # -> Geometry, Transform
filter_26 = StreamFilter(Gate=list_16, Stream0=move_22.Geometry, Stream1=move_22.Geometry, Stream2=move_22.Geometry, Stream3=move_22.Geometry)

orient_7 = Orient(Geometry=srf, Source=pl, Target=pl_2)  # -> Geometry, Transform
orient_8 = Orient(Geometry=item_8, Source=pl, Target=pl_2)  # -> Geometry, Transform

item_32 = ListItem(List=flatten(merge_6), Index="1", Wrap=True)
pull_4 = PullPoint(Point=item_24, Geometry=crv_cp_2.Point, ClosestOnly=True)  # -> ClosestPoint, Distance
pt_27 = Point(item_24)
item_33 = ListItem(List=flatten(merge_6), Index=0, Wrap=True)
item_34 = ListItem(List=flatten(merge_6), Index="3", Wrap=True)
ln_12 = Line(StartPoint=pull_4.ClosestPoint, EndPoint=pt_27)
filter_27 = StreamFilter(Gate=list_16, Stream0=item_33, Stream1=item_32, Stream2=item_33, Stream3=item_34)
amp_2 = Amplitude(Vector=ln_12, Amplitude=filter_12)
move_23 = Move(Geometry=pull_4.ClosestPoint, Motion=amp_2)  # -> Geometry, Transform
ln_13 = Line(StartPoint=move_23.Geometry, EndPoint=pull_4.ClosestPoint)
bbox_9 = BoundingBox(Content=graft(filter_27), Plane=PlaneXY(0, 0, 0))  # -> Box, Box_2
srf_2 = Surface(bbox_9.Box)

rotate_19 = Rotate(Geometry=ln_13, Angle=degrees(Slider(180, range=0..1000)), Plane=move_23.Geometry)  # -> Geometry, Transform

debrep_2 = DeconstructBrep(Brep=bbox_9.Box)  # -> Faces, Edges, Vertices
item_35 = ListItem(List=debrep_2.Faces, Index=Slider(5, range=0..10), Wrap=True)

rotate_20 = Rotate(Geometry=rotate_19.Geometry, Angle=-1.570796327, Plane=move_23.Geometry)  # -> Geometry, Transform
line_3 = Line(flatten(rotate_19.Geometry))
line_4 = Line(flatten(rotate_20.Geometry))
pl_3 = ConstructPlane(Origin=flatten(move_23.Geometry), XAxis=line_3, YAxis=line_4)
explode_2 = Explode(Curve=item_35, Recursive=True)  # -> Segments, Vertices
item_36 = ListItem(List=explode_2.Vertices, Index=0, Wrap=True)  # -> Item, Item1, Item2
ln_14 = Line(StartPoint=graft(item_36.Item1), EndPoint=graft(item_36.Item2))
midpt_2 = CurveMiddle(Curve=ln_14)
ln_15 = Line(StartPoint=midpt_2, EndPoint=item_36.Item1)
rotate_21 = Rotate(Geometry=ln_15, Angle=filter_18, Plane=PlaneXY(0, 0, 0))  # -> Geometry, Transform
pl_4 = ConstructPlane(Origin=midpt_2, XAxis=ln_15, YAxis=rotate_21.Geometry)
orient_9 = Orient(Geometry=srf_2, Source=pl_4, Target=pl_3)  # -> Geometry, Transform
orient_10 = Orient(Geometry=filter_27, Source=pl_4, Target=pl_3)  # -> Geometry, Transform
data_2 = Data(orient_10.Geometry)

item_37 = ListItem(List=debrep_2.Edges, Index=Slider(8, range=0..10), Wrap=True)
end_2 = EndPoints(Curve=item_37)  # -> Start, End
ln_16 = Line(StartPoint=end_2.Start, EndPoint=end_2.End)
move_24 = Move(Geometry=data_2, Motion=ln_16)  # -> Geometry, Transform
filter_28 = StreamFilter(Gate=list_16, Stream0=move_24.Geometry, Stream1=move_24.Geometry, Stream2=move_24.Geometry, Stream3=move_24.Geometry)

orient_11 = Orient(Geometry=item_35, Source=pl_4, Target=pl_3)  # -> Geometry, Transform

item_38 = ListItem(List=flatten(merge_6), Index=0, Wrap=True)
item_39 = ListItem(List=flatten(merge_6), Index="1", Wrap=True)
item_40 = ListItem(List=flatten(merge_6), Index="4", Wrap=True)
cull_i_5 = CullIndex(List=pt_11, Indices=c_script_4.specialPt, Wrap=True)  # -> graft(List)
filter_29 = StreamFilter(Gate=list_16, Stream0=item_38, Stream1=item_39, Stream2=item_38, Stream3=item_40)
ln_17 = Line(StartPoint=item_26, EndPoint=cull_i_5)
rotate_22 = Rotate(Geometry=ln_17, Angle=-1.570796327, Plane=item_26)  # -> Geometry, Transform
bbox_10 = BoundingBox(Content=graft(filter_29), Plane=PlaneXY(0, 0, 0))  # -> Box, Box_2
line_5 = Line(flatten(ln_17))
line_6 = Line(flatten(rotate_22.Geometry))
srf_3 = Surface(bbox_10.Box)
pl_5 = ConstructPlane(Origin=flatten(item_26), XAxis=line_6, YAxis=line_5)

debrep_3 = DeconstructBrep(Brep=bbox_10.Box)  # -> Faces, Edges, Vertices
item_41 = ListItem(List=debrep_3.Faces, Index=Slider(5, range=0..10), Wrap=True)

explode_3 = Explode(Curve=item_41, Recursive=True)  # -> Segments, Vertices
item_42 = ListItem(List=explode_3.Vertices, Index=0, Wrap=True)  # -> Item, Item1, Item2
ln_18 = Line(StartPoint=graft(item_42.Item1), EndPoint=graft(item_42.Item))
ln_19 = Line(StartPoint=graft(item_42.Item1), EndPoint=graft(item_42.Item2))
pt_28 = Point(item_42.Item1)
pl_6 = ConstructPlane(Origin=item_42.Item1, XAxis=ln_18, YAxis=ln_19)
pl_7 = ConstructPlane(Origin=pt_28, XAxis=ln_19, YAxis=ln_18)
filter_30 = StreamFilter(Gate=list_16, Stream0=pl_6, Stream1=pl_6, Stream2=pl_6, Stream3=pl_7)
orient_12 = Orient(Geometry=filter_29, Source=filter_30, Target=pl_5)  # -> Geometry, Transform
data_3 = Data(orient_12.Geometry)

debrep_4 = DeconstructBrep(Brep=bbox_10.Box)  # -> Faces, Edges, Vertices
item_43 = ListItem(List=debrep_4.Edges, Index=Slider(8, range=0..10), Wrap=True)
end_3 = EndPoints(Curve=item_43)  # -> Start, End
ln_20 = Line(StartPoint=end_3.Start, EndPoint=end_3.End)
move_25 = Move(Geometry=data_3, Motion=ln_20)  # -> Geometry, Transform
filter_31 = StreamFilter(Gate=list_16, Stream0=move_25.Geometry, Stream1=move_25.Geometry, Stream2=move_25.Geometry, Stream3=data_3)

data_4 = Data(filter_31)
preview_5 = CustomPreview(Geometry=data_4, Material=filter_22)
bake = BakeObjects(Geometry=data_4, Attributes=attributes_10, Bake=False)

item_44 = ListItem(List=flatten(merge_6), Index="3", Wrap=True)
item_45 = ListItem(List=flatten(merge_6), Index="1", Wrap=True)
item_46 = ListItem(List=flatten(merge_6), Index="1", Wrap=True)
cull_i_6 = CullIndex(List=pt_10, Indices=c_script_5.specialPt, Wrap=True)  # -> graft(List)
ln_21 = Line(StartPoint=item_27, EndPoint=cull_i_6)
filter_32 = StreamFilter(Gate=list_16, Stream0=item_45, Stream1=item_46, Stream2=item_45, Stream3=item_44)
bbox_11 = BoundingBox(Content=graft(filter_32), Plane=PlaneXY(0, 0, 0))  # -> Box, Box_2
rotate_23 = Rotate(Geometry=ln_21, Angle=-1.570796327, Plane=item_27)  # -> Geometry, Transform
line_7 = Line(flatten(ln_21))
line_8 = Line(flatten(rotate_23.Geometry))
srf_4 = Surface(bbox_11.Box)
pl_8 = ConstructPlane(Origin=flatten(item_27), XAxis=line_8, YAxis=line_7)

debrep_5 = DeconstructBrep(Brep=bbox_11.Box)  # -> Faces, Edges, Vertices
item_47 = ListItem(List=debrep_5.Faces, Index=Slider(5, range=0..10), Wrap=True)

pull_5 = PullPoint(Point=item_29, Geometry=crv_cp_2.Point, ClosestOnly=True)  # -> ClosestPoint, Distance
pt_29 = Point(item_29)
ln_22 = Line(StartPoint=pull_5.ClosestPoint, EndPoint=pt_29)
amp_3 = Amplitude(Vector=ln_22, Amplitude=filter_11)
move_26 = Move(Geometry=pull_5.ClosestPoint, Motion=amp_3)  # -> Geometry, Transform
ln_23 = Line(StartPoint=move_26.Geometry, EndPoint=pull_5.ClosestPoint)
item_48 = ListItem(List=flatten(merge_6), Index="1", Wrap=True)
bbox_12 = BoundingBox(Content=graft(item_48), Plane=PlaneXY(0, 0, 0))  # -> Box, Box_2
rotate_24 = Rotate(Geometry=ln_23, Angle=filter_16, Plane=move_26.Geometry)  # -> Geometry, Transform
line_9 = Line(flatten(rotate_24.Geometry))
line_10 = Line(flatten(ln_23))
srf_5 = Surface(bbox_12.Box)
pl_9 = ConstructPlane(Origin=flatten(move_26.Geometry), XAxis=line_10, YAxis=line_9)

debrep_6 = DeconstructBrep(Brep=bbox_12.Box)  # -> Faces, Edges, Vertices
item_49 = ListItem(List=debrep_6.Faces, Index=Slider(5, range=0..10), Wrap=True)

graft_2 = GraftTree(Tree=move_26.Geometry, IncludeEmptyLists=True, IncludeNullItems=True)  # -> simplify(Tree)

pull_6 = PullPoint(Point=item_28, Geometry=crv_cp_2.Point, ClosestOnly=True)  # -> ClosestPoint, Distance
pt_30 = Point(item_28)
ln_24 = Line(StartPoint=pull_6.ClosestPoint, EndPoint=pt_30)
amp_4 = Amplitude(Vector=ln_24, Amplitude=filter_12)
move_27 = Move(Geometry=pull_6.ClosestPoint, Motion=amp_4)  # -> Geometry, Transform
ln_25 = Line(StartPoint=move_27.Geometry, EndPoint=pull_6.ClosestPoint)
rotate_25 = Rotate(Geometry=ln_25, Angle=filter_15, Plane=move_27.Geometry)  # -> Geometry, Transform
item_50 = ListItem(List=flatten(merge_6), Index="1", Wrap=True)
line_11 = Line(flatten(ln_25))
line_12 = Line(flatten(rotate_25.Geometry))
bbox_13 = BoundingBox(Content=graft(item_50), Plane=PlaneXY(0, 0, 0))  # -> Box, Box_2
pl_10 = ConstructPlane(Origin=flatten(move_27.Geometry), XAxis=line_11, YAxis=line_12)
srf_6 = Surface(bbox_13.Box)

debrep_7 = DeconstructBrep(Brep=bbox_13.Box)  # -> Faces, Edges, Vertices
item_51 = ListItem(List=debrep_7.Faces, Index=Slider(5, range=0..10), Wrap=True)

explode_4 = Explode(Curve=item_47, Recursive=True)  # -> Segments, Vertices
item_52 = ListItem(List=explode_4.Vertices, Index=0, Wrap=True)  # -> Item, Item1, Item2
ln_26 = Line(StartPoint=graft(item_52.Item1), EndPoint=graft(item_52.Item))
ln_27 = Line(StartPoint=graft(item_52.Item1), EndPoint=graft(item_52.Item2))
pt_31 = Point(item_52.Item1)
pl_11 = ConstructPlane(Origin=item_52.Item1, XAxis=ln_26, YAxis=ln_27)
orient_13 = Orient(Geometry=filter_32, Source=pl_11, Target=pl_8)  # -> Geometry, Transform

item_53 = ListItem(List=debrep_5.Edges, Index=0, Wrap=True)  # -> Item, Item1, Item2, Item3, Item4, Item5, Item6, Item7, Item8, Item9
end_4 = EndPoints(Curve=item_53.Item8)  # -> Start, End
ln_28 = Line(StartPoint=end_4.Start, EndPoint=end_4.End)
move_28 = Move(Geometry=orient_13.Geometry, Motion=ln_28)  # -> Geometry, Transform

filter_33 = StreamFilter(
    Gate=list_16,
    Stream0=move_28.Geometry,
    Stream1=orient_13.Geometry,
    Stream2=orient_13.Geometry,
    Stream3=orient_13.Geometry)

data_5 = Data(filter_33)

data_6 = Data(data_5)
preview_6 = CustomPreview(Geometry=data_6, Material=col_3)
bake_2 = BakeObjects(Geometry=data_6, Attributes=attributes_6, Bake=False)

explode_5 = Explode(Curve=item_49, Recursive=True)  # -> Segments, Vertices
item_54 = ListItem(List=explode_5.Vertices, Index=0, Wrap=True)  # -> Item, Item1, Item2
ln_29 = Line(StartPoint=graft(item_54.Item1), EndPoint=graft(item_54.Item2))
midpt_3 = CurveMiddle(Curve=ln_29)
ln_30 = Line(StartPoint=midpt_3, EndPoint=item_54.Item1)
rotate_26 = Rotate(Geometry=ln_30, Angle=1.570796327, Plane=PlaneXY(0, 0, 0))  # -> Geometry, Transform
pl_12 = ConstructPlane(Origin=midpt_3, XAxis=ln_30, YAxis=rotate_26.Geometry)
orient_14 = Orient(Geometry=item_48, Source=pl_12, Target=pl_9)  # -> Geometry, Transform
orient_15 = Orient(Geometry=srf_5, Source=pl_12, Target=pl_9)  # -> Geometry, Transform

item_55 = ListItem(List=debrep_6.Edges, Index=0, Wrap=True)  # -> Item, Item1, Item2, Item3, Item4, Item5, Item6, Item7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
end_5 = EndPoints(Curve=item_55.Item8)  # -> Start, End
ln_31 = Line(StartPoint=end_5.Start, EndPoint=end_5.End)
move_29 = Move(Geometry=orient_14.Geometry, Motion=ln_31)  # -> Geometry, Transform

orient_16 = Orient(Geometry=item_49, Source=pl_12, Target=pl_9)  # -> Geometry, Transform
debrep_8 = DeconstructBrep(Brep=orient_16.Geometry)  # -> Faces, Edges, Vertices
item_56 = ListItem(List=debrep_8.Vertices, Index=0, Wrap=True)  # -> Item, Item1, Item2
move2pt = MoveToPoint(Geometry=move_29.Geometry, PointA=flatten(item_56.Item2), PointB=flatten(item_56.Item1))  # -> Moved, Vector, Transform
filter_34 = StreamFilter(Gate=list_16, Stream0=move2pt.Moved, Stream1=orient_14.Geometry, Stream2=orient_14.Geometry, Stream3=orient_14.Geometry)

data_7 = Data(filter_34)

boundary_2 = BoundarySurfaces(Edges=orient_16.Geometry)  # -> simplify(graft(Surfaces))
graft_3 = GraftTree(Tree=data_7, IncludeEmptyLists=True, IncludeNullItems=True)  # -> simplify(Tree)
findbrepintersect = FindBrepIntersect(BrepMain=boundary_2, BrepStay=boundary)  # -> out, BrepInters, BrepRemain; inputs BrepMain: list of Brep, BrepStay: list of Brep
# ---------- findbrepintersect: C# ----------
    List<Brep> BrepI = new List<Brep>();
    List<Brep> BrepR = new List<Brep>();
    


    double tolr = Rhino.RhinoDoc.ActiveDoc.ModelAbsoluteTolerance;

    for(int j = 0; j < BrepMain.Count;j++){
      foreach(Brep b in BrepStay) {
        bool test = Rhino.Geometry.Intersect.Intersection.BrepBrep(BrepMain[j], b, tolr, out crv, out pts);
        if(test && crv.Length != 0){
          tryThis = true;
          break;}
        else{
          tryThis = false;}
      }
      if(tryThis){
        BrepI.Add(BrepMain[j]);
      }
      else{
        BrepR.Add(BrepMain[j]);
      }
    }



    BrepInters = BrepI;
    BrepRemain = BrepR;
# ---------- findbrepintersect: C# additional code ----------
  Rhino.Geometry.Curve[] crv;
  Rhino.Geometry.Point3d[] pts;
  bool tryThis;
# ---------- end findbrepintersect ----------
item_57 = ListItem(List=graft_2, Index=findbrepintersect.BrepInters, Wrap=True)
pull_7 = PullPoint(Point=item_57, Geometry=pt_13, ClosestOnly=True)  # -> ClosestPoint, Distance
cull_i_7 = CullIndex(List=graft_3, Indices=findbrepintersect.BrepInters, Wrap=True)
pull_8 = PullPoint(Point=pull_7.ClosestPoint, Geometry=boundary, ClosestOnly=True)  # -> ClosestPoint, Distance
ln_32 = Line(StartPoint=pull_7.ClosestPoint, EndPoint=pull_8.ClosestPoint)
rotate_27 = Rotate(Geometry=ln_32, Angle=1.570796327, Plane=pull_8.ClosestPoint)  # -> Geometry, Transform
pl_13 = ConstructPlane(Origin=pull_8.ClosestPoint, XAxis=ln_32, YAxis=rotate_27.Geometry)
data_8 = Data(cull_i_7)
preview_7 = CustomPreview(Geometry=data_8, Material=col_4)
bake_3 = BakeObjects(Geometry=data_8, Attributes=attributes_4, Bake=False)

explode_6 = Explode(Curve=item_51, Recursive=True)  # -> Segments, Vertices
item_58 = ListItem(List=explode_6.Vertices, Index=0, Wrap=True)  # -> Item, Item1, Item2
ln_33 = Line(StartPoint=graft(item_58.Item1), EndPoint=graft(item_58.Item2))
midpt_4 = CurveMiddle(Curve=ln_33)
ln_34 = Line(StartPoint=midpt_4, EndPoint=item_58.Item1)
rotate_28 = Rotate(Geometry=ln_34, Angle=filter_19, Plane=PlaneXY(0, 0, 0))  # -> Geometry, Transform
pl_14 = ConstructPlane(Origin=midpt_4, XAxis=ln_34, YAxis=rotate_28.Geometry)
orient_17 = Orient(Geometry=srf_6, Source=pl_14, Target=pl_10)  # -> Geometry, Transform
orient_18 = Orient(Geometry=item_50, Source=pl_14, Target=pl_10)  # -> Geometry, Transform

item_59 = ListItem(List=debrep_7.Edges, Index=0, Wrap=True)  # -> Item, Item1, Item2, Item3, Item4, Item5, Item6, Item7, Item8, Item9
end_6 = EndPoints(Curve=item_59.Item8)  # -> Start, End
ln_35 = Line(StartPoint=end_6.Start, EndPoint=end_6.End)
move_30 = Move(Geometry=orient_18.Geometry, Motion=ln_35)  # -> Geometry, Transform

orient_19 = Orient(Geometry=item_51, Source=pl_14, Target=pl_10)  # -> Geometry, Transform
debrep_9 = DeconstructBrep(Brep=orient_19.Geometry)  # -> Faces, Edges, Vertices
item_60 = ListItem(List=debrep_9.Vertices, Index=0, Wrap=True)  # -> Item, Item1, Item2
move2pt_2 = MoveToPoint(Geometry=move_30.Geometry, PointA=flatten(item_60.Item2), PointB=flatten(item_60.Item1))  # -> Moved, Vector, Transform
filter_35 = StreamFilter(
    Gate=list_16,
    Stream0=move2pt_2.Moved,
    Stream1=orient_18.Geometry,
    Stream2=orient_18.Geometry,
    Stream3=orient_18.Geometry)

data_9 = Data(filter_35)

boundary_3 = BoundarySurfaces(Edges=orient_8.Geometry)  # -> simplify(graft(Surfaces))
boundary_4 = BoundarySurfaces(Edges=crv_9)  # -> simplify(Surfaces)
graft_4 = GraftTree(Tree=filter_26, IncludeEmptyLists=True, IncludeNullItems=True)  # -> simplify(Tree)
graft_5 = GraftTree(Tree=pt_26, IncludeEmptyLists=True, IncludeNullItems=True)  # -> simplify(Tree)
pt_32 = Point(pt_12)
findbrepintersect_2 = FindBrepIntersect(BrepMain=boundary_3, BrepStay=boundary_4)  # -> out, BrepInters, BrepRemain; inputs BrepMain: list of Brep, BrepStay: list of Brep; same code as findbrepintersect
item_61 = ListItem(List=graft_5, Index=findbrepintersect_2.BrepInters, Wrap=True)
pull_9 = PullPoint(Point=item_61, Geometry=pt_32, ClosestOnly=True)  # -> ClosestPoint, Distance
pull_10 = PullPoint(Point=pull_9.ClosestPoint, Geometry=boundary_4, ClosestOnly=True)  # -> ClosestPoint, Distance
ln_36 = Line(StartPoint=pull_9.ClosestPoint, EndPoint=pull_10.ClosestPoint)
rotate_29 = Rotate(Geometry=ln_36, Angle=1.570796327, Plane=pull_10.ClosestPoint)  # -> Geometry, Transform
pl_15 = ConstructPlane(Origin=pull_10.ClosestPoint, XAxis=ln_36, YAxis=rotate_29.Geometry)
cull_i_8 = CullIndex(List=graft_4, Indices=findbrepintersect_2.BrepInters, Wrap=True)

ungroup = Ungroup(Group=cull_i_8)
data_10 = Data(ungroup)
preview_8 = CustomPreview(Geometry=data_10, Material=filter_21)
bake_4 = BakeObjects(Geometry=data_10, Attributes=attributes_2, Bake=False)

item_62 = ListItem(List=flatten(merge_6), Index="2", Wrap=True)
bbox_14 = BoundingBox(Content=graft(item_62), Plane=PlaneXY(0, 0, 0))  # -> Box, Box_2
srf_7 = Surface(bbox_14.Box)

debrep_10 = DeconstructBrep(Brep=bbox_14.Box)  # -> Faces, Edges, Vertices
item_63 = ListItem(List=debrep_10.Faces, Index=Slider(5, range=0..10), Wrap=True)

explode_7 = Explode(Curve=item_63, Recursive=True)  # -> Segments, Vertices
item_64 = ListItem(List=explode_7.Vertices, Index=0, Wrap=True)  # -> Item, Item1, Item2
ln_37 = Line(StartPoint=graft(item_64.Item), EndPoint=graft(item_64.Item1))
ln_38 = Line(StartPoint=graft(item_64.Item1), EndPoint=graft(item_64.Item2))
move_31 = Move(Geometry=ln_37, Motion=ln_37)  # -> Geometry, Transform
midpt_5 = CurveMiddle(Curve=ln_38)
pl_16 = ConstructPlane(Origin=midpt_5, XAxis=move_31.Geometry, YAxis=ln_38)

boundary_5 = BoundarySurfaces(Edges=crv_9)  # -> simplify(Surfaces)
boundary_6 = BoundarySurfaces(Edges=orient_11.Geometry)  # -> simplify(graft(Surfaces))
graft_6 = GraftTree(Tree=move_23.Geometry, IncludeEmptyLists=True, IncludeNullItems=True)  # -> simplify(Tree)
graft_7 = GraftTree(Tree=filter_28, IncludeEmptyLists=True, IncludeNullItems=True)  # -> simplify(Tree)
pt_33 = Point(pt_12)
findbrepintersect_3 = FindBrepIntersect(BrepMain=boundary_6, BrepStay=boundary_5)  # -> out, BrepInters, BrepRemain; inputs BrepMain: list of Brep, BrepStay: list of Brep; same code as findbrepintersect
item_65 = ListItem(List=graft_6, Index=findbrepintersect_3.BrepInters, Wrap=True)
pull_11 = PullPoint(Point=item_65, Geometry=pt_33, ClosestOnly=True)  # -> ClosestPoint, Distance
pull_12 = PullPoint(Point=pull_11.ClosestPoint, Geometry=boundary_5, ClosestOnly=True)  # -> ClosestPoint, Distance
ln_39 = Line(StartPoint=pull_11.ClosestPoint, EndPoint=pull_12.ClosestPoint)
rotate_30 = Rotate(Geometry=ln_39, Angle=1.570796327, Plane=pull_12.ClosestPoint)  # -> Geometry, Transform
pl_17 = ConstructPlane(Origin=pull_12.ClosestPoint, XAxis=ln_39, YAxis=rotate_30.Geometry)
cull_i_9 = CullIndex(List=graft_7, Indices=findbrepintersect_3.BrepInters, Wrap=True)
orient_20 = Orient(Geometry=item_62, Source=pl_16, Target=pl_17)  # -> Geometry, Transform
merge_9 = Merge(Data1=cull_i_9, Data2=orient_20.Geometry)

orient_21 = Orient(Geometry=item_62, Source=pl_16, Target=pl_15)  # -> Geometry, Transform
merge_10 = Merge(Data1=cull_i_8, Data2=orient_21.Geometry)

orient_22 = Orient(Geometry=item_62, Source=pl_16, Target=pl_13)  # -> Geometry, Transform

debrep_11 = DeconstructBrep(Brep=bbox_14.Box)  # -> Faces, Edges, Vertices
item_66 = ListItem(List=debrep_11.Edges, Index=Slider(8, range=0..10), Wrap=True)
end_7 = EndPoints(Curve=item_66)  # -> Start, End
ln_40 = Line(StartPoint=end_7.Start, EndPoint=end_7.End)
move_32 = Move(Geometry=orient_21.Geometry, Motion=ln_40)  # -> Geometry, Transform

debrep_12 = DeconstructBrep(Brep=bbox_14.Box)  # -> Faces, Edges, Vertices

debrep_13 = DeconstructBrep(Brep=bbox_14.Box)  # -> Faces, Edges, Vertices
item_67 = ListItem(List=debrep_13.Edges, Index=Slider(8, range=0..10), Wrap=True)
end_8 = EndPoints(Curve=item_67)  # -> Start, End
ln_41 = Line(StartPoint=end_8.End, EndPoint=end_8.Start)
move_33 = Move(Geometry=orient_20.Geometry, Motion=ln_41)  # -> Geometry, Transform

item_68 = ListItem(List=debrep_12.Edges, Index=Slider(8, range=0..10), Wrap=True)
end_9 = EndPoints(Curve=item_68)  # -> Start, End
ln_42 = Line(StartPoint=end_9.Start, EndPoint=end_9.End)
move_34 = Move(Geometry=orient_22.Geometry, Motion=ln_42)  # -> Geometry, Transform
filter_36 = StreamFilter(Gate=list_16, Stream0=orient_22.Geometry, Stream1=move_34.Geometry, Stream2=move_34.Geometry, Stream3=move_34.Geometry)
ungroup_2 = Ungroup(Group=orient_21.Geometry)
merge_11 = Merge(Data1=cull_i_7, Data2=filter_36)
merge_12 = Merge(Data1=filter_31, Data2=merge_10, Data3=merge_9)
data_11 = Data(ungroup_2)
data_12 = Data(filter_36)
data_13 = Data(cull_i_9)
data_14 = Data(orient_20.Geometry)
preview_9 = CustomPreview(Geometry=data_11, Material=swatch_3)
preview_10 = CustomPreview(Geometry=data_12, Material=col_5)
preview_11 = CustomPreview(Geometry=data_13, Material=filter_20)
preview_12 = CustomPreview(Geometry=data_14, Material=filter_23)
bake_5 = BakeObjects(Geometry=data_11, Attributes=attributes_5, Bake=False)
bake_6 = BakeObjects(Geometry=data_12, Attributes=attributes_3, Bake=False)
bake_7 = BakeObjects(Geometry=data_13, Attributes=attributes_9, Bake=False)
bake_8 = BakeObjects(Geometry=data_14, Attributes=attributes_7, Bake=False)

boundary_7 = BoundarySurfaces(Edges=crv_9)  # -> simplify(Surfaces)
boundary_8 = BoundarySurfaces(Edges=orient_19.Geometry)  # -> simplify(graft(Surfaces))
graft_8 = GraftTree(Tree=data_9, IncludeEmptyLists=True, IncludeNullItems=True)  # -> simplify(Tree)
graft_9 = GraftTree(Tree=move_27.Geometry, IncludeEmptyLists=True, IncludeNullItems=True)  # -> simplify(Tree)
pt_34 = Point(pt_12)
findbrepintersect_4 = FindBrepIntersect(BrepMain=boundary_8, BrepStay=boundary_7)  # -> out, BrepInters, BrepRemain; inputs BrepMain: list of Brep, BrepStay: list of Brep; same code as findbrepintersect
item_69 = ListItem(List=graft_9, Index=findbrepintersect_4.BrepInters, Wrap=True)
pull_13 = PullPoint(Point=item_69, Geometry=pt_34, ClosestOnly=True)  # -> ClosestPoint, Distance
pull_14 = PullPoint(Point=pull_13.ClosestPoint, Geometry=boundary_7, ClosestOnly=True)  # -> ClosestPoint, Distance
ln_43 = Line(StartPoint=pull_13.ClosestPoint, EndPoint=pull_14.ClosestPoint)
rotate_31 = Rotate(Geometry=ln_43, Angle=1.570796327, Plane=pull_14.ClosestPoint)  # -> Geometry, Transform
pl_18 = ConstructPlane(Origin=pull_14.ClosestPoint, XAxis=ln_43, YAxis=rotate_31.Geometry)
orient_23 = Orient(Geometry=item_62, Source=pl_16, Target=pl_18)  # -> Geometry, Transform
cull_i_10 = CullIndex(List=graft_8, Indices=findbrepintersect_4.BrepInters, Wrap=True)
debrep_14 = DeconstructBrep(Brep=bbox_14.Box)  # -> Faces, Edges, Vertices
item_70 = ListItem(List=debrep_14.Edges, Index=Slider(8, range=0..10), Wrap=True)
end_10 = EndPoints(Curve=item_70)  # -> Start, End
ln_44 = Line(StartPoint=end_10.Start, EndPoint=end_10.End)
move_35 = Move(Geometry=orient_23.Geometry, Motion=ln_44)  # -> Geometry, Transform

filter_37 = StreamFilter(Gate=list_16, Stream0=orient_23.Geometry, Stream1=move_35.Geometry, Stream2=move_35.Geometry, Stream3=move_35.Geometry)

merge_13 = Merge(Data1=cull_i_10, Data2=filter_37)

merge_14 = Merge(Data1=data_5, Data2=merge_11, Data3=merge_13)

# ----
# BAKE ME
merge_15 = Merge(Data1=merge_12, Data2=merge_14)  # -> flatten(Result)

data_15 = Data(merge_13)
merge_16 = Merge(
    Data1=data_10,
    Data2=data_11,
    Data3=data_6,
    Data4=data_8,
    Data5=data_12,
    Data6=data_15,
    Data7=data_4,
    Data8=data_13,
    Data9=data_14)
preview_13 = CustomPreview(Geometry=data_15, Material=col_6)
bake_9 = BakeObjects(Geometry=data_15, Attributes=attributes_8, Bake=False)

# ==== cluster Cluster
G = ClusterInput()
rotate = Rotate(Geometry=G, Angle=3.141592654, Plane=PlaneXY(0, 0, 0))  # -> Geometry, Transform
boxprop = BoxProperties(Box=rotate.Geometry)  # -> Center, Diagonal, Area, Volume, Degeneracy
bbox = BoundingBox(Content=rotate.Geometry, Plane=PlaneXY(0, 0, 0))  # -> Box, Box_2
debox = DeconstructBox(Box=bbox.Box)  # -> Plane, X, Y, Z
pdecon = Deconstruct(Point=boxprop.Center)  # -> XComponent, YComponent, ZComponent
dedomain = DeconstructDomain(Domain=debox.Y)  # -> Start, End
pt = ConstructPoint(XCoordinate=pdecon.XComponent, YCoordinate=dedomain.Start, ZCoordinate=pdecon.ZComponent)
xy = XYPlane(Origin=Point(0, 0, 0))
pl_origin = PlaneOrigin(Base=xy, Origin=pt)
orient = Orient(Geometry=rotate.Geometry, Source=pl_origin, Target=xy)  # -> Geometry, Transform
G_2 = ClusterOutput(orient.Geometry)
