# Grasshopper definition FacadeEmbed_jinqiao-Default.gh (Grasshopper 1.0.7)
# plug-ins: EleFront, Hare, Wombat, TT Toolbox, Pufferfish

# ---- group: 混凝土
# 板埋几何INPUT
list = ValueList({"C15": 0, "C20": 1, "C25": 2, "C30": 3, "C35": 4, "C40": 5}, selected="C35")

# ---- group: 钢筋牌号
list_2 = ValueList({"HPB300": 0, "HRB400": 1}, selected="HPB300")

# ---- group: 直径
list_3 = ValueList({"10": 0, "12": 1, "16": 2, "18": 3, "20": 4, "25": 5}, selected="12")

# ---- group: 锚筋间距
s_y = Slider(22, range=14..60, expression="X*5")
s_x = Slider(22, range=14..60, expression="X*5")

# ---- group: 列
list_4 = ValueList({"2X": 0, "3X": 1, "4X": 2}, selected="3X")

# ---- group: 行
list_5 = ValueList({"2Y": 0, "3Y": 1, "4Y": 2}, selected="2Y")

# ---- group: 螺栓直径
list_6 = ValueList({"10": 0, "12": 1, "16": 2, "18": 3, "20": 4, "25": 5}, selected="16")

# ---- group: 锚筋直径
list_7 = ValueList({"10": 0, "12": 1, "16": 2, "18": 3, "20": 4, "25": 5}, selected="12")

# ---- group: 锚筋间距
s_x_2 = Slider(25, range=14..60, expression="X*5")
s_y_2 = Slider(20, range=14..60, expression="X*5")

# ---- group: 列
list_8 = ValueList({"2X": 0, "3X": 1, "4X": 2}, selected="3X")

# ---- group: 行
list_9 = ValueList({"2Y": 0, "3Y": 1, "4Y": 2}, selected="2Y")

# ----
# 板槽几何input
addition = Addition(A=list_8, B=1)
addition_2 = Addition(A=list_9, B=1)
锚板厚度 = Slider(12, range=0..100)
value_list = ValueList({"锚筋": 0, "锚焊": 1}, selected="锚焊")
锚筋末端焊板厚度 = Slider(12, range=0..100)
curve = Curve(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)
槽长 = Slider(270, range=0..1000)
锚筋到边 = Panel("75")
锚筋长度 = Slider(12, range=0..30, expression="x*10")
subtraction = Subtraction(A=锚筋长度, B=锚板厚度)
锚筋末端焊板边长 = Slider(40, range=0..100)
filter = StreamFilter(Gate=list_6, Stream0=10, Stream1=12, Stream2=16, Stream3=18, Stream4=20, Stream5=25)
filter_2 = StreamFilter(Gate=list_7, Stream0=10, Stream1=12, Stream2=16, Stream3=18, Stream4=20, Stream5=25)

# ---- group: 螺栓直径
list_10 = ValueList({"10": 0, "12": 1, "16": 2, "18": 3, "20": 4, "25": 5}, selected="16")

# ---- group: 锚筋直径
list_11 = ValueList({"10": 0, "12": 1, "16": 2, "18": 3, "20": 4, "25": 5}, selected="12")

# ---- group: 锚筋间距
s_x_3 = Slider(25, range=14..60, expression="X*5")
s_y_3 = Slider(20, range=14..60, expression="X*5")

# ---- group: 列
list_12 = ValueList({"2X": 0, "3X": 1, "4X": 2}, selected="3X")

# ---- group: 行
list_13 = ValueList({"2Y": 0, "3Y": 1, "4Y": 2}, selected="2Y")

# ----
# 钢板槽几何input
list_14 = ValueList({"板埋": 0, "槽埋": 1}, selected="板埋")
list_15 = ValueList({"顶埋": 0, "侧埋": 1}, selected="顶埋")
addition_3 = Addition(A=list_12, B=1)
addition_4 = Addition(A=list_13, B=1)
板凳厚度 = Slider(16, range=0..100)
value_list_2 = ValueList({"锚筋": 0, "锚焊": 1}, selected="锚焊")
锚筋末端焊板厚度_2 = Slider(12, range=0..100)
锚筋到边_2 = Panel("75")
锚筋长度_2 = Slider(12, range=0..30, expression="x*10")
锚板厚度_2 = Slider(12, range=0..100)
subtraction_2 = Subtraction(A=锚筋长度_2, B=锚板厚度_2)
锚筋末端焊板边长_2 = Slider(40, range=0..100)
curve_2 = Curve(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)
槽长_2 = Slider(270, range=0..1000)
filter_3 = StreamFilter(Gate=list_11, Stream0=10, Stream1=12, Stream2=16, Stream3=18, Stream4=20, Stream5=25)
filter_4 = StreamFilter(Gate=list_10, Stream0=10, Stream1=12, Stream2=16, Stream3=18, Stream4=20, Stream5=25)

max = Maximum(A=s_x, B=s_y)
filter_5 = StreamFilter(Gate=list, Stream0=7.2, Stream1=9.6, Stream2=11.9, Stream3=14.3, Stream4=16.7, Stream5=19.1)
filter_6 = StreamFilter(Gate=list_2, Stream0=270, Stream1=360)
filter_7 = StreamFilter(Gate=list_3, Stream0=10, Stream1=12, Stream2=16, Stream3=18, Stream4=20, Stream5=25)
filter_8 = StreamFilter(Gate=list, Stream0=0.91, Stream1=1.1, Stream2=1.27, Stream3=1.43, Stream4=1.57, Stream5=1.71)
filter_9 = StreamFilter(Gate=list_2, Stream0=0.16, Stream1=0.14)
addition_5 = Addition(A=list_4, B=1)
addition_6 = Addition(A=list_5, B=1)
division = Division(A=max, B=8)
t = Integer(division)
panel = Panel(filter_8)
panel_2 = Panel(filter_5)
panel_3 = Panel(filter_9)
min = Minimum(A=filter_6, B=300)
panel_4 = Panel(min)
expression = Expression(A=filter_9, fy=filter_6, ft=filter_8, d=filter_7, Expression="(int((0.6*1.1*A*fy/ft*d)/5)+1)*5")

yz_plane = YZPlane(Origin=Point(0, 0, 0))
orient = Orient(Geometry=curve, Source=PlaneXY(0, 0, 0), Target=yz_plane)  # -> Geometry, Transform
unit_x = UnitX(Factor=槽长)
division_2 = Division(A=槽长, B=2)
extrude = Extrude(Base=orient.Geometry, Direction=unit_x)
unit_x_2 = UnitX(Factor=division_2)
move = Move(Geometry=extrude, Motion=expr("-x", unit_x_2))  # -> Geometry, Transform
cap_holes = CapHoles(Brep=move.Geometry)

# ----
# 导入槽埋模型
brep = Brep(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)  # disabled

# ----
# 槽埋Modeling
brep_2 = Brep(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)  # disabled
bbox = BoundingBox(Content=brep, Plane=PlaneXY(0, 0, 0))  # -> Box, Box_2; disabled
debox = DeconstructBox(Box=bbox.Box)  # -> Plane, X, Y, Z; disabled
area = Area(Geometry=brep)  # -> Area, Centroid; disabled
edges = BrepEdges(Brep=bbox.Box)  # -> Naked, Interior, NonManifold; disabled
panel_5 = Panel("5")  # disabled
panel_6 = Panel("4")  # disabled
item = ListItem(List=edges.Interior, Index=panel_5, Wrap=True)  # disabled
item_2 = ListItem(List=edges.Interior, Index=panel_6, Wrap=True)  # disabled
pdecon = Deconstruct(Point=area.Centroid)  # -> XComponent, YComponent, ZComponent; disabled
dedomain = DeconstructDomain(Domain=debox.Z)  # -> Start, End; disabled
clx = CurveLine(Curve=item_2, Line=item)  # -> Points, Params, Count; disabled
Y = UnitY(Factor=item)  # disabled
xy = XYPlane(Origin=Point(0, 0, 0))  # disabled
pt = ConstructPoint(XCoordinate=pdecon.XComponent, YCoordinate=pdecon.YComponent, ZCoordinate=dedomain.End)  # disabled
rotate = Rotate(Geometry=brep, Angle=1.570796327, Plane=clx.Points)  # -> Geometry, Transform; disabled
move_2 = Move(Geometry=rotate.Geometry, Motion=Y)  # -> Geometry, Transform; disabled
pl_origin = PlaneOrigin(Base=xy, Origin=pt)  # disabled
merge = Merge(Data1=brep, Data2=move_2.Geometry)  # -> flatten(Result); disabled
sunion = SolidUnion(Breps=merge)  # disabled
bbox_2 = BoundingBox(Content=sunion, Plane=PlaneXY(0, 0, 0))  # -> Box, Box_2; disabled
area_2 = Area(Geometry=sunion)  # -> Area, Centroid; disabled
xy_2 = XYPlane(Origin=Point(0, 0, 0))  # disabled
debox_2 = DeconstructBox(Box=bbox_2.Box)  # -> Plane, X, Y, Z; disabled
pdecon_2 = Deconstruct(Point=area_2.Centroid)  # -> XComponent, YComponent, ZComponent; disabled
orient_2 = Orient(Geometry=brep, Source=pl_origin, Target=xy_2)  # -> Geometry, Transform; disabled
dedomain_2 = DeconstructDomain(Domain=debox_2.Z)  # -> Start, End; disabled
pt_2 = ConstructPoint(XCoordinate=pdecon_2.XComponent, YCoordinate=pdecon_2.YComponent, ZCoordinate=dedomain_2.End)  # disabled
xy_3 = XYPlane(Origin=Point(0, 0, 0))  # disabled
pl_origin_2 = PlaneOrigin(Base=xy_3, Origin=pt_2)  # disabled
xy_4 = XYPlane(Origin=Point(0, 0, 0))  # disabled
orient_3 = Orient(Geometry=sunion, Source=pl_origin_2, Target=xy_4)  # -> Geometry, Transform; disabled

c_script = CSharpScript()  # -> out, specialPt; inputs archPoint: list of Point3d, crvPoint: list of Point3d
# ---------- c_script: C# ----------
    List<int> passIndex = new List<int>();

    for(int i = 0; i < archPoint.Count; i++){
      foreach(Point3d t in crvPoint){
        if(archPoint[i].X == t.X && archPoint[i].Y == t.Y && archPoint[i].Z == t.Z){
          Print("pass");
          passIndex.Add(i);}
      }
    }

    specialPt = passIndex;
# ---------- end c_script ----------
filter_10 = StreamFilter(Gate=0, Stream0=orient_3.Geometry, Stream1=orient_2.Geometry)  # disabled
entwine = Entwine(Branch00=orient_2.Geometry, Branch01=filter_10, FlattenInputs=True)  # disabled

# ----
# 平面类型INPUT
# 平面定位INPUT
list_16 = ValueList({"楼板部分挑空": 0, "纯楼板": 1, "纯挑空/塔冠": 2, "女儿墙": 3}, selected="楼板部分挑空")

# ----
# 埋件offset-常规input1
number_slider = Slider(140, range=0..1000)

# ----
# 埋件offset-常规input2
number_slider_2 = Slider(87, range=0..1000)

# ----
# 柱线-所有type
crv = Curve([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])

# ----
# 埋件offset-女儿墙input
number_slider_3 = Slider(125, range=0..1000)

# ----
# 板边线-只有部分贯通的时候导入
crv_2 = Curve(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)

# ----
# 建筑线-所有type
crv_3 = Curve(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)

# ----
# 定位线/梁中线-所有type
crv_4 = Curve(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)

filter_11 = StreamFilter(Gate=list_16, Stream0=number_slider, Stream1=number_slider, Stream2=number_slider, Stream3=number_slider_3)
filter_12 = StreamFilter(Gate=list_16, Stream0=number_slider_2, Stream1=number_slider_2, Stream2=number_slider_2, Stream3=number_slider_3)
join = JoinCurves(Curves=crv, Preserve=False)

# ----
# 简化线段
disc = Discontinuity(Curve=crv_2, Level=1)  # -> Points, Parameters
shift = ShiftList(List=disc.Points, Shift=1, Wrap=True)
ln = Line(StartPoint=disc.Points, EndPoint=shift)
len = Length(Curve=ln)
sort = SortList(Keys=len)  # -> Keys, ValuesA
panel_7 = Panel(sort.Keys)
smaller = SmallerThan(FirstNumber=len, SecondNumber=Slider(20, range=0..100))  # -> SmallerThan, OrEqualTo
dispatch = Dispatch(List=disc.Points, DispatchPattern=smaller.SmallerThan)  # -> ListA, ListB
pt_3 = Point(dispatch.ListA)
pt_4 = Point(dispatch.ListB)

# ----
# 简化线段
disc_2 = Discontinuity(Curve=crv_3, Level=1)  # -> Points, Parameters
shift_2 = ShiftList(List=disc_2.Points, Shift=1, Wrap=True)
ln_2 = Line(StartPoint=disc_2.Points, EndPoint=shift_2)
len_2 = Length(Curve=ln_2)
sort_2 = SortList(Keys=len_2)  # -> Keys, ValuesA
panel_8 = Panel(sort_2.Keys)
smaller_2 = SmallerThan(FirstNumber=len_2, SecondNumber=Slider(20, range=0..100))  # -> SmallerThan, OrEqualTo
dispatch_2 = Dispatch(List=disc_2.Points, DispatchPattern=smaller_2.SmallerThan)  # -> ListA, ListB
pt_5 = Point(dispatch_2.ListA)
pt_6 = Point(dispatch_2.ListB)

# ----
# 简化线段
disc_3 = Discontinuity(Curve=crv_4, Level=1)  # -> Points, Parameters
shift_3 = ShiftList(List=disc_3.Points, Shift=1, Wrap=True)
ln_3 = Line(StartPoint=disc_3.Points, EndPoint=shift_3)
len_3 = Length(Curve=ln_3)
sort_3 = SortList(Keys=len_3)  # -> Keys, ValuesA
panel_9 = Panel(sort_3.Keys)
smaller_3 = SmallerThan(FirstNumber=len_3, SecondNumber=Slider(20, range=0..100))  # -> SmallerThan, OrEqualTo
dispatch_3 = Dispatch(List=disc_3.Points, DispatchPattern=smaller_3.SmallerThan)  # -> ListA, ListB
pt_7 = Point(dispatch_3.ListA)
pt_8 = Point(dispatch_3.ListB)

# ----
# 如果无法完整的生成埋件的三视图，
# 建议选择埋件的3D在Rhino中将
# Top/Perspective/Front/Right 试图缩放至合适大小后重新运行
panel_10 = Panel("""Top
Perspective
Front
Right""")
pline = PolyLine(Vertices=pt_6, Closed=invert(False))
pline_2 = PolyLine(Vertices=pt_8, Closed=invert(False))
pline_3 = PolyLine(Vertices=pt_4, Closed=invert(False))
m2d_rhino = Make2DRhinoView(Name=panel_10, Clip=True)
filter_13 = StreamFilter(Gate=list_16, Stream0=pline_3, Stream1=pline_2, Stream2=pline_2, Stream3=pline_2)

flip = FlipCurve(Curve=pline_2)  # -> Curve, Flag
filter_14 = StreamFilter(Gate=Toggle(False), Stream0=pline_2, Stream1=flip.Curve)
offset = OffsetCurve(Curve=filter_14, Distance=Slider(100, range=0..100), Corners=1)
disc_4 = Discontinuity(Curve=offset, Level=1)  # -> Points, Parameters

# ---- group: Block
layer = DefineLayer(Name="Embeded", Color=ColourSwatch(SwatchColor=RGB(255, 0, 0)))
panel_11 = Panel("embed1")
attributes = DefineObjectAttributes(Layer=layer)

# ----
number_slider_4 = Slider(964, range=0..10000)
number_slider_5 = Slider(56, range=0..1000)
X = UnitX(Factor=1)
number_slider_6 = Slider(5, range=0..100)
number_slider_7 = Slider(20, range=0..100)

# ----
# 钢板槽Modeling
recgrid = Rectangular(Plane=PlaneXY(0, 0, 0), SizeX=s_x_3, SizeY=s_y_3, ExtentX=addition_3, ExtentY=addition_4)  # -> Cells, Points
multiplication = Multiplication(A=s_x_3, B=addition_3)
multiplication_2 = Multiplication(A=s_y_3, B=addition_4)
division_3 = Division(A=multiplication, B=2)
division_4 = Division(A=multiplication_2, B=2)
vec = VectorXYZ(XComponent=expr("-x", division_3), YComponent=expr("-x", division_4), ZComponent=0)  # -> Vector, Length
division_5 = Division(A=filter_3, B=2)
move_3 = Move(Geometry=recgrid.Points, Motion=vec.Vector)  # -> Geometry, Transform
multiplication_3 = Multiplication(A=division_5, B=2)
yz_plane_2 = YZPlane(Origin=Point(0, 0, 0))
orient_4 = Orient(Geometry=curve_2, Source=PlaneXY(0, 0, 0), Target=yz_plane_2)  # -> Geometry, Transform
divide_curve = DivideCurve(Curve=orient_4.Geometry, Count=Slider(50, range=0..100), Kinks=False)  # -> Points, Tangents, Parameters
unit_x_3 = UnitX(Factor=槽长_2)
division_6 = Division(A=槽长_2, B=2)
extrude_2 = Extrude(Base=orient_4.Geometry, Direction=unit_x_3)
unit_x_4 = UnitX(Factor=division_6)
convex_hull = ConvexHull(Points=divide_curve.Points, Plane=yz_plane_2)  # -> Hull, HullZ, Indices
move_4 = Move(Geometry=extrude_2, Motion=expr("-x", unit_x_4))  # -> Geometry, Transform
boundary_surfaces = BoundarySurfaces(Edges=convex_hull.Hull)
multiplication_4 = Multiplication(A=Slider(10, range=0..100), B=2)
subtraction_3 = Subtraction(A=槽长_2, B=multiplication_4)
unit_z = UnitZ(Factor=expr("-X", subtraction_2))
cap_holes_2 = CapHoles(Brep=move_4.Geometry)
unit_x_5 = UnitX(Factor=subtraction_3)
extrude_3 = Extrude(Base=boundary_surfaces, Direction=unit_x_5)
division_7 = Division(A=unit_x_5, B=2)
extrude_4 = Extrude(Base=boundary_surfaces, Direction=unit_x_3)
move_5 = Move(Geometry=extrude_3, Motion=expr("-x", division_7))  # -> Geometry, Transform
move_6 = Move(Geometry=extrude_4, Motion=expr("-x", unit_x_4))  # -> Geometry, Transform
solid_difference = SolidDifference(BrepsA=move_6.Geometry, BrepsB=move_5.Geometry)
Z = UnitZ(Factor=expr("-x", 锚板厚度_2))
xy_plane = XYPlane(Origin=Point(0, 0, 0))
deconstruct_plane = DeconstructPlane(Plane=xy_plane)  # -> Origin, XAxis, YAxis, ZAxis

multiplication_5 = Multiplication(A=multiplication_3, B=6)
max_2 = Maximum(A=multiplication_5, B=70)
multiplication_6 = Multiplication(A=锚筋到边_2, B=2)
addition_7 = Addition(A=multiplication, B=multiplication_6)
addition_8 = Addition(A=multiplication_2, B=multiplication_6)
expression_2 = Expression(x=addition_7, Expression="Ceiling(x/10)*10/2")
expression_3 = Expression(x=addition_8, Expression="Ceiling(x/10)*10/2")
dom = ConstructDomain(DomainStart=expr("-x", expression_2), DomainEnd=expression_2)
dom_2 = ConstructDomain(DomainStart=expr("-x", expression_3), DomainEnd=expression_3)
box = DomainBox(Base=PlaneXY(0, 0, 0), X=dom, Y=dom_2, Z=锚板厚度_2)

flip_matrix = FlipMatrix(Data=move_3.Geometry)
cull_first_last = CullFirstLast(List=flip_matrix)  # -> CullFirst, CullLast, CullFirstAndEnd
point = Point(cull_first_last.CullFirstAndEnd)
flip_matrix_2 = FlipMatrix(Data=point)
number_slider_8 = Slider(50, range=0..100)
polyline = PolyLine(Vertices=flip_matrix_2, Closed=False)
extend_curve = ExtendCurve(Curve=polyline, Type=0, Start=number_slider_8, End=number_slider_8)
xy_plane_2 = XYPlane(Origin=Point(0, 0, 0))
average = Average(Input=move_3.Geometry)
addition_9 = Addition(A=filter_4, B=Slider(1, range=0..1))
multiplication_7 = Multiplication(A=filter_3, B=2.5)
division_8 = Division(A=addition_9, B=2)
polyline_2 = PolyLine(Vertices=flatten(average), Closed=False)
negative = Negative(Value=division_8)
offset_curve = OffsetCurve(
    Curve=extend_curve,
    Distance=[Slider(25, range=0..100), Slider(25, range=0..100, expression="-x")],
    Plane=xy_plane_2,
    Corners=1)
circle = Circle(Plane=move_3.Geometry, Radius=multiplication_7)
shift_paths = ShiftPaths(Data=offset_curve, Offset=-1)
region_union = RegionUnion(Curves=circle)
offset_curve_2 = OffsetCurve(Curve=polyline_2, Distance=[division_8, negative], Plane=xy_plane_2, Corners=1)
boundary_surfaces_2 = BoundarySurfaces(Edges=region_union)
loft = Loft(Curves=shift_paths, Options={Adjust=False, Closed=False, LoftEnds=0, LoftSimp=0, LoftType=0, Rebuild=10, Refit=0.01})
trim_with_regions = TrimWithRegions(Curve=offset_curve_2, Regions=flatten(boundary_surfaces_2))  # -> Inside, Outside
trim_with_regions_2 = TrimWithRegions(Curve=trim_with_regions.Outside, Regions=flatten(loft))  # -> Inside, Outside
curve_3 = Curve(trim_with_regions_2.Outside)
flip_matrix_3 = FlipMatrix(Data=curve_3)
loft_2 = Loft(Curves=flip_matrix_3, Options={Adjust=False, Closed=False, LoftEnds=0, LoftSimp=0, LoftType=0, Rebuild=10, Refit=0.01})
length = Length(Curve=flip_matrix_3)  # -> flatten(Length)
brep_edges = BrepEdges(Brep=loft_2)  # -> Naked, Interior, NonManifold
max_min = MaxMin(Numbers=length)  # -> Max, MaxIndex, Min, MinIndex
join_curves = JoinCurves(Curves=brep_edges.Naked, Preserve=False)
number_slider_9 = Slider(100, range=0..100)
subtraction_4 = Subtraction(A=max_min.Min, B=filter_4)
fillet = Fillet(Curve=join_curves, Radius=division_8)
unit_z_2 = UnitZ(Factor=expr("-x", number_slider_9))
unit_z_3 = UnitZ(Factor=number_slider_9)
boundary_surfaces_3 = BoundarySurfaces(Edges=fillet)
extrude_5 = Extrude(Base=boundary_surfaces_3, Direction=[unit_z_3, unit_z_2])
solid_difference_2 = SolidDifference(BrepsA=box, BrepsB=flatten(extrude_5))

subtraction_5 = Subtraction(A=expression_3, B=板凳厚度)
dom_3 = ConstructDomain(DomainStart=expr("-x", subtraction_5), DomainEnd=subtraction_5)
rectangle = Rectangle(Plane=PlaneXY(0, 0, 0), XSize=dom, YSize=dom_3, Radius=0)  # -> Rectangle, Length
rectangle_2 = Rectangle(Plane=PlaneXY(0, 0, 0), XSize=dom, YSize=dom_2, Radius=0)  # -> Rectangle, Length
region_difference = RegionDifference(CurvesA=rectangle_2.Rectangle, CurvesB=rectangle.Rectangle)
boundary_surfaces_4 = BoundarySurfaces(Edges=region_difference)
extrude_6 = Extrude(Base=boundary_surfaces_4, Direction=unit_z)
merge_2 = Merge(Data1=extrude_6, Data2=solid_difference_2, Data3=cap_holes_2, Data4=solid_difference)
flatten = FlattenTree(Tree=merge_2, Path="{0}")

move_7 = Move(Geometry=flatten, Motion=Z)  # -> Geometry, Transform
centre_point = Point(deconstruct_plane.Origin)

# ----
# 板槽Modeling
recgrid_2 = Rectangular(Plane=PlaneXY(0, 0, 0), SizeX=s_x_2, SizeY=s_y_2, ExtentX=addition, ExtentY=addition_2)  # -> Cells, Points
multiplication_8 = Multiplication(A=s_x_2, B=addition)
multiplication_9 = Multiplication(A=s_y_2, B=addition_2)
division_9 = Division(A=multiplication_8, B=2)
division_10 = Division(A=multiplication_9, B=2)
vec_2 = VectorXYZ(XComponent=expr("-x", division_9), YComponent=expr("-x", division_10), ZComponent=0)  # -> Vector, Length
move_8 = Move(Geometry=recgrid_2.Points, Motion=vec_2.Vector)  # -> Geometry, Transform
division_11 = Division(A=filter_2, B=2)
divide_curve_2 = DivideCurve(Curve=orient.Geometry, Count=Slider(50, range=0..100), Kinks=False)  # -> Points, Tangents, Parameters
convex_hull_2 = ConvexHull(Points=divide_curve_2.Points, Plane=yz_plane)  # -> Hull, HullZ, Indices
boundary_surfaces_5 = BoundarySurfaces(Edges=convex_hull_2.Hull)
multiplication_10 = Multiplication(A=Slider(10, range=0..100), B=2)
subtraction_6 = Subtraction(A=槽长, B=multiplication_10)
unit_x_6 = UnitX(Factor=subtraction_6)
extrude_7 = Extrude(Base=boundary_surfaces_5, Direction=unit_x_6)
division_12 = Division(A=unit_x_6, B=2)
extrude_8 = Extrude(Base=boundary_surfaces_5, Direction=unit_x)
move_9 = Move(Geometry=extrude_7, Motion=expr("-x", division_12))  # -> Geometry, Transform
move_10 = Move(Geometry=extrude_8, Motion=expr("-x", unit_x_2))  # -> Geometry, Transform
solid_difference_3 = SolidDifference(BrepsA=move_10.Geometry, BrepsB=move_9.Geometry)
Z_2 = UnitZ(Factor=expr("-x", 锚板厚度))
xy_plane_3 = XYPlane(Origin=Point(0, 0, 0))
deconstruct_plane_2 = DeconstructPlane(Plane=xy_plane_3)  # -> Origin, XAxis, YAxis, ZAxis

unit_z_4 = UnitZ(Factor=expr("x", 锚筋末端焊板厚度))
unit_z_5 = UnitZ(Factor=expr("-x", subtraction))
division_13 = Division(A=锚筋末端焊板边长, B=2)
construct_domain = ConstructDomain(DomainStart=expr("-x", division_13), DomainEnd=division_13)
move_11 = Move(Geometry=move_8.Geometry, Motion=unit_z_5)  # -> Geometry, Transform
rectangle_3 = Rectangle(Plane=move_11.Geometry, XSize=construct_domain, YSize=construct_domain, Radius=0)  # -> Rectangle, Length
extrude_9 = Extrude(Base=rectangle_3.Rectangle, Direction=unit_z_4)

multiplication_11 = Multiplication(A=division_11, B=2)
cyl = Cylinder(Base=move_8.Geometry, Radius=division_11, Length=expr("-x", subtraction))
edges_2 = BrepEdges(Brep=cyl)  # -> Naked, Interior, NonManifold
multiplication_12 = Multiplication(A=multiplication_11, B=5)
item_3 = ListItem(List=edges_2.Naked, Index=0, Wrap=True)
X_2 = UnitX(Factor=multiplication_11)
Z_3 = UnitZ(Factor=multiplication_12)
move_12 = Move(Geometry=item_3, Motion=X_2)  # -> Geometry, Transform
extr = Extrude(Base=move_12.Geometry, Direction=Z_3)

multiplication_13 = Multiplication(A=multiplication_11, B=6)
max_3 = Maximum(A=multiplication_13, B=70)
multiplication_14 = Multiplication(A=锚筋到边, B=2)
addition_10 = Addition(A=multiplication_8, B=multiplication_14)
addition_11 = Addition(A=multiplication_9, B=multiplication_14)
expression_4 = Expression(x=addition_10, Expression="Ceiling(x/10)*10/2")
expression_5 = Expression(x=addition_11, Expression="Ceiling(x/10)*10/2")
dom_4 = ConstructDomain(DomainStart=expr("-x", expression_4), DomainEnd=expression_4)
dom_5 = ConstructDomain(DomainStart=expr("-x", expression_5), DomainEnd=expression_5)
box_2 = DomainBox(Base=PlaneXY(0, 0, 0), X=dom_4, Y=dom_5, Z=锚板厚度)

flip_matrix_4 = FlipMatrix(Data=move_8.Geometry)
cull_first_last_2 = CullFirstLast(List=flip_matrix_4)  # -> CullFirst, CullLast, CullFirstAndEnd
point_2 = Point(cull_first_last_2.CullFirstAndEnd)
flip_matrix_5 = FlipMatrix(Data=point_2)
number_slider_10 = Slider(50, range=0..100)
polyline_3 = PolyLine(Vertices=flip_matrix_5, Closed=False)
extend_curve_2 = ExtendCurve(Curve=polyline_3, Type=0, Start=number_slider_10, End=number_slider_10)
xy_plane_4 = XYPlane(Origin=Point(0, 0, 0))
average_2 = Average(Input=move_8.Geometry)
addition_12 = Addition(A=filter, B=Slider(1, range=0..1))
multiplication_15 = Multiplication(A=filter_2, B=2.5)
division_14 = Division(A=addition_12, B=2)
polyline_4 = PolyLine(Vertices=flatten(average_2), Closed=False)
negative_2 = Negative(Value=division_14)
offset_curve_3 = OffsetCurve(
    Curve=extend_curve_2,
    Distance=[Slider(25, range=0..100), Slider(25, range=0..100, expression="-x")],
    Plane=xy_plane_4,
    Corners=1)
circle_2 = Circle(Plane=move_8.Geometry, Radius=multiplication_15)
shift_paths_2 = ShiftPaths(Data=offset_curve_3, Offset=-1)
region_union_2 = RegionUnion(Curves=circle_2)
offset_curve_4 = OffsetCurve(Curve=polyline_4, Distance=[division_14, negative_2], Plane=xy_plane_4, Corners=1)
boundary_surfaces_6 = BoundarySurfaces(Edges=region_union_2)
loft_3 = Loft(Curves=shift_paths_2, Options={Adjust=False, Closed=False, LoftEnds=0, LoftSimp=0, LoftType=0, Rebuild=10, Refit=0.01})
trim_with_regions_3 = TrimWithRegions(Curve=offset_curve_4, Regions=flatten(boundary_surfaces_6))  # -> Inside, Outside
trim_with_regions_4 = TrimWithRegions(Curve=trim_with_regions_3.Outside, Regions=flatten(loft_3))  # -> Inside, Outside
curve_4 = Curve(trim_with_regions_4.Outside)
flip_matrix_6 = FlipMatrix(Data=curve_4)
loft_4 = Loft(Curves=flip_matrix_6, Options={Adjust=False, Closed=False, LoftEnds=0, LoftSimp=0, LoftType=0, Rebuild=10, Refit=0.01})
length_2 = Length(Curve=flip_matrix_6)  # -> flatten(Length)
brep_edges_2 = BrepEdges(Brep=loft_4)  # -> Naked, Interior, NonManifold
max_min_2 = MaxMin(Numbers=length_2)  # -> Max, MaxIndex, Min, MinIndex
join_curves_2 = JoinCurves(Curves=brep_edges_2.Naked, Preserve=False)
number_slider_11 = Slider(100, range=0..100)
subtraction_7 = Subtraction(A=max_min_2.Min, B=filter)
fillet_2 = Fillet(Curve=join_curves_2, Radius=division_14)
unit_z_6 = UnitZ(Factor=expr("-x", number_slider_11))
unit_z_7 = UnitZ(Factor=number_slider_11)
boundary_surfaces_7 = BoundarySurfaces(Edges=fillet_2)
extrude_10 = Extrude(Base=boundary_surfaces_7, Direction=[unit_z_7, unit_z_6])
solid_difference_4 = SolidDifference(BrepsA=box_2, BrepsB=flatten(extrude_10))

stream_filter = StreamFilter(Gate=value_list, Stream0=extr, Stream1=extrude_9)
cap = CapHoles(Brep=[cyl, stream_filter])
merge_3 = Merge(Data1=cap, Data2=solid_difference_4, Data3=cap_holes, Data4=solid_difference_3)
flatten_2 = FlattenTree(Tree=merge_3, Path="{0}")

move_13 = Move(Geometry=flatten_2, Motion=Z_2)  # -> Geometry, Transform
centre_point_2 = Point(deconstruct_plane_2.Origin)

geo = Geometry(box_2)

# ----
# 板埋Modeling
multiplication_16 = Multiplication(A=s_x, B=addition_5)
multiplication_17 = Multiplication(A=s_y, B=addition_6)
recgrid_3 = Rectangular(Plane=PlaneXY(0, 0, 0), SizeX=s_x, SizeY=s_y, ExtentX=addition_5, ExtentY=addition_6)  # -> Cells, Points
直径 = Text(filter_7)
division_15 = Division(A=multiplication_16, B=2)
division_16 = Division(A=multiplication_17, B=2)
vec_3 = VectorXYZ(XComponent=expr("-x", division_15), YComponent=expr("-x", division_16), ZComponent=0)  # -> Vector, Length
move_14 = Move(Geometry=recgrid_3.Points, Motion=vec_3.Vector)  # -> Geometry, Transform
division_17 = Division(A=直径, B=2)
cyl_2 = Cylinder(Base=move_14.Geometry, Radius=division_17, Length=expr("-x", expression))
X_3 = UnitX(Factor=直径)
multiplication_18 = Multiplication(A=直径, B=6)
edges_3 = BrepEdges(Brep=cyl_2)  # -> Naked, Interior, NonManifold
item_4 = ListItem(List=edges_3.Naked, Index=0, Wrap=True)
max_4 = Maximum(A=multiplication_18, B=70)
move_15 = Move(Geometry=item_4, Motion=X_3)  # -> Geometry, Transform
multiplication_19 = Multiplication(A=max_4, B=2)
addition_13 = Addition(A=multiplication_16, B=multiplication_19)
addition_14 = Addition(A=multiplication_17, B=multiplication_19)
division_18 = Division(A=t, B=2)
expression_6 = Expression(x=addition_14, Expression="Ceiling(x/10)*10/2")
expression_7 = Expression(x=addition_13, Expression="Ceiling(x/10)*10/2")
round = Round(Number=division_18)  # -> Nearest, Floor, Ceiling
multiplication_20 = Multiplication(A=round.Ceiling, B=2)
dom_6 = ConstructDomain(DomainStart=expr("-x", expression_6), DomainEnd=expression_6)
dom_7 = ConstructDomain(DomainStart=expr("-x", expression_7), DomainEnd=expression_7)
box_3 = DomainBox(Base=PlaneXY(0, 0, 0), X=dom_7, Y=dom_6, Z=multiplication_20)
Z_4 = UnitZ(Factor=expr("-x", multiplication_20))
move_16 = Move(Geometry=box_3, Motion=Z_4)  # -> Geometry, Transform
Z_5 = UnitZ(Factor=expr("-x", multiplication_20))

multiplication_21 = Multiplication(A=直径, B=5)

Z_6 = UnitZ(Factor=multiplication_21)
extr_2 = Extrude(Base=move_15.Geometry, Direction=Z_6)
cap_2 = CapHoles(Brep=[extr_2, cyl_2])
merge_4 = Merge(Data1=cap_2, Data2=box_3)
flatten_3 = FlattenTree(Tree=merge_4, Path="{0}")
move_17 = Move(Geometry=flatten_3, Motion=Z_5)  # -> Geometry, Transform

box_4 = DomainBox(Base=PlaneXY(0, 0, 0), X=dom_7, Y=dom_7, Z=multiplication_20)
merge_5 = Merge(Data1=cap_2, Data2=box_4)
flatten_4 = FlattenTree(Tree=merge_5, Path="{0}")
move_18 = Move(Geometry=flatten_4, Motion=Z_5)  # -> Geometry, Transform
entwine_2 = Entwine(Branch00=move_17.Geometry, Branch01=move_18.Geometry, FlattenInputs=True)
entwine_3 = Entwine(Branch00=move_13.Geometry, Branch01=move_7.Geometry, Branch02=geo, Branch03=move_17.Geometry, FlattenInputs=True)
make2d = Make2D(Geometry=entwine_3, View=m2d_rhino, TangentEdges=False, TangentSeams=False, AutoComputeMake2D=False)  # -> VisibleCurves, VisibleIndex, VisibleType, HiddenCurves, HiddenIndex, HiddenType

# ----
# 三视图
# hidden lines of top+pers view
# move to center
number_slider_12 = Slider(1, range=0..10)
bang = ExplodeTree(Data=make2d.VisibleCurves)  # -> Branch0, Branch1, Branch2, Branch3, Branch4, Branch5, Branch6, Branch7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
bang_2 = ExplodeTree(Data=make2d.VisibleCurves)  # -> Branch0, Branch1, Branch2, Branch3, Branch4, Branch5, Branch6, Branch7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
bang_3 = ExplodeTree(Data=make2d.VisibleCurves)  # -> Branch0, Branch1, Branch2, Branch3, Branch4, Branch5, Branch6, Branch7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
bang_4 = ExplodeTree(Data=make2d.VisibleCurves)  # -> Branch0, Branch1, Branch2, Branch3, Branch4, Branch5, Branch6, Branch7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
divdist = DivideDistance(Curve=make2d.HiddenCurves, Distance=number_slider_12)  # -> Points, Tangents, Parameters
graft = GraftTree(Tree=make2d.HiddenCurves, IncludeEmptyLists=True, IncludeNullItems=True)
shatter = Shatter(Curve=graft, Parameters=divdist.Parameters)
dispatch_4 = Dispatch(List=shatter, DispatchPattern=[True, False])  # -> ListA, ListB
crv_5 = Curve(dispatch_4.ListA)
pshift = ShiftPaths(Data=crv_5, Offset=-1)
pshift_2 = ShiftPaths(Data=pshift, Offset=-1)
bang_5 = ExplodeTree(Data=pshift_2)  # -> Branch0, Branch1, Branch2, Branch3, Branch4, Branch5, Branch6, Branch7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
bang_6 = ExplodeTree(Data=pshift_2)  # -> Branch0, Branch1, Branch2, Branch3, Branch4, Branch5, Branch6, Branch7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
bang_7 = ExplodeTree(Data=pshift_2)  # -> Branch0, Branch1, Branch2, Branch3, Branch4, Branch5, Branch6, Branch7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
bang_8 = ExplodeTree(Data=pshift_2)  # -> Branch0, Branch1, Branch2, Branch3, Branch4, Branch5, Branch6, Branch7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
# Rhino 文件中导入的块名
entwine_4 = Entwine(Branch00=bang_7.Branch0, Branch01=bang_2.Branch0, FlattenInputs=True)  # -> flatten(Result)
entwine_5 = Entwine(Branch00=bang_7.Branch1, Branch01=bang_2.Branch1, FlattenInputs=True)  # -> flatten(Result)
entwine_6 = Entwine(Branch00=bang_5.Branch13, Branch01=bang_4.Branch13, FlattenInputs=True)  # -> flatten(Result); disabled
entwine_7 = Entwine(Branch00=bang_5.Branch12, Branch01=bang_4.Branch12, FlattenInputs=True)  # -> flatten(Result)
entwine_8 = Entwine(Branch00=bang_8.Branch4, Branch01=bang.Branch4, FlattenInputs=True)  # -> flatten(Result)
entwine_9 = Entwine(Branch00=bang_8.Branch5, Branch01=bang.Branch5, FlattenInputs=True)  # -> flatten(Result)
entwine_10 = Entwine(Branch00=bang_6.Branch8, Branch01=bang_3.Branch8, FlattenInputs=True)  # -> flatten(Result)
entwine_11 = Entwine(Branch00=bang_6.Branch9, Branch01=bang_3.Branch9, FlattenInputs=True)  # -> flatten(Result)
entwine_12 = Entwine(Branch00=entwine_4, Branch01=entwine_5, Branch02=bang_2.Branch2, Branch03=bang_2.Branch3, FlattenInputs=True)
entwine_13 = Entwine(Branch00=entwine_8, Branch01=entwine_9, Branch02=bang.Branch6, Branch03=bang.Branch7, FlattenInputs=True)
entwine_14 = Entwine(Branch00=entwine_7, Branch01=entwine_6, Branch02=bang_4.Branch14, Branch03=bang_4.Branch15, FlattenInputs=True)
entwine_15 = Entwine(Branch00=entwine_10, Branch01=entwine_11, Branch02=bang_3.Branch10, Branch03=bang_3.Branch11, FlattenInputs=True)
group = Group(Objects=entwine_13)
group_2 = Group(Objects=entwine_12)
group_3 = Group(Objects=entwine_14)
group_4 = Group(Objects=entwine_15)
entwine_16 = Entwine(Branch00=group_2, Branch01=group, Branch02=group_4, Branch03=group_3, FlattenInputs=True)
pshift_3 = ShiftPaths(Data=entwine_16, Offset=-1)
pshift_4 = ShiftPaths(Data=entwine_16, Offset=-1)
boxprop = BoxProperties(Box=pshift_3)  # -> Center, Diagonal, Area, Volume, Degeneracy
pt_9 = Point(Point(957.9296072, 367.7685097, 0))
pt_10 = Point("0,0,0")
recgrid_4 = Rectangular(
    Plane=pt_9,
    SizeX=Slider(12, range=1..20, expression="X*50"),
    SizeY=Slider(10, range=1..20, expression="X*50"),
    ExtentX=Slider(3, range=0..10),
    ExtentY=Slider(3, range=0..10))  # -> Cells, Points
vec2pt = Vector2Pt(PointA=boxprop.Center, PointB=pt_10, Unitize=False)  # -> Vector, Length
flatten_5 = FlattenTree(Tree=recgrid_4.Points, Path="{0}")
move_19 = Move(Geometry=pshift_4, Motion=vec2pt.Vector)  # -> flatten(Geometry), Transform
orient_5 = Orient(Geometry=move_19.Geometry, Source=PlaneXY(0, 0, 0), Target=flatten_5)  # -> Geometry, Transform

disc_5 = Discontinuity(Curve=pline, Level=1)  # -> Points, Parameters
flip_2 = FlipCurve(Curve=pline)  # -> Curve, Flag
filter_15 = StreamFilter(Gate=Toggle(False), Stream0=pline, Stream1=flip_2.Curve)
pull = PullPoint(Point=disc_5.Points, Geometry=disc_4.Points, ClosestOnly=True)  # -> ClosestPoint, Distance
entwine_17 = Entwine(Branch00=pull.ClosestPoint, Branch01=disc_5.Points, FlattenInputs=True)
offset_2 = OffsetCurve(Curve=filter_15, Distance=expr("-x", Slider(341, range=0..1000)), Corners=1)
flip_3 = FlipMatrix(Data=entwine_17)
crv_6 = Curve(offset_2)
item_5 = ListItem(List=flip_3, Index="0", Wrap=True)  # -> flatten(Item)
item_6 = ListItem(List=flip_3, Index="1", Wrap=True)  # -> flatten(Item)
disc_6 = Discontinuity(Curve=crv_6, Level=1)  # -> Points, Parameters
panel_12 = Panel("1")
disc_7 = Discontinuity(Curve=filter_13, Level=1)  # -> Points, Parameters
panel_13 = Panel("""0
-1""")
pt_11 = Point(item_5)
cull_i = CullIndex(List=disc_7.Points, Indices=panel_13, Wrap=True)
pull_2 = PullPoint(Point=pt_11, Geometry=cull_i, ClosestOnly=True)  # -> ClosestPoint, Distance
larger = LargerThan(FirstNumber=pull_2.Distance, SecondNumber=Slider(1, range=0..10))  # -> LargerThan, OrEqualTo
dispatch_5 = Dispatch(List=pt_11, DispatchPattern=larger.LargerThan)  # -> ListA, ListB
pt_12 = Point(dispatch_5.ListB)
pt_13 = Point(dispatch_5.ListA)

# ---- group: Arch Points
pt_14 = Point(item_6)

# ----
panel_14 = Panel("""false
false
true
false""")
panel_15 = Panel("""true
false
false
false""")
panel_16 = Panel("""false
false
false
true""")
cull = CullPattern(List=orient_5.Geometry, CullPattern=panel_16)
cull_2 = CullPattern(List=orient_5.Geometry, CullPattern=panel_14)
cull_3 = CullPattern(List=orient_5.Geometry, CullPattern=panel_15)
entwine_18 = Entwine(Branch00=cull_3, Branch01=cull_2, Branch02=cull, FlattenInputs=True)
flip_4 = FlipMatrix(Data=entwine_18)
branch = TreeBranch(Tree=flip_4, Path="{0;0}", MaintainPaths=True)
branch_2 = TreeBranch(Tree=flip_4, Path="{0;1}", MaintainPaths=True)
branch_3 = TreeBranch(Tree=flip_4, Path="{0;2}", MaintainPaths=True)
branch_4 = TreeBranch(Tree=flip_4, Path="{0;3}", MaintainPaths=True)
cluster = Cluster(G=branch_3)
cluster_2 = Cluster(G=branch_2)
cluster_3 = Cluster(G=branch)
cluster_4 = Cluster(G=branch_4)
entwine_19 = Entwine(Branch00=cluster_3, Branch01=cluster_2, Branch02=cluster, Branch03=cluster_4, FlattenInputs=True)

# ---- group: side
item_7 = ListItem(List=entwine_19, Index="1", Wrap=True)  # -> flatten(Item)

# ---- group: side-short
item_8 = ListItem(List=entwine_19, Index="2", Wrap=True)  # -> flatten(Item)

# ---- group: top
item_9 = ListItem(List=entwine_19, Index=0, Wrap=True)  # -> flatten(Item)

# ----
item_10 = ListItem(List=item_9, Index=0, Wrap=True)
item_11 = ListItem(List=item_7, Index="2", Wrap=True)
item_12 = ListItem(List=item_9, Index="1", Wrap=True)
item_13 = ListItem(List=item_7, Index="3", Wrap=True)
item_14 = ListItem(List=item_8, Index="3", Wrap=True)
ungroup = Ungroup(Group=item_10)
ungroup_2 = Ungroup(Group=item_11)
ungroup_3 = Ungroup(Group=item_12)
ungroup_4 = Ungroup(Group=item_14)
ungroup_5 = Ungroup(Group=item_13)
block = DefineBlock(Geometry=ungroup_3, Attributes=attributes, BlockName=panel_11, BasePlane=PlaneXY(0, 0, 0))
block_2 = DefineBlock(Geometry=ungroup_4, Attributes=attributes, BlockName="embed5", BasePlane=PlaneXY(0, 0, 0))
block_3 = DefineBlock(Geometry=ungroup, Attributes=attributes, BlockName="embed2", BasePlane=PlaneXY(0, 0, 0))
block_4 = DefineBlock(Geometry=ungroup_5, Attributes=attributes, BlockName="embed4", BasePlane=PlaneXY(0, 0, 0))
block_5 = DefineBlock(Geometry=ungroup_2, Attributes=attributes, BlockName="embed3", BasePlane=PlaneXY(0, 0, 0))
merge_6 = Merge(Data1=block, Data2=block_3, Data3=block_5, Data4=block_4, Data5=block_2)

item_15 = ListItem(List=flatten(merge_6), Index="1", Wrap=True)
item_16 = ListItem(List=flatten(merge_6), Index="1", Wrap=True)
item_17 = ListItem(List=flatten(merge_6), Index="1", Wrap=True)
item_18 = ListItem(List=flatten(merge_6), Index="4", Wrap=True)
item_19 = ListItem(List=flatten(merge_6), Index="1", Wrap=True)

item_20 = ListItem(List=flatten(merge_6), Index="2", Wrap=True)
bbox_3 = BoundingBox(Content=graft(item_20), Plane=PlaneXY(0, 0, 0))  # -> Box, Box_2
srf = Surface(bbox_3.Box)
explode = Explode(Curve=srf, Recursive=True)  # -> Segments, Vertices
item_21 = ListItem(List=explode.Vertices, Index=0, Wrap=True)  # -> Item, Item1, Item2
ln_4 = Line(StartPoint=graft(item_21.Item), EndPoint=graft(item_21.Item1))
ln_5 = Line(StartPoint=graft(item_21.Item1), EndPoint=graft(item_21.Item2))
midpt = CurveMiddle(Curve=ln_5)
move_20 = Move(Geometry=ln_4, Motion=ln_4)  # -> Geometry, Transform
pl = ConstructPlane(Origin=midpt, XAxis=move_20.Geometry, YAxis=ln_5)

crv_cp = CurveClosestPoint(Point=pt_14, Curve=crv_6)  # -> Point, Parameter, Distance
c_script_2 = CSharpScript(archPoint=crv_cp.Point, crvPoint=disc_6.Points)  # -> out, specialPt; inputs archPoint: list of Point3d, crvPoint: list of Point3d; same code as c_script
item_22 = ListItem(List=pt_14, Index=c_script_2.specialPt, Wrap=True)
cull_i_2 = CullIndex(List=item_5, Indices=c_script_2.specialPt, Wrap=True)
item_23 = ListItem(List=item_5, Index=c_script_2.specialPt, Wrap=True)
cull_i_3 = CullIndex(List=pt_14, Indices=c_script_2.specialPt, Wrap=True)
item_24 = ListItem(List=pt_14, Index=c_script_2.specialPt, Wrap=True)
shift_4 = ShiftList(List=item_22, Shift="1", Wrap=True)
pt_15 = Point(graft(shift_4))
pt_16 = Point(graft(item_22))
pt_17 = Point(graft(cull_i_3))
ln_6 = Line(StartPoint=pt_15, EndPoint=pt_17)
ln_7 = Line(StartPoint=pt_16, EndPoint=pt_17)
angle = Angle(VectorA=ln_6, VectorB=ln_7)  # -> flatten(Angle), Reflex
deg = Degrees(Radians=angle.Angle)
larger_2 = LargerThan(FirstNumber=deg, SecondNumber="96")  # -> LargerThan, OrEqualTo
dispatch_6 = Dispatch(List=flatten(cull_i_2), DispatchPattern=larger_2.LargerThan)  # -> ListA, ListB
dispatch_7 = Dispatch(List=flatten(pt_17), DispatchPattern=larger_2.LargerThan)  # -> ListA, ListB

pt_18 = Point(dispatch_6.ListB)
pt_19 = Point(item_23)
pt_20 = Point(dispatch_6.ListA)

pt_21 = Point(dispatch_7.ListB)
pt_22 = Point(item_24)
pt_23 = Point(dispatch_7.ListA)

c_script_3 = CSharpScript(archPoint=pt_13, crvPoint=pt_20)  # -> out, specialPt; inputs archPoint: list of Point3d, crvPoint: list of Point3d; same code as c_script
c_script_4 = CSharpScript(archPoint=pt_13, crvPoint=pt_18)  # -> out, specialPt; inputs archPoint: list of Point3d, crvPoint: list of Point3d; same code as c_script
c_script_5 = CSharpScript(archPoint=pt_13, crvPoint=pt_19)  # -> out, specialPt; inputs archPoint: list of Point3d, crvPoint: list of Point3d; same code as c_script
c_script_6 = CSharpScript(archPoint=pt_12, crvPoint=pt_19)  # -> out, specialPt; inputs archPoint: list of Point3d, crvPoint: list of Point3d; same code as c_script
c_script_7 = CSharpScript(archPoint=pt_12, crvPoint=pt_20)  # -> out, specialPt; inputs archPoint: list of Point3d, crvPoint: list of Point3d; same code as c_script
c_script_8 = CSharpScript(archPoint=pt_12, crvPoint=pt_18)  # -> out, specialPt; inputs archPoint: list of Point3d, crvPoint: list of Point3d; same code as c_script

item_25 = ListItem(List=pt_13, Index=c_script_3.specialPt, Wrap=True)
item_26 = ListItem(List=pt_13, Index=c_script_4.specialPt, Wrap=True)
item_27 = ListItem(List=pt_13, Index=c_script_5.specialPt, Wrap=True)  # -> graft(Item)

item_28 = ListItem(List=pt_12, Index=c_script_6.specialPt, Wrap=True)  # -> graft(Item)
item_29 = ListItem(List=pt_12, Index=c_script_7.specialPt, Wrap=True)
item_30 = ListItem(List=pt_12, Index=c_script_8.specialPt, Wrap=True)

panel_17 = Panel("""0
-1""")
item_31 = ListItem(List=pt_11, Index=panel_17, Wrap=True)
cull_i_4 = CullIndex(List=pt_11, Indices=panel_17, Wrap=True)
dispatch_8 = Dispatch(List=cull_i_4, DispatchPattern=[True, False])  # -> ListA, ListB
dispatch_9 = Dispatch(List=item_31, DispatchPattern=[True, False])  # -> ListA, ListB
pt_24 = Point(dispatch_8.ListA)
pt_25 = Point(dispatch_8.ListB)
pt_26 = Point(pt_17)
ln_8 = Line(StartPoint=pt_24, EndPoint=pt_25)
ln_9 = Line(StartPoint=dispatch_9.ListA, EndPoint=dispatch_9.ListB)
merge_7 = Merge(Data1=ln_9, Data2=ln_8)  # -> flatten(Result)
shift_5 = ShiftList(List=merge_7, Shift=1, Wrap=True)
crv_cp_2 = CurveClosestPoint(Point=graft(pt_26), Curve=graft(shift_5))  # -> flatten(Point), Parameter, Distance

pull_3 = PullPoint(Point=item_26, Geometry=crv_cp_2.Point, ClosestOnly=True)  # -> ClosestPoint, Distance
pt_27 = Point(item_26)
ln_10 = Line(StartPoint=pull_3.ClosestPoint, EndPoint=pt_27)
item_32 = ListItem(List=flatten(merge_6), Index=0, Wrap=True)
item_33 = ListItem(List=flatten(merge_6), Index="3", Wrap=True)
amp = Amplitude(Vector=ln_10, Amplitude=filter_11)
filter_16 = StreamFilter(Gate=list_16, Stream0=item_32, Stream1=item_15, Stream2=item_32, Stream3=item_33)
move_21 = Move(Geometry=pull_3.ClosestPoint, Motion=amp)  # -> Geometry, Transform
ln_11 = Line(StartPoint=move_21.Geometry, EndPoint=pull_3.ClosestPoint)
rotate_2 = Rotate(Geometry=ln_11, Angle=-1.570796327, Plane=move_21.Geometry)  # -> Geometry, Transform
line = Line(flatten(ln_11))
line_2 = Line(flatten(rotate_2.Geometry))
pl_2 = ConstructPlane(Origin=flatten(move_21.Geometry), XAxis=line, YAxis=line_2)
bbox_4 = BoundingBox(Content=graft(filter_16), Plane=PlaneXY(0, 0, 0))  # -> Box, Box_2
srf_2 = Surface(bbox_4.Box)
explode_2 = Explode(Curve=srf_2, Recursive=True)  # -> Segments, Vertices
item_34 = ListItem(List=explode_2.Vertices, Index=0, Wrap=True)  # -> Item, Item1, Item2
ln_12 = Line(StartPoint=graft(item_34.Item1), EndPoint=graft(item_34.Item2))
midpt_2 = CurveMiddle(Curve=ln_12)
ln_13 = Line(StartPoint=midpt_2, EndPoint=item_34.Item1)
rotate_3 = Rotate(Geometry=ln_13, Angle=-1.570796327, Plane=PlaneXY(0, 0, 0))  # -> Geometry, Transform
pl_3 = ConstructPlane(Origin=midpt_2, XAxis=ln_13, YAxis=rotate_3.Geometry)
orient_6 = Orient(Geometry=filter_16, Source=pl_3, Target=pl_2)  # -> Geometry, Transform
data = Data(orient_6.Geometry)

pull_4 = PullPoint(Point=item_25, Geometry=crv_cp_2.Point, ClosestOnly=True)  # -> ClosestPoint, Distance
pt_28 = Point(item_25)
item_35 = ListItem(List=flatten(merge_6), Index=0, Wrap=True)
item_36 = ListItem(List=flatten(merge_6), Index="3", Wrap=True)
ln_14 = Line(StartPoint=pull_4.ClosestPoint, EndPoint=pt_28)
filter_17 = StreamFilter(Gate=list_16, Stream0=item_35, Stream1=item_16, Stream2=item_35, Stream3=item_36)
amp_2 = Amplitude(Vector=ln_14, Amplitude=filter_12)
move_22 = Move(Geometry=pull_4.ClosestPoint, Motion=amp_2)  # -> Geometry, Transform
ln_15 = Line(StartPoint=move_22.Geometry, EndPoint=pull_4.ClosestPoint)
rotate_4 = Rotate(Geometry=ln_15, Angle=-1.570796327, Plane=move_22.Geometry)  # -> Geometry, Transform
line_3 = Line(flatten(ln_15))
line_4 = Line(flatten(rotate_4.Geometry))
pl_4 = ConstructPlane(Origin=flatten(move_22.Geometry), XAxis=line_3, YAxis=line_4)
bbox_5 = BoundingBox(Content=graft(filter_17), Plane=PlaneXY(0, 0, 0))  # -> Box, Box_2
srf_3 = Surface(bbox_5.Box)
explode_3 = Explode(Curve=srf_3, Recursive=True)  # -> Segments, Vertices
item_37 = ListItem(List=explode_3.Vertices, Index=0, Wrap=True)  # -> Item, Item1, Item2
ln_16 = Line(StartPoint=graft(item_37.Item1), EndPoint=graft(item_37.Item2))
midpt_3 = CurveMiddle(Curve=ln_16)
ln_17 = Line(StartPoint=midpt_3, EndPoint=item_37.Item1)
rotate_5 = Rotate(Geometry=ln_17, Angle=-1.570796327, Plane=PlaneXY(0, 0, 0))  # -> Geometry, Transform
pl_5 = ConstructPlane(Origin=midpt_3, XAxis=ln_17, YAxis=rotate_5.Geometry)
orient_7 = Orient(Geometry=srf_3, Source=pl_5, Target=pl_4)  # -> Geometry, Transform
orient_8 = Orient(Geometry=filter_17, Source=pl_5, Target=pl_4)  # -> Geometry, Transform
data_2 = Data(orient_8.Geometry)

pull_5 = PullPoint(Point=item_30, Geometry=crv_cp_2.Point, ClosestOnly=True)  # -> ClosestPoint, Distance
pt_29 = Point(item_30)
ln_18 = Line(StartPoint=pull_5.ClosestPoint, EndPoint=pt_29)
amp_3 = Amplitude(Vector=ln_18, Amplitude=filter_11)
move_23 = Move(Geometry=pull_5.ClosestPoint, Motion=amp_3)  # -> Geometry, Transform
ln_19 = Line(StartPoint=move_23.Geometry, EndPoint=pull_5.ClosestPoint)
rotate_6 = Rotate(Geometry=ln_19, Angle=-1.570796327, Plane=move_23.Geometry)  # -> Geometry, Transform
item_38 = ListItem(List=flatten(merge_6), Index="1", Wrap=True)
line_5 = Line(flatten(ln_19))
line_6 = Line(flatten(rotate_6.Geometry))
bbox_6 = BoundingBox(Content=graft(item_38), Plane=PlaneXY(0, 0, 0))  # -> Box, Box_2
srf_4 = Surface(bbox_6.Box)
pl_6 = ConstructPlane(Origin=flatten(move_23.Geometry), XAxis=line_5, YAxis=line_6)
explode_4 = Explode(Curve=srf_4, Recursive=True)  # -> Segments, Vertices
item_39 = ListItem(List=explode_4.Vertices, Index=0, Wrap=True)  # -> Item, Item1, Item2
ln_20 = Line(StartPoint=graft(item_39.Item1), EndPoint=graft(item_39.Item2))
midpt_4 = CurveMiddle(Curve=ln_20)
ln_21 = Line(StartPoint=midpt_4, EndPoint=item_39.Item1)
rotate_7 = Rotate(Geometry=ln_21, Angle=-1.570796327, Plane=PlaneXY(0, 0, 0))  # -> Geometry, Transform
pl_7 = ConstructPlane(Origin=midpt_4, XAxis=ln_21, YAxis=rotate_7.Geometry)
orient_9 = Orient(Geometry=item_38, Source=pl_7, Target=pl_6)  # -> Geometry, Transform
orient_10 = Orient(Geometry=srf_4, Source=pl_7, Target=pl_6)  # -> Geometry, Transform
data_3 = Data(orient_9.Geometry)

pull_6 = PullPoint(Point=item_29, Geometry=crv_cp_2.Point, ClosestOnly=True)  # -> ClosestPoint, Distance
pt_30 = Point(item_29)
ln_22 = Line(StartPoint=pull_6.ClosestPoint, EndPoint=pt_30)
amp_4 = Amplitude(Vector=ln_22, Amplitude=filter_12)
move_24 = Move(Geometry=pull_6.ClosestPoint, Motion=amp_4)  # -> Geometry, Transform
ln_23 = Line(StartPoint=move_24.Geometry, EndPoint=pull_6.ClosestPoint)
rotate_8 = Rotate(Geometry=ln_23, Angle=-1.570796327, Plane=move_24.Geometry)  # -> Geometry, Transform
item_40 = ListItem(List=flatten(merge_6), Index="1", Wrap=True)
line_7 = Line(flatten(ln_23))
line_8 = Line(flatten(rotate_8.Geometry))
bbox_7 = BoundingBox(Content=graft(item_40), Plane=PlaneXY(0, 0, 0))  # -> Box, Box_2
pl_8 = ConstructPlane(Origin=flatten(move_24.Geometry), XAxis=line_7, YAxis=line_8)
srf_5 = Surface(bbox_7.Box)
explode_5 = Explode(Curve=srf_5, Recursive=True)  # -> Segments, Vertices
item_41 = ListItem(List=explode_5.Vertices, Index=0, Wrap=True)  # -> Item, Item1, Item2
ln_24 = Line(StartPoint=graft(item_41.Item1), EndPoint=graft(item_41.Item2))
midpt_5 = CurveMiddle(Curve=ln_24)
ln_25 = Line(StartPoint=midpt_5, EndPoint=item_41.Item1)
rotate_9 = Rotate(Geometry=ln_25, Angle=-1.570796327, Plane=PlaneXY(0, 0, 0))  # -> Geometry, Transform
pl_9 = ConstructPlane(Origin=midpt_5, XAxis=ln_25, YAxis=rotate_9.Geometry)
orient_11 = Orient(Geometry=item_40, Source=pl_9, Target=pl_8)  # -> Geometry, Transform
orient_12 = Orient(Geometry=srf_5, Source=pl_9, Target=pl_8)  # -> Geometry, Transform
data_4 = Data(orient_11.Geometry)

item_42 = ListItem(List=flatten(merge_6), Index="1", Wrap=True)
cull_i_5 = CullIndex(List=pt_12, Indices=c_script_6.specialPt, Wrap=True)  # -> graft(List)
item_43 = ListItem(List=flatten(merge_6), Index="3", Wrap=True)
ln_26 = Line(StartPoint=item_28, EndPoint=cull_i_5)
filter_18 = StreamFilter(Gate=list_16, Stream0=item_42, Stream1=item_19, Stream2=item_42, Stream3=item_43)
bbox_8 = BoundingBox(Content=graft(filter_18), Plane=PlaneXY(0, 0, 0))  # -> Box, Box_2
rotate_10 = Rotate(Geometry=ln_26, Angle=-1.570796327, Plane=item_28)  # -> Geometry, Transform
line_9 = Line(flatten(ln_26))
line_10 = Line(flatten(rotate_10.Geometry))
srf_6 = Surface(bbox_8.Box)
pl_10 = ConstructPlane(Origin=flatten(item_28), XAxis=line_10, YAxis=line_9)
explode_6 = Explode(Curve=srf_6, Recursive=True)  # -> Segments, Vertices
item_44 = ListItem(List=explode_6.Vertices, Index=0, Wrap=True)  # -> Item, Item1, Item2
ln_27 = Line(StartPoint=graft(item_44.Item1), EndPoint=graft(item_44.Item))
ln_28 = Line(StartPoint=graft(item_44.Item1), EndPoint=graft(item_44.Item2))
pt_31 = Point(item_44.Item1)
pl_11 = ConstructPlane(Origin=item_44.Item1, XAxis=ln_27, YAxis=ln_28)
orient_13 = Orient(Geometry=filter_18, Source=pl_11, Target=pl_10)  # -> Geometry, Transform
data_5 = Data(orient_13.Geometry)

orient_14 = Orient(Geometry=srf_2, Source=pl_3, Target=pl_2)  # -> Geometry, Transform

boundary = BoundarySurfaces(Edges=crv)  # -> simplify(Surfaces)
boundary_2 = BoundarySurfaces(Edges=orient_14.Geometry)  # -> simplify(graft(Surfaces))
graft_2 = GraftTree(Tree=data, IncludeEmptyLists=True, IncludeNullItems=True)  # -> simplify(Tree)
graft_3 = GraftTree(Tree=pt_27, IncludeEmptyLists=True, IncludeNullItems=True)  # -> simplify(Tree)
findbrepintersect = FindBrepIntersect(BrepMain=boundary_2, BrepStay=boundary)  # -> out, BrepInters, BrepRemain; inputs BrepMain: list of Brep, BrepStay: list of Brep
# ---------- findbrepintersect: C# ----------
    List<Brep> BrepI = new List<Brep>();
    List<Brep> BrepR = new List<Brep>();
    


    double tolr = Rhino.RhinoDoc.ActiveDoc.ModelAbsoluteTolerance;

    for(int j = 0; j < BrepMain.Count;j++){
      foreach(Brep b in BrepStay) {
        bool test = Rhino.Geometry.Intersect.Intersection.BrepBrep(BrepMain[j], b, tolr, out crv, out pts);
        if(test && crv.Length != 0){
          tryThis = true;
          break;}
        else{
          tryThis = false;}
      }
      if(tryThis){
        BrepI.Add(BrepMain[j]);
      }
      else{
        BrepR.Add(BrepMain[j]);
      }
    }



    BrepInters = BrepI;
    BrepRemain = BrepR;
# ---------- findbrepintersect: C# additional code ----------
  Rhino.Geometry.Curve[] crv;
  Rhino.Geometry.Point3d[] pts;
  bool tryThis;
# ---------- end findbrepintersect ----------
pt_32 = Point(pt_14)
item_45 = ListItem(List=graft_3, Index=findbrepintersect.BrepInters, Wrap=True)
pull_7 = PullPoint(Point=item_45, Geometry=pt_32, ClosestOnly=True)  # -> ClosestPoint, Distance
pull_8 = PullPoint(Point=pull_7.ClosestPoint, Geometry=boundary, ClosestOnly=True)  # -> ClosestPoint, Distance
ln_29 = Line(StartPoint=pull_7.ClosestPoint, EndPoint=pull_8.ClosestPoint)
rotate_11 = Rotate(Geometry=ln_29, Angle=1.570796327, Plane=pull_8.ClosestPoint)  # -> Geometry, Transform
pl_12 = ConstructPlane(Origin=pull_8.ClosestPoint, XAxis=ln_29, YAxis=rotate_11.Geometry)
orient_15 = Orient(Geometry=item_20, Source=pl, Target=pl_12)  # -> Geometry, Transform
cull_i_6 = CullIndex(List=graft_2, Indices=findbrepintersect.BrepInters, Wrap=True)
merge_8 = Merge(Data1=cull_i_6, Data2=orient_15.Geometry)

boundary_3 = BoundarySurfaces(Edges=crv)  # -> simplify(Surfaces)
boundary_4 = BoundarySurfaces(Edges=orient_7.Geometry)  # -> simplify(graft(Surfaces))
graft_4 = GraftTree(Tree=move_22.Geometry, IncludeEmptyLists=True, IncludeNullItems=True)  # -> simplify(Tree)
graft_5 = GraftTree(Tree=data_2, IncludeEmptyLists=True, IncludeNullItems=True)  # -> simplify(Tree)
findbrepintersect_2 = FindBrepIntersect(BrepMain=boundary_4, BrepStay=boundary_3)  # -> out, BrepInters, BrepRemain; inputs BrepMain: list of Brep, BrepStay: list of Brep; same code as findbrepintersect
pt_33 = Point(pt_14)
item_46 = ListItem(List=graft_4, Index=findbrepintersect_2.BrepInters, Wrap=True)
pull_9 = PullPoint(Point=item_46, Geometry=pt_33, ClosestOnly=True)  # -> ClosestPoint, Distance
pull_10 = PullPoint(Point=pull_9.ClosestPoint, Geometry=boundary_3, ClosestOnly=True)  # -> ClosestPoint, Distance
ln_30 = Line(StartPoint=pull_9.ClosestPoint, EndPoint=pull_10.ClosestPoint)
rotate_12 = Rotate(Geometry=ln_30, Angle=1.570796327, Plane=pull_10.ClosestPoint)  # -> Geometry, Transform
pl_13 = ConstructPlane(Origin=pull_10.ClosestPoint, XAxis=ln_30, YAxis=rotate_12.Geometry)
orient_16 = Orient(Geometry=item_20, Source=pl, Target=pl_13)  # -> Geometry, Transform
cull_i_7 = CullIndex(List=graft_5, Indices=findbrepintersect_2.BrepInters, Wrap=True)
merge_9 = Merge(Data1=cull_i_7, Data2=orient_16.Geometry)

boundary_5 = BoundarySurfaces(Edges=crv)  # -> simplify(Surfaces)
boundary_6 = BoundarySurfaces(Edges=orient_12.Geometry)  # -> simplify(graft(Surfaces))
graft_6 = GraftTree(Tree=data_4, IncludeEmptyLists=True, IncludeNullItems=True)  # -> simplify(Tree)
graft_7 = GraftTree(Tree=move_24.Geometry, IncludeEmptyLists=True, IncludeNullItems=True)  # -> simplify(Tree)
pt_34 = Point(pt_14)
findbrepintersect_3 = FindBrepIntersect(BrepMain=boundary_6, BrepStay=boundary_5)  # -> out, BrepInters, BrepRemain; inputs BrepMain: list of Brep, BrepStay: list of Brep; same code as findbrepintersect
item_47 = ListItem(List=graft_7, Index=findbrepintersect_3.BrepInters, Wrap=True)
pull_11 = PullPoint(Point=item_47, Geometry=pt_34, ClosestOnly=True)  # -> ClosestPoint, Distance
pull_12 = PullPoint(Point=pull_11.ClosestPoint, Geometry=boundary_5, ClosestOnly=True)  # -> ClosestPoint, Distance
ln_31 = Line(StartPoint=pull_11.ClosestPoint, EndPoint=pull_12.ClosestPoint)
rotate_13 = Rotate(Geometry=ln_31, Angle=1.570796327, Plane=pull_12.ClosestPoint)  # -> Geometry, Transform
pl_14 = ConstructPlane(Origin=pull_12.ClosestPoint, XAxis=ln_31, YAxis=rotate_13.Geometry)
orient_17 = Orient(Geometry=item_20, Source=pl, Target=pl_14)  # -> Geometry, Transform
cull_i_8 = CullIndex(List=graft_6, Indices=findbrepintersect_3.BrepInters, Wrap=True)
merge_10 = Merge(Data1=cull_i_8, Data2=orient_17.Geometry)

boundary_7 = BoundarySurfaces(Edges=crv)  # -> simplify(Surfaces)
boundary_8 = BoundarySurfaces(Edges=orient_10.Geometry)  # -> simplify(graft(Surfaces))
graft_8 = GraftTree(Tree=data_3, IncludeEmptyLists=True, IncludeNullItems=True)  # -> simplify(Tree)
graft_9 = GraftTree(Tree=move_23.Geometry, IncludeEmptyLists=True, IncludeNullItems=True)  # -> simplify(Tree)
pt_35 = Point(pt_14)
findbrepintersect_4 = FindBrepIntersect(BrepMain=boundary_8, BrepStay=boundary_7)  # -> out, BrepInters, BrepRemain; inputs BrepMain: list of Brep, BrepStay: list of Brep; same code as findbrepintersect
item_48 = ListItem(List=graft_9, Index=findbrepintersect_4.BrepInters, Wrap=True)
pull_13 = PullPoint(Point=item_48, Geometry=pt_35, ClosestOnly=True)  # -> ClosestPoint, Distance
pull_14 = PullPoint(Point=pull_13.ClosestPoint, Geometry=boundary_7, ClosestOnly=True)  # -> ClosestPoint, Distance
ln_32 = Line(StartPoint=pull_13.ClosestPoint, EndPoint=pull_14.ClosestPoint)
rotate_14 = Rotate(Geometry=ln_32, Angle=1.570796327, Plane=pull_14.ClosestPoint)  # -> Geometry, Transform
pl_15 = ConstructPlane(Origin=pull_14.ClosestPoint, XAxis=ln_32, YAxis=rotate_14.Geometry)
orient_18 = Orient(Geometry=item_20, Source=pl, Target=pl_15)  # -> Geometry, Transform
cull_i_9 = CullIndex(List=graft_8, Indices=findbrepintersect_4.BrepInters, Wrap=True)
merge_11 = Merge(Data1=cull_i_9, Data2=orient_18.Geometry)

merge_12 = Merge(Data1=data_5, Data2=merge_11, Data3=merge_10)

toggle = BooleanToggle(True)
pt_36 = Point(pt_18)
pline_4 = PolyLine(Vertices=pt_36, Closed=toggle)
srf_7 = Surface(pline_4)
disc_8 = Discontinuity(Curve=srf_7, Level=1)  # -> Points, Parameters
area_3 = Area(Geometry=join)  # -> Area, Centroid
pline_5 = PolyLine(Vertices=disc_8.Points, Closed=toggle)
crv_7 = Curve(pline_5)
pt_37 = Point(area_3.Centroid)
debrep = DeconstructBrep(Brep=crv_7)  # -> Faces, Edges, Vertices
pull_15 = PullPoint(Point=debrep.Vertices, Geometry=pt_37, ClosestOnly=True)  # -> ClosestPoint, Distance
pline_6 = PolyLine(Vertices=pull_15.ClosestPoint, Closed=Toggle(True))
debrep_2 = DeconstructBrep(Brep=pline_6)  # -> Faces, Edges, Vertices
len_4 = Length(Curve=debrep_2.Edges)
sort_4 = SortList(Keys=reverse(len_4), ValuesA=debrep_2.Edges)  # -> Keys, ValuesA
item_49 = ListItem(List=sort_4.ValuesA, Index=0, Wrap=True)  # -> Item, Item1, Item2, Item3
number_slider_13 = Slider(3154, range=0..10000)
mp = Midpoint(Curve=[item_49.Item, item_49.Item1, item_49.Item2, item_49.Item3])  # -> graft(Midpoint)
scale = Scale(Geometry=graft([item_49.Item, item_49.Item1, item_49.Item2, item_49.Item3]), Center=mp, Factor="2")  # -> Geometry, Transform
item_50 = ListItem(List=flatten(scale.Geometry), Index=0, Wrap=True)  # -> Item, Item1, Item2, Item3
offset_3 = OffsetCurve(Curve=item_50.Item2, Distance=expr("-x", number_slider_13), Corners=1)  # -> flatten(Curve)
offset_4 = OffsetCurve(Curve=item_50.Item3, Distance=expr("-x", number_slider_13), Corners=1)  # -> flatten(Curve)
offset_5 = OffsetCurve(Curve=item_50.Item1, Distance=expr("-x", number_slider_13), Corners=1)  # -> flatten(Curve)
offset_6 = OffsetCurve(Curve=item_50.Item, Distance=expr("-x", number_slider_13), Corners=1)  # -> flatten(Curve)
clx_2 = CurveLine(Curve=offset_5, Line=[offset_6, offset_3, offset_4])  # -> Points, Params, Count
clx_3 = CurveLine(Curve=offset_6, Line=[offset_5, offset_3, offset_4])  # -> Points, Params, Count
clx_4 = CurveLine(Curve=offset_3, Line=[offset_6, offset_5, offset_4])  # -> Points, Params, Count
clx_5 = CurveLine(Curve=offset_4, Line=[offset_6, offset_5, offset_3])  # -> Points, Params, Count
merge_13 = Merge(Data1=offset_6, Data2=offset_5, Data3=offset_3, Data4=offset_4)
merge_14 = Merge(Data1=clx_3.Points, Data2=clx_2.Points, Data3=clx_4.Points, Data4=clx_5.Points)
cullduppoints = RemoveDuplicatePoints(InputPoints=flatten(merge_14), Tolerance=0.001)  # -> OutputPoints, FirstPointIndexes
null = NullItem(Item=cullduppoints.OutputPoints)  # -> NullFlags, InvalidFlags, Description
dispatch_10 = Dispatch(List=flatten(merge_14), DispatchPattern=null.NullFlags)  # -> ListA, ListB
pt_38 = Point(dispatch_10.ListB)
item_51 = ListItem(List=pt_38, Index=0, Wrap=True)  # -> Item, Item1, Item2, Item3
pull_16 = PullPoint(Point=[debrep_2.Vertices, pt_38], Geometry=merge_13, ClosestOnly=True)  # -> flatten(ClosestPoint), Distance
pull_17 = PullPoint(Point=pull_16.ClosestPoint, Geometry=item_51.Item3, ClosestOnly=True)  # -> ClosestPoint, Distance
pull_18 = PullPoint(Point=pull_16.ClosestPoint, Geometry=item_51.Item, ClosestOnly=True)  # -> ClosestPoint, Distance
pull_19 = PullPoint(Point=pull_16.ClosestPoint, Geometry=item_51.Item1, ClosestOnly=True)  # -> ClosestPoint, Distance
pull_20 = PullPoint(Point=pull_16.ClosestPoint, Geometry=item_51.Item2, ClosestOnly=True)  # -> ClosestPoint, Distance
sort_5 = SortList(Keys=pull_17.Distance, ValuesA=pull_16.ClosestPoint)  # -> Keys, ValuesA
sort_6 = SortList(Keys=pull_18.Distance, ValuesA=pull_16.ClosestPoint)  # -> Keys, ValuesA
sort_7 = SortList(Keys=pull_19.Distance, ValuesA=pull_16.ClosestPoint)  # -> Keys, ValuesA
sort_8 = SortList(Keys=pull_20.Distance, ValuesA=pull_16.ClosestPoint)  # -> Keys, ValuesA
item_52 = ListItem(List=sort_5.ValuesA, Index=0, Wrap=True)  # -> Item, Item1, Item2
item_53 = ListItem(List=sort_6.ValuesA, Index=0, Wrap=True)  # -> Item, Item1, Item2
item_54 = ListItem(List=sort_7.ValuesA, Index=0, Wrap=True)  # -> Item, Item1, Item2
item_55 = ListItem(List=sort_8.ValuesA, Index=0, Wrap=True)  # -> Item, Item1, Item2
ln_33 = Line(StartPoint=item_54.Item, EndPoint=item_54.Item2)
ln_34 = Line(StartPoint=item_54.Item, EndPoint=item_54.Item1)
ln_35 = Line(StartPoint=item_53.Item, EndPoint=item_53.Item2)
ln_36 = Line(StartPoint=item_53.Item, EndPoint=item_53.Item1)
ln_37 = Line(StartPoint=item_52.Item, EndPoint=item_52.Item2)
ln_38 = Line(StartPoint=item_52.Item, EndPoint=item_52.Item1)
ln_39 = Line(StartPoint=item_55.Item, EndPoint=item_55.Item2)
ln_40 = Line(StartPoint=item_55.Item, EndPoint=item_55.Item1)
extr_3 = Extrude(Base=ln_36, Direction=ln_35)
extr_4 = Extrude(Base=ln_34, Direction=ln_33)
extr_5 = Extrude(Base=ln_38, Direction=ln_37)
extr_6 = Extrude(Base=ln_40, Direction=ln_39)
pt_39 = Point(disc_4.Points)
merge_15 = Merge(Data1=extr_3, Data2=extr_4, Data3=extr_6, Data4=extr_5)
incurves = PointInCurves(Point=pt_39, Curves=merge_15)  # -> Relationship, Index, Point
equals = Equality(FirstNumber=incurves.Index, SecondNumber="-1")  # -> Equality, Inequality
dispatch_11 = Dispatch(List=pt_39, DispatchPattern=equals.Equality)  # -> ListA, ListB
data_6 = Data(dispatch_11.ListB)
incurve = PointInCurve(Point=data_6, Curve=extr_4)  # -> Relationship, Point
incurve_2 = PointInCurve(Point=data_6, Curve=extr_5)  # -> Relationship, Point
incurve_3 = PointInCurve(Point=data_6, Curve=extr_3)  # -> Relationship, Point
incurve_4 = PointInCurve(Point=data_6, Curve=extr_6)  # -> Relationship, Point
equals_2 = Equality(FirstNumber=incurve.Relationship, SecondNumber="2")  # -> Equality, Inequality
equals_3 = Equality(FirstNumber=incurve_3.Relationship, SecondNumber="2")  # -> Equality, Inequality
equals_4 = Equality(FirstNumber=incurve_2.Relationship, SecondNumber="2")  # -> Equality, Inequality
dispatch_12 = Dispatch(List=data_6, DispatchPattern=equals_2.Equality)  # -> ListA, ListB
dispatch_13 = Dispatch(List=data_6, DispatchPattern=equals_3.Equality)  # -> ListA, ListB
equals_5 = Equality(FirstNumber=incurve_4.Relationship, SecondNumber="2")  # -> Equality, Inequality
dispatch_14 = Dispatch(List=data_6, DispatchPattern=equals_4.Equality)  # -> ListA, ListB
dispatch_15 = Dispatch(List=data_6, DispatchPattern=equals_5.Equality)  # -> ListA, ListB
data_7 = Data(dispatch_11.ListA)
number_slider_14 = Slider(1000, range=0..1000)
offcrv = OffsetCurve(Curve=merge_13, Plane=PlaneXY(0, 0, 0), Distance=Slider(3836, range=0..10000), BothSides=0, Kinks=0, CapType=1)  # -> flatten(Offset)
item_56 = ListItem(List=offcrv, Index=0, Wrap=True)  # -> Item, Item1, Item2, Item3
incurve_5 = PointInCurve(Point=data_7, Curve=item_56.Item)  # -> Relationship, Point
incurve_6 = PointInCurve(Point=data_7, Curve=item_56.Item1)  # -> Relationship, Point
incurve_7 = PointInCurve(Point=data_7, Curve=item_56.Item2)  # -> Relationship, Point
incurve_8 = PointInCurve(Point=data_7, Curve=item_56.Item3)  # -> Relationship, Point
equals_6 = Equality(FirstNumber=incurve_5.Relationship, SecondNumber="2")  # -> Equality, Inequality
equals_7 = Equality(FirstNumber=incurve_6.Relationship, SecondNumber="2")  # -> Equality, Inequality
equals_8 = Equality(FirstNumber=incurve_7.Relationship, SecondNumber="2")  # -> Equality, Inequality
equals_9 = Equality(FirstNumber=incurve_8.Relationship, SecondNumber="2")  # -> Equality, Inequality
dispatch_16 = Dispatch(List=data_7, DispatchPattern=equals_6.Equality)  # -> ListA, ListB
dispatch_17 = Dispatch(List=data_7, DispatchPattern=equals_7.Equality)  # -> ListA, ListB
dispatch_18 = Dispatch(List=data_7, DispatchPattern=equals_8.Equality)  # -> ListA, ListB
dispatch_19 = Dispatch(List=data_7, DispatchPattern=equals_9.Equality)  # -> ListA, ListB
data_8 = Data(dispatch_13.ListA)
data_9 = Data(dispatch_15.ListA)
data_10 = Data(dispatch_14.ListA)
data_11 = Data(dispatch_12.ListA)

pt_40 = Point(dispatch_16.ListA)
pt_41 = Point(dispatch_17.ListA)
pt_42 = Point(dispatch_18.ListA)
pt_43 = Point(dispatch_19.ListA)

merge_16 = Merge(Data1=pt_40, Data2=data_11, Data3=data_8)
merge_17 = Merge(Data1=pt_41, Data2=data_8, Data3=data_9)
merge_18 = Merge(Data1=pt_42, Data2=data_11, Data3=data_10)
merge_19 = Merge(Data1=pt_43, Data2=data_9, Data3=data_10)

pt_44 = Point(item_52.Item)
pt_45 = Point(item_53.Item)
crv_8 = Curve(offset_5)
crv_9 = Curve(offset_6)
end = EndPoints(Curve=crv_8)  # -> Start, End
crv_10 = Curve(offset_3)
crv_11 = Curve(offset_4)

pull_21 = PullPoint(Point=merge_19, Geometry=crv_11, ClosestOnly=True)  # -> ClosestPoint, Distance
pull_22 = PullPoint(Point=pull_21.ClosestPoint, Geometry=pt_44, ClosestOnly=True)  # -> ClosestPoint, Distance
sort_9 = SortList(Keys=pull_22.Distance, ValuesA=merge_19)  # -> Keys, ValuesA
shift_6 = ShiftList(List=sort_9.ValuesA, Shift=1, Wrap=invert(True))
ln_41 = Line(StartPoint=sort_9.ValuesA, EndPoint=shift_6)
end_2 = EndPoints(Curve=ln_41)  # -> Start, End
cull_i_10 = CullIndex(List=ln_41, Indices="-1", Wrap=True)
offset_7 = OffsetCurve(Curve=crv_11, Distance=number_slider_4, Corners=1)

pull_23 = PullPoint(Point=merge_16, Geometry=crv_9, ClosestOnly=True)  # -> ClosestPoint, Distance
pull_24 = PullPoint(Point=pull_23.ClosestPoint, Geometry=pt_45, ClosestOnly=True)  # -> ClosestPoint, Distance
sort_10 = SortList(Keys=pull_24.Distance, ValuesA=merge_16)  # -> Keys, ValuesA
shift_7 = ShiftList(List=sort_10.ValuesA, Shift=1, Wrap=invert(True))
ln_42 = Line(StartPoint=sort_10.ValuesA, EndPoint=shift_7)
end_3 = EndPoints(Curve=ln_42)  # -> Start, End
cull_i_11 = CullIndex(List=ln_42, Indices="-1", Wrap=True)
offset_8 = OffsetCurve(Curve=crv_9, Distance=number_slider_4, Corners=1)

pull_25 = PullPoint(Point=merge_17, Geometry=crv_8, ClosestOnly=True)  # -> ClosestPoint, Distance
pull_26 = PullPoint(Point=pull_25.ClosestPoint, Geometry=pt_45, ClosestOnly=True)  # -> ClosestPoint, Distance
sort_11 = SortList(Keys=pull_26.Distance, ValuesA=merge_17)  # -> Keys, ValuesA
shift_8 = ShiftList(List=sort_11.ValuesA, Shift=1, Wrap=invert(True))
ln_43 = Line(StartPoint=sort_11.ValuesA, EndPoint=shift_8)
end_4 = EndPoints(Curve=ln_43)  # -> Start, End
cull_i_12 = CullIndex(List=ln_43, Indices="-1", Wrap=True)
offset_9 = OffsetCurve(Curve=crv_8, Distance=number_slider_4, Corners=1)

pull_27 = PullPoint(Point=merge_18, Geometry=crv_10, ClosestOnly=True)  # -> ClosestPoint, Distance
pull_28 = PullPoint(Point=pull_27.ClosestPoint, Geometry=pt_44, ClosestOnly=True)  # -> ClosestPoint, Distance
sort_12 = SortList(Keys=pull_28.Distance, ValuesA=merge_18)  # -> Keys, ValuesA
shift_9 = ShiftList(List=sort_12.ValuesA, Shift=1, Wrap=invert(True))
ln_44 = Line(StartPoint=sort_12.ValuesA, EndPoint=shift_9)
end_5 = EndPoints(Curve=ln_44)  # -> Start, End
cull_i_13 = CullIndex(List=ln_44, Indices="-1", Wrap=True)
offset_10 = OffsetCurve(Curve=crv_10, Distance=number_slider_4, Corners=1)

ln_45 = Line(StartPoint=end.Start, EndPoint=end.End)

# ----
# 标注
lineardim = LinearDimension(Line=offset_9, PointA=end_4.Start, PointB=end_4.End, Text="{0:0}", Size=number_slider_5)
lineardim_2 = LinearDimension(Line=offset_8, PointA=end_3.Start, PointB=end_3.End, Text="{0:0}", Size=number_slider_5)
lineardim_3 = LinearDimension(Line=offset_10, PointA=end_5.Start, PointB=end_5.End, Text="{0:0}", Size=number_slider_5)
lineardim_4 = LinearDimension(Line=offset_7, PointA=end_2.Start, PointB=end_2.End, Text="{0:0}", Size=number_slider_5)

lineardim_5 = DefineLinearDimension(
    Point1=end_4.Start,
    Point2=end_4.End,
    DimensionPlane=X,
    Offset=expr("-x", Slider(1000, range=0..1000)),
    DimensionStyle=number_slider_5)

item_57 = ListItem(List=flatten(merge_6), Index=0, Wrap=True)
cull_i_14 = CullIndex(List=pt_13, Indices=c_script_5.specialPt, Wrap=True)  # -> graft(List)
ln_46 = Line(StartPoint=item_27, EndPoint=cull_i_14)
rotate_15 = Rotate(Geometry=ln_46, Angle=-1.570796327, Plane=item_27)  # -> Geometry, Transform
line_11 = Line(flatten(ln_46))
line_12 = Line(flatten(rotate_15.Geometry))
pl_16 = ConstructPlane(Origin=flatten(item_27), XAxis=line_12, YAxis=line_11)

filter_19 = StreamFilter(Gate=list_16, Stream0=item_57, Stream1=item_17, Stream2=item_57, Stream3=item_18)

bbox_9 = BoundingBox(Content=graft(filter_19), Plane=PlaneXY(0, 0, 0))  # -> Box, Box_2
srf_8 = Surface(bbox_9.Box)
explode_7 = Explode(Curve=srf_8, Recursive=True)  # -> Segments, Vertices
item_58 = ListItem(List=explode_7.Vertices, Index=0, Wrap=True)  # -> Item, Item1, Item2
ln_47 = Line(StartPoint=graft(item_58.Item1), EndPoint=graft(item_58.Item))
ln_48 = Line(StartPoint=graft(item_58.Item1), EndPoint=graft(item_58.Item2))
pt_46 = Point(item_58.Item1)
# 这里如果跑红也不要紧，
# 说明单体没有出现相撞的情况
pl_17 = ConstructPlane(Origin=item_58.Item1, XAxis=ln_47, YAxis=ln_48)

pl_18 = ConstructPlane(Origin=pt_46, XAxis=ln_48, YAxis=ln_47)
filter_20 = StreamFilter(Gate=list_16, Stream0=pl_17, Stream1=pl_17, Stream2=pl_17, Stream3=pl_18)

orient_19 = Orient(Geometry=filter_19, Source=filter_20, Target=pl_16)  # -> Geometry, Transform
data_12 = Data(orient_19.Geometry)

merge_20 = Merge(Data1=data_12, Data2=merge_8, Data3=merge_9)
merge_21 = Merge(Data1=flatten(merge_20), Data2=flatten(merge_12))
preview = CustomPreview(Geometry=merge_21, Material=ColourSwatch(SwatchColor=RGB(255, 0, 0)))

# ----
# BAKE ME
toggle_2 = BooleanToggle(False)
bake = BakeObjects(Geometry=flatten(merge_21), Bake=toggle_2)

# ==== cluster Cluster
G = ClusterInput()
rotate = Rotate(Geometry=G, Angle=3.141592654, Plane=PlaneXY(0, 0, 0))  # -> Geometry, Transform
boxprop = BoxProperties(Box=rotate.Geometry)  # -> Center, Diagonal, Area, Volume, Degeneracy
bbox = BoundingBox(Content=rotate.Geometry, Plane=PlaneXY(0, 0, 0))  # -> Box, Box_2
debox = DeconstructBox(Box=bbox.Box)  # -> Plane, X, Y, Z
pdecon = Deconstruct(Point=boxprop.Center)  # -> XComponent, YComponent, ZComponent
dedomain = DeconstructDomain(Domain=debox.Y)  # -> Start, End
pt = ConstructPoint(XCoordinate=pdecon.XComponent, YCoordinate=dedomain.Start, ZCoordinate=pdecon.ZComponent)
xy = XYPlane(Origin=Point(0, 0, 0))
pl_origin = PlaneOrigin(Base=xy, Origin=pt)
orient = Orient(Geometry=rotate.Geometry, Source=pl_origin, Target=xy)  # -> Geometry, Transform
G_2 = ClusterOutput(orient.Geometry)
