# Grasshopper definition FacadeEmbed_jinqiao-Default_NEW.gh (Grasshopper 1.0.7)
# plug-ins: EleFront, Hare, Wombat, TT Toolbox, Pufferfish

# ---- group: 螺栓直径
list = ValueList({"10": 0, "12": 1, "16": 2, "18": 3, "20": 4, "25": 5}, selected="16")

# ---- group: 锚筋直径
list_2 = ValueList({"10": 0, "12": 1, "16": 2, "18": 3, "20": 4, "25": 5}, selected="12")

# ---- group: 锚筋间距
s_x = Slider(25, range=14..60, expression="X*5")
s_y = Slider(20, range=14..60, expression="X*5")

# ---- group: 列
list_3 = ValueList({"2X": 0, "3X": 1, "4X": 2}, selected="3X")

# ---- group: 行
list_4 = ValueList({"2Y": 0, "3Y": 1, "4Y": 2}, selected="2Y")

# ----
# 板槽几何input
addition = Addition(A=list_3, B=1)
addition_2 = Addition(A=list_4, B=1)
锚板厚度 = Slider(12, range=0..100)
value_list = ValueList({"锚筋": 0, "锚焊": 1}, selected="锚焊")
锚筋末端焊板厚度 = Slider(12, range=0..100)
curve = Curve(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)
槽长 = Slider(270, range=0..1000)
锚筋到边 = Panel("75")
锚筋长度 = Slider(12, range=0..30, expression="x*10")
subtraction = Subtraction(A=锚筋长度, B=锚板厚度)
锚筋末端焊板边长 = Slider(40, range=0..100)
filter = StreamFilter(Gate=list, Stream0=10, Stream1=12, Stream2=16, Stream3=18, Stream4=20, Stream5=25)
filter_2 = StreamFilter(Gate=list_2, Stream0=10, Stream1=12, Stream2=16, Stream3=18, Stream4=20, Stream5=25)

# ---- group: 螺栓直径
list_5 = ValueList({"10": 0, "12": 1, "16": 2, "18": 3, "20": 4, "25": 5}, selected="16")

# ---- group: 锚筋直径
list_6 = ValueList({"10": 0, "12": 1, "16": 2, "18": 3, "20": 4, "25": 5}, selected="12")

# ---- group: 锚筋间距
s_x_2 = Slider(25, range=14..60, expression="X*5")
s_y_2 = Slider(20, range=14..60, expression="X*5")

# ---- group: 列
list_7 = ValueList({"2X": 0, "3X": 1, "4X": 2}, selected="3X")

# ---- group: 行
list_8 = ValueList({"2Y": 0, "3Y": 1, "4Y": 2}, selected="2Y")

# ----
# 钢板槽几何input
list_9 = ValueList({"板埋": 0, "槽埋": 1}, selected="板埋")
list_10 = ValueList({"顶埋": 0, "侧埋": 1}, selected="顶埋")
addition_3 = Addition(A=list_7, B=1)
addition_4 = Addition(A=list_8, B=1)
板凳厚度 = Slider(16, range=0..100)
value_list_2 = ValueList({"锚筋": 0, "锚焊": 1}, selected="锚焊")
锚筋末端焊板厚度_2 = Slider(12, range=0..100)
锚筋到边_2 = Panel("75")
锚筋长度_2 = Slider(12, range=0..30, expression="x*10")
锚板厚度_2 = Slider(12, range=0..100)
subtraction_2 = Subtraction(A=锚筋长度_2, B=锚板厚度_2)
锚筋末端焊板边长_2 = Slider(40, range=0..100)
curve_2 = Curve(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)
槽长_2 = Slider(270, range=0..1000)
filter_3 = StreamFilter(Gate=list_6, Stream0=10, Stream1=12, Stream2=16, Stream3=18, Stream4=20, Stream5=25)
filter_4 = StreamFilter(Gate=list_5, Stream0=10, Stream1=12, Stream2=16, Stream3=18, Stream4=20, Stream5=25)

锚筋末端焊板厚度_3 = Slider(12, range=0..100)
锚筋长度_3 = Slider(12, range=0..30, expression="x*10")
锚筋末端焊板边长_3 = Slider(40, range=0..100)
锚板厚度_3 = Slider(12, range=0..100)
槽长_3 = Slider(270, range=0..1000)

# ---- group: 锚筋间距
s_x_3 = Slider(25, range=14..60, expression="X*5")
s_y_3 = Slider(20, range=14..60, expression="X*5")

# ----
value_list_3 = ValueList({"锚筋": 0, "锚焊": 1}, selected="锚筋")
锚筋到边_3 = Panel("75")
锚筋到边_4 = Panel("45")
# 板埋Modeling
list_11 = ValueList({"板埋": 0, "槽埋": 1}, selected="板埋")
list_12 = ValueList({"顶埋": 0, "侧埋": 1}, selected="顶埋")

# ---- group: 螺栓直径
list_13 = ValueList({"10": 0, "12": 1, "16": 2, "18": 3, "20": 4, "25": 5}, selected="16")

# ---- group: 锚筋直径
list_14 = ValueList({"10": 0, "12": 1, "16": 2, "18": 3, "20": 4, "25": 5}, selected="12")

# ---- group: 列
list_15 = ValueList({"2X": 0, "3X": 1, "4X": 2}, selected="3X")

# ---- group: 行
list_16 = ValueList({"2Y": 0, "3Y": 1, "4Y": 2}, selected="3Y")

# ----
curve_3 = Curve(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)
锚筋末端焊板厚度_4 = Slider(12, range=0..100)
锚筋长度_4 = Slider(22, range=0..30, expression="x*10")
锚筋末端焊板边长_4 = Slider(40, range=0..100)
锚板厚度_4 = Slider(12, range=0..100)
槽长_4 = Slider(270, range=0..1000)
subtraction_3 = Subtraction(A=Slider(215, range=0..1000), B=锚板厚度_3)

# ---- group: 锚筋间距
s_x_4 = Slider(25, range=14..60, expression="X*5")
s_y_4 = Slider(20, range=14..60, expression="X*5")

# ----
filter_5 = StreamFilter(Gate=list_14, Stream0=10, Stream1=12, Stream2=16, Stream3=18, Stream4=20, Stream5=25)
filter_6 = StreamFilter(Gate=list_13, Stream0=10, Stream1=12, Stream2=16, Stream3=18, Stream4=20, Stream5=25)
addition_5 = Addition(A=list_16, B=1)
value_list_4 = ValueList({"锚筋": 0, "锚焊": 1}, selected="锚筋")
addition_6 = Addition(A=list_15, B=1)
锚筋到边_5 = Panel("75")
锚筋到边_6 = Panel("45")

# ---- group: 混凝土
# 板埋几何INPUT
list_17 = ValueList({"C15": 0, "C20": 1, "C25": 2, "C30": 3, "C35": 4, "C40": 5}, selected="C35")  # disabled

# ---- group: 钢筋牌号
list_18 = ValueList({"HPB300": 0, "HRB400": 1}, selected="HPB300")  # disabled

# ---- group: 直径
list_19 = ValueList({"10": 0, "12": 1, "16": 2, "18": 3, "20": 4, "25": 5}, selected="12")  # disabled

# ---- group: 列
list_20 = ValueList({"2X": 0, "3X": 1, "4X": 2}, selected="3X")  # disabled

# ---- group: 行
list_21 = ValueList({"2Y": 0, "3Y": 1, "4Y": 2}, selected="2Y")  # disabled

# ---- group: 锚筋间距
s_y_5 = Slider(22, range=14..60, expression="X*5")  # disabled
s_x_5 = Slider(22, range=14..60, expression="X*5")  # disabled

# ----
# 板埋Modeling
list_22 = ValueList({"板埋": 0, "槽埋": 1}, selected="板埋")
list_23 = ValueList({"顶埋": 0, "侧埋": 1}, selected="顶埋")

# ---- group: 螺栓直径
list_24 = ValueList({"10": 0, "12": 1, "16": 2, "18": 3, "20": 4, "25": 5}, selected="16")

# ---- group: 锚筋直径
list_25 = ValueList({"10": 0, "12": 1, "16": 2, "18": 3, "20": 4, "25": 5}, selected="12")

# ---- group: 列
list_26 = ValueList({"2X": 0, "3X": 1, "4X": 2}, selected="2X")

# ---- group: 行
list_27 = ValueList({"2Y": 0, "3Y": 1, "4Y": 2}, selected="3Y")

# ----
curve_4 = Curve(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)
subtraction_4 = Subtraction(A=Slider(215, range=0..1000), B=锚板厚度_4)
filter_7 = StreamFilter(Gate=list_25, Stream0=10, Stream1=12, Stream2=16, Stream3=18, Stream4=20, Stream5=25)
filter_8 = StreamFilter(Gate=list_24, Stream0=10, Stream1=12, Stream2=16, Stream3=18, Stream4=20, Stream5=25)
addition_7 = Addition(A=list_27, B=1)
addition_8 = Addition(A=list_26, B=1)
max = Maximum(A=s_x_5, B=s_y_5)  # disabled
recgrid = Rectangular(Plane=PlaneXY(0, 0, 0), SizeX=s_x_3, SizeY=s_y_3, ExtentX=addition_6, ExtentY=addition_5)  # -> Cells, Points
multiplication = Multiplication(A=s_x_3, B=addition_6)
multiplication_2 = Multiplication(A=s_y_3, B=addition_5)
filter_9 = StreamFilter(Gate=list_17, Stream0=7.2, Stream1=9.6, Stream2=11.9, Stream3=14.3, Stream4=16.7, Stream5=19.1)  # disabled
filter_10 = StreamFilter(Gate=list_18, Stream0=270, Stream1=360)  # disabled
filter_11 = StreamFilter(Gate=list_19, Stream0=10, Stream1=12, Stream2=16, Stream3=18, Stream4=20, Stream5=25)  # disabled
filter_12 = StreamFilter(Gate=list_17, Stream0=0.91, Stream1=1.1, Stream2=1.27, Stream3=1.43, Stream4=1.57, Stream5=1.71)  # disabled
filter_13 = StreamFilter(Gate=list_18, Stream0=0.16, Stream1=0.14)  # disabled
addition_9 = Addition(A=list_20, B=1)  # disabled
addition_10 = Addition(A=list_21, B=1)  # disabled
division = Division(A=max, B=8)  # disabled

# ----
# 钢埋件Modeling
焊板高度 = Slider(300, range=0..1000)
焊板宽度 = Slider(450, range=0..1000)
division_2 = Division(A=焊板高度, B=2)
division_3 = Division(A=焊板宽度, B=2)
construct_domain = ConstructDomain(DomainStart=expr("-x", division_2), DomainEnd=division_2)
construct_domain_2 = ConstructDomain(DomainStart=expr("-x", division_3), DomainEnd=division_3)
negative = Negative(Value="16")
neg = Negative(Value=negative)
box = DomainBox(Base=PlaneXY(0, 0, 0), X=construct_domain_2, Y=construct_domain, Z=neg)

t = Integer(division)  # disabled
division_4 = Division(A=multiplication, B=2)
division_5 = Division(A=multiplication_2, B=2)
panel = Panel(filter_12)  # disabled
panel_2 = Panel(filter_9)  # disabled
recgrid_2 = Rectangular(Plane=PlaneXY(0, 0, 0), SizeX=s_x_4, SizeY=s_y_4, ExtentX=addition_8, ExtentY=addition_7)  # -> Cells, Points
panel_3 = Panel(filter_13)  # disabled
min = Minimum(A=filter_10, B=300)  # disabled
multiplication_3 = Multiplication(A=s_x_4, B=addition_8)
multiplication_4 = Multiplication(A=s_y_4, B=addition_7)
vec = VectorXYZ(XComponent=expr("-x", division_4), YComponent=expr("-x", division_5), ZComponent=0)  # -> Vector, Length
panel_4 = Panel(min)  # disabled
move = Move(Geometry=recgrid.Points, Motion=vec.Vector)  # -> Geometry, Transform
flip_matrix = FlipMatrix(Data=move.Geometry)
cull_first_last = CullFirstLast(List=flip_matrix)  # -> CullFirst, CullLast, CullFirstAndEnd
division_6 = Division(A=multiplication_3, B=2)
division_7 = Division(A=multiplication_4, B=2)
division_8 = Division(A=filter_5, B=2)

unit_z = UnitZ(Factor=expr("x", 锚筋末端焊板厚度_3))
unit_z_2 = UnitZ(Factor=expr("-x", subtraction_3))
division_9 = Division(A=锚筋末端焊板边长_3, B=2)
construct_domain_3 = ConstructDomain(DomainStart=expr("-x", division_9), DomainEnd=division_9)
move_2 = Move(Geometry=move.Geometry, Motion=unit_z_2)  # -> Geometry, Transform
rectangle = Rectangle(Plane=move_2.Geometry, XSize=construct_domain_3, YSize=construct_domain_3, Radius=0)  # -> Rectangle, Length
extrude = Extrude(Base=rectangle.Rectangle, Direction=unit_z)

vec_2 = VectorXYZ(XComponent=expr("-x", division_6), YComponent=expr("-x", division_7), ZComponent=0)  # -> Vector, Length
point = Point(cull_first_last.CullFirstAndEnd)

multiplication_5 = Multiplication(A=division_8, B=2)
cyl = Cylinder(Base=move.Geometry, Radius=division_8, Length=expr("-x", subtraction_3))
edges = BrepEdges(Brep=cyl)  # -> Naked, Interior, NonManifold
multiplication_6 = Multiplication(A=multiplication_5, B=5)
item = ListItem(List=edges.Naked, Index=0, Wrap=True)
X = UnitX(Factor=multiplication_5)
Z = UnitZ(Factor=multiplication_6)
move_3 = Move(Geometry=item, Motion=X)  # -> Geometry, Transform
extr = Extrude(Base=move_3.Geometry, Direction=Z)

flip_matrix_2 = FlipMatrix(Data=point)
move_4 = Move(Geometry=recgrid_2.Points, Motion=vec_2.Vector)  # -> Geometry, Transform
flip_matrix_3 = FlipMatrix(Data=move_4.Geometry)
cull_first_last_2 = CullFirstLast(List=flip_matrix_3)  # -> CullFirst, CullLast, CullFirstAndEnd
division_10 = Division(A=filter_7, B=2)
number_slider = Slider(50, range=0..100)

unit_z_3 = UnitZ(Factor=expr("x", 锚筋末端焊板厚度_4))
unit_z_4 = UnitZ(Factor=expr("-x", subtraction_4))
division_11 = Division(A=锚筋末端焊板边长_4, B=2)
construct_domain_4 = ConstructDomain(DomainStart=expr("-x", division_11), DomainEnd=division_11)
move_5 = Move(Geometry=move_4.Geometry, Motion=unit_z_4)  # -> Geometry, Transform
rectangle_2 = Rectangle(Plane=move_5.Geometry, XSize=construct_domain_4, YSize=construct_domain_4, Radius=0)  # -> Rectangle, Length
extrude_2 = Extrude(Base=rectangle_2.Rectangle, Direction=unit_z_3)

polyline = PolyLine(Vertices=flip_matrix_2, Closed=False)
point_2 = Point(cull_first_last_2.CullFirstAndEnd)

multiplication_7 = Multiplication(A=division_10, B=2)
cyl_2 = Cylinder(Base=move_4.Geometry, Radius=division_10, Length=expr("-x", subtraction_4))
edges_2 = BrepEdges(Brep=cyl_2)  # -> Naked, Interior, NonManifold
multiplication_8 = Multiplication(A=multiplication_7, B=5)
item_2 = ListItem(List=edges_2.Naked, Index=0, Wrap=True)
X_2 = UnitX(Factor=multiplication_7)
Z_2 = UnitZ(Factor=multiplication_8)
move_6 = Move(Geometry=item_2, Motion=X_2)  # -> Geometry, Transform
extr_2 = Extrude(Base=move_6.Geometry, Direction=Z_2)

flip_matrix_4 = FlipMatrix(Data=point_2)
expression = Expression(A=filter_13, fy=filter_10, ft=filter_12, d=filter_11, Expression="(int((0.6*1.1*A*fy/ft*d)/5)+1)*5")  # disabled
number_slider_2 = Slider(50, range=0..100)
multiplication_9 = Multiplication(A=锚筋到边_4, B=2)

multiplication_10 = Multiplication(A=锚筋到边_3, B=2)
addition_11 = Addition(A=multiplication, B=multiplication_10)
addition_12 = Addition(A=multiplication_2, B=multiplication_9)
expression_2 = Expression(x=addition_11, Expression="Ceiling(x/10)*10/2")
expression_3 = Expression(x=addition_12, Expression="Ceiling(x/10)*10/2")
dom = ConstructDomain(DomainStart=expr("-x", expression_2), DomainEnd=expression_2)
dom_2 = ConstructDomain(DomainStart=expr("-x", expression_3), DomainEnd=expression_3)
box_2 = DomainBox(Base=PlaneXY(0, 0, 0), X=dom, Y=dom_2, Z=锚板厚度_3)

extend_curve = ExtendCurve(Curve=polyline, Type=0, Start=number_slider, End=number_slider)
polyline_2 = PolyLine(Vertices=flip_matrix_4, Closed=False)

yz_plane = YZPlane(Origin=Point(0, 0, 0))  # disabled
orient = Orient(Geometry=curve_3, Source=PlaneXY(0, 0, 0), Target=yz_plane)  # -> Geometry, Transform; disabled
unit_x = UnitX(Factor=槽长_3)  # disabled
division_12 = Division(A=槽长_3, B=2)  # disabled
extrude_3 = Extrude(Base=orient.Geometry, Direction=unit_x)  # disabled
unit_x_2 = UnitX(Factor=division_12)  # disabled
move_7 = Move(Geometry=extrude_3, Motion=expr("-x", unit_x_2))  # -> Geometry, Transform; disabled
cap_holes = CapHoles(Brep=move_7.Geometry)  # disabled

xy_plane = XYPlane(Origin=Point(0, 0, 0))
average = Average(Input=move.Geometry)
number_slider_3 = Slider(50, range=0..100)  # disabled
addition_13 = Addition(A=filter_6, B=Slider(1, range=0..1))
multiplication_11 = Multiplication(A=锚筋到边_6, B=2)

multiplication_12 = Multiplication(A=锚筋到边_5, B=2)
addition_14 = Addition(A=multiplication_3, B=multiplication_12)
addition_15 = Addition(A=multiplication_4, B=multiplication_11)
expression_4 = Expression(x=addition_14, Expression="Ceiling(x/10)*10/2")
expression_5 = Expression(x=addition_15, Expression="Ceiling(x/10)*10/2")
dom_3 = ConstructDomain(DomainStart=expr("-x", expression_4), DomainEnd=expression_4)
dom_4 = ConstructDomain(DomainStart=expr("-x", expression_5), DomainEnd=expression_5)
box_3 = DomainBox(Base=PlaneXY(0, 0, 0), X=dom_3, Y=dom_4, Z=锚板厚度_4)

extend_curve_2 = ExtendCurve(Curve=polyline_2, Type=0, Start=number_slider_2, End=number_slider_2)
multiplication_13 = Multiplication(A=filter_5, B=2.5)
division_13 = Division(A=addition_13, B=2)

yz_plane_2 = YZPlane(Origin=Point(0, 0, 0))  # disabled
orient_2 = Orient(Geometry=curve_4, Source=PlaneXY(0, 0, 0), Target=yz_plane_2)  # -> Geometry, Transform; disabled
unit_x_3 = UnitX(Factor=槽长_4)  # disabled
division_14 = Division(A=槽长_4, B=2)  # disabled
extrude_4 = Extrude(Base=orient_2.Geometry, Direction=unit_x_3)  # disabled
unit_x_4 = UnitX(Factor=division_14)  # disabled
move_8 = Move(Geometry=extrude_4, Motion=expr("-x", unit_x_4))  # -> Geometry, Transform; disabled
cap_holes_2 = CapHoles(Brep=move_8.Geometry)  # disabled

polyline_3 = PolyLine(Vertices=flatten(average), Closed=False)
xy_plane_2 = XYPlane(Origin=Point(0, 0, 0))
average_2 = Average(Input=move_4.Geometry)
negative_2 = Negative(Value=division_13)
number_slider_4 = Slider(50, range=0..100)  # disabled
addition_16 = Addition(A=filter_8, B=Slider(1, range=0..1))
offset_curve = OffsetCurve(
    Curve=extend_curve,
    Distance=[Slider(25, range=0..100), Slider(25, range=0..100, expression="-x")],
    Plane=xy_plane,
    Corners=1)
circle = Circle(Plane=move.Geometry, Radius=multiplication_13)
divide_curve = DivideCurve(Curve=orient.Geometry, Count=number_slider_3, Kinks=False)  # -> Points, Tangents, Parameters; disabled

yz_plane_3 = YZPlane(Origin=Point(0, 0, 0))
orient_3 = Orient(Geometry=curve, Source=PlaneXY(0, 0, 0), Target=yz_plane_3)  # -> Geometry, Transform
unit_x_5 = UnitX(Factor=槽长)
division_15 = Division(A=槽长, B=2)
extrude_5 = Extrude(Base=orient_3.Geometry, Direction=unit_x_5)
unit_x_6 = UnitX(Factor=division_15)
move_9 = Move(Geometry=extrude_5, Motion=expr("-x", unit_x_6))  # -> Geometry, Transform
cap_holes_3 = CapHoles(Brep=move_9.Geometry)

multiplication_14 = Multiplication(A=filter_7, B=2.5)
division_16 = Division(A=addition_16, B=2)
shift_paths = ShiftPaths(Data=offset_curve, Offset=-1)
region_union = RegionUnion(Curves=circle)
polyline_4 = PolyLine(Vertices=flatten(average_2), Closed=False)
number_slider_5 = Slider(10, range=0..100)  # disabled
negative_3 = Negative(Value=division_16)
offset_curve_2 = OffsetCurve(
    Curve=extend_curve_2,
    Distance=[Slider(25, range=0..100), Slider(25, range=0..100, expression="-x")],
    Plane=xy_plane_2,
    Corners=1)
circle_2 = Circle(Plane=move_4.Geometry, Radius=multiplication_14)
divide_curve_2 = DivideCurve(Curve=orient_2.Geometry, Count=number_slider_4, Kinks=False)  # -> Points, Tangents, Parameters; disabled
offset_curve_3 = OffsetCurve(Curve=polyline_3, Distance=[division_13, negative_2], Plane=xy_plane, Corners=1)
convex_hull = ConvexHull(Points=divide_curve.Points, Plane=yz_plane)  # -> Hull, HullZ, Indices; disabled
boundary_surfaces = BoundarySurfaces(Edges=region_union)
loft = Loft(Curves=shift_paths, Options={Adjust=False, Closed=False, LoftEnds=0, LoftSimp=0, LoftType=0, Rebuild=10, Refit=0.01})
shift_paths_2 = ShiftPaths(Data=offset_curve_2, Offset=-1)
region_union_2 = RegionUnion(Curves=circle_2)
number_slider_6 = Slider(10, range=0..100)  # disabled
boundary_surfaces_2 = BoundarySurfaces(Edges=convex_hull.Hull)  # disabled
multiplication_15 = Multiplication(A=number_slider_5, B=2)  # disabled
offset_curve_4 = OffsetCurve(Curve=polyline_4, Distance=[division_16, negative_3], Plane=xy_plane_2, Corners=1)
trim_with_regions = TrimWithRegions(Curve=offset_curve_3, Regions=flatten(boundary_surfaces))  # -> Inside, Outside
convex_hull_2 = ConvexHull(Points=divide_curve_2.Points, Plane=yz_plane_2)  # -> Hull, HullZ, Indices; disabled
subtraction_5 = Subtraction(A=槽长_3, B=multiplication_15)  # disabled
boundary_surfaces_3 = BoundarySurfaces(Edges=region_union_2)
loft_2 = Loft(Curves=shift_paths_2, Options={Adjust=False, Closed=False, LoftEnds=0, LoftSimp=0, LoftType=0, Rebuild=10, Refit=0.01})
stream_filter = StreamFilter(Gate=value_list_3, Stream0=extr, Stream1=extrude)
unit_x_7 = UnitX(Factor=subtraction_5)  # disabled
boundary_surfaces_4 = BoundarySurfaces(Edges=convex_hull_2.Hull)  # disabled
multiplication_16 = Multiplication(A=number_slider_6, B=2)  # disabled
trim_with_regions_2 = TrimWithRegions(Curve=trim_with_regions.Outside, Regions=flatten(loft))  # -> Inside, Outside
trim_with_regions_3 = TrimWithRegions(Curve=offset_curve_4, Regions=flatten(boundary_surfaces_3))  # -> Inside, Outside

# ----
# 导入槽埋模型
brep = Brep(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)  # disabled

# ----
# 槽埋Modeling
brep_2 = Brep(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)  # disabled
bbox = BoundingBox(Content=brep, Plane=PlaneXY(0, 0, 0))  # -> Box, Box_2; disabled
debox = DeconstructBox(Box=bbox.Box)  # -> Plane, X, Y, Z; disabled
area = Area(Geometry=brep)  # -> Area, Centroid; disabled
edges_3 = BrepEdges(Brep=bbox.Box)  # -> Naked, Interior, NonManifold; disabled
panel_5 = Panel("5")  # disabled
panel_6 = Panel("4")  # disabled
item_3 = ListItem(List=edges_3.Interior, Index=panel_5, Wrap=True)  # disabled
item_4 = ListItem(List=edges_3.Interior, Index=panel_6, Wrap=True)  # disabled
pdecon = Deconstruct(Point=area.Centroid)  # -> XComponent, YComponent, ZComponent; disabled
dedomain = DeconstructDomain(Domain=debox.Z)  # -> Start, End; disabled
clx = CurveLine(Curve=item_4, Line=item_3)  # -> Points, Params, Count; disabled
Y = UnitY(Factor=item_3)  # disabled
xy = XYPlane(Origin=Point(0, 0, 0))  # disabled
pt = ConstructPoint(XCoordinate=pdecon.XComponent, YCoordinate=pdecon.YComponent, ZCoordinate=dedomain.End)  # disabled
rotate = Rotate(Geometry=brep, Angle=1.570796327, Plane=clx.Points)  # -> Geometry, Transform; disabled
move_10 = Move(Geometry=rotate.Geometry, Motion=Y)  # -> Geometry, Transform; disabled
pl_origin = PlaneOrigin(Base=xy, Origin=pt)  # disabled
merge = Merge(Data1=brep, Data2=move_10.Geometry)  # -> flatten(Result); disabled
sunion = SolidUnion(Breps=merge)  # disabled
bbox_2 = BoundingBox(Content=sunion, Plane=PlaneXY(0, 0, 0))  # -> Box, Box_2; disabled
area_2 = Area(Geometry=sunion)  # -> Area, Centroid; disabled
xy_2 = XYPlane(Origin=Point(0, 0, 0))  # disabled
debox_2 = DeconstructBox(Box=bbox_2.Box)  # -> Plane, X, Y, Z; disabled
pdecon_2 = Deconstruct(Point=area_2.Centroid)  # -> XComponent, YComponent, ZComponent; disabled
orient_4 = Orient(Geometry=brep, Source=pl_origin, Target=xy_2)  # -> Geometry, Transform; disabled
dedomain_2 = DeconstructDomain(Domain=debox_2.Z)  # -> Start, End; disabled
pt_2 = ConstructPoint(XCoordinate=pdecon_2.XComponent, YCoordinate=pdecon_2.YComponent, ZCoordinate=dedomain_2.End)  # disabled
xy_3 = XYPlane(Origin=Point(0, 0, 0))  # disabled
pl_origin_2 = PlaneOrigin(Base=xy_3, Origin=pt_2)  # disabled
xy_4 = XYPlane(Origin=Point(0, 0, 0))  # disabled
orient_5 = Orient(Geometry=sunion, Source=pl_origin_2, Target=xy_4)  # -> Geometry, Transform; disabled

subtraction_6 = Subtraction(A=槽长_4, B=multiplication_16)  # disabled
stream_filter_2 = StreamFilter(Gate=value_list_4, Stream0=extr_2, Stream1=extrude_2)
extrude_6 = Extrude(Base=boundary_surfaces_2, Direction=unit_x_7)  # disabled
division_17 = Division(A=unit_x_7, B=2)  # disabled
unit_x_8 = UnitX(Factor=subtraction_6)  # disabled
curve_5 = Curve(trim_with_regions_2.Outside)
extrude_7 = Extrude(Base=boundary_surfaces_2, Direction=unit_x)  # disabled
trim_with_regions_4 = TrimWithRegions(Curve=trim_with_regions_3.Outside, Regions=flatten(loft_2))  # -> Inside, Outside
move_11 = Move(Geometry=extrude_6, Motion=expr("-x", division_17))  # -> Geometry, Transform; disabled
flip_matrix_5 = FlipMatrix(Data=curve_5)
extrude_8 = Extrude(Base=boundary_surfaces_4, Direction=unit_x_8)  # disabled
division_18 = Division(A=unit_x_8, B=2)  # disabled
move_12 = Move(Geometry=extrude_7, Motion=expr("-x", unit_x_2))  # -> Geometry, Transform; disabled
curve_6 = Curve(trim_with_regions_4.Outside)
extrude_9 = Extrude(Base=boundary_surfaces_4, Direction=unit_x_3)  # disabled
loft_3 = Loft(Curves=flip_matrix_5, Options={Adjust=False, Closed=False, LoftEnds=0, LoftSimp=0, LoftType=0, Rebuild=10, Refit=0.01})
length = Length(Curve=flip_matrix_5)  # -> flatten(Length)
move_13 = Move(Geometry=extrude_8, Motion=expr("-x", division_18))  # -> Geometry, Transform; disabled
flip_matrix_6 = FlipMatrix(Data=curve_6)
solid_difference = SolidDifference(BrepsA=move_12.Geometry, BrepsB=move_11.Geometry)  # disabled
cap = CapHoles(Brep=[cyl, stream_filter])
brep_edges = BrepEdges(Brep=loft_3)  # -> Naked, Interior, NonManifold
move_14 = Move(Geometry=extrude_9, Motion=expr("-x", unit_x_4))  # -> Geometry, Transform; disabled
max_min = MaxMin(Numbers=length)  # -> Max, MaxIndex, Min, MinIndex
loft_4 = Loft(Curves=flip_matrix_6, Options={Adjust=False, Closed=False, LoftEnds=0, LoftSimp=0, LoftType=0, Rebuild=10, Refit=0.01})
length_2 = Length(Curve=flip_matrix_6)  # -> flatten(Length)
mass_addition = MassAddition(Input=length)  # -> Result, PartialResults
join_curves = JoinCurves(Curves=brep_edges.Naked, Preserve=False)
solid_difference_2 = SolidDifference(BrepsA=move_14.Geometry, BrepsB=move_13.Geometry)  # disabled
subtraction_7 = Subtraction(A=max_min.Min, B=filter_6)
最短槽长 = Panel(subtraction_7)
cap_2 = CapHoles(Brep=[cyl_2, stream_filter_2])
brep_edges_2 = BrepEdges(Brep=loft_4)  # -> Naked, Interior, NonManifold
number_slider_7 = Slider(100, range=0..100)
max_min_2 = MaxMin(Numbers=length_2)  # -> Max, MaxIndex, Min, MinIndex
division_19 = Division(A=mass_addition.Result, B=2)
fillet = Fillet(Curve=join_curves, Radius=division_13)
subtraction_8 = Subtraction(A=max_min.Max, B=filter_6)
最长槽长 = Panel(subtraction_8)
mass_addition_2 = MassAddition(Input=length_2)  # -> Result, PartialResults
join_curves_2 = JoinCurves(Curves=brep_edges_2.Naked, Preserve=False)
subtraction_9 = Subtraction(A=max_min_2.Min, B=filter_8)
最短槽长_2 = Panel(subtraction_9)
unit_z_5 = UnitZ(Factor=expr("-x", number_slider_7))
number_slider_8 = Slider(100, range=0..100)
unit_z_6 = UnitZ(Factor=number_slider_7)
boundary_surfaces_5 = BoundarySurfaces(Edges=fillet)
division_20 = Division(A=division_19, B=addition_11)
panel_7 = Panel(division_20)
division_21 = Division(A=mass_addition_2.Result, B=2)
fillet_2 = Fillet(Curve=join_curves_2, Radius=division_16)
subtraction_10 = Subtraction(A=max_min_2.Max, B=filter_8)
最长槽长_2 = Panel(subtraction_10)
extrude_10 = Extrude(Base=boundary_surfaces_5, Direction=[unit_z_6, unit_z_5])
unit_z_7 = UnitZ(Factor=expr("-x", number_slider_8))
unit_z_8 = UnitZ(Factor=number_slider_8)
boundary_surfaces_6 = BoundarySurfaces(Edges=fillet_2)
division_22 = Division(A=division_21, B=addition_14)
panel_8 = Panel(division_22)
extrude_11 = Extrude(Base=boundary_surfaces_6, Direction=[unit_z_8, unit_z_7])
merge_2 = Merge(Data1=cap, Data2=box_2, Data3=cap_holes, Data4=solid_difference)
flatten = FlattenTree(Tree=merge_2, Path="{0}")
filter_14 = StreamFilter(Gate=0, Stream0=orient_5.Geometry, Stream1=orient_4.Geometry)  # disabled
merge_3 = Merge(Data1=cap_2, Data2=box_3, Data3=cap_holes_2, Data4=solid_difference_2)
Z_3 = UnitZ(Factor=expr("-x", 锚板厚度_3))
xy_plane_3 = XYPlane(Origin=Point(0, 0, 0))
entwine = Entwine(Branch00=orient_4.Geometry, Branch01=filter_14, FlattenInputs=True)  # disabled
flatten_2 = FlattenTree(Tree=merge_3, Path="{0}")
deconstruct_plane = DeconstructPlane(Plane=xy_plane_3)  # -> Origin, XAxis, YAxis, ZAxis
Z_4 = UnitZ(Factor=expr("-x", 锚板厚度_4))
xy_plane_4 = XYPlane(Origin=Point(0, 0, 0))

move_15 = Move(Geometry=flatten, Motion=Z_3)  # -> Geometry, Transform
# Rhino 文件中导入的块名
centre_point = Point(deconstruct_plane.Origin)

deconstruct_plane_2 = DeconstructPlane(Plane=xy_plane_4)  # -> Origin, XAxis, YAxis, ZAxis
unit_x_9 = UnitX(Factor=1)

move_16 = Move(Geometry=flatten_2, Motion=Z_4)  # -> Geometry, Transform
centre_point_2 = Point(deconstruct_plane_2.Origin)

rotate_3d = Rotate3D(Geometry=move_16.Geometry, Angle=-1.570796327, Center=Point(0, 0, 0), Axis=unit_x_9)  # -> Geometry, Transform
geo = Geometry(box)

# ----
# 平面类型INPUT
# 平面定位INPUT
list_28 = ValueList({"楼板部分挑空": 0, "纯楼板": 1, "纯挑空/塔冠": 2, "女儿墙": 3}, selected="楼板部分挑空")

panel_9 = Panel("""Top
Perspective
Front
Right""")

# ----
# 埋件offset-常规input2
number_slider_9 = Slider(87, range=0..1000)

# ----
# 建筑线-所有type
crv = Curve(<curve referenced from the Rhino model>)

# ----
# 埋件offset-女儿墙input
number_slider_10 = Slider(125, range=0..1000)

# ----
# 柱线-所有type
crv_2 = Curve([<curve referenced from the Rhino model> x16])

# ----
# 板边线-只有部分贯通的时候导入
crv_3 = Curve(<curve referenced from the Rhino model>)

# ----
# 埋件offset-常规input1
number_slider_11 = Slider(140, range=0..1000)

# ----
# 定位线/梁中线-所有type
crv_4 = Curve(<curve referenced from the Rhino model>)

# ----
# 如果无法完整的生成埋件的三视图，
# 建议选择埋件的3D在Rhino中将
# Top/Perspective/Front/Right 试图缩放至合适大小后重新运行
m2d_rhino = Make2DRhinoView(Name=panel_9, Clip=True)
filter_15 = StreamFilter(Gate=list_28, Stream0=number_slider_11, Stream1=number_slider_11, Stream2=number_slider_11, Stream3=number_slider_10)
filter_16 = StreamFilter(Gate=list_28, Stream0=number_slider_9, Stream1=number_slider_9, Stream2=number_slider_9, Stream3=number_slider_10)

# ----
# 简化线段
disc = Discontinuity(Curve=crv_3, Level=1)  # -> Points, Parameters
shift = ShiftList(List=disc.Points, Shift=1, Wrap=True)
ln = Line(StartPoint=disc.Points, EndPoint=shift)
len = Length(Curve=ln)
sort = SortList(Keys=len)  # -> Keys, ValuesA
panel_10 = Panel(sort.Keys)
smaller = SmallerThan(FirstNumber=len, SecondNumber=Slider(20, range=0..100))  # -> SmallerThan, OrEqualTo
dispatch = Dispatch(List=disc.Points, DispatchPattern=smaller.SmallerThan)  # -> ListA, ListB
pt_3 = Point(dispatch.ListA)
pt_4 = Point(dispatch.ListB)

# ----
# 简化线段
disc_2 = Discontinuity(Curve=crv, Level=1)  # -> Points, Parameters
shift_2 = ShiftList(List=disc_2.Points, Shift=1, Wrap=True)
ln_2 = Line(StartPoint=disc_2.Points, EndPoint=shift_2)
len_2 = Length(Curve=ln_2)
sort_2 = SortList(Keys=len_2)  # -> Keys, ValuesA
panel_11 = Panel(sort_2.Keys)
smaller_2 = SmallerThan(FirstNumber=len_2, SecondNumber=Slider(20, range=0..100))  # -> SmallerThan, OrEqualTo
dispatch_2 = Dispatch(List=disc_2.Points, DispatchPattern=smaller_2.SmallerThan)  # -> ListA, ListB
pt_5 = Point(dispatch_2.ListA)
pt_6 = Point(dispatch_2.ListB)

# ----
# 简化线段
disc_3 = Discontinuity(Curve=crv_4, Level=1)  # -> Points, Parameters
shift_3 = ShiftList(List=disc_3.Points, Shift=1, Wrap=True)
ln_3 = Line(StartPoint=disc_3.Points, EndPoint=shift_3)
len_3 = Length(Curve=ln_3)
sort_3 = SortList(Keys=len_3)  # -> Keys, ValuesA
panel_12 = Panel(sort_3.Keys)
smaller_3 = SmallerThan(FirstNumber=len_3, SecondNumber=Slider(20, range=0..100))  # -> SmallerThan, OrEqualTo
dispatch_3 = Dispatch(List=disc_3.Points, DispatchPattern=smaller_3.SmallerThan)  # -> ListA, ListB
pt_7 = Point(dispatch_3.ListA)
pt_8 = Point(dispatch_3.ListB)

pline = PolyLine(Vertices=pt_6, Closed=invert(False))
pline_2 = PolyLine(Vertices=pt_4, Closed=invert(False))
pline_3 = PolyLine(Vertices=pt_8, Closed=invert(False))
filter_17 = StreamFilter(Gate=list_28, Stream0=pline_2, Stream1=pline_3, Stream2=pline_3, Stream3=pline_3)

flip = FlipCurve(Curve=pline_3)  # -> Curve, Flag
filter_18 = StreamFilter(Gate=Toggle(False), Stream0=pline_3, Stream1=flip.Curve)
# 结构边线角点
offset = OffsetCurve(Curve=filter_18, Distance=Slider(100, range=0..100), Corners=1)
disc_4 = Discontinuity(Curve=offset, Level=1)  # -> Points, Parameters

# ----
# 当前项目中由于楼板以及结构边线重合故取1，在其他项目中 应该适当放大
number_slider_12 = Slider(1, range=0..10)

# ---- group: Block
layer = DefineLayer(Name="Embeded", Color=ColourSwatch(SwatchColor=RGB(255, 0, 0)))
panel_13 = Panel("embed1")
attributes = DefineObjectAttributes(Layer=layer)

# ----
# 阴大面
panel_14 = Panel("1")
attributes_2 = DefineObjectAttributes(Layer=layer)

# ----
# 埋件编号命名
# 埋件编号Offset
panel_15 = Panel("MJ-01")
number_slider_13 = Slider(499, range=0..1000)
filter_19 = StreamFilter(Gate=list_28, Stream0="MJ-02", Stream1="MJ-02", Stream2="MJ-01", Stream3="MJ-03")
filter_20 = StreamFilter(Gate=list_28, Stream0=panel_15, Stream1="MJ-02", Stream2=panel_15, Stream3="MJ-03")

# ----
# Curve是否Dash
# Dash大小
list_29 = ValueList({"完整curve": 0, "dash curve": 1}, selected="完整curve")
number_slider_14 = Slider(205, range=0..1000)

# ----
# 撞到结构的标注-圆圈半径
# 大面标注-offset
number_slider_15 = Slider(548, range=0..10000)

# ----
# 标注样式
panel_16 = Panel("图例2-地上$0$XD100$0")

# ----
# 引线长度
# 引线位置
number_slider_16 = Slider(3030, range=0..10000)

panel_17 = Panel("""Dimension::直线1
Dimension::直线2
Dimension::轴线1
Dimension::轴线2
Dimension::轴线3
Dimension::轴线4
Dimension::角部1
Dimension::角部2
Dimension::角部3
Dimension::角部4
Dimension::角部5
Dimension::角部6""")
define_layer = DefineLayer(Name="标注大类", Color=ColourSwatch(SwatchColor=RGB(0, 8, 255)))  # -> graft(Layer)
define_layer_2 = DefineLayer(Name=panel_17, Color=ColourSwatch(SwatchColor=RGB(0, 187, 255)))  # -> graft(Layer)
define_layer_3 = DefineLayer(Name="埋件编号")
define_object_attributes = DefineObjectAttributes(Layer=define_layer)
define_object_attributes_2 = DefineObjectAttributes(Layer=define_layer_2)
define_object_attributes_3 = DefineObjectAttributes(Layer=define_layer_3, Color=ColourSwatch(SwatchColor=RGB(150, 197, 255)))

# ----
# 局部标注Offset
# 整体标注Offset
# 标注样式
number_slider_17 = Slider(2041, range=0..10000)
number_slider_18 = Slider(2908, range=0..10000)

# ----
# 钢板槽Modeling
recgrid_3 = Rectangular(Plane=PlaneXY(0, 0, 0), SizeX=s_x_2, SizeY=s_y_2, ExtentX=addition_3, ExtentY=addition_4)  # -> Cells, Points
multiplication_17 = Multiplication(A=s_x_2, B=addition_3)
multiplication_18 = Multiplication(A=s_y_2, B=addition_4)
division_23 = Division(A=multiplication_17, B=2)
division_24 = Division(A=multiplication_18, B=2)
vec_3 = VectorXYZ(XComponent=expr("-x", division_23), YComponent=expr("-x", division_24), ZComponent=0)  # -> Vector, Length
division_25 = Division(A=filter_3, B=2)
move_17 = Move(Geometry=recgrid_3.Points, Motion=vec_3.Vector)  # -> Geometry, Transform
multiplication_19 = Multiplication(A=division_25, B=2)
yz_plane_4 = YZPlane(Origin=Point(0, 0, 0))
orient_6 = Orient(Geometry=curve_2, Source=PlaneXY(0, 0, 0), Target=yz_plane_4)  # -> Geometry, Transform
divide_curve_3 = DivideCurve(Curve=orient_6.Geometry, Count=Slider(50, range=0..100), Kinks=False)  # -> Points, Tangents, Parameters
unit_x_10 = UnitX(Factor=槽长_2)
division_26 = Division(A=槽长_2, B=2)
extrude_12 = Extrude(Base=orient_6.Geometry, Direction=unit_x_10)
unit_x_11 = UnitX(Factor=division_26)
convex_hull_3 = ConvexHull(Points=divide_curve_3.Points, Plane=yz_plane_4)  # -> Hull, HullZ, Indices
move_18 = Move(Geometry=extrude_12, Motion=expr("-x", unit_x_11))  # -> Geometry, Transform
boundary_surfaces_7 = BoundarySurfaces(Edges=convex_hull_3.Hull)
multiplication_20 = Multiplication(A=Slider(10, range=0..100), B=2)
subtraction_11 = Subtraction(A=槽长_2, B=multiplication_20)
unit_z_9 = UnitZ(Factor=expr("-X", subtraction_2))
cap_holes_4 = CapHoles(Brep=move_18.Geometry)
unit_x_12 = UnitX(Factor=subtraction_11)
extrude_13 = Extrude(Base=boundary_surfaces_7, Direction=unit_x_12)
division_27 = Division(A=unit_x_12, B=2)
extrude_14 = Extrude(Base=boundary_surfaces_7, Direction=unit_x_10)
move_19 = Move(Geometry=extrude_13, Motion=expr("-x", division_27))  # -> Geometry, Transform
move_20 = Move(Geometry=extrude_14, Motion=expr("-x", unit_x_11))  # -> Geometry, Transform
solid_difference_3 = SolidDifference(BrepsA=move_20.Geometry, BrepsB=move_19.Geometry)
Z_5 = UnitZ(Factor=expr("-x", 锚板厚度_2))
xy_plane_5 = XYPlane(Origin=Point(0, 0, 0))
deconstruct_plane_3 = DeconstructPlane(Plane=xy_plane_5)  # -> Origin, XAxis, YAxis, ZAxis

multiplication_21 = Multiplication(A=multiplication_19, B=6)
max_2 = Maximum(A=multiplication_21, B=70)
multiplication_22 = Multiplication(A=锚筋到边_2, B=2)
addition_17 = Addition(A=multiplication_17, B=multiplication_22)
addition_18 = Addition(A=multiplication_18, B=multiplication_22)
expression_6 = Expression(x=addition_17, Expression="Ceiling(x/10)*10/2")
expression_7 = Expression(x=addition_18, Expression="Ceiling(x/10)*10/2")
dom_5 = ConstructDomain(DomainStart=expr("-x", expression_6), DomainEnd=expression_6)
dom_6 = ConstructDomain(DomainStart=expr("-x", expression_7), DomainEnd=expression_7)
box_4 = DomainBox(Base=PlaneXY(0, 0, 0), X=dom_5, Y=dom_6, Z=锚板厚度_2)

flip_matrix_7 = FlipMatrix(Data=move_17.Geometry)
cull_first_last_3 = CullFirstLast(List=flip_matrix_7)  # -> CullFirst, CullLast, CullFirstAndEnd
point_3 = Point(cull_first_last_3.CullFirstAndEnd)
flip_matrix_8 = FlipMatrix(Data=point_3)
number_slider_19 = Slider(50, range=0..100)
polyline_5 = PolyLine(Vertices=flip_matrix_8, Closed=False)
extend_curve_3 = ExtendCurve(Curve=polyline_5, Type=0, Start=number_slider_19, End=number_slider_19)
xy_plane_6 = XYPlane(Origin=Point(0, 0, 0))
average_3 = Average(Input=move_17.Geometry)
addition_19 = Addition(A=filter_4, B=Slider(1, range=0..1))
multiplication_23 = Multiplication(A=filter_3, B=2.5)
division_28 = Division(A=addition_19, B=2)
polyline_6 = PolyLine(Vertices=flatten(average_3), Closed=False)
negative_4 = Negative(Value=division_28)
offset_curve_5 = OffsetCurve(
    Curve=extend_curve_3,
    Distance=[Slider(25, range=0..100), Slider(25, range=0..100, expression="-x")],
    Plane=xy_plane_6,
    Corners=1)
circle_3 = Circle(Plane=move_17.Geometry, Radius=multiplication_23)
shift_paths_3 = ShiftPaths(Data=offset_curve_5, Offset=-1)
region_union_3 = RegionUnion(Curves=circle_3)
offset_curve_6 = OffsetCurve(Curve=polyline_6, Distance=[division_28, negative_4], Plane=xy_plane_6, Corners=1)
boundary_surfaces_8 = BoundarySurfaces(Edges=region_union_3)
loft_5 = Loft(Curves=shift_paths_3, Options={Adjust=False, Closed=False, LoftEnds=0, LoftSimp=0, LoftType=0, Rebuild=10, Refit=0.01})
trim_with_regions_5 = TrimWithRegions(Curve=offset_curve_6, Regions=flatten(boundary_surfaces_8))  # -> Inside, Outside
trim_with_regions_6 = TrimWithRegions(Curve=trim_with_regions_5.Outside, Regions=flatten(loft_5))  # -> Inside, Outside
curve_7 = Curve(trim_with_regions_6.Outside)
flip_matrix_9 = FlipMatrix(Data=curve_7)
loft_6 = Loft(Curves=flip_matrix_9, Options={Adjust=False, Closed=False, LoftEnds=0, LoftSimp=0, LoftType=0, Rebuild=10, Refit=0.01})
length_3 = Length(Curve=flip_matrix_9)  # -> flatten(Length)
brep_edges_3 = BrepEdges(Brep=loft_6)  # -> Naked, Interior, NonManifold
max_min_3 = MaxMin(Numbers=length_3)  # -> Max, MaxIndex, Min, MinIndex
join_curves_3 = JoinCurves(Curves=brep_edges_3.Naked, Preserve=False)
number_slider_20 = Slider(100, range=0..100)
subtraction_12 = Subtraction(A=max_min_3.Min, B=filter_4)
fillet_3 = Fillet(Curve=join_curves_3, Radius=division_28)
unit_z_10 = UnitZ(Factor=expr("-x", number_slider_20))
unit_z_11 = UnitZ(Factor=number_slider_20)
boundary_surfaces_9 = BoundarySurfaces(Edges=fillet_3)
extrude_15 = Extrude(Base=boundary_surfaces_9, Direction=[unit_z_11, unit_z_10])
solid_difference_4 = SolidDifference(BrepsA=box_4, BrepsB=flatten(extrude_15))

subtraction_13 = Subtraction(A=expression_7, B=板凳厚度)
dom_7 = ConstructDomain(DomainStart=expr("-x", subtraction_13), DomainEnd=subtraction_13)
rectangle_3 = Rectangle(Plane=PlaneXY(0, 0, 0), XSize=dom_5, YSize=dom_7, Radius=0)  # -> Rectangle, Length
rectangle_4 = Rectangle(Plane=PlaneXY(0, 0, 0), XSize=dom_5, YSize=dom_6, Radius=0)  # -> Rectangle, Length
region_difference = RegionDifference(CurvesA=rectangle_4.Rectangle, CurvesB=rectangle_3.Rectangle)
boundary_surfaces_10 = BoundarySurfaces(Edges=region_difference)
extrude_16 = Extrude(Base=boundary_surfaces_10, Direction=unit_z_9)
merge_4 = Merge(Data1=extrude_16, Data2=solid_difference_4, Data3=cap_holes_4, Data4=solid_difference_3)
flatten_3 = FlattenTree(Tree=merge_4, Path="{0}")

move_21 = Move(Geometry=flatten_3, Motion=Z_5)  # -> Geometry, Transform
centre_point_3 = Point(deconstruct_plane_3.Origin)

# ----
# 板槽Modeling
recgrid_4 = Rectangular(Plane=PlaneXY(0, 0, 0), SizeX=s_x, SizeY=s_y, ExtentX=addition, ExtentY=addition_2)  # -> Cells, Points
multiplication_24 = Multiplication(A=s_x, B=addition)
multiplication_25 = Multiplication(A=s_y, B=addition_2)
division_29 = Division(A=multiplication_24, B=2)
division_30 = Division(A=multiplication_25, B=2)
vec_4 = VectorXYZ(XComponent=expr("-x", division_29), YComponent=expr("-x", division_30), ZComponent=0)  # -> Vector, Length
move_22 = Move(Geometry=recgrid_4.Points, Motion=vec_4.Vector)  # -> Geometry, Transform
division_31 = Division(A=filter_2, B=2)
divide_curve_4 = DivideCurve(Curve=orient_3.Geometry, Count=Slider(50, range=0..100), Kinks=False)  # -> Points, Tangents, Parameters
convex_hull_4 = ConvexHull(Points=divide_curve_4.Points, Plane=yz_plane_3)  # -> Hull, HullZ, Indices
boundary_surfaces_11 = BoundarySurfaces(Edges=convex_hull_4.Hull)
multiplication_26 = Multiplication(A=Slider(10, range=0..100), B=2)
subtraction_14 = Subtraction(A=槽长, B=multiplication_26)
unit_x_13 = UnitX(Factor=subtraction_14)
extrude_17 = Extrude(Base=boundary_surfaces_11, Direction=unit_x_13)
division_32 = Division(A=unit_x_13, B=2)
extrude_18 = Extrude(Base=boundary_surfaces_11, Direction=unit_x_5)
move_23 = Move(Geometry=extrude_17, Motion=expr("-x", division_32))  # -> Geometry, Transform
move_24 = Move(Geometry=extrude_18, Motion=expr("-x", unit_x_6))  # -> Geometry, Transform
solid_difference_5 = SolidDifference(BrepsA=move_24.Geometry, BrepsB=move_23.Geometry)
Z_6 = UnitZ(Factor=expr("-x", 锚板厚度))
xy_plane_7 = XYPlane(Origin=Point(0, 0, 0))
deconstruct_plane_4 = DeconstructPlane(Plane=xy_plane_7)  # -> Origin, XAxis, YAxis, ZAxis

unit_z_12 = UnitZ(Factor=expr("x", 锚筋末端焊板厚度))
unit_z_13 = UnitZ(Factor=expr("-x", subtraction))
division_33 = Division(A=锚筋末端焊板边长, B=2)
construct_domain_5 = ConstructDomain(DomainStart=expr("-x", division_33), DomainEnd=division_33)
move_25 = Move(Geometry=move_22.Geometry, Motion=unit_z_13)  # -> Geometry, Transform
rectangle_5 = Rectangle(Plane=move_25.Geometry, XSize=construct_domain_5, YSize=construct_domain_5, Radius=0)  # -> Rectangle, Length
extrude_19 = Extrude(Base=rectangle_5.Rectangle, Direction=unit_z_12)

multiplication_27 = Multiplication(A=division_31, B=2)
cyl_3 = Cylinder(Base=move_22.Geometry, Radius=division_31, Length=expr("-x", subtraction))
edges_4 = BrepEdges(Brep=cyl_3)  # -> Naked, Interior, NonManifold
multiplication_28 = Multiplication(A=multiplication_27, B=5)
item_5 = ListItem(List=edges_4.Naked, Index=0, Wrap=True)
X_3 = UnitX(Factor=multiplication_27)
Z_7 = UnitZ(Factor=multiplication_28)
move_26 = Move(Geometry=item_5, Motion=X_3)  # -> Geometry, Transform
extr_3 = Extrude(Base=move_26.Geometry, Direction=Z_7)

multiplication_29 = Multiplication(A=multiplication_27, B=6)
max_3 = Maximum(A=multiplication_29, B=70)
multiplication_30 = Multiplication(A=锚筋到边, B=2)
addition_20 = Addition(A=multiplication_24, B=multiplication_30)
addition_21 = Addition(A=multiplication_25, B=multiplication_30)
expression_8 = Expression(x=addition_20, Expression="Ceiling(x/10)*10/2")
expression_9 = Expression(x=addition_21, Expression="Ceiling(x/10)*10/2")
dom_8 = ConstructDomain(DomainStart=expr("-x", expression_8), DomainEnd=expression_8)
dom_9 = ConstructDomain(DomainStart=expr("-x", expression_9), DomainEnd=expression_9)
box_5 = DomainBox(Base=PlaneXY(0, 0, 0), X=dom_8, Y=dom_9, Z=锚板厚度)

flip_matrix_10 = FlipMatrix(Data=move_22.Geometry)
cull_first_last_4 = CullFirstLast(List=flip_matrix_10)  # -> CullFirst, CullLast, CullFirstAndEnd
point_4 = Point(cull_first_last_4.CullFirstAndEnd)
flip_matrix_11 = FlipMatrix(Data=point_4)
number_slider_21 = Slider(50, range=0..100)
polyline_7 = PolyLine(Vertices=flip_matrix_11, Closed=False)
extend_curve_4 = ExtendCurve(Curve=polyline_7, Type=0, Start=number_slider_21, End=number_slider_21)
xy_plane_8 = XYPlane(Origin=Point(0, 0, 0))
average_4 = Average(Input=move_22.Geometry)
addition_22 = Addition(A=filter, B=Slider(1, range=0..1))
multiplication_31 = Multiplication(A=filter_2, B=2.5)
division_34 = Division(A=addition_22, B=2)
polyline_8 = PolyLine(Vertices=flatten(average_4), Closed=False)
negative_5 = Negative(Value=division_34)
offset_curve_7 = OffsetCurve(
    Curve=extend_curve_4,
    Distance=[Slider(25, range=0..100), Slider(25, range=0..100, expression="-x")],
    Plane=xy_plane_8,
    Corners=1)
circle_4 = Circle(Plane=move_22.Geometry, Radius=multiplication_31)
shift_paths_4 = ShiftPaths(Data=offset_curve_7, Offset=-1)
region_union_4 = RegionUnion(Curves=circle_4)
offset_curve_8 = OffsetCurve(Curve=polyline_8, Distance=[division_34, negative_5], Plane=xy_plane_8, Corners=1)
boundary_surfaces_12 = BoundarySurfaces(Edges=region_union_4)
loft_7 = Loft(Curves=shift_paths_4, Options={Adjust=False, Closed=False, LoftEnds=0, LoftSimp=0, LoftType=0, Rebuild=10, Refit=0.01})
trim_with_regions_7 = TrimWithRegions(Curve=offset_curve_8, Regions=flatten(boundary_surfaces_12))  # -> Inside, Outside
trim_with_regions_8 = TrimWithRegions(Curve=trim_with_regions_7.Outside, Regions=flatten(loft_7))  # -> Inside, Outside
curve_8 = Curve(trim_with_regions_8.Outside)
flip_matrix_12 = FlipMatrix(Data=curve_8)
loft_8 = Loft(Curves=flip_matrix_12, Options={Adjust=False, Closed=False, LoftEnds=0, LoftSimp=0, LoftType=0, Rebuild=10, Refit=0.01})
length_4 = Length(Curve=flip_matrix_12)  # -> flatten(Length)
brep_edges_4 = BrepEdges(Brep=loft_8)  # -> Naked, Interior, NonManifold
max_min_4 = MaxMin(Numbers=length_4)  # -> Max, MaxIndex, Min, MinIndex
join_curves_4 = JoinCurves(Curves=brep_edges_4.Naked, Preserve=False)
number_slider_22 = Slider(100, range=0..100)
subtraction_15 = Subtraction(A=max_min_4.Min, B=filter)
fillet_4 = Fillet(Curve=join_curves_4, Radius=division_34)
unit_z_14 = UnitZ(Factor=expr("-x", number_slider_22))
unit_z_15 = UnitZ(Factor=number_slider_22)
boundary_surfaces_13 = BoundarySurfaces(Edges=fillet_4)
extrude_20 = Extrude(Base=boundary_surfaces_13, Direction=[unit_z_15, unit_z_14])
solid_difference_6 = SolidDifference(BrepsA=box_5, BrepsB=flatten(extrude_20))

stream_filter_3 = StreamFilter(Gate=value_list, Stream0=extr_3, Stream1=extrude_19)
cap_3 = CapHoles(Brep=[cyl_3, stream_filter_3])
merge_5 = Merge(Data1=cap_3, Data2=solid_difference_6, Data3=cap_holes_3, Data4=solid_difference_5)
flatten_4 = FlattenTree(Tree=merge_5, Path="{0}")

move_27 = Move(Geometry=flatten_4, Motion=Z_6)  # -> Geometry, Transform
centre_point_4 = Point(deconstruct_plane_4.Origin)

entwine_2 = Entwine(
    Branch00=move_27.Geometry,
    Branch01=move_21.Geometry,
    Branch02=geo,
    Branch03=move_15.Geometry,
    Branch04=move_16.Geometry,
    FlattenInputs=True)
make2d = Make2D(Geometry=entwine_2, View=m2d_rhino, TangentEdges=False, TangentSeams=False, AutoComputeMake2D=False)  # -> VisibleCurves, VisibleIndex, VisibleType, HiddenCurves, HiddenIndex, HiddenType

# ----
# 板埋Modeling
multiplication_32 = Multiplication(A=s_x_5, B=addition_9)  # disabled
multiplication_33 = Multiplication(A=s_y_5, B=addition_10)  # disabled
recgrid_5 = Rectangular(Plane=PlaneXY(0, 0, 0), SizeX=s_x_5, SizeY=s_y_5, ExtentX=addition_9, ExtentY=addition_10)  # -> Cells, Points; disabled
直径 = Text(filter_11)  # disabled
division_35 = Division(A=multiplication_32, B=2)  # disabled
division_36 = Division(A=multiplication_33, B=2)  # disabled
vec_5 = VectorXYZ(XComponent=expr("-x", division_35), YComponent=expr("-x", division_36), ZComponent=0)  # -> Vector, Length; disabled
move_28 = Move(Geometry=recgrid_5.Points, Motion=vec_5.Vector)  # -> Geometry, Transform; disabled
division_37 = Division(A=直径, B=2)  # disabled
cyl_4 = Cylinder(Base=move_28.Geometry, Radius=division_37, Length=expr("-x", expression))  # disabled
X_4 = UnitX(Factor=直径)  # disabled
multiplication_34 = Multiplication(A=直径, B=6)  # disabled
edges_5 = BrepEdges(Brep=cyl_4)  # -> Naked, Interior, NonManifold; disabled
item_6 = ListItem(List=edges_5.Naked, Index=0, Wrap=True)  # disabled
max_4 = Maximum(A=multiplication_34, B=70)  # disabled
move_29 = Move(Geometry=item_6, Motion=X_4)  # -> Geometry, Transform; disabled
multiplication_35 = Multiplication(A=max_4, B=2)  # disabled
addition_23 = Addition(A=multiplication_32, B=multiplication_35)  # disabled
addition_24 = Addition(A=multiplication_33, B=multiplication_35)  # disabled
division_38 = Division(A=t, B=2)  # disabled
expression_10 = Expression(x=addition_24, Expression="Ceiling(x/10)*10/2")  # disabled
expression_11 = Expression(x=addition_23, Expression="Ceiling(x/10)*10/2")  # disabled
round = Round(Number=division_38)  # -> Nearest, Floor, Ceiling; disabled
multiplication_36 = Multiplication(A=round.Ceiling, B=2)  # disabled
dom_10 = ConstructDomain(DomainStart=expr("-x", expression_10), DomainEnd=expression_10)  # disabled
dom_11 = ConstructDomain(DomainStart=expr("-x", expression_11), DomainEnd=expression_11)  # disabled
box_6 = DomainBox(Base=PlaneXY(0, 0, 0), X=dom_11, Y=dom_10, Z=multiplication_36)  # disabled
Z_8 = UnitZ(Factor=expr("-x", multiplication_36))  # disabled
move_30 = Move(Geometry=box_6, Motion=Z_8)  # -> Geometry, Transform; disabled
Z_9 = UnitZ(Factor=expr("-x", multiplication_36))  # disabled

multiplication_37 = Multiplication(A=直径, B=5)  # disabled

Z_10 = UnitZ(Factor=multiplication_37)  # disabled
extr_4 = Extrude(Base=move_29.Geometry, Direction=Z_10)  # disabled
cap_4 = CapHoles(Brep=[extr_4, cyl_4])  # disabled
merge_6 = Merge(Data1=cap_4, Data2=box_6)  # disabled
flatten_5 = FlattenTree(Tree=merge_6, Path="{0}")  # disabled
move_31 = Move(Geometry=flatten_5, Motion=Z_9)  # -> Geometry, Transform; disabled

box_7 = DomainBox(Base=PlaneXY(0, 0, 0), X=dom_11, Y=dom_11, Z=multiplication_36)  # disabled
merge_7 = Merge(Data1=cap_4, Data2=box_7)  # disabled
flatten_6 = FlattenTree(Tree=merge_7, Path="{0}")  # disabled
move_32 = Move(Geometry=flatten_6, Motion=Z_9)  # -> Geometry, Transform; disabled
entwine_3 = Entwine(Branch00=move_31.Geometry, Branch01=move_32.Geometry, FlattenInputs=True)  # disabled

# ----
# 三视图
# hidden lines of top+pers view
# move to center
number_slider_23 = Slider(1, range=0..10)
bang = ExplodeTree(Data=make2d.VisibleCurves)  # -> Branch0, Branch1, Branch2, Branch3, Branch4, Branch5, Branch6, Branch7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
bang_2 = ExplodeTree(Data=make2d.VisibleCurves)  # -> Branch0, Branch1, Branch2, Branch3, Branch4, Branch5, Branch6, Branch7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
bang_3 = ExplodeTree(Data=make2d.VisibleCurves)  # -> Branch0, Branch1, Branch2, Branch3, Branch4, Branch5, Branch6, Branch7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
bang_4 = ExplodeTree(Data=make2d.VisibleCurves)  # -> Branch0, Branch1, Branch2, Branch3, Branch4, Branch5, Branch6, Branch7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
divdist = DivideDistance(Curve=make2d.HiddenCurves, Distance=number_slider_23)  # -> Points, Tangents, Parameters
graft = GraftTree(Tree=make2d.HiddenCurves, IncludeEmptyLists=True, IncludeNullItems=True)
shatter = Shatter(Curve=graft, Parameters=divdist.Parameters)
dispatch_4 = Dispatch(List=shatter, DispatchPattern=[True, False])  # -> ListA, ListB
crv_5 = Curve(dispatch_4.ListA)
pshift = ShiftPaths(Data=crv_5, Offset=-1)
pshift_2 = ShiftPaths(Data=pshift, Offset=-1)
bang_5 = ExplodeTree(Data=pshift_2)  # -> Branch0, Branch1, Branch2, Branch3, Branch4, Branch5, Branch6, Branch7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
bang_6 = ExplodeTree(Data=pshift_2)  # -> Branch0, Branch1, Branch2, Branch3, Branch4, Branch5, Branch6, Branch7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
bang_7 = ExplodeTree(Data=pshift_2)  # -> Branch0, Branch1, Branch2, Branch3, Branch4, Branch5, Branch6, Branch7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
bang_8 = ExplodeTree(Data=pshift_2)  # -> Branch0, Branch1, Branch2, Branch3, Branch4, Branch5, Branch6, Branch7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
entwine_4 = Entwine(Branch00=bang_7.Branch0, Branch01=bang_4.Branch0, FlattenInputs=True)  # -> flatten(Result)
entwine_5 = Entwine(Branch00=bang_7.Branch1, Branch01=bang_4.Branch1, FlattenInputs=True)  # -> flatten(Result)
entwine_6 = Entwine(Branch00=bang_6.Branch12, Branch01=bang_2.Branch12, FlattenInputs=True)  # -> flatten(Result)
entwine_7 = Entwine(Branch00=bang_6.Branch13, Branch01=bang_2.Branch13, FlattenInputs=True)  # -> flatten(Result); disabled
entwine_8 = Entwine(Branch00=bang_8.Branch4, Branch01=bang_3.Branch4, FlattenInputs=True)  # -> flatten(Result)
entwine_9 = Entwine(Branch00=bang_8.Branch5, Branch01=bang_3.Branch5, FlattenInputs=True)  # -> flatten(Result)
entwine_10 = Entwine(Branch00=bang_5.Branch8, Branch01=bang.Branch8, FlattenInputs=True)  # -> flatten(Result)
entwine_11 = Entwine(Branch00=bang_5.Branch9, Branch01=bang.Branch9, FlattenInputs=True)  # -> flatten(Result)
entwine_12 = Entwine(Branch00=entwine_4, Branch01=entwine_5, Branch02=bang_4.Branch2, Branch03=bang_4.Branch3, FlattenInputs=True)
entwine_13 = Entwine(Branch00=entwine_8, Branch01=entwine_9, Branch02=bang_3.Branch6, Branch03=bang_3.Branch7, FlattenInputs=True)
entwine_14 = Entwine(Branch00=entwine_6, Branch01=entwine_7, Branch02=bang_2.Branch14, Branch03=bang_2.Branch15, FlattenInputs=True)
entwine_15 = Entwine(Branch00=entwine_10, Branch01=entwine_11, Branch02=bang.Branch10, Branch03=bang.Branch11, FlattenInputs=True)
group = Group(Objects=entwine_13)
group_2 = Group(Objects=entwine_12)
group_3 = Group(Objects=entwine_14)
group_4 = Group(Objects=entwine_15)
pt_9 = Point(Point(957.9296072, 367.7685097, 0))
pt_10 = Point("0,0,0")
recgrid_6 = Rectangular(
    Plane=pt_9,
    SizeX=Slider(12, range=1..20, expression="X*50"),
    SizeY=Slider(10, range=1..20, expression="X*50"),
    ExtentX=Slider(4, range=0..10),
    ExtentY=Slider(3, range=0..10))  # -> Cells, Points
flatten_7 = FlattenTree(Tree=recgrid_6.Points, Path="{0}")

bang_9 = ExplodeTree(Data=make2d.VisibleCurves)  # -> Branch0, Branch1, Branch2, Branch3, Branch4, Branch5, Branch6, Branch7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
bang_10 = ExplodeTree(Data=pshift_2)  # -> Branch0, Branch1, Branch2, Branch3, Branch4, Branch5, Branch6, Branch7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
flip_2 = FlipCurve(Curve=pline)  # -> Curve, Flag
filter_21 = StreamFilter(Gate=Toggle(False), Stream0=pline_3, Stream1=flip_2.Curve)
entwine_16 = Entwine(Branch00=bang_10.Branch17, Branch01=bang_9.Branch17, FlattenInputs=True)  # -> flatten(Result)
entwine_17 = Entwine(Branch00=bang_10.Branch16, Branch01=bang_9.Branch16, FlattenInputs=True)  # -> flatten(Result)
offset_2 = OffsetCurve(Curve=filter_21, Distance=expr("-x", Slider(0, range=0..1000)), Corners=1)
entwine_18 = Entwine(Branch00=entwine_17, Branch01=entwine_16, Branch02=bang_9.Branch18, Branch03=bang_9.Branch19, FlattenInputs=True)
disc_5 = Discontinuity(Curve=offset_2, Level=1)  # -> Points, Parameters
group_5 = Group(Objects=entwine_18)
filter_22 = StreamFilter(Gate=list_28, Stream0=disc_4.Points, Stream1=disc_4.Points, Stream2=disc_4.Points, Stream3=disc_5.Points)
disc_6 = Discontinuity(Curve=pline, Level=1)  # -> Points, Parameters
# 建筑边线角点
pull = PullPoint(Point=disc_6.Points, Geometry=disc_4.Points, ClosestOnly=True)  # -> ClosestPoint, Distance
pull_2 = PullPoint(Point=pull.ClosestPoint, Geometry=filter_22, ClosestOnly=True)  # -> ClosestPoint, Distance

entwine_19 = Entwine(Branch00=group_2, Branch01=group, Branch02=group_4, Branch03=group_3, Branch04=group_5, FlattenInputs=True)
pshift_3 = ShiftPaths(Data=entwine_19, Offset=-1)
pshift_4 = ShiftPaths(Data=entwine_19, Offset=-1)
# 这里如果跑红也不要紧，
# 说明单体没有出现相撞的情况
boxprop = BoxProperties(Box=pshift_3)  # -> Center, Diagonal, Area, Volume, Degeneracy
vec2pt = Vector2Pt(PointA=boxprop.Center, PointB=pt_10, Unitize=False)  # -> Vector, Length
move_33 = Move(Geometry=pshift_4, Motion=vec2pt.Vector)  # -> flatten(Geometry), Transform
orient_7 = Orient(Geometry=move_33.Geometry, Source=PlaneXY(0, 0, 0), Target=flatten_7)  # -> Geometry, Transform

flip_3 = FlipCurve(Curve=pline)  # -> Curve, Flag
filter_23 = StreamFilter(Gate=Toggle(False), Stream0=pline, Stream1=flip_3.Curve)
entwine_20 = Entwine(Branch00=pull_2.ClosestPoint, Branch01=disc_6.Points, FlattenInputs=True)
offset_3 = OffsetCurve(Curve=filter_23, Distance=expr("-x", Slider(341, range=0..1000)), Corners=1)
flip_4 = FlipMatrix(Data=entwine_20)
crv_6 = Curve(offset_3)
# 结构边线角点
# 建筑边线角点
panel_18 = Panel("0")
item_7 = ListItem(List=flip_4, Index=panel_18, Wrap=True)  # -> flatten(Item)
item_8 = ListItem(List=flip_4, Index="1", Wrap=True)  # -> flatten(Item)
disc_7 = Discontinuity(Curve=crv_6, Level=1)  # -> Points, Parameters
panel_19 = Panel("1")
disc_8 = Discontinuity(Curve=filter_17, Level=1)  # -> Points, Parameters
panel_20 = Panel("""0
-1""")
pt_11 = Point(item_7)
# 有楼板时取楼板边线 无楼板时取结构边线
cull_i = CullIndex(List=disc_8.Points, Indices=panel_20, Wrap=True)
pull_3 = PullPoint(Point=pt_11, Geometry=cull_i, ClosestOnly=True)  # -> ClosestPoint, Distance
larger = LargerThan(FirstNumber=pull_3.Distance, SecondNumber=number_slider_12)  # -> LargerThan, OrEqualTo
dispatch_5 = Dispatch(List=pt_11, DispatchPattern=larger.LargerThan)  # -> ListA, ListB

# ---- group: Arch Points
pt_12 = Point(item_8)

# ----
filter_24 = StreamFilter(Gate=list_28, Stream0=dispatch_5.ListA, Stream1=dispatch_5.ListA, Stream2=dispatch_5.ListA, Stream3=pt_11)
filter_25 = StreamFilter(Gate=list_28, Stream0=dispatch_5.ListB, Stream1=dispatch_5.ListB, Stream2=dispatch_5.ListB, Stream3="0")

panel_21 = Panel("""false
false
true
false""")
panel_22 = Panel("""true
false
false
false""")
panel_23 = Panel("""false
false
false
true""")
cull = CullPattern(List=orient_7.Geometry, CullPattern=panel_23)
cull_2 = CullPattern(List=orient_7.Geometry, CullPattern=panel_21)
cull_3 = CullPattern(List=orient_7.Geometry, CullPattern=panel_22)
entwine_21 = Entwine(Branch00=cull_3, Branch01=cull_2, Branch02=cull, FlattenInputs=True)
flip_5 = FlipMatrix(Data=entwine_21)
branch = TreeBranch(Tree=flip_5, Path="{0;0}", MaintainPaths=True)
branch_2 = TreeBranch(Tree=flip_5, Path="{0;1}", MaintainPaths=True)
branch_3 = TreeBranch(Tree=flip_5, Path="{0;2}", MaintainPaths=True)
branch_4 = TreeBranch(Tree=flip_5, Path="{0;3}", MaintainPaths=True)
cluster = Cluster(G=branch_2)
cluster_2 = Cluster(G=branch_3)
cluster_3 = Cluster(G=branch)
cluster_4 = Cluster(G=branch_4)

branch_5 = TreeBranch(Tree=flip_5, Path="{0;4}", MaintainPaths=True)
cluster_5 = Cluster(G=branch_5)

crv_cp = CurveClosestPoint(Point=pt_12, Curve=crv_6)  # -> Point, Parameter, Distance
# 阳角筛选
c_script = CSharpScript(archPoint=crv_cp.Point, crvPoint=disc_7.Points)  # -> out, specialPt; inputs archPoint: list of Point3d, crvPoint: list of Point3d
# ---------- c_script: C# ----------
    List<int> passIndex = new List<int>();

    for(int i = 0; i < archPoint.Count; i++){
      foreach(Point3d t in crvPoint){
        if(archPoint[i].X == t.X && archPoint[i].Y == t.Y && archPoint[i].Z == t.Z){
          Print("pass");
          passIndex.Add(i);}
      }
    }

    specialPt = passIndex;
# ---------- end c_script ----------
item_9 = ListItem(List=pt_12, Index=c_script.specialPt, Wrap=True)
cull_i_2 = CullIndex(List=pt_12, Indices=c_script.specialPt, Wrap=True)
item_10 = ListItem(List=pt_12, Index=c_script.specialPt, Wrap=True)
cull_i_3 = CullIndex(List=item_7, Indices=c_script.specialPt, Wrap=True)
item_11 = ListItem(List=item_7, Index=c_script.specialPt, Wrap=True)
shift_4 = ShiftList(List=item_9, Shift="1", Wrap=True)
pt_13 = Point(graft(cull_i_2))
pt_14 = Point(graft(shift_4))
pt_15 = Point(graft(item_9))
ln_4 = Line(StartPoint=pt_14, EndPoint=pt_13)
ln_5 = Line(StartPoint=pt_15, EndPoint=pt_13)
angle = Angle(VectorA=ln_4, VectorB=ln_5)  # -> flatten(Angle), Reflex
# 夹角筛选
deg = Degrees(Radians=angle.Angle)
pt_16 = Point(filter_25)
larger_2 = LargerThan(FirstNumber=deg, SecondNumber="96")  # -> LargerThan, OrEqualTo
pt_17 = Point(filter_24)
# 结构边点阴阳以及夹角筛选后
dispatch_6 = Dispatch(List=flatten(cull_i_3), DispatchPattern=larger_2.LargerThan)  # -> ListA, ListB
dispatch_7 = Dispatch(List=flatten(pt_13), DispatchPattern=larger_2.LargerThan)  # -> ListA, ListB

pt_18 = Point(item_11)
pt_19 = Point(dispatch_6.ListA)
pt_20 = Point(dispatch_6.ListB)

pt_21 = Point(item_10)
pt_22 = Point(dispatch_7.ListA)
pt_23 = Point(dispatch_7.ListB)

c_script_2 = CSharpScript(archPoint=pt_17, crvPoint=pt_19)  # -> out, specialPt; inputs archPoint: list of Point3d, crvPoint: list of Point3d; same code as c_script
c_script_3 = CSharpScript(archPoint=pt_17, crvPoint=pt_20)  # -> out, specialPt; inputs archPoint: list of Point3d, crvPoint: list of Point3d; same code as c_script
c_script_4 = CSharpScript(archPoint=pt_17, crvPoint=pt_18)  # -> out, specialPt; inputs archPoint: list of Point3d, crvPoint: list of Point3d; same code as c_script
c_script_5 = CSharpScript(archPoint=pt_16, crvPoint=pt_18)  # -> out, specialPt; inputs archPoint: list of Point3d, crvPoint: list of Point3d; same code as c_script
c_script_6 = CSharpScript(archPoint=pt_16, crvPoint=pt_19)  # -> out, specialPt; inputs archPoint: list of Point3d, crvPoint: list of Point3d; same code as c_script
c_script_7 = CSharpScript(archPoint=pt_16, crvPoint=pt_20)  # -> out, specialPt; inputs archPoint: list of Point3d, crvPoint: list of Point3d; same code as c_script

item_12 = ListItem(List=pt_17, Index=c_script_2.specialPt, Wrap=True)
item_13 = ListItem(List=pt_17, Index=c_script_3.specialPt, Wrap=True)
item_14 = ListItem(List=pt_17, Index=c_script_4.specialPt, Wrap=True)  # -> graft(Item)

item_15 = ListItem(List=pt_16, Index=c_script_5.specialPt, Wrap=True)  # -> graft(Item)
item_16 = ListItem(List=pt_16, Index=c_script_6.specialPt, Wrap=True)
item_17 = ListItem(List=pt_16, Index=c_script_7.specialPt, Wrap=True)

panel_24 = Panel("""0
-1""")
item_18 = ListItem(List=pt_11, Index=panel_24, Wrap=True)
cull_i_4 = CullIndex(List=pt_11, Indices=panel_24, Wrap=True)
dispatch_8 = Dispatch(List=cull_i_4, DispatchPattern=[True, False])  # -> ListA, ListB
dispatch_9 = Dispatch(List=item_18, DispatchPattern=[True, False])  # -> ListA, ListB
pt_24 = Point(dispatch_8.ListA)
pt_25 = Point(dispatch_8.ListB)
pt_26 = Point(pt_13)
ln_6 = Line(StartPoint=pt_24, EndPoint=pt_25)
ln_7 = Line(StartPoint=dispatch_9.ListA, EndPoint=dispatch_9.ListB)
merge_8 = Merge(Data1=ln_7, Data2=ln_6)  # -> flatten(Result)
shift_5 = ShiftList(List=merge_8, Shift=1, Wrap=True)
crv_cp_2 = CurveClosestPoint(Point=graft(pt_26), Curve=graft(shift_5))  # -> flatten(Point), Parameter, Distance

pt_27 = Point(pt_20)

pt_28 = Point(flatten(pt_13))
pline_4 = PolyLine(Vertices=pt_28, Closed=invert(False))
offset_4 = OffsetCurve(Curve=pline_4, Distance=number_slider_15, Corners=1)

entwine_22 = Entwine(Branch00=cluster_3, Branch01=cluster, Branch02=cluster_2, Branch03=cluster_4, Branch04=cluster_5, FlattenInputs=True)

# ---- group: side-short
item_19 = ListItem(List=entwine_22, Index="2", Wrap=True)  # -> flatten(Item)

# ---- group: side
item_20 = ListItem(List=entwine_22, Index="1", Wrap=True)  # -> flatten(Item)

# ---- group: top
item_21 = ListItem(List=entwine_22, Index=0, Wrap=True)  # -> flatten(Item)

# ----
item_22 = ListItem(List=item_20, Index="4", Wrap=True)

item_23 = ListItem(List=item_19, Index="3", Wrap=True)
item_24 = ListItem(List=item_21, Index=0, Wrap=True)
item_25 = ListItem(List=item_21, Index="1", Wrap=True)
item_26 = ListItem(List=item_20, Index="2", Wrap=True)
item_27 = ListItem(List=item_20, Index="3", Wrap=True)
ungroup = Ungroup(Group=item_24)
ungroup_2 = Ungroup(Group=item_26)
ungroup_3 = Ungroup(Group=item_25)
ungroup_4 = Ungroup(Group=item_22)
ungroup_5 = Ungroup(Group=item_27)
block = DefineBlock(Geometry=ungroup_3, Attributes=attributes, BlockName=panel_13, BasePlane=PlaneXY(0, 0, 0))
block_2 = DefineBlock(Geometry=ungroup_4, Attributes=attributes, BlockName="embed5", BasePlane=PlaneXY(0, 0, 0))
block_3 = DefineBlock(Geometry=ungroup, Attributes=attributes, BlockName="embed2", BasePlane=PlaneXY(0, 0, 0))
block_4 = DefineBlock(Geometry=ungroup_5, Attributes=attributes, BlockName="embed4", BasePlane=PlaneXY(0, 0, 0))
block_5 = DefineBlock(Geometry=ungroup_2, Attributes=attributes, BlockName="embed3", BasePlane=PlaneXY(0, 0, 0))
merge_9 = Merge(Data1=block, Data2=block_3, Data3=block_5, Data4=block_4, Data5=block_2)

item_28 = ListItem(List=flatten(merge_9), Index=panel_14, Wrap=True)

pull_4 = PullPoint(Point=item_13, Geometry=crv_cp_2.Point, ClosestOnly=True)  # -> ClosestPoint, Distance
pt_29 = Point(item_13)
ln_8 = Line(StartPoint=pull_4.ClosestPoint, EndPoint=pt_29)
item_29 = ListItem(List=flatten(merge_9), Index=0, Wrap=True)
item_30 = ListItem(List=flatten(merge_9), Index="3", Wrap=True)
amp = Amplitude(Vector=ln_8, Amplitude=filter_15)
filter_26 = StreamFilter(Gate=list_28, Stream0=item_29, Stream1=item_28, Stream2=item_29, Stream3=item_30)
move_34 = Move(Geometry=pull_4.ClosestPoint, Motion=amp)  # -> Geometry, Transform
ln_9 = Line(StartPoint=move_34.Geometry, EndPoint=pull_4.ClosestPoint)
rotate_2 = Rotate(Geometry=ln_9, Angle=-1.570796327, Plane=move_34.Geometry)  # -> Geometry, Transform
line = Line(flatten(ln_9))
line_2 = Line(flatten(rotate_2.Geometry))
pl = ConstructPlane(Origin=flatten(move_34.Geometry), XAxis=line, YAxis=line_2)
bbox_3 = BoundingBox(Content=graft(filter_26), Plane=PlaneXY(0, 0, 0))  # -> Box, Box_2
srf = Surface(bbox_3.Box)
explode = Explode(Curve=srf, Recursive=True)  # -> Segments, Vertices
item_31 = ListItem(List=explode.Vertices, Index=0, Wrap=True)  # -> Item, Item1, Item2
ln_10 = Line(StartPoint=graft(item_31.Item1), EndPoint=graft(item_31.Item2))
midpt = CurveMiddle(Curve=ln_10)
ln_11 = Line(StartPoint=midpt, EndPoint=item_31.Item1)
rotate_3 = Rotate(Geometry=ln_11, Angle=-1.570796327, Plane=PlaneXY(0, 0, 0))  # -> Geometry, Transform
pl_2 = ConstructPlane(Origin=midpt, XAxis=ln_11, YAxis=rotate_3.Geometry)
orient_8 = Orient(Geometry=filter_26, Source=pl_2, Target=pl)  # -> Geometry, Transform
data = Data(orient_8.Geometry)

item_32 = ListItem(List=flatten(merge_9), Index="1", Wrap=True)
item_33 = ListItem(List=flatten(merge_9), Index="4", Wrap=True)
item_34 = ListItem(List=flatten(merge_9), Index="1", Wrap=True)

item_35 = ListItem(List=flatten(merge_9), Index="3", Wrap=True)
pt_30 = Point(item_12)
pull_5 = PullPoint(Point=item_12, Geometry=crv_cp_2.Point, ClosestOnly=True)  # -> ClosestPoint, Distance
# 阴角部
item_36 = ListItem(List=flatten(merge_9), Index=0, Wrap=True)
ln_12 = Line(StartPoint=pull_5.ClosestPoint, EndPoint=pt_30)
filter_27 = StreamFilter(Gate=list_28, Stream0=item_36, Stream1=item_34, Stream2=item_36, Stream3=item_35)
amp_2 = Amplitude(Vector=ln_12, Amplitude=filter_16)
move_35 = Move(Geometry=pull_5.ClosestPoint, Motion=amp_2)  # -> Geometry, Transform
ln_13 = Line(StartPoint=move_35.Geometry, EndPoint=pull_5.ClosestPoint)
rotate_4 = Rotate(Geometry=ln_13, Angle=-1.570796327, Plane=move_35.Geometry)  # -> Geometry, Transform
line_3 = Line(flatten(ln_13))
line_4 = Line(flatten(rotate_4.Geometry))
pl_3 = ConstructPlane(Origin=flatten(move_35.Geometry), XAxis=line_3, YAxis=line_4)
bbox_4 = BoundingBox(Content=graft(filter_27), Plane=PlaneXY(0, 0, 0))  # -> Box, Box_2
srf_2 = Surface(bbox_4.Box)
explode_2 = Explode(Curve=srf_2, Recursive=True)  # -> Segments, Vertices
item_37 = ListItem(List=explode_2.Vertices, Index=0, Wrap=True)  # -> Item, Item1, Item2
ln_14 = Line(StartPoint=graft(item_37.Item1), EndPoint=graft(item_37.Item2))
midpt_2 = CurveMiddle(Curve=ln_14)
ln_15 = Line(StartPoint=midpt_2, EndPoint=item_37.Item1)
rotate_5 = Rotate(Geometry=ln_15, Angle=-1.570796327, Plane=PlaneXY(0, 0, 0))  # -> Geometry, Transform
pl_4 = ConstructPlane(Origin=midpt_2, XAxis=ln_15, YAxis=rotate_5.Geometry)
orient_9 = Orient(Geometry=filter_27, Source=pl_4, Target=pl_3)  # -> Geometry, Transform
orient_10 = Orient(Geometry=srf_2, Source=pl_4, Target=pl_3)  # -> Geometry, Transform
data_2 = Data(orient_9.Geometry)

pull_6 = PullPoint(Point=item_17, Geometry=crv_cp_2.Point, ClosestOnly=True)  # -> ClosestPoint, Distance
# 阴大面
pt_31 = Point(item_17)
ln_16 = Line(StartPoint=pull_6.ClosestPoint, EndPoint=pt_31)
amp_3 = Amplitude(Vector=ln_16, Amplitude=filter_15)
move_36 = Move(Geometry=pull_6.ClosestPoint, Motion=amp_3)  # -> Geometry, Transform
ln_17 = Line(StartPoint=move_36.Geometry, EndPoint=pull_6.ClosestPoint)
rotate_6 = Rotate(Geometry=ln_17, Angle=-1.570796327, Plane=move_36.Geometry)  # -> Geometry, Transform
item_38 = ListItem(List=flatten(merge_9), Index="1", Wrap=True)
line_5 = Line(flatten(ln_17))
line_6 = Line(flatten(rotate_6.Geometry))
bbox_5 = BoundingBox(Content=graft(item_38), Plane=PlaneXY(0, 0, 0))  # -> Box, Box_2
srf_3 = Surface(bbox_5.Box)
pl_5 = ConstructPlane(Origin=flatten(move_36.Geometry), XAxis=line_5, YAxis=line_6)
explode_3 = Explode(Curve=srf_3, Recursive=True)  # -> Segments, Vertices
item_39 = ListItem(List=explode_3.Vertices, Index=0, Wrap=True)  # -> Item, Item1, Item2
ln_18 = Line(StartPoint=graft(item_39.Item1), EndPoint=graft(item_39.Item2))
midpt_3 = CurveMiddle(Curve=ln_18)
ln_19 = Line(StartPoint=midpt_3, EndPoint=item_39.Item1)
rotate_7 = Rotate(Geometry=ln_19, Angle=-1.570796327, Plane=PlaneXY(0, 0, 0))  # -> Geometry, Transform
pl_6 = ConstructPlane(Origin=midpt_3, XAxis=ln_19, YAxis=rotate_7.Geometry)
orient_11 = Orient(Geometry=item_38, Source=pl_6, Target=pl_5)  # -> Geometry, Transform
orient_12 = Orient(Geometry=srf_3, Source=pl_6, Target=pl_5)  # -> Geometry, Transform
data_3 = Data(orient_11.Geometry)

pull_7 = PullPoint(Point=item_16, Geometry=crv_cp_2.Point, ClosestOnly=True)  # -> ClosestPoint, Distance
# 阴角部
pt_32 = Point(item_16)
ln_20 = Line(StartPoint=pull_7.ClosestPoint, EndPoint=pt_32)
amp_4 = Amplitude(Vector=ln_20, Amplitude=filter_16)
move_37 = Move(Geometry=pull_7.ClosestPoint, Motion=amp_4)  # -> Geometry, Transform
ln_21 = Line(StartPoint=move_37.Geometry, EndPoint=pull_7.ClosestPoint)
rotate_8 = Rotate(Geometry=ln_21, Angle=-1.570796327, Plane=move_37.Geometry)  # -> Geometry, Transform
item_40 = ListItem(List=flatten(merge_9), Index="1", Wrap=True)
line_7 = Line(flatten(ln_21))
line_8 = Line(flatten(rotate_8.Geometry))
bbox_6 = BoundingBox(Content=graft(item_40), Plane=PlaneXY(0, 0, 0))  # -> Box, Box_2
pl_7 = ConstructPlane(Origin=flatten(move_37.Geometry), XAxis=line_7, YAxis=line_8)
srf_4 = Surface(bbox_6.Box)
explode_4 = Explode(Curve=srf_4, Recursive=True)  # -> Segments, Vertices
item_41 = ListItem(List=explode_4.Vertices, Index=0, Wrap=True)  # -> Item, Item1, Item2
ln_22 = Line(StartPoint=graft(item_41.Item1), EndPoint=graft(item_41.Item2))
midpt_4 = CurveMiddle(Curve=ln_22)
ln_23 = Line(StartPoint=midpt_4, EndPoint=item_41.Item1)
rotate_9 = Rotate(Geometry=ln_23, Angle=-1.570796327, Plane=PlaneXY(0, 0, 0))  # -> Geometry, Transform
pl_8 = ConstructPlane(Origin=midpt_4, XAxis=ln_23, YAxis=rotate_9.Geometry)
orient_13 = Orient(Geometry=item_40, Source=pl_8, Target=pl_7)  # -> Geometry, Transform
orient_14 = Orient(Geometry=srf_4, Source=pl_8, Target=pl_7)  # -> Geometry, Transform
data_4 = Data(orient_13.Geometry)

item_42 = ListItem(List=flatten(merge_9), Index="1", Wrap=True)

# ----
# 阳部
item_43 = ListItem(List=flatten(merge_9), Index="1", Wrap=True)
cull_i_5 = CullIndex(List=pt_16, Indices=c_script_5.specialPt, Wrap=True)  # -> graft(List)
item_44 = ListItem(List=flatten(merge_9), Index="3", Wrap=True)
ln_24 = Line(StartPoint=item_15, EndPoint=cull_i_5)
filter_28 = StreamFilter(Gate=list_28, Stream0=item_43, Stream1=item_42, Stream2=item_43, Stream3=item_44)
bbox_7 = BoundingBox(Content=graft(filter_28), Plane=PlaneXY(0, 0, 0))  # -> Box, Box_2
rotate_10 = Rotate(Geometry=ln_24, Angle=-1.570796327, Plane=item_15)  # -> Geometry, Transform
line_9 = Line(flatten(ln_24))
line_10 = Line(flatten(rotate_10.Geometry))
srf_5 = Surface(bbox_7.Box)
pl_9 = ConstructPlane(Origin=flatten(item_15), XAxis=line_10, YAxis=line_9)
explode_5 = Explode(Curve=srf_5, Recursive=True)  # -> Segments, Vertices
item_45 = ListItem(List=explode_5.Vertices, Index=0, Wrap=True)  # -> Item, Item1, Item2
ln_25 = Line(StartPoint=graft(item_45.Item1), EndPoint=graft(item_45.Item))
ln_26 = Line(StartPoint=graft(item_45.Item1), EndPoint=graft(item_45.Item2))
pt_33 = Point(item_45.Item1)
pl_10 = ConstructPlane(Origin=item_45.Item1, XAxis=ln_25, YAxis=ln_26)
orient_15 = Orient(Geometry=filter_28, Source=pl_10, Target=pl_9)  # -> Geometry, Transform
data_5 = Data(orient_15.Geometry)

orient_16 = Orient(Geometry=srf, Source=pl_2, Target=pl)  # -> Geometry, Transform

item_46 = ListItem(List=flatten(merge_9), Index="2", Wrap=True)
bbox_8 = BoundingBox(Content=graft(item_46), Plane=PlaneXY(0, 0, 0))  # -> Box, Box_2
srf_6 = Surface(bbox_8.Box)
explode_6 = Explode(Curve=srf_6, Recursive=True)  # -> Segments, Vertices
item_47 = ListItem(List=explode_6.Vertices, Index=0, Wrap=True)  # -> Item, Item1, Item2
ln_27 = Line(StartPoint=graft(item_47.Item), EndPoint=graft(item_47.Item1))
ln_28 = Line(StartPoint=graft(item_47.Item1), EndPoint=graft(item_47.Item2))
midpt_5 = CurveMiddle(Curve=ln_28)
move_38 = Move(Geometry=ln_27, Motion=ln_27)  # -> Geometry, Transform
pl_11 = ConstructPlane(Origin=midpt_5, XAxis=move_38.Geometry, YAxis=ln_28)

boundary = BoundarySurfaces(Edges=orient_10.Geometry)  # -> simplify(graft(Surfaces))
# 柱子碰撞
boundary_2 = BoundarySurfaces(Edges=crv_2)  # -> simplify(Surfaces)
graft_2 = GraftTree(Tree=move_35.Geometry, IncludeEmptyLists=True, IncludeNullItems=True)  # -> simplify(Tree)
graft_3 = GraftTree(Tree=data_2, IncludeEmptyLists=True, IncludeNullItems=True)  # -> simplify(Tree)
findbrepintersect = FindBrepIntersect(BrepMain=boundary, BrepStay=boundary_2)  # -> out, BrepInters, BrepRemain; inputs BrepMain: list of Brep, BrepStay: list of Brep
# ---------- findbrepintersect: C# ----------
    List<Brep> BrepI = new List<Brep>();
    List<Brep> BrepR = new List<Brep>();
    


    double tolr = Rhino.RhinoDoc.ActiveDoc.ModelAbsoluteTolerance;

    for(int j = 0; j < BrepMain.Count;j++){
      foreach(Brep b in BrepStay) {
        bool test = Rhino.Geometry.Intersect.Intersection.BrepBrep(BrepMain[j], b, tolr, out crv, out pts);
        if(test && crv.Length != 0){
          tryThis = true;
          break;}
        else{
          tryThis = false;}
      }
      if(tryThis){
        BrepI.Add(BrepMain[j]);
      }
      else{
        BrepR.Add(BrepMain[j]);
      }
    }



    BrepInters = BrepI;
    BrepRemain = BrepR;
# ---------- findbrepintersect: C# additional code ----------
  Rhino.Geometry.Curve[] crv;
  Rhino.Geometry.Point3d[] pts;
  bool tryThis;
# ---------- end findbrepintersect ----------
pt_34 = Point(pt_12)
item_48 = ListItem(List=graft_2, Index=findbrepintersect.BrepInters, Wrap=True)
pull_8 = PullPoint(Point=item_48, Geometry=pt_34, ClosestOnly=True)  # -> ClosestPoint, Distance
pull_9 = PullPoint(Point=pull_8.ClosestPoint, Geometry=boundary_2, ClosestOnly=True)  # -> ClosestPoint, Distance
ln_29 = Line(StartPoint=pull_8.ClosestPoint, EndPoint=pull_9.ClosestPoint)
rotate_11 = Rotate(Geometry=ln_29, Angle=1.570796327, Plane=pull_9.ClosestPoint)  # -> Geometry, Transform
pl_12 = ConstructPlane(Origin=pull_9.ClosestPoint, XAxis=ln_29, YAxis=rotate_11.Geometry)
orient_17 = Orient(Geometry=item_46, Source=pl_11, Target=pl_12)  # -> Geometry, Transform
cull_i_6 = CullIndex(List=graft_3, Indices=findbrepintersect.BrepInters, Wrap=True)
merge_10 = Merge(Data1=cull_i_6, Data2=orient_17.Geometry)

boundary_3 = BoundarySurfaces(Edges=orient_12.Geometry)  # -> simplify(graft(Surfaces))
# 柱子碰撞
boundary_4 = BoundarySurfaces(Edges=crv_2)  # -> simplify(Surfaces)
graft_4 = GraftTree(Tree=data_3, IncludeEmptyLists=True, IncludeNullItems=True)  # -> simplify(Tree)
graft_5 = GraftTree(Tree=move_36.Geometry, IncludeEmptyLists=True, IncludeNullItems=True)  # -> simplify(Tree)
pt_35 = Point(pt_12)
findbrepintersect_2 = FindBrepIntersect(BrepMain=boundary_3, BrepStay=boundary_4)  # -> out, BrepInters, BrepRemain; inputs BrepMain: list of Brep, BrepStay: list of Brep; same code as findbrepintersect
item_49 = ListItem(List=graft_5, Index=findbrepintersect_2.BrepInters, Wrap=True)
pull_10 = PullPoint(Point=item_49, Geometry=pt_35, ClosestOnly=True)  # -> ClosestPoint, Distance
pull_11 = PullPoint(Point=pull_10.ClosestPoint, Geometry=boundary_4, ClosestOnly=True)  # -> ClosestPoint, Distance
ln_30 = Line(StartPoint=pull_10.ClosestPoint, EndPoint=pull_11.ClosestPoint)
rotate_12 = Rotate(Geometry=ln_30, Angle=1.570796327, Plane=pull_11.ClosestPoint)  # -> Geometry, Transform
pl_13 = ConstructPlane(Origin=pull_11.ClosestPoint, XAxis=ln_30, YAxis=rotate_12.Geometry)
orient_18 = Orient(Geometry=item_46, Source=pl_11, Target=pl_13)  # -> Geometry, Transform
cull_i_7 = CullIndex(List=graft_4, Indices=findbrepintersect_2.BrepInters, Wrap=True)
merge_11 = Merge(Data1=cull_i_7, Data2=orient_18.Geometry)

# ----
# 柱子碰撞
boundary_5 = BoundarySurfaces(Edges=crv_2)  # -> simplify(Surfaces)
boundary_6 = BoundarySurfaces(Edges=orient_16.Geometry)  # -> simplify(graft(Surfaces))
graft_6 = GraftTree(Tree=pt_29, IncludeEmptyLists=True, IncludeNullItems=True)  # -> simplify(Tree)
graft_7 = GraftTree(Tree=data, IncludeEmptyLists=True, IncludeNullItems=True)  # -> simplify(Tree)
findbrepintersect_3 = FindBrepIntersect(BrepMain=boundary_6, BrepStay=boundary_5)  # -> out, BrepInters, BrepRemain; inputs BrepMain: list of Brep, BrepStay: list of Brep; same code as findbrepintersect
pt_36 = Point(pt_12)
item_50 = ListItem(List=graft_6, Index=findbrepintersect_3.BrepInters, Wrap=True)
pull_12 = PullPoint(Point=item_50, Geometry=pt_36, ClosestOnly=True)  # -> ClosestPoint, Distance
pull_13 = PullPoint(Point=pull_12.ClosestPoint, Geometry=boundary_5, ClosestOnly=True)  # -> ClosestPoint, Distance
ln_31 = Line(StartPoint=pull_12.ClosestPoint, EndPoint=pull_13.ClosestPoint)
rotate_13 = Rotate(Geometry=ln_31, Angle=1.570796327, Plane=pull_13.ClosestPoint)  # -> Geometry, Transform
pl_14 = ConstructPlane(Origin=pull_13.ClosestPoint, XAxis=ln_31, YAxis=rotate_13.Geometry)
cull_i_8 = CullIndex(List=graft_7, Indices=findbrepintersect_3.BrepInters, Wrap=True)
orient_19 = Orient(Geometry=item_46, Source=pl_11, Target=pl_14)  # -> Geometry, Transform
merge_12 = Merge(Data1=cull_i_8, Data2=orient_19.Geometry)

# ----
# 柱子碰撞
boundary_7 = BoundarySurfaces(Edges=crv_2)  # -> simplify(Surfaces)
boundary_8 = BoundarySurfaces(Edges=orient_14.Geometry)  # -> simplify(graft(Surfaces))
graft_8 = GraftTree(Tree=data_4, IncludeEmptyLists=True, IncludeNullItems=True)  # -> simplify(Tree)
graft_9 = GraftTree(Tree=move_37.Geometry, IncludeEmptyLists=True, IncludeNullItems=True)  # -> simplify(Tree)
pt_37 = Point(pt_12)
findbrepintersect_4 = FindBrepIntersect(BrepMain=boundary_8, BrepStay=boundary_7)  # -> out, BrepInters, BrepRemain; inputs BrepMain: list of Brep, BrepStay: list of Brep; same code as findbrepintersect
item_51 = ListItem(List=graft_9, Index=findbrepintersect_4.BrepInters, Wrap=True)
pull_14 = PullPoint(Point=item_51, Geometry=pt_37, ClosestOnly=True)  # -> ClosestPoint, Distance
pull_15 = PullPoint(Point=pull_14.ClosestPoint, Geometry=boundary_7, ClosestOnly=True)  # -> ClosestPoint, Distance
ln_32 = Line(StartPoint=pull_14.ClosestPoint, EndPoint=pull_15.ClosestPoint)
rotate_14 = Rotate(Geometry=ln_32, Angle=1.570796327, Plane=pull_15.ClosestPoint)  # -> Geometry, Transform
pl_15 = ConstructPlane(Origin=pull_15.ClosestPoint, XAxis=ln_32, YAxis=rotate_14.Geometry)
orient_20 = Orient(Geometry=item_46, Source=pl_11, Target=pl_15)  # -> Geometry, Transform
cull_i_9 = CullIndex(List=graft_8, Indices=findbrepintersect_4.BrepInters, Wrap=True)
merge_13 = Merge(Data1=cull_i_9, Data2=orient_20.Geometry)

cull_i_10 = CullIndex(List=graft_6, Indices=findbrepintersect_3.BrepInters, Wrap=True)
cull_i_11 = CullIndex(List=graft_2, Indices=findbrepintersect.BrepInters, Wrap=True)  # -> flatten(List)
merge_14 = Merge(Data1=data_5, Data2=merge_11, Data3=merge_13)

line_11 = Line(ln_30)
geo_2 = Geometry(pull_11.ClosestPoint)
rotate_15 = Rotate(Geometry=line_11, Angle=1.570796327, Plane=geo_2)  # -> Geometry, Transform
amp_5 = Amplitude(Vector=line_11, Amplitude=number_slider_13)
move_39 = Move(Geometry=simplify(geo_2), Motion=amp_5)  # -> Geometry, Transform
pl_16 = ConstructPlane(Origin=move_39.Geometry, XAxis=rotate_15.Geometry, YAxis=line_11)

line_12 = Line(ln_32)
geo_3 = Geometry(pull_15.ClosestPoint)
amp_6 = Amplitude(Vector=line_12, Amplitude=number_slider_13)
move_40 = Move(Geometry=simplify(geo_3), Motion=amp_6)  # -> Geometry, Transform
rotate_16 = Rotate(Geometry=line_12, Angle=1.570796327, Plane=geo_3)  # -> Geometry, Transform
pl_17 = ConstructPlane(Origin=move_40.Geometry, XAxis=rotate_16.Geometry, YAxis=line_12)

cull_i_12 = CullIndex(List=boundary_3, Indices=findbrepintersect_2.BrepInters, Wrap=True)
area_3 = Area(Geometry=cull_i_12)  # -> Area, Centroid
crv_7 = Curve(crv_4)
disc_9 = Discontinuity(Curve=crv_7, Level=1)  # -> Points, Parameters
pull_16 = PullPoint(Point=area_3.Centroid, Geometry=crv_7, ClosestOnly=True)  # -> ClosestPoint, Distance
pull_17 = PullPoint(Point=pull_16.ClosestPoint, Geometry=disc_9.Points, ClosestOnly=True)  # -> ClosestPoint, Distance
ln_33 = Line(StartPoint=pull_16.ClosestPoint, EndPoint=area_3.Centroid)
ln_34 = Line(StartPoint=pull_16.ClosestPoint, EndPoint=pull_17.ClosestPoint)
amp_7 = Amplitude(Vector=ln_33, Amplitude=number_slider_13)
move_41 = Move(Geometry=pull_16.ClosestPoint, Motion=amp_7)  # -> Geometry, Transform
pl_18 = ConstructPlane(Origin=move_41.Geometry, XAxis=ln_34, YAxis=ln_33)  # -> flatten(Plane)

cull_i_13 = CullIndex(List=boundary_8, Indices=findbrepintersect_4.BrepInters, Wrap=True)
area_4 = Area(Geometry=cull_i_13)  # -> Area, Centroid
crv_8 = Curve(crv_4)
disc_10 = Discontinuity(Curve=crv_8, Level=1)  # -> Points, Parameters
pull_18 = PullPoint(Point=area_4.Centroid, Geometry=crv_8, ClosestOnly=True)  # -> ClosestPoint, Distance
pull_19 = PullPoint(Point=pull_18.ClosestPoint, Geometry=disc_10.Points, ClosestOnly=True)  # -> ClosestPoint, Distance
ln_35 = Line(StartPoint=pull_18.ClosestPoint, EndPoint=area_4.Centroid)
ln_36 = Line(StartPoint=pull_18.ClosestPoint, EndPoint=pull_19.ClosestPoint)
amp_8 = Amplitude(Vector=ln_35, Amplitude=number_slider_13)
move_42 = Move(Geometry=pull_18.ClosestPoint, Motion=amp_8)  # -> Geometry, Transform
pl_19 = ConstructPlane(Origin=move_42.Geometry, XAxis=ln_36, YAxis=ln_35)  # -> flatten(Plane)

amp_9 = Amplitude(Vector=ln_29, Amplitude=number_slider_13)
rotate_17 = Rotate(Geometry=ln_29, Angle=-1.570796327, Plane=pull_9.ClosestPoint)  # -> Geometry, Transform
move_43 = Move(Geometry=simplify(pull_9.ClosestPoint), Motion=amp_9)  # -> Geometry, Transform
pl_20 = ConstructPlane(Origin=move_43.Geometry, XAxis=rotate_17.Geometry, YAxis=ln_29)

# ----
# 逐个埋件标注
toggle = BooleanToggle(True)
pt_38 = Point(pt_20)
pline_5 = PolyLine(Vertices=pt_38, Closed=toggle)
join = JoinCurves(Curves=crv_2, Preserve=False)
srf_7 = Surface(pline_5)
disc_11 = Discontinuity(Curve=srf_7, Level=1)  # -> Points, Parameters
area_5 = Area(Geometry=join)  # -> Area, Centroid
pline_6 = PolyLine(Vertices=disc_11.Points, Closed=toggle)
crv_9 = Curve(pline_6)
pt_39 = Point(area_5.Centroid)
debrep = DeconstructBrep(Brep=crv_9)  # -> Faces, Edges, Vertices
pull_20 = PullPoint(Point=debrep.Vertices, Geometry=pt_39, ClosestOnly=True)  # -> ClosestPoint, Distance
pline_7 = PolyLine(Vertices=pull_20.ClosestPoint, Closed=Toggle(True))
debrep_2 = DeconstructBrep(Brep=pline_7)  # -> Faces, Edges, Vertices
len_4 = Length(Curve=debrep_2.Edges)
sort_4 = SortList(Keys=reverse(len_4), ValuesA=debrep_2.Edges)  # -> Keys, ValuesA
lng = ListLength(List=sort_4.ValuesA)
division_39 = Division(A=lng, B=2)
split = SplitList(List=sort_4.ValuesA, Index=division_39)  # -> ListA, ListB
end = EndPoints(Curve=split.ListA)  # -> Start, End
item_52 = ListItem(List=sort_4.ValuesA, Index=0, Wrap=True)  # -> Item, Item1, Item2, Item3
mp = Midpoint(Curve=[item_52.Item, item_52.Item1, item_52.Item2, item_52.Item3])  # -> graft(Midpoint)
scale = Scale(Geometry=graft([item_52.Item, item_52.Item1, item_52.Item2, item_52.Item3]), Center=mp, Factor="2")  # -> Geometry, Transform
item_53 = ListItem(List=flatten(scale.Geometry), Index=0, Wrap=True)  # -> Item, Item1, Item2, Item3
mp_2 = Midpoint(Curve=item_53.Item)
mp_3 = Midpoint(Curve=item_53.Item1)
mp_4 = Midpoint(Curve=item_53.Item2)
mp_5 = Midpoint(Curve=item_53.Item3)
scale_2 = Scale(Geometry=item_53.Item, Center=mp_2, Factor="30")  # -> Geometry, Transform
scale_3 = Scale(Geometry=item_53.Item1, Center=mp_3, Factor="30")  # -> Geometry, Transform
scale_4 = Scale(Geometry=item_53.Item2, Center=mp_4, Factor="30")  # -> Geometry, Transform
scale_5 = Scale(Geometry=item_53.Item3, Center=mp_5, Factor="30")  # -> Geometry, Transform
offset_5 = OffsetCurve(Curve=scale_2.Geometry, Distance=expr("-x", number_slider_18), Corners=1)  # -> flatten(Curve)
offset_6 = OffsetCurve(Curve=scale_5.Geometry, Distance=expr("-x", number_slider_18), Corners=1)  # -> flatten(Curve)
offset_7 = OffsetCurve(Curve=scale_4.Geometry, Distance=expr("-x", number_slider_18), Corners=1)  # -> flatten(Curve)
offset_8 = OffsetCurve(Curve=scale_3.Geometry, Distance=expr("-x", number_slider_18), Corners=1)  # -> flatten(Curve)
clx_2 = CurveLine(Curve=offset_8, Line=[offset_5, offset_7, offset_6])  # -> Points, Params, Count
clx_3 = CurveLine(Curve=offset_5, Line=[offset_8, offset_7, offset_6])  # -> Points, Params, Count
clx_4 = CurveLine(Curve=offset_7, Line=[offset_5, offset_8, offset_6])  # -> Points, Params, Count
clx_5 = CurveLine(Curve=offset_6, Line=[offset_5, offset_8, offset_7])  # -> Points, Params, Count
merge_15 = Merge(Data1=clx_3.Points, Data2=clx_2.Points, Data3=clx_4.Points, Data4=clx_5.Points)
merge_16 = Merge(Data1=offset_5, Data2=offset_8, Data3=offset_7, Data4=offset_6)
cullduppoints = RemoveDuplicatePoints(InputPoints=flatten(merge_15), Tolerance=0.001)  # -> OutputPoints, FirstPointIndexes
null = NullItem(Item=cullduppoints.OutputPoints)  # -> NullFlags, InvalidFlags, Description
dispatch_10 = Dispatch(List=flatten(merge_15), DispatchPattern=null.NullFlags)  # -> ListA, ListB
pt_40 = Point(dispatch_10.ListB)
pull_21 = PullPoint(Point=[debrep_2.Vertices, pt_40], Geometry=merge_16, ClosestOnly=True)  # -> flatten(ClosestPoint), Distance
item_54 = ListItem(List=pt_40, Index=0, Wrap=True)  # -> Item, Item1, Item2, Item3
entwine_23 = Entwine(Branch00=item_54.Item, Branch01=item_54.Item1, Branch02=item_54.Item2, Branch03=item_54.Item3, FlattenInputs=True)
pull_22 = PullPoint(Point=pull_21.ClosestPoint, Geometry=entwine_23, ClosestOnly=True)  # -> ClosestPoint, Distance
sort_5 = SortList(Keys=pull_22.Distance, ValuesA=pull_21.ClosestPoint)  # -> Keys, ValuesA
item_55 = ListItem(List=sort_5.ValuesA, Index=0, Wrap=True)  # -> Item, Item1, Item2
ln_37 = Line(StartPoint=item_55.Item, EndPoint=item_55.Item2)
ln_38 = Line(StartPoint=item_55.Item, EndPoint=item_55.Item1)
panel_25 = Panel("""{1}
{2}
{3}""")
pt_41 = Point(disc_4.Points)
branch_6 = TreeBranch(Tree=simplify(ln_37), Path="{0}", MaintainPaths=True)
branch_7 = TreeBranch(Tree=simplify(ln_38), Path="{0}", MaintainPaths=True)
branch_8 = TreeBranch(Tree=simplify(ln_37), Path=panel_25, MaintainPaths=True)
branch_9 = TreeBranch(Tree=simplify(ln_38), Path=panel_25, MaintainPaths=True)
merge_17 = Merge(Data1=branch_6, Data2=branch_9)
merge_18 = Merge(Data1=branch_7, Data2=branch_8)
extr_5 = Extrude(Base=merge_17, Direction=merge_18)  # -> flatten(Extrusion)
incurves = PointInCurves(Point=pt_41, Curves=extr_5)  # -> Relationship, Index, Point
equals = Equality(FirstNumber=incurves.Index, SecondNumber="-1")  # -> Equality, Inequality
dispatch_11 = Dispatch(List=pt_41, DispatchPattern=equals.Equality)  # -> ListA, ListB
graft_10 = GraftTree(Tree=extr_5, IncludeEmptyLists=True, IncludeNullItems=True)
data_6 = Data(dispatch_11.ListB)
incurve = PointInCurve(Point=data_6, Curve=graft_10)  # -> Relationship, Point
equals_2 = Equality(FirstNumber=incurve.Relationship, SecondNumber="2")  # -> Equality, Inequality
merge_19 = Merge(Data1=merge_17, Data2=merge_18)
dispatch_12 = Dispatch(List=data_6, DispatchPattern=equals_2.Equality)  # -> ListA, ListB
pt_42 = Point(dispatch_10.ListB)
item_56 = ListItem(List=merge_19, Index=0, Wrap=True)  # -> simplify(Item), simplify(Item1)
data_7 = Data(simplify(dispatch_12.ListA))
crv_cp_3 = CurveClosestPoint(Point=data_7, Curve=item_56.Item)  # -> Point, Parameter, Distance
crv_cp_4 = CurveClosestPoint(Point=data_7, Curve=item_56.Item1)  # -> Point, Parameter, Distance
pull_23 = PullPoint(Point=crv_cp_3.Point, Geometry=graft(pt_42), ClosestOnly=True)  # -> ClosestPoint, Distance
pull_24 = PullPoint(Point=crv_cp_4.Point, Geometry=graft(pt_42), ClosestOnly=True)  # -> ClosestPoint, Distance
sort_6 = SortList(Keys=pull_24.Distance, ValuesA=data_7)  # -> Keys, ValuesA
sort_7 = SortList(Keys=pull_23.Distance, ValuesA=data_7)  # -> Keys, ValuesA
line_13 = Line(item_56.Item1)
points = PointList(Points=sort_6.ValuesA)
points_2 = PointList(Points=sort_7.ValuesA)
line_14 = Line(item_56.Item)
dispatch_13 = Dispatch(List=sort_6.ValuesA, DispatchPattern=[True, False])  # -> ListA, ListB
dispatch_14 = Dispatch(List=sort_7.ValuesA, DispatchPattern=[True, False])  # -> ListA, ListB
item_57 = ListItem(List=sort_7.ValuesA, Index=0, Wrap=True)
item_58 = ListItem(List=sort_7.ValuesA, Index="-1", Wrap=True)
pt_43 = Point(dispatch_14.ListA)
pt_44 = Point(dispatch_13.ListA)
pt_45 = Point(dispatch_13.ListB)
pt_46 = Point(dispatch_14.ListB)
merge_20 = Merge(Data1=item_57, Data2=item_58)
cull_i_14 = CullIndex(List=pt_43, Indices="0", Wrap=True)
cull_i_15 = CullIndex(List=pt_44, Indices="0", Wrap=True)
cull_i_16 = CullIndex(List=pt_44, Indices="-1", Wrap=True)
cull_i_17 = CullIndex(List=pt_43, Indices="-1", Wrap=True)
item_59 = ListItem(List=merge_20, Index="0", Wrap=True)
item_60 = ListItem(List=merge_20, Index="-1", Wrap=True)
pt_47 = Point(pull_20.ClosestPoint)

crv_10 = Curve(offset_8)
crv_11 = Curve(offset_5)
crv_12 = Curve(offset_7)
crv_13 = Curve(offset_6)

cull_i_18 = CullIndex(List=pt_17, Indices=c_script_4.specialPt, Wrap=True)  # -> graft(List)
# 阳部
item_61 = ListItem(List=flatten(merge_9), Index=0, Wrap=True)
ln_39 = Line(StartPoint=item_14, EndPoint=cull_i_18)
rotate_18 = Rotate(Geometry=ln_39, Angle=-1.570796327, Plane=item_14)  # -> Geometry, Transform
line_15 = Line(flatten(ln_39))
line_16 = Line(flatten(rotate_18.Geometry))
pl_21 = ConstructPlane(Origin=flatten(item_14), XAxis=line_16, YAxis=line_15)

filter_29 = StreamFilter(Gate=list_28, Stream0=item_61, Stream1=item_32, Stream2=item_61, Stream3=item_33)

bbox_9 = BoundingBox(Content=graft(filter_29), Plane=PlaneXY(0, 0, 0))  # -> Box, Box_2
srf_8 = Surface(bbox_9.Box)
explode_7 = Explode(Curve=srf_8, Recursive=True)  # -> Segments, Vertices
item_62 = ListItem(List=explode_7.Vertices, Index=0, Wrap=True)  # -> Item, Item1, Item2
ln_40 = Line(StartPoint=graft(item_62.Item1), EndPoint=graft(item_62.Item))
ln_41 = Line(StartPoint=graft(item_62.Item1), EndPoint=graft(item_62.Item2))
pt_48 = Point(item_62.Item1)
pl_22 = ConstructPlane(Origin=item_62.Item1, XAxis=ln_40, YAxis=ln_41)

pl_23 = ConstructPlane(Origin=pt_48, XAxis=ln_41, YAxis=ln_40)
filter_30 = StreamFilter(Gate=list_28, Stream0=pl_22, Stream1=pl_22, Stream2=pl_22, Stream3=pl_23)

orient_21 = Orient(Geometry=filter_29, Source=filter_30, Target=pl_21)  # -> Geometry, Transform
data_8 = Data(orient_21.Geometry)

merge_21 = Merge(Data1=data_8, Data2=merge_12, Data3=merge_10)
merge_22 = Merge(Data1=flatten(merge_21), Data2=flatten(merge_14))

# ----
# BAKE Geometry
panel_26 = Panel("test")
bake = BakeObjects(Geometry=merge_22, BakeName=panel_26, Bake=invert(False))

data_9 = Data(dispatch_11.ListA)
offcrv = OffsetCurve(Curve=merge_16, Plane=PlaneXY(0, 0, 0), Distance=Slider(3836, range=0..10000), BothSides=0, Kinks=0, CapType=1)  # -> flatten(Offset)
graft_11 = GraftTree(Tree=offcrv, IncludeEmptyLists=True, IncludeNullItems=True)
incurve_2 = PointInCurve(Point=data_9, Curve=graft_11)  # -> Relationship, Point
equals_3 = Equality(FirstNumber=incurve_2.Relationship, SecondNumber="2")  # -> Equality, Inequality
dispatch_15 = Dispatch(List=data_9, DispatchPattern=equals_3.Equality)  # -> ListA, ListB
pt_49 = Point(dispatch_15.ListA)
data_10 = Data(simplify(pt_49))
tstat = TreeStatistics(Tree=data_10)  # -> Paths, Length, Count
branch_10 = TreeBranch(Tree=data_10, Path="{0}", MaintainPaths=True)
branch_11 = TreeBranch(Tree=data_10, Path="{1}", MaintainPaths=True)
branch_12 = TreeBranch(Tree=data_10, Path="{2}", MaintainPaths=True)
branch_13 = TreeBranch(Tree=data_10, Path="{3}", MaintainPaths=True)
item_63 = ListItem(List=flatten(entwine_23), Index=0, Wrap=True)  # -> Item, Item1, Item2, Item3
pt_50 = Point(item_63.Item)
pt_51 = Point(item_63.Item3)
entwine_24 = Entwine(Branch00=crv_10, Branch01=crv_11, Branch02=crv_12, Branch03=crv_13, FlattenInputs=True)  # -> simplify(Result)
entwine_25 = Entwine(Branch00=pt_50, Branch01=pt_50, Branch02=pt_51, Branch03=pt_51, FlattenInputs=True)

pt_52 = Point(branch_13)
pt_53 = Point(branch_12)
pt_54 = Point(branch_11)
pt_55 = Point(branch_10)

entwine_26 = Entwine(Branch00=pt_54, Branch01=pt_55, Branch02=pt_53, Branch03=pt_52, FlattenInputs=True)
pull_25 = PullPoint(Point=entwine_26, Geometry=entwine_24, ClosestOnly=True)  # -> ClosestPoint, Distance
pull_26 = PullPoint(Point=pull_25.ClosestPoint, Geometry=entwine_25, ClosestOnly=True)  # -> ClosestPoint, Distance
sort_8 = SortList(Keys=pull_26.Distance, ValuesA=entwine_26)  # -> Keys, ValuesA
shift_6 = ShiftList(List=sort_8.ValuesA, Shift=1, Wrap=invert(True))
ln_42 = Line(StartPoint=sort_8.ValuesA, EndPoint=shift_6)
cull_i_19 = CullIndex(List=ln_42, Indices="-1", Wrap=True)
end_2 = EndPoints(Curve=cull_i_19)  # -> Start, End

crv_14 = Curve(entwine_24)
dispatch_16 = Dispatch(List=cull_i_19, DispatchPattern=[True, False])  # -> ListA, ListB
data_11 = Data(dispatch_16.ListB)
data_12 = Data(dispatch_16.ListA)
end_3 = EndPoints(Curve=data_11)  # -> Start, End
end_4 = EndPoints(Curve=data_12)  # -> Start, End
entwine_27 = Entwine(Branch00=crv_11, Branch01=crv_11, Branch02=crv_13, Branch03=crv_13, FlattenInputs=True)  # -> simplify(Result)
entwine_28 = Entwine(Branch00=crv_10, Branch01=crv_12, Branch02=crv_10, Branch03=crv_12, FlattenInputs=True)  # -> simplify(Result)
item_64 = ListItem(List=sort_8.ValuesA, Index="-1", Wrap=True)
item_65 = ListItem(List=sort_8.ValuesA, Index=0, Wrap=True)
merge_23 = Merge(Data1=item_65, Data2=item_64)  # -> flatten(Result)
line_17 = Line(entwine_27)
line_18 = Line(entwine_28)
pull_27 = PullPoint(Point=merge_20, Geometry=merge_23, ClosestOnly=True)  # -> ClosestPoint, Distance
offset_9 = OffsetCurve(Curve=entwine_24, Distance=expr("-x", number_slider_17), Corners=1)
offset_10 = OffsetCurve(Curve=line_17, Distance=expr("-x", number_slider_17), Corners=1)
offset_11 = OffsetCurve(Curve=line_18, Distance=expr("-x", number_slider_17), Corners=1)
item_66 = ListItem(List=pull_27.ClosestPoint, Index="0", Wrap=True)
item_67 = ListItem(List=pull_27.ClosestPoint, Index="-1", Wrap=True)
pt_56 = Point(simplify(pull_27.ClosestPoint))
ln_43 = Line(StartPoint=item_66, EndPoint=item_59)
pull_28 = PullPoint(Point=pt_56, Geometry=pt_47, ClosestOnly=True)  # -> ClosestPoint, Distance
pt_57 = Point(simplify(pull_28.ClosestPoint))
item_68 = ListItem(List=pt_57, Index=0, Wrap=True)
item_69 = ListItem(List=pt_56, Index=0, Wrap=True)
item_70 = ListItem(List=pt_57, Index="-1", Wrap=True)
item_71 = ListItem(List=pt_56, Index="-1", Wrap=True)

pt_58 = Point(end_3.End)
crv_15 = Curve(crv_14)
pt_59 = Point(end_4.Start)
pt_60 = Point(end_4.End)
crv_16 = Curve(offset_9)
pt_61 = Point(end_3.Start)

crv_17 = Curve(line_17)
pt_62 = Point(item_68)
pt_63 = Point(item_69)
crv_18 = Curve(line_18)
pt_64 = Point(item_69)
crv_19 = Curve(line_18)
pt_65 = Point(item_70)
crv_20 = Curve(offset_10)
pt_66 = Point(item_70)
pt_67 = Point(item_71)
pt_68 = Point(item_68)
pt_69 = Point(item_71)

crv_21 = Curve(offset_11)
pt_70 = Point(item_66)
pt_71 = Point(item_59)
crv_22 = Curve(line_18)
pt_72 = Point(cull_i_16)
pt_73 = Point(pt_45)
crv_23 = Curve(offset_10)
pt_74 = Point(item_67)
pt_75 = Point(item_60)
crv_24 = Curve(offset_10)
pt_76 = Point(cull_i_17)
pt_77 = Point(pt_46)
crv_25 = Curve(line_14)
pt_78 = Point(pt_46)
pt_79 = Point(cull_i_14)
pt_80 = Point(cull_i_15)
crv_26 = Curve(offset_11)
pt_81 = Point(pt_45)

pull_29 = PullPoint(Point=pt_59, Geometry=crv_15, ClosestOnly=True)  # -> ClosestPoint, Distance
ln_44 = Line(StartPoint=pt_59, EndPoint=pull_29.ClosestPoint)
len_5 = Length(Curve=ln_44)
pl_24 = ConstructPlane(Origin=pt_59, XAxis=ln_44, YAxis=Vector(0, 1, 0))
deplane = DeconstructPlane(Plane=pl_24)  # -> Origin, XAxis, YAxis, ZAxis
pl_25 = ConstructPlane(Origin=deplane.Origin, XAxis=deplane.YAxis, YAxis=deplane.XAxis)

pull_30 = PullPoint(Point=pt_61, Geometry=crv_16, ClosestOnly=True)  # -> ClosestPoint, Distance
ln_45 = Line(StartPoint=pt_61, EndPoint=pull_30.ClosestPoint)
len_6 = Length(Curve=ln_45)
pl_26 = ConstructPlane(Origin=pt_61, XAxis=ln_45, YAxis=Vector(0, 1, 0))
deplane_2 = DeconstructPlane(Plane=pl_26)  # -> Origin, XAxis, YAxis, ZAxis
pl_27 = ConstructPlane(Origin=deplane_2.Origin, XAxis=deplane_2.YAxis, YAxis=deplane_2.XAxis)

pull_31 = PullPoint(Point=pt_65, Geometry=crv_19, ClosestOnly=True)  # -> ClosestPoint, Distance
ln_46 = Line(StartPoint=pt_65, EndPoint=pull_31.ClosestPoint)
len_7 = Length(Curve=ln_46)
pl_28 = ConstructPlane(Origin=pt_65, XAxis=ln_46, YAxis=Vector(0, 1, 0))
deplane_3 = DeconstructPlane(Plane=pl_28)  # -> Origin, XAxis, YAxis, ZAxis
pl_29 = ConstructPlane(Origin=deplane_3.Origin, XAxis=deplane_3.YAxis, YAxis=deplane_3.XAxis)

pull_32 = PullPoint(Point=pt_68, Geometry=crv_18, ClosestOnly=True)  # -> ClosestPoint, Distance
ln_47 = Line(StartPoint=pt_68, EndPoint=pull_32.ClosestPoint)
len_8 = Length(Curve=ln_47)
pl_30 = ConstructPlane(Origin=pt_68, XAxis=ln_47, YAxis=Vector(0, 1, 0))
deplane_4 = DeconstructPlane(Plane=pl_30)  # -> Origin, XAxis, YAxis, ZAxis
pl_31 = ConstructPlane(Origin=deplane_4.Origin, XAxis=deplane_4.YAxis, YAxis=deplane_4.XAxis)

pull_33 = PullPoint(Point=pt_62, Geometry=crv_17, ClosestOnly=True)  # -> ClosestPoint, Distance
ln_48 = Line(StartPoint=pt_62, EndPoint=pull_33.ClosestPoint)
len_9 = Length(Curve=ln_48)
pl_32 = ConstructPlane(Origin=pt_62, XAxis=ln_48, YAxis=Vector(0, 1, 0))
deplane_5 = DeconstructPlane(Plane=pl_32)  # -> Origin, XAxis, YAxis, ZAxis
pl_33 = ConstructPlane(Origin=deplane_5.Origin, XAxis=deplane_5.YAxis, YAxis=deplane_5.XAxis)

pull_34 = PullPoint(Point=pt_66, Geometry=crv_20, ClosestOnly=True)  # -> ClosestPoint, Distance
ln_49 = Line(StartPoint=pt_66, EndPoint=pull_34.ClosestPoint)
pl_34 = ConstructPlane(Origin=pt_66, XAxis=ln_49, YAxis=Vector(0, 1, 0))
len_10 = Length(Curve=ln_49)
deplane_6 = DeconstructPlane(Plane=pl_34)  # -> Origin, XAxis, YAxis, ZAxis
pl_35 = ConstructPlane(Origin=deplane_6.Origin, XAxis=deplane_6.YAxis, YAxis=deplane_6.XAxis)

pull_35 = PullPoint(Point=pt_74, Geometry=crv_23, ClosestOnly=True)  # -> ClosestPoint, Distance
ln_50 = Line(StartPoint=pt_74, EndPoint=pull_35.ClosestPoint)
pl_36 = ConstructPlane(Origin=pt_74, XAxis=ln_50, YAxis=Vector(0, 1, 0))
len_11 = Length(Curve=ln_50)
deplane_7 = DeconstructPlane(Plane=pl_36)  # -> Origin, XAxis, YAxis, ZAxis
pl_37 = ConstructPlane(Origin=deplane_7.Origin, XAxis=deplane_7.YAxis, YAxis=deplane_7.XAxis)

pull_36 = PullPoint(Point=pt_76, Geometry=crv_24, ClosestOnly=True)  # -> ClosestPoint, Distance
ln_51 = Line(StartPoint=pt_76, EndPoint=pull_36.ClosestPoint)
pl_38 = ConstructPlane(Origin=pt_76, XAxis=ln_51, YAxis=Vector(0, 1, 0))
len_12 = Length(Curve=ln_51)
deplane_8 = DeconstructPlane(Plane=pl_38)  # -> Origin, XAxis, YAxis, ZAxis
pl_39 = ConstructPlane(Origin=deplane_8.Origin, XAxis=deplane_8.YAxis, YAxis=deplane_8.XAxis)

pull_37 = PullPoint(Point=pt_78, Geometry=crv_25, ClosestOnly=True)  # -> ClosestPoint, Distance
ln_52 = Line(StartPoint=pt_78, EndPoint=pull_37.ClosestPoint)
pl_40 = ConstructPlane(Origin=pt_78, XAxis=ln_52, YAxis=Vector(0, 1, 0))
len_13 = Length(Curve=ln_52)
deplane_9 = DeconstructPlane(Plane=pl_40)  # -> Origin, XAxis, YAxis, ZAxis
pl_41 = ConstructPlane(Origin=deplane_9.Origin, XAxis=deplane_9.YAxis, YAxis=deplane_9.XAxis)

pull_38 = PullPoint(Point=pt_70, Geometry=crv_21, ClosestOnly=True)  # -> ClosestPoint, Distance
ln_53 = Line(StartPoint=pt_70, EndPoint=pull_38.ClosestPoint)
pl_42 = ConstructPlane(Origin=pt_70, XAxis=ln_53, YAxis=Vector(0, 1, 0))
len_14 = Length(Curve=ln_53)
deplane_10 = DeconstructPlane(Plane=pl_42)  # -> Origin, XAxis, YAxis, ZAxis
pl_43 = ConstructPlane(Origin=deplane_10.Origin, XAxis=deplane_10.YAxis, YAxis=deplane_10.XAxis)

pull_39 = PullPoint(Point=pt_72, Geometry=crv_22, ClosestOnly=True)  # -> ClosestPoint, Distance
ln_54 = Line(StartPoint=pt_72, EndPoint=pull_39.ClosestPoint)
pl_44 = ConstructPlane(Origin=pt_72, XAxis=ln_54, YAxis=Vector(0, 1, 0))
len_15 = Length(Curve=ln_54)
deplane_11 = DeconstructPlane(Plane=pl_44)  # -> Origin, XAxis, YAxis, ZAxis
pl_45 = ConstructPlane(Origin=deplane_11.Origin, XAxis=deplane_11.YAxis, YAxis=deplane_11.XAxis)

pull_40 = PullPoint(Point=pt_81, Geometry=crv_26, ClosestOnly=True)  # -> ClosestPoint, Distance
ln_55 = Line(StartPoint=pt_81, EndPoint=pull_40.ClosestPoint)
pl_46 = ConstructPlane(Origin=pt_81, XAxis=ln_55, YAxis=Vector(0, 1, 0))
len_16 = Length(Curve=ln_55)
deplane_12 = DeconstructPlane(Plane=pl_46)  # -> Origin, XAxis, YAxis, ZAxis
pl_47 = ConstructPlane(Origin=deplane_12.Origin, XAxis=deplane_12.YAxis, YAxis=deplane_12.XAxis)

# ----
# 直线
define_linear_dimension = DefineLinearDimension(Point1=pt_59, Point2=pt_60, DimensionPlane=pl_25, Offset=len_5, DimensionStyle="图例2-地上$0$XD100$0")  # -> flatten(LinearDimension)
define_linear_dimension_2 = DefineLinearDimension(Point1=pt_61, Point2=pt_58, DimensionPlane=pl_27, Offset=len_6, DimensionStyle="图例2-地上$0$XD100$0")  # -> flatten(LinearDimension)

# ----
# 轴线相对位置
define_linear_dimension_3 = DefineLinearDimension(Point1=pt_62, Point2=pt_63, DimensionPlane=pl_33, Offset=len_9, DimensionStyle="图例2-地上$0$XD100$0")  # -> flatten(LinearDimension)
define_linear_dimension_4 = DefineLinearDimension(Point1=pt_68, Point2=pt_64, DimensionPlane=pl_31, Offset=len_8, DimensionStyle="图例2-地上$0$XD100$0")  # -> flatten(LinearDimension)
define_linear_dimension_5 = DefineLinearDimension(Point1=pt_65, Point2=pt_69, DimensionPlane=pl_29, Offset=len_7, DimensionStyle="图例2-地上$0$XD100$0")  # -> flatten(LinearDimension)
define_linear_dimension_6 = DefineLinearDimension(Point1=pt_66, Point2=pt_67, DimensionPlane=pl_35, Offset=len_10, DimensionStyle="图例2-地上$0$XD100$0")  # -> flatten(LinearDimension)

# ----
# 角部
define_linear_dimension_7 = DefineLinearDimension(Point1=pt_74, Point2=pt_75, DimensionPlane=pl_37, Offset=len_11, DimensionStyle="图例2-地上$0$XD100$0")  # -> flatten(LinearDimension)
define_linear_dimension_8 = DefineLinearDimension(Point1=pt_76, Point2=pt_77, DimensionPlane=pl_39, Offset=len_12, DimensionStyle="图例2-地上$0$XD100$0")  # -> flatten(LinearDimension)
define_linear_dimension_9 = DefineLinearDimension(Point1=pt_78, Point2=pt_79, DimensionPlane=pl_41, Offset=len_13, DimensionStyle="图例2-地上$0$XD100$0")  # -> flatten(LinearDimension)
define_linear_dimension_10 = DefineLinearDimension(Point1=pt_70, Point2=pt_71, DimensionPlane=pl_43, Offset=len_14, DimensionStyle="图例2-地上$0$XD100$0")  # -> flatten(LinearDimension)
define_linear_dimension_11 = DefineLinearDimension(Point1=pt_72, Point2=pt_73, DimensionPlane=pl_45, Offset=len_15, DimensionStyle="图例2-地上$0$XD100$0")  # -> flatten(LinearDimension)
define_linear_dimension_12 = DefineLinearDimension(Point1=pt_81, Point2=pt_80, DimensionPlane=pl_47, Offset=len_16, DimensionStyle="图例2-地上$0$XD100$0")  # -> flatten(LinearDimension)

entwine_29 = Entwine(
    Branch00=define_linear_dimension,
    Branch01=define_linear_dimension_2,
    Branch02=define_linear_dimension_3,
    Branch03=define_linear_dimension_4,
    Branch04=define_linear_dimension_5,
    Branch05=define_linear_dimension_6,
    Branch06=define_linear_dimension_7,
    Branch07=define_linear_dimension_8,
    Branch08=define_linear_dimension_9,
    Branch09=define_linear_dimension_10,
    Branch010=define_linear_dimension_11,
    Branch011=define_linear_dimension_12,
    FlattenInputs=True)

# ----
# 标注-埋件位置
bake_objects = BakeObjects(Geometry=entwine_29, Attributes=define_object_attributes_2, BakeName="dimension", Bake=False)

join_2 = JoinCurves(Curves=crv_3, Preserve=False)
end_5 = EndPoints(Curve=join_2)  # -> Start, End
pline_8 = PolyLine(Vertices=flatten(pt_13), Closed=invert(False))
ln_56 = Line(StartPoint=end_5.Start, EndPoint=end_5.End)
offset_12 = OffsetCurve(Curve=pline_8, Distance=number_slider_15, Corners=1)
clx_6 = CurveLine(Curve=offset_12, Line=ln_56)  # -> Points, Params, Count
item_72 = ListItem(List=clx_6.Points, Index=0, Wrap=True)  # -> Item, Item1
crv_27 = Curve(crv_10)
ln_57 = Line(StartPoint=item_72.Item, EndPoint=item_72.Item1)
amp_10 = Amplitude(Vector=crv_27, Amplitude=Slider(200, range=0..1000))
move_44 = Move(Geometry=ln_57, Motion=amp_10)  # -> Geometry, Transform

merge_24 = Merge(Data1=ln_57, Data2=move_44.Geometry)
ccx = CurveCurve(CurveA=offset_12, CurveB=merge_24)  # -> flatten(Points), ParamsA, ParamsB
split_2 = CurveSplit(Curve=offset_12, Object=ccx.Points, Tolerance=1)  # -> flatten(Curve)

len_17 = Length(Curve=split_2)
sort_9 = SortList(Keys=reverse(len_17), ValuesA=split_2)  # -> Keys, ValuesA
item_73 = ListItem(List=sort_9.ValuesA, Index=0, Wrap=True)  # -> Item, Item1

# ----
# 埋件大类标注
join_3 = JoinCurves(Curves=flatten([item_73.Item, item_73.Item1, ln_57, move_44.Geometry]), Preserve=False)
crv_28 = Curve(offset_4)
merge_25 = Merge(Data1=item_50, Data2=item_48, Data3=item_49, Data4=item_51)
filter_31 = StreamFilter(Gate=list_28, Stream0=join_3, Stream1=crv_28, Stream2=crv_28, Stream3=crv_28)
eval = EvaluateCurve(Curve=reparameterize(filter_31), Parameter=Slider(0.64, range=0..1))  # -> Point, Tangent, Angle
pt_82 = Point(graft(eval.Point))
crv_29 = Curve(crv_3)
pull_41 = PullPoint(Point=flatten(pt_82), Geometry=crv_29, ClosestOnly=True)  # -> ClosestPoint, Distance
number_slider_24 = Slider(1529, range=0..10000)
sort_10 = SortList(Keys=pull_41.Distance, ValuesA=flatten(pt_82))  # -> Keys, simplify(graft(ValuesA))
cir = Circle(Plane=merge_25, Radius=Slider(595, range=0..10000))
crv_30 = Curve(offset_12)
offset_13 = OffsetCurve(Curve=crv_30, Distance=number_slider_16, Corners=1)
crv_cp_5 = CurveClosestPoint(Point=merge_25, Curve=offset_13)  # -> Point, Parameter, Distance
crv_cp_6 = CurveClosestPoint(Point=crv_cp_5.Point, Curve=cir)  # -> Point, Parameter, Distance
merge_26 = Merge(Data1=crv_cp_6.Point, Data2=crv_cp_5.Point)
crv_cp_7 = CurveClosestPoint(Point=sort_10.ValuesA, Curve=offset_13)  # -> simplify(Point), Parameter, Distance
merge_27 = Merge(Data1=sort_10.ValuesA, Data2=crv_cp_7.Point)
flatten_8 = FlattenTree(Tree=merge_27, Path="{0}")
filter_32 = StreamFilter(Gate=list_28, Stream0=merge_27, Stream1=flatten_8, Stream2=flatten_8, Stream3=flatten_8)
dash = DashPattern(Curve=cir, Pattern=number_slider_14)  # -> Dashes, Gaps
txt = Text("2-2")
txt_2 = Text("1-1")
txt_3 = Text("3-3")
txt_4 = Text("4-4")
entwine_30 = Entwine(Branch00=txt, Branch01=txt_2, FlattenInputs=True)
filter_33 = StreamFilter(Gate=list_29, Stream0=cir, Stream1=dash.Dashes)
leader = DefineLeader(Text=txt_4, Points=merge_26, Plane=PlaneXY(0, 0, 0), DimensionStyle=panel_16)
filter_34 = StreamFilter(Gate=list_28, Stream0=entwine_30, Stream1=txt_2, Stream2=txt, Stream3=txt_3)
leader_2 = DefineLeader(Text=filter_34, Points=filter_32, Plane=PlaneXY(0, 0, 0), DimensionStyle=panel_16)

offset_14 = OffsetCurve(Curve=item_73.Item1, Distance=expr("-x", number_slider_24), Corners=1)
offset_15 = OffsetCurve(Curve=item_73.Item, Distance=expr("-x", number_slider_24), Corners=1)
end_6 = EndPoints(Curve=item_73.Item)  # -> Start, End
end_7 = EndPoints(Curve=offset_15)  # -> Start, End
end_8 = EndPoints(Curve=item_73.Item1)  # -> Start, End
end_9 = EndPoints(Curve=offset_14)  # -> Start, End
ln_58 = Line(StartPoint=end_7.Start, EndPoint=end_6.Start)
ln_59 = Line(StartPoint=end_7.End, EndPoint=end_6.End)
ln_60 = Line(StartPoint=end_9.Start, EndPoint=end_8.Start)
ln_61 = Line(StartPoint=end_9.End, EndPoint=end_8.End)
merge_28 = Merge(Data1=offset_15, Data2=ln_58, Data3=ln_59, Data4=item_73.Item)
merge_29 = Merge(Data1=offset_14, Data2=ln_60, Data3=ln_61, Data4=item_73.Item1)

merge_30 = Merge(Data1=merge_28, Data2=merge_29)
filter_35 = StreamFilter(Gate=list_28, Stream0=merge_30, Stream1=crv_28, Stream2=crv_28, Stream3=crv_28)
dash_2 = DashPattern(Curve=filter_35, Pattern=number_slider_14)  # -> Dashes, Gaps
crv_31 = Curve(dash_2.Dashes)
filter_36 = StreamFilter(Gate=list_29, Stream0=filter_35, Stream1=crv_31)

merge_31 = Merge(Data1=filter_36, Data2=leader_2)
merge_32 = Merge(Data1=leader, Data2=filter_33)

merge_33 = Merge(Data1=merge_31, Data2=merge_32)

# ----
# 标注-埋件大类
bake_objects_2 = BakeObjects(Geometry=merge_33, Attributes=define_object_attributes, BakeName="标注大类", Bake=False)

cull_i_20 = CullIndex(List=boundary_6, Indices=findbrepintersect_3.BrepInters, Wrap=True)
area_6 = Area(Geometry=cull_i_20)  # -> Area, Centroid
crv_32 = Curve(crv_4)
disc_12 = Discontinuity(Curve=crv_32, Level=1)  # -> Points, Parameters
pull_42 = PullPoint(Point=area_6.Centroid, Geometry=crv_32, ClosestOnly=True)  # -> ClosestPoint, Distance
pull_43 = PullPoint(Point=pull_42.ClosestPoint, Geometry=disc_12.Points, ClosestOnly=True)  # -> ClosestPoint, Distance
ln_62 = Line(StartPoint=pull_42.ClosestPoint, EndPoint=area_6.Centroid)
ln_63 = Line(StartPoint=pull_42.ClosestPoint, EndPoint=pull_43.ClosestPoint)

deblock = DeconstructBlock(Block=data_5)  # -> Name, Plane, Geometry
deplane_13 = DeconstructPlane(Plane=deblock.Plane)  # -> Origin, XAxis, YAxis, ZAxis
pull_44 = PullPoint(Point=deplane_13.Origin, Geometry=crv_32, ClosestOnly=True)  # -> ClosestPoint, Distance
ln_64 = Line(StartPoint=deplane_13.Origin, EndPoint=pull_44.ClosestPoint)
move_45 = Move(Geometry=deblock.Plane, Motion=ln_64)  # -> Geometry, Transform
amp_11 = Amplitude(Vector=deplane_13.YAxis, Amplitude=number_slider_13)
move_46 = Move(Geometry=move_45.Geometry, Motion=amp_11)  # -> Geometry, Transform

deblock_2 = DeconstructBlock(Block=data_8)  # -> Name, Plane, Geometry
deplane_14 = DeconstructPlane(Plane=deblock_2.Plane)  # -> Origin, XAxis, YAxis, ZAxis
pull_45 = PullPoint(Point=deplane_14.Origin, Geometry=crv_32, ClosestOnly=True)  # -> ClosestPoint, Distance
ln_65 = Line(StartPoint=deplane_14.Origin, EndPoint=pull_45.ClosestPoint)
move_47 = Move(Geometry=deblock_2.Plane, Motion=ln_65)  # -> Geometry, Transform
amp_12 = Amplitude(Vector=deplane_14.YAxis, Amplitude=number_slider_13)
move_48 = Move(Geometry=move_47.Geometry, Motion=amp_12)  # -> Geometry, Transform

deblock_3 = DeconstructBlock(Block=cull_i_6)  # -> Name, Plane, Geometry
rotate_19 = Rotate(Geometry=ln_31, Angle=1.570796327, Plane=pull_13.ClosestPoint)  # -> Geometry, Transform
amp_13 = Amplitude(Vector=ln_62, Amplitude=number_slider_13)
move_49 = Move(Geometry=pull_42.ClosestPoint, Motion=amp_13)  # -> Geometry, Transform
text = DefineTextObject(Text=filter_20, Plane=move_48.Geometry, DimensionStyle="图例2-地上$0$XD100$0", OutputType="Text")
text_2 = DefineTextObject(Text="MJ-04", Plane=pl_20, DimensionStyle="图例2-地上$0$XD100$0", OutputType="Text")
text_3 = DefineTextObject(Text=filter_19, Plane=move_46.Geometry, DimensionStyle="图例2-地上$0$XD100$0", OutputType="Text")
text_4 = DefineTextObject(Text=filter_19, Plane=pl_18, DimensionStyle="图例2-地上$0$XD100$0", OutputType="Text")
text_5 = DefineTextObject(Text="MJ-04", Plane=pl_16, DimensionStyle="图例2-地上$0$XD100$0", OutputType="Text")
text_6 = DefineTextObject(Text="MJ-04", Plane=pl_17, DimensionStyle="图例2-地上$0$XD100$0", OutputType="Text")
text_7 = DefineTextObject(Text=filter_19, Plane=pl_19, DimensionStyle="图例2-地上$0$XD100$0", OutputType="Text")

deplane_15 = DeconstructPlane(Plane=deblock_3.Plane)  # -> Origin, XAxis, YAxis, ZAxis
pull_46 = PullPoint(Point=deplane_15.Origin, Geometry=crv_32, ClosestOnly=True)  # -> ClosestPoint, Distance
ln_66 = Line(StartPoint=deplane_15.Origin, EndPoint=pull_46.ClosestPoint)
move_50 = Move(Geometry=deblock_3.Plane, Motion=ln_66)  # -> Geometry, Transform
amp_14 = Amplitude(Vector=deplane_15.YAxis, Amplitude=number_slider_13)
move_51 = Move(Geometry=move_50.Geometry, Motion=amp_14)  # -> Geometry, Transform

amp_15 = Amplitude(Vector=ln_31, Amplitude=number_slider_13)
move_52 = Move(Geometry=simplify(pull_13.ClosestPoint), Motion=amp_15)  # -> Geometry, Transform
pl_48 = ConstructPlane(Origin=move_52.Geometry, XAxis=rotate_19.Geometry, YAxis=ln_31)

pl_49 = ConstructPlane(Origin=move_49.Geometry, XAxis=ln_63, YAxis=ln_62)  # -> flatten(Plane)

text_8 = DefineTextObject(Text=filter_20, Plane=pl_49, DimensionStyle="图例2-地上$0$XD100$0", OutputType="Text")
text_9 = DefineTextObject(Text="MJ-04", Plane=pl_48, DimensionStyle="图例2-地上$0$XD100$0", OutputType="Text")
text_10 = DefineTextObject(Text=filter_20, Plane=move_51.Geometry, DimensionStyle="图例2-地上$0$XD100$0", OutputType="Text")

merge_34 = Merge(
    Data1=text,
    Data2=text_8,
    Data3=text_9,
    Data4=text_10,
    Data5=text_2,
    Data6=text_3,
    Data7=text_4,
    Data8=text_5,
    Data9=text_6,
    Data10=text_7)

# ----
# 标注-埋件编号
bake_objects_3 = BakeObjects(Geometry=merge_34, Attributes=define_object_attributes_3, BakeName="number", Bake=False)

# ==== cluster Cluster
G = ClusterInput()
rotate = Rotate(Geometry=G, Angle=3.141592654, Plane=PlaneXY(0, 0, 0))  # -> Geometry, Transform
boxprop = BoxProperties(Box=rotate.Geometry)  # -> Center, Diagonal, Area, Volume, Degeneracy
bbox = BoundingBox(Content=rotate.Geometry, Plane=PlaneXY(0, 0, 0))  # -> Box, Box_2
debox = DeconstructBox(Box=bbox.Box)  # -> Plane, X, Y, Z
pdecon = Deconstruct(Point=boxprop.Center)  # -> XComponent, YComponent, ZComponent
dedomain = DeconstructDomain(Domain=debox.Y)  # -> Start, End
pt = ConstructPoint(XCoordinate=pdecon.XComponent, YCoordinate=dedomain.Start, ZCoordinate=pdecon.ZComponent)
xy = XYPlane(Origin=Point(0, 0, 0))
pl_origin = PlaneOrigin(Base=xy, Origin=pt)
orient = Orient(Geometry=rotate.Geometry, Source=pl_origin, Target=xy)  # -> Geometry, Transform
G_2 = ClusterOutput(orient.Geometry)
