# Grasshopper definition findEmbedmentAxis.gh (Grasshopper 1.0.7)
# Copyright: Arup
# plug-ins: EleFront, Hare

# ---- group: Closed Outline Curve
crv = Curve(<curve referenced from the Rhino model>)

# ----
# Step 1 : input埋件定位点+梁线+闭合的轮廓线
circle = Curve(<curve referenced from the Rhino model>)

# ---- group: Beam Curve
crv_2 = Curve(<curve referenced from the Rhino model>)

# ----
# Step 3（Optional) :
# 调整参考轴线的位置和方向
# 然后点击Update
panel = Panel("Embed-YAxis")
reflay = ReferenceByLayer(LayerName=panel)

crv_3 = Curve(reflay)
end = EndPoints(Curve=graft(crv_3))  # -> Start, End
merge = Merge(Data1=end.Start, Data2=end.End)
pull = PullPoint(Point=merge, Geometry=crv, ClosestOnly=True)  # -> ClosestPoint, Distance
sort = SortList(Keys=pull.Distance, ValuesA=merge)  # -> Keys, ValuesA
item = ListItem(List=sort.ValuesA, Index=0, Wrap=True)
item_2 = ListItem(List=sort.ValuesA, Index="-1", Wrap=True)
pt = Point(item_2)
pt_2 = Point(item)
ln = Line(StartPoint=pt_2, EndPoint=pt)
rotate = Rotate(Geometry=ln, Angle=1.570796327, Plane=pt_2)  # -> Geometry, Transform
pl = ConstructPlane(Origin=pt_2, XAxis=rotate.Geometry, YAxis=ln)

# ----
# 最终生成的定位点Plane
pln = Plane(pl)

layer = ObjectLayer(Guid=circle)  # -> LayerIndex, LayerPathName
layer_2 = ObjectLayer(Guid=crv_2)  # -> LayerIndex, LayerPathName
reflay_2 = ReferenceByLayer(LayerName=layer.LayerPathName)
reflay_3 = ReferenceByLayer(LayerName=layer_2.LayerPathName)
area = Area(Geometry=reflay_2)  # -> Area, Centroid
crv_4 = Curve(reflay_3)
pull_2 = PullPoint(Point=area.Centroid, Geometry=crv_4, ClosestOnly=True)  # -> ClosestPoint, Distance
layer_3 = DefineLayer(Name=panel)
attributes = DefineObjectAttributes(Layer=layer_3)

# ---- group: Y Axis Line
ln_2 = Line(StartPoint=area.Centroid, EndPoint=pull_2.ClosestPoint)

# ----
# Step 2 :点击Bake
# 生成参考轴线在Embed-YAxis图层
bake = BakeObjects(Geometry=ln_2, Attributes=attributes, BakeName=panel, Bake=False)

rotate_2 = Rotate(Geometry=ln_2, Angle=1.570796327, Plane=area.Centroid)  # -> Geometry, Transform

# ---- group: Plane
pl_2 = ConstructPlane(Origin=area.Centroid, XAxis=ln_2, YAxis=rotate_2.Geometry)
