# Grasshopper definition TEST.gh (Grasshopper 1.0.7)
# Copyright: Arup
# plug-ins: EleFront

panel = Panel("BLOCKinput")
crv = Curve(<curve referenced from the Rhino model>)
disc = Discontinuity(Curve=crv, Level=1)  # -> Points, Parameters
listblockd = ListBlockDocument()
txt = Text("PX-GLAZ-F2$0$PX-GLAZ-F1$0$标准块")
panel_2 = Panel(txt)
refblock = ReferenceBlockByName(BlockName=panel_2)
deblock = DeconstructBlock(Block=refblock)  # -> Name, Plane, Geometry
item = ListItem(List=listblockd, Index="157", Wrap=True)
panel_3 = Panel(item)
panel_4 = Panel(listblockd)
