# Grasshopper definition embedSteel.gh (Grasshopper 1.0.7)
# plug-ins: TT Toolbox, Human, EF - R7 Beta

# ----
# 钢埋板长度（按需设定）
number_slider = Slider(350, range=0..1000)

# ----
# 钢埋板厚度（按需设定）
number_slider_2 = Slider(16, range=0..100)

图纸比例 = Slider(5, range=0..10)

# ----
# 肋板倒角距离（按需设定）
number_slider_3 = Slider(30, range=0..100)

# ----
# 钢结构截面列表
txt = Text(["GL2A-1\tHN 250x125x6x9\t\tQ235B\t热轧", "GL3-1\tHN 300x150x6.5x9\t\tQ235B\t热轧", "GL3-2\tH 300x100x8x10\t\tQ235B\t焊接H型", "GL3-3\tH 300x200x8x16\t\tQ355B\t焊接H型", "GL3-4\tHW 300x300x10x15\t\tQ355B\t热轧", "GL4-1\tHN 400x200x8x13\t\tQ355B\t热轧", "GL4-2\tH 400x200x10x16\t\tQ355B\t焊接H型", "GL4-3\tH 400x250x10x20\t\tQ355B\t焊接H型", "GL4-4\tH 400x350x16x35\t\tQ355B\t焊接H型", "GL4a-1\tH 450x200x9x14\t\tQ355B\t热轧", "GL5-1\tHN 500x200x10x16\t\tQ355B\t热轧", "GL5-2\tH 500x200x10x20\t\tQ355B\t焊接H型", "GL5-3\tH 500x300x14x20\t\tQ355B\t焊接H型", "GL5a-1\tH 550x250x10x25\t\tQ355B\t焊接H型", "GL5a-2\tH 550x300x14x25\t\tQ355B\t焊接H型", "GL6-1\tHN 600x200x11x17\t\tQ355B\t热轧", "GL6-2\tH 600x300x12x20\t\tQ355B\t焊接H型", "GL6-3\tH 600x350x12x25\t\tQ355B\t焊接H型", "GL6-4\tH 600x350x16x35\t\tQ355B\t焊接H型", "GL7-1\tHN 700x300x13x24\t\tQ355B\t热轧", "GL7-2\tH 700x350x14x30\t\tQ355B\t焊接H型", "GL7-3\tH 700x350x14x35\t\tQ355B\t焊接H型", "GL8-1\tHN 800x300x14x26\t\tQ355B\t热轧", "GL8-2\tH 800x300x20x40\t\tQ345GJB\t焊接H型", "GL9-1\tH 900x300x20x30\t\tQ355B\t焊接H型", "GL9-2\tH 900x400x20x40\t\tQ345GJB\t焊接H型", "GL10-1\tH 1000x400x20x30\t\tQ355B\t焊接H型", "GL10-2\tH 1000x500x20x30\t\tQ355B\t焊接H型", "GL10-3\tH 1000x500x20x35\t\tQ355B\t焊接H型", "GL10-4\tH 1000x400x20x40\t\tQ345GJB\t焊接H型", "GL10-5\tH 1000x500x20x40\t\tQ345GJB\t焊接H型", "GL10-6\t□ 1000x400x20x40\t\tQ345GJB\t焊接箱型", "GL12-1\tH 1200x400x25x50\t\tQ345GJB\t焊接H型"])

# ----
# 需要出图的钢结构编号
panel = Panel("GL10-1")

# ----
# 列表文字以空格进行分割
panel_2 = Panel(" ")
split = TextSplit(Text=txt, Separators=panel_2)

钢埋板长度_2 = Division(A=number_slider, B=2)
neg = Negative(Value=钢埋板长度_2)
dom = ConstructDomain(DomainStart=neg, DomainEnd=钢埋板长度_2)
panel_3 = Panel(dom)

钢埋板厚度_2 = Division(A=number_slider_2, B=2)
neg_2 = Negative(Value=钢埋板厚度_2)
dom_2 = ConstructDomain(DomainStart=neg_2, DomainEnd=钢埋板厚度_2)
panel_4 = Panel(dom_2)

# ----
# 钢埋板肋板位置 1/4处
panel_5 = Panel("4")
division = Division(A=number_slider, B=panel_5)

# ----
# 编号和截面尺寸分区
panel_6 = Panel("1")
split_2 = SplitList(List=split, Index=panel_6)  # -> flatten(ListA), flatten(ListB)

焊缝高度_埋板厚度_2 = 焊缝高度埋板厚度2(A=number_slider_2)

# ----
# 求出对应输入编号的钢结构截面尺寸
fsim = FindSimilarMember(Data=panel, Set=split_2.ListA)  # -> Hit, Index
item = ListItem(List=split_2.ListB, Index=fsim.Index, Wrap=True)

panel_7 = Panel(split_2.ListB)
钢结构截面尺寸 = 钢结构截面尺寸(T=item)
addition = Addition(A=neg_2, B=division)
addition_2 = Addition(A=钢埋板厚度_2, B=division)
dom_3 = ConstructDomain(DomainStart=addition, DomainEnd=addition_2)
cluster = Cluster(L=钢结构截面尺寸, L_2=钢结构截面尺寸, L_4=钢结构截面尺寸, L_3=钢结构截面尺寸)  # -> i, i_2, i_4, i_3

# ----
# 钢埋板高度，工字钢尺寸决定
panel_8 = Panel("2")
division_2 = Division(A=cluster.i, B=panel_8)
subtraction = Subtraction(A=division_2, B=cluster.i_3)
neg_3 = Negative(Value=subtraction)
dom_4 = ConstructDomain(DomainStart=neg_3, DomainEnd=subtraction)

钢肋板_侧视图 = 钢肋板侧视图_2(
    B_11=number_slider_2,
    A_7=cluster.i_2,
    Y=dom_3,
    B_12=cluster.i_4,
    B_13=钢埋板厚度_2,
    B=number_slider_3,
    A=addition,
    B_2=addition_2,
    A_2=division,
    B_3=钢埋板厚度_2,
    x=钢埋板厚度_2,
    A_3=division,
    B_4=number_slider_2,
    B_5=钢埋板厚度_2,
    x_2=钢埋板厚度_2,
    A_4=division,
    B_6=number_slider_2,
    B_7=钢埋板厚度_2,
    x_3=钢埋板厚度_2,
    B_8=number_slider_2,
    x_4=钢埋板厚度_2,
    A_5=division,
    B_9=钢埋板厚度_2,
    A_6=division,
    B_10=钢埋板厚度_2,
    x_5=钢埋板厚度_2)  # -> R, G, R_2
钢埋板_侧视图 = Rectangle(Plane=PlaneXY(0, 0, 0), XSize=dom_2, YSize=dom, Radius=0)  # -> Rectangle, Length
钢埋板肋板_俯视图 = 钢埋板肋板俯视图(
    X=subtraction,
    Y=钢埋板厚度_2,
    X_2=subtraction,
    B=number_slider_3,
    A=subtraction,
    B_2=number_slider_3,
    A_2=钢肋板_侧视图.R,
    B_3=钢埋板厚度_2)  # -> pt_4, R, pl, G
钢埋板_俯视图 = Rectangle(Plane=PlaneXY(0, 0, 0), XSize=dom_4, YSize=dom_2, Radius=0)  # -> Rectangle, Length
焊缝_立面 = 焊缝立面(B_2=焊缝高度_埋板厚度_2, A_2=钢埋板肋板_俯视图.G, B=钢埋板肋板_俯视图.pt_4, A=焊缝高度_埋板厚度_2)  # -> flatten(R)
number_slider_4 = Slider(200, range=0..1000)
group = Group(Objects=焊缝_立面)

侧视图 = Entwine(Branch00=钢埋板_侧视图.Rectangle, Branch01=钢肋板_侧视图.R_2, Branch02=钢肋板_侧视图.G, FlattenInputs=True)
cluster_2 = Cluster_2(G=侧视图, A=subtraction, B=number_slider_4, B_2=钢肋板_侧视图.R)

俯视图 = Entwine(Branch00=钢埋板_俯视图.Rectangle, Branch01=钢埋板肋板_俯视图.pl, Branch02=group, FlattenInputs=True)
cluster_3 = Cluster_3(G=俯视图, A=钢埋板肋板_俯视图.R, A_2=钢埋板长度_2, B=number_slider_4)

split_tree = SplitTree(Data=cluster_2, Masks=flatten("{0;0}"))  # -> Positive, Negative
钢埋板_正视图 = Rectangle(Plane=PlaneXY(0, 0, 0), XSize=dom_4, YSize=dom, Radius=0)  # -> Rectangle, Length
肋板_正视图 = 肋板正视图(X=dom_4, Y=dom_3, B_3=number_slider_3, A=division_2, B=cluster.i_3, Y_2=dom_3, B_2=number_slider_3)
标注 = 标注(C=钢埋板_正视图.Rectangle, B=图纸比例)  # -> ld, R
dispatch = Dispatch(List=split_tree.Negative, DispatchPattern=[True, False])  # -> flatten(ListA), ListB
entwine = Entwine(Branch00=钢埋板_正视图.Rectangle, Branch01=肋板_正视图, Branch03=标注.ld, FlattenInputs=True)
hatch_table = HatchTable(Update=True)
define_hatch = DefineHatch(Curve=dispatch.ListB, Pattern="Grid", Rotation=0, Scale=1)
merge = Merge(Data1=split_tree.Positive, Data2=dispatch.ListA)
tree_statistics = TreeStatistics()  # -> Paths, Length, Count
entwine_2 = Entwine(Branch00=merge, Branch02=dispatch.ListB, FlattenInputs=True)
geometry = Geometry(define_hatch)
panel_9 = Panel(肋板_正视图)
panel_10 = Panel(geometry)
cad_exporter = CADExporter(Export=False, ExportType="dwg")

xy = XYPlane(Origin=Point(0, 0, 0))

图框数值 = 图框数值(A="360", B=图纸比例, A_2="287", B_2=图纸比例)  # -> I, I_2

rectangle = Rectangle(Plane=xy, XSize=图框数值.I, YSize=图框数值.I_2, Radius=0)  # -> Rectangle, Length
panel_11 = Panel("""模型图框范围
不打印层""")

# ==== cluster 钢结构截面尺寸
T = ClusterInput()
split = TextSplit(Text=T, Separators="x")
split_2 = TextSplit(Text=split, Separators="Q")
item = ListItem(List=split_2, Index="0", Wrap=True)  # -> flatten(Item)
i = ClusterOutput(item)

# ==== cluster Cluster
L = ClusterInput()
L_2 = ClusterInput()
L_3 = ClusterInput()
L_4 = ClusterInput()
工字钢_h = ListItem(List=L, Index=0, Wrap=True)
工字钢_b = ListItem(List=L_2, Index=1, Wrap=True)
工字钢_tf = ListItem(List=L_3, Index=3, Wrap=True)
工字钢_tw = ListItem(List=L_4, Index=2, Wrap=True)
i = ClusterOutput(工字钢_h)
i_2 = ClusterOutput(工字钢_b)
i_3 = ClusterOutput(工字钢_tf)
i_4 = ClusterOutput(工字钢_tw)

# ==== cluster 焊缝高度埋板厚度2
A = ClusterInput()
subtraction = Subtraction(A=A, B=Slider(2, range=0..10))
R = ClusterOutput(subtraction)

# ==== cluster 焊缝立面
A = ClusterInput()
A_2 = ClusterInput()
B = ClusterInput()
division = Division(A=A, B="1")
ln = Line(StartPoint=A_2, EndPoint=B)
len = Length(Curve=ln)
integer_division = IntegerDivision(A=len, B=division)
subtraction = Subtraction(A=integer_division, B=Slider(1, range=0..1))
multiplication = Multiplication(A=subtraction, B=division)
subtraction_2 = Subtraction(A=len, B=multiplication)
division_2 = Division(A=subtraction_2, B="2")
B_2 = ClusterInput()
addition = Addition(A=division_2, B=B_2)
eval = EvaluateLength(Curve=ln, Length=addition, Normalized=False)  # -> Point, Tangent, Parameter
arc = Arc(Plane=eval.Point, Radius=division, Angle=Domain(0, 3.141592654))  # -> Arc, Length
end = EndPoints(Curve=arc.Arc)  # -> Start, End
arc_2 = Arc(Plane=end.End, Radius=division, Angle=Domain(0, 3.141592654))  # -> Arc, Length
ccx = CurveCurve(CurveA=arc_2.Arc, CurveB=arc.Arc)  # -> Points, ParamsA, ParamsB
subtraction_3 = Subtraction(A=integer_division, B="4")
line = LineSDL(Start=end.Start, Direction=ln, Length=division)
arc_3 = Arc(Plane=end.Start, Radius=division, Angle=ccx.ParamsA)  # -> Arc, Length
arrlinear = LinearArray(Geometry=arc_3.Arc, Direction=line, Count=subtraction_3)  # -> Geometry, Transform
merge = Merge(Data1=arc.Arc, Data2=arrlinear.Geometry)
R = ClusterOutput(merge)

# ==== cluster 图框数值
A = ClusterInput()
B = ClusterInput()
A_2 = ClusterInput()
B_2 = ClusterInput()
multiplication = Multiplication(A=A, B=B)
multiplication_2 = Multiplication(A=A_2, B=B_2)
division = Division(A=multiplication, B="2")
division_2 = Division(A=multiplication_2, B="2")
neg = Negative(Value=division)
neg_2 = Negative(Value=division_2)
dom = ConstructDomain(DomainStart=neg, DomainEnd=division)
dom_2 = ConstructDomain(DomainStart=neg_2, DomainEnd=division_2)
I = ClusterOutput(dom)
I_2 = ClusterOutput(dom_2)

# ==== cluster 钢埋板肋板俯视图
B = ClusterInput()
A = ClusterInput()
B_2 = ClusterInput()
A_2 = ClusterInput()
B_3 = ClusterInput()
subtraction = Subtraction(A=A, B=B_2)
subtraction_2 = Subtraction(A=A_2, B=B_3)
subtraction_3 = Subtraction(A=subtraction_2, B=B)
X = ClusterInput()
Y = ClusterInput()
X_2 = ClusterInput()
R = ClusterOutput(subtraction_2)
pt = ConstructPoint(XCoordinate=X, YCoordinate=Y, ZCoordinate=0)
pt_2 = ConstructPoint(XCoordinate=X_2, YCoordinate=subtraction_3, ZCoordinate=0)
pt_3 = ConstructPoint(XCoordinate=subtraction, YCoordinate=subtraction_2, ZCoordinate=0)
mirror = Mirror(Geometry=pt_3, Plane=PlaneYZ(0, 0, 0))  # -> Geometry, Transform
mirror_2 = Mirror(Geometry=pt_2, Plane=PlaneYZ(0, 0, 0))  # -> Geometry, Transform
mirror_3 = Mirror(Geometry=pt, Plane=PlaneYZ(0, 0, 0))  # -> Geometry, Transform
pt_4 = ClusterOutput(pt)
G = ClusterOutput(mirror_3.Geometry)
merge = Merge(Data1=pt, Data2=pt_2, Data3=pt_3, Data4=mirror.Geometry, Data5=mirror_2.Geometry, Data6=mirror_3.Geometry)
pline = PolyLine(Vertices=merge, Closed=True)
pl = ClusterOutput(pline)

# ==== cluster 钢肋板侧视图_2
B = ClusterInput()
A = ClusterInput()
B_2 = ClusterInput()
A_2 = ClusterInput()
B_3 = ClusterInput()
x = ClusterInput()
A_3 = ClusterInput()
B_4 = ClusterInput()
B_5 = ClusterInput()
x_2 = ClusterInput()
A_4 = ClusterInput()
B_6 = ClusterInput()
B_7 = ClusterInput()
x_3 = ClusterInput()
B_8 = ClusterInput()
x_4 = ClusterInput()
A_5 = ClusterInput()
B_9 = ClusterInput()
A_6 = ClusterInput()
B_10 = ClusterInput()
x_5 = ClusterInput()
B_11 = ClusterInput()
A_7 = ClusterInput()
Y = ClusterInput()
B_12 = ClusterInput()
B_13 = ClusterInput()
侧视图_焊缝截面 = 侧视图焊缝截面(
    A_4=A_2,
    B_4=B_3,
    x_4=x,
    A=A_3,
    B_5=B_4,
    B=B_5,
    x_5=x_2,
    A_2=A_4,
    B_6=B_6,
    B_2=B_7,
    x=x_3,
    B_7=B_8,
    x_2=x_4,
    A_5=A_5,
    B_8=B_9,
    A_3=A_6,
    B_3=B_10,
    x_3=x_5)
钢肋板_侧视图 = 钢肋板侧视图(B_2=B_11, A=A_7, Y=Y, B=B_12, B_3=B_13)  # -> R_3, R, y, R_2
钢肋板倒角_侧视图 = 钢肋板倒角侧视图(A=钢肋板_侧视图.y, B=钢肋板_侧视图.R_2, B_2=B, A_2=A, B_3=B_2)
R = ClusterOutput(钢肋板_侧视图.R)
merge = Merge(Data1=钢肋板_侧视图.R_3, Data2=侧视图_焊缝截面, Data3=钢肋板倒角_侧视图)
xz = XZPlane(Origin=Point(0, 0, 0))
mirror = Mirror(Geometry=merge, Plane=xz)  # -> Geometry, Transform
R_2 = ClusterOutput(merge)
G = ClusterOutput(mirror.Geometry)

# ==== cluster Cluster_2
A = ClusterInput()
B = ClusterInput()
B_2 = ClusterInput()
addition = Addition(A=A, B=B)
addition_2 = Addition(A=addition, B=B_2)
G = ClusterInput()
X = UnitX(Factor=addition_2)
move = Move(Geometry=G, Motion=X)  # -> Geometry, Transform
G_2 = ClusterOutput(move.Geometry)

# ==== cluster Cluster_3
A = ClusterInput()
B = ClusterInput()
A_2 = ClusterInput()
addition = Addition(A=A, B=B)
addition_2 = Addition(A=A_2, B=addition)
neg = Negative(Value=addition_2)
G = ClusterInput()
Y = UnitY(Factor=neg)
move = Move(Geometry=G, Motion=Y)  # -> Geometry, Transform
G_2 = ClusterOutput(move.Geometry)

# ==== cluster 肋板正视图
A = ClusterInput()
B = ClusterInput()
subtraction = Subtraction(A=A, B=B)
B_2 = ClusterInput()
neg = Negative(Value=subtraction)
B_3 = ClusterInput()
subtraction_2 = Subtraction(A=subtraction, B=B_2)
addition = Addition(A=neg, B=B_3)
X = ClusterInput()
Y = ClusterInput()
Y_2 = ClusterInput()
dom = ConstructDomain(DomainStart=addition, DomainEnd=subtraction_2)
钢埋板正视图_虚线 = Rectangle(Plane=PlaneXY(0, 0, 0), XSize=X, YSize=Y, Radius=0)  # -> Rectangle, Length
钢埋板倒角正视图_虚线 = Rectangle(Plane=PlaneXY(0, 0, 0), XSize=dom, YSize=Y_2, Radius=0)  # -> Rectangle, Length
merge = Merge(Data1=钢埋板正视图_虚线.Rectangle, Data2=钢埋板倒角正视图_虚线.Rectangle)
xz = XZPlane(Origin=Point(0, 0, 0))
mirror = Mirror(Geometry=merge, Plane=xz)  # -> Geometry, Transform
merge_2 = Merge(Data1=merge, Data2=mirror.Geometry)
result = ClusterOutput(merge_2)

# ==== cluster 标注
C = ClusterInput()
B = ClusterInput()
cpoly = ControlPolygon(Curve=C)  # -> Polygon, Points
# 标注
标注偏移10_8 = 标注偏移108(B=B)
R = ClusterOutput(标注偏移10_8)
cluster = Cluster_4(L_2=cpoly.Points, L=cpoly.Points)  # -> i_2, R, i
linear_dim = DefineLinearDimension(Point1=cluster.i_2, Point2=cluster.i, Offset=标注偏移10_8, internalize=False)
ld = ClusterOutput(linear_dim)

# ==== cluster 钢肋板侧视图
A = ClusterInput()
B = ClusterInput()
subtraction = Subtraction(A=A, B=B)
division = Division(A=subtraction, B="2")
R = ClusterOutput(division)
division_2 = Division(A=division, B="2")
B_2 = ClusterInput()
B_3 = ClusterInput()
subtraction_2 = Subtraction(A=division_2, B=B_2)
subtraction_3 = Subtraction(A=division_2, B=B_3)
neg = Negative(Value=division_2)
y = ClusterOutput(neg)
R_2 = ClusterOutput(subtraction_3)
subtraction_4 = Subtraction(A=subtraction_2, B=subtraction_3)
subtraction_5 = Subtraction(A=neg, B=subtraction_3)
dom = ConstructDomain(DomainStart=subtraction_4, DomainEnd=subtraction_5)
Y = ClusterInput()
钢肋板_侧视图 = Rectangle(Plane=PlaneXY(0, 0, 0), XSize=dom, YSize=Y, Radius=0)  # -> Rectangle, Length
R_3 = ClusterOutput(钢肋板_侧视图.Rectangle)

# ==== cluster 侧视图焊缝截面
A = ClusterInput()
B = ClusterInput()
A_2 = ClusterInput()
B_2 = ClusterInput()
A_3 = ClusterInput()
B_3 = ClusterInput()
x = ClusterInput()
x_2 = ClusterInput()
x_3 = ClusterInput()
A_4 = ClusterInput()
B_4 = ClusterInput()
B_5 = ClusterInput()
B_6 = ClusterInput()
B_7 = ClusterInput()
A_5 = ClusterInput()
B_8 = ClusterInput()
x_4 = ClusterInput()
x_5 = ClusterInput()
subtraction = Subtraction(A=A, B=B)
subtraction_2 = Subtraction(A=A_2, B=B_2)
subtraction_3 = Subtraction(A=A_3, B=B_3)
neg = Negative(Value=x)
neg_2 = Negative(Value=x_2)
neg_3 = Negative(Value=x_3)
subtraction_4 = Subtraction(A=A_4, B=B_4)
addition = Addition(A=subtraction, B=B_5)
addition_2 = Addition(A=subtraction_2, B=B_6)
subtraction_5 = Subtraction(A=neg, B=B_7)
subtraction_6 = Subtraction(A=neg_2, B="2")
subtraction_7 = Subtraction(A=A_5, B=B_8)
addition_3 = Addition(A=subtraction_3, B="2")
subtraction_8 = Subtraction(A=neg_3, B="2")
neg_4 = Negative(Value=x_4)
neg_5 = Negative(Value=x_5)
pt = ConstructPoint(XCoordinate=neg_4, YCoordinate=subtraction_4, ZCoordinate=0)
pt_2 = ConstructPoint(XCoordinate=neg_5, YCoordinate=addition, ZCoordinate=0)
pt_3 = ConstructPoint(XCoordinate=subtraction_5, YCoordinate=addition_2, ZCoordinate=0)
pt_4 = ConstructPoint(XCoordinate=subtraction_6, YCoordinate=subtraction_7, ZCoordinate=0)
pt_5 = ConstructPoint(XCoordinate=subtraction_8, YCoordinate=addition_3, ZCoordinate=0)
merge = Merge(Data1=pt, Data2=pt_2, Data3=pt_3, Data4=pt_5, Data5=pt_4)
pline = PolyLine(Vertices=merge, Closed=True)
pl = ClusterOutput(pline)

# ==== cluster 钢肋板倒角侧视图
A = ClusterInput()
B = ClusterInput()
B_2 = ClusterInput()
subtraction = Subtraction(A=A, B=B)
A_2 = ClusterInput()
B_3 = ClusterInput()
addition = Addition(A=subtraction, B=B_2)
dom = ConstructDomain(DomainStart=addition, DomainEnd=subtraction)
dom_2 = ConstructDomain(DomainStart=A_2, DomainEnd=B_3)
钢肋板倒角_侧视图 = Rectangle(Plane=PlaneXY(0, 0, 0), XSize=dom, YSize=dom_2, Radius=0)  # -> Rectangle, Length
R = ClusterOutput(钢肋板倒角_侧视图.Rectangle)

# ==== cluster Cluster_4
num = Number(graft([2, 3]))
num_2 = Number(graft([2, 3]))
L = ClusterInput()
L_2 = ClusterInput()
addition = Addition(A=num, B=1)
item = ListItem(List=L, Index=num_2, Wrap=True)
item_2 = ListItem(List=L_2, Index=addition, Wrap=True)
R = ClusterOutput(addition)
i = ClusterOutput(item)
i_2 = ClusterOutput(item_2)

# ==== cluster 标注偏移108
B = ClusterInput()
multiplication = Multiplication(A="18", B=B)
R = ClusterOutput(multiplication)
