# Grasshopper definition 闭合梁中线.gh (Grasshopper 1.0.7)
# Copyright: Arup
# plug-ins: TT Toolbox, Hare, EleFront

# ----
# 输入梁中线
crv = Curve([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])

midpt = CurveMiddle(Curve=crv)
scale = Scale(Geometry=crv, Center=midpt, Factor=Slider(3, range=0..10))  # -> Geometry, Transform
end = EndPoints(Curve=scale.Geometry)  # -> Start, End
end_2 = EndPoints(Curve=crv)  # -> Start, End
ccx = CurveCurve(CurveA=graft(scale.Geometry), CurveB=scale.Geometry)  # -> flatten(Points), ParamsA, ParamsB
merge = Merge(Data1=end.Start, Data2=end.End)
merge_2 = Merge(Data1=end_2.Start, Data2=end_2.End)
testpoint = TestPoint(archPoint=ccx.Points, crvPoint=merge)  # -> out, specialPt; inputs archPoint: list of Point3d, crvPoint: list of Point3d
# ---------- testpoint: C# ----------
    List<int> passIndex = new List<int>();

    for(int i = 0; i < archPoint.Count; i++){
      foreach(Point3d t in crvPoint){
        if(archPoint[i].X == t.X && archPoint[i].Y == t.Y && archPoint[i].Z == t.Z){
          Print("pass");
          passIndex.Add(i);}
      }
    }

    specialPt = passIndex;
# ---------- end testpoint ----------
cull_i = CullIndex(List=ccx.Points, Indices=testpoint.specialPt, Wrap=True)
pull = PullPoint(Point=merge_2, Geometry=cull_i, ClosestOnly=True)  # -> ClosestPoint, Distance
cullduppoints = RemoveDuplicatePoints(InputPoints=pull.ClosestPoint, Tolerance=0.001)  # -> OutputPoints, FirstPointIndexes
clean = CleanTree(RemoveNulls=True, RemoveInvalid=True, RemoveEmpty=True, Tree=cullduppoints.OutputPoints)
pull_2 = PullPoint(Point=end_2.End, Geometry=clean, ClosestOnly=True)  # -> ClosestPoint, Distance
pull_3 = PullPoint(Point=end_2.Start, Geometry=clean, ClosestOnly=True)  # -> ClosestPoint, Distance
ext = ExtendCurve(Curve=crv, Type=0, Start=pull_3.Distance, End=pull_2.Distance)
midpt_2 = CurveMiddle(Curve=ext)
scale_2 = Scale(Geometry=ext, Center=midpt_2, Factor=Slider(1.1, range=0..10))  # -> Geometry, Transform
layer = DefineLayer(Name="梁中线简化", Color=ColourSwatch(SwatchColor=RGB(255, 255, 255)))
attributes = DefineObjectAttributes(Layer=layer)

# ----
# Bake后
# 1.选中所有bake的线段
# 2.Rhino输入命令 ‘CurveBoolean’ 得到完整的一条线段。
bake = BakeObjects(Geometry=scale_2.Geometry, Attributes=attributes, BakeName="梁中线简化", Bake=False)
