# Grasshopper definition line_extend+intersect.gh (Grasshopper 1.0.7)
# Copyright: Arup

crv = Curve([<curve referenced from the Rhino model> x48])
crv_2 = Curve([<curve referenced from the Rhino model> x47])
crv_3 = Curve([<curve referenced from the Rhino model> x50])
crv_4 = Curve([<curve referenced from the Rhino model> x52])

pt = Point(Point(12288145.88, 1253636.993, 0))
end = EndPoints(Curve=crv_4)  # -> Start, End
ln = Line(StartPoint=end.Start, EndPoint=end.End)
midpt = CurveMiddle(Curve=ln)
pull = PullPoint(Point=midpt, Geometry=pt, ClosestOnly=True)  # -> ClosestPoint, Distance
sort = SortList(Keys=pull.Distance, ValuesA=ln)  # -> Keys, ValuesA
cull_i = CullIndex(List=sort.ValuesA, Indices="0", Wrap=True)
dispatch = Dispatch(List=sort.ValuesA, DispatchPattern=[True, False])  # -> ListA, ListB
dispatch_2 = Dispatch(List=cull_i, DispatchPattern=[True, False])  # -> ListA, ListB
line = Line(dispatch.ListA)
line_2 = Line(dispatch.ListB)
line_3 = Line(dispatch_2.ListA)
line_4 = Line(dispatch_2.ListB)
llx = LineLine(Line1=line, Line2=line_2)  # -> ParamA, ParamB, PointA, PointB
llx_2 = LineLine(Line1=line_3, Line2=line_4)  # -> ParamA, ParamB, PointA, PointB
pt_2 = Point(llx.PointA)
pt_3 = Point(llx_2.PointA)
merge = Merge(Data1=flatten(pt_2), Data2=flatten(pt_3))
pull_2 = PullPoint(Point=merge, Geometry=pt, ClosestOnly=True)  # -> ClosestPoint, Distance
sort_2 = SortList(Keys=pull_2.Distance, ValuesA=merge)  # -> Keys, ValuesA
pline = PolyLine(Vertices=sort_2.ValuesA, Closed=False)

end_2 = EndPoints(Curve=crv)  # -> Start, End
end_3 = EndPoints(Curve=crv_2)  # -> Start, End
end_4 = EndPoints(Curve=crv_3)  # -> Start, End
ln_2 = Line(StartPoint=end_2.Start, EndPoint=end_2.End)
pt_4 = Point(Point(12293448.97, 1287760.933, 0))
ln_3 = Line(StartPoint=end_3.Start, EndPoint=end_3.End)
pt_5 = Point(Point(12331365.57, 1282006.934, 0))
ln_4 = Line(StartPoint=end_4.Start, EndPoint=end_4.End)
pt_6 = Point(Point(12292446.23, 1288172.241, 0))
midpt_2 = CurveMiddle(Curve=ln_2)
midpt_3 = CurveMiddle(Curve=ln_3)
midpt_4 = CurveMiddle(Curve=ln_4)
pull_3 = PullPoint(Point=midpt_2, Geometry=pt_4, ClosestOnly=True)  # -> ClosestPoint, Distance
pull_4 = PullPoint(Point=midpt_3, Geometry=pt_5, ClosestOnly=True)  # -> ClosestPoint, Distance
pull_5 = PullPoint(Point=midpt_4, Geometry=pt_6, ClosestOnly=True)  # -> ClosestPoint, Distance
sort_3 = SortList(Keys=pull_3.Distance, ValuesA=ln_2)  # -> Keys, ValuesA
sort_4 = SortList(Keys=pull_4.Distance, ValuesA=ln_3)  # -> Keys, ValuesA
sort_5 = SortList(Keys=pull_5.Distance, ValuesA=ln_4)  # -> Keys, ValuesA
cull_i_2 = CullIndex(List=sort_3.ValuesA, Indices="0", Wrap=True)
cull_i_3 = CullIndex(List=sort_4.ValuesA, Indices="0", Wrap=True)
cull_i_4 = CullIndex(List=sort_5.ValuesA, Indices="0", Wrap=True)
dispatch_3 = Dispatch(List=sort_3.ValuesA, DispatchPattern=[True, False])  # -> ListA, ListB
dispatch_4 = Dispatch(List=sort_4.ValuesA, DispatchPattern=[True, False])  # -> ListA, ListB
dispatch_5 = Dispatch(List=sort_5.ValuesA, DispatchPattern=[True, False])  # -> ListA, ListB
dispatch_6 = Dispatch(List=cull_i_2, DispatchPattern=[True, False])  # -> ListA, ListB
dispatch_7 = Dispatch(List=cull_i_3, DispatchPattern=[True, False])  # -> ListA, ListB
dispatch_8 = Dispatch(List=cull_i_4, DispatchPattern=[True, False])  # -> ListA, ListB
line_5 = Line(dispatch_3.ListA)
line_6 = Line(dispatch_4.ListA)
line_7 = Line(dispatch_3.ListB)
line_8 = Line(dispatch_4.ListB)
line_9 = Line(dispatch_5.ListA)
line_10 = Line(dispatch_5.ListB)
line_11 = Line(dispatch_6.ListA)
line_12 = Line(dispatch_7.ListA)
line_13 = Line(dispatch_6.ListB)
line_14 = Line(dispatch_7.ListB)
line_15 = Line(dispatch_8.ListA)
line_16 = Line(dispatch_8.ListB)
llx_3 = LineLine(Line1=line_5, Line2=line_7)  # -> ParamA, ParamB, PointA, PointB
llx_4 = LineLine(Line1=line_6, Line2=line_8)  # -> ParamA, ParamB, PointA, PointB
llx_5 = LineLine(Line1=line_9, Line2=line_10)  # -> ParamA, ParamB, PointA, PointB
llx_6 = LineLine(Line1=line_11, Line2=line_13)  # -> ParamA, ParamB, PointA, PointB
llx_7 = LineLine(Line1=line_12, Line2=line_14)  # -> ParamA, ParamB, PointA, PointB
llx_8 = LineLine(Line1=line_15, Line2=line_16)  # -> ParamA, ParamB, PointA, PointB
pt_7 = Point(llx_3.PointA)
pt_8 = Point(llx_4.PointA)
pt_9 = Point(llx_6.PointA)
pt_10 = Point(llx_7.PointA)
pt_11 = Point(llx_5.PointA)
pt_12 = Point(llx_8.PointA)
merge_2 = Merge(Data1=flatten(pt_7), Data2=flatten(pt_9))
merge_3 = Merge(Data1=flatten(pt_8), Data2=flatten(pt_10))
merge_4 = Merge(Data1=flatten(pt_11), Data2=flatten(pt_12))
pull_6 = PullPoint(Point=merge_2, Geometry=pt_4, ClosestOnly=True)  # -> ClosestPoint, Distance
pull_7 = PullPoint(Point=merge_3, Geometry=pt_5, ClosestOnly=True)  # -> ClosestPoint, Distance
pull_8 = PullPoint(Point=merge_4, Geometry=pt_6, ClosestOnly=True)  # -> ClosestPoint, Distance
sort_6 = SortList(Keys=pull_6.Distance, ValuesA=merge_2)  # -> Keys, ValuesA
sort_7 = SortList(Keys=pull_7.Distance, ValuesA=merge_3)  # -> Keys, ValuesA
sort_8 = SortList(Keys=pull_8.Distance, ValuesA=merge_4)  # -> Keys, ValuesA
pline_2 = PolyLine(Vertices=sort_6.ValuesA, Closed=False)
pline_3 = PolyLine(Vertices=sort_7.ValuesA, Closed=False)
pline_4 = PolyLine(Vertices=sort_8.ValuesA, Closed=False)
crv_5 = Curve([pline, pline_4, pline_2, pline_3])
