# Grasshopper definition 板槽钢板槽Monomer.gh (Grasshopper 1.0.7)
# plug-ins: Hare

# ---- group: 槽埋
# 槽埋Modeling
brep = Brep(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)  # disabled
brep_2 = Brep(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)  # disabled
area = Area(Geometry=brep_2)  # -> Area, Centroid; disabled
bbox = BoundingBox(Content=brep_2, Plane=PlaneXY(0, 0, 0))  # -> Box, Box_2; disabled
pdecon = Deconstruct(Point=area.Centroid)  # -> XComponent, YComponent, ZComponent; disabled
debox = DeconstructBox(Box=bbox.Box)  # -> Plane, X, Y, Z; disabled
dedomain = DeconstructDomain(Domain=debox.Z)  # -> Start, End; disabled
pt = ConstructPoint(XCoordinate=pdecon.XComponent, YCoordinate=pdecon.YComponent, ZCoordinate=dedomain.End)  # disabled
xy = XYPlane(Origin=Point(0, 0, 0))  # disabled
pl_origin = PlaneOrigin(Base=xy, Origin=pt)  # disabled
xy_2 = XYPlane(Origin=Point(0, 0, 0))  # disabled
orient = Orient(Geometry=brep_2, Source=pl_origin, Target=xy_2)  # -> Geometry, Transform; disabled

# ---- group: 锚筋间距
s_x = Slider(25, range=14..60, expression="X*5")
s_y = Slider(20, range=14..60, expression="X*5")

s_x_2 = Slider(25, range=14..60, expression="X*5")
s_y_2 = Slider(20, range=14..60, expression="X*5")

# ---- group: 螺栓直径
list = ValueList({"10": 0, "12": 1, "16": 2, "18": 3, "20": 4, "25": 5}, selected="16")

# ---- group: 锚筋直径
list_2 = ValueList({"10": 0, "12": 1, "16": 2, "18": 3, "20": 4, "25": 5}, selected="12")

# ---- group: 列
list_3 = ValueList({"2X": 0, "3X": 1, "4X": 2}, selected="3X")

# ---- group: 行
list_4 = ValueList({"2Y": 0, "3Y": 1, "4Y": 2}, selected="2Y")

# ---- group: 螺栓直径
list_5 = ValueList({"10": 0, "12": 1, "16": 2, "18": 3, "20": 4, "25": 5}, selected="16")

# ---- group: 锚筋直径
list_6 = ValueList({"10": 0, "12": 1, "16": 2, "18": 3, "20": 4, "25": 5}, selected="12")

# ---- group: 列
list_7 = ValueList({"2X": 0, "3X": 1, "4X": 2}, selected="3X")

# ---- group: 行
list_8 = ValueList({"2Y": 0, "3Y": 1, "4Y": 2}, selected="2Y")

# ----
# 钢板槽Modeling
锚筋末端焊板厚度 = Slider(12, range=0..100)
锚筋长度 = Slider(12, range=0..30, expression="x*10")
锚筋末端焊板边长 = Slider(40, range=0..100)
锚板厚度 = Slider(12, range=0..100)
板凳厚度 = Slider(16, range=0..100)
槽长 = Slider(270, range=0..1000)
value_list = ValueList({"锚筋": 0, "锚焊": 1}, selected="锚焊")
锚筋到边 = Panel("75")
list_9 = ValueList({"板埋": 0, "槽埋": 1}, selected="板埋")
list_10 = ValueList({"顶埋": 0, "侧埋": 1}, selected="顶埋")
curve = Curve(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)
subtraction = Subtraction(A=锚筋长度, B=锚板厚度)
filter = StreamFilter(Gate=list_2, Stream0=10, Stream1=12, Stream2=16, Stream3=18, Stream4=20, Stream5=25)
filter_2 = StreamFilter(Gate=list, Stream0=10, Stream1=12, Stream2=16, Stream3=18, Stream4=20, Stream5=25)
addition = Addition(A=list_4, B=1)
addition_2 = Addition(A=list_3, B=1)
recgrid = Rectangular(Plane=PlaneXY(0, 0, 0), SizeX=s_x, SizeY=s_y, ExtentX=addition_2, ExtentY=addition)  # -> Cells, Points
multiplication = Multiplication(A=s_x, B=addition_2)
multiplication_2 = Multiplication(A=s_y, B=addition)
division = Division(A=multiplication, B=2)
division_2 = Division(A=multiplication_2, B=2)
vec = VectorXYZ(XComponent=expr("-x", division), YComponent=expr("-x", division_2), ZComponent=0)  # -> Vector, Length
division_3 = Division(A=filter, B=2)
move = Move(Geometry=recgrid.Points, Motion=vec.Vector)  # -> Geometry, Transform
multiplication_3 = Multiplication(A=division_3, B=2)
yz_plane = YZPlane(Origin=Point(0, 0, 0))
orient_2 = Orient(Geometry=curve, Source=PlaneXY(0, 0, 0), Target=yz_plane)  # -> Geometry, Transform
divide_curve = DivideCurve(Curve=orient_2.Geometry, Count=Slider(50, range=0..100), Kinks=False)  # -> Points, Tangents, Parameters
unit_x = UnitX(Factor=槽长)
division_4 = Division(A=槽长, B=2)
extrude = Extrude(Base=orient_2.Geometry, Direction=unit_x)
unit_x_2 = UnitX(Factor=division_4)
convex_hull = ConvexHull(Points=divide_curve.Points, Plane=yz_plane)  # -> Hull, HullZ, Indices
move_2 = Move(Geometry=extrude, Motion=expr("-x", unit_x_2))  # -> Geometry, Transform
boundary_surfaces = BoundarySurfaces(Edges=convex_hull.Hull)
multiplication_4 = Multiplication(A=Slider(10, range=0..100), B=2)
subtraction_2 = Subtraction(A=槽长, B=multiplication_4)
unit_z = UnitZ(Factor=expr("-X", subtraction))
cap_holes = CapHoles(Brep=move_2.Geometry)
unit_x_3 = UnitX(Factor=subtraction_2)
extrude_2 = Extrude(Base=boundary_surfaces, Direction=unit_x_3)
division_5 = Division(A=unit_x_3, B=2)
extrude_3 = Extrude(Base=boundary_surfaces, Direction=unit_x)
move_3 = Move(Geometry=extrude_2, Motion=expr("-x", division_5))  # -> Geometry, Transform
move_4 = Move(Geometry=extrude_3, Motion=expr("-x", unit_x_2))  # -> Geometry, Transform
solid_difference = SolidDifference(BrepsA=move_4.Geometry, BrepsB=move_3.Geometry)
Z = UnitZ(Factor=expr("-x", 锚板厚度))
xy_plane = XYPlane(Origin=Point(0, 0, 0))
deconstruct_plane = DeconstructPlane(Plane=xy_plane)  # -> Origin, XAxis, YAxis, ZAxis

multiplication_5 = Multiplication(A=multiplication_3, B=6)
max = Maximum(A=multiplication_5, B=70)
multiplication_6 = Multiplication(A=锚筋到边, B=2)
addition_3 = Addition(A=multiplication, B=multiplication_6)
addition_4 = Addition(A=multiplication_2, B=multiplication_6)
expression = Expression(x=addition_3, Expression="Ceiling(x/10)*10/2")
expression_2 = Expression(x=addition_4, Expression="Ceiling(x/10)*10/2")
dom = ConstructDomain(DomainStart=expr("-x", expression), DomainEnd=expression)
dom_2 = ConstructDomain(DomainStart=expr("-x", expression_2), DomainEnd=expression_2)
box = DomainBox(Base=PlaneXY(0, 0, 0), X=dom, Y=dom_2, Z=锚板厚度)

flip_matrix = FlipMatrix(Data=move.Geometry)
cull_first_last = CullFirstLast(List=flip_matrix)  # -> CullFirst, CullLast, CullFirstAndEnd
point = Point(cull_first_last.CullFirstAndEnd)
flip_matrix_2 = FlipMatrix(Data=point)
number_slider = Slider(50, range=0..100)
polyline = PolyLine(Vertices=flip_matrix_2, Closed=False)
extend_curve = ExtendCurve(Curve=polyline, Type=0, Start=number_slider, End=number_slider)
xy_plane_2 = XYPlane(Origin=Point(0, 0, 0))
average = Average(Input=move.Geometry)
addition_5 = Addition(A=filter_2, B=Slider(1, range=0..1))
multiplication_7 = Multiplication(A=filter, B=2.5)
division_6 = Division(A=addition_5, B=2)
polyline_2 = PolyLine(Vertices=flatten(average), Closed=False)
negative = Negative(Value=division_6)
offset_curve = OffsetCurve(
    Curve=extend_curve,
    Distance=[Slider(25, range=0..100), Slider(25, range=0..100, expression="-x")],
    Plane=xy_plane_2,
    Corners=1)
circle = Circle(Plane=move.Geometry, Radius=multiplication_7)
shift_paths = ShiftPaths(Data=offset_curve, Offset=-1)
region_union = RegionUnion(Curves=circle)
offset_curve_2 = OffsetCurve(Curve=polyline_2, Distance=[division_6, negative], Plane=xy_plane_2, Corners=1)
boundary_surfaces_2 = BoundarySurfaces(Edges=region_union)
loft = Loft(Curves=shift_paths, Options={Adjust=False, Closed=False, LoftEnds=0, LoftSimp=0, LoftType=0, Rebuild=10, Refit=0.01})
trim_with_regions = TrimWithRegions(Curve=offset_curve_2, Regions=flatten(boundary_surfaces_2))  # -> Inside, Outside
trim_with_regions_2 = TrimWithRegions(Curve=trim_with_regions.Outside, Regions=flatten(loft))  # -> Inside, Outside
curve_2 = Curve(trim_with_regions_2.Outside)
flip_matrix_3 = FlipMatrix(Data=curve_2)
loft_2 = Loft(Curves=flip_matrix_3, Options={Adjust=False, Closed=False, LoftEnds=0, LoftSimp=0, LoftType=0, Rebuild=10, Refit=0.01})
length = Length(Curve=flip_matrix_3)  # -> flatten(Length)
brep_edges = BrepEdges(Brep=loft_2)  # -> Naked, Interior, NonManifold
max_min = MaxMin(Numbers=length)  # -> Max, MaxIndex, Min, MinIndex
join_curves = JoinCurves(Curves=brep_edges.Naked, Preserve=False)
number_slider_2 = Slider(100, range=0..100)
subtraction_3 = Subtraction(A=max_min.Min, B=filter_2)
fillet = Fillet(Curve=join_curves, Radius=division_6)
unit_z_2 = UnitZ(Factor=expr("-x", number_slider_2))
unit_z_3 = UnitZ(Factor=number_slider_2)
boundary_surfaces_3 = BoundarySurfaces(Edges=fillet)
extrude_4 = Extrude(Base=boundary_surfaces_3, Direction=[unit_z_3, unit_z_2])
solid_difference_2 = SolidDifference(BrepsA=box, BrepsB=flatten(extrude_4))

最短槽长 = Panel(subtraction_3)
subtraction_4 = Subtraction(A=expression_2, B=板凳厚度)
dom_3 = ConstructDomain(DomainStart=expr("-x", subtraction_4), DomainEnd=subtraction_4)
rectangle = Rectangle(Plane=PlaneXY(0, 0, 0), XSize=dom, YSize=dom_3, Radius=0)  # -> Rectangle, Length
rectangle_2 = Rectangle(Plane=PlaneXY(0, 0, 0), XSize=dom, YSize=dom_2, Radius=0)  # -> Rectangle, Length
region_difference = RegionDifference(CurvesA=rectangle_2.Rectangle, CurvesB=rectangle.Rectangle)
boundary_surfaces_4 = BoundarySurfaces(Edges=region_difference)
extrude_5 = Extrude(Base=boundary_surfaces_4, Direction=unit_z)
merge = Merge(Data1=extrude_5, Data2=solid_difference_2, Data3=cap_holes, Data4=solid_difference)
flatten = FlattenTree(Tree=merge, Path="{0}")

move_5 = Move(Geometry=flatten, Motion=Z)  # -> Geometry, Transform
centre_point = Point(deconstruct_plane.Origin)

# ----
# 板槽Modeling
锚筋末端焊板厚度_2 = Slider(12, range=0..100)
锚筋长度_2 = Slider(12, range=0..30, expression="x*10")
锚筋末端焊板边长_2 = Slider(40, range=0..100)
锚板厚度_2 = Slider(12, range=0..100)
槽长_2 = Slider(270, range=0..1000)
value_list_2 = ValueList({"锚筋": 0, "锚焊": 1}, selected="锚焊")
锚筋到边_2 = Panel("75")
list_11 = ValueList({"板埋": 0, "槽埋": 1}, selected="板埋")
list_12 = ValueList({"顶埋": 0, "侧埋": 1}, selected="顶埋")
curve_3 = Curve(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)
subtraction_5 = Subtraction(A=锚筋长度_2, B=锚板厚度_2)
filter_3 = StreamFilter(Gate=list_6, Stream0=10, Stream1=12, Stream2=16, Stream3=18, Stream4=20, Stream5=25)
filter_4 = StreamFilter(Gate=list_5, Stream0=10, Stream1=12, Stream2=16, Stream3=18, Stream4=20, Stream5=25)
addition_6 = Addition(A=list_8, B=1)
addition_7 = Addition(A=list_7, B=1)
recgrid_2 = Rectangular(Plane=PlaneXY(0, 0, 0), SizeX=s_x_2, SizeY=s_y_2, ExtentX=addition_7, ExtentY=addition_6)  # -> Cells, Points
multiplication_8 = Multiplication(A=s_x_2, B=addition_7)
multiplication_9 = Multiplication(A=s_y_2, B=addition_6)
division_7 = Division(A=multiplication_8, B=2)
division_8 = Division(A=multiplication_9, B=2)
vec_2 = VectorXYZ(XComponent=expr("-x", division_7), YComponent=expr("-x", division_8), ZComponent=0)  # -> Vector, Length
move_6 = Move(Geometry=recgrid_2.Points, Motion=vec_2.Vector)  # -> Geometry, Transform
division_9 = Division(A=filter_3, B=2)
multiplication_10 = Multiplication(A=Slider(10, range=0..100), B=2)
subtraction_6 = Subtraction(A=槽长_2, B=multiplication_10)
unit_x_4 = UnitX(Factor=subtraction_6)
division_10 = Division(A=unit_x_4, B=2)
Z_2 = UnitZ(Factor=expr("-x", 锚板厚度_2))
xy_plane_3 = XYPlane(Origin=Point(0, 0, 0))
deconstruct_plane_2 = DeconstructPlane(Plane=xy_plane_3)  # -> Origin, XAxis, YAxis, ZAxis

unit_z_4 = UnitZ(Factor=expr("x", 锚筋末端焊板厚度_2))
unit_z_5 = UnitZ(Factor=expr("-x", subtraction_5))
division_11 = Division(A=锚筋末端焊板边长_2, B=2)
construct_domain = ConstructDomain(DomainStart=expr("-x", division_11), DomainEnd=division_11)
move_7 = Move(Geometry=move_6.Geometry, Motion=unit_z_5)  # -> Geometry, Transform
rectangle_3 = Rectangle(Plane=move_7.Geometry, XSize=construct_domain, YSize=construct_domain, Radius=0)  # -> Rectangle, Length
extrude_6 = Extrude(Base=rectangle_3.Rectangle, Direction=unit_z_4)

multiplication_11 = Multiplication(A=division_9, B=2)
cyl = Cylinder(Base=move_6.Geometry, Radius=division_9, Length=expr("-x", subtraction_5))
edges = BrepEdges(Brep=cyl)  # -> Naked, Interior, NonManifold
multiplication_12 = Multiplication(A=multiplication_11, B=5)
item = ListItem(List=edges.Naked, Index=0, Wrap=True)
X = UnitX(Factor=multiplication_11)
Z_3 = UnitZ(Factor=multiplication_12)
move_8 = Move(Geometry=item, Motion=X)  # -> Geometry, Transform
extr = Extrude(Base=move_8.Geometry, Direction=Z_3)

multiplication_13 = Multiplication(A=multiplication_11, B=6)
max_2 = Maximum(A=multiplication_13, B=70)
multiplication_14 = Multiplication(A=锚筋到边_2, B=2)
addition_8 = Addition(A=multiplication_8, B=multiplication_14)
addition_9 = Addition(A=multiplication_9, B=multiplication_14)
expression_3 = Expression(x=addition_8, Expression="Ceiling(x/10)*10/2")
expression_4 = Expression(x=addition_9, Expression="Ceiling(x/10)*10/2")
dom_4 = ConstructDomain(DomainStart=expr("-x", expression_3), DomainEnd=expression_3)
dom_5 = ConstructDomain(DomainStart=expr("-x", expression_4), DomainEnd=expression_4)
box_2 = DomainBox(Base=PlaneXY(0, 0, 0), X=dom_4, Y=dom_5, Z=锚板厚度_2)

flip_matrix_4 = FlipMatrix(Data=move_6.Geometry)
cull_first_last_2 = CullFirstLast(List=flip_matrix_4)  # -> CullFirst, CullLast, CullFirstAndEnd
point_2 = Point(cull_first_last_2.CullFirstAndEnd)
flip_matrix_5 = FlipMatrix(Data=point_2)
number_slider_3 = Slider(50, range=0..100)
polyline_3 = PolyLine(Vertices=flip_matrix_5, Closed=False)
extend_curve_2 = ExtendCurve(Curve=polyline_3, Type=0, Start=number_slider_3, End=number_slider_3)
xy_plane_4 = XYPlane(Origin=Point(0, 0, 0))
average_2 = Average(Input=move_6.Geometry)
addition_10 = Addition(A=filter_4, B=Slider(1, range=0..1))
multiplication_15 = Multiplication(A=filter_3, B=2.5)
division_12 = Division(A=addition_10, B=2)
polyline_4 = PolyLine(Vertices=flatten(average_2), Closed=False)
negative_2 = Negative(Value=division_12)
offset_curve_3 = OffsetCurve(
    Curve=extend_curve_2,
    Distance=[Slider(25, range=0..100), Slider(25, range=0..100, expression="-x")],
    Plane=xy_plane_4,
    Corners=1)
circle_2 = Circle(Plane=move_6.Geometry, Radius=multiplication_15)
shift_paths_2 = ShiftPaths(Data=offset_curve_3, Offset=-1)
region_union_2 = RegionUnion(Curves=circle_2)
offset_curve_4 = OffsetCurve(Curve=polyline_4, Distance=[division_12, negative_2], Plane=xy_plane_4, Corners=1)
boundary_surfaces_5 = BoundarySurfaces(Edges=region_union_2)
loft_3 = Loft(Curves=shift_paths_2, Options={Adjust=False, Closed=False, LoftEnds=0, LoftSimp=0, LoftType=0, Rebuild=10, Refit=0.01})
trim_with_regions_3 = TrimWithRegions(Curve=offset_curve_4, Regions=flatten(boundary_surfaces_5))  # -> Inside, Outside
trim_with_regions_4 = TrimWithRegions(Curve=trim_with_regions_3.Outside, Regions=flatten(loft_3))  # -> Inside, Outside
curve_4 = Curve(trim_with_regions_4.Outside)
flip_matrix_6 = FlipMatrix(Data=curve_4)
loft_4 = Loft(Curves=flip_matrix_6, Options={Adjust=False, Closed=False, LoftEnds=0, LoftSimp=0, LoftType=0, Rebuild=10, Refit=0.01})
length_2 = Length(Curve=flip_matrix_6)  # -> flatten(Length)
brep_edges_2 = BrepEdges(Brep=loft_4)  # -> Naked, Interior, NonManifold
max_min_2 = MaxMin(Numbers=length_2)  # -> Max, MaxIndex, Min, MinIndex
join_curves_2 = JoinCurves(Curves=brep_edges_2.Naked, Preserve=False)
number_slider_4 = Slider(100, range=0..100)
subtraction_7 = Subtraction(A=max_min_2.Min, B=filter_4)
fillet_2 = Fillet(Curve=join_curves_2, Radius=division_12)
unit_z_6 = UnitZ(Factor=expr("-x", number_slider_4))
unit_z_7 = UnitZ(Factor=number_slider_4)
boundary_surfaces_6 = BoundarySurfaces(Edges=fillet_2)
extrude_7 = Extrude(Base=boundary_surfaces_6, Direction=[unit_z_7, unit_z_6])
solid_difference_3 = SolidDifference(BrepsA=box_2, BrepsB=flatten(extrude_7))

yz_plane_2 = YZPlane(Origin=Point(0, 0, 0))
orient_3 = Orient(Geometry=curve_3, Source=PlaneXY(0, 0, 0), Target=yz_plane_2)  # -> Geometry, Transform
unit_x_5 = UnitX(Factor=槽长_2)
division_13 = Division(A=槽长_2, B=2)
extrude_8 = Extrude(Base=orient_3.Geometry, Direction=unit_x_5)
unit_x_6 = UnitX(Factor=division_13)
move_9 = Move(Geometry=extrude_8, Motion=expr("-x", unit_x_6))  # -> Geometry, Transform
cap_holes_2 = CapHoles(Brep=move_9.Geometry)

最短槽长_2 = Panel(subtraction_7)
divide_curve_2 = DivideCurve(Curve=orient_3.Geometry, Count=Slider(50, range=0..100), Kinks=False)  # -> Points, Tangents, Parameters
convex_hull_2 = ConvexHull(Points=divide_curve_2.Points, Plane=yz_plane_2)  # -> Hull, HullZ, Indices
boundary_surfaces_7 = BoundarySurfaces(Edges=convex_hull_2.Hull)
stream_filter = StreamFilter(Gate=value_list_2, Stream0=extr, Stream1=extrude_6)
extrude_9 = Extrude(Base=boundary_surfaces_7, Direction=unit_x_4)
extrude_10 = Extrude(Base=boundary_surfaces_7, Direction=unit_x_5)
move_10 = Move(Geometry=extrude_9, Motion=expr("-x", division_10))  # -> Geometry, Transform
move_11 = Move(Geometry=extrude_10, Motion=expr("-x", unit_x_6))  # -> Geometry, Transform
solid_difference_4 = SolidDifference(BrepsA=move_11.Geometry, BrepsB=move_10.Geometry)
cap = CapHoles(Brep=[cyl, stream_filter])
merge_2 = Merge(Data1=cap, Data2=solid_difference_3, Data3=cap_holes_2, Data4=solid_difference_4)
flatten_2 = FlattenTree(Tree=merge_2, Path="{0}")

move_12 = Move(Geometry=flatten_2, Motion=Z_2)  # -> Geometry, Transform
centre_point_2 = Point(deconstruct_plane_2.Origin)
