# Grasshopper definition simplifyStructurePlusTags.gh (Grasshopper 1.0.7)
# plug-ins: Wombat, EleFront

# ----
# 1.Input Data
# 1.1筛选结构线
# F2结构线
crv = Curve([<curve referenced from the Rhino model> x404])

# ----
# F1建筑线
crv_2 = Curve(<curve referenced from the Rhino model>)

# ----
# F2建筑线
crv_3 = Curve(<curve referenced from the Rhino model>)

# ----
# F1建筑线Offset
number_slider = Slider(600, range=0..1000)

# ----
# offset
# Text Reference Curve-Inside
number_slider_2 = Slider(3457, range=0..5000)

# ----
# 1.Input Data
# 1.2.筛选Text Tag
# Input Text Layer
panel = Panel("""T2-PLAN-F2$0$次梁编号
T2-PLAN-F2$0$框梁编号""")

# ----
# offset
number_slider_3 = Slider(4000, range=0..10000)

reflay = ReferenceByLayer(LayerName=panel)  # -> flatten(Geometry)
detext = DeconstructText(TextObject=reflay)  # -> Text, Plane, Height, Justification
tsort = SortText(Keys=detext.Text, Culture=127)  # -> Keys, Values
c_script = CSharpScript(text=tsort.Keys)  # -> out, eachName; inputs text: list of String
# ---------- c_script: C# ----------
    bool startSearch = false;

    List<string> textToSave = new List<string>();
    textToSave.Add(text[0]);

    for (int i = 0; i < text.Count - 1;i++){
      foreach(string t in textToSave){
        if(t == text[i]){
          startSearch = false;
        }
        else{
          startSearch = true;
        }
      }

      if(startSearch){
        textToSave.Add(text[i]);

      }
    }

    eachName = textToSave;
# ---------- end c_script ----------
tmatch = MatchText(Text=detext.Text, Pattern=graft(c_script.eachName), Case=True)
dispatch = Dispatch(List=reflay, DispatchPattern=tmatch)  # -> ListA, ListB
project = Project(Geometry=dispatch.ListA, Plane=PlaneXY(0, 0, 0))  # -> Geometry, Transform
data = Data(project.Geometry)
detext_2 = DeconstructText(TextObject=data)  # -> Text, Plane, Height, Justification
pt = Point(detext_2.Plane)
data_2 = Data(c_script.eachName)
panel_2 = Panel(data_2)
concat = Concatenate(FragmentA="Text::", FragmentB=data_2)
panel_3 = Panel(concat)

# ----
# All Text locations
# Text Reference Curve-Inside
pt_2 = Point(detext.Plane)

offset = OffsetCurve(Curve=crv_2, Distance=expr("-x", Slider(800, range=0..10000)), Corners=1)
offset_2 = OffsetCurve(Curve=crv_2, Distance=number_slider, Corners=1)
project_2 = Project(Geometry=crv_3, Plane=PlaneXY(0, 0, 0))  # -> Geometry, Transform
project_3 = Project(Geometry=offset, Plane=PlaneXY(0, 0, 0))  # -> Geometry, Transform
project_4 = Project(Geometry=offset_2, Plane=PlaneXY(0, 0, 0))  # -> Geometry, Transform
close = CloseCurve(Curve=project_2.Geometry, Tolerance=0)
close_2 = CloseCurve(Curve=project_4.Geometry, Tolerance=0)
close_3 = CloseCurve(Curve=project_3.Geometry, Tolerance=0)
boundary = BoundarySurfaces(Edges=close)
boundary_2 = BoundarySurfaces(Edges=close_3)
sdiff = SolidDifference(BrepsA=boundary, BrepsB=boundary_2)
boundary_3 = BoundarySurfaces(Edges=[close_2, close_3])
swatch = ColourSwatch(SwatchColor=RGB(38, 38, 38))
layer = DefineLayer(Name="CleanStructureCurve", Color=swatch)
attributes = DefineObjectAttributes(Layer=layer, Color=swatch)

area = Area(Geometry=sdiff)  # -> Area, Centroid
reb = RebuildCurve(Curve=close_3, Count=Slider(200, range=0..1000), Tangents=False)
incurve = PointInCurve(Point=area.Centroid, Curve=reb)  # -> Relationship, Point
equals = Equality(FirstNumber=incurve.Relationship, SecondNumber="0")  # -> Equality, Inequality
dispatch_2 = Dispatch(List=sdiff, DispatchPattern=equals.Equality)  # -> ListA, ListB
srf = Surface(dispatch_2.ListA)

reb_2 = RebuildCurve(Curve=offset, Count=Slider(50, range=0..100), Tangents=False)
project_5 = Project(Geometry=reb_2, Plane=PlaneXY(0, 0, 0))  # -> Geometry, Transform
offset_3 = OffsetCurve(Curve=project_5.Geometry, Distance=expr("-x", number_slider_2), Corners=1)
incurve_2 = PointInCurve(Point=pt, Curve=offset_3)  # -> Relationship, Point
equals_2 = Equality(FirstNumber=incurve_2.Relationship, SecondNumber="0")  # -> Equality, Inequality
dispatch_3 = Dispatch(List=data, DispatchPattern=equals_2.Equality)  # -> ListA, ListB
data_3 = Data(dispatch_3.ListA)
detext_3 = DeconstructText(TextObject=data_3)  # -> simplify(Text), simplify(Plane), Height, Justification
reb_3 = RebuildCurve(Curve=close, Count=Slider(30, range=0..100), Tangents=False)
offset_4 = OffsetCurve(Curve=reb_3, Distance=number_slider_3, Corners=1)
incurve_3 = PointInCurve(Point=detext_3.Plane, Curve=offset_4)  # -> Relationship, Point
equals_3 = Equality(FirstNumber=incurve_3.Relationship, SecondNumber="0")  # -> Equality, Inequality
dispatch_4 = Dispatch(List=data_3, DispatchPattern=equals_3.Inequality)  # -> ListA, ListB
detext_4 = DeconstructText(TextObject=dispatch_4.ListA)  # -> simplify(Text), simplify(Plane), Height, Justification
tstat = TreeStatistics(Tree=detext_4.Text)  # -> Paths, Length, Count
text = DefineTextObject(Text=detext_4.Text, Plane=detext_4.Plane, DimensionStyle="图例2-地上$0$XD100$0", OutputType="Text")
series = Series(Start="1", Step=1, Count=tstat.Count)
gradient = Gradient(
    LowerLimit="1",
    UpperLimit=tstat.Count,
    Parameter=series,
    stops=[0: RGB(243, 57, 0), 0.1: RGB(236, 27, 60), 0.2: RGB(210, 0, 118), 0.3: RGB(103, 0, 120), 0.4: RGB(39, 72, 161), 0.5: RGB(1, 192, 229), 0.6: RGB(18, 178, 90), 0.7: RGB(79, 186, 8), 0.8: RGB(220, 237, 32), 0.9: RGB(247, 159, 20), 1: RGB(243, 57, 0)])
layer_2 = DefineLayer(Name=concat, Color=flatten(gradient))  # -> graft(Layer)
attributes_2 = DefineObjectAttributes(Layer=layer_2)  # -> simplify(Attributes)
panel_4 = Panel(gradient)

# ----
# curve used
crv_4 = Curve(offset_3)

# ----
# curve used
crv_5 = Curve(offset_4)

merge = Merge(Data1=srf, Data2=boundary_3)  # -> flatten(Result)
scx = SurfaceCurve(Surface=graft(merge), Curve=graft(crv))  # -> Curves, Points, UVPoints, Normals, Parameters, Tangents
null = NullItem(Item=scx.Curves)  # -> NullFlags, simplify(InvalidFlags), Description
dispatch_5 = Dispatch(List=simplify(graft(crv)), DispatchPattern=null.InvalidFlags)  # -> ListA, ListB
crv_6 = Curve(dispatch_5.ListB)

# ----
# 2.Bake Data
# Bake Structure Lines
panel_5 = Panel("CleanStructureCurve")
bake = BakeObjects(Geometry=crv_6, Attributes=attributes, BakeName=panel_5, Bake=False)

# ----
# Bake Tags
panel_6 = Panel("text")
bake_2 = BakeObjects(Geometry=text, Attributes=attributes_2, BakeName=panel_6, Bake=False)
